# Grasshopper definition 161201_CityMatrix_Mini_for_Waleed_Kent.gh (Grasshopper 0.9.76)
# plug-ins: Firefly.X, HDTReference

path = FilePath("\\vmware-host\Shared Folders\RYAN\Dropbox (MIT)\01_Work\MAS\05_Summer 2016\CityMatrix Mini\_for Waleed\Data\Dynamic Data for Kent_02_ID.txt")
path_2 = FilePath("\\vmware-host\Shared Folders\RYAN\Dropbox (MIT)\01_Work\MAS\05_Summer 2016\CityMatrix Mini\_for Waleed\Data\Dynamic Data for Kent_01_ID.txt")
path_3 = FilePath("\\vmware-host\Shared Folders\RYAN\Dropbox (MIT)\01_Work\MAS\05_Summer 2016\CityMatrix Mini\_for Waleed\Data\Dynamic Data for Kent_03_ID.txt")
path_4 = FilePath("\\vmware-host\Shared Folders\RYAN\Dropbox (MIT)\01_Work\MAS\05_Summer 2016\CityMatrix Mini\_for Waleed\Data\Dynamic Data for Kent_03BK_ID.txt")
panel = Panel(path)
panel_2 = Panel(path_2)
panel_3 = Panel(path_3)
panel_4 = Panel(path_4)

# ---- group: reading txt
file = ReadFile(File=panel_3, PerLineParse=True)

# ----
txt = Text(file)

# ---- group: data
txt_2 = Text(txt)

# ----
panel_5 = Panel(txt_2)
split = TextSplit(Text=txt_2, Separators=",")
pshift = ShiftPaths(Data=split, Offset=1)
pshift_2 = ShiftPaths(Data=pshift, Offset=-1)

# ---- group: all data - dynamic from text file
int = Integer(pshift_2)

# ----
panel_6 = Panel(int)

# ---- group: dockRotation
int_2 = Integer()

# ---- group: dockID
int_3 = Integer()

# ---- group: slider1
num = Number()

# ---- group: toggle1
bool = Boolean()

# ---- group: toggle2
bool_2 = Boolean()

bool_3 = Boolean()

# ----
path_5 = FilePath("\\vmware-host\Shared Folders\RYAN\Dropbox (MIT)\01_Work\MAS\05_Summer 2016\CityMatrix Mini\_for Waleed\Data\Waleed_Exist Data_01_ID.txt")

# ---- group: shrink
cell_shrink = Slider(0.98, range=0.75..1)

cell_shrink_2 = Slider(0.905, range=0.75..1)  # disabled

# ---- group: module meshes lego ref: -1
mesh = Mesh(<mesh referenced from the Rhino model>)

# ---- group: module meshes lego ref: Commercial
mesh_2 = Mesh(<mesh referenced from the Rhino model>)

# ----
number_slider = Slider(16, range=0..100)

# ---- group: gridExtent_x
int_4 = Integer(number_slider)

int_5 = Integer(int_4)

# ---- group: module meshes lego ref: 0 to 7
mesh_3 = Mesh([<mesh referenced from the Rhino model> x8])

# ---- group: module meshes lego ref: -1
mesh_4 = Mesh(<mesh referenced from the Rhino model>)  # disabled

# ---- group: gridExtent_y
int_6 = Integer(number_slider)

int_7 = Integer(int_6)

# ---- group: module meshes lego ref: 0 to 7
mesh_5 = Mesh([<mesh referenced from the Rhino model> x8])  # disabled

# ---- group: colortizer orgin
# CityMatrix Mini Lego Simulator
pt = Point(<point referenced from the Rhino model>)  # disabled

# ---- group: table size ref pt
pt_2 = Point(<point referenced from the Rhino model>)  # disabled

# ---- group: colortizer orgin
# LEGO Grid System
pt_3 = Point(<point referenced from the Rhino model>)

# ---- group: gridExtent_x
int_8 = Integer(int_4)  # disabled

# ---- group: table size ref pt
pt_4 = Point(<point referenced from the Rhino model>)

# ---- group: gridExtent_y
int_9 = Integer(int_6)  # disabled

# ---- group: Building Heigt Slider
_0_r = Slider(14, range=1..25)
_1_r = Slider(17, range=1..25)
_3_o = Slider(7, range=1..25)
_4_ps = Slider(7, range=1..25)
_7_edu = Slider(7, range=1..25)
_2_r = Slider(20, range=1..25)

# ----
# CityMatrix Mini
# 
# "Ryan" Yan Zhang <ryanz@mit.edu>
# MIT Media Lab, Changing Place Group
# Augest. 2016
# Parsing Test Dynamic ID Data
panel_7 = Panel("C:\Users\RYAN\Dropbox (MIT)\01_Work\MAS\05_Summer 2016\CityMatrix Mini\_for Waleed\Data\Dynamic Data_Test_01.txt")
path_6 = FilePath("\\vmware-host\Shared Folders\RYAN\Dropbox (MIT)\01_Work\MAS\05_Summer 2016\CityMatrix Mini\_for Waleed\Data\Waleed_Exist Data_02_Commercial.txt")
# Parsing Exist ID Data
# C:\Users\RYAN\Dropbox (MIT)\01_Work\MAS\05_Summer 2016\CityMatrix Mini\_for Waleed\Data\Waleed_Exist Data_01_ID.txt
panel_8 = Panel(path_5)

# ---- group: 3D building site move amount
# 3D City Grid System
panel_9 = Panel("10000")
X = UnitX(Factor=panel_9)

# ----
# Parsing Exist Commercial Data
# C:\Users\RYAN\Dropbox (MIT)\01_Work\MAS\05_Summer 2016\CityMatrix Mini\_for Waleed\Data\Waleed_Exist Data_02_Commercial.txt
panel_10 = Panel(path_6)
xy = XYPlane(Origin=pt)  # disabled
dist = Distance(PointA=pt, PointB=pt_2)  # disabled
xy_2 = XYPlane(Origin=pt_3)
dist_2 = Distance(PointA=pt_3, PointB=pt_4)
com = ColourSwatch(SwatchColor=RGB(158, 158, 158))
com_2 = ColourSwatch(SwatchColor=RGB(71, 71, 71))
res = ColourSwatch(SwatchColor=RGB(212, 212, 212))
res_2 = ColourSwatch(SwatchColor=RGB(76, 76, 76))

# ---- group: blank
mesh_6 = Mesh()

# ----
division = Division(A=dist, B=int_8)  # disabled
movetoorgin = MoveToOrgin(G=mesh_5, num=cell_shrink_2)  # disabled
movetoorgin_2 = MoveToOrgin(G=mesh_4, num=cell_shrink_2)  # disabled
division_2 = Division(A=dist_2, B=int_4)
vec = Vector(X)

# ---- group: base cplane
pln = Plane(xy)  # disabled

pln_2 = Plane(xy_2)

# ----
int_10 = Integer(_7_edu)
int_11 = Integer(_4_ps)
int_12 = Integer(_2_r)
int_13 = Integer(_3_o)
int_14 = Integer(_1_r)
int_15 = Integer(_0_r)
merge = Merge(Data1=res, Data2=res, Data3=res, Data4=com, Data5=com, Data6=com)
merge_2 = Merge(Data1=res_2, Data2=res_2, Data3=res_2, Data4=com_2, Data5=com_2, Data6=com_2)

# ---- group: cell size
num_2 = Number(division)  # disabled

# ----
modulecenter = ModuleCenter(pt=pt, num=num_2, int_2=int_8, int=int_9)  # -> pt_5, transform_2; disabled
merge_3 = Merge(Data1=int_15, Data2=int_14, Data3=int_12, Data4=int_13, Data5=int_11, Data6=int_10)

# ---- group: cell size
num_3 = Number(division_2)

# ----
movetoorgin_3 = MoveToOrgin(G=mesh_2, num=cell_shrink)
movetoorgin_4 = MoveToOrgin(G=mesh_3, num=cell_shrink)
movetoorgin_5 = MoveToOrgin(G=mesh, num=cell_shrink)

# ---- group: all fl #s
txt_3 = Text([int_15, int_14, int_12, int_13, int_11, int_10])

# ---- group: reading txt
file_2 = ReadFile(File=panel_7, PerLineParse=True)

# ----
merge_4 = Merge(Data1=merge, Data2=merge_2)

# ---- group: reading txt
file_3 = ReadFile(File=panel_8, PerLineParse=True)

# ---- group: cell size
num_4 = Number(division_2)

# ---- group: Cell Center
pt_5 = Point(modulecenter.pt_5)  # disabled

# ---- group: color for each type
col = Colour(merge_4)

# ---- group: reading txt
file_4 = ReadFile(File=panel_10, PerLineParse=True)

# ---- group: floor num for each type
int_16 = Integer(merge_3)

# ---- group: floor height
panel_11 = Panel("3.5")

# ----
txt_4 = Text(file_2)
division_3 = Division(A=num_4, B=2)

# ---- group: module meshes lego at orgin
mesh_7 = Mesh(movetoorgin_2)  # disabled

mesh_8 = Mesh(movetoorgin)  # disabled

# ----
multiplication = Multiplication(A=int_16, B=panel_11)

# ---- group: module meshes lego at orgin
mesh_9 = Mesh(movetoorgin_5)

# ----
txt_5 = Text(file_3)

# ---- group: module meshes lego at orgin
mesh_10 = Mesh(movetoorgin_4)

# ---- group: data
txt_6 = Text(txt_4)

# ----
panel_12 = Panel(txt_6)

# ---- group: module meshes lego at orgin
mesh_11 = Mesh(movetoorgin_3)

# ---- group: base height
panel_13 = Panel("5.0")

# ----
move = Move(Geometry=mesh_6, Motion=vec)  # -> Geometry, Transform
multiplication_2 = Multiplication(A=division_3, B=Slider(0.95, range=0..1))
txt_7 = Text(file_4)

# ---- group: data
txt_8 = Text(txt_5)

# ----
panel_14 = Panel(txt_8)
neg = Negative(Value=multiplication_2)

# ---- group: building height for each type
num_5 = Number(multiplication)

# ----
panel_15 = Panel("0")  # disabled
panel_16 = Panel("7")  # disabled
split_2 = TextSplit(Text=txt_6, Separators=",")
dom = ConstructDomain(DomainStart=neg, DomainEnd=multiplication_2)

# ---- group: data
txt_9 = Text(txt_7)

# ----
panel_17 = Panel(txt_9)
panel_18 = Panel(num_5)
split_3 = TextSplit(Text=txt_8, Separators=",")
pshift_3 = ShiftPaths(Data=split_2, Offset=1)
split_4 = TextSplit(Text=txt_9, Separators=",")

# ---- group: mesh coloring
color04 = ColourSwatch(SwatchColor=RGB(255, 255, 0))  # disabled
mesh_12 = Mesh([<mesh referenced from the Rhino model> x2])  # disabled
color01 = ColourSwatch(SwatchColor=RGB(255, 255, 255))  # disabled
color02 = ColourSwatch(SwatchColor=RGB(0, 0, 0))  # disabled
color03 = ColourSwatch(SwatchColor=RGB(255, 0, 0))  # disabled
color05 = ColourSwatch(SwatchColor=RGB(0, 102, 255))  # disabled
color06 = ColourSwatch(SwatchColor=RGB(3, 201, 0))  # disabled
text = ColourSwatch(SwatchColor=RGB(71, 71, 71))  # disabled
mcol = MeshColours(Mesh=mesh_12, Colours=text)  # disabled
mesh_13 = Mesh(mcol)  # disabled

# ----
P = ColourSwatch(SwatchColor=RGB(128, 128, 128))

# ---- group: mesh coloring
text_2 = ColourSwatch(SwatchColor=RGB(0, 0, 0))
C = ColourSwatch(SwatchColor=RGB(255, 0, 255))
blank = ColourSwatch(SwatchColor=RGB(230, 230, 230))
mesh_14 = Mesh(<mesh referenced from the Rhino model>)
R = ColourSwatch(SwatchColor=RGB(255, 255, 128))
O = ColourSwatch(SwatchColor=RGB(255, 128, 128))
ps = ColourSwatch(SwatchColor=RGB(128, 212, 255))
os = ColourSwatch(SwatchColor=RGB(184, 230, 92))
P_2 = ColourSwatch(SwatchColor=RGB(89, 89, 89))
edu = ColourSwatch(SwatchColor=RGB(128, 170, 255))
mcol_2 = MeshColours(Mesh=mesh_14, Colours=P)
mesh_15 = Mesh(mcol_2)

# ---- group: saved dynamic data - proposed
int_17 = Integer([-1, -1, -1, -1, -1, -1, -1, -1, -1, -1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])

# ----
panel_19 = Panel("0")  # disabled
pshift_4 = ShiftPaths(Data=split_3, Offset=1)
pshift_5 = ShiftPaths(Data=split_4, Offset=1)
pshift_6 = ShiftPaths(Data=pshift_3, Offset=-1)
pshift_7 = ShiftPaths(Data=pshift_4, Offset=-1)

# ---- group: building height factor
number_slider_2 = Slider(1.8, range=0..10)

# ---- group: all data
int_18 = Integer(pshift_5)

# ----
panel_20 = Panel(int_18)

# ---- group: dynamic data from file
int_19 = Integer(pshift_6)

# ----
pshift_8 = ShiftPaths(Data=int_18, Offset=-1)

# ---- group: all data
int_20 = Integer(pshift_7)

# ----
panel_21 = Panel(int_20)
equals = Equality(FirstNumber=int_20, SecondNumber=Slider(9, range=0..10))  # -> Equality, Inequality

# ---- group: saved dynamic data - improve 02 Commercial and Housing Diversity
int_21 = Integer([-1, -1, -1, -1, -1, -1, -1, -1, -1, -1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])

# ---- group: all dynamic data
int_22 = Integer(int)

# ----
panel_22 = Panel(int_22)

# ---- group: is dynamic
bool_4 = Boolean(equals.Equality)

# ----
multiplication_3 = Multiplication(A=Slider(20, range=0..100), B=bool_4)
Z = UnitZ(Factor=multiplication_3)

# ---- group: is commercial in existing
bool_5 = Boolean(pshift_8)

# ---- group: blank
mesh_16 = Mesh(move.Geometry)

# ---- group: saved dynamic data - improve 03 Green Space
int_23 = Integer([-1, -1, -1, -1, -1, -1, -1, -1, -1, -1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])

# ----
# Commercial Slider
# Commercial Combined
commercial_slider = Slider(0.7, range=0..1)

# ---- group: 2nd round final
# Combined ID Data
int_24 = Integer([-1, -1, 0, -1, -1, -1, -1, -1, -1, -1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])

# ----
p_n_c = PickNChoose(Pattern=bool_4, Stream0=int_20, Stream1=int_22)

# ---- group: IDs that is building
panel_23 = Panel("0")
panel_24 = Panel("1")
panel_25 = Panel("2")
panel_26 = Panel("3")
panel_27 = Panel("4")
# Base Data
panel_28 = Panel("7")

# ----
merge_5 = Merge(Data1=panel_23, Data2=panel_24, Data3=panel_25, Data4=panel_26, Data5=panel_27, Data6=panel_28)
repeat = RepeatData(Data=Slider(0, range=0..360), Length=256)
int_25 = Integer(merge_5)

# ---- group: slider in CV
num_6 = Number()

# ---- group: x
int_26 = Integer([0, 1, 2, 3, 4, 5, 6, 7, 8, 9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])

int_27 = Integer(int_26)

int_28 = Integer(int_26)

# ---- group: slider in GH
num_7 = Number(commercial_slider)

# ---- group: y
int_29 = Integer([0, 0, 0, 0, 0, 0, 0, 0, 0, 0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])

int_30 = Integer(int_29)

int_31 = Integer(int_29)

# ----
modulecenter_2 = ModuleCenter(pt=pt_3, num=num_3, int_2=int_28, int=int_31)  # -> pt_5, transform_2

# ---- group: module center
pt_6 = Point(modulecenter_2.pt_5)

# ----
move_2 = Move(Geometry=pt_6, Motion=Z)  # -> Geometry, Transform

# ---- group: module center dynamic area lifted
pt_7 = Point(move_2.Geometry)

# ---- group: module center
pt_8 = Point(pt_7)

# ---- group: rotation
int_32 = Integer(repeat)

int_33 = Integer(int_32)

int_34 = Integer(int_32)

int_35 = Integer(int_34)

# ----
panel_29 = Panel(int_26)
panel_30 = Panel(int_29)
panel_31 = Panel(int_32)

# ---- group: combined ID data
int_36 = Integer(p_n_c)

int_37 = Integer(int_36)

# ----
mindex = MemberIndex(Set=graft(int_37), Member=int_25)  # -> Index, Count

# ---- group: module id
int_38 = Integer(int_36)

int_39 = Integer(int_38)

int_40 = Integer(int_38)

int_41 = Integer(int_40)

# ----
larger = LargerThan(FirstNumber=int_39, SecondNumber="0")  # -> LargerThan, OrEqualTo
smaller = SmallerThan(FirstNumber=int_39, SecondNumber="5")  # -> SmallerThan, OrEqualTo
and = GateAnd(A=larger.OrEqualTo, B=smaller.OrEqualTo)

# ---- group: is building or not
bool_6 = Boolean(and)

# ----
dispatch = Dispatch(List=pt_8, DispatchPattern=bool_6)  # -> ListA, ListB
dispatch_2 = Dispatch(List=int_39, DispatchPattern=bool_6)  # -> ListA, ListB

# ---- group: building center
pt_9 = Point(dispatch.ListA)

# ---- group: building id
int_42 = Integer(dispatch_2.ListA)

# ----
larger_2 = LargerThan(FirstNumber=int_40, SecondNumber="0")  # -> LargerThan, OrEqualTo
smaller_2 = SmallerThan(FirstNumber=int_40, SecondNumber="7")  # -> SmallerThan, OrEqualTo
larger_3 = LargerThan(FirstNumber=int_41, SecondNumber=panel_15)  # -> LargerThan, OrEqualTo; disabled
smaller_3 = SmallerThan(FirstNumber=int_41, SecondNumber=panel_16)  # -> SmallerThan, OrEqualTo; disabled
and_2 = GateAnd(A=larger_3.OrEqualTo, B=smaller_3.OrEqualTo)  # disabled
and_3 = GateAnd(A=larger_2.OrEqualTo, B=smaller_2.OrEqualTo)
item = ListItem(List=panel_18, Index=graft(int_42), Wrap=False)
dispatch_3 = Dispatch(List=int_41, DispatchPattern=and_2)  # -> ListA, ListB; disabled
dispatch_4 = Dispatch(List=int_40, DispatchPattern=and_3)  # -> ListA, ListB
smaller_4 = SmallerThan(FirstNumber=int_40, SecondNumber="0")  # -> SmallerThan, OrEqualTo
smaller_5 = SmallerThan(FirstNumber=int_41, SecondNumber=panel_19)  # -> SmallerThan, OrEqualTo; disabled
pshift_9 = ShiftPaths(Data=item, Offset=-1)
item_2 = ListItem(List=mesh_10, Index=graft(dispatch_4.ListA), Wrap=False)
item_3 = ListItem(List=mesh_8, Index=graft(dispatch_3.ListA), Wrap=False)  # disabled
dispatch_5 = Dispatch(List=pt_7, DispatchPattern=smaller_4.SmallerThan)  # -> ListA, ListB
dispatch_6 = Dispatch(List=pt_5, DispatchPattern=smaller_5.SmallerThan)  # -> ListA, ListB; disabled
multiplication_4 = Multiplication(A=pshift_9, B=number_slider_2)
pshift_10 = ShiftPaths(Data=item_2, Offset=-1)
pshift_11 = ShiftPaths(Data=item_3, Offset=-1)  # disabled

# ---- group: building height of each building
num_8 = Number(multiplication_4)

# ----
addition = Addition(A=num_8, B=panel_13)
dom_2 = ConstructDomain(DomainStart=0, DomainEnd=addition)
box = DomainBox(Base=pt_9, X=dom, Y=dom, Z=dom_2)
move_3 = Move(Geometry=box, Motion=vec)  # -> Geometry, Transform
dispatch_7 = Dispatch(List=int_34, DispatchPattern=and_3)  # -> ListA, ListB
dispatch_8 = Dispatch(List=int_35, DispatchPattern=and_2)  # -> ListA, ListB; disabled

# ---- group: building geo
box_2 = Box(move_3.Geometry)

# ----
vec2pt = Vector2Pt(PointA=Point(0, 0, 0), PointB=dispatch_5.ListA, Unitize=False)  # -> Vector, Length
vec2pt_2 = Vector2Pt(PointA=Point(0, 0, 0), PointB=dispatch_6.ListA, Unitize=False)  # -> Vector, Length; disabled
rotate = Rotate(Geometry=pshift_10, Angle=degrees(dispatch_7.ListA), Plane=PlaneXY(0, 0, 0))  # -> Geometry, Transform
rotate_2 = Rotate(Geometry=pshift_11, Angle=degrees(dispatch_8.ListA), Plane=PlaneXY(0, 0, 0))  # -> Geometry, Transform; disabled
dispatch_9 = Dispatch(List=pt_7, DispatchPattern=and_3)  # -> ListA, ListB
dispatch_10 = Dispatch(List=pt_5, DispatchPattern=and_2)  # -> ListA, ListB; disabled
move_4 = Move(Geometry=mesh_9, Motion=vec2pt.Vector)  # -> Geometry, Transform
vec2pt_3 = Vector2Pt(PointA=Point(0, 0, 0), PointB=dispatch_9.ListA, Unitize=False)  # -> Vector, Length
vec2pt_4 = Vector2Pt(PointA=Point(0, 0, 0), PointB=dispatch_10.ListA, Unitize=False)  # -> Vector, Length; disabled
move_5 = Move(Geometry=rotate.Geometry, Motion=vec2pt_3.Vector)  # -> Geometry, Transform
move_6 = Move(Geometry=rotate_2.Geometry, Motion=vec2pt_4.Vector)  # -> Geometry, Transform; disabled
move_7 = Move(Geometry=mesh_7, Motion=vec2pt_2.Vector)  # -> Geometry, Transform; disabled

# ---- group: all 0 to 7 instantiated
mesh_17 = Mesh(move_6.Geometry)  # disabled

# ---- group: all -1 instantiated
mesh_18 = Mesh(move_7.Geometry)  # disabled

# ---- group: building lego modules
mesh_19 = Mesh(move_5.Geometry)

# ---- group: blank
mesh_20 = Mesh(move_4.Geometry)

# ----
panel_32 = Panel(int_36)
ma = MassAddition(Input=mindex.Count)  # -> Result, PartialResults
panel_33 = Panel(int_38)
pshift_12 = ShiftPaths(Data=ma.Result, Offset=-1)

# ---- group: Commercial % in Dynamic Part
num_9 = Number(num_7)

# ---- group: is building
bool_7 = Boolean(pshift_12)

# ---- group: is dynamic
bool_8 = Boolean(bool_4)

# ----
lng = ListLength(List=bool_8)
random = Random(Range=Domain(0, 1), Number=lng, Seed=Slider(67, range=0..100))
smaller_6 = SmallerThan(FirstNumber=random, SecondNumber=num_9)  # -> SmallerThan, OrEqualTo
and_4 = GateAnd(A=bool_7, B=bool_8)
# Human Interation @ Lego - Outside
dispatch_11 = Dispatch(List=int_40, DispatchPattern=and_3)  # -> ListA, ListB; disabled

# ---- group: rnd true by percentage
bool_9 = Boolean(smaller_6.OrEqualTo)

# ---- group: is dynamic building
bool_10 = Boolean(and_4)

# ---- group: floor num for each type
# Dashboard
# Calculation
int_43 = Integer(merge_3)

# ---- group: all dynamic data
int_44 = Integer(int_22)

# ----
panel_34 = Panel("0")  # disabled
panel_36 = Panel("6")  # disabled
panel_38 = Panel("12")  # disabled
panel_40 = Panel("36")  # disabled
panel_45 = Panel("9")  # disabled
panel_47 = Panel("18")  # disabled
panel_49 = Panel("48")  # disabled

# ---- group: RL
num_10 = Number()  # disabled

# ---- group: module id
int_45 = Integer(int_36)

# ---- group: module center
pt_10 = Point(pt_6)

# ---- group: filted id
int_46 = Integer(dispatch_11.ListA)  # disabled

# ---- group: module center
pt_11 = Point(modulecenter_2.pt_5)

# ----
# Activation Mask
# On LEGOs
srf = Surface(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)

# ---- group: module id
int_47 = Integer(int_38)

# ---- group: dockID
int_48 = Integer()

# ----
equals_2 = Equality(FirstNumber=int_42, SecondNumber=int_48)  # -> Equality, Inequality
multiplication_5 = Multiplication(A=equals_2.Inequality, B=6)
addition_2 = Addition(A=int_42, B=multiplication_5)
and_5 = GateAnd(A=bool_10, B=bool_9)

# ---- group: RM
num_11 = Number()  # disabled

# ---- group: is commercial in existing
bool_11 = Boolean(bool_5)

# ----
mesh_21 = Mesh(srf)
equals_3 = Equality(FirstNumber=int_48, SecondNumber="-1")  # -> Equality, Inequality
filter = StreamFilter(Gate=equals_3.Equality, Stream0=addition_2, Stream1=int_42)
item_4 = ListItem(List=col, Index=graft(filter), Wrap=False)
pshift_13 = ShiftPaths(Data=item_4, Offset=-1)

# ---- group: color for each building
col_2 = Colour(pshift_13)

# ---- group: 3D Buldings
preview = CustomPreview(Geometry=box_2, Shader=col_2)

# ----
equals_4 = Equality(FirstNumber=int_47, SecondNumber=int_48)  # -> Equality, Inequality
item_5 = ListItem(List=int_43, Index=1, Wrap=False)
item_6 = ListItem(List=int_43, Index=2, Wrap=False)
item_7 = ListItem(List=int_43, Index=0, Wrap=False)
item_8 = ListItem(List=int_43, Index=4, Wrap=False)
item_9 = ListItem(List=int_43, Index=5, Wrap=False)
item_10 = ListItem(List=int_43, Index=3, Wrap=False)

# ---- group: RS
num_12 = Number()  # disabled

# ----
item_11 = ListItem(List=txt_3, Index=graft(int_46), Wrap=True)  # disabled

# ---- group: is dynamic commercial
bool_12 = Boolean(and_5)

# ----
equals_5 = Equality(FirstNumber=int_44, SecondNumber="1")  # -> Equality, Inequality
equals_6 = Equality(FirstNumber=int_44, SecondNumber="0")  # -> Equality, Inequality
equals_7 = Equality(FirstNumber=int_44, SecondNumber="2")  # -> Equality, Inequality
equals_8 = Equality(FirstNumber=int_44, SecondNumber="3")  # -> Equality, Inequality
equals_9 = Equality(FirstNumber=int_44, SecondNumber="5")  # -> Equality, Inequality
Z_2 = UnitZ(Factor=Slider(6.2, range=0..10))
equals_10 = Equality(FirstNumber=int_44, SecondNumber="4")  # -> Equality, Inequality
equals_11 = Equality(FirstNumber=int_44, SecondNumber="6")  # -> Equality, Inequality
equals_12 = Equality(FirstNumber=int_44, SecondNumber="7")  # -> Equality, Inequality
or = GateOr(A=bool_12, B=bool_11)
equals_13 = Equality(FirstNumber=int_45, SecondNumber="5")  # -> Equality, Inequality

# ---- group: is dynamic building
bool_13 = Boolean(bool_10)

# ---- group: OL
num_13 = Number()  # disabled

# ---- group: 0_R$$$
int_49 = Integer(item_7)

# ---- group: 1_R$$
int_50 = Integer(item_5)

# ---- group: 2_R$
int_51 = Integer(item_6)

# ---- group: 4_PS
int_52 = Integer(item_8)

# ---- group: 7_EDU
int_53 = Integer(item_9)

# ---- group: 3_O
int_54 = Integer(item_10)

# ----
move_8 = Move(Geometry=mesh_21, Motion=Z_2)  # -> Geometry, Transform
pshift_14 = ShiftPaths(Data=item_11, Offset=-1)  # disabled
int_55 = Integer(equals_6.Equality)
int_56 = Integer(equals_5.Equality)
int_57 = Integer(equals_10.Equality)
int_58 = Integer(equals_7.Equality)
int_59 = Integer(equals_8.Equality)
int_60 = Integer(equals_9.Equality)
int_61 = Integer(equals_11.Equality)
int_62 = Integer(equals_12.Equality)

# ---- group: OM
num_14 = Number()  # disabled

# ---- group: is commercial
bool_14 = Boolean(or)

# ----
dispatch_12 = Dispatch(List=pt_7, DispatchPattern=bool_14)  # -> ListA, ListB
vec2pt_5 = Vector2Pt(PointA=Point(0, 0, 0), PointB=dispatch_12.ListA, Unitize=False)  # -> Vector, Length
move_9 = Move(Geometry=mesh_11, Motion=vec2pt_5.Vector)  # -> Geometry, Transform

# ---- group: building lego modules
mesh_22 = Mesh(move_9.Geometry)

# ---- group: mask settings
swatch = ColourSwatch(SwatchColor=RGB(0, 0, 0))
panel_52 = Panel(".35")
path_7 = FilePath("C:\Users\RYAN\Documents\GitHub\CityMatrix\Map\MAP_BLACK.png")

# ----
dispatch_13 = Dispatch(List=pt_11, DispatchPattern=equals_4.Inequality)  # -> ListA, ListB
panel_53 = Panel(int_52)
panel_54 = Panel(int_50)
panel_55 = Panel(int_49)
panel_56 = Panel(int_54)
panel_57 = Panel(int_53)
panel_58 = Panel(int_51)
dispatch_14 = Dispatch(List=pt_10, DispatchPattern=bool_13)  # -> ListA, ListB
dispatch_15 = Dispatch(List=pt_10, DispatchPattern=equals_13.Equality)  # -> ListA, ListB

# ---- group: flr #s
txt_10 = Text(pshift_14)  # disabled

# ---- group: OS
num_15 = Number()  # disabled

# ---- group: ppl per flr
# id5
# id3
# id4
# id0
# id2
# id1
# young
# mid
# old
panel_59 = Panel("0")  # disabled
panel_60 = Panel("0")  # disabled
panel_62 = Panel("0")  # disabled
panel_63 = Panel("7")  # disabled
panel_64 = Panel("0")  # disabled
panel_65 = Panel("8")  # disabled
panel_66 = Panel("0")  # disabled
panel_67 = Panel("0")  # disabled
panel_68 = Panel("0")  # disabled
panel_69 = Panel("0")  # disabled
panel_71 = Panel("0")  # disabled
panel_72 = Panel("10")  # disabled
panel_73 = Panel("0")  # disabled
panel_74 = Panel("11")  # disabled
panel_75 = Panel("0")  # disabled
panel_76 = Panel("0")  # disabled
num_16 = Number([panel_60, num_11, num_14, panel_66, panel_75, panel_69])  # disabled
num_17 = Number([num_10, panel_64, num_13, panel_67, panel_76, panel_73])  # disabled
num_18 = Number([panel_59, num_12, panel_62, num_15, panel_71, panel_68])  # disabled

# ----
ma_2 = MassAddition(Input=[int_55, int_56, int_59])  # -> Result, PartialResults
ma_3 = MassAddition(Input=int_56)  # -> Result, PartialResults
ma_4 = MassAddition(Input=[int_55, int_56, int_58, int_59, int_57, int_62])  # -> Result, PartialResults
ma_5 = MassAddition(Input=int_55)  # -> Result, PartialResults
ma_6 = MassAddition(Input=int_58)  # -> Result, PartialResults
vec2pt_6 = Vector2Pt(PointA=Point(0, 0, 0), PointB=dispatch_13.ListA, Unitize=False)  # -> Vector, Length
move_10 = Move(Geometry=move_8.Geometry, Motion=vec2pt_6.Vector)  # -> Geometry, Transform

# ---- group: multipe for ppls
number_slider_3 = Slider(0.3, range=-0.01..2)  # disabled

# ---- group: NumID3
int_63 = Integer(ma_2.Result)

# ----
panel_77 = Panel(int_63)

# ---- group: NumID1
int_64 = Integer(ma_3.Result)

# ----
panel_78 = Panel(int_64)

# ---- group: NumID0
int_65 = Integer(ma_5.Result)

# ----
panel_79 = Panel(int_65)

# ---- group: NumBuildings
int_66 = Integer(ma_4.Result)

# ----
panel_80 = Panel(int_66)

# ---- group: NumID2
int_67 = Integer(ma_6.Result)

# ----
panel_81 = Panel(int_67)

# ---- group: all building center
pt_12 = Point(dispatch_14.ListA)

# ---- group: all park center
pt_13 = Point(dispatch_15.ListA)

# ----
multiplication_6 = Multiplication(A=num_18, B=number_slider_3)  # disabled
multiplication_7 = Multiplication(A=num_16, B=number_slider_3)  # disabled
multiplication_8 = Multiplication(A=num_17, B=number_slider_3)  # disabled
mjoin = MeshJoin(Meshes=move_10.Geometry)
num_19 = Number(multiplication_6)  # disabled
num_20 = Number(multiplication_7)  # disabled
num_21 = Number(multiplication_8)  # disabled
filter_2 = StreamFilter(Gate=equals_3.Equality, Stream0=mjoin)
cp = ClosestPoint(Point=pt_12, Cloud=pt_13)  # -> ClosestPoint, CPIndex, Distance
item_12 = ListItem(List=num_21, Index=graft(int_46), Wrap=True)  # disabled
item_13 = ListItem(List=num_19, Index=graft(int_46), Wrap=True)  # disabled
item_14 = ListItem(List=num_20, Index=graft(int_46), Wrap=True)  # disabled
number_slider_4 = Slider(0.001, range=0.001..3)
panel_82 = Panel("(52000+NumID3*2500*0.4*NumFLID3/16+NumBuildings*2500*0.4*ComSlider/23)/(1300000+NumID3*2500*0.4*NumFLID3+NumBuildings*2500*0.4*ComSlider)")
panel_83 = Panel("(6800+NumID0*2500*0.4*NumFLID0/60+NumID1*2500*0.4*NumFLID1/50+NumID2*2500*0.4*NumFLID2/33)/(1300000+NumID0*2500*0.4*NumFLID0+NumID1*2500*0.4*NumFLID1+NumID2*2500*0.4*NumFLID2)")
panel_84 = Panel("(NumID0/(NumID0+NumID1+NumID2)*log10(NumID0/(NumID0+NumID1+NumID2))/log10(3)+NumID1/(NumID0+NumID1+NumID2)*log10(NumID1/(NumID0+NumID1+NumID2))/log10(3)+NumID2/(NumID0+NumID1+NumID2)*log10(NumID2/(NumID0+NumID1+NumID2))/log10(3))*-1")
lng_2 = ListLength(List=pt_12)
ma_7 = MassAddition(Input=cp.Distance)  # -> Result, PartialResults
previewmat = CustomPreviewMaterials(Geometry=filter_2, DiffuseColor=swatch, Transparency=panel_52, DiffuseBitmap=path_7)
pshift_15 = ShiftPaths(Data=item_12, Offset=-1)  # disabled
pshift_16 = ShiftPaths(Data=item_13, Offset=-1)  # disabled
pshift_17 = ShiftPaths(Data=item_14, Offset=-1)  # disabled
panel_85 = Panel("(NumID0*NumFLID0/NumFLRes*log10(NumID0*NumFLID0/NumFLRes)/log10(3)+NumID1*NumFLID1/NumFLRes*log10(NumID1*NumFLID1/NumFLRes)/log10(3)+NumID2*NumFLID2/NumFLRes*log10(NumID2*NumFLID2/NumFLRes)/log10(3))*-1")
video_stream = WebCamVideoStream()
# CityMatrix CV
path_8 = FilePath("C:\Users\RYAN\Dropbox (MIT)\01_Work\MAS\05_Summer 2016\CityMatrix Mini\Snapshot002.PNG")
panel_86 = Panel("52000+NumID3*2500*0.4*NumFLID3/16+NumBuildings*2500*0.4*ComSlider/23")
panel_87 = Panel("6800+NumID0*2500*0.4*NumFLID0/60+NumID1*2500*0.4*NumFLID1/50+NumID2*2500*0.4*NumFLID2/33")

# ---- group: Int Grid X Extent
number_slider_5 = Slider(16, range=1..20)

# ---- group: Int Grid Y Extent
number_slider_6 = Slider(16, range=1..20)

# ----
load_bitmap = LoadBitmap(FilePathToImageLocation=path_8)

# ---- group: Sample White
# Reference Color
pt_14 = Point(<point referenced from the Rhino model>)

# ---- group: Pts Sample Grid Corner
# Grid Sampling
pt_15 = Point([<point referenced from the Rhino model> x4])

# ---- group: Sample Black
pt_16 = Point(<point referenced from the Rhino model>)

# ---- group: Sample Red
pt_17 = Point(<point referenced from the Rhino model>)

# ---- group: Sample Yellow
pt_18 = Point(<point referenced from the Rhino model>)  # disabled

# ---- group: Sample Blue
pt_19 = Point(<point referenced from the Rhino model>)  # disabled

# ---- group: Sample Green
pt_20 = Point(<point referenced from the Rhino model>)  # disabled

# ----
pline = PolyLine(Vertices=pt_15, Closed=False)

# ---- group: old per flr
num_22 = Number(pshift_15)  # disabled

# ---- group: young per flr
num_23 = Number(pshift_16)  # disabled

# ---- group: mid per flr
num_24 = Number(pshift_17)  # disabled

# ---- group: Prox. to Parks
division_4 = Division(A=ma_7.Result, B=lng_2)

# ----
ma_8 = MassAddition(Input=[number_slider_4, Slider(0.001, range=0.001..3), Slider(0.001, range=0.001..3)])  # -> Result, PartialResults
multiplication_9 = Multiplication(A=int_64, B=int_50)
multiplication_10 = Multiplication(A=int_67, B=int_51)
multiplication_11 = Multiplication(A=int_65, B=int_49)
multiplication_12 = Multiplication(A=num_24, B=txt_10)  # disabled
multiplication_13 = Multiplication(A=num_23, B=txt_10)  # disabled
multiplication_14 = Multiplication(A=num_22, B=txt_10)  # disabled
preview_2 = CustomPreview(Geometry=pline, Shader=ColourSwatch(SwatchColor=RGB(255, 0, 230)))
min = Minimum(A=division_4, B=Slider(1000, range=0..1000))
multiplication_15 = Multiplication(A=number_slider_6, B=2)
division_5 = Division(A=number_slider_4, B=ma_8.Result)
ma_9 = MassAddition(Input=[multiplication_11, multiplication_9, multiplication_10])  # -> Result, PartialResults
multiplication_16 = Multiplication(A=number_slider_5, B=2)
crv = Curve(<curve referenced from the Rhino model>)  # disabled
crv_2 = Curve(<curve referenced from the Rhino model>)  # disabled
crv_3 = Curve(<curve referenced from the Rhino model>)  # disabled
crv_4 = Curve(<curve referenced from the Rhino model>)
division_6 = Division(A=number_slider_4, B=ma_8.Result)
crv_5 = Curve(<curve referenced from the Rhino model>)
crv_6 = Curve(<curve referenced from the Rhino model>)

# ---- group: total ppl in building mid
int_68 = Integer(multiplication_12)  # disabled

# ---- group: total ppl in building young
int_69 = Integer(multiplication_13)  # disabled

# ----
addition_3 = Addition(A=int_69, B=int_68)  # disabled

# ---- group: total ppl in building old
int_70 = Integer(multiplication_14)  # disabled

# ----
addition_4 = Addition(A=addition_3, B=int_70)  # disabled

# ---- group: total ppl in building - all
int_71 = Integer(addition_4)  # disabled

# ----
boundary = BoundarySurfaces(Edges=crv)  # disabled
boundary_2 = BoundarySurfaces(Edges=crv_3)  # disabled
boundary_3 = BoundarySurfaces(Edges=crv_2)  # disabled
boundary_4 = BoundarySurfaces(Edges=crv_4)
boundary_5 = BoundarySurfaces(Edges=crv_6)
boundary_6 = BoundarySurfaces(Edges=crv_5)
max = Maximum(A=min, B=Slider(100, range=0..100))
logn = LogN(Number=division_5, Base=10)

# ---- group: webcam stream
data = Data(video_stream)

# ----
perspective = Perspective(pt=pt_15, int_2=multiplication_16, int=multiplication_15)
mesh_23 = MeshBrep(
    Brep=boundary,
    Settings={GridMaxCount=0, GridMinCount=16, JaggedSeams=False, MaxEdgeLength=0, MinEdgeLength=0.0001, MinTolerance=0, Refine=True, RefineAngle=0, RelativeTolerance=0.65, SimplePlanes=True, Tolerance=0})  # disabled
mesh_24 = MeshBrep(
    Brep=boundary_2,
    Settings={GridMaxCount=0, GridMinCount=16, JaggedSeams=False, MaxEdgeLength=0, MinEdgeLength=0.0001, MinTolerance=0, Refine=True, RefineAngle=0, RelativeTolerance=0.65, SimplePlanes=True, Tolerance=0})  # disabled
mesh_25 = MeshBrep(
    Brep=boundary_3,
    Settings={GridMaxCount=0, GridMinCount=16, JaggedSeams=False, MaxEdgeLength=0, MinEdgeLength=0.0001, MinTolerance=0, Refine=True, RefineAngle=0, RelativeTolerance=0.65, SimplePlanes=True, Tolerance=0})  # disabled
mesh_26 = MeshBrep(
    Brep=boundary_4,
    Settings={GridMaxCount=0, GridMinCount=16, JaggedSeams=False, MaxEdgeLength=0, MinEdgeLength=0.0001, MinTolerance=0, Refine=True, RefineAngle=0, RelativeTolerance=0.65, SimplePlanes=True, Tolerance=0})
mesh_27 = MeshBrep(
    Brep=boundary_5,
    Settings={GridMaxCount=0, GridMinCount=16, JaggedSeams=False, MaxEdgeLength=0, MinEdgeLength=0.0001, MinTolerance=0, Refine=True, RefineAngle=0, RelativeTolerance=0.65, SimplePlanes=True, Tolerance=0})
mesh_28 = MeshBrep(
    Brep=boundary_6,
    Settings={GridMaxCount=0, GridMinCount=16, JaggedSeams=False, MaxEdgeLength=0, MinEdgeLength=0.0001, MinTolerance=0, Refine=True, RefineAngle=0, RelativeTolerance=0.65, SimplePlanes=True, Tolerance=0})
snapshot = Snapshot(FireflyBitmap=video_stream)  # disabled
one_over_x = OneOverX(Value=max)
mesh_29 = MeshFromImage(Bmp=data, Sx=Domain(0, 1), Sy=Domain(0, 1), Z=0, C=True)
addition_5 = Addition(A=int_64, B=0.001)
addition_6 = Addition(A=int_65, B=0.001)
addition_7 = Addition(A=int_67, B=0.001)

# ---- group: webcam stream
bmp = BitmapToModify(data)

# ----
sample = BitmapSampler(BitmapToModify=bmp, PointToSample=pt_19, BitmapToModify_2=bmp, PointToSample_2=pt_19, bitmap_filter=0)  # -> SampledImageData, SampledImageData_2; disabled
sample_2 = BitmapSampler(BitmapToModify=bmp, PointToSample=pt_20, BitmapToModify_2=bmp, PointToSample_2=pt_20, bitmap_filter=0)  # -> SampledImageData, SampledImageData_2; disabled
sample_3 = BitmapSampler(BitmapToModify=bmp, PointToSample=pt_18, BitmapToModify_2=bmp, PointToSample_2=pt_18, bitmap_filter=0)  # -> SampledImageData, SampledImageData_2; disabled
sample_4 = BitmapSampler(BitmapToModify=bmp, PointToSample=pt_16, BitmapToModify_2=bmp, PointToSample_2=pt_16, bitmap_filter=0)  # -> SampledImageData, SampledImageData_2
sample_5 = BitmapSampler(BitmapToModify=bmp, PointToSample=pt_17, BitmapToModify_2=bmp, PointToSample_2=pt_17, bitmap_filter=0)  # -> SampledImageData, SampledImageData_2
sample_6 = BitmapSampler(BitmapToModify=bmp, PointToSample=pt_14, BitmapToModify_2=bmp, PointToSample_2=pt_14, bitmap_filter=0)  # -> SampledImageData, SampledImageData_2

# ---- group: x
series = Series(Start=0, Step=1, Count=number_slider_5)

# ---- group: y
series_2 = Series(Start=0, Step=1, Count=number_slider_6)

# ---- group: webcam stream
bmp_2 = BitmapToModify(data)

# ---- group: Employment Density
eval = Evaluate(F=panel_82, NumID3=int_63, NumFLID3=int_54, ComSlider=num_9, NumBuildings=int_66)

# ---- group: Housing Diversity
eval_2 = Evaluate(
    F=panel_84,
    NumID0=addition_6,
    NumFLID0=int_49,
    NumID1=addition_5,
    NumFLID1=int_50,
    NumID2=addition_7,
    NumFLID2=int_51,
    NumFLRes=ma_9.Result)

# ---- group: Residential Density
eval_3 = Evaluate(F=panel_83, NumID0=int_65, NumFLID0=int_49, NumID1=int_64, NumFLID1=int_50, NumID2=int_67, NumFLID2=int_51)

# ----
col_3 = Colour(sample.SampledImageData_2)  # disabled
col_4 = Colour(sample_3.SampledImageData_2)  # disabled
col_5 = Colour(sample_2.SampledImageData_2)  # disabled
col_6 = Colour(sample_4.SampledImageData_2)
col_7 = Colour(sample_6.SampledImageData_2)
col_8 = Colour(sample_5.SampledImageData_2)

# ---- group: Employment Population
eval_4 = Evaluate(F=panel_86, NumID3=int_63, NumFLID3=int_54, ComSlider=num_9, NumBuildings=int_66)

# ----
mcol_3 = MeshColours(Mesh=mesh_23, Colours=col_3)  # disabled
mcol_4 = MeshColours(Mesh=mesh_24, Colours=col_5)  # disabled
mcol_5 = MeshColours(Mesh=mesh_25, Colours=col_4)  # disabled
multiplication_17 = Multiplication(A=series_2, B=4)
mcol_6 = MeshColours(Mesh=mesh_26, Colours=col_6)
mcol_7 = MeshColours(Mesh=mesh_27, Colours=col_8)
mcol_8 = MeshColours(Mesh=mesh_28, Colours=col_7)

# ---- group: Residential Population
eval_5 = Evaluate(F=panel_87, NumID0=int_65, NumFLID0=int_49, NumID1=int_64, NumFLID1=int_50, NumID2=int_67, NumFLID2=int_51)

# ----
multiplication_18 = Multiplication(A=series, B=2)

# ---- group: keystoned grid pts
pt_21 = Point(perspective)

# ----
multiplication_19 = Multiplication(A=multiplication_17, B=number_slider_5)
preview_3 = CustomPreview(
    Geometry=mcol_3,
    Shader={ambient=RGB(0, 0, 0), diffuse=RGB(255, 105, 180), emission=RGB(76, 32, 54), shine=0.5, specular=RGB(255, 255, 255), transparency=0})  # disabled
preview_4 = CustomPreview(
    Geometry=mcol_4,
    Shader={ambient=RGB(0, 0, 0), diffuse=RGB(255, 105, 180), emission=RGB(76, 32, 54), shine=0.5, specular=RGB(255, 255, 255), transparency=0})  # disabled
preview_5 = CustomPreview(
    Geometry=mcol_5,
    Shader={ambient=RGB(0, 0, 0), diffuse=RGB(255, 105, 180), emission=RGB(76, 32, 54), shine=0.5, specular=RGB(255, 255, 255), transparency=0})  # disabled
preview_6 = CustomPreview(
    Geometry=mcol_6,
    Shader={ambient=RGB(0, 0, 0), diffuse=RGB(255, 105, 180), emission=RGB(76, 32, 54), shine=0.5, specular=RGB(255, 255, 255), transparency=0})
preview_7 = CustomPreview(
    Geometry=mcol_7,
    Shader={ambient=RGB(0, 0, 0), diffuse=RGB(255, 105, 180), emission=RGB(76, 32, 54), shine=0.5, specular=RGB(255, 255, 255), transparency=0})
pshift_18 = ShiftPaths(Data=pt_21, Offset=-1)

# ---- group: all sample pts
pt_22 = Point(pshift_18)

# ----
sample_7 = BitmapSampler(BitmapToModify=bmp_2, PointToSample=pt_22, BitmapToModify_2=bmp_2, PointToSample_2=pt_22, bitmap_filter=0)  # -> SampledImageData, SampledImageData_2
preview_8 = CustomPreview(
    Geometry=mcol_8,
    Shader={ambient=RGB(0, 0, 0), diffuse=RGB(255, 105, 180), emission=RGB(76, 32, 54), shine=0.5, specular=RGB(255, 255, 255), transparency=0})

# ---- group: Parameter 5
num_25 = Number(one_over_x)

# ----
panel_88 = Panel(num_25)

# ---- group: Parameter 4
num_26 = Number(eval_2)

# ----
panel_89 = Panel(num_26)
box_3 = CenterBox(Base=pt_22, X=0.003, Y=0.003, Z=0.003)

# ---- group: Parameter 1
num_27 = Number(eval)

# ----
panel_90 = Panel(num_27)

# ---- group: Parameter 2
num_28 = Number(eval_3)

# ---- group: Res. over Emp.
division_7 = Division(A=num_28, B=num_27)

# ----
panel_91 = Panel(num_28)

# ---- group: Parameter 3
num_29 = Number(division_7)

# ----
panel_92 = Panel(num_29)
# Kendall Existing Scenario
panel_93 = Panel("0.042")
addition_8 = Addition(A=multiplication_18, B=graft(multiplication_19))
merge_6 = Merge(Data1=col_7, Data2=col_6, Data3=col_8, Data4=col_4, Data5=col_3, Data6=col_5)

# ---- group: all sample color
col_9 = Colour(sample_7.SampledImageData_2)

# ---- group: all sample boxes
box_4 = Box(box_3)

# ---- group: Residential Population
num_30 = Number(eval_5)

# ----
panel_94 = Panel(num_30)
pshift_19 = ShiftPaths(Data=addition_8, Offset=-1)

# ---- group: Employment Population
int_72 = Integer(eval_4)

# ----
panel_95 = Panel(int_72)
multiplication_20 = Multiplication(A=number_slider_5, B=2)
dom_3 = ConstructDomain(DomainStart="0", DomainEnd="1")
dom_4 = ConstructDomain(DomainStart="0.035", DomainEnd="0.045")
addition_9 = Addition(A=pshift_19, B=multiplication_20)
dom_5 = ConstructDomain(DomainStart="0.003", DomainEnd="0.01")
dom_6 = ConstructDomain(DomainStart="0.001", DomainEnd="0.01")
dom_7 = ConstructDomain(DomainStart=".1", DomainEnd=".3")
addition_10 = Addition(A=pshift_19, B=1)

# ---- group: all perfect colors
col_10 = Colour([ColourSwatch(SwatchColor=RGB(255, 255, 255)), ColourSwatch(SwatchColor=RGB(0, 0, 0)), ColourSwatch(SwatchColor=RGB(255, 0, 0))])

# ---- group: all ref colors
col_11 = Colour([RGB(72, 116, 172), RGB(38, 42, 52), RGB(69, 39, 48)])

# ---- group: Parameter 5
num_31 = Number("0.003")

# ----
panel_96 = Panel(num_31)

# ---- group: Parameter 4
num_32 = Number("0")

# ----
panel_97 = Panel(num_32)

# ---- group: Parameter 3
num_33 = Number("0.13")

# ----
panel_98 = Panel(num_33)
remap = RemapNumbers(Value=num_26, Source=dom_3, Target=Domain(0, 1))  # -> Mapped, Clipped

# ---- group: Parameter 1
num_34 = Number(panel_93)

# ----
panel_99 = Panel(num_34)
remap_2 = RemapNumbers(Value=num_27, Source=dom_4, Target=Domain(0, 1))  # -> Mapped, Clipped

# ---- group: Parameter 2
num_35 = Number("0.0052")

# ----
panel_100 = Panel(num_35)
remap_3 = RemapNumbers(Value=num_28, Source=dom_5, Target=Domain(0, 1))  # -> Mapped, Clipped
remap_4 = RemapNumbers(Value=num_25, Source=dom_6, Target=Domain(0, 1))  # -> Mapped, Clipped
remap_5 = RemapNumbers(Value=num_29, Source=dom_7, Target=Domain(0, 1))  # -> Mapped, Clipped
addition_11 = Addition(A=addition_9, B=1)
addition_12 = Addition(A=int_72, B=num_30)

# ---- group: Parameter 5
num_36 = Number(remap_4.Mapped)

# ----
panel_101 = Panel(num_36)
# Closest Color Code
dist_3 = Distance(PointA=graft(col_9), PointB=col_11)

# ---- group: Parameter 4
num_37 = Number(remap.Mapped)

# ----
panel_102 = Panel(num_37)

# ---- group: Parameter 3
num_38 = Number(remap_5.Mapped)

# ----
panel_103 = Panel(num_38)

# ---- group: Parameter 1
num_39 = Number(remap_2.Mapped)

# ----
panel_104 = Panel(num_39)

# ---- group: Parameter 2
num_40 = Number(remap_3.Mapped)

# ----
panel_105 = Panel(num_40)
dom_8 = ConstructDomain(DomainStart="0", DomainEnd="1")
dom_9 = ConstructDomain(DomainStart="0.01", DomainEnd="0.067")
dom_10 = ConstructDomain(DomainStart="0.003", DomainEnd="0.01")
dom_11 = ConstructDomain(DomainStart="0.001", DomainEnd="0.01")
dom_12 = ConstructDomain(DomainStart="0", DomainEnd="1")

# ---- group: Total Population
int_73 = Integer(addition_12)

# ----
panel_106 = Panel(int_73)
lng_3 = ListLength(List=dist_3)
series_3 = Series(Start=0, Step=1, Count=lng_3)
remap_6 = RemapNumbers(Value=num_32, Source=dom_8, Target=Domain(0, 1))  # -> Mapped, Clipped
remap_7 = RemapNumbers(Value=num_34, Source=dom_9, Target=Domain(0, 1))  # -> Mapped, Clipped
remap_8 = RemapNumbers(Value=num_35, Source=dom_10, Target=Domain(0, 1))  # -> Mapped, Clipped
remap_9 = RemapNumbers(Value=num_31, Source=dom_11, Target=Domain(0, 1))  # -> Mapped, Clipped
remap_10 = RemapNumbers(Value=num_33, Source=dom_12, Target=Domain(0, 1))  # -> Mapped, Clipped
int_74 = Integer(series_3)
sort = SortList(Keys=dist_3, ValuesA=int_74)  # -> Keys, ValuesA
number_slider_7 = Slider(0.907, range=0..1)
number_slider_8 = Slider(0.651, range=0..1)
number_slider_9 = Slider(0.379, range=0..1)
number_slider_10 = Slider(0.005, range=0..1)
number_slider_11 = Slider(0.185, range=0..1)

# ---- group: sample pts
item_15 = ListItem(List=pt_22, Index=addition_9, Wrap=False)
item_16 = ListItem(List=pt_22, Index=pshift_19, Wrap=False)
item_17 = ListItem(List=pt_22, Index=addition_11, Wrap=False)
item_18 = ListItem(List=pt_22, Index=addition_10, Wrap=False)

# ----
addition_13 = Addition(A=item_16, B=item_17)

# ---- group: Parameter 5
num_41 = Number(remap_9.Mapped)

# ----
panel_107 = Panel(num_41)
item_19 = ListItem(List=sort.ValuesA, Index=0, Wrap=False)

# ---- group: Parameter 4
num_42 = Number(remap_6.Mapped)

# ----
panel_108 = Panel(num_42)
division_8 = Division(A=addition_13, B=2)

# ---- group: quart mid pts
pt_23 = Point(division_8)

# ---- group: Parameter 3
num_43 = Number(remap_10.Mapped)

# ----
panel_109 = Panel(num_43)

# ---- group: Parameter 1
num_44 = Number(remap_7.Mapped)

# ----
panel_110 = Panel(num_44)

# ---- group: Parameter 2
num_45 = Number(remap_8.Mapped)

# ----
panel_111 = Panel(num_45)
pshift_20 = ShiftPaths(Data=item_19, Offset=-1)
merge_7 = Merge(Data1=num_39, Data2=num_40, Data3=num_38, Data4=num_37, Data5=num_36)

# ---- group: saved proposed parameters
num_46 = Number([0.8566364466, 0.4793737498, 0.229417789, 0.9417594905, 0.4758952378])

# ---- group: 5 axises
# Radar Chart
crv_7 = Curve(reparameterize([<curve referenced from the Rhino model> x5]))

# ----
merge_8 = Merge(Data1=num_44, Data2=num_45, Data3=num_43, Data4=num_42, Data5=num_41)
pshift_21 = ShiftPaths(Data=pshift_20, Offset=-1)
number_slider_12 = Slider(0.7, range=0..1)
number_slider_13 = Slider(1.5, range=0..2)
eval_6 = EvaluateCurve(Curve=crv_7, Parameter=num_46)  # -> Point, Tangent, Angle
number_slider_14 = Slider(0.7, range=0..1)
eval_7 = EvaluateCurve(Curve=crv_7, Parameter=merge_7)  # -> Point, Tangent, Angle
eval_8 = EvaluateCurve(Curve=crv_7, Parameter=merge_8)  # -> Point, Tangent, Angle
neg_2 = Negative(Value=number_slider_12)
neg_3 = Negative(Value=number_slider_13)

# ---- group: saved proposed parameters
num_47 = Number([0.5843594777, 0.5496911155, 0.290588378, 0.5799996396, 0.4753219941])

# ----
neg_4 = Negative(Value=number_slider_14)

# ---- group: Total Population
# Suggested 3rd Places
int_75 = Integer(int_73)

# ----
pline_2 = PolyLine(Vertices=eval_6.Point, Closed=True)
pline_3 = PolyLine(Vertices=eval_7.Point, Closed=True)

# ---- group: color code of each smaple pt
int_76 = Integer(pshift_21)

# ----
item_20 = ListItem(List=col_11, Index=int_76, Wrap=False)
preview_9 = CustomPreview(Geometry=box_4, Shader=item_20)

# ---- group: color codes
item_21 = ListItem(List=int_76, Index=pshift_19, Wrap=False)
item_22 = ListItem(List=int_76, Index=addition_9, Wrap=False)
item_23 = ListItem(List=int_76, Index=addition_11, Wrap=False)
item_24 = ListItem(List=int_76, Index=addition_10, Wrap=False)

# ----
pline_4 = PolyLine(Vertices=eval_8.Point, Closed=True)
offset = Offset(Curve=pline_2, Distance=[neg_2, number_slider_12], Plane=PlaneXY(0, 0, 0), Corners=1)
offset_2 = Offset(Curve=pline_3, Distance=[neg_3, number_slider_13], Plane=PlaneXY(0, 0, 0), Corners=1)
offset_3 = Offset(Curve=pline_4, Distance=[neg_4, number_slider_14], Plane=PlaneXY(0, 0, 0), Corners=1)

# ---- group: 03
num_48 = Number([0.651, 0.379, 0.185, 0.005, 0.907])

# ----
merge_9 = Merge(Data1=graft(item_21), Data2=graft(item_22), Data3=graft(item_23), Data4=graft(item_24))
pshift_22 = ShiftPaths(Data=offset, Offset=-1)
pshift_23 = ShiftPaths(Data=offset_2, Offset=-1)
pshift_24 = ShiftPaths(Data=offset_3, Offset=-1)

# ---- group: 04
num_49 = Number([0.8566364466, 0.4793737498, 0.229417789, 0.9417594905, 0.4758952378])

# ----
Z_3 = UnitZ(Factor=Slider(1.5, range=0..10))
multiplication_21 = Multiplication(A=int_75, B=Slider(0.6, range=0..1))
division_9 = Division(A=multiplication_21, B=Slider(10000, range=0..10000))
division_10 = Division(A=multiplication_21, B=Slider(8000, range=0..10000))
division_11 = Division(A=multiplication_21, B=Slider(20000, range=0..20000))
division_12 = Division(A=multiplication_21, B=Slider(20000, range=0..20000))
division_13 = Division(A=multiplication_21, B=Slider(15000, range=0..20000))
division_14 = Division(A=multiplication_21, B=Slider(20000, range=0..20000))
division_15 = Division(A=multiplication_21, B=Slider(15000, range=0..20000))
division_16 = Division(A=multiplication_21, B=Slider(20000, range=0..20000))
subtraction = Subtraction(A=division_9, B=Slider(3, range=0..100))
subtraction_2 = Subtraction(A=division_10, B=Slider(13, range=0..100))
subtraction_3 = Subtraction(A=division_11, B=Slider(0, range=0..100))
subtraction_4 = Subtraction(A=division_12, B=Slider(3, range=0..100))
subtraction_5 = Subtraction(A=division_13, B=Slider(0, range=0..100))
subtraction_6 = Subtraction(A=division_14, B=Slider(1, range=0..100))
subtraction_7 = Subtraction(A=division_15, B=Slider(2, range=0..100))
subtraction_8 = Subtraction(A=division_16, B=Slider(1, range=0..100))
Z_4 = UnitZ(Factor=Slider(2, range=0..10))
boundary_7 = BoundarySurfaces(Edges=pshift_22)
Z_5 = UnitZ(Factor=Slider(1, range=0..10))
boundary_8 = BoundarySurfaces(Edges=pshift_23)
boundary_9 = BoundarySurfaces(Edges=pshift_24)

# ---- group: all color code quarts (no rotation)
panel_112 = Panel("2,0,0,0\t2,1,0,0\t2,0,1,0\t2,0,0,1\t2,1,1,0\t2,1,0,1\t2,0,1,1\t2,1,1,1\t3,0,0,0\t3,1,0,0\t3,0,1,0\t3,0,0,1\t3,1,1,0\t3,1,0,1\t3,0,1,1\t3,1,1,1\t4,0,0,0\t4,1,0,0\t4,0,1,0\t4,0,0,1\t4,1,1,0\t4,1,0,1\t4,0,1,1\t4,1,1,1\t5,0,0,0\t5,1,0,0\t5,0,1,0\t5,0,0,1\t5,1,1,0\t5,1,0,1\t5,0,1,1\t5,1,1,1")

# ----
max_2 = Maximum(A=subtraction, B=0)
max_3 = Maximum(A=subtraction_2, B=0)
max_4 = Maximum(A=subtraction_3, B=0)
max_5 = Maximum(A=subtraction_4, B=0)
max_6 = Maximum(A=subtraction_5, B=0)
max_7 = Maximum(A=subtraction_6, B=0)
max_8 = Maximum(A=subtraction_7, B=0)
max_9 = Maximum(A=subtraction_8, B=0)
extr = Extrude(Base=boundary_7, Direction=Z_3)
extr_2 = Extrude(Base=boundary_8, Direction=Z_4)

# ---- group: all color code quarts (with rotation)
# Decode Piece ID
panel_113 = Panel("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")

# ---- group: color code quarts
int_77 = Integer(merge_9)

# ----
extr_3 = Extrude(Base=boundary_9, Direction=Z_5)
brep = Brep(extr)
brep_2 = Brep(extr_2)
rev = ReverseList(List=int_77)

# ---- group: suggested bar
int_78 = Integer(max_2)

# ---- group: suggested restaurant
int_79 = Integer(max_3)

# ---- group: suggested supermarket
int_80 = Integer(max_4)

# ----
brep_3 = Brep(extr_3)

# ---- group: suggested bakery
int_81 = Integer(max_5)

# ---- group: suggested pharmacy
int_82 = Integer(max_6)

# ----
mcol_9 = MeshColours(Mesh=brep, Colours=ColourSwatch(SwatchColor=RGB(0, 153, 255)))

# ---- group: suggested nightclub
int_83 = Integer(max_7)

# ----
mcol_10 = MeshColours(Mesh=brep_2, Colours=ColourSwatch(SwatchColor=RGB(255, 153, 0)))

# ---- group: suggested bookstore
int_84 = Integer(max_8)

# ---- group: suggested art
int_85 = Integer(max_9)

# ----
mcol_11 = MeshColours(Mesh=brep_3, Colours=ColourSwatch(SwatchColor=RGB(255, 255, 255)))
txt_11 = Text(rev)

# ---- group: Radar Chart Proposed
mesh_30 = Mesh(mcol_9)

# ---- group: Radar Chart Dynamic
mesh_31 = Mesh(mcol_10)

# ----
join = TextJoin(Text=txt_11, Join=",")

# ---- group: Radar Chart Existing
mesh_32 = Mesh(mcol_11)

# ---- group: tab
panel_114 = Panel("\t")

# ----
split_5 = TextSplit(Text=panel_113, Separators=panel_114)

# ---- group: 3rd places label location pts
pt_24 = Point([<point referenced from the Rhino model> x8])

# ----
merge_10 = Merge(Data1=int_80, Data2=int_78, Data3=int_79, Data4=int_81, Data5=int_83, Data6=int_82, Data7=int_84, Data8=int_85)
pshift_25 = ShiftPaths(Data=join, Offset=-1)

# ---- group: all color quarts data
txt_12 = Text(split_5)

# ----
lng_4 = ListLength(List=txt_12)
panel_115 = Panel("2,0,0,0")
division_17 = Division(A=lng_4, B="4")

# ---- group: color code quart texts
txt_13 = Text(pshift_25)

# ----
tag = TextTag3D(
    Location=pt_24,
    Text=merge_10,
    Size=Slider(14, range=0..100),
    Colour=ColourSwatch(SwatchColor=RGB(240, 240, 240)),
    Justification=1)
panel_116 = Panel(txt_12)
series_4 = Series(Start=0, Step=1, Count=division_17)
pshift_26 = ShiftPaths(Data=series_4, Offset=-1)
multiplication_22 = Multiplication(A=division_17, B="4")
item_25 = ListItem(List=mesh_10, Index=0, Wrap=False)
pt_25 = Point(<point referenced from the Rhino model>)
neg_5 = Negative()
repeat_2 = RepeatData(Data=pshift_26, Length=multiplication_22)
rotate_3 = Rotate(Geometry=item_25, Angle=degrees(neg_5), Plane=PlaneXY(0, 0, 0))  # -> Geometry, Transform
panel_117 = Panel("Medium Unit")  # disabled
panel_118 = Panel("Small Unit")  # disabled
panel_119 = Panel("Large Unit")  # disabled
panel_120 = Panel("Large Unit")  # disabled
panel_121 = Panel("Medium Unit")  # disabled
panel_122 = Panel("Small Unit")  # disabled
pshift_27 = ShiftPaths(Data=repeat_2, Offset=-1)

# ---- group: all color quart ids
int_86 = Integer(pshift_27)

# ----
keysearch = KeyValueSearch(Keys=txt_12, Values=int_86, Search=graft(txt_13))
nullrep = ReplaceNulls(Items=keysearch, Replacements="-1")  # -> Items, Count
panel_123 = Panel("Residential")  # disabled
panel_124 = Panel("Residential")  # disabled
panel_125 = Panel("Office")  # disabled
# Dock
panel_126 = Panel("Residential")  # disabled
panel_127 = Panel("Office")  # disabled
panel_128 = Panel("Office")  # disabled
vec2pt_7 = Vector2Pt(PointA=Point(0, 0, 0), PointB=pt_25, Unitize=False)  # -> Vector, Length
pshift_28 = ShiftPaths(Data=nullrep.Items, Offset=-1)
pt_26 = ConstructPoint(XCoordinate=Slider(3.5, range=0..10), YCoordinate=Slider(-14, range=-30..0), ZCoordinate=Slider(5.1, range=0..10))
panel_129 = Panel(int_86)
move_11 = Move(Geometry=rotate_3.Geometry, Motion=vec2pt_7.Vector)  # -> Geometry, Transform
txt_14 = Text([panel_120, panel_117, panel_118, panel_119, panel_121, panel_122])  # disabled
txt_15 = Text([panel_126, panel_123, panel_124, panel_125, panel_127, panel_128])  # disabled
xy_3 = XYPlane(Origin=pt_26)
number_slider_15 = Slider(15.2, range=0..100)  # disabled
item_26 = ListItem(List=txt_14, Index=0, Wrap=False)  # disabled
item_27 = ListItem(List=txt_15, Index=0, Wrap=False)  # disabled
comp = Compound(Transforms=flatten([rotate_3.Transform, move_11.Transform]))

# ---- group: all piece ids
int_87 = Integer(pshift_28)

# ---- group: dynamic data from CityMatix CV
int_88 = Integer(int_87)

# ----
tag_2 = TextTag3D(Location=pt_23, Text=int_87, Size=0.01, Justification=5)

# ---- group: dock lego modules
mesh_33 = Mesh(move_11.Geometry)

# ----
swatch_2 = ColourSwatch(SwatchColor=RGB(201, 201, 201))  # disabled
transform = Transform(Geometry=xy_3, Transform=comp)
pt_27 = Point(<point referenced from the Rhino model>)  # disabled
pt_28 = Point(<point referenced from the Rhino model>)  # disabled
panel_130 = Panel(int_87)

# ---- group: unit name
tag_3 = TextTag3D(Location=pt_27, Text=item_26, Size=number_slider_15, Colour=swatch_2, Justification=5)  # disabled

# ---- group: res/off
tag_4 = TextTag3D(Location=pt_28, Text=item_27, Size=number_slider_15, Colour=swatch_2, Justification=5)  # disabled

# ----
panel_131 = Panel("Amenity Off")  # disabled
panel_132 = Panel("Human Int. Off")  # disabled
panel_133 = Panel("Amenity On")  # disabled
panel_134 = Panel("Human Int. On")  # disabled
panel_135 = Panel("Sat. Map On")  # disabled
panel_136 = Panel("MoD.")  # disabled
panel_137 = Panel("Sat. Map Off")  # disabled
# Toggles
panel_138 = Panel("Private Car")  # disabled
txt_16 = Text([panel_133, panel_131])  # disabled
txt_17 = Text([panel_134, panel_132])  # disabled
txt_18 = Text([panel_135, panel_137])  # disabled
txt_19 = Text([panel_138, panel_136])  # disabled
item_28 = ListItem(List=txt_16, Index=0, Wrap=True)  # disabled
item_29 = ListItem(List=txt_18, Index=0, Wrap=True)  # disabled
item_30 = ListItem(List=txt_17, Index=0, Wrap=True)  # disabled
item_31 = ListItem(List=txt_19, Index=0, Wrap=True)  # disabled
pt_29 = Point(<point referenced from the Rhino model>)  # disabled
pt_30 = Point(<point referenced from the Rhino model>)  # disabled
pt_31 = Point(<point referenced from the Rhino model>)  # disabled
pt_32 = Point(<point referenced from the Rhino model>)  # disabled

# ---- group: amenities
tag_5 = TextTag3D(Location=pt_30, Text=item_28, Size=number_slider_15, Colour=swatch_2, Justification=5)  # disabled

# ---- group: google map
tag_6 = TextTag3D(Location=pt_31, Text=item_29, Size=number_slider_15, Colour=swatch_2, Justification=5)  # disabled

# ---- group: human interaction
tag_7 = TextTag3D(Location=pt_29, Text=item_30, Size=number_slider_15, Colour=swatch_2, Justification=5)  # disabled

# ---- group: transportation mode
tag_8 = TextTag3D(Location=pt_32, Text=item_31, Size=number_slider_15, Colour=swatch_2, Justification=5)  # disabled

# ----
panel_139 = Panel("1 to 30")  # disabled

# ---- group: slider1
# Slider
num_50 = Number()  # disabled

# ----
range = Range(Domain=panel_139, Steps=100)  # disabled
multiplication_23 = Multiplication(A=num_50, B=100)  # disabled
int_89 = Integer(range)  # disabled
txt_20 = Text(int_89)  # disabled
int_90 = Integer(multiplication_23)  # disabled
item_32 = ListItem(List=txt_20, Index=int_90, Wrap=True)  # disabled

# ---- group: dock lego floor number
tag_9 = TextTag3D(
    Location=transform,
    Text=item_32,
    Size=Slider(17, range=0..100),
    Colour=ColourSwatch(SwatchColor=RGB(0, 0, 0)),
    Justification=5)

# ----
pt_33 = Point(<point referenced from the Rhino model>)  # disabled

# ---- group: fl # slider
tag_10 = TextTag3D(Location=pt_33, Text=item_32, Size=number_slider_15, Colour=swatch_2, Justification=8)  # disabled

# ==== cluster ModuleCenter
pt = ClusterInput()
int = ClusterInput()
num = ClusterInput()
int_2 = ClusterInput()

# ---- group: cell size
num_2 = Number(num)

# ---- group: y
int_3 = Integer(int)

# ---- group: x
int_4 = Integer(int_2)

# ---- group: center
pt_2 = Point(pt)

# ----
pt_3 = ConstructPoint(XCoordinate=0, YCoordinate=0, ZCoordinate=0)  # disabled
addition = Addition(A=int_4, B=0.5)
vec2pt = Vector2Pt(PointA=pt_3, PointB=pt_2, Unitize=False)  # -> Vector, Length; disabled
addition_2 = Addition(A=int_3, B=0.5)
multiplication = Multiplication(A=addition, B=num_2)
move = Move(Motion=vec2pt.Vector)  # -> Geometry, Transform; disabled
lng = ListLength(List=int_4)  # disabled
multiplication_2 = Multiplication(A=addition_2, B=num_2)
X = UnitX(Factor=multiplication)
repeat = RepeatData(Data=move.Transform, Length=lng)  # disabled
neg = Negative(Value=multiplication_2)
move_2 = Move(Geometry=pt_2, Motion=X)  # -> Geometry, Transform
graft = GraftTree(Tree=move_2.Transform, IncludeEmptyLists=True, IncludeNullItems=True)  # disabled
Y = UnitY(Factor=neg)
pshift = ShiftPaths(Data=repeat, Offset=-1)  # disabled
move_3 = Move(Geometry=move_2.Geometry, Motion=Y)  # -> Geometry, Transform
graft_2 = GraftTree(Tree=move_3.Transform, IncludeEmptyLists=True, IncludeNullItems=True)  # disabled
comp = Compound(Transforms=[graft, graft_2])  # disabled
graft_3 = GraftTree(Tree=pshift, IncludeEmptyLists=True, IncludeNullItems=True)  # disabled
comp_2 = Compound(Transforms=[comp, graft_3])  # disabled

# ---- group: module center
pt_4 = Point(move_3.Geometry)

# ----
pshift_2 = ShiftPaths(Data=comp_2, Offset=-1)  # disabled
transform = Transform(pshift_2)  # disabled
pt_5 = ClusterOutput(pt_4)
transform_2 = ClusterOutput(transform)  # disabled

# ==== cluster MoveToOrgin
num = ClusterInput()
G = ClusterInput()
num_2 = Number(num)
geobottomcenter = GeoBottomCenter(geo=G)
vec2pt = Vector2Pt(PointA=geobottomcenter, PointB=Point(0, 0, 0), Unitize=False)  # -> Vector, Length
move = Move(Geometry=G, Motion=vec2pt.Vector)  # -> Geometry, Transform
scale_nu = ScaleNU(Geometry=move.Geometry, Plane=PlaneXY(0, 0, 0), ScaleX=num_2, ScaleY=num_2, ScaleZ=1)  # -> Geometry, Transform
G_2 = ClusterOutput(scale_nu.Geometry)

# ==== cluster Perspective
int = ClusterInput()
int_2 = ClusterInput()
pt = ClusterInput()

# ---- group: grid extent y
int_3 = Integer(int)

# ---- group: grid extent x
int_4 = Integer(int_2)

# ---- group: Pts Sample Grid Corner
pt_2 = Point(pt)

# ----
subtraction = Subtraction(A=int_4, B=1)
subtraction_2 = Subtraction(A=int_3, B=1)
item = ListItem(List=pt_2, Index=0, Wrap=False)
item_2 = ListItem(List=pt_2, Index=1, Wrap=False)
item_3 = ListItem(List=pt_2, Index=2, Wrap=False)
item_4 = ListItem(List=pt_2, Index=3, Wrap=False)
pt_3 = Point(item_4)
pt_4 = Point(item)
ln = Line(StartPoint=pt_3, EndPoint=pt_4)
pt_5 = Point(item_2)
ln_2 = Line(StartPoint=pt_4, EndPoint=pt_5)
pt_6 = Point(item_3)
ln_3 = Line(StartPoint=pt_6, EndPoint=pt_3)
ln_4 = Line(StartPoint=pt_5, EndPoint=pt_6)
llx = LineLine(Line1=ln, Line2=ln_4)  # -> ParamA, ParamB, PointA, PointB
pt_7 = Point(llx.PointA)
llx_2 = LineLine(Line1=ln_2, Line2=ln_3)  # -> ParamA, ParamB, PointA, PointB
pt_8 = Point(llx_2.PointA)
vec2pt = Vector2Pt(PointA=pt_8, PointB=pt_7, Unitize=False)  # -> Vector, Length
line = LineSDL(Start=pt_3, Direction=vec2pt.Vector, Length=1)
llx_3 = LineLine(Line1=ln_2, Line2=line)  # -> ParamA, ParamB, PointA, PointB
pt_9 = Point(llx_3.PointA)
ln_5 = Line(StartPoint=pt_3, EndPoint=pt_9)
divide = DivideCurve(Curve=ln_5, Count=subtraction_2, Kinks=False)  # -> Points, Tangents, Parameters
ln_6 = Line(StartPoint=pt_8, EndPoint=divide.Points)
llx_4 = LineLine(Line1=ln_4, Line2=line)  # -> ParamA, ParamB, PointA, PointB
pt_10 = Point(llx_4.PointA)
ln_7 = Line(StartPoint=pt_3, EndPoint=pt_10)
divide_2 = DivideCurve(Curve=ln_7, Count=subtraction, Kinks=False)  # -> Points, Tangents, Parameters
ln_8 = Line(StartPoint=pt_7, EndPoint=divide_2.Points)
ln_9 = Line(StartPoint=pt_8, EndPoint=pt_7)

# ---- group: x
line_2 = Line(ln_8)

# ---- group: y
line_3 = Line(ln_6)

# ----
graft = GraftTree(Tree=ln_6, IncludeEmptyLists=True, IncludeNullItems=True)
llx_5 = LineLine(Line1=line_2, Line2=graft)  # -> ParamA, ParamB, PointA, PointB

# ---- group: keystoned grid pts
pt_11 = Point(llx_5.PointA)

# ----
pt_12 = ClusterOutput(pt_11)

# ==== cluster GeoBottomCenter
geo = ClusterInput()
geo_2 = Geometry(geo)
bbox = BoundingBox(Content=geo_2, Plane=PlaneXY(0, 0, 0))  # -> Box, Box_2
box_corners = BoxCorners(Box=bbox.Box)  # -> CornerA, CornerB, CornerC, CornerD, CornerE, CornerF, CornerG, CornerH
pdecon = Deconstruct(Point=box_corners.CornerA)  # -> XComponent, YComponent, ZComponent
pdecon_2 = Deconstruct(Point=box_corners.CornerC)  # -> XComponent, YComponent, ZComponent
addition = Addition(A=pdecon.XComponent, B=pdecon_2.XComponent)
addition_2 = Addition(A=pdecon.YComponent, B=pdecon_2.YComponent)
division = Division(A=addition, B=2)
division_2 = Division(A=addition_2, B=2)
pt = ConstructPoint(XCoordinate=division, YCoordinate=division_2, ZCoordinate=pdecon.ZComponent)
pt_2 = Point(pt)
pt_3 = ClusterOutput(pt_2)
