# Grasshopper definition 180119_CityMatrix_Mini_CV.gh (Grasshopper 0.9.76)
# plug-ins: Python Interpreter, Firefly.X, gHowl

# ---- group: GH Profiler List_David Rutten_Jung
gh_profiler_list = VBScript()  # -> out; disabled
# ---------- gh_profiler_list: VB ----------
    If (_form IsNot Nothing) Then Return

    _form = New Form()
    _form.StartPosition = FormStartPosition.Manual
    _form.ShowInTaskbar = False
    _form.FormBorderStyle = FormBorderStyle.SizableToolWindow
    _form.Text = "Component List"
    AddHandler _form.FormClosing, AddressOf FormClosing

    _list = New ListView()
    _list.View = View.Details
    _list.AllowColumnReorder = False
    _list.MultiSelect = False
    _list.Columns.Add("Component", 200)
    _list.Columns.Add("Runtime", 80)
    _list.Dock = DockStyle.Fill
    AddHandler _list.ItemActivate, AddressOf ItemActivate
    _form.Controls.Add(_list)

    Grasshopper.GUI.GH_WindowsFormUtil.CenterFormOnCursor(_form, True)
    _form.Show(Instances.DocumentEditor)
    Instances.DocumentEditor.FormShepard.RegisterForm(_form)

    If (_handler) Then Return
    AddHandler GrasshopperDocument.SolutionEnd, AddressOf DocumentSolutionEnd
# ---------- gh_profiler_list: VB additional code ----------
  Private _form As Form
  Private _list As ListView
  Private _handler As Boolean = False

  Private Sub FormClosing(sender As Object, e As EventArgs)
    If (_form Is Nothing) Then Return
    RemoveHandler _form.FormClosing, AddressOf FormClosing
    RemoveHandler _list.ItemActivate, AddressOf ItemActivate

    _form = Nothing
    _list = Nothing
  End Sub
  Private Sub ItemActivate(sender As Object, e As EventArgs)
    Try
      Dim item As ListViewItem = _list.SelectedItems(0)
      Dim target As RectangleF = TryCast(item.Tag, IGH_DocumentObject).Attributes.Bounds
      Dim view As New Grasshopper.GUI.Canvas.GH_NamedView(Instances.ActiveCanvas.Viewport.ScreenPort, target)
      view.SetToViewport(Instances.ActiveCanvas, 350)
    Catch
    End Try
  End Sub

  Private Sub DocumentSolutionEnd(sender As Object, e As GH_SolutionEventArgs)
    If (_form Is Nothing) Then Return
    _list.Items.Clear()

    Dim doc As GH_Document = e.Document
    If (doc Is Nothing) Then Return
    If (doc.ObjectCount = 0) Then Return

    Dim times As Int64()
    Dim objects As IGH_DocumentObject()
    ReDim times(doc.ObjectCount - 1)
    ReDim objects(doc.ObjectCount - 1)
    For i As Int32 = 0 To doc.ObjectCount - 1
      Dim obj As IGH_ActiveObject = TryCast(doc.Objects(i), IGH_ActiveObject)
      If (obj Is Nothing) Then
        times(i) = 0
        objects(i) = doc.Objects(i)
        Continue For
      End If

      times(i) = obj.ProcessorTime.Ticks
      objects(i) = obj
    Next
    Array.Sort(times, objects)

    For i As Int32 = doc.ObjectCount - 1 To 0 Step -1
      If (times(i) < TimeSpan.TicksPerMillisecond) Then Continue For
      Dim item As New ListViewItem(objects(i).Name)
      item.Tag = objects(i)
      item.SubItems.Add(String.Format("{0:0} ms", New TimeSpan(times(i)).TotalMilliseconds))
      _list.Items.Add(item)
    Next
    _list.Invalidate()
  End Sub
# ---------- end gh_profiler_list ----------

# ---- group: right click -> Slow(1s)
video_stream = WebCamVideoStream()

# ----
pushtempstep = Button()

# ---- group: AI Step (manual)
aisteptest = Slider(19, range=-1..24)

# ---- group: manual or CV
list = ValueList({"manual": 0, "CV": 1}, selected="CV")

# ---- group: mask tmp
panel = Panel("""1,1,1,1,1,1,1,1,1,1,1,1,1,1,1,1
1,1,1,1,1,1,1,1,1,1,1,1,1,1,1,1
1,1,1,1,1,1,1,1,1,1,1,1,1,1,1,1
1,1,1,1,1,1,1,1,1,1,1,1,1,1,1,1
1,1,1,1,0,0,0,0,1,0,0,0,0,1,1,1
1,1,1,1,0,0,0,0,1,0,0,0,0,1,1,1
1,1,1,1,0,0,0,0,1,0,0,0,0,1,1,1
1,1,1,1,0,0,0,0,1,0,0,0,0,1,1,1
1,1,1,1,1,1,1,1,1,1,1,1,1,1,1,1
1,1,1,1,0,0,0,0,1,0,0,0,0,1,1,1
1,1,1,1,0,0,0,0,1,0,0,0,0,1,1,1
1,1,1,1,0,0,0,0,1,0,0,0,0,1,1,1
1,1,1,1,0,0,0,0,1,0,0,0,0,1,1,1
1,1,1,1,1,1,1,1,1,1,1,1,1,1,1,1
1,1,1,1,1,1,1,1,1,1,1,1,1,1,1,1
1,1,1,1,1,1,1,1,1,1,1,1,1,1,1,1""")

# ----
# Reference Color
timer = Timer(TimerInterval=500, Target=path)  # disabled

# ---- group: ref color pop area
crv = Curve(<curve referenced from the Rhino model>)

# ----
path = FilePath("C:\Users\RYAN\Dropbox (MIT)\01_Work\Share\_CityScope\CityMatrix_ML\01_Software\RH_GH\Grasshopper\CamCapture\CamCapture_05_ML.PNG")

# ---- group: all rotations
panel_2 = Panel("270,270,270,270,270,270,270,270,270,270,270,270,270,270,270,270,270,270,270,270,270,270,270,270,270,270,270,270,270,270,270,270,180,180,180,180,180,180,180,180,180,180,180,180,180,180,180,180,180,180,180,180,180,180,180,180,180,180,180,180,180,180,180,180,90,90,90,90,90,90,90,90,90,90,90,90,90,90,90,90,90,90,90,90,90,90,90,90,90,90,90,90,90,90,90,90,0,0,0,0,0,0,0,0,0,0,0,0,0,0,0,0,0,0,0,0,0,0,0,0,0,0,0,0,0,0,0,0")

# ---- group: all color code quarts (no rotation)
panel_3 = Panel("2,0,0,0\t2,1,0,0\t2,0,1,0\t2,0,0,1\t2,1,1,0\t2,1,0,1\t2,0,1,1\t2,1,1,1\t3,0,0,0\t3,1,0,0\t3,0,1,0\t3,0,0,1\t3,1,1,0\t3,1,0,1\t3,0,1,1\t3,1,1,1\t4,0,0,0\t4,1,0,0\t4,0,1,0\t4,0,0,1\t4,1,1,0\t4,1,0,1\t4,0,1,1\t4,1,1,1\t5,0,0,0\t5,1,0,0\t5,0,1,0\t5,0,0,1\t5,1,1,0\t5,1,0,1\t5,0,1,1\t5,1,1,1")

# ----
# Input Parameters
gridextent_x = Slider(16, range=2..48)
gridextent_y = Slider(16, range=2..48)

_0_reslux = Slider(5, range=1..25)
_1_resmed = Slider(4, range=1..25)
_2_resmu = Slider(2, range=1..25)
_3_comhq = Slider(3, range=1..25)
_4_commed = Slider(6, range=1..25)
# CityMatrix CV
_5_rescw = Slider(1, range=1..25)

set1 = Button()
set2 = Button()

# ---- group: Density Array - Initial - set1
panel_4 = Panel("""20
10
5
5
5
5""")

# ---- group: Density Array - running - set 2
panel_5 = Panel("""30
30
30
30
30
30""")

# ----
load_bitmap = LoadBitmap(FilePathToImageLocation=path)

# ---- group: Int Grid X Extent
number_slider = Slider(16, range=1..20)

# ---- group: Int Grid Y Extent
number_slider_2 = Slider(16, range=1..20)

# ---- group: Pts Sample Grid Corner
pt = Point([<point referenced from the Rhino model> x4])

# ---- group: dock position ref pts
# Dock Sampling
pt_2 = Point([<point referenced from the Rhino model> x4])

# ----
pline = PolyLine(Vertices=pt, Closed=False)

# ---- group: Sample Toggle
pt_3 = Point(<point referenced from the Rhino model>)

# ---- group: Sample Other
pt_4 = Point(<point referenced from the Rhino model>)

# ---- group: color ids
int = Integer("0")
int_2 = Integer("1")
int_3 = Integer("2")
panel_6 = Panel("3")  # disabled
int_4 = Integer(panel_6)  # disabled
panel_7 = Panel("4")  # disabled
int_5 = Integer(panel_7)  # disabled
panel_8 = Panel("5")  # disabled
# Grid Sampling
int_6 = Integer(panel_8)  # disabled

# ---- group: Color Space Calibration / ref color pop area
crv_2 = Curve([<curve referenced from the Rhino model> x2])  # disabled

# ---- group: slider postion ref lines
# 3 Level Slider Sampling
crv_3 = Curve(reparameterize(graft([<curve referenced from the Rhino model> x5])))

# ---- group: Sample Others
pt_5 = Point([<point referenced from the Rhino model> x3])

# ---- group: Sample Toggle
pt_6 = Point(<point referenced from the Rhino model>)

# ---- group: Sample Others
pt_7 = Point([<point referenced from the Rhino model> x3])

# ---- group: Sample Toggle
pt_8 = Point(<point referenced from the Rhino model>)

# ---- group: Color Space Calibration / ref color pop area
crv_4 = Curve(<curve referenced from the Rhino model>)  # disabled

crv_5 = Curve(<curve referenced from the Rhino model>)  # disabled

# ---- group: slider position ref pts
# Slider Sampling
pt_9 = Point([<point referenced from the Rhino model> x2])

# Slider 2 Sampling
pt_10 = Point([<point referenced from the Rhino model> x2])

# ---- group: toggle 1 position ref pt
pt_11 = Point(<point referenced from the Rhino model>)

# ---- group: Color Space Calibration / ref color pop area
crv_6 = Curve(<curve referenced from the Rhino model>)  # disabled

# ---- group: Sample Other
pt_12 = Point(<point referenced from the Rhino model>)

# ---- group: Sample Toggle
pt_13 = Point(<point referenced from the Rhino model>)

# ----
pdecon = Deconstruct(Point=pt_13)  # -> XComponent, YComponent, ZComponent
pdecon_2 = Deconstruct(Point=pt_12)  # -> XComponent, YComponent, ZComponent

# ---- group: all color code quarts (with rotation)
# Decode Piece ID
panel_9 = Panel("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")

# ----
split = TextSplit(Text=panel_2, Separators=",")
preview = CustomPreview(Geometry=pline, Shader=ColourSwatch(SwatchColor=RGB(255, 0, 230)))
pdecon_3 = Deconstruct(Point=pt_6)  # -> XComponent, YComponent, ZComponent
pdecon_4 = Deconstruct(Point=pt_5)  # -> XComponent, YComponent, ZComponent
pdecon_5 = Deconstruct(Point=pt_8)  # -> XComponent, YComponent, ZComponent
pdecon_6 = Deconstruct(Point=pt_7)  # -> XComponent, YComponent, ZComponent

# ---- group: manual text city
panel_10 = Panel("""g,g,g,r,g,g,g,g,r,g,g,g,g,r,g,g
g,g,g,r,g,g,g,g,r,g,g,g,g,r,g,g
g,g,g,r,g,g,g,g,r,g,g,g,g,r,g,g
r,r,r,r,r,r,r,r,r,r,r,r,r,r,r,r
g,g,g,r,0,0,0,0,r,1,1,1,2,r,g,g
g,g,g,r,0,g,g,0,r,1,g,g,2,r,g,g
g,g,g,r,0,g,g,0,r,1,g,g,2,r,g,g
g,g,g,r,0,0,0,0,r,1,1,1,2,r,g,g
r,r,r,r,r,r,r,r,r,r,r,r,r,r,r,r
g,g,g,r,3,3,3,3,r,4,4,4,5,r,g,g
g,g,g,r,3,g,g,3,r,4,g,g,5,r,g,g
g,g,g,r,3,g,g,3,r,4,g,g,5,r,g,g
g,g,g,r,3,3,3,3,r,4,4,4,5,r,g,g
r,r,r,r,r,r,r,r,r,r,r,r,r,r,r,r
g,g,g,r,g,g,g,g,r,g,g,g,g,r,g,g
g,g,g,r,g,g,g,g,r,g,g,g,g,r,g,g""")

# ----
merge = Merge(Data1=int, Data2=int_2, Data3=int_3, Data4=int_4, Data5=int_5, Data6=int_6)
data = Data(video_stream)

# ---- group: startFlag
startflag = Button()
panel_11 = Panel(startflag)

# ----
pdecon_7 = Deconstruct(Point=pt_13)  # -> XComponent, YComponent, ZComponent
pdecon_8 = Deconstruct(Point=pt_12)  # -> XComponent, YComponent, ZComponent
frgb = ColourRGBF(Alpha=1, Red=pdecon.XComponent, Green=pdecon.YComponent, Blue=pdecon.ZComponent)
frgb_2 = ColourRGBF(Alpha=1, Red=pdecon_2.XComponent, Green=pdecon_2.YComponent, Blue=pdecon_2.ZComponent)
multiplication = Multiplication(A=number_slider_2, B=2)
merge_2 = Merge(Data1=_0_reslux, Data2=_1_resmed, Data3=_2_resmu, Data4=_3_comhq, Data5=_4_commed, Data6=_5_rescw)
multiplication_2 = Multiplication(A=number_slider, B=2)
frgb_3 = ColourRGBF(Alpha=1, Red=pdecon_3.XComponent, Green=pdecon_3.YComponent, Blue=pdecon_3.ZComponent)
frgb_4 = ColourRGBF(Alpha=1, Red=pdecon_4.XComponent, Green=pdecon_4.YComponent, Blue=pdecon_4.ZComponent)
frgb_5 = ColourRGBF(Alpha=1, Red=pdecon_5.XComponent, Green=pdecon_5.YComponent, Blue=pdecon_5.ZComponent)
frgb_6 = ColourRGBF(Alpha=1, Red=pdecon_6.XComponent, Green=pdecon_6.YComponent, Blue=pdecon_6.ZComponent)

# ---- group: All Colors IDs
int_7 = Integer(merge)

# ----
frgb_7 = ColourRGBF(Alpha=1, Red=pdecon_7.XComponent, Green=pdecon_7.YComponent, Blue=pdecon_7.ZComponent)
frgb_8 = ColourRGBF(Alpha=1, Red=pdecon_8.XComponent, Green=pdecon_8.YComponent, Blue=pdecon_8.ZComponent)

# ---- group: all rotations reference
txt = Text(split)

# ----
text_grid_to_list = TextGridToList(txt=panel)
merge_3 = Merge(Data1=frgb, Data2=frgb_2)

# ---- group: webcam stream
data_2 = Data(data)

bmp = BitmapToModify(data_2)

bmp_2 = BitmapToModify(data_2)

bmp_3 = BitmapToModify(data_2)

bmp_4 = BitmapToModify(data_2)

# Toggle 1
bmp_5 = BitmapToModify(data_2)

# ----
sample = BitmapSampler(BitmapToModify=bmp_5, PointToSample=pt_11, BitmapToModify_2=bmp_5, PointToSample_2=pt_11, bitmap_filter=0)  # -> SampledImageData, SampledImageData_2
sample_2 = BitmapSampler(BitmapToModify=bmp, PointToSample=pt_2, BitmapToModify_2=bmp, PointToSample_2=pt_2, bitmap_filter=0)  # -> SampledImageData, SampledImageData_2
merge_4 = Merge(Data1=frgb_5, Data2=frgb_6)
col = Colour(sample.SampledImageData_2)
merge_5 = Merge(Data1=frgb_3, Data2=frgb_4)
col_2 = Colour(sample_2.SampledImageData_2)
pline_2 = PolyLine(Vertices=pt_9, Closed=False)  # -> reparameterize(Polyline)
pline_3 = PolyLine(Vertices=pt_10, Closed=False)  # -> reparameterize(Polyline)
merge_6 = Merge(Data1=frgb_7, Data2=frgb_8)
perspective = Perspective(pt=pt, int_2=multiplication_2, int=multiplication)
panel_12 = Panel(txt)

# ---- group: tab
panel_13 = Panel("\t")

# ----
split_2 = TextSplit(Text=panel_9, Separators=panel_13)
divide = DivideCurve(Curve=crv_3, Count=Slider(1, range=1..99), Kinks=False)  # -> Points, Tangents, Parameters
divide_2 = DivideCurve(Curve=pline_2, Count=Slider(14, range=9..99), Kinks=False)  # -> Points, Tangents, Parameters
divide_3 = DivideCurve(Curve=pline_3, Count=Slider(21, range=9..99), Kinks=False)  # -> Points, Tangents, Parameters

# ---- group: All Manual Reference Colors
col_3 = Colour(merge_3)

# ---- group: gridExtent_y
int_8 = Integer(gridextent_y)

# ---- group: floor num for each type
int_9 = Integer(merge_2)

# ---- group: gridExtent_x
int_10 = Integer(gridextent_x)

# ---- group: manual text city
# -2 means static context
# -1 means empty site
# please manually replace -1
# to building types 0 to 5
# 0 means RL
# 1 means RM
# 2 means RS
# 3 means OL
# 4 means OM
# 5 means OS
panel_14 = Panel("""b,r,b,b,b,b,r,b,b,b,b,r,b,b,b,b
r,r,r,r,r,r,r,r,r,r,r,r,r,r,r,r
b,r,b,b,b,b,r,b,b,b,b,r,b,b,b,b
b,r,b,g,g,b,r,b,g,g,b,r,b,g,g,b
b,r,b,g,g,b,r,b,g,g,b,r,b,g,g,b
b,r,b,b,b,b,r,b,b,b,b,r,b,b,b,b
r,r,r,r,r,r,r,r,r,r,r,r,r,r,r,r
b,r,b,b,b,b,r,4,4,4,4,r,3,3,3,3
b,r,b,g,g,b,r,4,g,g,4,r,3,g,g,3
b,r,b,g,g,b,r,4,g,g,4,r,3,g,g,3
b,r,b,b,b,b,r,4,4,4,4,r,3,3,3,3
r,r,r,r,r,r,r,r,r,r,r,r,r,r,r,r
b,r,2,2,2,2,r,1,1,1,1,r,0,0,0,0
b,r,2,g,g,2,r,1,g,g,1,r,0,g,g,0
b,r,2,g,g,2,r,1,g,g,1,r,0,g,g,0
b,r,2,2,2,2,r,1,1,1,1,r,0,0,0,0""")

# ---- group: All Manual Reference Colors
col_4 = Colour(merge_5)

col_5 = Colour(merge_4)

# ---- group: manual text city
panel_15 = Panel("""g,g,g,r,g,g,g,g,r,g,g,g,g,r,g,g
g,g,g,r,g,g,g,g,r,g,g,g,g,r,g,g
g,g,g,r,g,g,g,g,r,g,g,g,g,r,g,g
r,r,r,r,r,r,r,r,r,r,r,r,r,r,r,r
g,g,g,r,0,0,0,0,r,1,1,1,2,r,g,g
g,g,g,r,0,g,g,0,r,1,g,g,2,r,g,g
g,g,g,r,0,g,g,0,r,1,g,g,2,r,g,g
g,g,g,r,0,0,0,0,r,1,1,1,2,r,g,g
r,r,r,r,r,r,r,r,r,r,r,r,r,r,r,r
g,g,g,r,3,3,3,3,r,4,4,4,5,r,g,g
g,g,g,r,3,g,g,3,r,4,g,g,5,r,g,g
g,g,g,r,3,g,g,3,r,4,g,g,5,r,g,g
g,g,g,r,3,3,3,3,r,4,4,4,5,r,g,g
r,r,r,r,r,r,r,r,r,r,r,r,r,r,r,r
g,g,g,r,g,g,g,g,r,g,g,g,g,r,g,g
g,g,g,r,g,g,g,g,r,g,g,g,g,r,g,g""")

# ---- group: all piece if mask
int_11 = Integer(text_grid_to_list)

# ----
preview_2 = CustomPreview(Geometry=pline_2, Shader=ColourSwatch(SwatchColor=RGB(255, 0, 230)))
preview_3 = CustomPreview(Geometry=pline_3, Shader=ColourSwatch(SwatchColor=RGB(255, 0, 230)))

# ---- group: All Manual Reference Colors
col_6 = Colour(merge_6)

# ---- group: manual calibration / Sample White
pt_14 = Point(<point referenced from the Rhino model>)

# ---- group: manual calibration / Sample Black
pt_15 = Point(<point referenced from the Rhino model>)

# ---- group: manual calibration / Sample Red
pt_16 = Point(<point referenced from the Rhino model>)

# ---- group: manual calibration / Sample Yellow
pt_17 = Point(<point referenced from the Rhino model>)  # disabled

# ---- group: manual calibration / Sample Blue
pt_18 = Point(<point referenced from the Rhino model>)  # disabled

# ---- group: manual calibration / Sample Green
pt_19 = Point(<point referenced from the Rhino model>)  # disabled

# ----
graft = GraftTree(Tree=int_11, IncludeEmptyLists=True, IncludeNullItems=True)

# ---- group: all color quarts reference
txt_2 = Text(split_2)

# ----
lng = ListLength(List=txt_2)
pdecon_9 = Deconstruct(Point=pt_14)  # -> XComponent, YComponent, ZComponent
pdecon_10 = Deconstruct(Point=pt_15)  # -> XComponent, YComponent, ZComponent
pdecon_11 = Deconstruct(Point=pt_16)  # -> XComponent, YComponent, ZComponent
pdecon_12 = Deconstruct(Point=pt_17)  # -> XComponent, YComponent, ZComponent
pdecon_13 = Deconstruct(Point=pt_18)  # -> XComponent, YComponent, ZComponent
pdecon_14 = Deconstruct(Point=pt_19)  # -> XComponent, YComponent, ZComponent

# ---- group: Position Calibration / CityMatrix CV Calibration
mesh = MeshFromImage(Bmp=data_2, Sx=Domain(0, 1), Sy=Domain(0, 1), Z=0, C=True)

# ---- group: x
series = Series(Start=0, Step=1, Count=number_slider)

# ---- group: y
series_2 = Series(Start=0, Step=1, Count=number_slider_2)

# ---- group: slider and toggle ref colors
col_7 = Colour(col_3)

col_8 = Colour(col_4)

col_9 = Colour(col_5)

# ----
division = Division(A=lng, B="4")

# ---- group: webcam stream
bmp_6 = BitmapToModify(data_2)

# ---- group: slider sample pts
pt_20 = Point(divide.Points)

# ----
line = LineSDL(Start=pt_20, Direction=Vector(1, 0, 0), Length=0.005)
frgb_9 = ColourRGBF(Alpha=1, Red=pdecon_9.XComponent, Green=pdecon_9.YComponent, Blue=pdecon_9.ZComponent)
frgb_10 = ColourRGBF(Alpha=1, Red=pdecon_10.XComponent, Green=pdecon_10.YComponent, Blue=pdecon_10.ZComponent)
frgb_11 = ColourRGBF(Alpha=1, Red=pdecon_11.XComponent, Green=pdecon_11.YComponent, Blue=pdecon_11.ZComponent)
frgb_12 = ColourRGBF(Alpha=1, Red=pdecon_12.XComponent, Green=pdecon_12.YComponent, Blue=pdecon_12.ZComponent)
frgb_13 = ColourRGBF(Alpha=1, Red=pdecon_13.XComponent, Green=pdecon_13.YComponent, Blue=pdecon_13.ZComponent)
frgb_14 = ColourRGBF(Alpha=1, Red=pdecon_14.XComponent, Green=pdecon_14.YComponent, Blue=pdecon_14.ZComponent)

# ---- group: slider sample pts
pt_21 = Point(divide_2.Points)

# ----
line_2 = LineSDL(Start=pt_21, Direction=Vector(1, 0, 0), Length=0.005)

# ---- group: slider sample pts
pt_22 = Point(divide_3.Points)

# ----
line_3 = LineSDL(Start=pt_22, Direction=Vector(1, 0, 0), Length=0.005)

# ---- group: slider and toggle ref colors
col_10 = Colour(col_6)

# ----
cp = ClosestPoint(Point=graft(col), Cloud=col_10)  # -> ClosestPoint, CPIndex, Distance
pshift = ShiftPaths(Data=cp.CPIndex, Offset=-1)

# ---- group: color ID
int_12 = Integer(pshift)

# ----
sample_3 = BitmapSampler(BitmapToModify=bmp_2, PointToSample=pt_20, BitmapToModify_2=bmp_2, PointToSample_2=pt_20, bitmap_filter=0)  # -> SampledImageData, SampledImageData_2
panel_16 = Panel(txt_2)
sample_4 = BitmapSampler(BitmapToModify=bmp_3, PointToSample=pt_21, BitmapToModify_2=bmp_3, PointToSample_2=pt_21, bitmap_filter=0)  # -> SampledImageData, SampledImageData_2
sample_5 = BitmapSampler(BitmapToModify=bmp_4, PointToSample=pt_22, BitmapToModify_2=bmp_4, PointToSample_2=pt_22, bitmap_filter=0)  # -> SampledImageData, SampledImageData_2
multiplication_3 = Multiplication(A=series_2, B=4)
series_3 = Series(Start=0, Step=1, Count=division)
multiplication_4 = Multiplication(A=series, B=2)
merge_7 = Merge(Data1=frgb_9, Data2=frgb_10, Data3=frgb_11, Data4=frgb_12, Data5=frgb_13, Data6=frgb_14)
equals = Equality(FirstNumber=int_12, SecondNumber="0")  # -> Equality, Inequality

# ---- group: keystoned grid pts
pt_23 = Point(perspective)

# ----
pshift_2 = ShiftPaths(Data=series_3, Offset=-1)
multiplication_5 = Multiplication(A=division, B="4")
pshift_3 = ShiftPaths(Data=sample_3.SampledImageData_2, Offset=-1)
pshift_4 = ShiftPaths(Data=sample_4.SampledImageData_2, Offset=-1)
pshift_5 = ShiftPaths(Data=sample_5.SampledImageData_2, Offset=-1)
multiplication_6 = Multiplication(A=multiplication_3, B=number_slider)
pshift_6 = ShiftPaths(Data=pt_23, Offset=-1)

# ---- group: all sample pts
pt_24 = Point(pshift_6)

# ----
sample_6 = BitmapSampler(BitmapToModify=bmp_6, PointToSample=pt_24, BitmapToModify_2=bmp_6, PointToSample_2=pt_24, bitmap_filter=0)  # -> SampledImageData, SampledImageData_2

# ---- group: All Manual Reference Colors
col_11 = Colour(merge_7)

# ---- group: toggle 1 value
bool = Boolean(equals.Equality)

# ---- group: sampled pts color
col_12 = Colour(pshift_3)

# ----
# Decode Slider Value
cp_2 = ClosestPoint(Point=graft(col_12), Cloud=col_7)  # -> ClosestPoint, CPIndex, Distance
pshift_7 = ShiftPaths(Data=cp_2.CPIndex, Offset=-1)

# ---- group: color IDs
int_13 = Integer(pshift_7)

# ----
dispatch = Dispatch(List=pt_20, DispatchPattern=int_13)  # -> ListA, ListB
pdecon_15 = Deconstruct(Point=dispatch.ListB)  # -> XComponent, YComponent, ZComponent
lng_2 = ListLength(List=dispatch.ListB)
ma = MassAddition(Input=pdecon_15.XComponent)  # -> Result, PartialResults
ma_2 = MassAddition(Input=pdecon_15.YComponent)  # -> Result, PartialResults
division_2 = Division(A=ma.Result, B=lng_2)
division_3 = Division(A=ma_2.Result, B=lng_2)
pt_25 = ConstructPoint(XCoordinate=division_2, YCoordinate=division_3, ZCoordinate=0)

# ---- group: average slide block pt
pt_26 = Point(pt_25)

# ----
crv_cp = CurveClosestPoint(Point=pt_26, Curve=crv_3)  # -> Point, Parameter, Distance
repeat = RepeatData(Data=pshift_2, Length=multiplication_5)

# ---- group: sampled pts color
col_13 = Colour(pshift_4)

# ----
# Decode Slider Value
cp_3 = ClosestPoint(Point=graft(col_13), Cloud=col_8)  # -> ClosestPoint, CPIndex, Distance
pshift_8 = ShiftPaths(Data=cp_3.CPIndex, Offset=-1)

# ---- group: color IDs
int_14 = Integer(pshift_8)

# ----
dispatch_2 = Dispatch(List=pt_21, DispatchPattern=int_14)  # -> ListA, ListB
pdecon_16 = Deconstruct(Point=dispatch_2.ListB)  # -> XComponent, YComponent, ZComponent
lng_3 = ListLength(List=dispatch_2.ListB)
ma_3 = MassAddition(Input=pdecon_16.XComponent)  # -> Result, PartialResults
ma_4 = MassAddition(Input=pdecon_16.YComponent)  # -> Result, PartialResults
division_4 = Division(A=ma_3.Result, B=lng_3)
division_5 = Division(A=ma_4.Result, B=lng_3)
pt_27 = ConstructPoint(XCoordinate=division_4, YCoordinate=division_5, ZCoordinate=0)

# ---- group: average slide block pt
pt_28 = Point(pt_27)

# ----
crv_cp_2 = CurveClosestPoint(Point=pt_28, Curve=pline_2)  # -> Point, Parameter, Distance

# ---- group: sampled pts color
col_14 = Colour(pshift_5)

# ----
# Decode Slider Value
cp_4 = ClosestPoint(Point=graft(col_14), Cloud=col_9)  # -> ClosestPoint, CPIndex, Distance
pshift_9 = ShiftPaths(Data=cp_4.CPIndex, Offset=-1)

# ---- group: color IDs
int_15 = Integer(pshift_9)

# ----
dispatch_3 = Dispatch(List=pt_22, DispatchPattern=int_15)  # -> ListA, ListB
pdecon_17 = Deconstruct(Point=dispatch_3.ListB)  # -> XComponent, YComponent, ZComponent
lng_4 = ListLength(List=dispatch_3.ListB)
ma_5 = MassAddition(Input=pdecon_17.XComponent)  # -> Result, PartialResults
ma_6 = MassAddition(Input=pdecon_17.YComponent)  # -> Result, PartialResults
division_6 = Division(A=ma_5.Result, B=lng_4)
division_7 = Division(A=ma_6.Result, B=lng_4)
pt_29 = ConstructPoint(XCoordinate=division_6, YCoordinate=division_7, ZCoordinate=0)

# ---- group: average slide block pt
pt_30 = Point(pt_29)

# ----
crv_cp_3 = CurveClosestPoint(Point=pt_30, Curve=pline_3)  # -> Point, Parameter, Distance
addition = Addition(A=multiplication_4, B=graft(multiplication_6))

# ---- group: module id data (manual)
txt_3 = Text(panel_10)

# ----
pshift_10 = ShiftPaths(Data=crv_cp.Parameter, Offset=-1)
pshift_11 = ShiftPaths(Data=crv_cp_2.Parameter, Offset=-1)
pshift_12 = ShiftPaths(Data=crv_cp_3.Parameter, Offset=-1)
pshift_13 = ShiftPaths(Data=repeat, Offset=-1)

# ---- group: all color quart ids reference
int_16 = Integer(pshift_13)

# ---- group: all ref colors
col_15 = Colour(col_11)

# ----
# Decode Dock ID
cp_5 = ClosestPoint(Point=col_2, Cloud=col_15)  # -> ClosestPoint, CPIndex, Distance
item = ListItem(List=int_7, Index=cp_5.CPIndex, Wrap=False)

# ---- group: color code of each smaple pt
int_17 = Integer(item)

# ----
rev = ReverseList(List=int_17)
txt_4 = Text(rev)
join = TextJoin(Text=txt_4, Join=",")

# ---- group: color code quart text data
txt_5 = Text(join)

# ----
panel_17 = Panel(txt_5)

# ---- group: all sample color
col_16 = Colour(sample_6.SampledImageData_2)

# ----
rep = ReplaceText(Text=txt_3, Find="r", Replace="6", RecursiveReplace=False)
rep_2 = ReplaceText(Text=rep, Find="g", Replace="-1", RecursiveReplace=False)
rep_3 = ReplaceText(Text=rep_2, Find="b", Replace="0", RecursiveReplace=False)
panel_18 = Panel(rep_3)
pshift_14 = ShiftPaths(Data=addition, Offset=-1)
multiplication_7 = Multiplication(A=set2, B=2)
multiplication_8 = Multiplication(A=number_slider, B=2)
keysearch = KeyValueSearch(Keys=txt_2, Values=panel_12, Search=graft(txt_5))
keysearch_2 = KeyValueSearch(Keys=txt_2, Values=int_16, Search=graft(txt_5))
item_2 = ListItem(List=col_7, Index=int_13, Wrap=True)
panel_19 = Panel(int_16)
item_3 = ListItem(List=col_8, Index=int_14, Wrap=True)
item_4 = ListItem(List=col_9, Index=int_15, Wrap=True)
addition_2 = Addition(A=set1, B=multiplication_7)

# ---- group: slider read 0-1
num = Number(pshift_10)

# ----
panel_20 = Panel(num)

# ---- group: slider read 0-1
num_2 = Number(pshift_11)

# ----
panel_21 = Panel(num_2)

# ---- group: slider read 0-1
num_3 = Number(pshift_12)

# ----
panel_22 = Panel(num_3)
addition_3 = Addition(A=pshift_14, B=multiplication_8)

# ---- group: module id data
txt_6 = Text(rep_3)

# ----
preview_4 = CustomPreview(Geometry=pt_20, Shader=item_2)
addition_4 = Addition(A=pshift_14, B=1)
preview_5 = CustomPreview(Geometry=pt_21, Shader=item_3)
preview_6 = CustomPreview(Geometry=pt_22, Shader=item_4)
nullrep = ReplaceNulls(Items=keysearch, Replacements="0")  # -> Items, Count
nullrep_2 = ReplaceNulls(Items=num, Replacements=0)  # -> Items, Count
nullrep_3 = ReplaceNulls(Items=keysearch_2, Replacements="-1")  # -> Items, Count
nullrep_4 = ReplaceNulls(Items=num_2, Replacements=0)  # -> Items, Count
nullrep_5 = ReplaceNulls(Items=num_3, Replacements=0)  # -> Items, Count
panel_23 = Panel(addition_2)

# ---- group: Color Space Calibration / all ref colors
col_17 = Colour(col_10)  # disabled

# ----
split_3 = TextSplit(Text=txt_6)
panel_24 = Panel("""2
1
1
1
1
1""")
addition_5 = Addition(A=addition_3, B=1)
pshift_15 = ShiftPaths(Data=nullrep_2.Items, Offset=-1)
item_5 = ListItem(List=pshift_15, Index=2, Wrap=False)
item_6 = ListItem(List=pshift_15, Index=3, Wrap=False)
item_7 = ListItem(List=pshift_15, Index=0, Wrap=False)
item_8 = ListItem(List=pshift_15, Index=1, Wrap=False)
item_9 = ListItem(List=pshift_15, Index=4, Wrap=False)

# ---- group: max id
int_18 = Integer("6")

# ----
pshift_16 = ShiftPaths(Data=nullrep_3.Items, Offset=-1)

# ---- group: slider1
num_4 = Number(nullrep_4.Items)

# ---- group: 3LevelSlider3
num_5 = Number(item_5)

# ---- group: slider2
num_6 = Number(nullrep_5.Items)

# ---- group: 3LevelSlider1
num_7 = Number(item_7)

# ---- group: 3LevelSlider2
num_8 = Number(item_8)

# ---- group: 3LevelSlider4
num_9 = Number(item_6)

# ---- group: 3LevelSlider5
num_10 = Number(item_9)

# ----
# Closest Color Code
cp_6 = ClosestPoint(Point=col_16, Cloud=col_15)  # -> ClosestPoint, CPIndex, Distance
item_10 = ListItem(List=col_15, Index=cp_6.CPIndex, Wrap=False)
pshift_17 = ShiftPaths(Data=nullrep.Items, Offset=-1)
set1_2 = Integer(panel_4)

# ---- group: slider1
num_11 = Number(num_4)

# ----
set2_2 = Integer(panel_5)

# ---- group: set number
integer = Integer(panel_23)

# ---- group: Color Space Calibration / all ref colors
col_18 = Colour(col_7)  # disabled

# ----
cull = CullPattern(List=split_3, CullPattern=[True, False])
join_2 = TextJoin(Text=cull, Join=",")
split_4 = TextSplit(Text=join_2, Separators=",")

# ---- group: Color Space Calibration / all ref colors
col_19 = Colour(col_9)  # disabled

# ---- group: max id
int_19 = Integer("6")

# ----
panel_25 = Panel("""1
1
1
1
1
1""")

# ---- group: all sample color
col_20 = Colour(sample_6.SampledImageData_2)  # disabled

# ---- group: Color Space Calibration / all ref colors
col_21 = Colour(col_8)  # disabled

# ---- group: all ref colors
col_22 = Colour(col_15)  # disabled

# ----
item_11 = ListItem(List=int_7, Index=cp_6.CPIndex, Wrap=False)
pshift_18 = ShiftPaths(Data=split_4, Offset=-2)

# ---- group: all piece ids raw
int_20 = Integer(pshift_18)

# ----
limitmaxid = LimitMaxID(int_2=int_20, int=int_19)
panel_26 = Panel("""10
10
10
10
10
10""")

# ---- group: dock id
int_21 = Integer(pshift_16)

# ---- group: dock rotation
int_22 = Integer(pshift_17)

# ---- group: Color Space Calibration / all ref colors
col_23 = Colour(col_19)  # disabled

# ---- group: color code of each smaple pt
int_23 = Integer(item_11)

# ----
panel_27 = Panel("""15
15
15
15
15
15""")

# ---- group: sample pts
item_12 = ListItem(List=pt_24, Index=addition_3, Wrap=False)
item_13 = ListItem(List=pt_24, Index=pshift_14, Wrap=False)
item_14 = ListItem(List=pt_24, Index=addition_5, Wrap=False)
item_15 = ListItem(List=pt_24, Index=addition_4, Wrap=False)

# ---- group: module id (manual)
# Grid Base Data
int_24 = Integer(limitmaxid)

int_25 = Integer(int_24)

# ----
graft_2 = GraftTree(Tree=int_25, IncludeEmptyLists=True, IncludeNullItems=True)
panel_28 = Panel(int_24)
repeat_2 = RepeatData(Data=Slider(0, range=0..360), Length=256)
panel_29 = Panel("""30
30
30
30
30
30""")

# ---- group: all 0
pshift_19 = ShiftPaths(Data=repeat_2, Offset=-1)

# ----
panel_30 = Panel("""29
30
30
30
30
30""")

# ---- group: x
int_26 = Integer([0, 1, 2, 3, 4, 5, 6, 7, 8, 9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])

# ---- group: y
int_27 = Integer([0, 0, 0, 0, 0, 0, 0, 0, 0, 0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])

# ---- group: rotation
int_28 = Integer(pshift_19)

# ----
panel_31 = Panel(int_26)
panel_32 = Panel(int_27)
panel_33 = Panel(int_28)

# ---- group: color codes
item_16 = ListItem(List=int_23, Index=pshift_14, Wrap=False)
item_17 = ListItem(List=int_23, Index=addition_3, Wrap=False)
item_18 = ListItem(List=int_23, Index=addition_5, Wrap=False)
item_19 = ListItem(List=int_23, Index=addition_4, Wrap=False)

# ----
# Densities
# Initial
panel_34 = Panel("""10
25
5
15
5
5""")
slider2 = Slider(0.79, range=0..1)
slider2_2 = Slider(0, range=0..1)
nullrep_6 = ReplaceNulls(Items=int_22, Replacements=0)  # -> Items, Count
nullrep_7 = ReplaceNulls(Items=bool, Replacements=False)  # -> Items, Count

# ---- group: 3LevelSlider5
num_12 = Number(num_10)

# ---- group: 3LevelSlider4
num_13 = Number(num_9)

# ---- group: 3LevelSlider3
num_14 = Number(num_5)

# ---- group: 3LevelSlider1
num_15 = Number(num_7)

# ---- group: 3LevelSlider2
num_16 = Number(num_8)

# ----
merge_8 = Merge(Data1=graft(item_16), Data2=graft(item_17), Data3=graft(item_18), Data4=graft(item_19))

# ---- group: color code quarts
int_29 = Integer(merge_8)

# ----
rev_2 = ReverseList(List=int_29)
txt_7 = Text(rev_2)
join_3 = TextJoin(Text=txt_7, Join=",")
pshift_20 = ShiftPaths(Data=join_3, Offset=-1)

# ---- group: color code quart texts data
txt_8 = Text(pshift_20)

# ----
panel_35 = Panel(txt_8)
keysearch_3 = KeyValueSearch(Keys=txt_2, Values=panel_12, Search=graft(txt_8))
nullrep_8 = ReplaceNulls(Items=keysearch_3, Replacements="0")  # -> Items, Count
keysearch_4 = KeyValueSearch(Keys=txt_2, Values=int_16, Search=graft(txt_8))
pshift_21 = ShiftPaths(Data=nullrep_8.Items, Offset=-1)
nullrep_9 = ReplaceNulls(Items=keysearch_4, Replacements="-1")  # -> Items, Count
pshift_22 = ShiftPaths(Data=pshift_21, Offset=-1)
pshift_23 = ShiftPaths(Data=nullrep_9.Items, Offset=-1)
pshift_24 = ShiftPaths(Data=pshift_23, Offset=-1)

# ---- group: all rotation data
int_30 = Integer(pshift_22)

# ---- group: all piece ids raw
int_31 = Integer(pshift_24)

# ----
limitmaxid_2 = LimitMaxID(int_2=int_31, int=int_18)

# ---- group: all piece ids
int_32 = Integer(limitmaxid_2)

# ---- group: rotation
int_33 = Integer(int_30)

# ----
panel_36 = Panel(int_32)

# ---- group: module id (CV)
int_34 = Integer(int_32)

int_35 = Integer(int_34)

# ----
graft_3 = GraftTree(Tree=int_35, IncludeEmptyLists=True, IncludeNullItems=True)
merge_9 = Merge(Data1=graft_3, Data2=graft_2)
item_20 = ListItem(List=merge_9, Index=graft, Wrap=False)
pshift_25 = ShiftPaths(Data=item_20, Offset=-1)

# ---- group: module id (CV partial masked to manual)
# Building Heights
int_36 = Integer(pshift_25)

# ----
panel_37 = Panel(int_34)
panel_38 = Panel("0")
nullrep_10 = ReplaceNulls(Items=int_21, Replacements=-1)  # -> Items, Count

# ---- group: dock rotation
int_37 = Integer(nullrep_6.Items)

# ----
nullrep_11 = ReplaceNulls(Items=num_4, Replacements=0)  # -> Items, Count
nullrep_12 = ReplaceNulls(Items=num_6, Replacements=0)  # -> Items, Count
# CityMatrix
# 
# "Ryan" Yan Zhang <ryanz@mit.edu>
# MIT Media Lab, Changing Place Group
# September. 2016
# Densities
# Running
panel_39 = Panel("""30
1
1
1
1
1""")

# ---- group: module id (CV partial masked to manual)
int_38 = Integer(int_36)

# ---- group: module id (manual)
int_39 = Integer(int_24)

# ---- group: module id (CV)
int_40 = Integer(int_34)

# ---- group: toggle1
bool_2 = Boolean(nullrep_7.Items)

# ---- group: temp overide
panel_40 = Panel("1.0")

# ---- group: dockID
int_41 = Integer(nullrep_10.Items)

# ---- group: slider1
num_17 = Number(nullrep_11.Items)

# ---- group: slider2
num_18 = Number(nullrep_12.Items)

# ----
filter = StreamFilter(Gate=list, Stream0="1.0", Stream1=num_12)
filter_2 = StreamFilter(Gate=list, Stream0="1.0", Stream1=num_13)
filter_3 = StreamFilter(Gate=list, Stream0="1.0", Stream1=num_14)
filter_4 = StreamFilter(Gate=list, Stream0="1.0", Stream1=num_16)
filter_5 = StreamFilter(Gate=list, Stream0="1.0", Stream1=num_15)
filter_6 = StreamFilter(Gate=list, Stream0=Toggle(True), Stream1=bool_2)
filter_7 = StreamFilter(Gate=list, Stream0=slider2_2, Stream1=num_17)
filter_8 = StreamFilter(Gate=list, Stream0="-1", Stream1=int_41)
filter_9 = StreamFilter(Gate=list, Stream0=slider2, Stream1=num_18)
filter_10 = StreamFilter(Gate=list, Stream0=int_39, Stream1=int_38)

# ---- group: gridExtent_x
int_42 = Integer(int_10)

# ---- group: gridExtent_y
int_43 = Integer(int_8)

# ---- group: module id
int_44 = Integer(filter_10)

# ---- group: x
int_45 = Integer(int_26)

# ---- group: y
int_46 = Integer(int_27)

# ---- group: rotation
int_47 = Integer(int_28)

# ---- group: slider1
num_19 = Number(filter_7)

# ---- group: slider2
num_20 = Number(filter_9)

# ---- group: dockID
int_48 = Integer(filter_8)

int_49 = Integer(int_48)

# ----
record_density_slider_set = RecordDensitySliderSet(int=int_49, num=num_11, integer=integer, set1=set1_2, set2=set2_2)

# ---- group: floor num for each type
int_50 = Integer(record_density_slider_set)

# ----
panel_41 = Panel(int_50)

nullrep_13 = ReplaceNulls(Items=int_50, Replacements=1)  # -> Items, Count

# ---- group: dock rotation
int_51 = Integer(int_37)

# ---- group: toggle1
bool_3 = Boolean(panel_40)

# ---- group: floor num for each type
int_52 = Integer(nullrep_13.Items)

# ---- group: 3LevelSlider3
num_21 = Number(panel_40)

# ---- group: 3LevelSlider4
num_22 = Number(panel_40)

# ---- group: 3LevelSlider1
num_23 = Number(panel_40)

# ---- group: 3LevelSlider2
num_24 = Number(panel_40)

# ---- group: 3LevelSlider5
num_25 = Number(panel_40)

# ----
_3levelsliderstoweights_py = PythonScript(s0=num_23, s1=num_24, s2=num_21, s3=num_22, s4=num_25)  # -> out, weights
# ---------- _3levelsliderstoweights_py: Python ----------
if s0==0.0 and s1==0.0 and s2==0.0 and s3==0.0 and s4==0.0:
    weights = [0.0, 0.0, 0.0, 0.0, 0.0]
else:
    ts = [s0, s1, s2, s3, s4]
    tTotal = 0.0
    for t in ts:
        tTotal = tTotal + t
    print 'tTotal = ' + str(tTotal)
    weights = list(map(lambda x: x/tTotal, ts))
    print 'weights = ' + str(weights)
# ---------- end _3levelsliderstoweights_py ----------
remap = RemapNumbers(Value=num_20, Source=Domain(0, 1), Target="-0.25 To 5.00")  # -> Mapped, Clipped
togglestoweights_py = PythonScript()  # -> out, a, weights; disabled
# ---------- togglestoweights_py: Python ----------
if not bool0 and not bool1 and not bool2 and not bool3 and not bool4:
    weights = [0.0, 0.0, 0.0, 0.0, 0.0]
else:
    bools = [bool0, bool1, bool2, bool3, bool4]
    ts = list(map(lambda x: float(x), bools))
    tTotal = 0.0
    for t in ts:
        tTotal = tTotal + t
    print 'tTotal = ' + str(tTotal)
    weights = list(map(lambda x: x/tTotal, ts))
    print 'weights = ' + str(weights)
# ---------- end togglestoweights_py ----------

# ---- group: viz ctrl - slider
int_53 = Integer(remap.Mapped)

# ----
panel_42 = Panel(int_53)
pshift_26 = ShiftPaths(Data=_3levelsliderstoweights_py.weights, Offset=-1)

# ---- group: AI weights
num_26 = Number(pshift_26)

# ----
panel_43 = Panel(num_26)

# ---- group: Toggle 1
# AI Step Control
bool_4 = Boolean(bool_3)

# ---- group: module id
int_54 = Integer(int_44)

# ---- group: works, no memory leak
initsticky_py = PythonScript()  # -> out, a
# ---------- initsticky_py: Python ----------
import scriptcontext as sc
import time

sc.sticky["count"] = -1
sc.sticky["bool"] = False

print(time.time())
sc.sticky["prevTime"] = time.time()


a = True
# ---------- end initsticky_py ----------
stickycount_py = PythonScript(x=bool_4, push=pushtempstep, tempStep=aisteptest, initiated=initsticky_py.a)  # -> out, a; inputs push: Boolean, tempStep: Int32
# ---------- stickycount_py: Python ----------
import scriptcontext as sc
import time

if initiated and not x == sc.sticky["bool"] :
    if time.time() - sc.sticky["prevTime"] >= 0.5 :
        sc.sticky["count"] = sc.sticky["count"] + 1
    sc.sticky["prevTime"] = time.time()

if push:
    print(push)
    sc.sticky["count"] = tempStep

sc.sticky["bool"] = x

print(sc.sticky["count"])
print(sc.sticky["prevTime"])
print(sc.sticky["bool"])
print(time.time())

a = sc.sticky["count"]
# ---------- end stickycount_py ----------

# ---- group: shrink
cell_shrink = Slider(0.98, range=0.75..1)  # disabled

# ---- group: gridExtent_x
int_55 = Integer(int_42)  # disabled

# ---- group: rotation
int_56 = Integer(int_47)  # disabled

# ---- group: shrink
num_27 = Number(cell_shrink)  # disabled

# ---- group: gridExtent_y
int_57 = Integer(int_43)  # disabled

# ---- group: module id
int_58 = Integer(int_44)  # disabled

# ---- group: y
int_59 = Integer(int_46)  # disabled

# ---- group: x
int_60 = Integer(int_45)  # disabled

# ---- group: floor num for each type
int_61 = Integer(int_52)  # disabled

# ---- group: colortizer orgin
# Initial Solar Sim (DIVA)
pt_31 = Point(<point referenced from the Rhino model>)  # disabled

# ---- group: table size ref pt
pt_32 = Point(<point referenced from the Rhino model>)  # disabled

# ---- group: floor num for each type
int_62 = Integer(int_52)

# ----
min = Minimum(A=stickycount_py.a, B="24")
equals_2 = Equality(FirstNumber=int_54, SecondNumber="0")  # -> Equality, Inequality
equals_3 = Equality(FirstNumber=int_54, SecondNumber="1")  # -> Equality, Inequality
equals_4 = Equality(FirstNumber=int_54, SecondNumber="3")  # -> Equality, Inequality
equals_5 = Equality(FirstNumber=int_54, SecondNumber="2")  # -> Equality, Inequality
equals_6 = Equality(FirstNumber=int_54, SecondNumber="4")  # -> Equality, Inequality
equals_7 = Equality(FirstNumber=int_54, SecondNumber="5")  # -> Equality, Inequality
# Dashboard
number_slider_3 = Slider(0.4, range=0..1)
item_21 = ListItem(List=int_62, Index="0", Wrap=False)
item_22 = ListItem(List=int_62, Index="2", Wrap=False)
item_23 = ListItem(List=int_62, Index="1", Wrap=False)
item_24 = ListItem(List=int_62, Index="3", Wrap=False)

# ---- group: AI Step (manual)
int_63 = Integer(aisteptest)

# ----
panel_44 = Panel(int_63)
item_25 = ListItem(List=int_62, Index="4", Wrap=False)
item_26 = ListItem(List=int_62, Index="5", Wrap=False)

# ---- group: AI Step (CV)
int_64 = Integer(min)

# ----
panel_45 = Panel(int_64)

# ---- group: AI Step (manual)
aisteptest_2 = Slider(20, range=-1..24)

# ----
int_65 = Integer(equals_2.Equality)
int_66 = Integer(equals_3.Equality)
int_67 = Integer(equals_4.Equality)
int_68 = Integer(equals_5.Equality)

# ---- group: cell area
sqr = Square(Value=62.5)

# ----
int_69 = Integer(equals_6.Equality)
int_70 = Integer(equals_7.Equality)
filter_11 = StreamFilter(Gate=list, Stream0=int_63, Stream1=int_64)
ma_7 = MassAddition(Input=int_65)  # -> Result, PartialResults
ma_8 = MassAddition(Input=int_66)  # -> Result, PartialResults
ma_9 = MassAddition(Input=int_67)  # -> Result, PartialResults
ma_10 = MassAddition(Input=int_68)  # -> Result, PartialResults
ma_11 = MassAddition(Input=int_69)  # -> Result, PartialResults

# ---- group: building id 0 fl #
int_71 = Integer(item_21)

# ---- group: building id 2 fl #
int_72 = Integer(item_22)

# ---- group: building id 1 fl #
int_73 = Integer(item_23)

# ----
ma_12 = MassAddition(Input=int_70)  # -> Result, PartialResults

# ---- group: building id 3 fl #
int_74 = Integer(item_24)

# ---- group: building id 4 fl #
int_75 = Integer(item_25)

# ---- group: building id 5 fl #
int_76 = Integer(item_26)

# ----
multiplication_9 = Multiplication(A=sqr, B=number_slider_3)
int_77 = Integer(ma_7.Result)
panel_46 = Panel(int_77)
int_78 = Integer(ma_8.Result)
panel_47 = Panel(int_78)
int_79 = Integer(ma_9.Result)
panel_48 = Panel(int_79)
int_80 = Integer(ma_10.Result)
panel_49 = Panel(int_80)
int_81 = Integer(ma_11.Result)
panel_50 = Panel(int_81)
int_82 = Integer(ma_12.Result)
panel_51 = Panel(int_82)

# ---- group: AI Step
int_83 = Integer(filter_11)

# ----
panel_52 = Panel(int_83)

# ---- group: floor area
num_28 = Number(multiplication_9)

# ----
panel_53 = Panel("7003")  # disabled
panel_54 = Panel("127.0.0.1")  # disabled

# ---- group: Micro-unit Building #
int_84 = Integer(int_80)

# ---- group: Luxury Building #
int_85 = Integer(int_77)

# ---- group: Regular residential Building #
int_86 = Integer(int_78)

# ---- group: Head Quater Building #
int_87 = Integer(int_79)

# ---- group: Regular Office Building #
int_88 = Integer(int_81)

# ---- group: Co-working Building #
int_89 = Integer(int_82)

# ---- group: parking cell #
parking_cell = Slider(0, range=0..50)

# ----
txt_9 = Text(int_83)  # disabled

# ---- group: UDP Send to Unity AI
udp = UDPSender(Address=panel_54, Port=panel_53, Pattern=0, Data=txt_9)  # disabled

# ---- group: ppl per flr
panel_55 = Panel("18")
panel_56 = Panel("28")
panel_57 = Panel("63")
panel_58 = Panel("52")
panel_59 = Panel("87")
panel_60 = Panel("156")

# ---- group: park cell #
park_cell = Slider(150, range=0..150)

# ----
merge_10 = Merge(Data1=panel_55, Data2=panel_56, Data3=panel_57, Data4=panel_58, Data5=panel_59, Data6=panel_60)

# ---- group: how many floors in total
multiplication_10 = Multiplication(A=int_75, B=int_88)
multiplication_11 = Multiplication(A=int_73, B=int_86)
multiplication_12 = Multiplication(A=int_76, B=int_89)
multiplication_13 = Multiplication(A=int_72, B=int_84)
multiplication_14 = Multiplication(A=int_74, B=int_87)
multiplication_15 = Multiplication(A=int_71, B=int_85)

# ----
multiplication_16 = Multiplication(A=panel_59, B=multiplication_10)
multiplication_17 = Multiplication(A=panel_56, B=multiplication_11)
multiplication_18 = Multiplication(A=panel_57, B=multiplication_13)
multiplication_19 = Multiplication(A=panel_60, B=multiplication_12)
multiplication_20 = Multiplication(A=panel_58, B=multiplication_14)
multiplication_21 = Multiplication(A=panel_55, B=multiplication_15)

# ---- group: # ppl per flr
num_29 = Number(merge_10)

# ----
panel_61 = Panel("0.0 To 400000.0")  # disabled

# ---- group: Regular Office ppl #
int_90 = Integer(multiplication_16)

# ---- group: Head Quater ppl #
int_91 = Integer(multiplication_20)

# ---- group: Co-working ppl #
int_92 = Integer(multiplication_19)

# ---- group: Micro-unit ppl #
int_93 = Integer(multiplication_18)

# ---- group: Luxury ppl #
int_94 = Integer(multiplication_21)

# ---- group: Regular residential ppl #
int_95 = Integer(multiplication_17)

# ----
ma_13 = MassAddition(Input=[int_92, int_90, int_91])  # -> Result, PartialResults
ma_14 = MassAddition(Input=[int_93, int_95, int_94])  # -> Result, PartialResults

# ---- group: gridExtent_x
int_96 = Integer(int_42)

# ----
subtraction = Subtraction(A=int_96, B=1)
int_97 = Integer(int_45)

# ---- group: total working ppl #
int_98 = Integer(ma_13.Result)

# ---- group: total residential ppl #
int_99 = Integer(ma_14.Result)

# ----
u_div = Slider(7, range=0..10)  # disabled
v_div = Slider(7, range=0..10)  # disabled

# ---- group: AI Step
int_100 = Integer(int_83)

# ----
panel_62 = Panel(int_100)

# ---- group: start flag
bool_5 = Boolean(startflag)

# ---- group: AI weights
num_30 = Number(num_26)

# ----
panel_63 = Panel(num_30)
subtraction_2 = Subtraction(A=subtraction, B=int_97)
# Send to Python Server (json, UDP)
panel_64 = Panel("{\"grid\":[")
int_101 = Integer()
addition_6 = Addition(A=int_99, B=int_98)

# ---- group: total ppl #
int_102 = Integer(addition_6)  # disabled

# ----
remap_2 = RemapNumbers(Value=int_102, Source=panel_61, Target=Domain(0, 1))  # -> Mapped, Clipped; disabled
max = Maximum(A=remap_2.Mapped, B=0)  # disabled
min_2 = Minimum(A=max, B=1)  # disabled

# ---- group: DensityScore
num_31 = Number(min_2)  # disabled

# ----
int_103 = Integer()
panel_65 = Panel("\"IDMax\":15,\"pop_young\":0,\"pop_mid\":0,\"pop_old\":0,\"AIMov\":[\"CELL\",0,0,0],\"animBlink\":0,\"score\":0.0,")
int_104 = Integer(int_48)
item_27 = ListItem(List=num_30, Index=0, Wrap=False)
txt_10 = Text(int_44)
txt_11 = Text(int_97)
txt_12 = Text(int_46)
txt_13 = Text(int_47)
txt_14 = Text(num_19)
int_105 = Integer()
int_106 = Integer()
int_107 = Integer()
int_108 = Integer(int_51)
int_109 = Integer(int_52)
int_110 = Integer(int_100)
int_111 = Integer(bool_5)
panel_66 = Panel("\"DensityScore\":")  # disabled
int_112 = Integer(bool_3)
txt_15 = Text(num_20)
num_32 = Number(num_31)  # disabled
txt_16 = Text(int_101)
txt_17 = Text(int_103)
txt_18 = Text(int_104)
txt_19 = Text(int_108)
txt_20 = Text(int_109)
txt_21 = Text(int_110)
txt_22 = Text(int_107)
txt_23 = Text(int_111)
txt_24 = Text(num_32)  # disabled
txt_25 = Text(int_106)
txt_26 = Text(int_105)
txt_27 = Text(int_112)
item_28 = ListItem(List=num_30, Index=1, Wrap=False)
join_4 = TextJoin(Text=txt_20, Join=",")

# ---- group: total ppl #
int_113 = Integer(addition_6)

# ----
lng_5 = ListLength(List=txt_10)
repeat_3 = RepeatData(Data=",\"rot\":", Length=lng_5)
repeat_4 = RepeatData(Data=",\"data\":{\"traffic\":0,\"wait\":0,\"solar\":", Length=lng_5)
repeat_5 = RepeatData(Data="}", Length=lng_5)
repeat_6 = RepeatData(Data="}", Length=lng_5)
repeat_7 = RepeatData(Data=",\"y\":", Length=lng_5)
repeat_8 = RepeatData(Data=",\"x\":", Length=lng_5)
repeat_9 = RepeatData(Data="{\"type\":", Length=lng_5)
join_5 = TextJoin(Text=["\"dockID\":", txt_18, ","])
join_6 = TextJoin(Text=["\"toggle5\":", txt_16, ","])
join_7 = TextJoin(Text=["\"toggle6\":", txt_17, ","])
join_8 = TextJoin(Text=["\"AIStep\":", txt_21, ","])
item_29 = ListItem(List=num_30, Index=2, Wrap=False)
join_9 = TextJoin(Text=["\"toggle4\":", txt_22, ","])
join_10 = TextJoin(Text=["\"toggle2\":", txt_25, ","])
join_11 = TextJoin(Text=["\"toggle3\":", txt_26, ","])
join_12 = TextJoin(Text=["\"slider1\":", txt_14, ","])
join_13 = TextJoin(Text=["\"slider2\":", txt_15, ","])
join_14 = TextJoin(Text=["\"toggle1\":", txt_27, ","])
pshift_27 = ShiftPaths(Data=repeat_3, Offset=-1)
pshift_28 = ShiftPaths(Data=repeat_4, Offset=-1)
pshift_29 = ShiftPaths(Data=repeat_6, Offset=-1)
pshift_30 = ShiftPaths(Data=repeat_5, Offset=-1)
pshift_31 = ShiftPaths(Data=repeat_8, Offset=-1)
pshift_32 = ShiftPaths(Data=repeat_7, Offset=-1)
pshift_33 = ShiftPaths(Data=repeat_9, Offset=-1)
join_15 = TextJoin(Text=["\"dockRotation\":", txt_19, ","])
join_16 = TextJoin(Text=["\"densities\":[", join_4, "],"])
join_17 = TextJoin(Text=["\"startFlag\":", txt_23, ","])
join_18 = TextJoin(Text=[panel_66, txt_24])  # disabled
panel_67 = Panel(int_113)
item_30 = ListItem(List=num_30, Index=3, Wrap=False)
item_31 = ListItem(List=num_30, Index=4, Wrap=False)
join_19 = TextJoin(Text=["\"metrics\": {\"density\":{\"weight\":", item_27, ",\"metric\": 0.0},\"diversity\":{\"weight\":", item_28, ",\"metric\":0.0},\"energy\":{\"weight\":", item_29, ",\"metric\":0.0},\"traffic\":{\"weight\":", item_30, ",\"metric\":0.0},\"solar\":{\"weight\":", item_31, ",\"metric\": 0.0}}"])
num_33 = Number(num_30)
panel_68 = Panel("\"IDMax\":15,\"pop_young\":0,\"pop_mid\":0,\"pop_old\":0,\"AIMov\":[\"CELL\",0,0,0],\"animBlink\":0,\"scores\":{\"density\":0,\"diversity\":0,\"energy\":0,\"traffic\":0,\"solar\":0}")
txt_28 = Text(num_33)
join_20 = TextJoin(Text=txt_28, Join=",")
join_21 = TextJoin(Text=["\"AIWeights\":[", join_20, "],"])

# ---- group: 49
multiplication_22 = Multiplication(A=u_div, B=v_div)  # disabled

# ---- group: 256
multiplication_23 = Multiplication(A=int_55, B=int_57)  # disabled

# ---- group: glass
brep = Brep()  # disabled

# ---- group: ground
brep_2 = Brep()  # disabled

# ---- group: can not be button!
toggle = BooleanToggle(False)  # disabled

# ---- group: 0 to 255
series_4 = Series(Start=0, Step=1, Count=multiplication_23)  # disabled

# ---- group: 0 to 48
series_5 = Series(Start=0, Step=1, Count=multiplication_22)  # disabled

# ---- group: sim result
num_34 = Number([1017, 1059, 1100, 1073, 1101, 1129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])  # disabled

num_35 = Number(num_34)  # disabled

# ----
panel_69 = Panel("api/table/update/citymatrix")  # disabled
panel_70 = Panel("https://cityio.media.mit.edu")  # disabled

# ---- group: internalised sim result - averaged on each roof
num_36 = Number([1389.102041, 1357.55102, 1380.816327, 1402.122449, 1371.571429, 1370.877551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])

# ---- group: sim result - averaged on each roof
num_37 = Number(num_36)

# ----
int_114 = Integer(num_37)
txt_29 = Text(int_114)
merge_11 = Merge(
    Data1=graft(pshift_33),
    Data2=graft(txt_10),
    Data3=graft(pshift_31),
    Data4=graft(txt_11),
    Data5=graft(pshift_32),
    Data6=graft(txt_12),
    Data7=graft(pshift_27),
    Data8=graft(txt_13),
    Data9=graft(pshift_28),
    Data10=graft(txt_29),
    Data11=graft(pshift_30),
    Data12=graft(pshift_29))
join_22 = TextJoin(Text=merge_11)
pshift_34 = ShiftPaths(Data=join_22, Offset=-1)
txt_30 = Text(pshift_34)
panel_71 = Panel(txt_30)
join_23 = TextJoin(Text=txt_30, Join=",")
txt_31 = Text(join_23)
merge_12 = Merge(
    Data1=panel_64,
    Data2=txt_31,
    Data3="],\"objects\":{",
    Data4=join_12,
    Data5=join_13,
    Data6=join_14,
    Data8=join_5,
    Data9=join_15,
    Data10=join_16,
    Data11=join_8,
    Data12=join_17,
    Data14=join_21,
    Data15=panel_65,
    Data16=join_19,
    Data18="}",
    Data19="}")
join_24 = TextJoin(Text=merge_12)

# ---- group: json data to send
txt_32 = Text(join_24)

# ----
panel_72 = Panel(txt_32)

# ---- group: bk firefly udp, not as good as gHowl, data size limit too small
panel_73 = Panel("7002")  # disabled
panel_74 = Panel("127.0.0.1")  # disabled
udp_sender = UDPSender(Data=txt_32, IPAddressOfUDPServer=panel_74, UDPPort=panel_73)  # disabled

# ---- group: send to another GH script
udp_2 = UDPSender(Address="127.0.0.1", Port="7000", Pattern=0, Data=txt_32)

# ---- group: json data to send
# Send to CityIO Server
# (json, internet, Yasushi)
txt_33 = Text(txt_32)  # disabled

# ----
dam = DataDam(DataA=txt_33, BufferDelay=10000000, BufferMode=2)  # disabled
send_table_data = PythonScript(url=panel_70, path=panel_69, jsonString=dam)  # -> out; disabled
# ---------- send_table_data: Python ----------
import System 
import System.Net 
import System.Uri
import System.IO
import System.Text.Encoding
import json


def postTable(url,stringData,debug=False):
    webclient = System.Net.WebClient()
    webclient.Headers['Content-type'] = 'text/plain'
    
    if debug:
        
        # simple validation before we send
        try:
            json.loads(stringData)
        except:
            print 'invalid string, revise your string data'
            return
        
        # this will block your process
        data = System.Text.Encoding.Default.GetBytes(stringData)
        webclient.UploadData(url,'POST',data)
        
    else:
        data = System.Text.Encoding.Default.GetBytes(stringData)
        webclient.UploadDataAsync(url,'POST',data)

endpoint = System.Uri('{}/{}'.format(url,path))



postTable(endpoint,jsonString,False)
# rhino crashes using async callbacks,
# so try the following if something is wrong
# postData(endpoint,jsonString,debug=True)
# ---------- end send_table_data ----------
panel_75 = Panel(send_table_data)  # disabled

# ---- group: Color Space Calibration
# Color Space Viz / Sliders and Toggles
number_slider_4 = Slider(500, range=0..1000)  # disabled
number_slider_5 = Slider(500, range=0..1000)  # disabled
number_slider_6 = Slider(500, range=0..1000)  # disabled
number_slider_7 = Slider(500, range=0..1000)  # disabled
mjoin = MeshJoin(Meshes=crv)  # disabled
mjoin_2 = MeshJoin(Meshes=crv_4)  # disabled
mjoin_3 = MeshJoin(Meshes=crv_5)  # disabled
mjoin_4 = MeshJoin(Meshes=crv_6)  # disabled
popgeo = PopulateGeometry(Geometry=mjoin, Count=number_slider_4, Seed=1)  # disabled
popgeo_2 = PopulateGeometry(Geometry=mjoin_2, Count=number_slider_5, Seed=1)  # disabled
popgeo_3 = PopulateGeometry(Geometry=mjoin_3, Count=number_slider_6, Seed=1)  # disabled
popgeo_4 = PopulateGeometry(Geometry=mjoin_4, Count=number_slider_7, Seed=1)  # disabled
sample_7 = BitmapSampler(BitmapToModify=bmp_2, PointToSample=popgeo, BitmapToModify_2=bmp_2, PointToSample_2=popgeo, bitmap_filter=0)  # -> SampledImageData, SampledImageData_2; disabled
sample_8 = BitmapSampler(BitmapToModify=bmp_3, PointToSample=popgeo_2, BitmapToModify_2=bmp_3, PointToSample_2=popgeo_2, bitmap_filter=0)  # -> SampledImageData, SampledImageData_2; disabled
sample_9 = BitmapSampler(BitmapToModify=bmp_4, PointToSample=popgeo_3, BitmapToModify_2=bmp_4, PointToSample_2=popgeo_3, bitmap_filter=0)  # -> SampledImageData, SampledImageData_2; disabled
sample_10 = BitmapSampler(BitmapToModify=bmp_5, PointToSample=popgeo_4, BitmapToModify_2=bmp_5, PointToSample_2=popgeo_4, bitmap_filter=0)  # -> SampledImageData, SampledImageData_2; disabled
argb = SplitARGB(Colour=col_23)  # -> Alpha, Red, Green, Blue; disabled
ahsv = SplitAHSV(Colour=col_23)  # -> Alpha, Hue, Saturation, Value; disabled
pt_33 = ConstructPoint(XCoordinate=argb.Red, YCoordinate=argb.Green, ZCoordinate=argb.Blue)  # disabled
pt_34 = ConstructPoint(XCoordinate=ahsv.Hue, YCoordinate=ahsv.Saturation, ZCoordinate=ahsv.Value)  # disabled
pt_35 = Point(col_23)  # disabled
sph = Sphere(Base=pt_34, Radius=0.05)  # disabled
sph_2 = Sphere(Base=pt_33, Radius=0.05)  # disabled
preview_7 = CustomPreview(Geometry=sph, Shader=col_23)  # disabled
preview_8 = CustomPreview(Geometry=sph_2, Shader=col_23)  # disabled
box = Box2Pt(PointA=Point(0, 0, 0), PointB=Point(1, 1, 1), Plane=PlaneXY(0, 0, 0))  # disabled
box_2 = Box2Pt(PointA=Point(0, 0, 0), PointB=Point(1, 1, 1), Plane=PlaneXY(0, 0, 0))  # disabled
voronoi³ = Voronoi3D(Points=pt_34, Box=box)  # -> Cells, Boundary; disabled
voronoi³_2 = Voronoi3D(Points=pt_33, Box=box_2)  # -> Cells, Boundary; disabled
brep_3 = Brep(voronoi³.Cells)  # disabled
brep_4 = Brep(voronoi³_2.Cells)  # disabled
range = Range(Domain=Domain(0, 1), Steps=10)  # disabled
graft_4 = GraftTree(Tree=range, IncludeEmptyLists=True, IncludeNullItems=True)  # disabled
pt_36 = ConstructPoint(XCoordinate=range, YCoordinate=graft_4, ZCoordinate=0)  # disabled
Z = UnitZ(Factor=range)  # disabled
pshift_35 = ShiftPaths(Data=pt_36, Offset=-1)  # disabled
graft_5 = GraftTree(Tree=Z, IncludeEmptyLists=True, IncludeNullItems=True)  # disabled
number_slider_8 = Slider(5, range=0..10)  # disabled
move = Move(Geometry=pshift_35, Motion=graft_5)  # -> Geometry, Transform; disabled
flip = FlipMatrix(Data=move.Geometry)  # disabled
item_32 = ListItem(List=flip, Index=number_slider_8, Wrap=False)  # disabled

# ---- group: Color Space Calibration / ref sample colors
col_24 = Colour(sample_7.SampledImageData_2)  # disabled

col_25 = Colour(sample_8.SampledImageData_2)  # disabled

col_26 = Colour(sample_9.SampledImageData_2)  # disabled

col_27 = Colour(sample_10.SampledImageData_2)  # disabled

# ---- group: Color Space Calibration / all sample color
col_28 = Colour(col_27)  # disabled

col_29 = Colour(col_24)  # disabled

col_30 = Colour(col_26)  # disabled

col_31 = Colour(col_25)  # disabled

col_32 = Colour(col_30)  # disabled

# ---- group: Color Space Calibration / color space pts - one plan
pt_37 = Point(item_32)  # disabled

# ---- group: Color Space Calibration / color space pts
pt_38 = Point(flip)  # disabled

# ---- group: Color Space Calibration / color space pts - showing
pt_39 = Point(pt_38)  # disabled

# ---- group: Color Space Calibration (continued)
argb_2 = SplitARGB(Colour=col_32)  # -> Alpha, Red, Green, Blue; disabled
ahsv_2 = SplitAHSV(Colour=col_32)  # -> Alpha, Hue, Saturation, Value; disabled
pt_40 = ConstructPoint(XCoordinate=argb_2.Red, YCoordinate=argb_2.Green, ZCoordinate=argb_2.Blue)  # disabled
pt_41 = ConstructPoint(XCoordinate=ahsv_2.Hue, YCoordinate=ahsv_2.Saturation, ZCoordinate=ahsv_2.Value)  # disabled
pt_42 = Point(col_32)  # disabled
preview_9 = CustomPreview(Geometry=pt_41, Shader=col_32)  # disabled
preview_10 = CustomPreview(Geometry=pt_40, Shader=col_32)  # disabled
pdecon_18 = Deconstruct(Point=pt_39)  # -> XComponent, YComponent, ZComponent; disabled
hsl = ColourHSL(Alpha=1, Hue=pdecon_18.XComponent, Saturation=pdecon_18.YComponent, Luminance=pdecon_18.ZComponent)  # disabled
frgb_15 = ColourRGBF(Alpha=1, Red=pdecon_18.XComponent, Green=pdecon_18.YComponent, Blue=pdecon_18.ZComponent)  # disabled
preview_11 = CustomPreview(Geometry=pt_39, Shader=hsl)  # disabled
pt_43 = Point(frgb_15)  # disabled
preview_12 = CustomPreview(Geometry=pt_39, Shader=frgb_15)  # disabled

# ---- group: Position Calibration
move_2 = Move(Geometry=mesh, Motion=Vector(0, 0, -0.1))  # -> Geometry, Transform
addition_7 = Addition(A=item_13, B=item_14)
division_8 = Division(A=addition_7, B=2)

# ---- group: Position Calibration / moved down 0.1
mesh_2 = Mesh(move_2.Geometry)

# ---- group: Position Calibration / quart mid pts
pt_44 = Point(division_8)

# ---- group: Position Calibration (continued)
tag = TextTag3D(Location=pt_44, Text=int_32, Size=0.01, Justification=5)

# ---- group: Position Calibration / disable when not calibrating CV
box_3 = CenterBox(Base=pt_24, X=0.003, Y=0.003, Z=0.003)

# ---- group: Position Calibration / disable when not calibrating CV / all sample boxes
box_4 = Box(box_3)

# ---- group: Position Calibration / disable when not calibrating CV (continued)
preview_13 = CustomPreview(Geometry=box_4, Shader=item_10)

# ----
# Color Space Viz / Grid
argb_3 = SplitARGB(Colour=col_20)  # -> Alpha, Red, Green, Blue; disabled
ahsv_3 = SplitAHSV(Colour=col_20)  # -> Alpha, Hue, Saturation, Value; disabled
argb_4 = SplitARGB(Colour=col_22)  # -> Alpha, Red, Green, Blue; disabled
ahsv_4 = SplitAHSV(Colour=col_22)  # -> Alpha, Hue, Saturation, Value; disabled
pt_45 = ConstructPoint(XCoordinate=argb_3.Red, YCoordinate=argb_3.Green, ZCoordinate=argb_3.Blue)  # disabled
pt_46 = ConstructPoint(XCoordinate=ahsv_3.Hue, YCoordinate=ahsv_3.Saturation, ZCoordinate=ahsv_3.Value)  # disabled
pt_47 = ConstructPoint(XCoordinate=argb_4.Red, YCoordinate=argb_4.Green, ZCoordinate=argb_4.Blue)  # disabled
pt_48 = ConstructPoint(XCoordinate=ahsv_4.Hue, YCoordinate=ahsv_4.Saturation, ZCoordinate=ahsv_4.Value)  # disabled
pt_49 = Point(col_20)  # disabled
pt_50 = Point(col_22)  # disabled
sph_3 = Sphere(Base=pt_48, Radius=0.05)  # disabled
sph_4 = Sphere(Base=pt_47, Radius=0.05)  # disabled
preview_14 = CustomPreview(Geometry=pt_46, Shader=col_20)  # disabled
preview_15 = CustomPreview(Geometry=pt_45, Shader=col_20)  # disabled
preview_16 = CustomPreview(Geometry=sph_3, Shader=col_22)  # disabled
preview_17 = CustomPreview(Geometry=sph_4, Shader=col_22)  # disabled
box_5 = Box2Pt(PointA=Point(0, 0, 0), PointB=Point(1, 1, 1), Plane=PlaneXY(0, 0, 0))  # disabled
box_6 = Box2Pt(PointA=Point(0, 0, 0), PointB=Point(1, 1, 1), Plane=PlaneXY(0, 0, 0))  # disabled
voronoi³_3 = Voronoi3D(Points=pt_48, Box=box_5)  # -> Cells, Boundary; disabled
voronoi³_4 = Voronoi3D(Points=pt_47, Box=box_6)  # -> Cells, Boundary; disabled
brep_5 = Brep(voronoi³_3.Cells)  # disabled
brep_6 = Brep(voronoi³_4.Cells)  # disabled
range_2 = Range(Domain=Domain(0, 1), Steps=10)  # disabled
graft_6 = GraftTree(Tree=range_2, IncludeEmptyLists=True, IncludeNullItems=True)  # disabled
pt_51 = ConstructPoint(XCoordinate=range_2, YCoordinate=graft_6, ZCoordinate=0)  # disabled
Z_2 = UnitZ(Factor=range_2)  # disabled
pshift_36 = ShiftPaths(Data=pt_51, Offset=-1)  # disabled
graft_7 = GraftTree(Tree=Z_2, IncludeEmptyLists=True, IncludeNullItems=True)  # disabled
number_slider_9 = Slider(5, range=0..10)  # disabled
move_3 = Move(Geometry=pshift_36, Motion=graft_7)  # -> Geometry, Transform; disabled
flip_2 = FlipMatrix(Data=move_3.Geometry)  # disabled
item_33 = ListItem(List=flip_2, Index=number_slider_9, Wrap=False)  # disabled

# ---- group: color space pts - one plan
pt_52 = Point(item_33)  # disabled

# ---- group: color space pts
pt_53 = Point(flip_2)  # disabled

# ---- group: color space pts - showing
pt_54 = Point(pt_53)  # disabled

# ----
pdecon_19 = Deconstruct(Point=pt_54)  # -> XComponent, YComponent, ZComponent; disabled
hsl_2 = ColourHSL(Alpha=1, Hue=pdecon_19.XComponent, Saturation=pdecon_19.YComponent, Luminance=pdecon_19.ZComponent)  # disabled
frgb_16 = ColourRGBF(Alpha=1, Red=pdecon_19.XComponent, Green=pdecon_19.YComponent, Blue=pdecon_19.ZComponent)  # disabled
preview_18 = CustomPreview(Geometry=pt_54, Shader=hsl_2)  # disabled
pt_55 = Point(frgb_16)  # disabled
preview_19 = CustomPreview(Geometry=pt_54, Shader=frgb_16)  # disabled

# ----
# Building Volumes
# Nodes
# DIVA Solar Radiation Analysis
# default: -ab 2 -ad 1000 -as 20 -ar 300 -aa 0.1
# low1: -ab 2 -ad 600 -as 12 -ar 200 -aa 0.1
# low2: -ab 2 -ad 450 -as 9 -ar 150 -aa 0.1
# low3: -ab 2 -ad 300 -as 6 -ar 100 -aa 0.1
panel_76 = Panel("0 To 30")  # disabled
panel_77 = Panel("0.1 To 80")  # disabled
panel_78 = Panel("0")  # disabled
merge_13 = Merge(Data1=int_61, Data2=panel_78)  # disabled
xy = XYPlane(Origin=pt_31)  # disabled
dist = Distance(PointA=pt_31, PointB=pt_32)  # disabled
txt_34 = Text(int_58)  # disabled
panel_79 = Panel("-1")  # disabled
panel_80 = Panel("6")  # disabled
replace = ReplaceMembers(Set=txt_34, Find=panel_79, Replace=panel_80)  # disabled
remap_3 = RemapNumbers(Value=merge_13, Source=panel_76, Target=panel_77)  # -> Mapped, Clipped; disabled
division_9 = Division(A=dist, B=int_55)  # disabled
nodes_offset_out = Slider(0.1, range=0..1)  # disabled
panel_81 = Panel("PROJECT_NAME")  # disabled
graft_8 = GraftTree(Tree=series_4, IncludeEmptyLists=True, IncludeNullItems=True)  # disabled
multiplication_24 = Multiplication(A=multiplication_22, B=graft_8)  # disabled
addition_8 = Addition(A=series_5, B=multiplication_24)  # disabled
bnd = Bounds(Numbers=num_34)  # disabled
panel_82 = Panel(bnd)  # disabled
remap_4 = RemapNumbers(Value=num_34, Source=bnd, Target=Domain(0, 1))  # -> Mapped, Clipped; disabled
gradient = Gradient(
    LowerLimit=0,
    UpperLimit=1,
    Parameter=remap_4.Mapped,
    stops=[0: RGB(0, 128, 0), 0.5: RGB(255, 255, 0), 1: RGB(255, 0, 0)])  # disabled

# ---- group: base cplane
pln = Plane(xy)  # disabled

# ---- group: road, blank replaced
int_115 = Integer(replace)  # disabled

# ---- group: building height for each type
num_38 = Number(remap_3.Mapped)  # disabled

# ---- group: cell size
num_39 = Number(division_9)  # disabled

# ---- group: grouped list ids
int_116 = Integer(addition_8)  # disabled

# ----
modulecenter = ModuleCenter(pt=pt_31, num=num_39, int_2=int_60, int=int_59)  # -> pt_5, transform_2; disabled
item_34 = ListItem(List=num_38, Index=int_115, Wrap=False)  # disabled
division_10 = Division(A=num_39, B=2)  # disabled
multiplication_25 = Multiplication(A=division_10, B=num_27)  # disabled
neg = Negative(Value=multiplication_25)  # disabled
dom = ConstructDomain(DomainStart=neg, DomainEnd=multiplication_25)  # disabled
item_35 = ListItem(List=num_35, Index=int_116, Wrap=False)  # disabled
ma_15 = MassAddition(Input=item_35)  # -> Result, PartialResults; disabled
division_11 = Division(A=ma_15.Result, B=multiplication_22)  # disabled
pshift_37 = ShiftPaths(Data=division_11, Offset=-2)  # disabled

# ---- group: module center
pt_56 = Point(modulecenter.pt_5)  # disabled

# ---- group: building heights
num_40 = Number(item_34)  # disabled

# ---- group: sim result - averaged on each roof
num_41 = Number(pshift_37)  # disabled

num_42 = Number(num_41)  # disabled

# ----
xy_2 = XYPlane(Origin=pt_56)  # disabled
dom_2 = ConstructDomain(DomainStart=0, DomainEnd=num_40)  # disabled
box_7 = DomainBox(Base=xy_2, X=dom, Y=dom, Z=dom_2)  # disabled
bnd_2 = Bounds(Numbers=num_41)  # disabled
panel_83 = Panel(bnd_2)  # disabled
remap_5 = RemapNumbers(Value=num_41, Source=bnd_2, Target=Domain(0, 1))  # -> Mapped, Clipped; disabled
gradient_2 = Gradient(
    LowerLimit=0,
    UpperLimit=1,
    Parameter=remap_5.Mapped,
    stops=[0: RGB(0, 128, 0), 0.5: RGB(255, 255, 0), 1: RGB(255, 0, 0)])  # disabled

# ---- group: Parsed Buidling Volumes
box_8 = Box(box_7)  # disabled

# ---- group: slab
brep_7 = Brep(box_8)  # disabled

# ----
removebreptoporbottom = RemoveBrepTopOrBottom(brep=box_8, bool=True)  # disabled

# ---- group: Roof Srfs
srf = Surface(removebreptoporbottom)  # disabled

# ---- group: node base srf
brep_8 = Brep(srf)  # disabled

# ----
item_36 = ListItem(List=brep_8, Index=Slider(18, range=0..255), Wrap=False)

# ---- group: result
preview_20 = CustomPreview(Geometry=srf, Shader=gradient_2)  # disabled

# ----
join_25 = BrepJoin(Breps=flatten(brep_8))  # -> Breps, Closed; disabled
srf_2 = Surface(reparameterize(flatten(brep_8)))  # disabled
mesh_3 = MeshBrep(
    Brep=join_25.Breps,
    Settings={GridMaxCount=0, GridMinCount=16, JaggedSeams=False, MaxEdgeLength=0, MinEdgeLength=0.0001, MinTolerance=0, Refine=True, RefineAngle=0, RelativeTolerance=0.65, SimplePlanes=True, Tolerance=0})  # disabled
mjoin_5 = MeshJoin(Meshes=mesh_3)  # disabled

# ---- group: glass srf
srf_3 = Surface(reparameterize(graft(srf_2)))  # disabled

# ----
divide_4 = DivideDomain²(Domain=srf_3, UCount=u_div, VCount=v_div)  # disabled
subsrf = Isotrim(Surface=srf_3, Domain=divide_4)  # disabled

# ---- group: result geo
srf_4 = Surface(reparameterize(flatten(subsrf)))  # disabled

# ----
evalsrf = EvaluateSurface(Surface=srf_4, Point=Point(0.5, 0.5, 0))  # -> Point, Normal, Frame; disabled
meshcp = MeshClosestPoint(Point=evalsrf.Point, Mesh=mjoin_5)  # -> Point, Index, Parameter; disabled
meval = MeshEval(Mesh=mjoin_5, Parameter=meshcp.Parameter)  # -> Point, Normal, Colour; disabled
amp = Amplitude(Vector=meval.Normal, Amplitude=nodes_offset_out)  # disabled
move_4 = Move(Geometry=evalsrf.Point, Motion=amp)  # -> Geometry, Transform; disabled

# ---- group: initial testing nodes
pt_57 = Point(move_4.Geometry)  # disabled

# ---- group: result
preview_21 = CustomPreview(Geometry=srf_4, Shader=gradient)  # disabled

# ==== cluster Perspective
int = ClusterInput()
int_2 = ClusterInput()
pt = ClusterInput()

# ---- group: grid extent y
int_3 = Integer(int)

# ---- group: grid extent x
int_4 = Integer(int_2)

# ---- group: Pts Sample Grid Corner
pt_2 = Point(pt)

# ----
subtraction = Subtraction(A=int_4, B=1)
subtraction_2 = Subtraction(A=int_3, B=1)
item = ListItem(List=pt_2, Index=0, Wrap=False)
item_2 = ListItem(List=pt_2, Index=1, Wrap=False)
item_3 = ListItem(List=pt_2, Index=2, Wrap=False)
item_4 = ListItem(List=pt_2, Index=3, Wrap=False)
pt_3 = Point(item_4)
pt_4 = Point(item)
ln = Line(StartPoint=pt_3, EndPoint=pt_4)
pt_5 = Point(item_2)
ln_2 = Line(StartPoint=pt_4, EndPoint=pt_5)
pt_6 = Point(item_3)
ln_3 = Line(StartPoint=pt_6, EndPoint=pt_3)
ln_4 = Line(StartPoint=pt_5, EndPoint=pt_6)
llx = LineLine(Line1=ln, Line2=ln_4)  # -> ParamA, ParamB, PointA, PointB
pt_7 = Point(llx.PointA)
llx_2 = LineLine(Line1=ln_2, Line2=ln_3)  # -> ParamA, ParamB, PointA, PointB
pt_8 = Point(llx_2.PointA)
vec2pt = Vector2Pt(PointA=pt_8, PointB=pt_7, Unitize=False)  # -> Vector, Length
line = LineSDL(Start=pt_3, Direction=vec2pt.Vector, Length=1)
llx_3 = LineLine(Line1=ln_2, Line2=line)  # -> ParamA, ParamB, PointA, PointB
pt_9 = Point(llx_3.PointA)
ln_5 = Line(StartPoint=pt_3, EndPoint=pt_9)
divide = DivideCurve(Curve=ln_5, Count=subtraction_2, Kinks=False)  # -> Points, Tangents, Parameters
ln_6 = Line(StartPoint=pt_8, EndPoint=divide.Points)
llx_4 = LineLine(Line1=ln_4, Line2=line)  # -> ParamA, ParamB, PointA, PointB
pt_10 = Point(llx_4.PointA)
ln_7 = Line(StartPoint=pt_3, EndPoint=pt_10)
divide_2 = DivideCurve(Curve=ln_7, Count=subtraction, Kinks=False)  # -> Points, Tangents, Parameters
ln_8 = Line(StartPoint=pt_7, EndPoint=divide_2.Points)
ln_9 = Line(StartPoint=pt_8, EndPoint=pt_7)

# ---- group: x
line_2 = Line(ln_8)

# ---- group: y
line_3 = Line(ln_6)

# ----
graft = GraftTree(Tree=ln_6, IncludeEmptyLists=True, IncludeNullItems=True)
llx_5 = LineLine(Line1=line_2, Line2=graft)  # -> ParamA, ParamB, PointA, PointB

# ---- group: keystoned grid pts
pt_11 = Point(llx_5.PointA)

# ----
pt_12 = ClusterOutput(pt_11)

# ==== cluster RemoveBrepTopOrBottom
brep = ClusterInput()
bool = ClusterInput()
brep_2 = Brep(brep)
bool_2 = Boolean(bool)
num = Number(bool_2)
debrep = DeconstructBrep(Brep=brep_2)  # -> Faces, Edges, Vertices
subtraction = Subtraction(A=num, B=0.5)
multiplication = Multiplication(A=subtraction, B=2)
Z = UnitZ(Factor=multiplication)
area = Area(Geometry=debrep.Faces)  # -> Area, Centroid
srf_cp = SurfaceClosestPoint(Point=area.Centroid, Surface=debrep.Faces)  # -> Point, UVPoint, Distance
evalsrf = EvaluateSurface(Surface=debrep.Faces, Point=srf_cp.UVPoint)  # -> Point, Normal, Frame
angle = Angle(VectorA=evalsrf.Normal, VectorB=Z)  # -> Angle, Reflex
equals = Equality(FirstNumber=angle.Angle, SecondNumber=0)  # -> Equality, Inequality
dispatch = Dispatch(List=debrep.Faces, DispatchPattern=equals.Inequality)  # -> ListA, ListB
srf = Surface(dispatch.ListA)
join = BrepJoin(Breps=srf)  # -> Breps, Closed
pshift = ShiftPaths(Data=join.Breps, Offset=-1)
brep_3 = Brep(pshift)
brep_4 = ClusterOutput(brep_3)

# ==== cluster ModuleCenter
pt = ClusterInput()
int = ClusterInput()
num = ClusterInput()
int_2 = ClusterInput()

# ---- group: y
int_3 = Integer(int)

# ---- group: cell size
num_2 = Number(num)

# ---- group: x
int_4 = Integer(int_2)

# ---- group: center
pt_2 = Point(pt)

# ----
pt_3 = ConstructPoint(XCoordinate=0, YCoordinate=0, ZCoordinate=0)  # disabled
addition = Addition(A=int_4, B=0.5)
vec2pt = Vector2Pt(PointA=pt_3, PointB=pt_2, Unitize=False)  # -> Vector, Length; disabled
addition_2 = Addition(A=int_3, B=0.5)
multiplication = Multiplication(A=addition, B=num_2)
move = Move(Motion=vec2pt.Vector)  # -> Geometry, Transform; disabled
lng = ListLength(List=int_4)  # disabled
multiplication_2 = Multiplication(A=addition_2, B=num_2)
X = UnitX(Factor=multiplication)
repeat = RepeatData(Data=move.Transform, Length=lng)  # disabled
neg = Negative(Value=multiplication_2)
move_2 = Move(Geometry=pt_2, Motion=X)  # -> Geometry, Transform
graft = GraftTree(Tree=move_2.Transform, IncludeEmptyLists=True, IncludeNullItems=True)  # disabled
Y = UnitY(Factor=neg)
pshift = ShiftPaths(Data=repeat, Offset=-1)  # disabled
move_3 = Move(Geometry=move_2.Geometry, Motion=Y)  # -> Geometry, Transform
graft_2 = GraftTree(Tree=move_3.Transform, IncludeEmptyLists=True, IncludeNullItems=True)  # disabled
comp = Compound(Transforms=[graft, graft_2])  # disabled
graft_3 = GraftTree(Tree=pshift, IncludeEmptyLists=True, IncludeNullItems=True)  # disabled
comp_2 = Compound(Transforms=[comp, graft_3])  # disabled

# ---- group: module center
pt_4 = Point(move_3.Geometry)

# ----
pshift_2 = ShiftPaths(Data=comp_2, Offset=-1)  # disabled
transform = Transform(pshift_2)  # disabled
pt_5 = ClusterOutput(pt_4)
transform_2 = ClusterOutput(transform)  # disabled

# ==== cluster RecordDensitySliderSet
num = ClusterInput()
int = ClusterInput()
set1 = ClusterInput()
integer = ClusterInput()
set2 = ClusterInput()

# ---- group: slider1
num_2 = Number(num)

# ---- group: dockID
int_2 = Integer(int)

# ---- group: set number
integer_2 = Integer(integer)

# ----
set1_2 = Integer(set1)
remap = RemapNumbers(Value=set1_2, Source="1 to 30", Target=Domain(0, 1))  # -> Mapped, Clipped
panel = Panel(remap.Mapped)
set2_2 = Integer(set2)
remap_2 = RemapNumbers(Value=set2_2, Source="1 to 30", Target=Domain(0, 1))  # -> Mapped, Clipped
panel_2 = Panel(remap_2.Mapped)
equals = Equality(FirstNumber=int_2, SecondNumber="5")  # -> Equality, Inequality
equals_2 = Equality(FirstNumber=int_2, SecondNumber="2")  # -> Equality, Inequality
equals_3 = Equality(FirstNumber=int_2, SecondNumber="3")  # -> Equality, Inequality
equals_4 = Equality(FirstNumber=int_2, SecondNumber="4")  # -> Equality, Inequality
equals_5 = Equality(FirstNumber=int_2, SecondNumber="0")  # -> Equality, Inequality
equals_6 = Equality(FirstNumber=int_2, SecondNumber="1")  # -> Equality, Inequality

# ---- group: density set 1
item = ListItem(List=panel, Index=0, Wrap=False)
item_2 = ListItem(List=panel, Index=2, Wrap=False)
item_3 = ListItem(List=panel, Index=1, Wrap=False)
item_4 = ListItem(List=panel, Index=3, Wrap=False)
item_5 = ListItem(List=panel, Index=4, Wrap=False)
item_6 = ListItem(List=panel, Index=5, Wrap=False)
panel_3 = Panel(item)
panel_4 = Panel(item_3)
panel_5 = Panel(item_2)
panel_6 = Panel(item_4)
panel_7 = Panel(item_5)
panel_8 = Panel(item_6)

# ---- group: density set 2
item_7 = ListItem(List=panel_2, Index=0, Wrap=False)
item_8 = ListItem(List=panel_2, Index=2, Wrap=False)
item_9 = ListItem(List=panel_2, Index=1, Wrap=False)
item_10 = ListItem(List=panel_2, Index=3, Wrap=False)
item_11 = ListItem(List=panel_2, Index=4, Wrap=False)
item_12 = ListItem(List=panel_2, Index=5, Wrap=False)
panel_9 = Panel(item_7)
panel_10 = Panel(item_9)
panel_11 = Panel(item_8)
panel_12 = Panel(item_10)
panel_13 = Panel(item_11)
panel_14 = Panel(item_12)

# ----
panel_15 = Panel(integer_2)
filter = StreamFilter(Gate=equals.Equality, Stream1=num_2)
filter_2 = StreamFilter(Gate=equals_2.Equality, Stream1=num_2)
filter_3 = StreamFilter(Gate=equals_3.Equality, Stream1=num_2)
filter_4 = StreamFilter(Gate=equals_4.Equality, Stream1=num_2)
filter_5 = StreamFilter(Gate=equals_5.Equality, Stream1=num_2)
filter_6 = StreamFilter(Gate=equals_6.Equality, Stream1=num_2)
filter_7 = StreamFilter(Gate=panel_15, Stream0=filter_5, Stream1=panel_3, Stream2=panel_9)
filter_8 = StreamFilter(Gate=panel_15, Stream0=filter, Stream1=panel_8, Stream2=panel_14)
filter_9 = StreamFilter(Gate=panel_15, Stream0=filter_2, Stream1=panel_5, Stream2=panel_11)
filter_10 = StreamFilter(Gate=panel_15, Stream0=filter_3, Stream1=panel_6, Stream2=panel_12)
filter_11 = StreamFilter(Gate=panel_15, Stream0=filter_4, Stream1=panel_7, Stream2=panel_13)
filter_12 = StreamFilter(Gate=panel_15, Stream0=filter_6, Stream1=panel_4, Stream2=panel_10)
rec = DataRecorder(filter_9, DataLimit=1, RecordData=True)
panel_16 = Panel(rec)
rec_2 = DataRecorder(filter_8, DataLimit=1, RecordData=True)
panel_17 = Panel(rec_2)
rec_3 = DataRecorder(filter_12, DataLimit=1, RecordData=True)
panel_18 = Panel(rec_3)
rec_4 = DataRecorder(filter_10, DataLimit=1, RecordData=True)
panel_19 = Panel(rec_4)
rec_5 = DataRecorder(filter_11, DataLimit=1, RecordData=True)
panel_20 = Panel(rec_5)
rec_6 = DataRecorder(filter_7, DataLimit=1, RecordData=True)
panel_21 = Panel(rec_6)
null = NullItem(Item=rec_2)  # -> NullFlags, InvalidFlags, Description
null_2 = NullItem(Item=rec)  # -> NullFlags, InvalidFlags, Description
null_3 = NullItem(Item=rec_4)  # -> NullFlags, InvalidFlags, Description
null_4 = NullItem(Item=rec_5)  # -> NullFlags, InvalidFlags, Description
null_5 = NullItem(Item=rec_6)  # -> NullFlags, InvalidFlags, Description
null_6 = NullItem(Item=rec_3)  # -> NullFlags, InvalidFlags, Description
filter_13 = StreamFilter(Gate=null.NullFlags, Stream0=rec_2, Stream1="0")
filter_14 = StreamFilter(Gate=null_2.NullFlags, Stream0=rec, Stream1="0")
filter_15 = StreamFilter(Gate=null_3.NullFlags, Stream0=rec_4, Stream1="0")
filter_16 = StreamFilter(Gate=null_4.NullFlags, Stream0=rec_5, Stream1="0")
filter_17 = StreamFilter(Gate=null_5.NullFlags, Stream0=rec_6, Stream1="0")
filter_18 = StreamFilter(Gate=null_6.NullFlags, Stream0=rec_3, Stream1="0")
merge = Merge(Data1=filter_17, Data2=filter_18, Data3=filter_14, Data4=filter_15, Data5=filter_16, Data6=filter_13)
remap_3 = RemapNumbers(Value=merge, Source=Domain(0, 1), Target="1 to 30")  # -> Mapped, Clipped

# ---- group: floor num for each type
int_3 = Integer(remap_3.Mapped)

# ----
panel_22 = Panel(int_3)

int_4 = ClusterOutput(int_3)

# ==== cluster LimitMaxID
int = ClusterInput()
int_2 = ClusterInput()

# ---- group: max id
int_3 = Integer(int)

# ---- group: all piece ids raw
int_4 = Integer(int_2)

# ----
lng = ListLength(List=int_4)
larger = LargerThan(FirstNumber=int_4, SecondNumber=int_3)  # -> LargerThan, OrEqualTo
repeat = RepeatData(Data="-1", Length=lng)
pshift = ShiftPaths(Data=repeat, Offset=-1)
merge = Merge(Data1=graft(int_4), Data2=graft(pshift))
item = ListItem(List=merge, Index=graft(larger.LargerThan), Wrap=False)
pshift_2 = ShiftPaths(Data=item, Offset=-1)

# ---- group: all piece ids
int_5 = Integer(pshift_2)

# ----
int_6 = ClusterOutput(int_5)

# ==== cluster TextGridToList
txt = ClusterInput()

# ---- group: module id data
txt_2 = Text(txt)

# ----
split = TextSplit(Text=txt_2)
cull = CullPattern(List=split, CullPattern=[True, False])
join = TextJoin(Text=cull, Join=",")
split_2 = TextSplit(Text=join, Separators=",")
pshift = ShiftPaths(Data=split_2, Offset=-2)

# ---- group: all piece ids raw
int = Integer(pshift)

# ----
int_2 = ClusterOutput(int)
