# Grasshopper definition 180119_CityMatrix_Mini_VIZ.gh (Grasshopper 0.9.76)
# plug-ins: Python Interpreter, Firefly.X, gHowl, HDTReference, LunchBox

# ---- group: GH Profiler List_David Rutten_Jung
gh_profiler_list = VBScript()  # -> out; disabled
# ---------- gh_profiler_list: VB ----------
    If (_form IsNot Nothing) Then Return

    _form = New Form()
    _form.StartPosition = FormStartPosition.Manual
    _form.ShowInTaskbar = False
    _form.FormBorderStyle = FormBorderStyle.SizableToolWindow
    _form.Text = "Component List"
    AddHandler _form.FormClosing, AddressOf FormClosing

    _list = New ListView()
    _list.View = View.Details
    _list.AllowColumnReorder = False
    _list.MultiSelect = False
    _list.Columns.Add("Component", 200)
    _list.Columns.Add("Runtime", 80)
    _list.Dock = DockStyle.Fill
    AddHandler _list.ItemActivate, AddressOf ItemActivate
    _form.Controls.Add(_list)

    Grasshopper.GUI.GH_WindowsFormUtil.CenterFormOnCursor(_form, True)
    _form.Show(Instances.DocumentEditor)
    Instances.DocumentEditor.FormShepard.RegisterForm(_form)

    If (_handler) Then Return
    AddHandler GrasshopperDocument.SolutionEnd, AddressOf DocumentSolutionEnd
# ---------- gh_profiler_list: VB additional code ----------
  Private _form As Form
  Private _list As ListView
  Private _handler As Boolean = False

  Private Sub FormClosing(sender As Object, e As EventArgs)
    If (_form Is Nothing) Then Return
    RemoveHandler _form.FormClosing, AddressOf FormClosing
    RemoveHandler _list.ItemActivate, AddressOf ItemActivate

    _form = Nothing
    _list = Nothing
  End Sub
  Private Sub ItemActivate(sender As Object, e As EventArgs)
    Try
      Dim item As ListViewItem = _list.SelectedItems(0)
      Dim target As RectangleF = TryCast(item.Tag, IGH_DocumentObject).Attributes.Bounds
      Dim view As New Grasshopper.GUI.Canvas.GH_NamedView(Instances.ActiveCanvas.Viewport.ScreenPort, target)
      view.SetToViewport(Instances.ActiveCanvas, 350)
    Catch
    End Try
  End Sub

  Private Sub DocumentSolutionEnd(sender As Object, e As GH_SolutionEventArgs)
    If (_form Is Nothing) Then Return
    _list.Items.Clear()

    Dim doc As GH_Document = e.Document
    If (doc Is Nothing) Then Return
    If (doc.ObjectCount = 0) Then Return

    Dim times As Int64()
    Dim objects As IGH_DocumentObject()
    ReDim times(doc.ObjectCount - 1)
    ReDim objects(doc.ObjectCount - 1)
    For i As Int32 = 0 To doc.ObjectCount - 1
      Dim obj As IGH_ActiveObject = TryCast(doc.Objects(i), IGH_ActiveObject)
      If (obj Is Nothing) Then
        times(i) = 0
        objects(i) = doc.Objects(i)
        Continue For
      End If

      times(i) = obj.ProcessorTime.Ticks
      objects(i) = obj
    Next
    Array.Sort(times, objects)

    For i As Int32 = doc.ObjectCount - 1 To 0 Step -1
      If (times(i) < TimeSpan.TicksPerMillisecond) Then Continue For
      Dim item As New ListViewItem(objects(i).Name)
      item.Tag = objects(i)
      item.SubItems.Add(String.Format("{0:0} ms", New TimeSpan(times(i)).TotalMilliseconds))
      _list.Items.Add(item)
    Next
    _list.Invalidate()
  End Sub
# ---------- end gh_profiler_list ----------

# ----
# CityMatrix CV (UDP)
panel = Panel("127.0.0.1")

# ---- group: module meshes lego ref: -1
# Building Type Mesh
mesh = Mesh(<mesh referenced from the Rhino model>)

# ---- group: module meshes lego ref: 0 to 5
mesh_2 = Mesh([<mesh referenced from the Rhino model> x6])

# ---- group: module meshes lego ref: 0 to 5 - with hight test
# -2 means static context
# -1 means empty site
# please manually replace -1
# to building types 0 to 5
# 0 means RL
# 1 means RM
# 2 means RS
# 3 means OL
# 4 means OM
# 5 means OS
mesh_3 = Mesh([<mesh referenced from the Rhino model> x6])

# ----
# Input Parameters
gridextent_x = Slider(16, range=2..48)
gridextent_y = Slider(16, range=2..48)
toggle1 = BooleanToggle(False)
toggle2 = BooleanToggle(True)
toggle4 = BooleanToggle(False)
toggle3 = BooleanToggle(False)
toggle = BooleanToggle(False)  # disabled
# Animation Control
initstickyall_py = PythonScript()  # -> out, a; disabled
# ---------- initstickyall_py: Python ----------
import scriptcontext as sc
import time

sc.sticky["count"] = -1
sc.sticky["bool"] = False
sc.sticky["blink2"] = False

print(time.time())
sc.sticky["prevTime"] = time.time()


a = True
# ---------- end initstickyall_py ----------

# ---- group: mesh coloring
mesh_4 = Mesh(<mesh referenced from the Rhino model>)
res_color = ColourSwatch(SwatchColor=RGB(251, 255, 122))
res_gray = ColourSwatch(SwatchColor=RGB(227, 227, 227))
sidewalk = ColourSwatch(SwatchColor=RGB(107, 107, 107))
bikelane = ColourSwatch(SwatchColor=RGB(86, 135, 87))
off_gray = ColourSwatch(SwatchColor=RGB(171, 171, 171))
offcolor = ColourSwatch(SwatchColor=RGB(255, 122, 122))
parking = ColourSwatch(SwatchColor=RGB(196, 156, 100))
blank = ColourSwatch(SwatchColor=RGB(110, 110, 110))
road = ColourSwatch(SwatchColor=RGB(64, 64, 64))
park = ColourSwatch(SwatchColor=RGB(165, 201, 44))
text = ColourSwatch(SwatchColor=RGB(0, 0, 0))
res_warm = ColourSwatch(SwatchColor=RGB(255, 251, 230))
text_new = ColourSwatch(SwatchColor=RGB(64, 64, 64))
off_cold = ColourSwatch(SwatchColor=RGB(230, 242, 255))
mcol = MeshColours(Mesh=mesh_4, Colours=off_cold)
mesh_5 = Mesh(mcol)

# ----
udp = UDPReceiver(Address=panel, Port="7002", Pattern=0)  # -> Info, Data

# ---- group: stickyInitiated
bool = Boolean(initstickyall_py.a)  # disabled

bool_2 = Boolean(bool)  # disabled

# ---- group: json data received from GH CV
txt = Text(udp.Data)

# ---- group: gridExtent_y
int = Integer(gridextent_y)

# ---- group: toggle1
bool_3 = Boolean(toggle1)

# ---- group: toggle2
bool_4 = Boolean(toggle2)

# ---- group: toggle3
bool_5 = Boolean(toggle3)

# ---- group: toggle4
bool_6 = Boolean(toggle4)

# ---- group: gridExtent_x
int_2 = Integer(gridextent_x)

# ---- group: manual text city
panel_2 = Panel("""b,r,b,b,b,b,r,b,b,b,b,r,b,b,b,b
r,r,r,r,r,r,r,r,r,r,r,r,r,r,r,r
b,r,b,b,b,b,r,b,b,b,b,r,b,b,b,b
b,r,b,g,g,b,r,b,g,g,b,r,b,g,g,b
b,r,b,g,g,b,r,b,g,g,b,r,b,g,g,b
b,r,b,b,b,b,r,b,b,b,b,r,b,b,b,b
r,r,r,r,r,r,r,r,r,r,r,r,r,r,r,r
b,r,b,b,b,b,r,4,4,4,4,r,3,3,3,3
b,r,b,g,g,b,r,4,g,g,4,r,3,g,g,3
b,r,b,g,g,b,r,4,g,g,4,r,3,g,g,3
b,r,b,b,b,b,r,4,4,4,4,r,3,3,3,3
r,r,r,r,r,r,r,r,r,r,r,r,r,r,r,r
b,r,2,2,2,2,r,1,1,1,1,r,0,0,0,0
b,r,2,g,g,2,r,1,g,g,1,r,0,g,g,0
b,r,2,g,g,2,r,1,g,g,1,r,0,g,g,0
b,r,2,2,2,2,r,1,1,1,1,r,0,0,0,0""")

# ---- group: module id data (manual)
txt_2 = Text(panel_2)

# ---- group: dell
path = FilePath("C:\Users\RYAN\Dropbox (MIT)\01_Work\Share\_CityScope\CityMatrix_ML\00_Data\04_json format\initial JSON data for GH VIZ.json")

# ---- group: ml
path_2 = FilePath("C:\Users\RYAN\Dropbox (Changing Places)\CPG_PROJECTS\CPG_CITYSCOPE\CityMatrix_ML\00_Data\04_json format\initial JSON data for GH VIZ.json")

# ----
rep = ReplaceText(Text=txt_2, Find="r", Replace="6", RecursiveReplace=False)
rep_2 = ReplaceText(Text=rep, Find="g", Replace="-1", RecursiveReplace=False)
rep_3 = ReplaceText(Text=rep_2, Find="b", Replace="5", RecursiveReplace=False)
panel_3 = Panel(rep_3)
file = ReadFile(File=path, PerLineParse=True)

# ---- group: module id data
txt_3 = Text(rep_3)

# ----
split = TextSplit(Text=txt_3)

# ---- group: json data all blank
txt_4 = Text(file)

# ---- group: is Null?
null = NullItem(Item=txt)  # -> NullFlags, InvalidFlags, Description
panel_4 = Panel(null.NullFlags)

# ----
cull = CullPattern(List=split, CullPattern=[True, False])
join = TextJoin(Text=cull, Join=",")
split_2 = TextSplit(Text=join, Separators=",")

# ---- group: floor height
panel_5 = Panel("3.5")

# ----
pshift = ShiftPaths(Data=split_2, Offset=-2)

# ---- group: if null, replace blank
filter = StreamFilter(Gate=null.NullFlags, Stream0=txt, Stream1=txt_4)

# ---- group: json string received
txt_5 = Text(filter)

txt_6 = Text(filter)

# ---- group: predict city
json_parsor_predict_py = PythonScript(jsonString=txt_6)  # -> out, types, xs, ys, rots, traffics, waits, solars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
# ---------- json_parsor_predict_py: Python ----------
import json

jsonData  = json.loads(jsonString)

predict = jsonData['predict']

grid = predict['grid']
#print str(grid)
rots = []
types = []
xs = []
ys = []
traffics = []
waits = []
solars = []
for cell in grid:
    #print cell
    rot = cell['rot']
    type = cell['type']
    x = cell['x']
    y = cell['y']
    
    # Traffic
    if type == 6: 
        #print "is road!"
        dataResult = cell['data']
        #print dataResult
        traffic = float(dataResult['traffic'])
        #print traffic
        wait = float(dataResult['wait'])
        #print wait
    else:
        #print "is NOT road!"
        traffic = -1.0
        wait = -1.0
    #print traffic
    #print wait
    rots.append(rot)
    types.append(type)
    xs.append(x)
    ys.append(y)
    traffics.append(traffic)
    waits.append(wait)
    
    # Solar
    dataResult = cell['data']
    solar = float(dataResult['solar'])
    solars.append(solar)
    
#print rots
#print types
#print xs
#print ys
#print traffics
#print waits

objects = predict['objects']
densities = objects['densities']

m = objects['metrics']
metrics = []
metrics.append(m['Density']['metric'])
metrics.append(m['Diversity']['metric'])
metrics.append(m['Energy']['metric'])
metrics.append(m['Traffic']['metric'])
metrics.append(m['Solar']['metric'])


AIStep = objects['AIStep']
#print 'AIStep: ' + str(AIStep)
toggle1 = objects['toggle1']
#print 'toggle1: ' + str(toggle1)
slider1 = objects['slider1']
#print 'slider1: ' + str(slider1)
slider2 = objects['slider2']
#print 'slider2: ' + str(slider2)
dockID = objects['dockID']
#print 'dockID: ' + str(dockID)
dockRotation = objects['dockRotation']
#print 'dockRotation: ' + str(dockRotation)
animBlink = objects['animBlink']
#print 'animBlink: ' + str(animBlink)


animActivation = True
# ---------- end json_parsor_predict_py ----------

# ---- group: PREDICT / type / module id
int_3 = Integer(json_parsor_predict_py.types)

# ---- group: PREDICT / x
num = Number(json_parsor_predict_py.xs)

# ---- group: PREDICT / y
num_2 = Number(json_parsor_predict_py.ys)

# ---- group: PREDICT / rotation
num_3 = Number(json_parsor_predict_py.rots)

# ---- group: PREDICT / density list
num_4 = Number(json_parsor_predict_py.densities)

# ---- group: PREDICT / traffic value
num_5 = Number(json_parsor_predict_py.traffics)

# ---- group: PREDICT / metrics
num_6 = Number(json_parsor_predict_py.metrics)

# ---- group: metrics current city
num_7 = Number(num_6)

# ----
panel_6 = Panel(num_7)

# ---- group: PREDICT / animActivation
bool_7 = Boolean(json_parsor_predict_py.animActivation)

# ---- group: animActivation
bool_8 = Boolean(bool_7)  # disabled

# ----
blink2_py = PythonScript(activation=bool_8, initiated=bool_2)  # -> out, a; disabled
# ---------- blink2_py: Python ----------
import time
import math
import scriptcontext as sc

if initiated and activation:
    sc.sticky["blink2"] = not sc.sticky["blink2"]
    a = sc.sticky["blink2"]

print(a)
# ---------- end blink2_py ----------

# ---- group: blink anim
bool_9 = Boolean(blink2_py.a)  # disabled

# ----
panel_7 = Panel(bool_9)  # disabled

# ---- group: UI / AI Step from Python Server
int_4 = Integer(json_parsor_predict_py.AIStep)

# ---- group: UI / slider2
num_8 = Number(json_parsor_predict_py.slider2)

# ---- group: PREDICT / waiting time value
num_9 = Number(json_parsor_predict_py.waits)

# ---- group: UI / slider1
num_10 = Number(json_parsor_predict_py.slider1)

# ---- group: UI / dockID
int_5 = Integer(json_parsor_predict_py.dockID)

# ---- group: UI / toggle1
int_6 = Integer(json_parsor_predict_py.toggle1)

# ---- group: UI / animBlink
int_7 = Integer(json_parsor_predict_py.animBlink)

# ---- group: UI / dockRoatation
int_8 = Integer(json_parsor_predict_py.dockRotation)

# ---- group: solar value
num_11 = Number(json_parsor_predict_py.solars)

# ---- group: UI / animBlink
bool_10 = Boolean(int_7)

# ---- group: UI
panel_8 = Panel(int_7)
panel_9 = Panel(int_4)
panel_10 = Panel("20")
panel_11 = Panel(bool_10)

# ----
larger = LargerThan(FirstNumber=int_4, SecondNumber=panel_10)  # -> LargerThan, OrEqualTo

# ---- group: if ai step = 20 / show ai or not
filter_2 = StreamFilter(Gate=larger.OrEqualTo, Stream1=txt_5)

# ---- group: ai city
json_parsor_ai_py = PythonScript(jsonString=filter_2)  # -> out, types, xs, ys, rots, traffics, waits, solars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
# ---------- json_parsor_ai_py: Python ----------
import json

jsonData  = json.loads(jsonString)

ai = jsonData['ai']

grid = ai['grid']
#print str(grid)
rots = []
types = []
xs = []
ys = []
traffics = []
waits = []
solars = []
for cell in grid:
    #print cell
    rot = cell['rot']
    type = cell['type']
    x = cell['x']
    y = cell['y']
    
    # Traffic
    if type == 6: 
        #print "is road!"
        dataResult = cell['data']
        #print dataResult
        traffic = float(dataResult['traffic'])
        #print traffic
        wait = float(dataResult['wait'])
        #print wait
    else:
        #print "is NOT road!"
        traffic = -1.0
        wait = -1.0
    #print traffic
    #print wait
    rots.append(rot)
    types.append(type)
    xs.append(x)
    ys.append(y)
    traffics.append(traffic)
    waits.append(wait)
    
    # Solar
    dataResult = cell['data']
    solar = float(dataResult['solar'])
    solars.append(solar)

objects = ai['objects']
#print str(objects)
densities = objects['densities']
#print str(densities)
score = objects['score']
#print str(scores)
AIWeights = objects['AIWeights']
AIMov = objects['AIMov']

m = objects['metrics']
metrics = []
metrics.append(m['Density']['metric'])
metrics.append(m['Diversity']['metric'])
metrics.append(m['Energy']['metric'])
metrics.append(m['Traffic']['metric'])
metrics.append(m['Solar']['metric'])
# ---------- end json_parsor_ai_py ----------

# ---- group: AIWeights
num_12 = Number(json_parsor_ai_py.AIWeights)

# ---- group: AIMov
data = Data(json_parsor_ai_py.AIMov)

data_2 = Data(data)

# ----
panel_12 = Panel(data_2)

# ---- group: AI / type / module id
int_9 = Integer(json_parsor_ai_py.types)

# ---- group: AI / x
num_13 = Number(json_parsor_ai_py.xs)

# ---- group: AI / y
num_14 = Number(json_parsor_ai_py.ys)

# ---- group: AI / rotation
num_15 = Number(json_parsor_ai_py.rots)

# ---- group: AI / traffic value
num_16 = Number(json_parsor_ai_py.traffics)

# ---- group: AI / metrics
num_17 = Number(json_parsor_ai_py.metrics)

# ---- group: metrics suggested city
num_18 = Number(num_17)

# ----
panel_13 = Panel(num_18)

# ---- group: AI / animActivation
bool_11 = Boolean(json_parsor_ai_py.animActivation)

# ---- group: AI / density list
num_19 = Number(json_parsor_ai_py.densities)

# ---- group: AI / waiting time value
num_20 = Number(json_parsor_ai_py.waits)

# ----
item = ListItem(List=data, Index=0, Wrap=False)

# ---- group: solar value
num_21 = Number(json_parsor_ai_py.solars)

# ----
panel_14 = Panel(data)

# ---- group: AIMovType
txt_7 = Text(item)

# ----
panel_15 = Panel(txt_7)
mindex = MemberIndex(Set=txt_7, Member="DENSITY")  # -> Index, Count
equals = Equality(FirstNumber=mindex.Count, SecondNumber=1)  # -> Equality, Inequality

# ---- group: blink anim
bool_12 = Boolean(bool_10)

# ----
panel_16 = Panel(bool_12)

# ---- group: True: DENSITY; False: CELL
bool_13 = Boolean(equals.Equality)

# ----
filter_3 = StreamFilter(Gate=larger.OrEqualTo, Stream0=False, Stream1=Toggle(False))
filter_4 = StreamFilter(Gate=bool_13, Stream0=data)
filter_5 = StreamFilter(Gate=bool_13, Stream1=data)

# ---- group: Density Value Suggested
item_2 = ListItem(List=filter_5, Index=2, Wrap=False)
panel_17 = Panel(item_2)

# ---- group: Density idx
item_3 = ListItem(List=filter_5, Index=1, Wrap=False)
panel_18 = Panel(item_3)

# ---- group: Cell x
item_4 = ListItem(List=filter_4, Index=1, Wrap=False)
panel_19 = Panel(item_4)

item_5 = ListItem(List=filter_4, Index=2, Wrap=False)
panel_20 = Panel(item_5)

# ---- group: Cell new id
item_6 = ListItem(List=filter_4, Index=3, Wrap=False)
panel_21 = Panel(item_6)

# ---- group: false: prediction; true: ai
bool_14 = Boolean(filter_3)

# ---- group: blink anim
filter_6 = StreamFilter(Gate=bool_14, Stream0=num_11, Stream1=num_21)

filter_7 = StreamFilter(Gate=bool_14, Stream0=num_9, Stream1=num_20)

filter_8 = StreamFilter(Gate=bool_14, Stream0=int_3, Stream1=int_9)

filter_9 = StreamFilter(Gate=bool_14, Stream0=num, Stream1=num_13)

filter_10 = StreamFilter(Gate=bool_14, Stream0=num_2, Stream1=num_14)

filter_11 = StreamFilter(Gate=bool_14, Stream0=num_4, Stream1=num_19)

filter_12 = StreamFilter(Gate=bool_14, Stream0=num_5, Stream1=num_16)

filter_13 = StreamFilter(Gate=bool_14, Stream0=num_3, Stream1=num_15)

# ---- group: x
num_22 = Number(filter_9)

# ---- group: y
num_23 = Number(filter_10)

# ---- group: solar value
num_24 = Number(filter_6)

# ---- group: type / module id
int_10 = Integer(filter_8)

# ---- group: density list
num_25 = Number(filter_11)

# ---- group: floor num for each type from server
# Building Heights
int_11 = Integer(num_25)

# ---- group: traffic value
num_26 = Number(filter_12)

# ---- group: waiting time value
num_27 = Number(filter_7)

# ---- group: rotation
num_28 = Number(filter_13)

# ---- group: floor num for each type
int_12 = Integer(int_11)

# ----
panel_22 = Panel(int_12)

panel_23 = Panel(bool_14)
multiplication = Multiplication(A=int_12, B=panel_5)

# ---- group: new id
int_13 = Integer(item_6)

# ---- group: Density Value Suggested
int_14 = Integer(item_2)

# ---- group: Changed / x
int_15 = Integer(item_4)

# ---- group: module id (manual)
# Grid Base Data
int_16 = Integer(pshift)

# ----
panel_24 = Panel(int_16)

# ---- group: building height for each type
num_29 = Number(multiplication)

# ---- group: Changed / y
int_17 = Integer(item_5)

# ----
repeat = RepeatData(Data=Slider(0, range=0..360), Length=256)

# ---- group: rotation
int_18 = Integer([0, -90, 0, 0, 0, 0, -90, 0, 0, 0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])

# ---- group: all 0
pshift_2 = ShiftPaths(Data=repeat, Offset=-1)

# ---- group: module id (CV UDP)
int_19 = Integer(int_10)

# ---- group: x
int_20 = Integer(num_22)

# ---- group: y
int_21 = Integer(num_23)

# ---- group: rotation
int_22 = Integer(num_28)

# ----
panel_25 = Panel(int_20)
panel_26 = Panel(int_19)
panel_27 = Panel(int_21)
panel_28 = Panel(int_22)
number_slider = Slider(0.389, range=0..1)
toggle_2 = BooleanToggle(False)

# ---- group: module id (manual)
int_23 = Integer(int_16)

# ---- group: module id (CV UDP)
int_24 = Integer(int_19)

# ---- group: slider2
num_30 = Number(num_8)

# ---- group: toggle1
bool_15 = Boolean(int_6)

# ---- group: gridExtent_x
int_25 = Integer(int_2)

int_26 = Integer(int_25)

# ---- group: AI
subtraction = Subtraction(A=int_26, B=num_13)  # disabled
panel_29 = Panel(num_17)
subtraction_2 = Subtraction(A=subtraction, B=num)  # disabled

# ---- group: PREDICT
subtraction_3 = Subtraction(A=int_26, B=1)  # disabled
panel_30 = Panel(num_6)
subtraction_4 = Subtraction(A=subtraction_3, B=num)  # disabled

# ---- group: AI / x flipped
num_31 = Number(subtraction_2)  # disabled

# ---- group: PREDICT / x flipped
num_32 = Number(subtraction_4)  # disabled

# ---- group: gridExtent_y
int_27 = Integer(int)

int_28 = Integer(int_27)

# ---- group: x
int_29 = Integer(int_20)

int_30 = Integer(int_29)

# ---- group: y
int_31 = Integer(int_21)

int_32 = Integer(int_31)

# ---- group: rotation
int_33 = Integer(int_22)

# ---- group: dockID
int_34 = Integer(int_5)

# ---- group: toggle1
bool_16 = Boolean(bool_15)

# ---- group: toggle2
bool_17 = Boolean(bool_4)

# ---- group: toggle3
bool_18 = Boolean(bool_5)

# ---- group: toggle4
bool_19 = Boolean(bool_6)

# ---- group: floor num for each type
int_35 = Integer(int_12)

# ----
panel_31 = Panel(int_35)

# ---- group: module id
int_36 = Integer(int_24)

int_37 = Integer(int_36)

# ----
equals_2 = Equality(FirstNumber=int_37, SecondNumber=item_3)  # -> Equality, Inequality
dispatch = Dispatch(List=int_30, DispatchPattern=equals_2.Equality)  # -> ListA, ListB
dispatch_2 = Dispatch(List=int_32, DispatchPattern=equals_2.Equality)  # -> ListA, ListB

# ---- group: changed / x
int_38 = Integer(dispatch.ListA)

# ---- group: changed / y
int_39 = Integer(dispatch_2.ListA)

# ---- group: x
filter_14 = StreamFilter(Gate=bool_13, Stream0=int_15, Stream1=int_38)

# ---- group: y
filter_15 = StreamFilter(Gate=bool_13, Stream0=int_17, Stream1=int_39)

# ---- group: Changed / x
int_40 = Integer(filter_14)

# ---- group: Changed / y
int_41 = Integer(filter_15)

# ---- group: slider1
num_33 = Number(num_10)

# ---- group: slider2
num_34 = Number(num_30)

# ---- group: dock rotation
int_42 = Integer(int_8)

# ----
remap = RemapNumbers(Value=num_34, Source=Domain(0, 1), Target="-0.25 To 5.25")  # -> Mapped, Clipped

# ---- group: viz ctrl - slider
int_43 = Integer(remap.Mapped)

# ----
panel_32 = Panel(int_43)
number_slider_2 = Slider(20, range=-1..30)

# ---- group: ref crvs - density suggest value arrow location
crv = Curve(reparameterize(<curve referenced from the Rhino model>))

# ----
arrow_size = Slider(25, range=0..100)
arrow_size_2 = Slider(25, range=0..100)

# ---- group: ref crvs - density arrow base
crv_2 = Curve([<curve referenced from the Rhino model> x6])

# ----
neg = Negative(Value=1)

# ---- group: Density Value Suggested
int_44 = Integer(int_14)

# ---- group: id suggested
int_45 = Integer(int_13)

# ---- group: cell change arrow start pts
pt = Point([<point referenced from the Rhino model> x6])

# ---- group: arrow size
num_35 = Number(arrow_size_2)

# ---- group: module id
int_46 = Integer(int_36)

# ---- group: mask/highlight - AI Assistance
crv_3 = Curve(<curve referenced from the Rhino model>)

# ----
move_z = Slider(13.1, range=0..30)
move_z_2 = Slider(22.5, range=0..30)
remap_2 = RemapNumbers(Value=int_44, Source=Domain(1, 30), Target=Domain(0, 1))  # -> Mapped, Clipped
Y = UnitY(Factor=1)
X = UnitX(Factor=neg)
eval = EvaluateCurve(Curve=crv, Parameter=remap_2.Mapped)  # -> Point, Tangent, Angle

# ---- group: floor num for each type
int_47 = Integer(int_35)

# CityMatrix
# 
# "Ryan" Yan Zhang <ryanz@mit.edu>
# MIT Media Lab, Changing Place Group
# September. 2016
# Human Interation @ Lego - Outside
int_48 = Integer(int_35)

# ----
number_slider_3 = Slider(17, range=0..100)  # disabled
# mid
number_slider_4 = Slider(55, range=0..100)  # disabled

# ---- group: highlight - viz 1
crv_4 = Curve(<curve referenced from the Rhino model>)

# ---- group: mask/highlight - lego grid
crv_5 = Curve(<curve referenced from the Rhino model>)

# ----
number_slider_5 = Slider(51, range=0..100)  # disabled
number_slider_6 = Slider(46, range=0..100)  # disabled

# ---- group: mask/highlight - building types
crv_6 = Curve(<curve referenced from the Rhino model>)

# ---- group: mask/highlight - density slider
crv_7 = Curve(<curve referenced from the Rhino model>)

# ---- group: mask/highlight - people statistics
crv_8 = Curve(<curve referenced from the Rhino model>)

# ---- group: mask/highlight - selection dock
crv_9 = Curve(<curve referenced from the Rhino model>)

# ---- group: highlight - viz 2
crv_10 = Curve(<curve referenced from the Rhino model>)

# ---- group: mask/highlight - viz slider
crv_11 = Curve(<curve referenced from the Rhino model>)

# ---- group: highlight - viz 3
crv_12 = Curve(<curve referenced from the Rhino model>)

# ---- group: arrow 1
crv_13 = Curve([<curve referenced from the Rhino model> x10])

# ---- group: arrow 2
crv_14 = Curve([<curve referenced from the Rhino model> x2])

# ---- group: highlight - viz 4
crv_15 = Curve(<curve referenced from the Rhino model>)

# ---- group: highlight - viz 5
crv_16 = Curve(<curve referenced from the Rhino model>)

# ---- group: arrow 3
crv_17 = Curve([<curve referenced from the Rhino model> x2])

# ---- group: arrow 4
# AI Suggestion
crv_18 = Curve([<curve referenced from the Rhino model> x2])

# ----
# old
number_slider_7 = Slider(23, range=0..100)  # disabled
number_slider_8 = Slider(69, range=0..100)  # disabled
aisteptest = Slider(15, range=-1..30)
line = LineSDL(Start=eval.Point, Direction=Y, Length=arrow_size_2)

# ---- group: stickyInitiated
bool_20 = Boolean(bool)  # disabled

# ----
equals_3 = Equality(FirstNumber=int_46, SecondNumber="0")  # -> Equality, Inequality
equals_4 = Equality(FirstNumber=int_46, SecondNumber="1")  # -> Equality, Inequality
equals_5 = Equality(FirstNumber=int_46, SecondNumber="3")  # -> Equality, Inequality
equals_6 = Equality(FirstNumber=int_46, SecondNumber="2")  # -> Equality, Inequality

# ---- group: Toggle 1
# AI Step Control
bool_21 = Boolean(bool_16)  # disabled

# ----
addarrowhead = AddArrowHead(crv=crv_2, num=arrow_size)
equals_7 = Equality(FirstNumber=int_46, SecondNumber="4")  # -> Equality, Inequality
equals_8 = Equality(FirstNumber=int_46, SecondNumber="5")  # -> Equality, Inequality

# ---- group: viz ctrl - slider
int_49 = Integer(int_43)

# ----
panel_33 = Panel(int_49)
# Dashboard
number_slider_9 = Slider(0.4, range=0..1)
# young
number_slider_10 = Slider(200, range=0..500)  # disabled
number_slider_11 = Slider(120, range=0..500)  # disabled
number_slider_12 = Slider(75, range=0..500)  # disabled
item_7 = ListItem(List=int_47, Index="0", Wrap=False)
item_8 = ListItem(List=int_47, Index="2", Wrap=False)
item_9 = ListItem(List=int_47, Index="1", Wrap=False)
item_10 = ListItem(List=int_47, Index="3", Wrap=False)
item_11 = ListItem(List=int_47, Index="4", Wrap=False)
item_12 = ListItem(List=int_47, Index="5", Wrap=False)

# ---- group: ppl per flr
# id5
# id3
# id4
# id0
# id2
# id1
# young
# mid
# old
panel_34 = Panel("0")
panel_35 = Panel("18")
panel_36 = Panel("28")
panel_37 = Panel("63")
panel_38 = Panel("52")
panel_39 = Panel("87")
panel_40 = Panel("156")
num_36 = Number([panel_34, "0", "0", "0"])
num_37 = Number(["0", "0", "0", "0"])
num_38 = Number(["0", "0", "0", "0"])

# ----
stickycount_py = PythonScript(x=bool_21, initiated=bool_20)  # -> out, a; disabled
# ---------- stickycount_py: Python ----------
import scriptcontext as sc
import time

if initiated and not x == sc.sticky["bool"] :
    if time.time() - sc.sticky["prevTime"] >= 0.5 :
        sc.sticky["count"] = sc.sticky["count"] + 1
    sc.sticky["prevTime"] = time.time()

sc.sticky["bool"] = x

print(sc.sticky["count"])
print(sc.sticky["prevTime"])
print(sc.sticky["bool"])
print(time.time())

a = sc.sticky["count"]
# ---------- end stickycount_py ----------
int_50 = Integer(equals_3.Equality)
int_51 = Integer(equals_4.Equality)
addarrowhead_2 = AddArrowHead(crv=line, num=arrow_size_2)
int_52 = Integer(equals_5.Equality)
int_53 = Integer(equals_6.Equality)
int_54 = Integer(equals_7.Equality)
int_55 = Integer(equals_8.Equality)

# ---- group: all but viz
crv_19 = Curve([crv_6, crv_9, crv_7, crv_8, crv_3])

# ---- group: table all
crv_20 = Curve([crv_5, crv_6, crv_9, crv_7, crv_8, crv_11, crv_3])

# ----
ma = MassAddition(Input=int_50)  # -> Result, PartialResults
ma_2 = MassAddition(Input=int_51)  # -> Result, PartialResults

# ---- group: dock and slider highlight crv
crv_21 = Curve(<curve referenced from the Rhino model>)

# ----
ma_3 = MassAddition(Input=int_52)  # -> Result, PartialResults
ma_4 = MassAddition(Input=int_53)  # -> Result, PartialResults

# ---- group: type highlight crvs
crv_22 = Curve([<curve referenced from the Rhino model> x6])

# ----
ma_5 = MassAddition(Input=int_54)  # -> Result, PartialResults

# ---- group: building id 0 fl #
int_56 = Integer(item_7)

# ---- group: building id 2 fl #
int_57 = Integer(item_8)

# ----
data_3 = Data([crv_6, crv_8, crv_9, crv_7])

# ---- group: building id 1 fl #
int_58 = Integer(item_9)

# ----
data_4 = Data([crv_6, crv_8, crv_11])
ma_6 = MassAddition(Input=int_55)  # -> Result, PartialResults

# ---- group: building id 3 fl #
int_59 = Integer(item_10)

# ----
data_5 = Data([crv_7, crv_8, crv_11])
pt_2 = ConstructPoint(XCoordinate=Slider(0, range=0..10), YCoordinate=Slider(0, range=-30..0), ZCoordinate=Slider(5.1, range=0..10))

# ---- group: building id 4 fl #
int_60 = Integer(item_11)

# ----
data_6 = Data([crv_9, crv_7])
data_7 = Data([crv_9, crv_6])

# ---- group: building id 5 fl #
int_61 = Integer(item_12)

# ----
data_8 = Data(crv_14)
data_9 = Data(crv_17)

# ---- group: x
int_62 = Integer(int_40)

# ---- group: y
int_63 = Integer(int_41)

# ---- group: range
B = DomainEnd(number_slider_10)  # disabled

# ----
int_64 = Integer(ma.Result)
panel_41 = Panel(int_64)
int_65 = Integer(ma_2.Result)
panel_42 = Panel(int_65)
int_66 = Integer(ma_3.Result)
panel_43 = Panel(int_66)
int_67 = Integer(ma_4.Result)
panel_44 = Panel(int_67)
int_68 = Integer(ma_5.Result)
panel_45 = Panel(int_68)

# ---- group: range
B_2 = DomainEnd(number_slider_11)  # disabled

B_3 = DomainEnd(number_slider_12)  # disabled

# ----
int_69 = Integer(ma_6.Result)
panel_46 = Panel(int_69)
xy = XYPlane(Origin=pt_2)

# ---- group: AI Step from Python Server
int_70 = Integer(int_4)

# ----
panel_47 = Panel(int_70)
filter_16 = StreamFilter(Gate=bool_13, Stream1=crv_21)  # -> graft(Stream)
Z = UnitZ(Factor=move_z_2)
X_2 = UnitX(Factor=move_z)

# ---- group: new id
int_71 = Integer(int_13)

# ---- group: Density idx
int_72 = Integer(item_3)

# ---- group: crvs with arrow
crv_23 = Curve(addarrowhead)

# ----
dom = ConstructDomain(DomainStart=0, DomainEnd=B)  # disabled
dom_2 = ConstructDomain(DomainStart=0, DomainEnd=B_2)  # disabled
dom_3 = ConstructDomain(DomainStart=0, DomainEnd=B_3)  # disabled

# ---- group: Micro-unit Building #
int_73 = Integer(int_67)

# ---- group: Luxury Building #
int_74 = Integer(int_64)

# ---- group: Regular residential Building #
int_75 = Integer(int_65)

# ---- group: Head Quater Building #
int_76 = Integer(int_66)

# ---- group: Regular Office Building #
int_77 = Integer(int_68)

# ---- group: AI Step
int_78 = Integer(int_70)

int_79 = Integer(int_78)

# ----
panel_48 = Panel(int_79)

# ---- group: AI Step
int_80 = Integer(int_79)

# ----
panel_49 = Panel(int_80)

# ---- group: AI Step
# AI Step Mask and Highlight
int_81 = Integer(int_78)

# ----
panel_50 = Panel(int_81)

# ---- group: AI Step
int_82 = Integer(int_78)

# ----
panel_51 = Panel(int_82)

# ---- group: viz ctrl AI over rider
vizctrlaioverride_py = PythonScript(vizIntSlider=int_49, AIStepInt=int_82)  # -> out, a
# ---------- vizctrlaioverride_py: Python ----------
import rhinoscriptsyntax as rs
import scriptcontext as sc

if AIStepInt < 11:
    a = 0
elif AIStepInt == 11:
    a = 1
elif AIStepInt == 12:
    a = 2
elif AIStepInt == 13:
    a = 3
elif AIStepInt == 14:
    a = 4
elif AIStepInt == 15:
    a = 5
else:
    a = vizIntSlider
# ---------- end vizctrlaioverride_py ----------

# ---- group: Masks Filter
filter_17 = StreamFilter(
    Gate=int_81,
    Stream0=[crv_20, crv_3],
    Stream1=[crv_6, crv_9, crv_7, crv_8, crv_11, crv_3],
    Stream2=[crv_5, crv_9, crv_7, crv_8, crv_11, crv_3],
    Stream3=[crv_9, crv_7, crv_8, crv_11, crv_3],
    Stream4=crv_3,
    Stream5=[crv_5, crv_11, crv_3],
    Stream6=crv_20,
    Stream7=crv_20,
    Stream8=crv_20,
    Stream9=crv_20,
    Stream10=data_3,
    Stream11=crv_19,
    Stream12=crv_19,
    Stream13=crv_19,
    Stream14=crv_19,
    Stream15=crv_19,
    Stream16=crv_3,
    Stream17=crv_3,
    Stream18=crv_3,
    Stream19=crv_3,
    Stream20=crv_3)

# ---- group: Highlight Filter
filter_18 = StreamFilter(
    Gate=int_81,
    Stream1=crv_5,
    Stream2=crv_6,
    Stream3=[crv_5, crv_6],
    Stream4=[data_7, data_6],
    Stream5=crv_8,
    Stream10=[crv_11, crv_5],
    Stream11=[crv_5, crv_4],
    Stream12=[crv_10, crv_5],
    Stream13=[crv_12, crv_5],
    Stream14=[crv_15, crv_5],
    Stream15=[crv_16, crv_5],
    Stream21=crv_3)

# ---- group: Arrow Filter
filter_19 = StreamFilter(Gate=int_81, Stream3=crv_13, Stream4=[data_8, data_9], Stream10=crv_18)

# ----
crv_24 = Curve(filter_19)
crv_25 = Curve(graft(filter_18))

# ---- group: viz ctrl - AI override
int_83 = Integer(vizctrlaioverride_py.a)

# ----
panel_52 = Panel(int_83)
panel_53 = Panel(int_78)

# ---- group: Co-working Building #
int_84 = Integer(int_69)

# ----
area = Area(Geometry=crv_25)  # -> Area, Centroid; disabled
filter_20 = StreamFilter(Gate=bool_13, Stream0=int_71, Stream1=int_72)
scaleanim_py = PythonScript()  # -> out, a; disabled
# ---------- scaleanim_py: Python ----------
import time
import math


speed = 4.0
deltaScale = 0.02

a = 1.0 + math.sin(time.time() * speed) * deltaScale
# ---------- end scaleanim_py ----------
blink_py = PythonScript()  # -> out, a; disabled
# ---------- blink_py: Python ----------
import time
import math


inteval = 1

a = time.time() % inteval >= inteval / 2

print(a)
# ---------- end blink_py ----------

# ---- group: parking cell #
parking_cell = Slider(0, range=0..50)

# ----
equals_9 = Equality(FirstNumber=int_81, SecondNumber="-1")  # -> Equality, Inequality

# ---- group: blink anim
bool_22 = Boolean(bool_12)

# ----
panel_54 = Panel(bool_22)

# ---- group: crvs with arrow - density value suggested
crv_26 = Curve(addarrowhead_2)

# ---- group: blink2
filter_21 = StreamFilter(Gate=bool_22, Stream1=crv_25)

filter_22 = StreamFilter(Gate=bool_22, Stream1=crv_24)

# ---- group: works, but might cause memory leak
equals_10 = Equality()  # -> Equality, Inequality; disabled
int_85 = Integer(equals_10.Inequality)  # disabled
panel_55 = Panel(int_85)  # disabled
rec = DataRecorder(int_85, DataLimit=-1, RecordData=True)  # disabled
panel_56 = Panel(rec)  # disabled
ma_7 = MassAddition(Input=rec)  # -> Result, PartialResults; disabled
panel_57 = Panel(ma_7.Result)  # disabled

# ----
scale = Scale(Geometry=crv_25, Center=area.Centroid, Factor=scaleanim_py.a)  # -> Geometry, Transform; disabled
filter_23 = StreamFilter(Gate=equals_9.Equality, Stream1=crv_20)
crv_27 = Curve([filter_17, filter_23])
boundary = BoundarySurfaces(Edges=crv_27)
mesh_6 = MeshBrep(
    Brep=boundary,
    Settings={GridMaxCount=0, GridMinCount=16, JaggedSeams=False, MaxEdgeLength=0, MinEdgeLength=0.0001, MinTolerance=0, Refine=True, RefineAngle=0, RelativeTolerance=0.65, SimplePlanes=True, Tolerance=0})
panel_58 = Panel("7003")  # disabled
panel_59 = Panel("127.0.0.1")  # disabled

# ---- group: multipe for ppls
number_slider_13 = Slider(0.2, range=-0.01..2)

# ----
item_13 = ListItem(List=crv_22, Index=filter_20, Wrap=False)

# ---- group: ppl per flr
panel_60 = Panel("18")
panel_61 = Panel("28")
panel_62 = Panel("63")
panel_63 = Panel("52")
panel_64 = Panel("87")
panel_65 = Panel("156")

# ----
item_14 = ListItem(List=crv_23, Index=int_72, Wrap=False)
multiplication_2 = Multiplication(A=num_36, B=number_slider_13)
multiplication_3 = Multiplication(A=num_37, B=number_slider_13)
multiplication_4 = Multiplication(A=num_38, B=number_slider_13)

# ---- group: Arrows
previewlw = CustomPreviewLineweights(Geometry=filter_22, Shader=ColourSwatch(SwatchColor=RGB(255, 127, 0)), Thickness=Slider(7, range=0..100))

# ---- group: Highlights
previewlw_2 = CustomPreviewLineweights(Geometry=filter_21, Shader=ColourSwatch(SwatchColor=RGB(255, 127, 0)), Thickness=Slider(7, range=0..100))

# ---- group: Masks
preview = CustomPreview(Geometry=mesh_6, Shader=ColourSwatch(SwatchColor=RGBA(0, 0, 0, 180)))

# ----
txt_8 = Text(int_78)  # disabled
num_39 = Number(multiplication_2)
num_40 = Number(multiplication_3)
num_41 = Number(multiplication_4)

# ---- group: park cell #
park_cell = Slider(150, range=0..150)

# ----
merge = Merge(Data1=filter_16, Data2=item_13)

# ---- group: UDP Send to Unity AI
udp_2 = UDPSender(Address=panel_59, Port=panel_58, Pattern=0, Data=txt_8)  # disabled

# ----
merge_2 = Merge(Data1=panel_60, Data2=panel_61, Data3=panel_62, Data4=panel_63, Data5=panel_64, Data6=panel_65)

# ---- group: how many floors in total
multiplication_5 = Multiplication(A=int_60, B=int_77)
multiplication_6 = Multiplication(A=int_58, B=int_75)
multiplication_7 = Multiplication(A=int_61, B=int_84)
multiplication_8 = Multiplication(A=int_57, B=int_73)
multiplication_9 = Multiplication(A=int_59, B=int_76)
multiplication_10 = Multiplication(A=int_56, B=int_74)

# ----
filter_24 = StreamFilter(Gate=bool_14, Stream1=merge)  # disabled
multiplication_11 = Multiplication(A=panel_64, B=multiplication_5)
multiplication_12 = Multiplication(A=panel_61, B=multiplication_6)
multiplication_13 = Multiplication(A=panel_62, B=multiplication_8)
multiplication_14 = Multiplication(A=panel_65, B=multiplication_7)
multiplication_15 = Multiplication(A=panel_63, B=multiplication_9)
multiplication_16 = Multiplication(A=panel_60, B=multiplication_10)

# ---- group: # ppl per flr
num_42 = Number(merge_2)

# ---- group: reduce ratio
number_slider_14 = Slider(0, range=0..1)  # disabled

# ----
number_slider_15 = Slider(52, range=0..100)  # disabled
number_slider_16 = Slider(0.2, range=0..1)  # disabled
number_slider_17 = Slider(59, range=0..100)  # disabled
number_slider_18 = Slider(0.2, range=0..1)  # disabled
number_slider_19 = Slider(72, range=0..100)  # disabled
number_slider_20 = Slider(0.2, range=0..1)  # disabled

# ---- group: Regular Office ppl #
int_86 = Integer(multiplication_11)

# ---- group: Head Quater ppl #
int_87 = Integer(multiplication_15)

# ---- group: Co-working ppl #
int_88 = Integer(multiplication_14)

# ---- group: Micro-unit ppl #
int_89 = Integer(multiplication_13)

# ---- group: Luxury ppl #
int_90 = Integer(multiplication_16)

# ---- group: Regular residential ppl #
int_91 = Integer(multiplication_12)

# ---- group: crv with arrow - cell to change
crv_28 = Curve(item_14)

# ---- group: rect crvs - no off set
crv_29 = Curve(merge)

# ----
ma_8 = MassAddition(Input=[int_88, int_86, int_87])  # -> Result, PartialResults
ma_9 = MassAddition(Input=[int_89, int_91, int_90])  # -> Result, PartialResults
mid_mid_career = ColourSwatch(SwatchColor=RGB(255, 208, 0))  # disabled
mln_young = ColourSwatch(SwatchColor=RGB(0, 166, 255))  # disabled
exc_elderly = ColourSwatch(SwatchColor=RGB(255, 0, 0))  # disabled

# ---- group: dot shape
number_slider_21 = Slider(9, range=0..10)  # disabled
number_slider_22 = Slider(3, range=0..10)  # disabled
polygon = Polygon(Plane=PlaneXY(0, 0, 0), Radius=number_slider_22, Segments=number_slider_21, FilletRadius=0)  # -> Polygon, Length; disabled
boundary_2 = BoundarySurfaces(Edges=polygon.Polygon)  # disabled
mesh_7 = Mesh(boundary_2)  # disabled

# ----
mesh_8 = Mesh(mesh_7)  # disabled
mesh_9 = Mesh(mesh_7)  # disabled
mesh_10 = Mesh(mesh_7)  # disabled

# ---- group: total working ppl #
int_92 = Integer(ma_8.Result)

# ----
panel_66 = Panel("0.0 To 400000.0")  # disabled

# ---- group: total residential ppl #
int_93 = Integer(ma_9.Result)

# ----
res_warm_2 = ColourSwatch(SwatchColor=RGB(255, 246, 204))
off_cold_2 = ColourSwatch(SwatchColor=RGB(204, 229, 255))

# ---- group: Dashboard Text Color
color = ColourSwatch(SwatchColor=RGB(201, 201, 201))
col = Colour(color)

# ----
addition = Addition(A=int_93, B=int_92)

# ---- group: total ppl #
int_94 = Integer(addition)  # disabled

# ----
remap_3 = RemapNumbers(Value=int_94, Source=panel_66, Target=Domain(0, 1))  # -> Mapped, Clipped; disabled

# ---- group: Dashboard Text Size 2
size = Slider(13.5, range=0..100)
num_43 = Number(size)

# ---- group: Dashboard Text Size 1
size_2 = Slider(15, range=0..100)
num_44 = Number(size_2)

# ----
max = Maximum(A=remap_3.Mapped, B=0)  # disabled
min = Minimum(A=max, B=1)  # disabled
mid_mid_career_2 = ColourSwatch(SwatchColor=RGB(255, 208, 0))
_0 = Slider(0, range=0..1)

# ---- group: total ppl #
int_95 = Integer(addition)

# ----
# Bar Diagram
mln_young_2 = ColourSwatch(SwatchColor=RGB(0, 166, 255))
exc_elderly_2 = ColourSwatch(SwatchColor=RGB(255, 0, 0))

# ---- group: gridExtent_x
int_96 = Integer(int_25)  # disabled

# ---- group: v sep ln length
number_slider_23 = Slider(16, range=10..20)

# ---- group: gh ref pt start
pt_3 = Point(<point referenced from the Rhino model>)

# ---- group: gh ref pt end
pt_4 = Point(<point referenced from the Rhino model>)

# ---- group: bar diagram ppl range
domain = Domain("0 to 75000")

# ---- group: viz ctrl - AI override
# Send to and Receive from Python Server (json, UDP)
int_97 = Integer(int_83)  # disabled

# ----
panel_67 = Panel(int_97)  # disabled
number_slider_24 = Slider(0.5, range=0..1)  # disabled
subtraction_5 = Subtraction(A=int_96, B=1)  # disabled
pdecon = Deconstruct(Point=pt_4)  # -> XComponent, YComponent, ZComponent
pdecon_2 = Deconstruct(Point=pt_3)  # -> XComponent, YComponent, ZComponent
panel_68 = Panel(",\"popDensity\":")  # disabled
txt_9 = Text(min)  # disabled
panel_69 = Panel(int_95)
int_98 = Integer(int_29)  # disabled
neg_2 = Negative(Value=number_slider_23)
graft = GraftTree(Tree=_0, IncludeEmptyLists=True, IncludeNullItems=True)
txt_10 = Text(num_33)  # disabled
subtraction_6 = Subtraction(A=subtraction_5, B=int_98)  # disabled
Y_2 = UnitY(Factor=number_slider_23)
Y_3 = UnitY(Factor=neg_2)
merge_3 = Merge(Data1=mln_young_2, Data2=mid_mid_career_2, Data3=exc_elderly_2)
# Send to Unity (json, UDP)
panel_70 = Panel("{\"grid\":[")  # disabled
panel_71 = Panel("],\"objects\":{")  # disabled
panel_72 = Panel("}")  # disabled
panel_73 = Panel("{\"type\":")  # disabled
panel_74 = Panel(",\"x\":")  # disabled
panel_75 = Panel(",\"y\":")  # disabled
txt_11 = Text(int_31)  # disabled
panel_76 = Panel(",\"rot\":")  # disabled
txt_12 = Text(int_33)  # disabled
panel_77 = Panel("}")  # disabled
panel_78 = Panel(",")  # disabled
panel_79 = Panel("\"slider1\":")  # disabled
panel_80 = Panel(",\"toggle2\":")  # disabled
panel_81 = Panel(",\"toggle3\":")  # disabled
panel_82 = Panel(",\"toggle4\":")  # disabled
panel_83 = Panel(",\"dockID\":")  # disabled
txt_13 = Text(int_34)  # disabled
panel_84 = Panel(",\"density\":[")  # disabled
txt_14 = Text(int_36)  # disabled
txt_15 = Text(subtraction_6)  # disabled
panel_85 = Panel(",\"toggle1\":")  # disabled
int_99 = Integer(bool_18)  # disabled
panel_86 = Panel(",\"dockRotation\":")  # disabled
txt_16 = Text(int_42)  # disabled
panel_87 = Panel(",\"IDMax\":15")  # disabled
panel_88 = Panel("],\"pop_young\":0,\"pop_mid\":0,\"pop_old\":0")  # disabled
panel_89 = Panel("}")  # disabled
int_100 = Integer(bool_16)  # disabled
int_101 = Integer(bool_18)  # disabled
txt_17 = Text(number_slider_24)  # disabled
int_102 = Integer(bool_17)  # disabled

ttl_min = Slider(60, range=0..100)
type_min = Slider(20, range=0..100)

txt_18 = Text(int_35)  # disabled
panel_90 = Panel(",")  # disabled
nullrep = ReplaceNulls(Items=int_93, Replacements=0)  # -> Items, Count

# ---- group: inactive area mask ref crvs
# Inactive Area Mask
crv_30 = Curve([<curve referenced from the Rhino model> x2])

# ----
txt_19 = Text(int_100)  # disabled
txt_20 = Text(int_102)  # disabled
txt_21 = Text(int_99)  # disabled
txt_22 = Text(int_101)  # disabled
nullrep_2 = ReplaceNulls(Items=int_90, Replacements=0)  # -> Items, Count
nullrep_3 = ReplaceNulls(Items=int_89, Replacements=0)  # -> Items, Count
nullrep_4 = ReplaceNulls(Items=int_91, Replacements=0)  # -> Items, Count
max_2 = Maximum(A=nullrep.Items, B=ttl_min)
lng = ListLength(List=txt_14)  # disabled
repeat_2 = RepeatData(Data=panel_76, Length=lng)  # disabled
repeat_3 = RepeatData(Data=panel_77, Length=lng)  # disabled
repeat_4 = RepeatData(Data=panel_75, Length=lng)  # disabled
repeat_5 = RepeatData(Data=panel_74, Length=lng)  # disabled
repeat_6 = RepeatData(Data=panel_73, Length=lng)  # disabled
join_2 = TextJoin(Text=txt_18, Join=panel_90)  # disabled
max_3 = Maximum(A=nullrep_2.Items, B=type_min)
max_4 = Maximum(A=nullrep_4.Items, B=type_min)
max_5 = Maximum(A=nullrep_3.Items, B=type_min)
pshift_3 = ShiftPaths(Data=repeat_2, Offset=-1)  # disabled
pshift_4 = ShiftPaths(Data=repeat_3, Offset=-1)  # disabled
pshift_5 = ShiftPaths(Data=repeat_5, Offset=-1)  # disabled
pshift_6 = ShiftPaths(Data=repeat_4, Offset=-1)  # disabled
pshift_7 = ShiftPaths(Data=repeat_6, Offset=-1)  # disabled

# ---- group: R
int_103 = Integer(max_2)

# ----
neg_3 = Negative(Value=number_slider_23)

# ---- group: RL
int_104 = Integer(max_3)

# ---- group: RM
int_105 = Integer(max_4)

# ---- group: RS
int_106 = Integer(max_5)

# ----
addition_2 = Addition(A=int_106, B=int_105)
addition_3 = Addition(A=addition_2, B=int_104)
merge_4 = Merge(Data1=graft, Data2=int_106, Data3=addition_2, Data4=addition_3)
# Population Matrix - New
pt_5 = Point(<point referenced from the Rhino model>)
col_2 = Colour(res_warm_2)
merge_5 = Merge(
    Data1=graft(pshift_7),
    Data2=graft(txt_14),
    Data3=graft(pshift_5),
    Data4=graft(txt_15),
    Data5=graft(pshift_6),
    Data6=graft(txt_11),
    Data7=graft(pshift_3),
    Data8=graft(txt_12),
    Data9=graft(pshift_4))  # disabled

# ---- group: ttl h len
subtraction_7 = Subtraction(A=pdecon.XComponent, B=pdecon_2.XComponent)

# ---- group: 0-1
remap_4 = RemapNumbers(Value=merge_4, Source=domain, Target=Domain(0, 1))  # -> Mapped, Clipped

# ----
pt_6 = Point(<point referenced from the Rhino model>)
num_45 = Number(num_44)
pt_7 = Point(<point referenced from the Rhino model>)
num_46 = Number(num_44)
col_3 = Colour(res_warm_2)
pt_8 = Point(<point referenced from the Rhino model>)
num_47 = Number(num_44)
col_4 = Colour(res_warm_2)
division = Division(A=neg_3, B=2)
col_5 = Colour(res_warm_2)
division_2 = Division(A=number_slider_23, B=2)
number_slider_25 = Slider(2.5, range=0..10)  # disabled
boundary_3 = BoundarySurfaces(Edges=crv_30)
panel_91 = Panel("35000")  # disabled

# ---- group: RL
tag = TextTag3D(Location=pt_7, Text=int_104, Size=num_46, Colour=col_4, Justification=7)

# ----
join_3 = TextJoin(Text=merge_5)  # disabled

# ---- group: RS
tag_2 = TextTag3D(Location=pt_6, Text=int_106, Size=num_45, Colour=col_3, Justification=7)

# ---- group: RM
tag_3 = TextTag3D(Location=pt_8, Text=int_105, Size=num_47, Colour=col_5, Justification=7)

# ----
nullrep_5 = ReplaceNulls(Items=int_92, Replacements=0)  # -> Items, Count
multiplication_17 = Multiplication(A=remap_4.Mapped, B=subtraction_7)
Y_4 = UnitY(Factor=division)
Y_5 = UnitY(Factor=division_2)
multiplication_18 = Multiplication(A=panel_91, B=number_slider_25)  # disabled
mesh_11 = MeshBrep(
    Brep=boundary_3,
    Settings={GridMaxCount=0, GridMinCount=16, JaggedSeams=False, MaxEdgeLength=0, MinEdgeLength=0.0001, MinTolerance=0, Refine=True, RefineAngle=0, RelativeTolerance=0.65, SimplePlanes=True, Tolerance=0})
nullrep_6 = ReplaceNulls(Items=int_87, Replacements=0)  # -> Items, Count
pshift_8 = ShiftPaths(Data=join_3, Offset=-1)  # disabled
nullrep_7 = ReplaceNulls(Items=int_88, Replacements=0)  # -> Items, Count
max_6 = Maximum(A=nullrep_5.Items, B=ttl_min)
nullrep_8 = ReplaceNulls(Items=int_86, Replacements=0)  # -> Items, Count
addition_4 = Addition(A=pdecon_2.XComponent, B=multiplication_17)
panel_92 = Panel("127.0.0.1")  # disabled
panel_93 = Panel("9000")  # disabled

# ---- group: O
int_107 = Integer(max_6)

# ----
max_7 = Maximum(A=nullrep_7.Items, B=type_min)
max_8 = Maximum(A=nullrep_6.Items, B=type_min)

# ---- group: intersections
crossings = Point([Point(156.25, 281.25, 0), Point(468.75, 281.25, 0), Point(718.75, 281.25, 0), Point(156.25, 656.25, 0), Point(468.75, 656.25, 0), Point(718.75, 656.25, 0), Point(906.25, 906.25, 0), Point(718.75, 906.25, 0), Point(468.75, 906.25, 0), Point(156.25, 906.25, 0), Point(906.25, 281.25, 0), Point(906.25, 656.25, 0), Point(906.25, 781.25, 0), Point(906.25, 531.25, 0), Point(906.25, 156.25, 0)])  # disabled

# ----
max_9 = Maximum(A=nullrep_8.Items, B=type_min)

# ---- group: all road pieces
pt_9 = Point([Point(906.25, 156.25, 0), Point(906.25, 531.25, 0), Point(906.25, 781.25, 0), Point(906.25, 656.25, 0), Point(906.25, 281.25, 0), Point(156.25, 906.25, 0)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])  # disabled

# ---- group: total ppl #
int_108 = Integer(int_95)  # disabled

# ----
number_slider_26 = Slider(700, range=700..35000)  # disabled
txt_23 = Text(pshift_8)  # disabled
panel_94 = Panel(txt_23)  # disabled
join_4 = TextJoin(Text=txt_23, Join=panel_78)  # disabled
txt_24 = Text(join_4)  # disabled
panel_95 = Panel("-0.8")  # disabled

# ---- group: traffic mode is PEV
bool_23 = Boolean(bool_16)  # disabled

# ---- group: Masks
preview_2 = CustomPreview(Geometry=mesh_11, Shader=ColourSwatch(SwatchColor=RGBA(0, 0, 0, 180)))

# ---- group: OL
int_109 = Integer(max_8)

# ---- group: OM
int_110 = Integer(max_9)

# ---- group: OS
int_111 = Integer(max_7)

# ----
addition_5 = Addition(A=int_111, B=int_110)
addition_6 = Addition(A=addition_5, B=int_109)
merge_6 = Merge(Data1=graft, Data2=int_111, Data3=addition_5, Data4=addition_6)

# ---- group: 0-1
remap_5 = RemapNumbers(Value=merge_6, Source=domain, Target=Domain(0, 1))  # -> Mapped, Clipped

# ----
multiplication_19 = Multiplication(A=remap_5.Mapped, B=subtraction_7)
addition_7 = Addition(A=pdecon_2.XComponent, B=multiplication_19)
pt_10 = ConstructPoint(XCoordinate=addition_7, YCoordinate=pdecon_2.YComponent, ZCoordinate=0)
move = Move(Geometry=pt_10, Motion=Y_4)  # -> Geometry, Transform
shift = ShiftList(List=move.Geometry, Shift=-1, Wrap=False)
pt_11 = Point(<point referenced from the Rhino model>)
col_6 = Colour(off_cold_2)
pt_12 = ConstructPoint(XCoordinate=addition_4, YCoordinate=pdecon_2.YComponent, ZCoordinate=0)
move_2 = Move(Geometry=pt_12, Motion=Y_5)  # -> Geometry, Transform
shift_2 = ShiftList(List=move_2.Geometry, Shift=-1, Wrap=False)
merge_7 = Merge(
    Data1=panel_70,
    Data2=txt_24,
    Data3=panel_71,
    Data4=panel_79,
    Data5=txt_17,
    Data6=panel_85,
    Data7=txt_19,
    Data8=panel_80,
    Data9=txt_20,
    Data10=panel_81,
    Data11=txt_21,
    Data12=panel_82,
    Data13=txt_22,
    Data14=panel_83,
    Data15=txt_13,
    Data16=panel_86,
    Data17=txt_16,
    Data18=panel_87,
    Data19=panel_68,
    Data20=txt_9,
    Data21=panel_84,
    Data22=join_2,
    Data23=panel_88,
    Data24=panel_89,
    Data25=panel_72)  # disabled
shift_3 = ShiftList(List=move.Geometry, Shift=1, Wrap=False)
shift_4 = ShiftList(List=move_2.Geometry, Shift=1, Wrap=False)
pt_13 = Point(<point referenced from the Rhino model>)
num_48 = Number(num_44)
pt_14 = Point(<point referenced from the Rhino model>)
num_49 = Number(num_44)
col_7 = Colour(off_cold_2)
pt_15 = Point(<point referenced from the Rhino model>)
num_50 = Number(num_44)
col_8 = Colour(off_cold_2)
col_9 = Colour(off_cold_2)

# ---- group: lower v sep ln
line_2 = LineSDL(Start=pt_10, Direction=Y_3, Length=number_slider_23)

# ---- group: h sep ln
ln = Line(StartPoint=pt_3, EndPoint=pt_4)

# ----
filter_25 = StreamFilter(Gate=int_97, Stream4=panel_93)  # disabled

# ---- group: OL
tag_4 = TextTag3D(Location=pt_14, Text=int_109, Size=num_49, Colour=col_8, Justification=7)

# ---- group: OS
tag_5 = TextTag3D(Location=pt_13, Text=int_111, Size=num_48, Colour=col_7, Justification=7)

# ---- group: OM
tag_6 = TextTag3D(Location=pt_15, Text=int_110, Size=num_50, Colour=col_9, Justification=7)

# ----
multiplication_20 = Multiplication(A=bool_23, B=panel_95)  # disabled
ln_2 = Line(StartPoint=shift, EndPoint=shift_3)
ln_3 = Line(StartPoint=shift_2, EndPoint=shift_4)

# ---- group: upper v sep ln
line_3 = LineSDL(Start=pt_12, Direction=Y_2, Length=number_slider_23)

# ----
neg_4 = Negative(Value=number_slider_23)
neg_5 = Negative(Value=number_slider_23)
join_5 = TextJoin(Text=merge_7)  # disabled
division_3 = Division(A=neg_4, B=6)
division_4 = Division(A=neg_5, B=6)
panel_96 = Panel("127.0.0.1")  # disabled
panel_97 = Panel("7002")  # disabled

# ---- group: Dashboard Text Size 3
size_3 = Slider(12, range=0..100)
num_51 = Number(size_3)

# ----
num_52 = Number(num_51)

# ---- group: residential total
tag_7 = TextTag3D(Location=pt_5, Text=int_103, Size=num_52, Colour=col_2, Justification=7)

# ----
num_53 = Number(num_51)

# ---- group: office total
tag_8 = TextTag3D(Location=pt_11, Text=int_107, Size=num_53, Colour=col_6, Justification=7)

# ----
Y_6 = UnitY(Factor=division_3)
Y_7 = UnitY(Factor=division_4)
pt_16 = Point(<point referenced from the Rhino model>)
int_112 = Integer(int_57)
pt_17 = Point(<point referenced from the Rhino model>)
int_113 = Integer(int_56)
pt_18 = Point(<point referenced from the Rhino model>)
int_114 = Integer(int_58)
col_10 = Colour(res_warm_2)
col_11 = Colour(res_warm_2)
num_54 = Number(num_51)
num_55 = Number(num_51)
col_12 = Colour(res_warm_2)
num_56 = Number(num_51)
division_5 = Division(A=number_slider_23, B=3)
division_6 = Division(A=number_slider_23, B=3)

# ---- group: json data to send
txt_25 = Text(join_5)  # disabled

txt_26 = Text(txt_25)  # disabled

# ----
panel_98 = Panel(txt_26)  # disabled
panel_99 = Panel(txt_25)  # disabled
udp_3 = UDPSender(Address=panel_92, Port=panel_93, Pattern=0, Data=txt_26)  # disabled

# ---- group: 2
tag_9 = TextTag3D(Location=pt_16, Text=int_112, Size=num_54, Colour=col_10, Justification=7)

# ---- group: 0
tag_10 = TextTag3D(Location=pt_17, Text=int_113, Size=num_55, Colour=col_11, Justification=7)

# ---- group: 1
tag_11 = TextTag3D(Location=pt_18, Text=int_114, Size=num_56, Colour=col_12, Justification=7)

# ----
move_3 = Move(Geometry=ln_2, Motion=Y_6)  # -> Geometry, Transform
move_4 = Move(Geometry=ln_3, Motion=Y_7)  # -> Geometry, Transform

# ---- group: balance two colors
number_slider_27 = Slider(0.8, range=0..1)  # disabled

# ----
Y_8 = UnitY(Factor=division_5)
Y_9 = UnitY(Factor=division_6)
subtraction_8 = Subtraction(A=1, B=number_slider_27)  # disabled
road_2 = ColourSwatch(SwatchColor=RGB(64, 64, 64))  # disabled

# ---- group: last pt O
item_15 = ListItem(List=pt_10, Index=-1, Wrap=True)

# ---- group: last pt R
item_16 = ListItem(List=pt_12, Index=-1, Wrap=True)

# ----
extr = Extrude(Base=move_3.Geometry, Direction=Y_8)
extr_2 = Extrude(Base=move_4.Geometry, Direction=Y_9)
udp_4 = UDPSender(Address=panel_96, Port=panel_97, Pattern=0, Data=txt_25)  # disabled
pt_19 = Point(<point referenced from the Rhino model>)
int_115 = Integer(int_61)
pt_20 = Point(<point referenced from the Rhino model>)
int_116 = Integer(int_59)
pt_21 = Point(<point referenced from the Rhino model>)
int_117 = Integer(int_60)
col_13 = Colour(off_cold_2)
col_14 = Colour(off_cold_2)
num_57 = Number(num_51)
num_58 = Number(num_51)
col_15 = Colour(off_cold_2)
num_59 = Number(num_51)
mesh_12 = Mesh(extr)
mesh_13 = Mesh(extr_2)
neg_6 = Negative(Value=number_slider_23)
division_7 = Division(A=neg_6, B=1.5)
division_8 = Division(A=number_slider_23, B=1.5)
Y_10 = UnitY(Factor=division_7)
move_5 = Move(Geometry=item_15, Motion=Y_10)  # -> Geometry, Transform
Y_11 = UnitY(Factor=division_8)
move_6 = Move(Geometry=item_16, Motion=Y_11)  # -> Geometry, Transform
argb = SplitARGB(Colour=road_2, IntegerChannels=True)  # -> Alpha, Red, Green, Blue; disabled

# ---- group: 5
tag_12 = TextTag3D(Location=pt_19, Text=int_115, Size=num_57, Colour=col_13, Justification=7)

# ---- group: 3
tag_13 = TextTag3D(Location=pt_20, Text=int_116, Size=num_58, Colour=col_14, Justification=7)

# ---- group: 4
tag_14 = TextTag3D(Location=pt_21, Text=int_117, Size=num_59, Colour=col_15, Justification=7)

# ----
mspray = MeshSpray(Mesh=graft(mesh_12), Points=Point(0, 0, 0), Colours=graft(merge_3), SprayMode=0)
panel_100 = Panel("127.0.0.1")  # disabled
mspray_2 = MeshSpray(Mesh=graft(mesh_13), Points=Point(0, 0, 0), Colours=graft(merge_3), SprayMode=0)
panel_101 = Panel("9001")  # disabled
X_3 = UnitX(Factor=5)
move_7 = Move(Geometry=move_5.Geometry, Motion=X_3)  # -> Geometry, Transform
X_4 = UnitX(Factor=5)
move_8 = Move(Geometry=move_6.Geometry, Motion=X_4)  # -> Geometry, Transform
vec = VectorXYZ(XComponent=argb.Red, YComponent=argb.Green, ZComponent=argb.Blue)  # -> Vector, Length; disabled
pshift_9 = ShiftPaths(Data=mspray, Offset=-1)
pshift_10 = ShiftPaths(Data=mspray_2, Offset=-1)

# ---- group: all sep lns
crv_31 = Curve([ln, line_3, line_2])

# ----
pt_22 = Point(move_7.Geometry)
num_60 = Number(num_43)
pt_23 = Point(move_8.Geometry)
num_61 = Number(num_43)
col_16 = Colour(off_cold_2)
col_17 = Colour(res_warm_2)
multiplication_21 = Multiplication(A=vec.Vector, B=subtraction_8)  # disabled
filter_26 = StreamFilter(Gate=int_97, Stream4=panel_101)  # disabled

# ---- group: work
mesh_14 = Mesh(pshift_9)

tag_15 = TextTag3D(Location=pt_22, Text="work", Size=num_60, Colour=col_16, Justification=4)

# ---- group: live
tag_16 = TextTag3D(Location=pt_23, Text="live", Size=num_61, Colour=col_17, Justification=4)

mesh_15 = Mesh(pshift_10)

# ----
preview_3 = CustomPreview(Geometry=crv_31, Shader=col)
udp_5 = UDPReceiver(Address=panel_100, Port=panel_101, Pattern=0)  # -> Info, Data; disabled

# ---- group: json data to send
# Send to CityIO Server
# (json, internet, Yasushi)
txt_27 = Text(txt_25)  # disabled

# ----
dam = DataDam(DataA=txt_27, BufferDelay=10000000, BufferMode=2)  # disabled

# ---- group: json data received
txt_28 = Text(udp_5.Data)  # disabled

# ----
panel_102 = Panel(txt_28)  # disabled
panel_103 = Panel("table/update/citymatrix")  # disabled
panel_104 = Panel("https://cityio.media.mit.edu")  # disabled
send_table_data = PythonScript(url=panel_104, path=panel_103, jsonString=dam)  # -> out; disabled
# ---------- send_table_data: Python ----------
import System 
import System.Net 
import System.Uri
import System.IO
import System.Text.Encoding
import json


def postTable(url,stringData,debug=False):
    webclient = System.Net.WebClient()
    webclient.Headers['Content-type'] = 'text/plain'
    
    if debug:
        
        # simple validation before we send
        try:
            json.loads(stringData)
        except:
            print 'invalid string, revise your string data'
            return
        
        # this will block your process
        data = System.Text.Encoding.Default.GetBytes(stringData)
        webclient.UploadData(url,'POST',data)
        
    else:
        data = System.Text.Encoding.Default.GetBytes(stringData)
        webclient.UploadDataAsync(url,'POST',data)

endpoint = System.Uri('{}/{}'.format(url,path))



postTable(endpoint,jsonString,False)
# rhino crashes using async callbacks,
# so try the following if something is wrong
# postData(endpoint,jsonString,debug=True)
# ---------- end send_table_data ----------
panel_105 = Panel(send_table_data)  # disabled
panel_106 = Panel("""-0.2
0.0
0.2
-0.4
0.0
0.4""")

# ---- group: type / module id
int_118 = Integer(int_10)

int_119 = Integer(int_10)

# ---- group: module id
int_120 = Integer(int_36)

# ---- group: viz ctrl - AI override
int_121 = Integer(int_83)

# ----
filter_27 = StreamFilter(Gate=int_121, Stream4=int_118)
panel_107 = Panel(int_121)

# ---- group: viz ctrl - AI override
int_122 = Integer(int_83)

# ----
filter_28 = StreamFilter(Gate=int_122, Stream5=int_119)
panel_108 = Panel(int_122)

# ---- group: viz ctrl - AI override
# Energy/Cost Efficiency Heatmap - GH
int_123 = Integer(int_83)

# ----
panel_109 = Panel(int_123)

# ---- group: shrink
cell_shrink = Slider(1, range=0.75..1)

# ----
move_z_3 = Slider(6.5, range=0..30)
filter_29 = StreamFilter(Gate=int_123, Stream3=int_120)
move_z_4 = Slider(5.5, range=0..10)
move_z_5 = Slider(6.5, range=0..10)

# ---- group: shrink
cell_shrink_2 = Slider(0.98, range=0.75..1)

# ---- group: gridExtent_x
int_124 = Integer(int_25)

# ---- group: shrink
num_62 = Number(cell_shrink_2)

# ---- group: gridExtent_y
int_125 = Integer(int_27)

# ---- group: rotation
int_126 = Integer(int_33)

# ---- group: module id
int_127 = Integer(int_36)

# ---- group: y
int_128 = Integer(int_31)

# ---- group: x
int_129 = Integer(int_29)

# ---- group: toggle1
bool_24 = Boolean(Toggle(True))

# ---- group: colortizer orgin
# LEGO Grid System
pt_24 = Point(<point referenced from the Rhino model>)

pt_25 = Point(pt_24)

# ---- group: table size ref pt
pt_26 = Point(<point referenced from the Rhino model>)

# ---- group: floor num for each type
int_130 = Integer(int_35)

# ---- group: colortizer orgin
pt_27 = Point(pt_24)

# ---- group: # ppl per flr
num_63 = Number(num_42)

# ---- group: gridExtent_x
# Energy/Cost Efficiency Formular:
# Sum of (Nearest N Building Population/Distance to that building)
int_131 = Integer(int_25)

# ---- group: gridExtent_y
int_132 = Integer(int_27)

# ---- group: x
int_133 = Integer(int_29)

# ---- group: y
int_134 = Integer(int_31)

# ---- group: module id
int_135 = Integer(filter_29)

# ---- group: shrink
num_64 = Number(cell_shrink)

# ---- group: gridExtent_x
# Traffic Heatmap - Machine Learning Server
int_136 = Integer(int_25)

# ---- group: gridExtent_y
int_137 = Integer(int_27)

# ---- group: colortizer orgin
pt_28 = Point(pt_24)

# ---- group: type / module id
int_138 = Integer(filter_27)

# ---- group: shrink
num_65 = Number(num_62)

# ---- group: x
num_66 = Number(num_22)

# ---- group: y
num_67 = Number(num_23)

# ---- group: traffic value
num_68 = Number(num_26)

# ---- group: waiting time value
num_69 = Number(num_27)

# ---- group: gridExtent_x
# Solar Access Heatmap - Machine Learning Server
int_139 = Integer(int_25)

# ---- group: gridExtent_y
int_140 = Integer(int_27)

# ---- group: colortizer orgin
pt_29 = Point(pt_24)

# ---- group: type / module id
int_141 = Integer(filter_28)

# ---- group: shrink
num_70 = Number(num_62)

# ---- group: x
num_71 = Number(num_22)

# ---- group: y
num_72 = Number(num_23)

# ---- group: solar value
num_73 = Number(num_24)

# ----
Z_2 = UnitZ(Factor=20)  # disabled
# Dashboard
# Dock
panel_110 = Panel("Residential")

# ---- group: dockID
int_142 = Integer(int_34)

# ---- group: dockRotation
int_143 = Integer(int_42)

# ----
swatch = ColourSwatch(SwatchColor=RGB(255, 255, 255))  # disabled
panel_111 = Panel("C:\Users\RYAN\Documents\GitHub\CityMatrix\Map\Amenities Maps\Amenities_Trans.png")  # disabled
panel_112 = Panel("C:\Users\RYAN\Documents\GitHub\CityMatrix\Map\Amenities Maps\Amenities_85Alpha.png")  # disabled
# C:\Users\RYAN\Documents\GitHub\CityMatrix\Map\HAMBURG RS 1600pxl.jpg
panel_113 = Panel("0.0")  # disabled
xy_2 = XYPlane(Origin=pt_24)
dist = Distance(PointA=pt_24, PointB=pt_26)

# ---- group: crv with arrow - cell to change
crv_32 = Curve(crv_28)

# ---- group: crvs with arrow - density value suggested
crv_33 = Curve(crv_26)

# ---- group: rect crvs - no off set
crv_34 = Curve(crv_29)

# ---- group: module meshes lego ref: -1
mesh_16 = Mesh(mesh)

# ---- group: module meshes lego ref: 0 to 5
mesh_17 = Mesh(mesh_2)

# ----
multiplication_22 = Multiplication(A=int_130, B=num_63)
neg_7 = Negative(Value=int_143)
subtraction_9 = Subtraction(A="16", B=num_66)
division_9 = Division(A=dist, B=int_124)

# ---- group: influence range - distance limit
number_slider_28 = Slider(200, range=0..1000)

# ----
txt_29 = Text(["Large Unit", "Medium Unit", "Small Unit", "Large Unit", "Medium Unit", "Small Unit"])

# ---- group: infulence range - # nearest
range_count = Slider(49, range=1..130)

# ----
movetoorgin = MoveToOrgin(G=mesh_16, num=num_62)
movetoorgin_2 = MoveToOrgin(G=mesh_17, num=num_62)
txt_30 = Text([panel_110, "Residential", "Residential", "Office", "Office", "Office"])

# ---- group: base cplane
pln = Plane(xy_2)

# ----
# Google Map @ Lego
planesrf = PlaneSurface(Plane=pln, XSize=Domain(0, 1000), YSize=Domain(-1000, 0))  # disabled
move_9 = Move(Geometry=planesrf, Motion=Z_2)  # -> Geometry, Transform; disabled

# ---- group: road check matrix
python = PythonScript(xe=int_124, ye=int_125, x=int_129, y=int_128, id=int_127)  # -> out, m; inputs x: list, y: list, id: list
# ---------- python: Python ----------
"""
CityMatrix

written by "Ryan" Yan Zhang <ryanz@mit.edu>
for MIT Media Lab, Changing Place Group
April.6th.2016
"""

import rhinoscriptsyntax as rs

m = [[-1 for n in range(xe)] for n in range(ye)]

#for n in range(len(id)):
#    if id[n] == 7:
#        m[y[n]][x[n]] = 6
#    else:
#        m[y[n]][x[n]] = id[n]

for n in range(len(id)):
    m[y[n]][x[n]] = id[n]

for n in range(ye):
    print m[n]
# ---------- end python ----------

python_2 = PythonScript(xe=int_124, ye=int_125, x=int_129, y=int_128, id=int_127)  # -> out, m; inputs x: list, y: list, id: list; same code as python

# ---- group: sidewalk check matrix
python_3 = PythonScript(xe=int_124, ye=int_125, x=int_129, y=int_128, id=int_127)  # -> out, m; inputs x: list, y: list, id: list; same code as python

# ----
larger_2 = LargerThan(FirstNumber=int_135, SecondNumber="0")  # -> LargerThan, OrEqualTo
smaller = SmallerThan(FirstNumber=int_135, SecondNumber="5")  # -> SmallerThan, OrEqualTo
number_slider_29 = Slider(14, range=0..100)
item_17 = ListItem(List=txt_29, Index=int_142, Wrap=False)

# ---- group: private car / road quator 0s
mesh_18 = Mesh([<mesh referenced from the Rhino model> x4])
pt_30 = Point(<point referenced from the Rhino model>)

# ----
item_18 = ListItem(List=txt_30, Index=int_142, Wrap=False)

# ---- group: private car / center line quator 0s
mesh_19 = Mesh([<mesh referenced from the Rhino model> x4])
pt_31 = Point(<point referenced from the Rhino model>)

# ---- group: private car / sidewalk quator 0s
mesh_20 = Mesh([<mesh referenced from the Rhino model> x4])
pt_32 = Point(<point referenced from the Rhino model>)

# ----
pt_33 = Point(<point referenced from the Rhino model>)

# ---- group: cell size
num_74 = Number(division_9)

num_75 = Number(num_74)

# ----
filter_30 = StreamFilter(Gate=int_80, Stream24=num_75)

# ---- group: cell size
num_76 = Number(filter_30)

# ----
modulecenter = ModuleCenter(pt=pt_25, num=num_76, int_2=int_62, int=int_63)  # -> pt_5, transform_2
division_10 = Division(A=num_76, B=2)
neg_8 = Negative(Value=division_10)
dom_4 = ConstructDomain(DomainStart=neg_8, DomainEnd=division_10)
rectangle = Rectangle(Plane=PlaneXY(0, 0, 0), XSize=dom_4, YSize=dom_4, Radius=0)  # -> Rectangle, Length

# ---- group: module center
pt_34 = Point(modulecenter.pt_5)

# ---- group: module center suggested
pt_35 = Point(pt_34)

# ----
cellchangearrowcrv = CellChangeArrowCrv(int=int_45, pt=pt_35, pt_2=pt, num=num_35)
addarrowhead_3 = AddArrowHead(crv=cellchangearrowcrv, num=num_35)
crv_35 = Curve(rectangle.Rectangle)
move_10 = Move(Geometry=rectangle.Rectangle, Motion=Z)  # -> Geometry, Transform
move_11 = Move(Geometry=move_10.Geometry, Motion=X_2)  # -> Geometry, Transform
vec2pt = Vector2Pt(PointA=Point(0, 0, 0), PointB=pt_34, Unitize=False)  # -> Vector, Length

# ---- group: rect crv at orgin
crv_36 = Curve(move_11.Geometry)

# ----
move_12 = Move(Geometry=crv_36, Motion=vec2pt.Vector)  # -> Geometry, Transform

# ---- group: no crv if no id
null_2 = NullItem(Item=int_62)  # -> NullFlags, InvalidFlags, Description
filter_31 = StreamFilter(Gate=null_2.NullFlags, Stream0=move_12.Geometry)

# ---- group: cell change arrow crv
crv_37 = Curve(addarrowhead_3)

# ----
filter_32 = StreamFilter(Gate=bool_14, Stream1=filter_31)  # disabled

# ---- group: rect crvs at module centers
crv_38 = Curve(filter_31)

# ---- group: cell size
num_77 = Number(num_74)

num_78 = Number(num_74)

num_79 = Number(num_74)

# ----
filter_33 = StreamFilter(Gate=int_121, Stream4=num_77)
filter_34 = StreamFilter(Gate=int_122, Stream5=num_78)
filter_35 = StreamFilter(Gate=int_123, Stream3=num_79)

# ---- group: cell size
num_80 = Number(filter_35)

num_81 = Number(filter_33)

num_82 = Number(filter_34)

# ---- group: cell change arrow crv
crv_39 = Curve(crv_37)

# ---- group: square crvs to highlight
# AI Suggestion Highlighter
crv_40 = Curve(crv_38)

# ----
modulecenter_2 = ModuleCenter(pt=pt_27, num=num_80, int_2=int_133, int=int_134)  # -> pt_5, transform_2
division_11 = Division(A=num_80, B=2)
neg_9 = Negative(Value=division_11)
division_12 = Division(A=num_81, B=2)
neg_10 = Negative(Value=division_12)
division_13 = Division(A=num_82, B=2)
neg_11 = Negative(Value=division_13)
dom_5 = ConstructDomain(DomainStart=neg_9, DomainEnd=division_11)
modulecenter_3 = ModuleCenter(pt=pt_24, num=num_74, int_2=int_129, int=int_128)  # -> pt_5, transform_2

# ---- group: # ppl per building
num_83 = Number(multiplication_22)

# ----
panel_114 = Panel(num_83)
dom_6 = ConstructDomain(DomainStart=neg_10, DomainEnd=division_12)
swatch_2 = ColourSwatch(SwatchColor=RGB(255, 255, 255))
dom_7 = ConstructDomain(DomainStart=neg_11, DomainEnd=division_13)

# ---- group: module center
pt_36 = Point(modulecenter_3.pt_5)

pt_37 = Point(pt_36)

# ----
offset = Offset(Curve=crv_40, Distance=Slider(15, range=0..100), Plane=PlaneXY(0, 0, 0), Corners=1)
and = GateAnd(A=larger_2.OrEqualTo, B=smaller.OrEqualTo)
vec2pt_2 = Vector2Pt(PointA=Point(0, 0, 0), PointB=pt_33, Unitize=False)  # -> Vector, Length

# ---- group: private car / road quator 1s
mesh_21 = Mesh([<mesh referenced from the Rhino model> x4])
pt_38 = Point(<point referenced from the Rhino model>)

# ---- group: private car
scale_nu = ScaleNU(Geometry=mesh_18, Plane=pt_30, ScaleX=num_62, ScaleY=num_62, ScaleZ=1)  # -> Geometry, Transform
scale_nu_2 = ScaleNU(Geometry=mesh_21, Plane=pt_38, ScaleX=num_62, ScaleY=num_62, ScaleZ=1)  # -> Geometry, Transform

# ---- group: private car / center line quator 1s
mesh_22 = Mesh([<mesh referenced from the Rhino model> x4])
pt_39 = Point(<point referenced from the Rhino model>)

# ---- group: private car
scale_nu_3 = ScaleNU(Geometry=mesh_19, Plane=pt_31, ScaleX=num_62, ScaleY=num_62, ScaleZ=1)  # -> Geometry, Transform
scale_nu_4 = ScaleNU(Geometry=mesh_22, Plane=pt_39, ScaleX=num_62, ScaleY=num_62, ScaleZ=1)  # -> Geometry, Transform

# ---- group: road check list
python_4 = PythonScript(xe=int_124, ye=int_125, x=int_129, y=int_128, id=int_127, m=python.m)  # -> out, rdType; inputs x: list, y: list, id: list, m: list
# ---------- python_4: Python ----------
"""
CityMatrix

written by "Ryan" Yan Zhang <ryanz@mit.edu>
for MIT Media Lab, Changing Place Group
April.6th.2016
"""

import rhinoscriptsyntax as rs

rdType = []

for n in range(len(id)):
    
    code = []
    
    if id[n]==6:
        
        # 0: check x, y+1
        if y[n]+1>ye-1:
            code.append(1)
        else:
            if m[y[n]+1][x[n]]==6:
                code.append(1)
            else:
                code.append(0)
        
        # 1: check x+1, y
        if x[n]+1>xe-1:
            code.append(1)
        else:
            if m[y[n]][x[n]+1]==6:
                code.append(1)
            else:
                code.append(0)
        
        # 2: check x, y-1
        if y[n]-1<0:
            code.append(1)
        else:
            if m[y[n]-1][x[n]]==6:
                code.append(1)
            else:
                code.append(0)
        
        # 3: check x-1, y
        if x[n]-1<0:
            code.append(1)
        else:
            if m[y[n]][x[n]-1]==6:
                code.append(1)
            else:
                code.append(0)
    
    else:
        
        code = [0,0,0,0]
    
    print code
    rdType.append(code)
# ---------- end python_4 ----------

python_5 = PythonScript(xe=int_124, ye=int_125, x=int_129, y=int_128, id=int_127, m=python_2.m)  # -> out, rdType; inputs x: list, y: list, id: list, m: list; same code as python_4

# ---- group: type / module id
int_144 = Integer(int_138)

# ---- group: x
num_84 = Number(subtraction_9)

# ---- group: y
num_85 = Number(num_67)

# ----
modulecenter_4 = ModuleCenter(pt=pt_28, num=num_81, int_2=num_84, int=num_85)  # -> pt_5, transform_2

# ---- group: traffic value
num_86 = Number(num_68)

# ---- group: waiting time value
num_87 = Number(num_69)

# ---- group: private car / sidewalk quator 1s
mesh_23 = Mesh([<mesh referenced from the Rhino model> x4])
pt_40 = Point(<point referenced from the Rhino model>)

# ---- group: private car
scale_nu_5 = ScaleNU(Geometry=mesh_20, Plane=pt_32, ScaleX=num_62, ScaleY=num_62, ScaleZ=1)  # -> Geometry, Transform
scale_nu_6 = ScaleNU(Geometry=mesh_23, Plane=pt_40, ScaleX=num_62, ScaleY=num_62, ScaleZ=1)  # -> Geometry, Transform

# ---- group: type / module id
int_145 = Integer(int_141)

# ---- group: x
num_88 = Number(num_71)

# ---- group: y
num_89 = Number(num_72)

# ----
modulecenter_5 = ModuleCenter(pt=pt_29, num=num_82, int_2=num_88, int=num_89)  # -> pt_5, transform_2

# ---- group: solar value
num_90 = Number(num_73)

# ---- group: sidewalk check list
python_6 = PythonScript(xe=int_124, ye=int_125, x=int_129, y=int_128, id=int_127, m=python_3.m)  # -> out, rdType; inputs x: list, y: list, id: list, m: list; same code as python_4

# ----
pt_41 = Point(<point referenced from the Rhino model>)
pt_42 = Point(<point referenced from the Rhino model>)
planesrf_2 = PlaneSurface(Plane=PlaneXY(0, 0, 0), XSize=dom_5, YSize=dom_5)
crv_41 = Curve(offset)
planesrf_3 = PlaneSurface(Plane=PlaneXY(0, 0, 0), XSize=dom_6, YSize=dom_6)
planesrf_4 = PlaneSurface(Plane=PlaneXY(0, 0, 0), XSize=dom_7, YSize=dom_7)

# ---- group: connected and offset ref crvs
crv_42 = Curve(crv_34)

# ---- group: module center
pt_43 = Point(modulecenter_2.pt_5)

# ---- group: isBuilding
bool_25 = Boolean(and)

# ---- group: unit name
tag_17 = TextTag3D(Location=pt_41, Text=item_17, Size=number_slider_29, Colour=swatch_2, Justification=5)

# ---- group: module meshes lego at orgin
mesh_24 = Mesh(movetoorgin)

mesh_25 = Mesh(movetoorgin_2)

# ----
item_19 = ListItem(List=mesh_25, Index=int_142, Wrap=False)
rotate = Rotate(Geometry=item_19, Angle=degrees(int_143), Plane=PlaneXY(0, 0, 0))  # -> Geometry, Transform
move_13 = Move(Geometry=rotate.Geometry, Motion=vec2pt_2.Vector)  # -> Geometry, Transform

# ---- group: res/off
tag_18 = TextTag3D(Location=pt_42, Text=item_18, Size=number_slider_29, Colour=swatch_2, Justification=5)

# ----
pshift_11 = ShiftPaths(Data=crv_41, Offset=-1)
lng_2 = ListLength(List=pshift_11)
larger_3 = LargerThan(FirstNumber=lng_2, SecondNumber=1)  # -> LargerThan, OrEqualTo

# ---- group: PEV / road quator 0s
mesh_26 = Mesh([<mesh referenced from the Rhino model> x4])
pt_44 = Point(<point referenced from the Rhino model>)

# ---- group: PEV / center line quator 0s
mesh_27 = Mesh(mesh_19)
pt_45 = Point(pt_31)

# ---- group: PEV / sidewalk quator 0s
mesh_28 = Mesh([<mesh referenced from the Rhino model> x4])
pt_46 = Point(<point referenced from the Rhino model>)

# ----
scale_nu_7 = ScaleNU(Geometry=planesrf_2, Plane=PlaneXY(0, 0, 0), ScaleX=num_64, ScaleY=num_64, ScaleZ=1)  # -> Geometry, Transform
Z_3 = UnitZ(Factor=move_z_3)
scale_nu_8 = ScaleNU(Geometry=planesrf_3, Plane=PlaneXY(0, 0, 0), ScaleX=num_65, ScaleY=num_65, ScaleZ=1)  # -> Geometry, Transform
Z_4 = UnitZ(Factor=move_z_4)
scale_nu_9 = ScaleNU(Geometry=planesrf_4, Plane=PlaneXY(0, 0, 0), ScaleX=num_70, ScaleY=num_70, ScaleZ=1)  # -> Geometry, Transform
Z_5 = UnitZ(Factor=move_z_5)

# ---- group: module center
pt_47 = Point(modulecenter_4.pt_5)

pt_48 = Point(modulecenter_5.pt_5)

# ----
dispatch_3 = Dispatch(List=int_135, DispatchPattern=bool_25)  # -> ListA, ListB
dispatch_4 = Dispatch(List=pt_43, DispatchPattern=bool_25)  # -> ListA, ListB

# ---- group: dock lego modules
mesh_29 = Mesh(move_13.Geometry)

# ----
larger_4 = LargerThan(FirstNumber=int_127, SecondNumber="0")  # -> LargerThan, OrEqualTo
smaller_2 = SmallerThan(FirstNumber=int_127, SecondNumber="5")  # -> SmallerThan, OrEqualTo
runion = RegionUnion(Curves=pshift_11)

# ---- group: PEV / road quator 1s
mesh_30 = Mesh([<mesh referenced from the Rhino model> x4])
pt_49 = Point(<point referenced from the Rhino model>)

# ---- group: PEV
scale_nu_10 = ScaleNU(Geometry=mesh_26, Plane=pt_44, ScaleX=num_62, ScaleY=num_62, ScaleZ=1)  # -> Geometry, Transform
scale_nu_11 = ScaleNU(Geometry=mesh_30, Plane=pt_49, ScaleX=num_62, ScaleY=num_62, ScaleZ=1)  # -> Geometry, Transform

# ---- group: PEV / center line quator 1s
mesh_31 = Mesh(mesh_22)
pt_50 = Point(pt_39)

# ---- group: PEV
scale_nu_12 = ScaleNU(Geometry=mesh_27, Plane=pt_45, ScaleX=num_62, ScaleY=num_62, ScaleZ=1)  # -> Geometry, Transform
scale_nu_13 = ScaleNU(Geometry=mesh_31, Plane=pt_50, ScaleX=num_62, ScaleY=num_62, ScaleZ=1)  # -> Geometry, Transform

# ----
move_14 = Move(Geometry=scale_nu_7.Geometry, Motion=Z_3)  # -> Geometry, Transform

# ---- group: PEV / sidewalk quator 1s
mesh_32 = Mesh([<mesh referenced from the Rhino model> x4])
pt_51 = Point(<point referenced from the Rhino model>)

# ---- group: PEV
scale_nu_14 = ScaleNU(Geometry=mesh_28, Plane=pt_46, ScaleX=num_62, ScaleY=num_62, ScaleZ=1)  # -> Geometry, Transform
scale_nu_15 = ScaleNU(Geometry=mesh_32, Plane=pt_51, ScaleX=num_62, ScaleY=num_62, ScaleZ=1)  # -> Geometry, Transform

# ----
move_15 = Move(Geometry=scale_nu_8.Geometry, Motion=Z_4)  # -> Geometry, Transform
move_16 = Move(Geometry=scale_nu_9.Geometry, Motion=Z_5)  # -> Geometry, Transform
subtraction_10 = Subtraction(A=int_136, B=1)
and_2 = GateAnd(A=larger_4.OrEqualTo, B=smaller_2.OrEqualTo)
dispatch_5 = Dispatch(List=int_127, DispatchPattern=and_2)  # -> ListA, ListB

# ---- group: filted id
int_146 = Integer(dispatch_5.ListA)

# ----
item_20 = ListItem(List=int_48, Index=graft(int_146), Wrap=True)
pshift_12 = ShiftPaths(Data=item_20, Offset=-1)

# ---- group: flr #s
txt_31 = Text(pshift_12)

# ----
item_21 = ListItem(List=num_41, Index=graft(int_146), Wrap=True)
item_22 = ListItem(List=num_39, Index=graft(int_146), Wrap=True)
item_23 = ListItem(List=num_40, Index=graft(int_146), Wrap=True)
pshift_13 = ShiftPaths(Data=item_21, Offset=-1)
pshift_14 = ShiftPaths(Data=item_22, Offset=-1)
pshift_15 = ShiftPaths(Data=item_23, Offset=-1)

# ---- group: old per flr
num_91 = Number(pshift_13)

# ---- group: young per flr
num_92 = Number(pshift_14)

# ---- group: mid per flr
num_93 = Number(pshift_15)

# ----
multiplication_23 = Multiplication(A=num_93, B=txt_31)
multiplication_24 = Multiplication(A=num_92, B=txt_31)
multiplication_25 = Multiplication(A=num_91, B=txt_31)

# ---- group: total ppl in building mid
int_147 = Integer(multiplication_23)

# ---- group: total ppl in building young
int_148 = Integer(multiplication_24)

# ----
addition_8 = Addition(A=int_148, B=int_147)

# ---- group: total ppl in building old
int_149 = Integer(multiplication_25)

# ----
addition_9 = Addition(A=addition_8, B=int_149)

# ---- group: total ppl in building - all
int_150 = Integer(addition_9)

# ----
simplify = SimplifyCurve(Curve=runion)  # -> Curve, Simplified
filter_36 = StreamFilter(Gate=larger_3.LargerThan, Stream0=crv_41, Stream1=simplify.Curve)

# ---- group: module center - building only
pt_52 = Point(dispatch_4.ListA)

# ----
cps = ClosestPoints(Point=pt_43, Cloud=pt_52, Count=range_count)  # -> ClosestPoint, CPIndex, Distance
smaller_3 = SmallerThan(FirstNumber=cps.Distance, SecondNumber=number_slider_28)  # -> SmallerThan, OrEqualTo

# ---- group: module id - building only
int_151 = Integer(dispatch_3.ListA)

# ----
item_24 = ListItem(List=int_151, Index=cps.CPIndex, Wrap=False)
vec2pt_3 = Vector2Pt(PointA=Point(0, 0, 0), PointB=pt_43, Unitize=False)  # -> Vector, Length

# ---- group: toggle1
bool_26 = Boolean(bool_24)

# ----
filter_37 = StreamFilter(Gate=bool_26, Stream0=scale_nu.Geometry, Stream1=scale_nu_10.Geometry)
filter_38 = StreamFilter(Gate=bool_26, Stream0=scale_nu_2.Geometry, Stream1=scale_nu_11.Geometry)

# ---- group: toggle1
bool_27 = Boolean(bool_24)

# ----
filter_39 = StreamFilter(Gate=bool_27, Stream0=scale_nu_3.Geometry, Stream1=scale_nu_12.Geometry)
filter_40 = StreamFilter(Gate=bool_27, Stream0=scale_nu_4.Geometry, Stream1=scale_nu_13.Geometry)

# ---- group: mesh srf at orgin
mesh_33 = Mesh(move_14.Geometry)

# ---- group: toggle1
bool_28 = Boolean(bool_24)

# ----
filter_41 = StreamFilter(Gate=bool_28, Stream0=scale_nu_5.Geometry, Stream1=scale_nu_14.Geometry)
filter_42 = StreamFilter(Gate=bool_28, Stream0=scale_nu_6.Geometry, Stream1=scale_nu_15.Geometry)
vec2pt_4 = Vector2Pt(PointA=Point(0, 0, 0), PointB=pt_48, Unitize=False)  # -> Vector, Length

# ---- group: mesh srf at orgin
mesh_34 = Mesh(move_15.Geometry)

# ----
dispatch_6 = Dispatch(List=cps.ClosestPoint, DispatchPattern=smaller_3.OrEqualTo)  # -> ListA, ListB
dispatch_7 = Dispatch(List=item_24, DispatchPattern=smaller_3.OrEqualTo)  # -> ListA, ListB
dispatch_8 = Dispatch(List=int_127, DispatchPattern=and_2)  # -> ListA, ListB
subtraction_11 = Subtraction(A=subtraction_10, B=num_84)
dispatch_9 = Dispatch(List=cps.Distance, DispatchPattern=smaller_3.OrEqualTo)  # -> ListA, ListB

# ---- group: mesh srf at orgin
mesh_35 = Mesh(move_16.Geometry)

# ---- group: translate example
pt_53 = Point(Point(-15, -8, 0))  # disabled
python_7 = PythonScript(point=pt_53)  # -> out, output; inputs point: Point3d; disabled
# ---------- python_7: Python ----------
import Rhino

transform = Rhino.Geometry.Transform.Translation(0,0,5)
point.Transform(transform)

output = point
# ---------- end python_7 ----------

# ----
int_152 = Integer(bool_22)
panel_115 = Panel(int_152)

# ---- group: toggle1
# Toggles
bool_29 = Boolean(bool_16)

# ---- group: toggle2
bool_30 = Boolean(bool_17)

bool_31 = Boolean(bool_30)  # disabled

# ---- group: connected and offset ref crvs
crv_43 = Curve(filter_36)

# ---- group: toggle3
bool_32 = Boolean(bool_18)

# ---- group: toggle4
bool_33 = Boolean(bool_19)

# ----
move_17 = Move(Geometry=mesh_33, Motion=vec2pt_3.Vector)  # -> Geometry, Transform
smaller_4 = SmallerThan(FirstNumber=int_127, SecondNumber="0")  # -> SmallerThan, OrEqualTo
mesh_36 = Mesh(filter_38)
mesh_37 = Mesh(filter_37)
mesh_38 = Mesh(filter_40)
mesh_39 = Mesh(filter_39)
equals_11 = Equality(FirstNumber=int_144, SecondNumber="6")  # -> Equality, Inequality
mesh_40 = Mesh(filter_42)
hatchtable = HatchTable(Update=True)
mesh_41 = Mesh(filter_41)
item_25 = ListItem(List=mesh_25, Index=graft(dispatch_8.ListA), Wrap=False)
move_18 = Move(Geometry=mesh_35, Motion=vec2pt_4.Vector)  # -> Geometry, Transform
fillet = FilletDistance(Curve=[crv_43, crv_42], Distance=Slider(15, range=0..100))

# ---- group: x flipped
num_94 = Number(subtraction_11)

# ---- group: blink2
filter_43 = StreamFilter(Gate=Slider(1, range=0..1), Stream1=[crv_32, crv_33, crv_39])

# ----
filter_44 = StreamFilter(Gate=bool_26, Stream0=pt_30, Stream1=pt_44)
filter_45 = StreamFilter(Gate=bool_26, Stream0=pt_38, Stream1=pt_49)
filter_46 = StreamFilter(Gate=bool_27, Stream0=pt_31, Stream1=pt_45)
filter_47 = StreamFilter(Gate=bool_27, Stream0=pt_39, Stream1=pt_50)

# ---- group: bldg cntr in range
pt_54 = Point(dispatch_6.ListA)

# ---- group: distances in range
num_95 = Number(dispatch_9.ListA)

# ----
filter_48 = StreamFilter(Gate=bool_28, Stream0=pt_32, Stream1=pt_46)
filter_49 = StreamFilter(Gate=bool_28, Stream0=pt_40, Stream1=pt_51)

# ---- group: module ids in range
int_153 = Integer(dispatch_7.ListA)

# ----
dispatch_10 = Dispatch(List=pt_36, DispatchPattern=smaller_4.SmallerThan)  # -> ListA, ListB
rad = Radians(Degrees=Slider(45, range=0..100))
show_google_map = BooleanToggle(False)
filter_50 = StreamFilter(Gate=show_google_map, Stream1=move_9.Geometry)  # disabled
previewmat = CustomPreviewMaterials(Geometry=filter_50, DiffuseColor=swatch, Transparency=panel_113, DiffuseBitmap=panel_111)  # disabled
item_26 = ListItem(List=hatchtable, Index=Slider(1, range=0..1), Wrap=False)

# ---- group: mesh srfs at module centers
mesh_42 = Mesh(move_17.Geometry)

# ----
pshift_16 = ShiftPaths(Data=item_25, Offset=-1)

# ---- group: isRoad
bool_34 = Boolean(equals_11.Equality)

# ----
dispatch_11 = Dispatch(List=pt_47, DispatchPattern=bool_34)  # -> ListA, ListB

# ---- group: module center road only
pt_55 = Point(dispatch_11.ListA)

# ----
vec2pt_5 = Vector2Pt(PointA=Point(0, 0, 0), PointB=pt_55, Unitize=False)  # -> Vector, Length
move_19 = Move(Geometry=mesh_34, Motion=vec2pt_5.Vector)  # -> Geometry, Transform
dispatch_12 = Dispatch(List=num_86, DispatchPattern=bool_34)  # -> ListA, ListB
dispatch_13 = Dispatch(List=num_87, DispatchPattern=bool_34)  # -> ListA, ListB
dispatch_14 = Dispatch(List=int_126, DispatchPattern=and_2)  # -> ListA, ListB
crv_44 = Curve(fillet)

# ---- group: mesh srfs at module centers
mesh_43 = Mesh(move_19.Geometry)

mesh_44 = Mesh(move_18.Geometry)

# ----
vec2pt_6 = Vector2Pt(PointA=Point(0, 0, 0), PointB=dispatch_10.ListA, Unitize=False)  # -> Vector, Length
item_27 = ListItem(List=panel_106, Index=int_153, Wrap=False)
item_28 = ListItem(List=int_130, Index=int_153, Wrap=False)
pt_56 = Point(filter_45)
pt_57 = Point(filter_47)
pt_58 = Point(filter_44)

# ---- group: road check list
python_8 = PythonScript(pt=pt_36, id=int_127, rdType=python_4.rdType, rdQua0=mesh_37, c0=pt_58, rdQua1=mesh_36, c1=pt_56)  # -> out, allRoadMesh; inputs pt: list, id: list, rdType: list, rdQua0: list, rdQua1: list
# ---------- python_8: Python ----------
"""
CityMatrix

written by "Ryan" Yan Zhang <ryanz@mit.edu>
for MIT Media Lab, Changing Place Group
April.6th.2016
"""

import rhinoscriptsyntax as rs
import Rhino.Geometry as rg

allRoadMesh = []

for n in range(len(id)):
    
    if id[n]==6:
        
        for i in range(len(rdType[n])):
            t = rdType[n][i]
            v = rs.PointCoordinates(pt[n])
            if t == 0:
                c = rs.PointCoordinates(c0)
                vx = v[0]-c[0]
                vy = v[1]-c[1]
                new = rs.CopyObject(rdQua0[i],(vx,vy,0.))
            else:
                c = rs.PointCoordinates(c1)
                vx = v[0]-c[0]
                vy = v[1]-c[1]
                new = rs.CopyObject(rdQua1[i],(vx,vy,0.))
            allRoadMesh.append(new)
# ---------- end python_8 ----------
# ----
pt_59 = Point(filter_46)

# ---- group: road check list
python_9 = PythonScript(pt=pt_36, id=int_127, rdType=python_5.rdType, rdQua0=mesh_39, c0=pt_59, rdQua1=mesh_38, c1=pt_57)  # -> out, allRoadMesh; inputs pt: list, id: list, rdType: list, rdQua0: list, rdQua1: list; same code as python_8

# ----
pt_60 = Point(filter_49)
pt_61 = Point(filter_48)

# ---- group: sidewalk check list
python_10 = PythonScript(pt=pt_36, id=int_127, rdType=python_6.rdType, rdQua0=mesh_41, c0=pt_61, rdQua1=mesh_40, c1=pt_60)  # -> out, allRoadMesh; inputs pt: list, id: list, rdType: list, rdQua0: list, rdQua1: list; same code as python_8

# ----
dashline2_0 = DashLine20(crv=crv_44, num=Slider(7.5, range=0..100))
addition_10 = Addition(A=num_95, B=num_80)
createhatch = CreateHatch(Bake=Toggle(False), Curves=crv_44, HatchPatternName=item_26, HatchScale=Slider(75, range=0..100), HatchRotation=rad)
swatch_3 = ColourSwatch(SwatchColor=RGB(255, 127, 0))
txt_32 = Text(["Amenity On", "Amenity Off"])
txt_33 = Text(["Human Int. On", "Human Int. Off"])
txt_34 = Text(["Sat. Map On", "Sat. Map Off"])
swatch_4 = ColourSwatch(SwatchColor=RGB(255, 0, 0))  # disabled
txt_35 = Text(["Next", "- Next -"])
rotate_2 = Rotate(Geometry=pshift_16, Angle=degrees(dispatch_14.ListA), Plane=PlaneXY(0, 0, 0))  # -> Geometry, Transform
graft_2 = GraftTree(Tree=rotate_2.Transform, IncludeEmptyLists=True, IncludeNullItems=True)

# ---- group: traffic value - road
num_96 = Number(dispatch_12.ListA)

# ----
bnd = Bounds(Numbers=num_96)
panel_116 = Panel(bnd)
dispatch_15 = Dispatch(List=pt_36, DispatchPattern=and_2)  # -> ListA, ListB

# ---- group: wait value - road
num_97 = Number(dispatch_13.ListA)

# ----
bnd_2 = Bounds(Numbers=num_97)
panel_117 = Panel(bnd_2)

# ---- group: solar value
num_98 = Number(num_90)

# ----
bnd_3 = Bounds(Numbers=num_98)
panel_118 = Panel(bnd_3)
number_slider_30 = Slider(7, range=0..100)
move_20 = Move(Geometry=mesh_24, Motion=vec2pt_6.Vector)  # -> Geometry, Transform
multiplication_26 = Multiplication(A=item_27, B=item_28)
dispatch_16 = Dispatch(List=num_86, DispatchPattern=bool_34)  # -> ListA, ListB
item_29 = ListItem(List=txt_32, Index=bool_32, Wrap=True)
item_30 = ListItem(List=txt_34, Index=bool_33, Wrap=True)
item_31 = ListItem(List=txt_33, Index=bool_30, Wrap=True)
item_32 = ListItem(List=txt_35, Index=bool_29, Wrap=True)

# ---- group: AI Step
int_154 = Integer(int_4)

# ----
panel_119 = Panel(int_154)
swatch_5 = ColourSwatch(SwatchColor=RGB(125, 125, 125))
Y_12 = UnitY(Factor=-100)
remap_6 = RemapNumbers(Value=num_96, Source="0.0 to 8000", Target=Domain(0, 1))  # -> Mapped, Clipped

# ---- group: energy/cost efficiency in range
num_99 = Number(multiplication_26)

# ----
remap_7 = RemapNumbers(Value=num_97, Source="0.0 to 12000", Target=Domain(0, 1))  # -> Mapped, Clipped
remap_8 = RemapNumbers(Value=num_98, Source="500.0 To 1400.0", Target=Domain(0, 1))  # -> Mapped, Clipped
vec2pt_7 = Vector2Pt(PointA=Point(0, 0, 0), PointB=dispatch_15.ListA, Unitize=False)  # -> Vector, Length
equals_12 = Equality(FirstNumber=int_127, SecondNumber="7")  # -> Equality, Inequality
equals_13 = Equality(FirstNumber=int_127, SecondNumber="6")  # -> Equality, Inequality

# ---- group: distances in range - avoid 0
num_100 = Number(addition_10)

# ----
join_6 = TextJoin(Text=["AIStep: ", int_154])
crv_45 = Curve(createhatch)

# ---- group: traffic value road only
num_101 = Number(dispatch_16.ListA)

# ----
crv_46 = Curve(dashline2_0)
filter_51 = StreamFilter(Gate=bool_14, Stream0=swatch_4, Stream1=swatch_3)  # disabled
pt_62 = Point(<point referenced from the Rhino model>)
move_21 = Move(Geometry=pt_62, Motion=Y_12)  # -> Geometry, Transform
pt_63 = Point(<point referenced from the Rhino model>)  # disabled
pt_64 = Point(<point referenced from the Rhino model>)  # disabled
pt_65 = Point(<point referenced from the Rhino model>)  # disabled

# ---- group: score range by experience
panel_120 = Panel("-0.4 To 0.4")

# ----
move_22 = Move(Geometry=rotate_2.Geometry, Motion=vec2pt_7.Vector)  # -> Geometry, Transform
graft_3 = GraftTree(Tree=move_22.Transform, IncludeEmptyLists=True, IncludeNullItems=True)
comp = Compound(Transforms=[graft_2, graft_3])
transform = Transform(Geometry=xy, Transform=comp)
pshift_17 = ShiftPaths(Data=transform, Offset=-1)

# ---- group: people dots base plans
pln_2 = Plane(pshift_17)

# ---- group: block #
lng_3 = ListLength(List=pln_2)

# ---- group: seed d
random = Random(Range=Domain(0, 10000), Number=lng_3, Seed=number_slider_3)  # disabled

# ---- group: seed r
random_2 = Random(Range=Domain(0, 10000), Number=lng_3, Seed=number_slider_4)  # disabled

# ---- group: seed d
random_3 = Random(Range=Domain(0, 10000), Number=lng_3, Seed=number_slider_5)  # disabled

random_4 = Random(Range=Domain(0, 10000), Number=lng_3, Seed=number_slider_6)  # disabled

# ---- group: seed r
random_5 = Random(Range=Domain(0, 10000), Number=lng_3, Seed=number_slider_7)  # disabled

random_6 = Random(Range=Domain(0, 10000), Number=lng_3, Seed=number_slider_8)  # disabled

# ----
pshift_18 = ShiftPaths(Data=random_2, Offset=-1)  # disabled
pshift_19 = ShiftPaths(Data=random, Offset=-1)  # disabled
pshift_20 = ShiftPaths(Data=random_5, Offset=-1)  # disabled
pshift_21 = ShiftPaths(Data=random_6, Offset=-1)  # disabled
pshift_22 = ShiftPaths(Data=random_3, Offset=-1)  # disabled
pshift_23 = ShiftPaths(Data=random_4, Offset=-1)  # disabled

# ---- group: d
random_7 = Random(Range=Domain(0, 1), Number=int_148, Seed=pshift_19)  # disabled

# ---- group: r
random_8 = Random(Range=Domain(0, 360), Number=int_148, Seed=pshift_18)  # disabled

# ---- group: d
random_9 = Random(Range=Domain(0, 1), Number=int_147, Seed=pshift_22)  # disabled

random_10 = Random(Range=Domain(0, 1), Number=int_149, Seed=pshift_23)  # disabled

# ---- group: r
random_11 = Random(Range=Domain(0, 360), Number=int_147, Seed=pshift_20)  # disabled

random_12 = Random(Range=Domain(0, 360), Number=int_149, Seed=pshift_21)  # disabled

# ----
graph = GraphMapper(
    random_7,
    x0=0,
    x1=1,
    y0=0,
    y1=1,
    container_name="Bezier",
    cpx=[0, 0.2763824463, 1, 1],
    cpy=[0, 0.2786865234, 0.3680863976, 1])  # disabled
graph_2 = GraphMapper(
    random_9,
    x0=0,
    x1=1,
    y0=0,
    y1=1,
    container_name="Bezier",
    cpx=[0, 0.3430397809, 1, 1],
    cpy=[0, 0.5653408766, 0.3680863976, 1])  # disabled
graph_3 = GraphMapper(
    random_10,
    x0=0,
    x1=1,
    y0=0,
    y1=1,
    container_name="Bezier",
    cpx=[0, 0.2961647809, 0.9886363745, 1],
    cpy=[0, 0.6839488745, 0.5063920021, 1])  # disabled
rad_2 = Radians(Degrees=random_8)  # disabled
rad_3 = Radians(Degrees=random_11)  # disabled
rad_4 = Radians(Degrees=random_12)  # disabled
remap_9 = RemapNumbers(Value=graph, Source=Domain(0, 1), Target=dom)  # -> Mapped, Clipped; disabled
remap_10 = RemapNumbers(Value=graph_2, Source=Domain(0, 1), Target=dom_2)  # -> Mapped, Clipped; disabled
remap_11 = RemapNumbers(Value=graph_3, Source=Domain(0, 1), Target=dom_3)  # -> Mapped, Clipped; disabled
pt_66 = PointCylindrical(BasePlane=graft(pln_2), Angle=rad_2, Radius=remap_9.Mapped, Elevation=0)  # disabled
pt_67 = PointCylindrical(BasePlane=graft(pln_2), Angle=rad_3, Radius=remap_10.Mapped, Elevation=0)  # disabled
pt_68 = PointCylindrical(BasePlane=graft(pln_2), Angle=rad_4, Radius=remap_11.Mapped, Elevation=0)  # disabled
pshift_24 = ShiftPaths(Data=pt_66, Offset=-1)  # disabled
pdecon_3 = Deconstruct(Point=pshift_24)  # -> XComponent, YComponent, ZComponent; disabled
pshift_25 = ShiftPaths(Data=pt_67, Offset=-1)  # disabled
pdecon_4 = Deconstruct(Point=pshift_25)  # -> XComponent, YComponent, ZComponent; disabled
pshift_26 = ShiftPaths(Data=pt_68, Offset=-1)  # disabled
pdecon_5 = Deconstruct(Point=pshift_26)  # -> XComponent, YComponent, ZComponent; disabled
inc = Includes(Value=pdecon_3.YComponent, Domain=Domain(0, 1000))  # -> Includes, Deviation; disabled
inc_2 = Includes(Value=pdecon_3.XComponent, Domain=Domain(0, 1000))  # -> Includes, Deviation; disabled
inc_3 = Includes(Value=pdecon_4.YComponent, Domain=Domain(0, 1000))  # -> Includes, Deviation; disabled
inc_4 = Includes(Value=pdecon_4.XComponent, Domain=Domain(0, 1000))  # -> Includes, Deviation; disabled
inc_5 = Includes(Value=pdecon_5.YComponent, Domain=Domain(0, 1000))  # -> Includes, Deviation; disabled
inc_6 = Includes(Value=pdecon_5.XComponent, Domain=Domain(0, 1000))  # -> Includes, Deviation; disabled
and_3 = GateAnd(A=inc_2.Includes, B=inc.Includes)  # disabled
and_4 = GateAnd(A=inc_4.Includes, B=inc_3.Includes)  # disabled
and_5 = GateAnd(A=inc_6.Includes, B=inc_5.Includes)  # disabled
dispatch_17 = Dispatch(List=pshift_24, DispatchPattern=and_3)  # -> ListA, ListB; disabled
dispatch_18 = Dispatch(List=pshift_25, DispatchPattern=and_4)  # -> ListA, ListB; disabled
dispatch_19 = Dispatch(List=pshift_26, DispatchPattern=and_5)  # -> ListA, ListB; disabled
pt_69 = Point(dispatch_17.ListA)  # disabled
pt_70 = Point(dispatch_18.ListA)  # disabled
pt_71 = Point(dispatch_19.ListA)  # disabled
rnd_reduce_by_ratio = RndReduceByRatio(L=pt_69, B=number_slider_14, S=number_slider_15)  # disabled
rnd_reduce_by_ratio_2 = RndReduceByRatio(L=pt_70, B=number_slider_14, S=number_slider_17)  # disabled
rnd_reduce_by_ratio_3 = RndReduceByRatio(L=pt_71, B=number_slider_14, S=number_slider_19)  # disabled
pt_72 = Point(rnd_reduce_by_ratio)  # disabled
move_23 = Move(Geometry=mesh_8, Motion=pt_72)  # -> Geometry, Transform; disabled
pt_73 = Point(rnd_reduce_by_ratio_2)  # disabled
move_24 = Move(Geometry=mesh_10, Motion=pt_73)  # -> Geometry, Transform; disabled
pt_74 = Point(rnd_reduce_by_ratio_3)  # disabled
move_25 = Move(Geometry=mesh_9, Motion=pt_74)  # -> Geometry, Transform; disabled
mjoin = MeshJoin(Meshes=move_23.Geometry)  # disabled
mjoin_2 = MeshJoin(Meshes=move_25.Geometry)  # disabled
mjoin_3 = MeshJoin(Meshes=move_24.Geometry)  # disabled
mcol_2 = MeshColours(Mesh=mjoin, Colours=mln_young)  # disabled
mcol_3 = MeshColours(Mesh=mjoin_2, Colours=exc_elderly)  # disabled
mcol_4 = MeshColours(Mesh=mjoin_3, Colours=mid_mid_career)  # disabled
preview_4 = CustomPreview(Geometry=pt_73, Shader=mid_mid_career)  # disabled
preview_5 = CustomPreview(Geometry=pt_74, Shader=exc_elderly)  # disabled
filter_52 = StreamFilter(Gate=bool_31, Stream1=mcol_2)  # disabled
filter_53 = StreamFilter(Gate=bool_31, Stream1=mcol_3)  # disabled
preview_6 = CustomPreview(Geometry=pt_72, Shader=mln_young)  # disabled
filter_54 = StreamFilter(Gate=bool_31, Stream1=mcol_4)  # disabled

# ---- group: old ppl dots mesh
mesh_45 = Mesh(filter_53)  # disabled

# ---- group: mid ppl dots mesh
mesh_46 = Mesh(filter_54)  # disabled

# ---- group: young ppl dots mesh
mesh_47 = Mesh(filter_52)  # disabled

# ----
or = GateOr(A=equals_13.Equality, B=equals_12.Equality)
division_14 = Division(A=num_99, B=num_100)

# ---- group: solar value - normalized
num_102 = Number(remap_8.Mapped)

# ---- group: traffic value - normalized
num_103 = Number(remap_6.Mapped)

# ---- group: wait value - normalized
num_104 = Number(remap_7.Mapped)

# ---- group: amenities
tag_19 = TextTag3D(Location=pt_63, Text=item_29, Size=number_slider_29, Colour=swatch_2, Justification=5)  # disabled

# ---- group: google map
tag_20 = TextTag3D(Location=pt_64, Text=item_30, Size=number_slider_29, Colour=swatch_2, Justification=5)  # disabled

# ---- group: human interaction
tag_21 = TextTag3D(Location=pt_65, Text=item_31, Size=number_slider_29, Colour=swatch_2, Justification=5)  # disabled

# ---- group: AI Step Next
tag_22 = TextTag3D(Location=move_21.Geometry, Text=item_32, Size=number_slider_30, Colour=swatch_5, Justification=5)

# ---- group: AI Step Int
tag_23 = TextTag3D(Location=pt_62, Text=join_6, Size=number_slider_30, Colour=swatch_5, Justification=5)

# ----
dispatch_20 = Dispatch(List=pt_36, DispatchPattern=or)  # -> ListA, ListB

# ---- group: Dashline
previewlw_3 = CustomPreviewLineweights(Geometry=crv_46, Shader=swatch_3, Thickness=Slider(5, range=0..100))

# ---- group: Arrows
previewlw_4 = CustomPreviewLineweights(Geometry=filter_43, Shader=ColourSwatch(SwatchColor=RGB(255, 127, 0)), Thickness=Slider(7, range=0..100))

# ---- group: Hatch
preview_7 = CustomPreview(Geometry=crv_45, Shader=swatch_3)

# ----
gradient = Gradient(LowerLimit=0, UpperLimit=1, Parameter=num_103, stops=[0: RGB(0, 128, 0), 0.5: RGB(222, 222, 0), 1: RGB(255, 0, 0)])
gradient_2 = Gradient(LowerLimit=0, UpperLimit=1, Parameter=num_103, stops=[0: RGB(255, 255, 255), 1: RGB(0, 0, 0)])
gradient_3 = Gradient(LowerLimit=0, UpperLimit=1, Parameter=num_104, stops=[0: RGB(0, 128, 0), 0.5: RGB(222, 222, 0), 1: RGB(255, 0, 0)])
ma_10 = MassAddition(Input=division_14)  # -> Result, PartialResults

# ---- group: green is good, more solar access
gradient_4 = Gradient(LowerLimit=0, UpperLimit=1, Parameter=num_102, stops=[0: RGB(0, 128, 0), 0.5: RGB(222, 222, 0), 1: RGB(255, 0, 0)])  # disabled

# ----
gradient_5 = Gradient(LowerLimit=0, UpperLimit=1, stops=[0: RGB(0, 51, 153), 0.5: RGB(6, 176, 0), 1: RGB(242, 40, 0)])
gradient_6 = Gradient(LowerLimit=0, UpperLimit=1, stops=[0: RGB(0, 128, 0), 0.5: RGB(222, 222, 0), 1: RGB(255, 0, 0)])
gradient_7 = Gradient(LowerLimit=0, UpperLimit=1, stops=[0: RGB(0, 128, 0), 1: RGB(255, 0, 0)])

# ---- group: red is good, more solar access
gradient_8 = Gradient(LowerLimit=0, UpperLimit=1, Parameter=num_102, stops=[0: RGB(255, 0, 0), 0.5: RGB(255, 255, 0), 1: RGB(0, 128, 0)])  # disabled

# ---- group: white is good, more solar access
gradient_9 = Gradient(LowerLimit=0, UpperLimit=1, Parameter=num_102, stops=[0: RGB(0, 50, 199), 1: RGB(255, 255, 0)])

# ----
gradient_10 = Gradient(LowerLimit=0, UpperLimit=1, stops=[0: RGB(0, 51, 153), 0.5: RGB(6, 176, 0), 1: RGB(242, 40, 0)])
gradient_11 = Gradient(LowerLimit=0, UpperLimit=1, stops=[0: RGB(0, 128, 0), 0.5: RGB(222, 222, 0), 1: RGB(255, 0, 0)])
gradient_12 = Gradient(LowerLimit=0, UpperLimit=1, stops=[0: RGB(0, 128, 0), 1: RGB(255, 0, 0)])

# ---- group: Alpha
number_slider_31 = Slider(0.5, range=0..1)

number_slider_32 = Slider(0.5, range=0..1)

# ---- group: road center pts
pt_75 = Point(dispatch_20.ListA)

# ---- group: road mesh final!
mesh_48 = Mesh(python_8.allRoadMesh)

# ---- group: center line mesh final!
mesh_49 = Mesh(python_9.allRoadMesh)

# ----
easter_eggs = EasterEggs(L=pt_36, A_2=int_127, shrink=num_62, L_2=pt_36, A=int_127, shrink_2=num_62)  # disabled

# ---- group: building lego modules
mesh_50 = Mesh(move_22.Geometry)

# ---- group: blank
mesh_51 = Mesh(move_20.Geometry)

# ---- group: sidewalk mesh final!
mesh_52 = Mesh(python_10.allRoadMesh)

# ----
pshift_27 = ShiftPaths(Data=ma_10.Result, Offset=-1)
# AI Weights
panel_121 = Panel("1 to 30")

# ---- group: Ref Pts
pt_76 = Point([<point referenced from the Rhino model> x6])

# ----
panel_122 = Panel("""Density
Diversity
Energy
Traffic
Solar""")

# ---- group: AIWeights
num_105 = Number(num_12)

# ----
panel_123 = Panel("%")  # disabled

# ---- group: Ref Pts
# Slider 2 - Heatmap Mode
pt_77 = Point([<point referenced from the Rhino model> x5])

# ---- group: Alpha
number_slider_33 = Slider(0.5, range=0..1)

# ----
filter_55 = StreamFilter(Gate=show_google_map, Stream0=mesh_50)

# ---- group: population density score
num_106 = Number(pshift_27)

# ----
bnd_4 = Bounds(Numbers=num_106)
panel_124 = Panel(bnd_4)
filter_56 = StreamFilter(Gate=show_google_map, Stream0=mesh_48)
filter_57 = StreamFilter(Gate=show_google_map, Stream0=mesh_49)
filter_58 = StreamFilter(Gate=show_google_map, Stream0=mesh_51)
panel_125 = Panel("""Heatmap
Off""")
panel_126 = Panel("""Population
Density""")
panel_127 = Panel("""Experience
Diversity""")
panel_128 = Panel("""Energy
Efficiency""")
panel_129 = Panel("""Traffic
Perform.""")
filter_59 = StreamFilter(Gate=show_google_map, Stream0=mesh_52)
panel_130 = Panel("""Solar
Perform.""")

# ---- group: slider1
# Slider
num_107 = Number(num_33)

# ----
argb_2 = SplitARGB(Colour=gradient)  # -> Alpha, Red, Green, Blue
argb_3 = SplitARGB(Colour=gradient_3)  # -> Alpha, Red, Green, Blue
range = Range(Domain=panel_121, Steps=100)
argb_4 = SplitARGB(Colour=gradient_9)  # -> Alpha, Red, Green, Blue

# ---- group: road color - none
swatch_6 = ColourSwatch(SwatchColor=RGB(64, 64, 64))

# ----
lng_4 = ListLength(List=num_105)
multiplication_27 = Multiplication(A=num_107, B=100)
multiplication_28 = Multiplication(A=num_105, B=100)  # disabled
remap_12 = RemapNumbers(Value=num_106, Source=panel_120, Target=Domain(0, 1))  # -> Mapped, Clipped
max_10 = Maximum(A=remap_12.Mapped, B=0)
min_2 = Minimum(A=max_10, B=1)
txt_36 = Text(panel_122)
txt_37 = Text(panel_123)  # disabled
txt_38 = Text("")
frgb = ColourRGBF(Alpha=number_slider_31, Red=argb_2.Red, Green=argb_2.Green, Blue=argb_2.Blue)
frgb_2 = ColourRGBF(Alpha=number_slider_31, Red=argb_3.Red, Green=argb_3.Green, Blue=argb_3.Blue)
frgb_3 = ColourRGBF(Alpha=number_slider_32, Red=argb_4.Red, Green=argb_4.Green, Blue=argb_4.Blue)
int_155 = Integer(range)
repeat_7 = RepeatData(Data=txt_38, Length=lng_4)
repeat_8 = RepeatData(Data=txt_37, Length=lng_4)  # disabled
int_156 = Integer(multiplication_28)  # disabled
txt_39 = Text(int_155)

# ---- group: population density score normalized
num_108 = Number(remap_12.Mapped)

# ----
gradient_13 = Gradient(LowerLimit=0, UpperLimit=1, Parameter=num_108, stops=[0: RGB(0, 0, 0), 1: RGB(255, 255, 255)])
gradient_14 = Gradient(LowerLimit=0, UpperLimit=1, Parameter=num_108, stops=[0: RGB(255, 0, 0), 0.5: RGB(222, 222, 0), 1: RGB(0, 128, 0)])
argb_5 = SplitARGB(Colour=gradient_14)  # -> Alpha, Red, Green, Blue
frgb_4 = ColourRGBF(Alpha=number_slider_33, Red=argb_5.Red, Green=argb_5.Green, Blue=argb_5.Blue)

# ---- group: viz color
col_18 = Colour(frgb_4)

# ----
int_157 = Integer(multiplication_27)
pshift_28 = ShiftPaths(Data=int_156, Offset=-1)  # disabled
merge_8 = Merge(Data1=panel_125, Data2=panel_126, Data3=panel_127, Data4=panel_128, Data5=panel_129, Data6=panel_130)
pshift_29 = ShiftPaths(Data=repeat_7, Offset=-2)
pshift_30 = ShiftPaths(Data=repeat_8, Offset=-2)  # disabled

# ---- group: road mesh final!
mesh_53 = Mesh(filter_56)

# ---- group: center line mesh final!
mesh_54 = Mesh(filter_57)

# Traffic Heatmap - Ryan - Crude
mesh_55 = Mesh(mesh_54)  # disabled

# ----
pshift_31 = ShiftPaths(Data=mesh_55, Offset=-3)  # disabled
area_2 = Area(Geometry=pshift_31)  # -> Area, Centroid; disabled

# ---- group: center pts
pt_78 = Point(area_2.Centroid)  # disabled

# ----
cps_2 = ClosestPoints(Point=pt_78, Cloud=pt_9, Count=1)  # -> ClosestPoint, CPIndex, Distance; disabled
pshift_32 = ShiftPaths(Data=cps_2.ClosestPoint, Offset=-1)  # disabled
dist_2 = Distance(PointA=graft(pshift_32), PointB=crossings)  # disabled
bnd_5 = Bounds(Numbers=dist_2)  # disabled
dedomain = DeconstructDomain(Domain=bnd_5)  # -> Start, End; disabled
pshift_33 = ShiftPaths(Data=dedomain.Start, Offset=-1)  # disabled

# ---- group: min dis to intersections
num_109 = Number(pshift_33)  # disabled

# ----
bnd_6 = Bounds(Numbers=num_109)  # disabled
remap_13 = RemapNumbers(Value=num_109, Source=bnd_6, Target=Domain(0, 1))  # -> Mapped, Clipped; disabled
subtraction_12 = Subtraction(A=1, B=remap_13.Mapped)  # disabled
graph_4 = GraphMapper(
    subtraction_12,
    x0=0,
    x1=1,
    y0=0,
    y1=0.5,
    container_name="Bezier",
    cpx=[0, 0.1613658518, 0.7159118652, 1],
    cpy=[0, 0.3613502979, 0.9704423547, 1])  # disabled

# ---- group: building lego modules
mesh_56 = Mesh(filter_55)

# ---- group: blank
mesh_57 = Mesh(filter_58)

# ---- group: sidewalk mesh final!
mesh_58 = Mesh(filter_59)

# ---- group: road color - wait
col_19 = Colour(frgb_2)

# ---- group: road color - none
col_20 = Colour(swatch_6)

# ---- group: road color - traffic
col_21 = Colour(frgb)

# ---- group: heatmap color - solar
col_22 = Colour(frgb_3)

# ----
item_33 = ListItem(List=txt_39, Index=int_157, Wrap=True)
merge_9 = Merge(Data1=graft(txt_36), Data2=graft(pshift_29), Data3=graft(pshift_28), Data4=graft(pshift_30))

# ---- group: population density viz
preview_8 = CustomPreview(Geometry=mesh_42, Shader=col_18)

# ----
pt_79 = Point(<point referenced from the Rhino model>)

# ---- group: viz ctrl - AI override
int_158 = Integer(int_83)

# ----
equals_14 = Equality(FirstNumber=int_158, SecondNumber=[0, 1, 2, 3, 4, 5])  # -> Equality, Inequality
panel_131 = Panel(int_158)
item_34 = ListItem(
    List=[ColourSwatch(SwatchColor=RGB(125, 125, 125)), ColourSwatch(SwatchColor=RGB(255, 255, 255))],
    Index=equals_14.Equality,
    Wrap=False)

# ---- group: wait
preview_9 = CustomPreview(Geometry=mesh_43, Shader=col_19)  # disabled

# ---- group: traffic
preview_10 = CustomPreview(Geometry=mesh_43, Shader=col_21)

# ---- group: solar
preview_11 = CustomPreview(Geometry=mesh_44, Shader=col_22)

# ---- group: fl # slider
tag_24 = TextTag3D(Location=pt_79, Text=item_33, Size=Slider(16, range=0..100), Colour=swatch_2, Justification=8)

# ----
join_7 = TextJoin(Text=merge_9)

# ---- group: fl # slider
tag_25 = TextTag3D(Location=pt_76, Text=merge_8, Size=Slider(10, range=0..100), Colour=item_34, Justification=4)

# ----
pshift_34 = ShiftPaths(Data=join_7, Offset=-1)
txt_40 = Text(pshift_34)
panel_132 = Panel(txt_40)

# ---- group: cell size
num_110 = Number(num_74)

# ---- group: module id
int_159 = Integer(int_36)

# ---- group: viz ctrl - AI override
int_160 = Integer(int_83)

# ----
panel_133 = Panel(int_160)

# ---- group: module id
int_161 = Integer(int_36)

# ---- group: fl # slider
tag_26 = TextTag3D(
    Location=pt_77,
    Text=txt_40,
    Size=Slider(12, range=0..100),
    Colour=ColourSwatch(SwatchColor=RGB(255, 255, 255)),
    Justification=1)

# ---- group: cell size
num_111 = Number(num_74)

# ---- group: shrink
cell_shrink_3 = Slider(1, range=0.75..1)

# ---- group: viz ctrl - AI override
# Population Density Heatmap - GH
int_162 = Integer(int_83)

# ----
panel_134 = Panel(int_162)
move_z_6 = Slider(6.5, range=0..30)
filter_60 = StreamFilter(Gate=int_160, Stream2=int_159)
filter_61 = StreamFilter(Gate=int_160, Stream2=num_110)

# ---- group: shrink
cell_shrink_4 = Slider(1, range=0.75..1)

# ----
filter_62 = StreamFilter(Gate=int_162, Stream1=num_111)
move_z_7 = Slider(6.5, range=0..30)
filter_63 = StreamFilter(Gate=int_162, Stream1=int_161)

# ---- group: Diversity Formular
# Population Diversity Heatmap - GH
panel_135 = Panel("\CityMatrix_ML\01_Software\RH_GH\Grasshopper\ImagesInGH\Diversity Formular.PNG")  # disabled
path_3 = FilePath("C:\Users\RYAN\Dropbox (MIT)\01_Work\Share\_CityScope\CityMatrix_ML\01_Software\RH_GH\Grasshopper\ImagesInGH\Diversity Formular.PNG")  # disabled
panel_136 = Panel(path_3)  # disabled
load_bitmap = LoadBitmap(FilePathToImageLocation=path_3)  # disabled

# ---- group: floor num for each type
int_163 = Integer(int_35)

# ---- group: colortizer orgin
pt_80 = Point(pt_24)

# ---- group: # ppl per flr
num_112 = Number(num_42)

# ---- group: cell size
num_113 = Number(filter_61)

# ---- group: gridExtent_x
int_164 = Integer(int_25)

# ---- group: gridExtent_y
int_165 = Integer(int_27)

# ---- group: module id
int_166 = Integer(filter_60)

# ---- group: x
int_167 = Integer(int_29)

# ---- group: y
int_168 = Integer(int_31)

# ---- group: shrink
num_114 = Number(cell_shrink_3)

# ---- group: floor num for each type
int_169 = Integer(int_35)

# ---- group: colortizer orgin
pt_81 = Point(pt_24)

# ---- group: # ppl per flr
num_115 = Number(num_42)

# ---- group: cell size
num_116 = Number(filter_62)

# ---- group: gridExtent_x
# Population Density Formular:
# Sum of (Nearest N Building Population/Distance to that building)
int_170 = Integer(int_25)

# ---- group: gridExtent_y
int_171 = Integer(int_27)

# ---- group: x
int_172 = Integer(int_29)

# ---- group: y
int_173 = Integer(int_31)

# ---- group: shrink
num_117 = Number(cell_shrink_4)

# ---- group: module id
int_174 = Integer(filter_63)

# ---- group: total parking cell number
# Parking & Park
int_175 = Integer(parking_cell)

# ---- group: cell size
num_118 = Number(division_9)

# ---- group: 3D City / module id
int_176 = Integer(int_36)  # disabled

# ---- group: parking / meshes lego ref: parking
mesh_59 = Mesh(<mesh referenced from the Rhino model>)  # disabled

# ---- group: blank modules
mesh_60 = Mesh(mesh_51)

# ---- group: meshes lego ref: park
mesh_61 = Mesh(<mesh referenced from the Rhino model>)

# ---- group: total park cell number
int_177 = Integer(park_cell)

# ----
division_15 = Division(A=num_118, B=2.5)

# ---- group: prevent 0
panel_137 = Panel(".000001")

panel_138 = Panel(".000001")  # disabled

panel_139 = Panel(".000001")  # disabled

# ----
multiplication_29 = Multiplication(A=int_163, B=num_112)

# ---- group: note: none of P1, P2, or P3 could be 0 !!!
panel_140 = Panel("(P1*log10(P1)+P2*log10(P2)+P3*log10(P3)+P4*log10(P4)+P5*log10(P5)+P6*log10(P6)) / log10(6) * (-1)")

panel_141 = Panel("(P1*log10(P1)+P2*log10(P2)+P3*log10(P3)) / log10(3) * (-1)")  # disabled

# ---- group: prevent 0
panel_142 = Panel(".000001")  # disabled

# ---- group: note: none of P1, P2, or P3 could be 0 !!!
panel_143 = Panel("(P1*log10(P1)+P2*log10(P2)+P3*log10(P3)) / log10(3) * (-1)")  # disabled

panel_144 = Panel("(P1*log10(P1)+P2*log10(P2)) / log10(2) * (-1)")  # disabled

# ----
modulecenter_6 = ModuleCenter(pt=pt_80, num=num_113, int_2=int_167, int=int_168)  # -> pt_5, transform_2
division_16 = Division(A=num_113, B=2)
neg_12 = Negative(Value=division_16)

# ---- group: dockID
int_178 = Integer(int_34)

# ----
multiplication_30 = Multiplication(A=int_169, B=num_115)

# ---- group: influence range - distance limit
number_slider_34 = Slider(200, range=0..1000)

# ---- group: infulence range - # nearest
range_count_2 = Slider(49, range=1..130)

# ---- group: 3D City / 3D building site move amount
panel_145 = Panel("10000")  # disabled
X_5 = UnitX(Factor=panel_145)  # disabled

# ---- group: module center
pt_82 = Point(modulecenter_3.pt_5)

# ----
# On Dashboard
panel_146 = Panel("-1")
modulecenter_7 = ModuleCenter(pt=pt_81, num=num_116, int_2=int_172, int=int_173)  # -> pt_5, transform_2
# Activation Mask
# On LEGOs
srf = Surface(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)

# ---- group: module id
int_179 = Integer(int_36)

# ----
division_17 = Division(A=num_116, B=2)
neg_13 = Negative(Value=division_17)

# ---- group: dockID
int_180 = Integer(int_142)

# ----
neg_14 = Negative(Value=division_15)

# ---- group: ref mask srf - R
srf_2 = Surface(<surface referenced from the Rhino model>)

# ---- group: ref mask srf - RM
srf_3 = Surface(<surface referenced from the Rhino model>)

# ---- group: ref mask srf - bar live
srf_4 = Surface(<surface referenced from the Rhino model>)

# ---- group: ref mask srf - RS
srf_5 = Surface(<surface referenced from the Rhino model>)

# ----
geobottomcenter = GeoBottomCenter_2(geo=mesh_60)

# ---- group: influence range - distance limit
number_slider_35 = Slider(200, range=0..1000)

# ---- group: ref mask srf - RL
srf_6 = Surface(<surface referenced from the Rhino model>)

# ---- group: infulence range - # nearest
range_count_3 = Slider(49, range=1..130)

# ----
movetoorgin_3 = MoveToOrgin(G=mesh_61, num=num_62)
larger_5 = LargerThan(FirstNumber=int_166, SecondNumber="0")  # -> LargerThan, OrEqualTo
smaller_5 = SmallerThan(FirstNumber=int_166, SecondNumber="5")  # -> SmallerThan, OrEqualTo
dom_8 = ConstructDomain(DomainStart=neg_12, DomainEnd=division_16)
larger_6 = LargerThan(FirstNumber=int_174, SecondNumber="0")  # -> LargerThan, OrEqualTo
smaller_6 = SmallerThan(FirstNumber=int_174, SecondNumber="5")  # -> SmallerThan, OrEqualTo
mesh_62 = Mesh(srf)
equals_15 = Equality(FirstNumber=int_180, SecondNumber=panel_146)  # -> Equality, Inequality

# ---- group: # ppl per building
num_119 = Number(multiplication_29)

# ----
panel_147 = Panel(num_119)
equals_16 = Equality(FirstNumber=int_179, SecondNumber=int_180)  # -> Equality, Inequality
dom_9 = ConstructDomain(DomainStart=neg_13, DomainEnd=division_17)

# ---- group: 3D City / module center
pt_83 = Point(pt_36)  # disabled

# ---- group: # ppl per building
num_120 = Number(multiplication_30)

# ----
panel_148 = Panel(num_120)
Z_6 = UnitZ(Factor=Slider(6.2, range=0..10))
lng_5 = ListLength(List=geobottomcenter)

# ---- group: 3D City / blank
mesh_63 = Mesh(mesh_51)  # disabled

# ---- group: 3D City / sidewalk mesh final!
mesh_64 = Mesh(python_10.allRoadMesh)  # disabled

# ---- group: 3D City / road mesh final!
mesh_65 = Mesh(mesh_53)  # disabled

# ----
equals_17 = Equality(FirstNumber=int_178, SecondNumber="1")  # -> Equality, Inequality
and_6 = GateAnd(A=larger_5.OrEqualTo, B=smaller_5.OrEqualTo)
equals_18 = Equality(FirstNumber=int_178, SecondNumber="2")  # -> Equality, Inequality
and_7 = GateAnd(A=equals_18.Inequality, B=equals_17.Inequality)
equals_19 = Equality(FirstNumber=int_178, SecondNumber="0")  # -> Equality, Inequality
and_8 = GateAnd(A=and_7, B=equals_19.Inequality)
equals_20 = Equality(FirstNumber=int_178, SecondNumber="-1")  # -> Equality, Inequality
and_9 = GateAnd(A=larger_6.OrEqualTo, B=smaller_6.OrEqualTo)
planesrf_5 = PlaneSurface(Plane=PlaneXY(0, 0, 0), XSize=dom_8, YSize=dom_8)
division_18 = Division(A=int_175, B=lng_5)
and_10 = GateAnd(A=equals_17.Inequality, B=equals_20.Inequality)
and_11 = GateAnd(A=equals_18.Inequality, B=equals_20.Inequality)
and_12 = GateAnd(A=equals_19.Inequality, B=equals_20.Inequality)
move_26 = Move(Geometry=mesh_62, Motion=Z_6)  # -> Geometry, Transform
planesrf_6 = PlaneSurface(Plane=PlaneXY(0, 0, 0), XSize=dom_9, YSize=dom_9)

# ---- group: module meshes lego at orgin
mesh_66 = Mesh(movetoorgin_3)

# ---- group: module center
pt_84 = Point(modulecenter_6.pt_5)

# ---- group: isBuilding
bool_35 = Boolean(and_6)

# ----
and_13 = GateAnd(A=and_8, B=equals_20.Inequality)

# ---- group: mask settings
swatch_7 = ColourSwatch(SwatchColor=RGB(0, 0, 0))
panel_149 = Panel(".5")
path_4 = FilePath("C:\Users\RYAN\Documents\GitHub\CityMatrix\Map\MAP_BLACK.png")

# ----
dispatch_21 = Dispatch(List=pt_82, DispatchPattern=equals_16.Inequality)  # -> ListA, ListB

# ---- group: module center
pt_85 = Point(modulecenter_7.pt_5)

# ---- group: isBuilding
bool_36 = Boolean(and_9)

# ----
randomsplit = RandomSplitList(MasterList=geobottomcenter, Seed=Slider(32, range=0..100), Split=division_18)  # -> ListA, ListB
lng_6 = ListLength(List=randomsplit.ListA)
division_19 = Division(A=int_177, B=lng_6)
scale_nu_16 = ScaleNU(Geometry=planesrf_5, Plane=PlaneXY(0, 0, 0), ScaleX=num_114, ScaleY=num_114, ScaleZ=1)  # -> Geometry, Transform
Z_7 = UnitZ(Factor=move_z_6)
filter_64 = StreamFilter(Gate=and_10, Stream1=srf_3)
filter_65 = StreamFilter(Gate=and_13, Stream1=srf_4)
filter_66 = StreamFilter(Gate=and_11, Stream1=srf_5)
filter_67 = StreamFilter(Gate=and_12, Stream1=srf_6)
filter_68 = StreamFilter(Gate=and_13, Stream1=srf_2)
randomsplit_2 = RandomSplitList(MasterList=randomsplit.ListA, Seed=Slider(25, range=0..100), Split=division_19)  # -> ListA, ListB
scale_nu_17 = ScaleNU(Geometry=planesrf_6, Plane=PlaneXY(0, 0, 0), ScaleX=num_117, ScaleY=num_117, ScaleZ=1)  # -> Geometry, Transform
Z_8 = UnitZ(Factor=move_z_7)

# ---- group: mask setting
swatch_8 = ColourSwatch(SwatchColor=RGBA(0, 0, 0, 127))

# ----
dispatch_22 = Dispatch(List=int_166, DispatchPattern=bool_35)  # -> ListA, ListB
dispatch_23 = Dispatch(List=pt_84, DispatchPattern=bool_35)  # -> ListA, ListB

# ---- group: 3D City / cell size
num_121 = Number(division_9)  # disabled

# ---- group: cell area
sqr = Square(Value=num_121)

# ----
multiplication_31 = Multiplication(A=sqr, B=number_slider_9)

# ---- group: floor area
num_122 = Number(multiplication_31)

# ----
vec2pt_8 = Vector2Pt(PointA=Point(0, 0, 0), PointB=dispatch_21.ListA, Unitize=False)  # -> Vector, Length
move_27 = Move(Geometry=scale_nu_16.Geometry, Motion=Z_7)  # -> Geometry, Transform
dispatch_24 = Dispatch(List=int_174, DispatchPattern=bool_36)  # -> ListA, ListB
dispatch_25 = Dispatch(List=pt_85, DispatchPattern=bool_36)  # -> ListA, ListB

# ---- group: 3D City / 3D building site move amount
vec_2 = Vector(X_5)  # disabled

# ----
preview_12 = CustomPreview(Geometry=filter_64, Shader=swatch_8)
preview_13 = CustomPreview(Geometry=filter_65, Shader=swatch_8)
preview_14 = CustomPreview(Geometry=filter_66, Shader=swatch_8)
preview_15 = CustomPreview(Geometry=filter_67, Shader=swatch_8)
preview_16 = CustomPreview(Geometry=filter_68, Shader=swatch_8)
move_28 = Move(Geometry=scale_nu_17.Geometry, Motion=Z_8)  # -> Geometry, Transform
move_29 = Move(Geometry=move_26.Geometry, Motion=vec2pt_8.Vector)  # -> Geometry, Transform

# ---- group: parking / parking center
pt_86 = Point(randomsplit.ListB)  # disabled

# ---- group: park center lego
pt_87 = Point(randomsplit_2.ListB)

# ---- group: module center - building only
pt_88 = Point(dispatch_23.ListA)

# ----
cps_3 = ClosestPoints(Point=pt_88, Cloud=pt_88, Count=range_count_2)  # -> ClosestPoint, CPIndex, Distance
# Population Diversity Formular:
# (P1*log10(P1)+P2*log10(P2)+P3*log10(P3)) / log10(3) * (-1)
# P is probability
smaller_7 = SmallerThan(FirstNumber=cps_3.Distance, SecondNumber=number_slider_34)  # -> SmallerThan, OrEqualTo

# ---- group: module id - building only
int_181 = Integer(dispatch_22.ListA)

# ----
item_35 = ListItem(List=int_181, Index=cps_3.CPIndex, Wrap=False)
vec2pt_9 = Vector2Pt(PointA=Point(0, 0, 0), PointB=pt_88, Unitize=False)  # -> Vector, Length

# ---- group: module center - building only
pt_89 = Point(dispatch_25.ListA)

# ----
cps_4 = ClosestPoints(Point=pt_85, Cloud=pt_89, Count=range_count_3)  # -> ClosestPoint, CPIndex, Distance
smaller_8 = SmallerThan(FirstNumber=cps_4.Distance, SecondNumber=number_slider_35)  # -> SmallerThan, OrEqualTo

# ---- group: module id - building only
int_182 = Integer(dispatch_24.ListA)

# ----
item_36 = ListItem(List=int_182, Index=cps_4.CPIndex, Wrap=False)

# ---- group: mesh srf at orgin
mesh_67 = Mesh(move_27.Geometry)

# ---- group: 3D City / base height
panel_150 = Panel("5.0")  # disabled

# ----
vec2pt_10 = Vector2Pt(PointA=Point(0, 0, 0), PointB=pt_85, Unitize=False)  # -> Vector, Length
dispatch_26 = Dispatch(List=item_35, DispatchPattern=smaller_7.OrEqualTo)  # -> ListA, ListB
mjoin_4 = MeshJoin(Meshes=move_29.Geometry)

# ---- group: mesh srf at orgin
mesh_68 = Mesh(move_28.Geometry)

# ---- group: ref mask srf - O
srf_7 = Surface(<surface referenced from the Rhino model>)

# ---- group: ref mask srf - OM
srf_8 = Surface(<surface referenced from the Rhino model>)

# ---- group: ref mask srf - bar work
srf_9 = Surface(<surface referenced from the Rhino model>)

# ---- group: ref mask srf - OS
srf_10 = Surface(<surface referenced from the Rhino model>)

# ---- group: ref mask srf - OL
srf_11 = Surface(<surface referenced from the Rhino model>)

# ----
dispatch_27 = Dispatch(List=cps_4.ClosestPoint, DispatchPattern=smaller_8.OrEqualTo)  # -> ListA, ListB
dispatch_28 = Dispatch(List=item_36, DispatchPattern=smaller_8.OrEqualTo)  # -> ListA, ListB
dispatch_29 = Dispatch(List=cps_4.Distance, DispatchPattern=smaller_8.OrEqualTo)  # -> ListA, ListB
panel_151 = Panel("1.0")  # disabled
panel_152 = Panel("0.0")  # disabled
panel_153 = Panel("1.0")  # disabled
panel_154 = Panel("0.0")  # disabled
vec2pt_11 = Vector2Pt(PointA=Point(0, 0, 0), PointB=pt_87, Unitize=False)  # -> Vector, Length
move_30 = Move(Geometry=mesh_67, Motion=vec2pt_9.Vector)  # -> Geometry, Transform
panel_155 = Panel("1.0")  # disabled
panel_156 = Panel("0.0")  # disabled
move_31 = Move(Geometry=mesh_68, Motion=vec2pt_10.Vector)  # -> Geometry, Transform

# ---- group: 3D City / building height for each type
num_123 = Number(num_29)  # disabled

# ----
filter_69 = StreamFilter(Gate=equals_15.Equality, Stream0=mjoin_4)
move_32 = Move(Geometry=mesh_66, Motion=vec2pt_11.Vector)  # -> Geometry, Transform

# ---- group: module ids in range
int_183 = Integer(dispatch_26.ListA)

# ----
equals_21 = Equality(FirstNumber=int_178, SecondNumber="4")  # -> Equality, Inequality
equals_22 = Equality(FirstNumber=int_178, SecondNumber="5")  # -> Equality, Inequality
and_14 = GateAnd(A=equals_22.Inequality, B=equals_21.Inequality)
equals_23 = Equality(FirstNumber=int_178, SecondNumber="3")  # -> Equality, Inequality

# ---- group: mesh srfs at module centers
mesh_69 = Mesh(move_30.Geometry)

# ----
and_15 = GateAnd(A=and_14, B=equals_23.Inequality)

# ---- group: bldg cntr in range
pt_90 = Point(dispatch_27.ListA)

# ---- group: distances in range
num_124 = Number(dispatch_29.ListA)

# ---- group: module ids in range
int_184 = Integer(dispatch_28.ListA)

# ----
num_125 = Number(panel_151)  # disabled
num_126 = Number(panel_152)  # disabled
num_127 = Number(panel_153)  # disabled
num_128 = Number(panel_154)  # disabled
num_129 = Number(panel_155)  # disabled
num_130 = Number(panel_156)  # disabled
num_131 = Number("1.0")
num_132 = Number("0.0")

# ---- group: mesh srfs at module centers
mesh_70 = Mesh(move_31.Geometry)

# ----
and_16 = GateAnd(A=equals_21.Inequality, B=equals_20.Inequality)
and_17 = GateAnd(A=equals_22.Inequality, B=equals_20.Inequality)
and_18 = GateAnd(A=equals_23.Inequality, B=equals_20.Inequality)
previewmat_2 = CustomPreviewMaterials(Geometry=filter_69, DiffuseColor=swatch_7, Transparency=panel_149, DiffuseBitmap=path_4)
and_19 = GateAnd(A=and_15, B=equals_20.Inequality)
equals_24 = Equality(FirstNumber=int_183, SecondNumber="3")  # -> Equality, Inequality
equals_25 = Equality(FirstNumber=int_183, SecondNumber="5")  # -> Equality, Inequality
equals_26 = Equality(FirstNumber=int_183, SecondNumber="4")  # -> Equality, Inequality
equals_27 = Equality(FirstNumber=int_183, SecondNumber="0")  # -> Equality, Inequality
equals_28 = Equality(FirstNumber=int_183, SecondNumber="2")  # -> Equality, Inequality
equals_29 = Equality(FirstNumber=int_183, SecondNumber="1")  # -> Equality, Inequality
item_37 = ListItem(List=num_120, Index=int_184, Wrap=False)
addition_11 = Addition(A=num_124, B=num_116)
filter_70 = StreamFilter(Gate=and_16, Stream1=srf_8)
filter_71 = StreamFilter(Gate=and_19, Stream1=srf_9)
filter_72 = StreamFilter(Gate=and_17, Stream1=srf_10)
filter_73 = StreamFilter(Gate=and_18, Stream1=srf_11)
filter_74 = StreamFilter(Gate=and_19, Stream1=srf_7)
int_185 = Integer(equals_24.Equality)
int_186 = Integer(equals_27.Equality)
int_187 = Integer(equals_26.Equality)
int_188 = Integer(equals_25.Equality)
int_189 = Integer(equals_29.Equality)
int_190 = Integer(equals_28.Equality)

# ---- group: park lego
mesh_71 = Mesh(move_32.Geometry)

# ----
preview_17 = CustomPreview(Geometry=filter_70, Shader=swatch_8)
preview_18 = CustomPreview(Geometry=filter_71, Shader=swatch_8)
preview_19 = CustomPreview(Geometry=filter_72, Shader=swatch_8)
preview_20 = CustomPreview(Geometry=filter_73, Shader=swatch_8)
ma_11 = MassAddition(Input=int_185)  # -> Result, PartialResults
ma_12 = MassAddition(Input=int_188)  # -> Result, PartialResults
preview_21 = CustomPreview(Geometry=filter_74, Shader=swatch_8)
ma_13 = MassAddition(Input=int_187)  # -> Result, PartialResults
ma_14 = MassAddition(Input=int_186)  # -> Result, PartialResults
ma_15 = MassAddition(Input=int_190)  # -> Result, PartialResults
ma_16 = MassAddition(Input=int_189)  # -> Result, PartialResults

# ---- group: 3D City / building height factor
number_slider_36 = Slider(3.1, range=0..10)  # disabled

# ---- group: distances in range - avoid 0
num_133 = Number(addition_11)

# ---- group: # ppl in range
num_134 = Number(item_37)

# ----
filter_75 = StreamFilter(Gate=show_google_map, Stream0=mesh_71)

# ---- group: score range by experience
panel_157 = Panel("0.0 To 250.0")

# ---- group: building # in range
int_191 = Integer(ma_14.Result)
int_192 = Integer(ma_16.Result)
int_193 = Integer(ma_15.Result)
int_194 = Integer(ma_11.Result)
int_195 = Integer(ma_13.Result)
int_196 = Integer(ma_12.Result)

# ----
division_20 = Division(A=num_134, B=num_133)
item_38 = ListItem(List=num_119, Index="0", Wrap=False)
item_39 = ListItem(List=num_119, Index="2", Wrap=False)
item_40 = ListItem(List=num_119, Index="1", Wrap=False)
item_41 = ListItem(List=num_119, Index="3", Wrap=False)
item_42 = ListItem(List=num_119, Index="4", Wrap=False)
item_43 = ListItem(List=num_119, Index="5", Wrap=False)
ma_17 = MassAddition(Input=division_20)  # -> Result, PartialResults

# ---- group: park lego
mesh_72 = Mesh(filter_75)

# ---- group: # ppl per building
num_135 = Number(item_38)
num_136 = Number(item_40)
num_137 = Number(item_39)
num_138 = Number(item_41)
num_139 = Number(item_42)
num_140 = Number(item_43)

# ---- group: Alpha
number_slider_37 = Slider(0.5, range=0..1)

# ----
pshift_35 = ShiftPaths(Data=ma_17.Result, Offset=-1)
multiplication_32 = Multiplication(A=int_194, B=num_138)
multiplication_33 = Multiplication(A=int_192, B=num_136)
multiplication_34 = Multiplication(A=int_195, B=num_139)
multiplication_35 = Multiplication(A=int_196, B=num_140)
multiplication_36 = Multiplication(A=int_191, B=num_135)
multiplication_37 = Multiplication(A=int_193, B=num_137)

# ---- group: Alpha
number_slider_38 = Slider(0.5, range=0..1)

# ---- group: population density score
num_141 = Number(pshift_35)

# ----
bnd_7 = Bounds(Numbers=num_141)
panel_158 = Panel(bnd_7)
pshift_36 = ShiftPaths(Data=multiplication_32, Offset=-1)
pshift_37 = ShiftPaths(Data=multiplication_33, Offset=-1)
pshift_38 = ShiftPaths(Data=multiplication_36, Offset=-1)
pshift_39 = ShiftPaths(Data=multiplication_37, Offset=-1)
pshift_40 = ShiftPaths(Data=multiplication_34, Offset=-1)
pshift_41 = ShiftPaths(Data=multiplication_35, Offset=-1)
remap_14 = RemapNumbers(Value=num_141, Source=panel_157, Target=Domain(0, 1))  # -> Mapped, Clipped
max_11 = Maximum(A=remap_14.Mapped, B=0)
min_3 = Minimum(A=max_11, B=1)

# ---- group: total # ppl in range
num_142 = Number(pshift_38)
num_143 = Number(pshift_37)
num_144 = Number(pshift_39)
num_145 = Number(pshift_36)
num_146 = Number(pshift_40)
num_147 = Number(pshift_41)

num_148 = Number(num_142)
num_149 = Number(num_143)
num_150 = Number(num_144)
num_151 = Number(num_145)
num_152 = Number(num_146)
num_153 = Number(num_147)

# ----
addition_12 = Addition(A=num_151, B=num_152)  # disabled
addition_13 = Addition(A=num_148, B=num_149)  # disabled
addition_14 = Addition(A=addition_12, B=num_153)  # disabled
addition_15 = Addition(A=addition_13, B=num_150)  # disabled

# ---- group: living
num_154 = Number(addition_15)  # disabled

# ---- group: working
num_155 = Number(addition_14)  # disabled

# ---- group: RL pop.
num_156 = Number(graft(num_148))

# ---- group: OL pop.
num_157 = Number(graft(num_151))

# ---- group: RS pop.
num_158 = Number(graft(num_150))

# ---- group: OS pop.
num_159 = Number(graft(num_153))

# ---- group: OL pop.
num_160 = Number(graft(num_151))  # disabled

# ---- group: OM pop.
num_161 = Number(graft(num_152))

# ---- group: RM pop.
num_162 = Number(graft(num_149))

# ---- group: OS pop.
num_163 = Number(graft(num_153))  # disabled

# ---- group: OM pop.
num_164 = Number(graft(num_152))  # disabled

# ---- group: RL pop.
num_165 = Number(graft(num_148))  # disabled

# ---- group: RS pop.
num_166 = Number(graft(num_150))  # disabled

# ---- group: RM pop.
num_167 = Number(graft(num_149))  # disabled

# ---- group: R pop.
num_168 = Number(graft(num_154))  # disabled

# ---- group: O pop.
num_169 = Number(graft(num_155))  # disabled

# ----
addition_16 = Addition(A=num_159, B=panel_137)
addition_17 = Addition(A=num_158, B=panel_137)
addition_18 = Addition(A=num_157, B=panel_137)
addition_19 = Addition(A=num_156, B=panel_137)
addition_20 = Addition(A=num_161, B=panel_137)
addition_21 = Addition(A=num_162, B=panel_137)
addition_22 = Addition(A=num_163, B=panel_138)  # disabled
addition_23 = Addition(A=num_160, B=panel_138)  # disabled
addition_24 = Addition(A=num_164, B=panel_138)  # disabled
addition_25 = Addition(A=num_166, B=panel_139)  # disabled
addition_26 = Addition(A=num_165, B=panel_139)  # disabled
addition_27 = Addition(A=num_167, B=panel_139)  # disabled
addition_28 = Addition(A=num_168, B=panel_142)  # disabled
addition_29 = Addition(A=num_169, B=panel_142)  # disabled
ma_18 = MassAddition(Input=[addition_19, addition_21, addition_17, addition_18, addition_20, addition_16])  # -> Result, PartialResults
ma_19 = MassAddition(Input=[addition_23, addition_24, addition_22])  # -> Result, PartialResults; disabled
ma_20 = MassAddition(Input=[addition_26, addition_27, addition_25])  # -> Result, PartialResults; disabled
ma_21 = MassAddition(Input=[addition_28, addition_29])  # -> Result, PartialResults; disabled

# ---- group: total O. pop.
num_170 = Number(ma_18.Result)

# ----
division_21 = Division(A=addition_18, B=num_170)
division_22 = Division(A=addition_19, B=num_170)
division_23 = Division(A=addition_16, B=num_170)
division_24 = Division(A=addition_17, B=num_170)
division_25 = Division(A=addition_20, B=num_170)
division_26 = Division(A=addition_21, B=num_170)

# ---- group: total O. pop.
num_171 = Number(ma_19.Result)  # disabled

# ----
division_27 = Division(A=addition_23, B=num_171)  # disabled
division_28 = Division(A=addition_22, B=num_171)  # disabled
division_29 = Division(A=addition_24, B=num_171)  # disabled

# ---- group: total res. pop.
num_172 = Number(ma_20.Result)  # disabled

# ----
division_30 = Division(A=addition_26, B=num_172)  # disabled
division_31 = Division(A=addition_25, B=num_172)  # disabled
division_32 = Division(A=addition_27, B=num_172)  # disabled

# ---- group: total O. pop.
num_173 = Number(ma_21.Result)  # disabled

# ----
division_33 = Division(A=addition_28, B=num_173)  # disabled
division_34 = Division(A=addition_29, B=num_173)  # disabled

# ---- group: % RL pop.
num_174 = Number(division_22)

# ---- group: % OL pop.
num_175 = Number(division_21)

# ---- group: % RM pop.
num_176 = Number(division_26)

# ---- group: % OM pop.
num_177 = Number(division_25)

# ---- group: % OL pop.
num_178 = Number(division_27)  # disabled

# ---- group: % RS pop.
num_179 = Number(division_24)

# ---- group: % OS pop.
num_180 = Number(division_23)

# ---- group: % OM pop.
num_181 = Number(division_29)  # disabled

# ---- group: % OS pop.
num_182 = Number(division_28)  # disabled

# ---- group: % RL pop.
num_183 = Number(division_30)  # disabled

# ---- group: % RM pop.
num_184 = Number(division_32)  # disabled

# ---- group: % RS pop.
num_185 = Number(division_31)  # disabled

# ---- group: % OL pop.
num_186 = Number(division_33)  # disabled

# ---- group: % OM pop.
num_187 = Number(division_34)  # disabled

# ---- group: Diversity Calc
eval_2 = Evaluate(F=panel_140, P1=num_174, P2=num_176, P3=num_179, P4=num_175, P5=num_177, P6=num_180)

eval_3 = Evaluate(F=panel_141, P1=num_178, P2=num_181, P3=num_182)  # disabled

eval_4 = Evaluate(F=panel_143, P1=num_183, P2=num_184, P3=num_185)  # disabled

eval_5 = Evaluate(F=panel_144, P1=num_186, P2=num_187)  # disabled

# ----
pshift_42 = ShiftPaths(Data=eval_3, Offset=-1)  # disabled
pshift_43 = ShiftPaths(Data=eval_4, Offset=-1)  # disabled
pshift_44 = ShiftPaths(Data=eval_2, Offset=-1)
pshift_45 = ShiftPaths(Data=eval_5, Offset=-1)  # disabled

# ---- group: office diversity - all
num_188 = Number(pshift_42)  # disabled

# ---- group: residential diversity - all
num_189 = Number(pshift_43)  # disabled

# ---- group: living working diversity - all
num_190 = Number(pshift_45)  # disabled

# ---- group: diversity - all
num_191 = Number(pshift_44)

# ----
replace = ReplaceMembers(Set=num_188, Find=num_125, Replace=num_126)  # disabled
replace_2 = ReplaceMembers(Set=num_189, Find=num_127, Replace=num_128)  # disabled
replace_3 = ReplaceMembers(Set=num_191, Find=num_131, Replace=num_132)
replace_4 = ReplaceMembers(Set=num_190, Find=num_129, Replace=num_130)  # disabled

# ---- group: diversity
num_192 = Number(replace_3)

# ---- group: office diversity
num_193 = Number(replace)  # disabled

# ---- group: residential diversity
num_194 = Number(replace_2)  # disabled

# ---- group: living working diversity
num_195 = Number(replace_4)  # disabled

# ----
addition_30 = Addition(A=num_194, B=num_193)  # disabled
addition_31 = Addition(A=addition_30, B=num_195)  # disabled
division_35 = Division(A=addition_31, B=3)  # disabled

# ---- group: final pop. diversity
num_196 = Number(num_192)

# ----
gradient_15 = Gradient(LowerLimit=0, UpperLimit=1, Parameter=num_196, stops=[0: RGB(0, 0, 0), 1: RGB(255, 255, 255)])
gradient_16 = Gradient(LowerLimit=0, UpperLimit=1, Parameter=num_196, stops=[0: RGB(255, 0, 0), 0.5: RGB(222, 222, 0), 1: RGB(0, 128, 0)])
argb_6 = SplitARGB(Colour=gradient_16)  # -> Alpha, Red, Green, Blue
frgb_5 = ColourRGBF(Alpha=number_slider_37, Red=argb_6.Red, Green=argb_6.Green, Blue=argb_6.Blue)

# ---- group: viz color
col_23 = Colour(frgb_5)

# ---- group: population density score normalized
num_197 = Number(remap_14.Mapped)

# ----
gradient_17 = Gradient(LowerLimit=0, UpperLimit=1, Parameter=num_197, stops=[0: RGB(0, 0, 0), 1: RGB(255, 255, 255)])
gradient_18 = Gradient(LowerLimit=0, UpperLimit=1, Parameter=num_197, stops=[0: RGB(255, 0, 0), 0.5: RGB(222, 222, 0), 1: RGB(0, 128, 0)])
argb_7 = SplitARGB(Colour=gradient_18)  # -> Alpha, Red, Green, Blue
frgb_6 = ColourRGBF(Alpha=number_slider_38, Red=argb_7.Red, Green=argb_7.Green, Blue=argb_7.Blue)

# ---- group: viz color
col_24 = Colour(frgb_6)

# ---- group: population density viz
preview_22 = CustomPreview(Geometry=mesh_70, Shader=col_24)

preview_23 = CustomPreview(Geometry=mesh_69, Shader=col_23)

# ---- group: total ppl bound
panel_159 = Panel("700")  # disabled

# ----
multiplication_38 = Multiplication(A=panel_159, B=number_slider_25)  # disabled
dom_10 = ConstructDomain(DomainStart=multiplication_38, DomainEnd=multiplication_18)  # disabled

# ---- group: total ppl bound (continued)
domain_2 = Domain(dom_10)  # disabled

# ----
remap_15 = RemapNumbers(Value=int_108, Source=domain_2, Target=Domain(0, 0.5))  # -> Mapped, Clipped; disabled
remap_16 = RemapNumbers(Value=int_108, Source=domain_2, Target=Domain(0.3, 1))  # -> Mapped, Clipped; disabled
multiplication_39 = Multiplication(A=graph_4, B=remap_16.Mapped)  # disabled
addition_32 = Addition(A=remap_15.Mapped, B=multiplication_39)  # disabled
addition_33 = Addition(A=addition_32, B=multiplication_20)  # disabled
gradient_19 = Gradient(
    LowerLimit=0,
    UpperLimit=1,
    Parameter=addition_33,
    stops=[0: RGB(0, 128, 0), 0.422: RGB(255, 255, 0), 0.919: RGB(255, 0, 0)])  # disabled
argb_8 = SplitARGB(Colour=gradient_19, IntegerChannels=True)  # -> Alpha, Red, Green, Blue; disabled
vec_3 = VectorXYZ(XComponent=argb_8.Red, YComponent=argb_8.Green, ZComponent=argb_8.Blue)  # -> Vector, Length; disabled
multiplication_40 = Multiplication(A=vec_3.Vector, B=number_slider_27)  # disabled
addition_34 = Addition(A=multiplication_40, B=multiplication_21)  # disabled
devec = DeconstructVector(Vector=addition_34)  # -> XComponent, YComponent, ZComponent; disabled
rgb = ColourRGB(Alpha=255, Red=devec.XComponent, Green=devec.YComponent, Blue=devec.ZComponent)  # disabled
col_25 = Colour(rgb)  # disabled
mspray_3 = MeshSpray(Mesh=graft(pshift_31), Points=graft(pshift_32), Colours=graft(col_25), SprayMode=0)  # disabled
mjoin_5 = MeshJoin(Meshes=flatten(mspray_3))  # disabled
filter_76 = StreamFilter(Gate=show_google_map, Stream0=mjoin_5)  # disabled

# ---- group: road traffic lego
mesh_73 = Mesh(filter_76)  # disabled

# ---- group: 3D City
# 3D City Grid System
number_slider_39 = Slider(10, range=10..100)  # disabled
number_slider_40 = Slider(5, range=0..10)  # disabled
number_slider_41 = Slider(6, range=0..10)  # disabled
Z_9 = UnitZ(Factor=number_slider_39)  # disabled
msphereex = MeshSphereEx(Base=Z_9, Radius=number_slider_39, Count=number_slider_40)  # disabled
Z_10 = UnitZ(Factor=number_slider_41)  # disabled
move_33 = Move(Geometry=msphereex, Motion=Z_10)  # -> Geometry, Transform; disabled
panel_160 = Panel("0")  # disabled
com = ColourSwatch(SwatchColor=RGB(158, 158, 158))  # disabled
com_2 = ColourSwatch(SwatchColor=RGB(71, 71, 71))  # disabled
panel_161 = Panel("5")  # disabled
res = ColourSwatch(SwatchColor=RGB(212, 212, 212))  # disabled
res_2 = ColourSwatch(SwatchColor=RGB(76, 76, 76))  # disabled
number_slider_42 = Slider(72, range=0..100)  # disabled
larger_7 = LargerThan(FirstNumber=int_176, SecondNumber=panel_160)  # -> LargerThan, OrEqualTo; disabled
smaller_9 = SmallerThan(FirstNumber=int_176, SecondNumber=panel_161)  # -> SmallerThan, OrEqualTo; disabled
panel_162 = Panel("0.8 to 1.4")  # disabled
vec_4 = Vector(X_5)  # disabled
mcol_5 = MeshColours(Mesh=move_33.Geometry, Colours=park)  # disabled
tree_scale = Slider(0.81, range=0.5..2)  # disabled
merge_10 = Merge(Data1=res, Data2=res, Data3=res, Data4=com, Data5=com, Data6=com)  # disabled
merge_11 = Merge(Data1=res_2, Data2=res_2, Data3=res_2, Data4=com_2, Data5=com_2, Data6=com_2)  # disabled
and_20 = GateAnd(A=larger_7.OrEqualTo, B=smaller_9.OrEqualTo)  # disabled
panel_163 = Panel("3")  # disabled
merge_12 = Merge(Data1=merge_10, Data2=merge_11)  # disabled
number_slider_43 = Slider(0.95, range=0..1)  # disabled
dom_11 = ConstructDomain(DomainStart=neg_14, DomainEnd=division_15)  # disabled
move_34 = Move(Geometry=pt_87, Motion=vec_2)  # -> Geometry, Transform; disabled
panel_164 = Panel("3")  # disabled
number_slider_44 = Slider(17, range=0..100)  # disabled
tree = Slider(2.13, range=0..5)  # disabled
division_36 = Division(A=num_121, B=2)  # disabled
move_35 = Move(Geometry=mesh_65, Motion=vec_4)  # -> Geometry, Transform; disabled
move_36 = Move(Geometry=mesh_64, Motion=vec_4)  # -> Geometry, Transform; disabled
move_37 = Move(Geometry=mesh_63, Motion=vec_4)  # -> Geometry, Transform; disabled
multiplication_41 = Multiplication(A=division_36, B=number_slider_43)  # disabled
neg_15 = Negative(Value=multiplication_41)  # disabled
multiplication_42 = Multiplication(A=panel_163, B=tree)  # disabled
multiplication_43 = Multiplication(A=panel_164, B=tree)  # disabled
dom_12 = ConstructDomain(DomainStart=multiplication_42, DomainEnd=multiplication_43)  # disabled
move_38 = Move(Geometry=mesh_71, Motion=vec_2)  # -> Geometry, Transform; disabled
dom_13 = ConstructDomain(DomainStart=neg_15, DomainEnd=multiplication_41)  # disabled
panel_165 = Panel(num_123)  # disabled

# ---- group: 3D City / meshes 3D ref: Tree
mesh_74 = Mesh(mcol_5)  # disabled

# ---- group: 3D City / is building or not
bool_37 = Boolean(and_20)  # disabled

# ---- group: 3D City / color for each type
col_26 = Colour(merge_12)  # disabled

# ---- group: 3D City / park center 3D
pt_91 = Point(move_34.Geometry)  # disabled

# ---- group: 3D City / park 3D
mesh_75 = Mesh(move_38.Geometry)  # disabled

# ---- group: 3D City / sidewalk
mesh_76 = Mesh(move_36.Geometry)  # disabled

# ---- group: 3D City / road
mesh_77 = Mesh(move_35.Geometry)  # disabled

# ---- group: 3D City / blank
mesh_78 = Mesh(move_37.Geometry)  # disabled

# ---- group: parking
movetoorgin_4 = MoveToOrgin(G=mesh_59, num=num_62)  # disabled
vec2pt_12 = Vector2Pt(PointA=Point(0, 0, 0), PointB=pt_86, Unitize=False)  # -> Vector, Length; disabled

# ---- group: parking / module meshes lego at orgin
mesh_79 = Mesh(movetoorgin_4)  # disabled

# ---- group: 3D City (continued)
dispatch_30 = Dispatch(List=pt_83, DispatchPattern=bool_37)  # -> ListA, ListB; disabled
dispatch_31 = Dispatch(List=int_176, DispatchPattern=bool_37)  # -> ListA, ListB; disabled
planesrf_7 = PlaneSurface(Plane=pt_91, XSize=dom_11, YSize=dom_11)  # disabled
lng_7 = ListLength(List=pt_91)  # disabled
random_13 = Random(Range=panel_162, Number=lng_7, Seed=number_slider_42)  # disabled
multiplication_44 = Multiplication(A=random_13, B=tree_scale)  # disabled
scale_2 = Scale(Geometry=mesh_74, Center=Point(0, 0, 0), Factor=multiplication_44)  # -> Geometry, Transform; disabled
random_14 = Random(Range=dom_12, Number=lng_7, Seed=number_slider_44)  # disabled
random_15 = Random(Range=Domain(0, 1000), Number=lng_7, Seed=Slider(35, range=0..100))  # disabled
popgeo = PopulateGeometry(Geometry=flatten(planesrf_7), Count=flatten(random_14), Seed=flatten(random_15))  # disabled

# ---- group: 3D City / building center
pt_92 = Point(dispatch_30.ListA)  # disabled

# ---- group: 3D City / building id
int_197 = Integer(dispatch_31.ListA)  # disabled

# ---- group: 3D City / tree center
pt_93 = Point(flatten(popgeo))  # disabled

# ---- group: 3D City (continued)
equals_30 = Equality(FirstNumber=int_197, SecondNumber=int_180)  # -> Equality, Inequality; disabled
multiplication_45 = Multiplication(A=equals_30.Inequality, B=6)  # disabled
addition_35 = Addition(A=int_197, B=multiplication_45)  # disabled
vec2pt_13 = Vector2Pt(PointA=Point(0, 0, 0), PointB=pt_93, Unitize=False)  # -> Vector, Length; disabled
filter_77 = StreamFilter(Gate=equals_15.Equality, Stream0=addition_35, Stream1=int_197)  # disabled
item_44 = ListItem(List=col_26, Index=graft(filter_77), Wrap=False)  # disabled
pshift_46 = ShiftPaths(Data=item_44, Offset=-1)  # disabled
move_39 = Move(Geometry=scale_2.Geometry, Motion=vec2pt_13.Vector)  # -> Geometry, Transform; disabled
item_45 = ListItem(List=panel_165, Index=graft(int_197), Wrap=False)  # disabled
pshift_47 = ShiftPaths(Data=item_45, Offset=-1)  # disabled
multiplication_46 = Multiplication(A=pshift_47, B=number_slider_36)  # disabled

# ---- group: 3D City / color for each building
col_27 = Colour(pshift_46)  # disabled

# ---- group: 3D City / trees 3D
mesh_80 = Mesh(move_39.Geometry)  # disabled

# ---- group: 3D City / building height of each building
num_198 = Number(multiplication_46)  # disabled

# ---- group: 3D City (continued)
addition_36 = Addition(A=num_198, B=panel_150)  # disabled
dom_14 = ConstructDomain(DomainStart=0, DomainEnd=addition_36)  # disabled
box = DomainBox(Base=pt_92, X=dom_13, Y=dom_13, Z=dom_14)  # disabled
move_40 = Move(Geometry=box, Motion=vec_4)  # -> Geometry, Transform; disabled

# ---- group: 3D City / building geo
box_2 = Box(move_40.Geometry)  # disabled

# ---- group: textured buildings
panel_166 = Panel("C:\Users\RYAN\Documents\GitHub\CityMatrix\Map\PEV_PSG AND PKG_300DPI.png")  # disabled
panel_167 = Panel("0.01")  # disabled
swatch_9 = ColourSwatch(SwatchColor=RGB(255, 255, 255))  # disabled
boxmap = BoxMapping(Mesh=box_2, Box=box_2)  # disabled
previewmat_3 = CustomPreviewMaterials(Geometry=boxmap, DiffuseColor=swatch_9, Transparency=panel_167, DiffuseBitmap=panel_166)  # disabled

# ---- group: 3D City / 3D Buldings
preview_24 = CustomPreview(Geometry=box_2, Shader=col_27)  # disabled

# ---- group: parking (continued)
move_41 = Move(Geometry=mesh_79, Motion=vec2pt_12.Vector)  # -> Geometry, Transform; disabled

# ---- group: parking / parking lego
mesh_81 = Mesh(move_41.Geometry)  # disabled

# ---- group: parking (continued)
move_42 = Move(Geometry=mesh_81, Motion=vec_2)  # -> Geometry, Transform; disabled
filter_78 = StreamFilter(Gate=show_google_map, Stream0=mesh_81)  # disabled

# ---- group: parking / parking 3D
mesh_82 = Mesh(move_42.Geometry)  # disabled

# ---- group: parking / parking lego
mesh_83 = Mesh(filter_78)  # disabled

# ==== cluster ModuleCenter
pt = ClusterInput()
int = ClusterInput()
num = ClusterInput()
int_2 = ClusterInput()

# ---- group: y
int_3 = Integer(int)

# ---- group: cell size
num_2 = Number(num)

# ---- group: x
int_4 = Integer(int_2)

# ---- group: center
pt_2 = Point(pt)

# ----
pt_3 = ConstructPoint(XCoordinate=0, YCoordinate=0, ZCoordinate=0)  # disabled
addition = Addition(A=int_4, B=0.5)
vec2pt = Vector2Pt(PointA=pt_3, PointB=pt_2, Unitize=False)  # -> Vector, Length; disabled
addition_2 = Addition(A=int_3, B=0.5)
multiplication = Multiplication(A=addition, B=num_2)
move = Move(Motion=vec2pt.Vector)  # -> Geometry, Transform; disabled
lng = ListLength(List=int_4)  # disabled
multiplication_2 = Multiplication(A=addition_2, B=num_2)
X = UnitX(Factor=multiplication)
repeat = RepeatData(Data=move.Transform, Length=lng)  # disabled
neg = Negative(Value=multiplication_2)
move_2 = Move(Geometry=pt_2, Motion=X)  # -> Geometry, Transform
graft = GraftTree(Tree=move_2.Transform, IncludeEmptyLists=True, IncludeNullItems=True)  # disabled
Y = UnitY(Factor=neg)
pshift = ShiftPaths(Data=repeat, Offset=-1)  # disabled
move_3 = Move(Geometry=move_2.Geometry, Motion=Y)  # -> Geometry, Transform
graft_2 = GraftTree(Tree=move_3.Transform, IncludeEmptyLists=True, IncludeNullItems=True)  # disabled
comp = Compound(Transforms=[graft, graft_2])  # disabled
graft_3 = GraftTree(Tree=pshift, IncludeEmptyLists=True, IncludeNullItems=True)  # disabled
comp_2 = Compound(Transforms=[comp, graft_3])  # disabled

# ---- group: module center
pt_4 = Point(move_3.Geometry)

# ----
pshift_2 = ShiftPaths(Data=comp_2, Offset=-1)  # disabled
transform = Transform(pshift_2)  # disabled
pt_5 = ClusterOutput(pt_4)
transform_2 = ClusterOutput(transform)  # disabled

# ==== cluster MoveToOrgin
num = ClusterInput()
G = ClusterInput()
num_2 = Number(num)
geobottomcenter = GeoBottomCenter(geo=G)
vec2pt = Vector2Pt(PointA=geobottomcenter, PointB=Point(0, 0, 0), Unitize=False)  # -> Vector, Length
move = Move(Geometry=G, Motion=vec2pt.Vector)  # -> Geometry, Transform
scale_nu = ScaleNU(Geometry=move.Geometry, Plane=PlaneXY(0, 0, 0), ScaleX=num_2, ScaleY=num_2, ScaleZ=1)  # -> Geometry, Transform
G_2 = ClusterOutput(scale_nu.Geometry)

# ==== cluster GeoBottomCenter_2
geo = ClusterInput()
geo_2 = Geometry(geo)
bbox = BoundingBox(Content=geo_2, Plane=PlaneXY(0, 0, 0))  # -> Box, Box_2
box_corners = BoxCorners(Box=bbox.Box)  # -> CornerA, CornerB, CornerC, CornerD, CornerE, CornerF, CornerG, CornerH
pdecon = Deconstruct(Point=box_corners.CornerA)  # -> XComponent, YComponent, ZComponent
pdecon_2 = Deconstruct(Point=box_corners.CornerC)  # -> XComponent, YComponent, ZComponent
addition = Addition(A=pdecon.XComponent, B=pdecon_2.XComponent)
addition_2 = Addition(A=pdecon.YComponent, B=pdecon_2.YComponent)
division = Division(A=addition, B=2)
division_2 = Division(A=addition_2, B=2)
pt = ConstructPoint(XCoordinate=division, YCoordinate=division_2, ZCoordinate=pdecon.ZComponent)
pshift = ShiftPaths(Data=pt, Offset=-1)
pt_2 = Point(pshift)
pt_3 = ClusterOutput(pt_2)

# ==== cluster EasterEggs
panel = Panel("79")  # disabled
panel_2 = Panel("30")  # disabled
subtraction = Subtraction(A=panel, B=1)  # disabled
subtraction_2 = Subtraction(A=panel_2, B=1)  # disabled
sqgrid = Square(Plane=PlaneXY(0, 0, 0), Size=1, ExtentX=subtraction, ExtentY=subtraction_2)  # -> Cells, Points; disabled
pdecon = Deconstruct(Point=sqgrid.Points)  # -> XComponent, YComponent, ZComponent; disabled
division = Division(A=pdecon.XComponent, B=panel)  # disabled
division_2 = Division(A=pdecon.YComponent, B=panel_2)  # disabled
pt = ConstructPoint(XCoordinate=division, YCoordinate=division_2, ZCoordinate=0)  # disabled
ahsv = SplitAHSV()  # -> Alpha, Hue, Saturation, Value; disabled
smaller = SmallerThan(FirstNumber=ahsv.Alpha, SecondNumber=1)  # -> SmallerThan, OrEqualTo; disabled
dispatch = Dispatch(List=sqgrid.Points, DispatchPattern=smaller.SmallerThan)  # -> ListA, ListB; disabled
dispatch_2 = Dispatch(DispatchPattern=smaller.SmallerThan)  # -> ListA, ListB; disabled
vec = VectorXYZ(XComponent=2, YComponent=-2, ZComponent=-10)  # -> Vector, Length; disabled
planesrf = PlaneSurface(Plane=dispatch.ListB, XSize=Domain(-0.5, 0.5), YSize=Domain(-0.5, 0.5))  # disabled
mesh = Mesh(flatten(planesrf))  # disabled
col = Colour(flatten(dispatch_2.ListB))  # disabled
mspray = MeshSpray(Mesh=graft(mesh), Points=Point(0, 0, 0), Colours=graft(col), SprayMode=0)  # disabled
mjoin = MeshJoin(Meshes=flatten(mspray))  # disabled
move = Move(Geometry=mjoin, Motion=vec.Vector)  # -> Geometry, Transform; disabled
mcol = MeshColours(Mesh=move.Geometry, Colours=RGB(0, 0, 0))  # disabled
preview = CustomPreview(Geometry=planesrf, Shader=dispatch_2.ListB)  # disabled
mjoin_2 = MeshJoin(Meshes=flatten([mjoin, mcol]))  # disabled
toggle = BooleanToggle(False)  # disabled
toggle_2 = BooleanToggle(False)  # disabled
panel_3 = Panel("7")  # disabled
swatch = ColourSwatch(SwatchColor=RGB(0, 0, 0))  # disabled
swatch_2 = ColourSwatch(SwatchColor=RGB(255, 115, 0))  # disabled

# ---- group: module meshes lego ref: 7 - J
mesh_2 = Mesh(<mesh referenced from the Rhino model>)  # disabled

# ---- group: on screen mesh ref: 8 - X
mesh_3 = Mesh(<mesh referenced from the Rhino model>)  # disabled

# ---- group: module meshes lego ref: 8 - X
mesh_4 = Mesh(<mesh referenced from the Rhino model>)  # disabled

# ----
panel_4 = Panel("7")  # disabled
mesh_5 = Mesh(<mesh referenced from the Rhino model>)  # disabled

# ---- group: on screen mesh ref: 7 - J
mesh_6 = Mesh(mjoin_2)  # disabled

# ----
mcol_2 = MeshColours(Mesh=mesh_3, Colours=swatch_2)  # disabled
mcol_3 = MeshColours(Mesh=mesh_5, Colours=swatch)  # disabled
shrink = ClusterInput()
shrink_2 = ClusterInput()
movetoorgin = MoveToOrgin(G=mesh_2, num=shrink)  # disabled
movetoorgin_2 = MoveToOrgin(G=mesh_4, num=shrink_2)  # disabled
mjoin_3 = MeshJoin(Meshes=[mcol_2, mcol_3])  # disabled

# ---- group: module meshes lego at orgin
mesh_7 = Mesh(movetoorgin)  # disabled

mesh_8 = Mesh(movetoorgin_2)  # disabled

# ----
A = ClusterInput()
A_2 = ClusterInput()
equals = Equality(FirstNumber=A, SecondNumber=panel_4)  # -> Equality, Inequality; disabled
int = Integer(equals.Equality)  # disabled
ma = MassAddition(Input=int)  # -> Result, PartialResults; disabled
larger = LargerThan(FirstNumber=ma.Result, SecondNumber=0)  # -> LargerThan, OrEqualTo; disabled
equals_2 = Equality(FirstNumber=A_2, SecondNumber=panel_3)  # -> Equality, Inequality; disabled
L = ClusterInput()
int_2 = Integer(equals_2.Equality)  # disabled
ma_2 = MassAddition(Input=int_2)  # -> Result, PartialResults; disabled
larger_2 = LargerThan(FirstNumber=ma_2.Result, SecondNumber=0)  # -> LargerThan, OrEqualTo; disabled
L_2 = ClusterInput()
dispatch_3 = Dispatch(List=L, DispatchPattern=equals_2.Equality)  # -> ListA, ListB; disabled

# ---- group: if has this special id
bool = Boolean(larger.LargerThan)  # disabled

bool_2 = Boolean(bool)  # disabled

# ----
getcamera = GetCamera(GetCamera=bool_2)  # -> Location, Target, LensLength, UpDirection; disabled
ln = Line(StartPoint=getcamera.Location, EndPoint=getcamera.Target)  # disabled
getplanefrom2pts = GetPlaneFrom2pts(pt_2=getcamera.Location, pt=getcamera.Target)  # disabled
dispatch_4 = Dispatch(List=L_2, DispatchPattern=equals.Equality)  # -> ListA, ListB; disabled
number_slider = Slider(6.4, range=0..10)  # disabled
number_slider_2 = Slider(14.4, range=0..100)  # disabled
pt_2 = ConstructPoint(XCoordinate=500, YCoordinate=500, ZCoordinate=20)  # disabled

# ---- group: if has this special id
bool_3 = Boolean(larger_2.LargerThan)  # disabled

bool_4 = Boolean(bool_3)  # disabled

# ----
getcamera_2 = GetCamera(GetCamera=bool_4)  # -> Location, Target, LensLength, UpDirection; disabled
ln_2 = Line(StartPoint=getcamera_2.Location, EndPoint=getcamera_2.Target)  # disabled
getplanefrom2pts_2 = GetPlaneFrom2pts(pt_2=getcamera_2.Location, pt=getcamera_2.Target)  # disabled
vec2pt = Vector2Pt(PointA=Point(0, 0, 0), PointB=dispatch_3.ListA, Unitize=False)  # -> Vector, Length; disabled
vec2pt_2 = Vector2Pt(PointA=Point(0, 0, 0), PointB=dispatch_4.ListA, Unitize=False)  # -> Vector, Length; disabled
move_2 = Move(Geometry=mesh_7, Motion=vec2pt.Vector)  # -> Geometry, Transform; disabled
pt_3 = Point(pt_2)  # disabled
move_3 = Move(Geometry=mesh_8, Motion=vec2pt_2.Vector)  # -> Geometry, Transform; disabled

# ---- group: current cam canvas pln
pln = Plane(getplanefrom2pts)  # disabled

pln_2 = Plane(getplanefrom2pts_2)  # disabled

# ----
xy = XYPlane(Origin=pt_3)  # disabled
number_slider_3 = Slider(0.01, range=0.001..1)  # disabled
number_slider_4 = Slider(0.01, range=0.001..1)  # disabled
number_slider_5 = Slider(0.81, range=0.001..101)  # disabled
movetoorgin_3 = MoveToOrgin(G=mjoin_3, num=number_slider)  # disabled
movetoorgin_4 = MoveToOrgin(G=mesh_6, num=number_slider_2)  # disabled
orient = Orient(Geometry=movetoorgin_4, Source=PlaneXY(0, 0, 0), Target=xy)  # -> Geometry, Transform; disabled
orient_2 = Orient(Geometry=movetoorgin_3, Source=PlaneXY(0, 0, 0), Target=pln)  # -> Geometry, Transform; disabled
orient_3 = Orient(Geometry=movetoorgin_4, Source=PlaneXY(0, 0, 0), Target=pln_2)  # -> Geometry, Transform; disabled
scale = Scale(Geometry=orient_2.Geometry, Center=getcamera.Location, Factor=number_slider_3)  # -> Geometry, Transform; disabled
scale_2 = Scale(Geometry=orient_3.Geometry, Center=getcamera_2.Location, Factor=number_slider_4)  # -> Geometry, Transform; disabled
scale_3 = Scale(Geometry=orient.Geometry, Center=pt_3, Factor=number_slider_5)  # -> Geometry, Transform; disabled
filter = StreamFilter(Gate=bool_2, Stream1=scale.Geometry)  # disabled
filter_2 = StreamFilter(Gate=bool_4, Stream1=scale_2.Geometry)  # disabled
filter_3 = StreamFilter(Gate=bool_4, Stream1=scale_3.Geometry)  # disabled

# ---- group: special JR
mesh_9 = Mesh(move_2.Geometry)  # disabled

# ---- group: on 3d view
mesh_10 = Mesh(filter)  # disabled

# ---- group: special Xin
mesh_11 = Mesh(move_3.Geometry)  # disabled

# ---- group: on 3d view
mesh_12 = Mesh(filter_2)  # disabled

# ---- group: on lego
mesh_13 = Mesh(filter_3)  # disabled

# ==== cluster RndReduceByRatio
L = ClusterInput()
B = ClusterInput()
lng = ListLength(List=L)
S = ClusterInput()
multiplication = Multiplication(A=lng, B=B)
reduce = RandomReduce(List=L, Reduction=multiplication, Seed=S)
L_2 = ClusterOutput(reduce)

# ==== cluster DashLine20
num = ClusterInput()
crv = ClusterInput()
crv_2 = Curve(reparameterize(graft(crv)))
num_2 = Number(num)
explode = Explode(Curve=crv_2, Recursive=True)  # -> Segments, Vertices
crv_3 = Curve(reparameterize(graft(explode.Segments)))
len = Length(Curve=crv_3)
division = Division(A=len, B=num_2)

# ---- group: make sure it's odd number
int = Integer(division)
mod = Modulus(A=int, B=Slider(2, range=0..10))
subtraction = Subtraction(A=Slider(1, range=0..1), B=mod)
addition = Addition(A=int, B=subtraction)

# ----
int_2 = Integer(addition)
dom = Domain(DomainStart=0, DomainEnd=expr("1-1/x", int_2))
dom_2 = Domain(DomainStart=expr("1/x", int_2), DomainEnd=1)
range = Range(Domain=dom_2, Steps=expr("x-1", int_2))
range_2 = Range(Domain=dom, Steps=expr("x-1", int_2))
series = Series(Start=0, Step=2, Count=expr("(x+1)/2", int_2))
dom_3 = Domain(DomainStart=range_2, DomainEnd=range)
item = ListItem(List=dom_3, Index=series, Wrap=False)
subcrv = SubCurve(BaseCurve=crv_3, Domain=item)
C = ClusterOutput(subcrv)

# ==== cluster AddArrowHead
num = ClusterInput()
crv = ClusterInput()

# ---- group: arrow size
num_2 = Number(num)

# ---- group: ref crvs - density arrow base
crv_2 = Curve(reparameterize(graft(crv)))

# ----
eval = EvaluateCurve(Curve=crv_2, Parameter=1)  # -> Point, Tangent, Angle
multiplication = Multiplication(A=num_2, B=Slider(0.2, range=0..1))
neg = Negative(Value=multiplication)
xy = XYPlane(Origin=eval.Point)
align = AlignPlane(Plane=xy, Direction=eval.Tangent)  # -> Plane, Angle
pt = PointOriented(BasePlane=align.Plane, UComponent=0, VComponent=-0.1, WComponent=0)
pt_2 = PointOriented(BasePlane=align.Plane, UComponent=0, VComponent=multiplication, WComponent=0)
pt_3 = PointOriented(BasePlane=align.Plane, UComponent=num_2, VComponent=0, WComponent=0)
pt_4 = PointOriented(BasePlane=align.Plane, UComponent=0, VComponent=neg, WComponent=0)
merge = Merge(Data1=eval.Point, Data2=pt_2, Data3=pt_3, Data4=pt_4, Data5=pt)
pline = PolyLine(Vertices=merge, Closed=False)
merge_2 = Merge(Data1=crv_2, Data2=pline)
join = JoinCurves(Curves=merge_2, Preserve=False)
pshift = ShiftPaths(Data=join, Offset=-2)
D = ClusterOutput(pshift)

# ==== cluster CellChangeArrowCrv
int = ClusterInput()
pt = ClusterInput()
pt_2 = ClusterInput()
num = ClusterInput()

# ---- group: id suggested
int_2 = Integer(graft(int))

# ---- group: module center suggested
pt_3 = Point(graft(pt))

# ---- group: cell change arrow start pts
pt_4 = Point(pt_2)

# ---- group: arrow size
num_2 = Number(num)

# ----
vec = VectorXYZ(XComponent=10, YComponent=0, ZComponent=20)  # -> Vector, Length
item = ListItem(List=pt_4, Index=int_2, Wrap=False)
move = Move(Geometry=pt_3, Motion=vec.Vector)  # -> Geometry, Transform

# ---- group: cell change arrow start pt
pt_5 = Point(item)

# ----
dist = Distance(PointA=pt_5, PointB=move.Geometry)
ln = Line(StartPoint=pt_5, EndPoint=move.Geometry)
multiplication = Multiplication(A=dist, B=0.14)
crv = Curve(reparameterize(ln))
eval = EvaluateCurve(Curve=crv, Parameter=0.5)  # -> Point, Tangent, Angle
rotate = Rotate(Geometry=eval.Tangent, Angle=degrees(-90), Plane=PlaneXY(0, 0, 0))  # -> Geometry, Transform
amp = Amplitude(Vector=rotate.Geometry, Amplitude=multiplication)
addition = Addition(A=eval.Point, B=amp)
pt_6 = Point(addition)
arc = Arc3Pt(PointA=pt_5, PointB=pt_6, PointC=move.Geometry)  # -> Arc, Plane, Radius

# ---- group: arc
crv_2 = Curve(reparameterize(arc.Arc))

# ----
len = Length(Curve=crv_2)
subtraction = Subtraction(A=len, B=num_2)
division = Division(A=subtraction, B=len)
dom = ConstructDomain(DomainStart=0, DomainEnd=division)
subcrv = SubCurve(BaseCurve=crv_2, Domain=dom)
pshift = ShiftPaths(Data=subcrv, Offset=-1)

# ---- group: arc trimed
crv_3 = Curve(pshift)

# ----
crv_4 = ClusterOutput(crv_3)

# ==== cluster GeoBottomCenter
geo = ClusterInput()
geo_2 = Geometry(geo)
bbox = BoundingBox(Content=geo_2, Plane=PlaneXY(0, 0, 0))  # -> Box, Box_2
box_corners = BoxCorners(Box=bbox.Box)  # -> CornerA, CornerB, CornerC, CornerD, CornerE, CornerF, CornerG, CornerH
pdecon = Deconstruct(Point=box_corners.CornerA)  # -> XComponent, YComponent, ZComponent
pdecon_2 = Deconstruct(Point=box_corners.CornerC)  # -> XComponent, YComponent, ZComponent
addition = Addition(A=pdecon.XComponent, B=pdecon_2.XComponent)
addition_2 = Addition(A=pdecon.YComponent, B=pdecon_2.YComponent)
division = Division(A=addition, B=2)
division_2 = Division(A=addition_2, B=2)
pt = ConstructPoint(XCoordinate=division, YCoordinate=division_2, ZCoordinate=pdecon.ZComponent)
pt_2 = Point(pt)
pt_3 = ClusterOutput(pt_2)

# ==== cluster GetPlaneFrom2pts
pt = ClusterInput()
pt_2 = ClusterInput()

# ---- group: current cam tgt pos
pt_3 = Point(pt)

# ---- group: current cam pos
pt_4 = Point(pt_2)

# ----
Z = UnitZ(Factor=100)
move = Move(Geometry=pt_3, Motion=Z)  # -> Geometry, Transform
pl_3pt = Plane3Pt(PointA=pt_3, PointB=pt_4, PointC=move.Geometry)
pt_5 = PointOriented(BasePlane=pl_3pt, UComponent=0, VComponent=0, WComponent=-100)
pt_6 = PointOriented(BasePlane=pl_3pt, UComponent=0, VComponent=100, WComponent=0)
pl_3pt_2 = Plane3Pt(PointA=pt_3, PointB=pt_5, PointC=pt_6)
pln = Plane(pl_3pt_2)
pln_2 = ClusterOutput(pln)
