# Grasshopper definition 180502_CS_BentoScope_Dubai.gh (Grasshopper 0.9.76)
# plug-ins: Firefly.X, Human

vb = VBScript()  # -> out, A
# ---------- vb: VB ----------
    Dim gh_d As GH_Document = owner.OnPingDocument()

    If gh_d.IsFilePathDefined Then
      Print("A path is defined.")
      A = gh_d.FilePath
    Else
      Print("No path defined.")
    End If
# ---------- end vb ----------
# Parsing Resource Data
panel = Panel(vb.out)
panel_2 = Panel(vb.A)
split = TextSplit(Text=panel_2, Separators="\")
shift = ShiftList(List=split, Shift=-1, Wrap=False)
txt = Text(flatten("Data\data.csv"))
txt_2 = Text(flatten(shift))
join = TextJoin(Text=flatten([txt_2, txt]), Join="\")
path = FilePath(join)
panel_3 = Panel(path)

vb_2 = VBScript()  # -> out, A; same code as vb
# Parsing Exist Flr # Data
panel_4 = Panel(vb_2.out)
panel_5 = Panel(vb_2.A)
split_2 = TextSplit(Text=panel_5, Separators="\")
shift_2 = ShiftList(List=split_2, Shift=-1, Wrap=False)
txt_3 = Text(flatten("Data\building floor number.csv"))
txt_4 = Text(flatten(shift_2))
join_2 = TextJoin(Text=flatten([txt_4, txt_3]), Join="\")
path_2 = FilePath(join_2)
panel_6 = Panel(path_2)

vb_3 = VBScript()  # -> out, A; same code as vb
panel_7 = Panel(vb_3.out)
panel_8 = Panel(vb_3.A)
split_3 = TextSplit(Text=panel_8, Separators="\")
shift_3 = ShiftList(List=split_3, Shift=-1, Wrap=False)
txt_5 = Text(flatten("Maps\Population Density.png"))
txt_6 = Text(flatten(shift_3))
join_3 = TextJoin(Text=flatten([txt_6, txt_5]), Join="\")
path_3 = FilePath(join_3)
panel_9 = Panel(path_3)

panel_10 = Panel("0.02,0.01,0.02,0.05,0.02,0.02,0,0,0.01,0.005311,0.027,0.023,0.022,0.01,0.001,0.001")

# ---- group: layer "pop dens"
crv = Curve([<curve referenced from the Rhino model> x16])

# ---- group: reading txt
file = ReadFile(File=path, PerLineParse=True)

file_2 = ReadFile(File=panel_6, PerLineParse=True)

# ----
txt_7 = Text(file)
boundary = BoundarySurfaces(Edges=graft(crv))
split_4 = TextSplit(Text=panel_10, Separators=",")
path_4 = FilePath(path_3)
txt_8 = Text(file_2)

# ---- group: data
txt_9 = Text(txt_7)

# ----
panel_11 = Panel(txt_9)
load_bitmap = LoadBitmap(FilePathToImageLocation=path_4)
num = Number(split_4)
bnd = Bounds(Numbers=num)

# ---- group: data
txt_10 = Text(txt_8)

# ----
panel_12 = Panel(txt_10)
split_5 = TextSplit(Text=txt_9, Separators=",")
dedomain = DeconstructDomain(Domain=bnd)  # -> Start, End
split_6 = TextSplit(Text=txt_10, Separators=",")
pshift = ShiftPaths(Data=split_5, Offset=1)
gradient = Gradient(LowerLimit=dedomain.Start, UpperLimit=dedomain.End, Parameter=num, stops=[0: RGB(0, 0, 0), 1: RGB(255, 255, 255)])
mcol = MeshColours(Mesh=boundary, Colours=graft(gradient))
pshift_2 = ShiftPaths(Data=split_6, Offset=1)
pshift_3 = ShiftPaths(Data=pshift, Offset=-1)
pshift_4 = ShiftPaths(Data=mcol, Offset=-1)
pshift_5 = ShiftPaths(Data=pshift_2, Offset=-1)

# ---- group: all data 32x32
int = Integer(pshift_3)

# ----
panel_13 = Panel(int)

# ---- group: export png
mesh = Mesh(pshift_4)

# ---- group: all data 32x32
int_2 = Integer(pshift_5)

# ----
panel_14 = Panel(int_2)

# ---- group: shrink
cell_shrink = Slider(0.98, range=0.75..1)

# ---- group: module meshes lego ref: -1
mesh_2 = Mesh(<mesh referenced from the Rhino model>)

# ----
sqr = Square(Value="75")
movetoorgin = MoveToOrgin(G=mesh_2, num=cell_shrink)
multiplication = Multiplication(A=sqr, B="0.5")

# ---- group: area per floor per lego dot
num_2 = Number(multiplication)

# ----
panel_15 = Panel(num_2)

# ---- group: module meshes lego at orgin
mesh_3 = Mesh(movetoorgin)

# ---- group: r
number_slider = Slider(1000, range=0..1000)

# ---- group: Total Pop.
number_slider_2 = Slider(100000, range=0..100000)

# ----
vb_4 = VBScript()  # -> out, A; same code as vb
# Parsing Test Dynamic ID Data
panel_16 = Panel(vb_4.out)
panel_17 = Panel(vb_4.A)
split_7 = TextSplit(Text=panel_17, Separators="\")
shift_4 = ShiftList(List=split_7, Shift=-1, Wrap=False)
txt_11 = Text(flatten("Data\Dynamic Data_Test_01.txt"))
txt_12 = Text(flatten(shift_4))
join_4 = TextJoin(Text=flatten([txt_12, txt_11]), Join="\")
path_5 = FilePath(join_4)
panel_18 = Panel(path_5)

# ---- group: dockRotation
int_3 = Integer()

# ---- group: dockID
int_4 = Integer()

# ---- group: slider1
num_3 = Number()

# ---- group: toggle1
bool = Boolean()

# ---- group: toggle2
bool_2 = Boolean()

bool_3 = Boolean()

# ---- group: shrink
cell_shrink_2 = Slider(0.98, range=0.75..1)

cell_shrink_3 = Slider(0.905, range=0.75..1)  # disabled

# ---- group: module meshes lego ref: -1
mesh_4 = Mesh(<mesh referenced from the Rhino model>)

# ---- group: module meshes lego ref: Commercial
mesh_5 = Mesh(<mesh referenced from the Rhino model>)

# ----
number_slider_3 = Slider(16, range=0..100)

# ---- group: gridExtent_x
int_5 = Integer(number_slider_3)

int_6 = Integer(int_5)

# ---- group: module meshes lego ref: 0 to 7
mesh_6 = Mesh([<mesh referenced from the Rhino model> x8])

# ---- group: module meshes lego ref: -1
mesh_7 = Mesh(<mesh referenced from the Rhino model>)  # disabled

# ---- group: gridExtent_y
int_7 = Integer(number_slider_3)

int_8 = Integer(int_7)

# ---- group: module meshes lego ref: 0 to 7
mesh_8 = Mesh([<mesh referenced from the Rhino model> x8])  # disabled

# ---- group: colortizer orgin
# CityMatrix Mini Lego Simulator
pt = Point(<point referenced from the Rhino model>)  # disabled

# ---- group: table size ref pt
pt_2 = Point(<point referenced from the Rhino model>)  # disabled

# ---- group: colortizer orgin
# LEGO Grid System
pt_3 = Point(<point referenced from the Rhino model>)

# ---- group: gridExtent_x
int_9 = Integer(int_5)  # disabled

# ---- group: table size ref pt
pt_4 = Point(<point referenced from the Rhino model>)

# ---- group: gridExtent_y
int_10 = Integer(int_7)  # disabled

# ---- group: Building Heigt Slider
_0_r = Slider(14, range=1..25)
_1_r = Slider(17, range=1..25)
_3_o = Slider(7, range=1..25)
_4_ps = Slider(7, range=1..25)
_7_edu = Slider(7, range=1..25)
_2_r = Slider(20, range=1..25)

# ---- group: 3D building site move amount
# 3D City Grid System
panel_19 = Panel("10000")
X = UnitX(Factor=panel_19)

# ----
# Parsing Exist Commercial Data
panel_20 = Panel("C:\Users\RYAN\Dropbox (MIT)\01_Work\MAS\05_Summer 2016\CityMatrix Mini\_for Waleed\Data\Waleed_Exist Data_02_Commercial.txt")
xy = XYPlane(Origin=pt)  # disabled
dist = Distance(PointA=pt, PointB=pt_2)  # disabled
xy_2 = XYPlane(Origin=pt_3)
dist_2 = Distance(PointA=pt_3, PointB=pt_4)
com = ColourSwatch(SwatchColor=RGB(158, 158, 158))
com_2 = ColourSwatch(SwatchColor=RGB(71, 71, 71))
res = ColourSwatch(SwatchColor=RGB(212, 212, 212))
res_2 = ColourSwatch(SwatchColor=RGB(76, 76, 76))

# ---- group: blank
mesh_9 = Mesh()

# ----
division = Division(A=dist, B=int_9)  # disabled
movetoorgin_2 = MoveToOrgin(G=mesh_8, num=cell_shrink_3)  # disabled
movetoorgin_3 = MoveToOrgin(G=mesh_7, num=cell_shrink_3)  # disabled
division_2 = Division(A=dist_2, B=int_5)
vec = Vector(X)

# ---- group: base cplane
pln = Plane(xy)  # disabled

pln_2 = Plane(xy_2)

# ----
int_11 = Integer(_7_edu)
int_12 = Integer(_4_ps)
int_13 = Integer(_2_r)
int_14 = Integer(_3_o)
int_15 = Integer(_1_r)
int_16 = Integer(_0_r)
merge = Merge(Data1=res, Data2=res, Data3=res, Data4=com, Data5=com, Data6=com)
merge_2 = Merge(Data1=res_2, Data2=res_2, Data3=res_2, Data4=com_2, Data5=com_2, Data6=com_2)

# ---- group: cell size
num_4 = Number(division)  # disabled

# ----
modulecenter = ModuleCenter(pt=pt, num=num_4, int_2=int_9, int=int_10)  # -> pt_5, transform_2; disabled
merge_3 = Merge(Data1=int_16, Data2=int_15, Data3=int_13, Data4=int_14, Data5=int_12, Data6=int_11)

# ---- group: cell size
num_5 = Number(division_2)

# ----
movetoorgin_4 = MoveToOrgin(G=mesh_5, num=cell_shrink_2)
movetoorgin_5 = MoveToOrgin(G=mesh_6, num=cell_shrink_2)
movetoorgin_6 = MoveToOrgin(G=mesh_4, num=cell_shrink_2)

# ---- group: all fl #s
txt_13 = Text([int_16, int_15, int_13, int_14, int_12, int_11])

# ---- group: reading txt
file_3 = ReadFile(File=path_5, PerLineParse=True)

# ----
merge_4 = Merge(Data1=merge, Data2=merge_2)

# ---- group: cell size
num_6 = Number(division_2)

# ---- group: Cell Center
pt_5 = Point(modulecenter.pt_5)  # disabled

# ---- group: color for each type
col = Colour(merge_4)

# ---- group: reading txt
file_4 = ReadFile(File=panel_20, PerLineParse=True)

# ---- group: floor num for each type
int_17 = Integer(merge_3)

# ---- group: floor height
panel_21 = Panel("3.5")

# ----
txt_14 = Text(file_3)
division_3 = Division(A=num_6, B=2)

# ---- group: module meshes lego at orgin
mesh_10 = Mesh(movetoorgin_3)  # disabled

mesh_11 = Mesh(movetoorgin_2)  # disabled

# ----
multiplication_2 = Multiplication(A=int_17, B=panel_21)

# ---- group: module meshes lego at orgin
mesh_12 = Mesh(movetoorgin_6)

mesh_13 = Mesh(movetoorgin_5)

# ---- group: data
txt_15 = Text(txt_14)

# ----
panel_22 = Panel(txt_15)

# ---- group: module meshes lego at orgin
mesh_14 = Mesh(movetoorgin_4)

# ---- group: base height
panel_23 = Panel("5.0")

# ----
move = Move(Geometry=mesh_9, Motion=vec)  # -> Geometry, Transform
multiplication_3 = Multiplication(A=division_3, B=Slider(0.95, range=0..1))
txt_16 = Text(file_4)
neg = Negative(Value=multiplication_3)

# ---- group: building height for each type
num_7 = Number(multiplication_2)

# ----
panel_24 = Panel("0")  # disabled
panel_25 = Panel("7")  # disabled
split_8 = TextSplit(Text=txt_15, Separators=",")
multiplication_4 = Multiplication(A=Slider(20, range=0..100))
Z = UnitZ(Factor=multiplication_4)
dom = ConstructDomain(DomainStart=neg, DomainEnd=multiplication_3)

# ---- group: data
txt_17 = Text(txt_16)

# ----
panel_26 = Panel(txt_17)
panel_27 = Panel(num_7)
pshift_6 = ShiftPaths(Data=split_8, Offset=1)
split_9 = TextSplit(Text=txt_17, Separators=",")

# ---- group: mesh coloring
color04 = ColourSwatch(SwatchColor=RGB(255, 255, 0))  # disabled
mesh_15 = Mesh([<mesh referenced from the Rhino model> x2])  # disabled
color01 = ColourSwatch(SwatchColor=RGB(255, 255, 255))  # disabled
color02 = ColourSwatch(SwatchColor=RGB(0, 0, 0))  # disabled
color03 = ColourSwatch(SwatchColor=RGB(255, 0, 0))  # disabled
color05 = ColourSwatch(SwatchColor=RGB(0, 102, 255))  # disabled
color06 = ColourSwatch(SwatchColor=RGB(3, 201, 0))  # disabled
text = ColourSwatch(SwatchColor=RGB(71, 71, 71))  # disabled
mcol_2 = MeshColours(Mesh=mesh_15, Colours=text)  # disabled
mesh_16 = Mesh(mcol_2)  # disabled

# ----
P = ColourSwatch(SwatchColor=RGB(128, 128, 128))

# ---- group: mesh coloring
text_2 = ColourSwatch(SwatchColor=RGB(0, 0, 0))
C = ColourSwatch(SwatchColor=RGB(255, 0, 255))
blank = ColourSwatch(SwatchColor=RGB(230, 230, 230))
mesh_17 = Mesh(<mesh referenced from the Rhino model>)
R = ColourSwatch(SwatchColor=RGB(255, 255, 128))
O = ColourSwatch(SwatchColor=RGB(255, 128, 128))
ps = ColourSwatch(SwatchColor=RGB(128, 212, 255))
os = ColourSwatch(SwatchColor=RGB(184, 230, 92))
P_2 = ColourSwatch(SwatchColor=RGB(89, 89, 89))
edu = ColourSwatch(SwatchColor=RGB(128, 170, 255))
mcol_3 = MeshColours(Mesh=mesh_17, Colours=P)
mesh_18 = Mesh(mcol_3)

# ---- group: saved dynamic data - proposed
int_18 = Integer([-1, -1, -1, -1, -1, -1, -1, -1, -1, -1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])

# ----
panel_28 = Panel("0")  # disabled
pshift_7 = ShiftPaths(Data=split_9, Offset=1)
pshift_8 = ShiftPaths(Data=pshift_6, Offset=-1)

# ---- group: building height factor
number_slider_4 = Slider(1.8, range=0..10)

# ---- group: all data
int_19 = Integer(pshift_7)

# ----
panel_29 = Panel(int_19)

# ---- group: dynamic data from file
int_20 = Integer(pshift_8)

# ----
pshift_9 = ShiftPaths(Data=int_19, Offset=-1)

# ---- group: saved dynamic data - improve 02 Commercial and Housing Diversity
int_21 = Integer([-1, -1, -1, -1, -1, -1, -1, -1, -1, -1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])

# ---- group: is commercial in existing
bool_4 = Boolean(pshift_9)

# ---- group: blank
mesh_19 = Mesh(move.Geometry)

# ---- group: saved dynamic data - improve 03 Green Space
int_22 = Integer([-1, -1, -1, -1, -1, -1, -1, -1, -1, -1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])

# ----
# Commercial Slider
# Commercial Combined
commercial_slider = Slider(0.7, range=0..1)

# ---- group: 2nd round final
# Combined ID Data
int_23 = Integer([-1, -1, 0, -1, -1, -1, -1, -1, -1, -1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])

# ---- group: IDs that is building
panel_30 = Panel("0")
panel_31 = Panel("1")
panel_32 = Panel("2")
panel_33 = Panel("3")
panel_34 = Panel("4")
# Base Data
panel_35 = Panel("7")

# ----
merge_5 = Merge(Data1=panel_30, Data2=panel_31, Data3=panel_32, Data4=panel_33, Data5=panel_34, Data6=panel_35)
repeat = RepeatData(Data=Slider(0, range=0..360), Length=256)
int_24 = Integer(merge_5)

# ---- group: slider in CV
num_8 = Number()

# ---- group: x
int_25 = Integer([0, 1, 2, 3, 4, 5, 6, 7, 8, 9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])

int_26 = Integer(int_25)

int_27 = Integer(graft(int_26))

int_28 = Integer(int_25)

int_29 = Integer(int_25)

# ---- group: slider in GH
num_9 = Number(commercial_slider)

# ---- group: y
int_30 = Integer([0, 0, 0, 0, 0, 0, 0, 0, 0, 0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])

int_31 = Integer(int_30)

int_32 = Integer(graft(int_31))

int_33 = Integer(int_30)

int_34 = Integer(int_30)

# ----
modulecenter_2 = ModuleCenter(pt=pt_3, num=num_5, int_2=int_29, int=int_34)  # -> pt_5, transform_2

# ---- group: module center
pt_6 = Point(modulecenter_2.pt_5)

pt_7 = Point(pt_6)

# ----
division_4 = Division(A=pt_7, B=1000)
sample = BitmapSampler(
    BitmapToModify=load_bitmap,
    PointToSample=division_4,
    BitmapToModify_2=load_bitmap,
    PointToSample_2=division_4,
    bitmap_filter=0)  # -> SampledImageData, SampledImageData_2
col_2 = Colour(sample.SampledImageData_2)
ahsv = SplitAHSV(Colour=col_2)  # -> Alpha, Hue, Saturation, Value
num_10 = Number(ahsv.Value)
remap = RemapNumbers(Value=num_10, Source=Domain(0, 1), Target=bnd)  # -> Mapped, Clipped

# ---- group: population density
num_11 = Number(remap.Mapped)

# ---- group: module center
# LEGO Grid Viz
pt_8 = Point(pt_6)

# ---- group: population density
num_12 = Number(num_11)

# ----
lng = ListLength(List=num_12)
repeat_2 = RepeatData(Data="0.02", Length=lng)
vec2pt = Vector2Pt(PointA=Point(0, 0, 0), PointB=pt_8, Unitize=False)  # -> Vector, Length
multiplication_5 = Multiplication(A=num_2, B=num_12)
move_2 = Move(Geometry=mesh_3, Motion=vec2pt.Vector)  # -> Geometry, Transform

# ---- group: area per floor per lego dot
num_13 = Number(multiplication_5)

# ----
panel_36 = Panel(num_13)
move_3 = Move(Geometry=pt_6, Motion=Z)  # -> Geometry, Transform

# ---- group: module center dynamic area lifted
pt_9 = Point(move_3.Geometry)

# ---- group: module center
pt_10 = Point(pt_9)

# ---- group: rotation
int_35 = Integer(repeat)

int_36 = Integer(int_35)

int_37 = Integer(int_35)

int_38 = Integer(int_37)

# ----
panel_37 = Panel(int_25)
panel_38 = Panel(int_30)
panel_39 = Panel(int_35)

# ---- group: Commercial % in Dynamic Part
num_14 = Number(num_9)

# ---- group: is dynamic
bool_5 = Boolean()

# ----
lng_2 = ListLength(List=bool_5)
random = Random(Range=Domain(0, 1), Number=lng_2, Seed=Slider(67, range=0..100))
smaller = SmallerThan(FirstNumber=random, SecondNumber=num_14)  # -> SmallerThan, OrEqualTo

# ---- group: rnd true by percentage
bool_6 = Boolean(smaller.OrEqualTo)

# ---- group: floor num for each type
# Dashboard
# Calculation
int_39 = Integer(merge_3)

# ----
panel_40 = Panel("0")  # disabled
panel_42 = Panel("6")  # disabled
panel_44 = Panel("12")  # disabled
panel_46 = Panel("36")  # disabled
panel_51 = Panel("9")  # disabled
panel_53 = Panel("18")  # disabled
panel_55 = Panel("48")  # disabled

# ---- group: RL
num_15 = Number()  # disabled

# ---- group: module center
pt_11 = Point(modulecenter_2.pt_5)

# ----
# Activation Mask
# On LEGOs
srf = Surface(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)

# ---- group: dockID
int_40 = Integer()

# ---- group: RM
num_16 = Number()  # disabled

# ---- group: is commercial in existing
bool_7 = Boolean(bool_4)

# ----
mesh_20 = Mesh(srf)
equals = Equality(FirstNumber=int_40, SecondNumber="-1")  # -> Equality, Inequality
item = ListItem(List=int_39, Index=1, Wrap=False)
item_2 = ListItem(List=int_39, Index=2, Wrap=False)
item_3 = ListItem(List=int_39, Index=0, Wrap=False)
item_4 = ListItem(List=int_39, Index=4, Wrap=False)
item_5 = ListItem(List=int_39, Index=5, Wrap=False)
item_6 = ListItem(List=int_39, Index=3, Wrap=False)

# ---- group: RS
num_17 = Number()  # disabled

# ----
Z_2 = UnitZ(Factor=Slider(6.2, range=0..10))

# ---- group: OL
num_18 = Number()  # disabled

# ---- group: 0_R$$$
int_41 = Integer(item_3)

# ---- group: 1_R$$
int_42 = Integer(item)

# ---- group: 2_R$
int_43 = Integer(item_2)

# ---- group: 4_PS
int_44 = Integer(item_4)

# ---- group: 7_EDU
int_45 = Integer(item_5)

# ---- group: 3_O
int_46 = Integer(item_6)

# ----
move_4 = Move(Geometry=mesh_20, Motion=Z_2)  # -> Geometry, Transform

# ---- group: OM
num_19 = Number()  # disabled

# ---- group: mask settings
swatch = ColourSwatch(SwatchColor=RGB(0, 0, 0))
panel_58 = Panel(".35")
path_6 = FilePath("C:\Users\RYAN\Documents\GitHub\CityMatrix\Map\MAP_BLACK.png")

# ----
panel_59 = Panel(int_44)
panel_60 = Panel(int_42)
panel_61 = Panel(int_41)
panel_62 = Panel(int_46)
panel_63 = Panel(int_45)
panel_64 = Panel(int_43)

# ---- group: OS
num_20 = Number()  # disabled

# ---- group: ppl per flr
# id5
# id3
# id4
# id0
# id2
# id1
# young
# mid
# old
panel_65 = Panel("0")  # disabled
panel_66 = Panel("0")  # disabled
panel_68 = Panel("0")  # disabled
panel_69 = Panel("7")  # disabled
panel_70 = Panel("0")  # disabled
panel_71 = Panel("8")  # disabled
panel_72 = Panel("0")  # disabled
panel_73 = Panel("0")  # disabled
panel_74 = Panel("0")  # disabled
panel_75 = Panel("0")  # disabled
panel_77 = Panel("0")  # disabled
panel_78 = Panel("10")  # disabled
panel_79 = Panel("0")  # disabled
panel_80 = Panel("11")  # disabled
panel_81 = Panel("0")  # disabled
panel_82 = Panel("0")  # disabled
num_21 = Number([panel_66, num_16, num_19, panel_72, panel_81, panel_75])  # disabled
num_22 = Number([num_15, panel_70, num_18, panel_73, panel_82, panel_79])  # disabled
num_23 = Number([panel_65, num_17, panel_68, num_20, panel_77, panel_74])  # disabled

# ----
vb_5 = VBScript()  # -> out, A; same code as vb
panel_83 = Panel(vb_5.out)
panel_84 = Panel(vb_5.A)
split_10 = TextSplit(Text=panel_84, Separators="\")
shift_5 = ShiftList(List=split_10, Shift=-1, Wrap=False)
txt_18 = Text(flatten("Maps\Snapshot002.PNG"))
txt_19 = Text(flatten(shift_5))
join_5 = TextJoin(Text=flatten([txt_19, txt_18]), Join="\")
# Reference Color
path_7 = FilePath(join_5)
panel_85 = Panel(path_7)

# ---- group: multipe for ppls
number_slider_5 = Slider(0.3, range=-0.01..2)  # disabled

# ----
multiplication_6 = Multiplication(A=num_23, B=number_slider_5)  # disabled
multiplication_7 = Multiplication(A=num_21, B=number_slider_5)  # disabled
multiplication_8 = Multiplication(A=num_22, B=number_slider_5)  # disabled
num_24 = Number(multiplication_6)  # disabled
num_25 = Number(multiplication_7)  # disabled
num_26 = Number(multiplication_8)  # disabled
number_slider_6 = Slider(0.001, range=0.001..3)
# CityMatrix CV
path_8 = FilePath(path_7)
video_stream = WebCamVideoStream()  # disabled
panel_86 = Panel("52000+NumID3*2500*0.4*NumFLID3/16+NumBuildings*2500*0.4*ComSlider/23")
panel_87 = Panel("6800+NumID0*2500*0.4*NumFLID0/60+NumID1*2500*0.4*NumFLID1/50+NumID2*2500*0.4*NumFLID2/33")

# ---- group: Int Grid X Extent
number_slider_7 = Slider(16, range=1..20)

# ---- group: x
series = Series(Start=0, Step=1, Count=number_slider_7)

series_2 = Series(Start=0, Step=1, Count=number_slider_7)

# ----
multiplication_9 = Multiplication(A=series, B=2)
multiplication_10 = Multiplication(A=series_2, B=2)
multiplication_11 = Multiplication(A=number_slider_7, B=2)
multiplication_12 = Multiplication(A=number_slider_7, B=2)

# ---- group: Int Grid Y Extent
number_slider_8 = Slider(16, range=1..20)

# ---- group: y
series_3 = Series(Start=0, Step=1, Count=number_slider_8)

# Population Density
series_4 = Series(Start=0, Step=1, Count=number_slider_8)

# ----
multiplication_13 = Multiplication(A=series_3, B=4)
multiplication_14 = Multiplication(A=series_4, B=4)
multiplication_15 = Multiplication(A=multiplication_13, B=number_slider_7)
multiplication_16 = Multiplication(A=multiplication_14, B=number_slider_7)
addition = Addition(A=multiplication_9, B=graft(multiplication_15))
addition_2 = Addition(A=multiplication_10, B=graft(multiplication_16))
pshift_10 = ShiftPaths(Data=addition, Offset=-1)
pshift_11 = ShiftPaths(Data=addition_2, Offset=-1)
addition_3 = Addition(A=pshift_10, B=multiplication_11)
addition_4 = Addition(A=pshift_10, B=1)
addition_5 = Addition(A=pshift_11, B=multiplication_12)
addition_6 = Addition(A=pshift_11, B=1)
addition_7 = Addition(A=addition_3, B=1)
addition_8 = Addition(A=addition_5, B=1)

# ---- group: sample pts
item_7 = ListItem(List=int, Index=addition_3, Wrap=False)
item_8 = ListItem(List=int, Index=pshift_10, Wrap=False)
item_9 = ListItem(List=int, Index=addition_7, Wrap=False)
item_10 = ListItem(List=int, Index=addition_4, Wrap=False)

item_11 = ListItem(List=int_2, Index=addition_5, Wrap=False)
item_12 = ListItem(List=int_2, Index=pshift_11, Wrap=False)
item_13 = ListItem(List=int_2, Index=addition_8, Wrap=False)
item_14 = ListItem(List=int_2, Index=addition_6, Wrap=False)

# ----
merge_6 = Merge(Data1=graft(item_8), Data2=graft(item_10), Data3=graft(item_7), Data4=graft(item_9))
addition_9 = Addition(A=item_12, B=item_14)
addition_10 = Addition(A=item_11, B=item_13)
bnd_2 = Bounds(Numbers=merge_6)
addition_11 = Addition(A=addition_9, B=addition_10)
dedomain_2 = DeconstructDomain(Domain=bnd_2)  # -> Start, End
pshift_12 = ShiftPaths(Data=dedomain_2.End, Offset=-1)

# ---- group: building floor dot number 16x16
int_47 = Integer(addition_11)

# ---- group: static data
int_48 = Integer(pshift_12)

# ---- group: building floor dot number 16x16
int_49 = Integer(int_47)

# ----
multiplication_17 = Multiplication(A=int_49, B=num_13)

# ---- group: population 16 x 16
num_27 = Number(multiplication_17)

# ----
panel_88 = Panel(num_27)
bnd_3 = Bounds(Numbers=num_27)
remap_2 = RemapNumbers(Value=num_27, Source=bnd_3, Target=Domain(0, 1))  # -> Mapped, Clipped
gradient_2 = Gradient(LowerLimit=0, UpperLimit=1, Parameter=remap_2.Mapped, stops=[0: RGB(0, 0, 0), 0.154: RGB(255, 255, 255)])
addition_12 = Addition(A=num_27, B="1")
division_5 = Division(A=number_slider_2, B=addition_12)

# ---- group: bw color by population
col_3 = Colour(gradient_2)

# ----
mcol_4 = MeshColours(Mesh=graft(move_2.Geometry), Colours=graft(col_3))

# ---- group: population
mesh_21 = Mesh(mcol_4)  # disabled

# ----
equals_2 = Equality(FirstNumber=num_27, SecondNumber="0")  # -> Equality, Inequality
multiplication_18 = Multiplication(A=division_5, B=equals_2.Inequality)

# ---- group: pop. effect
num_28 = Number(multiplication_18)

# ----
bnd_4 = Bounds(Numbers=num_28)
remap_3 = RemapNumbers(Value=num_28, Source=bnd_4, Target=Domain(0, 1))  # -> Mapped, Clipped
E = NaturalLogarithm(Factor=remap_3.Mapped)
pow = Power(A=remap_3.Mapped, B=".25")
sqrt = SquareRoot(Value=remap_3.Mapped)

# ---- group: pop. effect logged
num_29 = Number(pow)

# ----
load_bitmap_2 = LoadBitmap(FilePathToImageLocation=path_8)

# ---- group: Sample White
pt_12 = Point(<point referenced from the Rhino model>)

# ---- group: Pts Sample Grid Corner
# Grid Sampling
pt_13 = Point([<point referenced from the Rhino model> x4])

# ---- group: Sample Black
pt_14 = Point(<point referenced from the Rhino model>)

# ---- group: Sample Red
pt_15 = Point(<point referenced from the Rhino model>)

# ---- group: Sample Yellow
pt_16 = Point(<point referenced from the Rhino model>)  # disabled

# ---- group: Sample Blue
pt_17 = Point(<point referenced from the Rhino model>)  # disabled

# ---- group: Sample Green
pt_18 = Point(<point referenced from the Rhino model>)  # disabled

# ----
pline = PolyLine(Vertices=pt_13, Closed=False)
ma = MassAddition(Input=[number_slider_6, Slider(0.001, range=0.001..3), Slider(0.001, range=0.001..3)])  # -> Result, PartialResults
preview = CustomPreview(Geometry=pline, Shader=ColourSwatch(SwatchColor=RGB(255, 0, 230)))
multiplication_19 = Multiplication(A=number_slider_8, B=2)
division_6 = Division(A=number_slider_6, B=ma.Result)
multiplication_20 = Multiplication(A=number_slider_7, B=2)
crv_2 = Curve(<curve referenced from the Rhino model>)  # disabled
crv_3 = Curve(<curve referenced from the Rhino model>)  # disabled
crv_4 = Curve(<curve referenced from the Rhino model>)  # disabled
crv_5 = Curve(<curve referenced from the Rhino model>)
division_7 = Division(A=number_slider_6, B=ma.Result)
crv_6 = Curve(<curve referenced from the Rhino model>)
crv_7 = Curve(<curve referenced from the Rhino model>)
boundary_2 = BoundarySurfaces(Edges=crv_2)  # disabled
boundary_3 = BoundarySurfaces(Edges=crv_4)  # disabled
boundary_4 = BoundarySurfaces(Edges=crv_3)  # disabled
boundary_5 = BoundarySurfaces(Edges=crv_5)
boundary_6 = BoundarySurfaces(Edges=crv_7)
boundary_7 = BoundarySurfaces(Edges=crv_6)
logn = LogN(Number=division_6, Base=10)

# ---- group: webcam stream
data = Data(load_bitmap_2)

# ----
perspective = Perspective(pt=pt_13, int_2=multiplication_20, int=multiplication_19)
mesh_22 = MeshBrep(
    Brep=boundary_2,
    Settings={GridMaxCount=0, GridMinCount=16, JaggedSeams=False, MaxEdgeLength=0, MinEdgeLength=0.0001, MinTolerance=0, Refine=True, RefineAngle=0, RelativeTolerance=0.65, SimplePlanes=True, Tolerance=0})  # disabled
mesh_23 = MeshBrep(
    Brep=boundary_3,
    Settings={GridMaxCount=0, GridMinCount=16, JaggedSeams=False, MaxEdgeLength=0, MinEdgeLength=0.0001, MinTolerance=0, Refine=True, RefineAngle=0, RelativeTolerance=0.65, SimplePlanes=True, Tolerance=0})  # disabled
mesh_24 = MeshBrep(
    Brep=boundary_4,
    Settings={GridMaxCount=0, GridMinCount=16, JaggedSeams=False, MaxEdgeLength=0, MinEdgeLength=0.0001, MinTolerance=0, Refine=True, RefineAngle=0, RelativeTolerance=0.65, SimplePlanes=True, Tolerance=0})  # disabled
mesh_25 = MeshBrep(
    Brep=boundary_5,
    Settings={GridMaxCount=0, GridMinCount=16, JaggedSeams=False, MaxEdgeLength=0, MinEdgeLength=0.0001, MinTolerance=0, Refine=True, RefineAngle=0, RelativeTolerance=0.65, SimplePlanes=True, Tolerance=0})
mesh_26 = MeshBrep(
    Brep=boundary_6,
    Settings={GridMaxCount=0, GridMinCount=16, JaggedSeams=False, MaxEdgeLength=0, MinEdgeLength=0.0001, MinTolerance=0, Refine=True, RefineAngle=0, RelativeTolerance=0.65, SimplePlanes=True, Tolerance=0})
mesh_27 = MeshBrep(
    Brep=boundary_7,
    Settings={GridMaxCount=0, GridMinCount=16, JaggedSeams=False, MaxEdgeLength=0, MinEdgeLength=0.0001, MinTolerance=0, Refine=True, RefineAngle=0, RelativeTolerance=0.65, SimplePlanes=True, Tolerance=0})
snapshot = Snapshot(FireflyBitmap=video_stream)  # disabled
mesh_28 = MeshFromImage(Bmp=data, Sx=Domain(0, 1), Sy=Domain(0, 1), Z=0, C=True)  # disabled

# ---- group: webcam stream
bmp = BitmapToModify(data)

# ----
sample_2 = BitmapSampler(BitmapToModify=bmp, PointToSample=pt_17, BitmapToModify_2=bmp, PointToSample_2=pt_17, bitmap_filter=0)  # -> SampledImageData, SampledImageData_2; disabled
sample_3 = BitmapSampler(BitmapToModify=bmp, PointToSample=pt_18, BitmapToModify_2=bmp, PointToSample_2=pt_18, bitmap_filter=0)  # -> SampledImageData, SampledImageData_2; disabled
sample_4 = BitmapSampler(BitmapToModify=bmp, PointToSample=pt_16, BitmapToModify_2=bmp, PointToSample_2=pt_16, bitmap_filter=0)  # -> SampledImageData, SampledImageData_2; disabled
sample_5 = BitmapSampler(BitmapToModify=bmp, PointToSample=pt_14, BitmapToModify_2=bmp, PointToSample_2=pt_14, bitmap_filter=0)  # -> SampledImageData, SampledImageData_2
sample_6 = BitmapSampler(BitmapToModify=bmp, PointToSample=pt_15, BitmapToModify_2=bmp, PointToSample_2=pt_15, bitmap_filter=0)  # -> SampledImageData, SampledImageData_2
sample_7 = BitmapSampler(BitmapToModify=bmp, PointToSample=pt_12, BitmapToModify_2=bmp, PointToSample_2=pt_12, bitmap_filter=0)  # -> SampledImageData, SampledImageData_2

# ---- group: x
series_5 = Series(Start=0, Step=1, Count=number_slider_7)

# ---- group: y
series_6 = Series(Start=0, Step=1, Count=number_slider_8)

# ---- group: webcam stream
bmp_2 = BitmapToModify(data)

# ----
col_4 = Colour(sample_2.SampledImageData_2)  # disabled
col_5 = Colour(sample_4.SampledImageData_2)  # disabled
col_6 = Colour(sample_3.SampledImageData_2)  # disabled
col_7 = Colour(sample_5.SampledImageData_2)
col_8 = Colour(sample_7.SampledImageData_2)
col_9 = Colour(sample_6.SampledImageData_2)
mcol_5 = MeshColours(Mesh=mesh_22, Colours=col_4)  # disabled
mcol_6 = MeshColours(Mesh=mesh_23, Colours=col_6)  # disabled
mcol_7 = MeshColours(Mesh=mesh_24, Colours=col_5)  # disabled
multiplication_21 = Multiplication(A=series_6, B=4)
mcol_8 = MeshColours(Mesh=mesh_25, Colours=col_7)
mcol_9 = MeshColours(Mesh=mesh_26, Colours=col_9)
mcol_10 = MeshColours(Mesh=mesh_27, Colours=col_8)
multiplication_22 = Multiplication(A=series_5, B=2)

# ---- group: keystoned grid pts
pt_19 = Point(perspective)

# ----
multiplication_23 = Multiplication(A=multiplication_21, B=number_slider_7)
preview_2 = CustomPreview(
    Geometry=mcol_5,
    Shader={ambient=RGB(0, 0, 0), diffuse=RGB(255, 105, 180), emission=RGB(76, 32, 54), shine=0.5, specular=RGB(255, 255, 255), transparency=0})  # disabled
preview_3 = CustomPreview(
    Geometry=mcol_6,
    Shader={ambient=RGB(0, 0, 0), diffuse=RGB(255, 105, 180), emission=RGB(76, 32, 54), shine=0.5, specular=RGB(255, 255, 255), transparency=0})  # disabled
preview_4 = CustomPreview(
    Geometry=mcol_7,
    Shader={ambient=RGB(0, 0, 0), diffuse=RGB(255, 105, 180), emission=RGB(76, 32, 54), shine=0.5, specular=RGB(255, 255, 255), transparency=0})  # disabled
preview_5 = CustomPreview(
    Geometry=mcol_8,
    Shader={ambient=RGB(0, 0, 0), diffuse=RGB(255, 105, 180), emission=RGB(76, 32, 54), shine=0.5, specular=RGB(255, 255, 255), transparency=0})
preview_6 = CustomPreview(
    Geometry=mcol_9,
    Shader={ambient=RGB(0, 0, 0), diffuse=RGB(255, 105, 180), emission=RGB(76, 32, 54), shine=0.5, specular=RGB(255, 255, 255), transparency=0})
pshift_13 = ShiftPaths(Data=pt_19, Offset=-1)

# ---- group: all sample pts
pt_20 = Point(pshift_13)

# ----
sample_8 = BitmapSampler(BitmapToModify=bmp_2, PointToSample=pt_20, BitmapToModify_2=bmp_2, PointToSample_2=pt_20, bitmap_filter=0)  # -> SampledImageData, SampledImageData_2
preview_7 = CustomPreview(
    Geometry=mcol_10,
    Shader={ambient=RGB(0, 0, 0), diffuse=RGB(255, 105, 180), emission=RGB(76, 32, 54), shine=0.5, specular=RGB(255, 255, 255), transparency=0})

# ---- group: Parameter 5
num_30 = Number(".7")

# ----
panel_89 = Panel(num_30)

# ---- group: Parameter 4
num_31 = Number(".35")

# ----
panel_90 = Panel(num_31)
box = CenterBox(Base=pt_20, X=0.003, Y=0.003, Z=0.003)

# ---- group: Parameter 3
num_32 = Number(".45")

# ----
panel_91 = Panel(num_32)
# Kendall Existing Scenario
panel_92 = Panel("0.042")
addition_13 = Addition(A=multiplication_22, B=graft(multiplication_23))

# ---- group: mobility viz current hours
number_slider_9 = Slider(16, range=0..23)

# ----
merge_7 = Merge(Data1=col_8, Data2=col_7, Data3=col_9, Data4=col_5, Data5=col_4, Data6=col_6)

viz_selection = ValueList({"Satellite": 0, "Population": 1, "Education": 2, "Health": 3, "Green": 4, "Culture": 5, "Mobility": 6, "Happiness": 7, "Taxi Data": 8}, selected="Happiness")

# ---- group: all sample color
col_10 = Colour(sample_8.SampledImageData_2)

# ---- group: all sample boxes
box_2 = Box(box)

# ----
pshift_14 = ShiftPaths(Data=addition_13, Offset=-1)
multiplication_24 = Multiplication(A=number_slider_7, B=2)

# ---- group: all ref colors
col_11 = Colour([RGB(171, 147, 186), RGB(85, 89, 107), RGB(186, 71, 83)])

# ----
dom_2 = ConstructDomain(DomainStart="0", DomainEnd="1")
dom_3 = ConstructDomain(DomainStart="20", DomainEnd="40")
addition_14 = Addition(A=pshift_14, B=multiplication_24)
dom_4 = ConstructDomain(DomainStart="15", DomainEnd="40")
dom_5 = ConstructDomain(DomainStart="0", DomainEnd="1")
dom_6 = ConstructDomain(DomainStart="0", DomainEnd="1")
addition_15 = Addition(A=pshift_14, B=1)

# ---- group: all perfect colors
col_12 = Colour([ColourSwatch(SwatchColor=RGB(255, 255, 255)), ColourSwatch(SwatchColor=RGB(0, 0, 0)), ColourSwatch(SwatchColor=RGB(255, 0, 0))])

# ---- group: Parameter 5
num_33 = Number("0.003")

# ----
panel_93 = Panel(num_33)

# ---- group: Parameter 4
num_34 = Number("0")

# ----
panel_94 = Panel(num_34)

# ---- group: Parameter 3
num_35 = Number("0.13")

# ----
panel_95 = Panel(num_35)
remap_4 = RemapNumbers(Value=num_31, Source=dom_2, Target=Domain(0, 1))  # -> Mapped, Clipped

# ---- group: Parameter 1
num_36 = Number(panel_92)

# ----
panel_96 = Panel(num_36)

# ---- group: Parameter 2
num_37 = Number("0.0052")

# ----
panel_97 = Panel(num_37)
remap_5 = RemapNumbers(Value=num_30, Source=dom_5, Target=Domain(0, 1))  # -> Mapped, Clipped
remap_6 = RemapNumbers(Value=num_32, Source=dom_6, Target=Domain(0, 1))  # -> Mapped, Clipped
addition_16 = Addition(A=addition_14, B=1)

# ---- group: population
mesh_29 = Mesh(mcol_4)

# ----
vb_6 = VBScript()  # -> out, A; same code as vb
panel_98 = Panel(vb_6.out)
panel_99 = Panel(vb_6.A)
split_11 = TextSplit(Text=panel_99, Separators="\")
shift_6 = ShiftList(List=split_11, Shift=-1, Wrap=False)
txt_20 = Text(flatten("Data\careem coords\2km\drops_"))
txt_21 = Text(flatten(shift_6))
join_6 = TextJoin(Text=flatten([txt_21, txt_20]), Join="\")
path_9 = FilePath(join_6)
panel_100 = Panel(path_9)

# ---- group: Parameter 5
num_38 = Number(remap_5.Mapped)

# ----
panel_101 = Panel(num_38)
# Closest Color Code
dist_3 = Distance(PointA=graft(col_10), PointB=col_11)

# ---- group: Parameter 4
num_39 = Number(remap_4.Mapped)

# ----
panel_102 = Panel(num_39)

# ---- group: Parameter 3
num_40 = Number(remap_6.Mapped)

# ----
panel_103 = Panel(num_40)

vb_7 = VBScript()  # -> out, A; same code as vb
# GoogleMaps Ref
panel_104 = Panel(vb_7.out)
panel_105 = Panel(vb_7.A)
split_12 = TextSplit(Text=panel_105, Separators="\")
shift_7 = ShiftList(List=split_12, Shift=-1, Wrap=False)
txt_22 = Text(flatten("Maps\base map.png"))
txt_23 = Text(flatten(shift_7))
join_7 = TextJoin(Text=flatten([txt_23, txt_22]), Join="\")
path_10 = FilePath(join_7)
panel_106 = Panel(path_10)

dom_7 = ConstructDomain(DomainStart="0", DomainEnd="1")
dom_8 = ConstructDomain(DomainStart="0.01", DomainEnd="0.067")
dom_9 = ConstructDomain(DomainStart="0.003", DomainEnd="0.01")
dom_10 = ConstructDomain(DomainStart="0.001", DomainEnd="0.01")
dom_11 = ConstructDomain(DomainStart="0", DomainEnd="1")
lng_3 = ListLength(List=dist_3)
series_7 = Series(Start=0, Step=1, Count=lng_3)
remap_7 = RemapNumbers(Value=num_34, Source=dom_7, Target=Domain(0, 1))  # -> Mapped, Clipped
remap_8 = RemapNumbers(Value=num_36, Source=dom_8, Target=Domain(0, 1))  # -> Mapped, Clipped
remap_9 = RemapNumbers(Value=num_37, Source=dom_9, Target=Domain(0, 1))  # -> Mapped, Clipped
remap_10 = RemapNumbers(Value=num_33, Source=dom_10, Target=Domain(0, 1))  # -> Mapped, Clipped
remap_11 = RemapNumbers(Value=num_35, Source=dom_11, Target=Domain(0, 1))  # -> Mapped, Clipped
int_50 = Integer(series_7)
sort = SortList(Keys=dist_3, ValuesA=int_50)  # -> Keys, ValuesA
number_slider_10 = Slider(0.907, range=0..1)  # disabled
number_slider_11 = Slider(0.651, range=0..1)  # disabled
number_slider_12 = Slider(0.379, range=0..1)  # disabled
number_slider_13 = Slider(0.005, range=0..1)  # disabled
number_slider_14 = Slider(0.185, range=0..1)  # disabled

# ---- group: sample pts
item_15 = ListItem(List=pt_20, Index=addition_14, Wrap=False)
item_16 = ListItem(List=pt_20, Index=pshift_14, Wrap=False)
item_17 = ListItem(List=pt_20, Index=addition_16, Wrap=False)
item_18 = ListItem(List=pt_20, Index=addition_15, Wrap=False)

# ----
addition_17 = Addition(A=item_16, B=item_17)
int_51 = Integer(number_slider_9)

# ---- group: Parameter 5
num_41 = Number(remap_10.Mapped)

# ----
panel_107 = Panel(num_41)
item_19 = ListItem(List=sort.ValuesA, Index=0, Wrap=False)

# ---- group: Parameter 4
num_42 = Number(remap_7.Mapped)

# ----
panel_108 = Panel(num_42)
division_8 = Division(A=addition_17, B=2)

# ---- group: quart mid pts
pt_21 = Point(division_8)

# ----
panel_109 = Panel("C:\Users\RYAN\Dropbox (MIT)\01_Work\MAS\05_Summer 2016\Dubai Workshop_160830\careem coords\2km\rides_")

# ---- group: Parameter 3
num_43 = Number(remap_11.Mapped)

# ----
panel_110 = Panel(num_43)

# ---- group: Parameter 1
num_44 = Number(remap_8.Mapped)

# ----
panel_111 = Panel(num_44)

# ---- group: Parameter 2
num_45 = Number(remap_9.Mapped)

# ----
panel_112 = Panel(num_45)
pt_22 = Point(<point referenced from the Rhino model>)
pshift_15 = ShiftPaths(Data=item_19, Offset=-1)

# ---- group: saved proposed parameters
num_46 = Number([0.8566364466, 0.4793737498, 0.229417789, 0.9417594905, 0.4758952378])  # disabled

# ---- group: 5 axises
# Radar Chart
crv_8 = Curve(reparameterize([<curve referenced from the Rhino model> x5]))

# ----
crv_9 = Curve(<curve referenced from the Rhino model>)  # disabled
crv_10 = Curve(<curve referenced from the Rhino model>)
merge_8 = Merge(Data1=num_44, Data2=num_45, Data3=num_43, Data4=num_42, Data5=num_41)  # disabled
crv_11 = Curve(<curve referenced from the Rhino model>)  # disabled
pshift_16 = ShiftPaths(Data=pshift_15, Offset=-1)
boundary_8 = BoundarySurfaces(Edges=crv_9)  # disabled
boundary_9 = BoundarySurfaces(Edges=crv_10)
geo = Geometry(boundary_9)
boundary_10 = BoundarySurfaces(Edges=crv_11)  # disabled
number_slider_15 = Slider(0.7, range=0..1)  # disabled
number_slider_16 = Slider(1.5, range=0..2)
eval = EvaluateCurve(Curve=crv_8, Parameter=num_46)  # -> Point, Tangent, Angle; disabled
number_slider_17 = Slider(0.7, range=0..1)  # disabled
path_11 = FilePath("C:\Users\RYAN\Desktop\02.jpg")  # disabled
path_12 = FilePath(path_10)
path_13 = FilePath("C:\Users\RYAN\Desktop\01.jpg")  # disabled
eval_2 = EvaluateCurve(Curve=crv_8, Parameter=merge_8)  # -> Point, Tangent, Angle; disabled
neg_2 = Negative(Value=number_slider_15)  # disabled
neg_3 = Negative(Value=number_slider_16)

# ---- group: saved proposed parameters
num_47 = Number([0.5843594777, 0.5496911155, 0.290588378, 0.5799996396, 0.4753219941])

# ----
neg_4 = Negative(Value=number_slider_17)  # disabled
pline_2 = PolyLine(Vertices=eval.Point, Closed=True)  # disabled

# ---- group: color code of each smaple pt
int_52 = Integer(pshift_16)

# ----
item_20 = ListItem(List=col_11, Index=int_52, Wrap=False)
preview_8 = CustomPreview(Geometry=box_2, Shader=item_20)

# ---- group: color codes
item_21 = ListItem(List=int_52, Index=pshift_14, Wrap=False)
item_22 = ListItem(List=int_52, Index=addition_14, Wrap=False)
item_23 = ListItem(List=int_52, Index=addition_16, Wrap=False)
item_24 = ListItem(List=int_52, Index=addition_15, Wrap=False)

# ----
pline_3 = PolyLine(Vertices=eval_2.Point, Closed=True)  # disabled
previewmat = CustomPreviewMaterials(Geometry=boundary_8, DiffuseColor=RGB(255, 255, 255), DiffuseBitmap=path_11)  # disabled
previewmat_2 = CustomPreviewMaterials(Geometry=boundary_10, DiffuseColor=RGB(255, 255, 255), DiffuseBitmap=path_13)  # disabled
number_slider_18 = Slider(1.5, range=0..10)  # disabled
number_slider_19 = Slider(1, range=0..10)  # disabled
offset = Offset(Curve=pline_2, Distance=[neg_2, number_slider_15], Plane=PlaneXY(0, 0, 0), Corners=1)  # disabled
offset_2 = Offset(Curve=pline_3, Distance=[neg_4, number_slider_17], Plane=PlaneXY(0, 0, 0), Corners=1)  # disabled

# ---- group: 03
num_48 = Number([0.651, 0.379, 0.185, 0.005, 0.907])

# ----
vb_8 = VBScript()  # -> out, A; same code as vb
# Mobility Viz
panel_113 = Panel(vb_8.out)
panel_114 = Panel(vb_8.A)
split_13 = TextSplit(Text=panel_114, Separators="\")
shift_8 = ShiftList(List=split_13, Shift=-1, Wrap=False)
txt_24 = Text(flatten("Maps\Screen Shot 2016-08-31 at 6.39.22 PM.png"))
txt_25 = Text(flatten(shift_8))
join_8 = TextJoin(Text=flatten([txt_25, txt_24]), Join="\")
path_14 = FilePath(join_8)
panel_115 = Panel(path_14)

merge_9 = Merge(Data1=graft(item_21), Data2=graft(item_22), Data3=graft(item_23), Data4=graft(item_24))
pshift_17 = ShiftPaths(Data=offset, Offset=-1)  # disabled
pshift_18 = ShiftPaths(Data=offset_2, Offset=-1)  # disabled

# ---- group: 04
num_49 = Number([0.8566364466, 0.4793737498, 0.229417789, 0.9417594905, 0.4758952378])

# ----
Z_3 = UnitZ(Factor=number_slider_18)  # disabled
Z_4 = UnitZ(Factor=Slider(2, range=0..10))
boundary_11 = BoundarySurfaces(Edges=pshift_17)  # disabled
Z_5 = UnitZ(Factor=number_slider_19)  # disabled
boundary_12 = BoundarySurfaces(Edges=pshift_18)  # disabled

# ---- group: all color code quarts (no rotation)
panel_116 = Panel("2,0,0,0\t2,1,0,0\t2,0,1,0\t2,0,0,1\t2,1,1,0\t2,1,0,1\t2,0,1,1\t2,1,1,1\t3,0,0,0\t3,1,0,0\t3,0,1,0\t3,0,0,1\t3,1,1,0\t3,1,0,1\t3,0,1,1\t3,1,1,1\t4,0,0,0\t4,1,0,0\t4,0,1,0\t4,0,0,1\t4,1,1,0\t4,1,0,1\t4,0,1,1\t4,1,1,1\t5,0,0,0\t5,1,0,0\t5,0,1,0\t5,0,0,1\t5,1,1,0\t5,1,0,1\t5,0,1,1\t5,1,1,1")

# ----
swatch_2 = ColourSwatch(SwatchColor=RGB(0, 153, 255))  # disabled
swatch_3 = ColourSwatch(SwatchColor=RGB(255, 255, 255))  # disabled
extr = Extrude(Base=boundary_11, Direction=Z_3)  # disabled

# ---- group: all color code quarts (with rotation)
# Decode Piece ID
panel_117 = Panel("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")

# ---- group: color code quarts
int_53 = Integer(merge_9)

# ----
extr_2 = Extrude(Base=boundary_12, Direction=Z_5)  # disabled
brep = Brep(extr)  # disabled
rev = ReverseList(List=int_53)
brep_2 = Brep(extr_2)  # disabled
mcol_11 = MeshColours(Mesh=brep, Colours=swatch_2)  # disabled
mcol_12 = MeshColours(Mesh=brep_2, Colours=swatch_3)  # disabled
txt_26 = Text(rev)

# ---- group: Radar Chart Proposed
mesh_30 = Mesh(mcol_11)  # disabled

# ----
join_9 = TextJoin(Text=txt_26, Join=",")

# ---- group: Radar Chart Existing
mesh_31 = Mesh(mcol_12)  # disabled

# ---- group: tab
panel_118 = Panel("\t")

# ----
split_14 = TextSplit(Text=panel_117, Separators=panel_118)

# ---- group: table upper-left / colortizer orgin
pt_23 = Point(pt_3)

# ---- group: table size ref pt
pt_24 = Point(pt_4)

# ----
crv_12 = Curve(<curve referenced from the Rhino model>)
pshift_19 = ShiftPaths(Data=join_9, Offset=-1)
boundary_13 = BoundarySurfaces(Edges=crv_12)
Z_6 = UnitZ(Factor=1)
xy_3 = XYPlane(Origin=pt_23)
dist_4 = Distance(PointA=pt_23, PointB=pt_24)

# ---- group: all color quarts data
txt_27 = Text(split_14)

# ----
lng_4 = ListLength(List=txt_27)

# ---- group: upper left
pt_25 = ConstructPoint(XCoordinate="55.27794", YCoordinate="25.24312", ZCoordinate=0)

# ---- group: lower right
pt_26 = ConstructPoint(XCoordinate="55.30156", YCoordinate="25.22157", ZCoordinate=0)

# ----
panel_119 = Panel("2,0,0,0")
move_5 = Move(Geometry=boundary_13, Motion=Z_6)  # -> Geometry, Transform
path_15 = FilePath(path_14)
division_9 = Division(A=lng_4, B="4")

# ---- group: base cplane
pln_3 = Plane(xy_3)

# ---- group: table size
num_50 = Number(dist_4)

# ----
X_2 = UnitX(Factor=num_50)
neg_5 = Negative(Value=num_50)
Y = UnitY(Factor=neg_5)
move_6 = Move(Geometry=pt_23, Motion=Y)  # -> Geometry, Transform
move_7 = Move(Geometry=move_6.Geometry, Motion=X_2)  # -> Geometry, Transform

# ---- group: table lower-right
pt_27 = Point(move_7.Geometry)

# ---- group: color code quart texts
txt_28 = Text(pshift_19)

# ----
panel_120 = Panel(txt_27)
pt_28 = Point(pt_26)
pt_29 = Point(pt_25)
series_8 = Series(Start=0, Step=1, Count=division_9)
previewmat_3 = CustomPreviewMaterials(Geometry=move_5.Geometry, DiffuseColor=ColourSwatch(SwatchColor=RGB(255, 0, 0)), TransparencyBitmap=path_15)  # disabled
pdecon = Deconstruct(Point=pt_23)  # -> XComponent, YComponent, ZComponent
pdecon_2 = Deconstruct(Point=pt_29)  # -> XComponent, YComponent, ZComponent
pshift_20 = ShiftPaths(Data=series_8, Offset=-1)
multiplication_25 = Multiplication(A=division_9, B="4")
item_25 = ListItem(List=mesh_13, Index=0, Wrap=False)
pt_30 = Point(<point referenced from the Rhino model>)
neg_6 = Negative()
pdecon_3 = Deconstruct(Point=pt_27)  # -> XComponent, YComponent, ZComponent
pdecon_4 = Deconstruct(Point=pt_28)  # -> XComponent, YComponent, ZComponent
repeat_3 = RepeatData(Data=pshift_20, Length=multiplication_25)
rotate = Rotate(Geometry=item_25, Angle=degrees(neg_6), Plane=PlaneXY(0, 0, 0))  # -> Geometry, Transform
panel_121 = Panel("Medium Unit")  # disabled
panel_122 = Panel("Small Unit")  # disabled
panel_123 = Panel("Large Unit")  # disabled
panel_124 = Panel("Large Unit")  # disabled
panel_125 = Panel("Medium Unit")  # disabled
panel_126 = Panel("Small Unit")  # disabled
pshift_21 = ShiftPaths(Data=repeat_3, Offset=-1)

# ---- group: all color quart ids
int_54 = Integer(pshift_21)

# ----
keysearch = KeyValueSearch(Keys=txt_27, Values=int_54, Search=graft(txt_28))
nullrep = ReplaceNulls(Items=keysearch, Replacements="-1")  # -> Items, Count
panel_127 = Panel("Residential")  # disabled
panel_128 = Panel("Residential")  # disabled
panel_129 = Panel("Office")  # disabled
# Dock
panel_130 = Panel("Residential")  # disabled
panel_131 = Panel("Office")  # disabled
panel_132 = Panel("Office")  # disabled
vec2pt_2 = Vector2Pt(PointA=Point(0, 0, 0), PointB=pt_30, Unitize=False)  # -> Vector, Length
pshift_22 = ShiftPaths(Data=nullrep.Items, Offset=-1)
pt_31 = ConstructPoint(XCoordinate=Slider(3.5, range=0..10), YCoordinate=Slider(-14, range=-30..0), ZCoordinate=Slider(5.1, range=0..10))
panel_133 = Panel(int_54)
dom_12 = ConstructDomain(DomainStart=pdecon.XComponent, DomainEnd=pdecon.YComponent)
dom_13 = ConstructDomain(DomainStart=pdecon_3.XComponent, DomainEnd=pdecon_3.YComponent)
move_8 = Move(Geometry=rotate.Geometry, Motion=vec2pt_2.Vector)  # -> Geometry, Transform
dom_14 = ConstructDomain(DomainStart=pdecon_2.XComponent, DomainEnd=pdecon_4.XComponent)
dom_15 = ConstructDomain(DomainStart=pdecon_2.YComponent, DomainEnd=pdecon_4.YComponent)
txt_29 = Text([panel_124, panel_121, panel_122, panel_123, panel_125, panel_126])  # disabled
txt_30 = Text([panel_130, panel_127, panel_128, panel_129, panel_131, panel_132])  # disabled
xy_4 = XYPlane(Origin=pt_31)
number_slider_20 = Slider(15.2, range=0..100)  # disabled
item_26 = ListItem(List=txt_29, Index=0, Wrap=False)  # disabled
item_27 = ListItem(List=txt_30, Index=0, Wrap=False)  # disabled
comp = Compound(Transforms=flatten([rotate.Transform, move_8.Transform]))

# ---- group: all piece ids
int_55 = Integer(pshift_22)

# ---- group: dynamic data from CityMatix CV
int_56 = Integer(int_55)

# ----
max = Maximum(A=int_48, B=int_56)

# ---- group: combined
int_57 = Integer(max)

# ----
equals_3 = Equality(FirstNumber=int_57, SecondNumber="0")  # -> Equality, Inequality
equals_4 = Equality(FirstNumber=int_57, SecondNumber="2")  # -> Equality, Inequality
equals_5 = Equality(FirstNumber=int_57, SecondNumber="4")  # -> Equality, Inequality
equals_6 = Equality(FirstNumber=int_57, SecondNumber="1")  # -> Equality, Inequality
equals_7 = Equality(FirstNumber=int_57, SecondNumber="3")  # -> Equality, Inequality

# ---- group: 4
dispatch = Dispatch(List=int_26, DispatchPattern=equals_5.Equality)  # -> ListA, ListB
# Population Data
dispatch_2 = Dispatch(List=int_31, DispatchPattern=equals_5.Equality)  # -> ListA, ListB

# ---- group: 2
dispatch_3 = Dispatch(List=int_26, DispatchPattern=equals_4.Equality)  # -> ListA, ListB
dispatch_4 = Dispatch(List=int_31, DispatchPattern=equals_4.Equality)  # -> ListA, ListB

# ---- group: 3
dispatch_5 = Dispatch(List=int_26, DispatchPattern=equals_7.Equality)  # -> ListA, ListB
dispatch_6 = Dispatch(List=int_31, DispatchPattern=equals_7.Equality)  # -> ListA, ListB

# ---- group: 1
dispatch_7 = Dispatch(List=int_26, DispatchPattern=equals_6.Equality)  # -> ListA, ListB
dispatch_8 = Dispatch(List=int_31, DispatchPattern=equals_6.Equality)  # -> ListA, ListB

# ---- group: 0
dispatch_9 = Dispatch(List=int_26, DispatchPattern=equals_3.Equality)  # -> ListA, ListB
dispatch_10 = Dispatch(List=int_31, DispatchPattern=equals_3.Equality)  # -> ListA, ListB

# ---- group: y selected
int_58 = Integer(dispatch_2.ListA)

# ---- group: x selected
int_59 = Integer(dispatch.ListA)

# ---- group: y selected
int_60 = Integer(dispatch_4.ListA)

int_61 = Integer(dispatch_6.ListA)

# ---- group: x selected
int_62 = Integer(dispatch_3.ListA)

int_63 = Integer(dispatch_5.ListA)

# ---- group: y selected
int_64 = Integer(dispatch_8.ListA)

int_65 = Integer(dispatch_10.ListA)

# ---- group: x selected
int_66 = Integer(dispatch_7.ListA)

int_67 = Integer(dispatch_9.ListA)

# ----
subtraction = Subtraction(A=int_27, B=int_62)
subtraction_2 = Subtraction(A=int_32, B=int_60)
subtraction_3 = Subtraction(A=int_27, B=int_63)
subtraction_4 = Subtraction(A=int_27, B=int_59)
subtraction_5 = Subtraction(A=int_32, B=int_61)
subtraction_6 = Subtraction(A=int_27, B=int_66)
subtraction_7 = Subtraction(A=int_32, B=int_58)
subtraction_8 = Subtraction(A=int_32, B=int_64)
subtraction_9 = Subtraction(A=int_27, B=int_67)
subtraction_10 = Subtraction(A=int_32, B=int_65)
sqr_2 = Square(Value=subtraction_2)
sqr_3 = Square(Value=subtraction)
sqr_4 = Square(Value=subtraction_5)
sqr_5 = Square(Value=subtraction_3)
sqr_6 = Square(Value=subtraction_7)
sqr_7 = Square(Value=subtraction_4)
sqr_8 = Square(Value=subtraction_8)
sqr_9 = Square(Value=subtraction_6)
sqr_10 = Square(Value=subtraction_10)
sqr_11 = Square(Value=subtraction_9)
addition_18 = Addition(A=sqr_3, B=sqr_2)
addition_19 = Addition(A=sqr_5, B=sqr_4)
addition_20 = Addition(A=sqr_7, B=sqr_6)
addition_21 = Addition(A=sqr_9, B=sqr_8)
addition_22 = Addition(A=sqr_11, B=sqr_10)
sqrt_2 = SquareRoot(Value=addition_18)
sqrt_3 = SquareRoot(Value=addition_19)
sqrt_4 = SquareRoot(Value=addition_20)
sqrt_5 = SquareRoot(Value=addition_21)
sqrt_6 = SquareRoot(Value=addition_22)
addition_23 = Addition(A=sqrt_2, B="0.01")
addition_24 = Addition(A=sqrt_3, B="0.01")
addition_25 = Addition(A=sqrt_4, B="0.01")
addition_26 = Addition(A=sqrt_5, B="0.01")
addition_27 = Addition(A=sqrt_6, B="0.01")
equals_8 = Equality(FirstNumber=sqrt_2, SecondNumber="0")  # -> Equality, Inequality
equals_9 = Equality(FirstNumber=sqrt_3, SecondNumber="0")  # -> Equality, Inequality
equals_10 = Equality(FirstNumber=sqrt_4, SecondNumber="0")  # -> Equality, Inequality
equals_11 = Equality(FirstNumber=sqrt_5, SecondNumber="0")  # -> Equality, Inequality
one_over_x = OneOverX(Value=addition_23)
one_over_x_2 = OneOverX(Value=addition_24)
one_over_x_3 = OneOverX(Value=addition_25)
one_over_x_4 = OneOverX(Value=addition_26)
equals_12 = Equality(FirstNumber=sqrt_6, SecondNumber="0")  # -> Equality, Inequality
one_over_x_5 = OneOverX(Value=addition_27)
multiplication_26 = Multiplication(A=equals_8.Inequality, B=one_over_x)
multiplication_27 = Multiplication(A=equals_9.Inequality, B=one_over_x_2)
multiplication_28 = Multiplication(A=equals_10.Inequality, B=one_over_x_3)
multiplication_29 = Multiplication(A=equals_11.Inequality, B=one_over_x_4)
multiplication_30 = Multiplication(A=equals_12.Inequality, B=one_over_x_5)
ma_2 = MassAddition(Input=multiplication_26)  # -> Result, PartialResults
ma_3 = MassAddition(Input=multiplication_27)  # -> Result, PartialResults
ma_4 = MassAddition(Input=multiplication_28)  # -> Result, PartialResults
ma_5 = MassAddition(Input=multiplication_29)  # -> Result, PartialResults
ma_6 = MassAddition(Input=multiplication_30)  # -> Result, PartialResults
pshift_23 = ShiftPaths(Data=ma_2.Result, Offset=-1)
pshift_24 = ShiftPaths(Data=ma_3.Result, Offset=-1)
pshift_25 = ShiftPaths(Data=ma_4.Result, Offset=-1)
pshift_26 = ShiftPaths(Data=ma_5.Result, Offset=-1)
pshift_27 = ShiftPaths(Data=ma_6.Result, Offset=-1)
multiplication_31 = Multiplication(A=pshift_23, B=number_slider)
multiplication_32 = Multiplication(A=pshift_24, B=number_slider)
multiplication_33 = Multiplication(A=pshift_25, B=number_slider)
multiplication_34 = Multiplication(A=pshift_26, B=number_slider)
multiplication_35 = Multiplication(A=pshift_27, B=number_slider)

# ---- group: dist effect
num_51 = Number(multiplication_31)

num_52 = Number(multiplication_32)

num_53 = Number(multiplication_34)

num_54 = Number(multiplication_33)

num_55 = Number(multiplication_35)

# ----
bnd_5 = Bounds(Numbers=num_51)
bnd_6 = Bounds(Numbers=num_55)
bnd_7 = Bounds(Numbers=num_53)
bnd_8 = Bounds(Numbers=num_52)
bnd_9 = Bounds(Numbers=num_54)
remap_12 = RemapNumbers(Value=num_51, Source=bnd_5, Target=Domain(0, 1))  # -> Mapped, Clipped
remap_13 = RemapNumbers(Value=num_55, Source=bnd_6, Target=Domain(0, 1))  # -> Mapped, Clipped
remap_14 = RemapNumbers(Value=num_53, Source=bnd_7, Target=Domain(0, 1))  # -> Mapped, Clipped
remap_15 = RemapNumbers(Value=num_52, Source=bnd_8, Target=Domain(0, 1))  # -> Mapped, Clipped
remap_16 = RemapNumbers(Value=num_54, Source=bnd_9, Target=Domain(0, 1))  # -> Mapped, Clipped
pow_2 = Power(A=remap_12.Mapped, B="0.6")

# ---- group: score normalized
num_56 = Number(pow_2)

num_57 = Number(remap_13.Mapped)

num_58 = Number(remap_14.Mapped)

num_59 = Number(remap_15.Mapped)

num_60 = Number(remap_16.Mapped)

# ----
multiplication_36 = Multiplication(A=num_57, B=num_58)
multiplication_37 = Multiplication(A=multiplication_36, B=num_56)
multiplication_38 = Multiplication(A=multiplication_37, B=num_59)
multiplication_39 = Multiplication(A=multiplication_38, B=num_60)
multiplication_40 = Multiplication(A=multiplication_39, B=num_29)
multiplication_41 = Multiplication(A=num_56, B=num_29)
log = Logarithm(Value=multiplication_40)
pow_3 = Power(A=multiplication_40, B="0.15")
E_2 = NaturalLogarithm(Factor=multiplication_40)
multiplication_42 = Multiplication(A=num_57, B=num_29)
multiplication_43 = Multiplication(A=num_58, B=num_29)
multiplication_44 = Multiplication(A=num_59, B=num_29)
multiplication_45 = Multiplication(A=num_60, B=num_29)

# ---- group: score
num_61 = Number(multiplication_41)

# ----
gradient_3 = Gradient(LowerLimit=0, UpperLimit=1, Parameter=num_61, stops=[0: RGB(0, 0, 0), 1: RGB(78, 156, 0)])

# ---- group: color
col_13 = Colour(gradient_3)

# ----
mcol_13 = MeshColours(Mesh=graft(move_2.Geometry), Colours=graft(col_13))

# ---- group: 2 green
mesh_32 = Mesh(mcol_13)  # disabled

# ----
num_62 = Number(pow_3)
subtraction_11 = Subtraction(A=1, B=num_62)
gradient_4 = Gradient(
    LowerLimit=0,
    UpperLimit=1,
    Parameter=subtraction_11,
    stops=[0.326: RGB(234, 38, 0), 0.469: RGB(234, 126, 0), 0.614: RGB(254, 244, 84), 0.745: RGB(173, 203, 249), 0.884: RGB(59, 97, 191), 1: RGB(0, 0, 0)])
gradient_5 = Gradient(
    LowerLimit=0,
    UpperLimit=1,
    Parameter=subtraction_11,
    stops=[0.354: RGB(0, 64, 0), 0.667: RGB(125, 125, 0), 0.857: RGB(120, 0, 0), 1: RGB(0, 0, 0)])
gradient_6 = Gradient(LowerLimit=0, UpperLimit=1, Parameter=subtraction_11, stops=[0: RGB(255, 255, 255), 1: RGB(0, 0, 0)])
gradient_7 = Gradient(
    LowerLimit=0,
    UpperLimit=1,
    Parameter=subtraction_11,
    stops=[0.354: RGB(0, 128, 0), 0.667: RGB(255, 255, 0), 0.857: RGB(255, 0, 0), 1: RGB(0, 0, 0)])

# ---- group: color
col_14 = Colour(gradient_5)

# ----
mcol_14 = MeshColours(Mesh=graft(move_2.Geometry), Colours=graft(col_14))

# ---- group: all
mesh_33 = Mesh(mcol_14)  # disabled

# ---- group: score
num_63 = Number(multiplication_44)

# ----
gradient_8 = Gradient(LowerLimit=0, UpperLimit=1, Parameter=num_63, stops=[0: RGB(0, 0, 0), 1: RGB(0, 75, 156)])

# ---- group: color
col_15 = Colour(gradient_8)

# ----
mcol_15 = MeshColours(Mesh=graft(move_2.Geometry), Colours=graft(col_15))

# ---- group: 3 culture
mesh_34 = Mesh(mcol_15)  # disabled

# ---- group: score
# CityMatrix Mini
# 
# "Ryan" Yan Zhang <ryanz@mit.edu>
# MIT Media Lab, Changing Place Group
# Augest. 2016
num_64 = Number(multiplication_42)

# ----
gradient_9 = Gradient(LowerLimit=0, UpperLimit=1, Parameter=num_64, stops=[0: RGB(0, 0, 0), 1: RGB(130, 98, 0)])

# ---- group: color
col_16 = Colour(gradient_9)

# ----
mcol_16 = MeshColours(Mesh=graft(move_2.Geometry), Colours=graft(col_16))

# ---- group: 0 school
mesh_35 = Mesh(mcol_16)  # disabled

# ---- group: score
num_65 = Number(multiplication_43)

# ----
gradient_10 = Gradient(LowerLimit=0, UpperLimit=1, Parameter=num_65, stops=[0: RGB(0, 0, 0), 1: RGB(186, 0, 0)])

# ---- group: color
col_17 = Colour(gradient_10)

# ----
mcol_17 = MeshColours(Mesh=graft(move_2.Geometry), Colours=graft(col_17))

# ---- group: 1 healthcare
mesh_36 = Mesh(mcol_17)  # disabled

# ---- group: score
num_66 = Number(multiplication_45)

# ----
gradient_11 = Gradient(LowerLimit=0, UpperLimit=1, Parameter=num_66, stops=[0: RGB(0, 0, 0), 1: RGB(94, 0, 153)])

# ---- group: color
col_18 = Colour(gradient_11)

# ----
mcol_18 = MeshColours(Mesh=graft(move_2.Geometry), Colours=graft(col_18))

# ---- group: 4 mobility
mesh_37 = Mesh(mcol_18)  # disabled

# ---- group: dynamic data from CityMatix CV
int_68 = Integer(int_55)

# ---- group: all dynamic data
int_69 = Integer(int_68)

# ----
panel_134 = Panel(int_69)
p_n_c = PickNChoose(Pattern=[0, 1], Stream0=int_2, Stream1=int_69)

# ---- group: combined ID data
int_70 = Integer(p_n_c)

int_71 = Integer(int_70)

# ----
mindex = MemberIndex(Set=graft(int_71), Member=int_24)  # -> Index, Count

# ---- group: module id
int_72 = Integer(int_70)

int_73 = Integer(int_72)

int_74 = Integer(int_72)

int_75 = Integer(int_74)

# ----
larger = LargerThan(FirstNumber=int_73, SecondNumber="0")  # -> LargerThan, OrEqualTo
smaller_2 = SmallerThan(FirstNumber=int_73, SecondNumber="5")  # -> SmallerThan, OrEqualTo
and = GateAnd(A=larger.OrEqualTo, B=smaller_2.OrEqualTo)

# ---- group: is building or not
bool_8 = Boolean(and)

# ----
dispatch_11 = Dispatch(List=pt_10, DispatchPattern=bool_8)  # -> ListA, ListB
dispatch_12 = Dispatch(List=int_73, DispatchPattern=bool_8)  # -> ListA, ListB

# ---- group: building center
pt_32 = Point(dispatch_11.ListA)

# ---- group: building id
int_76 = Integer(dispatch_12.ListA)

# ----
equals_13 = Equality(FirstNumber=int_76, SecondNumber=int_40)  # -> Equality, Inequality
multiplication_46 = Multiplication(A=equals_13.Inequality, B=6)
addition_28 = Addition(A=int_76, B=multiplication_46)
larger_2 = LargerThan(FirstNumber=int_74, SecondNumber="0")  # -> LargerThan, OrEqualTo
smaller_3 = SmallerThan(FirstNumber=int_74, SecondNumber="7")  # -> SmallerThan, OrEqualTo
filter = StreamFilter(Gate=equals.Equality, Stream0=addition_28, Stream1=int_76)
item_28 = ListItem(List=col, Index=graft(filter), Wrap=False)
larger_3 = LargerThan(FirstNumber=int_75, SecondNumber=panel_24)  # -> LargerThan, OrEqualTo; disabled
smaller_4 = SmallerThan(FirstNumber=int_75, SecondNumber=panel_25)  # -> SmallerThan, OrEqualTo; disabled
pshift_28 = ShiftPaths(Data=item_28, Offset=-1)
and_2 = GateAnd(A=larger_3.OrEqualTo, B=smaller_4.OrEqualTo)  # disabled
and_3 = GateAnd(A=larger_2.OrEqualTo, B=smaller_3.OrEqualTo)

# ---- group: color for each building
col_19 = Colour(pshift_28)

# ----
item_29 = ListItem(List=panel_27, Index=graft(int_76), Wrap=False)
dispatch_13 = Dispatch(List=int_75, DispatchPattern=and_2)  # -> ListA, ListB; disabled
dispatch_14 = Dispatch(List=int_74, DispatchPattern=and_3)  # -> ListA, ListB
smaller_5 = SmallerThan(FirstNumber=int_74, SecondNumber="0")  # -> SmallerThan, OrEqualTo
smaller_6 = SmallerThan(FirstNumber=int_75, SecondNumber=panel_28)  # -> SmallerThan, OrEqualTo; disabled
pshift_29 = ShiftPaths(Data=item_29, Offset=-1)
item_30 = ListItem(List=mesh_13, Index=graft(dispatch_14.ListA), Wrap=False)
item_31 = ListItem(List=mesh_11, Index=graft(dispatch_13.ListA), Wrap=False)  # disabled
dispatch_15 = Dispatch(List=pt_9, DispatchPattern=smaller_5.SmallerThan)  # -> ListA, ListB
dispatch_16 = Dispatch(List=pt_5, DispatchPattern=smaller_6.SmallerThan)  # -> ListA, ListB; disabled
multiplication_47 = Multiplication(A=pshift_29, B=number_slider_4)
pshift_30 = ShiftPaths(Data=item_30, Offset=-1)
pshift_31 = ShiftPaths(Data=item_31, Offset=-1)  # disabled

# ---- group: building height of each building
num_67 = Number(multiplication_47)

# ----
addition_29 = Addition(A=num_67, B=panel_23)
dom_16 = ConstructDomain(DomainStart=0, DomainEnd=addition_29)
box_3 = DomainBox(Base=pt_32, X=dom, Y=dom, Z=dom_16)
move_9 = Move(Geometry=box_3, Motion=vec)  # -> Geometry, Transform
dispatch_17 = Dispatch(List=int_37, DispatchPattern=and_3)  # -> ListA, ListB
dispatch_18 = Dispatch(List=int_38, DispatchPattern=and_2)  # -> ListA, ListB; disabled

# ---- group: building geo
box_4 = Box(move_9.Geometry)

# ----
vec2pt_3 = Vector2Pt(PointA=Point(0, 0, 0), PointB=dispatch_15.ListA, Unitize=False)  # -> Vector, Length
vec2pt_4 = Vector2Pt(PointA=Point(0, 0, 0), PointB=dispatch_16.ListA, Unitize=False)  # -> Vector, Length; disabled
rotate_2 = Rotate(Geometry=pshift_30, Angle=degrees(dispatch_17.ListA), Plane=PlaneXY(0, 0, 0))  # -> Geometry, Transform
rotate_3 = Rotate(Geometry=pshift_31, Angle=degrees(dispatch_18.ListA), Plane=PlaneXY(0, 0, 0))  # -> Geometry, Transform; disabled
dispatch_19 = Dispatch(List=pt_9, DispatchPattern=and_3)  # -> ListA, ListB
dispatch_20 = Dispatch(List=pt_5, DispatchPattern=and_2)  # -> ListA, ListB; disabled
move_10 = Move(Geometry=mesh_12, Motion=vec2pt_3.Vector)  # -> Geometry, Transform
vec2pt_5 = Vector2Pt(PointA=Point(0, 0, 0), PointB=dispatch_19.ListA, Unitize=False)  # -> Vector, Length
vec2pt_6 = Vector2Pt(PointA=Point(0, 0, 0), PointB=dispatch_20.ListA, Unitize=False)  # -> Vector, Length; disabled
move_11 = Move(Geometry=rotate_2.Geometry, Motion=vec2pt_5.Vector)  # -> Geometry, Transform

# ---- group: 3D Buldings
preview_9 = CustomPreview(Geometry=box_4, Shader=col_19)

# ----
move_12 = Move(Geometry=rotate_3.Geometry, Motion=vec2pt_6.Vector)  # -> Geometry, Transform; disabled
move_13 = Move(Geometry=mesh_10, Motion=vec2pt_4.Vector)  # -> Geometry, Transform; disabled

# ---- group: all 0 to 7 instantiated
mesh_38 = Mesh(move_12.Geometry)  # disabled

# ---- group: all -1 instantiated
mesh_39 = Mesh(move_13.Geometry)  # disabled

# ---- group: building lego modules
mesh_40 = Mesh(move_11.Geometry)

# ---- group: blank
mesh_41 = Mesh(move_10.Geometry)

# ----
panel_135 = Panel(int_70)
ma_7 = MassAddition(Input=mindex.Count)  # -> Result, PartialResults
panel_136 = Panel(int_72)
pshift_32 = ShiftPaths(Data=ma_7.Result, Offset=-1)

# ---- group: is building
bool_9 = Boolean(pshift_32)

# ----
and_4 = GateAnd(A=bool_9, B=bool_5)
# Human Interation @ Lego - Outside
dispatch_21 = Dispatch(List=int_74, DispatchPattern=and_3)  # -> ListA, ListB; disabled

# ---- group: is dynamic building
bool_10 = Boolean(and_4)

# ---- group: all dynamic data
int_77 = Integer(int_69)

# ---- group: filted id
int_78 = Integer(dispatch_21.ListA)  # disabled

# ---- group: module id
int_79 = Integer(int_72)

# ----
and_5 = GateAnd(A=bool_10, B=bool_6)
equals_14 = Equality(FirstNumber=int_79, SecondNumber=int_40)  # -> Equality, Inequality
item_32 = ListItem(List=txt_13, Index=graft(int_78), Wrap=True)  # disabled

# ---- group: is dynamic commercial
bool_11 = Boolean(and_5)

# ----
equals_15 = Equality(FirstNumber=int_77, SecondNumber="1")  # -> Equality, Inequality
equals_16 = Equality(FirstNumber=int_77, SecondNumber="0")  # -> Equality, Inequality
equals_17 = Equality(FirstNumber=int_77, SecondNumber="2")  # -> Equality, Inequality
equals_18 = Equality(FirstNumber=int_77, SecondNumber="3")  # -> Equality, Inequality
equals_19 = Equality(FirstNumber=int_77, SecondNumber="5")  # -> Equality, Inequality
equals_20 = Equality(FirstNumber=int_77, SecondNumber="4")  # -> Equality, Inequality
equals_21 = Equality(FirstNumber=int_77, SecondNumber="6")  # -> Equality, Inequality
equals_22 = Equality(FirstNumber=int_77, SecondNumber="7")  # -> Equality, Inequality
or = GateOr(A=bool_11, B=bool_7)
pshift_33 = ShiftPaths(Data=item_32, Offset=-1)  # disabled
int_80 = Integer(equals_16.Equality)
int_81 = Integer(equals_15.Equality)
int_82 = Integer(equals_20.Equality)
int_83 = Integer(equals_17.Equality)
int_84 = Integer(equals_18.Equality)
int_85 = Integer(equals_19.Equality)
int_86 = Integer(equals_21.Equality)
int_87 = Integer(equals_22.Equality)

# ---- group: is commercial
bool_12 = Boolean(or)

# ----
dispatch_22 = Dispatch(List=pt_9, DispatchPattern=bool_12)  # -> ListA, ListB
vec2pt_7 = Vector2Pt(PointA=Point(0, 0, 0), PointB=dispatch_22.ListA, Unitize=False)  # -> Vector, Length
move_14 = Move(Geometry=mesh_14, Motion=vec2pt_7.Vector)  # -> Geometry, Transform

# ---- group: building lego modules
mesh_42 = Mesh(move_14.Geometry)

# ----
dispatch_23 = Dispatch(List=pt_11, DispatchPattern=equals_14.Inequality)  # -> ListA, ListB

# ---- group: flr #s
txt_31 = Text(pshift_33)  # disabled

# ----
ma_8 = MassAddition(Input=[int_80, int_81, int_84])  # -> Result, PartialResults
ma_9 = MassAddition(Input=int_81)  # -> Result, PartialResults
ma_10 = MassAddition(Input=[int_80, int_81, int_83, int_84, int_82, int_87])  # -> Result, PartialResults
ma_11 = MassAddition(Input=int_80)  # -> Result, PartialResults
ma_12 = MassAddition(Input=int_83)  # -> Result, PartialResults
vec2pt_8 = Vector2Pt(PointA=Point(0, 0, 0), PointB=dispatch_23.ListA, Unitize=False)  # -> Vector, Length
move_15 = Move(Geometry=move_4.Geometry, Motion=vec2pt_8.Vector)  # -> Geometry, Transform

# ---- group: NumID3
int_88 = Integer(ma_8.Result)

# ----
panel_137 = Panel(int_88)

# ---- group: NumID1
int_89 = Integer(ma_9.Result)

# ----
panel_138 = Panel(int_89)

# ---- group: NumID0
int_90 = Integer(ma_11.Result)

# ----
panel_139 = Panel(int_90)

# ---- group: NumBuildings
int_91 = Integer(ma_10.Result)

# ----
panel_140 = Panel(int_91)

# ---- group: NumID2
int_92 = Integer(ma_12.Result)

# ----
panel_141 = Panel(int_92)
mjoin = MeshJoin(Meshes=move_15.Geometry)
filter_2 = StreamFilter(Gate=equals.Equality, Stream0=mjoin)
item_33 = ListItem(List=num_26, Index=graft(int_78), Wrap=True)  # disabled
item_34 = ListItem(List=num_24, Index=graft(int_78), Wrap=True)  # disabled
item_35 = ListItem(List=num_25, Index=graft(int_78), Wrap=True)  # disabled
previewmat_4 = CustomPreviewMaterials(Geometry=filter_2, DiffuseColor=swatch, Transparency=panel_58, DiffuseBitmap=path_6)
pshift_34 = ShiftPaths(Data=item_33, Offset=-1)  # disabled
pshift_35 = ShiftPaths(Data=item_34, Offset=-1)  # disabled
pshift_36 = ShiftPaths(Data=item_35, Offset=-1)  # disabled

# ---- group: old per flr
num_68 = Number(pshift_34)  # disabled

# ---- group: young per flr
num_69 = Number(pshift_35)  # disabled

# ---- group: mid per flr
num_70 = Number(pshift_36)  # disabled

# ----
multiplication_48 = Multiplication(A=num_70, B=txt_31)  # disabled
multiplication_49 = Multiplication(A=num_69, B=txt_31)  # disabled
multiplication_50 = Multiplication(A=num_68, B=txt_31)  # disabled

# ---- group: total ppl in building mid
int_93 = Integer(multiplication_48)  # disabled

# ---- group: total ppl in building young
int_94 = Integer(multiplication_49)  # disabled

# ----
addition_30 = Addition(A=int_94, B=int_93)  # disabled

# ---- group: total ppl in building old
int_95 = Integer(multiplication_50)  # disabled

# ----
addition_31 = Addition(A=addition_30, B=int_95)  # disabled

# ---- group: total ppl in building - all
int_96 = Integer(addition_31)  # disabled

# ----
ma_13 = MassAddition(Input=num_64)  # -> Result, PartialResults
ma_14 = MassAddition(Input=num_65)  # -> Result, PartialResults
pshift_37 = ShiftPaths(Data=ma_13.Result, Offset=-1)
pshift_38 = ShiftPaths(Data=ma_14.Result, Offset=-1)

# ---- group: Employment Population
eval_3 = Evaluate(F=panel_86, NumID3=int_88, NumFLID3=int_46, ComSlider=num_14, NumBuildings=int_91)

# ---- group: Residential Population
eval_4 = Evaluate(F=panel_87, NumID0=int_90, NumFLID0=int_41, NumID1=int_89, NumFLID1=int_42, NumID2=int_92, NumFLID2=int_43)

# ---- group: Parameter 1
num_71 = Number(pshift_37)

# ----
panel_142 = Panel(num_71)

# ---- group: Parameter 2
num_72 = Number(pshift_38)

# ----
panel_143 = Panel(num_72)

# ---- group: Residential Population
num_73 = Number(eval_4)

# ----
panel_144 = Panel(num_73)

# ---- group: Employment Population
int_97 = Integer(eval_3)

# ----
panel_145 = Panel(int_97)
remap_17 = RemapNumbers(Value=num_71, Source=dom_3, Target=Domain(0, 1))  # -> Mapped, Clipped
remap_18 = RemapNumbers(Value=num_72, Source=dom_4, Target=Domain(0, 1))  # -> Mapped, Clipped
addition_32 = Addition(A=int_97, B=num_73)

# ---- group: 0 school
mesh_43 = Mesh(mcol_16)

# ---- group: 1 healthcare
mesh_44 = Mesh(mcol_17)

# ---- group: 2 green
mesh_45 = Mesh(mcol_13)

# ---- group: 3 culture
mesh_46 = Mesh(mcol_15)

# ---- group: all
mesh_47 = Mesh(mcol_14)

# ---- group: 4 mobility
mesh_48 = Mesh(mcol_18)

# ---- group: Parameter 1
num_74 = Number(remap_17.Mapped)

# ----
panel_146 = Panel(num_74)

# ---- group: Parameter 2
num_75 = Number(remap_18.Mapped)

# ----
panel_147 = Panel(num_75)
filter_3 = StreamFilter(
    Gate=viz_selection,
    Stream0=0,
    Stream1=mesh_29,
    Stream2=mesh_43,
    Stream3=mesh_44,
    Stream4=mesh_45,
    Stream5=mesh_46,
    Stream6=mesh_48,
    Stream7=mesh_47,
    Stream8=8)

# ---- group: Total Population
int_98 = Integer(addition_32)

# ----
panel_148 = Panel(int_98)
item_36 = ListItem(List=flatten(filter_3), Index=0, Wrap=False)

# ---- group: viz
mesh_49 = Mesh(filter_3)

# ----
item_37 = ListItem(List=flatten(filter_3), Index=0, Wrap=False)
equals_23 = Equality(FirstNumber=item_36, SecondNumber=0)  # -> Equality, Inequality
equals_24 = Equality(FirstNumber=item_37, SecondNumber=8)  # -> Equality, Inequality
p_n_c_2 = PickNChoose(Pattern=equals_23.Equality, Stream1=geo)
p_n_c_3 = PickNChoose(Pattern=equals_24.Equality, Stream1=int_51)

# ---- group: Satellite Image
previewmat_5 = CustomPreviewMaterials(Geometry=p_n_c_2, DiffuseColor=RGB(255, 255, 255), DiffuseBitmap=path_12)

# ----
merge_10 = Merge(Data1=num_74, Data2=num_75, Data3=num_40, Data4=num_39, Data5=num_38)
addition_33 = Addition(A=p_n_c_3, B=1)
int_99 = Integer(p_n_c_3)
eval_5 = EvaluateCurve(Curve=crv_8, Parameter=merge_10)  # -> Point, Tangent, Angle
int_100 = Integer(addition_33)
join_10 = TextJoin(Text=[int_99, ":00 - ", int_100, ":00"])
tag = TextTag3D(Location=pt_22, Text=join_10, Size=15, Colour=ColourSwatch(SwatchColor=RGB(255, 255, 255)), Justification=7)
join_11 = TextJoin(Text=[path_9, int_99, ".csv"])
pline_4 = PolyLine(Vertices=eval_5.Point, Closed=True)
join_12 = TextJoin(Text=[panel_109, int_99, ".csv"])
offset_3 = Offset(Curve=pline_4, Distance=[neg_3, number_slider_16], Plane=PlaneXY(0, 0, 0), Corners=1)
pshift_39 = ShiftPaths(Data=offset_3, Offset=-1)
boundary_14 = BoundarySurfaces(Edges=pshift_39)
extr_3 = Extrude(Base=boundary_14, Direction=Z_4)
brep_3 = Brep(extr_3)
mcol_19 = MeshColours(Mesh=brep_3, Colours=ColourSwatch(SwatchColor=RGB(255, 153, 0)))

# ---- group: Radar Chart Dynamic
mesh_50 = Mesh(mcol_19)

# ----
tag_2 = TextTag3D(Location=pt_21, Text=int_55, Size=0.01, Justification=5)

# ---- group: dock lego modules
mesh_51 = Mesh(move_8.Geometry)

# ----
swatch_4 = ColourSwatch(SwatchColor=RGB(201, 201, 201))  # disabled
transform = Transform(Geometry=xy_4, Transform=comp)
pt_33 = Point(<point referenced from the Rhino model>)  # disabled
pt_34 = Point(<point referenced from the Rhino model>)  # disabled
panel_149 = Panel(int_55)

# ---- group: unit name
tag_3 = TextTag3D(Location=pt_33, Text=item_26, Size=number_slider_20, Colour=swatch_4, Justification=5)  # disabled

# ---- group: res/off
tag_4 = TextTag3D(Location=pt_34, Text=item_27, Size=number_slider_20, Colour=swatch_4, Justification=5)  # disabled

# ----
path_16 = FilePath(join_11)
path_17 = FilePath(join_12)
polygon = Polygon(Plane=PlaneXY(0, 0, 0), Radius=Slider(15, range=0..100), Segments=Slider(12, range=3..20), FilletRadius=0)  # -> Polygon, Length

# ---- group: careem coords pick-up
file_5 = ReadFile(File=path_17, PerLineParse=True)

# ----
boundary_15 = BoundarySurfaces(Edges=polygon.Polygon)

# ---- group: careem coords drop-off
file_6 = ReadFile(File=path_16, PerLineParse=True)

# ----
panel_150 = Panel("Amenity Off")  # disabled
panel_151 = Panel("Human Int. Off")  # disabled
panel_152 = Panel("Amenity On")  # disabled
panel_153 = Panel("Human Int. On")  # disabled
panel_154 = Panel("Sat. Map On")  # disabled
panel_155 = Panel("MoD.")  # disabled
panel_156 = Panel("Sat. Map Off")  # disabled
# Toggles
panel_157 = Panel("Private Car")  # disabled
mesh_52 = Mesh(boundary_15)
txt_32 = Text(file_5)
txt_33 = Text(file_6)
txt_34 = Text([panel_152, panel_150])  # disabled
txt_35 = Text([panel_153, panel_151])  # disabled
txt_36 = Text([panel_154, panel_156])  # disabled
txt_37 = Text([panel_157, panel_155])  # disabled
item_38 = ListItem(List=txt_34, Index=0, Wrap=True)  # disabled
item_39 = ListItem(List=txt_36, Index=0, Wrap=True)  # disabled
item_40 = ListItem(List=txt_35, Index=0, Wrap=True)  # disabled
item_41 = ListItem(List=txt_37, Index=0, Wrap=True)  # disabled
split_15 = TextSplit(Text=txt_32, Separators=",")
split_16 = TextSplit(Text=txt_33, Separators=",")
pt_35 = Point(<point referenced from the Rhino model>)  # disabled
pt_36 = Point(<point referenced from the Rhino model>)  # disabled
pt_37 = Point(<point referenced from the Rhino model>)  # disabled
pt_38 = Point(<point referenced from the Rhino model>)  # disabled

# ---- group: amenities
tag_5 = TextTag3D(Location=pt_36, Text=item_38, Size=number_slider_20, Colour=swatch_4, Justification=5)  # disabled

# ---- group: google map
tag_6 = TextTag3D(Location=pt_37, Text=item_39, Size=number_slider_20, Colour=swatch_4, Justification=5)  # disabled

# ---- group: human interaction
tag_7 = TextTag3D(Location=pt_35, Text=item_40, Size=number_slider_20, Colour=swatch_4, Justification=5)  # disabled

# ---- group: transportation mode
tag_8 = TextTag3D(Location=pt_38, Text=item_41, Size=number_slider_20, Colour=swatch_4, Justification=5)  # disabled

# ----
item_42 = ListItem(List=split_15, Index=0, Wrap=False)
item_43 = ListItem(List=split_15, Index=1, Wrap=False)
item_44 = ListItem(List=split_16, Index=0, Wrap=False)
item_45 = ListItem(List=split_16, Index=1, Wrap=False)
pshift_40 = ShiftPaths(Data=item_43, Offset=-1)
pshift_41 = ShiftPaths(Data=item_42, Offset=-1)
pshift_42 = ShiftPaths(Data=item_45, Offset=-1)
pshift_43 = ShiftPaths(Data=item_44, Offset=-1)
panel_158 = Panel("1 to 30")  # disabled
num_76 = Number(pshift_41)
num_77 = Number(pshift_40)
num_78 = Number(pshift_43)
num_79 = Number(pshift_42)

# ---- group: slider1
# Slider
num_80 = Number()  # disabled

# ----
range = Range(Domain=panel_158, Steps=100)  # disabled
inc = Includes(Value=num_76, Domain=dom_15)  # -> Includes, Deviation
inc_2 = Includes(Value=num_77, Domain=dom_14)  # -> Includes, Deviation
inc_3 = Includes(Value=num_78, Domain=dom_15)  # -> Includes, Deviation
inc_4 = Includes(Value=num_79, Domain=dom_14)  # -> Includes, Deviation
multiplication_51 = Multiplication(A=num_80, B=100)  # disabled
int_101 = Integer(range)  # disabled
and_6 = GateAnd(A=inc_2.Includes, B=inc.Includes)
and_7 = GateAnd(A=inc_4.Includes, B=inc_3.Includes)
txt_38 = Text(int_101)  # disabled
int_102 = Integer(multiplication_51)  # disabled
dispatch_24 = Dispatch(List=num_76, DispatchPattern=and_6)  # -> ListA, ListB
dispatch_25 = Dispatch(List=num_77, DispatchPattern=and_6)  # -> ListA, ListB
dispatch_26 = Dispatch(List=num_78, DispatchPattern=and_7)  # -> ListA, ListB
dispatch_27 = Dispatch(List=num_79, DispatchPattern=and_7)  # -> ListA, ListB
item_46 = ListItem(List=txt_38, Index=int_102, Wrap=True)  # disabled

# ---- group: dock lego floor number
tag_9 = TextTag3D(
    Location=transform,
    Text=item_46,
    Size=Slider(17, range=0..100),
    Colour=ColourSwatch(SwatchColor=RGB(0, 0, 0)),
    Justification=5)

# ----
pt_39 = Point(<point referenced from the Rhino model>)  # disabled

# ---- group: lat / y
num_81 = Number(dispatch_24.ListA)

# ----
remap_19 = RemapNumbers(Value=num_81, Source=dom_15, Target=dom_13)  # -> Mapped, Clipped

# ---- group: lng / x
num_82 = Number(dispatch_25.ListA)

# ----
remap_20 = RemapNumbers(Value=num_82, Source=dom_14, Target=dom_12)  # -> Mapped, Clipped
lng_5 = ListLength(List=remap_20.Mapped)
random_2 = Random(Range=Domain(-10, 10), Number=lng_5, Seed=22)
addition_34 = Addition(A=random_2, B=remap_19.Mapped)
random_3 = Random(Range=Domain(-10, 10), Number=lng_5, Seed=85)
addition_35 = Addition(A=random_3, B=remap_20.Mapped)
pt_40 = ConstructPoint(XCoordinate=addition_35, YCoordinate=addition_34, ZCoordinate="15")
vec2pt_9 = Vector2Pt(PointA=<geometry referenced from the Rhino model>, PointB=pt_40, Unitize=False)  # -> Vector, Length
move_16 = Move(Geometry=mesh_52, Motion=vec2pt_9.Vector)  # -> Geometry, Transform

# ---- group: lat / y
num_83 = Number(dispatch_26.ListA)

# ----
remap_21 = RemapNumbers(Value=num_83, Source=dom_15, Target=dom_13)  # -> Mapped, Clipped

# ---- group: lng / x
num_84 = Number(dispatch_27.ListA)

# ----
remap_22 = RemapNumbers(Value=num_84, Source=dom_14, Target=dom_12)  # -> Mapped, Clipped
lng_6 = ListLength(List=remap_22.Mapped)
random_4 = Random(Range=Domain(-10, 10), Number=lng_6, Seed=27)
addition_36 = Addition(A=random_4, B=remap_21.Mapped)
random_5 = Random(Range=Domain(-10, 10), Number=lng_6, Seed=43)
addition_37 = Addition(A=random_5, B=remap_22.Mapped)
pt_41 = ConstructPoint(XCoordinate=addition_37, YCoordinate=addition_36, ZCoordinate="15")
vec2pt_10 = Vector2Pt(PointA=<geometry referenced from the Rhino model>, PointB=pt_41, Unitize=False)  # -> Vector, Length
move_17 = Move(Geometry=mesh_52, Motion=vec2pt_10.Vector)  # -> Geometry, Transform

preview_10 = CustomPreview(Geometry=move_16.Geometry, Shader=ColourSwatch(SwatchColor=RGBA(0, 128, 255, 140)))
preview_11 = CustomPreview(Geometry=move_17.Geometry, Shader=ColourSwatch(SwatchColor=RGBA(255, 178, 0, 140)))

# ---- group: fl # slider
tag_10 = TextTag3D(Location=pt_39, Text=item_46, Size=number_slider_20, Colour=swatch_4, Justification=8)  # disabled

# ==== cluster ModuleCenter
pt = ClusterInput()
int = ClusterInput()
num = ClusterInput()
int_2 = ClusterInput()

# ---- group: y
int_3 = Integer(int)

# ---- group: cell size
num_2 = Number(num)

# ---- group: x
int_4 = Integer(int_2)

# ---- group: center
pt_2 = Point(pt)

# ----
pt_3 = ConstructPoint(XCoordinate=0, YCoordinate=0, ZCoordinate=0)  # disabled
addition = Addition(A=int_4, B=0.5)
vec2pt = Vector2Pt(PointA=pt_3, PointB=pt_2, Unitize=False)  # -> Vector, Length; disabled
addition_2 = Addition(A=int_3, B=0.5)
multiplication = Multiplication(A=addition, B=num_2)
move = Move(Motion=vec2pt.Vector)  # -> Geometry, Transform; disabled
lng = ListLength(List=int_4)  # disabled
multiplication_2 = Multiplication(A=addition_2, B=num_2)
X = UnitX(Factor=multiplication)
repeat = RepeatData(Data=move.Transform, Length=lng)  # disabled
neg = Negative(Value=multiplication_2)
move_2 = Move(Geometry=pt_2, Motion=X)  # -> Geometry, Transform
graft = GraftTree(Tree=move_2.Transform, IncludeEmptyLists=True, IncludeNullItems=True)  # disabled
Y = UnitY(Factor=neg)
pshift = ShiftPaths(Data=repeat, Offset=-1)  # disabled
move_3 = Move(Geometry=move_2.Geometry, Motion=Y)  # -> Geometry, Transform
graft_2 = GraftTree(Tree=move_3.Transform, IncludeEmptyLists=True, IncludeNullItems=True)  # disabled
comp = Compound(Transforms=[graft, graft_2])  # disabled
graft_3 = GraftTree(Tree=pshift, IncludeEmptyLists=True, IncludeNullItems=True)  # disabled
comp_2 = Compound(Transforms=[comp, graft_3])  # disabled

# ---- group: module center
pt_4 = Point(move_3.Geometry)

# ----
pshift_2 = ShiftPaths(Data=comp_2, Offset=-1)  # disabled
transform = Transform(pshift_2)  # disabled
pt_5 = ClusterOutput(pt_4)
transform_2 = ClusterOutput(transform)  # disabled

# ==== cluster MoveToOrgin
num = ClusterInput()
G = ClusterInput()
num_2 = Number(num)
geobottomcenter = GeoBottomCenter(geo=G)
vec2pt = Vector2Pt(PointA=geobottomcenter, PointB=Point(0, 0, 0), Unitize=False)  # -> Vector, Length
move = Move(Geometry=G, Motion=vec2pt.Vector)  # -> Geometry, Transform
scale_nu = ScaleNU(Geometry=move.Geometry, Plane=PlaneXY(0, 0, 0), ScaleX=num_2, ScaleY=num_2, ScaleZ=1)  # -> Geometry, Transform
G_2 = ClusterOutput(scale_nu.Geometry)

# ==== cluster Perspective
int = ClusterInput()
int_2 = ClusterInput()
pt = ClusterInput()

# ---- group: grid extent y
int_3 = Integer(int)

# ---- group: grid extent x
int_4 = Integer(int_2)

# ---- group: Pts Sample Grid Corner
pt_2 = Point(pt)

# ----
subtraction = Subtraction(A=int_4, B=1)
subtraction_2 = Subtraction(A=int_3, B=1)
item = ListItem(List=pt_2, Index=0, Wrap=False)
item_2 = ListItem(List=pt_2, Index=1, Wrap=False)
item_3 = ListItem(List=pt_2, Index=2, Wrap=False)
item_4 = ListItem(List=pt_2, Index=3, Wrap=False)
pt_3 = Point(item_4)
pt_4 = Point(item)
ln = Line(StartPoint=pt_3, EndPoint=pt_4)
pt_5 = Point(item_2)
ln_2 = Line(StartPoint=pt_4, EndPoint=pt_5)
pt_6 = Point(item_3)
ln_3 = Line(StartPoint=pt_6, EndPoint=pt_3)
ln_4 = Line(StartPoint=pt_5, EndPoint=pt_6)
llx = LineLine(Line1=ln, Line2=ln_4)  # -> ParamA, ParamB, PointA, PointB
pt_7 = Point(llx.PointA)
llx_2 = LineLine(Line1=ln_2, Line2=ln_3)  # -> ParamA, ParamB, PointA, PointB
pt_8 = Point(llx_2.PointA)
vec2pt = Vector2Pt(PointA=pt_8, PointB=pt_7, Unitize=False)  # -> Vector, Length
line = LineSDL(Start=pt_3, Direction=vec2pt.Vector, Length=1)
llx_3 = LineLine(Line1=ln_2, Line2=line)  # -> ParamA, ParamB, PointA, PointB
pt_9 = Point(llx_3.PointA)
ln_5 = Line(StartPoint=pt_3, EndPoint=pt_9)
divide = DivideCurve(Curve=ln_5, Count=subtraction_2, Kinks=False)  # -> Points, Tangents, Parameters
ln_6 = Line(StartPoint=pt_8, EndPoint=divide.Points)
llx_4 = LineLine(Line1=ln_4, Line2=line)  # -> ParamA, ParamB, PointA, PointB
pt_10 = Point(llx_4.PointA)
ln_7 = Line(StartPoint=pt_3, EndPoint=pt_10)
divide_2 = DivideCurve(Curve=ln_7, Count=subtraction, Kinks=False)  # -> Points, Tangents, Parameters
ln_8 = Line(StartPoint=pt_7, EndPoint=divide_2.Points)
ln_9 = Line(StartPoint=pt_8, EndPoint=pt_7)

# ---- group: x
line_2 = Line(ln_8)

# ---- group: y
line_3 = Line(ln_6)

# ----
graft = GraftTree(Tree=ln_6, IncludeEmptyLists=True, IncludeNullItems=True)
llx_5 = LineLine(Line1=line_2, Line2=graft)  # -> ParamA, ParamB, PointA, PointB

# ---- group: keystoned grid pts
pt_11 = Point(llx_5.PointA)

# ----
pt_12 = ClusterOutput(pt_11)

# ==== cluster GeoBottomCenter
geo = ClusterInput()
geo_2 = Geometry(geo)
bbox = BoundingBox(Content=geo_2, Plane=PlaneXY(0, 0, 0))  # -> Box, Box_2
box_corners = BoxCorners(Box=bbox.Box)  # -> CornerA, CornerB, CornerC, CornerD, CornerE, CornerF, CornerG, CornerH
pdecon = Deconstruct(Point=box_corners.CornerA)  # -> XComponent, YComponent, ZComponent
pdecon_2 = Deconstruct(Point=box_corners.CornerC)  # -> XComponent, YComponent, ZComponent
addition = Addition(A=pdecon.XComponent, B=pdecon_2.XComponent)
addition_2 = Addition(A=pdecon.YComponent, B=pdecon_2.YComponent)
division = Division(A=addition, B=2)
division_2 = Division(A=addition_2, B=2)
pt = ConstructPoint(XCoordinate=division, YCoordinate=division_2, ZCoordinate=pdecon.ZComponent)
pt_2 = Point(pt)
pt_3 = ClusterOutput(pt_2)
