# Grasshopper definition 170908_CityScope_Volpe.gh (Grasshopper 0.9.76)
# plug-ins: Python Interpreter, Firefly.X, Human

# ---- group: Relative Filepath
vb = VBScript()  # -> out, A
# ---------- vb: VB ----------
    Dim gh_d As GH_Document = owner.OnPingDocument()

    If gh_d.IsFilePathDefined Then
      Print("A path is defined.")
      A = gh_d.FilePath
    Else
      Print("No path defined.")
    End If
# ---------- end vb ----------
panel = Panel(vb.out)
panel_2 = Panel(vb.A)
split = TextSplit(Text=panel_2, Separators="\")
shift = ShiftList(List=split, Shift=-1, Wrap=False)
txt = Text(flatten("Data\170830_Camera_Volpe.PNG"))
txt_2 = Text(flatten(shift))
join = TextJoin(Text=flatten([txt_2, txt]), Join="\")
path = FilePath(join)
panel_3 = Panel(path)

# ---- group: module meshes lego ref: 0 to 5 - GF View
mesh = Mesh([<mesh referenced from the Rhino model> x6])

# ---- group: module meshes lego ref: 0 to 5
mesh_2 = Mesh([<mesh referenced from the Rhino model> x6])

# ----
merge = Merge(Data1=graft(mesh_2), Data2=graft(mesh))
video_stream = WebCamVideoStream()  # disabled
barcelona = Panel("""34583
25544
34441
31943
33820
26139
31017
31537
27220
34038
23027
18951
35193
34607
26530
30389
28699
32224
34440
29205
33993
33546
34435
29715""")
path_2 = FilePath(path)

# ---- group: Pts Sample Grid Corner
# Grid Sampling
pt = Point([<point referenced from the Rhino model> x4])

# ---- group: all color code quarts (no rotation)
# Decode Piece ID
panel_4 = Panel("2,0,0,0\t2,1,0,0\t2,0,1,0\t2,0,0,1\t2,1,1,0\t2,1,0,1\t2,0,1,1\t2,1,1,1\t3,0,0,0\t3,1,0,0\t3,0,1,0\t3,0,0,1\t3,1,1,0\t3,1,0,1\t3,0,1,1\t3,1,1,1\t4,0,0,0\t4,1,0,0\t4,0,1,0\t4,0,0,1\t4,1,1,0\t4,1,0,1\t4,0,1,1\t4,1,1,1\t5,0,0,0\t5,1,0,0\t5,0,1,0\t5,0,0,1\t5,1,1,0\t5,1,0,1\t5,0,1,1\t5,1,1,1")

# ----
pline = PolyLine(Vertices=pt, Closed=False)
load_bitmap = LoadBitmap(FilePathToImageLocation=path_2)

# ---- group: indicator on table
crv = Curve(reparameterize(graft([<curve referenced from the Rhino model> x2])))

# ----
panel_5 = Panel(path_2)

# ---- group: color space tolerance
number_slider = Slider(0.381, range=0..0.5)

# ----
# CityMatrix CV
info = BitmapInfo(FireflyBitmap=video_stream)  # -> PixelResolutionInXAxis, PixelResolutionInYAxis

# ---- group: Slider 2 ref points
pt_2 = Point(graft([<point referenced from the Rhino model> x2]))

# ---- group: slider position ref pts
pt_3 = Point(graft([<point referenced from the Rhino model> x2]))

# ---- group: test color pts region
crv_2 = Curve([<curve referenced from the Rhino model> x2])

# ---- group: Color Space Sample Red
pt_4 = Point(<point referenced from the Rhino model>)

# ---- group: ref color area brep
brep = Brep(<brep referenced from the Rhino model>)

# ----
python = PythonScript(webcam_data=info.PixelResolutionInXAxis, reset=Button())  # -> out, a
# ---------- python: Python ----------
import rhinoscriptsyntax as rs
import scriptcontext as sc

if "counter" not in sc.sticky or reset:
    sc.sticky["counter"] = 0

if webcam_data is not None:
    sc.sticky["counter"] += 1

a = sc.sticky["counter"]
# ---------- end python ----------
preview = CustomPreview(Geometry=pline, Shader=ColourSwatch(SwatchColor=RGB(255, 0, 230)))
X = UnitX(Factor=-1)

# ---- group: Meaning of Colors
# Text or Intermediate Steps Values
panel_6 = Panel("Output Values")
panel_7 = Panel("Input Values")

# ---- group: 3rd Places Icons: Restaurant, Grocery, Hotel
mesh_3 = Mesh([<mesh referenced from the Rhino model> x3])

# ---- group: all color code quarts (with rotation)
panel_8 = Panel("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")

# ---- group: module meshes lego ref: -1 or 7
# Building Type Mesh
mesh_4 = Mesh(<mesh referenced from the Rhino model>)

# ----
dockid = Slider(-1, range=-1..15)

_0_reslux = Slider(5, range=1..25)
_1_resmed = Slider(4, range=1..25)
_3_comhq = Slider(3, range=1..25)
_4_commed = Slider(6, range=1..25)
_5_rescw = Slider(1, range=1..25)
_2_resmu = Slider(2, range=1..25)

# ---- group: Int Grid X Extent
# Input Parameters
number_slider_2 = Slider(14, range=-21..30)

# ---- group: Int Grid Y Extent
number_slider_3 = Slider(14, range=1..30)

# ----
panel_9 = Panel(python.a)

# ---- group: webcam stream
data = Data(load_bitmap)

bmp = BitmapToModify(data)

# ---- group: Weights
path_3 = FilePath("C:\Users\CPG\Dropbox (Changing Places)\CPG_PROJECTS\CPG_CITYSCOPE\CityMatrix_Volpe\RH_GH\DATA\Chart\Excel_Weights_170125.PNG")

# ----
panel_10 = Panel(path_3)  # disabled

# ---- group: mesh coloring
mesh_5 = Mesh([<mesh referenced from the Rhino model> x3])
res_color = ColourSwatch(SwatchColor=RGB(251, 255, 122))
res_gray = ColourSwatch(SwatchColor=RGB(227, 227, 227))
sidewalk = ColourSwatch(SwatchColor=RGB(107, 107, 107))
bikelane = ColourSwatch(SwatchColor=RGB(86, 135, 87))
off_gray = ColourSwatch(SwatchColor=RGB(171, 171, 171))
offcolor = ColourSwatch(SwatchColor=RGB(255, 122, 122))
parking = ColourSwatch(SwatchColor=RGB(196, 156, 100))
blank = ColourSwatch(SwatchColor=RGB(110, 110, 110))
road = ColourSwatch(SwatchColor=RGB(64, 64, 64))
park = ColourSwatch(SwatchColor=RGB(165, 201, 44))
text = ColourSwatch(SwatchColor=RGB(0, 0, 0))
res_warm = ColourSwatch(SwatchColor=RGB(255, 251, 230))
text_new = ColourSwatch(SwatchColor=RGB(64, 64, 64))
off_cold = ColourSwatch(SwatchColor=RGB(230, 242, 255))
mcol = MeshColours(Mesh=mesh_5, Colours=offcolor)
mesh_6 = Mesh(mcol)

# ----
# Full site
panel_11 = Panel("""B,B,B,B,B,B,B,B,B,B,B,B,B,B,B,B,B,B,R,R,G,G,R,R,0,G,2,2,2,R,R,R,4,R,2,G,G,2,B,B,4,4,4,4
B,B,B,B,B,B,B,B,B,B,B,B,B,B,B,B,B,R,R,G,G,R,R,0,1,1,2,1,R,R,4,5,5,R,R,2,G,G,2,B,3,3,B,B
B,B,B,B,B,B,B,B,B,B,B,B,B,B,B,B,R,R,G,G,R,R,0,1,1,1,P,R,R,B,B,4,5,4,R,R,2,G,4,3,4,B,B,4
B,B,B,B,B,B,B,B,B,B,B,B,B,B,B,R,R,G,G,R,R,3,3,5,4,P,R,R,R,4,B,4,5,5,5,R,B,4,4,3,B,B,3,4
B,B,B,B,B,B,B,B,B,B,B,B,R,R,R,R,G,G,R,R,3,3,3,P,P,R,R,P,R,3,B,G,4,5,B,R,R,4,B,B,B,B,3,5
B,B,B,B,B,B,B,B,B,B,B,R,R,G,G,G,R,R,R,3,3,R,R,R,R,R,P,P,R,4,4,B,B,B,B,B,R,4,4,G,G,B,3,3
B,B,B,B,B,B,R,R,R,R,R,R,G,G,R,R,R,3,4,4,4,R,4,4,4,R,P,P,R,4,4,B,B,B,4,4,R,3,B,G,G,B,B,4
B,B,R,R,R,R,R,B,B,B,B,G,G,R,R,3,3,3,3,3,3,R,4,4,4,R,P,P,R,4,3,4,4,4,4,4,R,3,3,G,G,G,B,3
B,R,R,B,B,B,B,G,G,G,G,R,R,R,G,3,3,4,3,4,B,R,P,P,P,R,3,3,R,4,3,4,4,4,4,4,R,4,5,B,B,B,B,B
R,R,B,B,B,R,G,R,R,R,R,R,G,3,3,3,3,3,3,P,P,R,P,P,P,R,3,3,R,R,R,R,R,P,P,4,R,R,B,3,3,3,3,B
R,B,B,B,R,R,R,R,3,3,3,3,3,G,3,B,B,B,P,2,2,R,4,4,4,R,3,3,B,3,3,P,3,3,P,4,4,R,B,4,3,3,4,B
R,B,B,R,R,G,G,R,3,3,3,3,3,G,3,B,P,P,P,2,2,R,4,4,4,R,3,3,B,3,3,3,3,3,P,4,R,R,R,R,R,R,R,R
R,B,B,R,G,G,4,R,3,3,3,3,3,G,3,G,P,P,G,G,G,R,R,R,R,R,R,R,R,R,R,R,R,R,R,R,R,3,3,3,3,B,B,R
R,R,R,R,R,R,R,R,R,R,R,R,R,R,R,R,R,R,R,R,R,R,G,G,3,3,3,B,B,4,4,4,3,4,4,4,R,3,3,3,4,4,4,R
R,G,R,B,4,4,4,4,4,4,4,4,4,R,4,P,4,4,5,5,5,R,G,G,3,3,3,3,3,3,3,3,3,3,3,R,R,3,3,3,3,4,4,R
R,R,R,4,4,4,4,4,4,4,4,4,4,R,4,P,4,4,5,5,5,R,R,R,R,3,3,3,3,4,4,3,3,3,3,R,3,3,3,3,3,4,4,R
R,B,B,B,B,B,B,B,B,B,B,B,B,R,P,P,4,4,5,5,5,R,-1,-1,R,R,R,3,3,3,3,3,3,3,4,R,3,3,3,3,3,4,4,R
R,B,B,B,B,B,B,B,B,B,B,B,B,R,R,P,4,4,R,5,5,R,-1,-1,-1,-1,R,R,R,R,4,3,3,3,3,R,R,R,R,R,3,4,4,R
R,G,4,4,4,B,B,B,B,B,B,B,B,B,R,R,R,R,R,R,R,R,-1,-1,-1,-1,-1,-1,-1,R,R,R,R,R,4,R,4,4,4,R,R,R,R,R
R,G,4,4,4,4,4,B,B,B,B,B,B,B,0,1,3,3,0,0,R,-1,-1,-1,-1,-1,-1,-1,-1,-1,-1,-1,-1,R,R,R,R,4,4,B,4,4,4,R
R,G,4,4,4,B,B,B,B,B,B,B,B,B,0,0,4,4,1,1,R,-1,-1,-1,-1,-1,-1,-1,-1,-1,-1,-1,-1,-1,-1,-1,R,R,R,R,4,4,4,R
R,B,4,3,4,4,B,B,B,B,B,B,B,R,R,R,R,R,R,R,R,R,R,R,-1,-1,-1,-1,-1,-1,-1,-1,-1,-1,-1,4,4,R,G,R,R,R,G,R
R,G,3,3,4,4,B,B,B,B,B,4,3,R,B,B,B,B,B,R,0,1,0,R,R,-1,-1,-1,-1,-1,-1,-1,-1,-1,-1,4,4,R,G,R,4,R,R,R
R,G,3,3,4,4,B,4,B,B,B,4,3,R,B,B,B,B,B,R,0,0,0,1,R,R,-1,-1,-1,-1,-1,-1,-1,-1,4,4,R,R,4,R,4,4,4,R
R,R,R,R,R,R,R,R,R,R,R,R,R,R,R,R,R,R,R,R,0,B,B,0,0,R,-1,-1,-1,-1,-1,-1,-1,-1,4,4,R,4,4,R,B,B,B,R
R,G,4,4,4,4,4,4,R,3,3,3,R,R,R,3,3,3,3,R,0,1,B,B,0,R,-1,-1,-1,-1,-1,-1,-1,4,4,4,R,4,R,4,4,3,3,R
R,G,4,4,4,4,4,4,R,3,3,3,R,G,R,3,3,3,3,R,0,G,G,G,0,R,-1,-1,-1,-1,-1,-1,-1,4,4,R,4,4,R,3,3,3,3,R
R,G,4,4,4,4,4,4,R,3,3,3,R,G,R,4,4,5,5,R,0,0,1,0,0,R,-1,-1,-1,-1,-1,-1,-1,4,4,R,3,3,R,3,3,B,B,R
R,R,R,R,R,R,R,R,R,R,R,R,R,R,R,R,R,R,R,R,R,R,R,R,R,R,-1,-1,-1,-1,-1,-1,-1,4,4,R,3,R,R,G,G,G,G,R
R,3,4,3,3,4,3,4,R,3,4,3,3,4,3,4,3,4,R,-1,-1,-1,-1,-1,-1,-1,-1,-1,-1,-1,-1,-1,-1,4,4,R,4,R,3,3,4,4,4,R
R,4,3,3,4,3,3,3,R,B,3,3,4,3,3,3,3,3,R,-1,-1,-1,-1,-1,-1,-1,-1,-1,-1,-1,-1,-1,-1,4,G,R,G,R,4,3,3,R,R,R
R,R,R,R,R,R,R,R,R,R,R,R,R,R,R,R,R,R,R,R,R,R,R,R,R,R,R,R,R,R,R,R,R,R,R,R,R,R,R,R,R,R,G,G
R,G,4,G,4,G,3,3,R,1,0,1,0,0,0,0,0,R,4,5,3,3,4,4,4,R,1,1,1,1,1,1,R,G,G,G,G,G,G,G,R,R,R,G
4,P,4,4,4,P,3,3,R,1,0,1,0,0,0,0,0,R,G,G,G,G,G,G,3,R,1,1,1,1,1,1,R,1,1,1,0,1,1,1,R,4,R,R
P,P,4,P,P,P,3,3,R,1,0,1,0,1,0,1,0,R,4,5,3,3,4,4,3,R,0,1,0,1,1,1,R,0,1,0,1,0,1,0,R,4,4,4
R,R,R,R,R,R,R,R,R,R,R,R,R,R,R,R,R,R,R,R,R,R,R,R,R,R,R,R,R,R,R,R,R,R,R,R,R,R,R,R,R,P,4,4
4,G,B,B,B,4,4,4,R,G,G,G,G,G,G,G,R,P,G,4,4,P,P,P,P,R,4,4,4,4,P,P,R,1,1,4,4,4,1,1,R,P,P,5
4,G,4,B,B,4,B,B,R,G,G,G,G,G,G,G,R,P,G,4,3,4,4,4,4,R,4,4,4,P,P,P,R,0,1,4,4,4,1,0,R,P,P,4
4,G,4,B,B,4,4,4,R,P,P,P,P,3,P,P,R,P,G,4,4,4,4,4,4,R,4,4,4,P,P,P,R,0,1,4,4,4,1,0,R,P,P,4
4,R,R,R,R,R,R,R,R,3,3,3,3,3,P,R,R,R,R,R,R,R,R,R,R,R,R,R,R,R,R,R,R,R,R,R,R,R,R,R,R,P,P,4
4,P,P,4,4,4,4,4,R,3,3,3,3,3,P,R,4,P,4,4,4,4,4,4,4,R,G,4,4,4,4,4,R,1,0,1,0,1,0,1,R,P,P,4
4,P,4,P,4,4,4,4,R,3,3,3,P,P,3,R,4,4,P,P,4,4,P,4,4,R,4,4,4,P,P,4,R,0,1,0,1,0,1,0,R,P,P,P
R,R,R,R,R,R,R,R,R,R,R,R,R,R,R,R,R,R,R,R,R,R,R,R,R,R,R,R,R,R,R,R,R,R,R,R,R,R,R,R,R,P,P,P
R,1,0,1,2,G,G,1,R,1,G,G,G,1,R,1,1,1,0,0,1,1,1,1,1,R,1,2,1,1,0,1,R,1,G,G,G,G,G,G,R,P,P,P""")

# ---- group: Int Grid X Shift
number_slider_4 = Slider(11, range=1..44)

# ---- group: Int Grid Y Shift
number_slider_5 = Slider(13, range=1..44)

# ---- group: Int Grid X Extent
number_slider_6 = Slider(44, range=1..44)

# ---- group: Int Grid Y Extent
number_slider_7 = Slider(44, range=1..44)

# ----
load_bitmap_2 = LoadBitmap(FilePathToImageLocation=path_3)
merge_2 = Merge(Data1=_0_reslux, Data2=_1_resmed, Data3=_2_resmu, Data4=_3_comhq, Data5=_4_commed, Data6=_5_rescw)
res_warm_2 = ColourSwatch(SwatchColor=RGB(255, 250, 158))
off_cold_2 = ColourSwatch(SwatchColor=RGB(0, 123, 255))

# ---- group: all rotations
panel_12 = Panel("270,270,270,270,270,270,270,270,270,270,270,270,270,270,270,270,270,270,270,270,270,270,270,270,270,270,270,270,270,270,270,270,180,180,180,180,180,180,180,180,180,180,180,180,180,180,180,180,180,180,180,180,180,180,180,180,180,180,180,180,180,180,180,180,90,90,90,90,90,90,90,90,90,90,90,90,90,90,90,90,90,90,90,90,90,90,90,90,90,90,90,90,90,90,90,90,0,0,0,0,0,0,0,0,0,0,0,0,0,0,0,0,0,0,0,0,0,0,0,0,0,0,0,0,0,0,0,0")

# ---- group: dock position ref pts
pt_5 = Point([<point referenced from the Rhino model> x4])

# ---- group: webcam stream
bmp_2 = BitmapToModify(data)

# ---- group: Amenities
path_4 = FilePath("C:\Users\CPG\Dropbox\CityMatrix_Volpe\DATA\170127_Amenities\170201_Amenities_Volpe.PNG")  # disabled

# ---- group: tab
panel_13 = Panel("\t")

# ---- group: webcam stream
bmp_3 = BitmapToModify(data)

# ---- group: for calebration of camera position - select all in group and ctrl E / disable when not calibrating CV / CityMatrix CV Calibration
mesh_7 = MeshFromImage(Bmp=data, Sx=Domain(0, 1), Sy=Domain(0, 1), Z=0, C=True)  # disabled

# ---- group: Indicators
path_5 = FilePath("C:\Users\CPG\Dropbox\CityMatrix_Volpe\rz\Excel_Indicators_170124.PNG")  # disabled

# ----
res_warm_3 = ColourSwatch(SwatchColor=RGB(255, 239, 161))
off_cold_3 = ColourSwatch(SwatchColor=RGB(171, 212, 255))

# ---- group: gridExtent_y_s
int = Integer(number_slider_5)

# ---- group: gridExtent_x_s
int_2 = Integer(number_slider_4)

# ---- group: gridExtent_y
int_3 = Integer(number_slider_3)

# ----
multiplication = Multiplication(A=int_3, B=2)
int_4 = Integer(int_3)

# ---- group: y
series = Series(Start=0, Step=1, Count=int_4)

# ---- group: gridExtent_y
int_5 = Integer(number_slider_7)

# ---- group: dockID
int_6 = Integer(dockid)

# ---- group: gridExtent_x
int_7 = Integer(number_slider_2)

# ----
multiplication_2 = Multiplication(A=int_7, B=2)
perspective = Perspective(pt=pt, int_2=multiplication_2, int=multiplication)
int_8 = Integer(int_7)

# ---- group: keystoned grid pts
pt_6 = Point(perspective)

# ----
pshift = ShiftPaths(Data=pt_6, Offset=-1)

# ---- group: x
series_2 = Series(Start=0, Step=1, Count=int_8)

# ---- group: all sample pts
pt_7 = Point(pshift)

# ---- group: gridExtent_x
int_9 = Integer(number_slider_6)

# ---- group: floor num for each type
int_10 = Integer(merge_2)

# ----
multiplication_3 = Multiplication(A=series, B=4)

# ---- group: Group titles
txt_3 = Text(["Density", "Energy", "Proximity", "Diversity"])

# ----
sample = BitmapSampler(BitmapToModify=bmp_3, PointToSample=pt_7, BitmapToModify_2=bmp_3, PointToSample_2=pt_7, bitmap_filter=0)  # -> SampledImageData, SampledImageData_2
multiplication_4 = Multiplication(A=series_2, B=2)

# ---- group: for calebration of camera position - select all in group and ctrl E / disable when not calibrating CV
move = Move(Geometry=mesh_7, Motion=Vector(0, 0, -0.1))  # -> Geometry, Transform; disabled

# ----
txt_4 = Text(["Residential", "Employment", "Residential Employment Ratio", "3rd Places", "Cultural", "Educational"])
cull_i = CullIndex(List=txt_3, Indices=1, Wrap=True)
txt_5 = Text(["Residential", "Employment", "3rd Places (Day)", "3rd Places (Night)", "Cultural", "Co-working", "Educational"])
multiplication_5 = Multiplication(A=multiplication_3, B=int_4)
txt_6 = Text(["Parks", "Public Transportation", "Intersection Density", "Security", "Healthy Food", "Physical Activity", "Healthcare"])
load_bitmap_3 = LoadBitmap(FilePathToImageLocation=path_4)  # disabled
txt_7 = Text(["Building Energy Efficiency", "Embodied Building Energy", "Mobility Energy Efficiency", "Embodied Mobility Energy"])
subset = SubList(List=barcelona, Domain=Domain(7, 10), Wrap=True)  # -> List, Index
subset_2 = SubList(List=barcelona, Domain=Domain(18, 23), Wrap=True)  # -> List, Index

# ---- group: Relative Filepath
vb_2 = VBScript()  # -> out, A; same code as vb
panel_14 = Panel(vb_2.out)
panel_15 = Panel(vb_2.A)
split_2 = TextSplit(Text=panel_15, Separators="\")
shift_2 = ShiftList(List=split_2, Shift=-1, Wrap=False)
txt_8 = Text(flatten("Data\height_sets.txt"))
txt_9 = Text(flatten(shift_2))
join_2 = TextJoin(Text=flatten([txt_9, txt_8]), Join="\")
path_6 = FilePath(join_2)
panel_16 = Panel(path_6)

# ----
subset_3 = SubList(List=barcelona, Domain=Domain(0, 6), Wrap=True)  # -> List, Index
subset_4 = SubList(List=barcelona, Domain=Domain(11, 17), Wrap=True)  # -> List, Index
set2 = Button()
set1 = Button()
txt_10 = Text(txt_4)
txt_11 = Text(txt_5)
txt_12 = Text(txt_6)
txt_13 = Text(txt_7)

# ---- group: all radar chart titles
txt_14 = Text([txt_11, txt_13, txt_12, txt_10])

# ---- group: for calebration of camera position - select all in group and ctrl E / disable when not calibrating CV / moved down 0.1
mesh_8 = Mesh(move.Geometry)  # disabled

# ---- group: all sample color
col = Colour(sample.SampledImageData_2)

# ----
addition = Addition(A=multiplication_4, B=graft(multiplication_5))
lng = ListLength(List=txt_11)
lng_2 = ListLength(List=txt_13)
lng_3 = ListLength(List=txt_12)
lng_4 = ListLength(List=txt_10)
multiplication_6 = Multiplication(A=set2, B=2)
pshift_2 = ShiftPaths(Data=addition, Offset=-1)
multiplication_7 = Multiplication(A=int_8, B=2)
num = Number(subset_3.List)

# ---- group: Full site statistics / Full site IDs
int_11 = Integer([-1, -1, -1, -1, -1, -1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])

# ----
addition_2 = Addition(A=set1, B=multiplication_6)
int_12 = Integer([lng, lng_3, lng_4])
addition_3 = Addition(A=pshift_2, B=1)
addition_4 = Addition(A=pshift_2, B=multiplication_7)
txt_15 = Text(["4", "0", "1.01", "1.65", "1.01", "0", "1.07"])
txt_16 = Text(["2", "1.5", "2", "1.3"])
panel_17 = Panel("3rd Places (Night)")
txt_17 = Text(["4", "0", "1.2", "0.95", "1.5", "1.7"])
panel_18 = Panel("3rd Places (Day)")
txt_18 = Text(["1.01", "1.5", "1.02", "0.3", "0.7", "1.5", "0.6"])
panel_19 = Panel(addition_2)

# ---- group: set number
integer = Integer(panel_19)

# ----
txt_19 = Text(["3rd Places(Day)", "3rd Places(Night)", "Cultural", "Co-working", "Educational"])
num_2 = Number(txt_15)
num_3 = Number(txt_17)
num_4 = Number(txt_16)
num_5 = Number(txt_18)
addition_5 = Addition(A=addition_4, B=1)
txt_20 = Text(txt_19)

# ---- group: color ids
# Reference Color
panel_20 = Panel("0")
int_13 = Integer(panel_20)
int_14 = Integer("1")
int_15 = Integer("2")
panel_21 = Panel("3")  # disabled
int_16 = Integer(panel_21)  # disabled
panel_22 = Panel("4")  # disabled
int_17 = Integer(panel_22)  # disabled
panel_23 = Panel("5")  # disabled
# Closest Color Code
int_18 = Integer(panel_23)  # disabled

# ----
txt_21 = Text(["Hotel", "Restaurant", "Night Life", "Leisure & Wellness", "Culture", "Fashion", "Luxury Shopping", "Shopping Center", "Technology Store", "Market", "Bank", "Educational", "Post Office", "Co-Working"])
load_bitmap_4 = LoadBitmap(FilePathToImageLocation=path_5)

# ---- group: sample pts
item = ListItem(List=pt_7, Index=addition_4, Wrap=False)
item_2 = ListItem(List=pt_7, Index=pshift_2, Wrap=False)
item_3 = ListItem(List=pt_7, Index=addition_5, Wrap=False)
item_4 = ListItem(List=pt_7, Index=addition_3, Wrap=False)

# ----
addition_6 = Addition(A=item_2, B=item_3)
panel_24 = Panel("ignore")
txt_22 = Text(txt_21)

# ---- group: manual calibration / Sample White
pt_8 = Point(<point referenced from the Rhino model>)

# ---- group: manual calibration / Sample Black
pt_9 = Point(<point referenced from the Rhino model>)

# ---- group: manual calibration / Sample Blue
pt_10 = Point(<point referenced from the Rhino model>)  # disabled

# ---- group: manual calibration / Sample Green
pt_11 = Point(<point referenced from the Rhino model>)  # disabled

# ---- group: manual calibration / Sample Red
pt_12 = Point(<point referenced from the Rhino model>)

# ---- group: manual calibration / Sample Yellow
pt_13 = Point(<point referenced from the Rhino model>)  # disabled

# ----
slider_2_bldg_heights = Number()
merge_3 = Merge(Data1=int_13, Data2=int_14, Data3=int_15, Data4=int_16, Data5=int_17, Data6=int_18)
division = Division(A=addition_6, B=2)
pdecon = Deconstruct(Point=pt_8)  # -> XComponent, YComponent, ZComponent
pdecon_2 = Deconstruct(Point=pt_9)  # -> XComponent, YComponent, ZComponent
pdecon_3 = Deconstruct(Point=pt_12)  # -> XComponent, YComponent, ZComponent
pdecon_4 = Deconstruct(Point=pt_13)  # -> XComponent, YComponent, ZComponent
pdecon_5 = Deconstruct(Point=pt_10)  # -> XComponent, YComponent, ZComponent
pdecon_6 = Deconstruct(Point=pt_11)  # -> XComponent, YComponent, ZComponent
bnd = Bounds(Numbers=barcelona)

# ---- group: quart mid pts
pt_14 = Point(division)

# ----
frgb = ColourRGBF(Alpha=1, Red=pdecon.XComponent, Green=pdecon.YComponent, Blue=pdecon.ZComponent)
frgb_2 = ColourRGBF(Alpha=1, Red=pdecon_2.XComponent, Green=pdecon_2.YComponent, Blue=pdecon_2.ZComponent)
frgb_3 = ColourRGBF(Alpha=1, Red=pdecon_3.XComponent, Green=pdecon_3.YComponent, Blue=pdecon_3.ZComponent)
frgb_4 = ColourRGBF(Alpha=1, Red=pdecon_4.XComponent, Green=pdecon_4.YComponent, Blue=pdecon_4.ZComponent)
frgb_5 = ColourRGBF(Alpha=1, Red=pdecon_5.XComponent, Green=pdecon_5.YComponent, Blue=pdecon_5.ZComponent)
frgb_6 = ColourRGBF(Alpha=1, Red=pdecon_6.XComponent, Green=pdecon_6.YComponent, Blue=pdecon_6.ZComponent)
office_floors = Slider(3, range=0..5)
set = Slider(1, range=0..5)
retail_floors = Slider(1, range=0..5)

# ---- group: color ids
int_19 = Integer("0")
int_20 = Integer("1")
int_21 = Integer("2")
panel_25 = Panel("3")  # disabled
int_22 = Integer(panel_25)  # disabled
panel_26 = Panel("4")  # disabled
int_23 = Integer(panel_26)  # disabled
panel_27 = Panel("5")  # disabled
int_24 = Integer(panel_27)  # disabled

# ----
txt_23 = Text(["50", "49", "0.5", "0.5"])
txt_24 = Text(["15", "15", "15", "15", "10", "20", "10"])
num_6 = Number(expr("x/100.0", txt_24))
txt_25 = Text(["25", "25", "5", "15", "15", "15"])
txt_26 = Text(["5", "74", "18", "0.25", "1", "1", "0.75"])
num_7 = Number(expr("x/100.0", txt_23))
num_8 = Number(expr("x/100.0", txt_25))
num_9 = Number(expr("x/100.0", txt_26))
load_sets = Button()
save_sets = Button()
merge_4 = Merge(Data1=frgb, Data2=frgb_2, Data3=frgb_3, Data4=frgb_4, Data5=frgb_5, Data6=frgb_6)
remap = RemapNumbers(Value=barcelona, Source="0 To 40000", Target=Domain(0, 1))  # -> Mapped, Clipped
merge_5 = Merge(Data1=int_19, Data2=int_20, Data3=int_21, Data4=int_22, Data5=int_23, Data6=int_24)
num_10 = Number(expr("x/100.0", "30"))
cluster = Cluster_3(values=num, B=num_6, per_indicator=num_10)
panel_28 = Panel(cluster)

# ---- group: gridExtent_y
int_25 = Integer(int_3)

# ---- group: gridExtent_x
int_26 = Integer(int_7)

# ----
height_sets_txt = FilePath(path_6)
num_11 = Number(expr("x/100.0", "10"))
num_12 = Number(expr("x/100.0", "5"))
num_13 = Number(expr("x/100.0", "55"))
int_27 = Integer(python.a)
num_14 = Number(panel_9)
txt_27 = Text(["1.9", "0", "1.5", "0.5", "0.5", "0", "1.02"])
txt_28 = Text(["1.2", "1.15", "1.05", "1.15"])
txt_29 = Text(["1.1", "0", "1.01", "1.5", "1.01", "2"])
txt_30 = Text(["2", "1.3", "1.22", "2", "2", "1.02", "2"])

# ---- group: slider 2 - heatmap selection
# 0.2 - Work Prox.
# 0.3 - Home Prox.
# 0.4 - Park Prox.
number_slider_8 = Slider(0.2, range=0..1)

# ---- group: mask data
# Module ID Masking
panel_29 = Panel("""1,0,0,0,0,0,0,0,0,0,0,0,0,0
1,0,0,0,0,0,0,0,0,0,0,0,0,0
1,0,0,0,0,0,0,1,1,1,1,1,1,1
1,0,0,0,0,0,0,1,1,1,1,1,1,1
1,0,0,0,0,0,0,1,1,1,1,1,1,1
1,0,0,0,0,0,0,1,1,1,1,1,1,1
1,0,0,0,0,0,0,1,1,1,1,1,1,1
0,0,0,0,0,0,0,1,1,1,1,1,1,1
0,0,0,0,0,0,0,0,0,1,1,1,1,1
0,0,0,0,0,0,0,0,0,0,0,0,1,1
0,0,0,0,0,0,0,0,0,0,0,1,1,1
1,1,0,0,0,0,0,0,0,0,0,1,1,1
1,1,1,1,1,0,0,0,0,0,0,1,1,1
1,1,1,1,1,1,1,1,0,0,1,1,1,1""")

# ----
num_15 = Number(txt_27)
num_16 = Number(txt_29)
num_17 = Number(txt_28)
num_18 = Number(txt_30)
series_3 = Series(Start=0, Step=1, Count=int_26)
graft = GraftTree(Tree=series_3, IncludeEmptyLists=True, IncludeNullItems=True)
site_data_text_cleanup_replacement = SiteDataTextCleanupReplacement(T=panel_11)
multiplication_8 = Multiplication(A=int_26, B=int_25)
txt_31 = Text(["0.5", "0.5", "50", "49"])
txt_32 = Text(["2", "74", "18", "0.25", "2.75", "2", "1"])

# ---- group: All Colors IDs
merge_6 = Merge(Data1=merge_3, Data2=merge_5)

# ----
txt_33 = Text(["15", "15", "15", "10", "10", "20", "15"])
txt_34 = Text(["25", "25", "5", "15", "15", "15"])
repeat = RepeatData(Data=series_3, Length=multiplication_8)
num_19 = Number(expr("x/100.0", txt_31))
num_20 = Number(expr("x/100.0", txt_32))
repeat_2 = RepeatData(Data=graft, Length=int_25)
num_21 = Number(expr("x/100.0", txt_33))
num_22 = Number(expr("x/100.0", txt_34))
repeat_3 = RepeatData(Data=Slider(180, range=0..360), Length=multiplication_8)
num_23 = Number(expr("x/100.0", "30"))
num_24 = Number(expr("x/100.0", "10"))
cluster_2 = Cluster_3(values=num, B=num_21, per_indicator=num_24)
panel_31 = Panel(cluster_2)
num_25 = Number(expr("x/100.0", "5"))
num_26 = Number(expr("x/100.0", "55"))
textformating = TextFormating(txt=site_data_text_cleanup_replacement)
nullrep = ReplaceNulls(Items=number_slider_8, Replacements=0)  # -> Items, Count
pshift_3 = ShiftPaths(Data=repeat, Offset=-2)
pshift_4 = ShiftPaths(Data=repeat_2, Offset=-3)
min = Minimum(A=remap.Mapped, B=Slider(1, range=0..1))
panel_32 = Panel("4887")
panel_33 = Panel("20000")

# ---- group: all 0
pshift_5 = ShiftPaths(Data=repeat_3, Offset=-1)

# ---- group: all perfect colors
col_2 = Colour([ColourSwatch(SwatchColor=RGB(255, 255, 255)), ColourSwatch(SwatchColor=RGB(0, 0, 0)), ColourSwatch(SwatchColor=RGB(255, 0, 0))])

# ----
txt_35 = Text(["30", "20", "30", "20"])
txt_36 = Text(["1.3", "0", "0.95", "1.5", "2", "0", "0.6"])
txt_37 = Text(["5", "40", "25", "10", "5", "10", "5"])
txt_38 = Text(["0.7", "0.5", "0.75", "0.4"])
txt_39 = Text(["19", "19", "5", "19", "19", "19"])
txt_40 = Text(["1.01", "0", "0.5", "1.2", "1.78", "1.01"])
txt_41 = Text(["0.95", "0.02", "0.95", "1.25", "1.6", "1.7", "1.2"])
txt_42 = Text(["10", "10", "15", "15", "15", "20", "15"])
division_2 = Division(A="8000", B=3)
txt_43 = Text(["21000", division_2, "20000", "12000", "17500", "15000", "25000", "18000", "20000", "20000", "22000", "19000", "30000", "20000"])
int_28 = Integer(txt_43)
num_27 = Number(txt_36)
num_28 = Number(txt_40)
num_29 = Number(expr("x/100.0", txt_42))
num_30 = Number(txt_38)

# ---- group: All Manual Reference Colors
col_3 = Colour(merge_4)

# ----
num_31 = Number(txt_41)
num_32 = Number(expr("x/100.0", txt_35))
num_33 = Number(expr("x/100.0", txt_37))
num_34 = Number(expr("x/100.0", txt_39))

# ---- group: x
int_29 = Integer(pshift_3)

# ---- group: y
int_30 = Integer(pshift_4)

# ---- group: rotation
int_31 = Integer(pshift_5)

# ----
pt_15 = Point([<point referenced from the Rhino model> x2])
panel_34 = Panel("""1
1
1
1
1
1""")

# ---- group: Barcelona
num_35 = Number(min)

# ----
num_36 = Number(expr("x/100.0", "32"))
cluster_3 = Cluster_3(values=num, B=num_29, per_indicator=num_36)
panel_35 = Panel(cluster_3)
num_37 = Number(expr("x/100.0", "32"))
num_38 = Number(expr("x/100.0", "4"))
num_39 = Number(expr("x/100.0", "32"))

# ---- group: all sample color
col_4 = Colour(col)  # disabled

# ----
pdecon_7 = Deconstruct(Point=pt_15)  # -> XComponent, YComponent, ZComponent

# ---- group: all ref colors
col_5 = Colour(col_3)

col_6 = Colour(col_5)

# ----
cp = ClosestPoint(Point=col, Cloud=col_5)  # -> ClosestPoint, CPIndex, Distance
item_5 = ListItem(List=merge_6, Index=cp.CPIndex, Wrap=False)
item_6 = ListItem(List=col_5, Index=cp.CPIndex, Wrap=False)

# ---- group: color code of each smaple pt
int_32 = Integer(item_5)

# ---- group: color codes
item_7 = ListItem(List=int_32, Index=pshift_2, Wrap=False)
item_8 = ListItem(List=int_32, Index=addition_4, Wrap=False)
item_9 = ListItem(List=int_32, Index=addition_5, Wrap=False)
item_10 = ListItem(List=int_32, Index=addition_3, Wrap=False)

# ----
merge_7 = Merge(Data1=graft(item_7), Data2=graft(item_8), Data3=graft(item_9), Data4=graft(item_10))

# ---- group: color code quarts
int_33 = Integer(merge_7)

# ---- group: all ref colors
col_7 = Colour(col_5)  # disabled

# ----
txt_44 = Text(panel_29)
panel_37 = Panel(int_29)
panel_38 = Panel(int_30)
panel_39 = Panel(int_31)
pt_16 = Point([<point referenced from the Rhino model> x29])
frgb_7 = ColourRGBF(Alpha=1, Red=pdecon_7.XComponent, Green=pdecon_7.YComponent, Blue=pdecon_7.ZComponent)
txt_45 = Text(["3", "3", "25", "60", "2", "2", "5"])
txt_46 = Text(["40", "10", "40", "10"])
txt_47 = Text(["25", "20", "20", "20", "5", "5", "5"])
sample_2 = BitmapSampler(BitmapToModify=bmp_3, PointToSample=pt_16, BitmapToModify_2=bmp_3, PointToSample_2=pt_16, bitmap_filter=0)  # -> SampledImageData, SampledImageData_2
txt_48 = Text(["40", "30", "5", "10", "5", "10"])
num_40 = Number(expr("x/100.0", txt_47))
num_41 = Number(expr("x/100.0", txt_46))
num_42 = Number(expr("x/100.0", txt_45))
num_43 = Number(expr("x/100.0", txt_48))
num_44 = Number(expr("x/100.0", "25"))
cluster_4 = Cluster_3(values=num, B=num_40, per_indicator=num_44)
panel_40 = Panel(cluster_4)
num_45 = Number(expr("x/100.0", "37"))
num_46 = Number(expr("x/100.0", "1"))
num_47 = Number(expr("x/100.0", "37"))
txt_49 = Text(["0", "1.1", "0.7", "1.1", "0.9", "3", "1.05"])
txt_50 = Text(["1.05", "0.96", "1.02", "0.9"])
txt_51 = Text(["0", "2.2", "1.05", "1.2", "1.01", "1.05"])
col_8 = Colour(sample_2.SampledImageData_2)
txt_52 = Text(["0.5", "1.15", "1.1", "0.55", "0.35", "0.5", "0.35"])
num_48 = Number(txt_49)
num_49 = Number(txt_51)
txt_53 = Text(["10", "10", "10", "5", "25", "15", "25"])
txt_54 = Text(["25", "25", "25", "25"])
txt_55 = Text(["25", "20", "5", "10", "20", "20"])
num_50 = Number(txt_50)
txt_56 = Text(["15", "10", "10", "5", "25", "25", "10"])
num_51 = Number(txt_52)
num_52 = Number(expr("x/100.0", txt_55))
num_53 = Number(expr("x/100.0", txt_53))

# ---- group: Amenity Names
txt_57 = Text(txt_22)

# ----
num_54 = Number(expr("x/100.0", txt_54))
num_55 = Number(expr("x/100.0", txt_56))
num_56 = Number(expr("x/100.0", "48"))
num_57 = Number(expr("x/100.0", "45"))
num_58 = Number(expr("x/100.0", "6"))
cluster_5 = Cluster_3(values=num, B=num_53, per_indicator=num_58)
panel_41 = Panel(cluster_5)
num_59 = Number(expr("x/100.0", "1"))

# ---- group: floor height
panel_43 = Panel("1.0")

# ----
txt_58 = Text(["0", "0.9", "1.1", "0.18", "0.7", "0", "0.88"])
txt_59 = Text(["1.01", "0.5", "0.85", "0.75"])
txt_60 = Text(["0", "1.05", "0.7", "0.6", "0.9", "1.01"])
txt_61 = Text(["0.2", "1.03", "1.13", "1.1", "0.95", "0.75", "1.1"])
num_60 = Number(txt_58)
num_61 = Number(txt_60)
num_62 = Number(txt_59)
num_63 = Number(txt_61)

# ---- group: Meaning of Colors
# Text or Intermediate Steps Values
panel_45 = Panel("Output Values")

# ----
txt_62 = Text(["0", "0.8", "0.9", "0.8", "1.5", "0", "0.01"])
txt_63 = Text(["0.9", "0.35", "0.7", "0.5"])
txt_64 = Text(["0", "1.08", "0.8", "0.9", "1.25", "0.95"])
txt_65 = Text(["0.1", "0.12", "0.5", "1.02", "1.1", "1.1", "1.1"])
num_64 = Number(txt_62)
num_65 = Number(txt_64)
num_66 = Number(txt_63)
num_67 = Number(txt_65)

# ---- group: OL
num_68 = Number()

# ---- group: OM
num_69 = Number()

# ---- group: OS
num_70 = Number()

# ---- group: multipe for ppls
number_slider_9 = Slider(0.2, range=-0.01..2)

# ---- group: gridExtent_x
int_34 = Integer(int_7)

# ---- group: gridExtent_y
int_35 = Integer(int_3)

# ---- group: x
int_36 = Integer(int_29)

# ---- group: y
int_37 = Integer(int_30)

# ---- group: rotation
int_38 = Integer(int_31)

# ---- group: toggle1
bool = Boolean(False)

# ---- group: Slider 2
num_71 = Number(nullrep.Items)

# ---- group: module meshes lego ref: -1
mesh_9 = Mesh(mesh_4)

# ---- group: 3rd Places Icons: Restaurant, Grocery, Hotel
mesh_10 = Mesh(mesh_3)

# ----
remap_2 = RemapNumbers(Value=num_71, Source=Domain(0, 1), Target=Domain(0, 9))  # -> Mapped, Clipped
number_slider_10 = Slider(6, range=0..9)

# ---- group: Slider 2 remaped 0 to 9
int_39 = Integer(remap_2.Mapped)

# ----
equals = Equality(FirstNumber=int_39, SecondNumber=Slider(6, range=0..10))  # -> Equality, Inequality

# ---- group: normal or 3rd place view
bool_2 = Boolean(equals.Equality)

# ----
item_11 = ListItem(List=merge, Index=bool_2, Wrap=False)
pshift_6 = ShiftPaths(Data=item_11, Offset=-1)

# ---- group: module meshes lego ref: 0 to 5 - selected
mesh_11 = Mesh(pshift_6)

# ---- group: module meshes lego ref: 0 to 5
mesh_12 = Mesh(mesh_11)

mesh_13 = Mesh(mesh_12)

# ---- group: attractor pt - red line station
pt_17 = Point(<point referenced from the Rhino model>)

# ---- group: 3rd Places Icons: Restaurant, Grocery, Hotel
# 3rd Places View
mesh_14 = Mesh(mesh_10)

# ----
mid_mid_career = ColourSwatch(SwatchColor=RGB(255, 208, 0))
mln_young = ColourSwatch(SwatchColor=RGB(0, 166, 255))
exc_elderly = ColourSwatch(SwatchColor=RGB(255, 0, 0))

# ---- group: color or black 3rd places
number_slider_11 = Slider(1, range=0..1)

# ----
merge_8 = Merge(Data1=mln_young, Data2=mid_mid_career, Data3=exc_elderly)
lng_5 = ListLength(List=merge_8)
subtraction = Subtraction(A=lng_5, B=1)
dom = ConstructDomain(DomainStart=0, DomainEnd=subtraction)
black = ColourSwatch(SwatchColor=RGB(0, 0, 0))

# ---- group: total number control - crude
number_slider_12 = Slider(0.5, range=0..5)

# ----
panel_48 = Panel("1953 to 8337")

# ---- group: Relative Filepath
vb_3 = VBScript()  # -> out, A; same code as vb
panel_49 = Panel(vb_3.out)
panel_50 = Panel(vb_3.A)
split_3 = TextSplit(Text=panel_50, Separators="\")
shift_3 = ShiftList(List=split_3, Shift=-1, Wrap=False)
txt_66 = Text(flatten("Data\170101_Kendall_bg.jpg"))
txt_67 = Text(flatten(shift_3))
join_3 = TextJoin(Text=flatten([txt_67, txt_66]), Join="\")
path_7 = FilePath(join_3)
panel_51 = Panel(path_7)

# ---- group: module meshes lego ref: -1
mesh_15 = Mesh(mesh_9)

# ---- group: module meshes lego ref: 0 to 5
mesh_16 = Mesh(mesh_13)

# ---- group: Slider value
int_40 = Integer(int_39)

# ---- group: shrink
cell_shrink = Slider(0.32, range=0.15..1)

# ----
movetoorgin = MoveToOrgin(G=mesh_14, num=cell_shrink)

# ---- group: module meshes lego at orgin
mesh_17 = Mesh(movetoorgin)

# ----
lng_6 = ListLength(List=mesh_17)
subtraction_2 = Subtraction(A=lng_6, B=1)
dom_2 = ConstructDomain(DomainStart=0, DomainEnd=subtraction_2)

# ---- group: gridExtent_x
int_41 = Integer(int_34)

# ---- group: gridExtent_y
int_42 = Integer(int_35)

# ---- group: rotation
int_43 = Integer(int_38)

# ---- group: y
int_44 = Integer(int_37)

# ---- group: x
int_45 = Integer(int_36)

# ---- group: toggle1
bool_3 = Boolean(bool)

# ---- group: colortizer orgin
# LEGO Grid System
pt_18 = Point(<point referenced from the Rhino model>)

# ---- group: table size ref pt
pt_19 = Point(<point referenced from the Rhino model>)

# ---- group: module meshes lego ref: -1
mesh_18 = Mesh(mesh_4)

# ---- group: heatmap slider (0 to 5)
int_46 = Integer(int_39)

# ----
crv_3 = Curve(<curve referenced from the Rhino model>)
path_8 = FilePath("C:\Users\CPG\Dropbox (Changing Places)\CityMatrix_Volpe\DATA\3rdPlacesCor2.jpg")  # disabled
path_9 = FilePath(path_7)
path_10 = FilePath("C:\Users\CPG\Dropbox (Changing Places)\CityMatrix_Volpe\DATA\Kendall_bg_night2.jpg")  # disabled

# ---- group: all radar chart titles
txt_68 = Text(txt_14)

# ---- group: module meshes lego ref: 0 to 5
mesh_19 = Mesh(mesh_12)

# ----
panel_52 = Panel(path_9)
panel_53 = Panel(path_10)
panel_54 = Panel(path_8)
boundary = BoundarySurfaces(Edges=crv_3)
Z = UnitZ(Factor="0.01")
# Kendall Sat. Image
panel_55 = Panel(path_9)
move_2 = Move(Geometry=boundary, Motion=Z)  # -> Geometry, Transform
split_4 = TextSplit(Text=graft(txt_68), Separators=" ")
# Full site matrix
filter = StreamFilter(Gate=int_40, Stream1=mesh_18, Stream6=mesh_18)

# ---- group: dockRotation
int_47 = Integer(Slider(180, range=0..1000))

# ----
filter_2 = StreamFilter(Gate=int_40, Stream1=mesh_19, Stream6=mesh_19)

# ---- group: Slider 2 values
num_72 = Number(int_39)

# ----
join_4 = TextJoin(Text=split_4)
neg = Negative(Value=int_47)
txt_69 = Text(["Large Unit", "Medium Unit", "Small Unit", "Large Unit", "Medium Unit", "Small Unit"])
txt_70 = Text(["Residential", "Residential", "Residential", "Office", "Office", "Office"])
# Radar Chart (Carson)
panel_56 = Panel("""7
8
9
10""")
x_coordinate_of_graph = Slider(2200, range=0..3000)
window_height = Slider(1200, range=0..3000)
# Bar Chart
multiplication_9 = Multiplication(A=window_height, B=Slider(0.25, range=0..1))
number_slider_13 = Slider(0, range=-1000..2000)
number_slider_14 = Slider(300, range=0..1000)
window_width = Slider(2200, range=0..3000)
number_slider_15 = Slider(-200, range=-1000..2000)
swatch = ColourSwatch(SwatchColor=RGBA(0, 0, 0, 0))
number_slider_16 = Slider(8, range=0..100)
txt_71 = Text(flatten(join_4))
null = NullItem(Item=num_72)  # -> NullFlags, InvalidFlags, Description
pt_20 = Point(<point referenced from the Rhino model>)
panel_57 = Panel("""  Social
Wellbeing""")
panel_58 = Panel("""   Safety 
& Security""")
panel_59 = Panel("""Innovation
 Potential""")
panel_60 = Panel("""Building
 Energy""")
panel_61 = Panel("""Mobility
 Energy""")
pt_21 = Point(<point referenced from the Rhino model>)
vec2pt = Vector2Pt(PointA=Point(0, 0, 0), PointB=pt_20, Unitize=False)  # -> Vector, Length
y_coordinate_of_graph_w_i_screen = Number(multiplication_9)
cluster_6 = Cluster(B=pt_21)
pt_22 = Point(<point referenced from the Rhino model>)
filter_3 = StreamFilter(Gate=null.NullFlags, Stream0=num_72, Stream1=Slider(6, range=0..10))
cull_i_2 = CullIndex(List=txt_71, Indices=panel_56, Wrap=True)
panel_62 = Panel(cull_i_2)
filter_4 = StreamFilter(Gate=int_46, Stream0=move_2.Geometry)
filter_5 = StreamFilter(Gate=int_46, Stream0=path_9)
swatch_2 = ColourSwatch(SwatchColor=RGB(138, 138, 138))
swatch_3 = ColourSwatch(SwatchColor=RGB(255, 255, 255))
pt_23 = ConstructPoint(XCoordinate=x_coordinate_of_graph, YCoordinate=expr("x*(-1)", y_coordinate_of_graph_w_i_screen), ZCoordinate=0)
int_48 = Integer(filter_3)
movetoorgin_2 = MoveToOrgin(G=filter, num=cell_shrink)  # disabled
movetoorgin_3 = MoveToOrgin(G=filter_2, num=cell_shrink)  # disabled
txt_72 = Text([panel_60, panel_61, panel_59, panel_58, panel_57])

# ---- group: Slider end point
pt_24 = Point(<point referenced from the Rhino model>)

# ---- group: Slider start point
pt_25 = Point(<point referenced from the Rhino model>)

# ----
equals_2 = Equality(FirstNumber=int_48, SecondNumber=Slider(4, range=0..10))  # -> Equality, Inequality
equals_3 = Equality(FirstNumber=int_48, SecondNumber=Slider(3, range=0..10))  # -> Equality, Inequality
equals_4 = Equality(FirstNumber=int_48, SecondNumber=Slider(9, range=0..10))  # -> Equality, Inequality
equals_5 = Equality(FirstNumber=int_48, SecondNumber=Slider(5, range=0..10))  # -> Equality, Inequality
equals_6 = Equality(FirstNumber=int_48, SecondNumber=Slider(2, range=0..10))  # -> Equality, Inequality
equals_7 = Equality(FirstNumber=int_48, SecondNumber=Slider(6, range=0..10))  # -> Equality, Inequality
equals_8 = Equality(FirstNumber=int_48, SecondNumber=Slider(8, range=0..10))  # -> Equality, Inequality
equals_9 = Equality(FirstNumber=int_48, SecondNumber=Slider(7, range=0..10))  # -> Equality, Inequality
equals_10 = Equality(FirstNumber=int_48, SecondNumber=Slider(1, range=0..1))  # -> Equality, Inequality
equals_11 = Equality(FirstNumber=int_48, SecondNumber=Slider(0, range=0..1))  # -> Equality, Inequality
labels_for_bars = Panel(txt_72)
ln = Line(StartPoint=pt_25, EndPoint=pt_24)

# ---- group: module meshes lego at orgin
mesh_20 = Mesh(movetoorgin_3)  # disabled

# ----
filter_6 = StreamFilter(Gate=equals_3.Equality, Stream0=swatch_2, Stream1=swatch_3)
filter_7 = StreamFilter(Gate=equals_2.Equality, Stream0=swatch_2, Stream1=swatch_3)
filter_8 = StreamFilter(Gate=equals_4.Equality, Stream0=swatch_2, Stream1=swatch_3)
filter_9 = StreamFilter(Gate=equals_5.Equality, Stream0=swatch_2, Stream1=swatch_3)
filter_10 = StreamFilter(Gate=equals_7.Equality, Stream0=swatch_2, Stream1=swatch_3)

# ---- group: module meshes lego at orgin
mesh_21 = Mesh(movetoorgin_2)  # disabled

# ----
filter_11 = StreamFilter(Gate=equals_8.Equality, Stream0=swatch_2, Stream1=swatch_3)
filter_12 = StreamFilter(Gate=equals_9.Equality, Stream0=swatch_2, Stream1=swatch_3)
filter_13 = StreamFilter(Gate=equals_6.Equality, Stream0=swatch_2, Stream1=swatch_3)
panel_63 = Panel("0")  # disabled
filter_14 = StreamFilter(Gate=equals_10.Equality, Stream0=swatch_2, Stream1=swatch_3)
filter_15 = StreamFilter(Gate=equals_11.Equality, Stream0=swatch_2, Stream1=swatch_3)

# ---- group: Dashboard Text Size 2
size = Slider(13.5, range=0..100)
num_73 = Number(size)

# ---- group: Dashboard Text Size 1
size_2 = Slider(15, range=0..100)
num_74 = Number(size_2)

# ----
ttl_min = Slider(60, range=0..100)
type_min = Slider(20, range=0..100)

res_warm_4 = ColourSwatch(SwatchColor=RGB(255, 246, 204))
off_cold_4 = ColourSwatch(SwatchColor=RGB(204, 229, 255))

# ---- group: Dashboard Text Color
color = ColourSwatch(SwatchColor=RGB(201, 201, 201))
col_9 = Colour(color)

# ----
number_slider_17 = Slider(250, range=0..1000)

# ---- group: for calebration of camera position - select all in group and ctrl E
previewmat = CustomPreviewMaterials(
    Geometry=filter_4,
    DiffuseColor=ColourSwatch(SwatchColor=RGB(255, 255, 255)),
    Transparency=Slider(0.01, range=0..1),
    DiffuseBitmap=filter_5)

# ----
divide = DivideCurve(Curve=ln, Count=Slider(9, range=0..10), Kinks=False)  # -> Points, Tangents, Parameters
item_12 = ListItem(List=divide.Points, Index=9, Wrap=True)
item_13 = ListItem(List=divide.Points, Index=8, Wrap=True)
item_14 = ListItem(List=divide.Points, Index=6, Wrap=True)
item_15 = ListItem(List=divide.Points, Index=7, Wrap=True)
item_16 = ListItem(List=divide.Points, Index=5, Wrap=True)
item_17 = ListItem(List=divide.Points, Index=4, Wrap=True)
item_18 = ListItem(List=divide.Points, Index=3, Wrap=True)
item_19 = ListItem(List=divide.Points, Index=2, Wrap=True)
item_20 = ListItem(List=divide.Points, Index=1, Wrap=True)
item_21 = ListItem(List=divide.Points, Index=0, Wrap=True)
panel_64 = Panel("-1")  # disabled
cluster_7 = Cluster(B=item_14)
cluster_8 = Cluster(B=item_12)
cluster_9 = Cluster(B=item_16)
cluster_10 = Cluster(B=item_15)
cluster_11 = Cluster(B=item_13)
cluster_12 = Cluster(B=item_17)
cluster_13 = Cluster(B=item_20)
cluster_14 = Cluster(B=item_19)
cluster_15 = Cluster(B=item_21)
cluster_16 = Cluster(B=item_18)
tag = TextTag3D(Location=cluster_7, Text="Amenities", Size=number_slider_16, Colour=filter_10, Justification=4)
tag_2 = TextTag3D(Location=cluster_8, Text="PEV Traffic", Size=number_slider_16, Colour=filter_8, Justification=4)
tag_3 = TextTag3D(Location=cluster_12, Text="Park Prox.", Size=number_slider_16, Colour=filter_7, Justification=4)
tag_4 = TextTag3D(Location=cluster_9, Text="Agents", Size=number_slider_16, Colour=filter_9, Justification=4)
tag_5 = TextTag3D(Location=cluster_10, Text="Coll. Potential", Size=number_slider_16, Colour=filter_12, Justification=4)
tag_6 = TextTag3D(Location=cluster_11, Text="Car Traffic", Size=number_slider_16, Colour=filter_11, Justification=4)
tag_7 = TextTag3D(Location=cluster_14, Text="Work Prox.", Size=number_slider_16, Colour=filter_13, Justification=4)
tag_8 = TextTag3D(Location=cluster_16, Text="Home Prox. ", Size=number_slider_16, Colour=filter_6, Justification=4)
tag_9 = TextTag3D(Location=cluster_13, Text="Building Types", Size=number_slider_16, Colour=filter_14, Justification=4)
tag_10 = TextTag3D(Location=cluster_15, Text="Site Image", Size=number_slider_16, Colour=filter_15, Justification=4)
num_75 = Number(number_slider_17)
dom_3 = ConstructDomain(DomainStart=Slider(0, range=0..100), DomainEnd=num_75)
dom_4 = ConstructDomain(DomainStart=0, DomainEnd=num_75)

# ---- group: park cell #
park_cell = Slider(150, range=0..150)

# ----
lng_7 = ListLength(List=cull_i_2)
dedomain = DeconstructDomain(Domain=dom_4)  # -> Start, End
# Population Matrix - New
pt_26 = Point(<point referenced from the Rhino model>)
num_76 = Number(num_74)
col_10 = Colour(res_warm_4)
pt_27 = Point(<point referenced from the Rhino model>)
num_77 = Number(num_74)
pt_28 = Point(<point referenced from the Rhino model>)
num_78 = Number(num_74)
col_11 = Colour(res_warm_4)
pt_29 = Point(<point referenced from the Rhino model>)
num_79 = Number(num_74)
col_12 = Colour(res_warm_4)
col_13 = Colour(res_warm_4)

# ---- group: parking cell #
parking_cell = Slider(0, range=0..50)

# ----
bool_4 = Boolean(Toggle(False))
swatch_4 = ColourSwatch(SwatchColor=RGB(86, 120, 32))  # disabled
pt_30 = Point(<point referenced from the Rhino model>)
num_80 = Number(num_74)
col_14 = Colour(off_cold_4)
Z_2 = UnitZ(Factor=0.1)  # disabled
pt_31 = Point(<point referenced from the Rhino model>)
num_81 = Number(num_74)
pt_32 = Point(<point referenced from the Rhino model>)
num_82 = Number(num_74)
col_15 = Colour(off_cold_4)
col_16 = Colour(off_cold_4)
pt_33 = Point(<point referenced from the Rhino model>)
num_83 = Number(num_74)
col_17 = Colour(off_cold_4)

# ---- group: Amenities ref pt
pt_34 = Point(<point referenced from the Rhino model>)

# ----
filter_16 = StreamFilter(
    Gate=int_40,
    Stream0=bool_4,
    Stream1=bool_4,
    Stream2=bool_4,
    Stream3=bool_4,
    Stream4=bool_4,
    Stream5=bool_4,
    Stream6=bool_4,
    Stream7=bool_4,
    Stream8=bool_4,
    Stream9=Toggle(True))

# ---- group: Background grid
number_slider_18 = Slider(6, range=0..100)
division_3 = Division(A=number_slider_14, B=number_slider_18)
polygon = Polygon(Plane=pt_23, Radius=number_slider_14, Segments=Slider(63, range=0..100), FilletRadius=Slider(4, range=0..10))  # -> Polygon, Length
series_4 = Series(Start=0, Step=division_3, Count=number_slider_18)
cull_i_3 = CullIndex(List=series_4, Indices=Slider(0, range=0..100), Wrap=True)
number_slider_19 = Slider(223, range=0..1000)
swatch_5 = ColourSwatch(SwatchColor=RGB(87, 87, 87))
polygon_2 = Polygon(Plane=pt_23, Radius=cull_i_3, Segments=Slider(63, range=0..100), FilletRadius=Slider(4, range=0..10))  # -> Polygon, Length

# ----
pt_35 = Point(<point referenced from the Rhino model>)

# ---- group: mask setting
swatch_6 = ColourSwatch(SwatchColor=RGBA(0, 0, 0, 185))

# ----
number_slider_20 = Slider(1, range=0..10)
multiplication_10 = Multiplication(A="8500", B=number_slider_20)

# ---- group: dockID
int_49 = Integer()

# ---- group: ref mask srf - R
srf = Surface(<surface referenced from the Rhino model>)

# ---- group: ref mask srf - RM
srf_2 = Surface(<surface referenced from the Rhino model>)

# ---- group: ref mask srf - bar live
srf_3 = Surface(<surface referenced from the Rhino model>)

# ---- group: ref mask srf - RS
srf_4 = Surface(<surface referenced from the Rhino model>)

# ---- group: ref mask srf - RL
srf_5 = Surface(<surface referenced from the Rhino model>)

# ----
pt_36 = Point([Point(947.3283196, 388.9989554, 0), Point(768.7886048, 388.9989554, 0), Point(679.5187474, 388.9989554, 0), Point(612.5663543, 388.9989554, 0), Point(947.3283196, 455.9513484, 0), Point(768.7886048, 455.9513484, 0)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])

# ---- group: intersections
crossings = Point(pt_36)

# ---- group: traffic mode is PEV
bool_5 = Boolean(filter_16)

# ----
multiplication_11 = Multiplication(A=bool_5, B="-0.7")
panel_65 = Panel(int_12)

# ---- group: Background grid / plots
preview_2 = CustomPreview(Geometry=[polygon.Polygon, polygon_2.Polygon], Shader=swatch_5)

# ---- group: Relative Filepath
vb_4 = VBScript()  # -> out, A; same code as vb
panel_66 = Panel(vb_4.out)
panel_67 = Panel(vb_4.A)
split_5 = TextSplit(Text=panel_67, Separators="\")
shift_4 = ShiftList(List=split_5, Shift=-1, Wrap=False)
txt_73 = Text(flatten("Data\BLACK.png"))
txt_74 = Text(flatten(shift_4))
join_5 = TextJoin(Text=flatten([txt_74, txt_73]), Join="\")
path_11 = FilePath(join_5)
panel_68 = Panel(path_11)

# ---- group: mask settings
swatch_7 = ColourSwatch(SwatchColor=RGB(0, 0, 0))
panel_69 = Panel(".35")
path_12 = FilePath(path_11)

# ---- group: ref mask srf - O
srf_6 = Surface(<surface referenced from the Rhino model>)

# ---- group: ref mask srf - OM
srf_7 = Surface(<surface referenced from the Rhino model>)

# ---- group: ref mask srf - bar work
srf_8 = Surface(<surface referenced from the Rhino model>)

# ---- group: ref mask srf - OS
srf_9 = Surface(<surface referenced from the Rhino model>)

# ---- group: ref mask srf - OL
srf_10 = Surface(<surface referenced from the Rhino model>)

# ---- group: balance two colors
number_slider_21 = Slider(0.8, range=0..1)

# ---- group: v sep ln length
number_slider_22 = Slider(16, range=10..20)

# ----
subtraction_3 = Subtraction(A=1, B=number_slider_21)
road_2 = ColourSwatch(SwatchColor=RGB(64, 64, 64))

# ---- group: gh ref pt end
pt_37 = Point(<point referenced from the Rhino model>)

# ---- group: gh ref pt start
pt_38 = Point(<point referenced from the Rhino model>)

# ---- group: bar diagram ppl range
domain = Domain("0 to 4000000")

# ----
argb = SplitARGB(Colour=road_2)  # -> Alpha, Red, Green, Blue
vec = VectorXYZ(XComponent=argb.Red, YComponent=argb.Green, ZComponent=argb.Blue)  # -> Vector, Length
multiplication_12 = Multiplication(A=vec.Vector, B=subtraction_3)
pt_39 = Point(pt_23)

# ---- group: h sep ln
ln_2 = Line(StartPoint=pt_38, EndPoint=pt_37)

# ----
shift_5 = ShiftList(List=cull_i, Shift=3, Wrap=True)
equals_12 = Equality(FirstNumber=int_40, SecondNumber=1)  # -> Equality, Inequality
equals_13 = Equality(FirstNumber=int_40, SecondNumber=1)  # -> Equality, Inequality
equals_14 = Equality(FirstNumber=int_40, SecondNumber=0)  # -> Equality, Inequality
layers = CreateModifyLayers(LayerName="building mesh - outer site", Visibility=equals_12.Equality, DeleteLayer=False, enableFullPath=False)  # -> LayerNames, LayerFullPath
layers_2 = CreateModifyLayers(LayerName="human dots - outer site", Visibility=equals_13.Equality, DeleteLayer=False, enableFullPath=False)  # -> LayerNames, LayerFullPath
layers_3 = CreateModifyLayers(LayerName="roads - outer site", Visibility=equals_14.Inequality, DeleteLayer=False, enableFullPath=False)  # -> LayerNames, LayerFullPath

# ---- group: traffic heatmap / road traffic lego
mesh_22 = Mesh()

# ---- group: gridExtent_x
# Send to Unity (json)
int_50 = Integer(int_34)

# ----
number_slider_23 = Slider(0, range=0..100)
subtraction_4 = Subtraction(A=int_50, B=1)
int_51 = Integer(int_36)

# ---- group: 3D building site move amount
# 3D City Grid System
panel_70 = Panel("10000")
X_2 = UnitX(Factor=panel_70)

# ----
subtraction_5 = Subtraction(A=subtraction_4, B=int_51)
txt_75 = Text(int_38)
txt_76 = Text(subtraction_5)
txt_77 = Text(int_37)
int_52 = Integer(number_slider_23)
int_53 = Integer(int_39)
int_54 = Integer(number_slider_23)
int_55 = Integer(number_slider_23)
txt_78 = Text(int_53)
txt_79 = Text(int_55)
txt_80 = Text(int_52)
txt_81 = Text(int_54)
panel_71 = Panel("0")  # disabled
panel_72 = Panel("5")  # disabled
number_slider_24 = Slider(0.015, range=0..1)  # disabled
slider_value = Integer(int_39)
slider_value_2 = Integer(int_39)
filter_17 = StreamFilter(Gate=slider_value_2, Stream1=Toggle(True))
multiplication_13 = Multiplication(A=4682, B=number_slider_24)  # disabled
bool_6 = Boolean(False)  # disabled
multiplication_14 = Multiplication(A=8932, B=number_slider_24)  # disabled
slider_value_3 = Integer(int_39)  # disabled
multiplication_15 = Multiplication(A=10499, B=number_slider_24)  # disabled
filter_18 = StreamFilter(
    Gate=slider_value_3,
    Stream0=bool_6,
    Stream1=bool_6,
    Stream2=bool_6,
    Stream3=bool_6,
    Stream4=bool_6,
    Stream6=bool_6,
    Stream7=bool_6,
    Stream8=bool_6,
    Stream9=bool_6)  # disabled
button = Button()
# Human Interation @ Lego - Outside
whole_site_t_active_site_f = BooleanToggle(False)
# mid
number_slider_25 = Slider(55, range=0..100)
# old
number_slider_26 = Slider(23, range=0..100)

# ---- group: influence range
# Proximity (Walkability) to Offices
range_count = Slider(30, range=1..80)

# ---- group: heat map mesh z position
number_slider_27 = Slider(2.1, range=0..10)

# ---- group: shrink
cell_shrink_2 = Slider(1, range=0.15..1)

# ---- group: heatmap slider (0 to 5)
int_56 = Integer(int_39)

# ---- group: ppl per flr
# id5
# id3
# id4
# id0
# id2
# id1
# young
# mid
# old
panel_73 = Panel("0")
num_84 = Number(["0", "7", "0", "0", "10", "0"])
num_85 = Number(["6", "0", "0", "9", "0", "0"])
num_86 = Number([panel_73, "0", "8", "0", "0", "11"])

# ----
range_count_2 = Slider(49, range=1..80)

# ---- group: textured buildings
# C:\Users\RYAN\Documents\GitHub\CityMatrix\Map\PEV_PSG AND PKG_300DPI.png
panel_74 = Panel("0.01")  # disabled
swatch_8 = ColourSwatch(SwatchColor=RGB(255, 255, 255))  # disabled

# ----
pt_40 = ConstructPoint(XCoordinate=Slider(0, range=0..10), YCoordinate=Slider(0, range=-30..0), ZCoordinate=Slider(0, range=0..10))

# ---- group: infulence range - # nearest
range_count_3 = Slider(30, range=1..80)

# ---- group: range
B = DomainEnd(Slider(200, range=0..500))

B_2 = DomainEnd(Slider(120, range=0..500))

B_3 = DomainEnd(Slider(75, range=0..500))

# ----
xy = XYPlane(Origin=pt_40)

# ---- group: heat map mesh z position
num_87 = Number(number_slider_27)

# ----
equals_15 = Equality(FirstNumber=int_56, SecondNumber="3")  # -> Equality, Inequality

# ---- group: heat map mesh z position
num_88 = Number(number_slider_27)

num_89 = Number(number_slider_27)

num_90 = Number(number_slider_27)

# ----
Z_3 = UnitZ(Factor=num_88)
Z_4 = UnitZ(Factor=num_89)
dom_5 = ConstructDomain(DomainStart=0, DomainEnd=B)
dom_6 = ConstructDomain(DomainStart=0, DomainEnd=B_2)
dom_7 = ConstructDomain(DomainStart=0, DomainEnd=B_3)

# ---- group: show heatmap or not
bool_7 = Boolean(equals_15.Equality)

# ----
pt_41 = ConstructPoint(XCoordinate=0, YCoordinate=0, ZCoordinate=num_87)

# ---- group: multipe for ppls
number_slider_28 = Slider(0.2, range=-0.01..2)

# ----
multiplication_16 = Multiplication(A=num_86, B=number_slider_28)
multiplication_17 = Multiplication(A=num_84, B=number_slider_28)
multiplication_18 = Multiplication(A=num_85, B=number_slider_28)
num_91 = Number(multiplication_16)
num_92 = Number(multiplication_17)
num_93 = Number(multiplication_18)

# ---- group: reduce ratio
number_slider_29 = Slider(0.25, range=0..1)

# ---- group: heatmap opacity
number_slider_30 = Slider(0.7, range=0..1)

# ----
number_slider_31 = Slider(0.2, range=0..1)
number_slider_32 = Slider(0.2, range=0..1)
number_slider_33 = Slider(0.2, range=0..1)
mid_mid_career_2 = ColourSwatch(SwatchColor=RGB(255, 208, 0))
mln_young_2 = ColourSwatch(SwatchColor=RGB(0, 166, 255))
exc_elderly_2 = ColourSwatch(SwatchColor=RGB(255, 0, 0))

# ---- group: dot shape
polygon_3 = Polygon(Plane=PlaneXY(0, 0, 0), Radius=Slider(2.1, range=0..10), Segments=Slider(9, range=0..10), FilletRadius=0)  # -> Polygon, Length
boundary_2 = BoundarySurfaces(Edges=polygon_3.Polygon)
mesh_23 = Mesh(boundary_2)

# ----
mesh_24 = Mesh(mesh_23)
mesh_25 = Mesh(mesh_23)
mesh_26 = Mesh(mesh_23)

# ---- group: toggle2
bool_8 = Boolean(True)

# ----
Z_5 = UnitZ(Factor=1)
panel_75 = Panel("0.1 To 1.0")

# ---- group: Relative Filepath
vb_5 = VBScript()  # -> out, A; same code as vb
panel_76 = Panel(vb_5.out)
panel_77 = Panel(vb_5.A)
split_6 = TextSplit(Text=panel_77, Separators="\")
shift_6 = ShiftList(List=split_6, Shift=-1, Wrap=False)
txt_82 = Text(flatten("Data\Chart\Diversity Formular.PNG"))
txt_83 = Text(flatten(shift_6))
join_6 = TextJoin(Text=flatten([txt_83, txt_82]), Join="\")
path_13 = FilePath(join_6)
panel_78 = Panel(path_13)

# ---- group: infulence range - # nearby
range_count_4 = Slider(25, range=1..49)

# ---- group: Diversity Formular
# Residential Diversity
panel_79 = Panel("CityMatrix_Volpe\rz\Diversity Formular.PNG")
path_14 = FilePath(path_13)
panel_80 = Panel(path_14)
load_bitmap_5 = LoadBitmap(FilePathToImageLocation=path_14)

# ----
# Residential to Office Diversity
panel_81 = Panel("5")

# ---- group: heatmap opacity
number_slider_34 = Slider(0.7, range=0..1)

# ---- group: note: none of P1, P2, or P3 could be 0 !!!
panel_83 = Panel("(P1*log10(P1)+P2*log10(P2)) / log10(2) * (-1)")

# ---- group: prevent 0
panel_84 = Panel(".000001")

# ---- group: note: none of P1, P2, or P3 could be 0 !!!
panel_85 = Panel("(P1*log10(P1)+P2*log10(P2)+P3*log10(P3)) / log10(3) * (-1)")

# ---- group: prevent 0
panel_86 = Panel(".000001")

# ---- group: note: none of P1, P2, or P3 could be 0 !!!
panel_87 = Panel("(P1*log10(P1)+P2*log10(P2)+P3*log10(P3)) / log10(3) * (-1)")

# ---- group: prevent 0
panel_88 = Panel(".000001")

# ---- group: heatmap value (0.0-1.0:bad-good)
num_94 = Number()  # disabled

# ----
gradient = Gradient(
    LowerLimit=0,
    UpperLimit=1,
    Parameter=num_94,
    stops=[0.0851: RGB(255, 0, 0), 0.337: RGB(255, 255, 0), 0.743: RGB(0, 130, 0), 0.801: RGB(0, 0, 0)])  # disabled
gradient_2 = Gradient(
    LowerLimit=0,
    UpperLimit=1,
    Parameter=num_94,
    stops=[0.0451: RGB(255, 0, 0), 0.375: RGB(255, 255, 0), 0.694: RGB(0, 128, 0)])  # disabled
gradient_3 = Gradient(
    LowerLimit=0,
    UpperLimit=1,
    Parameter=num_94,
    stops=[0.157: RGB(255, 0, 0), 0.444: RGB(255, 255, 0), 0.748: RGB(0, 128, 0), 0.932: RGB(0, 0, 0)])  # disabled
gradient_4 = Gradient(LowerLimit=0, UpperLimit=1, Parameter=num_94, stops=[0: RGB(255, 0, 0), 0.5: RGB(255, 255, 0), 0.999: RGB(0, 128, 0)])  # disabled
gradient_5 = Gradient(LowerLimit=0, UpperLimit=1, Parameter=num_94, stops=[0: RGB(255, 0, 0), 0.5: RGB(255, 255, 0), 0.999: RGB(0, 128, 0)])  # disabled
filter_19 = StreamFilter(Gate=0, Stream1=gradient, Stream2=gradient_3, Stream3=gradient_2, Stream4=gradient_5, Stream5=gradient_4)  # disabled
num_95 = Number("1.0")
num_96 = Number("0.0")
num_97 = Number("0.0")
num_98 = Number("1.0")
num_99 = Number("1.0")
num_100 = Number("0.0")
num_101 = Number(".4")
num_102 = Number(".1")
num_103 = Number(".4")
num_104 = Number("1.2")
num_105 = Number("0.4")

pdecon_8 = Deconstruct(Point=pt_4)  # -> XComponent, YComponent, ZComponent
pt_42 = Point([pt_3, pt_2])
frgb_8 = ColourRGBF(Alpha=1, Red=pdecon_8.XComponent, Green=pdecon_8.YComponent, Blue=pdecon_8.ZComponent)
flip = FlipMatrix(Data=pt_42)
num_106 = Number(number_slider)
slider_color_reference = Colour(frgb_8)
pline_2 = PolyLine(Vertices=flip, Closed=False)  # -> reparameterize(Polyline)
argb_2 = SplitARGB(Colour=slider_color_reference)  # -> Alpha, Red, Green, Blue
panel_92 = Panel(flip)
preview_3 = CustomPreview(Geometry=pline_2, Shader=ColourSwatch(SwatchColor=RGB(255, 0, 230)))
divide_2 = DivideCurve(Curve=pline_2, Count=Slider(50, range=9..99), Kinks=False)  # -> Points, Tangents, Parameters
pt_43 = ConstructPoint(XCoordinate=argb_2.Red, YCoordinate=argb_2.Green, ZCoordinate=argb_2.Blue)
number_slider_35 = Slider(0.5, range=0..1)
color_space_visualization = Panel(" ")  # disabled

# ---- group: slider sample pts
pt_44 = Point(divide_2.Points)

# ---- group: ref color sphere center
reference_colors = Colour(slider_color_reference)  # disabled

# ----
number_slider_36 = Slider(300, range=0..1000)  # disabled
pop2d = Populate2D(Region=crv_2, Count=number_slider_36, Seed=1)  # disabled
sample_3 = BitmapSampler(BitmapToModify=bmp, PointToSample=pop2d, BitmapToModify_2=bmp, PointToSample_2=pop2d, bitmap_filter=0)  # -> SampledImageData, SampledImageData_2; disabled
argb_3 = SplitARGB(Colour=reference_colors)  # -> Alpha, Red, Green, Blue; disabled
range = Range(Domain=Domain(0, 1), Steps=10)  # disabled
pt_45 = ConstructPoint(XCoordinate=argb_3.Red, YCoordinate=argb_3.Green, ZCoordinate=argb_3.Blue)  # disabled
graft_2 = GraftTree(Tree=range, IncludeEmptyLists=True, IncludeNullItems=True)  # disabled
sph = Sphere(Base=pt_45, Radius=num_106)  # disabled
pt_46 = ConstructPoint(XCoordinate=range, YCoordinate=graft_2, ZCoordinate=0)  # disabled
Z_6 = UnitZ(Factor=range)  # disabled
color_reference = CustomPreview(Geometry=sph, Shader=reference_colors)  # disabled
pshift_7 = ShiftPaths(Data=pt_46, Offset=-1)  # disabled
graft_3 = GraftTree(Tree=Z_6, IncludeEmptyLists=True, IncludeNullItems=True)  # disabled
box = Box2Pt(PointA=Point(0, 0, 0), PointB=Point(1, 1, 1), Plane=PlaneXY(0, 0, 0))  # disabled
move_3 = Move(Geometry=pshift_7, Motion=graft_3)  # -> Geometry, Transform; disabled
flip_2 = FlipMatrix(Data=move_3.Geometry)  # disabled
pt_47 = Point(flip_2)  # disabled
color_space_partitions_rgb = Brep(box)  # disabled
pdecon_9 = Deconstruct(Point=pt_47)  # -> XComponent, YComponent, ZComponent; disabled
hsl = ColourHSL(Alpha=1, Hue=pdecon_9.XComponent, Saturation=pdecon_9.YComponent, Luminance=pdecon_9.ZComponent)  # disabled
frgb_9 = ColourRGBF(Alpha=1, Red=pdecon_9.XComponent, Green=pdecon_9.YComponent, Blue=pdecon_9.ZComponent)  # disabled
preview_4 = CustomPreview(Geometry=pt_47, Shader=frgb_9)  # disabled
preview_5 = CustomPreview(Geometry=pt_47, Shader=hsl)  # disabled
pt_48 = Point(frgb_9)  # disabled

# ---- group: test sample colors in area
sampled_colors = Colour(sample_3.SampledImageData_2)

# ---- group: test sample colors
sampled_colors_2 = Colour(sampled_colors)  # disabled

# ----
argb_4 = SplitARGB(Colour=sampled_colors_2)  # -> Alpha, Red, Green, Blue; disabled
ahsv = SplitAHSV(Colour=sampled_colors_2)  # -> Alpha, Hue, Saturation, Value; disabled
pt_49 = Point(sampled_colors_2)  # disabled
pt_50 = ConstructPoint(XCoordinate=argb_4.Red, YCoordinate=argb_4.Green, ZCoordinate=argb_4.Blue)  # disabled
pt_51 = ConstructPoint(XCoordinate=ahsv.Hue, YCoordinate=ahsv.Saturation, ZCoordinate=ahsv.Value)  # disabled
sampled_points = CustomPreview(Geometry=pt_50, Shader=sampled_colors_2)  # disabled
preview_6 = CustomPreview(Geometry=pt_51, Shader=sampled_colors_2)  # disabled

# ---- group: Full site statistics
panel_93 = Panel("""0,0,0,0,0,0,0,0,0,0,0,0,0,0,0,0,0,0,0,0,0,0,0,0,12,0,12,12,12,0,0,0,6,0,6,0,0,6,0,0,7,7,7,7
0,0,0,0,0,0,0,0,0,0,0,0,0,0,0,0,0,0,0,0,0,0,0,12,12,12,12,12,0,0,6,6,6,0,0,6,0,0,6,0,7,7,0,0
0,0,0,0,0,0,0,0,0,0,0,0,0,0,0,0,0,0,0,0,0,0,12,12,12,12,0,0,0,0,0,6,6,4,0,0,6,0,7,7,7,0,0,3
0,0,0,0,0,0,0,0,0,0,0,0,0,0,0,0,0,0,0,0,0,4,4,4,4,0,0,0,0,9,0,6,4,4,4,0,0,5,5,5,0,0,2,3
0,0,0,0,0,0,0,0,0,0,0,0,0,0,0,0,0,0,0,0,4,4,4,0,0,0,0,0,0,9,0,0,4,4,0,0,0,5,0,0,0,0,2,3
0,0,0,0,0,0,0,0,0,0,0,0,0,0,0,0,0,0,0,4,4,0,0,0,0,0,0,0,0,8,8,0,0,0,0,0,0,6,6,0,0,0,2,3
0,0,0,0,0,0,0,0,0,0,0,0,0,0,0,0,0,7,7,7,7,0,4,4,4,0,0,0,0,7,7,0,0,0,6,6,0,6,0,0,0,0,0,3
0,0,0,0,0,0,0,0,0,0,0,0,0,0,0,8,8,8,8,8,8,0,4,4,4,0,0,0,0,6,6,6,6,6,6,6,0,6,6,0,0,0,0,3
0,0,0,0,0,0,0,0,0,0,0,0,0,0,0,8,8,8,3,3,0,0,0,0,0,0,15,15,0,6,6,6,6,6,6,6,0,6,6,0,0,0,0,0
0,0,0,0,0,0,0,0,0,0,0,0,0,3,3,8,8,3,3,0,0,0,0,0,0,0,15,15,0,0,0,0,0,0,0,6,0,0,0,6,6,6,6,0
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""")

# ----
rev = ReverseList(List=int_33)
sample_4 = BitmapSampler(BitmapToModify=bmp_2, PointToSample=pt_5, BitmapToModify_2=bmp_2, PointToSample_2=pt_5, bitmap_filter=0)  # -> SampledImageData, SampledImageData_2
txt_84 = Text(rev)
split_7 = TextSplit(Text=panel_8, Separators=panel_13)
join_7 = TextJoin(Text=txt_84, Join=",")
col_18 = Colour(sample_4.SampledImageData_2)
split_8 = TextSplit(Text=panel_12, Separators=",")
pshift_8 = ShiftPaths(Data=join_7, Offset=-1)
cp_2 = ClosestPoint(Point=col_18, Cloud=col_5)  # -> ClosestPoint, CPIndex, Distance
item_22 = ListItem(List=merge_6, Index=cp_2.CPIndex, Wrap=False)

# ---- group: all color quarts reference
txt_85 = Text(split_7)

# ---- group: all rotations reference
txt_86 = Text(split_8)

# ---- group: color code quart texts data
txt_87 = Text(pshift_8)

# ---- group: color code of each smaple pt
int_57 = Integer(item_22)

# ----
line = LineSDL(Start=pt_44, Direction=Vector(1, 0, 0), Length=0.005)
sample_5 = BitmapSampler(BitmapToModify=bmp, PointToSample=pt_44, BitmapToModify_2=bmp, PointToSample_2=pt_44, bitmap_filter=0)  # -> SampledImageData, SampledImageData_2
pshift_9 = ShiftPaths(Data=sample_5.SampledImageData_2, Offset=-1)

# ---- group: sampled pts color
col_19 = Colour(pshift_9)

# ----
argb_5 = SplitARGB(Colour=col_19)  # -> Alpha, Red, Green, Blue
pt_52 = ConstructPoint(XCoordinate=argb_5.Red, YCoordinate=argb_5.Green, ZCoordinate=argb_5.Blue)
brepinc = PointInBrep(Brep=brep, Point=pt_52, Strict=False)

# ---- group: color IDs
int_58 = Integer(brepinc)

# ----
panel_94 = Panel(int_58)
dispatch = Dispatch(List=pt_44, DispatchPattern=int_58)  # -> ListA, ListB
slider_calclume_brep = SliderCalclumeBrep(C=pline_2, L=pt_44, P=col_19, B=brep)  # -> D, int_2; disabled
pdecon_10 = Deconstruct(Point=dispatch.ListA)  # -> XComponent, YComponent, ZComponent
lng_8 = ListLength(List=dispatch.ListA)
ma = MassAddition(Input=pdecon_10.XComponent)  # -> Result, PartialResults
ma_2 = MassAddition(Input=pdecon_10.YComponent)  # -> Result, PartialResults
division_4 = Division(A=ma.Result, B=lng_8)
division_5 = Division(A=ma_2.Result, B=lng_8)
pt_53 = ConstructPoint(XCoordinate=division_4, YCoordinate=division_5, ZCoordinate=0)
panel_95 = Panel(pt_53)

# ---- group: average slide block pt
pt_54 = Point(pt_53)

# ----
crv_cp = CurveClosestPoint(Point=pt_54, Curve=pline_2)  # -> Point, Parameter, Distance
pshift_10 = ShiftPaths(Data=crv_cp.Parameter, Offset=-1)
eval = EvaluateCurve(Curve=crv, Parameter=pshift_10)  # -> Point, Tangent, Angle
line_2 = LineSDL(Start=eval.Point, Direction=X, Length=5)
preview_7 = CustomPreview(Geometry=line_2, Shader=ColourSwatch(SwatchColor=RGB(255, 255, 255)))

# ---- group: slider read 0-1
num_107 = Number(pshift_10)

# ----
slider_calc_sphere = SliderCalcSphere(C_2=pline_2, L=pt_44, P=col_19, C=slider_color_reference, B=num_106)  # -> D, int_2; disabled
panel_96 = Panel(num_107)
branch = TreeBranch(Tree=num_107, Path="{0;1}", MaintainPaths=True)
branch_2 = TreeBranch(Tree=num_107, Path="{0;0}", MaintainPaths=True)  # -> simplify(Branch)
pshift_11 = ShiftPaths(Data=branch, Offset=-1)
pshift_12 = ShiftPaths(Data=branch_2, Offset=-1)

# ---- group: slider 2
num_108 = Number(pshift_11)

# ----
panel_97 = Panel(num_108)

# ---- group: slider1
num_109 = Number(pshift_12)

# ----
panel_98 = Panel(num_109)
nullrep_2 = ReplaceNulls(Items=num_109, Replacements=0)  # -> Items, Count

# ---- group: test sample colors on sliders
sampled_colors_3 = Colour(col_19)

# ---- group: slider1
num_110 = Number(nullrep_2.Items)

num_111 = Number(num_110)

# ----
remap_3 = RemapNumbers(Value=num_110, Source=Domain(0, 1), Target=Domain(1, 30))  # -> Mapped, Clipped
record_slider_value = RecordSliderValue(rec=num_111)
int_59 = Integer(remap_3.Mapped)

# ---- group: Floor # for Dock ID type
int_60 = Integer(record_slider_value)

# ----
txt_88 = Text(num_110)

panel_99 = Panel(txt_87)
panel_100 = Panel(txt_86)
panel_101 = Panel(txt_85)
lng_9 = ListLength(List=txt_85)
keysearch = KeyValueSearch(Keys=txt_85, Values=panel_100, Search=graft(txt_87))
division_6 = Division(A=lng_9, B="4")
series_5 = Series(Start=0, Step=1, Count=division_6)
rev_2 = ReverseList(List=int_57)
pshift_13 = ShiftPaths(Data=series_5, Offset=-1)
multiplication_19 = Multiplication(A=division_6, B="4")
txt_89 = Text(rev_2)
nullrep_3 = ReplaceNulls(Items=keysearch, Replacements="0")  # -> Items, Count
join_8 = TextJoin(Text=txt_89, Join=",")
pshift_14 = ShiftPaths(Data=nullrep_3.Items, Offset=-1)
repeat_4 = RepeatData(Data=pshift_13, Length=multiplication_19)
pshift_15 = ShiftPaths(Data=repeat_4, Offset=-1)
pshift_16 = ShiftPaths(Data=pshift_14, Offset=-1)

# ---- group: color code quart text data
txt_90 = Text(join_8)

# ---- group: all color quart ids reference
int_61 = Integer(pshift_15)

# ---- group: all rotation data
int_62 = Integer(pshift_16)

# ---- group: rotation
int_63 = Integer(int_62)

# ---- group: for calebration of camera position - select all in group and ctrl E / disable when not calibrating CV
box_2 = CenterBox(Base=pt_7, X=0.003, Y=0.003, Z=0.003)  # disabled

# ---- group: for calebration of camera position - select all in group and ctrl E / disable when not calibrating CV / all sample boxes
box_3 = Box(box_2)  # disabled

# ---- group: for calebration of camera position - select all in group and ctrl E / disable when not calibrating CV (continued)
preview_8 = CustomPreview(Geometry=box_3, Shader=item_6)  # disabled

# ----
keysearch_2 = KeyValueSearch(Keys=txt_85, Values=int_61, Search=graft(txt_87))
nullrep_4 = ReplaceNulls(Items=keysearch_2, Replacements="-1")  # -> Items, Count
pshift_17 = ShiftPaths(Data=nullrep_4.Items, Offset=-1)
pshift_18 = ShiftPaths(Data=pshift_17, Offset=-1)
panel_102 = Panel(txt_90)
keysearch_3 = KeyValueSearch(Keys=txt_85, Values=int_61, Search=graft(txt_90))
keysearch_4 = KeyValueSearch(Keys=txt_85, Values=panel_100, Search=graft(txt_90))
nullrep_5 = ReplaceNulls(Items=keysearch_4, Replacements="0")  # -> Items, Count
nullrep_6 = ReplaceNulls(Items=keysearch_3, Replacements="-1")  # -> Items, Count
pshift_19 = ShiftPaths(Data=nullrep_5.Items, Offset=-1)
pshift_20 = ShiftPaths(Data=nullrep_6.Items, Offset=-1)

# ---- group: all piece ids
int_64 = Integer(pshift_18)

# ----
tag_11 = TextTag3D(Location=pt_14, Text=int_64, Size=0.01, Justification=5)
panel_103 = Panel(int_64)

# ---- group: dock id
int_65 = Integer(pshift_20)

# ---- group: dock rotation
int_66 = Integer(pshift_19)

# ---- group: module id
# Grid Base Data
int_67 = Integer(int_64)

# ----
panel_104 = Panel(int_67)
id_masking = IDMasking(int_2=int_67, T=txt_44)

# ---- group: module id (masked)
int_68 = Integer(id_masking)

# ----
panel_105 = Panel(int_68)

# ---- group: dockID
int_69 = Integer(int_65)

int_70 = Integer(int_69)

# ----
# Building Heights
record_density_slider_set = RecordDensitySliderSet(integer=integer, int=int_70, num=num_111)
dock_id = Integer(int_69)

# ---- group: floor num for each type
# CityScope
# 
# "Ryan" Yan Zhang <ryanz@mit.edu>
# Dalma, Ariel, John
# MIT Media Lab, Changing Place Group
# March.2017
int_71 = Integer(record_density_slider_set)

# ----
panel_106 = Panel(int_71)

# ---- group: Dock ID
# 0 RL 4
# 1 RM 4
# 2 RS 5
# 3 OL 3
# 4 OM 4
# 5 OS 5
int_72 = Integer(int_70)

# ----
building_height_calculations = PythonScript(
    counter=num_14,
    height_sets_txt=height_sets_txt,
    setID=set,
    dockID=dock_id,
    bldg_height=int_59,
    load_sets=load_sets,
    save_sets=save_sets,
    retail_flr=retail_floors,
    office_flr=office_floors)  # -> out, floor_numbers, building_heights, curr_dock_display; inputs setID: Int32, dockID: Int32, bldg_height: Int32
# ---------- building_height_calculations: Python ----------
import rhinoscriptsyntax as rs

#read saved sets
if load_sets or counter <= 5 or counter % 6000 == 0:
    height_sets = []
    height_sets_txts = open(height_sets_txt, "r+")
    for line in height_sets_txts:
        curr_set = [int(x) for x in line.strip().split(",")]
        height_sets.append(curr_set)

#print setID
#print dockID
#print bldg_height

#update current set / dock display
if dockID != -1:
    height_sets[setID][dockID] = bldg_height
    if bldg_height < (office_flr + retail_flr):
        curr_dock_display = [retail_flr, bldg_height - retail_flr]
    else:
        curr_dock_display = [retail_flr, office_flr, bldg_height - retail_flr - office_flr]
    curr_dock_display = [int(x) for x in curr_dock_display]

#save sets
if save_sets:
    height_sets_txt_to_save = ""
    for curr_set in height_sets:
        height_sets_txt_to_save = height_sets_txt_to_save + ','.join(str(x) for x in curr_set) + "\n"
    with open(height_sets_txt, "w") as height_sets_txts:
        height_sets_txts.write(height_sets_txt_to_save)

curr_set = height_sets[setID]
floor_numbers = list(curr_set)
building_heights = list(curr_set)

for i in range(0,3):
    if floor_numbers[i] <= 1:
        continue
    if floor_numbers[i] < (office_flr + retail_flr):
        floor_numbers[i] = curr_set[i] - retail_flr
        floor_numbers[i+3] = curr_set[i+3] - retail_flr
    else:
        floor_numbers[i] = curr_set[i] - (retail_flr + office_flr)
        floor_numbers[i+3] = floor_numbers[i+3] + office_flr
for i in range(3,6):
    if floor_numbers[i] <= 1:
        continue
    else:
        floor_numbers[i] -= 1
        
floor_numbers = [int(x) for x in floor_numbers]
# ---------- end building_height_calculations ----------

# ---- group: selected building section - do not disable the preview
unit_layer_visualization = UnitLayerVisualization(unit_floor_number=int_60, dock_id=int_72)  # -> added_office_floor_2, office_type_2

# ----
lng_10 = ListLength(List=building_height_calculations.building_heights)
panel_107 = Panel(building_height_calculations.building_heights)
nullrep_7 = ReplaceNulls(Items=building_height_calculations.building_heights, Replacements=1)  # -> Items, Count
equals_16 = Equality(FirstNumber=lng_10, SecondNumber=0)  # -> Equality, Inequality
panel_108 = Panel(unit_layer_visualization.added_office_floor_2)
panel_109 = Panel(unit_layer_visualization.office_type_2)
filter_20 = StreamFilter(Gate=equals_16.Equality, Stream0=nullrep_7.Items, Stream1=panel_34)
item_23 = ListItem(List=int_71, Index=panel_109, Wrap=True)
floor_for_each_type = Text(building_height_calculations.floor_numbers)
addition_7 = Addition(A=panel_108, B=item_23)
building_heights = Text(filter_20)
replace = ReplaceItems(List=int_71, Item=addition_7, Indices=panel_109, Wrap=False)
floor_for_each_type_2 = Text(building_heights)

# ---- group: Floor #s with added office floors
int_73 = Integer(replace)

# ----
panel_110 = Panel(int_73)
multiplication_20 = Multiplication(A=int_73, B=panel_43)

# ---- group: all fl #s
txt_91 = Text(int_73)

# ---- group: building height for each type
num_112 = Number(multiplication_20)

# ----
building_heights_2 = Text(building_heights)
floor_for_each_type_3 = Text(floor_for_each_type_2)
floor_for_each_type_4 = Text(floor_for_each_type_2)

# ---- group: module id (masked)
int_74 = Integer(int_68)

# ---- group: dock rotation
int_75 = Integer(int_66)

# ---- group: floor num for each type
int_76 = Integer(floor_for_each_type_4)

# ---- group: module id
int_77 = Integer(int_74)

# ----
larger = LargerThan(FirstNumber=int_77, SecondNumber="0")  # -> LargerThan, OrEqualTo
smaller = SmallerThan(FirstNumber=int_77, SecondNumber="5")  # -> SmallerThan, OrEqualTo
and = GateAnd(A=larger.OrEqualTo, B=smaller.OrEqualTo)

# ---- group: module id
int_78 = Integer(int_74)

int_79 = Integer(int_74)

# ---- group: floor num for each type
int_80 = Integer(int_76)

# ---- group: dockID
int_81 = Integer(int_69)

# ----
item_24 = ListItem(List=txt_69, Index=int_81, Wrap=False)
item_25 = ListItem(List=txt_70, Index=int_81, Wrap=False)

# ---- group: unit name
tag_12 = TextTag3D(Location=cluster_6, Text=item_24, Size=number_slider_16, Colour=swatch_3, Justification=5)

# ---- group: res/off
tag_13 = TextTag3D(Location=pt_22, Text=item_25, Size=number_slider_16, Colour=swatch_3, Justification=5)  # disabled

# ---- group: dockID
int_82 = Integer(int_69)

# ---- group: module id
int_83 = Integer(int_74)

# ----
building_heights_3 = Text(flatten(building_heights))
txt_92 = Text(int_74)
txt_93 = Text(int_69)
txt_94 = Text(int_75)
txt_95 = Text(building_heights_3)
lng_11 = ListLength(List=txt_92)
repeat_5 = RepeatData(Data=",\"rot\":", Length=lng_11)
repeat_6 = RepeatData(Data="}", Length=lng_11)
repeat_7 = RepeatData(Data=",\"y\":", Length=lng_11)
repeat_8 = RepeatData(Data=",\"x\":", Length=lng_11)
repeat_9 = RepeatData(Data="{\"type\":", Length=lng_11)
join_9 = TextJoin(Text=txt_95, Join=",")
pshift_21 = ShiftPaths(Data=repeat_5, Offset=-1)
pshift_22 = ShiftPaths(Data=repeat_6, Offset=-1)
pshift_23 = ShiftPaths(Data=repeat_8, Offset=-1)
pshift_24 = ShiftPaths(Data=repeat_7, Offset=-1)
pshift_25 = ShiftPaths(Data=repeat_9, Offset=-1)

# ---- group: module id
int_84 = Integer(int_74)

# ----
building_heights_4 = Text(building_heights)
merge_9 = Merge(
    Data1=graft(pshift_25),
    Data2=graft(txt_92),
    Data3=graft(pshift_23),
    Data4=graft(txt_76),
    Data5=graft(pshift_24),
    Data6=graft(txt_77),
    Data7=graft(pshift_21),
    Data8=graft(txt_75),
    Data9=graft(pshift_22))
join_10 = TextJoin(Text=merge_9)
pshift_26 = ShiftPaths(Data=join_10, Offset=-1)
txt_96 = Text(pshift_26)
join_11 = TextJoin(Text=txt_96, Join=",")
txt_97 = Text(join_11)
merge_10 = Merge(
    Data1="{\"grid\":[",
    Data2=txt_97,
    Data3="],\"objects\":{",
    Data4="\"slider1\":",
    Data5=txt_88,
    Data6=",\"toggle1\":",
    Data7=txt_78,
    Data8=",\"toggle2\":",
    Data9=txt_79,
    Data10=",\"toggle3\":",
    Data11=txt_80,
    Data12=",\"toggle4\":",
    Data13=txt_81,
    Data14=",\"dockID\":",
    Data15=txt_93,
    Data16=",\"dockRotation\":",
    Data17=txt_94,
    Data18=",\"IDMax\":15",
    Data19=",\"density\":[",
    Data20=join_9,
    Data21="],\"pop_young\":0,\"pop_mid\":0,\"pop_old\":0",
    Data22="}",
    Data23="}")
join_12 = TextJoin(Text=merge_10)

# ---- group: json data to unity
txt_98 = Text(join_12)

# ----
panel_111 = Panel(txt_98)
building_heights_5 = Text(building_heights)
dam = DataDam(DataA=txt_98, BufferDelay=5000000, BufferMode=2)
send_table_data = PythonScript(url="https://cityio.media.mit.edu", path="api/table/update/citymatrix_volpe", jsonString=dam)  # -> out
# ---------- send_table_data: Python ----------
import System 
import System.Net 
import System.Uri
import System.IO
import System.Text.Encoding
import json


def postTable(url,stringData,debug=False):
    webclient = System.Net.WebClient()
    webclient.Headers['Content-type'] = 'text/plain'
    
    if debug:
        
        # simple validation before we send
        try:
            json.loads(stringData)
        except:
            print 'invalid string, revise your string data'
            return
        
        # this will block your process
        data = System.Text.Encoding.Default.GetBytes(stringData)
        webclient.UploadData(url,'POST',data)
        
    else:
        data = System.Text.Encoding.Default.GetBytes(stringData)
        webclient.UploadDataAsync(url,'POST',data)

endpoint = System.Uri('{}/{}'.format(url,path))



postTable(endpoint,jsonString)
# rhino crashes using async callbacks,
# so try the following if something is wrong
# postData(endpoint,jsonString,debug=True)
# ---------- end send_table_data ----------
panel_112 = Panel(send_table_data)

# ---- group: Volpe module Ids
int_85 = Integer(int_84)

# ----
floor_for_each_type_5 = Text(floor_for_each_type_2)

# ---- group: all building type fl #s
int_86 = Integer(floor_for_each_type_5)

# ----
item_26 = ListItem(List=int_86, Index="3", Wrap=False)
item_27 = ListItem(List=int_86, Index="0", Wrap=False)
item_28 = ListItem(List=int_86, Index="4", Wrap=False)
item_29 = ListItem(List=int_86, Index="1", Wrap=False)
item_30 = ListItem(List=int_86, Index=panel_81, Wrap=False)
item_31 = ListItem(List=int_86, Index="2", Wrap=False)

# ---- group: RL fl #s
int_87 = Integer(item_26)

int_88 = Integer(item_27)

# ---- group: RM fl #s
int_89 = Integer(item_28)

# ---- group: RS fl #s
int_90 = Integer(item_30)

# ---- group: RM fl #s
int_91 = Integer(item_29)

# ---- group: RS fl #s
int_92 = Integer(item_31)

# ----
# Color Space Viz
range_2 = Range(Domain=Domain(0, 1), Steps=10)  # disabled
graft_4 = GraftTree(Tree=range_2, IncludeEmptyLists=True, IncludeNullItems=True)  # disabled
argb_6 = SplitARGB(Colour=col_7)  # -> Alpha, Red, Green, Blue; disabled
ahsv_2 = SplitAHSV(Colour=col_7)  # -> Alpha, Hue, Saturation, Value; disabled
argb_7 = SplitARGB(Colour=col_4)  # -> Alpha, Red, Green, Blue; disabled
ahsv_3 = SplitAHSV(Colour=col_4)  # -> Alpha, Hue, Saturation, Value; disabled
pt_55 = ConstructPoint(XCoordinate=range_2, YCoordinate=graft_4, ZCoordinate=0)  # disabled
Z_7 = UnitZ(Factor=range_2)  # disabled
pt_56 = ConstructPoint(XCoordinate=argb_6.Red, YCoordinate=argb_6.Green, ZCoordinate=argb_6.Blue)  # disabled
pt_57 = ConstructPoint(XCoordinate=ahsv_2.Hue, YCoordinate=ahsv_2.Saturation, ZCoordinate=ahsv_2.Value)  # disabled
pt_58 = Point(col_7)  # disabled
pt_59 = ConstructPoint(XCoordinate=argb_7.Red, YCoordinate=argb_7.Green, ZCoordinate=argb_7.Blue)  # disabled
pt_60 = ConstructPoint(XCoordinate=ahsv_3.Hue, YCoordinate=ahsv_3.Saturation, ZCoordinate=ahsv_3.Value)  # disabled
pt_61 = Point(col_4)  # disabled
pshift_27 = ShiftPaths(Data=pt_55, Offset=-1)  # disabled
graft_5 = GraftTree(Tree=Z_7, IncludeEmptyLists=True, IncludeNullItems=True)  # disabled
sph_2 = Sphere(Base=pt_57, Radius=0.05)  # disabled
sph_3 = Sphere(Base=pt_56, Radius=0.05)  # disabled
number_slider_37 = Slider(5, range=0..10)  # disabled
preview_9 = CustomPreview(Geometry=pt_60, Shader=col_4)  # disabled
preview_10 = CustomPreview(Geometry=pt_59, Shader=col_4)  # disabled
move_4 = Move(Geometry=pshift_27, Motion=graft_5)  # -> Geometry, Transform; disabled
preview_11 = CustomPreview(Geometry=sph_2, Shader=col_7)  # disabled
preview_12 = CustomPreview(Geometry=sph_3, Shader=col_7)  # disabled
flip_3 = FlipMatrix(Data=move_4.Geometry)  # disabled
item_32 = ListItem(List=flip_3, Index=number_slider_37, Wrap=False)  # disabled
box_4 = Box2Pt(PointA=Point(0, 0, 0), PointB=Point(1, 1, 1), Plane=PlaneXY(0, 0, 0))  # disabled
box_5 = Box2Pt(PointA=Point(0, 0, 0), PointB=Point(1, 1, 1), Plane=PlaneXY(0, 0, 0))  # disabled
voronoi³ = Voronoi3D(Points=pt_57, Box=box_4)  # -> Cells, Boundary; disabled
voronoi³_2 = Voronoi3D(Points=pt_56, Box=box_5)  # -> Cells, Boundary; disabled
brep_2 = Brep(voronoi³.Cells)  # disabled
brep_3 = Brep(voronoi³_2.Cells)  # disabled

# ---- group: color space pts - one plan
pt_62 = Point(item_32)  # disabled

# ---- group: color space pts
pt_63 = Point(flip_3)  # disabled

# ---- group: color space pts - showing
pt_64 = Point(pt_63)  # disabled

# ----
pdecon_11 = Deconstruct(Point=pt_64)  # -> XComponent, YComponent, ZComponent; disabled
hsl_2 = ColourHSL(Alpha=1, Hue=pdecon_11.XComponent, Saturation=pdecon_11.YComponent, Luminance=pdecon_11.ZComponent)  # disabled
frgb_10 = ColourRGBF(Alpha=1, Red=pdecon_11.XComponent, Green=pdecon_11.YComponent, Blue=pdecon_11.ZComponent)  # disabled
preview_13 = CustomPreview(Geometry=pt_64, Shader=hsl_2)  # disabled
pt_65 = Point(frgb_10)  # disabled
preview_14 = CustomPreview(Geometry=pt_64, Shader=frgb_10)  # disabled

# ---- group: ppl per flr
# id5
# id3
# id4
# id0
# id2
# id1
# young
# mid
# old
panel_113 = Panel("0")
panel_114 = Panel("8")
panel_115 = Panel("12")
panel_116 = Panel("18")
panel_117 = Panel("8")
panel_118 = Panel("12")
panel_119 = Panel("18")

# ---- group: RL
num_113 = Number(panel_114)

# ---- group: RM
num_114 = Number(panel_115)

# ---- group: RS
num_115 = Number(panel_116)

# ---- group: ppl per flr (continued)
num_116 = Number([num_113, "0", "0", num_68, "0", "0"])
num_117 = Number(["0", num_114, "0", "0", num_69, "0"])
num_118 = Number([panel_113, "0", num_115, "0", "0", num_70])

# ----
multiplication_21 = Multiplication(A=num_118, B=number_slider_9)
multiplication_22 = Multiplication(A=num_117, B=number_slider_9)
multiplication_23 = Multiplication(A=num_116, B=number_slider_9)
num_119 = Number(multiplication_21)
num_120 = Number(multiplication_22)
num_121 = Number(multiplication_23)

# ---- group: ppl per flr - RL
num_122 = Number(panel_114)

# ---- group: ppl per flr - RM
num_123 = Number(panel_115)

# ---- group: ppl per flr - RS
# Office Diversity
num_124 = Number(panel_116)

# ----
# Defining the floor number for each
# building type.
show_google_map = BooleanToggle(False)
xy_2 = XYPlane(Origin=pt_18)
dist = Distance(PointA=pt_18, PointB=pt_19)
movetoorgin_4 = MoveToOrgin(G=mesh_15, num=cell_shrink)
movetoorgin_5 = MoveToOrgin(G=mesh_16, num=cell_shrink)
division_7 = Division(A=dist, B=int_41)
panel_120 = Panel("22.14745454545455")
larger_2 = LargerThan(FirstNumber=int_78, SecondNumber="0")  # -> LargerThan, OrEqualTo
smaller_2 = SmallerThan(FirstNumber=int_78, SecondNumber="5")  # -> SmallerThan, OrEqualTo
and_2 = GateAnd(A=larger_2.OrEqualTo, B=smaller_2.OrEqualTo)
dispatch_2 = Dispatch(List=int_78, DispatchPattern=and_2)  # -> ListA, ListB
equals_17 = Equality(FirstNumber=int_78, SecondNumber="-1")  # -> Equality, Inequality
equals_18 = Equality(FirstNumber=int_78, SecondNumber="7")  # -> Equality, Inequality
dispatch_3 = Dispatch(List=int_43, DispatchPattern=and_2)  # -> ListA, ListB
equals_19 = Equality(FirstNumber=int_78, SecondNumber="7")  # -> Equality, Inequality
equals_20 = Equality(FirstNumber=int_78, SecondNumber="6")  # -> Equality, Inequality
or = GateOr(A=equals_20.Equality, B=equals_19.Equality)
Z_8 = UnitZ(Factor=0.1)
Z_9 = UnitZ(Factor=0.1)

# ----
# Human Interation @ Lego - Outside
dispatch_4 = Dispatch(List=int_78, DispatchPattern=and_2)  # -> ListA, ListB

# ---- group: filted id
int_93 = Integer(dispatch_4.ListA)

# ----
item_33 = ListItem(List=building_heights_2, Index=graft(int_93), Wrap=True)
pshift_28 = ShiftPaths(Data=item_33, Offset=-1)

# ---- group: flr #s
txt_99 = Text(pshift_28)

# ----
item_34 = ListItem(List=num_121, Index=graft(int_93), Wrap=True)
item_35 = ListItem(List=num_119, Index=graft(int_93), Wrap=True)
item_36 = ListItem(List=num_120, Index=graft(int_93), Wrap=True)
pshift_29 = ShiftPaths(Data=item_34, Offset=-1)
pshift_30 = ShiftPaths(Data=item_35, Offset=-1)
pshift_31 = ShiftPaths(Data=item_36, Offset=-1)

# ---- group: old per flr
num_125 = Number(pshift_29)

# ---- group: young per flr
num_126 = Number(pshift_30)

# ---- group: mid per flr
num_127 = Number(pshift_31)

# ----
multiplication_24 = Multiplication(A=num_127, B=txt_99)
multiplication_25 = Multiplication(A=num_126, B=txt_99)
multiplication_26 = Multiplication(A=num_125, B=txt_99)

# ---- group: total ppl in building mid
int_94 = Integer(multiplication_24)

# ---- group: total ppl in building young
int_95 = Integer(multiplication_25)

# ----
addition_8 = Addition(A=int_95, B=int_94)

# ---- group: total ppl in building old
int_96 = Integer(multiplication_26)

# ----
addition_9 = Addition(A=addition_8, B=int_96)

# ---- group: total ppl in building - all
int_97 = Integer(addition_9)

# ---- group: base cplane
pln = Plane(xy_2)

# ---- group: module meshes lego at orgin
mesh_27 = Mesh(movetoorgin_5)

# ----
item_37 = ListItem(List=mesh_27, Index=int_81, Wrap=False)
rotate = Rotate(Geometry=item_37, Angle=degrees(int_47), Plane=PlaneXY(0, 0, 0))  # -> Geometry, Transform

# ---- group: cell size
num_128 = Number(division_7)

# ----
full_site_grid_matrix_calculation = FullSiteGridMatrixCalculation(
    A_2=number_slider_4,
    xi=int_8,
    yi=int_4,
    x_2=int_9,
    num_2=num_128,
    y_2=int_5,
    xs=int_2,
    A_3=number_slider_5,
    ys=int,
    C_2=number_slider_6,
    G=pt_18,
    A=number_slider_6,
    num=num_128,
    B=number_slider_7,
    C=number_slider_7,
    L=number_slider_6)  # -> int_2, G_2, x_3, y_3, z_2

# ---- group: module center (full site)
pt_66 = Point(full_site_grid_matrix_calculation.G_2)

# ----
full_site_id_replacement = FullSiteIDReplacement(int_5=textformating, int=int_84, int_2=full_site_grid_matrix_calculation.int_2)  # -> L, _1_list

# ---- group: full site module id
int_98 = Integer(full_site_id_replacement.L)

# ---- group: cell area
# Dashboard
sqr = Square(Value=num_128)

# ---- group: full site centers
pt_67 = Point(full_site_grid_matrix_calculation.G_2)

# ----
population_calculation = PopulationCalculation(
    A_7=sqr,
    A=int_79,
    A_2=int_79,
    A_4=int_79,
    A_3=int_79,
    A_5=int_79,
    A_6=int_79,
    L=int_80,
    L_3=int_80,
    L_2=int_80,
    L_4=int_80,
    L_5=int_80,
    L_6=int_80)  # -> num_2, R_4, R_12, R, R_8, R_3, R_9, R_6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
filter_21 = StreamFilter(Gate=int_40, Stream1=pt_67, Stream6=pt_67, Stream7=pt_67, Stream8=pt_67, Stream9=pt_67)

# ---- group: full site (w/o active area)
int_99 = Integer(full_site_id_replacement._1_list)

# ---- group: Cell size
num_129 = Number(num_128)

# ----
multiplication_27 = Multiplication(A=population_calculation.R_12, B=140)
multiplication_28 = Multiplication(A=population_calculation.R_10, B=100)
multiplication_29 = Multiplication(A=population_calculation.R_7, B=360)
multiplication_30 = Multiplication(A=population_calculation.R_11, B=600)
multiplication_31 = Multiplication(A=population_calculation.R_8, B=1100)
multiplication_32 = Multiplication(A=population_calculation.R_9, B=300)

# ---- group: module meshes lego at orgin
mesh_28 = Mesh(movetoorgin_4)

# ---- group: OL
num_130 = Number(population_calculation.R_6)

# ---- group: Regular Office ppl #
int_100 = Integer(population_calculation.R_7)

# ---- group: Micro-unit ppl #
int_101 = Integer(population_calculation.R_9)

# ---- group: OS
num_131 = Number(population_calculation.R_5)

# ---- group: RS
num_132 = Number(population_calculation.R_3)

# ---- group: OM
num_133 = Number(population_calculation.R_2)

# ---- group: RM
num_134 = Number(population_calculation.R)

# ---- group: Regular residential ppl #
int_102 = Integer(population_calculation.R)

# ---- group: Head Quater ppl #
int_103 = Integer(population_calculation.R_11)

# ---- group: RL
num_135 = Number(population_calculation.R_4)

# ---- group: Co-working ppl #
int_104 = Integer(population_calculation.R_10)

# ---- group: Luxury ppl #
int_105 = Integer(population_calculation.R_12)

# ----
move_5 = Move(Geometry=rotate.Geometry, Motion=vec2pt.Vector)  # -> Geometry, Transform

# ---- group: OS SQFT
int_106 = Integer(multiplication_28)

# ---- group: RS SQFT
int_107 = Integer(multiplication_32)

# ---- group: OM SQFT
int_108 = Integer(multiplication_29)

# ---- group: OL SQFT
int_109 = Integer(multiplication_30)

# ---- group: RL SQFT
int_110 = Integer(multiplication_27)

# ---- group: RM SQFT
int_111 = Integer(multiplication_31)

# ----
ma_3 = MassAddition(Input=[int_104, int_100, int_103])  # -> Result, PartialResults
ma_4 = MassAddition(Input=[int_101, int_102, int_105])  # -> Result, PartialResults
ma_5 = MassAddition(Input=[int_109, int_108, int_106])  # -> Result, PartialResults
ma_6 = MassAddition(Input=[int_110, int_111, int_107])  # -> Result, PartialResults

# ---- group: dock lego modules
mesh_29 = Mesh(move_5.Geometry)
# ----
modulecenter = ModuleCenter(pt=pt_18, num=num_128, int_2=int_45, int=int_44)  # -> pt_5, transform_2; disabled
roads = Roads_2(
    xe=int_9,
    ye=int_5,
    x=full_site_grid_matrix_calculation.x_3,
    y=full_site_grid_matrix_calculation.y_3,
    id=int_99,
    bool=bool_3,
    X=cell_shrink,
    pt=filter_21,
    id_2=int_99,
    Y=cell_shrink)  # disabled
sidewalk_2 = Sidewalk_2(
    xe=int_9,
    ye=int_5,
    x=full_site_grid_matrix_calculation.x_3,
    y=full_site_grid_matrix_calculation.y_3,
    id=int_99,
    bool=bool_3,
    X=cell_shrink,
    pt=filter_21,
    Y=cell_shrink)  # disabled
center_line = CenterLine_2(
    pt=filter_21,
    xe=int_9,
    ye=int_5,
    x=full_site_grid_matrix_calculation.x_3,
    y=full_site_grid_matrix_calculation.y_3,
    id=int_99,
    bool=bool_3,
    X=cell_shrink,
    Y=cell_shrink)

# ---- group: total working ppl #
int_112 = Integer(ma_3.Result)

# ---- group: total residential ppl #
int_113 = Integer(ma_4.Result)

# ---- group: total working ppl sqft
int_114 = Integer(ma_5.Result)

# ---- group: total residential ppl sqft
int_115 = Integer(ma_6.Result)

# ----
addition_10 = Addition(A=int_113, B=int_112)
addition_11 = Addition(A=int_115, B=int_114)

# ---- group: total ppl #
int_116 = Integer(addition_10)

int_117 = Integer(int_116)

# ----
remap_4 = RemapNumbers(Value=int_117, Source="1953 to 6000", Target="0.5 to 3.0")  # -> Mapped, Clipped

# ---- group: total number control
num_136 = Number(remap_4.Mapped)

# ----
larger_3 = LargerThan(FirstNumber=int_99, SecondNumber=panel_63)  # -> LargerThan, OrEqualTo; disabled
smaller_3 = SmallerThan(FirstNumber=int_99, SecondNumber="5")  # -> SmallerThan, OrEqualTo; disabled

# ---- group: total ppl sqft
int_118 = Integer(addition_11)

# ----
panel_121 = Panel(int_116)
and_3 = GateAnd(A=larger_3.OrEqualTo, B=smaller_3.OrEqualTo)  # disabled
dispatch_5 = Dispatch(List=int_99, DispatchPattern=and_3)  # -> ListA, ListB; disabled
equals_21 = Equality(FirstNumber=int_99, SecondNumber=panel_64)  # -> Equality, Inequality; disabled
item_38 = ListItem(List=mesh_20, Index=graft(dispatch_5.ListA), Wrap=False)  # disabled
dispatch_6 = Dispatch(List=filter_21, DispatchPattern=equals_21.Equality)  # -> ListA, ListB; disabled
pshift_32 = ShiftPaths(Data=item_38, Offset=-1)  # disabled
dispatch_7 = Dispatch(List=int_43, DispatchPattern=and_3)  # -> ListA, ListB; disabled
mesh_30 = Mesh(center_line)
mesh_31 = Mesh(roads)  # disabled
mesh_32 = Mesh(sidewalk_2)  # disabled
vec2pt_2 = Vector2Pt(PointA=Point(0, 0, 0), PointB=dispatch_6.ListA, Unitize=False)  # -> Vector, Length; disabled
rotate_2 = Rotate(Geometry=pshift_32, Angle=degrees(dispatch_7.ListA), Plane=PlaneXY(0, 0, 0))  # -> Geometry, Transform; disabled
dispatch_8 = Dispatch(List=filter_21, DispatchPattern=and_3)  # -> ListA, ListB; disabled
move_6 = Move(Geometry=mesh_21, Motion=vec2pt_2.Vector)  # -> Geometry, Transform; disabled
nullrep_8 = ReplaceNulls(Items=int_115, Replacements=0)  # -> Items, Count
filter_22 = StreamFilter(Gate=show_google_map, Stream0=mesh_30)
filter_23 = StreamFilter(Gate=show_google_map, Stream0=mesh_31)  # disabled
filter_24 = StreamFilter(Gate=show_google_map, Stream0=mesh_32)  # disabled
vec2pt_3 = Vector2Pt(PointA=Point(0, 0, 0), PointB=dispatch_8.ListA, Unitize=False)  # -> Vector, Length; disabled
nullrep_9 = ReplaceNulls(Items=int_110, Replacements=0)  # -> Items, Count
nullrep_10 = ReplaceNulls(Items=int_107, Replacements=0)  # -> Items, Count
nullrep_11 = ReplaceNulls(Items=int_111, Replacements=0)  # -> Items, Count
max = Maximum(A=nullrep_8.Items, B=ttl_min)
max_2 = Maximum(A=nullrep_9.Items, B=type_min)
max_3 = Maximum(A=nullrep_11.Items, B=type_min)
max_4 = Maximum(A=nullrep_10.Items, B=type_min)
move_7 = Move(Geometry=rotate_2.Geometry, Motion=vec2pt_3.Vector)  # -> Geometry, Transform; disabled

# ---- group: R
int_119 = Integer(max)

# ---- group: RL
int_120 = Integer(max_2)

# ---- group: RM
int_121 = Integer(max_3)

# ---- group: RS
int_122 = Integer(max_4)

# ----
mesh_33 = Mesh(filter_22)
mesh_34 = Mesh(filter_23)  # disabled
mesh_35 = Mesh(filter_24)  # disabled

# ---- group: residential total
tag_14 = TextTag3D(Location=pt_26, Text=int_119, Size=num_76, Colour=col_10, Justification=7)

# ----
mjoin = MeshJoin(Meshes=mesh_34)  # disabled
mjoin_2 = MeshJoin(Meshes=mesh_35)  # disabled

# ---- group: RL
tag_15 = TextTag3D(Location=pt_28, Text=int_120, Size=num_78, Colour=col_12, Justification=7)

# ---- group: RS
tag_16 = TextTag3D(Location=pt_27, Text=int_122, Size=num_77, Colour=col_11, Justification=7)

# ---- group: RM
tag_17 = TextTag3D(Location=pt_29, Text=int_121, Size=num_79, Colour=col_13, Justification=7)

# ----
nullrep_12 = ReplaceNulls(Items=int_112, Replacements=0)  # -> Items, Count

# ---- group: building lego modules
mesh_36 = Mesh(move_7.Geometry)  # disabled

# ---- group: blank
mesh_37 = Mesh(move_6.Geometry)  # disabled

# ----
nullrep_13 = ReplaceNulls(Items=int_109, Replacements=0)  # -> Items, Count
nullrep_14 = ReplaceNulls(Items=int_106, Replacements=0)  # -> Items, Count
max_5 = Maximum(A=nullrep_12.Items, B=ttl_min)
nullrep_15 = ReplaceNulls(Items=int_108, Replacements=0)  # -> Items, Count
filter_25 = StreamFilter(Gate=show_google_map, Stream0=mesh_37)  # disabled

# ---- group: O
int_123 = Integer(int_114)

# ----
max_6 = Maximum(A=nullrep_14.Items, B=type_min)
max_7 = Maximum(A=nullrep_13.Items, B=type_min)
max_8 = Maximum(A=nullrep_15.Items, B=type_min)

# ---- group: OL
int_124 = Integer(max_7)

# ---- group: OM
int_125 = Integer(max_8)

# ---- group: OS
int_126 = Integer(max_6)

# ----
mjoin_3 = MeshJoin(Meshes=mesh_36)  # disabled

# ---- group: office total
tag_18 = TextTag3D(Location=pt_30, Text=int_123, Size=num_80, Colour=col_14, Justification=7)

# ---- group: OL
tag_19 = TextTag3D(Location=pt_31, Text=int_124, Size=num_81, Colour=col_15, Justification=7)

# ---- group: OS
tag_20 = TextTag3D(Location=pt_32, Text=int_126, Size=num_82, Colour=col_16, Justification=7)

# ---- group: OM
tag_21 = TextTag3D(Location=pt_33, Text=int_125, Size=num_83, Colour=col_17, Justification=7)

# ----
mcol_2 = MeshColours(Mesh=filter_25, Colours=swatch_4)  # disabled
move_8 = Move(Geometry=mcol_2, Motion=Z_2)  # -> Geometry, Transform; disabled
equals_22 = Equality(FirstNumber=int_98, SecondNumber="6")  # -> Equality, Inequality

# ---- group: center line mesh final!
mesh_38 = Mesh(mesh_33)

# ---- group: total ppl #
int_127 = Integer(int_116)

# ----
panel_122 = Panel(int_127)
# Traffic Heatmap - Ryan
filter_26 = StreamFilter(Gate=int_40, Stream8=mesh_38, Stream9=mesh_38)

# ---- group: is dynamic
bool_9 = Boolean(equals_22.Inequality)

# ----
dispatch_9 = Dispatch(List=pt_66, DispatchPattern=bool_9)  # -> ListA, ListB

# ---- group: all road pieces
pt_68 = Point(dispatch_9.ListB)

# ---- group: total ppl #
int_128 = Integer(int_127)

# ----
pshift_33 = ShiftPaths(Data=filter_26, Offset=-3)
area = Area(Geometry=pshift_33)  # -> Area, Centroid

# ---- group: center pts
pt_69 = Point(area.Centroid)

# ----
cps = ClosestPoints(Point=pt_69, Cloud=pt_68, Count=1)  # -> ClosestPoint, CPIndex, Distance
pshift_34 = ShiftPaths(Data=cps.ClosestPoint, Offset=-1)
dist_2 = Distance(PointA=graft(pshift_34), PointB=crossings)
bnd_2 = Bounds(Numbers=dist_2)
dedomain_2 = DeconstructDomain(Domain=bnd_2)  # -> Start, End
pshift_35 = ShiftPaths(Data=dedomain_2.Start, Offset=-1)

# ---- group: min dis to intersections
num_137 = Number(pshift_35)

# ----
bnd_3 = Bounds(Numbers=num_137)
remap_5 = RemapNumbers(Value=num_137, Source=bnd_3, Target=Domain(0, 1))  # -> Mapped, Clipped
subtraction_6 = Subtraction(A=1, B=remap_5.Mapped)
graph = GraphMapper(
    subtraction_6,
    x0=0,
    x1=1,
    y0=0,
    y1=0.5,
    container_name="Bezier",
    cpx=[0, 0.1613658518, 0.7159118652, 1],
    cpy=[0, 0.3613502979, 0.9704423547, 1])

# ---- group: full site use code / blank
mesh_39 = Mesh(move_8.Geometry)

# ---- group: cell size
num_138 = Number(division_7)

# ----
larger_4 = LargerThan(FirstNumber=int_98, SecondNumber=panel_71)  # -> LargerThan, OrEqualTo; disabled
smaller_4 = SmallerThan(FirstNumber=int_98, SecondNumber=panel_72)  # -> SmallerThan, OrEqualTo; disabled
and_4 = GateAnd(A=larger_4.OrEqualTo, B=smaller_4.OrEqualTo)  # disabled
filter_27 = StreamFilter(Gate=slider_value, Stream1=int_98)
filter_28 = StreamFilter(Gate=whole_site_t_active_site_f, Stream0=int_77, Stream1=filter_27)
filter_29 = StreamFilter(Gate=whole_site_t_active_site_f, Stream0=and, Stream1=and_3)
dispatch_10 = Dispatch(List=filter_28, DispatchPattern=filter_29)  # -> ListA, ListB
filter_30 = StreamFilter(Gate=filter_17, Stream1=dispatch_10.ListA)

# ---- group: full site module id
int_129 = Integer(int_98)

# ---- group: cell size
num_139 = Number(num_128)

# ---- group: module center (ful site)
# Heatmaps Output Geometry
pt_70 = Point(pt_66)

# ---- group: full site module id
int_130 = Integer(int_129)

# ---- group: module center (ful site)
pt_71 = Point(pt_66)

pt_72 = Point(pt_70)

pt_73 = Point(pt_66)

# ---- group: full site module id
int_131 = Integer(int_129)

int_132 = Integer(int_129)

# ---- group: RL
num_140 = Number(population_calculation.R_4)

# ----
stream_filter = StreamFilter(Gate=int_56, Stream2=int_130)
stream_filter_2 = StreamFilter(Gate=int_56, Stream2=pt_71)

# ---- group: filtered id
int_133 = Integer(filter_30)

# ----
# Proximity (Walkability) to Residential Buildings
stream_filter_3 = StreamFilter(Gate=int_56, Stream3=int_132)
stream_filter_4 = StreamFilter(Gate=int_56, Stream3=pt_73)
stream_filter_5 = StreamFilter(Gate=int_56, Stream4=pt_72)
# Proximity (Walkability) to Open Spaces
stream_filter_6 = StreamFilter(Gate=int_56, Stream4=int_131)

# ---- group: RM
num_141 = Number(population_calculation.R)

# ----
index = ItemIndex(List=filter_28, Item=filter_30)
item_39 = ListItem(List=building_heights_5, Index=int_133, Wrap=True)

# ---- group: RS
num_142 = Number(population_calculation.R_3)

# ---- group: full site module id
int_134 = Integer(stream_filter)

# ---- group: module center (ful site)
pt_74 = Point(stream_filter_2)

pt_75 = Point(stream_filter_5)

# ---- group: full site module id
int_135 = Integer(stream_filter_3)

# ---- group: module center (ful site)
pt_76 = Point(stream_filter_4)

# ----
equals_23 = Equality(FirstNumber=int_129, SecondNumber="-2")  # -> Equality, Inequality

# ---- group: cell size
num_143 = Number(num_139)

num_144 = Number(num_139)

# ---- group: OL
num_145 = Number(population_calculation.R_6)

# ---- group: full site module id
int_136 = Integer(stream_filter_6)

# ----
division_8 = Division(A=num_139, B=2)

# ---- group: cell size
num_146 = Number(num_139)

# ---- group: is dynamic
bool_10 = Boolean(equals_23.Inequality)

# ----
equals_24 = Equality(FirstNumber=int_134, SecondNumber="4")  # -> Equality, Inequality
equals_25 = Equality(FirstNumber=int_134, SecondNumber="3")  # -> Equality, Inequality
equals_26 = Equality(FirstNumber=int_134, SecondNumber="5")  # -> Equality, Inequality

# ---- group: OM
num_147 = Number(population_calculation.R_2)

# ----
neg_2 = Negative(Value=division_8)

# ---- group: avoiding 0
Z_10 = UnitZ(Factor=num_90)
move_9 = Move(Geometry=pt_75, Motion=Z_10)  # -> Geometry, Transform

# ----
equals_27 = Equality(FirstNumber=int_135, SecondNumber="4")  # -> Equality, Inequality
equals_28 = Equality(FirstNumber=int_135, SecondNumber="3")  # -> Equality, Inequality
equals_29 = Equality(FirstNumber=int_135, SecondNumber="5")  # -> Equality, Inequality
equals_30 = Equality(FirstNumber=int_135, SecondNumber="1")  # -> Equality, Inequality
equals_31 = Equality(FirstNumber=int_135, SecondNumber="0")  # -> Equality, Inequality
equals_32 = Equality(FirstNumber=int_135, SecondNumber="2")  # -> Equality, Inequality
move_10 = Move(Geometry=pt_74, Motion=Z_3)  # -> Geometry, Transform
equals_33 = Equality(FirstNumber=int_134, SecondNumber="1")  # -> Equality, Inequality
equals_34 = Equality(FirstNumber=int_134, SecondNumber="0")  # -> Equality, Inequality
equals_35 = Equality(FirstNumber=int_134, SecondNumber="2")  # -> Equality, Inequality
dispatch_11 = Dispatch(List=pt_70, DispatchPattern=bool_10)  # -> ListA, ListB
or_2 = GateOr(A=equals_25.Equality, B=equals_24.Equality)

# ---- group: OS
num_148 = Number(population_calculation.R_5)

# ----
move_11 = Move(Geometry=pt_76, Motion=Z_4)  # -> Geometry, Transform
dispatch_12 = Dispatch(List=pt_70, DispatchPattern=bool_10)  # -> ListA, ListB
or_3 = GateOr(A=or_2, B=equals_26.Equality)
dom_8 = ConstructDomain(DomainStart=neg_2, DomainEnd=division_8)
equals_36 = Equality(FirstNumber=int_136, SecondNumber="-1")  # -> Equality, Inequality
or_4 = GateOr(A=equals_28.Equality, B=equals_27.Equality)
or_5 = GateOr(A=equals_31.Equality, B=equals_30.Equality)
or_6 = GateOr(A=equals_34.Equality, B=equals_33.Equality)
or_7 = GateOr(A=or_4, B=equals_29.Equality)
or_8 = GateOr(A=or_5, B=equals_32.Equality)
or_9 = GateOr(A=or_6, B=equals_35.Equality)

# ---- group: module id (dynamic only)
int_137 = Integer(dispatch_11.ListA)

# ----
bool_11 = Boolean(or_3)
planesrf = PlaneSurface(Plane=pt_41, XSize=dom_8, YSize=dom_8)

# ---- group: is open space
bool_12 = Boolean(equals_36.Equality)

# ----
bool_13 = Boolean(or_7)
bool_14 = Boolean(or_8)

# ---- group: module center - checking pts
pt_77 = Point(graft(move_9.Geometry))

# ----
bool_15 = Boolean(or_9)
scale_nu = ScaleNU(Geometry=planesrf, Plane=PlaneXY(0, 0, 0), ScaleX=cell_shrink_2, ScaleY=cell_shrink_2, ScaleZ=1)  # -> Geometry, Transform
dispatch_13 = Dispatch(List=pt_74, DispatchPattern=bool_11)  # -> ListA, ListB
dispatch_14 = Dispatch(List=pt_76, DispatchPattern=bool_14)  # -> ListA, ListB
dispatch_15 = Dispatch(List=move_11.Geometry, DispatchPattern=bool_13)  # -> ListA, ListB
dispatch_16 = Dispatch(List=move_10.Geometry, DispatchPattern=bool_15)  # -> ListA, ListB

# ---- group: module center (dynamic only)
pt_78 = Point([dispatch_16.ListA, dispatch_15.ListA, move_9.Geometry])

# ----
vec2pt_4 = Vector2Pt(PointA=Point(0, 0, 0), PointB=pt_78, Unitize=False)  # -> Vector, Length
dispatch_17 = Dispatch(List=pt_75, DispatchPattern=bool_12)  # -> ListA, ListB

# ---- group: Mesh at Orgin to Copy
mesh_40 = Mesh(scale_nu.Geometry)

# ----
pt_79 = Point(graft(dispatch_15.ListA))
pt_80 = Point(dispatch_14.ListA)
pt_81 = Point(dispatch_13.ListA)
pt_82 = Point(graft(dispatch_16.ListA))
item_40 = ListItem(List=num_93, Index=graft(int_133), Wrap=True)
item_41 = ListItem(List=num_91, Index=graft(int_133), Wrap=True)
item_42 = ListItem(List=num_92, Index=graft(int_133), Wrap=True)
move_12 = Move(Geometry=mesh_40, Motion=vec2pt_4.Vector)  # -> Geometry, Transform

# ---- group: open space module center
pt_83 = Point(dispatch_17.ListA)

# ----
cps_2 = ClosestPoints(Point=pt_82, Cloud=pt_81, Count=range_count_2)  # -> ClosestPoint, CPIndex, Distance
cps_3 = ClosestPoints(Point=pt_79, Cloud=pt_80, Count=range_count)  # -> ClosestPoint, CPIndex, Distance
pshift_36 = ShiftPaths(Data=item_40, Offset=-1)
pshift_37 = ShiftPaths(Data=item_41, Offset=-1)
pshift_38 = ShiftPaths(Data=item_42, Offset=-1)
cps_4 = ClosestPoints(Point=pt_77, Cloud=pt_83, Count=range_count_3)  # -> ClosestPoint, CPIndex, Distance
ma_7 = MassAddition(Input=cps_2.Distance)  # -> Result, PartialResults
ma_8 = MassAddition(Input=cps_3.Distance)  # -> Result, PartialResults

# ---- group: mesh on lego (dynamic only)
mesh_41 = Mesh(move_12.Geometry)

# ----
pshift_39 = ShiftPaths(Data=ma_7.Result, Offset=-2)
ma_9 = MassAddition(Input=cps_4.Distance)  # -> Result, PartialResults

# ---- group: old per flr
num_149 = Number(pshift_36)

# ---- group: young per flr
num_150 = Number(pshift_37)

# ---- group: mid per flr
num_151 = Number(pshift_38)

# ----
pshift_40 = ShiftPaths(Data=ma_8.Result, Offset=-2)
pshift_41 = ShiftPaths(Data=ma_9.Result, Offset=-2)
num_152 = Number(pshift_39)
num_153 = Number(pshift_40)

# ---- group: distance to closest open spaces
num_154 = Number(pshift_41)

# ----
one_over_x = OneOverX(Value=num_152)
one_over_x_2 = OneOverX(Value=num_153)
filter_31 = StreamFilter(Gate=bool_7, Stream1=mesh_41)
one_over_x_3 = OneOverX(Value=num_154)
bool_16 = Boolean(bool_10)
num_155 = Number(one_over_x)
bool_17 = Boolean(bool_10)
num_156 = Number(one_over_x_2)

# ---- group: is dynamic
bool_18 = Boolean(bool_10)

# ---- group: proximity score - all
num_157 = Number(one_over_x_3)

# ----
dispatch_18 = Dispatch(List=num_155, DispatchPattern=bool_16)  # -> ListA, ListB
dispatch_19 = Dispatch(List=num_156, DispatchPattern=bool_17)  # -> ListA, ListB
dispatch_20 = Dispatch(List=num_157, DispatchPattern=bool_18)  # -> ListA, ListB
num_158 = Number(dispatch_18.ListA)
num_159 = Number(dispatch_19.ListA)

# ---- group: proximity score - dynamic
num_160 = Number(dispatch_20.ListA)

# ----
bnd_4 = Bounds(Numbers=num_158)
panel_123 = Panel(bnd_4)
remap_6 = RemapNumbers(Value=num_158, Source="0.0 to 0.0002", Target="0.1 To 1.0")  # -> Mapped, Clipped
bnd_5 = Bounds(Numbers=num_159)
panel_124 = Panel(bnd_5)
remap_7 = RemapNumbers(Value=num_159, Source="0.0 to 0.00175", Target="0.1 To 1.0")  # -> Mapped, Clipped
bnd_6 = Bounds(Numbers=num_160)
panel_125 = Panel(bnd_6)
remap_8 = RemapNumbers(Value=num_160, Source=bnd_6, Target=Domain(0, 1))  # -> Mapped, Clipped
panel_126 = Panel(num_150)
num_161 = Number(remap_6.Mapped)
panel_127 = Panel(num_161)
num_162 = Number(remap_7.Mapped)
panel_128 = Panel(num_162)

# ---- group: heat map volume - normalized
num_163 = Number(remap_8.Mapped)

num_164 = Number([num_163, num_162, num_161])

# ----
gradient_6 = Gradient(LowerLimit=0, UpperLimit=1, Parameter=num_164, stops=[0: RGB(255, 0, 0), 0.5: RGB(255, 255, 0), 1: RGB(0, 128, 0)])
argb_8 = SplitARGB(Colour=gradient_6)  # -> Alpha, Red, Green, Blue
multiplication_33 = Multiplication(A=number_slider_30, B=argb_8.Alpha)
frgb_11 = ColourRGBF(Alpha=multiplication_33, Red=argb_8.Red, Green=argb_8.Green, Blue=argb_8.Blue)

# ---- group: heatmap
preview_15 = CustomPreview(Geometry=mesh_41, Shader=frgb_11)

# ----
panel_129 = Panel(num_163)

# ---- group: full site module id
int_138 = Integer(int_129)

# ---- group: module center (ful site)
pt_84 = Point(pt_70)

# ----
stream_filter_7 = StreamFilter(Gate=int_56, Stream7=pt_84)
stream_filter_8 = StreamFilter(Gate=int_56, Stream7=int_138)

# ---- group: full site module id
int_139 = Integer(stream_filter_8)

# ---- group: module center (ful site)
pt_85 = Point(stream_filter_7)

# ---- group: module center
pt_86 = Point(graft(pt_85))

# ---- group: Mesh at Orgin to Copy
# Heatmaps Collision Potential
mesh_42 = Mesh(mesh_40)

# ----
vec2pt_5 = Vector2Pt(PointA=Point(0, 0, 0), PointB=pt_85, Unitize=False)  # -> Vector, Length

# ---- group: get nearest N pts for each
cps_5 = ClosestPoints(Point=pt_86, Cloud=pt_85, Count=range_count_4)  # -> ClosestPoint, CPIndex, Distance

# ----
move_13 = Move(Geometry=mesh_42, Motion=vec2pt_5.Vector)  # -> Geometry, Transform
item_43 = ListItem(List=int_139, Index=cps_5.CPIndex, Wrap=False)

# ---- group: mesh on lego (dynamic only)
mesh_43 = Mesh(move_13.Geometry)

# ---- group: neaest module ids
int_140 = Integer(item_43)

# ----
equals_37 = Equality(FirstNumber=int_140, SecondNumber="3")  # -> Equality, Inequality
equals_38 = Equality(FirstNumber=int_140, SecondNumber="4")  # -> Equality, Inequality
equals_39 = Equality(FirstNumber=int_140, SecondNumber="0")  # -> Equality, Inequality
equals_40 = Equality(FirstNumber=int_140, SecondNumber=panel_81)  # -> Equality, Inequality
equals_41 = Equality(FirstNumber=int_140, SecondNumber="1")  # -> Equality, Inequality
equals_42 = Equality(FirstNumber=int_140, SecondNumber="2")  # -> Equality, Inequality
ma_10 = MassAddition(Input=equals_37.Equality)  # -> Result, PartialResults
ma_11 = MassAddition(Input=equals_38.Equality)  # -> Result, PartialResults
ma_12 = MassAddition(Input=equals_39.Equality)  # -> Result, PartialResults
ma_13 = MassAddition(Input=equals_40.Equality)  # -> Result, PartialResults
ma_14 = MassAddition(Input=equals_41.Equality)  # -> Result, PartialResults
ma_15 = MassAddition(Input=equals_42.Equality)  # -> Result, PartialResults
pshift_42 = ShiftPaths(Data=ma_10.Result, Offset=-2)
pshift_43 = ShiftPaths(Data=ma_11.Result, Offset=-2)
pshift_44 = ShiftPaths(Data=ma_12.Result, Offset=-2)
pshift_45 = ShiftPaths(Data=ma_13.Result, Offset=-2)
pshift_46 = ShiftPaths(Data=ma_14.Result, Offset=-2)
pshift_47 = ShiftPaths(Data=ma_15.Result, Offset=-2)

# ---- group: # RL nearby
int_141 = Integer(pshift_42)

# ---- group: # RM nearby
int_142 = Integer(pshift_43)

# ---- group: # RL nearby
int_143 = Integer(pshift_44)

# ---- group: # RS nearby
int_144 = Integer(pshift_45)

# ---- group: # RM nearby
int_145 = Integer(pshift_46)

# ---- group: # RS nearby
int_146 = Integer(pshift_47)

# ----
multiplication_34 = Multiplication(A=int_141, B=int_87)
multiplication_35 = Multiplication(A=int_143, B=int_88)
multiplication_36 = Multiplication(A=int_142, B=int_89)
multiplication_37 = Multiplication(A=int_144, B=int_90)
multiplication_38 = Multiplication(A=int_145, B=int_91)
multiplication_39 = Multiplication(A=int_146, B=int_92)
multiplication_40 = Multiplication(A=multiplication_34, B=num_122)
multiplication_41 = Multiplication(A=multiplication_36, B=num_123)
multiplication_42 = Multiplication(A=multiplication_35, B=num_122)
multiplication_43 = Multiplication(A=multiplication_38, B=num_123)
multiplication_44 = Multiplication(A=multiplication_37, B=num_124)
multiplication_45 = Multiplication(A=multiplication_39, B=num_124)

# ---- group: RL pop.
num_165 = Number(graft(multiplication_40))

# ---- group: RS pop.
num_166 = Number(graft(multiplication_44))

# ---- group: RM pop.
num_167 = Number(graft(multiplication_41))

# ----
ma_16 = MassAddition(Input=[num_165, num_167, num_166])  # -> Result, PartialResults
pshift_48 = ShiftPaths(Data=ma_16.Result, Offset=-1)

# ---- group: RL pop.
num_168 = Number(graft(multiplication_42))

# ---- group: RS pop.
num_169 = Number(graft(multiplication_45))

# ---- group: RM pop.
num_170 = Number(graft(multiplication_43))

# ----
# Density
ma_17 = MassAddition(Input=[num_168, num_170, num_169, num_165, num_167, num_166])  # -> Result, PartialResults
pshift_49 = ShiftPaths(Data=ma_17.Result, Offset=-1)

# ---- group: residential diversity
num_171 = Number(pshift_49)

# ----
bnd_7 = Bounds(Numbers=num_171)
panel_130 = Panel(bnd_7)
remap_9 = RemapNumbers(Value=num_171, Source=bnd_7, Target=Domain(0, 1))  # -> Mapped, Clipped

# ---- group: value 1 - remapped
num_172 = Number(remap_9.Mapped)

# ----
panel_131 = Panel(num_172)
ma_18 = MassAddition(Input=[num_168, num_170, num_169])  # -> Result, PartialResults
pshift_50 = ShiftPaths(Data=ma_18.Result, Offset=-1)
division_9 = Division(A=pshift_49, B="4000")

# ---- group: RL pop.
num_173 = Number(graft(pshift_50))

# ---- group: RM pop.
num_174 = Number(graft(pshift_48))

# ----
addition_12 = Addition(A=num_166, B=panel_84)
addition_13 = Addition(A=num_165, B=panel_84)
addition_14 = Addition(A=num_167, B=panel_84)
addition_15 = Addition(A=num_169, B=panel_86)
addition_16 = Addition(A=num_168, B=panel_86)
addition_17 = Addition(A=num_170, B=panel_86)
ma_19 = MassAddition(Input=[addition_13, addition_14, addition_12])  # -> Result, PartialResults
ma_20 = MassAddition(Input=[addition_16, addition_17, addition_15])  # -> Result, PartialResults
addition_18 = Addition(A=num_173, B=panel_88)
addition_19 = Addition(A=num_174, B=panel_88)
ma_21 = MassAddition(Input=[addition_18, addition_19])  # -> Result, PartialResults

# ---- group: total res. pop.
num_175 = Number(ma_19.Result)

# ----
division_10 = Division(A=addition_13, B=num_175)
division_11 = Division(A=addition_12, B=num_175)
division_12 = Division(A=addition_14, B=num_175)

# ---- group: total res. pop.
num_176 = Number(ma_20.Result)

# ----
division_13 = Division(A=addition_16, B=num_176)
division_14 = Division(A=addition_15, B=num_176)
division_15 = Division(A=addition_17, B=num_176)

# ---- group: total res. pop.
num_177 = Number(ma_21.Result)

# ----
division_16 = Division(A=addition_18, B=num_177)
division_17 = Division(A=addition_19, B=num_177)

# ---- group: % RL pop.
num_178 = Number(division_10)

# ---- group: % RM pop.
num_179 = Number(division_12)

# ---- group: % RS pop.
num_180 = Number(division_11)

# ---- group: % RL pop.
num_181 = Number(division_13)

# ---- group: % RM pop.
num_182 = Number(division_15)

# ---- group: % RS pop.
num_183 = Number(division_14)

# ---- group: % RL pop.
num_184 = Number(division_16)

# ---- group: % RM pop.
num_185 = Number(division_17)

# ---- group: Diversity Calc
eval_2 = Evaluate(F=panel_85, P1=num_178, P2=num_179, P3=num_180)

eval_3 = Evaluate(F=panel_87, P1=num_181, P2=num_182, P3=num_183)

# ----
eval_4 = Evaluate(F=panel_83, P1=num_184, P2=num_185)
pshift_51 = ShiftPaths(Data=eval_2, Offset=-1)
pshift_52 = ShiftPaths(Data=eval_3, Offset=-1)
pshift_53 = ShiftPaths(Data=eval_4, Offset=-1)

# ---- group: residential diversity - all
num_186 = Number(pshift_51)

num_187 = Number(pshift_52)

# ----
subtraction_7 = Subtraction(A=ma_18.Result, B=ma_16.Result)

# ---- group: residential diversity - all
num_188 = Number(pshift_53)

# ----
replace_2 = ReplaceMembers(Set=num_186, Find=num_95, Replace=num_96)
replace_3 = ReplaceMembers(Set=num_187, Find=num_98, Replace=num_97)
replace_4 = ReplaceMembers(Set=num_188, Find=num_99, Replace=num_100)

# ---- group: residential diversity - dynamic
num_189 = Number(replace_2)

num_190 = Number(num_189)

# ----
bnd_8 = Bounds(Numbers=num_190)
panel_132 = Panel(bnd_8)
remap_10 = RemapNumbers(Value=num_190, Source=bnd_8, Target=Domain(0, 1))  # -> Mapped, Clipped

# ---- group: value 1 - remapped
num_191 = Number(remap_10.Mapped)

# ----
panel_133 = Panel(num_191)

# ---- group: residential diversity
num_192 = Number(replace_3)

num_193 = Number(num_192)

# ----
bnd_9 = Bounds(Numbers=num_193)
panel_134 = Panel(bnd_9)
remap_11 = RemapNumbers(Value=num_193, Source=bnd_9, Target=Domain(0, 1))  # -> Mapped, Clipped

# ---- group: value 1 - remapped
num_194 = Number(remap_11.Mapped)

# ----
panel_135 = Panel(num_194)

# ---- group: residential diversity - dynamic
num_195 = Number(replace_4)

num_196 = Number(num_195)

# ----
bnd_10 = Bounds(Numbers=num_196)
panel_136 = Panel(bnd_10)
remap_12 = RemapNumbers(Value=num_196, Source=bnd_10, Target=Domain(0, 1))  # -> Mapped, Clipped

# ---- group: value 1 - remapped
num_197 = Number(remap_12.Mapped)

# ----
panel_137 = Panel(num_197)
multiplication_46 = Multiplication(A=num_189, B=num_101)
multiplication_47 = Multiplication(A=num_195, B=num_102)
multiplication_48 = Multiplication(A=num_192, B=num_103)

# ---- group: density
num_198 = Number(division_9)

# ----
addition_20 = Addition(A=multiplication_48, B=multiplication_46)
addition_21 = Addition(A=addition_20, B=multiplication_47)
multiplication_49 = Multiplication(A=num_198, B=Slider(1, range=0..10))

# ---- group: weighted diversity
num_199 = Number(addition_21)

# ----
multiplication_50 = Multiplication(A=num_199, B=num_104)
multiplication_51 = Multiplication(A=multiplication_49, B=num_105)
addition_22 = Addition(A=multiplication_50, B=multiplication_51)

# ---- group: final score
num_200 = Number(addition_22)

# ---- group: heat map volume - normalized
num_201 = Number(num_200)

# ----
gradient_7 = Gradient(LowerLimit=0, UpperLimit=1, Parameter=num_201, stops=[0: RGB(255, 0, 0), 0.5: RGB(255, 255, 0), 1: RGB(0, 128, 0)])
argb_9 = SplitARGB(Colour=gradient_7)  # -> Alpha, Red, Green, Blue
multiplication_52 = Multiplication(A=number_slider_34, B=argb_9.Alpha)
frgb_12 = ColourRGBF(Alpha=multiplication_52, Red=argb_9.Red, Green=argb_9.Green, Blue=argb_9.Blue)

# ---- group: heatmap
preview_16 = CustomPreview(Geometry=mesh_43, Shader=frgb_12)

# ---- group: Full site statistics (continued)
cluster_17 = Cluster_8(A=population_calculation.num_2, int=int_11, txt=panel_93)  # -> R_6, R_2, R_3, R_5, R, R_4, txt_3
int_147 = Integer(cluster_17.R)
int_148 = Integer(cluster_17.R_5)
int_149 = Integer(cluster_17.R_4)
int_150 = Integer(cluster_17.R_3)
int_151 = Integer(cluster_17.R_6)
int_152 = Integer(cluster_17.R_2)

# ---- group: Full site / Micro-unit ppl #
int_153 = Integer(int_150)

# ---- group: Full site / Luxury ppl #
int_154 = Integer(int_151)

# ---- group: Full site / Regular residential ppl #
int_155 = Integer(int_152)

# ----
repeat_10 = RepeatData(Data=int_153, Length=2)
rev_3 = ReverseList(List=cluster_17.txt_3)
pshift_54 = ShiftPaths(Data=repeat_10, Offset=-1)
addition_23 = Addition(A=int_154, B=int_105)
addition_24 = Addition(A=int_155, B=int_102)
addition_25 = Addition(A=int_153, B=int_101)

# ---- group: Micro-unit ppl #
int_156 = Integer(addition_25)

# ----
panel_138 = Panel([int_156, int_153])
multiplication_53 = Multiplication(Pop=graft(panel_138), WPerS=num_3)  # -> graft(Result)
multiplication_54 = Multiplication(Pop=graft(panel_138), WPerS=num_2)  # -> graft(Result)
multiplication_55 = Multiplication(Pop=graft(panel_138), WPerS=num_5)  # -> graft(Result)
cluster_18 = Cluster_5(list=multiplication_54, number=multiplication_54)
cluster_19 = Cluster_6(list=multiplication_53, number=multiplication_53)
multiplication_56 = Multiplication(Pop=graft(panel_138), WPerS=num_4)  # -> graft(Result)

# ---- group: Luxury ppl #
int_157 = Integer(addition_23)

# ---- group: Regular residential ppl #
int_158 = Integer(addition_24)

# ----
ma_22 = MassAddition(Input=[int_157, int_158, int_156])  # -> Result, PartialResults
panel_139 = Panel([int_158, int_155])
multiplication_57 = Multiplication(Pop=graft(panel_139), WPerS=num_18)  # -> graft(Result)
repeat_11 = RepeatData(Data=int_155, Length=2)
multiplication_58 = Multiplication(Pop=graft(panel_139), WPerS=num_16)  # -> graft(Result)
multiplication_59 = Multiplication(Pop=graft(panel_139), WPerS=num_15)  # -> graft(Result)
multiplication_60 = Multiplication(Pop=graft(panel_139), WPerS=num_17)  # -> graft(Result)

# ---- group: Full site statistics / Regular Office ppl #
int_159 = Integer(int_147)

# ---- group: Full site statistics / Head Quater ppl #
int_160 = Integer(int_148)

# ---- group: Full site statistics / Co-working ppl #
int_161 = Integer(int_149)

# ----
cluster_20 = Cluster_6(list=multiplication_58, number=multiplication_58)

# ---- group: Full site statistics / Micro-unit ppl #
int_162 = Integer(int_150)

# ---- group: Full site statistics / Luxury ppl #
int_163 = Integer(int_151)

# ---- group: Full site statistics / Regular residential ppl #
int_164 = Integer(int_152)

# ----
pshift_55 = ShiftPaths(Data=repeat_11, Offset=-1)
cluster_21 = Cluster_5(list=multiplication_59, number=multiplication_59)
panel_140 = Panel([int_157, int_154])
repeat_12 = RepeatData(Data=int_154, Length=2)
multiplication_61 = Multiplication(Pop=graft(panel_140), WPerS=num_31)  # -> graft(Result)

# ---- group: Full site statistics (continued)
panel_141 = Panel([int_163, int_164, int_162, int_160, int_159, int_161])

# ----
multiplication_62 = Multiplication(Pop=graft(panel_140), WPerS=num_30)  # -> graft(Result)
multiplication_63 = Multiplication(Pop=graft(panel_140), WPerS=num_27)  # -> graft(Result)
multiplication_64 = Multiplication(Pop=graft(panel_140), WPerS=num_28)  # -> graft(Result)

# ---- group: total old
addition_26 = Addition(A=int_163, B=int_160)

# ---- group: total mid
addition_27 = Addition(A=int_164, B=int_159)

# ---- group: total young
addition_28 = Addition(A=int_162, B=int_161)

# ----
pshift_56 = ShiftPaths(Data=repeat_12, Offset=-1)
cluster_22 = Cluster_6(list=multiplication_64, number=multiplication_64)
cluster_23 = Cluster_5(list=multiplication_63, number=multiplication_63)
ma_23 = MassAddition(Input=[addition_26, addition_27, addition_28])  # -> Result, PartialResults

# ---- group: Full site / Regular Office ppl #
int_165 = Integer(int_147)

# ---- group: Full site / Head Quater ppl #
int_166 = Integer(int_148)

# ---- group: Full site / Co-working ppl #
int_167 = Integer(int_149)

# ----
repeat_13 = RepeatData(Data=int_167, Length=2)
pshift_57 = ShiftPaths(Data=repeat_13, Offset=-1)
addition_29 = Addition(A=int_167, B=int_104)
addition_30 = Addition(A=int_165, B=int_100)
addition_31 = Addition(A=int_166, B=int_103)

# ---- group: Regular Office ppl #
int_168 = Integer(addition_30)

# ----
panel_142 = Panel([int_168, int_165])

# ---- group: Head Quater ppl #
int_169 = Integer(addition_31)

# ---- group: Co-working ppl #
int_170 = Integer(addition_29)

# ----
panel_143 = Panel([int_170, int_167])
multiplication_65 = Multiplication(Pop=graft(panel_143), WPerS=num_51)  # -> graft(Result)
multiplication_66 = Multiplication(Pop=graft(panel_143), WPerS=num_49)
multiplication_67 = Multiplication(Pop=graft(panel_143), WPerS=num_50)  # -> graft(Result)
multiplication_68 = Multiplication(Pop=graft(panel_143), WPerS=num_48)  # -> graft(Result)
cluster_24 = Cluster_6(list=multiplication_66, number=multiplication_66)
cluster_25 = Cluster_4(list=multiplication_68, number=multiplication_68)
multiplication_69 = Multiplication(Pop=graft(panel_142), WPerS=num_63)  # -> graft(Result)
repeat_14 = RepeatData(Data=int_165, Length=2)
multiplication_70 = Multiplication(Pop=graft(panel_142), WPerS=num_61)  # -> graft(Result)
multiplication_71 = Multiplication(Pop=graft(panel_142), WPerS=num_62)  # -> graft(Result)
multiplication_72 = Multiplication(Pop=graft(panel_142), WPerS=num_60)  # -> graft(Result)
cluster_26 = Cluster_6(list=multiplication_70, number=multiplication_70)
pshift_58 = ShiftPaths(Data=repeat_14, Offset=-1)
cluster_27 = Cluster_4(list=multiplication_72, number=multiplication_72)
panel_144 = Panel([int_169, int_166])
multiplication_73 = Multiplication(Pop=graft(panel_144), WPerS=num_67)  # -> graft(Result)
cluster_28 = Cluster_2(num=[multiplication_55, multiplication_57, multiplication_61, multiplication_65, multiplication_69, multiplication_73])
num_202 = Number(cluster_28)
panel_145 = Panel(num_202)
num_203 = Number([num_202, subset_4.List])
cluster_29 = Cluster_3(values=num_203, B=num_9, per_indicator=num_11)
panel_146 = Panel(cluster_29)
cluster_30 = Cluster_3(values=num_203, B=num_20, per_indicator=num_23)
panel_147 = Panel(cluster_30)
cluster_31 = Cluster_3(values=num_203, B=num_33, per_indicator=num_37)
panel_148 = Panel(cluster_31)
cluster_32 = Cluster_3(values=num_203, B=num_42, per_indicator=num_45)
panel_149 = Panel(cluster_32)
cluster_33 = Cluster_3(values=num_203, B=num_55, per_indicator=num_56)
panel_150 = Panel(cluster_33)
repeat_15 = RepeatData(Data=int_166, Length=2)
multiplication_74 = Multiplication(Pop=graft(panel_144), WPerS=num_65)  # -> graft(Result)
cluster_34 = Cluster_2(num=[multiplication_53, multiplication_58, multiplication_64, multiplication_66, multiplication_70, multiplication_74])
num_204 = Number(cluster_34)
panel_151 = Panel(num_204)
num_205 = Number([num_204, subset_2.List])
cluster_35 = Cluster_3(values=num_205, B=num_8, per_indicator=num_12)
panel_152 = Panel(cluster_35)
cluster_36 = Cluster_3(values=num_205, B=num_22, per_indicator=num_25)
panel_153 = Panel(cluster_36)
cluster_37 = Cluster_3(values=num_205, B=num_34, per_indicator=num_39)
panel_154 = Panel(cluster_37)
cluster_38 = Cluster_3(values=num_205, B=num_43, per_indicator=num_47)
panel_155 = Panel(cluster_38)
cluster_39 = Cluster_3(values=num_205, B=num_52, per_indicator=num_57)
panel_156 = Panel(cluster_39)
multiplication_75 = Multiplication(Pop=graft(panel_144), WPerS=num_66)  # -> graft(Result)
cluster_40 = Cluster_2(num=[multiplication_56, multiplication_60, multiplication_62, multiplication_67, multiplication_71, multiplication_75])
num_206 = Number(cluster_40)
panel_157 = Panel(num_206)
num_207 = Number([num_206, subset.List])
cluster_41 = Cluster_3(values=num_207, B=num_7, per_indicator=num_13)
panel_158 = Panel(cluster_41)
ma_24 = MassAddition(Input=[panel_28, panel_158, panel_146, panel_152])  # -> Result, PartialResults
panel_159 = Panel(ma_24.Result)
cluster_42 = Cluster_3(values=num_207, B=num_19, per_indicator=num_26)
panel_160 = Panel(cluster_42)
ma_25 = MassAddition(Input=[panel_31, panel_160, panel_147, panel_153])  # -> Result, PartialResults
panel_161 = Panel(ma_25.Result)
cluster_43 = Cluster_3(values=num_207, B=num_32, per_indicator=num_38)
panel_162 = Panel(cluster_43)
ma_26 = MassAddition(Input=[panel_35, panel_162, panel_148, panel_154])  # -> Result, PartialResults
panel_163 = Panel(ma_26.Result)
cluster_44 = Cluster_3(values=num_207, B=num_41, per_indicator=num_46)
panel_164 = Panel(cluster_44)
ma_27 = MassAddition(Input=[panel_40, panel_164, panel_149, panel_155])  # -> Result, PartialResults
panel_165 = Panel(ma_27.Result)
cluster_45 = Cluster_3(values=num_207, B=num_54, per_indicator=num_59)
panel_166 = Panel(cluster_45)
ma_28 = MassAddition(Input=[panel_41, panel_166, panel_150, panel_156])  # -> Result, PartialResults
panel_167 = Panel(ma_28.Result)
txt_100 = Text([panel_159, panel_161, panel_163, panel_165, panel_167])

# ---- group: final bar chart numbers
num_208 = Number(txt_100)

# ----
panel_168 = Panel(num_208)
remap_13 = RemapNumbers(Value=num_208, Source="10000 To 40000", Target=Domain(0, 1))  # -> Mapped, Clipped
bnd_11 = Bounds(Numbers=num_208)
panel_169 = Panel(bnd_11)
min_2 = Minimum(A=remap_13.Mapped, B=Slider(1, range=0..1))
panel_170 = Panel(min_2)
multiplication_76 = Multiplication(Pop=graft(panel_144), WPerS=num_64)  # -> graft(Result)
cluster_46 = Cluster_2(num=[multiplication_68, multiplication_72, multiplication_76, multiplication_54, multiplication_59, multiplication_63])
num_209 = Number(cluster_46)

# ---- group: all radar chart values
num_210 = Number([num_209, num_206, num_202, num_204])

# ----
volpe_kendall = Panel(num_210)
bnd_12 = Bounds(Numbers=[volpe_kendall, barcelona])
panel_171 = Panel(bnd_12)
division_18 = Division(A=num_210, B=ma_22.Result)
bnd_13 = Bounds(Numbers=num_210)
remap_14 = RemapNumbers(Value=num_210, Source="0 To 40000", Target=Domain(0, 1))  # -> Mapped, Clipped
panel_172 = Panel(num_209)
panel_173 = Panel(bnd_13)
dedomain_3 = DeconstructDomain(Domain=panel_173)  # -> Start, End
dom_9 = ConstructDomain(DomainStart=dedomain_3.Start, DomainEnd=expr("x*1.3", dedomain_3.End))
min_3 = Minimum(A=remap_14.Mapped, B=Slider(1, range=0..1))
pshift_59 = ShiftPaths(Data=min_3, Offset=2)
bang = ExplodeTree(Data=pshift_59)  # -> Branch0, Branch1

# ---- group: Full site
num_211 = Number(bang.Branch1)

# ---- group: Volpe
num_212 = Number(bang.Branch0)

# ---- group: all radar chart values - normalized
num_213 = Number([num_212, num_211])

# ---- group: normalized bar chart values
num_214 = Number(min_2)

# ----
pshift_60 = ShiftPaths(Data=repeat_15, Offset=-1)
cluster_47 = Cluster_6(list=multiplication_74, number=multiplication_74)
cluster_48 = Cluster_4(list=multiplication_76, number=multiplication_76)
txt_101 = Text([panel_138, panel_139, panel_140, panel_143, panel_142, panel_144])

# ---- group: pop. per type list
int_171 = Integer(txt_101)

# ----
ma_29 = MassAddition(Input=int_171)  # -> Result, PartialResults

# ---- group: total population
int_172 = Integer(ma_29.Result)

int_173 = Integer(int_172)

# ----
division_19 = Division(TotalPop=int_173, PeoplePerAmenity=int_28)
num_215 = Number(division_19)
panel_174 = Panel(num_215)
int_174 = Integer(num_215)
panel_175 = Panel(int_174)

# ---- group: Required Amenities
int_175 = Integer(num_215)

# ---- group: normalized bar chart values
num_216 = Number(num_214)

# ----
panel_176 = Panel(num_216)
multiplication_77 = Multiplication(A=panel_176, B=Slider(1.3, range=0..5))
multiplication_78 = Multiplication(A=multiplication_77, B=number_slider_17)
num_217 = Number(multiplication_78)
remap_15 = RemapNumbers(Value=num_217, Source=dom_3, Target=dom_4)  # -> Mapped, Clipped

# ---- group: Chart curves / all radar chart values - normalized
num_218 = Number(num_213)

# ----
split_9 = SplitTree(Data=remap_15.Mapped, Masks=flatten(["{0;0}", "{0;0;1}"]))  # -> Positive, Negative
cull_i_4 = CullIndex(List=num_218, Indices=panel_56, Wrap=True)
gradient_8 = Gradient(
    LowerLimit=dedomain.Start,
    UpperLimit=dedomain.End,
    Parameter=split_9.Negative,
    stops=[0.122: RGB(255, 0, 0), 0.367: RGB(255, 255, 0), 0.617: RGB(0, 128, 0)])
gradient_9 = Gradient(
    LowerLimit=dedomain.Start,
    UpperLimit=dedomain.End,
    Parameter=split_9.Negative,
    stops=[0: RGB(234, 38, 0), 0.25: RGB(234, 126, 0), 0.5: RGB(254, 244, 84), 0.75: RGB(173, 203, 249), 1: RGB(75, 107, 169)])

# ---- group: Chart curves
panel_177 = Panel(cull_i_4)
polygon_4 = Polygon(Plane=pt_23, Radius=number_slider_14, Segments=lng_7, FilletRadius=0)  # -> Polygon, Length
cp_3 = ControlPoints(Curve=polygon_4.Polygon)  # -> Points, Weights, Knots
partition = PartitionList(List=panel_177, Size=graft(lng_7))
cull_i_5 = CullIndex(List=cp_3.Points, Indices=lng_7, Wrap=True)
panel_178 = Panel(partition)
ln_3 = Line(StartPoint=pt_23, EndPoint=graft(cull_i_5))
dom_10 = ConstructDomain(DomainStart=Slider(0, range=0..100), DomainEnd=Slider(1, range=0..100))
remap_16 = RemapNumbers(Value=[panel_178, num_35], Source=dom_10, Target=Domain(0, 1))  # -> Mapped, Clipped
eval_5 = EvaluateCurve(Curve=flatten(ln_3), Parameter=remap_16.Mapped)  # -> Point, Tangent, Angle
swatch_9 = ColourSwatch(SwatchColor=RGBA(16, 76, 135, 159))
swatch_10 = ColourSwatch(SwatchColor=RGBA(140, 191, 230, 175))
swatch_11 = ColourSwatch(SwatchColor=RGBA(58, 255, 91, 136))
pline_3 = PolyLine(Vertices=eval_5.Point, Closed=True)
fillet = Fillet(Curve=pline_3, Radius=0)  # disabled
branch_3 = TreeBranch(Tree=pline_3, Path="{0;0;1;0}", MaintainPaths=True)
branch_4 = TreeBranch(Tree=pline_3, Path="{0;0;0;0}", MaintainPaths=True)
col_20 = Colour(graft([swatch_11, swatch_9, swatch_10]))
loft = Loft(
    Curves=flatten([branch_4, branch_3]),
    Options={Adjust=False, Closed=False, LoftEnds=0, LoftSimp=0, LoftType=3, Rebuild=10, Refit=0.01})
swatch_12 = ColourSwatch(SwatchColor=RGB(97, 97, 97))
preview_17 = CustomPreview(Geometry=loft, Shader=ColourSwatch(SwatchColor=RGBA(126, 169, 230, 238)))

# ----
col_21 = Colour(swatch_9)
col_22 = Colour(gradient_8)

# ---- group: Chart curves / radar back lines
preview_18 = CustomPreview(Geometry=ln_3, Shader=swatch_12)

# ---- group: Chart curves / plotes
preview_19 = CustomPreview(Geometry=pline_3, Shader=col_20)

# ----
merge_11 = Merge(Data1=swatch_11, Data2=swatch_10)
argb_10 = SplitARGB(Colour=merge_11)  # -> Alpha, Red, Green, Blue
frgb_13 = ColourRGBF(Alpha=1, Red=argb_10.Red, Green=argb_10.Green, Blue=argb_10.Blue)
num_219 = Number(addition_26)  # disabled
num_220 = Number(addition_27)  # disabled
num_221 = Number(addition_28)  # disabled
item_44 = ListItem(List=rev_3, Index=index, Wrap=True)
pshift_61 = ShiftPaths(Data=item_44, Offset=-1)
filter_32 = StreamFilter(Gate=whole_site_t_active_site_f, Stream0=item_39, Stream1=pshift_61)

# ---- group: flr #s
txt_102 = Text(filter_32)

# ----
multiplication_79 = Multiplication(A=num_151, B=txt_102)
multiplication_80 = Multiplication(A=num_150, B=txt_102)
multiplication_81 = Multiplication(A=num_149, B=txt_102)
ma_30 = MassAddition(Input=[int_164, int_159])  # -> Result, PartialResults; disabled
num_222 = Number([int_162, int_161])  # disabled

# ---- group: total ppl in building mid
int_176 = Integer(multiplication_79)

# ---- group: total ppl in building young
int_177 = Integer(multiplication_80)

# ---- group: total ppl in building old
int_178 = Integer(multiplication_81)

# ----
panel_179 = Panel(txt_102)

# ----
# Clustering Calc
clustering_by_id = PythonScript(xe=int_41, ye=int_42, x=int_45, y=int_44, id=int_78)  # -> out, m, clusterList, clusterIds; inputs x: list, y: list, id: list
# ---------- clustering_by_id: Python ----------
"""
CityMatrix

MIT Media Lab, Changing Place Group
"""

import rhinoscriptsyntax as rs

clusterList = []
clusterIds = []
clusterIndex = [0 for i in range(len(id))]

# List to tree conversion
# From https://gist.githubusercontent.com/piac/ef91ac83cb5ee92a1294/raw/dc4e341c16b09dee3c6727dcec851d9af4ecc46f/list_to_tree.py
def list_to_tree(input, none_and_holes=True, source=[0]):
    """Transforms nestings of lists or tuples to a Grasshopper DataTree"""
    from Grasshopper import DataTree as Tree
    from Grasshopper.Kernel.Data import GH_Path as Path
    from System import Array
    def proc(input,tree,track):
        path = Path(Array[int](track))
        if len(input) == 0 and none_and_holes: tree.EnsurePath(path); return
        for i,item in enumerate(input):
            if hasattr(item, '__iter__'): #if list or tuple
                track.append(i); proc(item,tree,track); track.pop()
            else:
                if none_and_holes: tree.Insert(item,path,i)
                elif item is not None: tree.Add(item,path)
    if input is not None: t=Tree[object]();proc(input,t,source[:]);
    return t

def cluster():
    currList = []
    
    for i in range(0, xe):
        for j in range(0, ye):
#            print str(i) + " " + str(j) + " " + str(m[i][j])
            up = -5
            left = -5
            if (i-1>=0):
                up = m[i-1][j]
                upId = clusterIndex[(i-1)*xe + j]
            if (j-1>=0):
                left = m[i][j-1]
                leftId = clusterIndex[j-1 + i*xe]
            curr = m[i][j]
            
            if (curr < 0) or (curr > 5):
                continue
                
            index = i*xe + j
            
            
            # make new cluster
            if (left != curr) and (up != curr):
                currList = []
                currList.append(index)
                clusterList.append(currList)
                clusterIds.append(curr)
                
                # save curr cluster's number
                if (len(clusterList)-1) >= 0:
                    clusterIndex[index] = len(clusterList)-1
            # or find existing cluster
            elif (up == curr) and (left == curr) and i-1>=0 and j-1>=0:
                clusterList[upId].append(index)
                clusterList[upId].append(j-1 + i*xe) # must also remove!
                clusterIndex[index] = clusterIndex[(i-1)*xe + j]
                if (len(clusterList) < leftId):
                    print clusterList[leftId]
                    del clusterList[leftId]
                    del clusterIds[leftId]
            elif (up == curr) and i-1>=0:
                clusterList[upId].append(index)
                clusterIndex[index] = clusterIndex[(i-1)*xe + j]
            elif (left == curr) and j-1>=0:
                clusterList[leftId].append(index)
                clusterIndex[index] = clusterIndex[j-1 + i*xe]
        
    #print clusterIndex
    print clusterList
    print clusterIds


m = [[-1 for n in range(xe)] for n in range(ye)]
    
for n in range(len(id)):
    m[y[n]][x[n]] = id[n]
    
for n in range(ye):
    print m[n]
    
cluster()
clusterList = list_to_tree(clusterList)
# ---------- end clustering_by_id ----------
num_223 = Number(clustering_by_id.clusterList)
# Clustering Viz
panel_180 = Panel(num_223)
division_20 = Division(A=num_129, B=Slider(2, range=0..10))
vec_2 = VectorXYZ(XComponent=division_20, YComponent=division_20, ZComponent=0)  # -> Vector, Length
neg_3 = Negative(Value=vec_2.Vector)

# ---- group: ID list
int_179 = Integer(clustering_by_id.clusterIds)

int_180 = Integer(clustering_by_id.clusterIds)

# ----
modulecenter_2 = ModuleCenter(pt=pt_18, num=num_128, int_2=int_45, int=int_44)  # -> pt_5, transform_2
xform = Transform(modulecenter_2.transform_2)  # disabled
item_45 = ListItem(List=mesh_27, Index=graft(dispatch_2.ListA), Wrap=True)
pshift_62 = ShiftPaths(Data=item_45, Offset=-1)
rotate_3 = Rotate(Geometry=pshift_62, Angle=degrees(dispatch_3.ListA), Plane=PlaneXY(0, 0, 0))  # -> Geometry, Transform

# ---- group: module center
pt_87 = Point(modulecenter_2.pt_5)

pt_88 = Point(pt_87)

# ----
dispatch_21 = Dispatch(List=pt_88, DispatchPattern=and)  # -> ListA, ListB

# ---- group: module center - 0 to 5
pt_89 = Point(dispatch_21.ListA)

# ----
dist_3 = Distance(PointA=pt_89, PointB=pt_17)
one_over_x_4 = OneOverX(Value=dist_3)
bnd_14 = Bounds(Numbers=one_over_x_4)
remap_17 = RemapNumbers(Value=one_over_x_4, Source=bnd_14, Target=Domain(0, 1))  # -> Mapped, Clipped
lng_12 = ListLength(List=dist_3)
graph_2 = GraphMapper(
    remap_17.Mapped,
    x0=0,
    x1=1,
    y0=0,
    y1=1,
    container_name="Bezier",
    cpx=[0, 0.02228338085, 0.545909524, 1],
    cpy=[0, 0.3859086633, 0.9269992113, 0.9974365234])
random = Random(Range=Domain(0, 1), Number=lng_12, Seed=Slider(25, range=0..100))
multiplication_82 = Multiplication(A=graph_2, B=num_136)

# ---- group: attracting score / pop chance
num_224 = Number(multiplication_82)

# ----
smaller_5 = SmallerThan(FirstNumber=random, SecondNumber=num_224)  # -> SmallerThan, OrEqualTo

# ---- group: pop or not
bool_19 = Boolean(smaller_5.OrEqualTo)

# ----
dispatch_22 = Dispatch(List=pt_89, DispatchPattern=bool_19)  # -> ListA, ListB

# ---- group: module center - popped 3rd places
pt_90 = Point(dispatch_22.ListA)

# ----
lng_13 = ListLength(List=pt_90)
lng_14 = ListLength(List=pt_90)
random_2 = Random(Range=dom_2, Number=lng_13, Seed=Slider(26, range=0..100))
random_3 = Random(Range=dom, Number=lng_14, Seed=Slider(86, range=0..100))
item_46 = ListItem(List=mesh_17, Index=random_2, Wrap=False)
item_47 = ListItem(List=merge_8, Index=random_3, Wrap=False)
vec2pt_6 = Vector2Pt(PointA=Point(0, 0, 0), PointB=pt_90, Unitize=False)  # -> Vector, Length
filter_33 = StreamFilter(Gate=number_slider_11, Stream0=item_47, Stream1=black)

# ---- group: random profile colors
col_23 = Colour(filter_33)

# ----
move_14 = Move(Geometry=item_46, Motion=vec2pt_6.Vector)  # -> Geometry, Transform
mcol_3 = MeshColours(Mesh=graft(move_14.Geometry), Colours=graft(col_23))
pshift_63 = ShiftPaths(Data=mcol_3, Offset=-1)

# ---- group: 3rd Places Meshes
mesh_44 = Mesh(pshift_63)

# ----
filter_34 = StreamFilter(Gate=bool_2, Stream1=mesh_44)

# ---- group: 3rd Places Meshes
mesh_45 = Mesh(filter_34)

# ---- group: module center
pt_91 = Point(pt_87)

# ----
item_48 = ListItem(List=pt_91, Index=num_223, Wrap=True)
move_15 = Move(Geometry=item_48, Motion=neg_3)  # -> Geometry, Transform
planesrf_2 = PlaneSurface(Plane=move_15.Geometry, XSize=num_129, YSize=num_129)
runion = RegionUnion(Curves=planesrf_2)
lng_15 = ListLength(List=planesrf_2)
equals_43 = Equality(FirstNumber=lng_15, SecondNumber=1)  # -> Equality, Inequality
boundary_3 = BoundarySurfaces(Edges=runion)
cull = CullPattern(List=planesrf_2, CullPattern=equals_43.Equality)
area_2 = Area(Geometry=cull)  # -> Area, Centroid
area_3 = Area(Geometry=boundary_3)  # -> Area, Centroid

# ---- group: module center
pt_92 = Point(modulecenter_2.pt_5)

# ----
# Activation Mask
addition_32 = Addition(A=cell_shrink, B=0.05)
mesh_46 = Mesh(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)
num_225 = Number(addition_32)
scale_nu_2 = ScaleNU(Geometry=mesh_46, Plane=PlaneXY(0, 0, 0), ScaleX=num_225, ScaleY=num_225, ScaleZ=1)  # -> Geometry, Transform
equals_44 = Equality(FirstNumber=int_49, SecondNumber="-1")  # -> Equality, Inequality
equals_45 = Equality(FirstNumber=int_83, SecondNumber=int_49)  # -> Equality, Inequality
Z_11 = UnitZ(Factor=Slider(6.1, range=0..110))
equals_46 = Equality(FirstNumber=int_82, SecondNumber="1")  # -> Equality, Inequality
equals_47 = Equality(FirstNumber=int_82, SecondNumber="2")  # -> Equality, Inequality
and_5 = GateAnd(A=equals_47.Inequality, B=equals_46.Inequality)
equals_48 = Equality(FirstNumber=int_82, SecondNumber="0")  # -> Equality, Inequality
and_6 = GateAnd(A=and_5, B=equals_48.Inequality)
equals_49 = Equality(FirstNumber=int_82, SecondNumber="-1")  # -> Equality, Inequality
and_7 = GateAnd(A=equals_46.Inequality, B=equals_49.Inequality)
and_8 = GateAnd(A=equals_47.Inequality, B=equals_49.Inequality)
and_9 = GateAnd(A=equals_48.Inequality, B=equals_49.Inequality)
move_16 = Move(Geometry=scale_nu_2.Geometry, Motion=Z_11)  # -> Geometry, Transform
and_10 = GateAnd(A=and_6, B=equals_49.Inequality)
dispatch_23 = Dispatch(List=pt_92, DispatchPattern=equals_45.Inequality)  # -> ListA, ListB
filter_35 = StreamFilter(Gate=and_7, Stream1=srf_2)
filter_36 = StreamFilter(Gate=and_10, Stream1=srf_3)
filter_37 = StreamFilter(Gate=and_8, Stream1=srf_4)
filter_38 = StreamFilter(Gate=and_9, Stream1=srf_5)
filter_39 = StreamFilter(Gate=and_10, Stream1=srf)
vec2pt_7 = Vector2Pt(PointA=Point(0, 0, 0), PointB=dispatch_23.ListA, Unitize=False)  # -> Vector, Length
preview_20 = CustomPreview(Geometry=filter_35, Shader=swatch_6)
preview_21 = CustomPreview(Geometry=filter_36, Shader=swatch_6)
preview_22 = CustomPreview(Geometry=filter_37, Shader=swatch_6)
preview_23 = CustomPreview(Geometry=filter_38, Shader=swatch_6)
preview_24 = CustomPreview(Geometry=filter_39, Shader=swatch_6)
move_17 = Move(Geometry=move_16.Geometry, Motion=vec2pt_7.Vector)  # -> Geometry, Transform
mjoin_4 = MeshJoin(Meshes=move_17.Geometry)
filter_40 = StreamFilter(Gate=equals_44.Equality, Stream0=mjoin_4)
custom_preview_materials = CustomPreviewMaterials(Geometry=filter_40, DiffuseColor=swatch_7, Transparency=panel_69, DiffuseBitmap=path_12)
equals_50 = Equality(FirstNumber=int_82, SecondNumber="4")  # -> Equality, Inequality
equals_51 = Equality(FirstNumber=int_82, SecondNumber="5")  # -> Equality, Inequality
and_11 = GateAnd(A=equals_51.Inequality, B=equals_50.Inequality)
equals_52 = Equality(FirstNumber=int_82, SecondNumber="3")  # -> Equality, Inequality
and_12 = GateAnd(A=and_11, B=equals_52.Inequality)
and_13 = GateAnd(A=equals_50.Inequality, B=equals_49.Inequality)
and_14 = GateAnd(A=equals_51.Inequality, B=equals_49.Inequality)
and_15 = GateAnd(A=equals_52.Inequality, B=equals_49.Inequality)
and_16 = GateAnd(A=and_12, B=equals_49.Inequality)
filter_41 = StreamFilter(Gate=and_13, Stream1=srf_7)
filter_42 = StreamFilter(Gate=and_16, Stream1=srf_8)
filter_43 = StreamFilter(Gate=and_14, Stream1=srf_9)
filter_44 = StreamFilter(Gate=and_15, Stream1=srf_10)
filter_45 = StreamFilter(Gate=and_16, Stream1=srf_6)
preview_25 = CustomPreview(Geometry=filter_41, Shader=swatch_6)
preview_26 = CustomPreview(Geometry=filter_42, Shader=swatch_6)
preview_27 = CustomPreview(Geometry=filter_43, Shader=swatch_6)
preview_28 = CustomPreview(Geometry=filter_44, Shader=swatch_6)
preview_29 = CustomPreview(Geometry=filter_45, Shader=swatch_6)

# ---- group: module center
pt_93 = Point(pt_91)

# ----
filter_46 = StreamFilter(Gate=filter_17, Stream1=pt_89)
vec2pt_8 = Vector2Pt(PointA=Point(0, 0, 0), PointB=filter_46, Unitize=False)  # -> Vector, Length
move_18 = Move(Geometry=Point(0, 0, 0), Motion=vec2pt_8.Vector)  # -> Geometry, Transform
# young
filter_47 = StreamFilter(Gate=whole_site_t_active_site_f, Stream0=move_18.Transform, Stream1=move_7.Transform)
transform = Transform(filter_47)
transform_2 = Transform(Geometry=xy, Transform=transform)
pshift_64 = ShiftPaths(Data=transform_2, Offset=-1)
filter_48 = StreamFilter(Gate=whole_site_t_active_site_f, Stream0=transform_2, Stream1=pshift_64)

# ---- group: people dots base plans
pln_2 = Plane(filter_48)

# ---- group: block #
lng_16 = ListLength(List=pln_2)

# ---- group: seed d
random_4 = Random(Range=Domain(0, 10000), Number=lng_16, Seed=Slider(17, range=0..100))

# ---- group: seed r
random_5 = Random(Range=Domain(0, 10000), Number=lng_16, Seed=number_slider_25)

# ---- group: seed d
random_6 = Random(Range=Domain(0, 10000), Number=lng_16, Seed=Slider(51, range=0..100))

random_7 = Random(Range=Domain(0, 10000), Number=lng_16, Seed=Slider(46, range=0..100))

# ---- group: seed r
random_8 = Random(Range=Domain(0, 10000), Number=lng_16, Seed=number_slider_26)

random_9 = Random(Range=Domain(0, 10000), Number=lng_16, Seed=Slider(69, range=0..100))

# ----
pshift_65 = ShiftPaths(Data=random_5, Offset=-1)
pshift_66 = ShiftPaths(Data=random_4, Offset=-1)
pshift_67 = ShiftPaths(Data=random_8, Offset=-1)
pshift_68 = ShiftPaths(Data=random_9, Offset=-1)
pshift_69 = ShiftPaths(Data=random_6, Offset=-1)
pshift_70 = ShiftPaths(Data=random_7, Offset=-1)

# ---- group: d
random_10 = Random(Range=Domain(0, 1), Number=int_177, Seed=pshift_66)

# ---- group: r
random_11 = Random(Range=Domain(0, 360), Number=int_177, Seed=pshift_65)

# ---- group: d
random_12 = Random(Range=Domain(0, 1), Number=int_176, Seed=pshift_69)

random_13 = Random(Range=Domain(0, 1), Number=int_178, Seed=pshift_70)

# ---- group: r
random_14 = Random(Range=Domain(0, 360), Number=int_176, Seed=pshift_67)

random_15 = Random(Range=Domain(0, 360), Number=int_178, Seed=pshift_68)

# ----
graph_3 = GraphMapper(
    random_10,
    x0=0,
    x1=1,
    y0=0,
    y1=1,
    container_name="Bezier",
    cpx=[0, 0.2763824463, 1, 1],
    cpy=[0, 0.2786865234, 0.3680863976, 1])
graph_4 = GraphMapper(
    random_12,
    x0=0,
    x1=1,
    y0=0,
    y1=1,
    container_name="Bezier",
    cpx=[0, 0.3430397809, 1, 1],
    cpy=[0, 0.5653408766, 0.3680863976, 1])
graph_5 = GraphMapper(
    random_13,
    x0=0,
    x1=1,
    y0=0,
    y1=1,
    container_name="Bezier",
    cpx=[0, 0.2961647809, 0.9886363745, 1],
    cpy=[0, 0.6839488745, 0.5063920021, 1])
rad = Radians(Degrees=random_11)
rad_2 = Radians(Degrees=random_14)
rad_3 = Radians(Degrees=random_15)
remap_18 = RemapNumbers(Value=graph_3, Source=Domain(0, 1), Target=dom_5)  # -> Mapped, Clipped
remap_19 = RemapNumbers(Value=graph_4, Source=Domain(0, 1), Target=dom_6)  # -> Mapped, Clipped
remap_20 = RemapNumbers(Value=graph_5, Source=Domain(0, 1), Target=dom_7)  # -> Mapped, Clipped
pt_94 = PointCylindrical(BasePlane=graft(pln_2), Angle=rad, Radius=remap_18.Mapped, Elevation=0)
pt_95 = PointCylindrical(BasePlane=graft(pln_2), Angle=rad_2, Radius=remap_19.Mapped, Elevation=0)
pt_96 = PointCylindrical(BasePlane=graft(pln_2), Angle=rad_3, Radius=remap_20.Mapped, Elevation=0)
pshift_71 = ShiftPaths(Data=pt_94, Offset=-1)
pdecon_12 = Deconstruct(Point=pshift_71)  # -> XComponent, YComponent, ZComponent
pshift_72 = ShiftPaths(Data=pt_95, Offset=-1)
pdecon_13 = Deconstruct(Point=pshift_72)  # -> XComponent, YComponent, ZComponent
pshift_73 = ShiftPaths(Data=pt_96, Offset=-1)
pdecon_14 = Deconstruct(Point=pshift_73)  # -> XComponent, YComponent, ZComponent
inc = Includes(Value=pdecon_12.YComponent, Domain=Domain(0, 1000))  # -> Includes, Deviation
inc_2 = Includes(Value=pdecon_12.XComponent, Domain=Domain(0, 1000))  # -> Includes, Deviation
inc_3 = Includes(Value=pdecon_13.YComponent, Domain=Domain(0, 1000))  # -> Includes, Deviation
inc_4 = Includes(Value=pdecon_13.XComponent, Domain=Domain(0, 1000))  # -> Includes, Deviation
inc_5 = Includes(Value=pdecon_14.YComponent, Domain=Domain(0, 1000))  # -> Includes, Deviation
inc_6 = Includes(Value=pdecon_14.XComponent, Domain=Domain(0, 1000))  # -> Includes, Deviation
and_17 = GateAnd(A=inc_2.Includes, B=inc.Includes)
and_18 = GateAnd(A=inc_4.Includes, B=inc_3.Includes)
and_19 = GateAnd(A=inc_6.Includes, B=inc_5.Includes)
dispatch_24 = Dispatch(List=pshift_71, DispatchPattern=and_17)  # -> ListA, ListB
dispatch_25 = Dispatch(List=pshift_72, DispatchPattern=and_18)  # -> ListA, ListB
dispatch_26 = Dispatch(List=pshift_73, DispatchPattern=and_19)  # -> ListA, ListB
pt_97 = Point([dispatch_24.ListA, dispatch_24.ListB])
pt_98 = Point([dispatch_25.ListA, dispatch_25.ListB])
pt_99 = Point([dispatch_26.ListA, dispatch_26.ListB])
rnd_reduce_by_ratio = RndReduceByRatio(L=pt_97, B=number_slider_29, S=Slider(52, range=0..100))
rnd_reduce_by_ratio_2 = RndReduceByRatio(L=pt_98, B=number_slider_29, S=Slider(59, range=0..100))
rnd_reduce_by_ratio_3 = RndReduceByRatio(L=pt_99, B=number_slider_29, S=Slider(72, range=0..100))
pt_100 = Point(rnd_reduce_by_ratio)
move_19 = Move(Geometry=mesh_24, Motion=pt_100)  # -> Geometry, Transform
pt_101 = Point(rnd_reduce_by_ratio_2)
move_20 = Move(Geometry=mesh_26, Motion=pt_101)  # -> Geometry, Transform
pt_102 = Point(rnd_reduce_by_ratio_3)
move_21 = Move(Geometry=mesh_25, Motion=pt_102)  # -> Geometry, Transform
mjoin_5 = MeshJoin(Meshes=move_19.Geometry)
mjoin_6 = MeshJoin(Meshes=move_21.Geometry)
mjoin_7 = MeshJoin(Meshes=move_20.Geometry)
mcol_4 = MeshColours(Mesh=mjoin_5, Colours=mln_young_2)
mcol_5 = MeshColours(Mesh=mjoin_6, Colours=exc_elderly_2)
mcol_6 = MeshColours(Mesh=mjoin_7, Colours=mid_mid_career_2)
preview_30 = CustomPreview(Geometry=pt_101, Shader=mid_mid_career_2)
preview_31 = CustomPreview(Geometry=pt_102, Shader=exc_elderly_2)
filter_49 = StreamFilter(Gate=bool_8, Stream1=mcol_4)
filter_50 = StreamFilter(Gate=bool_8, Stream1=mcol_5)
preview_32 = CustomPreview(Geometry=pt_100, Shader=mln_young_2)
filter_51 = StreamFilter(Gate=bool_8, Stream1=mcol_6)

# ---- group: old ppl dots mesh
mesh_47 = Mesh(filter_50)

# ---- group: mid ppl dots mesh
mesh_48 = Mesh(filter_51)

# ---- group: young ppl dots mesh
mesh_49 = Mesh(filter_49)

# ----
mjoin_8 = MeshJoin(Meshes=[mesh_49, mesh_48, mesh_47])
move_22 = Move(Geometry=mjoin_8, Motion=Z_5)  # -> Geometry, Transform

# ---- group: Volpe module center
pt_103 = Point(modulecenter_2.pt_5)

# ----
center_line_2 = CenterLine(
    pt=pt_91,
    xe_2=int_41,
    xe=int_41,
    id_3=int_78,
    ye_2=int_42,
    ye=int_42,
    x_2=int_45,
    x=int_45,
    y_2=int_44,
    y=int_44,
    id_2=int_78,
    id=int_78,
    bool=bool_3,
    X=cell_shrink,
    X_2=cell_shrink,
    X_3=cell_shrink,
    X_4=cell_shrink,
    Y=cell_shrink,
    Y_2=cell_shrink,
    Y_3=cell_shrink,
    Y_4=cell_shrink)
roads_2 = Roads(
    xe_2=int_41,
    xe=int_41,
    ye_2=int_42,
    ye=int_42,
    x_2=int_45,
    x=int_45,
    y_2=int_44,
    y=int_44,
    id_2=int_78,
    id=int_78,
    bool=bool_3,
    X=cell_shrink,
    pt=pt_91,
    X_2=cell_shrink,
    id_3=int_78,
    X_3=cell_shrink,
    X_4=cell_shrink,
    Y=cell_shrink,
    Y_2=cell_shrink,
    Y_3=cell_shrink,
    Y_4=cell_shrink)
sidewalk_3 = Sidewalk(
    xe_2=int_41,
    xe=int_41,
    ye_2=int_42,
    ye=int_42,
    x_2=int_45,
    x=int_45,
    y_2=int_44,
    y=int_44,
    id_2=int_78,
    id=int_78,
    bool=bool_3,
    X=cell_shrink,
    X_2=cell_shrink,
    X_3=cell_shrink,
    X_4=cell_shrink,
    pt=pt_91,
    Y=cell_shrink,
    id_3=int_78,
    Y_2=cell_shrink,
    Y_3=cell_shrink,
    Y_4=cell_shrink)
dispatch_27 = Dispatch(List=pt_91, DispatchPattern=equals_17.Equality)  # -> ListA, ListB
dispatch_28 = Dispatch(List=pt_91, DispatchPattern=equals_18.Equality)  # -> ListA, ListB
vec2pt_9 = Vector2Pt(PointA=Point(0, 0, 0), PointB=dispatch_27.ListA, Unitize=False)  # -> Vector, Length
vec2pt_10 = Vector2Pt(PointA=Point(0, 0, 0), PointB=dispatch_28.ListA, Unitize=False)  # -> Vector, Length
dispatch_29 = Dispatch(List=pt_91, DispatchPattern=and_2)  # -> ListA, ListB
move_23 = Move(Geometry=mesh_28, Motion=vec2pt_9.Vector)  # -> Geometry, Transform
move_24 = Move(Geometry=mesh_28, Motion=vec2pt_10.Vector)  # -> Geometry, Transform
vec2pt_11 = Vector2Pt(PointA=Point(0, 0, 0), PointB=dispatch_29.ListA, Unitize=False)  # -> Vector, Length
move_25 = Move(Geometry=rotate_3.Geometry, Motion=vec2pt_11.Vector)  # -> Geometry, Transform
dispatch_30 = Dispatch(List=pt_91, DispatchPattern=or)  # -> ListA, ListB
easter_eggs = EasterEggs(L=pt_91, A_2=int_78, shrink=cell_shrink, L_2=pt_91, A=int_78, shrink_2=cell_shrink)  # disabled

# ---- group: building lego modules
mesh_50 = Mesh(move_25.Geometry)

# ---- group: blank
mesh_51 = Mesh(move_23.Geometry)

# ---- group: plaza
mesh_52 = Mesh(move_24.Geometry)

# ---- group: road center pts
pt_104 = Point(dispatch_30.ListA)

# ---- group: road mesh final!
mesh_53 = Mesh(roads_2)

# ---- group: center line mesh final!
mesh_54 = Mesh(center_line_2)

# ---- group: sidewalk mesh final!
mesh_55 = Mesh(sidewalk_3)

# ----
filter_52 = StreamFilter(Gate=show_google_map, Stream0=mesh_50)
filter_53 = StreamFilter(Gate=show_google_map, Stream0=mesh_51)
filter_54 = StreamFilter(Gate=show_google_map, Stream0=mesh_52)
filter_55 = StreamFilter(Gate=show_google_map, Stream0=mesh_53)
filter_56 = StreamFilter(Gate=show_google_map, Stream0=mesh_54)
filter_57 = StreamFilter(Gate=show_google_map, Stream0=mesh_55)
mcol_7 = MeshColours(Mesh=filter_53, Colours=ColourSwatch(SwatchColor=RGB(86, 120, 32)))
move_26 = Move(Geometry=mcol_7, Motion=Z_8)  # -> Geometry, Transform
mcol_8 = MeshColours(Mesh=filter_54, Colours=ColourSwatch(SwatchColor=RGB(196, 167, 86)))
move_27 = Move(Geometry=mcol_8, Motion=Z_9)  # -> Geometry, Transform

# ---- group: road mesh final!
mesh_56 = Mesh(filter_55)

# ---- group: center line mesh final!
mesh_57 = Mesh(filter_56)

# ---- group: building lego modules
mesh_58 = Mesh(filter_52)

# ---- group: plaza
mesh_59 = Mesh(move_27.Geometry)

# ---- group: blank
mesh_60 = Mesh(move_26.Geometry)

# ---- group: sidewalk mesh final!
mesh_61 = Mesh(filter_57)

# ---- group: blank
mesh_62 = Mesh(mesh_51)

# ---- group: road mesh final!
mesh_63 = Mesh(mesh_56)

# ---- group: sidewalk mesh final!
mesh_64 = Mesh(sidewalk_3)

# ----
stream_filter_9 = StreamFilter(Gate=int_46, Stream2=item_48)  # disabled
filter_58 = StreamFilter(Gate=int_46, Stream2=[cull, runion])  # disabled
filter_59 = StreamFilter(Gate=int_46, Stream2=cull)  # disabled
filter_60 = StreamFilter(Gate=int_46, Stream2=boundary_3)  # disabled
mesh_65 = MeshBrep(
    Brep=filter_59,
    Settings={GridMaxCount=0, GridMinCount=16, JaggedSeams=False, MaxEdgeLength=0, MinEdgeLength=0.0001, MinTolerance=0, Refine=True, RefineAngle=0, RelativeTolerance=0.65, SimplePlanes=True, Tolerance=0})
mesh_66 = MeshBrep(
    Brep=filter_60,
    Settings={GridMaxCount=0, GridMinCount=16, JaggedSeams=False, MaxEdgeLength=0, MinEdgeLength=0.0001, MinTolerance=0, Refine=True, RefineAngle=0, RelativeTolerance=0.65, SimplePlanes=True, Tolerance=0})
crv_4 = Curve(filter_58)
item_49 = ListItem(List=stream_filter_9, Index=0, Wrap=True)
number_slider_38 = Slider(21, range=0..30)
xy_3 = XYPlane(Origin=item_49)
X_3 = UnitX(Factor=Slider(0, range=0..100))
Y = UnitY(Factor=Slider(3, range=0..10))
Z_12 = UnitZ(Factor=Slider(20, range=0..100))
vec_3 = VectorXYZ(XComponent=X_3, YComponent=Y, ZComponent=Z_12)  # -> Vector, Length
Z_13 = UnitZ(Factor=Slider(21, range=0..100))
Z_14 = UnitZ(Factor=number_slider_38)
Z_15 = UnitZ(Factor=number_slider_38)
number_slider_39 = Slider(7, range=0..100)
panel_181 = Panel("""L
M
S
L
M
S""")
panel_182 = Panel("""R
R
R
O
O
O""")
move_28 = Move(Geometry=crv_4, Motion=Z_13)  # -> Geometry, Transform
move_29 = Move(Geometry=mesh_66, Motion=Z_14)  # -> Geometry, Transform
move_30 = Move(Geometry=xy_3, Motion=vec_3.Vector)  # -> Geometry, Transform
move_31 = Move(Geometry=mesh_65, Motion=Z_15)  # -> Geometry, Transform
rotate_plane = RotatePlane(Plane=move_30.Geometry, Angle=3.141592654)
area_4 = Area(Geometry=move_28.Geometry)  # -> Area, Centroid
list_item = ListItem(List=panel_182, Index=int_179, Wrap=True)
list_item_2 = ListItem(List=panel_181, Index=int_179, Wrap=True)
addition_33 = Addition(A=number_slider_39, B=Slider(2, range=0..10))
unit_y = UnitY(Factor=addition_33)
negative = Negative(Value=unit_y)
move_32 = Move(Geometry=rotate_plane, Motion=negative)  # -> Geometry, Transform
colour_swatch = ColourSwatch(SwatchColor=RGB(0, 0, 0))
colour = Colour([ColourSwatch(SwatchColor=RGB(255, 0, 0)), ColourSwatch(SwatchColor=RGB(255, 255, 0)), ColourSwatch(SwatchColor=RGB(0, 0, 255))])
scale = Scale(Geometry=move_28.Geometry, Center=area_4.Centroid, Factor=Slider(0.97, range=0..1))  # -> Geometry, Transform
colour_swatch_2 = ColourSwatch(SwatchColor=RGB(255, 255, 255))
list_item_3 = ListItem(List=colour, Index=int_179, Wrap=True)
justified_text = JustifiedText3d(
    Location=flatten(rotate_plane),
    Text=list_item_2,
    Size=number_slider_39,
    Color=colour_swatch,
    HorizontalAlignment=1,
    VerticalAlginment=1,
    Font="Arial Black",
    UseMeshes=False,
    Bake=False)
justified_text_2 = JustifiedText3d(
    Location=flatten(move_32.Geometry),
    Text=list_item,
    Size=number_slider_39,
    Color=colour_swatch,
    HorizontalAlignment=1,
    VerticalAlginment=1,
    Font="Arial Black",
    UseMeshes=False,
    Bake=False)
previewlw = CustomPreviewLineweights(Geometry=scale.Geometry, Shader=ColourSwatch(SwatchColor=RGB(255, 255, 255)), Thickness=Slider(2, range=0..10))

# ---- group: Bar graph text
Y_2 = UnitY(Factor=Slider(40, range=-100..100))
X_4 = UnitX(Factor=Slider(21, range=0..100))
vec_4 = VectorXYZ(XComponent=X_4, YComponent=expr("x*(-1)", Y_2), ZComponent=0)  # -> Vector, Length
number_slider_40 = Slider(12, range=0..100)
swatch_13 = ColourSwatch(SwatchColor=RGB(255, 255, 255))

# ---- group: Rectangles / Position offsets
number_slider_41 = Slider(183, range=0..1000)
number_slider_42 = Slider(700, range=100..700)
Y_3 = UnitY(Factor=expr("x*(-1)", 100))

# ---- group: Rectangles
lng_17 = ListLength(List=split_9.Negative)
bar_width = Slider(30, range=0..100)
panel_183 = Panel(gradient_9)

# ---- group: Rectangles / Position offsets (continued)
series_6 = Series(Start=0, Step=Slider(80, range=0..200), Count=lng_17)
repeat_16 = RepeatData(Data=Y_3, Length=lng_17)
addition_34 = Addition(A=series_6)
X_5 = UnitX(Factor=addition_34)
vec_5 = VectorXYZ(XComponent=X_5, YComponent=expr("x*(-1)", repeat_16), ZComponent=3)  # -> Vector, Length
move_33 = Move(Geometry=pt_35, Motion=vec_5.Vector)  # -> Geometry, Transform

# ---- group: White stroke outline rectangles
rectangle = Rectangle(Plane=move_33.Geometry, XSize=bar_width, YSize=num_75, Radius=0)  # -> Rectangle, Length
swatch_14 = ColourSwatch(SwatchColor=RGB(214, 214, 214))

# ---- group: Bar graph text (continued)
move_34 = Move(Geometry=move_33.Geometry, Motion=vec_4.Vector)  # -> Geometry, Transform

# ---- group: Bar graph text / titles
tag_22 = TextTag3D(Location=move_34.Geometry, Text=labels_for_bars, Size=number_slider_40, Colour=swatch_13, Justification=5)

# ---- group: Rectangles (continued)
rectangle_2 = Rectangle(Plane=move_33.Geometry, XSize=bar_width, YSize=Domain(-2, 2), Radius=0)  # -> Rectangle, Length
planesrf_3 = PlaneSurface(Plane=rectangle_2.Rectangle, XSize=bar_width, YSize=split_9.Negative)
mesh_67 = Mesh(planesrf_3)
preview_33 = CustomPreview(Geometry=mesh_67, Shader=col_22)

# ----
preview_34 = CustomPreview(Geometry=rectangle.Rectangle, Shader=swatch_14)
num_226 = Number(bar_width)
multiplication_83 = Multiplication(A=Slider(1.3, range=0..10), B=num_226)

# ---- group: Previous value bars / lines
subtraction_8 = Subtraction(A=bar_width, B=multiplication_83)
division_21 = Division(A=subtraction_8, B=2)
lng_18 = ListLength(List=X_5)
repeat_17 = RepeatData(Data=division_21, Length=lng_18)
number_slider_43 = Slider(4, range=0..10)
X_6 = UnitX(Factor=repeat_17)
vec_6 = VectorXYZ(XComponent=expr("x*(-1)", X_6), YComponent=split_9.Positive, ZComponent=5)  # -> Vector, Length
move_35 = Move(Geometry=move_33.Geometry, Motion=vec_6.Vector)  # -> Geometry, Transform
rectangle_3 = Rectangle(Plane=move_35.Geometry, XSize=multiplication_83, YSize=number_slider_43, Radius=0)  # -> Rectangle, Length
planesrf_4 = PlaneSurface(Plane=rectangle_3.Rectangle, XSize=multiplication_83, YSize=number_slider_43)
mesh_68 = Mesh(planesrf_4)
preview_35 = CustomPreview(Geometry=mesh_68, Shader=graft(frgb_13))

# ----
pdecon_15 = Deconstruct(Point=pt_23)  # -> XComponent, YComponent, ZComponent
neg_4 = Negative(Value=Slider(400, range=0..1000))
addition_35 = Addition(A=pdecon_15.XComponent, B=neg_4)
number_slider_44 = Slider(60, range=0..200)
pt_105 = ConstructPoint(XCoordinate=addition_35, YCoordinate=0, ZCoordinate=0)
Y_4 = UnitY(Factor=Slider(800, range=0..1000))
neg_5 = Negative(Value=number_slider_44)
neg_6 = Negative(Value=Y_4)
move_36 = Move(Geometry=pt_105, Motion=neg_6)  # -> Geometry, Transform
X_7 = UnitX(Factor=neg_5)
subtraction_9 = Subtraction(A=number_slider_44, B=Slider(14, range=0..20))
move_37 = Move(Geometry=move_36.Geometry, Motion=X_7)  # -> Geometry, Transform
rectangle_4 = Rectangle(Plane=move_37.Geometry, XSize=subtraction_9, YSize=Slider(5, range=0..10), Radius=0)  # -> Rectangle, Length
panel_184 = Panel("""Barcelona
Site with Changes
Current Site""")
mesh_69 = MeshBrep(
    Brep=rectangle_4.Rectangle,
    Settings={GridMaxCount=0, GridMinCount=16, JaggedSeams=False, MaxEdgeLength=0, MinEdgeLength=0.0001, MinTolerance=0, Refine=True, RefineAngle=0, RelativeTolerance=0.65, SimplePlanes=True, Tolerance=0})
tag_23 = TextTag3D(
    Location=move_36.Geometry,
    Text=panel_184,
    Size=Slider(14, range=0..100),
    Colour=ColourSwatch(SwatchColor=RGB(255, 255, 255)),
    Justification=4)
series_7 = Series(Start=0, Step=Slider(24, range=15..30), Count=3)
Y_5 = UnitY(Factor=series_7)
neg_7 = Negative(Value=Y_5)
move_38 = Move(Geometry=mesh_69, Motion=neg_7)  # -> Geometry, Transform
preview_36 = CustomPreview(Geometry=graft(move_38.Geometry), Shader=col_20)

graft_6 = GraftTree(Tree=txt_57, IncludeEmptyLists=True, IncludeNullItems=True)
merge_12 = Merge(Data1=graft_6)
txt_103 = Text(int_175)
join_13 = TextJoin(Text=merge_12, Join="\t\t\t\t\t\t\t\t\t")
graft_7 = GraftTree(Tree=txt_103, IncludeEmptyLists=True, IncludeNullItems=True)
case = TextCase(Text="3rd Places", Culture=127)  # -> UpperCase, LowerCase
pshift_74 = ShiftPaths(Data=join_13, Offset=-1)
merge_13 = Merge(Data1=case.UpperCase, Data2=pshift_74)
# Amenities
panel_185 = Panel("""19
122
83
50
36
60
27
4
25
20
13
21
1
2""")
join_14 = TextJoin(Text=merge_13)
join_15 = TextJoin(Text=flatten(graft_7))  # -> flatten(Result)
number_slider_45 = Slider(220, range=0..300)
txt_104 = Text(join_15)
txt_105 = Text(panel_185)
panel_186 = Panel(txt_104)
case_2 = TextCase(Text="Barcelona", Culture=127)  # -> UpperCase, LowerCase
cluster_49 = Cluster_7(title=case_2.UpperCase, amenities_list=txt_105, G=pt_34, A=number_slider_45, B=Slider(120, range=0..300))  # -> result, G_2
cluster_50 = Cluster_7(title="KENDALL", amenities_list=panel_186, G=pt_34, A=number_slider_45, B=Slider(0, range=0..100))  # -> result, G_2
number_slider_46 = Slider(12, range=0..100)
tag_24 = TextTag3D(Location=cluster_49.G_2, Text=cluster_49.result, Size=number_slider_46, Colour=swatch_11, Justification=8)
tag_25 = TextTag3D(Location=cluster_50.G_2, Text=cluster_50.result, Size=number_slider_46, Colour=swatch_10, Justification=8)

# ---- group: 3rd Places text final
txt_106 = Text(join_14)

# ----
panel_187 = Panel(txt_106)
tag_26 = TextTag3D(
    Location=pt_34,
    Text=panel_187,
    Size=number_slider_46,
    Colour=ColourSwatch(SwatchColor=RGB(255, 255, 255)),
    Justification=7)

# ---- group: Chart labels
multiplication_84 = Multiplication(A=number_slider_14, B=Slider(1.8, range=0..3))
multiplication_85 = Multiplication(A=number_slider_14, B=Slider(1.3, range=0..3))
polygon_5 = Polygon(Plane=pt_23, Radius=multiplication_85, Segments=lng_7, FilletRadius=Slider(0, range=0..10))  # -> Polygon, Length
cp_4 = ControlPoints(Curve=polygon_5.Polygon)  # -> Points, Weights, Knots
swatch_15 = ColourSwatch(SwatchColor=RGB(128, 128, 128))
number_slider_47 = Slider(11, range=0..100)
cull_i_6 = CullIndex(List=cp_4.Points, Indices=lng_7, Wrap=True)
col_24 = Colour([ColourSwatch(SwatchColor=RGB(224, 224, 224)), ColourSwatch(SwatchColor=RGB(79, 79, 79)), ColourSwatch(SwatchColor=RGB(153, 153, 153))])
repeat_18 = RepeatData(Data=graft(col_24), Length=graft(panel_65))  # -> flatten(Data)

# ----
addition_36 = Addition(A=multiplication_84, B=pdecon_15.XComponent)

circle = CircleCNR(Center=pt_23, Normal=Vector(0, 0, 1), Radius=multiplication_84)
lenp = LengthParameter(Curve=circle, Parameter=1)  # -> Length, Length_2
division_22 = Division(A=lenp.Length_2, B=lng_7)
multiplication_86 = Multiplication(A=division_22, B=int_12)
divlength = DivideLength(Curve=polygon_5.Polygon, Length=multiplication_86)  # -> Points, Tangents, Parameters
branch_5 = TreeBranch(Tree=divlength.Points, Path="{0;0;2}", MaintainPaths=True)
pt_106 = Point(branch_5)
cull_i_7 = CullIndex(List=pt_106, Indices=Slider(0, range=0..10), Wrap=True)
pline_4 = PolyLine(Vertices=pt_106, Closed=Toggle(True))

# ---- group: Chart labels / titles
tag_27 = TextTag3D(Location=cull_i_6, Text=cull_i_2, Size=number_slider_47, Colour=repeat_18, Justification=5)

# ---- group: Graph grouping outline
item_50 = ListItem(List=pt_106, Index=0, Wrap=True)
item_51 = ListItem(List=pt_106, Index=1, Wrap=True)
item_52 = ListItem(List=pt_106, Index=2, Wrap=True)
circle_2 = Circle3Pt(PointA=item_50, PointB=item_51, PointC=item_52)  # -> Circle, Plane, Radius
scale_2 = Scale(Geometry=circle_2.Circle, Center=circle_2.Plane, Factor=Slider(1.2, range=0..10))  # -> Geometry, Transform
crv_cp_2 = CurveClosestPoint(Point=pt_106, Curve=scale_2.Geometry)  # -> Point, Parameter, Distance
shift_7 = ShiftList(List=col_24, Shift=1, Wrap=True)
circle_3 = CircleCNR(Center=crv_cp_2.Point, Normal=Vector(0, 0, 1), Radius=Slider(100, range=0..200))
shatter = Shatter(Curve=scale_2.Geometry, Parameters=crv_cp_2.Parameter)
trim = TrimWithRegions(Curve=shatter, Regions=circle_3)  # -> Inside, flatten(Outside)
preview_37 = CustomPreview(Geometry=trim.Outside, Shader=shift_7)  # disabled

# ----
divide_3 = DivideCurve(Curve=trim.Outside, Count=2, Kinks=False)  # -> Points, Tangents, Parameters
item_53 = ListItem(List=divide_3.Points, Index=1, Wrap=True)
vec2pt_12 = Vector2Pt(PointA=pt_39, PointB=item_53, Unitize=True)  # -> Vector, Length
multiplication_87 = Multiplication(A=vec2pt_12.Vector, B=Slider(100, range=0..100))
move_39 = Move(Geometry=item_53, Motion=multiplication_87)  # -> Geometry, Transform

# ---- group: Chart labels (continued)
tag_28 = TextTag3D(Location=flatten(move_39.Geometry), Text=shift_5, Size=Slider(30, range=0..100), Colour=shift_7, Justification=5)  # disabled

# ---- group: Graph borders & UX text
bnd_15 = Bounds2D(Coordinates=flatten(move_39.Geometry))
number_slider_48 = Slider(100, range=0..200)
dedom2 = DeconstructDomain²(Domain=bnd_15)  # -> UComponent, VComponent
number_slider_49 = Slider(30, range=0..100)
rectangle_5 = Rectangle(Plane=PlaneXY(0, 0, 0), XSize=dedom2.UComponent, YSize=dedom2.VComponent, Radius=0)  # -> Rectangle, Length
debrep = DeconstructBrep(Brep=rectangle_5.Rectangle)  # -> Faces, Edges, Vertices
swatch_16 = ColourSwatch(SwatchColor=RGBA(64, 64, 64, 86))
vec_7 = VectorXYZ(XComponent=expr("x*(-1)", number_slider_48), YComponent=number_slider_48, ZComponent=0)  # -> Vector, Length
item_54 = ListItem(List=debrep.Vertices, Index=1, Wrap=True)
move_40 = Move(Geometry=item_54, Motion=vec_7.Vector)  # -> Geometry, Transform
swatch_17 = ColourSwatch(SwatchColor=RGB(255, 255, 255))
crv_5 = Curve([<curve referenced from the Rhino model> x4])
rectangle_6 = Rectangle(Plane=PlaneXY(0, 0, 0), XSize=dedom2.UComponent, YSize=dedom2.VComponent, Radius=Slider(10, range=0..10))  # -> Rectangle, Length
pt_107 = Point(<point referenced from the Rhino model>)
pt_108 = Point(<point referenced from the Rhino model>)
pt_109 = Point(<point referenced from the Rhino model>)
fillet_2 = Fillet(Curve=crv_5, Radius=Slider(10, range=0..10))
case_3 = TextCase(Text="Indicators", Culture=127)  # -> UpperCase, LowerCase
case_4 = TextCase(Text="Amenities", Culture=127)  # -> UpperCase, LowerCase
case_5 = TextCase(Text="SQ. Footage", Culture=127)  # -> UpperCase, LowerCase
case_6 = TextCase(Text="Urban Performance", Culture=127)  # -> UpperCase, LowerCase
scale_3 = Scale(Geometry=rectangle_6.Rectangle, Center=pt_39, Factor=Slider(1.4, range=0..10))  # -> Geometry, Transform
preview_38 = CustomPreview(Geometry=scale_3.Geometry, Shader=swatch_16)
preview_39 = CustomPreview(Geometry=fillet_2, Shader=swatch_16)
tag_29 = TextTag3D(Location=pt_109, Text=case_5.UpperCase, Size=number_slider_49, Colour=swatch_17, Justification=4)
tag_30 = TextTag3D(Location=pt_107, Text=case_3.UpperCase, Size=number_slider_49, Colour=swatch_17, Justification=4)
tag_31 = TextTag3D(Location=pt_108, Text=case_4.UpperCase, Size=number_slider_49, Colour=swatch_17, Justification=4)
tag_32 = TextTag3D(Location=move_40.Geometry, Text=case_6.UpperCase, Size=number_slider_49, Colour=swatch_17, Justification=4)

# ---- group: total ppl bound
panel_188 = Panel("0")

# ----
multiplication_88 = Multiplication(A=panel_188, B=number_slider_20)
dom_11 = ConstructDomain(DomainStart=multiplication_88, DomainEnd=multiplication_10)

# ---- group: total ppl bound (continued)
domain_2 = Domain(dom_11)

# ----
remap_21 = RemapNumbers(Value=int_128, Source=domain_2, Target=Domain(0, 0.5))  # -> Mapped, Clipped
remap_22 = RemapNumbers(Value=int_128, Source=domain_2, Target=Domain(0.3, 1))  # -> Mapped, Clipped
multiplication_89 = Multiplication(A=graph, B=remap_22.Mapped)
addition_37 = Addition(A=remap_21.Mapped, B=multiplication_89)
addition_38 = Addition(A=addition_37, B=multiplication_11)
gradient_10 = Gradient(LowerLimit=0, UpperLimit=1, Parameter=addition_38, stops=[0: RGB(0, 128, 0), 0.524: RGB(255, 255, 0), 1: RGB(255, 0, 0)])
argb_11 = SplitARGB(Colour=gradient_10)  # -> Alpha, Red, Green, Blue
vec_8 = VectorXYZ(XComponent=argb_11.Red, YComponent=argb_11.Green, ZComponent=argb_11.Blue)  # -> Vector, Length
multiplication_90 = Multiplication(A=vec_8.Vector, B=number_slider_21)
addition_39 = Addition(A=multiplication_90, B=multiplication_12)
pdecon_16 = Deconstruct(Point=addition_39)  # -> XComponent, YComponent, ZComponent
frgb_14 = ColourRGBF(Alpha=1, Red=pdecon_16.XComponent, Green=pdecon_16.YComponent, Blue=pdecon_16.ZComponent)
col_25 = Colour(frgb_14)
mspray = MeshSpray(Mesh=graft(pshift_33), Points=graft(pshift_34), Colours=graft(col_25), SprayMode=0)
mjoin_9 = MeshJoin(Meshes=flatten(mspray))
filter_61 = StreamFilter(Gate=0, Stream0=mjoin_9)

# ---- group: traffic heatmap / road traffic lego
mesh_70 = Mesh(filter_61)

# ----
mid_mid_career_3 = ColourSwatch(SwatchColor=RGB(255, 208, 0))
exc_elderly_3 = ColourSwatch(SwatchColor=RGB(255, 0, 0))
# Dashboard
mln_young_3 = ColourSwatch(SwatchColor=RGB(0, 166, 255))
_0 = Slider(0, range=0..1)
pdecon_17 = Deconstruct(Point=pt_37)  # -> XComponent, YComponent, ZComponent
pdecon_18 = Deconstruct(Point=pt_38)  # -> XComponent, YComponent, ZComponent
neg_8 = Negative(Value=number_slider_22)
merge_14 = Merge(Data1=mln_young_3, Data2=mid_mid_career_3, Data3=exc_elderly_3)
Y_6 = UnitY(Factor=number_slider_22)
Y_7 = UnitY(Factor=neg_8)
addition_40 = Addition(A=int_122, B=int_121)
addition_41 = Addition(A=int_126, B=int_125)
addition_42 = Addition(A=addition_40, B=int_120)
addition_43 = Addition(A=addition_41, B=int_124)
merge_15 = Merge(Data1=_0, Data2=int_122, Data3=addition_40, Data4=addition_42)
merge_16 = Merge(Data1=_0, Data2=int_126, Data3=addition_41, Data4=addition_43)
neg_9 = Negative(Value=number_slider_22)
division_23 = Division(A=neg_9, B=1.5)
division_24 = Division(A=number_slider_22, B=1.5)
Y_8 = UnitY(Factor=division_23)
Y_9 = UnitY(Factor=division_24)
neg_10 = Negative(Value=number_slider_22)
X_8 = UnitX(Factor=5)
X_9 = UnitX(Factor=5)
num_227 = Number(num_73)
num_228 = Number(num_73)
col_26 = Colour(off_cold_4)
col_27 = Colour(res_warm_4)

# ---- group: ttl h len
subtraction_10 = Subtraction(A=pdecon_17.XComponent, B=pdecon_18.XComponent)

# ---- group: 0-1
remap_23 = RemapNumbers(Value=merge_15, Source=domain, Target=Domain(0, 1))  # -> Mapped, Clipped

remap_24 = RemapNumbers(Value=merge_16, Source=domain, Target=Domain(0, 1))  # -> Mapped, Clipped

# ----
multiplication_91 = Multiplication(A=remap_24.Mapped, B=subtraction_10)
multiplication_92 = Multiplication(A=remap_23.Mapped, B=subtraction_10)
addition_44 = Addition(A=pdecon_18.XComponent, B=multiplication_92)
addition_45 = Addition(A=pdecon_18.XComponent, B=multiplication_91)
pt_110 = ConstructPoint(XCoordinate=addition_44, YCoordinate=pdecon_18.YComponent, ZCoordinate=0)
pt_111 = ConstructPoint(XCoordinate=addition_45, YCoordinate=pdecon_18.YComponent, ZCoordinate=0)
working_calculation = LivingCalculation(G=pt_111, A=neg_10, C=merge_14, x=number_slider_22, A_2=number_slider_22)
living_calculation = LivingCalculation(G=pt_110, A=number_slider_22, C=merge_14, x=number_slider_22, A_2=number_slider_22)

# ---- group: lower v sep ln
line_3 = LineSDL(Start=pt_111, Direction=Y_7, Length=number_slider_22)

# ---- group: upper v sep ln
line_4 = LineSDL(Start=pt_110, Direction=Y_6, Length=number_slider_22)

# ---- group: last pt O
item_55 = ListItem(List=pt_111, Index=-1, Wrap=True)

# ---- group: last pt R
item_56 = ListItem(List=pt_110, Index=-1, Wrap=True)

# ---- group: all sep lns
crv_6 = Curve([ln_2, line_4, line_3])

# ----
move_41 = Move(Geometry=item_55, Motion=Y_8)  # -> Geometry, Transform
move_42 = Move(Geometry=item_56, Motion=Y_9)  # -> Geometry, Transform
move_43 = Move(Geometry=move_41.Geometry, Motion=X_8)  # -> Geometry, Transform
move_44 = Move(Geometry=move_42.Geometry, Motion=X_9)  # -> Geometry, Transform
pt_112 = Point(move_43.Geometry)
pt_113 = Point(move_44.Geometry)
preview_40 = CustomPreview(Geometry=crv_6, Shader=col_9)

# ---- group: work
tag_33 = TextTag3D(Location=pt_112, Text="work", Size=num_227, Colour=col_26, Justification=4)

# ---- group: live
tag_34 = TextTag3D(Location=pt_113, Text="live", Size=num_228, Colour=col_27, Justification=4)

# ---- group: work
mesh_71 = Mesh(working_calculation)

# ---- group: live
mesh_72 = Mesh(living_calculation)

# ----
# 3D Clusters
swatch_18 = ColourSwatch(SwatchColor=RGB(125, 114, 51))
swatch_19 = ColourSwatch(SwatchColor=RGB(181, 169, 101))
swatch_20 = ColourSwatch(SwatchColor=RGB(222, 214, 171))
swatch_21 = ColourSwatch(SwatchColor=RGB(23, 81, 110))
swatch_22 = ColourSwatch(SwatchColor=RGB(101, 156, 184))
swatch_23 = ColourSwatch(SwatchColor=RGB(180, 219, 237))
col_28 = Colour([swatch_18, swatch_19, swatch_20, swatch_21, swatch_22, swatch_23])
argb_12 = SplitARGB(Colour=col_28)  # -> Alpha, Red, Green, Blue
frgb_15 = ColourRGBF(Alpha=Slider(0.7, range=0..1), Red=argb_12.Red, Green=argb_12.Green, Blue=argb_12.Blue)
col_29 = Colour(frgb_15)
panel_189 = Panel(col_29)
item_57 = ListItem(List=panel_189, Index=int_180, Wrap=True)

col_30 = Colour([swatch_18, swatch_19, swatch_20, swatch_21, swatch_22, swatch_23])
list_item_4 = ListItem(List=col_30, Index=int_179, Wrap=True)
mesh_colours = MeshColours(Mesh=move_31.Geometry, Colours=graft(list_item_4))
mesh_colours_2 = MeshColours(Mesh=move_29.Geometry, Colours=graft(list_item_4))

vec_9 = Vector(X_2)
move_45 = Move(Geometry=mesh_62, Motion=vec_9)  # -> Geometry, Transform
move_46 = Move(Geometry=mesh_64, Motion=vec_9)  # -> Geometry, Transform
move_47 = Move(Geometry=mesh_63, Motion=vec_9)  # -> Geometry, Transform
larger_5 = LargerThan(FirstNumber=int_84, SecondNumber="0")  # -> LargerThan, OrEqualTo
smaller_6 = SmallerThan(FirstNumber=int_84, SecondNumber="5")  # -> SmallerThan, OrEqualTo
and_20 = GateAnd(A=larger_5.OrEqualTo, B=smaller_6.OrEqualTo)
division_25 = Division(A=num_138, B=2)
multiplication_93 = Multiplication(A=division_25, B=Slider(0.95, range=0..1))
swatch_24 = ColourSwatch(SwatchColor=RGB(66, 89, 29))
Z_16 = UnitZ(Factor=0.1)
mcol_9 = MeshColours(Mesh=move_45.Geometry, Colours=swatch_24)  # disabled
move_48 = Move(Geometry=move_45.Geometry, Motion=Z_16)  # -> Geometry, Transform

# ---- group: is building or not
bool_20 = Boolean(and_20)

# ----
dispatch_31 = Dispatch(List=pt_93, DispatchPattern=bool_20)  # -> ListA, ListB
dispatch_32 = Dispatch(List=int_84, DispatchPattern=bool_20)  # -> ListA, ListB

# ---- group: building center
pt_114 = Point(dispatch_31.ListA)

# ---- group: building id
int_181 = Integer(dispatch_32.ListA)

# ---- group: blank/park
preview_41 = CustomPreview(Geometry=move_48.Geometry, Shader=swatch_24)

# ---- group: sidewalk
mesh_73 = Mesh(move_46.Geometry)

# ---- group: road
mesh_74 = Mesh(move_47.Geometry)

# ---- group: Building heights
panel_190 = Panel(building_heights_4)
item_58 = ListItem(List=panel_190, Index=graft(int_180), Wrap=False)

# ----
multiplication_94 = Multiplication(A=item_58, B=Slider(5, range=0..10))

# ---- group: Building heights (continued)
panel_191 = Panel(multiplication_94)
# ----
Z_17 = UnitZ(Factor=panel_191)
Z_18 = UnitZ(Factor=panel_191)
extr = Extrude(Base=cull, Direction=Z_17)
extr_2 = Extrude(Base=boundary_3, Direction=Z_18)
move_49 = Move(Geometry=extr_2, Motion=vec_9)  # -> Geometry, Transform
move_50 = Move(Geometry=extr, Motion=vec_9)  # -> Geometry, Transform
mesh_75 = MeshBrep(
    Brep=move_50.Geometry,
    Settings={GridMaxCount=0, GridMinCount=16, JaggedSeams=False, MaxEdgeLength=0, MinEdgeLength=0.0001, MinTolerance=0, Refine=True, RefineAngle=0, RelativeTolerance=0.65, SimplePlanes=True, Tolerance=0})
mesh_76 = MeshBrep(
    Brep=move_49.Geometry,
    Settings={GridMaxCount=0, GridMinCount=16, JaggedSeams=False, MaxEdgeLength=0, MinEdgeLength=0.0001, MinTolerance=0, Refine=True, RefineAngle=0, RelativeTolerance=0.65, SimplePlanes=True, Tolerance=0})
preview_42 = CustomPreview(Geometry=mesh_75, Shader=graft(item_57))
preview_43 = CustomPreview(Geometry=mesh_76, Shader=graft(item_57))

# ==== cluster SliderCalclumeBrep
P = ClusterInput()
B = ClusterInput()
brepinc = PointInBrep(Brep=B, Point=P, Strict=False)

# ---- group: color IDs
int = Integer(brepinc)

# ----
panel = Panel(int)
L = ClusterInput()
dispatch = Dispatch(List=L, DispatchPattern=int)  # -> ListA, ListB
int_2 = ClusterOutput(int)
pdecon = Deconstruct(Point=dispatch.ListA)  # -> XComponent, YComponent, ZComponent
lng = ListLength(List=dispatch.ListA)
ma = MassAddition(Input=pdecon.XComponent)  # -> Result, PartialResults
ma_2 = MassAddition(Input=pdecon.YComponent)  # -> Result, PartialResults
division = Division(A=ma.Result, B=lng)
division_2 = Division(A=ma_2.Result, B=lng)
pt = ConstructPoint(XCoordinate=division, YCoordinate=division_2, ZCoordinate=0)
panel_2 = Panel(pt)
C = ClusterInput()

# ---- group: average slide block pt
pt_2 = Point(pt)

# ----
crv_cp = CurveClosestPoint(Point=pt_2, Curve=C)  # -> Point, Parameter, Distance
pshift = ShiftPaths(Data=crv_cp.Parameter, Offset=-1)
D = ClusterOutput(pshift)

# ==== cluster ModuleCenter
pt = ClusterInput()
int = ClusterInput()
num = ClusterInput()
int_2 = ClusterInput()

# ---- group: y
int_3 = Integer(int)

# ---- group: cell size
num_2 = Number(num)

# ---- group: x
int_4 = Integer(int_2)

# ---- group: center
pt_2 = Point(pt)

# ----
pt_3 = ConstructPoint(XCoordinate=0, YCoordinate=0, ZCoordinate=0)  # disabled
addition = Addition(A=int_4, B=0.5)
vec2pt = Vector2Pt(PointA=pt_3, PointB=pt_2, Unitize=False)  # -> Vector, Length; disabled
addition_2 = Addition(A=int_3, B=0.5)
multiplication = Multiplication(A=addition, B=num_2)
move = Move(Motion=vec2pt.Vector)  # -> Geometry, Transform; disabled
lng = ListLength(List=int_4)  # disabled
multiplication_2 = Multiplication(A=addition_2, B=num_2)
X = UnitX(Factor=multiplication)
repeat = RepeatData(Data=move.Transform, Length=lng)  # disabled
neg = Negative(Value=multiplication_2)
move_2 = Move(Geometry=pt_2, Motion=X)  # -> Geometry, Transform
graft = GraftTree(Tree=move_2.Transform, IncludeEmptyLists=True, IncludeNullItems=True)  # disabled
Y = UnitY(Factor=neg)
pshift = ShiftPaths(Data=repeat, Offset=-1)  # disabled
move_3 = Move(Geometry=move_2.Geometry, Motion=Y)  # -> Geometry, Transform
graft_2 = GraftTree(Tree=move_3.Transform, IncludeEmptyLists=True, IncludeNullItems=True)  # disabled
comp = Compound(Transforms=[graft, graft_2])  # disabled
graft_3 = GraftTree(Tree=pshift, IncludeEmptyLists=True, IncludeNullItems=True)  # disabled
comp_2 = Compound(Transforms=[comp, graft_3])  # disabled

# ---- group: module center
pt_4 = Point(move_3.Geometry)

# ----
pshift_2 = ShiftPaths(Data=comp_2, Offset=-1)  # disabled
transform = Transform(pshift_2)  # disabled
pt_5 = ClusterOutput(pt_4)
transform_2 = ClusterOutput(transform)  # disabled

# ==== cluster MoveToOrgin
num = ClusterInput()
G = ClusterInput()
num_2 = Number(num)
geobottomcenter = GeoBottomCenter(geo=G)
vec2pt = Vector2Pt(PointA=geobottomcenter, PointB=Point(0, 0, 0), Unitize=False)  # -> Vector, Length
move = Move(Geometry=G, Motion=vec2pt.Vector)  # -> Geometry, Transform
scale_nu = ScaleNU(Geometry=move.Geometry, Plane=PlaneXY(0, 0, 0), ScaleX=num_2, ScaleY=num_2, ScaleZ=1)  # -> Geometry, Transform
G_2 = ClusterOutput(scale_nu.Geometry)

# ==== cluster EasterEggs
panel = Panel("79")  # disabled
panel_2 = Panel("30")  # disabled
subtraction = Subtraction(A=panel, B=1)  # disabled
subtraction_2 = Subtraction(A=panel_2, B=1)  # disabled
sqgrid = Square(Plane=PlaneXY(0, 0, 0), Size=1, ExtentX=subtraction, ExtentY=subtraction_2)  # -> Cells, Points; disabled
pdecon = Deconstruct(Point=sqgrid.Points)  # -> XComponent, YComponent, ZComponent; disabled
division = Division(A=pdecon.XComponent, B=panel)  # disabled
division_2 = Division(A=pdecon.YComponent, B=panel_2)  # disabled
pt = ConstructPoint(XCoordinate=division, YCoordinate=division_2, ZCoordinate=0)  # disabled
ahsv = SplitAHSV()  # -> Alpha, Hue, Saturation, Value; disabled
smaller = SmallerThan(FirstNumber=ahsv.Alpha, SecondNumber=1)  # -> SmallerThan, OrEqualTo; disabled
dispatch = Dispatch(List=sqgrid.Points, DispatchPattern=smaller.SmallerThan)  # -> ListA, ListB; disabled
dispatch_2 = Dispatch(DispatchPattern=smaller.SmallerThan)  # -> ListA, ListB; disabled
vec = VectorXYZ(XComponent=2, YComponent=-2, ZComponent=-10)  # -> Vector, Length; disabled
planesrf = PlaneSurface(Plane=dispatch.ListB, XSize=Domain(-0.5, 0.5), YSize=Domain(-0.5, 0.5))  # disabled
mesh = Mesh(flatten(planesrf))  # disabled
col = Colour(flatten(dispatch_2.ListB))  # disabled
mspray = MeshSpray(Mesh=graft(mesh), Points=Point(0, 0, 0), Colours=graft(col), SprayMode=0)  # disabled
mjoin = MeshJoin(Meshes=flatten(mspray))  # disabled
move = Move(Geometry=mjoin, Motion=vec.Vector)  # -> Geometry, Transform; disabled
mcol = MeshColours(Mesh=move.Geometry, Colours=RGB(0, 0, 0))  # disabled
preview = CustomPreview(Geometry=planesrf, Shader=dispatch_2.ListB)  # disabled
mjoin_2 = MeshJoin(Meshes=flatten([mjoin, mcol]))  # disabled
toggle = BooleanToggle(False)  # disabled
toggle_2 = BooleanToggle(False)  # disabled
panel_3 = Panel("7")  # disabled
swatch = ColourSwatch(SwatchColor=RGB(0, 0, 0))  # disabled
swatch_2 = ColourSwatch(SwatchColor=RGB(255, 115, 0))  # disabled

# ---- group: module meshes lego ref: 7 - J
mesh_2 = Mesh(<mesh referenced from the Rhino model>)  # disabled

# ---- group: on screen mesh ref: 8 - X
mesh_3 = Mesh(<mesh referenced from the Rhino model>)  # disabled

# ---- group: module meshes lego ref: 8 - X
mesh_4 = Mesh(<mesh referenced from the Rhino model>)  # disabled

# ----
panel_4 = Panel("7")  # disabled
mesh_5 = Mesh(<mesh referenced from the Rhino model>)  # disabled

# ---- group: on screen mesh ref: 7 - J
mesh_6 = Mesh(mjoin_2)  # disabled

# ----
mcol_2 = MeshColours(Mesh=mesh_3, Colours=swatch_2)  # disabled
mcol_3 = MeshColours(Mesh=mesh_5, Colours=swatch)  # disabled
shrink = ClusterInput()
shrink_2 = ClusterInput()
movetoorgin = MoveToOrgin(G=mesh_2, num=shrink)  # disabled
movetoorgin_2 = MoveToOrgin(G=mesh_4, num=shrink_2)  # disabled
mjoin_3 = MeshJoin(Meshes=[mcol_2, mcol_3])  # disabled

# ---- group: module meshes lego at orgin
mesh_7 = Mesh(movetoorgin)  # disabled

mesh_8 = Mesh(movetoorgin_2)  # disabled

# ----
A = ClusterInput()
A_2 = ClusterInput()
equals = Equality(FirstNumber=A, SecondNumber=panel_4)  # -> Equality, Inequality; disabled
int = Integer(equals.Equality)  # disabled
ma = MassAddition(Input=int)  # -> Result, PartialResults; disabled
larger = LargerThan(FirstNumber=ma.Result, SecondNumber=0)  # -> LargerThan, OrEqualTo; disabled
equals_2 = Equality(FirstNumber=A_2, SecondNumber=panel_3)  # -> Equality, Inequality; disabled
L = ClusterInput()
int_2 = Integer(equals_2.Equality)  # disabled
ma_2 = MassAddition(Input=int_2)  # -> Result, PartialResults; disabled
larger_2 = LargerThan(FirstNumber=ma_2.Result, SecondNumber=0)  # -> LargerThan, OrEqualTo; disabled
L_2 = ClusterInput()
dispatch_3 = Dispatch(List=L, DispatchPattern=equals_2.Equality)  # -> ListA, ListB; disabled

# ---- group: if has this special id
bool = Boolean(larger.LargerThan)  # disabled

bool_2 = Boolean(bool)  # disabled

# ----
getcamera = GetCamera(GetCamera=bool_2)  # -> Location, Target, LensLength, UpDirection; disabled
ln = Line(StartPoint=getcamera.Location, EndPoint=getcamera.Target)  # disabled
getplanefrom2pts = GetPlaneFrom2pts(pt_2=getcamera.Location, pt=getcamera.Target)  # disabled
dispatch_4 = Dispatch(List=L_2, DispatchPattern=equals.Equality)  # -> ListA, ListB; disabled
number_slider = Slider(6.4, range=0..10)  # disabled
number_slider_2 = Slider(14.4, range=0..100)  # disabled
pt_2 = ConstructPoint(XCoordinate=500, YCoordinate=500, ZCoordinate=20)  # disabled

# ---- group: if has this special id
bool_3 = Boolean(larger_2.LargerThan)  # disabled

bool_4 = Boolean(bool_3)  # disabled

# ----
getcamera_2 = GetCamera(GetCamera=bool_4)  # -> Location, Target, LensLength, UpDirection; disabled
ln_2 = Line(StartPoint=getcamera_2.Location, EndPoint=getcamera_2.Target)  # disabled
getplanefrom2pts_2 = GetPlaneFrom2pts(pt_2=getcamera_2.Location, pt=getcamera_2.Target)  # disabled
vec2pt = Vector2Pt(PointA=Point(0, 0, 0), PointB=dispatch_3.ListA, Unitize=False)  # -> Vector, Length; disabled
vec2pt_2 = Vector2Pt(PointA=Point(0, 0, 0), PointB=dispatch_4.ListA, Unitize=False)  # -> Vector, Length; disabled
move_2 = Move(Geometry=mesh_7, Motion=vec2pt.Vector)  # -> Geometry, Transform; disabled
pt_3 = Point(pt_2)  # disabled
move_3 = Move(Geometry=mesh_8, Motion=vec2pt_2.Vector)  # -> Geometry, Transform; disabled

# ---- group: current cam canvas pln
pln = Plane(getplanefrom2pts)  # disabled

pln_2 = Plane(getplanefrom2pts_2)  # disabled

# ----
xy = XYPlane(Origin=pt_3)  # disabled
number_slider_3 = Slider(0.01, range=0.001..1)  # disabled
number_slider_4 = Slider(0.01, range=0.001..1)  # disabled
number_slider_5 = Slider(0.81, range=0.001..101)  # disabled
movetoorgin_3 = MoveToOrgin(G=mjoin_3, num=number_slider)  # disabled
movetoorgin_4 = MoveToOrgin(G=mesh_6, num=number_slider_2)  # disabled
orient = Orient(Geometry=movetoorgin_4, Source=PlaneXY(0, 0, 0), Target=xy)  # -> Geometry, Transform; disabled
orient_2 = Orient(Geometry=movetoorgin_3, Source=PlaneXY(0, 0, 0), Target=pln)  # -> Geometry, Transform; disabled
orient_3 = Orient(Geometry=movetoorgin_4, Source=PlaneXY(0, 0, 0), Target=pln_2)  # -> Geometry, Transform; disabled
scale = Scale(Geometry=orient_2.Geometry, Center=getcamera.Location, Factor=number_slider_3)  # -> Geometry, Transform; disabled
scale_2 = Scale(Geometry=orient_3.Geometry, Center=getcamera_2.Location, Factor=number_slider_4)  # -> Geometry, Transform; disabled
scale_3 = Scale(Geometry=orient.Geometry, Center=pt_3, Factor=number_slider_5)  # -> Geometry, Transform; disabled
filter = StreamFilter(Gate=bool_2, Stream1=scale.Geometry)  # disabled
filter_2 = StreamFilter(Gate=bool_4, Stream1=scale_2.Geometry)  # disabled
filter_3 = StreamFilter(Gate=bool_4, Stream1=scale_3.Geometry)  # disabled

# ---- group: special JR
mesh_9 = Mesh(move_2.Geometry)  # disabled

# ---- group: on 3d view
mesh_10 = Mesh(filter)  # disabled

# ---- group: special Xin
mesh_11 = Mesh(move_3.Geometry)  # disabled

# ---- group: on 3d view
mesh_12 = Mesh(filter_2)  # disabled

# ---- group: on lego
mesh_13 = Mesh(filter_3)  # disabled

# ==== cluster Perspective
int = ClusterInput()
int_2 = ClusterInput()
pt = ClusterInput()

# ---- group: grid extent y
int_3 = Integer(int)

# ---- group: grid extent x
int_4 = Integer(int_2)

# ---- group: Pts Sample Grid Corner
pt_2 = Point(pt)

# ----
subtraction = Subtraction(A=int_4, B=1)
subtraction_2 = Subtraction(A=int_3, B=1)
item = ListItem(List=pt_2, Index=0, Wrap=False)
item_2 = ListItem(List=pt_2, Index=1, Wrap=False)
item_3 = ListItem(List=pt_2, Index=2, Wrap=False)
item_4 = ListItem(List=pt_2, Index=3, Wrap=False)
pt_3 = Point(item_4)
pt_4 = Point(item)
ln = Line(StartPoint=pt_3, EndPoint=pt_4)
pt_5 = Point(item_2)
ln_2 = Line(StartPoint=pt_4, EndPoint=pt_5)
pt_6 = Point(item_3)
ln_3 = Line(StartPoint=pt_6, EndPoint=pt_3)
ln_4 = Line(StartPoint=pt_5, EndPoint=pt_6)
llx = LineLine(Line1=ln, Line2=ln_4)  # -> ParamA, ParamB, PointA, PointB
pt_7 = Point(llx.PointA)
llx_2 = LineLine(Line1=ln_2, Line2=ln_3)  # -> ParamA, ParamB, PointA, PointB
pt_8 = Point(llx_2.PointA)
vec2pt = Vector2Pt(PointA=pt_8, PointB=pt_7, Unitize=False)  # -> Vector, Length
line = LineSDL(Start=pt_3, Direction=vec2pt.Vector, Length=1)
llx_3 = LineLine(Line1=ln_2, Line2=line)  # -> ParamA, ParamB, PointA, PointB
pt_9 = Point(llx_3.PointA)
ln_5 = Line(StartPoint=pt_3, EndPoint=pt_9)
divide = DivideCurve(Curve=ln_5, Count=subtraction_2, Kinks=False)  # -> Points, Tangents, Parameters
ln_6 = Line(StartPoint=pt_8, EndPoint=divide.Points)
llx_4 = LineLine(Line1=ln_4, Line2=line)  # -> ParamA, ParamB, PointA, PointB
pt_10 = Point(llx_4.PointA)
ln_7 = Line(StartPoint=pt_3, EndPoint=pt_10)
divide_2 = DivideCurve(Curve=ln_7, Count=subtraction, Kinks=False)  # -> Points, Tangents, Parameters
ln_8 = Line(StartPoint=pt_7, EndPoint=divide_2.Points)
ln_9 = Line(StartPoint=pt_8, EndPoint=pt_7)

# ---- group: x
line_2 = Line(ln_8)

# ---- group: y
line_3 = Line(ln_6)

# ----
graft = GraftTree(Tree=ln_6, IncludeEmptyLists=True, IncludeNullItems=True)
llx_5 = LineLine(Line1=line_2, Line2=graft)  # -> ParamA, ParamB, PointA, PointB

# ---- group: keystoned grid pts
pt_11 = Point(llx_5.PointA)

# ----
pt_12 = ClusterOutput(pt_11)

# ==== cluster IDMasking
T = ClusterInput()
split = TextSplit(Text=T)
cull = CullPattern(List=split, CullPattern=[True, False])
panel = Panel(cull)
join = TextJoin(Text=panel, Join=",")
split_2 = TextSplit(Text=join, Separators=",")
pshift = ShiftPaths(Data=split_2, Offset=-2)

# ---- group: masking data
int = Integer(pshift)

# ----
panel_2 = Panel(int)
lng = ListLength(List=split_2)
int_2 = ClusterInput()

# ---- group: module id
int_3 = Integer(int_2)

# ----
repeat = RepeatData(Data="-2", Length=lng)
pshift_2 = ShiftPaths(Data=repeat, Offset=-3)
panel_3 = Panel(pshift_2)
merge = Merge(Data1=graft(int_3), Data2=graft(pshift_2))
item = ListItem(List=merge, Index=graft(int), Wrap=False)
pshift_3 = ShiftPaths(Data=item, Offset=-1)
D = ClusterOutput(pshift_3)

# ==== cluster CenterLine
xe = ClusterInput()
ye = ClusterInput()
x = ClusterInput()
y = ClusterInput()
id = ClusterInput()

# ---- group: road check matrix
python = PythonScript(xe=xe, ye=ye, x=x, y=y, id=id)  # -> out, m; inputs x: list, y: list, id: list
# ---------- python: Python ----------
"""
CityMatrix

written by "Ryan" Yan Zhang <ryanz@mit.edu>
for MIT Media Lab, Changing Place Group
April.6th.2016
"""

import rhinoscriptsyntax as rs

m = [[-1 for n in range(xe)] for n in range(ye)]

#for n in range(len(id)):
#    if id[n] == 7:
#        m[y[n]][x[n]] = 6
#    else:
#        m[y[n]][x[n]] = id[n]

for n in range(len(id)):
    m[y[n]][x[n]] = id[n]

for n in range(ye):
    print m[n]
# ---------- end python ----------

# ----
bool = ClusterInput()
X = ClusterInput()
X_2 = ClusterInput()
X_3 = ClusterInput()
X_4 = ClusterInput()
Y = ClusterInput()
Y_2 = ClusterInput()
Y_3 = ClusterInput()
Y_4 = ClusterInput()
xe_2 = ClusterInput()
ye_2 = ClusterInput()
x_2 = ClusterInput()
y_2 = ClusterInput()
id_2 = ClusterInput()
road_scaling = RoadScaling(bool=bool, X=X, X_2=X_2, X_3=X_3, X_4=X_4, Y=Y, Y_2=Y_2, Y_3=Y_3, Y_4=Y_4)  # -> mesh_8, pt_8, pt_7, mesh_7

# ---- group: road check list
python_2 = PythonScript(xe=xe_2, ye=ye_2, x=x_2, y=y_2, id=id_2, m=python.m)  # -> out, rdType; inputs x: list, y: list, id: list, m: list
# ---------- python_2: Python ----------
"""
CityMatrix

written by "Ryan" Yan Zhang <ryanz@mit.edu>
for MIT Media Lab, Changing Place Group
April.6th.2016
"""

import rhinoscriptsyntax as rs

rdType = []

for n in range(len(id)):
    
    code = []
    
    if id[n]==6:
        
        # 0: check x, y+1
        if y[n]+1>ye-1:
            code.append(1)
        else:
            if m[y[n]+1][x[n]]==6 or m[y[n]+1][x[n]]==-2:
                code.append(1)
            else:
                code.append(0)
        
        # 1: check x+1, y
        if x[n]+1>xe-1:
            code.append(1)
        else:
            if m[y[n]][x[n]+1]==6 or m[y[n]][x[n]+1]==-2:
                code.append(1)
            else:
                code.append(0)
        
        # 2: check x, y-1
        if y[n]-1<0:
            code.append(1)
        else:
            if m[y[n]-1][x[n]]==6 or m[y[n]-1][x[n]]==-2:
                code.append(1)
            else:
                code.append(0)
        
        # 3: check x-1, y
        if x[n]-1<0:
            code.append(1)
        else:
            if m[y[n]][x[n]-1]==6 or m[y[n]][x[n]-1]==-2:
                code.append(1)
            else:
                code.append(0)
    
    else:
        
        code = [0,0,0,0]
    
    print code
    rdType.append(code)
# ---------- end python_2 ----------

# ----
pt = ClusterInput()
id_3 = ClusterInput()

# ---- group: road check list
python_3 = PythonScript(
    pt=pt,
    id=id_3,
    rdType=python_2.rdType,
    rdQua0=road_scaling.mesh_8,
    c0=road_scaling.pt_8,
    rdQua1=road_scaling.mesh_7,
    c1=road_scaling.pt_7)  # -> out, allRoadMesh; inputs pt: list, id: list, rdType: list, rdQua0: list, rdQua1: list
# ---------- python_3: Python ----------
"""
CityMatrix

written by "Ryan" Yan Zhang <ryanz@mit.edu>
for MIT Media Lab, Changing Place Group
April.6th.2016
"""

import rhinoscriptsyntax as rs
import Rhino.Geometry as rg

allRoadMesh = []

for n in range(len(id)):
    
    if id[n]==6:
        
        for i in range(len(rdType[n])):
            t = rdType[n][i]
            v = rs.PointCoordinates(pt[n])
            if t == 0:
                c = rs.PointCoordinates(c0)
                vx = v[0]-c[0]
                vy = v[1]-c[1]
                new = rs.CopyObject(rdQua0[i],(vx,vy,0.))
            else:
                c = rs.PointCoordinates(c1)
                vx = v[0]-c[0]
                vy = v[1]-c[1]
                new = rs.CopyObject(rdQua1[i],(vx,vy,0.))
            allRoadMesh.append(new)
# ---------- end python_3 ----------

# ----
allroadmesh = ClusterOutput(python_3.allRoadMesh)

# ==== cluster Roads
xe = ClusterInput()
ye = ClusterInput()
x = ClusterInput()
y = ClusterInput()
id = ClusterInput()

# ---- group: road check matrix
python = PythonScript(xe=xe, ye=ye, x=x, y=y, id=id)  # -> out, m; inputs x: list, y: list, id: list; same code as python

# ----
bool = ClusterInput()
X = ClusterInput()
X_2 = ClusterInput()
X_3 = ClusterInput()
X_4 = ClusterInput()
Y = ClusterInput()
Y_2 = ClusterInput()
Y_3 = ClusterInput()
Y_4 = ClusterInput()
xe_2 = ClusterInput()
ye_2 = ClusterInput()
x_2 = ClusterInput()
y_2 = ClusterInput()
id_2 = ClusterInput()
road_scaling_picking = RoadScalingPicking(bool=bool, X=X, X_2=X_2, X_3=X_3, X_4=X_4, Y=Y, Y_2=Y_2, Y_3=Y_3, Y_4=Y_4)  # -> mesh_8, pt_8, pt_7, mesh_7

# ---- group: road check list
python_2 = PythonScript(xe=xe_2, ye=ye_2, x=x_2, y=y_2, id=id_2, m=python.m)  # -> out, rdType; inputs x: list, y: list, id: list, m: list
# ---------- python_2: Python ----------
"""
CityMatrix

written by "Ryan" Yan Zhang <ryanz@mit.edu>
for MIT Media Lab, Changing Place Group
April.6th.2016
"""

import rhinoscriptsyntax as rs

rdType = []

for n in range(len(id)):
    
    code = []
    
    if id[n]==6:
        
        # 0: check x, y+1
        if y[n]+1>ye-1:
            code.append(1)
        else:
            if m[y[n]+1][x[n]]==6:
                code.append(1)
            elif m[y[n]+1][x[n]]==-2:
                code.append(1)
            else:
                code.append(0)
        
        # 1: check x+1, y
        if x[n]+1>xe-1:
            code.append(1)
        else:
            if (m[y[n]][x[n]+1]==6) or (m[y[n]][x[n]+1]==-2):
                code.append(1)
            else:
                code.append(0)
        
        # 2: check x, y-1
        if y[n]-1<0:
            code.append(1)
        else:
            if m[y[n]-1][x[n]]==6 or m[y[n]-1][x[n]]==-2:
                code.append(1)
            else:
                code.append(0)
        
        # 3: check x-1, y
        if x[n]-1<0:
            code.append(1)
        else:
            if (m[y[n]][x[n]-1]==6) or (m[y[n]][x[n]-1]==-2):
                code.append(1)
            else:
                code.append(0)
    
    else:
        
        code = [0,0,0,0]
    
    print code
    rdType.append(code)
# ---------- end python_2 ----------

# ----
pt = ClusterInput()
id_3 = ClusterInput()

# ---- group: road check list
python_3 = PythonScript(
    pt=pt,
    id=id_3,
    rdType=python_2.rdType,
    rdQua0=road_scaling_picking.mesh_8,
    c0=road_scaling_picking.pt_8,
    rdQua1=road_scaling_picking.mesh_7,
    c1=road_scaling_picking.pt_7)  # -> out, allRoadMesh; inputs pt: list, id: list, rdType: list, rdQua0: list, rdQua1: list; same code as python_3

# ----
allroadmesh = ClusterOutput(python_3.allRoadMesh)

# ==== cluster Sidewalk
xe = ClusterInput()
ye = ClusterInput()
x = ClusterInput()
y = ClusterInput()
id = ClusterInput()

# ---- group: sidewalk check matrix
python = PythonScript(xe=xe, ye=ye, x=x, y=y, id=id)  # -> out, m; inputs x: list, y: list, id: list; same code as python

# ----
bool = ClusterInput()
X = ClusterInput()
X_2 = ClusterInput()
X_3 = ClusterInput()
X_4 = ClusterInput()
Y = ClusterInput()
Y_2 = ClusterInput()
Y_3 = ClusterInput()
Y_4 = ClusterInput()
xe_2 = ClusterInput()
ye_2 = ClusterInput()
x_2 = ClusterInput()
y_2 = ClusterInput()
id_2 = ClusterInput()
sidewalk_scaling = SidewalkScaling(bool=bool, X=X, X_2=X_2, X_3=X_3, X_4=X_4, Y=Y, Y_2=Y_2, Y_3=Y_3, Y_4=Y_4)  # -> mesh_8, pt_8, pt_7, mesh_7

# ---- group: sidewalk check list
python_2 = PythonScript(xe=xe_2, ye=ye_2, x=x_2, y=y_2, id=id_2, m=python.m)  # -> out, rdType; inputs x: list, y: list, id: list, m: list
# ---------- python_2: Python ----------
"""
CityMatrix

written by "Ryan" Yan Zhang <ryanz@mit.edu>
for MIT Media Lab, Changing Place Group
April.6th.2016
"""

import rhinoscriptsyntax as rs

rdType = []

for n in range(len(id)):
    
    code = []
    
    if id[n]==6:
        
        # 0: check x, y+1
        if y[n]+1>ye-1:
            code.append(1)
        else:
            if m[y[n]+1][x[n]]==6:
                code.append(1)
            else:
                code.append(0)
        
        # 1: check x+1, y
        if x[n]+1>xe-1:
            code.append(1)
        else:
            if m[y[n]][x[n]+1]==6:
                code.append(1)
            else:
                code.append(0)
        
        # 2: check x, y-1
        if y[n]-1<0:
            code.append(1)
        else:
            if m[y[n]-1][x[n]]==6:
                code.append(1)
            else:
                code.append(0)
        
        # 3: check x-1, y
        if x[n]-1<0:
            code.append(1)
        else:
            if m[y[n]][x[n]-1]==6:
                code.append(1)
            else:
                code.append(0)
    
    else:
        
        code = [0,0,0,0]
    
    print code
    rdType.append(code)
# ---------- end python_2 ----------

# ----
pt = ClusterInput()
id_3 = ClusterInput()

# ---- group: sidewalk check list
python_3 = PythonScript(
    pt=pt,
    id=id_3,
    rdType=python_2.rdType,
    rdQua0=sidewalk_scaling.mesh_8,
    c0=sidewalk_scaling.pt_8,
    rdQua1=sidewalk_scaling.mesh_7,
    c1=sidewalk_scaling.pt_7)  # -> out, allRoadMesh; inputs pt: list, id: list, rdType: list, rdQua0: list, rdQua1: list; same code as python_3

# ----
allroadmesh = ClusterOutput(python_3.allRoadMesh)

# ==== cluster UnitLayerVisualization
unit_floor_number = ClusterInput()
dock_id = ClusterInput()

# ---- group: Current dock ID
dock_id_2 = Integer(dock_id)

# ---- group: Floor #
unit_floor_number_2 = Integer(unit_floor_number)

# ----
smaller = SmallerThan(FirstNumber=dock_id_2, SecondNumber=0)  # -> SmallerThan, OrEqualTo
filter = StreamFilter(Gate=smaller.SmallerThan, Stream0=unit_floor_number_2)
int = Integer(filter)

number_slider = Slider(6, range=0..20)
how_many_office_floors = Slider(4, range=0..5)
number_slider_2 = Slider(30, range=0..70)

how_many_retail_floors = Slider(2, range=0..4)
number_slider_3 = Slider(6, range=0..20)
number_slider_4 = Slider(35, range=0..70)

number_slider_5 = Slider(6, range=0..20)

office_floor = Number(how_many_office_floors)

number_slider_6 = Slider(3, range=1..3)
number_slider_7 = Slider(8, range=0..10)

filter_2 = StreamFilter(Gate=dock_id_2, Stream0="OM", Stream1="OM", Stream2="OS", Stream3="OL", Stream4="OM", Stream5="OS")
panel = Panel("""0 RL
1 RM
2 RS
3 OL
4 OM
5 OS""")
filter_3 = StreamFilter(Gate=dock_id_2, Stream0="RL", Stream1="RM", Stream2="RS", Stream3="OL", Stream4="OM", Stream5="OS")
# 0 RL 4
# 1 RM 4
# 2 RS 5
# 3 OL 3
# 4 OM 4
# 5 OS 5
panel_2 = Panel("3")

# ---- group: Office type
filter_4 = StreamFilter(Gate=dock_id_2, Stream0="4", Stream1="4", Stream2="5", Stream3=panel_2, Stream4="4", Stream5="5")

# ----
office_type = Integer(filter_4)
office_type_2 = ClusterOutput(office_type)

larger = LargerThan(FirstNumber=int, SecondNumber=how_many_retail_floors)  # -> LargerThan, OrEqualTo
panel_3 = Panel("IF BIG THEN")
gate = StreamGate(Stream=int, Gate=larger.LargerThan)  # -> Target0, Target1
gate_2 = StreamGate(Stream=how_many_retail_floors, Gate=larger.LargerThan)  # -> Target0, Target1
panel_4 = Panel(gate_2.Target1)
panel_5 = Panel(gate.Target0)
series = Series(Start="0", Step=number_slider_3, Count=panel_5)
panel_6 = Panel("Retail functions floors+Height")
swatch = ColourSwatch(SwatchColor=RGBA(255, 255, 255, 72))

num = Number(panel_4)

subtraction = Subtraction(A=gate.Target1, B=how_many_retail_floors)
larger_2 = LargerThan(FirstNumber=subtraction, SecondNumber=office_floor)  # -> LargerThan, OrEqualTo
gate_3 = StreamGate(Stream=office_floor, Gate=larger_2.LargerThan)  # -> Target0, Target1
gate_4 = StreamGate(Stream=subtraction, Gate=larger_2.LargerThan)  # -> Target0, Target1
panel_8 = Panel(gate_4.Target0)
panel_9 = Panel(gate_3.Target1)
multiplication = Multiplication(A=[panel_5, num], B=number_slider_3)
panel_10 = Panel(multiplication)
panel_11 = Panel("OS/OM functions floors+Height")
series_2 = Series(Start=panel_10, Step=number_slider, Count=panel_8)
series_3 = Series(Start=panel_10, Step=number_slider, Count=panel_9)
addition = Addition(A=[series_2, series_3], B=number_slider)
pt = ConstructPoint(XCoordinate=number_slider_2, YCoordinate=addition, ZCoordinate=0)
pt_2 = ConstructPoint(XCoordinate=0, YCoordinate=[series_2, series_3], ZCoordinate=0)
rec_2pt = Rectangle2Pt(Plane=PlaneXY(0, 0, 0), PointA=pt_2, PointB=pt, Radius=0)  # -> Rectangle, Length
boundary = BoundarySurfaces(Edges=rec_2pt.Rectangle)
swatch_2 = ColourSwatch(SwatchColor=RGBA(0, 117, 153, 55))

multiplication_2 = Multiplication(A=[panel_8, panel_9], B="5")
cp = ControlPoints(Curve=rec_2pt.Rectangle)  # -> flatten(Points), Weights, Knots
subtraction_2 = Subtraction(A=multiplication_2, B="2")
item = ListItem(List=cp.Points, Index=0, Wrap=True)
item_2 = ListItem(List=cp.Points, Index=subtraction_2, Wrap=True)
number_slider_8 = Slider(-9, range=-10..10)
vec = VectorXYZ(XComponent=number_slider_8, YComponent=expr("-x", number_slider_8), ZComponent=0)  # -> Vector, Length
move = Move(Geometry=[item_2, item], Motion=vec.Vector)  # -> Geometry, Transform
merge = Merge(Data1=item, Data2=item_2, Data3=move.Geometry)
intcrv = Interpolate(Vertices=merge, Degree=1, Periodic=Toggle(True), KnotStyle=1)  # -> Curve, Length, Domain

relocate_to_ux_display = RelocateToUXDisplay(G=[rec_2pt.Rectangle, boundary, intcrv.Curve])

preview = CustomPreview(Geometry=relocate_to_ux_display, Shader=swatch_2)

null = NullItem(Item=boundary)  # -> NullFlags, InvalidFlags, Description

# ---- group: Validation
filter_5 = StreamFilter(Gate=null.NullFlags, Stream0=how_many_office_floors, Stream1=Slider(0, range=0..100))

# ----
added_office_floor = Number(filter_5)
added_office_floor_2 = ClusterOutput(added_office_floor)

panel_12 = Panel([panel_5, num])
multiplication_3 = Multiplication(A=Slider(4, range=0..4), B=panel_12)
number_slider_9 = Slider(-9, range=-10..10)
vec_2 = VectorXYZ(XComponent=number_slider_9, YComponent=expr("-x", number_slider_9), ZComponent=0)  # -> Vector, Length

subtraction_3 = Subtraction(A=subtraction, B=office_floor)
multiplication_4 = Multiplication(A=[panel_9, panel_8], B=number_slider)
addition_2 = Addition(A=panel_10, B=multiplication_4)
panel_13 = Panel(addition_2)
panel_14 = Panel("OFFICE functions floors+Height")
series_4 = Series(Start=panel_13, Step=number_slider_5, Count=subtraction_3)
addition_3 = Addition(A=series_4, B=number_slider_5)
pt_3 = ConstructPoint(XCoordinate=Slider(25, range=0..50), YCoordinate=addition_3, ZCoordinate=0)
pt_4 = ConstructPoint(XCoordinate=0, YCoordinate=series_4, ZCoordinate=0)
rec_2pt_2 = Rectangle2Pt(Plane=PlaneXY(0, 0, 0), PointA=pt_4, PointB=pt_3, Radius=0)  # -> Rectangle, Length
boundary_2 = BoundarySurfaces(Edges=rec_2pt_2.Rectangle)
swatch_3 = ColourSwatch(SwatchColor=RGBA(209, 0, 178, 55))

multiplication_5 = Multiplication(A=subtraction_3, B="5")
cp_2 = ControlPoints(Curve=rec_2pt_2.Rectangle)  # -> flatten(Points), Weights, Knots
subtraction_4 = Subtraction(A=multiplication_5, B="2")
item_3 = ListItem(List=cp_2.Points, Index=0, Wrap=True)
item_4 = ListItem(List=cp_2.Points, Index=subtraction_4, Wrap=True)
number_slider_10 = Slider(-9, range=-10..10)
vec_3 = VectorXYZ(XComponent=number_slider_10, YComponent=expr("-x", number_slider_10), ZComponent=0)  # -> Vector, Length
move_2 = Move(Geometry=[item_4, item_3], Motion=vec_3.Vector)  # -> Geometry, Transform
merge_2 = Merge(Data1=item_3, Data2=item_4, Data3=move_2.Geometry)
intcrv_2 = Interpolate(Vertices=merge_2, Degree=1, Periodic=Toggle(True), KnotStyle=1)  # -> Curve, Length, Domain

relocate_to_ux_display_2 = RelocateToUXDisplay(G=[rec_2pt_2.Rectangle, boundary_2, intcrv_2.Curve])

preview_2 = CustomPreview(Geometry=relocate_to_ux_display_2, Shader=swatch_3)

multiplication_6 = Multiplication(A=subtraction_3, B=number_slider_5)
division = Division(A=multiplication_6, B=2)
null_2 = NullItem(Item=boundary_2)  # -> NullFlags, InvalidFlags, Description
filter_6 = StreamFilter(Gate=null_2.NullFlags, Stream0=filter_3)

series_5 = Series(Start="0", Step=number_slider_3, Count=num)
addition_4 = Addition(A=[series, series_5], B=number_slider_3)
pt_5 = ConstructPoint(XCoordinate=0, YCoordinate=[series, series_5], ZCoordinate=0)
pt_6 = ConstructPoint(XCoordinate=number_slider_4, YCoordinate=addition_4, ZCoordinate=0)
rec_2pt_3 = Rectangle2Pt(Plane=PlaneXY(0, 0, 0), PointA=pt_5, PointB=pt_6, Radius=0)  # -> Rectangle, Length
boundary_3 = BoundarySurfaces(Edges=rec_2pt_3.Rectangle)

cp_3 = ControlPoints(Curve=rec_2pt_3.Rectangle)  # -> flatten(Points), Weights, Knots
item_5 = ListItem(List=cp_3.Points, Index=0, Wrap=True)
item_6 = ListItem(List=cp_3.Points, Index=multiplication_3, Wrap=True)
move_3 = Move(Geometry=[item_5, item_6], Motion=vec_2.Vector)  # -> Geometry, Transform
merge_3 = Merge(Data1=item_6, Data2=item_5, Data3=move_3.Geometry)
intcrv_3 = Interpolate(Vertices=merge_3, Degree=1, Periodic=Toggle(True), KnotStyle=1)  # -> Curve, Length, Domain

relocate_to_ux_display_3 = RelocateToUXDisplay(G=[rec_2pt_3.Rectangle, boundary_3, intcrv_3.Curve])

preview_3 = CustomPreview(Geometry=relocate_to_ux_display_3, Shader=swatch)

multiplication_7 = Multiplication(A=[panel_8, panel_9], B=number_slider)
division_2 = Division(A=multiplication_7, B=2)
addition_5 = Addition(A=division_2, B=Slider(3, range=0..50))

item_7 = ListItem(List=pt_6, Index=0, Wrap=True)
multiplication_8 = Multiplication(A=[num, panel_5], B=number_slider_3)
pdecon = Deconstruct(Point=item_7)  # -> XComponent, YComponent, ZComponent
division_3 = Division(A=multiplication_8, B=2)
addition_6 = Addition(A=pdecon.XComponent, B=Slider(14, range=0..50))
pt_7 = ConstructPoint(XCoordinate=addition_6, YCoordinate=division_3, ZCoordinate=0)

planesrf = PlaneSurface(Plane=pt_7, XSize=Domain(-10, 10), YSize=Domain(-10, 10))
relocate_text_to_ux_display = RelocateToUXDisplay(G=planesrf)

lng = ListLength(List=rec_2pt.Rectangle)
pow = Power(A=number_slider_2, B=2)
multiplication_9 = Multiplication(A=lng, B=pow)
int_2 = Integer(multiplication_9)
panel_15 = Panel(int_2)  # disabled

lng_2 = ListLength(List=rec_2pt_3.Rectangle)
pow_2 = Power(A=number_slider_4, B=2)
multiplication_10 = Multiplication(A=lng_2, B=pow_2)
int_3 = Integer(multiplication_10)
panel_16 = Panel(int_3)  # disabled

null_3 = NullItem(Item=int_3)  # -> NullFlags, InvalidFlags, Description
null_4 = NullItem(Item=int_3)  # -> NullFlags, InvalidFlags, Description
filter_7 = StreamFilter(Gate=null_3.NullFlags, Stream0="Area (Sq/f)")  # disabled
filter_8 = StreamFilter(Gate=null_4.NullFlags, Stream0="Area (Sq/f)")  # disabled

merge_4 = Merge(Data1=filter_2, Data2=filter_7, Data3=flatten(panel_15))
join = TextJoin(Text=merge_4)

merge_5 = Merge(Data1="Retail & 3rd Places", Data2=filter_8, Data3=flatten(panel_16))
join_2 = TextJoin(Text=merge_5)

filter_9 = StreamFilter(Gate=null.NullFlags, Stream0=join)

justified_text = JustifiedText3d(
    Location=relocate_text_to_ux_display,
    Text=join_2,
    Size=number_slider_7,
    Color=swatch,
    HorizontalAlignment=number_slider_6,
    VerticalAlginment=1,
    UseMeshes=False,
    Bake=False)

addition_7 = Addition(A=multiplication_8, B=addition_5)
pt_8 = ConstructPoint(XCoordinate=addition_6, YCoordinate=addition_7, ZCoordinate=0)

addition_8 = Addition(A=addition_5, B=addition_7)
addition_9 = Addition(A=division, B=addition_8)
pt_9 = ConstructPoint(XCoordinate=addition_6, YCoordinate=addition_9, ZCoordinate=0)
planesrf_2 = PlaneSurface(Plane=pt_8, XSize=Domain(-10, 10), YSize=Domain(-10, 10))
planesrf_3 = PlaneSurface(Plane=pt_9, XSize=Domain(-10, 10), YSize=Domain(-10, 10))
relocate_text_to_ux_display_2 = RelocateToUXDisplay(G=planesrf_2)
relocate_text_to_ux_display_3 = RelocateToUXDisplay(G=planesrf_3)
justified_text_2 = JustifiedText3d(
    Location=relocate_text_to_ux_display_3,
    Text=filter_6,
    Size=number_slider_7,
    Color=swatch_3,
    HorizontalAlignment=number_slider_6,
    VerticalAlginment=1,
    UseMeshes=False,
    Bake=False)

justified_text_3 = JustifiedText3d(
    Location=relocate_text_to_ux_display_2,
    Text=filter_9,
    Size=number_slider_7,
    Color=swatch_2,
    HorizontalAlignment=number_slider_6,
    VerticalAlginment=1,
    UseMeshes=False,
    Bake=False)

# ==== cluster RecordSliderValue
rec = ClusterInput()
rec_2 = DataRecorder(rec, DataLimit=1, RecordData=True)
panel = Panel(rec_2)
null = NullItem(Item=rec_2)  # -> NullFlags, InvalidFlags, Description
filter = StreamFilter(Gate=null.NullFlags, Stream0=rec_2, Stream1=Slider(0, range=0..100))
remap = RemapNumbers(Value=filter, Source=Domain(0, 1), Target="1 to 30")  # -> Mapped, Clipped
R = ClusterOutput(remap.Mapped)

# ==== cluster RecordDensitySliderSet
integer = ClusterInput()
num = ClusterInput()
int = ClusterInput()

# ---- group: set number
integer_2 = Integer(integer)

# ---- group: slider1
num_2 = Number(num)

# ---- group: dockID
int_2 = Integer(int)

# ----
number_slider = Slider(4, range=0..10)
number_slider_2 = Slider(2.92, range=0..10)

# ---- group: density set 1
remap = RemapNumbers(Value="13", Source="1 to 30", Target=Domain(0, 1))  # -> Mapped, Clipped
remap_2 = RemapNumbers(Value="13", Source="1 to 30", Target=Domain(0, 1))  # -> Mapped, Clipped
remap_3 = RemapNumbers(Value="1", Source="1 to 30", Target=Domain(0, 1))  # -> Mapped, Clipped
remap_4 = RemapNumbers(Value="19", Source="1 to 30", Target=Domain(0, 1))  # -> Mapped, Clipped
remap_5 = RemapNumbers(Value="19", Source="1 to 30", Target=Domain(0, 1))  # -> Mapped, Clipped
remap_6 = RemapNumbers(Value="1", Source="1 to 30", Target=Domain(0, 1))  # -> Mapped, Clipped
panel = Panel(remap_2.Mapped)
panel_2 = Panel(remap_3.Mapped)
panel_3 = Panel(remap_5.Mapped)
panel_4 = Panel(remap.Mapped)
panel_5 = Panel(remap_4.Mapped)
panel_6 = Panel(remap_6.Mapped)

# ----
equals = Equality(FirstNumber=int_2, SecondNumber="5")  # -> Equality, Inequality
equals_2 = Equality(FirstNumber=int_2, SecondNumber="2")  # -> Equality, Inequality
equals_3 = Equality(FirstNumber=int_2, SecondNumber="3")  # -> Equality, Inequality
equals_4 = Equality(FirstNumber=int_2, SecondNumber="4")  # -> Equality, Inequality
equals_5 = Equality(FirstNumber=int_2, SecondNumber="0")  # -> Equality, Inequality
equals_6 = Equality(FirstNumber=int_2, SecondNumber="1")  # -> Equality, Inequality
filter = StreamFilter(Gate=equals.Equality, Stream1=num_2)
filter_2 = StreamFilter(Gate=equals_2.Equality, Stream1=num_2)
filter_3 = StreamFilter(Gate=equals_3.Equality, Stream1=num_2)
filter_4 = StreamFilter(Gate=equals_4.Equality, Stream1=num_2)
filter_5 = StreamFilter(Gate=equals_5.Equality, Stream1=num_2)
filter_6 = StreamFilter(Gate=equals_6.Equality, Stream1=num_2)
panel_7 = Panel(integer_2)

# ---- group: density set 2
remap_7 = RemapNumbers(Value="19", Source="1 to 30", Target=Domain(0, 1))  # -> Mapped, Clipped
remap_8 = RemapNumbers(Value="19", Source="1 to 30", Target=Domain(0, 1))  # -> Mapped, Clipped
remap_9 = RemapNumbers(Value="19", Source="1 to 30", Target=Domain(0, 1))  # -> Mapped, Clipped
remap_10 = RemapNumbers(Value="25", Source="1 to 30", Target=Domain(0, 1))  # -> Mapped, Clipped
remap_11 = RemapNumbers(Value="25", Source="1 to 30", Target=Domain(0, 1))  # -> Mapped, Clipped
remap_12 = RemapNumbers(Value="5", Source="1 to 30", Target=Domain(0, 1))  # -> Mapped, Clipped
panel_8 = Panel(remap_7.Mapped)
panel_9 = Panel(remap_8.Mapped)
panel_10 = Panel(remap_9.Mapped)
panel_11 = Panel(remap_10.Mapped)
panel_12 = Panel(remap_11.Mapped)
panel_13 = Panel(remap_12.Mapped)

# ----
filter_7 = StreamFilter(Gate=panel_7, Stream0=filter_5, Stream1=panel_4, Stream2=panel_8)
filter_8 = StreamFilter(Gate=panel_7, Stream0=filter, Stream1=panel_6, Stream2=panel_13)
filter_9 = StreamFilter(Gate=panel_7, Stream0=filter_2, Stream1=panel_2, Stream2=panel_10)
filter_10 = StreamFilter(Gate=panel_7, Stream0=filter_3, Stream1=panel_5, Stream2=panel_11)
filter_11 = StreamFilter(Gate=panel_7, Stream0=filter_4, Stream1=panel_3, Stream2=panel_12)
filter_12 = StreamFilter(Gate=panel_7, Stream0=filter_6, Stream1=panel, Stream2=panel_9)
rec = DataRecorder(filter_9, DataLimit=1, RecordData=True)
panel_14 = Panel(rec)
rec_2 = DataRecorder(filter_8, DataLimit=1, RecordData=True)
panel_15 = Panel(rec_2)
rec_3 = DataRecorder(filter_12, DataLimit=1, RecordData=True)
panel_16 = Panel(rec_3)
rec_4 = DataRecorder(filter_10, DataLimit=1, RecordData=True)
panel_17 = Panel(rec_4)
rec_5 = DataRecorder(filter_11, DataLimit=1, RecordData=True)
panel_18 = Panel(rec_5)
rec_6 = DataRecorder(filter_7, DataLimit=1, RecordData=True)
panel_19 = Panel(rec_6)
null = NullItem(Item=rec_2)  # -> NullFlags, InvalidFlags, Description
null_2 = NullItem(Item=rec)  # -> NullFlags, InvalidFlags, Description
null_3 = NullItem(Item=rec_4)  # -> NullFlags, InvalidFlags, Description
null_4 = NullItem(Item=rec_5)  # -> NullFlags, InvalidFlags, Description
null_5 = NullItem(Item=rec_6)  # -> NullFlags, InvalidFlags, Description
null_6 = NullItem(Item=rec_3)  # -> NullFlags, InvalidFlags, Description
filter_13 = StreamFilter(Gate=null.NullFlags, Stream0=rec_2, Stream1="0")
filter_14 = StreamFilter(Gate=null_2.NullFlags, Stream0=rec, Stream1="0")
filter_15 = StreamFilter(Gate=null_3.NullFlags, Stream0=rec_4, Stream1="0")
filter_16 = StreamFilter(Gate=null_4.NullFlags, Stream0=rec_5, Stream1="0")
filter_17 = StreamFilter(Gate=null_5.NullFlags, Stream0=rec_6, Stream1="0")
filter_18 = StreamFilter(Gate=null_6.NullFlags, Stream0=rec_3, Stream1="0")
merge = Merge(Data1=filter_17, Data2=filter_18, Data3=filter_14, Data4=filter_15, Data5=filter_16, Data6=filter_13)
remap_13 = RemapNumbers(Value=merge, Source=Domain(0, 1), Target="1 to 30")  # -> Mapped, Clipped

# ---- group: floor num for each type
int_3 = Integer(remap_13.Mapped)

# ----
panel_20 = Panel(int_3)

int_4 = ClusterOutput(int_3)

# ==== cluster Cluster
xy = XYPlane(Origin=Point(0, 0, 0))
rotate = Rotate(Geometry=xy, Angle=degrees(180), Plane=PlaneXY(0, 0, 0))  # -> Geometry, Transform
B = ClusterInput()
vec2pt = Vector2Pt(PointA=Point(0, 0, 0), PointB=B, Unitize=False)  # -> Vector, Length
move = Move(Geometry=rotate.Geometry, Motion=vec2pt.Vector)  # -> Geometry, Transform
G = ClusterOutput(move.Geometry)

# ==== cluster Cluster_2
num = ClusterInput()
num_2 = Number(num)
ma = MassAddition(Input=num_2)  # -> Result, PartialResults
pshift = ShiftPaths(Data=ma.Result, Offset=-1)
num_3 = Number(pshift)
num_4 = ClusterOutput(num_3)

# ==== cluster Cluster_3
values = ClusterInput()
per_indicator = ClusterInput()
B = ClusterInput()
multiplication = Multiplication(Values=values, B=B)
ma = MassAddition(Input=multiplication)  # -> Result, PartialResults
multiplication_2 = Multiplication(A=ma.Result, PerIndicator=per_indicator)
R = ClusterOutput(multiplication_2)

# ==== cluster Cluster_4
panel = Panel("""2
3""")
list = ClusterInput()
number = ClusterInput()
number_2 = Number(number)
tree_item = TreeItem(Tree=number_2, Path="{0;0;1}", Index=panel, Wrap=True)
replace_items = ReplaceItems(List=list, Item=tree_item, Indices=panel, Wrap=False)
shift_paths = ShiftPaths(Data=replace_items, Offset=-1)  # -> graft(Data)
data = ClusterOutput(shift_paths)
panel_2 = Panel(shift_paths)

# ==== cluster Cluster_5
panel = Panel("""2
3""")
number = ClusterInput()
list = ClusterInput()
number_2 = Number(number)
tree_item = TreeItem(Tree=number_2, Path="{0;0;1}", Index=panel, Wrap=True)
replace_items = ReplaceItems(List=list, Item=tree_item, Indices=panel, Wrap=False)
shift_paths = ShiftPaths(Data=replace_items, Offset=-1)  # -> graft(Data)
panel_2 = Panel(tree_item)
data = ClusterOutput(shift_paths)
panel_3 = Panel(replace_items)
panel_4 = Panel(shift_paths)

# ==== cluster Cluster_6
number = ClusterInput()
list = ClusterInput()
number_2 = Number(number)
tree_item = TreeItem(Tree=number_2, Path="{0;0;1}", Index="3", Wrap=True)
replace_items = ReplaceItems(List=list, Item=tree_item, Indices="3", Wrap=False)
shift_paths = ShiftPaths(Data=replace_items, Offset=-1)  # -> graft(Data)
panel = Panel(tree_item)
data = ClusterOutput(shift_paths)
panel_2 = Panel(replace_items)
panel_3 = Panel(shift_paths)

# ==== cluster Cluster_7
amenities_list = ClusterInput()
amenities_list_2 = Text(amenities_list)
panel = Panel(amenities_list_2)
title = ClusterInput()
title_2 = Text(title)
A = ClusterInput()
B = ClusterInput()
panel_2 = Panel(title_2)
addition = Addition(A=A, B=B)
X = UnitX(Factor=addition)
merge = Merge(Data1=panel_2, Data2=panel)  # -> flatten(Result)
vec = VectorXYZ(XComponent=X, YComponent=expr("x*(-1)", 0), ZComponent=0)  # -> Vector, Length
text_join = TextJoin(Text=merge, Join=graft(""))
G = ClusterInput()
move = Move(Geometry=G, Motion=vec.Vector)  # -> Geometry, Transform
result = ClusterOutput(text_join)
G_2 = ClusterOutput(move.Geometry)

# ==== cluster Cluster_8
txt = ClusterInput()
txt_2 = Text(txt)
int = ClusterInput()
textformating = TextFormating(txt=txt_2)
multiplication = Multiplication(A=textformating, B="0.7464233879328219")

# ---- group: Full site ID
int_2 = Integer(simplify(int))

# ----
int_3 = Integer(simplify(textformating))
panel = Panel(textformating)
txt_3 = ClusterOutput(textformating)
equals = Equality(FirstNumber=int_2, SecondNumber="5")  # -> Equality, Inequality
equals_2 = Equality(FirstNumber=int_2, SecondNumber="2")  # -> Equality, Inequality
equals_3 = Equality(FirstNumber=int_2, SecondNumber="3")  # -> Equality, Inequality
equals_4 = Equality(FirstNumber=int_2, SecondNumber="4")  # -> Equality, Inequality
equals_5 = Equality(FirstNumber=int_2, SecondNumber="0")  # -> Equality, Inequality
equals_6 = Equality(FirstNumber=int_2, SecondNumber="1")  # -> Equality, Inequality
cull = CullPattern(List=int_3, CullPattern=equals.Equality)
cull_2 = CullPattern(List=int_3, CullPattern=equals_4.Equality)
cull_3 = CullPattern(List=int_3, CullPattern=equals_3.Equality)
cull_4 = CullPattern(List=int_3, CullPattern=equals_2.Equality)
cull_5 = CullPattern(List=int_3, CullPattern=equals_6.Equality)
cull_6 = CullPattern(List=int_3, CullPattern=equals_5.Equality)
ma = MassAddition(Input=cull)  # -> Result, PartialResults
ma_2 = MassAddition(Input=cull_2)  # -> Result, PartialResults
ma_3 = MassAddition(Input=cull_3)  # -> Result, PartialResults
ma_4 = MassAddition(Input=cull_4)  # -> Result, PartialResults
ma_5 = MassAddition(Input=cull_5)  # -> Result, PartialResults
ma_6 = MassAddition(Input=cull_6)  # -> Result, PartialResults
A = ClusterInput()
multiplication_2 = Multiplication(A=A, B="0.0666667")
multiplication_3 = Multiplication(A=A, B="0.0337")
multiplication_4 = Multiplication(A=A, B="0.05454")
multiplication_5 = Multiplication(A=A, B="0.018181")
multiplication_6 = Multiplication(A=A, B="0.2")
multiplication_7 = Multiplication(A=A, B="0.01123")
panel_2 = Panel(multiplication_7)
panel_3 = Panel(multiplication_2)
panel_4 = Panel(multiplication_3)
panel_5 = Panel(multiplication_5)
panel_6 = Panel(multiplication_6)
panel_7 = Panel(multiplication_4)
num = Number(multiplication_6)
multiplication_8 = Multiplication(A=panel_7, B=ma_2.Result)
multiplication_9 = Multiplication(A=panel_5, B=ma_5.Result)
multiplication_10 = Multiplication(A=panel_3, B=ma_6.Result)
multiplication_11 = Multiplication(A=panel_6, B=ma_3.Result)
multiplication_12 = Multiplication(A=panel_4, B=ma.Result)
multiplication_13 = Multiplication(A=panel_2, B=ma_4.Result)
num_2 = Number(multiplication_3)
num_3 = Number(multiplication_2)
num_4 = Number(multiplication_4)
num_5 = Number(multiplication_5)
num_6 = Number(multiplication_7)
R = ClusterOutput(multiplication_8)
R_2 = ClusterOutput(multiplication_9)
R_3 = ClusterOutput(multiplication_10)
R_4 = ClusterOutput(multiplication_11)
R_5 = ClusterOutput(multiplication_12)
R_6 = ClusterOutput(multiplication_13)

# ==== cluster PopulationCalculation
A = ClusterInput()
A_2 = ClusterInput()
A_3 = ClusterInput()
A_4 = ClusterInput()
A_5 = ClusterInput()
A_6 = ClusterInput()
L = ClusterInput()
L_2 = ClusterInput()
L_3 = ClusterInput()
L_4 = ClusterInput()
equals = Equality(FirstNumber=A, SecondNumber="0")  # -> Equality, Inequality
equals_2 = Equality(FirstNumber=A_2, SecondNumber="1")  # -> Equality, Inequality
equals_3 = Equality(FirstNumber=A_3, SecondNumber="3")  # -> Equality, Inequality
L_5 = ClusterInput()
equals_4 = Equality(FirstNumber=A_4, SecondNumber="2")  # -> Equality, Inequality
L_6 = ClusterInput()
equals_5 = Equality(FirstNumber=A_5, SecondNumber="4")  # -> Equality, Inequality
equals_6 = Equality(FirstNumber=A_6, SecondNumber="5")  # -> Equality, Inequality
item = ListItem(List=L, Index="0", Wrap=False)
item_2 = ListItem(List=L_2, Index="2", Wrap=False)
item_3 = ListItem(List=L_3, Index="1", Wrap=False)
item_4 = ListItem(List=L_4, Index="3", Wrap=False)
item_5 = ListItem(List=L_5, Index="4", Wrap=False)
item_6 = ListItem(List=L_6, Index="5", Wrap=False)
int = Integer(equals.Equality)
int_2 = Integer(equals_2.Equality)
int_3 = Integer(equals_3.Equality)
int_4 = Integer(equals_4.Equality)
int_5 = Integer(equals_5.Equality)
int_6 = Integer(equals_6.Equality)
A_7 = ClusterInput()
ma = MassAddition(Input=int)  # -> Result, PartialResults
ma_2 = MassAddition(Input=int_2)  # -> Result, PartialResults
ma_3 = MassAddition(Input=int_3)  # -> Result, PartialResults
ma_4 = MassAddition(Input=int_4)  # -> Result, PartialResults
ma_5 = MassAddition(Input=int_5)  # -> Result, PartialResults

# ---- group: building id 0 fl #
int_7 = Integer(item)

# ---- group: building id 2 fl #
int_8 = Integer(item_2)

# ---- group: building id 1 fl #
int_9 = Integer(item_3)

# ----
ma_6 = MassAddition(Input=int_6)  # -> Result, PartialResults

# ---- group: building id 3 fl #
int_10 = Integer(item_4)

# ---- group: building id 4 fl #
int_11 = Integer(item_5)

# ---- group: building id 5 fl #
int_12 = Integer(item_6)

# ----
multiplication = Multiplication(A=A_7, B=Slider(0.25, range=0..1))
int_13 = Integer(ma.Result)
panel = Panel(int_13)
int_14 = Integer(ma_2.Result)
panel_2 = Panel(int_14)
int_15 = Integer(ma_3.Result)
panel_3 = Panel(int_15)
int_16 = Integer(ma_4.Result)
panel_4 = Panel(int_16)
int_17 = Integer(ma_5.Result)
panel_5 = Panel(int_17)
int_18 = Integer(ma_6.Result)
panel_6 = Panel(int_18)
num = Number(multiplication)
num_2 = ClusterOutput(num)

# ---- group: Micro-unit Building #
int_19 = Integer(int_16)

# ---- group: Luxury Building #
int_20 = Integer(int_13)

# ---- group: Regular residential Building #
int_21 = Integer(int_14)

# ---- group: Head Quater Building #
int_22 = Integer(int_15)

# ---- group: Regular Office Building #
int_23 = Integer(int_17)

# ---- group: Co-working Building #
int_24 = Integer(int_18)

# ---- group: ppl per m2
multiplication_2 = Multiplication(A=num, B="0.018181")
multiplication_3 = Multiplication(A=num, B="0.05454")
multiplication_4 = Multiplication(A=num, B="0.0666667")
multiplication_5 = Multiplication(A=num, B="0.01123")
multiplication_6 = Multiplication(A=num, B="0.2")
multiplication_7 = Multiplication(A=num, B="0.0337")

# ----
R = ClusterOutput(multiplication_2)

# ---- group: ppl per flr
panel_7 = Panel(multiplication_5)
panel_8 = Panel(multiplication_2)
panel_9 = Panel(multiplication_4)
panel_10 = Panel(multiplication_7)
panel_11 = Panel(multiplication_3)
panel_12 = Panel(multiplication_6)

# ----
R_2 = ClusterOutput(multiplication_3)
R_3 = ClusterOutput(multiplication_4)
R_4 = ClusterOutput(multiplication_5)
R_5 = ClusterOutput(multiplication_6)
R_6 = ClusterOutput(multiplication_7)

multiplication_8 = Multiplication(A=int_11, B=int_23)
multiplication_9 = Multiplication(A=int_9, B=int_21)
multiplication_10 = Multiplication(A=int_12, B=int_24)
multiplication_11 = Multiplication(A=int_8, B=int_19)
multiplication_12 = Multiplication(A=int_10, B=int_22)
multiplication_13 = Multiplication(A=int_7, B=int_20)

multiplication_14 = Multiplication(A=panel_11, B=multiplication_8)
multiplication_15 = Multiplication(A=panel_8, B=multiplication_9)
multiplication_16 = Multiplication(A=panel_9, B=multiplication_11)
multiplication_17 = Multiplication(A=panel_12, B=multiplication_10)
multiplication_18 = Multiplication(A=panel_10, B=multiplication_12)
multiplication_19 = Multiplication(A=panel_7, B=multiplication_13)
R_7 = ClusterOutput(multiplication_14)
R_8 = ClusterOutput(multiplication_15)
R_9 = ClusterOutput(multiplication_16)
R_10 = ClusterOutput(multiplication_17)
R_11 = ClusterOutput(multiplication_18)
R_12 = ClusterOutput(multiplication_19)

# ==== cluster LivingCalculation
A = ClusterInput()
division = Division(A=A, B=2)
G = ClusterInput()
Y = UnitY(Factor=division)
move = Move(Geometry=G, Motion=Y)  # -> Geometry, Transform
shift = ShiftList(List=move.Geometry, Shift=-1, Wrap=False)
shift_2 = ShiftList(List=move.Geometry, Shift=1, Wrap=False)
x = ClusterInput()
ln = Line(StartPoint=shift, EndPoint=shift_2)
neg = Negative(Value=x)
division_2 = Division(A=neg, B=6)
A_2 = ClusterInput()
Y_2 = UnitY(Factor=division_2)
division_3 = Division(A=A_2, B=3)
move_2 = Move(Geometry=ln, Motion=Y_2)  # -> Geometry, Transform
Y_3 = UnitY(Factor=division_3)
extr = Extrude(Base=move_2.Geometry, Direction=Y_3)
C = ClusterInput()
mesh = Mesh(extr)
mspray = MeshSpray(Mesh=graft(mesh), Points=Point(0, 0, 0), Colours=graft(C), SprayMode=0)
pshift = ShiftPaths(Data=mspray, Offset=-1)
D = ClusterOutput(pshift)

# ==== cluster SiteDataTextCleanupReplacement
T = ClusterInput()
rep = ReplaceText(Text=T, Find="-1", Replace="-5", RecursiveReplace=False)
rep_2 = ReplaceText(Text=rep, Find="R", Replace="6", RecursiveReplace=False)
rep_3 = ReplaceText(Text=rep_2, Find="B", Replace="-1", RecursiveReplace=False)
rep_4 = ReplaceText(Text=rep_3, Find="P", Replace="-1", RecursiveReplace=False)
rep_5 = ReplaceText(Text=rep_4, Find="G", Replace="-1", RecursiveReplace=False)
R = ClusterOutput(rep_5)

# ==== cluster FullSiteGridMatrixCalculation
C = ClusterInput()
A = ClusterInput()
B = ClusterInput()
C_2 = ClusterInput()
L = ClusterInput()
series = Series(Start=0, Step=1, Count=C)
multiplication = Multiplication(A=A, B=B)
series_2 = Series(Start=0, Step=1, Count=C_2)
repeat = RepeatData(Data=graft(series), Length=L)
pshift = ShiftPaths(Data=repeat, Offset=-1)
repeat_2 = RepeatData(Data=series_2, Length=multiplication)
pshift_2 = ShiftPaths(Data=pshift, Offset=-1)
pshift_3 = ShiftPaths(Data=repeat_2, Offset=-1)
lng = ListLength(List=pshift_3)
repeat_3 = RepeatData(Data="0", Length=lng)
pshift_4 = ShiftPaths(Data=repeat_3, Offset=-1)
x = Integer(pshift_3)
y = Integer(pshift_2)

# ---- group: rotation
z = Integer(pshift_4)

# ----
xi = ClusterInput()
yi = ClusterInput()
x_2 = ClusterInput()
y_2 = ClusterInput()
xs = ClusterInput()
ys = ClusterInput()
panel = Panel(x)
panel_2 = Panel(y)
panel_3 = Panel(z)
replacingitemid = ReplacingItemID(int_4=xi, int=yi, int_6=x_2, int_5=y_2, int_3=xs, int_2=ys)
int = Integer(replacingitemid)
int_2 = ClusterOutput(int)
G = ClusterInput()
num = ClusterInput()
y_3 = ClusterOutput(y)
z_2 = ClusterOutput(z)
x_3 = ClusterOutput(x)
modulecenter = ModuleCenter(pt=G, num=num, int_2=x, int=y)  # -> pt_5, transform_2
num_2 = ClusterInput()

# ---- group: cell size
num_3 = Number(num_2)

# ----
A_2 = ClusterInput()
A_3 = ClusterInput()
multiplication_2 = Multiplication(A=A_2, B=num_3)
multiplication_3 = Multiplication(A=A_3, B=num_3)
neg = Negative(Value=multiplication_2)
vec = VectorXYZ(XComponent=neg, YComponent=multiplication_3, ZComponent=0)  # -> Vector, Length
move = Move(Geometry=modulecenter.pt_5, Motion=vec.Vector)  # -> Geometry, Transform
G_2 = ClusterOutput(move.Geometry)

# ==== cluster FullSiteIDReplacement
int = ClusterInput()
int_2 = ClusterInput()

# ---- group: all module piece ids - from CityMatrix CV
int_3 = Integer(int)

# ---- group: replacing item indices
int_4 = Integer(int_2)

# ----
int_5 = ClusterInput()
# Ignoring masked items (marked as -5 in the full site grid)
# in the replacement array
panel = Panel("-5")

# ---- group: all module piece ids - from Text Data
int_6 = Integer(int_5)

# ----
rev = ReverseList(List=int_6)
item = ListItem(List=rev, Index=int_4, Wrap=True)
equals = Equality(FirstNumber=item, SecondNumber=panel)  # -> Equality, Inequality
panel_2 = Panel(equals.Equality)
int_7 = Integer(flatten(panel_2))
cull = CullPattern(List=int_4, CullPattern=int_7)
cull_2 = CullPattern(List=int_3, CullPattern=int_7)
lng = ListLength(List=cull_2)
repeat = RepeatData(Data="-1", Length=lng)
replace = ReplaceItems(List=rev, Item=repeat, Indices=cull, Wrap=False)
replace_2 = ReplaceItems(List=rev, Item=cull_2, Indices=cull, Wrap=False)
L = ClusterOutput(replace_2)
_1_list = ClusterOutput(replace)

# ==== cluster Roads_2
xe = ClusterInput()
ye = ClusterInput()
x = ClusterInput()
y = ClusterInput()
id = ClusterInput()

# ---- group: road check matrix
python = PythonScript(xe=xe, ye=ye, x=x, y=y, id=id)  # -> out, m; inputs x: list, y: list, id: list; same code as python

# ----
bool = ClusterInput()
X = ClusterInput()
Y = ClusterInput()
road_scaling_picking = RoadScalingPicking(bool=bool, X=X, X_2=X, X_3=X, X_4=X, Y=Y, Y_2=Y, Y_3=Y, Y_4=Y)  # -> mesh_8, pt_8, pt_7, mesh_7

# ---- group: road check list
python_2 = PythonScript(xe=xe, ye=ye, x=x, y=y, id=id, m=python.m)  # -> out, rdType; inputs x: list, y: list, id: list, m: list
# ---------- python_2: Python ----------
"""
CityMatrix

written by "Ryan" Yan Zhang <ryanz@mit.edu>
for MIT Media Lab, Changing Place Group
April.6th.2016
"""

import rhinoscriptsyntax as rs

rdType = []

for n in range(len(id)):
    
    code = []
    
    if id[n]==6:
        
        # 0: check x, y+1
        if y[n]+1>ye-1:
            code.append(0)
        else:
            if m[y[n]+1][x[n]]==6:
                code.append(1)
            elif m[y[n]+1][x[n]]==-2:
                code.append(1)
            else:
                code.append(0)
        
        # 1: check x+1, y
        if x[n]+1>xe-1:
            code.append(0)
        else:
            if (m[y[n]][x[n]+1]==6):
                code.append(1)
            else:
                code.append(0)
        
        # 2: check x, y-1
        if y[n]-1<0:
            code.append(0)
        else:
            if m[y[n]-1][x[n]]==6:
                code.append(1)
            else:
                code.append(0)
        
        # 3: check x-1, y
        if x[n]-1<0:
            code.append(0)
        else:
            if (m[y[n]][x[n]-1]==6):
                code.append(1)
            else:
                code.append(0)
    
    else:
        
        code = [0,0,0,0]
    
    print code
    rdType.append(code)
# ---------- end python_2 ----------

# ----
pt = ClusterInput()
id_2 = ClusterInput()

# ---- group: road check list
python_3 = PythonScript(
    pt=pt,
    id=id_2,
    rdType=python_2.rdType,
    rdQua0=road_scaling_picking.mesh_8,
    c0=road_scaling_picking.pt_8,
    rdQua1=road_scaling_picking.mesh_7,
    c1=road_scaling_picking.pt_7)  # -> out, allRoadMesh; inputs pt: list, id: list, rdType: list, rdQua0: list, rdQua1: list; same code as python_3

# ----
allroadmesh = ClusterOutput(python_3.allRoadMesh)

# ==== cluster Sidewalk_2
xe = ClusterInput()
ye = ClusterInput()
x = ClusterInput()
y = ClusterInput()
id = ClusterInput()

# ---- group: sidewalk check matrix
python = PythonScript(xe=xe, ye=ye, x=x, y=y, id=id)  # -> out, m; inputs x: list, y: list, id: list; same code as python

# ----
bool = ClusterInput()
X = ClusterInput()
Y = ClusterInput()
sidewalk_scaling = SidewalkScaling(bool=bool, X=X, X_2=X, X_3=X, X_4=X, Y=Y, Y_2=Y, Y_3=Y, Y_4=Y)  # -> mesh_8, pt_8, pt_7, mesh_7

# ---- group: sidewalk check list
python_2 = PythonScript(xe=xe, ye=ye, x=x, y=y, id=id, m=python.m)  # -> out, rdType; inputs x: list, y: list, id: list, m: list
# ---------- python_2: Python ----------
"""
CityMatrix

written by "Ryan" Yan Zhang <ryanz@mit.edu>
for MIT Media Lab, Changing Place Group
April.6th.2016
"""

import rhinoscriptsyntax as rs

rdType = []

for n in range(len(id)):
    
    code = []
    
    if id[n]==6:
        
        # 0: check x, y+1
        if y[n]+1>ye-1:
            code.append(0)
        else:
            if m[y[n]+1][x[n]]==6:
                code.append(1)
            else:
                code.append(0)
        
        # 1: check x+1, y
        if x[n]+1>xe-1:
            code.append(0)
        else:
            if m[y[n]][x[n]+1]==6:
                code.append(1)
            else:
                code.append(0)
    
        # 2: check x, y-1
        if y[n]-1<0:
            code.append(0)
        else:
            if m[y[n]-1][x[n]]==6:
                code.append(1)
            else:
                code.append(0)
        
        # 3: check x-1, y
        if x[n]-1<0:
            code.append(0)
        else:
            if m[y[n]][x[n]-1]==6:
                code.append(1)
            else:
                code.append(0)
    
    else:
        
        code = [0,0,0,0]
    
    print code
    rdType.append(code)
# ---------- end python_2 ----------

# ----
pt = ClusterInput()

# ---- group: sidewalk check list
python_3 = PythonScript(
    pt=pt,
    id=id,
    rdType=python_2.rdType,
    rdQua0=sidewalk_scaling.mesh_8,
    c0=sidewalk_scaling.pt_8,
    rdQua1=sidewalk_scaling.mesh_7,
    c1=sidewalk_scaling.pt_7)  # -> out, allRoadMesh; inputs pt: list, id: list, rdType: list, rdQua0: list, rdQua1: list; same code as python_3

# ----
allroadmesh = ClusterOutput(python_3.allRoadMesh)

# ==== cluster CenterLine_2
xe = ClusterInput()
ye = ClusterInput()
x = ClusterInput()
y = ClusterInput()
id = ClusterInput()

# ---- group: road check matrix
python = PythonScript(xe=xe, ye=ye, x=x, y=y, id=id)  # -> out, m; inputs x: list, y: list, id: list; same code as python

# ----
bool = ClusterInput()
X = ClusterInput()
Y = ClusterInput()
road_scaling = RoadScaling(bool=bool, X=X, X_2=X, X_3=X, X_4=X, Y=Y, Y_2=Y, Y_3=Y, Y_4=Y)  # -> mesh_8, pt_8, pt_7, mesh_7

# ---- group: road check list
python_2 = PythonScript(xe=xe, ye=ye, x=x, y=y, id=id, m=python.m)  # -> out, rdType; inputs x: list, y: list, id: list, m: list
# ---------- python_2: Python ----------
"""
CityMatrix

written by "Ryan" Yan Zhang <ryanz@mit.edu>
for MIT Media Lab, Changing Place Group
April.6th.2016
"""

import rhinoscriptsyntax as rs

rdType = []

for n in range(len(id)):
    
    code = []
    
    if id[n]==6:
        
        # 0: check x, y+1
        if y[n]+1>ye-1:
            code.append(0)
        else:
            if m[y[n]+1][x[n]]==6 or m[y[n]+1][x[n]]==-2:
                code.append(1)
            else:
                code.append(0)
        
        # 1: check x+1, y
        if x[n]+1>xe-1:
            code.append(0)
        else:
            if m[y[n]][x[n]+1]==6 or m[y[n]][x[n]+1]==-2:
                code.append(1)
            else:
                code.append(0)
        
        # 2: check x, y-1
        if y[n]-1<0:
            code.append(0)
        else:
            if m[y[n]-1][x[n]]==6 or m[y[n]-1][x[n]]==-2:
                code.append(1)
            else:
                code.append(0)
        
        # 3: check x-1, y
        if x[n]-1<0:
            code.append(0)
        else:
            if m[y[n]][x[n]-1]==6 or m[y[n]][x[n]-1]==-2:
                code.append(1)
            else:
                code.append(0)
    
    else:
        
        code = [0,0,0,0]
    
    print code
    rdType.append(code)
# ---------- end python_2 ----------

# ----
pt = ClusterInput()

# ---- group: road check list
python_3 = PythonScript(
    pt=pt,
    id=id,
    rdType=python_2.rdType,
    rdQua0=road_scaling.mesh_8,
    c0=road_scaling.pt_8,
    rdQua1=road_scaling.mesh_7,
    c1=road_scaling.pt_7)  # -> out, allRoadMesh; inputs pt: list, id: list, rdType: list, rdQua0: list, rdQua1: list; same code as python_3

# ----
allroadmesh = ClusterOutput(python_3.allRoadMesh)

# ==== cluster RndReduceByRatio
L = ClusterInput()
B = ClusterInput()
lng = ListLength(List=L)
S = ClusterInput()
multiplication = Multiplication(A=lng, B=B)
reduce = RandomReduce(List=L, Reduction=multiplication, Seed=S)
L_2 = ClusterOutput(reduce)

# ==== cluster SliderCalcSphere
B = ClusterInput()
P = ClusterInput()
C = ClusterInput()
cp = ClosestPoint(Point=graft(P), Cloud=C)  # -> ClosestPoint, CPIndex, Distance; disabled
dist = Distance(PointA=P, PointB=C)
pshift = ShiftPaths(Data=cp.CPIndex, Offset=-1)  # disabled
smaller = SmallerThan(FirstNumber=dist, SecondNumber=B)  # -> SmallerThan, OrEqualTo

# ---- group: color IDs
int = Integer(smaller.SmallerThan)

# ----
panel = Panel(int)
L = ClusterInput()
dispatch = Dispatch(List=L, DispatchPattern=int)  # -> ListA, ListB
int_2 = ClusterOutput(int)
pdecon = Deconstruct(Point=dispatch.ListA)  # -> XComponent, YComponent, ZComponent
lng = ListLength(List=dispatch.ListA)
ma = MassAddition(Input=pdecon.XComponent)  # -> Result, PartialResults
ma_2 = MassAddition(Input=pdecon.YComponent)  # -> Result, PartialResults
division = Division(A=ma.Result, B=lng)
division_2 = Division(A=ma_2.Result, B=lng)
pt = ConstructPoint(XCoordinate=division, YCoordinate=division_2, ZCoordinate=0)
panel_2 = Panel(pt)
C_2 = ClusterInput()

# ---- group: average slide block pt
pt_2 = Point(pt)

# ----
crv_cp = CurveClosestPoint(Point=pt_2, Curve=C_2)  # -> Point, Parameter, Distance
pshift_2 = ShiftPaths(Data=crv_cp.Parameter, Offset=-1)
D = ClusterOutput(pshift_2)

# ==== cluster GeoBottomCenter
geo = ClusterInput()
geo_2 = Geometry(geo)
bbox = BoundingBox(Content=geo_2, Plane=PlaneXY(0, 0, 0))  # -> Box, Box_2
box_corners = BoxCorners(Box=bbox.Box)  # -> CornerA, CornerB, CornerC, CornerD, CornerE, CornerF, CornerG, CornerH
pdecon = Deconstruct(Point=box_corners.CornerA)  # -> XComponent, YComponent, ZComponent
pdecon_2 = Deconstruct(Point=box_corners.CornerC)  # -> XComponent, YComponent, ZComponent
addition = Addition(A=pdecon.XComponent, B=pdecon_2.XComponent)
addition_2 = Addition(A=pdecon.YComponent, B=pdecon_2.YComponent)
division = Division(A=addition, B=2)
division_2 = Division(A=addition_2, B=2)
pt = ConstructPoint(XCoordinate=division, YCoordinate=division_2, ZCoordinate=pdecon.ZComponent)
pt_2 = Point(pt)
pt_3 = ClusterOutput(pt_2)

# ==== cluster GetPlaneFrom2pts
pt = ClusterInput()
pt_2 = ClusterInput()

# ---- group: current cam tgt pos
pt_3 = Point(pt)

# ---- group: current cam pos
pt_4 = Point(pt_2)

# ----
Z = UnitZ(Factor=100)
move = Move(Geometry=pt_3, Motion=Z)  # -> Geometry, Transform
pl_3pt = Plane3Pt(PointA=pt_3, PointB=pt_4, PointC=move.Geometry)
pt_5 = PointOriented(BasePlane=pl_3pt, UComponent=0, VComponent=0, WComponent=-100)
pt_6 = PointOriented(BasePlane=pl_3pt, UComponent=0, VComponent=100, WComponent=0)
pl_3pt_2 = Plane3Pt(PointA=pt_3, PointB=pt_5, PointC=pt_6)
pln = Plane(pl_3pt_2)
pln_2 = ClusterOutput(pln)

# ==== cluster RoadScaling
X = ClusterInput()
Y = ClusterInput()

# ---- group: private car / center line quator 0s
mesh = Mesh([<mesh referenced from the Rhino model> x4])
pt = Point(<point referenced from the Rhino model>)

# ----
X_2 = ClusterInput()
Y_2 = ClusterInput()

# ---- group: private car / center line quator 1s
mesh_2 = Mesh([<mesh referenced from the Rhino model> x4])
pt_2 = Point(<point referenced from the Rhino model>)

# ---- group: private car
scale_nu = ScaleNU(Geometry=mesh, Plane=pt, ScaleX=X, ScaleY=Y, ScaleZ=1)  # -> Geometry, Transform
scale_nu_2 = ScaleNU(Geometry=mesh_2, Plane=pt_2, ScaleX=X_2, ScaleY=Y_2, ScaleZ=1)  # -> Geometry, Transform

# ----
X_3 = ClusterInput()
Y_3 = ClusterInput()

# ---- group: PEV / center line quator 0s
mesh_3 = Mesh(mesh)
pt_3 = Point(pt)

# ----
X_4 = ClusterInput()
Y_4 = ClusterInput()

# ---- group: PEV / center line quator 1s
mesh_4 = Mesh(mesh_2)
pt_4 = Point(pt_2)

# ---- group: PEV
scale_nu_3 = ScaleNU(Geometry=mesh_3, Plane=pt_3, ScaleX=X_3, ScaleY=Y_3, ScaleZ=1)  # -> Geometry, Transform
scale_nu_4 = ScaleNU(Geometry=mesh_4, Plane=pt_4, ScaleX=X_4, ScaleY=Y_4, ScaleZ=1)  # -> Geometry, Transform

# ----
bool = ClusterInput()

# ---- group: toggle1
bool_2 = Boolean(bool)

# ----
filter = StreamFilter(Gate=bool_2, Stream0=scale_nu.Geometry, Stream1=scale_nu_3.Geometry)
filter_2 = StreamFilter(Gate=bool_2, Stream0=scale_nu_2.Geometry, Stream1=scale_nu_4.Geometry)
mesh_5 = Mesh(filter_2)
mesh_6 = Mesh(filter)
filter_3 = StreamFilter(Gate=bool_2, Stream0=pt, Stream1=pt_3)
filter_4 = StreamFilter(Gate=bool_2, Stream0=pt_2, Stream1=pt_4)
mesh_7 = ClusterOutput(mesh_5)
mesh_8 = ClusterOutput(mesh_6)
pt_5 = Point(filter_4)
pt_6 = Point(filter_3)
pt_7 = ClusterOutput(pt_5)
pt_8 = ClusterOutput(pt_6)

# ==== cluster RoadScalingPicking
X = ClusterInput()
Y = ClusterInput()

# ---- group: private car / road quator 0s
mesh = Mesh([<mesh referenced from the Rhino model> x4])
pt = Point(<point referenced from the Rhino model>)

# ----
X_2 = ClusterInput()
Y_2 = ClusterInput()

# ---- group: private car / road quator 1s
mesh_2 = Mesh([<mesh referenced from the Rhino model> x4])
pt_2 = Point(<point referenced from the Rhino model>)

# ---- group: private car
scale_nu = ScaleNU(Geometry=mesh, Plane=pt, ScaleX=X, ScaleY=Y, ScaleZ=1)  # -> Geometry, Transform
scale_nu_2 = ScaleNU(Geometry=mesh_2, Plane=pt_2, ScaleX=X_2, ScaleY=Y_2, ScaleZ=1)  # -> Geometry, Transform

# ----
X_3 = ClusterInput()
Y_3 = ClusterInput()

# ---- group: PEV / road quator 0s
mesh_3 = Mesh([<mesh referenced from the Rhino model> x4])
pt_3 = Point(<point referenced from the Rhino model>)

# ----
X_4 = ClusterInput()
Y_4 = ClusterInput()

# ---- group: PEV / road quator 1s
mesh_4 = Mesh([<mesh referenced from the Rhino model> x4])
pt_4 = Point(<point referenced from the Rhino model>)

# ---- group: PEV
scale_nu_3 = ScaleNU(Geometry=mesh_3, Plane=pt_3, ScaleX=X_3, ScaleY=Y_3, ScaleZ=1)  # -> Geometry, Transform
scale_nu_4 = ScaleNU(Geometry=mesh_4, Plane=pt_4, ScaleX=X_4, ScaleY=Y_4, ScaleZ=1)  # -> Geometry, Transform

# ----
bool = ClusterInput()

# ---- group: toggle1
bool_2 = Boolean(bool)

# ----
filter = StreamFilter(Gate=bool_2, Stream0=scale_nu.Geometry, Stream1=scale_nu_3.Geometry)
filter_2 = StreamFilter(Gate=bool_2, Stream0=scale_nu_2.Geometry, Stream1=scale_nu_4.Geometry)
mesh_5 = Mesh(filter_2)
mesh_6 = Mesh(filter)
filter_3 = StreamFilter(Gate=bool_2, Stream0=pt, Stream1=pt_3)
filter_4 = StreamFilter(Gate=bool_2, Stream0=pt_2, Stream1=pt_4)
mesh_7 = ClusterOutput(mesh_5)
mesh_8 = ClusterOutput(mesh_6)
pt_5 = Point(filter_4)
pt_6 = Point(filter_3)
pt_7 = ClusterOutput(pt_5)
pt_8 = ClusterOutput(pt_6)

# ==== cluster SidewalkScaling
X = ClusterInput()
Y = ClusterInput()

# ---- group: private car / sidewalk quator 0s
mesh = Mesh([<mesh referenced from the Rhino model> x4])
pt = Point(<point referenced from the Rhino model>)

# ----
X_2 = ClusterInput()
Y_2 = ClusterInput()

# ---- group: private car / sidewalk quator 1s
mesh_2 = Mesh([<mesh referenced from the Rhino model> x4])
pt_2 = Point(<point referenced from the Rhino model>)

# ---- group: private car
scale_nu = ScaleNU(Geometry=mesh, Plane=pt, ScaleX=X, ScaleY=Y, ScaleZ=1)  # -> Geometry, Transform
scale_nu_2 = ScaleNU(Geometry=mesh_2, Plane=pt_2, ScaleX=X_2, ScaleY=Y_2, ScaleZ=1)  # -> Geometry, Transform

# ----
X_3 = ClusterInput()
Y_3 = ClusterInput()

# ---- group: PEV / sidewalk quator 0s
mesh_3 = Mesh([<mesh referenced from the Rhino model> x4])
pt_3 = Point(<point referenced from the Rhino model>)

# ----
X_4 = ClusterInput()
Y_4 = ClusterInput()

# ---- group: PEV / sidewalk quator 1s
mesh_4 = Mesh([<mesh referenced from the Rhino model> x4])
pt_4 = Point(<point referenced from the Rhino model>)

# ---- group: PEV
scale_nu_3 = ScaleNU(Geometry=mesh_3, Plane=pt_3, ScaleX=X_3, ScaleY=Y_3, ScaleZ=1)  # -> Geometry, Transform
scale_nu_4 = ScaleNU(Geometry=mesh_4, Plane=pt_4, ScaleX=X_4, ScaleY=Y_4, ScaleZ=1)  # -> Geometry, Transform

# ----
bool = ClusterInput()

# ---- group: toggle1
bool_2 = Boolean(bool)

# ----
filter = StreamFilter(Gate=bool_2, Stream0=scale_nu.Geometry, Stream1=scale_nu_3.Geometry)
filter_2 = StreamFilter(Gate=bool_2, Stream0=scale_nu_2.Geometry, Stream1=scale_nu_4.Geometry)
mesh_5 = Mesh(filter_2)
mesh_6 = Mesh(filter)
filter_3 = StreamFilter(Gate=bool_2, Stream0=pt, Stream1=pt_3)
filter_4 = StreamFilter(Gate=bool_2, Stream0=pt_2, Stream1=pt_4)
mesh_7 = ClusterOutput(mesh_5)
mesh_8 = ClusterOutput(mesh_6)
pt_5 = Point(filter_4)
pt_6 = Point(filter_3)
pt_7 = ClusterOutput(pt_5)
pt_8 = ClusterOutput(pt_6)

# ==== cluster RelocateToUXDisplay
pt = Point(<point referenced from the Rhino model>)
vec2pt = Vector2Pt(PointA="{0,0,0}", PointB=pt, Unitize=False)  # -> Vector, Length
G = ClusterInput()
move = Move(Geometry=G, Motion=vec2pt.Vector)  # -> Geometry, Transform
rotate = Rotate(Geometry=move.Geometry, Angle=3.141592654, Plane=pt)  # -> Geometry, Transform
G_2 = ClusterOutput(rotate.Geometry)

# ==== cluster TextFormating
txt = ClusterInput()
txt_2 = Text(txt)

# ---- group: 'Enter'
panel = Panel("")

# ----
split = TextSplit(Text=txt_2, Separators=panel)
lng = ListLength(List=split)
addition = Addition(A=lng, B=1)
division = Division(A=addition, B=2)
series = Series(Start=0, Step=2, Count=division)
item = ListItem(List=split, Index=series, Wrap=False)
pshift = ShiftPaths(Data=item, Offset=1)
graft = GraftTree(Tree=pshift, IncludeEmptyLists=True, IncludeNullItems=True)
split_2 = TextSplit(Text=graft, Separators=",")
pshift_2 = ShiftPaths(Data=split_2, Offset=-2)
txt_3 = Text(pshift_2)
txt_4 = ClusterOutput(txt_3)

# ==== cluster ReplacingItemID
int = ClusterInput()
int_2 = ClusterInput()
int_3 = ClusterInput()
int_4 = ClusterInput()
int_5 = ClusterInput()
int_6 = ClusterInput()

# ---- group: gridExtent_y_i
int_7 = Integer(int)

# ---- group: gridExtent_y_s
int_8 = Integer(int_2)

# ---- group: gridExtent_x_s
int_9 = Integer(int_3)

# ---- group: gridExtent_x_i
int_10 = Integer(int_4)

# ---- group: gridExtent_y
int_11 = Integer(int_5)

# ---- group: gridExtent_x
int_12 = Integer(int_6)

# ---- group: adding y
series = Series(Start=0, Step=1, Count=int_7)
int_13 = Integer(series)
graft = GraftTree(Tree=int_13, IncludeEmptyLists=True, IncludeNullItems=True)
repeat = RepeatData(Data=graft, Length=int_10)
pshift = ShiftPaths(Data=repeat, Offset=-2)
addition = Addition(A=int_8, B=pshift)
multiplication = Multiplication(A=addition, B=int_12)

# ---- group: adding x
multiplication_2 = Multiplication(A=int_10, B=int_7)
series_2 = Series(Start=0, Step=1, Count=multiplication_2)
int_14 = Integer(series_2)
mod = Modulus(A=int_14, B=int_10)
addition_2 = Addition(A=int_9, B=mod)

# ----
addition_3 = Addition(A=multiplication, B=addition_2)

# ---- group: item replacing ID
int_15 = Integer(addition_3)

# ----
int_16 = ClusterOutput(int_15)
