# Grasshopper definition 180601_CS_BentoScope_Madrid_st.gh (Grasshopper 1.0.5)
# plug-ins: Human UI, Firefly.X, Human, gHowl, LunchBox

# ---- group: Relative Filepath
vb = VBScript()  # -> out, A
# ---------- vb: VB ----------
    Dim gh_d As GH_Document = owner.OnPingDocument()

    If gh_d.IsFilePathDefined Then
      Print("A path is defined.")
      A = gh_d.FilePath
    Else
      Print("No path defined.")
    End If
# ---------- end vb ----------
panel = Panel(vb.out)
panel_2 = Panel(vb.A)
split = TextSplit(Text=panel_2, Separators="\")
txt = Text(flatten("Data\CamCapture_03_ML.PNG"))
shift = ShiftList(List=split, Shift=-1, Wrap=False)
txt_2 = Text(flatten(shift))
join = TextJoin(Text=flatten([txt_2, txt]), Join="\")
path = FilePath(join)
panel_3 = Panel(path)

# ---- group: manual or CV
list = ValueList({"manual": 0, "CV": 1}, selected="manual")

int = Integer(list)

# ----
# CityMatrix CV
video_stream = WebCamVideoStream()  # disabled
path_2 = FilePath(path)

# ---- group: module meshes lego ref: -1
# Building Type Mesh
mesh = Mesh(<mesh referenced from the Rhino model>)

# ---- group: module meshes lego ref: 0 to 5
mesh_2 = Mesh([<mesh referenced from the Rhino model> x6])

# ---- group: module meshes lego ref: 0 to 5 - with hight test
# -2 means static context
# -1 means empty site
# please manually replace -1
# to building types 0 to 5
# 0 means RL
# 1 means RM
# 2 means RS
# 3 means OL
# 4 means OM
# 5 means OS
mesh_3 = Mesh([<mesh referenced from the Rhino model> x6])

# ---- group: all rotations
panel_4 = Panel("270,270,270,270,270,270,270,270,270,270,270,270,270,270,270,270,270,270,270,270,270,270,270,270,270,270,270,270,270,270,270,270,180,180,180,180,180,180,180,180,180,180,180,180,180,180,180,180,180,180,180,180,180,180,180,180,180,180,180,180,180,180,180,180,90,90,90,90,90,90,90,90,90,90,90,90,90,90,90,90,90,90,90,90,90,90,90,90,90,90,90,90,90,90,90,90,0,0,0,0,0,0,0,0,0,0,0,0,0,0,0,0,0,0,0,0,0,0,0,0,0,0,0,0,0,0,0,0")

# ---- group: all color code quarts (no rotation)
panel_5 = Panel("2,0,0,0\t2,1,0,0\t2,0,1,0\t2,0,0,1\t2,1,1,0\t2,1,0,1\t2,0,1,1\t2,1,1,1\t3,0,0,0\t3,1,0,0\t3,0,1,0\t3,0,0,1\t3,1,1,0\t3,1,0,1\t3,0,1,1\t3,1,1,1\t4,0,0,0\t4,1,0,0\t4,0,1,0\t4,0,0,1\t4,1,1,0\t4,1,0,1\t4,0,1,1\t4,1,1,1\t5,0,0,0\t5,1,0,0\t5,0,1,0\t5,0,0,1\t5,1,1,0\t5,1,0,1\t5,0,1,1\t5,1,1,1")

# ----
# Input Parameters
gridextent_x = Slider(16, range=2..48)
gridextent_y = Slider(16, range=2..48)
toggle1 = BooleanToggle(False)
toggle2 = BooleanToggle(True)
toggle4 = BooleanToggle(False)
dockid = Slider(-1, range=-1..15)
toggle3 = BooleanToggle(False)

_0_reslux = Slider(5, range=1..25)
_1_resmed = Slider(4, range=1..25)
_2_resmu = Slider(2, range=1..25)
_3_comhq = Slider(3, range=1..25)
_4_commed = Slider(6, range=1..25)
_5_rescw = Slider(11, range=1..25)

slider1 = Slider(0.3, range=0..1)
load_bitmap = LoadBitmap(FilePathToImageLocation=path_2)

# ---- group: Int Grid X Extent
number_slider = Slider(16, range=1..20)

# ---- group: Int Grid Y Extent
number_slider_2 = Slider(16, range=1..20)

# ---- group: Pts Sample Grid Corner
pt = Point([<point referenced from the Rhino model> x4])

# ---- group: dock position ref pts
# Dock Sampling
pt_2 = Point([<point referenced from the Rhino model> x4])

# ---- group: color ids
# Reference Color
panel_6 = Panel("0")
int_2 = Integer(panel_6)
int_3 = Integer("1")
int_4 = Integer("2")
panel_7 = Panel("3")  # disabled
int_5 = Integer(panel_7)  # disabled
panel_8 = Panel("4")  # disabled
int_6 = Integer(panel_8)  # disabled
panel_9 = Panel("5")  # disabled
# Grid Sampling
int_7 = Integer(panel_9)  # disabled

# ----
pline = PolyLine(Vertices=pt, Closed=False)

# ---- group: Sample Toggle
pt_3 = Point(<point referenced from the Rhino model>)

# ---- group: Sample Other
pt_4 = Point(<point referenced from the Rhino model>)

# ---- group: ref color pop area
crv = Curve([<curve referenced from the Rhino model> x3])

# ---- group: slider position ref pts
# Slider Sampling
pt_5 = Point([<point referenced from the Rhino model> x2])

# ---- group: toggle 2 position ref pt
pt_6 = Point(<point referenced from the Rhino model>)

# ---- group: toggle 4 position ref pt
pt_7 = Point(<point referenced from the Rhino model>)

# ---- group: toggle 1 position ref pt
pt_8 = Point(<point referenced from the Rhino model>)

# ---- group: toggle 3 position ref pt
pt_9 = Point(<point referenced from the Rhino model>)

# ---- group: mesh coloring
mesh_4 = Mesh(<mesh referenced from the Rhino model>)
res_color = ColourSwatch(SwatchColor=RGB(251, 255, 122))
res_gray = ColourSwatch(SwatchColor=RGB(227, 227, 227))
sidewalk = ColourSwatch(SwatchColor=RGB(107, 107, 107))
bikelane = ColourSwatch(SwatchColor=RGB(86, 135, 87))
off_gray = ColourSwatch(SwatchColor=RGB(171, 171, 171))
offcolor = ColourSwatch(SwatchColor=RGB(255, 122, 122))
parking = ColourSwatch(SwatchColor=RGB(196, 156, 100))
blank = ColourSwatch(SwatchColor=RGB(110, 110, 110))
road = ColourSwatch(SwatchColor=RGB(64, 64, 64))
park = ColourSwatch(SwatchColor=RGB(165, 201, 44))
text = ColourSwatch(SwatchColor=RGB(0, 0, 0))
res_warm = ColourSwatch(SwatchColor=RGB(255, 251, 230))
text_new = ColourSwatch(SwatchColor=RGB(64, 64, 64))
off_cold = ColourSwatch(SwatchColor=RGB(230, 242, 255))
mcol = MeshColours(Mesh=mesh_4, Colours=off_cold)
mesh_5 = Mesh(mcol)

# ---- group: all color code quarts (with rotation)
# Decode Piece ID
panel_10 = Panel("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")

# ----
split_2 = TextSplit(Text=panel_4, Separators=",")
preview = CustomPreview(Geometry=pline, Shader=ColourSwatch(SwatchColor=RGB(255, 0, 230)))
mjoin = MeshJoin(Meshes=crv)
pdecon = Deconstruct(Point=pt_3)  # -> XComponent, YComponent, ZComponent
pdecon_2 = Deconstruct(Point=pt_4)  # -> XComponent, YComponent, ZComponent
merge = Merge(Data1=int_2, Data2=int_3, Data3=int_4, Data4=int_5, Data5=int_6, Data6=int_7)
multiplication = Multiplication(A=number_slider_2, B=2)
multiplication_2 = Multiplication(A=number_slider, B=2)
merge_2 = Merge(Data1=_0_reslux, Data2=_1_resmed, Data3=_2_resmu, Data4=_3_comhq, Data5=_4_commed, Data6=_5_rescw)
frgb = ColourRGBF(Alpha=1, Red=pdecon.XComponent, Green=pdecon.YComponent, Blue=pdecon.ZComponent)
frgb_2 = ColourRGBF(Alpha=1, Red=pdecon_2.XComponent, Green=pdecon_2.YComponent, Blue=pdecon_2.ZComponent)
popgeo = PopulateGeometry(Geometry=mjoin, Count=Slider(500, range=0..1000), Seed=1)

# ---- group: All Colors IDs
int_8 = Integer(merge)

# ---- group: all rotations reference
txt_3 = Text(split_2)

# ---- group: webcam stream
data = Data(load_bitmap)

bmp = BitmapToModify(data)

bmp_2 = BitmapToModify(data)

# Toggles
bmp_3 = BitmapToModify(data)

# ----
sample = BitmapSampler(BitmapToModify=bmp_3, PointToSample=pt_7, BitmapToModify_2=bmp_3, PointToSample_2=pt_7, bitmap_filter=0)  # -> SampledImageData, SampledImageData_2
sample_2 = BitmapSampler(BitmapToModify=bmp_3, PointToSample=pt_6, BitmapToModify_2=bmp_3, PointToSample_2=pt_6, bitmap_filter=0)  # -> SampledImageData, SampledImageData_2
sample_3 = BitmapSampler(BitmapToModify=bmp_3, PointToSample=pt_9, BitmapToModify_2=bmp_3, PointToSample_2=pt_9, bitmap_filter=0)  # -> SampledImageData, SampledImageData_2
sample_4 = BitmapSampler(BitmapToModify=bmp_3, PointToSample=pt_8, BitmapToModify_2=bmp_3, PointToSample_2=pt_8, bitmap_filter=0)  # -> SampledImageData, SampledImageData_2
sample_5 = BitmapSampler(BitmapToModify=bmp, PointToSample=pt_2, BitmapToModify_2=bmp, PointToSample_2=pt_2, bitmap_filter=0)  # -> SampledImageData, SampledImageData_2
col = Colour(sample.SampledImageData_2)
col_2 = Colour(sample_2.SampledImageData_2)
col_3 = Colour(sample_3.SampledImageData_2)
merge_3 = Merge(Data1=frgb, Data2=frgb_2)
col_4 = Colour(sample_4.SampledImageData_2)
col_5 = Colour(sample_5.SampledImageData_2)
pline_2 = PolyLine(Vertices=pt_5, Closed=False)  # -> reparameterize(Polyline)
sample_6 = BitmapSampler(BitmapToModify=bmp_2, PointToSample=popgeo, BitmapToModify_2=bmp_2, PointToSample_2=popgeo, bitmap_filter=0)  # -> SampledImageData, SampledImageData_2
panel_11 = Panel(txt_3)

# ---- group: tab
panel_12 = Panel("\t")

# ----
split_3 = TextSplit(Text=panel_10, Separators=panel_12)

# ---- group: manual text city
panel_13 = Panel("""b,r,b,b,b,b,r,b,b,b,b,r,b,b,b,b
r,r,r,r,r,r,r,r,r,r,r,r,r,r,r,r
b,r,b,b,b,b,r,b,b,b,b,r,b,b,b,b
b,r,b,g,g,b,r,b,g,g,b,r,b,g,g,b
b,r,b,g,g,b,r,b,g,g,b,r,b,g,g,b
b,r,b,b,b,b,r,b,b,b,b,r,b,b,b,b
r,r,r,r,r,r,r,r,r,r,r,r,r,r,r,r
b,r,b,b,b,b,r,4,4,4,4,r,3,3,3,3
b,r,b,g,g,b,r,4,g,g,4,r,3,g,g,3
b,r,b,g,g,b,r,4,g,g,4,r,3,g,g,3
b,r,b,b,b,b,r,4,4,4,4,r,3,3,3,3
r,r,r,r,r,r,r,r,r,r,r,r,r,r,r,r
b,r,2,2,2,2,r,1,1,1,1,r,0,0,0,0
b,r,2,g,g,2,r,1,g,g,1,r,0,g,g,0
b,r,2,g,g,2,r,1,g,g,1,r,0,g,g,0
b,r,2,2,2,2,r,1,1,1,1,r,0,0,0,0""")

# ---- group: slider1
num = Number(slider1)

# ---- group: gridExtent_y
int_9 = Integer(gridextent_y)

# ---- group: toggle1
bool = Boolean(toggle1)

# ---- group: toggle2
bool_2 = Boolean(toggle2)

# ---- group: toggle3
bool_3 = Boolean(toggle3)

# ---- group: toggle4
bool_4 = Boolean(toggle4)

# ---- group: dockID
int_10 = Integer(dockid)

# ---- group: floor num for each type
int_11 = Integer(merge_2)

# ---- group: gridExtent_x
int_12 = Integer(gridextent_x)

# ----
divide = DivideCurve(Curve=pline_2, Count=Slider(9, range=9..99), Kinks=False)  # -> Points, Tangents, Parameters
perspective = Perspective(pt=pt, int_2=multiplication_2, int=multiplication)

# ---- group: All Manual Reference Colors
col_6 = Colour(merge_3)

# ---- group: ref sample colors
col_7 = Colour(sample_6.SampledImageData_2)

# ----
preview_2 = CustomPreview(Geometry=pline_2, Shader=ColourSwatch(SwatchColor=RGB(255, 0, 230)))

# ---- group: manual calibration / Sample White
pt_10 = Point(<point referenced from the Rhino model>)

# ---- group: manual calibration / Sample Black
pt_11 = Point(<point referenced from the Rhino model>)

# ---- group: manual calibration / Sample Red
pt_12 = Point(<point referenced from the Rhino model>)

# ---- group: manual calibration / Sample Yellow
pt_13 = Point(<point referenced from the Rhino model>)  # disabled

# ---- group: manual calibration / Sample Blue
pt_14 = Point(<point referenced from the Rhino model>)  # disabled

# ---- group: manual calibration / Sample Green
pt_15 = Point(<point referenced from the Rhino model>)  # disabled

# ---- group: all color quarts reference
txt_4 = Text(split_3)

# ----
lng = ListLength(List=txt_4)
pdecon_3 = Deconstruct(Point=pt_10)  # -> XComponent, YComponent, ZComponent
pdecon_4 = Deconstruct(Point=pt_11)  # -> XComponent, YComponent, ZComponent
pdecon_5 = Deconstruct(Point=pt_12)  # -> XComponent, YComponent, ZComponent
pdecon_6 = Deconstruct(Point=pt_13)  # -> XComponent, YComponent, ZComponent
pdecon_7 = Deconstruct(Point=pt_14)  # -> XComponent, YComponent, ZComponent
pdecon_8 = Deconstruct(Point=pt_15)  # -> XComponent, YComponent, ZComponent

# ---- group: x
series = Series(Start=0, Step=1, Count=number_slider)

# ---- group: y
series_2 = Series(Start=0, Step=1, Count=number_slider_2)

# ---- group: slider and toggle ref colors
col_8 = Colour(col_6)

# ----
cp = ClosestPoint(Point=graft(col), Cloud=col_8)  # -> ClosestPoint, CPIndex, Distance
cp_2 = ClosestPoint(Point=graft(col_2), Cloud=col_8)  # -> ClosestPoint, CPIndex, Distance
cp_3 = ClosestPoint(Point=graft(col_3), Cloud=col_8)  # -> ClosestPoint, CPIndex, Distance
cp_4 = ClosestPoint(Point=graft(col_4), Cloud=col_8)  # -> ClosestPoint, CPIndex, Distance
pshift = ShiftPaths(Data=cp.CPIndex, Offset=-1)
pshift_2 = ShiftPaths(Data=cp_2.CPIndex, Offset=-1)
pshift_3 = ShiftPaths(Data=cp_3.CPIndex, Offset=-1)
pshift_4 = ShiftPaths(Data=cp_4.CPIndex, Offset=-1)

# ---- group: webcam stream
bmp_4 = BitmapToModify(data)

# ----
division = Division(A=lng, B="4")

# ---- group: slider sample pts
pt_16 = Point(divide.Points)

# ----
line = LineSDL(Start=pt_16, Direction=Vector(1, 0, 0), Length=0.005)
frgb_3 = ColourRGBF(Alpha=1, Red=pdecon_3.XComponent, Green=pdecon_3.YComponent, Blue=pdecon_3.ZComponent)
frgb_4 = ColourRGBF(Alpha=1, Red=pdecon_4.XComponent, Green=pdecon_4.YComponent, Blue=pdecon_4.ZComponent)
frgb_5 = ColourRGBF(Alpha=1, Red=pdecon_5.XComponent, Green=pdecon_5.YComponent, Blue=pdecon_5.ZComponent)
frgb_6 = ColourRGBF(Alpha=1, Red=pdecon_6.XComponent, Green=pdecon_6.YComponent, Blue=pdecon_6.ZComponent)
frgb_7 = ColourRGBF(Alpha=1, Red=pdecon_7.XComponent, Green=pdecon_7.YComponent, Blue=pdecon_7.ZComponent)
frgb_8 = ColourRGBF(Alpha=1, Red=pdecon_8.XComponent, Green=pdecon_8.YComponent, Blue=pdecon_8.ZComponent)

# ---- group: to calebrate - select all and ctl+E / CityMatrix CV Calibration
mesh_6 = MeshFromImage(Bmp=data, Sx=Domain(0, 1), Sy=Domain(0, 1), Z=0, C=True)  # disabled

# ---- group: color ID
int_13 = Integer(pshift)

int_14 = Integer(pshift_2)

int_15 = Integer(pshift_3)

int_16 = Integer(pshift_4)

# ----
panel_14 = Panel(txt_4)
multiplication_3 = Multiplication(A=series_2, B=4)
series_3 = Series(Start=0, Step=1, Count=division)
sample_7 = BitmapSampler(BitmapToModify=bmp_2, PointToSample=pt_16, BitmapToModify_2=bmp_2, PointToSample_2=pt_16, bitmap_filter=0)  # -> SampledImageData, SampledImageData_2
multiplication_4 = Multiplication(A=series, B=2)
equals = Equality(FirstNumber=int_13, SecondNumber="0")  # -> Equality, Inequality

# ---- group: to calebrate - select all and ctl+E
move = Move(Geometry=mesh_6, Motion=Vector(0, 0, -0.1))  # -> Geometry, Transform; disabled

# ----
equals_2 = Equality(FirstNumber=int_14, SecondNumber="0")  # -> Equality, Inequality
equals_3 = Equality(FirstNumber=int_15, SecondNumber="0")  # -> Equality, Inequality
equals_4 = Equality(FirstNumber=int_16, SecondNumber="0")  # -> Equality, Inequality
merge_4 = Merge(Data1=frgb_3, Data2=frgb_4, Data3=frgb_5, Data4=frgb_6, Data5=frgb_7, Data6=frgb_8)

# ---- group: keystoned grid pts
pt_17 = Point(perspective)

# ----
multiplication_5 = Multiplication(A=division, B="4")
pshift_5 = ShiftPaths(Data=series_3, Offset=-1)
pshift_6 = ShiftPaths(Data=sample_7.SampledImageData_2, Offset=-1)
multiplication_6 = Multiplication(A=multiplication_3, B=number_slider)

# ---- group: to calebrate - select all and ctl+E / moved down 0.1
mesh_7 = Mesh(move.Geometry)  # disabled

# ----
pshift_7 = ShiftPaths(Data=pt_17, Offset=-1)

# ---- group: all sample pts
pt_18 = Point(pshift_7)

# ----
sample_8 = BitmapSampler(BitmapToModify=bmp_4, PointToSample=pt_18, BitmapToModify_2=bmp_4, PointToSample_2=pt_18, bitmap_filter=0)  # -> SampledImageData, SampledImageData_2

# ---- group: toggle 4 value
bool_5 = Boolean(equals.Equality)

# ---- group: toggle 2 value
bool_6 = Boolean(equals_2.Equality)

# ---- group: toggle 3 value
bool_7 = Boolean(equals_3.Equality)

# ---- group: All Manual Reference Colors
col_9 = Colour(merge_4)

# ---- group: toggle 1 value
bool_8 = Boolean(equals_4.Equality)

# ----
repeat = RepeatData(Data=pshift_5, Length=multiplication_5)

# ---- group: sampled pts color
col_10 = Colour(pshift_6)

# ----
# Decode Slider Value
cp_5 = ClosestPoint(Point=graft(col_10), Cloud=col_8)  # -> ClosestPoint, CPIndex, Distance
pshift_8 = ShiftPaths(Data=cp_5.CPIndex, Offset=-1)

# ---- group: color IDs
int_17 = Integer(pshift_8)

# ----
dispatch = Dispatch(List=pt_16, DispatchPattern=int_17)  # -> ListA, ListB
pdecon_9 = Deconstruct(Point=dispatch.ListB)  # -> XComponent, YComponent, ZComponent
lng_2 = ListLength(List=dispatch.ListB)
ma = MassAddition(Input=pdecon_9.XComponent)  # -> Result, PartialResults
ma_2 = MassAddition(Input=pdecon_9.YComponent)  # -> Result, PartialResults
division_2 = Division(A=ma.Result, B=lng_2)
division_3 = Division(A=ma_2.Result, B=lng_2)
pt_19 = ConstructPoint(XCoordinate=division_2, YCoordinate=division_3, ZCoordinate=0)

# ---- group: average slide block pt
pt_20 = Point(pt_19)

# ----
crv_cp = CurveClosestPoint(Point=pt_20, Curve=pline_2)  # -> Point, Parameter, Distance
addition = Addition(A=multiplication_4, B=graft(multiplication_6))

# ---- group: module id data (manual)
txt_5 = Text(panel_13)

# ---- group: all ref colors
col_11 = Colour(col_9)

# ----
# Decode Dock ID
cp_6 = ClosestPoint(Point=col_5, Cloud=col_11)  # -> ClosestPoint, CPIndex, Distance
item = ListItem(List=int_8, Index=cp_6.CPIndex, Wrap=False)

# ---- group: color code of each smaple pt
int_18 = Integer(item)

# ----
rev = ReverseList(List=int_18)
txt_6 = Text(rev)
join_2 = TextJoin(Text=txt_6, Join=",")

# ---- group: color code quart text data
txt_7 = Text(join_2)

# ----
panel_15 = Panel(txt_7)

# ---- group: all sample color
col_12 = Colour(sample_8.SampledImageData_2)

# ----
pshift_9 = ShiftPaths(Data=crv_cp.Parameter, Offset=-1)
pshift_10 = ShiftPaths(Data=repeat, Offset=-1)

# ---- group: all color quart ids reference
int_19 = Integer(pshift_10)

# ----
rep = ReplaceText(Text=txt_5, Find="r", Replace="6", RecursiveReplace=False)
rep_2 = ReplaceText(Text=rep, Find="g", Replace="-1", RecursiveReplace=False)
rep_3 = ReplaceText(Text=rep_2, Find="b", Replace="5", RecursiveReplace=False)
panel_16 = Panel(rep_3)
pshift_11 = ShiftPaths(Data=addition, Offset=-1)
# Building Heights
panel_17 = Panel("0")
multiplication_7 = Multiplication(A=number_slider, B=2)
keysearch = KeyValueSearch(Keys=txt_4, Values=panel_11, Search=graft(txt_7))
keysearch_2 = KeyValueSearch(Keys=txt_4, Values=int_19, Search=graft(txt_7))
panel_18 = Panel(int_19)
item_2 = ListItem(List=col_8, Index=int_17, Wrap=True)

# ---- group: slider read 0-1
num_2 = Number(pshift_9)

# ----
panel_19 = Panel(num_2)
addition_2 = Addition(A=pshift_11, B=multiplication_7)

# ---- group: module id data
txt_8 = Text(rep_3)

# ----
addition_3 = Addition(A=pshift_11, B=1)
preview_3 = CustomPreview(Geometry=pt_16, Shader=item_2)
nullrep = ReplaceNulls(Items=keysearch, Replacements="0")  # -> Items, Count
nullrep_2 = ReplaceNulls(Items=keysearch_2, Replacements="-1")  # -> Items, Count
split_4 = TextSplit(Text=txt_8)
addition_4 = Addition(A=addition_2, B=1)
pshift_12 = ShiftPaths(Data=nullrep_2.Items, Offset=-1)

# ---- group: slider1
num_3 = Number(num_2)

num_4 = Number(num_3)

# ----
# Closest Color Code
cp_7 = ClosestPoint(Point=col_12, Cloud=col_11)  # -> ClosestPoint, CPIndex, Distance
item_3 = ListItem(List=col_11, Index=cp_7.CPIndex, Wrap=False)
pshift_13 = ShiftPaths(Data=nullrep.Items, Offset=-1)
cull = CullPattern(List=split_4, CullPattern=[True, False])
join_3 = TextJoin(Text=cull, Join=",")
split_5 = TextSplit(Text=join_3, Separators=",")

# ---- group: reference color calebration - select all and ctrl E / all sample color
col_13 = Colour(sample_8.SampledImageData_2)  # disabled

# ---- group: reference color calebration - select all and ctrl E / all ref colors
col_14 = Colour(col_11)  # disabled

# ----
item_4 = ListItem(List=int_8, Index=cp_7.CPIndex, Wrap=False)
pshift_14 = ShiftPaths(Data=split_5, Offset=-2)

# ---- group: dock id
int_20 = Integer(pshift_12)

# ---- group: dock rotation
int_21 = Integer(pshift_13)

# ---- group: module id (manual)
# Grid Base Data
int_22 = Integer(pshift_14)

# ----
panel_20 = Panel(int_22)

# ---- group: color code of each smaple pt
int_23 = Integer(item_4)

# ---- group: all sample color
col_15 = Colour(col_7)  # disabled

# ---- group: all ref colors
col_16 = Colour(col_8)  # disabled

# ---- group: sample pts
item_5 = ListItem(List=pt_18, Index=addition_2, Wrap=False)
item_6 = ListItem(List=pt_18, Index=pshift_11, Wrap=False)
item_7 = ListItem(List=pt_18, Index=addition_4, Wrap=False)
item_8 = ListItem(List=pt_18, Index=addition_3, Wrap=False)

# ----
addition_5 = Addition(A=item_6, B=item_7)
repeat_2 = RepeatData(Data=Slider(0, range=0..360), Length=256)
division_4 = Division(A=addition_5, B=2)

# ---- group: quart mid pts
pt_21 = Point(division_4)

# ---- group: all 0
pshift_15 = ShiftPaths(Data=repeat_2, Offset=-1)

# ----
# CityMatrix
# 
# "Ryan" Yan Zhang <ryanz@mit.edu>
# MIT Media Lab, Changing Place Group
# September. 2016
panel_21 = Panel("""1
1
1
1
1
1""")
panel_22 = Panel("""15
15
15
15
15
15""")
panel_23 = Panel("""30
30
30
30
30
30""")

# ---- group: module id
int_24 = Integer(int_22)

# ---- group: x
int_25 = Integer([0, 1, 2, 3, 4, 5, 6, 7, 8, 9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])

# ---- group: y
int_26 = Integer([0, 0, 0, 0, 0, 0, 0, 0, 0, 0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])

# ---- group: rotation
int_27 = Integer(pshift_15)

# ----
panel_24 = Panel(int_25)
panel_25 = Panel(int_24)
panel_26 = Panel(int_26)
panel_27 = Panel(int_27)

# ---- group: color codes
item_9 = ListItem(List=int_23, Index=pshift_11, Wrap=False)
item_10 = ListItem(List=int_23, Index=addition_2, Wrap=False)
item_11 = ListItem(List=int_23, Index=addition_4, Wrap=False)
item_12 = ListItem(List=int_23, Index=addition_3, Wrap=False)

# ---- group: floor height
panel_28 = Panel("3.5")

# ----
merge_5 = Merge(Data1=graft(item_9), Data2=graft(item_10), Data3=graft(item_11), Data4=graft(item_12))

# ---- group: color code quarts
int_28 = Integer(merge_5)

# ----
rev_2 = ReverseList(List=int_28)
txt_9 = Text(rev_2)
join_4 = TextJoin(Text=txt_9, Join=",")
pshift_16 = ShiftPaths(Data=join_4, Offset=-1)

# ---- group: color code quart texts data
txt_10 = Text(pshift_16)

# ----
panel_29 = Panel(txt_10)
keysearch_3 = KeyValueSearch(Keys=txt_4, Values=panel_11, Search=graft(txt_10))
nullrep_3 = ReplaceNulls(Items=keysearch_3, Replacements="0")  # -> Items, Count
keysearch_4 = KeyValueSearch(Keys=txt_4, Values=int_19, Search=graft(txt_10))
pshift_17 = ShiftPaths(Data=nullrep_3.Items, Offset=-1)
nullrep_4 = ReplaceNulls(Items=keysearch_4, Replacements="-1")  # -> Items, Count
pshift_18 = ShiftPaths(Data=pshift_17, Offset=-1)
pshift_19 = ShiftPaths(Data=nullrep_4.Items, Offset=-1)

# ---- group: all rotation data
int_29 = Integer(pshift_18)

# ----
pshift_20 = ShiftPaths(Data=pshift_19, Offset=-1)

# ---- group: all piece ids
int_30 = Integer(pshift_20)

# ----
tag = TextTag3D(Location=pt_21, Text=int_30, Size=0.01, Justification=5)
panel_30 = Panel(int_30)

# ---- group: rotation
int_31 = Integer(int_29)

# ---- group: module id
int_32 = Integer(int_30)

# ---- group: dockID CV
int_33 = Integer(int_20)

# ---- group: dockID manual
int_34 = Integer(int_10)

# ---- group: slider1 CV
num_5 = Number(num_3)

# ---- group: slider1 manual
num_6 = Number(num)

# ---- group: manual or CV
int_35 = Integer(int)

# ----
filter = StreamFilter(Gate=int_35, Stream0=num_6, Stream1=num_5)
filter_2 = StreamFilter(Gate=int_35, Stream0=int_34, Stream1=int_33)

# ---- group: gridExtent_x
int_36 = Integer(int_12)

# ---- group: gridExtent_y
int_37 = Integer(int_9)

# ---- group: x
int_38 = Integer(int_25)

# ---- group: y
int_39 = Integer(int_26)

# ---- group: rotation
int_40 = Integer(int_27)

# ---- group: dockID
int_41 = Integer(filter_2)

int_42 = Integer(int_41)

# ----
equals_5 = Equality(FirstNumber=int_42, SecondNumber="5")  # -> Equality, Inequality
equals_6 = Equality(FirstNumber=int_42, SecondNumber="2")  # -> Equality, Inequality
equals_7 = Equality(FirstNumber=int_42, SecondNumber="3")  # -> Equality, Inequality
equals_8 = Equality(FirstNumber=int_42, SecondNumber="4")  # -> Equality, Inequality
equals_9 = Equality(FirstNumber=int_42, SecondNumber=panel_17)  # -> Equality, Inequality
equals_10 = Equality(FirstNumber=int_42, SecondNumber="1")  # -> Equality, Inequality
filter_3 = StreamFilter(Gate=equals_5.Equality, Stream1=num_4)
filter_4 = StreamFilter(Gate=equals_6.Equality, Stream1=num_4)
filter_5 = StreamFilter(Gate=equals_7.Equality, Stream1=num_4)
filter_6 = StreamFilter(Gate=equals_8.Equality, Stream1=num_4)
filter_7 = StreamFilter(Gate=equals_9.Equality, Stream1=num_4)
filter_8 = StreamFilter(Gate=equals_10.Equality, Stream1=num_4)
rec = DataRecorder(filter_4, DataLimit=1, RecordData=True)
panel_31 = Panel(rec)
rec_2 = DataRecorder(filter_3, DataLimit=1, RecordData=True)
panel_32 = Panel(rec_2)
rec_3 = DataRecorder(filter_7, DataLimit=1, RecordData=True)
panel_33 = Panel(rec_3)
rec_4 = DataRecorder(filter_8, DataLimit=1, RecordData=True)
panel_34 = Panel(rec_4)
rec_5 = DataRecorder(filter_5, DataLimit=1, RecordData=True)
panel_35 = Panel(rec_5)
rec_6 = DataRecorder(filter_6, DataLimit=1, RecordData=True)
panel_36 = Panel(rec_6)
null = NullItem(Item=rec_2)  # -> NullFlags, InvalidFlags, Description
null_2 = NullItem(Item=rec)  # -> NullFlags, InvalidFlags, Description
null_3 = NullItem(Item=rec_5)  # -> NullFlags, InvalidFlags, Description
null_4 = NullItem(Item=rec_6)  # -> NullFlags, InvalidFlags, Description
null_5 = NullItem(Item=rec_3)  # -> NullFlags, InvalidFlags, Description
null_6 = NullItem(Item=rec_4)  # -> NullFlags, InvalidFlags, Description
filter_9 = StreamFilter(Gate=null.NullFlags, Stream0=rec_2, Stream1="0")
filter_10 = StreamFilter(Gate=null_2.NullFlags, Stream0=rec, Stream1="0")
filter_11 = StreamFilter(Gate=null_3.NullFlags, Stream0=rec_5, Stream1="0")
filter_12 = StreamFilter(Gate=null_4.NullFlags, Stream0=rec_6, Stream1="0")
filter_13 = StreamFilter(Gate=null_5.NullFlags, Stream0=rec_3, Stream1="0")
filter_14 = StreamFilter(Gate=null_6.NullFlags, Stream0=rec_4, Stream1="0")
merge_6 = Merge(Data1=filter_13, Data2=filter_14, Data3=filter_10, Data4=filter_11, Data5=filter_12, Data6=filter_9)
remap = RemapNumbers(Value=merge_6, Source=Domain(0, 1), Target="1 to 30")  # -> Mapped, Clipped

# ---- group: floor num for each type
int_43 = Integer(remap.Mapped)

# ----
panel_37 = Panel(int_43)

multiplication_8 = Multiplication(A=int_43, B=panel_28)

# ---- group: building height for each type
num_7 = Number(multiplication_8)

# ---- group: all fl #s
txt_11 = Text(int_43)

# ---- group: toggle1
bool_9 = Boolean(bool_8)

# ---- group: toggle2
bool_10 = Boolean(bool_2)

# ---- group: toggle3
bool_11 = Boolean(bool_3)

# ---- group: toggle4
bool_12 = Boolean(bool_4)

# ---- group: floor num for each type
int_44 = Integer(int_43)

# ---- group: module id
int_45 = Integer(int_24)

# ---- group: slider1
num_8 = Number(filter)

# ---- group: dock rotation
int_46 = Integer(int_21)

# ---- group: module id
int_47 = Integer(int_45)

# ---- group: floor num for each type
int_48 = Integer(int_44)

# ----
number_slider_3 = Slider(17, range=0..100)  # disabled
# mid
number_slider_4 = Slider(55, range=0..100)  # disabled
number_slider_5 = Slider(51, range=0..100)  # disabled
number_slider_6 = Slider(46, range=0..100)  # disabled
# old
number_slider_7 = Slider(23, range=0..100)  # disabled
number_slider_8 = Slider(69, range=0..100)  # disabled
equals_11 = Equality(FirstNumber=int_47, SecondNumber="0")  # -> Equality, Inequality
equals_12 = Equality(FirstNumber=int_47, SecondNumber="1")  # -> Equality, Inequality
equals_13 = Equality(FirstNumber=int_47, SecondNumber="3")  # -> Equality, Inequality
equals_14 = Equality(FirstNumber=int_47, SecondNumber="2")  # -> Equality, Inequality
# Dashboard
number_slider_9 = Slider(0.25, range=0..1)
equals_15 = Equality(FirstNumber=int_47, SecondNumber="4")  # -> Equality, Inequality
equals_16 = Equality(FirstNumber=int_47, SecondNumber="5")  # -> Equality, Inequality
# young
number_slider_10 = Slider(200, range=0..500)  # disabled
number_slider_11 = Slider(120, range=0..500)  # disabled
number_slider_12 = Slider(75, range=0..500)  # disabled
item_13 = ListItem(List=int_48, Index="0", Wrap=False)
item_14 = ListItem(List=int_48, Index="2", Wrap=False)
item_15 = ListItem(List=int_48, Index="1", Wrap=False)
item_16 = ListItem(List=int_48, Index="3", Wrap=False)
item_17 = ListItem(List=int_48, Index="4", Wrap=False)
item_18 = ListItem(List=int_48, Index="5", Wrap=False)
int_49 = Integer(equals_11.Equality)
int_50 = Integer(equals_12.Equality)
int_51 = Integer(equals_13.Equality)
int_52 = Integer(equals_14.Equality)
int_53 = Integer(equals_15.Equality)
int_54 = Integer(equals_16.Equality)
ma_3 = MassAddition(Input=int_49)  # -> Result, PartialResults
ma_4 = MassAddition(Input=int_50)  # -> Result, PartialResults
ma_5 = MassAddition(Input=int_51)  # -> Result, PartialResults

# ---- group: building id 0 fl #
int_55 = Integer(item_13)

# ---- group: building id 2 fl #
int_56 = Integer(item_14)

# ----
ma_6 = MassAddition(Input=int_52)  # -> Result, PartialResults

# ---- group: building id 1 fl #
int_57 = Integer(item_15)

# ---- group: building id 3 fl #
int_58 = Integer(item_16)

# ----
ma_7 = MassAddition(Input=int_53)  # -> Result, PartialResults
ma_8 = MassAddition(Input=int_54)  # -> Result, PartialResults

# ---- group: building id 4 fl #
int_59 = Integer(item_17)

# ---- group: building id 5 fl #
int_60 = Integer(item_18)

# ----
pt_22 = ConstructPoint(XCoordinate=Slider(0, range=0..10), YCoordinate=Slider(0, range=-30..0), ZCoordinate=Slider(5.1, range=0..10))

# ---- group: range
B = DomainEnd(number_slider_10)  # disabled

# ----
int_61 = Integer(ma_3.Result)
panel_38 = Panel(int_61)
int_62 = Integer(ma_4.Result)
panel_39 = Panel(int_62)
int_63 = Integer(ma_5.Result)
panel_40 = Panel(int_63)
int_64 = Integer(ma_6.Result)
panel_41 = Panel(int_64)
int_65 = Integer(ma_7.Result)
panel_42 = Panel(int_65)

# ---- group: range
B_2 = DomainEnd(number_slider_11)  # disabled

B_3 = DomainEnd(number_slider_12)  # disabled

# ----
int_66 = Integer(ma_8.Result)
panel_43 = Panel(int_66)
xy = XYPlane(Origin=pt_22)
dom = ConstructDomain(DomainStart=0, DomainEnd=B)  # disabled

# ---- group: Micro-unit Building #
int_67 = Integer(int_64)

# ---- group: Luxury Building #
int_68 = Integer(int_61)

# ---- group: Regular residential Building #
int_69 = Integer(int_62)

# ----
dom_2 = ConstructDomain(DomainStart=0, DomainEnd=B_2)  # disabled
dom_3 = ConstructDomain(DomainStart=0, DomainEnd=B_3)  # disabled

# ---- group: Head Quater Building #
int_70 = Integer(int_63)

# ---- group: Regular Office Building #
int_71 = Integer(int_65)

# ---- group: Co-working Building #
int_72 = Integer(int_66)

# ---- group: parking cell #
parking_cell = Slider(0, range=0..50)

# ---- group: multipe for ppls
number_slider_13 = Slider(0.2, range=-0.01..2)

# ---- group: park cell #
park_cell = Slider(150, range=0..150)

# ----
multiplication_9 = Multiplication(A=int_59, B=int_71)
multiplication_10 = Multiplication(A=int_57, B=int_69)
multiplication_11 = Multiplication(A=int_60, B=int_72)
multiplication_12 = Multiplication(A=int_56, B=int_67)
multiplication_13 = Multiplication(A=int_58, B=int_70)
multiplication_14 = Multiplication(A=int_55, B=int_68)

# ---- group: reduce ratio
number_slider_14 = Slider(0, range=0..1)  # disabled

# ----
number_slider_15 = Slider(52, range=0..100)  # disabled
number_slider_16 = Slider(0.2, range=0..1)  # disabled
number_slider_17 = Slider(59, range=0..100)  # disabled
number_slider_18 = Slider(0.2, range=0..1)  # disabled
number_slider_19 = Slider(72, range=0..100)  # disabled
number_slider_20 = Slider(0.2, range=0..1)  # disabled
panel_44 = Panel("""b,r,b,b,b,b,r,b,b,b,b,r,b,b,b,b
r,r,r,r,r,r,r,r,r,r,r,r,r,r,r,r
b,r,b,b,b,b,r,b,b,b,b,r,b,b,b,b
b,r,b,g,g,b,r,b,g,g,b,r,b,g,g,b
b,r,b,g,g,b,r,b,g,g,b,r,b,g,g,b
b,r,b,b,b,b,r,b,b,b,b,r,b,b,b,b
r,r,r,r,r,r,r,r,r,r,r,r,r,r,r,r
b,r,b,b,b,b,r,4,4,4,4,r,3,3,3,3
b,r,b,g,g,b,r,4,g,g,4,r,3,g,g,3
b,r,b,g,g,b,r,4,g,g,4,r,3,g,g,3
b,r,b,b,b,b,r,4,4,4,4,r,3,3,3,3
r,r,r,r,r,r,r,r,r,r,r,r,r,r,r,r
b,r,2,2,2,2,r,1,1,1,1,r,0,0,0,0
b,r,2,g,g,2,r,1,g,g,1,r,0,g,g,0
b,r,2,g,g,2,r,1,g,g,1,r,0,g,g,0
b,r,2,2,2,2,r,1,1,1,1,r,0,0,0,0""")
panel_45 = Panel(panel_13)
mid_mid_career = ColourSwatch(SwatchColor=RGB(255, 208, 0))  # disabled
mln_young = ColourSwatch(SwatchColor=RGB(0, 166, 255))  # disabled
exc_elderly = ColourSwatch(SwatchColor=RGB(255, 0, 0))  # disabled

# ---- group: dot shape
number_slider_21 = Slider(9, range=0..10)  # disabled
number_slider_22 = Slider(3, range=0..10)  # disabled
polygon = Polygon(Plane=PlaneXY(0, 0, 0), Radius=number_slider_22, Segments=number_slider_21, FilletRadius=0)  # -> Polygon, Length; disabled
boundary = BoundarySurfaces(Edges=polygon.Polygon)  # disabled
mesh_8 = Mesh(boundary)  # disabled

# ----
mesh_9 = Mesh(mesh_8)  # disabled
mesh_10 = Mesh(mesh_8)  # disabled
mesh_11 = Mesh(mesh_8)  # disabled
res_warm_2 = ColourSwatch(SwatchColor=RGB(255, 246, 204))
off_cold_2 = ColourSwatch(SwatchColor=RGB(204, 229, 255))

# ---- group: Dashboard Text Color
color = ColourSwatch(SwatchColor=RGB(201, 201, 201))
col_17 = Colour(color)

# ---- group: Dashboard Text Size 2
size = Slider(13.5, range=0..100)
num_9 = Number(size)

# ---- group: Dashboard Text Size 1
size_2 = Slider(15, range=0..100)
num_10 = Number(size_2)

# ----
index = Slider(3000, range=1000..10000)
coefficient = Slider(0.25, range=0..1)

ttl_min = Slider(60, range=0..100)
type_min = Slider(20, range=0..100)

# ----
# Shadow calculation Tuo version 1
heights = Slider(3.5, range=1..4.5)
# Showcase - Tuo Version 6/1
b_id = Slider(5, range=-1..30)
building = Slider(6, range=1..30)
g_id = Slider(-1, range=-1..30)
r_id = Slider(6, range=-1..30)
# Shadow update Tuo version 1
centroid = Point(<point referenced from the Rhino model>)
number_slider_23 = Slider(10, range=1..30)
Z = UnitZ(Factor=1)
amp = Amplitude(Vector=Z, Amplitude=10)
# Population Matrix - New
pt_23 = Point(<point referenced from the Rhino model>)
num_11 = Number(num_10)
col_18 = Colour(res_warm_2)
pt_24 = Point(<point referenced from the Rhino model>)
num_12 = Number(num_10)
pt_25 = Point(<point referenced from the Rhino model>)
num_13 = Number(num_10)
col_19 = Colour(res_warm_2)
pt_26 = Point(<point referenced from the Rhino model>)
num_14 = Number(num_10)
col_20 = Colour(res_warm_2)
col_21 = Colour(res_warm_2)
number_slider_24 = Slider(2.5, range=0..10)
number_slider_25 = Slider(700, range=700..35000)
multiplication_15 = Multiplication(A="35000", B=number_slider_24)

# ---- group: intersections
crossings = Point([Point(156.25, 281.25, 0), Point(468.75, 281.25, 0), Point(718.75, 281.25, 0), Point(156.25, 656.25, 0), Point(468.75, 656.25, 0), Point(718.75, 656.25, 0), Point(906.25, 906.25, 0), Point(718.75, 906.25, 0), Point(468.75, 906.25, 0), Point(156.25, 906.25, 0), Point(906.25, 281.25, 0), Point(906.25, 656.25, 0), Point(906.25, 781.25, 0), Point(906.25, 531.25, 0), Point(906.25, 156.25, 0)])

# ----
python = GhPythonScript()  # -> out, a, b, c; unedited script template

# ---- group: all road pieces
pt_27 = Point([Point(906.25, 156.25, 0), Point(906.25, 531.25, 0), Point(906.25, 781.25, 0), Point(906.25, 656.25, 0), Point(906.25, 281.25, 0), Point(156.25, 906.25, 0)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])

# ---- group: traffic mode is PEV
bool_13 = Boolean(bool_9)

# ----
pt_28 = Point(<point referenced from the Rhino model>)
num_15 = Number(num_10)
col_22 = Colour(off_cold_2)
python_2 = PythonScript(Panels=panel_44)  # -> out, panelvalue; inputs Panels: list
# ---------- python_2: Python ----------
import Grasshopper as gh


panelvalue = Panels
# ---------- end python_2 ----------
pt_29 = Point(<point referenced from the Rhino model>)
num_16 = Number(num_10)
pt_30 = Point(<point referenced from the Rhino model>)
num_17 = Number(num_10)
col_23 = Colour(off_cold_2)
pt_31 = Point(<point referenced from the Rhino model>)
num_18 = Number(num_10)
col_24 = Colour(off_cold_2)
col_25 = Colour(off_cold_2)
multiplication_16 = Multiplication(A=bool_13, B="-0.8")

# ---- group: gridExtent_x
int_73 = Integer(int_36)

# ---- group: gridExtent_y
int_74 = Integer(int_37)

# ----
python_3 = PythonScript(Panels=python_2.panelvalue)  # -> out, x, y, panellist; inputs Panels: list
# ---------- python_3: Python ----------
import Grasshopper as gh

panellist = []


for paneltext in Panels:
    rows = paneltext.split("\r\n")

    
for row in rows:
    panellist.append(row.split(","))

x,y = len(rows[0])//2+1,len(rows)

print(panellist)
# ---------- end python_3 ----------
panel_46 = Panel("""4
4""")
iron2panel = GhPythonScript(ironList=python_3.panellist)  # -> out, panelOut
# ---------- iron2panel: Python ----------
"""Provides a scripting component.
    Inputs:
        centroid: Building's centroid point (area)
        floors: the number of floor
        grid: The gird
        cellSize: the size of the grid cell
        
    Output:
        a: The a output variable"""

__author__ = "sunt"
__version__ = "2018.05.28"

import rhinoscriptsyntax as rs

panelOut = ironList
# ---------- end iron2panel ----------
id_replace = PythonScript(inPanelList=iron2panel.panelOut, b=b_id, g=g_id, r=r_id)  # -> out, outPanelList; inputs inPanelList: list
# ---------- id_replace: Python ----------
import Grasshopper as gh

outPanelList = inPanelList[:]

replaceDict ={"r":r,"g":g,"b":b}


#for row in range(len(outPanelList)):
#    for item in range(len(row)):
#        outPanelList[row][item] = replaceDict.get(outPanelList[row][item],outPanelList[row][item])
#    
for item in range(len(outPanelList)):
    outPanelList[item] = int(replaceDict.get(outPanelList[item],outPanelList[item]))

    
print(outPanelList)
# ---------- end id_replace ----------
floor_replace = PythonScript(inPanelList=iron2panel.panelOut, b=building)  # -> out, outPanelList; inputs inPanelList: list
# ---------- floor_replace: Python ----------
import Grasshopper as gh

outPanelList = inPanelList[:]

replaceDict ={"r":0,"g":-1,"b":b}


#for row in range(len(outPanelList)):
#    for item in range(len(row)):
#        outPanelList[row][item] = replaceDict.get(outPanelList[row][item],outPanelList[row][item])
#    
for item in range(len(outPanelList)):
    outPanelList[item] = int(replaceDict.get(outPanelList[item],outPanelList[item]))

    
print(outPanelList)
# ---------- end floor_replace ----------
byheight = PythonScript(inPanelList=floor_replace.outPanelList, heights=heights)  # -> out, outPanelList; inputs inPanelList: list
# ---------- byheight: Python ----------
import Grasshopper as gh

outPanelList = inPanelList[:]


for item in range(len(outPanelList)):
    outPanelList[item] = int(outPanelList[item])*heights

    
print(outPanelList)
# ---------- end byheight ----------

# ---- group: balance two colors
number_slider_26 = Slider(0.8, range=0..1)

# ----
road_2 = ColourSwatch(SwatchColor=RGB(64, 64, 64))
subtraction = Subtraction(A=1, B=number_slider_26)
panel_47 = Panel(byheight.outPanelList)
move_z = Slider(5.5, range=0..10)
argb = SplitARGB(Colour=road_2, IntegerChannels=True)  # -> Alpha, Red, Green, Blue
gradient = Gradient(LowerLimit=0, UpperLimit=1, Parameter=byheight.outPanelList, stops=[0: RGB(255, 255, 255), 1: RGB(0, 0, 0)])
vec = VectorXYZ(XComponent=argb.Red, YComponent=argb.Green, ZComponent=argb.Blue)  # -> Vector, Length
multiplication_17 = Multiplication(A=vec.Vector, B=subtraction)
Z_2 = UnitZ(Factor=move_z)
Z_3 = UnitZ(Factor=1)
amp_2 = Amplitude(Vector=Z_3, Amplitude=flatten(panel_47))
argb_2 = SplitARGB(Colour=gradient)  # -> Alpha, Red, Green, Blue
frgb_9 = ColourRGBF(Alpha=Slider(0.5, range=0..1), Red=argb_2.Red, Green=argb_2.Green, Blue=argb_2.Blue)
subtraction_2 = Subtraction(A=int_73, B=1)
panel_48 = Panel("0.0 to 28000")
panel_49 = Panel("0.0 to 66000")
number_slider_27 = Slider(0, range=0..255)  # disabled
Z_4 = UnitZ(Factor=1)  # disabled
gradient_2 = Gradient(LowerLimit=0, UpperLimit=1, Parameter=panel_47, stops=[0: RGB(102, 102, 102), 1: RGB(255, 255, 255)])  # disabled
number_slider_28 = Slider(1, range=0..1)  # disabled
number_slider_29 = Slider(0.5, range=0..1)  # disabled
number_slider_30 = Slider(1, range=0..1)  # disabled
amp_3 = Amplitude(Vector=Z_4, Amplitude=1)  # disabled
argb_3 = SplitARGB(Colour=gradient_2)  # -> Alpha, Red, Green, Blue; disabled
frgb_10 = ColourRGBF(Alpha=number_slider_28, Red=argb_3.Red, Green=argb_3.Green, Blue=argb_3.Blue)  # disabled
col_26 = Colour(frgb_10)  # disabled

# ---- group: Alpha
number_slider_31 = Slider(0.5, range=0..1)

# ---- group: road color - none
swatch = ColourSwatch(SwatchColor=RGB(64, 64, 64))

# ----
gradient_3 = Gradient(LowerLimit=0, UpperLimit=1, stops=[0: RGB(0, 51, 153), 0.5: RGB(6, 176, 0), 1: RGB(242, 40, 0)])
gradient_4 = Gradient(LowerLimit=0, UpperLimit=1, stops=[0: RGB(0, 128, 0), 0.5: RGB(222, 222, 0), 1: RGB(255, 0, 0)])
gradient_5 = Gradient(LowerLimit=0, UpperLimit=1, stops=[0: RGB(0, 128, 0), 1: RGB(255, 0, 0)])

# ---- group: road color - none
col_27 = Colour(swatch)

# ---- group: gridExtent_x
int_75 = Integer(int_36)

# ---- group: shrink
cell_shrink = Slider(0.98, range=0.75..1)

# ---- group: gridExtent_x
int_76 = Integer(int_36)

# ----
grid_x_extent = Number(int_76)

# ---- group: shrink
num_19 = Number(cell_shrink)

num_20 = Number(num_19)

# ---- group: gridExtent_y
int_77 = Integer(int_37)

# ----
grid_y_extent = Number(int_77)

# ---- group: rotation
int_78 = Integer(int_40)

# ---- group: module id
int_79 = Integer(int_45)

# ---- group: y
int_80 = Integer(int_39)

# ---- group: x
int_81 = Integer(int_38)

# ---- group: toggle1
bool_14 = Boolean(bool_9)

# ----
subtraction_3 = Subtraction(A=int_75, B=1)

# ---- group: colortizer orgin
# LEGO Grid System
pt_32 = Point(<point referenced from the Rhino model>)

pt_33 = Point(pt_32)

# ---- group: table size ref pt
pt_34 = Point(<point referenced from the Rhino model>)

# ----
number_slider_32 = Slider(0.5, range=0..1)
int_82 = Integer(int_38)
mid_mid_career_2 = ColourSwatch(SwatchColor=RGB(255, 208, 0))
txt_12 = Text(num_8)
# Dashboard
# Bar Diagram
mln_young_2 = ColourSwatch(SwatchColor=RGB(0, 166, 255))
exc_elderly_2 = ColourSwatch(SwatchColor=RGB(255, 0, 0))
_0 = Slider(0, range=0..1)

# ---- group: v sep ln length
number_slider_33 = Slider(16, range=10..20)

# ---- group: gh ref pt start
pt_35 = Point(<point referenced from the Rhino model>)

# ---- group: gh ref pt end
pt_36 = Point(<point referenced from the Rhino model>)

# ---- group: bar diagram ppl range
domain = Domain("0 to 20000")

# ----
subtraction_4 = Subtraction(A=subtraction_3, B=int_82)
# Dock
panel_50 = Panel("Residential")

# ---- group: dockID
int_83 = Integer(int_41)

# ---- group: dockRotation
int_84 = Integer(int_46)

# ----
swatch_2 = ColourSwatch(SwatchColor=RGB(255, 255, 255))  # disabled
panel_51 = Panel("C:\Users\RYAN\Documents\GitHub\CityMatrix\Map\Amenities Maps\Amenities_Trans.png")  # disabled
Z_5 = UnitZ(Factor=20)  # disabled
panel_52 = Panel("C:\Users\RYAN\Documents\GitHub\CityMatrix\Map\Amenities Maps\Amenities_85Alpha.png")  # disabled
# C:\Users\RYAN\Documents\GitHub\CityMatrix\Map\HAMBURG RS 1600pxl.jpg
panel_53 = Panel("0.0")  # disabled
xy_2 = XYPlane(Origin=pt_32)
dist = Distance(PointA=pt_32, PointB=pt_34)
# Send to Unity (json)
panel_54 = Panel("{\"grid\":[")
pdecon_10 = Deconstruct(Point=pt_36)  # -> XComponent, YComponent, ZComponent

# ---- group: module meshes lego ref: -1
mesh_12 = Mesh(mesh)

# ----
pdecon_11 = Deconstruct(Point=pt_35)  # -> XComponent, YComponent, ZComponent

# ---- group: module meshes lego ref: 0 to 5
mesh_13 = Mesh(mesh_2)

# ----
txt_13 = Text(subtraction_4)
txt_14 = Text(int_39)
txt_15 = Text(int_40)
txt_16 = Text(int_41)
txt_17 = Text(int_46)
txt_18 = Text(int_45)
int_85 = Integer(bool_11)
txt_19 = Text(txt_12)
int_86 = Integer(bool_9)
int_87 = Integer(bool_11)
int_88 = Integer(bool_10)
neg = Negative(Value=number_slider_33)
merge_7 = Merge(Data1=mln_young_2, Data2=mid_mid_career_2, Data3=exc_elderly_2)
txt_20 = Text(int_44)
neg_2 = Negative(Value=int_84)
division_5 = Division(A=dist, B=int_76)
txt_21 = Text(["Large Unit", "Medium Unit", "Small Unit", "Large Unit", "Medium Unit", "Small Unit"])
txt_22 = Text([panel_50, "Residential", "Residential", "Office", "Office", "Office"])

# ---- group: base cplane
pln = Plane(xy_2)

# ----
# Google Map @ Lego
planesrf = PlaneSurface(Plane=pln, XSize=Domain(0, 1000), YSize=Domain(-1000, 0))  # disabled
move_2 = Move(Geometry=planesrf, Motion=Z_5)  # -> Geometry, Transform; disabled
txt_23 = Text(int_86)
txt_24 = Text(int_88)
txt_25 = Text(int_85)
txt_26 = Text(int_87)

# ---- group: road check matrix
python_4 = PythonScript(xe=int_76, ye=int_77, x=int_81, y=int_80, id=int_79)  # -> out, m; inputs x: list, y: list, id: list
# ---------- python_4: Python ----------
"""
CityMatrix

written by "Ryan" Yan Zhang <ryanz@mit.edu>
for MIT Media Lab, Changing Place Group
April.6th.2016
"""

import rhinoscriptsyntax as rs

m = [[-1 for n in range(xe)] for n in range(ye)]

#for n in range(len(id)):
#    if id[n] == 7:
#        m[y[n]][x[n]] = 6
#    else:
#        m[y[n]][x[n]] = id[n]

for n in range(len(id)):
    m[y[n]][x[n]] = id[n]

for n in range(ye):
    print m[n]
# ---------- end python_4 ----------

# ----
Y = UnitY(Factor=number_slider_33)

# ---- group: road check matrix
python_5 = PythonScript(xe=int_76, ye=int_77, x=int_81, y=int_80, id=int_79)  # -> out, m; inputs x: list, y: list, id: list; same code as python_4

# ----
Y_2 = UnitY(Factor=neg)
movetoorgin = MoveToOrgin(G=mesh_12, num=num_19)
movetoorgin_2 = MoveToOrgin(G=mesh_13, num=num_19)

# ---- group: sidewalk check matrix
python_6 = PythonScript(xe=int_76, ye=int_77, x=int_81, y=int_80, id=int_79)  # -> out, m; inputs x: list, y: list, id: list; same code as python_4

# ----
number_slider_34 = Slider(15.2, range=0..100)

# ---- group: private car / road quator 0s
mesh_14 = Mesh([<mesh referenced from the Rhino model> x4])
pt_37 = Point(<point referenced from the Rhino model>)

# ---- group: private car / center line quator 0s
mesh_15 = Mesh([<mesh referenced from the Rhino model> x4])
pt_38 = Point(<point referenced from the Rhino model>)

# ----
item_19 = ListItem(List=txt_21, Index=int_83, Wrap=False)
item_20 = ListItem(List=txt_22, Index=int_83, Wrap=False)

# ---- group: private car / sidewalk quator 0s
mesh_16 = Mesh([<mesh referenced from the Rhino model> x4])
pt_39 = Point(<point referenced from the Rhino model>)

# ----
pt_40 = Point(<point referenced from the Rhino model>)

# ---- group: cell size
num_21 = Number(division_5)

# ----
# Traffic- Tuo Version 6/1
cell_size = Number(num_21)
cell_size_2 = Number(cell_size)
cell_size_3 = Integer(cell_size_2)

# ---- group: cell size
num_22 = Number(num_21)

# ----
division_6 = Division(A=num_22, B=2)
neg_3 = Negative(Value=division_6)
dom_4 = ConstructDomain(DomainStart=neg_3, DomainEnd=division_6)
shadowbyfloor = GhPythonScript(heights=heights, floor=number_slider_23, index=coefficient, cellSize=cell_size_3)  # -> out, shadowGrid; disabled
# ---------- shadowbyfloor: Python ----------
"""Provides a scripting component.
    Inputs:
        centroid: Building's centroid point (area)
        floors: the number of floor
        grid: The gird
        cellSize: the size of the grid cell
        
    Output:
        a: The a output variable"""

__author__ = "sunt"
__version__ = "2018.05.28"

import rhinoscriptsyntax as rs
import math


radius = math.ceil((floor * heights * index) / cellSize)

shadowGrid = [[8*radius - math.sqrt((x-radius)**2 + y**2 ) for x in range(int(2*radius+1))] for y in range(int(radius+1))]
# ---------- end shadowbyfloor ----------
sqgrid = Square(Plane=PlaneXY(0, 0, 0), Size=cell_size_2, ExtentX=python_3.x, ExtentY=python_3.y)  # -> Cells, Points
planesrf_2 = PlaneSurface(Plane=PlaneXY(0, 0, 0), XSize=dom_4, YSize=dom_4)
shadowbyfloor_2 = GhPythonScript(bldgHeights=panel_47, xExt=python_3.x, yExt=python_3.y, index=coefficient, cellSize=cell_size_3)  # -> out, zeroList; inputs bldgHeights: tree
# ---------- shadowbyfloor_2: Python ----------
"""Provides a scripting component.
    Inputs:
        centroid: Building's centroid point (area)
        floors: the number of floor
        grid: The gird
        cellSize: the size of the grid cell
        
    Output:
        a: The a output variable"""

__author__ = "sunt"
__version__ = "2018.05.28"

import rhinoscriptsyntax as rs
import math
import Grasshopper as gh


zeroList = [[0 for x in range(xExt)] for y in range(yExt)]

print(zeroList)
print(bldgHeights)

#for i in range(bldgHeights.BranchCount):
#    for j in range(len(bldgHeights.Branch(i))):
#        print(bldgHeights.Branch(i)[j])


for bldgY in range(yExt):
    for bldgX in range(xExt):
        radius = math.ceil(5* (float(bldgHeights.Branch(bldgY)[bldgX]) * index) / cellSize)
        for y in range(int(bldgY), int(bldgY+radius+1)):
            for x in range(int(bldgX-radius), int(bldgX+radius+1)):
#                print(8*radius - math.sqrt((x-radius)**2 + y**2 ))
#                print(x,y,xExt,yExt)
                if 0<=x and x<xExt and 0<=y and y<yExt:
                    zeroList[y][x] = max(zeroList[y][x], 8*radius - math.sqrt((x-radius)**2 + y**2 ))
#
#shadowGrid = [[1+radius - math.sqrt((x-radius)**2 + y**2 ) for x in range(int(2*radius+1))] for y in range(int(radius+1))]

print(zeroList)
# ---------- end shadowbyfloor_2 ----------
rev_3 = ReverseList(List=sqgrid.Cells)  # -> flatten(List)
scale_nu = ScaleNU(Geometry=planesrf_2, Plane=PlaneXY(0, 0, 0), ScaleX=num_20, ScaleY=num_20, ScaleZ=1)  # -> Geometry, Transform
iron2panel_2 = GhPythonScript(ironList=shadowbyfloor.shadowGrid)  # -> out, panelOut; disabled; same code as iron2panel
iron2panel_3 = GhPythonScript(ironList=shadowbyfloor_2.zeroList)  # -> out, panelOut; same code as iron2panel
boundary_2 = BoundarySurfaces(Edges=rev_3)
extr = Extrude(Base=boundary_2, Direction=amp)
area = Area(Geometry=boundary_2)  # -> Area, Centroid
move_3 = Move(Geometry=scale_nu.Geometry, Motion=Z_2)  # -> Geometry, Transform
extr_2 = Extrude(Base=boundary_2, Direction=amp_2)

# ---- group: mesh srf at orgin
mesh_17 = Mesh(move_3.Geometry)

# ----
panel_55 = Panel(iron2panel_2.panelOut)  # disabled
getgridcorners = GhPythonScript(cells=rev_3)  # -> out, corners; inputs cells: list
# ---------- getgridcorners: Python ----------
__author__ = "sunt"
__version__ = "2018.05.28"

import rhinoscriptsyntax as rs

print(cells[0])
print(cells[-1])

a= rs.CurvePoints(cells[0])[3]
b= rs.CurvePoints(cells[15])[0]
d= rs.CurvePoints(cells[-16])[2]
c= rs.CurvePoints(cells[-1])[1]

corners = [b,a,d,c]
# ---------- end getgridcorners ----------
pline_3 = PolyLine(Vertices=getgridcorners.corners, Closed=True)
grid_boundary = Curve(pline_3)
bldgingrid = GhPythonScript(centroid=centroid, grid=grid_boundary, cellSize=cell_size_3)  # -> out, XInGrid, YInGrid, XYInGrid
# ---------- bldgingrid: Python ----------
"""Provides a scripting component.
    Inputs:
        centroid: Building's centroid point (area)
        floors: the number of floor
        grid: The gird
        cellSize: the size of the grid cell
        
    Output:
        a: The a output variable"""

__author__ = "sunt"
__version__ = "2018.05.28"

import rhinoscriptsyntax as rs


bldgX = rs.PointCoordinates(centroid)[0]
bldgY = rs.PointCoordinates(centroid)[1]

ptsOnGrid = rs.CurvePoints(grid)
girdXMin = ptsOnGrid[0][0]
girdXMax = ptsOnGrid[2][0]
girdYMin = ptsOnGrid[0][1]
girdYMax = ptsOnGrid[2][1]

a = ptsOnGrid
b = [girdXMin,girdXMax,girdYMin,girdYMax]

#XInGrid = (girdXMax - bldgX)//cellSize
YInGrid = (girdYMax - bldgY)//cellSize
XInGrid = (bldgX-girdXMin)//cellSize
#YInGrid1 = (bldgY-girdYMin)//cellSize
#print(XInGrid,YInGrid,XInGrid1,YInGrid1)
XYInGrid = [int(XInGrid),int(YInGrid)]
# ---------- end bldgingrid ----------
gridout = GhPythonScript(grid=grid_boundary, cellSize=cell_size_3)  # -> out, gridOut
# ---------- gridout: Python ----------
"""Provides a scripting component.
    Inputs:
        centroid: Building's centroid point (area)
        floors: the number of floor
        grid: The gird
        cellSize: the size of the grid cell
        
    Output:
        a: The a output variable"""

__author__ = "sunt"
__version__ = "2018.05.28"

import rhinoscriptsyntax as rs



ptsOnGrid = rs.CurvePoints(grid)
girdXMin = ptsOnGrid[0][0]
girdXMax = ptsOnGrid[2][0]
girdYMin = ptsOnGrid[0][1]
girdYMax = ptsOnGrid[2][1]


b = [girdXMin,girdXMax,girdYMin,girdYMax]

Xrange = int((girdXMax-girdXMin)//cellSize + 1)
Yrange = int((girdYMax-girdYMin)//cellSize + 1)

zeroList = [[0 for x in range(Xrange)] for y in range(Yrange)]

gridOut = zeroList
# ---------- end gridout ----------
iron2panel_4 = GhPythonScript(ironList=gridout.gridOut)  # -> out, panelOut; same code as iron2panel
panel_56 = Panel(iron2panel_4.panelOut)
shadowbyfloor_3 = GhPythonScript(shadowGrid=shadowbyfloor.shadowGrid, gridOut=shadowbyfloor_2.zeroList, XYInGrid=bldgingrid.XYInGrid)  # -> out, nextGrid; inputs shadowGrid: tree, gridOut: tree, XYInGrid: list; disabled
# ---------- shadowbyfloor_3: Python ----------
"""Provides a scripting component.
    Inputs:
        centroid: Building's centroid point (area)
        floors: the number of floor
        grid: The gird
        cellSize: the size of the grid cell
        
    Output:
        a: The a output variable"""

__author__ = "sunt"
__version__ = "2018.05.28"

import rhinoscriptsyntax as rs
import math
print(gridOut)
nextGrid = gridOut[:]

for x in range(int(len(shadowGrid[0]))):
     for y in range(int(len(shadowGrid))):
         nextX = x+XYInGrid[0]-int(len(shadowGrid[0])//2)
         nextY = y+XYInGrid[1]
         print([x,y,nextX,nextY,len(nextGrid[0]),len(nextGrid)])
         if 0<=nextX and nextX<len(nextGrid[0]) and 0<=nextY and nextY<len(nextGrid):
             nextGrid[nextY][nextX] = max(shadowGrid[y][x],nextGrid[nextY][nextX])

print(shadowGrid)
print(gridOut)
#print(len(shadowGrid[0])//2)
#print(XYInGrid[0])
#print(0+XYInGrid[0]-math.floor(len(shadowGrid[0])//2))
print(nextGrid)
# ---------- end shadowbyfloor_3 ----------
singlechange = GhPythonScript(
    Heights=byheight.outPanelList,
    newFloor=number_slider_23,
    floorHeight=heights,
    x=bldgingrid.XInGrid,
    y=bldgingrid.YInGrid)  # -> out, Heights; inputs Heights: tree
# ---------- singlechange: Python ----------
"""Provides a scripting component.
    Inputs:
        centroid: Building's centroid point (area)
        floors: the number of floor
        grid: The gird
        cellSize: the size of the grid cell
        
    Output:
        a: The a output variable"""

__author__ = "sunt"
__version__ = "2018.05.28"

import rhinoscriptsyntax as rs
import math
import Grasshopper as gh

print(x,y)

print(Heights.Branch(int(x))[int(y)])

print(float(newFloor*floorHeight))

Heights.Branch(int(x))[int(y)] = float(newFloor*floorHeight)
# ---------- end singlechange ----------
python_7 = GhPythonScript(toggle=Toggle(True), old=byheight.outPanelList, updates=singlechange.Heights)  # -> out, Heights
# ---------- python_7: Python ----------
__author__ = "sunt"
__version__ = "2018.05.29"

import rhinoscriptsyntax as rs

if toggle:
    Heights = updates
else:
    Heights = old
# ---------- end python_7 ----------
iron2panel_5 = GhPythonScript(ironList=shadowbyfloor_3.nextGrid)  # -> out, panelOut; disabled; same code as iron2panel
panel_57 = Panel(iron2panel_3.panelOut)
panel_58 = Panel(iron2panel_5.panelOut)  # disabled
gradient_6 = Gradient(
    LowerLimit=0,
    UpperLimit=1,
    Parameter=panel_57,
    stops=[0: RGB(234, 126, 0), 0: RGB(234, 38, 0), 0.5: RGB(254, 244, 84), 0.75: RGB(173, 203, 249), 1: RGB(75, 107, 169)])  # disabled
gradient_7 = Gradient(LowerLimit=0, UpperLimit=1, Parameter=panel_58, stops=[0: RGB(0, 50, 199), 1: RGB(255, 255, 0)])  # disabled
extr_3 = Extrude(Base=boundary_2, Direction=amp_3)  # disabled
argb_4 = SplitARGB(Colour=gradient_6)  # -> Alpha, Red, Green, Blue; disabled
argb_5 = SplitARGB(Colour=gradient_7)  # -> Alpha, Red, Green, Blue; disabled
frgb_11 = ColourRGBF(Alpha=number_slider_30, Red=argb_4.Red, Green=argb_4.Green, Blue=argb_4.Blue)  # disabled
frgb_12 = ColourRGBF(Alpha=number_slider_29, Red=argb_5.Red, Green=argb_5.Green, Blue=argb_5.Blue)  # disabled
col_28 = Colour(frgb_12)
col_29 = Colour(frgb_11)  # disabled
preview_4 = CustomPreview(Geometry=extr_2, Material=flatten(col_26))  # disabled
preview_5 = CustomPreview(Geometry=extr_3, Material=flatten(col_29))  # disabled
preview_6 = CustomPreview(Geometry=extr_3, Material=flatten(col_28))  # disabled
modulecenter = ModuleCenter(pt=pt_32, num=num_21, int_2=int_81, int=int_80)  # -> pt_5, transform_2
lng_3 = ListLength(List=txt_18)
repeat_3 = RepeatData(Data=",\"rot\":", Length=lng_3)
repeat_4 = RepeatData(Data="}", Length=lng_3)
repeat_5 = RepeatData(Data=",\"y\":", Length=lng_3)
repeat_6 = RepeatData(Data=",\"x\":", Length=lng_3)
repeat_7 = RepeatData(Data="{\"type\":", Length=lng_3)
join_5 = TextJoin(Text=txt_20, Join=",")
swatch_3 = ColourSwatch(SwatchColor=RGB(255, 255, 255))
pshift_21 = ShiftPaths(Data=repeat_3, Offset=-1)
pshift_22 = ShiftPaths(Data=repeat_4, Offset=-1)
pshift_23 = ShiftPaths(Data=repeat_6, Offset=-1)
pshift_24 = ShiftPaths(Data=repeat_5, Offset=-1)
pshift_25 = ShiftPaths(Data=repeat_7, Offset=-1)

# ---- group: private car / road quator 1s
mesh_18 = Mesh([<mesh referenced from the Rhino model> x4])
pt_41 = Point(<point referenced from the Rhino model>)

# ---- group: private car
scale_nu_2 = ScaleNU(Geometry=mesh_14, Plane=pt_37, ScaleX=num_19, ScaleY=num_19, ScaleZ=1)  # -> Geometry, Transform
scale_nu_3 = ScaleNU(Geometry=mesh_18, Plane=pt_41, ScaleX=num_19, ScaleY=num_19, ScaleZ=1)  # -> Geometry, Transform

# ---- group: private car / center line quator 1s
mesh_19 = Mesh([<mesh referenced from the Rhino model> x4])
pt_42 = Point(<point referenced from the Rhino model>)

# ---- group: private car
scale_nu_4 = ScaleNU(Geometry=mesh_15, Plane=pt_38, ScaleX=num_19, ScaleY=num_19, ScaleZ=1)  # -> Geometry, Transform
scale_nu_5 = ScaleNU(Geometry=mesh_19, Plane=pt_42, ScaleX=num_19, ScaleY=num_19, ScaleZ=1)  # -> Geometry, Transform

# ----
vec2pt = Vector2Pt(PointA=Point(0, 0, 0), PointB=pt_40, Unitize=False)  # -> Vector, Length

# ---- group: private car / sidewalk quator 1s
mesh_20 = Mesh([<mesh referenced from the Rhino model> x4])
pt_43 = Point(<point referenced from the Rhino model>)

# ---- group: private car
scale_nu_6 = ScaleNU(Geometry=mesh_16, Plane=pt_39, ScaleX=num_19, ScaleY=num_19, ScaleZ=1)  # -> Geometry, Transform
scale_nu_7 = ScaleNU(Geometry=mesh_20, Plane=pt_43, ScaleX=num_19, ScaleY=num_19, ScaleZ=1)  # -> Geometry, Transform

# ----
xform = Transform(modulecenter.transform_2)  # disabled

# ---- group: road check list
python_8 = PythonScript(xe=int_76, ye=int_77, x=int_81, y=int_80, id=int_79, m=python_4.m)  # -> out, rdType; inputs x: list, y: list, id: list, m: list
# ---------- python_8: Python ----------
"""
CityMatrix

written by "Ryan" Yan Zhang <ryanz@mit.edu>
for MIT Media Lab, Changing Place Group
April.6th.2016
"""

import rhinoscriptsyntax as rs

rdType = []

for n in range(len(id)):
    
    code = []
    
    if id[n]==6:
        
        # 0: check x, y+1
        if y[n]+1>ye-1:
            code.append(1)
        else:
            if m[y[n]+1][x[n]]==6:
                code.append(1)
            else:
                code.append(0)
        
        # 1: check x+1, y
        if x[n]+1>xe-1:
            code.append(1)
        else:
            if m[y[n]][x[n]+1]==6:
                code.append(1)
            else:
                code.append(0)
        
        # 2: check x, y-1
        if y[n]-1<0:
            code.append(1)
        else:
            if m[y[n]-1][x[n]]==6:
                code.append(1)
            else:
                code.append(0)
        
        # 3: check x-1, y
        if x[n]-1<0:
            code.append(1)
        else:
            if m[y[n]][x[n]-1]==6:
                code.append(1)
            else:
                code.append(0)
    
    else:
        
        code = [0,0,0,0]
    
    print code
    rdType.append(code)
# ---------- end python_8 ----------

python_9 = PythonScript(xe=int_76, ye=int_77, x=int_81, y=int_80, id=int_79, m=python_5.m)  # -> out, rdType; inputs x: list, y: list, id: list, m: list; same code as python_8

# ----
pt_44 = Point(<point referenced from the Rhino model>)
pt_45 = Point(<point referenced from the Rhino model>)

# ---- group: sidewalk check list
python_10 = PythonScript(xe=int_76, ye=int_77, x=int_81, y=int_80, id=int_79, m=python_6.m)  # -> out, rdType; inputs x: list, y: list, id: list, m: list; same code as python_8

# ---- group: module meshes lego at orgin
mesh_21 = Mesh(movetoorgin_2)

# ----
item_21 = ListItem(List=mesh_21, Index=int_83, Wrap=False)
rotate = Rotate(Geometry=item_21, Angle=degrees(int_84), Plane=PlaneXY(0, 0, 0))  # -> Geometry, Transform

# ---- group: module meshes lego at orgin
mesh_22 = Mesh(movetoorgin)

# ---- group: module center
pt_46 = Point(modulecenter.pt_5)

# ----
merge_8 = Merge(
    Data1=graft(pshift_25),
    Data2=graft(txt_18),
    Data3=graft(pshift_23),
    Data4=graft(txt_13),
    Data5=graft(pshift_24),
    Data6=graft(txt_14),
    Data7=graft(pshift_21),
    Data8=graft(txt_15),
    Data9=graft(pshift_22))
move_4 = Move(Geometry=rotate.Geometry, Motion=vec2pt.Vector)  # -> Geometry, Transform

# ---- group: unit name
tag_2 = TextTag3D(Location=pt_44, Text=item_19, Size=number_slider_34, Colour=swatch_3, Justification=5)

# ---- group: res/off
tag_3 = TextTag3D(Location=pt_45, Text=item_20, Size=number_slider_34, Colour=swatch_3, Justification=5)

# ---- group: PEV / road quator 0s
mesh_23 = Mesh([<mesh referenced from the Rhino model> x4])
pt_47 = Point(<point referenced from the Rhino model>)

# ---- group: PEV / center line quator 0s
mesh_24 = Mesh(mesh_15)
pt_48 = Point(pt_38)

# ---- group: PEV / sidewalk quator 0s
mesh_25 = Mesh([<mesh referenced from the Rhino model> x4])
pt_49 = Point(<point referenced from the Rhino model>)

# ----
join_6 = TextJoin(Text=merge_8)
neg_4 = Negative(Value=number_slider_33)

# ---- group: dock lego modules
mesh_26 = Mesh(move_4.Geometry)

# ----
larger = LargerThan(FirstNumber=int_79, SecondNumber="0")  # -> LargerThan, OrEqualTo
smaller = SmallerThan(FirstNumber=int_79, SecondNumber="5")  # -> SmallerThan, OrEqualTo

# ---- group: PEV / road quator 1s
mesh_27 = Mesh([<mesh referenced from the Rhino model> x4])
pt_50 = Point(<point referenced from the Rhino model>)

# ---- group: PEV
scale_nu_8 = ScaleNU(Geometry=mesh_23, Plane=pt_47, ScaleX=num_19, ScaleY=num_19, ScaleZ=1)  # -> Geometry, Transform
scale_nu_9 = ScaleNU(Geometry=mesh_27, Plane=pt_50, ScaleX=num_19, ScaleY=num_19, ScaleZ=1)  # -> Geometry, Transform

# ---- group: PEV / center line quator 1s
mesh_28 = Mesh(mesh_19)
pt_51 = Point(pt_42)

# ---- group: PEV
scale_nu_10 = ScaleNU(Geometry=mesh_24, Plane=pt_48, ScaleX=num_19, ScaleY=num_19, ScaleZ=1)  # -> Geometry, Transform
scale_nu_11 = ScaleNU(Geometry=mesh_28, Plane=pt_51, ScaleX=num_19, ScaleY=num_19, ScaleZ=1)  # -> Geometry, Transform

# ----
pshift_26 = ShiftPaths(Data=join_6, Offset=-1)

# ---- group: PEV / sidewalk quator 1s
mesh_29 = Mesh([<mesh referenced from the Rhino model> x4])
pt_52 = Point(<point referenced from the Rhino model>)

# ---- group: PEV
scale_nu_12 = ScaleNU(Geometry=mesh_25, Plane=pt_49, ScaleX=num_19, ScaleY=num_19, ScaleZ=1)  # -> Geometry, Transform
scale_nu_13 = ScaleNU(Geometry=mesh_29, Plane=pt_52, ScaleX=num_19, ScaleY=num_19, ScaleZ=1)  # -> Geometry, Transform

# ---- group: ttl h len
subtraction_5 = Subtraction(A=pdecon_10.XComponent, B=pdecon_11.XComponent)

# ----
division_7 = Division(A=neg_4, B=2)
division_8 = Division(A=number_slider_33, B=2)
and = GateAnd(A=larger.OrEqualTo, B=smaller.OrEqualTo)
# Human Interation @ Lego - Outside
dispatch_2 = Dispatch(List=int_79, DispatchPattern=and)  # -> ListA, ListB

# ---- group: filted id
int_89 = Integer(dispatch_2.ListA)

# ----
item_22 = ListItem(List=txt_11, Index=graft(int_89), Wrap=True)
pshift_27 = ShiftPaths(Data=item_22, Offset=-1)

# ---- group: flr #s
txt_27 = Text(pshift_27)

# ----
txt_28 = Text(pshift_26)
panel_59 = Panel(txt_28)
join_7 = TextJoin(Text=txt_28, Join=",")
txt_29 = Text(join_7)
Y_3 = UnitY(Factor=division_7)
Y_4 = UnitY(Factor=division_8)

# ---- group: toggle1
bool_15 = Boolean(bool_14)

# ----
filter_15 = StreamFilter(Gate=bool_15, Stream0=scale_nu_2.Geometry, Stream1=scale_nu_8.Geometry)
filter_16 = StreamFilter(Gate=bool_15, Stream0=scale_nu_3.Geometry, Stream1=scale_nu_9.Geometry)

# ---- group: toggle1
bool_16 = Boolean(bool_14)

# ----
filter_17 = StreamFilter(Gate=bool_16, Stream0=scale_nu_4.Geometry, Stream1=scale_nu_10.Geometry)
filter_18 = StreamFilter(Gate=bool_16, Stream0=scale_nu_5.Geometry, Stream1=scale_nu_11.Geometry)

# ---- group: toggle1
bool_17 = Boolean(bool_14)

# ----
filter_19 = StreamFilter(Gate=bool_17, Stream0=scale_nu_6.Geometry, Stream1=scale_nu_12.Geometry)
filter_20 = StreamFilter(Gate=bool_17, Stream0=scale_nu_7.Geometry, Stream1=scale_nu_13.Geometry)
dispatch_3 = Dispatch(List=int_79, DispatchPattern=and)  # -> ListA, ListB
merge_9 = Merge(
    Data1=panel_54,
    Data2=txt_29,
    Data3="],\"objects\":{",
    Data4="\"slider1\":",
    Data5=txt_19,
    Data6=",\"toggle1\":",
    Data7=txt_23,
    Data8=",\"toggle2\":",
    Data9=txt_24,
    Data10=",\"toggle3\":",
    Data11=txt_25,
    Data12=",\"toggle4\":",
    Data13=txt_26,
    Data14=",\"dockID\":",
    Data15=txt_16,
    Data16=",\"dockRotation\":",
    Data17=txt_17,
    Data18=",\"IDMax\":15",
    Data19=",\"density\":[",
    Data20=join_5,
    Data21="],\"pop_young\":0,\"pop_mid\":0,\"pop_old\":0",
    Data22="}",
    Data23="}")

# ---- group: translate example
pt_53 = Point(Point(-15, -8, 0))  # disabled
python_11 = PythonScript(point=pt_53)  # -> out, output; inputs point: Point3d; disabled
# ---------- python_11: Python ----------
import Rhino

transform = Rhino.Geometry.Transform.Translation(0,0,5)
point.Transform(transform)

output = point
# ---------- end python_11 ----------

# ---- group: toggle1
# Toggles
bool_18 = Boolean(bool_9)

# ---- group: toggle2
bool_19 = Boolean(bool_10)

bool_20 = Boolean(bool_19)  # disabled

# ---- group: toggle3
bool_21 = Boolean(bool_11)

# ---- group: toggle4
bool_22 = Boolean(bool_12)

# ----
mesh_30 = Mesh(filter_16)
mesh_31 = Mesh(filter_15)
mesh_32 = Mesh(filter_18)
mesh_33 = Mesh(filter_17)
smaller_2 = SmallerThan(FirstNumber=int_79, SecondNumber="0")  # -> SmallerThan, OrEqualTo
mesh_34 = Mesh(filter_20)
mesh_35 = Mesh(filter_19)
item_23 = ListItem(List=mesh_21, Index=graft(dispatch_3.ListA), Wrap=False)
filter_21 = StreamFilter(Gate=bool_15, Stream0=pt_37, Stream1=pt_47)
filter_22 = StreamFilter(Gate=bool_15, Stream0=pt_41, Stream1=pt_50)
filter_23 = StreamFilter(Gate=bool_16, Stream0=pt_38, Stream1=pt_48)
filter_24 = StreamFilter(Gate=bool_16, Stream0=pt_42, Stream1=pt_51)
join_8 = TextJoin(Text=merge_9)
filter_25 = StreamFilter(Gate=bool_17, Stream0=pt_39, Stream1=pt_49)
filter_26 = StreamFilter(Gate=bool_17, Stream0=pt_43, Stream1=pt_52)
dispatch_4 = Dispatch(List=pt_46, DispatchPattern=smaller_2.SmallerThan)  # -> ListA, ListB
show_google_map = BooleanToggle(False)
filter_27 = StreamFilter(Gate=show_google_map, Stream1=move_2.Geometry)  # disabled
previewmat = CustomPreviewMaterials(Geometry=filter_27, DiffuseColor=swatch_2, Transparency=panel_53, DiffuseBitmap=panel_51)  # disabled
pshift_28 = ShiftPaths(Data=item_23, Offset=-1)
dispatch_5 = Dispatch(List=int_78, DispatchPattern=and)  # -> ListA, ListB

# ---- group: h sep ln
ln = Line(StartPoint=pt_35, EndPoint=pt_36)

# ----
pt_54 = Point(filter_22)
pt_55 = Point(filter_24)
pt_56 = Point(filter_21)

# ---- group: road check list
python_12 = PythonScript(pt=pt_46, id=int_79, rdType=python_8.rdType, rdQua0=mesh_31, c0=pt_56, rdQua1=mesh_30, c1=pt_54)  # -> out, allRoadMesh; inputs pt: list, id: list, rdType: list, rdQua0: list, rdQua1: list
# ---------- python_12: Python ----------
"""
CityMatrix

written by "Ryan" Yan Zhang <ryanz@mit.edu>
for MIT Media Lab, Changing Place Group
April.6th.2016
"""

import rhinoscriptsyntax as rs
import Rhino.Geometry as rg

allRoadMesh = []

for n in range(len(id)):
    
    if id[n]==6:
        
        for i in range(len(rdType[n])):
            t = rdType[n][i]
            v = rs.PointCoordinates(pt[n])
            if t == 0:
                c = rs.PointCoordinates(c0)
                vx = v[0]-c[0]
                vy = v[1]-c[1]
                new = rs.CopyObject(rdQua0[i],(vx,vy,0.))
            else:
                c = rs.PointCoordinates(c1)
                vx = v[0]-c[0]
                vy = v[1]-c[1]
                new = rs.CopyObject(rdQua1[i],(vx,vy,0.))
            allRoadMesh.append(new)
# ---------- end python_12 ----------

# ----
vec2pt_2 = Vector2Pt(PointA=Point(0, 0, 0), PointB=dispatch_4.ListA, Unitize=False)  # -> Vector, Length
pt_57 = Point(filter_23)

# ---- group: road check list
python_13 = PythonScript(pt=pt_46, id=int_79, rdType=python_9.rdType, rdQua0=mesh_33, c0=pt_57, rdQua1=mesh_32, c1=pt_55)  # -> out, allRoadMesh; inputs pt: list, id: list, rdType: list, rdQua0: list, rdQua1: list; same code as python_12

# ----
pt_58 = Point(filter_26)
pt_59 = Point(filter_25)

# ---- group: sidewalk check list
python_14 = PythonScript(pt=pt_46, id=int_79, rdType=python_10.rdType, rdQua0=mesh_35, c0=pt_59, rdQua1=mesh_34, c1=pt_58)  # -> out, allRoadMesh; inputs pt: list, id: list, rdType: list, rdQua0: list, rdQua1: list; same code as python_12

# ----
neg_5 = Negative(Value=number_slider_33)
neg_6 = Negative(Value=number_slider_33)
txt_30 = Text(["Amenity On", "Amenity Off"])
txt_31 = Text(["Human Int. On", "Human Int. Off"])
txt_32 = Text(["Sat. Map On", "Sat. Map Off"])
txt_33 = Text(["Private Car", "MoD."])
rotate_2 = Rotate(Geometry=pshift_28, Angle=degrees(dispatch_5.ListA), Plane=PlaneXY(0, 0, 0))  # -> Geometry, Transform
graft = GraftTree(Tree=rotate_2.Transform, IncludeEmptyLists=True, IncludeNullItems=True)
dispatch_6 = Dispatch(List=pt_46, DispatchPattern=and)  # -> ListA, ListB
move_5 = Move(Geometry=mesh_22, Motion=vec2pt_2.Vector)  # -> Geometry, Transform

# ---- group: json data to unity
txt_34 = Text(join_8)

# ----
panel_60 = Panel(txt_34)
dam = DataDam(DataA=txt_34, BufferDelay=10000000, BufferMode=2)
division_9 = Division(A=neg_5, B=6)
division_10 = Division(A=neg_6, B=6)
item_24 = ListItem(List=txt_30, Index=bool_21, Wrap=True)
item_25 = ListItem(List=txt_32, Index=bool_22, Wrap=True)
item_26 = ListItem(List=txt_31, Index=bool_19, Wrap=True)
item_27 = ListItem(List=txt_33, Index=bool_18, Wrap=True)
vec2pt_3 = Vector2Pt(PointA=Point(0, 0, 0), PointB=dispatch_6.ListA, Unitize=False)  # -> Vector, Length
equals_17 = Equality(FirstNumber=int_79, SecondNumber="7")  # -> Equality, Inequality
equals_18 = Equality(FirstNumber=int_79, SecondNumber="6")  # -> Equality, Inequality
send_table_data = PythonScript(url="https://cityio.media.mit.edu", path="table/update/citymatrix", jsonString=dam)  # -> out
# ---------- send_table_data: Python ----------
import System 
import System.Net 
import System.Uri
import System.IO
import System.Text.Encoding
import json


def postTable(url,stringData,debug=False):
    webclient = System.Net.WebClient()
    webclient.Headers['Content-type'] = 'text/plain'
    
    if debug:
        
        # simple validation before we send
        try:
            json.loads(stringData)
        except:
            print 'invalid string, revise your string data'
            return
        
        # this will block your process
        data = System.Text.Encoding.Default.GetBytes(stringData)
        webclient.UploadData(url,'POST',data)
        
    else:
        data = System.Text.Encoding.Default.GetBytes(stringData)
        webclient.UploadDataAsync(url,'POST',data)

endpoint = System.Uri('{}/{}'.format(url,path))



postTable(endpoint,jsonString,False)
# rhino crashes using async callbacks,
# so try the following if something is wrong
# postData(endpoint,jsonString,debug=True)
# ---------- end send_table_data ----------
Y_5 = UnitY(Factor=division_9)
Y_6 = UnitY(Factor=division_10)
division_11 = Division(A=number_slider_33, B=3)
division_12 = Division(A=number_slider_33, B=3)
pt_60 = Point(<point referenced from the Rhino model>)  # disabled
pt_61 = Point(<point referenced from the Rhino model>)  # disabled
pt_62 = Point(<point referenced from the Rhino model>)  # disabled
pt_63 = Point(<point referenced from the Rhino model>)
move_6 = Move(Geometry=rotate_2.Geometry, Motion=vec2pt_3.Vector)  # -> Geometry, Transform
graft_2 = GraftTree(Tree=move_6.Transform, IncludeEmptyLists=True, IncludeNullItems=True)
comp = Compound(Transforms=[graft, graft_2])
transform = Transform(Geometry=xy, Transform=comp)
pshift_29 = ShiftPaths(Data=transform, Offset=-1)

# ---- group: people dots base plans
pln_2 = Plane(pshift_29)

# ---- group: block #
lng_4 = ListLength(List=pln_2)

# ---- group: seed d
random = Random(Range=Domain(0, 10000), Number=lng_4, Seed=number_slider_3)  # disabled

# ---- group: seed r
random_2 = Random(Range=Domain(0, 10000), Number=lng_4, Seed=number_slider_4)  # disabled

# ---- group: seed d
random_3 = Random(Range=Domain(0, 10000), Number=lng_4, Seed=number_slider_5)  # disabled

random_4 = Random(Range=Domain(0, 10000), Number=lng_4, Seed=number_slider_6)  # disabled

# ---- group: seed r
random_5 = Random(Range=Domain(0, 10000), Number=lng_4, Seed=number_slider_7)  # disabled

random_6 = Random(Range=Domain(0, 10000), Number=lng_4, Seed=number_slider_8)  # disabled

# ----
pshift_30 = ShiftPaths(Data=random_2, Offset=-1)  # disabled
pshift_31 = ShiftPaths(Data=random, Offset=-1)  # disabled
pshift_32 = ShiftPaths(Data=random_5, Offset=-1)  # disabled
pshift_33 = ShiftPaths(Data=random_6, Offset=-1)  # disabled
pshift_34 = ShiftPaths(Data=random_3, Offset=-1)  # disabled
pshift_35 = ShiftPaths(Data=random_4, Offset=-1)  # disabled
or = GateOr(A=equals_18.Equality, B=equals_17.Equality)
Y_7 = UnitY(Factor=division_11)
Y_8 = UnitY(Factor=division_12)

# ---- group: amenities
tag_4 = TextTag3D(Location=pt_60, Text=item_24, Size=number_slider_34, Colour=swatch_3, Justification=5)  # disabled

# ---- group: google map
tag_5 = TextTag3D(Location=pt_61, Text=item_25, Size=number_slider_34, Colour=swatch_3, Justification=5)  # disabled

# ---- group: human interaction
tag_6 = TextTag3D(Location=pt_62, Text=item_26, Size=number_slider_34, Colour=swatch_3, Justification=5)  # disabled

# ---- group: transportation mode
tag_7 = TextTag3D(Location=pt_63, Text=item_27, Size=number_slider_34, Colour=swatch_3, Justification=5)

# ----
panel_61 = Panel(send_table_data)
dispatch_7 = Dispatch(List=pt_46, DispatchPattern=or)  # -> ListA, ListB
neg_7 = Negative(Value=number_slider_33)
division_13 = Division(A=neg_7, B=1.5)
Y_9 = UnitY(Factor=division_13)
division_14 = Division(A=number_slider_33, B=1.5)

# ---- group: road center pts
pt_64 = Point(dispatch_7.ListA)

# ---- group: road mesh final!
mesh_36 = Mesh(python_12.allRoadMesh)

# ----
Y_10 = UnitY(Factor=division_14)

# ---- group: center line mesh final!
mesh_37 = Mesh(python_13.allRoadMesh)

# ---- group: building lego modules
mesh_38 = Mesh(move_6.Geometry)

# ---- group: blank
mesh_39 = Mesh(move_5.Geometry)

# ---- group: sidewalk mesh final!
mesh_40 = Mesh(python_14.allRoadMesh)

# ----
easter_eggs = EasterEggs(L=pt_46, A_2=int_79, shrink=num_19, L_2=pt_46, A=int_79, shrink_2=num_19)  # disabled
udp_sender = UDPSender(Data=txt_34, IPAddressOfUDPServer="127.0.0.1", UDPPort="7002")
udp_sender_2 = UDPSender(Data=txt_34, IPAddressOfUDPServer="127.0.0.1", UDPPort="9000")
X = UnitX(Factor=5)
X_2 = UnitX(Factor=5)
filter_28 = StreamFilter(Gate=show_google_map, Stream0=mesh_38)
filter_29 = StreamFilter(Gate=show_google_map, Stream0=mesh_36)
filter_30 = StreamFilter(Gate=show_google_map, Stream0=mesh_37)
filter_31 = StreamFilter(Gate=show_google_map, Stream0=mesh_39)
udp = UDPReceiver(Address="127.0.0.1", Port="9001", Pattern=0)  # -> Info, Data

# ---- group: json string received
txt_35 = Text(udp.Data)

# ---- group: json parsor python script by Ryan Zhang
json_parsor = PythonScript(jsonString=txt_35)  # -> out, types, xs, ys, rots, traffics, waits, densities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
# ---------- json_parsor: Python ----------
import json

data  = json.loads(jsonString)

grid = data['grid']
#print str(grid)
rots = []
types = []
xs = []
ys = []
traffics = []
waits = []
for cell in grid:
    #print cell
    rot = cell['rot']
    type = cell['type']
    x = cell['x']
    y = cell['y']
    if type == 6: 
        #print "is road!"
        dataResult = cell['data']
        #print dataResult
        traffic = float(dataResult['traffic'])
        #print traffic
        wait = float(dataResult['wait'])
        #print wait
    else:
        #print "is NOT road!"
        traffic = -1.0
        wait = -1.0
    #print traffic
    #print wait
    rots.append(rot)
    types.append(type)
    xs.append(x)
    ys.append(y)
    traffics.append(traffic)
    waits.append(wait)
#print rots
#print types
#print xs
#print ys
#print traffics
#print waits

objects = data['objects']
#print str(objects)
densities = objects['density']
#print str(densities)
"""
objectsData = objects['data']
#print str(objectsData)
total = int(objectsData['total'])
totalStr = "total trip: "+str(objectsData['total'])
completed = int(objectsData['completed'])
missedStr = "missed trip: "+str(objectsData['missed'])
completeRateStr = "complete rate: "+str(int(float(completed)/float(total)*100.0))+"%"
finishedStr = "is sim finished: "+str(bool(int(objectsData['finished'])))
fleetStr = "fleet number: "+str(objectsData['fleet'])
maxWaitStr = "max wait: "+str(objectsData['max_wait'])
populationStr = "population: "+str(objectsData['population'])
"""
# ---------- end json_parsor ----------

# ---- group: traffic value
num_23 = Number(json_parsor.traffics)

# ---- group: waiting time value
num_24 = Number(json_parsor.waits)

# ---- group: rotation
num_25 = Number(json_parsor.rots)

# ---- group: x
num_26 = Number(json_parsor.xs)

# ---- group: y
num_27 = Number(json_parsor.ys)

# ---- group: density list
num_28 = Number(json_parsor.densities)

# ---- group: type / module id
int_90 = Integer(json_parsor.types)

# ----
panel_62 = Panel(int_90)
subtraction_6 = Subtraction(A=subtraction_2, B=num_26)

# ---- group: x flipped
num_29 = Number(subtraction_6)

# ----
modulecenter_2 = ModuleCenter(pt=pt_33, num=num_22, int_2=num_29, int=num_27)  # -> pt_5, transform_2

# ---- group: module center
pt_65 = Point(modulecenter_2.pt_5)

# ----
equals_19 = Equality(FirstNumber=int_90, SecondNumber="6")  # -> Equality, Inequality

# ---- group: isRoad
bool_23 = Boolean(equals_19.Equality)

# ----
dispatch_8 = Dispatch(List=pt_65, DispatchPattern=bool_23)  # -> ListA, ListB

# ---- group: module center road only
pt_66 = Point(dispatch_8.ListA)

# ----
vec2pt_4 = Vector2Pt(PointA=Point(0, 0, 0), PointB=pt_66, Unitize=False)  # -> Vector, Length
move_7 = Move(Geometry=mesh_17, Motion=vec2pt_4.Vector)  # -> Geometry, Transform

# ---- group: mesh srfs at module centers
mesh_41 = Mesh(move_7.Geometry)

# ----
item_28 = ListItem(List=pt_66, Index=number_slider_27, Wrap=False)  # disabled
dispatch_9 = Dispatch(List=num_23, DispatchPattern=bool_23)  # -> ListA, ListB
dispatch_10 = Dispatch(List=num_24, DispatchPattern=bool_23)  # -> ListA, ListB
dispatch_11 = Dispatch(List=num_23, DispatchPattern=bool_23)  # -> ListA, ListB

# ---- group: traffic value - road
num_30 = Number(dispatch_9.ListA)

# ----
bnd = Bounds(Numbers=num_30)
panel_63 = Panel(bnd)

# ---- group: wait value - road
num_31 = Number(dispatch_10.ListA)

# ----
bnd_2 = Bounds(Numbers=num_31)
panel_64 = Panel(bnd_2)
remap_2 = RemapNumbers(Value=num_30, Source="0.0 to 14000", Target=Domain(0, 1))  # -> Mapped, Clipped
remap_3 = RemapNumbers(Value=num_31, Source="0.0 to 12000", Target=Domain(0, 1))  # -> Mapped, Clipped

# ---- group: traffic value road only
num_32 = Number(dispatch_11.ListA)

# ---- group: traffic value - normalized
num_33 = Number(remap_2.Mapped)

# ---- group: wait value - normalized
num_34 = Number(remap_3.Mapped)

# ----
gradient_8 = Gradient(LowerLimit=0, UpperLimit=1, Parameter=num_33, stops=[0: RGB(0, 128, 0), 0.5: RGB(222, 222, 0), 1: RGB(255, 0, 0)])
gradient_9 = Gradient(LowerLimit=0, UpperLimit=1, Parameter=num_34, stops=[0: RGB(0, 128, 0), 0.5: RGB(222, 222, 0), 1: RGB(255, 0, 0)])
argb_6 = SplitARGB(Colour=gradient_8)  # -> Alpha, Red, Green, Blue
argb_7 = SplitARGB(Colour=gradient_9)  # -> Alpha, Red, Green, Blue
frgb_13 = ColourRGBF(Alpha=number_slider_31, Red=argb_6.Red, Green=argb_6.Green, Blue=argb_6.Blue)
frgb_14 = ColourRGBF(Alpha=number_slider_31, Red=argb_7.Red, Green=argb_7.Green, Blue=argb_7.Blue)

# ---- group: road color - wait
col_30 = Colour(frgb_14)

# ---- group: road color - traffic
col_31 = Colour(frgb_13)

# ---- group: traffic
preview_7 = CustomPreview(Geometry=mesh_41, Shader=col_31)

# ----
filter_32 = StreamFilter(Gate=show_google_map, Stream0=mesh_40)

# ---- group: slider1
# Slider
num_35 = Number(num_8)

# ----
num_36 = Number(num_9)
num_37 = Number(num_9)
col_32 = Colour(off_cold_2)
col_33 = Colour(res_warm_2)
range = Range(Domain="1 to 30", Steps=100)
multiplication_18 = Multiplication(A=num_35, B=100)
panel_65 = Panel(udp.Data)
int_91 = Integer(range)
txt_36 = Text(int_91)
int_92 = Integer(multiplication_18)

# ---- group: to calebrate - select all and ctl+E / road mesh final!
mesh_42 = Mesh(filter_29)

# ---- group: to calebrate - select all and ctl+E / center line mesh final!
mesh_43 = Mesh(filter_30)

# ---- group: center line mesh final!
# Traffic Heatmap - Ryan
mesh_44 = Mesh(mesh_43)

# ----
mjoin_2 = MeshJoin(Meshes=mesh_44)
pshift_36 = ShiftPaths(Data=mesh_44, Offset=-3)
area_2 = Area(Geometry=pshift_36)  # -> Area, Centroid

# ---- group: center pts
pt_67 = Point(area_2.Centroid)

# ----
cps = ClosestPoints(Point=pt_67, Cloud=pt_27, Count=1)  # -> ClosestPoint, CPIndex, Distance
pshift_37 = ShiftPaths(Data=cps.ClosestPoint, Offset=-1)
dist_2 = Distance(PointA=graft(pshift_37), PointB=crossings)
bnd_3 = Bounds(Numbers=dist_2)
dedomain = DeconstructDomain(Domain=bnd_3)  # -> Start, End
pshift_38 = ShiftPaths(Data=dedomain.Start, Offset=-1)

# ---- group: min dis to intersections
num_38 = Number(pshift_38)

# ----
bnd_4 = Bounds(Numbers=num_38)
remap_4 = RemapNumbers(Value=num_38, Source=bnd_4, Target=Domain(0, 1))  # -> Mapped, Clipped
subtraction_7 = Subtraction(A=1, B=remap_4.Mapped)
graph = GraphMapper(
    subtraction_7,
    x0=0,
    x1=1,
    y0=0,
    y1=0.5,
    container_name="Bezier",
    cpx=[0, 0.1613658518, 0.7159118652, 1],
    cpy=[0, 0.3613502979, 0.9704423547, 1])

# ---- group: to calebrate - select all and ctl+E / building lego modules
mesh_45 = Mesh(filter_28)

# ---- group: to calebrate - select all and ctl+E / blank
mesh_46 = Mesh(filter_31)

# ---- group: to calebrate - select all and ctl+E / sidewalk mesh final!
mesh_47 = Mesh(filter_32)

# ----
item_29 = ListItem(List=txt_36, Index=int_92, Wrap=True)
pt_68 = Point(<point referenced from the Rhino model>)

# ---- group: fl # slider
tag_8 = TextTag3D(Location=pt_68, Text=item_29, Size=number_slider_34, Colour=swatch_3, Justification=8)

# ----
number_slider_35 = Slider(10, range=10..100)

# ---- group: total parking cell number
# Parking & Park
int_93 = Integer(parking_cell)

# ---- group: cell size
num_39 = Number(division_5)

# ---- group: module id
int_94 = Integer(int_45)

# ---- group: meshes lego ref: parking
mesh_48 = Mesh(<mesh referenced from the Rhino model>)

# ---- group: blank modules
mesh_49 = Mesh(mesh_39)

# ---- group: meshes lego ref: park
mesh_50 = Mesh(<mesh referenced from the Rhino model>)

# ---- group: total park cell number
int_95 = Integer(park_cell)

# ----
planesrf_3 = PlaneSurface(Plane=pln, XSize=Domain(0, 1000), YSize=Domain(-1000, 0))  # disabled

# ---- group: toggle3
# Amenity Map @ Lego
bool_24 = Boolean(bool_21)  # disabled

# ----
division_15 = Division(A=num_39, B=2.5)
number_slider_36 = Slider(446, range=0..3000)  # disabled
Z_6 = UnitZ(Factor=number_slider_35)
number_slider_37 = Slider(454, range=0..3000)  # disabled
number_slider_38 = Slider(227, range=0..1000)  # disabled
number_slider_39 = Slider(1569, range=0..3000)  # disabled
number_slider_40 = Slider(-246, range=-1000..2000)  # disabled
number_slider_41 = Slider(-43, range=-1000..2000)  # disabled
swatch_4 = ColourSwatch(SwatchColor=RGBA(0, 0, 0, 0))  # disabled
number_slider_42 = Slider(2.896, range=0..10)  # disabled
number_slider_43 = Slider(4.729, range=0..10)  # disabled
number_slider_44 = Slider(7.537, range=0..10)  # disabled
number_slider_45 = Slider(3.617, range=0..10)  # disabled
number_slider_46 = Slider(7.413, range=0..10)  # disabled
number_slider_47 = Slider(4.411, range=0..10)  # disabled
number_slider_48 = Slider(7.154, range=0..10)  # disabled
number_slider_49 = Slider(3.366, range=0..10)  # disabled
number_slider_50 = Slider(8.088, range=0..10)  # disabled
number_slider_51 = Slider(7.117, range=0..10)  # disabled
number_slider_52 = Slider(8.024, range=0..10)  # disabled
number_slider_53 = Slider(2.242, range=0..10)  # disabled
number_slider_54 = Slider(5.369, range=0..10)  # disabled
number_slider_55 = Slider(10, range=0..10)  # disabled
number_slider_56 = Slider(5.562, range=0..10)  # disabled
number_slider_57 = Slider(6.294, range=0..10)  # disabled
number_slider_58 = Slider(4.872, range=0..10)  # disabled
number_slider_59 = Slider(10, range=0..10)  # disabled
number_slider_60 = Slider(7.199, range=0..10)  # disabled
number_slider_61 = Slider(10, range=0..10)  # disabled
number_slider_62 = Slider(2.242, range=0..10)  # disabled
number_slider_63 = Slider(0.098, range=0..10)  # disabled
number_slider_64 = Slider(9.922, range=0..10)  # disabled
number_slider_65 = Slider(5.939, range=0..10)  # disabled
number_slider_66 = Slider(3.349, range=0..10)  # disabled
number_slider_67 = Slider(2.253, range=0..10)  # disabled
number_slider_68 = Slider(4.332, range=0..10)  # disabled

# ---- group: dockID
int_96 = Integer(int_41)

# ---- group: 3D building site move amount
# 3D City Grid System
panel_66 = Panel("10000")
X_3 = UnitX(Factor=panel_66)

# ---- group: module center
pt_69 = Point(modulecenter.pt_5)

# ----
# On Dashboard
panel_67 = Panel("-1")

# ---- group: x calibration
number_slider_69 = Slider(0.5, range=0..10)  # disabled
X_4 = UnitX(Factor=number_slider_69)  # disabled
move_8 = Move(Geometry=planesrf_3, Motion=X_4)  # -> Geometry, Transform; disabled

# ----
# Activation Mask
# On LEGOs
srf = Surface(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)

# ---- group: module id
int_97 = Integer(int_45)

# ---- group: dockID
int_98 = Integer(int_83)

# ----
neg_8 = Negative(Value=division_15)
msphereex = MeshSphereEx(Base=Z_6, Radius=number_slider_35, Count=Slider(5, range=0..10))

# ---- group: ref mask srf - R
srf_2 = Surface(<surface referenced from the Rhino model>)

# ----
Z_7 = UnitZ(Factor=Slider(6, range=0..10))

# ---- group: ref mask srf - RM
srf_3 = Surface(<surface referenced from the Rhino model>)

# ---- group: ref mask srf - bar live
srf_4 = Surface(<surface referenced from the Rhino model>)

# ---- group: ref mask srf - RS
srf_5 = Surface(<surface referenced from the Rhino model>)

# ---- group: ref mask srf - RL
srf_6 = Surface(<surface referenced from the Rhino model>)

# ----
geobottomcenter = GeoBottomCenter_2(geo=mesh_49)
movetoorgin_3 = MoveToOrgin(G=mesh_48, num=num_19)
movetoorgin_4 = MoveToOrgin(G=mesh_50, num=num_19)
mesh_51 = Mesh(srf)
com = ColourSwatch(SwatchColor=RGB(158, 158, 158))
com_2 = ColourSwatch(SwatchColor=RGB(71, 71, 71))
equals_20 = Equality(FirstNumber=int_98, SecondNumber=panel_67)  # -> Equality, Inequality
res = ColourSwatch(SwatchColor=RGB(212, 212, 212))
move_9 = Move(Geometry=msphereex, Motion=Z_7)  # -> Geometry, Transform
res_2 = ColourSwatch(SwatchColor=RGB(76, 76, 76))
number_slider_70 = Slider(6.1, range=0..100)  # disabled
equals_21 = Equality(FirstNumber=int_97, SecondNumber=int_98)  # -> Equality, Inequality

# ---- group: module center
pt_70 = Point(pt_46)

# ---- group: blank
mesh_52 = Mesh(mesh_39)

# ----
Z_8 = UnitZ(Factor=Slider(6.2, range=0..10))
lng_5 = ListLength(List=geobottomcenter)

# ---- group: sidewalk mesh final!
mesh_53 = Mesh(python_14.allRoadMesh)

# ---- group: road mesh final!
mesh_54 = Mesh(mesh_42)

# ----
larger_2 = LargerThan(FirstNumber=int_94, SecondNumber="0")  # -> LargerThan, OrEqualTo
smaller_3 = SmallerThan(FirstNumber=int_94, SecondNumber="5")  # -> SmallerThan, OrEqualTo
equals_22 = Equality(FirstNumber=int_96, SecondNumber="1")  # -> Equality, Inequality
equals_23 = Equality(FirstNumber=int_96, SecondNumber="2")  # -> Equality, Inequality
and_2 = GateAnd(A=equals_23.Inequality, B=equals_22.Inequality)
equals_24 = Equality(FirstNumber=int_96, SecondNumber="0")  # -> Equality, Inequality
vec_2 = Vector(X_3)
# Radar Chart (Carson)
panel_68 = Panel("""Diversity
Density
Approximity
Health
Life Quality
Traffic
Energy
Education
Invation""")  # disabled
panel_69 = Panel([number_slider_50, number_slider_51, number_slider_52, number_slider_53, number_slider_54, number_slider_55, number_slider_56, number_slider_57, number_slider_58])  # disabled
panel_70 = Panel([number_slider_59, number_slider_60, number_slider_61, number_slider_62, number_slider_63, number_slider_64, number_slider_65, number_slider_66, number_slider_67])  # disabled
and_3 = GateAnd(A=and_2, B=equals_24.Inequality)
panel_71 = Panel("""Res. Small
Density
Approximity
Health
Life Quality
Traffic
Energy
Education
Invation""")  # disabled
panel_72 = Panel([number_slider_42, number_slider_68, number_slider_43, number_slider_44, number_slider_45, number_slider_46, number_slider_47, number_slider_48, number_slider_49])  # disabled
tree_scale = Slider(0.81, range=0.5..2)
Z_9 = UnitZ(Factor=number_slider_70)  # disabled
move_10 = Move(Geometry=move_8.Geometry, Motion=Z_9)  # -> Geometry, Transform; disabled
equals_25 = Equality(FirstNumber=int_96, SecondNumber="-1")  # -> Equality, Inequality
mcol_2 = MeshColours(Mesh=move_9.Geometry, Colours=park)
swatch_5 = ColourSwatch(SwatchColor=RGBA(189, 189, 189, 159))  # disabled
swatch_6 = ColourSwatch(SwatchColor=RGBA(20, 106, 255, 194))  # disabled
swatch_7 = ColourSwatch(SwatchColor=RGBA(253, 0, 244, 237))  # disabled
merge_10 = Merge(Data1=res, Data2=res, Data3=res, Data4=com, Data5=com, Data6=com)
merge_11 = Merge(Data1=res_2, Data2=res_2, Data3=res_2, Data4=com_2, Data5=com_2, Data6=com_2)
division_16 = Division(A=int_93, B=lng_5)
and_4 = GateAnd(A=equals_22.Inequality, B=equals_25.Inequality)
and_5 = GateAnd(A=equals_23.Inequality, B=equals_25.Inequality)
and_6 = GateAnd(A=equals_24.Inequality, B=equals_25.Inequality)

# ---- group: module meshes lego at orgin
mesh_55 = Mesh(movetoorgin_3)

# ----
move_11 = Move(Geometry=mesh_51, Motion=Z_8)  # -> Geometry, Transform
and_7 = GateAnd(A=larger_2.OrEqualTo, B=smaller_3.OrEqualTo)

# ---- group: module meshes lego at orgin
mesh_56 = Mesh(movetoorgin_4)

# ----
and_8 = GateAnd(A=and_3, B=equals_25.Inequality)

# ---- group: mask settings
swatch_8 = ColourSwatch(SwatchColor=RGB(0, 0, 0))
panel_73 = Panel(".35")
path_3 = FilePath("C:\Users\RYAN\Documents\GitHub\CityMatrix\Map\MAP_BLACK.png")

# ----
filter_33 = StreamFilter(Gate=bool_24, Stream1=move_10.Geometry)  # disabled
dispatch_12 = Dispatch(List=pt_69, DispatchPattern=equals_21.Inequality)  # -> ListA, ListB
swatch_9 = ColourSwatch(SwatchColor=RGB(255, 255, 255))  # disabled
panel_74 = Panel("C:\Users\RYAN\Documents\GitHub\CityMatrix\Map\Amenities Maps\Amenities_Trans.png")  # disabled
panel_75 = Panel("0.01")  # disabled
randomsplit = RandomSplitList(MasterList=geobottomcenter, Seed=Slider(32, range=0..100), Split=division_16)  # -> ListA, ListB
lng_6 = ListLength(List=randomsplit.ListA)
division_17 = Division(A=int_95, B=lng_6)

# ---- group: meshes 3D ref: Tree
mesh_57 = Mesh(mcol_2)

# ---- group: is building or not
bool_25 = Boolean(and_7)

# ----
filter_34 = StreamFilter(Gate=and_4, Stream1=srf_3)
filter_35 = StreamFilter(Gate=and_8, Stream1=srf_4)
filter_36 = StreamFilter(Gate=and_5, Stream1=srf_5)
filter_37 = StreamFilter(Gate=and_6, Stream1=srf_6)
filter_38 = StreamFilter(Gate=and_8, Stream1=srf_2)
merge_12 = Merge(Data1=merge_10, Data2=merge_11)
randomsplit_2 = RandomSplitList(MasterList=randomsplit.ListA, Seed=Slider(25, range=0..100), Split=division_17)  # -> ListA, ListB

# ---- group: mask setting
swatch_10 = ColourSwatch(SwatchColor=RGBA(0, 0, 0, 185))

# ----
dom_5 = ConstructDomain(DomainStart=neg_8, DomainEnd=division_15)
vec2pt_5 = Vector2Pt(PointA=Point(0, 0, 0), PointB=dispatch_12.ListA, Unitize=False)  # -> Vector, Length

# ---- group: cell size
num_40 = Number(division_5)

# ---- group: cell area
sqr = Square(Value=num_40)

# ----
multiplication_19 = Multiplication(A=sqr, B=number_slider_9)
num_41 = Number(multiplication_19)

# ---- group: ppl per m2
multiplication_20 = Multiplication(A=num_41, B="0.018181")
multiplication_21 = Multiplication(A=num_41, B="0.05454")
multiplication_22 = Multiplication(A=num_41, B="0.0666667")
multiplication_23 = Multiplication(A=num_41, B="0.01123")
multiplication_24 = Multiplication(A=num_41, B="0.2")
multiplication_25 = Multiplication(A=num_41, B="0.0337")

# ---- group: ppl per flr
panel_76 = Panel(multiplication_23)
panel_77 = Panel(multiplication_20)
panel_78 = Panel(multiplication_22)
panel_79 = Panel(multiplication_25)
panel_80 = Panel(multiplication_21)
panel_81 = Panel(multiplication_24)

# ----
multiplication_26 = Multiplication(A=panel_80, B=multiplication_9)
multiplication_27 = Multiplication(A=panel_77, B=multiplication_10)
multiplication_28 = Multiplication(A=panel_78, B=multiplication_12)
multiplication_29 = Multiplication(A=panel_81, B=multiplication_11)
multiplication_30 = Multiplication(A=panel_79, B=multiplication_13)
multiplication_31 = Multiplication(A=panel_76, B=multiplication_14)

# ---- group: RS
num_42 = Number(multiplication_22)

num_43 = Number(num_42)

# ---- group: OL
num_44 = Number(multiplication_25)

num_45 = Number(num_44)

# ---- group: OS
num_46 = Number(multiplication_24)

num_47 = Number(num_46)

# ---- group: OM
num_48 = Number(multiplication_21)

num_49 = Number(num_48)

# ---- group: RM
num_50 = Number(multiplication_20)

num_51 = Number(num_50)

# ---- group: RL
num_52 = Number(multiplication_23)

num_53 = Number(num_52)

# ---- group: ppl per flr
# id5
# id3
# id4
# id0
# id2
# id1
# young
# mid
# old
panel_82 = Panel("0")
panel_83 = Panel("6")
panel_84 = Panel("7")
panel_85 = Panel("8")
panel_86 = Panel("9")
panel_87 = Panel("10")
panel_88 = Panel("11")
num_54 = Number(["0", num_51, "0", "0", num_49, "0"])
num_55 = Number([num_53, "0", "0", num_45, "0", "0"])
num_56 = Number([panel_82, "0", num_43, "0", "0", num_47])

# ----
multiplication_32 = Multiplication(A=num_56, B=number_slider_13)
multiplication_33 = Multiplication(A=num_54, B=number_slider_13)
multiplication_34 = Multiplication(A=num_55, B=number_slider_13)
num_57 = Number(multiplication_32)
num_58 = Number(multiplication_33)
num_59 = Number(multiplication_34)
item_30 = ListItem(List=num_59, Index=graft(int_89), Wrap=True)
item_31 = ListItem(List=num_57, Index=graft(int_89), Wrap=True)
item_32 = ListItem(List=num_58, Index=graft(int_89), Wrap=True)
pshift_39 = ShiftPaths(Data=item_30, Offset=-1)
pshift_40 = ShiftPaths(Data=item_31, Offset=-1)
pshift_41 = ShiftPaths(Data=item_32, Offset=-1)

# ---- group: Regular Office ppl #
int_99 = Integer(multiplication_26)

# ---- group: Head Quater ppl #
int_100 = Integer(multiplication_30)

# ---- group: Co-working ppl #
int_101 = Integer(multiplication_29)

# ---- group: Micro-unit ppl #
int_102 = Integer(multiplication_28)

# ---- group: Luxury ppl #
int_103 = Integer(multiplication_31)

# ---- group: Regular residential ppl #
int_104 = Integer(multiplication_27)

# ---- group: old per flr
num_60 = Number(pshift_39)

# ---- group: young per flr
num_61 = Number(pshift_40)

# ---- group: mid per flr
num_62 = Number(pshift_41)

# ----
multiplication_35 = Multiplication(A=num_62, B=txt_27)
multiplication_36 = Multiplication(A=num_61, B=txt_27)
multiplication_37 = Multiplication(A=num_60, B=txt_27)
ma_9 = MassAddition(Input=[int_101, int_99, int_100])  # -> Result, PartialResults
ma_10 = MassAddition(Input=[int_102, int_104, int_103])  # -> Result, PartialResults

# ---- group: total ppl in building mid
int_105 = Integer(multiplication_35)

# ---- group: d
random_7 = Random(Range=Domain(0, 1), Number=int_105, Seed=pshift_34)  # disabled

# ---- group: r
random_8 = Random(Range=Domain(0, 360), Number=int_105, Seed=pshift_32)  # disabled

# ----
graph_2 = GraphMapper(
    random_7,
    x0=0,
    x1=1,
    y0=0,
    y1=1,
    container_name="Bezier",
    cpx=[0, 0.3430397809, 1, 1],
    cpy=[0, 0.5653408766, 0.3680863976, 1])  # disabled
rad = Radians(Degrees=random_8)  # disabled
remap_5 = RemapNumbers(Value=graph_2, Source=Domain(0, 1), Target=dom_2)  # -> Mapped, Clipped; disabled
pt_71 = PointCylindrical(BasePlane=graft(pln_2), Angle=rad, Radius=remap_5.Mapped, Elevation=0)  # disabled
pshift_42 = ShiftPaths(Data=pt_71, Offset=-1)  # disabled
pdecon_12 = Deconstruct(Point=pshift_42)  # -> XComponent, YComponent, ZComponent; disabled
inc = Includes(Value=pdecon_12.YComponent, Domain=Domain(0, 1000))  # -> Includes, Deviation; disabled
inc_2 = Includes(Value=pdecon_12.XComponent, Domain=Domain(0, 1000))  # -> Includes, Deviation; disabled
and_9 = GateAnd(A=inc_2.Includes, B=inc.Includes)  # disabled
dispatch_13 = Dispatch(List=pshift_42, DispatchPattern=and_9)  # -> ListA, ListB; disabled
pt_72 = Point(dispatch_13.ListA)  # disabled
rnd_reduce_by_ratio = RndReduceByRatio(L=pt_72, B=number_slider_14, S=number_slider_17)  # disabled
pt_73 = Point(rnd_reduce_by_ratio)  # disabled
move_12 = Move(Geometry=mesh_11, Motion=pt_73)  # -> Geometry, Transform; disabled
mjoin_3 = MeshJoin(Meshes=move_12.Geometry)  # disabled

# ---- group: total ppl in building young
int_106 = Integer(multiplication_36)

# ---- group: d
random_9 = Random(Range=Domain(0, 1), Number=int_106, Seed=pshift_31)  # disabled

# ---- group: r
random_10 = Random(Range=Domain(0, 360), Number=int_106, Seed=pshift_30)  # disabled

# ----
graph_3 = GraphMapper(
    random_9,
    x0=0,
    x1=1,
    y0=0,
    y1=1,
    container_name="Bezier",
    cpx=[0, 0.2763824463, 1, 1],
    cpy=[0, 0.2786865234, 0.3680863976, 1])  # disabled
rad_2 = Radians(Degrees=random_10)  # disabled
remap_6 = RemapNumbers(Value=graph_3, Source=Domain(0, 1), Target=dom)  # -> Mapped, Clipped; disabled
pt_74 = PointCylindrical(BasePlane=graft(pln_2), Angle=rad_2, Radius=remap_6.Mapped, Elevation=0)  # disabled
pshift_43 = ShiftPaths(Data=pt_74, Offset=-1)  # disabled
pdecon_13 = Deconstruct(Point=pshift_43)  # -> XComponent, YComponent, ZComponent; disabled
inc_3 = Includes(Value=pdecon_13.YComponent, Domain=Domain(0, 1000))  # -> Includes, Deviation; disabled
inc_4 = Includes(Value=pdecon_13.XComponent, Domain=Domain(0, 1000))  # -> Includes, Deviation; disabled
and_10 = GateAnd(A=inc_4.Includes, B=inc_3.Includes)  # disabled
dispatch_14 = Dispatch(List=pshift_43, DispatchPattern=and_10)  # -> ListA, ListB; disabled
pt_75 = Point(dispatch_14.ListA)  # disabled
rnd_reduce_by_ratio_2 = RndReduceByRatio(L=pt_75, B=number_slider_14, S=number_slider_15)  # disabled
addition_6 = Addition(A=int_106, B=int_105)
pt_76 = Point(rnd_reduce_by_ratio_2)  # disabled
move_13 = Move(Geometry=mesh_9, Motion=pt_76)  # -> Geometry, Transform; disabled
mjoin_4 = MeshJoin(Meshes=move_13.Geometry)  # disabled

# ---- group: total ppl in building old
int_107 = Integer(multiplication_37)

# ---- group: d
random_11 = Random(Range=Domain(0, 1), Number=int_107, Seed=pshift_35)  # disabled

# ---- group: r
random_12 = Random(Range=Domain(0, 360), Number=int_107, Seed=pshift_33)  # disabled

# ----
graph_4 = GraphMapper(
    random_11,
    x0=0,
    x1=1,
    y0=0,
    y1=1,
    container_name="Bezier",
    cpx=[0, 0.2961647809, 0.9886363745, 1],
    cpy=[0, 0.6839488745, 0.5063920021, 1])  # disabled
rad_3 = Radians(Degrees=random_12)  # disabled
remap_7 = RemapNumbers(Value=graph_4, Source=Domain(0, 1), Target=dom_3)  # -> Mapped, Clipped; disabled
pt_77 = PointCylindrical(BasePlane=graft(pln_2), Angle=rad_3, Radius=remap_7.Mapped, Elevation=0)  # disabled
pshift_44 = ShiftPaths(Data=pt_77, Offset=-1)  # disabled
pdecon_14 = Deconstruct(Point=pshift_44)  # -> XComponent, YComponent, ZComponent; disabled
inc_5 = Includes(Value=pdecon_14.YComponent, Domain=Domain(0, 1000))  # -> Includes, Deviation; disabled
inc_6 = Includes(Value=pdecon_14.XComponent, Domain=Domain(0, 1000))  # -> Includes, Deviation; disabled
and_11 = GateAnd(A=inc_6.Includes, B=inc_5.Includes)  # disabled
dispatch_15 = Dispatch(List=pshift_44, DispatchPattern=and_11)  # -> ListA, ListB; disabled
pt_78 = Point(dispatch_15.ListA)  # disabled
rnd_reduce_by_ratio_3 = RndReduceByRatio(L=pt_78, B=number_slider_14, S=number_slider_19)  # disabled
pt_79 = Point(rnd_reduce_by_ratio_3)  # disabled
move_14 = Move(Geometry=mesh_10, Motion=pt_79)  # -> Geometry, Transform; disabled
addition_7 = Addition(A=addition_6, B=int_107)
mjoin_5 = MeshJoin(Meshes=move_14.Geometry)  # disabled

# ---- group: total ppl in building - all
int_108 = Integer(addition_7)

# ----
mcol_3 = MeshColours(Mesh=mjoin_4, Colours=mln_young)  # disabled
mcol_4 = MeshColours(Mesh=mjoin_5, Colours=exc_elderly)  # disabled
mcol_5 = MeshColours(Mesh=mjoin_3, Colours=mid_mid_career)  # disabled

# ---- group: total working ppl #
int_109 = Integer(ma_9.Result)

# ----
preview_8 = CustomPreview(Geometry=pt_73, Shader=mid_mid_career)  # disabled

# ---- group: total residential ppl #
int_110 = Integer(ma_10.Result)

# ----
preview_9 = CustomPreview(Geometry=pt_79, Shader=exc_elderly)  # disabled
filter_39 = StreamFilter(Gate=bool_20, Stream1=mcol_3)  # disabled
filter_40 = StreamFilter(Gate=bool_20, Stream1=mcol_4)  # disabled
preview_10 = CustomPreview(Geometry=pt_76, Shader=mln_young)  # disabled
filter_41 = StreamFilter(Gate=bool_20, Stream1=mcol_5)  # disabled
addition_8 = Addition(A=int_110, B=int_109)

# ---- group: old ppl dots mesh
mesh_58 = Mesh(filter_40)  # disabled

# ---- group: mid ppl dots mesh
mesh_59 = Mesh(filter_41)  # disabled

# ---- group: young ppl dots mesh
mesh_60 = Mesh(filter_39)  # disabled

# ---- group: total ppl #
int_111 = Integer(addition_8)

# ----
panel_89 = Panel(int_111)
nullrep_5 = ReplaceNulls(Items=int_110, Replacements=0)  # -> Items, Count
nullrep_6 = ReplaceNulls(Items=int_103, Replacements=0)  # -> Items, Count
nullrep_7 = ReplaceNulls(Items=int_102, Replacements=0)  # -> Items, Count
nullrep_8 = ReplaceNulls(Items=int_104, Replacements=0)  # -> Items, Count
max = Maximum(A=nullrep_5.Items, B=ttl_min)
ppl_by_id = GhPythonScript(inL=id_replace.outPanelList, id0=num_53, id1=num_51, id2=num_43, id3=num_45, id4=num_49, id5=num_47)  # -> out, outL; inputs inL: list
# ---------- ppl_by_id: Python ----------
__author__ = "sunt"
__version__ = "2018.06.01"

import rhinoscriptsyntax as rs

outL = inL[:]

replaceDict ={0:id0,1:id1,2:id2,3:id3,4:id4,5:id5,6:0}

for item in range(len(outL)):
    outL[item] = int(replaceDict.get(outL[item],outL[item]))

    
print(outL)
# ---------- end ppl_by_id ----------
max_2 = Maximum(A=nullrep_6.Items, B=type_min)
max_3 = Maximum(A=nullrep_8.Items, B=type_min)
max_4 = Maximum(A=nullrep_7.Items, B=type_min)

# ---- group: R
int_112 = Integer(max)

# ---- group: RL
int_113 = Integer(max_2)

# ---- group: RM
int_114 = Integer(max_3)

# ---- group: RS
int_115 = Integer(max_4)

# ----
traffic_by_id = GhPythonScript(inL=ppl_by_id.outL, xExt=grid_x_extent, yExt=grid_y_extent, cellSize=cell_size_2)  # -> out, outL; inputs inL: tree, xExt: Int32; disabled
# ---------- traffic_by_id: Python ----------
"""Provides a scripting component.
    Inputs:
        centroid: Building's centroid point (area)
        floors: the number of floor
        grid: The gird
        cellSize: the size of the grid cell
        
    Output:
        a: The a output variable"""

__author__ = "sunt"
__version__ = "2018.05.28"

import rhinoscriptsyntax as rs
import math
import Grasshopper as gh

xExt = int(xExt)
yExt = int(yExt)

midL = [[0 for x in range(xExt)] for y in range(yExt)]
outL = [[0 for x in range(xExt)] for y in range(yExt)]

print(outL)
print(inL.Branch(0)[0])




for bldgY in range(yExt):
    for bldgX in range(xExt):
        if float(inL.Branch(bldgY)[bldgX]) == 0:
            trafInd = 0
            for y in range(int(bldgY-2), int(bldgY+3)):
                for x in range(int(bldgX-2), int(bldgX+3)):
                    if 0<=x and x<xExt and 0<=y and y<yExt:
                        if bldgY-y == 2 or bldgY-y == -2 or bldgX-x == 2 or bldgX-x == -2:
                            trafInd += 0.5* float(inL.Branch(y)[x])
                        else:
                            trafInd += float(inL.Branch(y)[x])
            midL[bldgY][bldgX] = trafInd

for bldgY in range(yExt):
    for bldgX in range(xExt):
        if float(inL.Branch(bldgY)[bldgX]) == 0:
            accInd = midL[bldgY][bldgX]
            for (newY,newX) in [(bldgY-1,bldgX),(bldgY+1,bldgX),(bldgY,bldgX-1),(bldgY,bldgX+1)]:
                if 0<=newX and newX<xExt and 0<=newY and newY<yExt:
                    accInd += midL[newY][newX]*0.5
            outL[bldgY][bldgX] = accInd/10000

print(outL)
# ---------- end traffic_by_id ----------
traffic_by_id_2 = GhPythonScript(inL=ppl_by_id.outL, xExt=grid_x_extent, yExt=grid_y_extent, index=index)  # -> out, outL; inputs inL: tree, xExt: Int32
# ---------- traffic_by_id_2: Python ----------
"""Provides a scripting component.
    Inputs:
        centroid: Building's centroid point (area)
        floors: the number of floor
        grid: The gird
        cellSize: the size of the grid cell
        
    Output:
        a: The a output variable"""

__author__ = "sunt"
__version__ = "2018.05.28"

import rhinoscriptsyntax as rs
import math
import Grasshopper as gh

xExt = int(xExt)
yExt = int(yExt)

midL = [[0 for x in range(xExt)] for y in range(yExt)]
outL = [[0 for x in range(xExt)] for y in range(yExt)]

print(outL)
print(inL.Branch(0)[0])




for bldgY in range(yExt):
    for bldgX in range(xExt):
        if float(inL.Branch(bldgY)[bldgX]) == 0:
            trafInd = 0
            for (newY,newX) in [(bldgY-1,bldgX),(bldgY+1,bldgX),(bldgY,bldgX-1),(bldgY,bldgX+1)]:
                if 0<=newX and newX<xExt and 0<=newY and newY<yExt:
                    trafInd += inL.Branch(newY)[newX]
            midL[bldgY][bldgX] = trafInd

for bldgY in range(yExt):
    for bldgX in range(xExt):
        if float(inL.Branch(bldgY)[bldgX]) == 0:
            accInd = midL[bldgY][bldgX]
            for (newY,newX) in [(bldgY-1,bldgX),(bldgY+1,bldgX),(bldgY,bldgX-1),(bldgY,bldgX+1)]:
                if 0<=newX and newX<xExt and 0<=newY and newY<yExt:
                    accInd += midL[newY][newX]*0.5
            for (newY,newX) in [(bldgY-2,bldgX),(bldgY+2,bldgX),(bldgY,bldgX-2),(bldgY,bldgX+2)]:
                if 0<=newX and newX<xExt and 0<=newY and newY<yExt:
                    accInd += midL[newY][newX]*0.5
            outL[bldgY][bldgX] = accInd/index

print(outL)
# ---------- end traffic_by_id_2 ----------

# ---- group: residential total
tag_9 = TextTag3D(Location=pt_23, Text=int_112, Size=num_11, Colour=col_18, Justification=7)

# ---- group: RL
tag_10 = TextTag3D(Location=pt_25, Text=int_113, Size=num_13, Colour=col_20, Justification=7)

# ---- group: RS
tag_11 = TextTag3D(Location=pt_24, Text=int_115, Size=num_12, Colour=col_19, Justification=7)

# ---- group: RM
tag_12 = TextTag3D(Location=pt_26, Text=int_114, Size=num_14, Colour=col_21, Justification=7)

# ----
nullrep_9 = ReplaceNulls(Items=int_109, Replacements=0)  # -> Items, Count
iron2panel_6 = GhPythonScript(ironList=traffic_by_id_2.outL)  # -> out, panelOut; same code as iron2panel
nullrep_10 = ReplaceNulls(Items=int_100, Replacements=0)  # -> Items, Count
nullrep_11 = ReplaceNulls(Items=int_101, Replacements=0)  # -> Items, Count
max_5 = Maximum(A=nullrep_9.Items, B=ttl_min)
nullrep_12 = ReplaceNulls(Items=int_99, Replacements=0)  # -> Items, Count

# ---- group: O
int_116 = Integer(max_5)

# ---- group: total ppl #
int_117 = Integer(int_111)

# ----
max_6 = Maximum(A=nullrep_11.Items, B=type_min)
max_7 = Maximum(A=nullrep_10.Items, B=type_min)
max_8 = Maximum(A=nullrep_12.Items, B=type_min)

# ---- group: OL
int_118 = Integer(max_7)

# ---- group: OM
int_119 = Integer(max_8)

# ---- group: OS
int_120 = Integer(max_6)

# ----
panel_90 = Panel(iron2panel_6.panelOut)
gradient_10 = Gradient(
    LowerLimit=0.01,
    UpperLimit=1,
    Parameter=panel_90,
    stops=[0.01: RGB(255, 255, 240), 0.5: RGB(255, 255, 0), 1: RGB(255, 0, 0)])
argb_8 = SplitARGB(Colour=gradient_10)  # -> Alpha, Red, Green, Blue
frgb_15 = ColourRGBF(Alpha=Slider(1, range=0..1), Red=argb_8.Red, Green=argb_8.Green, Blue=argb_8.Blue)
col_34 = Colour(frgb_15)

# ---- group: office total
tag_13 = TextTag3D(Location=pt_28, Text=int_116, Size=num_15, Colour=col_22, Justification=7)

# ---- group: OL
tag_14 = TextTag3D(Location=pt_30, Text=int_118, Size=num_17, Colour=col_24, Justification=7)

# ---- group: OS
tag_15 = TextTag3D(Location=pt_29, Text=int_120, Size=num_16, Colour=col_23, Justification=7)

# ---- group: OM
tag_16 = TextTag3D(Location=pt_31, Text=int_119, Size=num_18, Colour=col_25, Justification=7)

# ----
preview_11 = CustomPreview(Geometry=extr, Material=flatten(col_34))  # disabled
mspray = MeshSpray(Mesh=graft(pshift_36), Points=area.Centroid, Colours=flatten(col_34), SprayMode=0)
mjoin_6 = MeshJoin(Meshes=flatten(mspray))
filter_42 = StreamFilter(Gate=show_google_map, Stream0=mjoin_6)

# ---- group: road traffic lego
mesh_61 = Mesh(filter_42)

# ----
addition_9 = Addition(A=int_115, B=int_114)
addition_10 = Addition(A=int_120, B=int_119)
addition_11 = Addition(A=addition_9, B=int_113)
addition_12 = Addition(A=addition_10, B=int_118)
merge_13 = Merge(Data1=_0, Data2=int_115, Data3=addition_9, Data4=addition_11)
merge_14 = Merge(Data1=_0, Data2=int_120, Data3=addition_10, Data4=addition_12)

# ---- group: 0-1
remap_8 = RemapNumbers(Value=merge_13, Source=domain, Target=Domain(0, 1))  # -> Mapped, Clipped

remap_9 = RemapNumbers(Value=merge_14, Source=domain, Target=Domain(0, 1))  # -> Mapped, Clipped

# ----
multiplication_38 = Multiplication(A=remap_9.Mapped, B=subtraction_5)
multiplication_39 = Multiplication(A=remap_8.Mapped, B=subtraction_5)
addition_13 = Addition(A=pdecon_11.XComponent, B=multiplication_39)
addition_14 = Addition(A=pdecon_11.XComponent, B=multiplication_38)
pt_80 = ConstructPoint(XCoordinate=addition_13, YCoordinate=pdecon_11.YComponent, ZCoordinate=0)
move_15 = Move(Geometry=pt_80, Motion=Y_4)  # -> Geometry, Transform
shift_2 = ShiftList(List=move_15.Geometry, Shift=-1, Wrap=False)
pt_81 = ConstructPoint(XCoordinate=addition_14, YCoordinate=pdecon_11.YComponent, ZCoordinate=0)
move_16 = Move(Geometry=pt_81, Motion=Y_3)  # -> Geometry, Transform
shift_3 = ShiftList(List=move_16.Geometry, Shift=-1, Wrap=False)
shift_4 = ShiftList(List=move_16.Geometry, Shift=1, Wrap=False)
shift_5 = ShiftList(List=move_15.Geometry, Shift=1, Wrap=False)

# ---- group: lower v sep ln
line_2 = LineSDL(Start=pt_81, Direction=Y_2, Length=number_slider_33)

# ---- group: upper v sep ln
line_3 = LineSDL(Start=pt_80, Direction=Y, Length=number_slider_33)

# ----
ln_2 = Line(StartPoint=shift_3, EndPoint=shift_4)
ln_3 = Line(StartPoint=shift_2, EndPoint=shift_5)
move_17 = Move(Geometry=ln_2, Motion=Y_5)  # -> Geometry, Transform
move_18 = Move(Geometry=ln_3, Motion=Y_6)  # -> Geometry, Transform

# ---- group: last pt O
item_33 = ListItem(List=pt_81, Index=-1, Wrap=True)

# ---- group: last pt R
item_34 = ListItem(List=pt_80, Index=-1, Wrap=True)

# ----
extr_4 = Extrude(Base=move_17.Geometry, Direction=Y_7)
extr_5 = Extrude(Base=move_18.Geometry, Direction=Y_8)
mesh_62 = Mesh(extr_4)
mesh_63 = Mesh(extr_5)
move_19 = Move(Geometry=item_33, Motion=Y_9)  # -> Geometry, Transform
move_20 = Move(Geometry=item_34, Motion=Y_10)  # -> Geometry, Transform
mspray_2 = MeshSpray(Mesh=graft(mesh_62), Points=Point(0, 0, 0), Colours=graft(merge_7), SprayMode=0)
mspray_3 = MeshSpray(Mesh=graft(mesh_63), Points=Point(0, 0, 0), Colours=graft(merge_7), SprayMode=0)
move_21 = Move(Geometry=move_19.Geometry, Motion=X)  # -> Geometry, Transform
move_22 = Move(Geometry=move_20.Geometry, Motion=X_2)  # -> Geometry, Transform
pshift_45 = ShiftPaths(Data=mspray_2, Offset=-1)
pshift_46 = ShiftPaths(Data=mspray_3, Offset=-1)

# ---- group: all sep lns
crv_2 = Curve([ln, line_3, line_2])

# ----
pt_82 = Point(move_21.Geometry)
pt_83 = Point(move_22.Geometry)

# ---- group: work
tag_17 = TextTag3D(Location=pt_82, Text="work", Size=num_36, Colour=col_32, Justification=4)

# ---- group: live
tag_18 = TextTag3D(Location=pt_83, Text="live", Size=num_37, Colour=col_33, Justification=4)

# ---- group: work
mesh_64 = Mesh(pshift_45)

# ---- group: live
mesh_65 = Mesh(pshift_46)

# ----
preview_12 = CustomPreview(Geometry=crv_2, Shader=col_17)
panel_91 = Panel([panel_72, panel_69])  # disabled
dispatch_16 = Dispatch(List=pt_70, DispatchPattern=bool_25)  # -> ListA, ListB
dispatch_17 = Dispatch(List=int_94, DispatchPattern=bool_25)  # -> ListA, ListB

# ---- group: 3D building site move amount
vec_3 = Vector(X_3)

# ---- group: color for each type
col_35 = Colour(merge_12)

# ----
preview_13 = CustomPreview(Geometry=filter_34, Shader=swatch_10)
preview_14 = CustomPreview(Geometry=filter_35, Shader=swatch_10)
preview_15 = CustomPreview(Geometry=filter_36, Shader=swatch_10)
preview_16 = CustomPreview(Geometry=filter_37, Shader=swatch_10)
preview_17 = CustomPreview(Geometry=filter_38, Shader=swatch_10)
tree = Slider(2.13, range=0..5)
move_23 = Move(Geometry=move_11.Geometry, Motion=vec2pt_5.Vector)  # -> Geometry, Transform

# ---- group: parking center
pt_84 = Point(randomsplit.ListB)

# ---- group: park center lego
pt_85 = Point(randomsplit_2.ListB)

# ----
move_24 = Move(Geometry=pt_85, Motion=vec_3)  # -> Geometry, Transform

# ---- group: park center 3D
pt_86 = Point(move_24.Geometry)

# ----
planesrf_4 = PlaneSurface(Plane=pt_86, XSize=dom_5, YSize=dom_5)
division_18 = Division(A=num_40, B=2)
col_36 = Colour(graft([swatch_5, swatch_6]))  # disabled

# ---- group: building center
pt_87 = Point(dispatch_16.ListA)

# ---- group: building id
int_121 = Integer(dispatch_17.ListA)

# ----
equals_26 = Equality(FirstNumber=int_121, SecondNumber=int_98)  # -> Equality, Inequality
multiplication_40 = Multiplication(A=equals_26.Inequality, B=6)
previewmat_2 = CustomPreviewMaterials(Geometry=filter_33, DiffuseColor=swatch_9, Transparency=panel_75, DiffuseBitmap=panel_74)  # disabled

# ---- group: base height
panel_92 = Panel("5.0")

# ----
move_25 = Move(Geometry=mesh_54, Motion=vec_2)  # -> Geometry, Transform
move_26 = Move(Geometry=mesh_53, Motion=vec_2)  # -> Geometry, Transform
move_27 = Move(Geometry=mesh_52, Motion=vec_2)  # -> Geometry, Transform
multiplication_41 = Multiplication(A=division_18, B=Slider(0.95, range=0..1))
lng_7 = ListLength(List=pt_86)
random_13 = Random(Range="0.8 to 1.4", Number=lng_7, Seed=Slider(72, range=0..100))
multiplication_42 = Multiplication(A=random_13, B=tree_scale)
scale = Scale(Geometry=mesh_57, Center=Point(0, 0, 0), Factor=multiplication_42)  # -> Geometry, Transform
random_14 = Random(Range=Domain(0, 1000), Number=lng_7, Seed=Slider(35, range=0..100))
mjoin_7 = MeshJoin(Meshes=move_23.Geometry)

# ---- group: ref mask srf - O
srf_7 = Surface(<surface referenced from the Rhino model>)

# ---- group: ref mask srf - OM
srf_8 = Surface(<surface referenced from the Rhino model>)

# ---- group: ref mask srf - bar work
srf_9 = Surface(<surface referenced from the Rhino model>)

# ---- group: ref mask srf - OS
srf_10 = Surface(<surface referenced from the Rhino model>)

# ---- group: ref mask srf - OL
srf_11 = Surface(<surface referenced from the Rhino model>)

# ----
addition_15 = Addition(A=int_121, B=multiplication_40)
neg_9 = Negative(Value=multiplication_41)
vec2pt_6 = Vector2Pt(PointA=Point(0, 0, 0), PointB=pt_85, Unitize=False)  # -> Vector, Length
vec2pt_7 = Vector2Pt(PointA=Point(0, 0, 0), PointB=pt_84, Unitize=False)  # -> Vector, Length
multiplication_43 = Multiplication(A="3", B=tree)
multiplication_44 = Multiplication(A="3", B=tree)
dom_6 = ConstructDomain(DomainStart=multiplication_43, DomainEnd=multiplication_44)
random_15 = Random(Range=dom_6, Number=lng_7, Seed=Slider(17, range=0..100))
popgeo_2 = PopulateGeometry(Geometry=flatten(planesrf_4), Count=flatten(random_15), Seed=flatten(random_14))
filter_43 = StreamFilter(Gate=equals_20.Equality, Stream0=addition_15, Stream1=int_121)
item_35 = ListItem(List=col_35, Index=graft(filter_43), Wrap=False)
filter_44 = StreamFilter(Gate=equals_20.Equality, Stream0=mjoin_7)
pshift_47 = ShiftPaths(Data=item_35, Offset=-1)
dom_7 = ConstructDomain(DomainStart=neg_9, DomainEnd=multiplication_41)
move_28 = Move(Geometry=mesh_56, Motion=vec2pt_6.Vector)  # -> Geometry, Transform
move_29 = Move(Geometry=mesh_55, Motion=vec2pt_7.Vector)  # -> Geometry, Transform
equals_27 = Equality(FirstNumber=int_96, SecondNumber="4")  # -> Equality, Inequality
equals_28 = Equality(FirstNumber=int_96, SecondNumber="5")  # -> Equality, Inequality
and_12 = GateAnd(A=equals_28.Inequality, B=equals_27.Inequality)
equals_29 = Equality(FirstNumber=int_96, SecondNumber="3")  # -> Equality, Inequality
and_13 = GateAnd(A=and_12, B=equals_29.Inequality)

# ---- group: tree center
pt_88 = Point(flatten(popgeo_2))

# ----
vec2pt_8 = Vector2Pt(PointA=Point(0, 0, 0), PointB=pt_88, Unitize=False)  # -> Vector, Length
move_30 = Move(Geometry=scale.Geometry, Motion=vec2pt_8.Vector)  # -> Geometry, Transform
panel_93 = Panel(num_7)
and_14 = GateAnd(A=equals_27.Inequality, B=equals_25.Inequality)
and_15 = GateAnd(A=equals_28.Inequality, B=equals_25.Inequality)
and_16 = GateAnd(A=equals_29.Inequality, B=equals_25.Inequality)
previewmat_3 = CustomPreviewMaterials(Geometry=filter_44, DiffuseColor=swatch_8, Transparency=panel_73, DiffuseBitmap=path_3)
and_17 = GateAnd(A=and_13, B=equals_25.Inequality)

# ---- group: color for each building
col_37 = Colour(pshift_47)

# ----
filter_45 = StreamFilter(Gate=and_14, Stream1=srf_8)
filter_46 = StreamFilter(Gate=and_17, Stream1=srf_9)
filter_47 = StreamFilter(Gate=and_15, Stream1=srf_10)
filter_48 = StreamFilter(Gate=and_16, Stream1=srf_11)
filter_49 = StreamFilter(Gate=and_17, Stream1=srf_7)
item_36 = ListItem(List=panel_93, Index=graft(int_121), Wrap=False)

# ---- group: parking lego
mesh_66 = Mesh(move_28.Geometry)

# ----
move_31 = Move(Geometry=mesh_66, Motion=vec_3)  # -> Geometry, Transform

# ---- group: parking 3D
mesh_67 = Mesh(move_31.Geometry)

# ---- group: parking lego
mesh_68 = Mesh(move_29.Geometry)

# ----
move_32 = Move(Geometry=mesh_68, Motion=vec_3)  # -> Geometry, Transform

# ---- group: parking 3D
mesh_69 = Mesh(move_32.Geometry)

# ---- group: trees 3D
mesh_70 = Mesh(move_30.Geometry)

# ----
preview_18 = CustomPreview(Geometry=filter_45, Shader=swatch_10)
preview_19 = CustomPreview(Geometry=filter_46, Shader=swatch_10)
preview_20 = CustomPreview(Geometry=filter_47, Shader=swatch_10)
preview_21 = CustomPreview(Geometry=filter_48, Shader=swatch_10)
preview_22 = CustomPreview(Geometry=filter_49, Shader=swatch_10)
pshift_48 = ShiftPaths(Data=item_36, Offset=-1)

# ---- group: building height factor
number_slider_71 = Slider(3.1, range=0..10)

# ----
number_slider_72 = Slider(1.2, range=0..10)  # disabled
filter_50 = StreamFilter(Gate=show_google_map, Stream0=mesh_66)
filter_51 = StreamFilter(Gate=show_google_map, Stream0=mesh_68)
multiplication_45 = Multiplication(A=pshift_48, B=number_slider_71)

# ---- group: building height of each building
num_63 = Number(multiplication_45)

# ----
addition_16 = Addition(A=num_63, B=panel_92)
dom_8 = ConstructDomain(DomainStart=0, DomainEnd=addition_16)
box = DomainBox(Base=pt_87, X=dom_7, Y=dom_7, Z=dom_8)
move_33 = Move(Geometry=box, Motion=vec_2)  # -> Geometry, Transform

# ---- group: building geo
box_2 = Box(move_33.Geometry)

# ---- group: textured buildings
panel_94 = Panel("C:\Users\RYAN\Documents\GitHub\CityMatrix\Map\PEV_PSG AND PKG_300DPI.png")  # disabled
panel_95 = Panel("0.01")  # disabled
swatch_11 = ColourSwatch(SwatchColor=RGB(255, 255, 255))  # disabled
boxmap = BoxMapping(Mesh=box_2, Box=box_2)  # disabled
previewmat_4 = CustomPreviewMaterials(Geometry=boxmap, DiffuseColor=swatch_11, Transparency=panel_95, DiffuseBitmap=panel_94)  # disabled

# ----
number_slider_73 = Slider(2, range=0..1000)  # disabled
item_37 = ListItem(List=panel_91, Index=0, Wrap=True)  # disabled
multiplication_46 = Multiplication(A=number_slider_38, B=number_slider_72)  # disabled
panel_96 = Panel("-1")  # disabled
division_19 = Division(A=item_37, B=item_37)  # disabled
number_slider_74 = Slider(0, range=0..10)  # disabled
panel_97 = Panel("-1")  # disabled
subtraction_8 = Subtraction(A=multiplication_46, B=number_slider_38)  # disabled
number_slider_75 = Slider(4, range=0..10)  # disabled
number_slider_76 = Slider(63, range=0..100)  # disabled
division_20 = Division(A=number_slider_39, B=number_slider_73)  # disabled

# ---- group: to calebrate - select all and ctl+E / parking lego
mesh_71 = Mesh(filter_50)

# ---- group: sidewalk
mesh_72 = Mesh(move_26.Geometry)

# ---- group: road
mesh_73 = Mesh(move_25.Geometry)

# ----
multiplication_47 = Multiplication(A=panel_96, B=division_19)  # disabled

# ---- group: to calebrate - select all and ctl+E / parking lego
mesh_74 = Mesh(filter_51)

# ---- group: 3D Buldings
preview_23 = CustomPreview(Geometry=box_2, Shader=col_37)

# ---- group: blank
mesh_75 = Mesh(move_27.Geometry)

# ----
division_21 = Division(A=subtraction_8, B=2)  # disabled
number_slider_77 = Slider(52, range=0..100)  # disabled
multiplication_48 = Multiplication(A=division_21, B=panel_97)  # disabled
lng_8 = ListLength(List=panel_71)  # disabled
partition = PartitionList(List=panel_91, Size=lng_8)  # disabled
panel_98 = Panel(partition)  # disabled
multiplication_49 = Multiplication(A=number_slider_37, B=multiplication_47)  # disabled
number_slider_78 = Slider(6, range=0..100)  # disabled
vec_4 = VectorXYZ(XComponent=division_21, YComponent=multiplication_48, ZComponent=0)  # -> Vector, Length; disabled
pt_89 = ConstructPoint(XCoordinate=division_20, YCoordinate=multiplication_49, ZCoordinate=0)  # disabled
number_slider_79 = Slider(0, range=0..100)  # disabled
polygon_2 = Polygon(Plane=pt_89, Radius=number_slider_38, Segments=number_slider_76, FilletRadius=number_slider_75)  # -> Polygon, Length; disabled
rev_4 = Reverse(Vector=vec_4.Vector)  # disabled
move_34 = Move(Geometry=pt_89, Motion=rev_4)  # -> Geometry, Transform; disabled
polygon_3 = Polygon(Plane=move_34.Geometry, Radius=multiplication_46, Segments=lng_8, FilletRadius=number_slider_74)  # -> Polygon, Length; disabled
polygon_4 = Polygon(Plane=pt_89, Radius=number_slider_38, Segments=lng_8, FilletRadius=0)  # -> Polygon, Length; disabled
division_22 = Division(A=number_slider_38, B=number_slider_78)  # disabled
polygon_5 = Polygon(Plane=pt_89, Radius=number_slider_38, Segments=lng_8, FilletRadius=number_slider_77)  # -> Polygon, Length; disabled
cp_8 = ControlPoints(Curve=polygon_3.Polygon)  # -> Points, Weights, Knots; disabled
panel_99 = Panel("CityScope Radar")  # disabled
number_slider_80 = Slider(1, range=0..10)  # disabled
number_slider_81 = Slider(9, range=0..10)  # disabled
series_4 = Series(Start=0, Step=division_22, Count=number_slider_78)  # disabled
number_slider_82 = Slider(223, range=0..1000)  # disabled
number_slider_83 = Slider(63, range=0..100)  # disabled
number_slider_84 = Slider(4, range=0..10)  # disabled
cp_9 = ControlPoints(Curve=polygon_4.Polygon)  # -> Points, Weights, Knots; disabled
toggle = BooleanToggle(True)  # disabled
number_slider_85 = Slider(1, range=0..10)  # disabled
number_slider_86 = Slider(1, range=0..10)  # disabled
cull_i = CullIndex(List=cp_8.Points, Indices=lng_8, Wrap=True)  # disabled
cull_i_2 = CullIndex(List=series_4, Indices=number_slider_79, Wrap=True)  # disabled
bnd_5 = Bounds(Numbers=panel_91)  # disabled
number_slider_87 = Slider(0, range=0..100)  # disabled
swatch_12 = ColourSwatch(SwatchColor=RGBA(255, 255, 255, 98))  # disabled
swatch_13 = ColourSwatch(SwatchColor=RGBA(255, 255, 255, 148))  # disabled
cull_i_3 = CullIndex(List=cp_9.Points, Indices=lng_8, Wrap=True)  # disabled
ln_4 = Line(StartPoint=pt_89, EndPoint=graft(cull_i_3))  # disabled
dedomain_2 = DeconstructDomain(Domain=bnd_5)  # -> Start, End; disabled
shape = CreateShape(Shape=polygon_2.Polygon, StrokeWeight=number_slider_81, StrokeColor=swatch_13, Scale=number_slider_86)  # disabled
polygon_6 = Polygon(Plane=pt_89, Radius=cull_i_2, Segments=number_slider_83, FilletRadius=number_slider_84)  # -> Polygon, Length; disabled
shape_2 = CreateShape(Shape=polygon_6.Polygon, StrokeWeight=number_slider_80, StrokeColor=swatch_12, Scale=number_slider_85)  # disabled
toggle_2 = BooleanToggle(False)  # disabled
number_slider_88 = Slider(0.39, range=0..1)  # disabled
pt_90 = ConstructPoint(XCoordinate=number_slider_40, YCoordinate=number_slider_41, ZCoordinate=0)  # disabled
launchxpwin = LaunchTransparentWindow(Show=toggle, Name=panel_99, Width=number_slider_39, Height=number_slider_39, ChildStatus=0, EnableHorizScroll=False)  # disabled
dom_9 = ConstructDomain(DomainStart=number_slider_87, DomainEnd=dedomain_2.End)  # disabled
argb_9 = SplitARGB(Colour=col_36)  # -> Alpha, Red, Green, Blue; disabled
winprops = SetWindowProperties(Window=launchxpwin, StartingLocation=pt_90, ShowTitleBar=toggle_2, BackgroundColor=swatch_4, ScaleFactor=1)  # disabled
remap_10 = RemapNumbers(Value=panel_98, Source=dom_9, Target=Domain(0, 1))  # -> Mapped, Clipped; disabled
number_slider_89 = Slider(7, range=0..10)  # disabled
frgb_16 = ColourRGBF(Alpha=number_slider_88, Red=argb_9.Red, Green=argb_9.Green, Blue=argb_9.Blue)  # disabled
eval = EvaluateCurve(Curve=flatten(ln_4), Parameter=remap_10.Mapped)  # -> Point, Tangent, Angle; disabled

panel_100 = Panel(cull_i)  # disabled
panel_101 = Panel(",")  # disabled
pdecon_15 = Deconstruct(Point=panel_100)  # -> graft(XComponent), graft(YComponent), ZComponent; disabled
concat = Concatenate(FragmentA=pdecon_15.XComponent, FragmentB=panel_101)  # disabled
number_slider_90 = Slider(0, range=0..1000)  # disabled
abs = Absolute(Value=pdecon_15.YComponent)  # disabled
concat_2 = Concatenate(FragmentA=concat, FragmentB=abs)  # disabled
panel_102 = Panel(",")  # disabled
concat_3 = Concatenate(FragmentA=concat_2, FragmentB=panel_102)  # disabled
number_slider_91 = Slider(0, range=0..1000)  # disabled
swatch_14 = ColourSwatch(SwatchColor=RGB(255, 239, 248))  # disabled
concat_4 = Concatenate(FragmentA=concat_3, FragmentB=number_slider_90)  # disabled
panel_103 = Panel(",")  # disabled
label = CreateLabel(LabelText=panel_71, LabelSize=12, Justification=0)  # -> flatten(Label); disabled
concat_5 = Concatenate(FragmentA=concat_4, FragmentB=panel_103)  # disabled
toggle_3 = BooleanToggle(True)  # disabled
adjustelem = AdjustElementAppearance(ElementsToAdjust=label, Foreground=swatch_14)  # disabled
concat_6 = Concatenate(FragmentA=concat_5, FragmentB=number_slider_91)  # -> flatten(Result); disabled
panel_104 = Panel(concat_6)  # disabled
adjustpos = AdjustElementPositioning(ElementsToAdjust=label, Margin=concat_6, AbsolutePositioning=toggle_3)  # disabled

number_slider_92 = Slider(1, range=0..10)  # disabled
number_slider_93 = Slider(1, range=0..10)  # disabled
number_slider_94 = Slider(4, range=0..10)  # disabled
number_slider_95 = Slider(1, range=0..10)  # disabled
number_slider_96 = Slider(1, range=0..10)  # disabled
number_slider_97 = Slider(1, range=0..10)  # disabled
pline_4 = PolyLine(Vertices=eval.Point, Closed=True)  # disabled
fillet = Fillet(Curve=pline_4, Radius=number_slider_89)  # disabled
swatch_15 = ColourSwatch(SwatchColor=RGBA(255, 255, 255, 98))  # disabled
swatch_16 = ColourSwatch(SwatchColor=RGBA(255, 255, 255, 47))  # disabled
number_slider_98 = Slider(0, range=0..1000)  # disabled
number_slider_99 = Slider(0, range=0..1000)  # disabled
shape_3 = CreateShape(Shape=ln_4, StrokeWeight=number_slider_92, StrokeColor=swatch_15, Scale=number_slider_95)  # disabled
shape_4 = CreateShape(Shape=polygon_5.Polygon, StrokeWeight=number_slider_93, StrokeColor=swatch_16, Scale=number_slider_96)  # disabled
shape_5 = CreateShape(Shape=fillet, FillColor=frgb_16, StrokeWeight=number_slider_94, StrokeColor=col_36, Scale=number_slider_97)  # disabled
panel_105 = Panel(",")  # disabled
concat_7 = Concatenate(FragmentA=number_slider_98, FragmentB=panel_105)  # disabled
concat_8 = Concatenate(FragmentA=concat_7, FragmentB=number_slider_99)  # disabled
number_slider_100 = Slider(0, range=0..1000)  # disabled
panel_106 = Panel(",")  # disabled
concat_9 = Concatenate(FragmentA=concat_8, FragmentB=panel_106)  # disabled
number_slider_101 = Slider(0, range=0..1000)  # disabled
concat_10 = Concatenate(FragmentA=concat_9, FragmentB=number_slider_100)  # disabled
panel_107 = Panel(",")  # disabled
toggle_4 = BooleanToggle(True)  # disabled
concat_11 = Concatenate(FragmentA=concat_10, FragmentB=panel_107)  # disabled
addelems = AddElements(Window=launchxpwin, Elements=flatten([shape_4, shape, shape_2, shape_5, shape_3, label]), DoVLChecking=True)  # -> AddedElements, ElementNames; disabled
concat_12 = Concatenate(FragmentA=concat_11, FragmentB=number_slider_101)  # -> flatten(Result); disabled
adjustpos_2 = AdjustElementPositioning(ElementsToAdjust=flatten([shape, shape_4, shape_2, shape_5, shape_3]), Margin=concat_12, AbsolutePositioning=toggle_4)  # disabled

# ---- group: to calebrate - select all and ctl+E / disable when not calibrating CV
box_3 = CenterBox(Base=pt_18, X=0.003, Y=0.003, Z=0.003)  # disabled

# ---- group: to calebrate - select all and ctl+E / disable when not calibrating CV / all sample boxes
box_4 = Box(box_3)  # disabled

# ---- group: to calebrate - select all and ctl+E / disable when not calibrating CV (continued)
preview_24 = CustomPreview(Geometry=box_4, Shader=item_3)  # disabled

# ---- group: reference color calebration - select all and ctrl E
# Color Space Viz / Grid
argb_10 = SplitARGB(Colour=col_13)  # -> Alpha, Red, Green, Blue; disabled
ahsv = SplitAHSV(Colour=col_13)  # -> Alpha, Hue, Saturation, Value; disabled
argb_11 = SplitARGB(Colour=col_14)  # -> Alpha, Red, Green, Blue; disabled
ahsv_2 = SplitAHSV(Colour=col_14)  # -> Alpha, Hue, Saturation, Value; disabled
pt_91 = ConstructPoint(XCoordinate=argb_10.Red, YCoordinate=argb_10.Green, ZCoordinate=argb_10.Blue)  # disabled
pt_92 = ConstructPoint(XCoordinate=ahsv.Hue, YCoordinate=ahsv.Saturation, ZCoordinate=ahsv.Value)  # disabled
pt_93 = ConstructPoint(XCoordinate=argb_11.Red, YCoordinate=argb_11.Green, ZCoordinate=argb_11.Blue)  # disabled
pt_94 = ConstructPoint(XCoordinate=ahsv_2.Hue, YCoordinate=ahsv_2.Saturation, ZCoordinate=ahsv_2.Value)  # disabled
pt_95 = Point(col_13)  # disabled
pt_96 = Point(col_14)  # disabled
sph = Sphere(Base=pt_94, Radius=0.05)  # disabled
sph_2 = Sphere(Base=pt_93, Radius=0.05)  # disabled
preview_25 = CustomPreview(Geometry=pt_92, Shader=col_13)  # disabled
preview_26 = CustomPreview(Geometry=pt_91, Shader=col_13)  # disabled
preview_27 = CustomPreview(Geometry=sph, Shader=col_14)  # disabled
preview_28 = CustomPreview(Geometry=sph_2, Shader=col_14)  # disabled
box_5 = Box2Pt(PointA=Point(0, 0, 0), PointB=Point(1, 1, 1), Plane=PlaneXY(0, 0, 0))  # disabled
box_6 = Box2Pt(PointA=Point(0, 0, 0), PointB=Point(1, 1, 1), Plane=PlaneXY(0, 0, 0))  # disabled
voronoi³ = Voronoi3D(Points=pt_94, Box=box_5)  # -> Cells, Boundary; disabled
voronoi³_2 = Voronoi3D(Points=pt_93, Box=box_6)  # -> Cells, Boundary; disabled
brep = Brep(voronoi³.Cells)  # disabled
brep_2 = Brep(voronoi³_2.Cells)  # disabled
range_2 = Range(Domain=Domain(0, 1), Steps=10)  # disabled
graft_3 = GraftTree(Tree=range_2, IncludeEmptyLists=True, IncludeNullItems=True)  # disabled
pt_97 = ConstructPoint(XCoordinate=range_2, YCoordinate=graft_3, ZCoordinate=0)  # disabled
Z_10 = UnitZ(Factor=range_2)  # disabled
pshift_49 = ShiftPaths(Data=pt_97, Offset=-1)  # disabled
graft_4 = GraftTree(Tree=Z_10, IncludeEmptyLists=True, IncludeNullItems=True)  # disabled
number_slider_102 = Slider(5, range=0..10)  # disabled
move_35 = Move(Geometry=pshift_49, Motion=graft_4)  # -> Geometry, Transform; disabled
flip = FlipMatrix(Data=move_35.Geometry)  # disabled
item_38 = ListItem(List=flip, Index=number_slider_102, Wrap=False)  # disabled

# ---- group: reference color calebration - select all and ctrl E / color space pts - one plan
pt_98 = Point(item_38)  # disabled

# ---- group: reference color calebration - select all and ctrl E / color space pts
pt_99 = Point(flip)  # disabled

# ---- group: reference color calebration - select all and ctrl E / color space pts - showing
pt_100 = Point(pt_99)  # disabled

# ---- group: reference color calebration - select all and ctrl E (continued)
pdecon_16 = Deconstruct(Point=pt_100)  # -> XComponent, YComponent, ZComponent; disabled
hsl = ColourHSL(Alpha=1, Hue=pdecon_16.XComponent, Saturation=pdecon_16.YComponent, Luminance=pdecon_16.ZComponent)  # disabled
frgb_17 = ColourRGBF(Alpha=1, Red=pdecon_16.XComponent, Green=pdecon_16.YComponent, Blue=pdecon_16.ZComponent)  # disabled
pt_101 = Point(frgb_17)  # disabled
preview_29 = CustomPreview(Geometry=pt_100, Shader=hsl)  # disabled
preview_30 = CustomPreview(Geometry=pt_100, Shader=frgb_17)  # disabled

# ----
# Color Space Viz / Slider & Toggle
argb_12 = SplitARGB(Colour=col_16)  # -> Alpha, Red, Green, Blue; disabled
ahsv_3 = SplitAHSV(Colour=col_16)  # -> Alpha, Hue, Saturation, Value; disabled
argb_13 = SplitARGB(Colour=col_15)  # -> Alpha, Red, Green, Blue; disabled
ahsv_4 = SplitAHSV(Colour=col_15)  # -> Alpha, Hue, Saturation, Value; disabled
pt_102 = ConstructPoint(XCoordinate=argb_12.Red, YCoordinate=argb_12.Green, ZCoordinate=argb_12.Blue)  # disabled
pt_103 = ConstructPoint(XCoordinate=ahsv_3.Hue, YCoordinate=ahsv_3.Saturation, ZCoordinate=ahsv_3.Value)  # disabled
pt_104 = Point(col_16)  # disabled
pt_105 = ConstructPoint(XCoordinate=argb_13.Red, YCoordinate=argb_13.Green, ZCoordinate=argb_13.Blue)  # disabled
pt_106 = ConstructPoint(XCoordinate=ahsv_4.Hue, YCoordinate=ahsv_4.Saturation, ZCoordinate=ahsv_4.Value)  # disabled
pt_107 = Point(col_15)  # disabled
sph_3 = Sphere(Base=pt_103, Radius=0.05)  # disabled
sph_4 = Sphere(Base=pt_102, Radius=0.05)  # disabled
preview_31 = CustomPreview(Geometry=pt_106, Shader=col_15)  # disabled
preview_32 = CustomPreview(Geometry=pt_105, Shader=col_15)  # disabled
preview_33 = CustomPreview(Geometry=sph_3, Shader=col_16)  # disabled
preview_34 = CustomPreview(Geometry=sph_4, Shader=col_16)  # disabled
box_7 = Box2Pt(PointA=Point(0, 0, 0), PointB=Point(1, 1, 1), Plane=PlaneXY(0, 0, 0))  # disabled
box_8 = Box2Pt(PointA=Point(0, 0, 0), PointB=Point(1, 1, 1), Plane=PlaneXY(0, 0, 0))  # disabled
voronoi³_3 = Voronoi3D(Points=pt_103, Box=box_7)  # -> Cells, Boundary; disabled
voronoi³_4 = Voronoi3D(Points=pt_102, Box=box_8)  # -> Cells, Boundary; disabled
brep_3 = Brep(voronoi³_3.Cells)  # disabled
brep_4 = Brep(voronoi³_4.Cells)  # disabled
range_3 = Range(Domain=Domain(0, 1), Steps=10)  # disabled
graft_5 = GraftTree(Tree=range_3, IncludeEmptyLists=True, IncludeNullItems=True)  # disabled
pt_108 = ConstructPoint(XCoordinate=range_3, YCoordinate=graft_5, ZCoordinate=0)  # disabled
Z_11 = UnitZ(Factor=range_3)  # disabled
pshift_50 = ShiftPaths(Data=pt_108, Offset=-1)  # disabled
graft_6 = GraftTree(Tree=Z_11, IncludeEmptyLists=True, IncludeNullItems=True)  # disabled
number_slider_103 = Slider(5, range=0..10)  # disabled
move_36 = Move(Geometry=pshift_50, Motion=graft_6)  # -> Geometry, Transform; disabled
flip_2 = FlipMatrix(Data=move_36.Geometry)  # disabled
item_39 = ListItem(List=flip_2, Index=number_slider_103, Wrap=False)  # disabled

# ---- group: color space pts - one plan
pt_109 = Point(item_39)  # disabled

# ---- group: color space pts
pt_110 = Point(flip_2)  # disabled

# ---- group: color space pts - showing
pt_111 = Point(pt_110)  # disabled

# ----
pdecon_17 = Deconstruct(Point=pt_111)  # -> XComponent, YComponent, ZComponent; disabled
hsl_2 = ColourHSL(Alpha=1, Hue=pdecon_17.XComponent, Saturation=pdecon_17.YComponent, Luminance=pdecon_17.ZComponent)  # disabled
frgb_18 = ColourRGBF(Alpha=1, Red=pdecon_17.XComponent, Green=pdecon_17.YComponent, Blue=pdecon_17.ZComponent)  # disabled
pt_112 = Point(frgb_18)  # disabled
preview_35 = CustomPreview(Geometry=pt_111, Shader=hsl_2)  # disabled
preview_36 = CustomPreview(Geometry=pt_111, Shader=frgb_18)  # disabled

# ---- group: total ppl bound
panel_108 = Panel("700")

# ----
multiplication_50 = Multiplication(A=panel_108, B=number_slider_24)
dom_10 = ConstructDomain(DomainStart=multiplication_50, DomainEnd=multiplication_15)

# ---- group: total ppl bound (continued)
domain_2 = Domain(dom_10)

# ----
remap_11 = RemapNumbers(Value=int_117, Source=domain_2, Target=Domain(0, 0.5))  # -> Mapped, Clipped
remap_12 = RemapNumbers(Value=int_117, Source=domain_2, Target=Domain(0.3, 1))  # -> Mapped, Clipped
multiplication_51 = Multiplication(A=graph, B=remap_12.Mapped)
addition_17 = Addition(A=remap_11.Mapped, B=multiplication_51)
addition_18 = Addition(A=addition_17, B=multiplication_16)
gradient_11 = Gradient(
    LowerLimit=0,
    UpperLimit=1,
    Parameter=addition_18,
    stops=[0: RGB(0, 128, 0), 0.422: RGB(255, 255, 0), 0.919: RGB(255, 0, 0)])
argb_14 = SplitARGB(Colour=gradient_11, IntegerChannels=True)  # -> Alpha, Red, Green, Blue
vec_5 = VectorXYZ(XComponent=argb_14.Red, YComponent=argb_14.Green, ZComponent=argb_14.Blue)  # -> Vector, Length
multiplication_52 = Multiplication(A=vec_5.Vector, B=number_slider_26)
addition_19 = Addition(A=multiplication_52, B=multiplication_17)
devec = DeconstructVector(Vector=addition_19)  # -> XComponent, YComponent, ZComponent
rgb = ColourRGB(Alpha=255, Red=devec.XComponent, Green=devec.YComponent, Blue=devec.ZComponent)
col_38 = Colour(rgb)
mspray_4 = MeshSpray(Mesh=graft(pshift_36), Points=graft(pshift_37), Colours=graft(col_38), SprayMode=0)  # disabled
mjoin_8 = MeshJoin(Meshes=flatten(mspray_4))  # disabled
filter_52 = StreamFilter(Gate=show_google_map, Stream0=mjoin_8)  # disabled

# ---- group: road traffic lego
mesh_76 = Mesh(filter_52)  # disabled

# ==== cluster ModuleCenter
pt = ClusterInput()
int = ClusterInput()
num = ClusterInput()
int_2 = ClusterInput()

# ---- group: y
int_3 = Integer(int)

# ---- group: cell size
num_2 = Number(num)

# ---- group: x
int_4 = Integer(int_2)

# ---- group: center
pt_2 = Point(pt)

# ----
pt_3 = ConstructPoint(XCoordinate=0, YCoordinate=0, ZCoordinate=0)  # disabled
addition = Addition(A=int_4, B=0.5)
vec2pt = Vector2Pt(PointA=pt_3, PointB=pt_2, Unitize=False)  # -> Vector, Length; disabled
addition_2 = Addition(A=int_3, B=0.5)
multiplication = Multiplication(A=addition, B=num_2)
lng = ListLength(List=int_4)  # disabled
move = Move(Motion=vec2pt.Vector)  # -> Geometry, Transform; disabled
multiplication_2 = Multiplication(A=addition_2, B=num_2)
X = UnitX(Factor=multiplication)
repeat = RepeatData(Data=move.Transform, Length=lng)  # disabled
neg = Negative(Value=multiplication_2)
move_2 = Move(Geometry=pt_2, Motion=X)  # -> Geometry, Transform
graft = GraftTree(Tree=move_2.Transform, IncludeEmptyLists=True, IncludeNullItems=True)  # disabled
Y = UnitY(Factor=neg)
pshift = ShiftPaths(Data=repeat, Offset=-1)  # disabled
move_3 = Move(Geometry=move_2.Geometry, Motion=Y)  # -> Geometry, Transform
graft_2 = GraftTree(Tree=move_3.Transform, IncludeEmptyLists=True, IncludeNullItems=True)  # disabled
comp = Compound(Transforms=[graft, graft_2])  # disabled
graft_3 = GraftTree(Tree=pshift, IncludeEmptyLists=True, IncludeNullItems=True)  # disabled
comp_2 = Compound(Transforms=[comp, graft_3])  # disabled

# ---- group: module center
pt_4 = Point(move_3.Geometry)

# ----
pshift_2 = ShiftPaths(Data=comp_2, Offset=-1)  # disabled
transform = Transform(pshift_2)  # disabled
pt_5 = ClusterOutput(pt_4)
transform_2 = ClusterOutput(transform)  # disabled

# ==== cluster MoveToOrgin
num = ClusterInput()
G = ClusterInput()
num_2 = Number(num)
geobottomcenter = GeoBottomCenter(geo=G)
vec2pt = Vector2Pt(PointA=geobottomcenter, PointB=Point(0, 0, 0), Unitize=False)  # -> Vector, Length
move = Move(Geometry=G, Motion=vec2pt.Vector)  # -> Geometry, Transform
scale_nu = ScaleNU(Geometry=move.Geometry, Plane=PlaneXY(0, 0, 0), ScaleX=num_2, ScaleY=num_2, ScaleZ=1)  # -> Geometry, Transform
G_2 = ClusterOutput(scale_nu.Geometry)

# ==== cluster GeoBottomCenter_2
geo = ClusterInput()
geo_2 = Geometry(geo)
bbox = BoundingBox(Content=geo_2, Plane=PlaneXY(0, 0, 0))  # -> Box, Box_2
box_corners = BoxCorners(Box=bbox.Box)  # -> CornerA, CornerB, CornerC, CornerD, CornerE, CornerF, CornerG, CornerH
pdecon = Deconstruct(Point=box_corners.CornerA)  # -> XComponent, YComponent, ZComponent
pdecon_2 = Deconstruct(Point=box_corners.CornerC)  # -> XComponent, YComponent, ZComponent
addition = Addition(A=pdecon.XComponent, B=pdecon_2.XComponent)
addition_2 = Addition(A=pdecon.YComponent, B=pdecon_2.YComponent)
division = Division(A=addition, B=2)
division_2 = Division(A=addition_2, B=2)
pt = ConstructPoint(XCoordinate=division, YCoordinate=division_2, ZCoordinate=pdecon.ZComponent)
pshift = ShiftPaths(Data=pt, Offset=-1)
pt_2 = Point(pshift)
pt_3 = ClusterOutput(pt_2)

# ==== cluster EasterEggs
panel = Panel("79")  # disabled
panel_2 = Panel("30")  # disabled
subtraction = Subtraction(A=panel, B=1)  # disabled
subtraction_2 = Subtraction(A=panel_2, B=1)  # disabled
sqgrid = Square(Plane=PlaneXY(0, 0, 0), Size=1, ExtentX=subtraction, ExtentY=subtraction_2)  # -> Cells, Points; disabled
pdecon = Deconstruct(Point=sqgrid.Points)  # -> XComponent, YComponent, ZComponent; disabled
division = Division(A=pdecon.XComponent, B=panel)  # disabled
division_2 = Division(A=pdecon.YComponent, B=panel_2)  # disabled
pt = ConstructPoint(XCoordinate=division, YCoordinate=division_2, ZCoordinate=0)  # disabled
ahsv = SplitAHSV()  # -> Alpha, Hue, Saturation, Value; disabled
smaller = SmallerThan(FirstNumber=ahsv.Alpha, SecondNumber=1)  # -> SmallerThan, OrEqualTo; disabled
dispatch = Dispatch(List=sqgrid.Points, DispatchPattern=smaller.SmallerThan)  # -> ListA, ListB; disabled
dispatch_2 = Dispatch(DispatchPattern=smaller.SmallerThan)  # -> ListA, ListB; disabled
vec = VectorXYZ(XComponent=2, YComponent=-2, ZComponent=-10)  # -> Vector, Length; disabled
col = Colour(flatten(dispatch_2.ListB))  # disabled
planesrf = PlaneSurface(Plane=dispatch.ListB, XSize=Domain(-0.5, 0.5), YSize=Domain(-0.5, 0.5))  # disabled
mesh = Mesh(flatten(planesrf))  # disabled
mspray = MeshSpray(Mesh=graft(mesh), Points=Point(0, 0, 0), Colours=graft(col), SprayMode=0)  # disabled
mjoin = MeshJoin(Meshes=flatten(mspray))  # disabled
move = Move(Geometry=mjoin, Motion=vec.Vector)  # -> Geometry, Transform; disabled
mcol = MeshColours(Mesh=move.Geometry, Colours=RGB(0, 0, 0))  # disabled
preview = CustomPreview(Geometry=planesrf, Shader=dispatch_2.ListB)  # disabled
mjoin_2 = MeshJoin(Meshes=flatten([mjoin, mcol]))  # disabled
toggle = BooleanToggle(False)  # disabled
toggle_2 = BooleanToggle(False)  # disabled
panel_3 = Panel("7")  # disabled
swatch = ColourSwatch(SwatchColor=RGB(0, 0, 0))  # disabled
swatch_2 = ColourSwatch(SwatchColor=RGB(255, 115, 0))  # disabled

# ---- group: module meshes lego ref: 7 - J
mesh_2 = Mesh(<mesh referenced from the Rhino model>)  # disabled

# ---- group: on screen mesh ref: 8 - X
mesh_3 = Mesh(<mesh referenced from the Rhino model>)  # disabled

# ---- group: module meshes lego ref: 8 - X
mesh_4 = Mesh(<mesh referenced from the Rhino model>)  # disabled

# ----
panel_4 = Panel("7")  # disabled
mesh_5 = Mesh(<mesh referenced from the Rhino model>)  # disabled

# ---- group: on screen mesh ref: 7 - J
mesh_6 = Mesh(mjoin_2)  # disabled

# ----
mcol_2 = MeshColours(Mesh=mesh_3, Colours=swatch_2)  # disabled
mcol_3 = MeshColours(Mesh=mesh_5, Colours=swatch)  # disabled
shrink = ClusterInput()
shrink_2 = ClusterInput()
movetoorgin = MoveToOrgin(G=mesh_2, num=shrink)  # disabled
mjoin_3 = MeshJoin(Meshes=[mcol_2, mcol_3])  # disabled
movetoorgin_2 = MoveToOrgin(G=mesh_4, num=shrink_2)  # disabled

# ---- group: module meshes lego at orgin
mesh_7 = Mesh(movetoorgin)  # disabled

mesh_8 = Mesh(movetoorgin_2)  # disabled

# ----
A = ClusterInput()
A_2 = ClusterInput()
equals = Equality(FirstNumber=A, SecondNumber=panel_4)  # -> Equality, Inequality; disabled
int = Integer(equals.Equality)  # disabled
ma = MassAddition(Input=int)  # -> Result, PartialResults; disabled
larger = LargerThan(FirstNumber=ma.Result, SecondNumber=0)  # -> LargerThan, OrEqualTo; disabled
L = ClusterInput()
equals_2 = Equality(FirstNumber=A_2, SecondNumber=panel_3)  # -> Equality, Inequality; disabled
int_2 = Integer(equals_2.Equality)  # disabled
ma_2 = MassAddition(Input=int_2)  # -> Result, PartialResults; disabled
larger_2 = LargerThan(FirstNumber=ma_2.Result, SecondNumber=0)  # -> LargerThan, OrEqualTo; disabled
L_2 = ClusterInput()

# ---- group: if has this special id
bool = Boolean(larger.LargerThan)  # disabled

bool_2 = Boolean(bool)  # disabled

# ----
getcamera = GetCamera(GetCamera=bool_2)  # -> Location, Target, LensLength, UpDirection; disabled
ln = Line(StartPoint=getcamera.Location, EndPoint=getcamera.Target)  # disabled
getplanefrom2pts = GetPlaneFrom2pts(pt_2=getcamera.Location, pt=getcamera.Target)  # disabled
dispatch_3 = Dispatch(List=L, DispatchPattern=equals_2.Equality)  # -> ListA, ListB; disabled
dispatch_4 = Dispatch(List=L_2, DispatchPattern=equals.Equality)  # -> ListA, ListB; disabled
number_slider = Slider(6.4, range=0..10)  # disabled
number_slider_2 = Slider(14.4, range=0..100)  # disabled
pt_2 = ConstructPoint(XCoordinate=500, YCoordinate=500, ZCoordinate=20)  # disabled

# ---- group: if has this special id
bool_3 = Boolean(larger_2.LargerThan)  # disabled

bool_4 = Boolean(bool_3)  # disabled

# ----
getcamera_2 = GetCamera(GetCamera=bool_4)  # -> Location, Target, LensLength, UpDirection; disabled
ln_2 = Line(StartPoint=getcamera_2.Location, EndPoint=getcamera_2.Target)  # disabled
getplanefrom2pts_2 = GetPlaneFrom2pts(pt_2=getcamera_2.Location, pt=getcamera_2.Target)  # disabled
vec2pt = Vector2Pt(PointA=Point(0, 0, 0), PointB=dispatch_3.ListA, Unitize=False)  # -> Vector, Length; disabled
vec2pt_2 = Vector2Pt(PointA=Point(0, 0, 0), PointB=dispatch_4.ListA, Unitize=False)  # -> Vector, Length; disabled
pt_3 = Point(pt_2)  # disabled
move_2 = Move(Geometry=mesh_7, Motion=vec2pt.Vector)  # -> Geometry, Transform; disabled
move_3 = Move(Geometry=mesh_8, Motion=vec2pt_2.Vector)  # -> Geometry, Transform; disabled

# ---- group: current cam canvas pln
pln = Plane(getplanefrom2pts)  # disabled

pln_2 = Plane(getplanefrom2pts_2)  # disabled

# ----
xy = XYPlane(Origin=pt_3)  # disabled
number_slider_3 = Slider(0.01, range=0.001..1)  # disabled
number_slider_4 = Slider(0.01, range=0.001..1)  # disabled
number_slider_5 = Slider(0.81, range=0.001..101)  # disabled
movetoorgin_3 = MoveToOrgin(G=mjoin_3, num=number_slider)  # disabled
movetoorgin_4 = MoveToOrgin(G=mesh_6, num=number_slider_2)  # disabled
orient = Orient(Geometry=movetoorgin_4, Source=PlaneXY(0, 0, 0), Target=xy)  # -> Geometry, Transform; disabled
orient_2 = Orient(Geometry=movetoorgin_3, Source=PlaneXY(0, 0, 0), Target=pln)  # -> Geometry, Transform; disabled
orient_3 = Orient(Geometry=movetoorgin_4, Source=PlaneXY(0, 0, 0), Target=pln_2)  # -> Geometry, Transform; disabled
scale = Scale(Geometry=orient_2.Geometry, Center=getcamera.Location, Factor=number_slider_3)  # -> Geometry, Transform; disabled
scale_2 = Scale(Geometry=orient_3.Geometry, Center=getcamera_2.Location, Factor=number_slider_4)  # -> Geometry, Transform; disabled
scale_3 = Scale(Geometry=orient.Geometry, Center=pt_3, Factor=number_slider_5)  # -> Geometry, Transform; disabled
filter = StreamFilter(Gate=bool_2, Stream1=scale.Geometry)  # disabled
filter_2 = StreamFilter(Gate=bool_4, Stream1=scale_2.Geometry)  # disabled
filter_3 = StreamFilter(Gate=bool_4, Stream1=scale_3.Geometry)  # disabled

# ---- group: special JR
mesh_9 = Mesh(move_2.Geometry)  # disabled

# ---- group: on 3d view
mesh_10 = Mesh(filter)  # disabled

# ---- group: special Xin
mesh_11 = Mesh(move_3.Geometry)  # disabled

# ---- group: on 3d view
mesh_12 = Mesh(filter_2)  # disabled

# ---- group: on lego
mesh_13 = Mesh(filter_3)  # disabled

# ==== cluster RndReduceByRatio
L = ClusterInput()
B = ClusterInput()
lng = ListLength(List=L)
S = ClusterInput()
multiplication = Multiplication(A=lng, B=B)
reduce = RandomReduce(List=L, Reduction=multiplication, Seed=S)
L_2 = ClusterOutput(reduce)

# ==== cluster Perspective
int = ClusterInput()
int_2 = ClusterInput()
pt = ClusterInput()

# ---- group: grid extent y
int_3 = Integer(int)

# ---- group: grid extent x
int_4 = Integer(int_2)

# ---- group: Pts Sample Grid Corner
pt_2 = Point(pt)

# ----
subtraction = Subtraction(A=int_4, B=1)
subtraction_2 = Subtraction(A=int_3, B=1)
item = ListItem(List=pt_2, Index=0, Wrap=False)
item_2 = ListItem(List=pt_2, Index=1, Wrap=False)
item_3 = ListItem(List=pt_2, Index=2, Wrap=False)
item_4 = ListItem(List=pt_2, Index=3, Wrap=False)
pt_3 = Point(item_4)
pt_4 = Point(item)
ln = Line(StartPoint=pt_3, EndPoint=pt_4)
pt_5 = Point(item_2)
ln_2 = Line(StartPoint=pt_4, EndPoint=pt_5)
pt_6 = Point(item_3)
ln_3 = Line(StartPoint=pt_6, EndPoint=pt_3)
ln_4 = Line(StartPoint=pt_5, EndPoint=pt_6)
llx = LineLine(Line1=ln, Line2=ln_4)  # -> ParamA, ParamB, PointA, PointB
pt_7 = Point(llx.PointA)
llx_2 = LineLine(Line1=ln_2, Line2=ln_3)  # -> ParamA, ParamB, PointA, PointB
pt_8 = Point(llx_2.PointA)
vec2pt = Vector2Pt(PointA=pt_8, PointB=pt_7, Unitize=False)  # -> Vector, Length
line = LineSDL(Start=pt_3, Direction=vec2pt.Vector, Length=1)
llx_3 = LineLine(Line1=ln_2, Line2=line)  # -> ParamA, ParamB, PointA, PointB
pt_9 = Point(llx_3.PointA)
ln_5 = Line(StartPoint=pt_3, EndPoint=pt_9)
divide = DivideCurve(Curve=ln_5, Count=subtraction_2, Kinks=False)  # -> Points, Tangents, Parameters
ln_6 = Line(StartPoint=pt_8, EndPoint=divide.Points)
llx_4 = LineLine(Line1=ln_4, Line2=line)  # -> ParamA, ParamB, PointA, PointB
pt_10 = Point(llx_4.PointA)
ln_7 = Line(StartPoint=pt_3, EndPoint=pt_10)
divide_2 = DivideCurve(Curve=ln_7, Count=subtraction, Kinks=False)  # -> Points, Tangents, Parameters
ln_8 = Line(StartPoint=pt_7, EndPoint=divide_2.Points)
ln_9 = Line(StartPoint=pt_8, EndPoint=pt_7)

# ---- group: x
line_2 = Line(ln_8)

# ---- group: y
line_3 = Line(ln_6)

# ----
graft = GraftTree(Tree=ln_6, IncludeEmptyLists=True, IncludeNullItems=True)
llx_5 = LineLine(Line1=line_2, Line2=graft)  # -> ParamA, ParamB, PointA, PointB

# ---- group: keystoned grid pts
pt_11 = Point(llx_5.PointA)

# ----
pt_12 = ClusterOutput(pt_11)

# ==== cluster GeoBottomCenter
geo = ClusterInput()
geo_2 = Geometry(geo)
bbox = BoundingBox(Content=geo_2, Plane=PlaneXY(0, 0, 0))  # -> Box, Box_2
box_corners = BoxCorners(Box=bbox.Box)  # -> CornerA, CornerB, CornerC, CornerD, CornerE, CornerF, CornerG, CornerH
pdecon = Deconstruct(Point=box_corners.CornerA)  # -> XComponent, YComponent, ZComponent
pdecon_2 = Deconstruct(Point=box_corners.CornerC)  # -> XComponent, YComponent, ZComponent
addition = Addition(A=pdecon.XComponent, B=pdecon_2.XComponent)
addition_2 = Addition(A=pdecon.YComponent, B=pdecon_2.YComponent)
division = Division(A=addition, B=2)
division_2 = Division(A=addition_2, B=2)
pt = ConstructPoint(XCoordinate=division, YCoordinate=division_2, ZCoordinate=pdecon.ZComponent)
pt_2 = Point(pt)
pt_3 = ClusterOutput(pt_2)

# ==== cluster GetPlaneFrom2pts
pt = ClusterInput()
pt_2 = ClusterInput()

# ---- group: current cam tgt pos
pt_3 = Point(pt)

# ---- group: current cam pos
pt_4 = Point(pt_2)

# ----
Z = UnitZ(Factor=100)
move = Move(Geometry=pt_3, Motion=Z)  # -> Geometry, Transform
pl_3pt = Plane3Pt(PointA=pt_3, PointB=pt_4, PointC=move.Geometry)
pt_5 = PointOriented(BasePlane=pl_3pt, UComponent=0, VComponent=0, WComponent=-100)
pt_6 = PointOriented(BasePlane=pl_3pt, UComponent=0, VComponent=100, WComponent=0)
pl_3pt_2 = Plane3Pt(PointA=pt_3, PointB=pt_5, PointC=pt_6)
pln = Plane(pl_3pt_2)
pln_2 = ClusterOutput(pln)
