# Grasshopper definition 180616_BentoScope_Madrid.gh (Grasshopper 0.9.76)
# plug-ins: Python Interpreter, Firefly.X, Human, gHowl, LunchBox

# ---- group: manual color space calibration for dock / Sample White
pt = Point(<point referenced from the Rhino model>)

# ---- group: manual color space calibration for dock / Sample Black
pt_2 = Point(<point referenced from the Rhino model>)

# ---- group: manual color space calibration for dock / Sample Yellow
pt_3 = Point(<point referenced from the Rhino model>)  # disabled

# ---- group: manual color space calibration for dock / Sample Blue
pt_4 = Point(<point referenced from the Rhino model>)  # disabled

# ---- group: manual color space calibration for dock / Sample Green
pt_5 = Point(<point referenced from the Rhino model>)  # disabled

# ---- group: manual color space calibration for dock / Sample Red
pt_6 = Point(<point referenced from the Rhino model>)

# ----
pdecon = Deconstruct(Point=pt)  # -> XComponent, YComponent, ZComponent
pdecon_2 = Deconstruct(Point=pt_2)  # -> XComponent, YComponent, ZComponent
pdecon_3 = Deconstruct(Point=pt_6)  # -> XComponent, YComponent, ZComponent
pdecon_4 = Deconstruct(Point=pt_3)  # -> XComponent, YComponent, ZComponent
pdecon_5 = Deconstruct(Point=pt_4)  # -> XComponent, YComponent, ZComponent
pdecon_6 = Deconstruct(Point=pt_5)  # -> XComponent, YComponent, ZComponent
frgb = ColourRGBF(Alpha=1, Red=pdecon.XComponent, Green=pdecon.YComponent, Blue=pdecon.ZComponent)
frgb_2 = ColourRGBF(Alpha=1, Red=pdecon_2.XComponent, Green=pdecon_2.YComponent, Blue=pdecon_2.ZComponent)
frgb_3 = ColourRGBF(Alpha=1, Red=pdecon_3.XComponent, Green=pdecon_3.YComponent, Blue=pdecon_3.ZComponent)
frgb_4 = ColourRGBF(Alpha=1, Red=pdecon_4.XComponent, Green=pdecon_4.YComponent, Blue=pdecon_4.ZComponent)
frgb_5 = ColourRGBF(Alpha=1, Red=pdecon_5.XComponent, Green=pdecon_5.YComponent, Blue=pdecon_5.ZComponent)
frgb_6 = ColourRGBF(Alpha=1, Red=pdecon_6.XComponent, Green=pdecon_6.YComponent, Blue=pdecon_6.ZComponent)
merge = Merge(Data1=frgb, Data2=frgb_2, Data3=frgb_3, Data4=frgb_4, Data5=frgb_5, Data6=frgb_6)

# ---- group: Relative Filepath
vb = VBScript()  # -> out, A
# ---------- vb: VB ----------
    Dim gh_d As GH_Document = owner.OnPingDocument()

    If gh_d.IsFilePathDefined Then
      Print("A path is defined.")
      A = gh_d.FilePath
    Else
      Print("No path defined.")
    End If
# ---------- end vb ----------
panel = Panel(vb.out)
panel_2 = Panel(vb.A)
split = TextSplit(Text=panel_2, Separators="\")
shift = ShiftList(List=split, Shift=-1, Wrap=False)
txt = Text(flatten("Data\180615_Camera Capture_Madrid_table2.PNG"))
txt_2 = Text(flatten(shift))
join = TextJoin(Text=flatten([txt_2, txt]), Join="\")
path = FilePath(join)
panel_3 = Panel(path)

# ---- group: All Manual Reference Colors
col = Colour(merge)

# ---- group: heatmap transparent
number_slider = Slider(0.8, range=0..1)

# ---- group: all ref colors
col_2 = Colour(col)

# ---- group: Walkable distance
index = Slider(500, range=1..1500)

# ---- group: right click -> Slow(1s)
video_stream = WebCamVideoStream()  # disabled

# ----
pushtempstep = Button()

# ---- group: AI Step (manual)
aisteptest = Slider(24, range=-1..24)

# ----
slider1 = Slider(0.5, range=0..1)
slider2 = Slider(0, range=0..1)
list = ValueList({"Small": 440, "Large": 1760}, selected="Small")
subtraction = Subtraction(A="1", B=number_slider)

# ---- group: manual or CV
list_2 = ValueList({"manual": 0, "CV": 1}, selected="manual")

# ---- group: Tuo's heatmap transparency
num = Number(subtraction)

# ---- group: ref color pop area
crv = Curve(<curve referenced from the Rhino model>)

# ----
path_2 = FilePath(path)

# ---- group: all rotations
panel_4 = Panel("270,270,270,270,270,270,270,270,270,270,270,270,270,270,270,270,270,270,270,270,270,270,270,270,270,270,270,270,270,270,270,270,180,180,180,180,180,180,180,180,180,180,180,180,180,180,180,180,180,180,180,180,180,180,180,180,180,180,180,180,180,180,180,180,90,90,90,90,90,90,90,90,90,90,90,90,90,90,90,90,90,90,90,90,90,90,90,90,90,90,90,90,90,90,90,90,0,0,0,0,0,0,0,0,0,0,0,0,0,0,0,0,0,0,0,0,0,0,0,0,0,0,0,0,0,0,0,0")

# ---- group: all color code quarts (no rotation)
panel_5 = Panel("2,0,0,0\t2,1,0,0\t2,0,1,0\t2,0,0,1\t2,1,1,0\t2,1,0,1\t2,0,1,1\t2,1,1,1\t3,0,0,0\t3,1,0,0\t3,0,1,0\t3,0,0,1\t3,1,1,0\t3,1,0,1\t3,0,1,1\t3,1,1,1\t4,0,0,0\t4,1,0,0\t4,0,1,0\t4,0,0,1\t4,1,1,0\t4,1,0,1\t4,0,1,1\t4,1,1,1\t5,0,0,0\t5,1,0,0\t5,0,1,0\t5,0,0,1\t5,1,1,0\t5,1,0,1\t5,0,1,1\t5,1,1,1")

# ----
# Input Parameters
gridextent_x = Slider(16, range=2..48)
gridextent_y = Slider(16, range=2..48)

_0_reslux = Slider(5, range=1..25)
_1_resmed = Slider(4, range=1..25)
_2_resmu = Slider(2, range=1..25)
_3_comhq = Slider(3, range=1..25)
_4_commed = Slider(6, range=1..25)
# CityMatrix CV
_5_rescw = Slider(1, range=1..25)

set1 = Button()
set2 = Button()

# ---- group: Density Array - Initial - set1
panel_6 = Panel("""20
10
5
5
5
5""")

# ---- group: Density Array - running - set 2
panel_7 = Panel("""30
30
30
30
30
30""")

# ----
load_bitmap = LoadBitmap(FilePathToImageLocation=path_2)

# ---- group: Int Grid X Extent
number_slider_2 = Slider(16, range=1..20)

# ---- group: Int Grid Y Extent
number_slider_3 = Slider(16, range=1..20)

# ---- group: Pts Sample Grid Corner
pt_7 = Point([<point referenced from the Rhino model> x4])

# ---- group: color calibration dock / ref color pop area
crv_2 = Curve(<curve referenced from the Rhino model>)  # disabled

# ---- group: dock position ref pts
pt_8 = Point([<point referenced from the Rhino model> x4])

# ----
pline = PolyLine(Vertices=pt_7, Closed=False)

# ---- group: Sample Toggle
pt_9 = Point(<point referenced from the Rhino model>)

# ---- group: Sample Other
pt_10 = Point(<point referenced from the Rhino model>)

# ---- group: color ids
int = Integer("0")
int_2 = Integer("1")
int_3 = Integer("2")
panel_8 = Panel("3")  # disabled
int_4 = Integer(panel_8)  # disabled
panel_9 = Panel("4")  # disabled
int_5 = Integer(panel_9)  # disabled
panel_10 = Panel("5")  # disabled
int_6 = Integer(panel_10)  # disabled

# ---- group: slider postion ref lines
crv_3 = Curve(reparameterize(graft([<curve referenced from the Rhino model> x5])))

# ---- group: Sample Others
pt_11 = Point([<point referenced from the Rhino model> x3])

# ---- group: Sample Toggle
pt_12 = Point(<point referenced from the Rhino model>)

# ---- group: Sample Others
pt_13 = Point([<point referenced from the Rhino model> x3])

# ---- group: Color Space Calibration sliders / ref color pop area
crv_4 = Curve([<curve referenced from the Rhino model> x2])  # disabled

# ---- group: Sample Toggle
pt_14 = Point(<point referenced from the Rhino model>)

# ---- group: slider position ref pts
pt_15 = Point([<point referenced from the Rhino model> x2])

pt_16 = Point([<point referenced from the Rhino model> x2])

# ---- group: Color Space Calibration sliders / ref color pop area
crv_5 = Curve(<curve referenced from the Rhino model>)  # disabled

crv_6 = Curve(<curve referenced from the Rhino model>)  # disabled

# ---- group: live feed of webcam
data = Data(video_stream)

# ---- group: toggle 1 position ref pt
pt_17 = Point(<point referenced from the Rhino model>)

# ---- group: Sample Other
pt_18 = Point(<point referenced from the Rhino model>)

# ---- group: Sample Toggle
pt_19 = Point(<point referenced from the Rhino model>)

# ---- group: Color Space Calibration sliders / ref color pop area
crv_7 = Curve(<curve referenced from the Rhino model>)  # disabled

# ----
pdecon_7 = Deconstruct(Point=pt_19)  # -> XComponent, YComponent, ZComponent
pdecon_8 = Deconstruct(Point=pt_18)  # -> XComponent, YComponent, ZComponent

# ---- group: all color code quarts (with rotation)
panel_11 = Panel("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")

# ----
split_2 = TextSplit(Text=panel_4, Separators=",")
preview = CustomPreview(Geometry=pline, Shader=ColourSwatch(SwatchColor=RGB(255, 0, 230)))
pdecon_9 = Deconstruct(Point=pt_12)  # -> XComponent, YComponent, ZComponent
pdecon_10 = Deconstruct(Point=pt_11)  # -> XComponent, YComponent, ZComponent
pdecon_11 = Deconstruct(Point=pt_14)  # -> XComponent, YComponent, ZComponent
pdecon_12 = Deconstruct(Point=pt_13)  # -> XComponent, YComponent, ZComponent
merge_2 = Merge(Data1=int, Data2=int_2, Data3=int_3, Data4=int_4, Data5=int_5, Data6=int_6)

# ---- group: manual text city
panel_12 = Panel("""g,g,g,r,g,g,g,g,r,g,g,g,g,r,g,g
g,g,g,r,g,g,g,g,r,g,g,g,g,r,g,g
g,g,g,r,g,g,g,g,r,g,g,g,g,r,g,g
r,r,r,r,r,r,r,r,r,r,r,r,r,r,r,r
g,g,g,r,0,0,0,0,r,1,1,1,2,r,g,g
g,g,g,r,0,g,g,0,r,1,g,g,2,r,g,g
g,g,g,r,0,g,g,0,r,1,g,g,2,r,g,g
g,g,g,r,0,0,0,0,r,1,1,1,2,r,g,g
r,r,r,r,r,r,r,r,r,r,r,r,r,r,r,r
g,g,g,r,3,3,3,3,r,4,4,4,5,r,g,g
g,g,g,r,3,g,g,3,r,4,g,g,5,r,g,g
g,g,g,r,3,g,g,3,r,4,g,g,5,r,g,g
g,g,g,r,3,3,3,3,r,4,4,4,5,r,g,g
r,r,r,r,r,r,r,r,r,r,r,r,r,r,r,r
g,g,g,r,g,g,g,g,r,g,g,g,g,r,g,g
g,g,g,r,g,g,g,g,r,g,g,g,g,r,g,g""")

panel_13 = Panel("""b,r,b,b,b,b,r,b,b,b,b,r,b,b,b,b
r,r,r,r,r,r,r,r,r,r,r,r,r,r,r,r
b,r,b,b,b,b,r,b,b,b,b,r,b,b,b,b
b,r,b,g,g,b,r,b,g,g,b,r,b,g,g,b
b,r,b,g,g,b,r,b,g,g,b,r,b,g,g,b
b,r,b,b,b,b,r,b,b,b,b,r,b,b,b,b
r,r,r,r,r,r,r,r,r,r,r,r,r,r,r,r
b,r,b,b,b,b,r,4,4,4,4,r,3,3,3,3
b,r,b,g,g,b,r,4,g,g,4,r,3,g,g,3
b,r,b,g,g,b,r,4,g,g,4,r,3,g,g,3
b,r,b,b,b,b,r,4,4,4,4,r,3,3,3,3
r,r,r,r,r,r,r,r,r,r,r,r,r,r,r,r
b,r,2,2,2,2,r,1,1,1,1,r,0,0,0,0
b,r,2,g,g,2,r,1,g,g,1,r,0,g,g,0
b,r,2,g,g,2,r,1,g,g,1,r,0,g,g,0
b,r,2,2,2,2,r,1,1,1,1,r,0,0,0,0""")

# ---- group: startFlag
startflag = Button()
panel_14 = Panel(startflag)

# ----
pdecon_13 = Deconstruct(Point=pt_19)  # -> XComponent, YComponent, ZComponent
pdecon_14 = Deconstruct(Point=pt_18)  # -> XComponent, YComponent, ZComponent
frgb_7 = ColourRGBF(Alpha=1, Red=pdecon_7.XComponent, Green=pdecon_7.YComponent, Blue=pdecon_7.ZComponent)
frgb_8 = ColourRGBF(Alpha=1, Red=pdecon_8.XComponent, Green=pdecon_8.YComponent, Blue=pdecon_8.ZComponent)
multiplication = Multiplication(A=number_slider_3, B=2)
merge_3 = Merge(Data1=_0_reslux, Data2=_1_resmed, Data3=_2_resmu, Data4=_3_comhq, Data5=_4_commed, Data6=_5_rescw)
multiplication_2 = Multiplication(A=number_slider_2, B=2)
frgb_9 = ColourRGBF(Alpha=1, Red=pdecon_9.XComponent, Green=pdecon_9.YComponent, Blue=pdecon_9.ZComponent)
frgb_10 = ColourRGBF(Alpha=1, Red=pdecon_10.XComponent, Green=pdecon_10.YComponent, Blue=pdecon_10.ZComponent)
frgb_11 = ColourRGBF(Alpha=1, Red=pdecon_11.XComponent, Green=pdecon_11.YComponent, Blue=pdecon_11.ZComponent)
frgb_12 = ColourRGBF(Alpha=1, Red=pdecon_12.XComponent, Green=pdecon_12.YComponent, Blue=pdecon_12.ZComponent)

# ---- group: All Colors IDs
int_7 = Integer(merge_2)

# ----
frgb_13 = ColourRGBF(Alpha=1, Red=pdecon_13.XComponent, Green=pdecon_13.YComponent, Blue=pdecon_13.ZComponent)
frgb_14 = ColourRGBF(Alpha=1, Red=pdecon_14.XComponent, Green=pdecon_14.YComponent, Blue=pdecon_14.ZComponent)

# ---- group: all rotations reference
txt_3 = Text(split_2)

# ----
merge_4 = Merge(Data1=frgb_7, Data2=frgb_8)

# ---- group: webcam stream
data_2 = Data(data)

bmp = BitmapToModify(data_2)

bmp_2 = BitmapToModify(data_2)

bmp_3 = BitmapToModify(data_2)

bmp_4 = BitmapToModify(data_2)

bmp_5 = BitmapToModify(data_2)

# ----
sample = BitmapSampler(BitmapToModify=bmp_5, PointToSample=pt_17, BitmapToModify_2=bmp_5, PointToSample_2=pt_17, bitmap_filter=0)  # -> SampledImageData, SampledImageData_2
sample_2 = BitmapSampler(BitmapToModify=bmp, PointToSample=pt_8, BitmapToModify_2=bmp, PointToSample_2=pt_8, bitmap_filter=0)  # -> SampledImageData, SampledImageData_2
merge_5 = Merge(Data1=frgb_11, Data2=frgb_12)
col_3 = Colour(sample.SampledImageData_2)
merge_6 = Merge(Data1=frgb_9, Data2=frgb_10)
col_4 = Colour(sample_2.SampledImageData_2)
pline_2 = PolyLine(Vertices=pt_15, Closed=False)  # -> reparameterize(Polyline)
pline_3 = PolyLine(Vertices=pt_16, Closed=False)  # -> reparameterize(Polyline)
merge_7 = Merge(Data1=frgb_13, Data2=frgb_14)
perspective = Perspective(pt=pt_7, int_2=multiplication_2, int=multiplication)
panel_15 = Panel(txt_3)

# ---- group: tab
panel_16 = Panel("\t")

# ----
split_3 = TextSplit(Text=panel_11, Separators=panel_16)
divide = DivideCurve(Curve=crv_3, Count=Slider(1, range=1..99), Kinks=False)  # -> Points, Tangents, Parameters
divide_2 = DivideCurve(Curve=pline_2, Count=Slider(14, range=9..99), Kinks=False)  # -> Points, Tangents, Parameters
divide_3 = DivideCurve(Curve=pline_3, Count=Slider(21, range=9..99), Kinks=False)  # -> Points, Tangents, Parameters

# ---- group: All Manual Reference Colors
col_5 = Colour(merge_4)

# ---- group: gridExtent_y
int_8 = Integer(gridextent_y)

# ---- group: floor num for each type
int_9 = Integer(merge_3)

# ---- group: gridExtent_x
int_10 = Integer(gridextent_x)

# ---- group: All Manual Reference Colors
col_6 = Colour(merge_6)

col_7 = Colour(merge_5)

# ----
preview_2 = CustomPreview(Geometry=pline_2, Shader=ColourSwatch(SwatchColor=RGB(255, 0, 230)))
preview_3 = CustomPreview(Geometry=pline_3, Shader=ColourSwatch(SwatchColor=RGB(255, 0, 230)))

# ---- group: All Manual Reference Colors
col_8 = Colour(merge_7)

# ---- group: manual color space calibration for grid / Sample White
pt_20 = Point(<point referenced from the Rhino model>)

# ---- group: manual color space calibration for grid / Sample Black
pt_21 = Point(<point referenced from the Rhino model>)

# ---- group: manual color space calibration for grid / Sample Red
pt_22 = Point(<point referenced from the Rhino model>)

# ---- group: manual color space calibration for grid / Sample Yellow
pt_23 = Point(<point referenced from the Rhino model>)  # disabled

# ---- group: manual color space calibration for grid / Sample Blue
pt_24 = Point(<point referenced from the Rhino model>)  # disabled

# ---- group: manual color space calibration for grid / Sample Green
pt_25 = Point(<point referenced from the Rhino model>)  # disabled

# ---- group: all color quarts reference
txt_4 = Text(split_3)

# ----
lng = ListLength(List=txt_4)

# ---- group: Position Calibration / CityMatrix CV Calibration
mesh = MeshFromImage(Bmp=data_2, Sx=Domain(0, 1), Sy=Domain(0, 1), Z=0, C=True)  # disabled

# ----
pdecon_15 = Deconstruct(Point=pt_20)  # -> XComponent, YComponent, ZComponent
pdecon_16 = Deconstruct(Point=pt_21)  # -> XComponent, YComponent, ZComponent
pdecon_17 = Deconstruct(Point=pt_22)  # -> XComponent, YComponent, ZComponent
pdecon_18 = Deconstruct(Point=pt_23)  # -> XComponent, YComponent, ZComponent
pdecon_19 = Deconstruct(Point=pt_24)  # -> XComponent, YComponent, ZComponent
pdecon_20 = Deconstruct(Point=pt_25)  # -> XComponent, YComponent, ZComponent
cp = ClosestPoint(Point=col_4, Cloud=col_2)  # -> ClosestPoint, CPIndex, Distance

# ---- group: x
series = Series(Start=0, Step=1, Count=number_slider_2)

# ---- group: y
series_2 = Series(Start=0, Step=1, Count=number_slider_3)

# ---- group: slider and toggle ref colors
col_9 = Colour(col_5)

col_10 = Colour(col_6)

col_11 = Colour(col_7)

# ----
division = Division(A=lng, B="4")

# ---- group: webcam stream
bmp_6 = BitmapToModify(data_2)

# ---- group: slider sample pts
pt_26 = Point(divide.Points)

# ----
line = LineSDL(Start=pt_26, Direction=Vector(1, 0, 0), Length=0.005)
frgb_15 = ColourRGBF(Alpha=1, Red=pdecon_15.XComponent, Green=pdecon_15.YComponent, Blue=pdecon_15.ZComponent)
frgb_16 = ColourRGBF(Alpha=1, Red=pdecon_16.XComponent, Green=pdecon_16.YComponent, Blue=pdecon_16.ZComponent)
frgb_17 = ColourRGBF(Alpha=1, Red=pdecon_17.XComponent, Green=pdecon_17.YComponent, Blue=pdecon_17.ZComponent)
frgb_18 = ColourRGBF(Alpha=1, Red=pdecon_18.XComponent, Green=pdecon_18.YComponent, Blue=pdecon_18.ZComponent)
frgb_19 = ColourRGBF(Alpha=1, Red=pdecon_19.XComponent, Green=pdecon_19.YComponent, Blue=pdecon_19.ZComponent)
frgb_20 = ColourRGBF(Alpha=1, Red=pdecon_20.XComponent, Green=pdecon_20.YComponent, Blue=pdecon_20.ZComponent)

# ---- group: slider sample pts
pt_27 = Point(divide_2.Points)

# ----
line_2 = LineSDL(Start=pt_27, Direction=Vector(1, 0, 0), Length=0.005)

# ---- group: slider sample pts
pt_28 = Point(divide_3.Points)

# ----
line_3 = LineSDL(Start=pt_28, Direction=Vector(1, 0, 0), Length=0.005)

# ---- group: slider and toggle ref colors
col_12 = Colour(col_8)

# ----
cp_2 = ClosestPoint(Point=graft(col_3), Cloud=col_12)  # -> ClosestPoint, CPIndex, Distance
pshift = ShiftPaths(Data=cp_2.CPIndex, Offset=-1)

# ---- group: color ID
int_11 = Integer(pshift)

# ----
item = ListItem(List=int_7, Index=cp.CPIndex, Wrap=False)
sample_3 = BitmapSampler(BitmapToModify=bmp_2, PointToSample=pt_26, BitmapToModify_2=bmp_2, PointToSample_2=pt_26, bitmap_filter=0)  # -> SampledImageData, SampledImageData_2
panel_17 = Panel(txt_4)
sample_4 = BitmapSampler(BitmapToModify=bmp_3, PointToSample=pt_27, BitmapToModify_2=bmp_3, PointToSample_2=pt_27, bitmap_filter=0)  # -> SampledImageData, SampledImageData_2
sample_5 = BitmapSampler(BitmapToModify=bmp_4, PointToSample=pt_28, BitmapToModify_2=bmp_4, PointToSample_2=pt_28, bitmap_filter=0)  # -> SampledImageData, SampledImageData_2
multiplication_3 = Multiplication(A=series_2, B=4)
series_3 = Series(Start=0, Step=1, Count=division)
multiplication_4 = Multiplication(A=series, B=2)
merge_8 = Merge(Data1=frgb_15, Data2=frgb_16, Data3=frgb_17, Data4=frgb_18, Data5=frgb_19, Data6=frgb_20)
equals = Equality(FirstNumber=int_11, SecondNumber="0")  # -> Equality, Inequality

# ---- group: keystoned grid pts
pt_29 = Point(perspective)

# ---- group: color code of each smaple pt
int_12 = Integer(item)

# ----
rev = ReverseList(List=int_12)
txt_5 = Text(rev)
join_2 = TextJoin(Text=txt_5, Join=",")
pshift_2 = ShiftPaths(Data=series_3, Offset=-1)
multiplication_5 = Multiplication(A=division, B="4")
pshift_3 = ShiftPaths(Data=sample_3.SampledImageData_2, Offset=-1)
pshift_4 = ShiftPaths(Data=sample_4.SampledImageData_2, Offset=-1)
pshift_5 = ShiftPaths(Data=sample_5.SampledImageData_2, Offset=-1)
multiplication_6 = Multiplication(A=multiplication_3, B=number_slider_2)
pshift_6 = ShiftPaths(Data=pt_29, Offset=-1)

# ---- group: all sample pts
pt_30 = Point(pshift_6)

# ----
sample_6 = BitmapSampler(BitmapToModify=bmp_6, PointToSample=pt_30, BitmapToModify_2=bmp_6, PointToSample_2=pt_30, bitmap_filter=0)  # -> SampledImageData, SampledImageData_2

# ---- group: All Manual Reference Colors
col_13 = Colour(merge_8)

# ---- group: toggle 1 value
bool = Boolean(equals.Equality)

# ---- group: color code quart text data
txt_6 = Text(join_2)

# ----
panel_18 = Panel(txt_6)

# ---- group: sampled pts color
col_14 = Colour(pshift_3)

# ----
cp_3 = ClosestPoint(Point=graft(col_14), Cloud=col_9)  # -> ClosestPoint, CPIndex, Distance
pshift_7 = ShiftPaths(Data=cp_3.CPIndex, Offset=-1)

# ---- group: color IDs
int_13 = Integer(pshift_7)

# ----
dispatch = Dispatch(List=pt_26, DispatchPattern=int_13)  # -> ListA, ListB
pdecon_21 = Deconstruct(Point=dispatch.ListB)  # -> XComponent, YComponent, ZComponent
lng_2 = ListLength(List=dispatch.ListB)
ma = MassAddition(Input=pdecon_21.XComponent)  # -> Result, PartialResults
ma_2 = MassAddition(Input=pdecon_21.YComponent)  # -> Result, PartialResults
division_2 = Division(A=ma.Result, B=lng_2)
division_3 = Division(A=ma_2.Result, B=lng_2)
pt_31 = ConstructPoint(XCoordinate=division_2, YCoordinate=division_3, ZCoordinate=0)

# ---- group: average slide block pt
pt_32 = Point(pt_31)

# ----
crv_cp = CurveClosestPoint(Point=pt_32, Curve=crv_3)  # -> Point, Parameter, Distance
repeat = RepeatData(Data=pshift_2, Length=multiplication_5)

# ---- group: sampled pts color
col_15 = Colour(pshift_4)

# ----
cp_4 = ClosestPoint(Point=graft(col_15), Cloud=col_10)  # -> ClosestPoint, CPIndex, Distance
pshift_8 = ShiftPaths(Data=cp_4.CPIndex, Offset=-1)

# ---- group: color IDs
int_14 = Integer(pshift_8)

# ----
dispatch_2 = Dispatch(List=pt_27, DispatchPattern=int_14)  # -> ListA, ListB
pdecon_22 = Deconstruct(Point=dispatch_2.ListB)  # -> XComponent, YComponent, ZComponent
lng_3 = ListLength(List=dispatch_2.ListB)
ma_3 = MassAddition(Input=pdecon_22.XComponent)  # -> Result, PartialResults
ma_4 = MassAddition(Input=pdecon_22.YComponent)  # -> Result, PartialResults
division_4 = Division(A=ma_3.Result, B=lng_3)
division_5 = Division(A=ma_4.Result, B=lng_3)
pt_33 = ConstructPoint(XCoordinate=division_4, YCoordinate=division_5, ZCoordinate=0)

# ---- group: average slide block pt
pt_34 = Point(pt_33)

# ----
crv_cp_2 = CurveClosestPoint(Point=pt_34, Curve=pline_2)  # -> Point, Parameter, Distance

# ---- group: sampled pts color
col_16 = Colour(pshift_5)

# ----
cp_5 = ClosestPoint(Point=graft(col_16), Cloud=col_11)  # -> ClosestPoint, CPIndex, Distance
pshift_9 = ShiftPaths(Data=cp_5.CPIndex, Offset=-1)

# ---- group: color IDs
int_15 = Integer(pshift_9)

# ----
dispatch_3 = Dispatch(List=pt_28, DispatchPattern=int_15)  # -> ListA, ListB
pdecon_23 = Deconstruct(Point=dispatch_3.ListB)  # -> XComponent, YComponent, ZComponent
lng_4 = ListLength(List=dispatch_3.ListB)
ma_5 = MassAddition(Input=pdecon_23.XComponent)  # -> Result, PartialResults
ma_6 = MassAddition(Input=pdecon_23.YComponent)  # -> Result, PartialResults
division_6 = Division(A=ma_5.Result, B=lng_4)
division_7 = Division(A=ma_6.Result, B=lng_4)
pt_35 = ConstructPoint(XCoordinate=division_6, YCoordinate=division_7, ZCoordinate=0)

# ---- group: average slide block pt
pt_36 = Point(pt_35)

# ----
crv_cp_3 = CurveClosestPoint(Point=pt_36, Curve=pline_3)  # -> Point, Parameter, Distance
addition = Addition(A=multiplication_4, B=graft(multiplication_6))

# ---- group: module id data (manual)
txt_7 = Text(panel_13)

# ----
pshift_10 = ShiftPaths(Data=crv_cp.Parameter, Offset=-1)
pshift_11 = ShiftPaths(Data=crv_cp_2.Parameter, Offset=-1)
pshift_12 = ShiftPaths(Data=crv_cp_3.Parameter, Offset=-1)
pshift_13 = ShiftPaths(Data=repeat, Offset=-1)

# ---- group: all color quart ids reference
int_16 = Integer(pshift_13)

# ---- group: all sample color
col_17 = Colour(sample_6.SampledImageData_2)

# ----
pshift_14 = ShiftPaths(Data=addition, Offset=-1)

# ---- group: all ref colors
col_18 = Colour(col_13)

# ----
multiplication_7 = Multiplication(A=set2, B=2)
multiplication_8 = Multiplication(A=number_slider_2, B=2)
keysearch = KeyValueSearch(Keys=txt_4, Values=panel_15, Search=graft(txt_6))
keysearch_2 = KeyValueSearch(Keys=txt_4, Values=int_16, Search=graft(txt_6))
item_2 = ListItem(List=col_9, Index=int_13, Wrap=True)
panel_19 = Panel(int_16)
item_3 = ListItem(List=col_10, Index=int_14, Wrap=True)
item_4 = ListItem(List=col_11, Index=int_15, Wrap=True)
addition_2 = Addition(A=set1, B=multiplication_7)

# ---- group: slider read 0-1
num_2 = Number(pshift_10)

# ----
panel_20 = Panel(num_2)

# ---- group: slider read 0-1
num_3 = Number(pshift_11)

# ----
panel_21 = Panel(num_3)

# ---- group: slider read 0-1
num_4 = Number(pshift_12)

# ----
panel_22 = Panel(num_4)
addition_3 = Addition(A=pshift_14, B=multiplication_8)
preview_4 = CustomPreview(Geometry=pt_26, Shader=item_2)
addition_4 = Addition(A=pshift_14, B=1)
preview_5 = CustomPreview(Geometry=pt_27, Shader=item_3)
preview_6 = CustomPreview(Geometry=pt_28, Shader=item_4)
nullrep = ReplaceNulls(Items=keysearch, Replacements="0")  # -> Items, Count
nullrep_2 = ReplaceNulls(Items=num_2, Replacements=0)  # -> Items, Count
nullrep_3 = ReplaceNulls(Items=keysearch_2, Replacements="-1")  # -> Items, Count
nullrep_4 = ReplaceNulls(Items=num_3, Replacements=0)  # -> Items, Count
nullrep_5 = ReplaceNulls(Items=num_4, Replacements=0)  # -> Items, Count
panel_23 = Panel(addition_2)

# ---- group: Color Space Calibration sliders / all ref colors
col_19 = Colour(col_12)  # disabled

# ----
panel_24 = Panel("""2
1
1
1
1
1""")
addition_5 = Addition(A=addition_3, B=1)
pshift_15 = ShiftPaths(Data=nullrep_2.Items, Offset=-1)
item_5 = ListItem(List=pshift_15, Index=2, Wrap=False)
item_6 = ListItem(List=pshift_15, Index=3, Wrap=False)
item_7 = ListItem(List=pshift_15, Index=0, Wrap=False)
item_8 = ListItem(List=pshift_15, Index=1, Wrap=False)
item_9 = ListItem(List=pshift_15, Index=4, Wrap=False)

# ---- group: max id
int_17 = Integer("9")

# ----
pshift_16 = ShiftPaths(Data=nullrep_3.Items, Offset=-1)

# ---- group: slider1
num_5 = Number(nullrep_4.Items)

# ---- group: 3LevelSlider3
num_6 = Number(item_5)

# ---- group: slider2
num_7 = Number(nullrep_5.Items)

# ---- group: 3LevelSlider1
num_8 = Number(item_7)

# ---- group: 3LevelSlider2
num_9 = Number(item_8)

# ---- group: 3LevelSlider4
num_10 = Number(item_6)

# ---- group: 3LevelSlider5
num_11 = Number(item_9)

# ----
cp_6 = ClosestPoint(Point=col_17, Cloud=col_18)  # -> ClosestPoint, CPIndex, Distance
pshift_17 = ShiftPaths(Data=nullrep.Items, Offset=-1)
set1_2 = Integer(panel_6)
set2_2 = Integer(panel_7)

# ---- group: set number
integer = Integer(panel_23)

# ---- group: Color Space Calibration sliders / all ref colors
col_20 = Colour(col_9)  # disabled

# ---- group: max id
int_18 = Integer("7")

# ----
panel_25 = Panel("""1
1
1
1
1
1""")

# ---- group: Color Space Calibration sliders / all ref colors
col_21 = Colour(col_11)  # disabled

# ---- group: all sample color
col_22 = Colour(sample_6.SampledImageData_2)  # disabled

# ---- group: all ref colors
col_23 = Colour(col_18)  # disabled

# ---- group: Color Space Calibration sliders / all ref colors
col_24 = Colour(col_10)  # disabled

# ----
item_10 = ListItem(List=int_7, Index=cp_6.CPIndex, Wrap=False)
panel_26 = Panel("""10
10
10
10
10
10""")

# ---- group: color calibration dock / all ref colors
col_25 = Colour(col_2)  # disabled

# ---- group: dock id
int_19 = Integer(pshift_16)

# ---- group: dock rotation
int_20 = Integer("0")

# ---- group: color code of each smaple pt
int_21 = Integer(item_10)

# ---- group: Color Space Calibration sliders / all ref colors
col_26 = Colour(col_21)  # disabled

# ----
panel_27 = Panel("""15
15
15
15
15
15""")

# ---- group: sample pts
item_11 = ListItem(List=pt_30, Index=addition_3, Wrap=False)
item_12 = ListItem(List=pt_30, Index=pshift_14, Wrap=False)
item_13 = ListItem(List=pt_30, Index=addition_5, Wrap=False)
item_14 = ListItem(List=pt_30, Index=addition_4, Wrap=False)

# ----
repeat_2 = RepeatData(Data=Slider(0, range=0..360), Length=256)
panel_28 = Panel("""30
30
30
30
30
30""")

# ---- group: all 0
pshift_18 = ShiftPaths(Data=repeat_2, Offset=-1)

# ----
panel_29 = Panel("""29
30
30
30
30
30""")

# ---- group: color calibration dock / all ref colors
col_27 = Colour(col_25)  # disabled

# ---- group: x
int_22 = Integer([0, 1, 2, 3, 4, 5, 6, 7, 8, 9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])

# ---- group: y
int_23 = Integer([0, 0, 0, 0, 0, 0, 0, 0, 0, 0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])

# ---- group: rotation
int_24 = Integer(pshift_18)

# ----
panel_30 = Panel(int_22)
panel_31 = Panel(int_23)
panel_32 = Panel(int_24)

# ---- group: color codes
item_15 = ListItem(List=int_21, Index=pshift_14, Wrap=False)
item_16 = ListItem(List=int_21, Index=addition_3, Wrap=False)
item_17 = ListItem(List=int_21, Index=addition_5, Wrap=False)
item_18 = ListItem(List=int_21, Index=addition_4, Wrap=False)

# ----
# Densities
# Initial
panel_33 = Panel("""10
25
5
15
5
5""")
nullrep_6 = ReplaceNulls(Items=int_20, Replacements=0)  # -> Items, Count
nullrep_7 = ReplaceNulls(Items=bool, Replacements=False)  # -> Items, Count

# ---- group: 3LevelSlider5
num_12 = Number(num_11)

# ---- group: 3LevelSlider4
num_13 = Number(num_10)

# ---- group: 3LevelSlider3
num_14 = Number(num_6)

# ---- group: 3LevelSlider1
num_15 = Number(num_8)

# ---- group: 3LevelSlider2
num_16 = Number(num_9)

# ----
merge_9 = Merge(Data1=graft(item_15), Data2=graft(item_16), Data3=graft(item_17), Data4=graft(item_18))

# ---- group: color code quarts
int_25 = Integer(merge_9)

# ----
rev_2 = ReverseList(List=int_25)
txt_8 = Text(rev_2)
join_3 = TextJoin(Text=txt_8, Join=",")
pshift_19 = ShiftPaths(Data=join_3, Offset=-1)

# ---- group: color code quart texts data
txt_9 = Text(pshift_19)

# ----
panel_34 = Panel(txt_9)
keysearch_3 = KeyValueSearch(Keys=txt_4, Values=panel_15, Search=graft(txt_9))
nullrep_8 = ReplaceNulls(Items=keysearch_3, Replacements="0")  # -> Items, Count
keysearch_4 = KeyValueSearch(Keys=txt_4, Values=int_16, Search=graft(txt_9))
pshift_20 = ShiftPaths(Data=nullrep_8.Items, Offset=-1)
nullrep_9 = ReplaceNulls(Items=keysearch_4, Replacements="-1")  # -> Items, Count
pshift_21 = ShiftPaths(Data=pshift_20, Offset=-1)
pshift_22 = ShiftPaths(Data=nullrep_9.Items, Offset=-1)
pshift_23 = ShiftPaths(Data=pshift_22, Offset=-1)

# ---- group: all rotation data
int_26 = Integer(pshift_21)

# ---- group: all piece ids raw
int_27 = Integer(pshift_23)

# ----
limitmaxid = LimitMaxID(int_2=int_27, int=int_17)

# ---- group: all piece ids
int_28 = Integer(limitmaxid)

# ---- group: rotation
int_29 = Integer(int_26)

# ----
panel_35 = Panel(int_28)

# ---- group: module id (CV)
int_30 = Integer(int_28)

# ----
panel_36 = Panel(int_30)
nullrep_10 = ReplaceNulls(Items=int_19, Replacements=-1)  # -> Items, Count
nullrep_11 = ReplaceNulls(Items=num_5, Replacements=0)  # -> Items, Count

# ---- group: dock rotation
int_31 = Integer(nullrep_6.Items)

# ---- group: scale control
num_17 = Number(1000)
division_8 = Division(A=list, B=num_17)

# ----
panel_37 = Panel("""r,r,r,r,r,r,r,r,r,r,r,r,r,r,r,r
r,0,0,0,r,0,0,0,r,1,1,1,r,2,2,2
r,0,g,0,r,0,g,0,r,1,e,1,r,2,e,2
r,0,0,0,r,0,0,0,r,1,1,1,r,2,2,2
r,r,r,r,r,r,r,r,r,r,r,r,r,r,r,r
r,0,0,0,r,0,0,0,r,1,1,1,r,2,2,2
r,0,g,0,r,0,g,0,r,1,e,1,r,2,e,2
r,0,0,0,r,0,0,0,r,1,1,1,r,2,2,2
r,r,r,r,r,r,r,r,r,r,r,r,r,r,r,r
r,3,3,3,r,3,3,3,r,4,4,4,r,5,5,5
r,3,e,3,r,3,e,3,r,4,g,4,r,5,g,5
r,3,3,3,r,3,3,3,r,4,4,4,r,5,5,5
r,r,r,r,r,r,r,r,r,r,r,r,r,r,r,r
r,3,3,3,r,3,3,3,r,4,4,4,r,5,5,5
r,3,e,3,r,3,e,3,r,4,g,4,r,5,g,5
r,3,3,3,r,3,3,3,r,4,4,4,r,5,5,5""")
panel_38 = Panel("""b,r,b,b,b,b,r,b,b,b,b,r,b,b,b,b
r,r,r,r,r,r,r,r,r,r,r,r,r,r,r,r
b,r,b,b,b,b,r,b,b,b,b,r,b,b,b,b
b,r,b,g,g,b,r,b,g,g,b,r,b,g,g,b
b,r,b,g,g,b,r,b,g,g,b,r,b,g,g,b
b,r,b,b,b,b,r,b,b,b,b,r,b,b,b,b
r,r,r,r,r,r,r,r,r,r,r,r,r,r,r,r
b,r,b,b,b,b,r,4,4,4,4,r,3,3,3,3
b,r,b,g,g,b,r,4,g,g,4,r,3,g,g,3
b,r,b,g,g,b,r,4,g,g,4,r,3,g,g,3
b,r,b,b,b,b,r,4,4,4,4,r,3,3,3,3
r,r,r,r,r,r,r,r,r,r,r,r,r,r,r,r
b,r,2,2,2,2,r,1,1,1,1,r,0,0,0,0
b,r,2,g,g,2,r,1,g,g,1,r,0,g,g,0
b,r,2,g,g,2,r,1,g,g,1,r,0,g,g,0
b,r,2,2,2,2,r,1,1,1,1,r,0,0,0,0""")
# Building Heights
panel_39 = Panel("""e,e,e,e,g,g,g,g,0,0,1,2,3,3,4,5
e,e,e,e,g,g,g,g,0,0,1,2,3,3,4,5
e,e,e,e,g,g,g,g,0,0,1,2,3,3,4,5
e,e,e,e,g,g,g,g,0,0,1,2,3,3,4,5
0,0,1,2,3,3,4,5,e,e,e,e,g,g,g,g
0,0,1,2,3,3,4,5,e,e,e,e,g,g,g,g
0,0,1,2,3,3,4,5,e,e,e,e,g,g,g,g
0,0,1,2,3,3,4,5,e,e,e,e,g,g,g,g
e,e,e,e,g,g,g,g,0,0,1,2,3,3,4,5
e,e,e,e,g,g,g,g,0,0,1,2,3,3,4,5
e,e,e,e,g,g,g,g,0,0,1,2,3,3,4,5
e,e,e,e,g,g,g,g,0,0,1,2,3,3,4,5
0,0,1,2,3,3,4,5,e,e,e,e,g,g,g,g
0,0,1,2,3,3,4,5,e,e,e,e,g,g,g,g
0,0,1,2,3,3,4,5,e,e,e,e,g,g,g,g
0,0,1,2,3,3,4,5,e,e,e,e,g,g,g,g""")
python = PythonScript(opt=division_8, grid_s=panel_37, grid_r=panel_38, grid_l=panel_39)  # -> out, grid
# ---------- python: Python ----------
if opt > 1:
    grid = grid_l
elif opt < 1:
    grid = grid_s
else:
    grid = grid_r
# ---------- end python ----------

# ---- group: manual text city
panel_40 = Panel(python.grid)

# ---- group: module id data (manual)
txt_10 = Text(panel_40)

# ----
rep = ReplaceText(Text=txt_10, Find="e", Replace="-1", RecursiveReplace=False)
rep_2 = ReplaceText(Text=rep, Find="r", Replace="6", RecursiveReplace=False)
rep_3 = ReplaceText(Text=rep_2, Find="g", Replace="7", RecursiveReplace=False)
rep_4 = ReplaceText(Text=rep_3, Find="b", Replace="0", RecursiveReplace=False)
panel_41 = Panel(rep_4)

# ---- group: module id data
txt_11 = Text(rep_4)

# ----
split_4 = TextSplit(Text=txt_11)
cull = CullPattern(List=split_4, CullPattern=[True, False])
join_4 = TextJoin(Text=cull, Join=",")
split_5 = TextSplit(Text=join_4, Separators=",")
pshift_24 = ShiftPaths(Data=split_5, Offset=-2)

# ---- group: all piece ids raw
int_32 = Integer(pshift_24)

# ----
limitmaxid_2 = LimitMaxID(int_2=int_32, int=int_18)

# ---- group: module id (manual)
# Grid Base Data
int_33 = Integer(limitmaxid_2)

# ----
panel_42 = Panel(int_33)
nullrep_12 = ReplaceNulls(Items=num_7, Replacements=0)  # -> Items, Count
# Densities
# Running
panel_43 = Panel("""30
1
1
1
1
1""")

# ---- group: module id (CV partial masked to manual)
int_34 = Integer(int_30)

# ---- group: module id (manual)
int_35 = Integer(int_33)

# ---- group: module id (CV)
int_36 = Integer(int_30)

# ---- group: toggle1
bool_2 = Boolean(nullrep_7.Items)

# ---- group: temp overide
panel_44 = Panel("1.0")

# ---- group: dockID
int_37 = Integer(nullrep_10.Items)

# ---- group: slider1
num_18 = Number(nullrep_11.Items)

# ---- group: slider2
num_19 = Number(nullrep_12.Items)

# ----
filter = StreamFilter(Gate=list_2, Stream0="1.0", Stream1=num_12)
filter_2 = StreamFilter(Gate=list_2, Stream0="1.0", Stream1=num_13)
filter_3 = StreamFilter(Gate=list_2, Stream0="1.0", Stream1=num_14)
filter_4 = StreamFilter(Gate=list_2, Stream0="1.0", Stream1=num_16)
filter_5 = StreamFilter(Gate=list_2, Stream0="1.0", Stream1=num_15)
filter_6 = StreamFilter(Gate=list_2, Stream0="0", Stream1=int_31)
filter_7 = StreamFilter(Gate=list_2, Stream0=Toggle(True), Stream1=bool_2)
filter_8 = StreamFilter(Gate=list_2, Stream0=int_35, Stream1=int_36)
filter_9 = StreamFilter(Gate=list_2, Stream0=slider1, Stream1=num_18)
filter_10 = StreamFilter(Gate=list_2, Stream0="-1", Stream1=int_37)
filter_11 = StreamFilter(Gate=list_2, Stream0=slider2, Stream1=num_19)

# ---- group: gridExtent_x
int_38 = Integer(int_10)

# ---- group: gridExtent_y
int_39 = Integer(int_8)

# ---- group: module id
int_40 = Integer(filter_8)

# ---- group: x
int_41 = Integer(int_22)

# ---- group: y
int_42 = Integer(int_23)

# ---- group: rotation
int_43 = Integer(int_24)

# ---- group: slider1
num_20 = Number(filter_9)

num_21 = Number(num_20)

# ---- group: slider2
num_22 = Number(filter_11)

# ---- group: dockID
int_44 = Integer(filter_10)

int_45 = Integer(int_44)

# ----
record_density_slider_set = RecordDensitySliderSet(int=int_45, num=num_21, integer=integer, set1=set1_2, set2=set2_2)

# ---- group: floor num for each type
int_46 = Integer(record_density_slider_set)

# ----
panel_45 = Panel(int_46)

nullrep_13 = ReplaceNulls(Items=int_46, Replacements=1)  # -> Items, Count

# ---- group: dock rotation
int_47 = Integer(filter_6)

# ---- group: toggle1
bool_3 = Boolean(panel_44)

# ---- group: floor num for each type
int_48 = Integer(nullrep_13.Items)

# ---- group: 3LevelSlider3
num_23 = Number(panel_44)

# ---- group: 3LevelSlider4
num_24 = Number(panel_44)

# ---- group: 3LevelSlider1
num_25 = Number(panel_44)

# ---- group: 3LevelSlider2
num_26 = Number(panel_44)

# ---- group: 3LevelSlider5
num_27 = Number(panel_44)

# ----
_3levelsliderstoweights_py = PythonScript(s0=num_25, s1=num_26, s2=num_23, s3=num_24, s4=num_27)  # -> out, weights
# ---------- _3levelsliderstoweights_py: Python ----------
if s0==0.0 and s1==0.0 and s2==0.0 and s3==0.0 and s4==0.0:
    weights = [0.0, 0.0, 0.0, 0.0, 0.0]
else:
    ts = [s0, s1, s2, s3, s4]
    tTotal = 0.0
    for t in ts:
        tTotal = tTotal + t
    print 'tTotal = ' + str(tTotal)
    weights = list(map(lambda x: x/tTotal, ts))
    print 'weights = ' + str(weights)
# ---------- end _3levelsliderstoweights_py ----------
togglestoweights_py = PythonScript()  # -> out, a, weights; disabled
# ---------- togglestoweights_py: Python ----------
if not bool0 and not bool1 and not bool2 and not bool3 and not bool4:
    weights = [0.0, 0.0, 0.0, 0.0, 0.0]
else:
    bools = [bool0, bool1, bool2, bool3, bool4]
    ts = list(map(lambda x: float(x), bools))
    tTotal = 0.0
    for t in ts:
        tTotal = tTotal + t
    print 'tTotal = ' + str(tTotal)
    weights = list(map(lambda x: x/tTotal, ts))
    print 'weights = ' + str(weights)
# ---------- end togglestoweights_py ----------
pshift_25 = ShiftPaths(Data=_3levelsliderstoweights_py.weights, Offset=-1)

# ---- group: AI weights
num_28 = Number(pshift_25)

# ----
panel_46 = Panel(num_28)

# ---- group: Toggle 1
# AI Step Control
bool_4 = Boolean(bool_3)

# ---- group: module id
int_49 = Integer(int_40)

# ---- group: works, no memory leak
initsticky_py = PythonScript()  # -> out, a
# ---------- initsticky_py: Python ----------
import scriptcontext as sc
import time

sc.sticky["count"] = -1
sc.sticky["bool"] = False

print(time.time())
sc.sticky["prevTime"] = time.time()


a = True
# ---------- end initsticky_py ----------
stickycount_py = PythonScript(x=bool_4, push=pushtempstep, tempStep=aisteptest, initiated=initsticky_py.a)  # -> out, a; inputs push: Boolean, tempStep: Int32
# ---------- stickycount_py: Python ----------
import scriptcontext as sc
import time

if initiated and not x == sc.sticky["bool"] :
    if time.time() - sc.sticky["prevTime"] >= 0.5 :
        sc.sticky["count"] = sc.sticky["count"] + 1
    sc.sticky["prevTime"] = time.time()

if push:
    print(push)
    sc.sticky["count"] = tempStep

sc.sticky["bool"] = x

print(sc.sticky["count"])
print(sc.sticky["prevTime"])
print(sc.sticky["bool"])
print(time.time())

a = sc.sticky["count"]
# ---------- end stickycount_py ----------

# ---- group: floor num for each type
int_50 = Integer(int_48)

# ----
min = Minimum(A=stickycount_py.a, B="24")
equals_2 = Equality(FirstNumber=int_49, SecondNumber="0")  # -> Equality, Inequality
equals_3 = Equality(FirstNumber=int_49, SecondNumber="1")  # -> Equality, Inequality
equals_4 = Equality(FirstNumber=int_49, SecondNumber="3")  # -> Equality, Inequality
equals_5 = Equality(FirstNumber=int_49, SecondNumber="2")  # -> Equality, Inequality
equals_6 = Equality(FirstNumber=int_49, SecondNumber="4")  # -> Equality, Inequality
equals_7 = Equality(FirstNumber=int_49, SecondNumber="5")  # -> Equality, Inequality
# Dashboard
number_slider_4 = Slider(0.4, range=0..1)
item_19 = ListItem(List=int_50, Index="0", Wrap=False)
item_20 = ListItem(List=int_50, Index="2", Wrap=False)
item_21 = ListItem(List=int_50, Index="1", Wrap=False)
item_22 = ListItem(List=int_50, Index="3", Wrap=False)

# ---- group: AI Step (manual)
int_51 = Integer(aisteptest)

# ----
panel_47 = Panel(int_51)
item_23 = ListItem(List=int_50, Index="4", Wrap=False)
item_24 = ListItem(List=int_50, Index="5", Wrap=False)

# ---- group: AI Step (CV)
int_52 = Integer(min)

# ----
panel_48 = Panel(int_52)

# ---- group: AI Step (manual)
aisteptest_2 = Slider(20, range=-1..24)

# ----
int_53 = Integer(equals_2.Equality)
int_54 = Integer(equals_3.Equality)
int_55 = Integer(equals_4.Equality)
int_56 = Integer(equals_5.Equality)

# ---- group: cell area
sqr = Square(Value=62.5)

# ----
int_57 = Integer(equals_6.Equality)
int_58 = Integer(equals_7.Equality)
filter_12 = StreamFilter(Gate=list_2, Stream0=int_51, Stream1=int_52)
ma_7 = MassAddition(Input=int_53)  # -> Result, PartialResults
ma_8 = MassAddition(Input=int_54)  # -> Result, PartialResults
ma_9 = MassAddition(Input=int_55)  # -> Result, PartialResults
ma_10 = MassAddition(Input=int_56)  # -> Result, PartialResults
ma_11 = MassAddition(Input=int_57)  # -> Result, PartialResults

# ---- group: building id 0 fl #
int_59 = Integer(item_19)

# ---- group: building id 2 fl #
int_60 = Integer(item_20)

# ---- group: building id 1 fl #
int_61 = Integer(item_21)

# ----
ma_12 = MassAddition(Input=int_58)  # -> Result, PartialResults

# ---- group: building id 3 fl #
int_62 = Integer(item_22)

# ---- group: building id 4 fl #
int_63 = Integer(item_23)

# ---- group: building id 5 fl #
int_64 = Integer(item_24)

# ----
multiplication_9 = Multiplication(A=sqr, B=number_slider_4)
int_65 = Integer(ma_7.Result)
panel_49 = Panel(int_65)
int_66 = Integer(ma_8.Result)
panel_50 = Panel(int_66)
int_67 = Integer(ma_9.Result)
panel_51 = Panel(int_67)
int_68 = Integer(ma_10.Result)
panel_52 = Panel(int_68)
int_69 = Integer(ma_11.Result)
panel_53 = Panel(int_69)
int_70 = Integer(ma_12.Result)
panel_54 = Panel(int_70)

# ---- group: AI Step
int_71 = Integer(filter_12)

# ----
panel_55 = Panel(int_71)

# ---- group: floor area
num_29 = Number(multiplication_9)

# ----
panel_56 = Panel("7003")  # disabled
panel_57 = Panel("127.0.0.1")  # disabled

# ---- group: Micro-unit Building #
int_72 = Integer(int_68)

# ---- group: Luxury Building #
int_73 = Integer(int_65)

# ---- group: Regular residential Building #
int_74 = Integer(int_66)

# ---- group: Head Quater Building #
int_75 = Integer(int_67)

# ---- group: Regular Office Building #
int_76 = Integer(int_69)

# ---- group: Co-working Building #
int_77 = Integer(int_70)

# ---- group: parking cell #
parking_cell = Slider(0, range=0..50)

# ----
txt_12 = Text(int_71)  # disabled

# ---- group: UDP Send to Unity AI
udp = UDPSender(Address=panel_57, Port=panel_56, Pattern=0, Data=txt_12)  # disabled

# ---- group: ppl per flr
panel_58 = Panel("18")
panel_59 = Panel("28")
panel_60 = Panel("63")
panel_61 = Panel("52")
panel_62 = Panel("87")
panel_63 = Panel("156")

# ---- group: park cell #
park_cell = Slider(150, range=0..150)

# ----
merge_10 = Merge(Data1=panel_58, Data2=panel_59, Data3=panel_60, Data4=panel_61, Data5=panel_62, Data6=panel_63)

# ---- group: how many floors in total
multiplication_10 = Multiplication(A=int_63, B=int_76)
multiplication_11 = Multiplication(A=int_61, B=int_74)
multiplication_12 = Multiplication(A=int_64, B=int_77)
multiplication_13 = Multiplication(A=int_60, B=int_72)
multiplication_14 = Multiplication(A=int_62, B=int_75)
multiplication_15 = Multiplication(A=int_59, B=int_73)

# ----
multiplication_16 = Multiplication(A=panel_62, B=multiplication_10)
multiplication_17 = Multiplication(A=panel_59, B=multiplication_11)
multiplication_18 = Multiplication(A=panel_60, B=multiplication_13)
multiplication_19 = Multiplication(A=panel_63, B=multiplication_12)
multiplication_20 = Multiplication(A=panel_61, B=multiplication_14)
multiplication_21 = Multiplication(A=panel_58, B=multiplication_15)

# ---- group: # ppl per flr
num_30 = Number(merge_10)

# ----
panel_64 = Panel("0")  # disabled

# ---- group: Regular Office ppl #
int_78 = Integer(multiplication_16)

# ---- group: Head Quater ppl #
int_79 = Integer(multiplication_20)

# ---- group: Co-working ppl #
int_80 = Integer(multiplication_19)

# ---- group: Micro-unit ppl #
int_81 = Integer(multiplication_18)

# ---- group: Luxury ppl #
int_82 = Integer(multiplication_21)

# ---- group: Regular residential ppl #
int_83 = Integer(multiplication_17)

# ----
ma_13 = MassAddition(Input=[int_80, int_78, int_79])  # -> Result, PartialResults
ma_14 = MassAddition(Input=[int_81, int_83, int_82])  # -> Result, PartialResults

# ---- group: gridExtent_x
int_84 = Integer(int_38)  # disabled

# ----
panel_65 = Panel(",\"data\":{\"traffic\":0,\"wait\":0,\"solar\":")  # disabled
panel_66 = Panel("}")  # disabled

# ---- group: sim result - averaged on each roof
num_31 = Number(panel_64)  # disabled

# ----
int_85 = Integer(num_31)  # disabled
txt_13 = Text(int_85)  # disabled
subtraction_2 = Subtraction(A=int_84, B=1)  # disabled
int_86 = Integer(int_41)  # disabled

# ---- group: total working ppl #
int_87 = Integer(ma_13.Result)

# ---- group: total residential ppl #
int_88 = Integer(ma_14.Result)

# ---- group: AI Step
int_89 = Integer(int_71)  # disabled

# ----
panel_67 = Panel(int_89)  # disabled

# ---- group: start flag
bool_5 = Boolean(startflag)  # disabled

# ---- group: AI weights
num_32 = Number(num_28)  # disabled

# ----
panel_68 = Panel(num_32)  # disabled
subtraction_3 = Subtraction(A=subtraction_2, B=int_86)  # disabled
# Send to Python Server (json, UDP)
panel_69 = Panel("{\"grid\":[")  # disabled
panel_70 = Panel("],\"objects\":{")  # disabled
panel_71 = Panel("}")  # disabled
panel_72 = Panel("\"toggle5\":")  # disabled
int_90 = Integer()  # disabled
panel_73 = Panel("\"toggle6\":")  # disabled
panel_74 = Panel("\"dockID\":")  # disabled
addition_6 = Addition(A=int_88, B=int_87)
int_91 = Integer()  # disabled
panel_75 = Panel("\"IDMax\":15,\"pop_young\":0,\"pop_mid\":0,\"pop_old\":0,\"AIMov\":[\"CELL\",0,0,0],\"animBlink\":0,\"score\":0.0,")  # disabled
int_92 = Integer(int_44)  # disabled
panel_76 = Panel("\"dockRotation\":")  # disabled
panel_77 = Panel("\"metrics\": {\"density\":{\"weight\":")  # disabled
panel_78 = Panel(",\"metric\":0.0},\"traffic\":{\"weight\":")  # disabled
panel_79 = Panel(",\"metric\":0.0},\"solar\":{\"weight\":")  # disabled
panel_80 = Panel(",\"metric\": 0.0}}")  # disabled
item_25 = ListItem(List=num_32, Index=0, Wrap=False)  # disabled
panel_81 = Panel("{\"type\":")  # disabled
txt_14 = Text(int_40)  # disabled
panel_82 = Panel(",\"x\":")  # disabled
txt_15 = Text(int_86)  # disabled
panel_83 = Panel(",\"y\":")  # disabled
txt_16 = Text(int_42)  # disabled
panel_84 = Panel(",\"rot\":")  # disabled
txt_17 = Text(int_43)  # disabled
panel_85 = Panel("}")  # disabled
panel_86 = Panel("\"slider1\":")  # disabled
txt_18 = Text(num_20)  # disabled
int_93 = Integer()  # disabled
panel_87 = Panel("\"toggle4\":")  # disabled
panel_88 = Panel("\"densities\":[")  # disabled
panel_89 = Panel(",\"metric\": 0.0},\"diversity\":{\"weight\":")  # disabled
panel_90 = Panel(",\"metric\":0.0},\"energy\":{\"weight\":")  # disabled
panel_91 = Panel("}")  # disabled
panel_92 = Panel("\"toggle2\":")  # disabled
int_94 = Integer()  # disabled
panel_93 = Panel("\"toggle3\":")  # disabled
int_95 = Integer()  # disabled
int_96 = Integer(int_47)  # disabled
int_97 = Integer(int_48)  # disabled
panel_94 = Panel(",")  # disabled
panel_95 = Panel("\"AIStep\":")  # disabled
int_98 = Integer(int_89)  # disabled
panel_96 = Panel("\"startFlag\":")  # disabled
int_99 = Integer(bool_5)  # disabled
panel_97 = Panel("\"slider2\":")  # disabled
int_100 = Integer(bool_3)  # disabled
txt_19 = Text(num_22)  # disabled
panel_98 = Panel("\"toggle1\":")  # disabled
panel_99 = Panel(",")  # disabled
txt_20 = Text(int_90)  # disabled
txt_21 = Text(int_91)  # disabled
txt_22 = Text(int_92)  # disabled
txt_23 = Text(int_96)  # disabled
txt_24 = Text(int_97)  # disabled
txt_25 = Text(int_98)  # disabled
txt_26 = Text(int_95)  # disabled
txt_27 = Text(int_99)  # disabled
txt_28 = Text(int_94)  # disabled
txt_29 = Text(int_93)  # disabled
txt_30 = Text(int_100)  # disabled
item_26 = ListItem(List=num_32, Index=1, Wrap=False)  # disabled
join_5 = TextJoin(Text=txt_24, Join=panel_94)  # disabled
panel_100 = Panel(",")  # disabled
panel_101 = Panel(",")  # disabled
panel_102 = Panel(",")  # disabled
panel_103 = Panel(",")  # disabled
panel_104 = Panel(",")  # disabled
panel_105 = Panel(",")  # disabled
panel_106 = Panel(",")  # disabled
panel_107 = Panel(",")  # disabled
panel_108 = Panel(",")  # disabled
panel_109 = Panel(",")  # disabled
panel_110 = Panel(",")  # disabled

# ---- group: total ppl #
int_101 = Integer(addition_6)

# ----
lng_5 = ListLength(List=txt_14)  # disabled
repeat_3 = RepeatData(Data=panel_84, Length=lng_5)  # disabled
repeat_4 = RepeatData(Data=panel_65, Length=lng_5)  # disabled
repeat_5 = RepeatData(Data=panel_66, Length=lng_5)  # disabled
repeat_6 = RepeatData(Data=panel_85, Length=lng_5)  # disabled
repeat_7 = RepeatData(Data=panel_83, Length=lng_5)  # disabled
repeat_8 = RepeatData(Data=panel_82, Length=lng_5)  # disabled
repeat_9 = RepeatData(Data=panel_81, Length=lng_5)  # disabled
join_6 = TextJoin(Text=[panel_74, txt_22, panel_102])  # disabled
join_7 = TextJoin(Text=[panel_72, txt_20, panel_100])  # disabled
join_8 = TextJoin(Text=[panel_73, txt_21, panel_101])  # disabled
join_9 = TextJoin(Text=[panel_95, txt_25, panel_103])  # disabled
item_27 = ListItem(List=num_32, Index=2, Wrap=False)  # disabled
join_10 = TextJoin(Text=[panel_87, txt_26, panel_105])  # disabled
join_11 = TextJoin(Text=[panel_92, txt_28, panel_106])  # disabled
join_12 = TextJoin(Text=[panel_93, txt_29, panel_107])  # disabled
join_13 = TextJoin(Text=[panel_86, txt_18, panel_104])  # disabled
join_14 = TextJoin(Text=[panel_97, txt_19, panel_108])  # disabled
join_15 = TextJoin(Text=[panel_98, txt_30, panel_109])  # disabled
panel_111 = Panel(",")  # disabled
panel_112 = Panel("],")  # disabled
pshift_26 = ShiftPaths(Data=repeat_3, Offset=-1)  # disabled
pshift_27 = ShiftPaths(Data=repeat_4, Offset=-1)  # disabled
pshift_28 = ShiftPaths(Data=repeat_6, Offset=-1)  # disabled
pshift_29 = ShiftPaths(Data=repeat_5, Offset=-1)  # disabled
pshift_30 = ShiftPaths(Data=repeat_8, Offset=-1)  # disabled
pshift_31 = ShiftPaths(Data=repeat_7, Offset=-1)  # disabled
pshift_32 = ShiftPaths(Data=repeat_9, Offset=-1)  # disabled
join_16 = TextJoin(Text=[panel_76, txt_23, panel_110])  # disabled
join_17 = TextJoin(Text=[panel_88, join_5, panel_112])  # disabled
join_18 = TextJoin(Text=[panel_96, txt_27, panel_111])  # disabled
panel_113 = Panel(int_101)
item_28 = ListItem(List=num_32, Index=3, Wrap=False)  # disabled
merge_11 = Merge(
    Data1=graft(pshift_32),
    Data2=graft(txt_14),
    Data3=graft(pshift_30),
    Data4=graft(txt_15),
    Data5=graft(pshift_31),
    Data6=graft(txt_16),
    Data7=graft(pshift_26),
    Data8=graft(txt_17),
    Data9=graft(pshift_27),
    Data10=graft(txt_13),
    Data11=graft(pshift_29),
    Data12=graft(pshift_28))  # disabled
item_29 = ListItem(List=num_32, Index=4, Wrap=False)  # disabled
join_19 = TextJoin(Text=merge_11)  # disabled
join_20 = TextJoin(Text=[panel_77, item_25, panel_89, item_26, panel_90, item_27, panel_78, item_28, panel_79, item_29, panel_80])  # disabled
pshift_33 = ShiftPaths(Data=join_19, Offset=-1)  # disabled
txt_31 = Text(pshift_33)  # disabled
panel_114 = Panel(txt_31)  # disabled
join_21 = TextJoin(Text=txt_31, Join=panel_99)  # disabled
txt_32 = Text(join_21)  # disabled
panel_115 = Panel("\"AIWeights\":[")  # disabled
num_33 = Number(num_32)  # disabled
panel_116 = Panel("\"IDMax\":15,\"pop_young\":0,\"pop_mid\":0,\"pop_old\":0,\"AIMov\":[\"CELL\",0,0,0],\"animBlink\":0,\"scores\":{\"density\":0,\"diversity\":0,\"energy\":0,\"traffic\":0,\"solar\":0}")  # disabled
panel_117 = Panel(",")  # disabled
txt_33 = Text(num_33)  # disabled
join_22 = TextJoin(Text=txt_33, Join=panel_117)  # disabled
panel_118 = Panel("],")  # disabled
join_23 = TextJoin(Text=[panel_115, join_22, panel_118])  # disabled
merge_12 = Merge(
    Data1=panel_69,
    Data2=txt_32,
    Data3=panel_70,
    Data4=join_13,
    Data5=join_14,
    Data6=join_15,
    Data8=join_6,
    Data9=join_16,
    Data10=join_17,
    Data11=join_9,
    Data12=join_18,
    Data14=join_23,
    Data15=panel_75,
    Data16=join_20,
    Data18=panel_91,
    Data19=panel_71)  # disabled
join_24 = TextJoin(Text=merge_12)  # disabled

# ---- group: json data to send
txt_34 = Text(join_24)  # disabled

# ----
panel_119 = Panel(txt_34)  # disabled

# ---- group: bk firefly udp, not as good as gHowl, data size limit too small
udp_sender = UDPSender(Data=txt_34, IPAddressOfUDPServer="127.0.0.1", UDPPort="7002")

# ---- group: send to another GH script
panel_120 = Panel("127.0.0.1")  # disabled
panel_121 = Panel("7000")  # disabled
udp_2 = UDPSender(Address=panel_120, Port=panel_121, Pattern=0, Data=txt_34)  # disabled

# ---- group: GH Profiler List_David Rutten_Jung
gh_profiler_list = VBScript()  # -> out; disabled
# ---------- gh_profiler_list: VB ----------
    If (_form IsNot Nothing) Then Return

    _form = New Form()
    _form.StartPosition = FormStartPosition.Manual
    _form.ShowInTaskbar = False
    _form.FormBorderStyle = FormBorderStyle.SizableToolWindow
    _form.Text = "Component List"
    AddHandler _form.FormClosing, AddressOf FormClosing

    _list = New ListView()
    _list.View = View.Details
    _list.AllowColumnReorder = False
    _list.MultiSelect = False
    _list.Columns.Add("Component", 200)
    _list.Columns.Add("Runtime", 80)
    _list.Dock = DockStyle.Fill
    AddHandler _list.ItemActivate, AddressOf ItemActivate
    _form.Controls.Add(_list)

    Grasshopper.GUI.GH_WindowsFormUtil.CenterFormOnCursor(_form, True)
    _form.Show(Instances.DocumentEditor)
    Instances.DocumentEditor.FormShepard.RegisterForm(_form)

    If (_handler) Then Return
    AddHandler GrasshopperDocument.SolutionEnd, AddressOf DocumentSolutionEnd
# ---------- gh_profiler_list: VB additional code ----------
  Private _form As Form
  Private _list As ListView
  Private _handler As Boolean = False

  Private Sub FormClosing(sender As Object, e As EventArgs)
    If (_form Is Nothing) Then Return
    RemoveHandler _form.FormClosing, AddressOf FormClosing
    RemoveHandler _list.ItemActivate, AddressOf ItemActivate

    _form = Nothing
    _list = Nothing
  End Sub
  Private Sub ItemActivate(sender As Object, e As EventArgs)
    Try
      Dim item As ListViewItem = _list.SelectedItems(0)
      Dim target As RectangleF = TryCast(item.Tag, IGH_DocumentObject).Attributes.Bounds
      Dim view As New Grasshopper.GUI.Canvas.GH_NamedView(Instances.ActiveCanvas.Viewport.ScreenPort, target)
      view.SetToViewport(Instances.ActiveCanvas, 350)
    Catch
    End Try
  End Sub

  Private Sub DocumentSolutionEnd(sender As Object, e As GH_SolutionEventArgs)
    If (_form Is Nothing) Then Return
    _list.Items.Clear()

    Dim doc As GH_Document = e.Document
    If (doc Is Nothing) Then Return
    If (doc.ObjectCount = 0) Then Return

    Dim times As Int64()
    Dim objects As IGH_DocumentObject()
    ReDim times(doc.ObjectCount - 1)
    ReDim objects(doc.ObjectCount - 1)
    For i As Int32 = 0 To doc.ObjectCount - 1
      Dim obj As IGH_ActiveObject = TryCast(doc.Objects(i), IGH_ActiveObject)
      If (obj Is Nothing) Then
        times(i) = 0
        objects(i) = doc.Objects(i)
        Continue For
      End If

      times(i) = obj.ProcessorTime.Ticks
      objects(i) = obj
    Next
    Array.Sort(times, objects)

    For i As Int32 = doc.ObjectCount - 1 To 0 Step -1
      If (times(i) < TimeSpan.TicksPerMillisecond) Then Continue For
      Dim item As New ListViewItem(objects(i).Name)
      item.Tag = objects(i)
      item.SubItems.Add(String.Format("{0:0} ms", New TimeSpan(times(i)).TotalMilliseconds))
      _list.Items.Add(item)
    Next
    _list.Invalidate()
  End Sub
# ---------- end gh_profiler_list ----------

# ----
# CityMatrix CV (UDP)
panel_122 = Panel("127.0.0.1")  # disabled
panel_123 = Panel("7002")  # disabled

# ---- group: mesh, flat
mesh_2 = Mesh([<mesh referenced from the Rhino model> x6])

# ----
volume = Volume(Geometry=mesh_2)  # -> Volume, Centroid
# -2 means static context
# -1 means empty site
# please manually replace -1
# to building types 0 to 5
# 0 means RL
# 1 means RM
# 2 means RS
# 3 means OL
# 4 means OM
# 5 means OS
number_slider_5 = Slider(0.97, range=0..1)
pdecon_24 = Deconstruct(Point=volume.Centroid)  # -> XComponent, YComponent, ZComponent
pt_37 = ConstructPoint(XCoordinate=pdecon_24.XComponent, YCoordinate=pdecon_24.YComponent, ZCoordinate=0)
scale = Scale(Geometry=mesh_2, Center=pt_37, Factor=number_slider_5)  # -> Geometry, Transform
mesh_3 = Mesh(scale.Geometry)

# ---- group: module meshes lego ref: -1
# Building Type Mesh
mesh_4 = Mesh(<mesh referenced from the Rhino model>)

# ---- group: module meshes lego ref: 0 to 5
mesh_5 = Mesh([<mesh referenced from the Rhino model> x6])

# ---- group: module meshes lego ref: 0 to 5 - with hight test
mesh_6 = Mesh([<mesh referenced from the Rhino model> x6])

# ----
# Input Parameters
gridextent_x_2 = Slider(16, range=2..48)
gridextent_y_2 = Slider(16, range=2..48)
toggle1 = BooleanToggle(False)
toggle2 = BooleanToggle(True)
toggle4 = BooleanToggle(False)
toggle3 = BooleanToggle(False)
toggle = BooleanToggle(False)  # disabled
# Animation Control
initstickyall_py = PythonScript()  # -> out, a; disabled
# ---------- initstickyall_py: Python ----------
import scriptcontext as sc
import time

sc.sticky["count"] = -1
sc.sticky["bool"] = False
sc.sticky["blink2"] = False

print(time.time())
sc.sticky["prevTime"] = time.time()


a = True
# ---------- end initstickyall_py ----------

# ---- group: mesh coloring
mesh_7 = Mesh(<mesh referenced from the Rhino model>)
res_color = ColourSwatch(SwatchColor=RGB(251, 255, 122))
res_gray = ColourSwatch(SwatchColor=RGB(227, 227, 227))
sidewalk = ColourSwatch(SwatchColor=RGB(107, 107, 107))
bikelane = ColourSwatch(SwatchColor=RGB(86, 135, 87))
off_gray = ColourSwatch(SwatchColor=RGB(171, 171, 171))
offcolor = ColourSwatch(SwatchColor=RGB(255, 122, 122))
parking = ColourSwatch(SwatchColor=RGB(196, 156, 100))
blank = ColourSwatch(SwatchColor=RGB(110, 110, 110))
road = ColourSwatch(SwatchColor=RGB(64, 64, 64))
park = ColourSwatch(SwatchColor=RGB(165, 201, 44))
text = ColourSwatch(SwatchColor=RGB(0, 0, 0))
res_warm = ColourSwatch(SwatchColor=RGB(255, 251, 230))
text_new = ColourSwatch(SwatchColor=RGB(64, 64, 64))
off_cold = ColourSwatch(SwatchColor=RGB(230, 242, 255))
mcol = MeshColours(Mesh=mesh_7, Colours=off_cold)
mesh_8 = Mesh(mcol)

# ----
udp_3 = UDPReceiver(Address=panel_122, Port=panel_123, Pattern=0)  # -> Info, Data; disabled

# ---- group: stickyInitiated
bool_6 = Boolean(initstickyall_py.a)  # disabled

bool_7 = Boolean(bool_6)  # disabled

# ----
mesh_9 = Mesh(mesh_3)

panel_124 = Panel("""r,r,r,r,r,r,r,r,r,r,r,r,r,r,r,r
r,0,0,0,r,0,0,0,r,1,1,1,r,2,2,2
r,0,g,0,r,0,g,0,r,1,e,1,r,2,e,2
r,0,0,0,r,0,0,0,r,1,1,1,r,2,2,2
r,r,r,r,r,r,r,r,r,r,r,r,r,r,r,r
r,0,0,0,r,0,0,0,r,1,1,1,r,2,2,2
r,0,g,0,r,0,g,0,r,1,e,1,r,2,e,2
r,0,0,0,r,0,0,0,r,1,1,1,r,2,2,2
r,r,r,r,r,r,r,r,r,r,r,r,r,r,r,r
r,3,3,3,r,3,3,3,r,4,4,4,r,5,5,5
r,3,e,3,r,3,e,3,r,4,g,4,r,5,g,5
r,3,3,3,r,3,3,3,r,4,4,4,r,5,5,5
r,r,r,r,r,r,r,r,r,r,r,r,r,r,r,r
r,3,3,3,r,3,3,3,r,4,4,4,r,5,5,5
r,3,e,3,r,3,e,3,r,4,g,4,r,5,g,5
r,3,3,3,r,3,3,3,r,4,4,4,r,5,5,5""")
panel_125 = Panel("""b,r,b,b,b,b,r,b,b,b,b,r,b,b,b,b
r,r,r,r,r,r,r,r,r,r,r,r,r,r,r,r
b,r,b,b,b,b,r,b,b,b,b,r,b,b,b,b
b,r,b,g,g,b,r,b,g,g,b,r,b,g,g,b
b,r,b,g,g,b,r,b,g,g,b,r,b,g,g,b
b,r,b,b,b,b,r,b,b,b,b,r,b,b,b,b
r,r,r,r,r,r,r,r,r,r,r,r,r,r,r,r
b,r,b,b,b,b,r,4,4,4,4,r,3,3,3,3
b,r,b,g,g,b,r,4,g,g,4,r,3,g,g,3
b,r,b,g,g,b,r,4,g,g,4,r,3,g,g,3
b,r,b,b,b,b,r,4,4,4,4,r,3,3,3,3
r,r,r,r,r,r,r,r,r,r,r,r,r,r,r,r
b,r,2,2,2,2,r,1,1,1,1,r,0,0,0,0
b,r,2,g,g,2,r,1,g,g,1,r,0,g,g,0
b,r,2,g,g,2,r,1,g,g,1,r,0,g,g,0
b,r,2,2,2,2,r,1,1,1,1,r,0,0,0,0""")
panel_126 = Panel("""e,e,e,e,g,g,g,g,0,0,1,2,3,3,4,5
e,e,e,e,g,g,g,g,0,0,1,2,3,3,4,5
e,e,e,e,g,g,g,g,0,0,1,2,3,3,4,5
e,e,e,e,g,g,g,g,0,0,1,2,3,3,4,5
0,0,1,2,3,3,4,5,e,e,e,e,g,g,g,g
0,0,1,2,3,3,4,5,e,e,e,e,g,g,g,g
0,0,1,2,3,3,4,5,e,e,e,e,g,g,g,g
0,0,1,2,3,3,4,5,e,e,e,e,g,g,g,g
e,e,e,e,g,g,g,g,0,0,1,2,3,3,4,5
e,e,e,e,g,g,g,g,0,0,1,2,3,3,4,5
e,e,e,e,g,g,g,g,0,0,1,2,3,3,4,5
e,e,e,e,g,g,g,g,0,0,1,2,3,3,4,5
0,0,1,2,3,3,4,5,e,e,e,e,g,g,g,g
0,0,1,2,3,3,4,5,e,e,e,e,g,g,g,g
0,0,1,2,3,3,4,5,e,e,e,e,g,g,g,g
0,0,1,2,3,3,4,5,e,e,e,e,g,g,g,g""")
python_2 = PythonScript(opt=division_8, grid_s=panel_124, grid_r=panel_125, grid_l=panel_126)  # -> out, grid; same code as python

# ---- group: json data received from GH CV
txt_35 = Text(udp_3.Data)  # disabled

# ---- group: gridExtent_y
int_102 = Integer(gridextent_y_2)

# ---- group: toggle1
bool_8 = Boolean(toggle1)

# ---- group: toggle2
bool_9 = Boolean(toggle2)

# ---- group: toggle3
bool_10 = Boolean(toggle3)

# ---- group: toggle4
bool_11 = Boolean(toggle4)

# ---- group: gridExtent_x
int_103 = Integer(gridextent_x_2)

# ---- group: AIWeights
num_34 = Number(num_28)

# ---- group: manual text city
panel_127 = Panel(python_2.grid)

# ----
toggle_2 = BooleanToggle(False)  # disabled

# ---- group: module id data (manual)
txt_36 = Text(panel_127)

# ----
series_4 = Series(Start=0, Step=0.003921568627, Count=256)

# ---- group: dell
path_3 = FilePath("C:\Users\RYAN\Dropbox (MIT)\01_Work\Share\_CityScope\CityMatrix_ML\00_Data\04_json format\initial JSON data for GH VIZ.json")  # disabled

# ---- group: ml
path_4 = FilePath("C:\Users\RYAN\Dropbox (Changing Places)\CPG_PROJECTS\CPG_CITYSCOPE\CityMatrix_ML\00_Data\04_json format\initial JSON data for GH VIZ.json")  # disabled

# ----
rep_5 = ReplaceText(Text=txt_36, Find="e", Replace="-1", RecursiveReplace=False)
rep_6 = ReplaceText(Text=rep_5, Find="r", Replace="6", RecursiveReplace=False)
rep_7 = ReplaceText(Text=rep_6, Find="g", Replace="7", RecursiveReplace=False)
rep_8 = ReplaceText(Text=rep_7, Find="b", Replace="5", RecursiveReplace=False)
panel_128 = Panel(rep_8)

# ---- group: x
num_35 = Number(int_41)

# ---- group: y
num_36 = Number(int_42)

# ---- group: type / module id
int_104 = Integer(int_40)

# ---- group: density list
num_37 = Number(int_46)

# ---- group: floor num for each type from server
# Building Heights
int_105 = Integer(num_37)

# ---- group: rotation
num_38 = Number(int_43)

# ----
file = ReadFile(File=path_3, PerLineParse=True)  # disabled

# ---- group: solar value new
num_39 = Number(series_4)

# ---- group: solar value
num_40 = Number(num_39)

# ---- group: traffic value new
num_41 = Number(series_4)

# ---- group: traffic value
num_42 = Number(num_41)

# ---- group: waiting time value new
num_43 = Number(series_4)

# ---- group: waiting time value
num_44 = Number(num_43)

# ---- group: module id data
txt_37 = Text(rep_8)

# ---- group: floor num for each type
int_106 = Integer(int_105)

# ----
panel_129 = Panel(int_106)

split_6 = TextSplit(Text=txt_37)

# ---- group: false: prediction; true: ai
bool_12 = Boolean(Toggle(False))

# ----
panel_130 = Panel(bool_12)

# ---- group: json data all blank
txt_38 = Text(file)  # disabled

# ---- group: is Null?
null = NullItem(Item=txt_35)  # -> NullFlags, InvalidFlags, Description; disabled
panel_131 = Panel(null.NullFlags)  # disabled

# ----
cull_2 = CullPattern(List=split_6, CullPattern=[True, False])
join_25 = TextJoin(Text=cull_2, Join=",")
split_7 = TextSplit(Text=join_25, Separators=",")

# ---- group: floor height
panel_132 = Panel("3.5")

# ----
multiplication_22 = Multiplication(A=int_106, B=panel_132)
pshift_34 = ShiftPaths(Data=split_7, Offset=-2)

# ---- group: if null, replace blank
filter_13 = StreamFilter(Gate=null.NullFlags, Stream0=txt_35, Stream1=txt_38)  # disabled

# ---- group: json string received
txt_39 = Text(filter_13)  # disabled

txt_40 = Text(filter_13)  # disabled

# ---- group: predict city
json_parsor_predict_py = PythonScript(jsonString=txt_40)  # -> out, types, xs, ys, rots, traffics, waits, solars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; disabled
# ---------- json_parsor_predict_py: Python ----------
import json

jsonData  = json.loads(jsonString)

predict = jsonData['predict']

grid = predict['grid']
#print str(grid)
rots = []
types = []
xs = []
ys = []
traffics = []
waits = []
solars = []
for cell in grid:
    #print cell
    rot = cell['rot']
    type = cell['type']
    x = cell['x']
    y = cell['y']
    
    # Traffic
    if type == 6: 
        #print "is road!"
        dataResult = cell['data']
        #print dataResult
        traffic = float(dataResult['traffic'])
        #print traffic
        wait = float(dataResult['wait'])
        #print wait
    else:
        #print "is NOT road!"
        traffic = -1.0
        wait = -1.0
    #print traffic
    #print wait
    rots.append(rot)
    types.append(type)
    xs.append(x)
    ys.append(y)
    traffics.append(traffic)
    waits.append(wait)
    
    # Solar
    dataResult = cell['data']
    solar = float(dataResult['solar'])
    solars.append(solar)
    
#print rots
#print types
#print xs
#print ys
#print traffics
#print waits

objects = predict['objects']
densities = objects['densities']

m = objects['metrics']
metrics = []
metrics.append(m['Density']['metric'])
metrics.append(m['Diversity']['metric'])
metrics.append(m['Energy']['metric'])
metrics.append(m['Traffic']['metric'])
metrics.append(m['Solar']['metric'])


AIStep = objects['AIStep']
#print 'AIStep: ' + str(AIStep)
toggle1 = objects['toggle1']
#print 'toggle1: ' + str(toggle1)
slider1 = objects['slider1']
#print 'slider1: ' + str(slider1)
slider2 = objects['slider2']
#print 'slider2: ' + str(slider2)
dockID = objects['dockID']
#print 'dockID: ' + str(dockID)
dockRotation = objects['dockRotation']
#print 'dockRotation: ' + str(dockRotation)
animBlink = objects['animBlink']
#print 'animBlink: ' + str(animBlink)


animActivation = True
# ---------- end json_parsor_predict_py ----------

# ---- group: UI / AI Step from Python Server
int_107 = Integer(json_parsor_predict_py.AIStep)  # disabled

# ---- group: UI / slider2
num_45 = Number(json_parsor_predict_py.slider2)  # disabled

# ---- group: UI / slider1
num_46 = Number(json_parsor_predict_py.slider1)  # disabled

# ---- group: UI / dockID
int_108 = Integer(json_parsor_predict_py.dockID)  # disabled

# ---- group: UI / toggle1
int_109 = Integer(json_parsor_predict_py.toggle1)  # disabled

# ---- group: UI / animBlink
int_110 = Integer(json_parsor_predict_py.animBlink)  # disabled

# ---- group: UI / dockRoatation
int_111 = Integer(json_parsor_predict_py.dockRotation)  # disabled

# ---- group: UI / animBlink
bool_13 = Boolean(int_110)  # disabled

# ---- group: UI
panel_133 = Panel(int_110)  # disabled
panel_134 = Panel(int_107)  # disabled
panel_135 = Panel("20")  # disabled
panel_136 = Panel(bool_13)  # disabled

# ---- group: PREDICT / type / module id
int_112 = Integer(json_parsor_predict_py.types)  # disabled

# ---- group: PREDICT / x
num_47 = Number(json_parsor_predict_py.xs)  # disabled

# ---- group: PREDICT / y
num_48 = Number(json_parsor_predict_py.ys)  # disabled

# ---- group: PREDICT / rotation
num_49 = Number(json_parsor_predict_py.rots)  # disabled

# ---- group: PREDICT / density list
num_50 = Number(json_parsor_predict_py.densities)  # disabled

# ---- group: PREDICT / traffic value
num_51 = Number(json_parsor_predict_py.traffics)  # disabled

# ---- group: PREDICT / metrics
num_52 = Number(json_parsor_predict_py.metrics)  # disabled

# ---- group: metrics current city
num_53 = Number(num_52)  # disabled

# ----
panel_137 = Panel(num_53)  # disabled

# ---- group: PREDICT / animActivation
bool_14 = Boolean(json_parsor_predict_py.animActivation)  # disabled

# ---- group: animActivation
bool_15 = Boolean(bool_14)  # disabled

# ----
blink2_py = PythonScript(activation=bool_15, initiated=bool_7)  # -> out, a; disabled
# ---------- blink2_py: Python ----------
import time
import math
import scriptcontext as sc

if initiated and activation:
    sc.sticky["blink2"] = not sc.sticky["blink2"]
    a = sc.sticky["blink2"]

print(a)
# ---------- end blink2_py ----------

# ---- group: blink anim
bool_16 = Boolean(blink2_py.a)  # disabled

# ----
panel_138 = Panel(bool_16)  # disabled

# ---- group: PREDICT / waiting time value
num_54 = Number(json_parsor_predict_py.waits)  # disabled

# ----
larger = LargerThan(FirstNumber=int_107, SecondNumber=panel_135)  # -> LargerThan, OrEqualTo; disabled

# ---- group: if ai step = 20 / show ai or not
filter_14 = StreamFilter(Gate=larger.OrEqualTo, Stream1=txt_39)  # disabled

# ---- group: ai city
json_parsor_ai_py = PythonScript(jsonString=filter_14)  # -> out, types, xs, ys, rots, traffics, waits, solars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; disabled
# ---------- json_parsor_ai_py: Python ----------
import json

jsonData  = json.loads(jsonString)

ai = jsonData['ai']

grid = ai['grid']
#print str(grid)
rots = []
types = []
xs = []
ys = []
traffics = []
waits = []
solars = []
for cell in grid:
    #print cell
    rot = cell['rot']
    type = cell['type']
    x = cell['x']
    y = cell['y']
    
    # Traffic
    if type == 6: 
        #print "is road!"
        dataResult = cell['data']
        #print dataResult
        traffic = float(dataResult['traffic'])
        #print traffic
        wait = float(dataResult['wait'])
        #print wait
    else:
        #print "is NOT road!"
        traffic = -1.0
        wait = -1.0
    #print traffic
    #print wait
    rots.append(rot)
    types.append(type)
    xs.append(x)
    ys.append(y)
    traffics.append(traffic)
    waits.append(wait)
    
    # Solar
    dataResult = cell['data']
    solar = float(dataResult['solar'])
    solars.append(solar)

objects = ai['objects']
#print str(objects)
densities = objects['densities']
#print str(densities)
score = objects['score']
#print str(scores)
AIWeights = objects['AIWeights']
AIMov = objects['AIMov']

m = objects['metrics']
metrics = []
metrics.append(m['Density']['metric'])
metrics.append(m['Diversity']['metric'])
metrics.append(m['Energy']['metric'])
metrics.append(m['Traffic']['metric'])
metrics.append(m['Solar']['metric'])
# ---------- end json_parsor_ai_py ----------

# ---- group: AIMov
data_3 = Data(json_parsor_ai_py.AIMov)

data_4 = Data(data_3)  # disabled

# ----
panel_139 = Panel(data_4)  # disabled

# ---- group: AI / type / module id
int_113 = Integer(json_parsor_ai_py.types)  # disabled

# ---- group: AI / x
num_55 = Number(json_parsor_ai_py.xs)  # disabled

# ---- group: AI / y
num_56 = Number(json_parsor_ai_py.ys)  # disabled

# ---- group: AI / rotation
num_57 = Number(json_parsor_ai_py.rots)  # disabled

# ---- group: AI / traffic value
num_58 = Number(json_parsor_ai_py.traffics)  # disabled

# ---- group: AI / metrics
num_59 = Number(json_parsor_ai_py.metrics)  # disabled

# ---- group: metrics suggested city
num_60 = Number(num_59)  # disabled

# ----
panel_140 = Panel(num_60)  # disabled

# ---- group: AI / animActivation
bool_17 = Boolean(json_parsor_ai_py.animActivation)  # disabled

# ---- group: AI / density list
num_61 = Number(json_parsor_ai_py.densities)  # disabled

# ---- group: AI / waiting time value
num_62 = Number(json_parsor_ai_py.waits)  # disabled

# ----
item_30 = ListItem(List=data_3, Index=0, Wrap=False)

# ---- group: solar value
num_63 = Number(json_parsor_predict_py.solars)  # disabled

num_64 = Number(json_parsor_ai_py.solars)  # disabled

# ----
panel_141 = Panel(data_3)

# ---- group: AIMovType
txt_41 = Text(item_30)

# ----
panel_142 = Panel(txt_41)
mindex = MemberIndex(Set=txt_41, Member="DENSITY")  # -> Index, Count
equals_8 = Equality(FirstNumber=mindex.Count, SecondNumber=1)  # -> Equality, Inequality

# ---- group: blink anim
filter_15 = StreamFilter(Gate=bool_12, Stream0=num_63, Stream1=num_64)  # disabled

filter_16 = StreamFilter(Gate=bool_12, Stream0=num_54, Stream1=num_62)  # disabled

filter_17 = StreamFilter(Gate=bool_12, Stream0=int_112, Stream1=int_113)  # disabled

filter_18 = StreamFilter(Gate=bool_12, Stream0=num_47, Stream1=num_55)  # disabled

filter_19 = StreamFilter(Gate=bool_12, Stream0=num_48, Stream1=num_56)  # disabled

filter_20 = StreamFilter(Gate=bool_12, Stream0=num_50, Stream1=num_61)  # disabled

filter_21 = StreamFilter(Gate=bool_12, Stream0=num_51, Stream1=num_58)  # disabled

filter_22 = StreamFilter(Gate=bool_12, Stream0=num_49, Stream1=num_57)  # disabled

bool_18 = Boolean(bool_13)  # disabled

# ----
panel_143 = Panel(bool_18)  # disabled

# ---- group: True: DENSITY; False: CELL
bool_19 = Boolean(equals_8.Equality)

# ----
filter_23 = StreamFilter(Gate=larger.OrEqualTo, Stream0=False, Stream1=toggle_2)  # disabled
filter_24 = StreamFilter(Gate=bool_19, Stream0=data_3)
filter_25 = StreamFilter(Gate=bool_19, Stream1=data_3)

# ---- group: Density Value Suggested
item_31 = ListItem(List=filter_25, Index=2, Wrap=False)
panel_144 = Panel(item_31)

# ---- group: Density idx
item_32 = ListItem(List=filter_25, Index=1, Wrap=False)
panel_145 = Panel(item_32)

# ---- group: Cell x
item_33 = ListItem(List=filter_24, Index=1, Wrap=False)
panel_146 = Panel(item_33)

item_34 = ListItem(List=filter_24, Index=2, Wrap=False)
panel_147 = Panel(item_34)

# ---- group: Cell new id
item_35 = ListItem(List=filter_24, Index=3, Wrap=False)
panel_148 = Panel(item_35)

# ---- group: new id
int_114 = Integer(item_35)

# ---- group: Density Value Suggested
int_115 = Integer(item_31)

# ---- group: Changed / x
int_116 = Integer(item_33)

# ---- group: module id (manual)
# Grid Base Data
int_117 = Integer(pshift_34)

# ----
panel_149 = Panel(int_117)

# ---- group: building height for each type
num_65 = Number(multiplication_22)

# ---- group: Changed / y
int_118 = Integer(item_34)

# ----
repeat_10 = RepeatData(Data=Slider(0, range=0..360), Length=256)

# ---- group: rotation
int_119 = Integer([0, -90, 0, 0, 0, 0, -90, 0, 0, 0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])

# ---- group: all 0
pshift_35 = ShiftPaths(Data=repeat_10, Offset=-1)

# ---- group: module id (CV UDP)
int_120 = Integer(int_104)

# ---- group: x
int_121 = Integer(num_35)

# ---- group: y
int_122 = Integer(num_36)

# ---- group: rotation
int_123 = Integer(num_38)

# ----
panel_150 = Panel(int_121)
panel_151 = Panel(int_120)
panel_152 = Panel(int_122)
panel_153 = Panel(int_123)
number_slider_6 = Slider(0.607, range=0..1)
toggle_3 = BooleanToggle(False)

# ---- group: module id (manual)
int_124 = Integer(int_117)

# ---- group: module id (CV UDP)
int_125 = Integer(int_120)

# ---- group: slider2
num_66 = Number(num_22)

# ---- group: toggle1
bool_20 = Boolean(bool_3)

# ---- group: gridExtent_x
int_126 = Integer(int_103)

int_127 = Integer(int_126)  # disabled

# ---- group: AI
subtraction_4 = Subtraction(A=int_127, B=num_55)  # disabled
panel_154 = Panel(num_59)  # disabled
subtraction_5 = Subtraction(A=subtraction_4, B=num_47)  # disabled

# ---- group: PREDICT
subtraction_6 = Subtraction(A=int_127, B=1)  # disabled
panel_155 = Panel(num_52)  # disabled
subtraction_7 = Subtraction(A=subtraction_6, B=num_47)  # disabled

# ---- group: AI / x flipped
num_67 = Number(subtraction_5)  # disabled

# ---- group: PREDICT / x flipped
num_68 = Number(subtraction_7)  # disabled

# ---- group: gridExtent_y
int_128 = Integer(int_102)

int_129 = Integer(int_128)  # disabled

# ---- group: x
int_130 = Integer(int_41)

int_131 = Integer(int_130)

# ---- group: y
int_132 = Integer(int_42)

int_133 = Integer(int_132)

# ---- group: rotation
int_134 = Integer(int_43)

# ---- group: dockID
int_135 = Integer(int_44)

# ---- group: toggle1
bool_21 = Boolean(bool_20)

# ---- group: toggle2
bool_22 = Boolean(bool_9)

# ---- group: toggle3
bool_23 = Boolean(bool_10)

# ---- group: toggle4
bool_24 = Boolean(bool_11)

# ---- group: floor num for each type
int_136 = Integer(int_106)

# ----
panel_156 = Panel(int_136)

# ---- group: module id
int_137 = Integer(int_40)

int_138 = Integer(int_137)

# ----
equals_9 = Equality(FirstNumber=int_138, SecondNumber=item_32)  # -> Equality, Inequality
dispatch_4 = Dispatch(List=int_131, DispatchPattern=equals_9.Equality)  # -> ListA, ListB
dispatch_5 = Dispatch(List=int_133, DispatchPattern=equals_9.Equality)  # -> ListA, ListB

# ---- group: changed / x
int_139 = Integer(dispatch_4.ListA)

# ---- group: changed / y
int_140 = Integer(dispatch_5.ListA)

# ---- group: x
filter_26 = StreamFilter(Gate=bool_19, Stream0=int_116, Stream1=int_139)

# ---- group: y
filter_27 = StreamFilter(Gate=bool_19, Stream0=int_118, Stream1=int_140)

# ---- group: Changed / x
int_141 = Integer(filter_26)

# ---- group: Changed / y
int_142 = Integer(filter_27)

# ---- group: slider1
num_69 = Number(num_20)

# ---- group: slider2
num_70 = Number(num_66)

# ---- group: dock rotation
int_143 = Integer(int_47)

# ----
number_slider_7 = Slider(20, range=-1..30)  # disabled

# ---- group: ref crvs - density suggest value arrow location
crv_8 = Curve(reparameterize(<curve referenced from the Rhino model>))  # disabled

# ----
arrow_size = Slider(25, range=0..100)  # disabled
arrow_size_2 = Slider(25, range=0..100)  # disabled

# ---- group: ref crvs - density arrow base
crv_9 = Curve([<curve referenced from the Rhino model> x6])  # disabled

# ----
neg = Negative(Value=1)  # disabled

# ---- group: Density Value Suggested
int_144 = Integer(int_115)  # disabled

# ---- group: id suggested
int_145 = Integer(int_114)  # disabled

# ---- group: cell change arrow start pts
pt_38 = Point([<point referenced from the Rhino model> x6])  # disabled

# ---- group: arrow size
num_71 = Number(arrow_size_2)  # disabled

# ---- group: module id
int_146 = Integer(int_137)

# ---- group: mask/highlight - AI Assistance
crv_10 = Curve(<curve referenced from the Rhino model>)  # disabled

# ----
move_z = Slider(13.1, range=0..30)  # disabled
move_z_2 = Slider(22.5, range=0..30)  # disabled
remap = RemapNumbers(Value=int_144, Source=Domain(1, 30), Target=Domain(0, 1))  # -> Mapped, Clipped; disabled
Y = UnitY(Factor=1)  # disabled
X = UnitX(Factor=neg)  # disabled
eval = EvaluateCurve(Curve=crv_8, Parameter=remap.Mapped)  # -> Point, Tangent, Angle; disabled

# ---- group: floor num for each type
int_147 = Integer(int_136)

# CityMatrix
# 
# "Ryan" Yan Zhang <ryanz@mit.edu>
# MIT Media Lab, Changing Place Group
# September. 2016
# Human Interation @ Lego - Outside
int_148 = Integer(int_136)

# ----
number_slider_8 = Slider(17, range=0..100)  # disabled
# mid
number_slider_9 = Slider(55, range=0..100)  # disabled

# ---- group: highlight - viz 1
crv_11 = Curve(<curve referenced from the Rhino model>)  # disabled

# ---- group: mask/highlight - lego grid
crv_12 = Curve(<curve referenced from the Rhino model>)  # disabled

# ----
number_slider_10 = Slider(51, range=0..100)  # disabled
number_slider_11 = Slider(46, range=0..100)  # disabled

# ---- group: mask/highlight - building types
crv_13 = Curve(<curve referenced from the Rhino model>)  # disabled

# ---- group: mask/highlight - density slider
crv_14 = Curve(<curve referenced from the Rhino model>)  # disabled

# ---- group: mask/highlight - people statistics
crv_15 = Curve(<curve referenced from the Rhino model>)  # disabled

# ---- group: mask/highlight - selection dock
crv_16 = Curve(<curve referenced from the Rhino model>)  # disabled

# ---- group: highlight - viz 2
crv_17 = Curve(<curve referenced from the Rhino model>)  # disabled

# ---- group: mask/highlight - viz slider
crv_18 = Curve(<curve referenced from the Rhino model>)  # disabled

# ---- group: highlight - viz 3
crv_19 = Curve(<curve referenced from the Rhino model>)  # disabled

# ---- group: arrow 1
crv_20 = Curve([<curve referenced from the Rhino model> x10])  # disabled

# ---- group: arrow 2
crv_21 = Curve([<curve referenced from the Rhino model> x2])  # disabled

# ---- group: highlight - viz 4
crv_22 = Curve(<curve referenced from the Rhino model>)  # disabled

# ---- group: highlight - viz 5
crv_23 = Curve(<curve referenced from the Rhino model>)  # disabled

# ---- group: arrow 3
crv_24 = Curve([<curve referenced from the Rhino model> x2])  # disabled

# ---- group: arrow 4
# AI Suggestion
crv_25 = Curve([<curve referenced from the Rhino model> x2])  # disabled

# ----
# old
number_slider_12 = Slider(23, range=0..100)  # disabled
number_slider_13 = Slider(69, range=0..100)  # disabled
aisteptest_3 = Slider(15, range=-1..30)
line_4 = LineSDL(Start=eval.Point, Direction=Y, Length=arrow_size_2)  # disabled

# ---- group: stickyInitiated
bool_25 = Boolean(bool_6)  # disabled

# ----
equals_10 = Equality(FirstNumber=int_146, SecondNumber="0")  # -> Equality, Inequality
equals_11 = Equality(FirstNumber=int_146, SecondNumber="1")  # -> Equality, Inequality
equals_12 = Equality(FirstNumber=int_146, SecondNumber="3")  # -> Equality, Inequality
equals_13 = Equality(FirstNumber=int_146, SecondNumber="2")  # -> Equality, Inequality

# ---- group: Toggle 1
# AI Step Control
bool_26 = Boolean(bool_21)  # disabled

# ----
addarrowhead = AddArrowHead(crv=crv_9, num=arrow_size)  # disabled
equals_14 = Equality(FirstNumber=int_146, SecondNumber="4")  # -> Equality, Inequality
equals_15 = Equality(FirstNumber=int_146, SecondNumber="5")  # -> Equality, Inequality
# Dashboard
number_slider_14 = Slider(0.4, range=0..1)
# young
number_slider_15 = Slider(200, range=0..500)  # disabled
number_slider_16 = Slider(120, range=0..500)  # disabled
number_slider_17 = Slider(75, range=0..500)  # disabled
item_36 = ListItem(List=int_147, Index="0", Wrap=False)
item_37 = ListItem(List=int_147, Index="2", Wrap=False)
item_38 = ListItem(List=int_147, Index="1", Wrap=False)
item_39 = ListItem(List=int_147, Index="3", Wrap=False)
item_40 = ListItem(List=int_147, Index="4", Wrap=False)
item_41 = ListItem(List=int_147, Index="5", Wrap=False)

# ---- group: ppl per flr
# id5
# id3
# id4
# id0
# id2
# id1
# young
# mid
# old
panel_157 = Panel("0")
panel_158 = Panel("18")
panel_159 = Panel("28")
panel_160 = Panel("63")
panel_161 = Panel("52")
panel_162 = Panel("87")
panel_163 = Panel("156")
num_72 = Number([panel_157, "0", "0", "0"])
num_73 = Number(["0", "0", "0", "0"])
num_74 = Number(["0", "0", "0", "0"])

# ----
stickycount_py_2 = PythonScript(x=bool_26, initiated=bool_25)  # -> out, a; disabled
# ---------- stickycount_py_2: Python ----------
import scriptcontext as sc
import time

if initiated and not x == sc.sticky["bool"] :
    if time.time() - sc.sticky["prevTime"] >= 0.5 :
        sc.sticky["count"] = sc.sticky["count"] + 1
    sc.sticky["prevTime"] = time.time()

sc.sticky["bool"] = x

print(sc.sticky["count"])
print(sc.sticky["prevTime"])
print(sc.sticky["bool"])
print(time.time())

a = sc.sticky["count"]
# ---------- end stickycount_py_2 ----------
int_149 = Integer(equals_10.Equality)
int_150 = Integer(equals_11.Equality)
addarrowhead_2 = AddArrowHead(crv=line_4, num=arrow_size_2)  # disabled
int_151 = Integer(equals_12.Equality)
int_152 = Integer(equals_13.Equality)
int_153 = Integer(equals_14.Equality)
int_154 = Integer(equals_15.Equality)

# ---- group: all but viz
crv_26 = Curve([crv_13, crv_16, crv_14, crv_15, crv_10])  # disabled

# ---- group: table all
crv_27 = Curve([crv_12, crv_13, crv_16, crv_14, crv_15, crv_18, crv_10])  # disabled

# ----
ma_15 = MassAddition(Input=int_149)  # -> Result, PartialResults
ma_16 = MassAddition(Input=int_150)  # -> Result, PartialResults

# ---- group: dock and slider highlight crv
crv_28 = Curve(<curve referenced from the Rhino model>)  # disabled

# ----
ma_17 = MassAddition(Input=int_151)  # -> Result, PartialResults
ma_18 = MassAddition(Input=int_152)  # -> Result, PartialResults

# ---- group: type highlight crvs
crv_29 = Curve([<curve referenced from the Rhino model> x6])  # disabled

# ----
ma_19 = MassAddition(Input=int_153)  # -> Result, PartialResults

# ---- group: building id 0 fl #
int_155 = Integer(item_36)

# ---- group: building id 2 fl #
int_156 = Integer(item_37)

# ----
data_5 = Data([crv_13, crv_15, crv_16, crv_14])  # disabled

# ---- group: building id 1 fl #
int_157 = Integer(item_38)

# ----
data_6 = Data([crv_13, crv_15, crv_18])  # disabled
ma_20 = MassAddition(Input=int_154)  # -> Result, PartialResults

# ---- group: building id 3 fl #
int_158 = Integer(item_39)

# ----
data_7 = Data([crv_14, crv_15, crv_18])  # disabled
pt_39 = ConstructPoint(XCoordinate=Slider(0, range=0..10), YCoordinate=Slider(0, range=-30..0), ZCoordinate=Slider(5.1, range=0..10))

# ---- group: building id 4 fl #
int_159 = Integer(item_40)

# ----
data_8 = Data([crv_16, crv_14])  # disabled
data_9 = Data([crv_16, crv_13])  # disabled

# ---- group: building id 5 fl #
int_160 = Integer(item_41)

# ----
data_10 = Data(crv_21)  # disabled
data_11 = Data(crv_24)  # disabled

# ---- group: x
int_161 = Integer(int_141)  # disabled

# ---- group: y
int_162 = Integer(int_142)  # disabled

# ---- group: range
B = DomainEnd(number_slider_15)  # disabled

# ----
int_163 = Integer(ma_15.Result)
panel_164 = Panel(int_163)
int_164 = Integer(ma_16.Result)
panel_165 = Panel(int_164)
int_165 = Integer(ma_17.Result)
panel_166 = Panel(int_165)
int_166 = Integer(ma_18.Result)
panel_167 = Panel(int_166)
int_167 = Integer(ma_19.Result)
panel_168 = Panel(int_167)

# ---- group: range
B_2 = DomainEnd(number_slider_16)  # disabled

B_3 = DomainEnd(number_slider_17)  # disabled

# ----
int_168 = Integer(ma_20.Result)
panel_169 = Panel(int_168)
xy = XYPlane(Origin=pt_39)

# ---- group: AI Step from Python Server
int_169 = Integer(int_71)

# ----
panel_170 = Panel(int_169)
filter_28 = StreamFilter(Gate=bool_19, Stream1=crv_28)  # -> graft(Stream); disabled
Z = UnitZ(Factor=move_z_2)  # disabled
X_2 = UnitX(Factor=move_z)  # disabled

# ---- group: new id
int_170 = Integer(int_114)  # disabled

# ---- group: Density idx
int_171 = Integer(item_32)  # disabled

# ---- group: crvs with arrow
crv_30 = Curve(addarrowhead)  # disabled

# ----
panel_171 = Panel("7")  # disabled
dom = ConstructDomain(DomainStart=0, DomainEnd=B)  # disabled
dom_2 = ConstructDomain(DomainStart=0, DomainEnd=B_2)  # disabled
dom_3 = ConstructDomain(DomainStart=0, DomainEnd=B_3)  # disabled

# ---- group: Micro-unit Building #
int_172 = Integer(int_166)

# ---- group: Luxury Building #
int_173 = Integer(int_163)

# ---- group: Regular residential Building #
int_174 = Integer(int_164)

# ---- group: Head Quater Building #
int_175 = Integer(int_165)

# ---- group: Regular Office Building #
int_176 = Integer(int_167)

# ---- group: AI Step
int_177 = Integer(int_169)

int_178 = Integer(int_177)  # disabled

# ----
panel_172 = Panel(int_178)  # disabled

# ---- group: AI Step
int_179 = Integer(int_178)  # disabled

# ----
panel_173 = Panel(int_179)  # disabled

# ---- group: AI Step
# AI Step Mask and Highlight
int_180 = Integer(int_177)  # disabled

# ----
panel_174 = Panel(int_180)  # disabled

# ---- group: AI Step
int_181 = Integer(int_177)

# ----
panel_175 = Panel(int_181)

# ---- group: Masks Filter
filter_29 = StreamFilter(
    Gate=int_180,
    Stream0=[crv_27, crv_10],
    Stream1=[crv_13, crv_16, crv_14, crv_15, crv_18, crv_10],
    Stream2=[crv_12, crv_16, crv_14, crv_15, crv_18, crv_10],
    Stream3=[crv_16, crv_14, crv_15, crv_18, crv_10],
    Stream4=crv_10,
    Stream5=[crv_12, crv_18, crv_10],
    Stream6=crv_27,
    Stream7=crv_27,
    Stream8=crv_27,
    Stream9=crv_27,
    Stream10=data_5,
    Stream11=crv_26,
    Stream12=crv_26,
    Stream13=crv_26,
    Stream14=crv_26,
    Stream15=crv_26,
    Stream16=crv_10,
    Stream17=crv_10,
    Stream18=crv_10,
    Stream19=crv_10,
    Stream20=crv_10)  # disabled

# ---- group: Highlight Filter
filter_30 = StreamFilter(
    Gate=int_180,
    Stream1=crv_12,
    Stream2=crv_13,
    Stream3=[crv_12, crv_13],
    Stream4=[data_9, data_8],
    Stream5=crv_15,
    Stream10=[crv_18, crv_12],
    Stream11=[crv_12, crv_11],
    Stream12=[crv_17, crv_12],
    Stream13=[crv_19, crv_12],
    Stream14=[crv_22, crv_12],
    Stream15=[crv_23, crv_12],
    Stream21=crv_10)  # disabled

# ---- group: Arrow Filter
filter_31 = StreamFilter(Gate=int_180, Stream3=crv_20, Stream4=[data_10, data_11], Stream10=crv_25)  # disabled

# ----
crv_31 = Curve(filter_31)  # disabled
crv_32 = Curve(graft(filter_30))  # disabled
panel_176 = Panel(int_177)
number_slider_18 = Slider(7, range=0..100)  # disabled
number_slider_19 = Slider(7, range=0..100)  # disabled

# ---- group: Co-working Building #
int_182 = Integer(int_168)

# ----
area = Area(Geometry=crv_32)  # -> Area, Centroid
filter_32 = StreamFilter(Gate=bool_19, Stream0=int_170, Stream1=int_171)  # disabled
scaleanim_py = PythonScript()  # -> out, a
# ---------- scaleanim_py: Python ----------
import time
import math


speed = 4.0
deltaScale = 0.02

a = 1.0 + math.sin(time.time() * speed) * deltaScale
# ---------- end scaleanim_py ----------
blink_py = PythonScript()  # -> out, a
# ---------- blink_py: Python ----------
import time
import math


inteval = 1

a = time.time() % inteval >= inteval / 2

print(a)
# ---------- end blink_py ----------

# ---- group: parking cell #
parking_cell_2 = Slider(0, range=0..50)

# ----
equals_16 = Equality(FirstNumber=int_180, SecondNumber=panel_171)  # -> Equality, Inequality; disabled

# ---- group: blink anim
bool_27 = Boolean(bool_18)  # disabled

# ----
panel_177 = Panel(bool_27)  # disabled
swatch = ColourSwatch(SwatchColor=RGB(255, 127, 0))  # disabled
swatch_2 = ColourSwatch(SwatchColor=RGB(255, 127, 0))  # disabled

# ---- group: crvs with arrow - density value suggested
crv_33 = Curve(addarrowhead_2)  # disabled

# ----
swatch_3 = ColourSwatch(SwatchColor=RGBA(0, 0, 0, 180))  # disabled

# ---- group: blink2
filter_33 = StreamFilter(Gate=bool_27, Stream1=crv_32)  # disabled

filter_34 = StreamFilter(Gate=bool_27, Stream1=crv_31)  # disabled

# ---- group: works, but might cause memory leak
equals_17 = Equality()  # -> Equality, Inequality; disabled
int_183 = Integer(equals_17.Inequality)  # disabled
panel_178 = Panel(int_183)  # disabled
rec = DataRecorder(int_183, DataLimit=-1, RecordData=True)  # disabled
panel_179 = Panel(rec)  # disabled
ma_21 = MassAddition(Input=rec)  # -> Result, PartialResults; disabled
panel_180 = Panel(ma_21.Result)  # disabled

# ----
scale_2 = Scale(Geometry=crv_32, Center=area.Centroid, Factor=scaleanim_py.a)  # -> Geometry, Transform
filter_35 = StreamFilter(Gate=equals_16.Equality, Stream1=crv_27)  # disabled
crv_34 = Curve([filter_29, filter_35])  # disabled
boundary = BoundarySurfaces(Edges=crv_34)  # disabled
mesh_10 = MeshBrep(
    Brep=boundary,
    Settings={GridMaxCount=0, GridMinCount=16, JaggedSeams=False, MaxEdgeLength=0, MinEdgeLength=0.0001, MinTolerance=0, Refine=True, RefineAngle=0, RelativeTolerance=0.65, SimplePlanes=True, Tolerance=0})  # disabled
panel_181 = Panel("7003")  # disabled
panel_182 = Panel("127.0.0.1")  # disabled

# ---- group: multipe for ppls
number_slider_20 = Slider(0.2, range=-0.01..2)

# ----
item_42 = ListItem(List=crv_29, Index=filter_32, Wrap=False)  # disabled
item_43 = ListItem(List=crv_30, Index=int_171, Wrap=False)  # disabled
multiplication_23 = Multiplication(A=num_72, B=number_slider_20)
multiplication_24 = Multiplication(A=num_73, B=number_slider_20)
multiplication_25 = Multiplication(A=num_74, B=number_slider_20)

# ---- group: Arrows
previewlw = CustomPreviewLineweights(Geometry=filter_34, Shader=swatch, Thickness=number_slider_18)  # disabled

# ---- group: Highlights
previewlw_2 = CustomPreviewLineweights(Geometry=filter_33, Shader=swatch_2, Thickness=number_slider_19)  # disabled

# ---- group: Masks
preview_7 = CustomPreview(Geometry=mesh_10, Shader=swatch_3)  # disabled

# ----
txt_42 = Text(int_177)  # disabled
num_75 = Number(multiplication_23)
num_76 = Number(multiplication_24)
num_77 = Number(multiplication_25)

# ---- group: park cell #
park_cell_2 = Slider(150, range=0..150)

# ----
merge_13 = Merge(Data1=filter_28, Data2=item_42)  # disabled

# ---- group: UDP Send to Unity AI
udp_4 = UDPSender(Address=panel_182, Port=panel_181, Pattern=0, Data=txt_42)  # disabled

# ----
multiplication_26 = Multiplication(A="28", B=division_8)
multiplication_27 = Multiplication(A="18", B=division_8)
multiplication_28 = Multiplication(A="63", B=division_8)
multiplication_29 = Multiplication(A="52", B=division_8)
multiplication_30 = Multiplication(A="156", B=division_8)
multiplication_31 = Multiplication(A="87", B=division_8)
filter_36 = StreamFilter(Gate=bool_12, Stream1=merge_13)
round = Round(Number=multiplication_26)  # -> Nearest, Floor, Ceiling
round_2 = Round(Number=multiplication_28)  # -> Nearest, Floor, Ceiling
round_3 = Round(Number=multiplication_29)  # -> Nearest, Floor, Ceiling
round_4 = Round(Number=multiplication_27)  # -> Nearest, Floor, Ceiling
round_5 = Round(Number=multiplication_30)  # -> Nearest, Floor, Ceiling
round_6 = Round(Number=multiplication_31)  # -> Nearest, Floor, Ceiling

# ---- group: ppl per flr
panel_183 = Panel(round_4.Nearest)
panel_184 = Panel(round.Nearest)
panel_185 = Panel(round_2.Nearest)
panel_186 = Panel(round_3.Nearest)
panel_187 = Panel(round_6.Nearest)
panel_188 = Panel(round_5.Nearest)

# ---- group: reduce ratio
number_slider_21 = Slider(0, range=0..1)  # disabled

# ----
number_slider_22 = Slider(52, range=0..100)  # disabled
number_slider_23 = Slider(0.2, range=0..1)  # disabled
number_slider_24 = Slider(59, range=0..100)  # disabled
number_slider_25 = Slider(0.2, range=0..1)  # disabled
number_slider_26 = Slider(72, range=0..100)  # disabled
number_slider_27 = Slider(0.2, range=0..1)  # disabled
merge_14 = Merge(Data1=panel_183, Data2=panel_184, Data3=panel_185, Data4=panel_186, Data5=panel_187, Data6=panel_188)

# ---- group: how many floors in total
multiplication_32 = Multiplication(A=int_159, B=int_176)
multiplication_33 = Multiplication(A=int_157, B=int_174)
multiplication_34 = Multiplication(A=int_160, B=int_182)
multiplication_35 = Multiplication(A=int_156, B=int_172)
multiplication_36 = Multiplication(A=int_158, B=int_175)
multiplication_37 = Multiplication(A=int_155, B=int_173)

# ---- group: crv with arrow - cell to change
crv_35 = Curve(item_43)  # disabled

# ---- group: rect crvs - no off set
crv_36 = Curve(merge_13)  # disabled

# ----
multiplication_38 = Multiplication(A=panel_187, B=multiplication_32)
multiplication_39 = Multiplication(A=panel_184, B=multiplication_33)
multiplication_40 = Multiplication(A=panel_185, B=multiplication_35)
multiplication_41 = Multiplication(A=panel_188, B=multiplication_34)
multiplication_42 = Multiplication(A=panel_186, B=multiplication_36)
multiplication_43 = Multiplication(A=panel_183, B=multiplication_37)

# ---- group: # ppl per flr
num_78 = Number(merge_14)

# ----
mid_mid_career = ColourSwatch(SwatchColor=RGB(255, 208, 0))  # disabled
mln_young = ColourSwatch(SwatchColor=RGB(0, 166, 255))  # disabled
exc_elderly = ColourSwatch(SwatchColor=RGB(255, 0, 0))  # disabled

# ---- group: Regular Office ppl #
int_184 = Integer(multiplication_38)

# ---- group: dot shape
number_slider_28 = Slider(9, range=0..10)  # disabled
number_slider_29 = Slider(3, range=0..10)  # disabled
polygon = Polygon(Plane=PlaneXY(0, 0, 0), Radius=number_slider_29, Segments=number_slider_28, FilletRadius=0)  # -> Polygon, Length; disabled
boundary_2 = BoundarySurfaces(Edges=polygon.Polygon)  # disabled
mesh_11 = Mesh(boundary_2)  # disabled

# ----
mesh_12 = Mesh(mesh_11)  # disabled
mesh_13 = Mesh(mesh_11)  # disabled
mesh_14 = Mesh(mesh_11)  # disabled

# ---- group: Head Quater ppl #
int_185 = Integer(multiplication_42)

# ---- group: Co-working ppl #
int_186 = Integer(multiplication_41)

# ---- group: Micro-unit ppl #
int_187 = Integer(multiplication_40)

# ---- group: Luxury ppl #
int_188 = Integer(multiplication_43)

# ---- group: Regular residential ppl #
int_189 = Integer(multiplication_39)

# ----
panel_189 = Panel("0.0 To 400000.0")  # disabled
res_warm_2 = ColourSwatch(SwatchColor=RGB(255, 246, 204))
off_cold_2 = ColourSwatch(SwatchColor=RGB(204, 229, 255))

# ---- group: Dashboard Text Color
color = ColourSwatch(SwatchColor=RGB(201, 201, 201))
col_28 = Colour(color)

# ----
ma_22 = MassAddition(Input=[int_186, int_184, int_185])  # -> Result, PartialResults
ma_23 = MassAddition(Input=[int_187, int_189, int_188])  # -> Result, PartialResults

# ---- group: total working ppl #
int_190 = Integer(ma_22.Result)

# ---- group: total residential ppl #
int_191 = Integer(ma_23.Result)

# ----
addition_7 = Addition(A=int_191, B=int_190)

# ---- group: total ppl #
int_192 = Integer(addition_7)  # disabled

# ----
remap_2 = RemapNumbers(Value=int_192, Source=panel_189, Target=Domain(0, 1))  # -> Mapped, Clipped; disabled

# ---- group: Dashboard Text Size 2
size = Slider(13.5, range=0..100)
num_79 = Number(size)

# ---- group: Dashboard Text Size 1
size_2 = Slider(15, range=0..100)
num_80 = Number(size_2)

# ----
max = Maximum(A=remap_2.Mapped, B=0)  # disabled
min_2 = Minimum(A=max, B=1)  # disabled
mid_mid_career_2 = ColourSwatch(SwatchColor=RGB(255, 208, 0))
_0 = Slider(0, range=0..1)

# ---- group: total ppl #
int_193 = Integer(addition_7)

# ----
# Bar Diagram
mln_young_2 = ColourSwatch(SwatchColor=RGB(0, 166, 255))
exc_elderly_2 = ColourSwatch(SwatchColor=RGB(255, 0, 0))

# ---- group: gridExtent_x
int_194 = Integer(int_126)  # disabled

# ---- group: v sep ln length
number_slider_30 = Slider(16, range=10..20)

# ---- group: gh ref pt start
pt_40 = Point(<point referenced from the Rhino model>)

# ---- group: gh ref pt end
pt_41 = Point(<point referenced from the Rhino model>)

# ---- group: bar diagram ppl range
domain = Domain("0 to 75000")

# ----
number_slider_31 = Slider(0.5, range=0..1)  # disabled
subtraction_8 = Subtraction(A=int_194, B=1)  # disabled
pdecon_25 = Deconstruct(Point=pt_41)  # -> XComponent, YComponent, ZComponent
pdecon_26 = Deconstruct(Point=pt_40)  # -> XComponent, YComponent, ZComponent
panel_190 = Panel(",\"popDensity\":")  # disabled
txt_43 = Text(min_2)  # disabled
panel_191 = Panel(int_193)
int_195 = Integer(int_130)  # disabled
neg_2 = Negative(Value=number_slider_30)
graft = GraftTree(Tree=_0, IncludeEmptyLists=True, IncludeNullItems=True)
txt_44 = Text(num_69)  # disabled
subtraction_9 = Subtraction(A=subtraction_8, B=int_195)  # disabled
merge_15 = Merge(Data1=mln_young_2, Data2=mid_mid_career_2, Data3=exc_elderly_2)
Y_2 = UnitY(Factor=number_slider_30)
Y_3 = UnitY(Factor=neg_2)
# Send to Unity (json, UDP)
panel_192 = Panel("{\"grid\":[")  # disabled
panel_193 = Panel("],\"objects\":{")  # disabled
panel_194 = Panel("}")  # disabled
panel_195 = Panel("{\"type\":")  # disabled
panel_196 = Panel(",\"x\":")  # disabled
panel_197 = Panel(",\"y\":")  # disabled
txt_45 = Text(int_132)  # disabled
panel_198 = Panel(",\"rot\":")  # disabled
txt_46 = Text(int_134)  # disabled
panel_199 = Panel("}")  # disabled
panel_200 = Panel(",")  # disabled
panel_201 = Panel("\"slider1\":")  # disabled
panel_202 = Panel(",\"toggle2\":")  # disabled
panel_203 = Panel(",\"toggle3\":")  # disabled
panel_204 = Panel(",\"toggle4\":")  # disabled
panel_205 = Panel(",\"dockID\":")  # disabled
txt_47 = Text(int_135)  # disabled
panel_206 = Panel(",\"density\":[")  # disabled
txt_48 = Text(int_137)  # disabled
txt_49 = Text(subtraction_9)  # disabled
panel_207 = Panel(",\"toggle1\":")  # disabled
int_196 = Integer(bool_23)  # disabled
panel_208 = Panel(",\"dockRotation\":")  # disabled
txt_50 = Text(int_143)  # disabled
panel_209 = Panel(",\"IDMax\":15")  # disabled
panel_210 = Panel("],\"pop_young\":0,\"pop_mid\":0,\"pop_old\":0")  # disabled
panel_211 = Panel("}")  # disabled
int_197 = Integer(bool_21)  # disabled
int_198 = Integer(bool_23)  # disabled
txt_51 = Text(number_slider_31)  # disabled
int_199 = Integer(bool_22)  # disabled
ttl_min = Slider(60, range=0..100)
type_min = Slider(20, range=0..100)

txt_52 = Text(int_136)  # disabled
panel_212 = Panel(",")  # disabled
nullrep_14 = ReplaceNulls(Items=int_191, Replacements=0)  # -> Items, Count

# ---- group: inactive area mask ref crvs
# Inactive Area Mask
crv_37 = Curve([<curve referenced from the Rhino model> x2])  # disabled

# ----
txt_53 = Text(int_197)  # disabled
txt_54 = Text(int_199)  # disabled
txt_55 = Text(int_196)  # disabled
txt_56 = Text(int_198)  # disabled
nullrep_15 = ReplaceNulls(Items=int_188, Replacements=0)  # -> Items, Count
nullrep_16 = ReplaceNulls(Items=int_187, Replacements=0)  # -> Items, Count
nullrep_17 = ReplaceNulls(Items=int_189, Replacements=0)  # -> Items, Count
max_2 = Maximum(A=nullrep_14.Items, B=ttl_min)
lng_6 = ListLength(List=txt_48)  # disabled
repeat_11 = RepeatData(Data=panel_198, Length=lng_6)  # disabled
repeat_12 = RepeatData(Data=panel_199, Length=lng_6)  # disabled
repeat_13 = RepeatData(Data=panel_197, Length=lng_6)  # disabled
repeat_14 = RepeatData(Data=panel_196, Length=lng_6)  # disabled
repeat_15 = RepeatData(Data=panel_195, Length=lng_6)  # disabled
join_26 = TextJoin(Text=txt_52, Join=panel_212)  # disabled
max_3 = Maximum(A=nullrep_15.Items, B=type_min)
max_4 = Maximum(A=nullrep_17.Items, B=type_min)
max_5 = Maximum(A=nullrep_16.Items, B=type_min)
pshift_36 = ShiftPaths(Data=repeat_11, Offset=-1)  # disabled
pshift_37 = ShiftPaths(Data=repeat_12, Offset=-1)  # disabled
pshift_38 = ShiftPaths(Data=repeat_14, Offset=-1)  # disabled
pshift_39 = ShiftPaths(Data=repeat_13, Offset=-1)  # disabled
pshift_40 = ShiftPaths(Data=repeat_15, Offset=-1)  # disabled

# ---- group: R
int_200 = Integer(max_2)

# ----
neg_3 = Negative(Value=number_slider_30)

# ---- group: RL
int_201 = Integer(max_3)

# ---- group: RM
int_202 = Integer(max_4)

# ---- group: RS
int_203 = Integer(max_5)

# ----
addition_8 = Addition(A=int_203, B=int_202)
addition_9 = Addition(A=addition_8, B=int_201)
merge_16 = Merge(Data1=graft, Data2=int_203, Data3=addition_8, Data4=addition_9)
# Population Matrix - New
pt_42 = Point(<point referenced from the Rhino model>)
col_29 = Colour(res_warm_2)
sort = SortList(Keys=flatten(merge_16))  # -> Keys, ValuesA

# ---- group: 0-1
remap_3 = RemapNumbers(Value=flatten(sort.Keys), Source=domain, Target=Domain(0, 1))  # -> Mapped, Clipped

# ----
merge_17 = Merge(
    Data1=graft(pshift_40),
    Data2=graft(txt_48),
    Data3=graft(pshift_38),
    Data4=graft(txt_49),
    Data5=graft(pshift_39),
    Data6=graft(txt_45),
    Data7=graft(pshift_36),
    Data8=graft(txt_46),
    Data9=graft(pshift_37))  # disabled

# ---- group: ttl h len
subtraction_10 = Subtraction(A=pdecon_25.XComponent, B=pdecon_26.XComponent)

# ----
pt_43 = Point(<point referenced from the Rhino model>)
num_81 = Number(num_80)
pt_44 = Point(<point referenced from the Rhino model>)
num_82 = Number(num_80)
col_30 = Colour(res_warm_2)
pt_45 = Point(<point referenced from the Rhino model>)
num_83 = Number(num_80)
col_31 = Colour(res_warm_2)
division_9 = Division(A=neg_3, B=2)
col_32 = Colour(res_warm_2)
division_10 = Division(A=number_slider_30, B=2)
number_slider_32 = Slider(2.5, range=0..10)  # disabled
boundary_3 = BoundarySurfaces(Edges=crv_37)  # disabled
panel_213 = Panel("35000")  # disabled

# ---- group: RL
tag = TextTag3D(Location=pt_44, Text=int_201, Size=num_82, Colour=col_31, Justification=7)

# ----
join_27 = TextJoin(Text=merge_17)  # disabled

# ---- group: RS
tag_2 = TextTag3D(Location=pt_43, Text=int_203, Size=num_81, Colour=col_30, Justification=7)

# ---- group: RM
tag_3 = TextTag3D(Location=pt_45, Text=int_202, Size=num_83, Colour=col_32, Justification=7)

# ----
nullrep_18 = ReplaceNulls(Items=int_190, Replacements=0)  # -> Items, Count
multiplication_44 = Multiplication(A=remap_3.Mapped, B=subtraction_10)
Y_4 = UnitY(Factor=division_9)
Y_5 = UnitY(Factor=division_10)
swatch_4 = ColourSwatch(SwatchColor=RGBA(0, 0, 0, 180))  # disabled
multiplication_45 = Multiplication(A=panel_213, B=number_slider_32)  # disabled
mesh_15 = MeshBrep(
    Brep=boundary_3,
    Settings={GridMaxCount=0, GridMinCount=16, JaggedSeams=False, MaxEdgeLength=0, MinEdgeLength=0.0001, MinTolerance=0, Refine=True, RefineAngle=0, RelativeTolerance=0.65, SimplePlanes=True, Tolerance=0})  # disabled
nullrep_19 = ReplaceNulls(Items=int_185, Replacements=0)  # -> Items, Count
pshift_41 = ShiftPaths(Data=join_27, Offset=-1)  # disabled
nullrep_20 = ReplaceNulls(Items=int_186, Replacements=0)  # -> Items, Count
max_6 = Maximum(A=nullrep_18.Items, B=ttl_min)
nullrep_21 = ReplaceNulls(Items=int_184, Replacements=0)  # -> Items, Count
addition_10 = Addition(A=pdecon_26.XComponent, B=multiplication_44)
panel_214 = Panel("127.0.0.1")  # disabled
panel_215 = Panel("9000")  # disabled

# ---- group: O
int_204 = Integer(max_6)

# ----
max_7 = Maximum(A=nullrep_20.Items, B=type_min)
max_8 = Maximum(A=nullrep_19.Items, B=type_min)

# ---- group: intersections
crossings = Point([Point(156.25, 281.25, 0), Point(468.75, 281.25, 0), Point(718.75, 281.25, 0), Point(156.25, 656.25, 0), Point(468.75, 656.25, 0), Point(718.75, 656.25, 0), Point(906.25, 906.25, 0), Point(718.75, 906.25, 0), Point(468.75, 906.25, 0), Point(156.25, 906.25, 0), Point(906.25, 281.25, 0), Point(906.25, 656.25, 0), Point(906.25, 781.25, 0), Point(906.25, 531.25, 0), Point(906.25, 156.25, 0)])  # disabled

# ----
max_9 = Maximum(A=nullrep_21.Items, B=type_min)

# ---- group: all road pieces
pt_46 = Point([Point(906.25, 156.25, 0), Point(906.25, 531.25, 0), Point(906.25, 781.25, 0), Point(906.25, 656.25, 0), Point(906.25, 281.25, 0), Point(156.25, 906.25, 0)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])  # disabled

# ---- group: total ppl #
int_205 = Integer(int_193)  # disabled

# ----
number_slider_33 = Slider(700, range=700..35000)  # disabled
txt_57 = Text(pshift_41)  # disabled
panel_216 = Panel(txt_57)  # disabled
join_28 = TextJoin(Text=txt_57, Join=panel_200)  # disabled
txt_58 = Text(join_28)  # disabled
panel_217 = Panel("-0.8")  # disabled

# ---- group: traffic mode is PEV
bool_28 = Boolean(bool_21)  # disabled

# ---- group: Masks
preview_8 = CustomPreview(Geometry=mesh_15, Shader=swatch_4)  # disabled

# ---- group: OL
int_206 = Integer(max_8)

# ---- group: OM
int_207 = Integer(max_9)

# ---- group: OS
int_208 = Integer(max_7)

# ----
addition_11 = Addition(A=int_208, B=int_207)
addition_12 = Addition(A=addition_11, B=int_206)
merge_18 = Merge(Data1=graft, Data2=int_208, Data3=addition_11, Data4=addition_12)
sort_2 = SortList(Keys=flatten(merge_18))  # -> Keys, ValuesA

# ---- group: 0-1
remap_4 = RemapNumbers(Value=flatten(sort_2.Keys), Source=domain, Target=Domain(0, 1))  # -> Mapped, Clipped

# ----
multiplication_46 = Multiplication(A=remap_4.Mapped, B=subtraction_10)
addition_13 = Addition(A=pdecon_26.XComponent, B=multiplication_46)
pt_47 = ConstructPoint(XCoordinate=addition_13, YCoordinate=pdecon_26.YComponent, ZCoordinate=0)
move = Move(Geometry=pt_47, Motion=Y_4)  # -> Geometry, Transform
shift_2 = ShiftList(List=move.Geometry, Shift=-1, Wrap=False)
pt_48 = Point(<point referenced from the Rhino model>)
col_33 = Colour(off_cold_2)
pt_49 = ConstructPoint(XCoordinate=addition_10, YCoordinate=pdecon_26.YComponent, ZCoordinate=0)
move_2 = Move(Geometry=pt_49, Motion=Y_5)  # -> Geometry, Transform
shift_3 = ShiftList(List=move_2.Geometry, Shift=-1, Wrap=False)
merge_19 = Merge(
    Data1=panel_192,
    Data2=txt_58,
    Data3=panel_193,
    Data4=panel_201,
    Data5=txt_51,
    Data6=panel_207,
    Data7=txt_53,
    Data8=panel_202,
    Data9=txt_54,
    Data10=panel_203,
    Data11=txt_55,
    Data12=panel_204,
    Data13=txt_56,
    Data14=panel_205,
    Data15=txt_47,
    Data16=panel_208,
    Data17=txt_50,
    Data18=panel_209,
    Data19=panel_190,
    Data20=txt_43,
    Data21=panel_206,
    Data22=join_26,
    Data23=panel_210,
    Data24=panel_211,
    Data25=panel_194)  # disabled
shift_4 = ShiftList(List=move.Geometry, Shift=1, Wrap=False)
shift_5 = ShiftList(List=move_2.Geometry, Shift=1, Wrap=False)
pt_50 = Point(<point referenced from the Rhino model>)
num_84 = Number(num_80)
pt_51 = Point(<point referenced from the Rhino model>)
num_85 = Number(num_80)
col_34 = Colour(off_cold_2)
pt_52 = Point(<point referenced from the Rhino model>)
num_86 = Number(num_80)
col_35 = Colour(off_cold_2)
col_36 = Colour(off_cold_2)

# ---- group: lower v sep ln
line_5 = LineSDL(Start=pt_47, Direction=Y_3, Length=number_slider_30)

# ---- group: h sep ln
ln = Line(StartPoint=pt_40, EndPoint=pt_41)

# ---- group: OL
tag_4 = TextTag3D(Location=pt_51, Text=int_206, Size=num_85, Colour=col_35, Justification=7)

# ---- group: OS
tag_5 = TextTag3D(Location=pt_50, Text=int_208, Size=num_84, Colour=col_34, Justification=7)

# ---- group: OM
tag_6 = TextTag3D(Location=pt_52, Text=int_207, Size=num_86, Colour=col_36, Justification=7)

# ----
multiplication_47 = Multiplication(A=bool_28, B=panel_217)  # disabled
ln_2 = Line(StartPoint=shift_2, EndPoint=shift_4)
ln_3 = Line(StartPoint=shift_3, EndPoint=shift_5)
neg_4 = Negative(Value=number_slider_30)

# ---- group: upper v sep ln
line_6 = LineSDL(Start=pt_49, Direction=Y_2, Length=number_slider_30)

# ----
neg_5 = Negative(Value=number_slider_30)
join_29 = TextJoin(Text=merge_19)  # disabled
division_11 = Division(A=neg_4, B=6)
division_12 = Division(A=neg_5, B=6)
sort_pt = SortPoints(Points=flatten(pt_47))  # -> Points, Indices
panel_218 = Panel("127.0.0.1")  # disabled
panel_219 = Panel("7002")  # disabled

# ---- group: Dashboard Text Size 3
size_3 = Slider(12, range=0..100)
num_87 = Number(size_3)

# ----
num_88 = Number(num_87)

# ---- group: residential total
tag_7 = TextTag3D(Location=pt_42, Text=int_200, Size=num_88, Colour=col_29, Justification=7)

# ----
num_89 = Number(num_87)

# ---- group: office total
tag_8 = TextTag3D(Location=pt_48, Text=int_204, Size=num_89, Colour=col_33, Justification=7)

# ----
Y_6 = UnitY(Factor=division_11)
Y_7 = UnitY(Factor=division_12)
pt_53 = Point(<point referenced from the Rhino model>)
int_209 = Integer(int_156)
pt_54 = Point(<point referenced from the Rhino model>)
int_210 = Integer(int_155)
pt_55 = Point(<point referenced from the Rhino model>)
int_211 = Integer(int_157)
col_37 = Colour(res_warm_2)
col_38 = Colour(res_warm_2)
num_90 = Number(num_87)
num_91 = Number(num_87)
col_39 = Colour(res_warm_2)
num_92 = Number(num_87)
division_13 = Division(A=number_slider_30, B=3)
division_14 = Division(A=number_slider_30, B=3)
sort_pt_2 = SortPoints(Points=flatten(pt_49))  # -> Points, Indices

# ---- group: json data to send
txt_59 = Text(join_29)  # disabled

txt_60 = Text(txt_59)  # disabled

# ----
panel_220 = Panel(txt_60)  # disabled
panel_221 = Panel(txt_59)  # disabled
udp_5 = UDPSender(Address=panel_214, Port=panel_215, Pattern=0, Data=txt_60)  # disabled

# ---- group: 2
tag_9 = TextTag3D(Location=pt_53, Text=int_209, Size=num_90, Colour=col_37, Justification=7)

# ---- group: 0
tag_10 = TextTag3D(Location=pt_54, Text=int_210, Size=num_91, Colour=col_38, Justification=7)

# ---- group: 1
tag_11 = TextTag3D(Location=pt_55, Text=int_211, Size=num_92, Colour=col_39, Justification=7)

# ----
move_3 = Move(Geometry=ln_2, Motion=Y_6)  # -> Geometry, Transform
move_4 = Move(Geometry=ln_3, Motion=Y_7)  # -> Geometry, Transform

# ---- group: balance two colors
number_slider_34 = Slider(0.8, range=0..1)  # disabled

# ----
Y_8 = UnitY(Factor=division_13)
Y_9 = UnitY(Factor=division_14)
subtraction_11 = Subtraction(A=1, B=number_slider_34)  # disabled
road_2 = ColourSwatch(SwatchColor=RGB(64, 64, 64))  # disabled

# ---- group: last pt O
item_44 = ListItem(List=sort_pt.Points, Index=-1, Wrap=True)

# ---- group: last pt R
item_45 = ListItem(List=sort_pt_2.Points, Index=-1, Wrap=True)

# ----
extr = Extrude(Base=move_3.Geometry, Direction=Y_8)
extr_2 = Extrude(Base=move_4.Geometry, Direction=Y_9)
udp_6 = UDPSender(Address=panel_218, Port=panel_219, Pattern=0, Data=txt_59)  # disabled
pt_56 = Point(<point referenced from the Rhino model>)
int_212 = Integer(int_160)
pt_57 = Point(<point referenced from the Rhino model>)
int_213 = Integer(int_158)
pt_58 = Point(<point referenced from the Rhino model>)
int_214 = Integer(int_159)
col_40 = Colour(off_cold_2)
col_41 = Colour(off_cold_2)
num_93 = Number(num_87)
num_94 = Number(num_87)
col_42 = Colour(off_cold_2)
num_95 = Number(num_87)
neg_6 = Negative(Value=number_slider_30)
division_15 = Division(A=neg_6, B=1.5)
mesh_16 = Mesh(extr)
Y_10 = UnitY(Factor=division_15)
move_5 = Move(Geometry=item_44, Motion=Y_10)  # -> Geometry, Transform
mesh_17 = Mesh(extr_2)
division_16 = Division(A=number_slider_30, B=1.5)
Y_11 = UnitY(Factor=division_16)
move_6 = Move(Geometry=item_45, Motion=Y_11)  # -> Geometry, Transform
argb = SplitARGB(Colour=road_2, IntegerChannels=True)  # -> Alpha, Red, Green, Blue; disabled

# ---- group: 5
tag_12 = TextTag3D(Location=pt_56, Text=int_212, Size=num_93, Colour=col_40, Justification=7)

# ---- group: 3
tag_13 = TextTag3D(Location=pt_57, Text=int_213, Size=num_94, Colour=col_41, Justification=7)

# ---- group: 4
tag_14 = TextTag3D(Location=pt_58, Text=int_214, Size=num_95, Colour=col_42, Justification=7)

# ----
mspray = MeshSpray(Mesh=graft(mesh_16), Points=Point(0, 0, 0), Colours=graft(merge_15), SprayMode=0)
panel_222 = Panel("127.0.0.1")  # disabled
mspray_2 = MeshSpray(Mesh=graft(mesh_17), Points=Point(0, 0, 0), Colours=graft(merge_15), SprayMode=0)
panel_223 = Panel("9001")  # disabled
X_3 = UnitX(Factor=5)
move_7 = Move(Geometry=move_5.Geometry, Motion=X_3)  # -> Geometry, Transform
X_4 = UnitX(Factor=5)
move_8 = Move(Geometry=move_6.Geometry, Motion=X_4)  # -> Geometry, Transform
vec = VectorXYZ(XComponent=argb.Red, YComponent=argb.Green, ZComponent=argb.Blue)  # -> Vector, Length; disabled
pshift_42 = ShiftPaths(Data=mspray, Offset=-1)
pshift_43 = ShiftPaths(Data=mspray_2, Offset=-1)

# ---- group: all sep lns
crv_38 = Curve([ln, line_6, line_5])

# ----
pt_59 = Point(move_7.Geometry)
num_96 = Number(num_79)
pt_60 = Point(move_8.Geometry)
num_97 = Number(num_79)
col_43 = Colour(off_cold_2)
col_44 = Colour(res_warm_2)
multiplication_48 = Multiplication(A=vec.Vector, B=subtraction_11)  # disabled

# ---- group: work
mesh_18 = Mesh(pshift_42)

tag_15 = TextTag3D(Location=pt_59, Text="work", Size=num_96, Colour=col_43, Justification=4)

# ---- group: live
tag_16 = TextTag3D(Location=pt_60, Text="live", Size=num_97, Colour=col_44, Justification=4)

mesh_19 = Mesh(pshift_43)

# ----
preview_9 = CustomPreview(Geometry=crv_38, Shader=col_28)
udp_7 = UDPReceiver(Address=panel_222, Port=panel_223, Pattern=0)  # -> Info, Data; disabled

# ---- group: json data to send
# Send to CityIO Server
# (json, internet, Yasushi)
txt_61 = Text(txt_59)  # disabled

# ----
dam = DataDam(DataA=txt_61, BufferDelay=10000000, BufferMode=2)  # disabled

# ---- group: json data received
txt_62 = Text(udp_7.Data)  # disabled

# ----
panel_224 = Panel(txt_62)  # disabled
panel_225 = Panel("table/update/citymatrix")  # disabled
panel_226 = Panel("https://cityio.media.mit.edu")  # disabled
send_table_data = PythonScript(url=panel_226, path=panel_225, jsonString=dam)  # -> out; disabled
# ---------- send_table_data: Python ----------
import System 
import System.Net 
import System.Uri
import System.IO
import System.Text.Encoding
import json


def postTable(url,stringData,debug=False):
    webclient = System.Net.WebClient()
    webclient.Headers['Content-type'] = 'text/plain'
    
    if debug:
        
        # simple validation before we send
        try:
            json.loads(stringData)
        except:
            print 'invalid string, revise your string data'
            return
        
        # this will block your process
        data = System.Text.Encoding.Default.GetBytes(stringData)
        webclient.UploadData(url,'POST',data)
        
    else:
        data = System.Text.Encoding.Default.GetBytes(stringData)
        webclient.UploadDataAsync(url,'POST',data)

endpoint = System.Uri('{}/{}'.format(url,path))



postTable(endpoint,jsonString,False)
# rhino crashes using async callbacks,
# so try the following if something is wrong
# postData(endpoint,jsonString,debug=True)
# ---------- end send_table_data ----------
panel_227 = Panel(send_table_data)  # disabled
panel_228 = Panel("""-0.2
0.0
0.2
-0.4
0.0
0.4""")

# ---- group: type / module id
int_215 = Integer(int_104)

int_216 = Integer(int_104)

# ---- group: module id
int_217 = Integer(int_137)

# ---- group: shrink
cell_shrink = Slider(1, range=0.75..1)

# ----
move_z_3 = Slider(6.5, range=0..30)
move_z_4 = Slider(5.5, range=0..10)
move_z_5 = Slider(6.5, range=0..10)

# ---- group: shrink
cell_shrink_2 = Slider(0.98, range=0.75..1)

# ---- group: gridExtent_x
int_218 = Integer(int_126)

# ---- group: shrink
num_98 = Number(cell_shrink_2)

# ---- group: gridExtent_y
int_219 = Integer(int_128)

# ---- group: rotation
int_220 = Integer(int_134)

# ---- group: module id
int_221 = Integer(int_137)

# ---- group: y
int_222 = Integer(int_132)

# ---- group: x
int_223 = Integer(int_130)

# ---- group: toggle1
bool_29 = Boolean(Toggle(True))

# ---- group: colortizer orgin
# LEGO Grid System
pt_61 = Point(<point referenced from the Rhino model>)

pt_62 = Point(pt_61)  # disabled

# ---- group: table size ref pt
pt_63 = Point(<point referenced from the Rhino model>)

# ----
number_slider_35 = Slider(-560, range=-1000..1000)  # disabled
num_99 = Number(1)  # disabled
vec_2 = VectorXYZ(XComponent=num_99, YComponent=num_99, ZComponent=0)  # -> Vector, Length; disabled
amp = Amplitude(Vector=vec_2.Vector, Amplitude=number_slider_35)  # disabled
move_9 = Move(Geometry=pt_63, Motion=amp)  # -> Geometry, Transform; disabled

# ---- group: floor num for each type
int_224 = Integer(int_136)

# ---- group: colortizer orgin
pt_64 = Point(pt_61)

# ---- group: # ppl per flr
# -2 means static context
# -1 means empty site
# please manually replace -1
# to building types 0 to 5
# 0 means RL
# 1 means RM
# 2 means RS
# 3 means OL
# 4 means OM
# 5 means OS
# Reference Color
# Grid Sampling
# Closest Color Code
# Decode Piece ID
# Dock Sampling
# Decode Dock ID
# Slider Sampling
# Decode Slider Value
# Slider 2 Sampling
# Decode Slider Value
# Toggle 1
# 3 Level Slider Sampling
# Decode Slider Value
num_100 = Number(num_78)

# ---- group: gridExtent_x
# Energy/Cost Efficiency Formular:
# Sum of (Nearest N Building Population/Distance to that building)
int_225 = Integer(int_126)

# ---- group: gridExtent_y
int_226 = Integer(int_128)

# ---- group: x
int_227 = Integer(int_130)

# ---- group: y
int_228 = Integer(int_132)

# ---- group: shrink
num_101 = Number(cell_shrink)

# ---- group: gridExtent_x
# Traffic Heatmap - Machine Learning Server
int_229 = Integer(int_126)  # disabled

# ---- group: gridExtent_y
int_230 = Integer(int_128)  # disabled

# ---- group: colortizer orgin
pt_65 = Point(pt_61)

# ---- group: shrink
num_102 = Number(num_98)

# ---- group: x
num_103 = Number(num_35)

# ---- group: y
num_104 = Number(num_36)

# ---- group: traffic value
num_105 = Number(num_42)  # disabled

# ---- group: waiting time value
num_106 = Number(num_44)  # disabled

# ---- group: gridExtent_x
# Solar Access Heatmap - Machine Learning Server
int_231 = Integer(int_126)

# ---- group: gridExtent_y
int_232 = Integer(int_128)

# ---- group: colortizer orgin
pt_66 = Point(pt_61)

# ---- group: shrink
num_107 = Number(num_98)

# ---- group: x
num_108 = Number(num_35)

# ---- group: y
num_109 = Number(num_36)

# ---- group: solar value
num_110 = Number(num_40)

# ----
Z_2 = UnitZ(Factor=20)  # disabled
# Dashboard
# Dock
panel_229 = Panel("Residential")

# ---- group: dockID
int_233 = Integer(int_135)

# ---- group: dockRotation
int_234 = Integer(int_143)

# ----
swatch_5 = ColourSwatch(SwatchColor=RGB(255, 255, 255))  # disabled
panel_230 = Panel("C:\Users\RYAN\Documents\GitHub\CityMatrix\Map\Amenities Maps\Amenities_Trans.png")  # disabled
panel_231 = Panel("C:\Users\RYAN\Documents\GitHub\CityMatrix\Map\Amenities Maps\Amenities_85Alpha.png")  # disabled
# C:\Users\RYAN\Documents\GitHub\CityMatrix\Map\HAMBURG RS 1600pxl.jpg
panel_232 = Panel("0.0")  # disabled
xy_2 = XYPlane(Origin=pt_61)
dist = Distance(PointA=pt_61, PointB=pt_63)

# ---- group: crv with arrow - cell to change
crv_39 = Curve(crv_35)

# ---- group: crvs with arrow - density value suggested
crv_40 = Curve(crv_33)

# ---- group: rect crvs - no off set
crv_41 = Curve(crv_36)

# ---- group: module meshes lego ref: -1
mesh_20 = Mesh(mesh_4)

# ---- group: module meshes lego ref: 0 to 5
mesh_21 = Mesh(mesh_5)

# ----
multiplication_49 = Multiplication(A=int_224, B=num_100)
neg_7 = Negative(Value=int_234)
panel_233 = Panel("16")  # disabled
subtraction_12 = Subtraction(A=panel_233, B=num_103)
division_17 = Division(A=dist, B=int_218)

# ---- group: influence range - distance limit
number_slider_36 = Slider(200, range=0..1000)

# ----
txt_63 = Text(["Large Unit", "Medium Unit", "Small Unit", "Large Unit", "Medium Unit", "Small Unit"])

# ---- group: infulence range - # nearest
range_count = Slider(49, range=1..130)

# ----
movetoorgin = MoveToOrgin(G=mesh_20, num=num_98)
movetoorgin_2 = MoveToOrgin(G=mesh_21, num=num_98)
txt_64 = Text([panel_229, "Residential", "Residential", "Office", "Office", "Office"])
movetoorgin_3 = MoveToOrgin(G=mesh_9, num=num_98)

# ---- group: base cplane
pln = Plane(xy_2)

# ----
# Google Map @ Lego
planesrf = PlaneSurface(Plane=pln, XSize=Domain(0, 1000), YSize=Domain(-1000, 0))  # disabled
move_10 = Move(Geometry=planesrf, Motion=Z_2)  # -> Geometry, Transform; disabled

# ---- group: road check matrix
python_3 = PythonScript(xe=int_218, ye=int_219, x=int_223, y=int_222, id=int_221)  # -> out, m; inputs x: list, y: list, id: list
# ---------- python_3: Python ----------
"""
CityMatrix

written by "Ryan" Yan Zhang <ryanz@mit.edu>
for MIT Media Lab, Changing Place Group
April.6th.2016
"""

import rhinoscriptsyntax as rs

m = [[-1 for n in range(xe)] for n in range(ye)]

#for n in range(len(id)):
#    if id[n] == 7:
#        m[y[n]][x[n]] = 6
#    else:
#        m[y[n]][x[n]] = id[n]

for n in range(len(id)):
    m[y[n]][x[n]] = id[n]

for n in range(ye):
    print m[n]
# ---------- end python_3 ----------

python_4 = PythonScript(xe=int_218, ye=int_219, x=int_223, y=int_222, id=int_221)  # -> out, m; inputs x: list, y: list, id: list; same code as python_3

# ---- group: sidewalk check matrix
python_5 = PythonScript(xe=int_218, ye=int_219, x=int_223, y=int_222, id=int_221)  # -> out, m; inputs x: list, y: list, id: list; same code as python_3

# ----
number_slider_37 = Slider(14, range=0..100)
item_46 = ListItem(List=txt_63, Index=int_233, Wrap=False)

# ---- group: private car / road quator 0s
mesh_22 = Mesh([<mesh referenced from the Rhino model> x4])
pt_67 = Point(<point referenced from the Rhino model>)

# ----
item_47 = ListItem(List=txt_64, Index=int_233, Wrap=False)

# ---- group: private car / center line quator 0s
mesh_23 = Mesh([<mesh referenced from the Rhino model> x4])
pt_68 = Point(<point referenced from the Rhino model>)

# ---- group: private car / sidewalk quator 0s
mesh_24 = Mesh([<mesh referenced from the Rhino model> x4])
pt_69 = Point(<point referenced from the Rhino model>)

# ----
pt_70 = Point(<point referenced from the Rhino model>)

# ---- group: # ppl per building
num_111 = Number(multiplication_49)

# ----
panel_234 = Panel(num_111)
swatch_6 = ColourSwatch(SwatchColor=RGB(255, 255, 255))

# ---- group: cell size
num_112 = Number(division_17)

num_113 = Number(num_112)  # disabled

# ----
filter_37 = StreamFilter(Gate=int_179, Stream24=num_113)  # disabled

# ---- group: cell size
num_114 = Number(filter_37)  # disabled

# ----
modulecenter = ModuleCenter(pt=pt_62, num=num_114, int_2=int_161, int=int_162)  # -> pt_5, transform_2; disabled
division_18 = Division(A=num_114, B=2)  # disabled
neg_8 = Negative(Value=division_18)  # disabled
dom_4 = ConstructDomain(DomainStart=neg_8, DomainEnd=division_18)  # disabled
rectangle = Rectangle(Plane=PlaneXY(0, 0, 0), XSize=dom_4, YSize=dom_4, Radius=0)  # -> Rectangle, Length; disabled

# ---- group: module center
pt_71 = Point(modulecenter.pt_5)  # disabled

# ---- group: module center suggested
pt_72 = Point(pt_71)  # disabled

# ----
cellchangearrowcrv = CellChangeArrowCrv(int=int_145, pt=pt_72, pt_2=pt_38, num=num_71)  # disabled
addarrowhead_3 = AddArrowHead(crv=cellchangearrowcrv, num=num_71)  # disabled
crv_42 = Curve(rectangle.Rectangle)  # disabled
move_11 = Move(Geometry=rectangle.Rectangle, Motion=Z)  # -> Geometry, Transform; disabled
move_12 = Move(Geometry=move_11.Geometry, Motion=X_2)  # -> Geometry, Transform; disabled
vec2pt = Vector2Pt(PointA=Point(0, 0, 0), PointB=pt_71, Unitize=False)  # -> Vector, Length; disabled

# ---- group: rect crv at orgin
crv_43 = Curve(move_12.Geometry)  # disabled

# ----
move_13 = Move(Geometry=crv_43, Motion=vec2pt.Vector)  # -> Geometry, Transform; disabled

# ---- group: no crv if no id
null_2 = NullItem(Item=int_161)  # -> NullFlags, InvalidFlags, Description; disabled
filter_38 = StreamFilter(Gate=null_2.NullFlags, Stream0=move_13.Geometry)  # disabled

# ---- group: cell change arrow crv
crv_44 = Curve(addarrowhead_3)  # disabled

# ----
filter_39 = StreamFilter(Gate=bool_12, Stream1=filter_38)

# ---- group: rect crvs at module centers
crv_45 = Curve(filter_38)  # disabled

# ---- group: cell size
num_115 = Number(num_112)

num_116 = Number(num_112)

num_117 = Number(num_112)

# ---- group: cell change arrow crv
crv_46 = Curve(crv_44)

# ---- group: square crvs to highlight
# AI Suggestion Highlighter
crv_47 = Curve(crv_45)

# ----
modulecenter_2 = ModuleCenter(pt=pt_61, num=num_112, int_2=int_223, int=int_222)  # -> pt_5, transform_2

# ---- group: module center
pt_73 = Point(modulecenter_2.pt_5)

pt_74 = Point(pt_73)  # disabled

# ----
offset = Offset(Curve=crv_47, Distance=Slider(15, range=0..100), Plane=PlaneXY(0, 0, 0), Corners=1)
vec2pt_2 = Vector2Pt(PointA=Point(0, 0, 0), PointB=pt_70, Unitize=False)  # -> Vector, Length

# ---- group: private car / road quator 1s
mesh_25 = Mesh([<mesh referenced from the Rhino model> x4])
pt_75 = Point(<point referenced from the Rhino model>)

# ---- group: private car
scale_nu = ScaleNU(Geometry=mesh_22, Plane=pt_67, ScaleX=num_98, ScaleY=num_98, ScaleZ=1)  # -> Geometry, Transform
scale_nu_2 = ScaleNU(Geometry=mesh_25, Plane=pt_75, ScaleX=num_98, ScaleY=num_98, ScaleZ=1)  # -> Geometry, Transform

# ---- group: private car / center line quator 1s
mesh_26 = Mesh([<mesh referenced from the Rhino model> x4])
pt_76 = Point(<point referenced from the Rhino model>)

# ---- group: private car
scale_nu_3 = ScaleNU(Geometry=mesh_23, Plane=pt_68, ScaleX=num_98, ScaleY=num_98, ScaleZ=1)  # -> Geometry, Transform
scale_nu_4 = ScaleNU(Geometry=mesh_26, Plane=pt_76, ScaleX=num_98, ScaleY=num_98, ScaleZ=1)  # -> Geometry, Transform

# ---- group: road check list
python_6 = PythonScript(xe=int_218, ye=int_219, x=int_223, y=int_222, id=int_221, m=python_3.m)  # -> out, rdType; inputs x: list, y: list, id: list, m: list
# ---------- python_6: Python ----------
"""
CityMatrix

written by "Ryan" Yan Zhang <ryanz@mit.edu>
for MIT Media Lab, Changing Place Group
April.6th.2016
"""

import rhinoscriptsyntax as rs

rdType = []

for n in range(len(id)):
    
    code = []
    
    if id[n]==6:
        
        # 0: check x, y+1
        if y[n]+1>ye-1:
            code.append(1)
        else:
            if m[y[n]+1][x[n]]==6:
                code.append(1)
            else:
                code.append(0)
        
        # 1: check x+1, y
        if x[n]+1>xe-1:
            code.append(1)
        else:
            if m[y[n]][x[n]+1]==6:
                code.append(1)
            else:
                code.append(0)
        
        # 2: check x, y-1
        if y[n]-1<0:
            code.append(1)
        else:
            if m[y[n]-1][x[n]]==6:
                code.append(1)
            else:
                code.append(0)
        
        # 3: check x-1, y
        if x[n]-1<0:
            code.append(1)
        else:
            if m[y[n]][x[n]-1]==6:
                code.append(1)
            else:
                code.append(0)
    
    else:
        
        code = [0,0,0,0]
    
    print code
    rdType.append(code)
# ---------- end python_6 ----------

python_7 = PythonScript(xe=int_218, ye=int_219, x=int_223, y=int_222, id=int_221, m=python_4.m)  # -> out, rdType; inputs x: list, y: list, id: list, m: list; same code as python_6

# ---- group: x
num_118 = Number(subtraction_12)

# ---- group: y
num_119 = Number(num_104)

# ---- group: traffic value
num_120 = Number(num_105)  # disabled

# ---- group: waiting time value
num_121 = Number(num_106)  # disabled

# ---- group: private car / sidewalk quator 1s
mesh_27 = Mesh([<mesh referenced from the Rhino model> x4])
pt_77 = Point(<point referenced from the Rhino model>)

# ---- group: private car
scale_nu_5 = ScaleNU(Geometry=mesh_24, Plane=pt_69, ScaleX=num_98, ScaleY=num_98, ScaleZ=1)  # -> Geometry, Transform
scale_nu_6 = ScaleNU(Geometry=mesh_27, Plane=pt_77, ScaleX=num_98, ScaleY=num_98, ScaleZ=1)  # -> Geometry, Transform

# ---- group: x
num_122 = Number(num_108)

# ---- group: y
num_123 = Number(num_109)

# ---- group: solar value
num_124 = Number(num_110)

# ---- group: sidewalk check list
python_8 = PythonScript(xe=int_218, ye=int_219, x=int_223, y=int_222, id=int_221, m=python_5.m)  # -> out, rdType; inputs x: list, y: list, id: list, m: list; same code as python_6

# ----
pt_78 = Point(<point referenced from the Rhino model>)
pt_79 = Point(<point referenced from the Rhino model>)
crv_48 = Curve(offset)

# ---- group: connected and offset ref crvs
crv_49 = Curve(crv_41)

# ---- group: unit name
tag_17 = TextTag3D(Location=pt_78, Text=item_46, Size=number_slider_37, Colour=swatch_6, Justification=5)

# ---- group: module meshes lego at orgin
mesh_28 = Mesh(movetoorgin)

mesh_29 = Mesh(movetoorgin_2)

# ----
item_48 = ListItem(List=mesh_29, Index=int_233, Wrap=False)
rotate = Rotate(Geometry=item_48, Angle=degrees(int_234), Plane=PlaneXY(0, 0, 0))  # -> Geometry, Transform
move_14 = Move(Geometry=rotate.Geometry, Motion=vec2pt_2.Vector)  # -> Geometry, Transform

# ---- group: res/off
tag_18 = TextTag3D(Location=pt_79, Text=item_47, Size=number_slider_37, Colour=swatch_6, Justification=5)

# ----
mesh_30 = Mesh(movetoorgin_3)
pshift_44 = ShiftPaths(Data=crv_48, Offset=-1)
lng_7 = ListLength(List=pshift_44)
larger_2 = LargerThan(FirstNumber=lng_7, SecondNumber=1)  # -> LargerThan, OrEqualTo

# ---- group: PEV / road quator 0s
mesh_31 = Mesh([<mesh referenced from the Rhino model> x4])
pt_80 = Point(<point referenced from the Rhino model>)

# ---- group: PEV / center line quator 0s
mesh_32 = Mesh(mesh_23)
pt_81 = Point(pt_68)

# ---- group: PEV / sidewalk quator 0s
mesh_33 = Mesh([<mesh referenced from the Rhino model> x4])
pt_82 = Point(<point referenced from the Rhino model>)

# ----
Z_3 = UnitZ(Factor=move_z_3)
Z_4 = UnitZ(Factor=move_z_4)
Z_5 = UnitZ(Factor=move_z_5)

# ---- group: dock lego modules
mesh_34 = Mesh(move_14.Geometry)

# ----
larger_3 = LargerThan(FirstNumber=int_221, SecondNumber="0")  # -> LargerThan, OrEqualTo
smaller = SmallerThan(FirstNumber=int_221, SecondNumber="5")  # -> SmallerThan, OrEqualTo
larger_4 = LargerThan(FirstNumber=int_221, SecondNumber="0")  # -> LargerThan, OrEqualTo
smaller_2 = SmallerThan(FirstNumber=int_221, SecondNumber="5")  # -> SmallerThan, OrEqualTo
runion = RegionUnion(Curves=pshift_44)

# ---- group: PEV / road quator 1s
mesh_35 = Mesh([<mesh referenced from the Rhino model> x4])
pt_83 = Point(<point referenced from the Rhino model>)

# ---- group: PEV
scale_nu_7 = ScaleNU(Geometry=mesh_31, Plane=pt_80, ScaleX=num_98, ScaleY=num_98, ScaleZ=1)  # -> Geometry, Transform
scale_nu_8 = ScaleNU(Geometry=mesh_35, Plane=pt_83, ScaleX=num_98, ScaleY=num_98, ScaleZ=1)  # -> Geometry, Transform

# ---- group: PEV / center line quator 1s
mesh_36 = Mesh(mesh_26)
pt_84 = Point(pt_76)

# ---- group: PEV
scale_nu_9 = ScaleNU(Geometry=mesh_32, Plane=pt_81, ScaleX=num_98, ScaleY=num_98, ScaleZ=1)  # -> Geometry, Transform
scale_nu_10 = ScaleNU(Geometry=mesh_36, Plane=pt_84, ScaleX=num_98, ScaleY=num_98, ScaleZ=1)  # -> Geometry, Transform

# ---- group: PEV / sidewalk quator 1s
mesh_37 = Mesh([<mesh referenced from the Rhino model> x4])
pt_85 = Point(<point referenced from the Rhino model>)

# ---- group: PEV
scale_nu_11 = ScaleNU(Geometry=mesh_33, Plane=pt_82, ScaleX=num_98, ScaleY=num_98, ScaleZ=1)  # -> Geometry, Transform
scale_nu_12 = ScaleNU(Geometry=mesh_37, Plane=pt_85, ScaleX=num_98, ScaleY=num_98, ScaleZ=1)  # -> Geometry, Transform

# ----
subtraction_13 = Subtraction(A=int_229, B=1)  # disabled
and = GateAnd(A=larger_3.OrEqualTo, B=smaller.OrEqualTo)
dispatch_6 = Dispatch(List=int_221, DispatchPattern=and)  # -> ListA, ListB

# ---- group: filted id
int_235 = Integer(dispatch_6.ListA)

# ----
item_49 = ListItem(List=int_148, Index=graft(int_235), Wrap=True)
pshift_45 = ShiftPaths(Data=item_49, Offset=-1)

# ---- group: flr #s
txt_65 = Text(pshift_45)

# ----
item_50 = ListItem(List=num_77, Index=graft(int_235), Wrap=True)
item_51 = ListItem(List=num_75, Index=graft(int_235), Wrap=True)
item_52 = ListItem(List=num_76, Index=graft(int_235), Wrap=True)
pshift_46 = ShiftPaths(Data=item_50, Offset=-1)
pshift_47 = ShiftPaths(Data=item_51, Offset=-1)
pshift_48 = ShiftPaths(Data=item_52, Offset=-1)

# ---- group: old per flr
num_125 = Number(pshift_46)

# ---- group: young per flr
num_126 = Number(pshift_47)

# ---- group: mid per flr
num_127 = Number(pshift_48)

# ----
multiplication_50 = Multiplication(A=num_127, B=txt_65)
multiplication_51 = Multiplication(A=num_126, B=txt_65)
multiplication_52 = Multiplication(A=num_125, B=txt_65)

# ---- group: total ppl in building mid
int_236 = Integer(multiplication_50)

# ---- group: total ppl in building young
int_237 = Integer(multiplication_51)

# ----
addition_14 = Addition(A=int_237, B=int_236)

# ---- group: total ppl in building old
int_238 = Integer(multiplication_52)

# ----
addition_15 = Addition(A=addition_14, B=int_238)

# ---- group: total ppl in building - all
int_239 = Integer(addition_15)

# ----
and_2 = GateAnd(A=larger_4.OrEqualTo, B=smaller_2.OrEqualTo)
panel_235 = Panel("6")  # disabled
simplify = SimplifyCurve(Curve=runion)  # -> Curve, Simplified
filter_40 = StreamFilter(Gate=larger_2.LargerThan, Stream0=crv_48, Stream1=simplify.Curve)

# ---- group: toggle1
bool_30 = Boolean(bool_29)

# ----
filter_41 = StreamFilter(Gate=bool_30, Stream0=scale_nu.Geometry, Stream1=scale_nu_7.Geometry)
filter_42 = StreamFilter(Gate=bool_30, Stream0=scale_nu_2.Geometry, Stream1=scale_nu_8.Geometry)

# ---- group: toggle1
bool_31 = Boolean(bool_29)

# ----
filter_43 = StreamFilter(Gate=bool_31, Stream0=scale_nu_3.Geometry, Stream1=scale_nu_9.Geometry)
filter_44 = StreamFilter(Gate=bool_31, Stream0=scale_nu_4.Geometry, Stream1=scale_nu_10.Geometry)

# ---- group: toggle1
bool_32 = Boolean(bool_29)

# ----
filter_45 = StreamFilter(Gate=bool_32, Stream0=scale_nu_5.Geometry, Stream1=scale_nu_11.Geometry)
filter_46 = StreamFilter(Gate=bool_32, Stream0=scale_nu_6.Geometry, Stream1=scale_nu_12.Geometry)
panel_236 = Panel("0.0 to 8000")  # disabled
panel_237 = Panel("0.0 to 12000")  # disabled
subtraction_14 = Subtraction(A=subtraction_13, B=num_118)  # disabled
dispatch_7 = Dispatch(List=int_221, DispatchPattern=and)  # -> ListA, ListB
dispatch_8 = Dispatch(List=int_221, DispatchPattern=and_2)  # -> ListA, ListB

# ---- group: translate example
pt_86 = Point(Point(-15, -8, 0))  # disabled
python_9 = PythonScript(point=pt_86)  # -> out, output; inputs point: Point3d; disabled
# ---------- python_9: Python ----------
import Rhino

transform = Rhino.Geometry.Transform.Translation(0,0,5)
point.Transform(transform)

output = point
# ---------- end python_9 ----------

# ----
int_240 = Integer(bool_27)
panel_238 = Panel(int_240)

# ---- group: toggle1
# Toggles
bool_33 = Boolean(bool_21)

# ---- group: toggle2
bool_34 = Boolean(bool_22)

bool_35 = Boolean(bool_34)  # disabled

# ---- group: connected and offset ref crvs
crv_50 = Curve(filter_40)

# ---- group: toggle3
bool_36 = Boolean(bool_23)

# ---- group: toggle4
bool_37 = Boolean(bool_24)

# ----
mesh_38 = Mesh(filter_42)
mesh_39 = Mesh(filter_41)
mesh_40 = Mesh(filter_44)
smaller_3 = SmallerThan(FirstNumber=int_221, SecondNumber="0")  # -> SmallerThan, OrEqualTo
mesh_41 = Mesh(filter_43)
larger_5 = LargerThan(FirstNumber=int_221, SecondNumber="6")  # -> LargerThan, OrEqualTo
mesh_42 = Mesh(filter_46)
hatchtable = HatchTable(Update=True)
mesh_43 = Mesh(filter_45)
item_53 = ListItem(List=mesh_29, Index=graft(dispatch_7.ListA), Wrap=False)
item_54 = ListItem(List=mesh_30, Index=graft(dispatch_8.ListA), Wrap=False)
fillet = FilletDistance(Curve=[crv_50, crv_49], Distance=Slider(15, range=0..100))

# ---- group: x flipped
num_128 = Number(subtraction_14)  # disabled

# ---- group: blink2
filter_47 = StreamFilter(Gate=Slider(1, range=0..1), Stream1=[crv_39, crv_40, crv_46])

# ----
filter_48 = StreamFilter(Gate=bool_30, Stream0=pt_67, Stream1=pt_80)
filter_49 = StreamFilter(Gate=bool_30, Stream0=pt_75, Stream1=pt_83)
filter_50 = StreamFilter(Gate=bool_31, Stream0=pt_68, Stream1=pt_81)
filter_51 = StreamFilter(Gate=bool_31, Stream0=pt_76, Stream1=pt_84)
filter_52 = StreamFilter(Gate=bool_32, Stream0=pt_69, Stream1=pt_82)
filter_53 = StreamFilter(Gate=bool_32, Stream0=pt_77, Stream1=pt_85)
dispatch_9 = Dispatch(List=pt_73, DispatchPattern=larger_5.LargerThan)  # -> ListA, ListB
rad = Radians(Degrees=Slider(45, range=0..100))
show_google_map = BooleanToggle(False)
filter_54 = StreamFilter(Gate=show_google_map, Stream1=move_10.Geometry)  # disabled
previewmat = CustomPreviewMaterials(Geometry=filter_54, DiffuseColor=swatch_5, Transparency=panel_232, DiffuseBitmap=panel_230)  # disabled
item_55 = ListItem(List=hatchtable, Index=Slider(1, range=0..1), Wrap=False)
pshift_49 = ShiftPaths(Data=item_53, Offset=-1)
pshift_50 = ShiftPaths(Data=item_54, Offset=-1)
dispatch_10 = Dispatch(List=int_220, DispatchPattern=and)  # -> ListA, ListB
crv_51 = Curve(fillet)
dispatch_11 = Dispatch(List=int_220, DispatchPattern=and_2)  # -> ListA, ListB
vec2pt_3 = Vector2Pt(PointA=Point(0, 0, 0), PointB=dispatch_9.ListA, Unitize=False)  # -> Vector, Length
pt_87 = Point(filter_49)
pt_88 = Point(filter_51)
pt_89 = Point(filter_48)

# ---- group: road check list
python_10 = PythonScript(pt=pt_73, id=int_221, rdType=python_6.rdType, rdQua0=mesh_39, c0=pt_89, rdQua1=mesh_38, c1=pt_87)  # -> out, allRoadMesh; inputs pt: list, id: list, rdType: list, rdQua0: list, rdQua1: list
# ---------- python_10: Python ----------
"""
CityMatrix

written by "Ryan" Yan Zhang <ryanz@mit.edu>
for MIT Media Lab, Changing Place Group
April.6th.2016
"""

import rhinoscriptsyntax as rs
import Rhino.Geometry as rg

allRoadMesh = []

for n in range(len(id)):
    
    if id[n]==6:
        
        for i in range(len(rdType[n])):
            t = rdType[n][i]
            v = rs.PointCoordinates(pt[n])
            if t == 0:
                c = rs.PointCoordinates(c0)
                vx = v[0]-c[0]
                vy = v[1]-c[1]
                new = rs.CopyObject(rdQua0[i],(vx,vy,0.))
            else:
                c = rs.PointCoordinates(c1)
                vx = v[0]-c[0]
                vy = v[1]-c[1]
                new = rs.CopyObject(rdQua1[i],(vx,vy,0.))
            allRoadMesh.append(new)
# ---------- end python_10 ----------

# ----
pt_90 = Point(filter_50)

# ---- group: road check list
python_11 = PythonScript(pt=pt_73, id=int_221, rdType=python_7.rdType, rdQua0=mesh_41, c0=pt_90, rdQua1=mesh_40, c1=pt_88)  # -> out, allRoadMesh; inputs pt: list, id: list, rdType: list, rdQua0: list, rdQua1: list; same code as python_10

# ----
pt_91 = Point(filter_53)
pt_92 = Point(filter_52)

# ---- group: sidewalk check list
python_12 = PythonScript(pt=pt_73, id=int_221, rdType=python_8.rdType, rdQua0=mesh_43, c0=pt_92, rdQua1=mesh_42, c1=pt_91)  # -> out, allRoadMesh; inputs pt: list, id: list, rdType: list, rdQua0: list, rdQua1: list; same code as python_10

# ----
dashline2_0 = DashLine20(crv=crv_51, num=Slider(7.5, range=0..100))
createhatch = CreateHatch(Bake=Toggle(False), Curves=crv_51, HatchPatternName=item_55, HatchScale=Slider(75, range=0..100), HatchRotation=rad)
swatch_7 = ColourSwatch(SwatchColor=RGB(255, 127, 0))
txt_66 = Text(["Amenity On", "Amenity Off"])
txt_67 = Text(["Human Int. On", "Human Int. Off"])
txt_68 = Text(["Sat. Map On", "Sat. Map Off"])
swatch_8 = ColourSwatch(SwatchColor=RGB(255, 0, 0))  # disabled
txt_69 = Text(["Next", "- Next -"])
rotate_2 = Rotate(Geometry=pshift_49, Angle=degrees(dispatch_10.ListA), Plane=PlaneXY(0, 0, 0))  # -> Geometry, Transform
graft_2 = GraftTree(Tree=rotate_2.Transform, IncludeEmptyLists=True, IncludeNullItems=True)
rotate_3 = Rotate(Geometry=pshift_50, Angle=degrees(dispatch_11.ListA), Plane=PlaneXY(0, 0, 0))  # -> Geometry, Transform

# ---- group: solar value
num_129 = Number(num_124)

# ----
bnd = Bounds(Numbers=num_129)
panel_239 = Panel(bnd)
dispatch_12 = Dispatch(List=pt_73, DispatchPattern=and)  # -> ListA, ListB
number_slider_38 = Slider(7, range=0..100)
dispatch_13 = Dispatch(List=pt_73, DispatchPattern=and_2)  # -> ListA, ListB
move_15 = Move(Geometry=mesh_28, Motion=vec2pt_3.Vector)  # -> Geometry, Transform
item_56 = ListItem(List=txt_66, Index=bool_36, Wrap=True)
item_57 = ListItem(List=txt_68, Index=bool_37, Wrap=True)
item_58 = ListItem(List=txt_67, Index=bool_34, Wrap=True)
item_59 = ListItem(List=txt_69, Index=bool_33, Wrap=True)

# ---- group: AI Step
int_241 = Integer(int_107)

# ----
panel_240 = Panel(int_241)
swatch_9 = ColourSwatch(SwatchColor=RGB(125, 125, 125))
Y_12 = UnitY(Factor=-100)
remap_5 = RemapNumbers(Value=num_129, Source="500.0 To 1400.0", Target=Domain(0, 1))  # -> Mapped, Clipped
vec2pt_4 = Vector2Pt(PointA=Point(0, 0, 0), PointB=dispatch_12.ListA, Unitize=False)  # -> Vector, Length
equals_18 = Equality(FirstNumber=int_221, SecondNumber="6")  # -> Equality, Inequality
equals_19 = Equality(FirstNumber=int_221, SecondNumber="7")  # -> Equality, Inequality
vec2pt_5 = Vector2Pt(PointA=Point(0, 0, 0), PointB=dispatch_13.ListA, Unitize=False)  # -> Vector, Length
join_30 = TextJoin(Text=["AIStep: ", int_241])
crv_52 = Curve(createhatch)
crv_53 = Curve(dashline2_0)
filter_55 = StreamFilter(Gate=bool_12, Stream0=swatch_8, Stream1=swatch_7)  # disabled
pt_93 = Point(<point referenced from the Rhino model>)
move_16 = Move(Geometry=pt_93, Motion=Y_12)  # -> Geometry, Transform
pt_94 = Point(<point referenced from the Rhino model>)  # disabled
pt_95 = Point(<point referenced from the Rhino model>)  # disabled
pt_96 = Point(<point referenced from the Rhino model>)  # disabled

# ---- group: score range by experience
panel_241 = Panel("-0.4 To 0.4")

# ----
move_17 = Move(Geometry=rotate_2.Geometry, Motion=vec2pt_4.Vector)  # -> Geometry, Transform
graft_3 = GraftTree(Tree=move_17.Transform, IncludeEmptyLists=True, IncludeNullItems=True)
comp = Compound(Transforms=[graft_2, graft_3])
transform = Transform(Geometry=xy, Transform=comp)
pshift_51 = ShiftPaths(Data=transform, Offset=-1)

# ---- group: people dots base plans
pln_2 = Plane(pshift_51)

# ---- group: block #
lng_8 = ListLength(List=pln_2)

# ---- group: seed d
random = Random(Range=Domain(0, 10000), Number=lng_8, Seed=number_slider_8)  # disabled

# ---- group: seed r
random_2 = Random(Range=Domain(0, 10000), Number=lng_8, Seed=number_slider_9)  # disabled

# ---- group: seed d
random_3 = Random(Range=Domain(0, 10000), Number=lng_8, Seed=number_slider_10)  # disabled

random_4 = Random(Range=Domain(0, 10000), Number=lng_8, Seed=number_slider_11)  # disabled

# ---- group: seed r
random_5 = Random(Range=Domain(0, 10000), Number=lng_8, Seed=number_slider_12)  # disabled

random_6 = Random(Range=Domain(0, 10000), Number=lng_8, Seed=number_slider_13)  # disabled

# ----
pshift_52 = ShiftPaths(Data=random_2, Offset=-1)  # disabled
pshift_53 = ShiftPaths(Data=random, Offset=-1)  # disabled
pshift_54 = ShiftPaths(Data=random_5, Offset=-1)  # disabled
pshift_55 = ShiftPaths(Data=random_6, Offset=-1)  # disabled
pshift_56 = ShiftPaths(Data=random_3, Offset=-1)  # disabled
pshift_57 = ShiftPaths(Data=random_4, Offset=-1)  # disabled

# ---- group: d
random_7 = Random(Range=Domain(0, 1), Number=int_237, Seed=pshift_53)  # disabled

# ---- group: r
random_8 = Random(Range=Domain(0, 360), Number=int_237, Seed=pshift_52)  # disabled

# ---- group: d
random_9 = Random(Range=Domain(0, 1), Number=int_236, Seed=pshift_56)  # disabled

random_10 = Random(Range=Domain(0, 1), Number=int_238, Seed=pshift_57)  # disabled

# ---- group: r
random_11 = Random(Range=Domain(0, 360), Number=int_236, Seed=pshift_54)  # disabled

random_12 = Random(Range=Domain(0, 360), Number=int_238, Seed=pshift_55)  # disabled

# ----
graph = GraphMapper(
    random_7,
    x0=0,
    x1=1,
    y0=0,
    y1=1,
    container_name="Bezier",
    cpx=[0, 0.2763824463, 1, 1],
    cpy=[0, 0.2786865234, 0.3680863976, 1])  # disabled
graph_2 = GraphMapper(
    random_9,
    x0=0,
    x1=1,
    y0=0,
    y1=1,
    container_name="Bezier",
    cpx=[0, 0.3430397809, 1, 1],
    cpy=[0, 0.5653408766, 0.3680863976, 1])  # disabled
graph_3 = GraphMapper(
    random_10,
    x0=0,
    x1=1,
    y0=0,
    y1=1,
    container_name="Bezier",
    cpx=[0, 0.2961647809, 0.9886363745, 1],
    cpy=[0, 0.6839488745, 0.5063920021, 1])  # disabled
rad_2 = Radians(Degrees=random_8)  # disabled
rad_3 = Radians(Degrees=random_11)  # disabled
rad_4 = Radians(Degrees=random_12)  # disabled
remap_6 = RemapNumbers(Value=graph, Source=Domain(0, 1), Target=dom)  # -> Mapped, Clipped; disabled
remap_7 = RemapNumbers(Value=graph_2, Source=Domain(0, 1), Target=dom_2)  # -> Mapped, Clipped; disabled
remap_8 = RemapNumbers(Value=graph_3, Source=Domain(0, 1), Target=dom_3)  # -> Mapped, Clipped; disabled
pt_97 = PointCylindrical(BasePlane=graft(pln_2), Angle=rad_2, Radius=remap_6.Mapped, Elevation=0)  # disabled
pt_98 = PointCylindrical(BasePlane=graft(pln_2), Angle=rad_3, Radius=remap_7.Mapped, Elevation=0)  # disabled
pt_99 = PointCylindrical(BasePlane=graft(pln_2), Angle=rad_4, Radius=remap_8.Mapped, Elevation=0)  # disabled
pshift_58 = ShiftPaths(Data=pt_97, Offset=-1)  # disabled
pdecon_27 = Deconstruct(Point=pshift_58)  # -> XComponent, YComponent, ZComponent; disabled
pshift_59 = ShiftPaths(Data=pt_98, Offset=-1)  # disabled
pdecon_28 = Deconstruct(Point=pshift_59)  # -> XComponent, YComponent, ZComponent; disabled
pshift_60 = ShiftPaths(Data=pt_99, Offset=-1)  # disabled
pdecon_29 = Deconstruct(Point=pshift_60)  # -> XComponent, YComponent, ZComponent; disabled
inc = Includes(Value=pdecon_27.YComponent, Domain=Domain(0, 1000))  # -> Includes, Deviation; disabled
inc_2 = Includes(Value=pdecon_27.XComponent, Domain=Domain(0, 1000))  # -> Includes, Deviation; disabled
inc_3 = Includes(Value=pdecon_28.YComponent, Domain=Domain(0, 1000))  # -> Includes, Deviation; disabled
inc_4 = Includes(Value=pdecon_28.XComponent, Domain=Domain(0, 1000))  # -> Includes, Deviation; disabled
inc_5 = Includes(Value=pdecon_29.YComponent, Domain=Domain(0, 1000))  # -> Includes, Deviation; disabled
inc_6 = Includes(Value=pdecon_29.XComponent, Domain=Domain(0, 1000))  # -> Includes, Deviation; disabled
and_3 = GateAnd(A=inc_2.Includes, B=inc.Includes)  # disabled
and_4 = GateAnd(A=inc_4.Includes, B=inc_3.Includes)  # disabled
and_5 = GateAnd(A=inc_6.Includes, B=inc_5.Includes)  # disabled
dispatch_14 = Dispatch(List=pshift_58, DispatchPattern=and_3)  # -> ListA, ListB; disabled
dispatch_15 = Dispatch(List=pshift_59, DispatchPattern=and_4)  # -> ListA, ListB; disabled
dispatch_16 = Dispatch(List=pshift_60, DispatchPattern=and_5)  # -> ListA, ListB; disabled
pt_100 = Point(dispatch_14.ListA)  # disabled
pt_101 = Point(dispatch_15.ListA)  # disabled
pt_102 = Point(dispatch_16.ListA)  # disabled
rnd_reduce_by_ratio = RndReduceByRatio(L=pt_100, B=number_slider_21, S=number_slider_22)  # disabled
rnd_reduce_by_ratio_2 = RndReduceByRatio(L=pt_101, B=number_slider_21, S=number_slider_24)  # disabled
rnd_reduce_by_ratio_3 = RndReduceByRatio(L=pt_102, B=number_slider_21, S=number_slider_26)  # disabled
pt_103 = Point(rnd_reduce_by_ratio)  # disabled
move_18 = Move(Geometry=mesh_12, Motion=pt_103)  # -> Geometry, Transform; disabled
pt_104 = Point(rnd_reduce_by_ratio_2)  # disabled
move_19 = Move(Geometry=mesh_14, Motion=pt_104)  # -> Geometry, Transform; disabled
pt_105 = Point(rnd_reduce_by_ratio_3)  # disabled
move_20 = Move(Geometry=mesh_13, Motion=pt_105)  # -> Geometry, Transform; disabled
mjoin = MeshJoin(Meshes=move_18.Geometry)  # disabled
mjoin_2 = MeshJoin(Meshes=move_20.Geometry)  # disabled
mjoin_3 = MeshJoin(Meshes=move_19.Geometry)  # disabled
mcol_2 = MeshColours(Mesh=mjoin, Colours=mln_young)  # disabled
mcol_3 = MeshColours(Mesh=mjoin_2, Colours=exc_elderly)  # disabled
mcol_4 = MeshColours(Mesh=mjoin_3, Colours=mid_mid_career)  # disabled
preview_10 = CustomPreview(Geometry=pt_104, Shader=mid_mid_career)  # disabled
preview_11 = CustomPreview(Geometry=pt_105, Shader=exc_elderly)  # disabled
filter_56 = StreamFilter(Gate=bool_35, Stream1=mcol_2)  # disabled
filter_57 = StreamFilter(Gate=bool_35, Stream1=mcol_3)  # disabled
preview_12 = CustomPreview(Geometry=pt_103, Shader=mln_young)  # disabled
filter_58 = StreamFilter(Gate=bool_35, Stream1=mcol_4)  # disabled

# ---- group: old ppl dots mesh
mesh_44 = Mesh(filter_57)  # disabled

# ---- group: mid ppl dots mesh
mesh_45 = Mesh(filter_58)  # disabled

# ---- group: young ppl dots mesh
mesh_46 = Mesh(filter_56)  # disabled

# ----
move_21 = Move(Geometry=rotate_3.Geometry, Motion=vec2pt_5.Vector)  # -> Geometry, Transform
or = GateOr(A=equals_18.Equality, B=equals_19.Equality)

# ---- group: solar value - normalized
num_130 = Number(remap_5.Mapped)

# ---- group: amenities
tag_19 = TextTag3D(Location=pt_94, Text=item_56, Size=number_slider_37, Colour=swatch_6, Justification=5)  # disabled

# ---- group: google map
tag_20 = TextTag3D(Location=pt_95, Text=item_57, Size=number_slider_37, Colour=swatch_6, Justification=5)  # disabled

# ---- group: human interaction
tag_21 = TextTag3D(Location=pt_96, Text=item_58, Size=number_slider_37, Colour=swatch_6, Justification=5)  # disabled

# ---- group: AI Step Next
tag_22 = TextTag3D(Location=move_16.Geometry, Text=item_59, Size=number_slider_38, Colour=swatch_9, Justification=5)

# ---- group: AI Step Int
tag_23 = TextTag3D(Location=pt_93, Text=join_30, Size=number_slider_38, Colour=swatch_9, Justification=5)

# ----
dispatch_17 = Dispatch(List=pt_73, DispatchPattern=or)  # -> ListA, ListB

# ---- group: Dashline
previewlw_3 = CustomPreviewLineweights(Geometry=crv_53, Shader=swatch_7, Thickness=Slider(5, range=0..100))

# ---- group: Arrows
previewlw_4 = CustomPreviewLineweights(Geometry=filter_47, Shader=ColourSwatch(SwatchColor=RGB(255, 127, 0)), Thickness=Slider(7, range=0..100))

# ---- group: Hatch
preview_13 = CustomPreview(Geometry=crv_52, Shader=swatch_7)

# ---- group: green is good, more solar access
gradient = Gradient(LowerLimit=0, UpperLimit=1, Parameter=num_130, stops=[0: RGB(0, 128, 0), 0.5: RGB(222, 222, 0), 1: RGB(255, 0, 0)])  # disabled

# ----
gradient_2 = Gradient(LowerLimit=0, UpperLimit=1, stops=[0: RGB(0, 51, 153), 0.5: RGB(6, 176, 0), 1: RGB(242, 40, 0)])  # disabled
gradient_3 = Gradient(LowerLimit=0, UpperLimit=1, stops=[0: RGB(0, 128, 0), 0.5: RGB(222, 222, 0), 1: RGB(255, 0, 0)])  # disabled
gradient_4 = Gradient(LowerLimit=0, UpperLimit=1, stops=[0: RGB(0, 128, 0), 1: RGB(255, 0, 0)])  # disabled

# ---- group: red is good, more solar access
gradient_5 = Gradient(LowerLimit=0, UpperLimit=1, Parameter=num_130, stops=[0: RGB(255, 0, 0), 0.5: RGB(255, 255, 0), 1: RGB(0, 128, 0)])  # disabled

# ---- group: white is good, more solar access
gradient_6 = Gradient(LowerLimit=0, UpperLimit=1, Parameter=num_130, stops=[0: RGB(0, 50, 199), 1: RGB(255, 255, 0)])

# ----
gradient_7 = Gradient(LowerLimit=0, UpperLimit=1, stops=[0: RGB(0, 51, 153), 0.5: RGB(6, 176, 0), 1: RGB(242, 40, 0)])
gradient_8 = Gradient(LowerLimit=0, UpperLimit=1, stops=[0: RGB(0, 128, 0), 0.5: RGB(222, 222, 0), 1: RGB(255, 0, 0)])
gradient_9 = Gradient(LowerLimit=0, UpperLimit=1, stops=[0: RGB(0, 128, 0), 1: RGB(255, 0, 0)])

# ---- group: Alpha
number_slider_39 = Slider(0.5, range=0..1)  # disabled

# ---- group: road center pts
pt_106 = Point(dispatch_17.ListA)

# ---- group: road mesh final!
mesh_47 = Mesh(python_10.allRoadMesh)

# ---- group: center line mesh final!
mesh_48 = Mesh(python_11.allRoadMesh)

# ----
easter_eggs = EasterEggs(L=pt_73, A_2=int_221, shrink=num_98, L_2=pt_73, A=int_221, shrink_2=num_98)  # disabled

# ---- group: blank
mesh_49 = Mesh(move_15.Geometry)

# ---- group: sidewalk mesh final!
mesh_50 = Mesh(python_12.allRoadMesh)

# ---- group: building lego modules
mesh_51 = Mesh(move_17.Geometry)

# ----
mesh_52 = Mesh(move_21.Geometry)
# AI Weights
panel_242 = Panel("1 to 30")
panel_243 = Panel("""Density
Diversity
Energy
Traffic
Solar""")

# ---- group: AIWeights
num_131 = Number(num_34)

# ----
panel_244 = Panel("%")  # disabled

# ---- group: Ref Pts
# Slider 2 - Heatmap Mode
pt_107 = Point([<point referenced from the Rhino model> x5])

# ---- group: Alpha
number_slider_40 = Slider(0.5, range=0..1)

# ----
filter_59 = StreamFilter(Gate=show_google_map, Stream0=mesh_51)
filter_60 = StreamFilter(Gate=show_google_map, Stream0=mesh_52)
filter_61 = StreamFilter(Gate=show_google_map, Stream0=mesh_47)
filter_62 = StreamFilter(Gate=show_google_map, Stream0=mesh_48)
filter_63 = StreamFilter(Gate=show_google_map, Stream0=mesh_49)
panel_245 = Panel("""Mobility
Effic.""")
panel_246 = Panel("""Satellite
Imagery""")
panel_247 = Panel("""Pop.
Density""")
panel_248 = Panel("""Exp.
Diversity""")
panel_249 = Panel("""Energy
Effic.""")
filter_64 = StreamFilter(Gate=show_google_map, Stream0=mesh_50)
panel_250 = Panel("""Working
Prox.""")
panel_251 = Panel("""H.M.
Off""")
panel_252 = Panel("""Park
Prox.""")
panel_253 = Panel("""Live/Work
Balance""")
panel_254 = Panel("""Living
Prox.""")
panel_255 = Panel("""Mobility
Perform.""")
panel_256 = Panel("""Solar
Perform.""")

# ---- group: slider1
# Slider
num_132 = Number(num_69)

# ----
range = Range(Domain=panel_242, Steps=100)
argb_2 = SplitARGB(Colour=gradient_6)  # -> Alpha, Red, Green, Blue

# ---- group: road color - none
swatch_10 = ColourSwatch(SwatchColor=RGB(64, 64, 64))  # disabled

# ----
lng_9 = ListLength(List=num_131)
multiplication_53 = Multiplication(A=num_132, B=100)
multiplication_54 = Multiplication(A=num_131, B=100)  # disabled
txt_70 = Text(panel_243)
txt_71 = Text(panel_244)  # disabled
txt_72 = Text("")
int_242 = Integer(range)
repeat_16 = RepeatData(Data=txt_72, Length=lng_9)
repeat_17 = RepeatData(Data=txt_71, Length=lng_9)  # disabled
int_243 = Integer(multiplication_54)  # disabled
txt_73 = Text(int_242)
int_244 = Integer(multiplication_53)
merge_20 = Merge(
    Data1=panel_251,
    Data2=panel_246,
    Data3=panel_247,
    Data4=panel_248,
    Data5=panel_249,
    Data6=panel_250,
    Data7=panel_254,
    Data8=panel_252,
    Data9=panel_253,
    Data10=panel_255,
    Data11=panel_256)
pshift_61 = ShiftPaths(Data=int_243, Offset=-1)  # disabled

# ---- group: Position Calibration / road mesh final!
mesh_53 = Mesh(filter_61)

# ---- group: Position Calibration / center line mesh final!
mesh_54 = Mesh(filter_62)

# ---- group: center line mesh final!
# Traffic Heatmap - Ryan - Crude
mesh_55 = Mesh(mesh_54)  # disabled

# ----
pshift_62 = ShiftPaths(Data=mesh_55, Offset=-3)  # disabled
area_2 = Area(Geometry=pshift_62)  # -> Area, Centroid; disabled

# ---- group: center pts
pt_108 = Point(area_2.Centroid)  # disabled

# ----
cps = ClosestPoints(Point=pt_108, Cloud=pt_46, Count=1)  # -> ClosestPoint, CPIndex, Distance; disabled
pshift_63 = ShiftPaths(Data=cps.ClosestPoint, Offset=-1)  # disabled
dist_2 = Distance(PointA=graft(pshift_63), PointB=crossings)  # disabled
bnd_2 = Bounds(Numbers=dist_2)  # disabled
dedomain = DeconstructDomain(Domain=bnd_2)  # -> Start, End; disabled
pshift_64 = ShiftPaths(Data=dedomain.Start, Offset=-1)  # disabled

# ---- group: min dis to intersections
num_133 = Number(pshift_64)  # disabled

# ----
bnd_3 = Bounds(Numbers=num_133)  # disabled
remap_9 = RemapNumbers(Value=num_133, Source=bnd_3, Target=Domain(0, 1))  # -> Mapped, Clipped; disabled
subtraction_15 = Subtraction(A=1, B=remap_9.Mapped)  # disabled
graph_4 = GraphMapper(
    subtraction_15,
    x0=0,
    x1=1,
    y0=0,
    y1=0.5,
    container_name="Bezier",
    cpx=[0, 0.1613658518, 0.7159118652, 1],
    cpy=[0, 0.3613502979, 0.9704423547, 1])  # disabled
pshift_65 = ShiftPaths(Data=repeat_16, Offset=-2)

# ---- group: Position Calibration / building lego modules
mesh_56 = Mesh(filter_59)

# ----
pshift_66 = ShiftPaths(Data=repeat_17, Offset=-2)  # disabled

# ---- group: Position Calibration / blank
mesh_57 = Mesh(filter_63)

# ---- group: Position Calibration / sidewalk mesh final!
mesh_58 = Mesh(filter_64)

# ----
num_134 = Number(number_slider)
frgb_21 = ColourRGBF(Alpha=num_134, Red=argb_2.Red, Green=argb_2.Green, Blue=argb_2.Blue)
python_13 = PythonScript(x=merge_20)  # -> out, a; inputs x: list
# ---------- python_13: Python ----------
a = [i for i in range(len(x))]
# ---------- end python_13 ----------
swatch_11 = ColourSwatch(SwatchColor=RGB(255, 255, 255))

# ---- group: road color - none
col_45 = Colour(swatch_10)  # disabled

# ---- group: heatmap color - solar
col_46 = Colour(frgb_21)

# ----
item_60 = ListItem(List=txt_73, Index=int_244, Wrap=True)
merge_21 = Merge(Data1=graft(txt_70), Data2=graft(pshift_65), Data3=graft(pshift_61), Data4=graft(pshift_66))
pt_109 = Point(<point referenced from the Rhino model>)
mesh_59 = Mesh(mesh_56)

# ---- group: fl # slider
tag_24 = TextTag3D(Location=pt_109, Text=item_60, Size=Slider(16, range=0..100), Colour=swatch_6, Justification=8)

# ----
join_31 = TextJoin(Text=merge_21)
pshift_67 = ShiftPaths(Data=join_31, Offset=-1)
python_14 = PythonScript(x=list)  # -> out, a
# ---------- python_14: Python ----------
if x < 1000:
    a = str(x)+"m"
elif x> 1000:
    a = str(x//1000) +"," + str(x%1000) + "m"
# ---------- end python_14 ----------

pt_110 = Point([<point referenced from the Rhino model> x2])
tag_25 = TextTag3D(Location=pt_110, Text=python_14.a, Size=Slider(15, range=0..100), Colour=swatch_11, Justification=5)

python_15 = PythonScript(x=list)  # -> out, a
# ---------- python_15: Python ----------
x = x/0.276225

a = "1:"+str(int(x/100)*100 )
# ---------- end python_15 ----------

pt_111 = Point(<point referenced from the Rhino model>)
tag_26 = TextTag3D(Location=pt_111, Text=python_15.a, Size=Slider(15, range=0..100), Colour=swatch_11, Justification=4)

txt_74 = Text(pshift_67)
panel_257 = Panel(txt_74)

# ---- group: cell size
num_135 = Number(num_112)

# ---- group: module id
int_245 = Integer(int_137)

int_246 = Integer(int_137)

# ---- group: fl # slider
tag_27 = TextTag3D(
    Location=pt_107,
    Text=txt_74,
    Size=Slider(12, range=0..100),
    Colour=ColourSwatch(SwatchColor=RGB(255, 255, 255)),
    Justification=1)

# ---- group: cell size
num_136 = Number(num_112)

# ---- group: shrink
cell_shrink_3 = Slider(1, range=0.75..1)

# ----
move_z_6 = Slider(6.5, range=0..30)

# ---- group: shrink
cell_shrink_4 = Slider(1, range=0.75..1)

# ----
move_z_7 = Slider(6.5, range=0..30)

# ---- group: Diversity Formular
# Population Diversity Heatmap - GH
panel_258 = Panel("\CityMatrix_ML\01_Software\RH_GH\Grasshopper\ImagesInGH\Diversity Formular.PNG")  # disabled
path_5 = FilePath("C:\Users\RYAN\Dropbox (MIT)\01_Work\Share\_CityScope\CityMatrix_ML\01_Software\RH_GH\Grasshopper\ImagesInGH\Diversity Formular.PNG")  # disabled
panel_259 = Panel(path_5)  # disabled
load_bitmap_2 = LoadBitmap(FilePathToImageLocation=path_5)  # disabled

# ---- group: floor num for each type
int_247 = Integer(int_136)

# ---- group: colortizer orgin
pt_112 = Point(pt_61)

# ---- group: # ppl per flr
num_137 = Number(num_78)

# ---- group: gridExtent_x
int_248 = Integer(int_126)

# ---- group: gridExtent_y
int_249 = Integer(int_128)

# ---- group: x
int_250 = Integer(int_130)

# ---- group: y
int_251 = Integer(int_132)

# ---- group: shrink
num_138 = Number(cell_shrink_3)

# ---- group: floor num for each type
int_252 = Integer(int_136)

# ---- group: colortizer orgin
pt_113 = Point(pt_61)

# ---- group: # ppl per flr
num_139 = Number(num_78)

# ---- group: gridExtent_x
# Population Density Formular:
# Sum of (Nearest N Building Population/Distance to that building)
int_253 = Integer(int_126)

# ---- group: gridExtent_y
int_254 = Integer(int_128)

# ---- group: x
int_255 = Integer(int_130)

# ---- group: y
int_256 = Integer(int_132)

# ---- group: shrink
num_140 = Number(cell_shrink_4)

# ---- group: total parking cell number
# Parking & Park
int_257 = Integer(parking_cell_2)

# ---- group: cell size
num_141 = Number(division_17)

# ---- group: 3D City / module id
int_258 = Integer(int_137)

# ---- group: parking / meshes lego ref: parking
mesh_60 = Mesh(<mesh referenced from the Rhino model>)  # disabled

# ---- group: blank modules
mesh_61 = Mesh(mesh_49)

# ---- group: meshes lego ref: park
mesh_62 = Mesh(<mesh referenced from the Rhino model>)

# ---- group: total park cell number
int_259 = Integer(park_cell_2)

# ----
division_19 = Division(A=num_141, B=2.5)

# ---- group: prevent 0
panel_260 = Panel(".000001")

panel_261 = Panel(".000001")  # disabled

panel_262 = Panel(".000001")  # disabled

# ----
multiplication_55 = Multiplication(A=int_247, B=num_137)

# ---- group: note: none of P1, P2, or P3 could be 0 !!!
panel_263 = Panel("(P1*log10(P1)+P2*log10(P2)+P3*log10(P3)+P4*log10(P4)+P5*log10(P5)+P6*log10(P6)) / log10(6) * (-1)")

panel_264 = Panel("(P1*log10(P1)+P2*log10(P2)+P3*log10(P3)) / log10(3) * (-1)")  # disabled

# ---- group: prevent 0
panel_265 = Panel(".000001")  # disabled

# ---- group: note: none of P1, P2, or P3 could be 0 !!!
panel_266 = Panel("(P1*log10(P1)+P2*log10(P2)+P3*log10(P3)) / log10(3) * (-1)")  # disabled

panel_267 = Panel("(P1*log10(P1)+P2*log10(P2)) / log10(2) * (-1)")  # disabled

# ---- group: dockID
int_260 = Integer(int_135)

# ----
multiplication_56 = Multiplication(A=int_252, B=num_139)

# ---- group: influence range - distance limit
number_slider_41 = Slider(217.9, range=0..1000)

# ---- group: infulence range - # nearest
range_count_2 = Slider(49, range=1..130)

# ---- group: 3D City / 3D building site move amount
X_5 = UnitX(Factor="10000")

# ---- group: module center
pt_114 = Point(modulecenter_2.pt_5)

# ----
# On Dashboard
panel_268 = Panel("-1")
# Activation Mask
# On LEGOs
srf = Surface(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)

# ---- group: module id
int_261 = Integer(int_137)

# ---- group: dockID
int_262 = Integer(int_233)

# ----
neg_9 = Negative(Value=division_19)

# ---- group: ref mask srf - R
srf_2 = Surface(<surface referenced from the Rhino model>)

# ---- group: ref mask srf - RM
srf_3 = Surface(<surface referenced from the Rhino model>)

# ---- group: ref mask srf - bar live
srf_4 = Surface(<surface referenced from the Rhino model>)

# ---- group: ref mask srf - RS
srf_5 = Surface(<surface referenced from the Rhino model>)

# ----
geobottomcenter = GeoBottomCenter_2(geo=mesh_61)

# ---- group: influence range - distance limit
number_slider_42 = Slider(200, range=0..1000)

# ---- group: ref mask srf - RL
srf_6 = Surface(<surface referenced from the Rhino model>)

# ---- group: infulence range - # nearest
range_count_3 = Slider(49, range=1..130)

# ----
movetoorgin_4 = MoveToOrgin(G=mesh_62, num=num_98)
mesh_63 = Mesh(srf)
equals_20 = Equality(FirstNumber=int_262, SecondNumber=panel_268)  # -> Equality, Inequality

# ---- group: # ppl per building
num_142 = Number(multiplication_55)

# ----
panel_269 = Panel(num_142)
equals_21 = Equality(FirstNumber=int_261, SecondNumber=int_262)  # -> Equality, Inequality

# ---- group: 3D City / module center
pt_115 = Point(pt_73)

# ---- group: # ppl per building
num_143 = Number(multiplication_56)

# ----
panel_270 = Panel(num_143)
Z_6 = UnitZ(Factor=Slider(6.2, range=0..10))
lng_10 = ListLength(List=geobottomcenter)

# ---- group: 3D City / blank
mesh_64 = Mesh(mesh_49)

# ---- group: 3D City / sidewalk mesh final!
mesh_65 = Mesh(python_12.allRoadMesh)

# ---- group: 3D City / road mesh final!
mesh_66 = Mesh(mesh_53)

# ----
equals_22 = Equality(FirstNumber=int_260, SecondNumber="1")  # -> Equality, Inequality
equals_23 = Equality(FirstNumber=int_260, SecondNumber="2")  # -> Equality, Inequality
and_6 = GateAnd(A=equals_23.Inequality, B=equals_22.Inequality)
equals_24 = Equality(FirstNumber=int_260, SecondNumber="0")  # -> Equality, Inequality
and_7 = GateAnd(A=and_6, B=equals_24.Inequality)
equals_25 = Equality(FirstNumber=int_260, SecondNumber="7")  # -> Equality, Inequality
division_20 = Division(A=int_257, B=lng_10)
and_8 = GateAnd(A=equals_22.Inequality, B=equals_25.Inequality)
and_9 = GateAnd(A=equals_23.Inequality, B=equals_25.Inequality)
and_10 = GateAnd(A=equals_24.Inequality, B=equals_25.Inequality)
move_22 = Move(Geometry=mesh_63, Motion=Z_6)  # -> Geometry, Transform

# ---- group: module meshes lego at orgin
mesh_67 = Mesh(movetoorgin_4)

# ----
and_11 = GateAnd(A=and_7, B=equals_25.Inequality)

# ---- group: mask settings
swatch_12 = ColourSwatch(SwatchColor=RGB(0, 0, 0))
panel_271 = Panel(".5")
path_6 = FilePath("C:\Users\RYAN\Documents\GitHub\CityMatrix\Map\MAP_BLACK.png")

# ----
dispatch_18 = Dispatch(List=pt_114, DispatchPattern=equals_21.Inequality)  # -> ListA, ListB
randomsplit = RandomSplitList(MasterList=geobottomcenter, Seed=Slider(32, range=0..100), Split=division_20)  # -> ListA, ListB
lng_11 = ListLength(List=randomsplit.ListA)
division_21 = Division(A=int_259, B=lng_11)
Z_7 = UnitZ(Factor=move_z_6)
filter_65 = StreamFilter(Gate=and_8, Stream1=srf_3)
filter_66 = StreamFilter(Gate=and_11, Stream1=srf_4)
filter_67 = StreamFilter(Gate=and_9, Stream1=srf_5)
filter_68 = StreamFilter(Gate=and_10, Stream1=srf_6)
mesh_68 = Mesh(filter_60)
filter_69 = StreamFilter(Gate=and_11, Stream1=srf_2)
randomsplit_2 = RandomSplitList(MasterList=randomsplit.ListA, Seed=Slider(25, range=0..100), Split=division_21)  # -> ListA, ListB
Z_8 = UnitZ(Factor=move_z_7)

# ---- group: mask setting
swatch_13 = ColourSwatch(SwatchColor=RGBA(0, 0, 0, 127))

# ----
# Population Diversity Formular:
# (P1*log10(P1)+P2*log10(P2)+P3*log10(P3)) / log10(3) * (-1)
# P is probability
panel_272 = Panel("""Res. Small
Density
Approximity
Health
Life Quality
Traffic
Energy
Education
Invation""")

# ---- group: 3D City / cell size
num_144 = Number(division_17)

# ---- group: cell area
sqr_2 = Square(Value=num_144)

# ----
multiplication_57 = Multiplication(A=sqr_2, B=number_slider_14)

# ---- group: floor area
num_145 = Number(multiplication_57)

# ----
vec2pt_6 = Vector2Pt(PointA=Point(0, 0, 0), PointB=dispatch_18.ListA, Unitize=False)  # -> Vector, Length

# ---- group: 3D City / 3D building site move amount
vec_3 = Vector(X_5)

# ----
preview_14 = CustomPreview(Geometry=filter_65, Shader=swatch_13)
preview_15 = CustomPreview(Geometry=filter_66, Shader=swatch_13)
preview_16 = CustomPreview(Geometry=filter_67, Shader=swatch_13)
preview_17 = CustomPreview(Geometry=filter_68, Shader=swatch_13)
preview_18 = CustomPreview(Geometry=filter_69, Shader=swatch_13)
move_23 = Move(Geometry=move_22.Geometry, Motion=vec2pt_6.Vector)  # -> Geometry, Transform

# ---- group: parking / parking center
pt_116 = Point(randomsplit.ListB)

# ---- group: park center lego
pt_117 = Point(randomsplit_2.ListB)

# ---- group: 3D City / base height
panel_273 = Panel("5.0")

# ----
mjoin_4 = MeshJoin(Meshes=move_23.Geometry)

# ---- group: ref mask srf - O
srf_7 = Surface(<surface referenced from the Rhino model>)

# ---- group: ref mask srf - OM
srf_8 = Surface(<surface referenced from the Rhino model>)

# ---- group: ref mask srf - bar work
srf_9 = Surface(<surface referenced from the Rhino model>)

# ---- group: ref mask srf - OS
srf_10 = Surface(<surface referenced from the Rhino model>)

# ---- group: ref mask srf - OL
srf_11 = Surface(<surface referenced from the Rhino model>)

# ----
panel_274 = Panel("1.0")  # disabled
panel_275 = Panel("0.0")  # disabled
panel_276 = Panel("1.0")  # disabled
panel_277 = Panel("0.0")  # disabled
vec2pt_7 = Vector2Pt(PointA=Point(0, 0, 0), PointB=pt_117, Unitize=False)  # -> Vector, Length
panel_278 = Panel("1.0")  # disabled
panel_279 = Panel("0.0")  # disabled

# ---- group: 3D City / building height for each type
num_146 = Number(num_65)

# ----
filter_70 = StreamFilter(Gate=equals_20.Equality, Stream0=mjoin_4)
move_24 = Move(Geometry=mesh_67, Motion=vec2pt_7.Vector)  # -> Geometry, Transform
equals_26 = Equality(FirstNumber=int_260, SecondNumber="4")  # -> Equality, Inequality
equals_27 = Equality(FirstNumber=int_260, SecondNumber="5")  # -> Equality, Inequality
and_12 = GateAnd(A=equals_27.Inequality, B=equals_26.Inequality)
equals_28 = Equality(FirstNumber=int_260, SecondNumber="3")  # -> Equality, Inequality
and_13 = GateAnd(A=and_12, B=equals_28.Inequality)
num_147 = Number(panel_274)  # disabled
num_148 = Number(panel_275)  # disabled
num_149 = Number(panel_276)  # disabled
num_150 = Number(panel_277)  # disabled
num_151 = Number(panel_278)  # disabled
num_152 = Number(panel_279)  # disabled
num_153 = Number("1.0")
num_154 = Number("0.0")

number_slider_43 = Slider(1, range=0..10)
argb_3 = SplitARGB(Colour=ColourSwatch(SwatchColor=RGB(0, 0, 0)))  # -> Alpha, Red, Green, Blue
frgb_22 = ColourRGBF(Alpha=Slider(1, range=0..1), Red=argb_3.Red, Green=argb_3.Green, Blue=argb_3.Blue)

and_14 = GateAnd(A=equals_26.Inequality, B=equals_25.Inequality)
and_15 = GateAnd(A=equals_27.Inequality, B=equals_25.Inequality)
and_16 = GateAnd(A=equals_28.Inequality, B=equals_25.Inequality)
previewmat_2 = CustomPreviewMaterials(Geometry=filter_70, DiffuseColor=swatch_12, Transparency=panel_271, DiffuseBitmap=path_6)
and_17 = GateAnd(A=and_13, B=equals_25.Inequality)
filter_71 = StreamFilter(Gate=and_14, Stream1=srf_8)
filter_72 = StreamFilter(Gate=and_17, Stream1=srf_9)
filter_73 = StreamFilter(Gate=and_15, Stream1=srf_10)
filter_74 = StreamFilter(Gate=and_16, Stream1=srf_11)
filter_75 = StreamFilter(Gate=and_17, Stream1=srf_7)

# ---- group: park lego
mesh_69 = Mesh(move_24.Geometry)

# ----
preview_19 = CustomPreview(Geometry=filter_71, Shader=swatch_13)
preview_20 = CustomPreview(Geometry=filter_72, Shader=swatch_13)
preview_21 = CustomPreview(Geometry=filter_73, Shader=swatch_13)
preview_22 = CustomPreview(Geometry=filter_74, Shader=swatch_13)
preview_23 = CustomPreview(Geometry=filter_75, Shader=swatch_13)

# ---- group: 3D City / building height factor
number_slider_44 = Slider(3.1, range=0..10)

# ----
filter_76 = StreamFilter(Gate=show_google_map, Stream0=mesh_69)

# ---- group: score range by experience
panel_280 = Panel("0.0 To 250.0")

# ----
item_61 = ListItem(List=num_142, Index="0", Wrap=False)
item_62 = ListItem(List=num_142, Index="2", Wrap=False)
item_63 = ListItem(List=num_142, Index="1", Wrap=False)
item_64 = ListItem(List=num_142, Index="3", Wrap=False)
item_65 = ListItem(List=num_142, Index="4", Wrap=False)
item_66 = ListItem(List=num_142, Index="5", Wrap=False)

# ---- group: Alpha
number_slider_45 = Slider(0.5, range=0..1)

# ---- group: Position Calibration / park lego
mesh_70 = Mesh(filter_76)

# ---- group: # ppl per building
num_155 = Number(item_61)
num_156 = Number(item_63)
num_157 = Number(item_62)
num_158 = Number(item_64)
num_159 = Number(item_65)
num_160 = Number(item_66)

# ---- group: Alpha
number_slider_46 = Slider(0.5, range=0..1)

# ----
multiplication_58 = Multiplication(A=num_112, B=division_8)
cell_size = Number(multiplication_58)

python_16 = PythonScript(x=Slider(9, range=6..15), scale=division_8)  # -> out, out_2; inputs inL: list
# ---------- python_16: Python ----------
out = x if scale>1 else x+2
# ---------- end python_16 ----------

# ---- group: adjust scales
subtraction_16 = Subtraction(A=python_16.out_2, B="0.75")
dom_5 = ConstructDomain(DomainStart="-0.25", DomainEnd=subtraction_16)

# ----
panel_281 = Panel(dom_5)
remap_10 = RemapNumbers(Value=num_22, Source=Domain(0, 1), Target=panel_281)  # -> Mapped, Clipped

# ---- group: viz ctrl - slider
int_263 = Integer(remap_10.Mapped)

# ----
panel_282 = Panel(int_263)
num_161 = Number(int_263)

# ---- group: adjust scales
subtraction_17 = Subtraction(A=python_16.out_2, B="0.75")
dom_6 = ConstructDomain(DomainStart="-0.25", DomainEnd=subtraction_17)

# ----
panel_283 = Panel(dom_6)
remap_11 = RemapNumbers(Value=num_70, Source=Domain(0, 1), Target=panel_283)  # -> Mapped, Clipped

# ---- group: viz ctrl - slider
int_264 = Integer(remap_11.Mapped)

# ----
panel_284 = Panel(int_264)

# ---- group: viz ctrl - slider
int_265 = Integer(int_264)

# ----
panel_285 = Panel(int_265)

# ---- group: viz ctrl AI over rider
vizctrlaioverride_py = PythonScript(vizIntSlider=int_265, AIStepInt=int_181)  # -> out, a; disabled
# ---------- vizctrlaioverride_py: Python ----------
import rhinoscriptsyntax as rs
import scriptcontext as sc

if AIStepInt < 11:
    a = 0
elif AIStepInt == 11:
    a = 1
elif AIStepInt == 12:
    a = 2
elif AIStepInt == 13:
    a = 3
elif AIStepInt == 14:
    a = 4
elif AIStepInt == 15:
    a = 5
else:
    a = vizIntSlider
# ---------- end vizctrlaioverride_py ----------

# ---- group: viz ctrl - AI override
int_266 = Integer(int_265)

# ----
panel_286 = Panel(int_266)

# ---- group: viz ctrl - AI override
# Send to and Receive from Python Server (json, UDP)
int_267 = Integer(int_266)  # disabled

# ----
panel_287 = Panel(int_267)  # disabled
filter_77 = StreamFilter(Gate=int_267, Stream4=panel_215)  # disabled
filter_78 = StreamFilter(Gate=int_267, Stream4=panel_223)  # disabled

# ---- group: viz ctrl - AI override
int_268 = Integer(int_266)

# ----
filter_79 = StreamFilter(Gate=int_268, Stream4=int_215)
panel_288 = Panel(int_268)  # disabled

# ---- group: viz ctrl - AI override
int_269 = Integer(int_266)

# ----
filter_80 = StreamFilter(Gate=int_269, Stream5=int_216)
panel_289 = Panel(int_269)

# ---- group: viz ctrl - AI override
# Energy/Cost Efficiency Heatmap - GH
int_270 = Integer(int_266)

# ----
panel_290 = Panel(int_270)
filter_81 = StreamFilter(Gate=int_268, Stream4=num_115)
filter_82 = StreamFilter(Gate=int_269, Stream5=num_116)
filter_83 = StreamFilter(Gate=int_270, Stream4=num_117)
filter_84 = StreamFilter(Gate=int_270, Stream4=int_217)

# ---- group: cell size
num_162 = Number(filter_83)

# ---- group: module id
int_271 = Integer(filter_84)

# ---- group: type / module id
int_272 = Integer(filter_79)  # disabled

# ---- group: cell size
num_163 = Number(filter_81)

# ---- group: type / module id
int_273 = Integer(filter_80)

# ---- group: cell size
num_164 = Number(filter_82)

# ----
modulecenter_3 = ModuleCenter(pt=pt_64, num=num_162, int_2=int_227, int=int_228)  # -> pt_5, transform_2
division_22 = Division(A=num_162, B=2)
neg_10 = Negative(Value=division_22)
modulecenter_4 = ModuleCenter(pt=pt_65, num=num_163, int_2=num_118, int=num_119)  # -> pt_5, transform_2
division_23 = Division(A=num_163, B=2)
neg_11 = Negative(Value=division_23)
modulecenter_5 = ModuleCenter(pt=pt_66, num=num_164, int_2=num_122, int=num_123)  # -> pt_5, transform_2
division_24 = Division(A=num_164, B=2)
neg_12 = Negative(Value=division_24)
larger_6 = LargerThan(FirstNumber=int_271, SecondNumber="0")  # -> LargerThan, OrEqualTo
smaller_4 = SmallerThan(FirstNumber=int_271, SecondNumber="5")  # -> SmallerThan, OrEqualTo
dom_7 = ConstructDomain(DomainStart=neg_10, DomainEnd=division_22)
dom_8 = ConstructDomain(DomainStart=neg_11, DomainEnd=division_23)
dom_9 = ConstructDomain(DomainStart=neg_12, DomainEnd=division_24)
and_18 = GateAnd(A=larger_6.OrEqualTo, B=smaller_4.OrEqualTo)

# ---- group: type / module id
int_274 = Integer(int_272)  # disabled

int_275 = Integer(int_273)

# ----
planesrf_2 = PlaneSurface(Plane=PlaneXY(0, 0, 0), XSize=dom_7, YSize=dom_7)
planesrf_3 = PlaneSurface(Plane=PlaneXY(0, 0, 0), XSize=dom_8, YSize=dom_8)
planesrf_4 = PlaneSurface(Plane=PlaneXY(0, 0, 0), XSize=dom_9, YSize=dom_9)

# ---- group: module center
pt_118 = Point(modulecenter_3.pt_5)

# ---- group: isBuilding
bool_38 = Boolean(and_18)

# ----
scale_nu_13 = ScaleNU(Geometry=planesrf_2, Plane=PlaneXY(0, 0, 0), ScaleX=num_101, ScaleY=num_101, ScaleZ=1)  # -> Geometry, Transform
scale_nu_14 = ScaleNU(Geometry=planesrf_3, Plane=PlaneXY(0, 0, 0), ScaleX=num_102, ScaleY=num_102, ScaleZ=1)  # -> Geometry, Transform
scale_nu_15 = ScaleNU(Geometry=planesrf_4, Plane=PlaneXY(0, 0, 0), ScaleX=num_107, ScaleY=num_107, ScaleZ=1)  # -> Geometry, Transform

# ---- group: module center
pt_119 = Point(modulecenter_4.pt_5)

pt_120 = Point(modulecenter_5.pt_5)

# ----
dispatch_19 = Dispatch(List=int_271, DispatchPattern=bool_38)  # -> ListA, ListB
dispatch_20 = Dispatch(List=pt_118, DispatchPattern=bool_38)  # -> ListA, ListB
move_25 = Move(Geometry=scale_nu_13.Geometry, Motion=Z_3)  # -> Geometry, Transform
move_26 = Move(Geometry=scale_nu_14.Geometry, Motion=Z_4)  # -> Geometry, Transform
move_27 = Move(Geometry=scale_nu_15.Geometry, Motion=Z_5)  # -> Geometry, Transform

# ---- group: module center - building only
pt_121 = Point(dispatch_20.ListA)

# ----
cps_2 = ClosestPoints(Point=pt_118, Cloud=pt_121, Count=range_count)  # -> ClosestPoint, CPIndex, Distance
smaller_5 = SmallerThan(FirstNumber=cps_2.Distance, SecondNumber=number_slider_36)  # -> SmallerThan, OrEqualTo

# ---- group: module id - building only
int_276 = Integer(dispatch_19.ListA)

# ----
item_67 = ListItem(List=int_276, Index=cps_2.CPIndex, Wrap=False)
vec2pt_8 = Vector2Pt(PointA=Point(0, 0, 0), PointB=pt_118, Unitize=False)  # -> Vector, Length

# ---- group: mesh srf at orgin
mesh_71 = Mesh(move_25.Geometry)

# ----
vec2pt_9 = Vector2Pt(PointA=Point(0, 0, 0), PointB=pt_120, Unitize=False)  # -> Vector, Length

# ---- group: mesh srf at orgin
mesh_72 = Mesh(move_26.Geometry)

# ----
dispatch_21 = Dispatch(List=cps_2.ClosestPoint, DispatchPattern=smaller_5.OrEqualTo)  # -> ListA, ListB
dispatch_22 = Dispatch(List=item_67, DispatchPattern=smaller_5.OrEqualTo)  # -> ListA, ListB
dispatch_23 = Dispatch(List=cps_2.Distance, DispatchPattern=smaller_5.OrEqualTo)  # -> ListA, ListB

# ---- group: mesh srf at orgin
mesh_73 = Mesh(move_27.Geometry)

# ----
move_28 = Move(Geometry=mesh_71, Motion=vec2pt_8.Vector)  # -> Geometry, Transform
equals_29 = Equality(FirstNumber=int_274, SecondNumber=panel_235)  # -> Equality, Inequality; disabled
move_29 = Move(Geometry=mesh_73, Motion=vec2pt_9.Vector)  # -> Geometry, Transform

# ---- group: bldg cntr in range
pt_122 = Point(dispatch_21.ListA)

# ---- group: distances in range
num_165 = Number(dispatch_23.ListA)

# ---- group: module ids in range
int_277 = Integer(dispatch_22.ListA)

# ---- group: mesh srfs at module centers
mesh_74 = Mesh(move_28.Geometry)

# ---- group: isRoad
bool_39 = Boolean(equals_29.Equality)  # disabled

# ----
dispatch_24 = Dispatch(List=pt_119, DispatchPattern=bool_39)  # -> ListA, ListB

# ---- group: module center road only
pt_123 = Point(dispatch_24.ListA)

# ----
vec2pt_10 = Vector2Pt(PointA=Point(0, 0, 0), PointB=pt_123, Unitize=False)  # -> Vector, Length; disabled
move_30 = Move(Geometry=mesh_72, Motion=vec2pt_10.Vector)  # -> Geometry, Transform; disabled
dispatch_25 = Dispatch(List=num_120, DispatchPattern=bool_39)  # -> ListA, ListB; disabled
dispatch_26 = Dispatch(List=num_121, DispatchPattern=bool_39)  # -> ListA, ListB; disabled

# ---- group: mesh srfs at module centers
mesh_75 = Mesh(move_30.Geometry)  # disabled

mesh_76 = Mesh(move_29.Geometry)

# ----
item_68 = ListItem(List=panel_228, Index=int_277, Wrap=False)
item_69 = ListItem(List=int_224, Index=int_277, Wrap=False)
addition_16 = Addition(A=num_165, B=num_162)

# ---- group: traffic value - road
num_166 = Number(dispatch_25.ListA)  # disabled

# ----
bnd_4 = Bounds(Numbers=num_166)  # disabled
panel_291 = Panel(bnd_4)  # disabled

# ---- group: wait value - road
num_167 = Number(dispatch_26.ListA)  # disabled

# ----
bnd_5 = Bounds(Numbers=num_167)  # disabled
panel_292 = Panel(bnd_5)  # disabled
multiplication_59 = Multiplication(A=item_68, B=item_69)
dispatch_27 = Dispatch(List=num_120, DispatchPattern=bool_39)  # -> ListA, ListB; disabled

pt_124 = Point(<point referenced from the Rhino model>)
pt_125 = Point(<point referenced from the Rhino model>)
ln_4 = Line(StartPoint=pt_124, EndPoint=pt_125)
subtraction_18 = Subtraction(A=python_16.out_2, B="1")
divide_4 = DivideCurve(Curve=ln_4, Count=subtraction_18, Kinks=False)  # -> Points, Tangents, Parameters

remap_12 = RemapNumbers(Value=num_166, Source=panel_236, Target=Domain(0, 1))  # -> Mapped, Clipped; disabled

crv_54 = Curve(<curve referenced from the Rhino model>)
subtraction_19 = Subtraction(A=python_16.out_2, B="0")
divide_5 = DivideCurve(Curve=crv_54, Count=subtraction_19, Kinks=False)  # -> Points, Tangents, Parameters

# ---- group: energy/cost efficiency in range
num_168 = Number(multiplication_59)

# ----
remap_13 = RemapNumbers(Value=num_167, Source=panel_237, Target=Domain(0, 1))  # -> Mapped, Clipped; disabled

# ---- group: distances in range - avoid 0
num_169 = Number(addition_16)

# ---- group: traffic value road only
num_170 = Number(dispatch_27.ListA)  # disabled

# ----
division_25 = Division(A=num_168, B=num_169)

# ---- group: traffic value - normalized
num_171 = Number(remap_12.Mapped)  # disabled

# ---- group: wait value - normalized
num_172 = Number(remap_13.Mapped)  # disabled

# ----
gradient_10 = Gradient(LowerLimit=0, UpperLimit=1, Parameter=num_171, stops=[0: RGB(0, 128, 0), 0.5: RGB(222, 222, 0), 1: RGB(255, 0, 0)])  # disabled
gradient_11 = Gradient(LowerLimit=0, UpperLimit=1, Parameter=num_171, stops=[0: RGB(255, 255, 255), 1: RGB(0, 0, 0)])  # disabled
gradient_12 = Gradient(LowerLimit=0, UpperLimit=1, Parameter=num_172, stops=[0: RGB(0, 128, 0), 0.5: RGB(222, 222, 0), 1: RGB(255, 0, 0)])  # disabled
ma_24 = MassAddition(Input=division_25)  # -> Result, PartialResults

# ---- group: Ref Pts
pt_126 = Point(divide_4.Points)

# ----
item_70 = ListItem(List=pt_126, Index="0", Wrap=True)
item_71 = ListItem(List=pt_126, Index="1", Wrap=True)
dist_3 = Distance(PointA=item_70, PointB=item_71)
division_26 = Division(A=dist_3, B="2")
vec_4 = VectorXYZ(XComponent=division_26, YComponent=0, ZComponent=0)  # -> Vector, Length
move_31 = Move(Geometry=pt_126, Motion=vec_4.Vector)  # -> Geometry, Transform

# ---- group: Ref Pts
pt_127 = Point(divide_5.Points)

# ----
item_72 = ListItem(List=pt_127, Index="0", Wrap=True)
item_73 = ListItem(List=pt_127, Index="1", Wrap=True)
dist_4 = Distance(PointA=item_72, PointB=item_73)
division_27 = Division(A=dist_4, B="2")
vec_5 = VectorXYZ(XComponent=division_27, YComponent=0, ZComponent=0)  # -> Vector, Length
move_32 = Move(Geometry=pt_127, Motion=vec_5.Vector)  # -> Geometry, Transform

pshift_68 = ShiftPaths(Data=ma_24.Result, Offset=-1)

# ---- group: population density score
num_173 = Number(pshift_68)

# ----
bnd_6 = Bounds(Numbers=num_173)
panel_293 = Panel(bnd_6)
argb_4 = SplitARGB(Colour=gradient_10)  # -> Alpha, Red, Green, Blue; disabled
argb_5 = SplitARGB(Colour=gradient_12)  # -> Alpha, Red, Green, Blue; disabled

pdecon_30 = Deconstruct(Point=item_70)  # -> XComponent, YComponent, ZComponent
pdecon_31 = Deconstruct(Point=item_72)  # -> XComponent, YComponent, ZComponent
python_17 = PythonScript(x=subtraction_19)  # -> out, a; inputs x: Int32
# ---------- python_17: Python ----------
import math
a = []
for n in range(x):
    i = max(n-int(x/2),int(x/2)-n)+2
    a.append(i)
    
print(a)
# ---------- end python_17 ----------
subtraction_20 = Subtraction(A=pdecon_30.YComponent, B=pdecon_31.YComponent)
division_28 = Division(A=subtraction_20, B=python_17.a)

number_slider_47 = Slider(10, range=0..30)
neg_13 = Negative(Value=number_slider_47)
vec_6 = VectorXYZ(XComponent=0, YComponent=Slider(10, range=0..30), ZComponent=0)  # -> Vector, Length
vec_7 = VectorXYZ(XComponent=number_slider_47, YComponent=0, ZComponent=0)  # -> Vector, Length
vec_8 = VectorXYZ(XComponent=neg_13, YComponent=0, ZComponent=0)  # -> Vector, Length
move_33 = Move(Geometry=move_32.Geometry, Motion=vec_7.Vector)  # -> Geometry, Transform
move_34 = Move(Geometry=move_32.Geometry, Motion=vec_8.Vector)  # -> Geometry, Transform
ln_5 = Line(StartPoint=move_33.Geometry, EndPoint=move_34.Geometry)
vec_9 = VectorXYZ(XComponent=0, YComponent=division_28, ZComponent=0)  # -> Vector, Length
split_8 = SplitList(List=ln_5, Index=subtraction_19)  # -> ListA, ListB
crv_55 = Curve(split_8.ListA)
curvepoint = PointOnCurve(crv_55, parameter=0.5)
move_35 = Move(Geometry=curvepoint, Motion=vec_9.Vector)  # -> Geometry, Transform

remap_14 = RemapNumbers(Value=num_173, Source=panel_241, Target=Domain(0, 1))  # -> Mapped, Clipped
max_10 = Maximum(A=remap_14.Mapped, B=0)
min_3 = Minimum(A=max_10, B=1)
frgb_23 = ColourRGBF(Alpha=number_slider_39, Red=argb_4.Red, Green=argb_4.Green, Blue=argb_4.Blue)  # disabled
frgb_24 = ColourRGBF(Alpha=number_slider_39, Red=argb_5.Red, Green=argb_5.Green, Blue=argb_5.Blue)  # disabled

# ---- group: population density score normalized
num_174 = Number(remap_14.Mapped)

# ----
gradient_13 = Gradient(LowerLimit=0, UpperLimit=1, Parameter=num_174, stops=[0: RGB(0, 0, 0), 1: RGB(255, 255, 255)])
gradient_14 = Gradient(LowerLimit=0, UpperLimit=1, Parameter=num_174, stops=[0: RGB(255, 0, 0), 0.5: RGB(222, 222, 0), 1: RGB(0, 128, 0)])
argb_6 = SplitARGB(Colour=gradient_14)  # -> Alpha, Red, Green, Blue
frgb_25 = ColourRGBF(Alpha=num_134, Red=argb_6.Red, Green=argb_6.Green, Blue=argb_6.Blue)

# ---- group: viz color
col_47 = Colour(frgb_25)

# ---- group: road color - wait
col_48 = Colour(frgb_24)  # disabled

# ---- group: road color - traffic
col_49 = Colour(frgb_23)  # disabled

# ----
subtraction_21 = Subtraction(A=subtraction_20, B=division_28)
neg_14 = Negative(Value=subtraction_21)
vec_10 = VectorXYZ(XComponent=0, YComponent=neg_14, ZComponent=0)  # -> Vector, Length
move_36 = Move(Geometry=move_31.Geometry, Motion=vec_6.Vector)  # -> Geometry, Transform
move_37 = Move(Geometry=move_31.Geometry, Motion=vec_10.Vector)  # -> Geometry, Transform
ln_6 = Line(StartPoint=move_37.Geometry, EndPoint=move_36.Geometry)
ln_7 = Line(StartPoint=move_37.Geometry, EndPoint=move_35.Geometry)
ln_8 = Line(StartPoint=curvepoint, EndPoint=move_35.Geometry)

# ---- group: viz ctrl - AI override
int_278 = Integer(int_266)

# ----
equals_30 = Equality(FirstNumber=int_278, SecondNumber=python_13.a)  # -> Equality, Inequality

# ---- group: population density viz
preview_24 = CustomPreview(Geometry=mesh_74, Shader=col_47)

# ----
item_74 = ListItem(List=[ColourSwatch(SwatchColor=RGB(125, 125, 125)), swatch_11], Index=equals_30.Equality, Wrap=False)

# ---- group: wait
preview_25 = CustomPreview(Geometry=mesh_75, Shader=col_48)  # disabled

# ---- group: traffic
preview_26 = CustomPreview(Geometry=mesh_75, Shader=col_49)  # disabled

# ---- group: solar
preview_27 = CustomPreview(Geometry=mesh_76, Shader=col_46)  # disabled

# ----
python_18 = PythonScript(x=subtraction_19, scale=division_8, inL=merge_20)  # -> out, out_2; inputs inL: list
# ---------- python_18: Python ----------
out = inL[:int(x)] if scale>1 else inL
# ---------- end python_18 ----------
python_19 = PythonScript(x=subtraction_19, scale=division_8, inL=item_74)  # -> out, out_2; inputs inL: list; same code as python_18
panel_294 = Panel(int_278)

# ---- group: fl # slider
tag_28 = TextTag3D(Location=pt_126, Text=python_18.out_2, Size=Slider(13.5, range=0..100), Colour=python_19.out_2, Justification=4)

# ----
item_75 = ListItem(List=ln_6, Index=int_278, Wrap=True)
item_76 = ListItem(List=crv_55, Index=int_278, Wrap=True)
item_77 = ListItem(List=ln_8, Index=int_278, Wrap=True)
item_78 = ListItem(List=ln_7, Index=int_278, Wrap=True)
# Population Density Heatmap - GH
previewlw_5 = CustomPreviewLineweights(Geometry=[ln_8, ln_7, ln_6, crv_55], Shader=ColourSwatch(SwatchColor=RGB(125, 125, 125)), Absolute=False)
previewlw_6 = CustomPreviewLineweights(Geometry=[item_76, item_77, item_78, item_75], Shader=ColourSwatch(SwatchColor=RGB(255, 255, 255)), Absolute=False)

# ---- group: viz ctrl - AI override
int_279 = Integer(int_266)

# ----
panel_295 = Panel(int_279)

# ---- group: viz ctrl - AI override
int_280 = Integer(int_266)

# ----
panel_296 = Panel(int_280)
filter_85 = StreamFilter(Gate=int_279, Stream3=int_245)
filter_86 = StreamFilter(Gate=int_279, Stream3=num_135)
filter_87 = StreamFilter(Gate=int_280, Stream2=num_136)
filter_88 = StreamFilter(Gate=int_280, Stream2=int_246)

# ---- group: cell size
num_175 = Number(filter_86)

# ---- group: module id
int_281 = Integer(filter_85)

# ---- group: cell size
num_176 = Number(filter_87)

# ---- group: module id
int_282 = Integer(filter_88)

# ----
modulecenter_6 = ModuleCenter(pt=pt_112, num=num_175, int_2=int_250, int=int_251)  # -> pt_5, transform_2
division_29 = Division(A=num_175, B=2)
neg_15 = Negative(Value=division_29)
modulecenter_7 = ModuleCenter(pt=pt_113, num=num_176, int_2=int_255, int=int_256)  # -> pt_5, transform_2
division_30 = Division(A=num_176, B=2)
neg_16 = Negative(Value=division_30)
larger_7 = LargerThan(FirstNumber=int_281, SecondNumber="0")  # -> LargerThan, OrEqualTo
smaller_6 = SmallerThan(FirstNumber=int_281, SecondNumber="5")  # -> SmallerThan, OrEqualTo
dom_10 = ConstructDomain(DomainStart=neg_15, DomainEnd=division_29)
larger_8 = LargerThan(FirstNumber=int_282, SecondNumber="0")  # -> LargerThan, OrEqualTo
smaller_7 = SmallerThan(FirstNumber=int_282, SecondNumber="5")  # -> SmallerThan, OrEqualTo
dom_11 = ConstructDomain(DomainStart=neg_16, DomainEnd=division_30)
and_19 = GateAnd(A=larger_7.OrEqualTo, B=smaller_6.OrEqualTo)
and_20 = GateAnd(A=larger_8.OrEqualTo, B=smaller_7.OrEqualTo)
planesrf_5 = PlaneSurface(Plane=PlaneXY(0, 0, 0), XSize=dom_10, YSize=dom_10)
planesrf_6 = PlaneSurface(Plane=PlaneXY(0, 0, 0), XSize=dom_11, YSize=dom_11)

# ---- group: module center
pt_128 = Point(modulecenter_6.pt_5)

# ---- group: isBuilding
bool_40 = Boolean(and_19)

# ---- group: module center
pt_129 = Point(modulecenter_7.pt_5)

# ---- group: isBuilding
bool_41 = Boolean(and_20)

# ----
scale_nu_16 = ScaleNU(Geometry=planesrf_5, Plane=PlaneXY(0, 0, 0), ScaleX=num_138, ScaleY=num_138, ScaleZ=1)  # -> Geometry, Transform
scale_nu_17 = ScaleNU(Geometry=planesrf_6, Plane=PlaneXY(0, 0, 0), ScaleX=num_140, ScaleY=num_140, ScaleZ=1)  # -> Geometry, Transform
dispatch_28 = Dispatch(List=int_281, DispatchPattern=bool_40)  # -> ListA, ListB
dispatch_29 = Dispatch(List=pt_128, DispatchPattern=bool_40)  # -> ListA, ListB
move_38 = Move(Geometry=scale_nu_16.Geometry, Motion=Z_7)  # -> Geometry, Transform
dispatch_30 = Dispatch(List=int_282, DispatchPattern=bool_41)  # -> ListA, ListB
dispatch_31 = Dispatch(List=pt_129, DispatchPattern=bool_41)  # -> ListA, ListB
move_39 = Move(Geometry=scale_nu_17.Geometry, Motion=Z_8)  # -> Geometry, Transform

# ---- group: module center - building only
pt_130 = Point(dispatch_29.ListA)

# ----
cps_3 = ClosestPoints(Point=pt_130, Cloud=pt_130, Count=range_count_2)  # -> ClosestPoint, CPIndex, Distance
smaller_8 = SmallerThan(FirstNumber=cps_3.Distance, SecondNumber=number_slider_41)  # -> SmallerThan, OrEqualTo

# ---- group: module id - building only
int_283 = Integer(dispatch_28.ListA)

# ----
item_79 = ListItem(List=int_283, Index=cps_3.CPIndex, Wrap=False)
vec2pt_11 = Vector2Pt(PointA=Point(0, 0, 0), PointB=pt_130, Unitize=False)  # -> Vector, Length

# ---- group: module center - building only
pt_131 = Point(dispatch_31.ListA)

# ----
cps_4 = ClosestPoints(Point=pt_129, Cloud=pt_131, Count=range_count_3)  # -> ClosestPoint, CPIndex, Distance
smaller_9 = SmallerThan(FirstNumber=cps_4.Distance, SecondNumber=number_slider_42)  # -> SmallerThan, OrEqualTo

# ---- group: module id - building only
int_284 = Integer(dispatch_30.ListA)

# ----
item_80 = ListItem(List=int_284, Index=cps_4.CPIndex, Wrap=False)

# ---- group: mesh srf at orgin
mesh_77 = Mesh(move_38.Geometry)

# ----
vec2pt_12 = Vector2Pt(PointA=Point(0, 0, 0), PointB=pt_129, Unitize=False)  # -> Vector, Length
dispatch_32 = Dispatch(List=item_79, DispatchPattern=smaller_8.OrEqualTo)  # -> ListA, ListB

# ---- group: mesh srf at orgin
mesh_78 = Mesh(move_39.Geometry)

# ----
dispatch_33 = Dispatch(List=cps_4.ClosestPoint, DispatchPattern=smaller_9.OrEqualTo)  # -> ListA, ListB
dispatch_34 = Dispatch(List=item_80, DispatchPattern=smaller_9.OrEqualTo)  # -> ListA, ListB
dispatch_35 = Dispatch(List=cps_4.Distance, DispatchPattern=smaller_9.OrEqualTo)  # -> ListA, ListB
move_40 = Move(Geometry=mesh_77, Motion=vec2pt_11.Vector)  # -> Geometry, Transform
move_41 = Move(Geometry=mesh_78, Motion=vec2pt_12.Vector)  # -> Geometry, Transform

# ---- group: module ids in range
int_285 = Integer(dispatch_32.ListA)

# ---- group: mesh srfs at module centers
mesh_79 = Mesh(move_40.Geometry)

# ---- group: bldg cntr in range
pt_132 = Point(dispatch_33.ListA)

# ---- group: distances in range
num_177 = Number(dispatch_35.ListA)

# ---- group: module ids in range
int_286 = Integer(dispatch_34.ListA)

# ---- group: mesh srfs at module centers
mesh_80 = Mesh(move_41.Geometry)

# ----
equals_31 = Equality(FirstNumber=int_285, SecondNumber="3")  # -> Equality, Inequality
equals_32 = Equality(FirstNumber=int_285, SecondNumber="5")  # -> Equality, Inequality
equals_33 = Equality(FirstNumber=int_285, SecondNumber="4")  # -> Equality, Inequality
equals_34 = Equality(FirstNumber=int_285, SecondNumber="0")  # -> Equality, Inequality
equals_35 = Equality(FirstNumber=int_285, SecondNumber="2")  # -> Equality, Inequality
equals_36 = Equality(FirstNumber=int_285, SecondNumber="1")  # -> Equality, Inequality
item_81 = ListItem(List=num_143, Index=int_286, Wrap=False)
addition_17 = Addition(A=num_177, B=num_176)
int_287 = Integer(equals_31.Equality)
int_288 = Integer(equals_34.Equality)
int_289 = Integer(equals_33.Equality)
int_290 = Integer(equals_32.Equality)
int_291 = Integer(equals_36.Equality)
int_292 = Integer(equals_35.Equality)
ma_25 = MassAddition(Input=int_287)  # -> Result, PartialResults
ma_26 = MassAddition(Input=int_290)  # -> Result, PartialResults
ma_27 = MassAddition(Input=int_289)  # -> Result, PartialResults
ma_28 = MassAddition(Input=int_288)  # -> Result, PartialResults
ma_29 = MassAddition(Input=int_292)  # -> Result, PartialResults
ma_30 = MassAddition(Input=int_291)  # -> Result, PartialResults

# ---- group: distances in range - avoid 0
num_178 = Number(addition_17)

# ---- group: # ppl in range
num_179 = Number(item_81)

# ---- group: building # in range
int_293 = Integer(ma_28.Result)
int_294 = Integer(ma_30.Result)
int_295 = Integer(ma_29.Result)
int_296 = Integer(ma_25.Result)
int_297 = Integer(ma_27.Result)
int_298 = Integer(ma_26.Result)

# ----
division_31 = Division(A=num_179, B=num_178)
ma_31 = MassAddition(Input=division_31)  # -> Result, PartialResults
pshift_69 = ShiftPaths(Data=ma_31.Result, Offset=-1)
multiplication_60 = Multiplication(A=int_296, B=num_158)
multiplication_61 = Multiplication(A=int_294, B=num_156)
multiplication_62 = Multiplication(A=int_297, B=num_159)
multiplication_63 = Multiplication(A=int_298, B=num_160)
multiplication_64 = Multiplication(A=int_293, B=num_155)
multiplication_65 = Multiplication(A=int_295, B=num_157)

# ---- group: population density score
num_180 = Number(pshift_69)

# ----
bnd_7 = Bounds(Numbers=num_180)
panel_297 = Panel(bnd_7)
pshift_70 = ShiftPaths(Data=multiplication_60, Offset=-1)
pshift_71 = ShiftPaths(Data=multiplication_61, Offset=-1)
pshift_72 = ShiftPaths(Data=multiplication_64, Offset=-1)
pshift_73 = ShiftPaths(Data=multiplication_65, Offset=-1)
pshift_74 = ShiftPaths(Data=multiplication_62, Offset=-1)
pshift_75 = ShiftPaths(Data=multiplication_63, Offset=-1)
remap_15 = RemapNumbers(Value=num_180, Source=panel_280, Target=Domain(0, 1))  # -> Mapped, Clipped
max_11 = Maximum(A=remap_15.Mapped, B=0)
min_4 = Minimum(A=max_11, B=1)

# ---- group: total # ppl in range
num_181 = Number(pshift_72)
num_182 = Number(pshift_71)
num_183 = Number(pshift_73)
num_184 = Number(pshift_70)
num_185 = Number(pshift_74)
num_186 = Number(pshift_75)

num_187 = Number(num_181)
num_188 = Number(num_182)
num_189 = Number(num_183)
num_190 = Number(num_184)
num_191 = Number(num_185)
num_192 = Number(num_186)

# ----
addition_18 = Addition(A=num_190, B=num_191)  # disabled
addition_19 = Addition(A=num_187, B=num_188)  # disabled
addition_20 = Addition(A=addition_18, B=num_192)  # disabled
addition_21 = Addition(A=addition_19, B=num_189)  # disabled

# ---- group: living
num_193 = Number(addition_21)  # disabled

# ---- group: working
num_194 = Number(addition_20)  # disabled

# ---- group: RL pop.
num_195 = Number(graft(num_187))

# ---- group: OL pop.
num_196 = Number(graft(num_190))

# ---- group: RS pop.
num_197 = Number(graft(num_189))

# ---- group: OS pop.
num_198 = Number(graft(num_192))

# ---- group: OL pop.
num_199 = Number(graft(num_190))  # disabled

# ---- group: OM pop.
num_200 = Number(graft(num_191))

# ---- group: RM pop.
num_201 = Number(graft(num_188))

# ---- group: OS pop.
num_202 = Number(graft(num_192))  # disabled

# ---- group: OM pop.
num_203 = Number(graft(num_191))  # disabled

# ---- group: RL pop.
num_204 = Number(graft(num_187))  # disabled
# ---- group: RS pop.
num_205 = Number(graft(num_189))  # disabled

# ---- group: RM pop.
num_206 = Number(graft(num_188))  # disabled

# ---- group: R pop.
num_207 = Number(graft(num_193))  # disabled

# ---- group: O pop.
num_208 = Number(graft(num_194))  # disabled

# ----
addition_22 = Addition(A=num_198, B=panel_260)
addition_23 = Addition(A=num_197, B=panel_260)
addition_24 = Addition(A=num_196, B=panel_260)
addition_25 = Addition(A=num_195, B=panel_260)
addition_26 = Addition(A=num_200, B=panel_260)
addition_27 = Addition(A=num_201, B=panel_260)
addition_28 = Addition(A=num_202, B=panel_261)  # disabled
addition_29 = Addition(A=num_199, B=panel_261)  # disabled
addition_30 = Addition(A=num_203, B=panel_261)  # disabled
addition_31 = Addition(A=num_205, B=panel_262)  # disabled
addition_32 = Addition(A=num_204, B=panel_262)  # disabled
addition_33 = Addition(A=num_206, B=panel_262)  # disabled
addition_34 = Addition(A=num_207, B=panel_265)  # disabled
addition_35 = Addition(A=num_208, B=panel_265)  # disabled
ma_32 = MassAddition(Input=[addition_25, addition_27, addition_23, addition_24, addition_26, addition_22])  # -> Result, PartialResults
ma_33 = MassAddition(Input=[addition_29, addition_30, addition_28])  # -> Result, PartialResults; disabled
ma_34 = MassAddition(Input=[addition_32, addition_33, addition_31])  # -> Result, PartialResults; disabled
ma_35 = MassAddition(Input=[addition_34, addition_35])  # -> Result, PartialResults; disabled

# ---- group: total O. pop.
num_209 = Number(ma_32.Result)

# ----
division_32 = Division(A=addition_24, B=num_209)
division_33 = Division(A=addition_25, B=num_209)
division_34 = Division(A=addition_22, B=num_209)
division_35 = Division(A=addition_23, B=num_209)
division_36 = Division(A=addition_26, B=num_209)
division_37 = Division(A=addition_27, B=num_209)

# ---- group: total O. pop.
num_210 = Number(ma_33.Result)  # disabled

# ----
division_38 = Division(A=addition_29, B=num_210)  # disabled
division_39 = Division(A=addition_28, B=num_210)  # disabled
division_40 = Division(A=addition_30, B=num_210)  # disabled

# ---- group: total res. pop.
num_211 = Number(ma_34.Result)  # disabled

# ----
division_41 = Division(A=addition_32, B=num_211)  # disabled
division_42 = Division(A=addition_31, B=num_211)  # disabled
division_43 = Division(A=addition_33, B=num_211)  # disabled

# ---- group: total O. pop.
num_212 = Number(ma_35.Result)  # disabled

# ----
division_44 = Division(A=addition_34, B=num_212)  # disabled
division_45 = Division(A=addition_35, B=num_212)  # disabled

# ---- group: % RL pop.
num_213 = Number(division_33)

# ---- group: % OL pop.
num_214 = Number(division_32)

# ---- group: % RM pop.
num_215 = Number(division_37)

# ---- group: % OM pop.
num_216 = Number(division_36)

# ---- group: % OL pop.
num_217 = Number(division_38)  # disabled

# ---- group: % RS pop.
num_218 = Number(division_35)

# ---- group: % OS pop.
num_219 = Number(division_34)

# ---- group: % OM pop.
num_220 = Number(division_40)  # disabled

# ---- group: % OS pop.
num_221 = Number(division_39)  # disabled

# ---- group: % RL pop.
num_222 = Number(division_41)  # disabled

# ---- group: % RM pop.
num_223 = Number(division_43)  # disabled

# ---- group: % RS pop.
num_224 = Number(division_42)  # disabled

# ---- group: % OL pop.
num_225 = Number(division_44)  # disabled

# ---- group: % OM pop.
num_226 = Number(division_45)  # disabled

# ---- group: Diversity Calc
eval_2 = Evaluate(F=panel_263, P1=num_213, P2=num_215, P3=num_218, P4=num_214, P5=num_216, P6=num_219)

eval_3 = Evaluate(F=panel_264, P1=num_217, P2=num_220, P3=num_221)  # disabled

eval_4 = Evaluate(F=panel_266, P1=num_222, P2=num_223, P3=num_224)  # disabled

eval_5 = Evaluate(F=panel_267, P1=num_225, P2=num_226)  # disabled

# ----
pshift_76 = ShiftPaths(Data=eval_3, Offset=-1)  # disabled
pshift_77 = ShiftPaths(Data=eval_4, Offset=-1)  # disabled
pshift_78 = ShiftPaths(Data=eval_2, Offset=-1)
pshift_79 = ShiftPaths(Data=eval_5, Offset=-1)  # disabled

# ---- group: office diversity - all
num_227 = Number(pshift_76)  # disabled

# ---- group: residential diversity - all
num_228 = Number(pshift_77)  # disabled

# ---- group: living working diversity - all
num_229 = Number(pshift_79)  # disabled

# ---- group: diversity - all
num_230 = Number(pshift_78)

# ----
replace = ReplaceMembers(Set=num_227, Find=num_147, Replace=num_148)  # disabled
replace_2 = ReplaceMembers(Set=num_228, Find=num_149, Replace=num_150)  # disabled
replace_3 = ReplaceMembers(Set=num_230, Find=num_153, Replace=num_154)
replace_4 = ReplaceMembers(Set=num_229, Find=num_151, Replace=num_152)  # disabled

# ---- group: diversity
num_231 = Number(replace_3)

# ---- group: office diversity
num_232 = Number(replace)  # disabled

# ---- group: residential diversity
num_233 = Number(replace_2)  # disabled

# ---- group: living working diversity
num_234 = Number(replace_4)  # disabled

# ----
addition_36 = Addition(A=num_233, B=num_232)  # disabled
addition_37 = Addition(A=addition_36, B=num_234)  # disabled
division_46 = Division(A=addition_37, B=3)  # disabled

# ---- group: final pop. diversity
num_235 = Number(num_231)

# ----
gradient_15 = Gradient(LowerLimit=0, UpperLimit=1, Parameter=num_235, stops=[0: RGB(0, 0, 0), 1: RGB(255, 255, 255)])
gradient_16 = Gradient(LowerLimit=0, UpperLimit=1, Parameter=num_235, stops=[0: RGB(255, 0, 0), 0.5: RGB(222, 222, 0), 1: RGB(0, 128, 0)])
argb_7 = SplitARGB(Colour=gradient_16)  # -> Alpha, Red, Green, Blue
frgb_26 = ColourRGBF(Alpha=num_134, Red=argb_7.Red, Green=argb_7.Green, Blue=argb_7.Blue)

# ---- group: viz color
col_50 = Colour(frgb_26)

# ---- group: population density score normalized
num_236 = Number(remap_15.Mapped)

# ----
gradient_17 = Gradient(LowerLimit=0, UpperLimit=1, Parameter=num_236, stops=[0: RGB(0, 0, 0), 1: RGB(255, 255, 255)])
gradient_18 = Gradient(LowerLimit=0, UpperLimit=1, Parameter=num_236, stops=[0: RGB(255, 0, 0), 0.5: RGB(222, 222, 0), 1: RGB(0, 128, 0)])
argb_8 = SplitARGB(Colour=gradient_18)  # -> Alpha, Red, Green, Blue
frgb_27 = ColourRGBF(Alpha=num_134, Red=argb_8.Red, Green=argb_8.Green, Blue=argb_8.Blue)

# ---- group: viz color
col_51 = Colour(frgb_27)

# ---- group: population density viz
preview_28 = CustomPreview(Geometry=mesh_80, Shader=col_51)

preview_29 = CustomPreview(Geometry=mesh_79, Shader=col_50)

# ---- group: viz ctrl - AI override
int_299 = Integer(int_266)

# ----
number_slider_48 = Slider(7, range=0..9)
panel_298 = Panel(int_299)
int_300 = Integer(int_299)

# ---- group: distance index
index_2 = Slider(300, range=1..1500)

# ----
# Work Prox - Tuo
panel_299 = Panel("5")
run_module = GhPythonScript(need=panel_299, actual=int_300)  # -> out, run; inputs need: Int32, actual: Int32
# ---------- run_module: Python ----------
__author__ = "sunt"
__version__ = "2018.06.03"

import rhinoscriptsyntax as rs

run = ( need == actual)
# ---------- end run_module ----------

run_module_2 = GhPythonScript(need="6", actual=int_300)  # -> out, run; inputs need: Int32, actual: Int32; same code as run_module

# ----
# Park Prox - Tuo
panel_300 = Panel("7")
run_module_3 = GhPythonScript(need=panel_300, actual=int_300)  # -> out, run; inputs need: Int32, actual: Int32; same code as run_module

# ----
# Solar - Tuo
panel_301 = Panel("10")
run_module_4 = GhPythonScript(need=panel_301, actual=int_300)  # -> out, run; inputs need: Int32, actual: Int32; same code as run_module

# ---- group: Ratio
# Living Prox - Tuo
num_237 = Number(division_8)

# ----
# Make python data tree/list- Tuo
make_grid_list = GhPythonScript(x=int_126, y=int_128, ids=int_137)  # -> out, outL; inputs ids: list
# ---------- make_grid_list: Python ----------
__author__ = "sunt"
__version__ = "2018.06.03"

import rhinoscriptsyntax as rs

print(x,y)
print(ids)
outL = []

for newY in range(y):
    row = []
    for newX in range(x):
        row.append(ids[newX+newY*16])
    outL.append(row)
    
print(outL)
# ---------- end make_grid_list ----------
floor_height = Number(panel_132)
floor_replace = PythonScript(inL=make_grid_list.outL, floorDict=int_147)  # -> out, outL; inputs floorDict: list
# ---------- floor_replace: Python ----------
outL = inL[:]
print(outL)

replaceDict ={x: floorDict[x] for x in range(5)}
if len(floorDict)==7:
    replaceDict[8]=floorDict[6]
#print(replaceDict)

for item in range(len(outL)):
    outL[item] = int(replaceDict.get(int(outL[item]),0))

print(outL)
# ---------- end floor_replace ----------
iron2panel = GhPythonScript(ironList=make_grid_list.outL)  # -> out, panelOut
# ---------- iron2panel: Python ----------
"""Provides a scripting component.
    Inputs:
        centroid: Building's centroid point (area)
        floors: the number of floor
        grid: The gird
        cellSize: the size of the grid cell
        
    Output:
        a: The a output variable"""

__author__ = "sunt"
__version__ = "2018.05.28"

import rhinoscriptsyntax as rs

panelOut = ironList
# ---------- end iron2panel ----------
panel_302 = Panel(floor_replace.outL)

panel_303 = Panel(make_grid_list.outL)

# ---- group: control on/off
# Traffic - Tuo
panel_304 = Panel("9")
run_module_5 = GhPythonScript(need=panel_304, actual=int_300)  # -> out, run; inputs need: Int32, actual: Int32; same code as run_module

# ----
python_20 = PythonScript(x=index, y=num_144)  # -> out, a
# ---------- python_20: Python ----------
a = float(x)-2*float(y)
# ---------- end python_20 ----------

# ---- group: control on/off
# Live/work balance- Tuo
panel_305 = Panel("8")
run_module_6 = GhPythonScript(need=panel_305, actual=int_300)  # -> out, run; inputs need: Int32, actual: Int32; same code as run_module

# ----
multiplication_66 = Multiplication(A=python_20.a, B=num_237)
division_47 = Division(A=python_20.a, B=num_237)

k = Slider(3, range=3..30)
grid_x_extent = Number(int_218)
grid_y_extent = Number(int_219)

k_2 = Slider(3, range=3..30)
grid_x_extent_2 = Number(int_218)
grid_y_extent_2 = Number(int_219)

k_3 = Slider(1, range=1..30)
grid_x_extent_3 = Number(int_218)
grid_y_extent_3 = Number(int_219)

index_3 = Slider(100, range=1..500)
cell_size_2 = Number(cell_size)
grid_x_extent_4 = Number(int_218)
grid_y_extent_4 = Number(int_219)
height_by_id = GhPythonScript(inL=floor_replace.outL, h=floor_height)  # -> out, outL; inputs inL: list
# ---------- height_by_id: Python ----------
__author__ = "sunt"
__version__ = "2018.06.01"

import rhinoscriptsyntax as rs

outL = [h*x for x in inL]
# ---------- end height_by_id ----------
solar_by_id = GhPythonScript(inL=height_by_id.outL, xExt=grid_x_extent_4, yExt=grid_y_extent_4, index=index_3, cellSize=cell_size_2)  # -> out, outL, avg; inputs inL: tree, xExt: Int32
# ---------- solar_by_id: Python ----------
"""Provides a scripting component.
    Inputs:
        centroid: Building's centroid point (area)
        floors: the number of floor
        grid: The gird
        cellSize: the size of the grid cell
        
    Output:
        a: The a output variable"""

__author__ = "sunt"
__version__ = "2018.05.28"

import rhinoscriptsyntax as rs
import math
import Grasshopper as gh

xExt = int(xExt)
yExt = int(yExt)
cellSize = int(cellSize)

outL = [[0 for x in range(xExt)] for y in range(yExt)]
shadows = [0.5,1,0.5,0.25,0.5,1,0.5,0.25,0.125,0.25,0.5,1,0.5,0.25,0.125]

#print(outL)
#print(inL.Branch(0)[0])

score,count = 0,0

for bldgY in range(yExt):
    for bldgX in range(xExt):
        solInd = 0
        shadowInd = 0
        h = float(inL.Branch(bldgY)[bldgX])
        row1 = [(bldgY+1,bldgX+i) for i in range(-1,2)]
        row2 = [(bldgY+2,bldgX+i) for i in range(-2,3)]
        row3 = [(bldgY+3,bldgX+i) for i in range(-3,4)]
        rows_raw = [row1,row2,row3]
#        print(int(30*3.5/cellSize))
        rows = rows_raw[:max(1,int(30*3.5/cellSize))]
        for r in range(len(rows)):
            for (newY,newX) in rows[r]:
                if 0<=newX and newX<xExt and 0<=newY and newY<yExt:
                    solInd += max((float(inL.Branch(newY)[newX])-h-cellSize*r)*shadows[shadowInd],0)
                shadowInd+=1
#        print(solInd)
        outL[bldgY][bldgX] = solInd/index
        if h > 0:
            
            score += max(1-solInd/index,0)
            count += 1
#            print("add score: ",score)
            
avg = score/count
#print(count)
#print(outL)
# ---------- end solar_by_id ----------
iron2panel_2 = GhPythonScript(run=run_module_4.run, ironList=solar_by_id.outL)  # -> out, panelOut
# ---------- iron2panel_2: Python ----------
"""Provides a scripting component.
    Inputs:
        centroid: Building's centroid point (area)
        floors: the number of floor
        grid: The gird
        cellSize: the size of the grid cell
        
    Output:
        a: The a output variable"""

__author__ = "sunt"
__version__ = "2018.05.28"

import rhinoscriptsyntax as rs

panelOut = ironList if run else None
# ---------- end iron2panel_2 ----------

# ---- group: building extrusion
byheight = PythonScript(inPanelList=floor_replace.outL, heights=floor_height)  # -> out, outPanelList; inputs inPanelList: list
# ---------- byheight: Python ----------
import Grasshopper as gh

outPanelList = inPanelList[:]


for item in range(len(outPanelList)):
    outPanelList[item] = int(outPanelList[item])*heights

    
print(outPanelList)
# ---------- end byheight ----------
panel_306 = Panel(byheight.outPanelList)
grid_x_extent_5 = Number(int_218)
grid_y_extent_5 = Number(int_219)
sqgrid = Square(Plane=PlaneXY(0, 0, 0), Size=num_112, ExtentX=grid_x_extent_5, ExtentY=grid_y_extent_5)  # -> Cells, Points
rev_3 = ReverseList(List=sqgrid.Cells)
Z_9 = UnitZ(Factor=1)
flip = FlipMatrix(Data=rev_3)
amp_2 = Amplitude(Vector=Z_9, Amplitude=flatten(panel_306))
boundary_4 = BoundarySurfaces(Edges=flatten(flip))
extr_3 = Extrude(Base=boundary_4, Direction=amp_2)
getgridcorners = GhPythonScript(cells=rev_3, x=grid_x_extent_5, y=grid_y_extent_5)  # -> out, corners; inputs cells: list
# ---------- getgridcorners: Python ----------
__author__ = "sunt"
__version__ = "2018.05.28"

import rhinoscriptsyntax as rs

print(cells[0])
print(cells[-1])

a= rs.CurvePoints(cells[0])[3]
b= rs.CurvePoints(cells[int(x)-1])[0]
d= rs.CurvePoints(cells[-int(x)])[2]
c= rs.CurvePoints(cells[-1])[1]

corners = [b,a,d,c]
# ---------- end getgridcorners ----------

# ----
area_3 = Area(Geometry=boundary_4)  # -> Area, Centroid

run = GhPythonScript(i=area_3.Centroid, run=run_module_2.run)  # -> out, o
# ---------- run: Python ----------
__author__ = "sunt"
__version__ = "2018.06.03"

import rhinoscriptsyntax as rs

o = i if run else []
# ---------- end run ----------
panel_307 = Panel("""3
4
5
8""")
panel_308 = Panel("""0
1
2""")
filter_elements = GhPythonScript(E=flatten(area_3.Centroid), ids=flatten(iron2panel.panelOut), f1=panel_307, f2=panel_308)  # -> out, ind1, outE1, outE2; inputs E: list, ids: list of Int32, f1: list of Int32, f2: list of Int32
# ---------- filter_elements: Python ----------
__author__ = "sunt"
__version__ = "2018.06.03"

import rhinoscriptsyntax as rs

outE1,outE2,ind1 = [],[],[]
print(f1,f2)

for e in range(len(ids)):
    if ids[e] in f1:
        outE1.append(E[e])
        ind1.append(e)
    elif ids[e] in f2:
        outE2.append(E[e])
# ---------- end filter_elements ----------
pt_133 = Point(flatten(filter_elements.outE1))
pt_134 = Point(filter_elements.outE2)
cps_5 = ClosestPoints(Point=pt_133, Cloud=pt_134, Count=k)  # -> ClosestPoint, CPIndex, Distance
avr = Average(Input=cps_5.Distance)  # -> flatten(ArithmeticMean)
panel_309 = Panel(avr)

run_2 = GhPythonScript(i=area_3.Centroid, run=run_module.run)  # -> out, o; same code as run
panel_310 = Panel("""3
4
5
8""")
panel_311 = Panel("""0
1
2""")
filter_elements_2 = GhPythonScript(E=flatten(area_3.Centroid), ids=flatten(iron2panel.panelOut), f1=panel_311, f2=panel_310)  # -> out, ind1, outE1, outE2; inputs E: list, ids: list of Int32, f1: list of Int32, f2: list of Int32; same code as filter_elements
pt_135 = Point(flatten(filter_elements_2.outE1))
pt_136 = Point(filter_elements_2.outE2)
cps_6 = ClosestPoints(Point=pt_135, Cloud=pt_136, Count=k_2)  # -> ClosestPoint, CPIndex, Distance
avr_2 = Average(Input=cps_6.Distance)  # -> flatten(ArithmeticMean)
panel_312 = Panel(avr_2)

run_3 = GhPythonScript(i=area_3.Centroid, run=run_module_3.run)  # -> out, o; same code as run
panel_313 = Panel("""0
1
2
3
4
5
8""")
filter_elements_3 = GhPythonScript(E=flatten(area_3.Centroid), ids=flatten(iron2panel.panelOut), f1=panel_313, f2="7")  # -> out, ind1, outE1, outE2; inputs E: list, ids: list of Int32, f1: list of Int32, f2: list of Int32; same code as filter_elements
pt_137 = Point(flatten(filter_elements_3.outE1))
pt_138 = Point(filter_elements_3.outE2)
cps_7 = ClosestPoints(Point=pt_137, Cloud=pt_138, Count=k_3)  # -> ClosestPoint, CPIndex, Distance
avr_3 = Average(Input=cps_7.Distance)  # -> flatten(ArithmeticMean)
panel_314 = Panel(avr_3)

# ---- group: colorize
gradient_19 = Gradient(LowerLimit=0, UpperLimit=1, Parameter=panel_306, stops=[0: RGB(102, 102, 102), 1: RGB(255, 255, 255)])  # disabled
number_slider_49 = Slider(1, range=0..1)  # disabled
argb_9 = SplitARGB(Colour=gradient_19)  # -> Alpha, Red, Green, Blue; disabled
frgb_28 = ColourRGBF(Alpha=number_slider_49, Red=argb_9.Red, Green=argb_9.Green, Blue=argb_9.Blue)  # disabled
col_52 = Colour(frgb_28)  # disabled
preview_30 = CustomPreview(Geometry=extr_3, Material=flatten(col_52))  # disabled

# ----
panel_315 = Panel(iron2panel_2.panelOut)
panel_316 = Panel(cps_7.Distance)
new_col_trans = GhPythonScript(x=grid_x_extent_2, y=grid_y_extent_2, ids=filter_elements_2.ind1, knn=panel_312, index=division_47)  # -> out, value, score; inputs x: Int32, y: Int32, ids: list, knn: list of Int32
# ---------- new_col_trans: Python ----------
__author__ = "sunt"
__version__ = "2018.06.04"

import rhinoscriptsyntax as rs

value= []
print(ids)
print(knn)
k = 0
for i in range(int(x*y)):
    if i != ids[k]:
        value.append(0)
    else:
        value.append(1-(knn[k]-100)/index)
        if k < len(ids)-1:
            k+=1
            
value_n0= [v for v in value if v>0]
score = sum(value_n0)/max(1,len(value_n0))
#print(score)
#print(value)
# ---------- end new_col_trans ----------
new_col_trans_2 = GhPythonScript(x=grid_x_extent, y=grid_y_extent, ids=filter_elements.ind1, knn=panel_309, index=division_47)  # -> out, value, score; inputs x: Int32, y: Int32, ids: list, knn: list of Int32
# ---------- new_col_trans_2: Python ----------
__author__ = "sunt"
__version__ = "2018.06.04"

import rhinoscriptsyntax as rs

value= []
print(ids)
print(knn)
k = 0
for i in range(int(x*y)):
    if i != ids[k]:
        value.append(0)
    else:
        value.append(1-(knn[k]-100)/index)
        if k < len(ids)-1:
            k+=1
            
value_n0= [v for v in value if v>0]
score = sum(value_n0)/max(1,len(value_n0))
#print(value_n0)
#print(score)
# ---------- end new_col_trans_2 ----------
new_col_trans_3 = GhPythonScript(x=grid_x_extent_3, y=grid_y_extent_3, ids=filter_elements_3.ind1, knn=panel_314, index=division_47)  # -> out, value, score; inputs x: Int32, y: Int32, ids: list, knn: list of Int32
# ---------- new_col_trans_3: Python ----------
__author__ = "sunt"
__version__ = "2018.06.04"

import rhinoscriptsyntax as rs

value= []
print(index)
#print(ids)
#print(knn)
k = 0
for i in range(int(x*y)):
    if i != ids[k]:
        value.append(0)
    else:
        value.append(1-(knn[k]-62.5)/int(index))
        if k < len(ids)-1:
            k+=1
            
value_n0= [v for v in value if v>0]
score = sum(value_n0)/max(1,len(value_n0))
#print(score)
# ---------- end new_col_trans_3 ----------
iron2panel_3 = GhPythonScript(run=run_module_2.run, ironList=new_col_trans_2.value)  # -> out, panelOut; same code as iron2panel_2
iron2panel_4 = GhPythonScript(run=run_module_3.run, ironList=new_col_trans_3.value)  # -> out, panelOut; same code as iron2panel_2
iron2panel_5 = GhPythonScript(run=run_module.run, ironList=new_col_trans.value)  # -> out, panelOut; same code as iron2panel_2

gradient_20 = Gradient(LowerLimit=0, UpperLimit=1, Parameter=panel_315, stops=[0: RGB(255, 255, 0), 1: RGB(0, 50, 199)])
panel_317 = Panel("""0
1
2
3
4
5
6
7
8
9""")
nonetype = GhPythonScript(i=gradient_20)  # -> out, run, o
# ---------- nonetype: Python ----------
__author__ = "sunt"
__version__ = "2018.06.03"

import rhinoscriptsyntax as rs
print(type(i))
if type(i)==type(None):
    o = []
    run = False
else:
    o = i
    run = True
# ---------- end nonetype ----------
run_4 = GhPythonScript(i=panel_317, run=nonetype.run)  # -> out, o; inputs run: tree
# ---------- run_4: Python ----------
__author__ = "sunt"
__version__ = "2018.06.03"

import rhinoscriptsyntax as rs

o = i if run.BranchCount >= 2 and run.Branch(0) else []
# ---------- end run_4 ----------

gradient_21 = Gradient(
    LowerLimit=0,
    UpperLimit=1,
    Parameter=iron2panel_3.panelOut,
    stops=[0: RGB(255, 0, 0), 0.5: RGB(255, 255, 0), 1: RGB(0, 128, 0)])
nonetype_2 = GhPythonScript(i=gradient_21)  # -> out, run, o; same code as nonetype
run_5 = GhPythonScript(i=panel_307, run=nonetype_2.run)  # -> out, o; inputs run: list
# ---------- run_5: Python ----------
__author__ = "sunt"
__version__ = "2018.06.03"

import rhinoscriptsyntax as rs

o = i if len(run) >= 2 and run[0] else []
# ---------- end run_5 ----------

gradient_22 = Gradient(
    LowerLimit=0,
    UpperLimit=1,
    Parameter=iron2panel_4.panelOut,
    stops=[0: RGB(255, 0, 0), 0.5: RGB(255, 255, 0), 1: RGB(0, 128, 0)])
nonetype_3 = GhPythonScript(i=gradient_22)  # -> out, run, o; same code as nonetype
run_6 = GhPythonScript(i=panel_313, run=nonetype_3.run)  # -> out, o; inputs run: list; same code as run_5

gradient_23 = Gradient(
    LowerLimit=0,
    UpperLimit=1,
    Parameter=iron2panel_5.panelOut,
    stops=[0: RGB(255, 0, 0), 0.5: RGB(255, 255, 0), 1: RGB(0, 128, 0)])
nonetype_4 = GhPythonScript(i=gradient_23)  # -> out, run, o; same code as nonetype
run_7 = GhPythonScript(i=panel_311, run=nonetype_4.run)  # -> out, o; inputs run: list; same code as run_5

# ---- group: color calibration dock
# Color Space Viz / Sliders and Toggles
number_slider_50 = Slider(300, range=0..1000)  # disabled
mjoin_5 = MeshJoin(Meshes=crv_2)  # disabled
popgeo = PopulateGeometry(Geometry=mjoin_5, Count=number_slider_50, Seed=1)  # disabled
sample_7 = BitmapSampler(BitmapToModify=bmp_4, PointToSample=popgeo, BitmapToModify_2=bmp_4, PointToSample_2=popgeo, bitmap_filter=0)  # -> SampledImageData, SampledImageData_2; disabled
argb_10 = SplitARGB(Colour=col_27)  # -> Alpha, Red, Green, Blue; disabled
ahsv = SplitAHSV(Colour=col_27)  # -> Alpha, Hue, Saturation, Value; disabled
pt_139 = ConstructPoint(XCoordinate=argb_10.Red, YCoordinate=argb_10.Green, ZCoordinate=argb_10.Blue)  # disabled
pt_140 = ConstructPoint(XCoordinate=ahsv.Hue, YCoordinate=ahsv.Saturation, ZCoordinate=ahsv.Value)  # disabled
pt_141 = Point(col_27)  # disabled
sph = Sphere(Base=pt_140, Radius=0.05)  # disabled
sph_2 = Sphere(Base=pt_139, Radius=0.05)  # disabled
preview_31 = CustomPreview(Geometry=sph, Shader=col_27)  # disabled
preview_32 = CustomPreview(Geometry=sph_2, Shader=col_27)  # disabled
box = Box2Pt(PointA=Point(0, 0, 0), PointB=Point(1, 1, 1), Plane=PlaneXY(0, 0, 0))  # disabled
box_2 = Box2Pt(PointA=Point(0, 0, 0), PointB=Point(1, 1, 1), Plane=PlaneXY(0, 0, 0))  # disabled
voronoi³ = Voronoi3D(Points=pt_140, Box=box)  # -> Cells, Boundary; disabled
voronoi³_2 = Voronoi3D(Points=pt_139, Box=box_2)  # -> Cells, Boundary; disabled
brep = Brep(voronoi³.Cells)  # disabled
brep_2 = Brep(voronoi³_2.Cells)  # disabled
range_2 = Range(Domain=Domain(0, 1), Steps=10)  # disabled
graft_4 = GraftTree(Tree=range_2, IncludeEmptyLists=True, IncludeNullItems=True)  # disabled
pt_142 = ConstructPoint(XCoordinate=range_2, YCoordinate=graft_4, ZCoordinate=0)  # disabled
Z_10 = UnitZ(Factor=range_2)  # disabled
pshift_80 = ShiftPaths(Data=pt_142, Offset=-1)  # disabled
graft_5 = GraftTree(Tree=Z_10, IncludeEmptyLists=True, IncludeNullItems=True)  # disabled
number_slider_51 = Slider(5, range=0..10)  # disabled
move_42 = Move(Geometry=pshift_80, Motion=graft_5)  # -> Geometry, Transform; disabled
flip_2 = FlipMatrix(Data=move_42.Geometry)  # disabled
item_82 = ListItem(List=flip_2, Index=number_slider_51, Wrap=False)  # disabled

# ---- group: color calibration dock / ref sample colors
col_53 = Colour(sample_7.SampledImageData_2)  # disabled

# ---- group: color calibration dock / all sample color
col_54 = Colour(col_53)  # disabled

col_55 = Colour(col_54)  # disabled

# ---- group: color calibration dock / color space pts - one plan
pt_143 = Point(item_82)  # disabled

# ---- group: color calibration dock / color space pts
pt_144 = Point(flip_2)  # disabled

# ---- group: color calibration dock / color space pts - showing
pt_145 = Point(pt_144)  # disabled

# ---- group: color calibration dock (continued)
argb_11 = SplitARGB(Colour=col_55)  # -> Alpha, Red, Green, Blue; disabled
ahsv_2 = SplitAHSV(Colour=col_55)  # -> Alpha, Hue, Saturation, Value; disabled
pt_146 = ConstructPoint(XCoordinate=argb_11.Red, YCoordinate=argb_11.Green, ZCoordinate=argb_11.Blue)  # disabled
pt_147 = ConstructPoint(XCoordinate=ahsv_2.Hue, YCoordinate=ahsv_2.Saturation, ZCoordinate=ahsv_2.Value)  # disabled
pt_148 = Point(col_55)  # disabled
preview_33 = CustomPreview(Geometry=pt_147, Shader=col_55)  # disabled
preview_34 = CustomPreview(Geometry=pt_146, Shader=col_55)  # disabled
pdecon_32 = Deconstruct(Point=pt_145)  # -> XComponent, YComponent, ZComponent; disabled
hsl = ColourHSL(Alpha=1, Hue=pdecon_32.XComponent, Saturation=pdecon_32.YComponent, Luminance=pdecon_32.ZComponent)  # disabled
frgb_29 = ColourRGBF(Alpha=1, Red=pdecon_32.XComponent, Green=pdecon_32.YComponent, Blue=pdecon_32.ZComponent)  # disabled
preview_35 = CustomPreview(Geometry=pt_145, Shader=hsl)  # disabled
pt_149 = Point(frgb_29)  # disabled
preview_36 = CustomPreview(Geometry=pt_145, Shader=frgb_29)  # disabled

# ---- group: color calibration dock / connecting sample pt and its color space pt
number_slider_52 = Slider(237, range=0..300)  # disabled
ln_9 = Line(StartPoint=popgeo, EndPoint=pt_146)  # disabled
item_83 = ListItem(List=ln_9, Index=number_slider_52, Wrap=True)  # disabled
crv_56 = Curve(item_83)  # disabled

# ---- group: Color Space Calibration sliders
# Color Space Viz / Sliders and Toggles
number_slider_53 = Slider(300, range=0..1000)  # disabled
number_slider_54 = Slider(300, range=0..1000)  # disabled
number_slider_55 = Slider(300, range=0..1000)  # disabled
number_slider_56 = Slider(300, range=0..1000)  # disabled
mjoin_6 = MeshJoin(Meshes=crv)  # disabled
mjoin_7 = MeshJoin(Meshes=crv_5)  # disabled
mjoin_8 = MeshJoin(Meshes=crv_6)  # disabled
mjoin_9 = MeshJoin(Meshes=crv_7)  # disabled
popgeo_2 = PopulateGeometry(Geometry=mjoin_6, Count=number_slider_53, Seed=1)  # disabled
popgeo_3 = PopulateGeometry(Geometry=mjoin_7, Count=number_slider_54, Seed=1)  # disabled
popgeo_4 = PopulateGeometry(Geometry=mjoin_8, Count=number_slider_55, Seed=1)  # disabled
popgeo_5 = PopulateGeometry(Geometry=mjoin_9, Count=number_slider_56, Seed=1)  # disabled
sample_8 = BitmapSampler(BitmapToModify=bmp_2, PointToSample=popgeo_2, BitmapToModify_2=bmp_2, PointToSample_2=popgeo_2, bitmap_filter=0)  # -> SampledImageData, SampledImageData_2; disabled
sample_9 = BitmapSampler(BitmapToModify=bmp_3, PointToSample=popgeo_3, BitmapToModify_2=bmp_3, PointToSample_2=popgeo_3, bitmap_filter=0)  # -> SampledImageData, SampledImageData_2; disabled
sample_10 = BitmapSampler(BitmapToModify=bmp_4, PointToSample=popgeo_4, BitmapToModify_2=bmp_4, PointToSample_2=popgeo_4, bitmap_filter=0)  # -> SampledImageData, SampledImageData_2; disabled
sample_11 = BitmapSampler(BitmapToModify=bmp_5, PointToSample=popgeo_5, BitmapToModify_2=bmp_5, PointToSample_2=popgeo_5, bitmap_filter=0)  # -> SampledImageData, SampledImageData_2; disabled
argb_12 = SplitARGB(Colour=col_26)  # -> Alpha, Red, Green, Blue; disabled
ahsv_3 = SplitAHSV(Colour=col_26)  # -> Alpha, Hue, Saturation, Value; disabled
pt_150 = ConstructPoint(XCoordinate=argb_12.Red, YCoordinate=argb_12.Green, ZCoordinate=argb_12.Blue)  # disabled
pt_151 = ConstructPoint(XCoordinate=ahsv_3.Hue, YCoordinate=ahsv_3.Saturation, ZCoordinate=ahsv_3.Value)  # disabled
pt_152 = Point(col_26)  # disabled
sph_3 = Sphere(Base=pt_151, Radius=0.05)  # disabled
sph_4 = Sphere(Base=pt_150, Radius=0.05)  # disabled
preview_37 = CustomPreview(Geometry=sph_3, Shader=col_26)  # disabled
preview_38 = CustomPreview(Geometry=sph_4, Shader=col_26)  # disabled
box_3 = Box2Pt(PointA=Point(0, 0, 0), PointB=Point(1, 1, 1), Plane=PlaneXY(0, 0, 0))  # disabled
box_4 = Box2Pt(PointA=Point(0, 0, 0), PointB=Point(1, 1, 1), Plane=PlaneXY(0, 0, 0))  # disabled
voronoi³_3 = Voronoi3D(Points=pt_151, Box=box_3)  # -> Cells, Boundary; disabled
voronoi³_4 = Voronoi3D(Points=pt_150, Box=box_4)  # -> Cells, Boundary; disabled
brep_3 = Brep(voronoi³_3.Cells)  # disabled
brep_4 = Brep(voronoi³_4.Cells)  # disabled
range_3 = Range(Domain=Domain(0, 1), Steps=10)  # disabled
graft_6 = GraftTree(Tree=range_3, IncludeEmptyLists=True, IncludeNullItems=True)  # disabled
pt_153 = ConstructPoint(XCoordinate=range_3, YCoordinate=graft_6, ZCoordinate=0)  # disabled
Z_11 = UnitZ(Factor=range_3)  # disabled
pshift_81 = ShiftPaths(Data=pt_153, Offset=-1)  # disabled
graft_7 = GraftTree(Tree=Z_11, IncludeEmptyLists=True, IncludeNullItems=True)  # disabled
number_slider_57 = Slider(5, range=0..10)  # disabled
move_43 = Move(Geometry=pshift_81, Motion=graft_7)  # -> Geometry, Transform; disabled
flip_3 = FlipMatrix(Data=move_43.Geometry)  # disabled
item_84 = ListItem(List=flip_3, Index=number_slider_57, Wrap=False)  # disabled

# ---- group: Color Space Calibration sliders / ref sample colors
col_56 = Colour(sample_8.SampledImageData_2)  # disabled

col_57 = Colour(sample_9.SampledImageData_2)  # disabled

col_58 = Colour(sample_10.SampledImageData_2)  # disabled

col_59 = Colour(sample_11.SampledImageData_2)  # disabled

# ---- group: Color Space Calibration sliders / all sample color
col_60 = Colour(col_59)  # disabled

col_61 = Colour(col_56)  # disabled

col_62 = Colour(col_58)  # disabled

col_63 = Colour(col_57)  # disabled

col_64 = Colour(col_62)  # disabled

# ---- group: Color Space Calibration sliders / color space pts - one plan
pt_154 = Point(item_84)  # disabled

# ---- group: Color Space Calibration sliders / color space pts
pt_155 = Point(flip_3)  # disabled

# ---- group: Color Space Calibration sliders / color space pts - showing
pt_156 = Point(pt_155)  # disabled

# ---- group: Color Space Calibration sliders (continued)
argb_13 = SplitARGB(Colour=col_64)  # -> Alpha, Red, Green, Blue; disabled
ahsv_4 = SplitAHSV(Colour=col_64)  # -> Alpha, Hue, Saturation, Value; disabled
pt_157 = ConstructPoint(XCoordinate=argb_13.Red, YCoordinate=argb_13.Green, ZCoordinate=argb_13.Blue)  # disabled
pt_158 = ConstructPoint(XCoordinate=ahsv_4.Hue, YCoordinate=ahsv_4.Saturation, ZCoordinate=ahsv_4.Value)  # disabled
pt_159 = Point(col_64)  # disabled
preview_39 = CustomPreview(Geometry=pt_158, Shader=col_64)  # disabled
preview_40 = CustomPreview(Geometry=pt_157, Shader=col_64)  # disabled
pdecon_33 = Deconstruct(Point=pt_156)  # -> XComponent, YComponent, ZComponent; disabled
hsl_2 = ColourHSL(Alpha=1, Hue=pdecon_33.XComponent, Saturation=pdecon_33.YComponent, Luminance=pdecon_33.ZComponent)  # disabled
frgb_30 = ColourRGBF(Alpha=1, Red=pdecon_33.XComponent, Green=pdecon_33.YComponent, Blue=pdecon_33.ZComponent)  # disabled
preview_41 = CustomPreview(Geometry=pt_156, Shader=hsl_2)  # disabled
pt_160 = Point(frgb_30)  # disabled
preview_42 = CustomPreview(Geometry=pt_156, Shader=frgb_30)  # disabled

# ---- group: Position Calibration / disable when not calibrating CV
box_5 = CenterBox(Base=pt_8, X=0.003, Y=0.003, Z=0.003)  # disabled
item_85 = ListItem(List=col_2, Index=item, Wrap=False)  # disabled

# ---- group: Position Calibration / disable when not calibrating CV / all sample boxes
box_6 = Box(box_5)  # disabled

# ---- group: Position Calibration / disable when not calibrating CV (continued)
preview_43 = CustomPreview(Geometry=box_6, Shader=item_85)  # disabled

# ---- group: Position Calibration
move_44 = Move(Geometry=mesh, Motion=Vector(0, 0, -0.1))  # -> Geometry, Transform; disabled
addition_38 = Addition(A=item_12, B=item_13)  # disabled
division_48 = Division(A=addition_38, B=2)  # disabled

# ---- group: Position Calibration / moved down 0.1
mesh_81 = Mesh(move_44.Geometry)  # disabled

# ---- group: Position Calibration / quart mid pts
pt_161 = Point(division_48)  # disabled

# ---- group: Position Calibration (continued)
tag_29 = TextTag3D(Location=pt_161, Text=int_28, Size=0.01, Justification=5)  # disabled

# ---- group: Position Calibration / disable when not calibrating CV
box_7 = CenterBox(Base=pt_30, X=0.003, Y=0.003, Z=0.003)  # disabled
item_86 = ListItem(List=col_18, Index=cp_6.CPIndex, Wrap=False)  # disabled

# ---- group: Position Calibration / disable when not calibrating CV / all sample boxes
box_8 = Box(box_7)  # disabled

# ---- group: Position Calibration / disable when not calibrating CV (continued)
preview_44 = CustomPreview(Geometry=box_8, Shader=item_86)  # disabled

# ----
# Color Space Viz / Grid
argb_14 = SplitARGB(Colour=col_22)  # -> Alpha, Red, Green, Blue; disabled
ahsv_5 = SplitAHSV(Colour=col_22)  # -> Alpha, Hue, Saturation, Value; disabled
argb_15 = SplitARGB(Colour=col_23)  # -> Alpha, Red, Green, Blue; disabled
ahsv_6 = SplitAHSV(Colour=col_23)  # -> Alpha, Hue, Saturation, Value; disabled
pt_162 = ConstructPoint(XCoordinate=argb_14.Red, YCoordinate=argb_14.Green, ZCoordinate=argb_14.Blue)  # disabled
pt_163 = ConstructPoint(XCoordinate=ahsv_5.Hue, YCoordinate=ahsv_5.Saturation, ZCoordinate=ahsv_5.Value)  # disabled
pt_164 = ConstructPoint(XCoordinate=argb_15.Red, YCoordinate=argb_15.Green, ZCoordinate=argb_15.Blue)  # disabled
pt_165 = ConstructPoint(XCoordinate=ahsv_6.Hue, YCoordinate=ahsv_6.Saturation, ZCoordinate=ahsv_6.Value)  # disabled
pt_166 = Point(col_22)  # disabled
pt_167 = Point(col_23)  # disabled
sph_5 = Sphere(Base=pt_165, Radius=0.05)  # disabled
sph_6 = Sphere(Base=pt_164, Radius=0.05)  # disabled
preview_45 = CustomPreview(Geometry=pt_163, Shader=col_22)  # disabled
preview_46 = CustomPreview(Geometry=pt_162, Shader=col_22)  # disabled
preview_47 = CustomPreview(Geometry=sph_5, Shader=col_23)  # disabled
preview_48 = CustomPreview(Geometry=sph_6, Shader=col_23)  # disabled
box_9 = Box2Pt(PointA=Point(0, 0, 0), PointB=Point(1, 1, 1), Plane=PlaneXY(0, 0, 0))  # disabled
box_10 = Box2Pt(PointA=Point(0, 0, 0), PointB=Point(1, 1, 1), Plane=PlaneXY(0, 0, 0))  # disabled
voronoi³_5 = Voronoi3D(Points=pt_165, Box=box_9)  # -> Cells, Boundary; disabled
voronoi³_6 = Voronoi3D(Points=pt_164, Box=box_10)  # -> Cells, Boundary; disabled
brep_5 = Brep(voronoi³_5.Cells)  # disabled
brep_6 = Brep(voronoi³_6.Cells)  # disabled
range_4 = Range(Domain=Domain(0, 1), Steps=10)  # disabled
graft_8 = GraftTree(Tree=range_4, IncludeEmptyLists=True, IncludeNullItems=True)  # disabled
pt_168 = ConstructPoint(XCoordinate=range_4, YCoordinate=graft_8, ZCoordinate=0)  # disabled
Z_12 = UnitZ(Factor=range_4)  # disabled
pshift_82 = ShiftPaths(Data=pt_168, Offset=-1)  # disabled
graft_9 = GraftTree(Tree=Z_12, IncludeEmptyLists=True, IncludeNullItems=True)  # disabled
number_slider_58 = Slider(5, range=0..10)  # disabled
move_45 = Move(Geometry=pshift_82, Motion=graft_9)  # -> Geometry, Transform; disabled
flip_4 = FlipMatrix(Data=move_45.Geometry)  # disabled
item_87 = ListItem(List=flip_4, Index=number_slider_58, Wrap=False)  # disabled

# ---- group: color space pts - one plan
pt_169 = Point(item_87)  # disabled

# ---- group: color space pts
pt_170 = Point(flip_4)  # disabled

# ---- group: color space pts - showing
pt_171 = Point(pt_170)  # disabled

# ----
pdecon_34 = Deconstruct(Point=pt_171)  # -> XComponent, YComponent, ZComponent; disabled
hsl_3 = ColourHSL(Alpha=1, Hue=pdecon_34.XComponent, Saturation=pdecon_34.YComponent, Luminance=pdecon_34.ZComponent)  # disabled
frgb_31 = ColourRGBF(Alpha=1, Red=pdecon_34.XComponent, Green=pdecon_34.YComponent, Blue=pdecon_34.ZComponent)  # disabled
preview_49 = CustomPreview(Geometry=pt_171, Shader=hsl_3)  # disabled
pt_172 = Point(frgb_31)  # disabled
preview_50 = CustomPreview(Geometry=pt_171, Shader=frgb_31)  # disabled

# ---- group: total ppl bound
panel_318 = Panel("700")  # disabled

# ----
multiplication_67 = Multiplication(A=panel_318, B=number_slider_32)  # disabled
dom_12 = ConstructDomain(DomainStart=multiplication_67, DomainEnd=multiplication_45)  # disabled

# ---- group: total ppl bound (continued)
domain_2 = Domain(dom_12)  # disabled

# ----
remap_16 = RemapNumbers(Value=int_205, Source=domain_2, Target=Domain(0, 0.5))  # -> Mapped, Clipped; disabled
remap_17 = RemapNumbers(Value=int_205, Source=domain_2, Target=Domain(0.3, 1))  # -> Mapped, Clipped; disabled
multiplication_68 = Multiplication(A=graph_4, B=remap_17.Mapped)  # disabled
addition_39 = Addition(A=remap_16.Mapped, B=multiplication_68)  # disabled
addition_40 = Addition(A=addition_39, B=multiplication_47)  # disabled
gradient_24 = Gradient(
    LowerLimit=0,
    UpperLimit=1,
    Parameter=addition_40,
    stops=[0: RGB(0, 128, 0), 0.422: RGB(255, 255, 0), 0.919: RGB(255, 0, 0)])  # disabled
argb_16 = SplitARGB(Colour=gradient_24, IntegerChannels=True)  # -> Alpha, Red, Green, Blue; disabled
vec_11 = VectorXYZ(XComponent=argb_16.Red, YComponent=argb_16.Green, ZComponent=argb_16.Blue)  # -> Vector, Length; disabled
multiplication_69 = Multiplication(A=vec_11.Vector, B=number_slider_34)  # disabled
addition_41 = Addition(A=multiplication_69, B=multiplication_48)  # disabled
devec = DeconstructVector(Vector=addition_41)  # -> XComponent, YComponent, ZComponent; disabled
rgb = ColourRGB(Alpha=255, Red=devec.XComponent, Green=devec.YComponent, Blue=devec.ZComponent)  # disabled
col_65 = Colour(rgb)  # disabled
mspray_3 = MeshSpray(Mesh=graft(pshift_62), Points=graft(pshift_63), Colours=graft(col_65), SprayMode=0)  # disabled
mjoin_10 = MeshJoin(Meshes=flatten(mspray_3))  # disabled
filter_89 = StreamFilter(Gate=show_google_map, Stream0=mjoin_10)  # disabled

# ---- group: road traffic lego
mesh_82 = Mesh(filter_89)  # disabled

# ---- group: 3D City
# 3D City Grid System
number_slider_59 = Slider(10, range=10..100)
Z_13 = UnitZ(Factor=number_slider_59)
msphereex = MeshSphereEx(Base=Z_13, Radius=number_slider_59, Count=Slider(5, range=0..10))
Z_14 = UnitZ(Factor=Slider(6, range=0..10))
move_46 = Move(Geometry=msphereex, Motion=Z_14)  # -> Geometry, Transform
com = ColourSwatch(SwatchColor=RGB(255, 66, 66))
com_2 = ColourSwatch(SwatchColor=RGB(71, 71, 71))
res = ColourSwatch(SwatchColor=RGB(255, 183, 0))
res_2 = ColourSwatch(SwatchColor=RGB(76, 76, 76))
larger_9 = LargerThan(FirstNumber=int_258, SecondNumber="0")  # -> LargerThan, OrEqualTo
smaller_10 = SmallerThan(FirstNumber=int_258, SecondNumber="5")  # -> SmallerThan, OrEqualTo
vec_12 = Vector(X_5)
mcol_5 = MeshColours(Mesh=move_46.Geometry, Colours=park)
tree_scale = Slider(0.81, range=0.5..2)
merge_22 = Merge(Data1=res, Data2=res, Data3=res, Data4=com, Data5=com, Data6=com)
merge_23 = Merge(Data1=res_2, Data2=res_2, Data3=res_2, Data4=com_2, Data5=com_2, Data6=com_2)
and_21 = GateAnd(A=larger_9.OrEqualTo, B=smaller_10.OrEqualTo)
merge_24 = Merge(Data1=merge_22, Data2=merge_23)
dom_13 = ConstructDomain(DomainStart=neg_9, DomainEnd=division_19)
move_47 = Move(Geometry=pt_117, Motion=vec_3)  # -> Geometry, Transform
tree = Slider(2.13, range=0..5)
division_49 = Division(A=num_144, B=2)
move_48 = Move(Geometry=mesh_66, Motion=vec_12)  # -> Geometry, Transform
move_49 = Move(Geometry=mesh_65, Motion=vec_12)  # -> Geometry, Transform
move_50 = Move(Geometry=mesh_64, Motion=vec_12)  # -> Geometry, Transform
multiplication_70 = Multiplication(A=division_49, B=Slider(0.95, range=0..1))
neg_17 = Negative(Value=multiplication_70)
multiplication_71 = Multiplication(A="3", B=tree)
division_50 = Division(A=num_146, B=division_8)
multiplication_72 = Multiplication(A="3", B=tree)
dom_14 = ConstructDomain(DomainStart=multiplication_71, DomainEnd=multiplication_72)
move_51 = Move(Geometry=mesh_69, Motion=vec_3)  # -> Geometry, Transform
dom_15 = ConstructDomain(DomainStart=neg_17, DomainEnd=multiplication_70)
panel_319 = Panel(division_50)

# ---- group: 3D City / meshes 3D ref: Tree
mesh_83 = Mesh(mcol_5)

# ---- group: 3D City / is building or not
bool_42 = Boolean(and_21)

# ---- group: 3D City / color for each type
col_66 = Colour(merge_24)

# ---- group: 3D City / park center 3D
pt_173 = Point(move_47.Geometry)

# ---- group: 3D City / park 3D
mesh_84 = Mesh(move_51.Geometry)

# ----
move_52 = Move(Geometry=mesh_68, Motion=vec_12)  # -> Geometry, Transform

# ---- group: 3D City / sidewalk
mesh_85 = Mesh(move_49.Geometry)

# ---- group: 3D City / road
mesh_86 = Mesh(move_48.Geometry)

# ---- group: 3D City / blank
mesh_87 = Mesh(move_50.Geometry)

# ---- group: parking
movetoorgin_5 = MoveToOrgin(G=mesh_60, num=num_98)  # disabled
vec2pt_13 = Vector2Pt(PointA=Point(0, 0, 0), PointB=pt_116, Unitize=False)  # -> Vector, Length; disabled

# ---- group: parking / module meshes lego at orgin
mesh_88 = Mesh(movetoorgin_5)  # disabled

# ---- group: 3D City (continued)
dispatch_36 = Dispatch(List=pt_115, DispatchPattern=bool_42)  # -> ListA, ListB
dispatch_37 = Dispatch(List=int_258, DispatchPattern=bool_42)  # -> ListA, ListB
planesrf_7 = PlaneSurface(Plane=pt_173, XSize=dom_13, YSize=dom_13)
lng_12 = ListLength(List=pt_173)
random_13 = Random(Range="0.8 to 1.4", Number=lng_12, Seed=Slider(72, range=0..100))
multiplication_73 = Multiplication(A=random_13, B=tree_scale)
scale_3 = Scale(Geometry=mesh_83, Center=Point(0, 0, 0), Factor=multiplication_73)  # -> Geometry, Transform
random_14 = Random(Range=dom_14, Number=lng_12, Seed=Slider(17, range=0..100))
random_15 = Random(Range=Domain(0, 1000), Number=lng_12, Seed=Slider(35, range=0..100))
popgeo_6 = PopulateGeometry(Geometry=flatten(planesrf_7), Count=flatten(random_14), Seed=flatten(random_15))

# ---- group: 3D City / building center
pt_174 = Point(dispatch_36.ListA)

# ---- group: 3D City / building id
int_301 = Integer(dispatch_37.ListA)

# ---- group: 3D City / tree center
pt_175 = Point(flatten(popgeo_6))

# ---- group: 3D City (continued)
equals_37 = Equality(FirstNumber=int_301, SecondNumber=int_262)  # -> Equality, Inequality
multiplication_74 = Multiplication(A=equals_37.Inequality, B=6)
addition_42 = Addition(A=int_301, B=multiplication_74)
vec2pt_14 = Vector2Pt(PointA=Point(0, 0, 0), PointB=pt_175, Unitize=False)  # -> Vector, Length
filter_90 = StreamFilter(Gate=equals_20.Equality, Stream0=addition_42, Stream1=int_301)
item_88 = ListItem(List=col_66, Index=graft(filter_90), Wrap=False)
pshift_83 = ShiftPaths(Data=item_88, Offset=-1)
move_53 = Move(Geometry=scale_3.Geometry, Motion=vec2pt_14.Vector)  # -> Geometry, Transform
item_89 = ListItem(List=panel_319, Index=graft(int_301), Wrap=False)
pshift_84 = ShiftPaths(Data=item_89, Offset=-1)
multiplication_75 = Multiplication(A=pshift_84, B=number_slider_44)

# ---- group: 3D City / color for each building
col_67 = Colour(pshift_83)

# ---- group: Position Calibration / trees 3D
mesh_89 = Mesh(move_53.Geometry)

# ---- group: 3D City / building height of each building
num_238 = Number(multiplication_75)

# ---- group: 3D City (continued)
addition_43 = Addition(A=num_238, B=panel_273)
dom_16 = ConstructDomain(DomainStart=0, DomainEnd=addition_43)
box_11 = DomainBox(Base=pt_174, X=dom_15, Y=dom_15, Z=dom_16)
move_54 = Move(Geometry=box_11, Motion=vec_12)  # -> Geometry, Transform

# ---- group: 3D City / building geo
box_12 = Box(move_54.Geometry)

# ---- group: textured buildings
panel_320 = Panel("C:\Users\RYAN\Documents\GitHub\CityMatrix\Map\PEV_PSG AND PKG_300DPI.png")
boxmap = BoxMapping(Mesh=box_12, Box=box_12)
previewmat_3 = CustomPreviewMaterials(Geometry=boxmap, DiffuseColor=ColourSwatch(SwatchColor=RGB(255, 255, 255)), Transparency="0.01", DiffuseBitmap=panel_320)

# ----
addition_44 = Addition(A=num_238, B=Slider(5, range=0..100))
vec_13 = VectorXYZ(XComponent=0, YComponent=0, ZComponent=addition_44)  # -> Vector, Length
move_55 = Move(Geometry=move_52.Geometry, Motion=vec_13.Vector)  # -> Geometry, Transform
wires = BrepWireframe(Brep=graft(box_12), Density=-1)

# ---- group: 3D City / 3D Buldings
preview_51 = CustomPreview(Geometry=box_12, Shader=col_67)

# ----
previewmat_4 = CustomPreviewMaterials(Geometry=box_12, DiffuseColor=col_67, Transparency=Slider(0.7, range=0..1))
partition = PartitionList(List=wires, Size=12)
preview_52 = CustomPreview(
    Geometry=move_55.Geometry,
    Shader={ambient=RGB(0, 0, 0), diffuse=RGB(255, 105, 180), emission=RGB(76, 32, 54), shine=0.5, specular=RGB(255, 255, 255), transparency=0})

# ---- group: parking (continued)
move_56 = Move(Geometry=mesh_88, Motion=vec2pt_13.Vector)  # -> Geometry, Transform; disabled

# ---- group: parking / parking lego
mesh_90 = Mesh(move_56.Geometry)  # disabled

# ---- group: parking (continued)
move_57 = Move(Geometry=mesh_90, Motion=vec_3)  # -> Geometry, Transform; disabled
filter_91 = StreamFilter(Gate=show_google_map, Stream0=mesh_90)  # disabled

# ---- group: parking / parking 3D
mesh_91 = Mesh(move_57.Geometry)  # disabled

# ---- group: parking / parking lego
mesh_92 = Mesh(filter_91)  # disabled

# ----
index_4 = Slider(30000, range=1000..100000)
cell_size_3 = Number(cell_size)
grid_x_extent_6 = Number(int_218)
grid_y_extent_6 = Number(int_219)
ppl_by_id = GhPythonScript(
    run=run_module_5.run,
    inL=iron2panel.panelOut,
    id0=int_188,
    id1=int_189,
    id2=int_187,
    id3=int_185,
    id4=int_184,
    id5=int_186,
    id8=int_186)  # -> out, outL; inputs inL: list
# ---------- ppl_by_id: Python ----------
__author__ = "sunt"
__version__ = "2018.06.01"

import rhinoscriptsyntax as rs
run =True
if run:
    
    outL = inL[:]
    
    replaceDict ={0:id0,1:id1,2:id2,3:id3,4:id4,5:id5,8:id8}
    
    for item in range(len(outL)):
        outL[item] = int(replaceDict.get(outL[item],0))
    
        
    print(outL)
# ---------- end ppl_by_id ----------
traffic_by_id = GhPythonScript(inL=ppl_by_id.outL, xExt=grid_x_extent_6, yExt=grid_y_extent_6, cellSize=cell_size_3)  # -> out, outL; inputs inL: tree, xExt: Int32; disabled
# ---------- traffic_by_id: Python ----------
"""Provides a scripting component.
    Inputs:
        centroid: Building's centroid point (area)
        floors: the number of floor
        grid: The gird
        cellSize: the size of the grid cell
        
    Output:
        a: The a output variable"""

__author__ = "sunt"
__version__ = "2018.05.28"

import rhinoscriptsyntax as rs
import math
import Grasshopper as gh

xExt = int(xExt)
yExt = int(yExt)

midL = [[0 for x in range(xExt)] for y in range(yExt)]
outL = [[0 for x in range(xExt)] for y in range(yExt)]

print(outL)
print(inL.Branch(0)[0])




for bldgY in range(yExt):
    for bldgX in range(xExt):
        if float(inL.Branch(bldgY)[bldgX]) == 0:
            trafInd = 0
            for y in range(int(bldgY-2), int(bldgY+3)):
                for x in range(int(bldgX-2), int(bldgX+3)):
                    if 0<=x and x<xExt and 0<=y and y<yExt:
                        if bldgY-y == 2 or bldgY-y == -2 or bldgX-x == 2 or bldgX-x == -2:
                            trafInd += 0.5* float(inL.Branch(y)[x])
                        else:
                            trafInd += float(inL.Branch(y)[x])
            midL[bldgY][bldgX] = trafInd

for bldgY in range(yExt):
    for bldgX in range(xExt):
        if float(inL.Branch(bldgY)[bldgX]) == 0:
            accInd = midL[bldgY][bldgX]
            for (newY,newX) in [(bldgY-1,bldgX),(bldgY+1,bldgX),(bldgY,bldgX-1),(bldgY,bldgX+1)]:
                if 0<=newX and newX<xExt and 0<=newY and newY<yExt:
                    accInd += midL[newY][newX]*0.5
            outL[bldgY][bldgX] = accInd/10000

print(outL)
# ---------- end traffic_by_id ----------

tag_30 = TextTag3D(
    Location=area_3.Centroid,
    Text=flatten(ppl_by_id.outL),
    Size=Slider(9.3, range=0..100),
    Colour=swatch_11,
    Justification=4)  # disabled
panel_321 = Panel(ppl_by_id.outL)

balance_by_id = GhPythonScript(ids=iron2panel.panelOut, inL=ppl_by_id.outL, xExt=grid_x_extent_6, yExt=grid_y_extent_6)  # -> out, outL, avg; inputs ids: tree, inL: tree, xExt: Int32
# ---------- balance_by_id: Python ----------
"""Provides a scripting component.
    Inputs:
        centroid: Building's centroid point (area)
        floors: the number of floor
        grid: The gird
        cellSize: the size of the grid cell
        
    Output:
        a: The a output variable"""

__author__ = "sunt"
__version__ = "2018.05.28"

import rhinoscriptsyntax as rs
import math
import Grasshopper as gh

xExt = int(xExt)
yExt = int(yExt)

print(ids.Branch(0)[0])
print(inL.Branch(0)[0])

midL = [[0 for x in range(xExt)] for y in range(yExt)]
outL = [[0 for x in range(xExt)] for y in range(yExt)]
#
##print(outL)
##print(inL.Branch(0)[0])
#
score,count = 0,0


for bldgY in range(yExt):
    for bldgX in range(xExt):
        if int(ids.Branch(bldgY)[bldgX])in [0,1,2,3,4,5,6,8]:
            res, emp = 0,0
            for newY in range(bldgY-3,bldgY+4):
                for newX in range(bldgX-3,bldgX+4):
                    if 0<=newX and newX<xExt and 0<=newY and newY<yExt:
                        if int(ids.Branch(newY)[newX])<3:
                            res += int(inL.Branch(newY)[newX])
                        elif int(ids.Branch(newY)[newX])>=3:
                            emp += int(inL.Branch(newY)[newX])
            s = 1-max(0.5-res/(res+emp),res/(res+emp)-0.5)*2
            outL[bldgY][bldgX] = s
            score += s
            count += 1
            
avg = score/count
print(avg)
#
#for bldgY in range(yExt):
#    for bldgX in range(xExt):
#        if float(inL.Branch(bldgY)[bldgX]) == 0:
#            accInd = midL[bldgY][bldgX]
#            for (newY,newX) in [(bldgY-1,bldgX),(bldgY+1,bldgX),(bldgY,bldgX-1),(bldgY,bldgX+1)]:
#                if 0<=newX and newX<xExt and 0<=newY and newY<yExt:
#                    accInd += midL[newY][newX]*0.5
#            for (newY,newX) in [(bldgY-2,bldgX),(bldgY+2,bldgX),(bldgY,bldgX-2),(bldgY,bldgX+2)]:
#                if 0<=newX and newX<xExt and 0<=newY and newY<yExt:
#                    accInd += midL[newY][newX]*0.5
#            outL[bldgY][bldgX] = accInd/index
#            score += max(0,1-accInd/index)
#            count += 1
#avg = score/max(count,1)

#print(outL)
# ---------- end balance_by_id ----------
iron2panel_6 = GhPythonScript(run=run_module_6.run, ironList=balance_by_id.outL)  # -> out, panelOut; same code as iron2panel_2

traffic_by_id_2 = GhPythonScript(
    ids=iron2panel.panelOut,
    inL=ppl_by_id.outL,
    xExt=grid_x_extent_6,
    yExt=grid_y_extent_6,
    index=index_4,
    balance=balance_by_id.avg)  # -> out, midL, outL, avg; inputs ids: tree, inL: tree, xExt: Int32
# ---------- traffic_by_id_2: Python ----------
"""Provides a scripting component.
    Inputs:
        centroid: Building's centroid point (area)
        floors: the number of floor
        grid: The gird
        cellSize: the size of the grid cell
        
    Output:
        a: The a output variable"""

__author__ = "sunt"
__version__ = "2018.05.28"

import rhinoscriptsyntax as rs
import math
import Grasshopper as gh

xExt = int(xExt)
yExt = int(yExt)

midL = [[0 for x in range(xExt)] for y in range(yExt)]
outL = [[0 for x in range(xExt)] for y in range(yExt)]

#print(outL)
#print(inL.Branch(0)[0])

score,count = 0,0


for bldgY in range(yExt):
    for bldgX in range(xExt):
        if float(ids.Branch(bldgY)[bldgX]) in [6,9]:
            trafInd = 0
            for (newY,newX) in [(bldgY-1,bldgX),(bldgY+1,bldgX),(bldgY,bldgX-1),(bldgY,bldgX+1)]:
                if 0<=newX and newX<xExt and 0<=newY and newY<yExt:
                    trafInd += inL.Branch(newY)[newX]
            midL[bldgY][bldgX] = trafInd

for bldgY in range(yExt):
    for bldgX in range(xExt):
        if float(ids.Branch(bldgY)[bldgX]) in [6,9]:
            accInd = midL[bldgY][bldgX]
            for (newY,newX) in [(bldgY-1,bldgX),(bldgY+1,bldgX),(bldgY,bldgX-1),(bldgY,bldgX+1)]:
                if 0<=newX and newX<xExt and 0<=newY and newY<yExt:
                    accInd += midL[newY][newX]*0.5
            for (newY,newX) in [(bldgY-2,bldgX),(bldgY+2,bldgX),(bldgY,bldgX-2),(bldgY,bldgX+2)]:
                if 0<=newX and newX<xExt and 0<=newY and newY<yExt:
                    accInd += midL[newY][newX]*0.5
            outL[bldgY][bldgX] = accInd/index * (1-balance)
            score += max(0,1-accInd/index * (1-balance))
            count += 1
avg = score/max(count,1)

#print(outL)
# ---------- end traffic_by_id_2 ----------
iron2panel_7 = GhPythonScript(run=run_module_5.run, ironList=traffic_by_id_2.outL)  # -> out, panelOut; same code as iron2panel_2

panel_322 = Panel(iron2panel_7.panelOut)
panel_323 = Panel(iron2panel_6.panelOut)

gradient_25 = Gradient(
    LowerLimit=0.01,
    UpperLimit=1,
    Parameter=panel_322,
    stops=[1e-06: RGB(255, 255, 240), 0.5: RGB(255, 255, 0), 1: RGB(255, 0, 0)])
panel_324 = Panel("""6
9""")
nonetype_5 = GhPythonScript(i=gradient_25)  # -> out, run, o; same code as nonetype
run_8 = GhPythonScript(i=panel_324, run=nonetype_5.run)  # -> out, o; inputs run: tree; same code as run_4

gradient_26 = Gradient(LowerLimit=0, UpperLimit=1, Parameter=panel_323, stops=[0: RGB(255, 0, 0), 0.5: RGB(255, 255, 0), 1: RGB(0, 128, 0)])

panel_325 = Panel("""0
1
2
3
4
5""")
nonetype_6 = GhPythonScript(i=gradient_26)  # -> out, run, o; same code as nonetype
run_9 = GhPythonScript(i=panel_325, run=nonetype_6.run)  # -> out, o; inputs run: tree; same code as run_4

filter_elements_4 = GhPythonScript(t=num, ids=flatten(iron2panel.panelOut), filter=flatten([run_4.o, run_8.o, run_7.o, run_5.o, run_6.o, run_9.o]))  # -> out, outE; inputs ids: list, filter: list of Int32
# ---------- filter_elements_4: Python ----------
__author__ = "sunt"
__version__ = "2018.06.03"

import rhinoscriptsyntax as rs

#print(E)
print(filter)
outE = []

for e in range(len(ids)):
    if ids[e] in filter:
        outE.append(t)
    else:
        outE.append(1)
# ---------- end filter_elements_4 ----------
# HeatMap display - Tuo
move_58 = Move(Geometry=boundary_4, Motion=Vector(0, 0, 8))  # -> Geometry, Transform
previewmat_5 = CustomPreviewMaterials(
    Geometry=move_58.Geometry,
    DiffuseColor=flatten([nonetype.o, nonetype_5.o, nonetype_4.o, nonetype_2.o, nonetype_3.o, nonetype_6.o]),
    Transparency=filter_elements_4.outE)

panel_326 = Panel(filter_elements_4.outE)

rings = GhPythonScript()  # -> out, a
# ---------- rings: Python ----------
__author__ = "sunt"
__version__ = "2018.06.04"

import rhinoscriptsyntax as rs

a = [0.2*(i+1) for i in range(4)]
# ---------- end rings ----------
# Radar Chart - Tuo
circle = Circle({Plane=Plane(origin=(1813.714054, -922.0555175, 0), x=(0.9138115486, -0.4061384661, 0), y=(0.4061384661, 0.9138115486, 0)), Radius=293.866235})
area_4 = Area(Geometry=circle)  # -> Area, Centroid
scale_4 = Scale(Geometry=circle, Center=area_4.Centroid, Factor=rings.a)  # -> Geometry, Transform

swatch_14 = ColourSwatch(SwatchColor=RGBA(150, 150, 150, 194))
argb_17 = SplitARGB(Colour=swatch_14)  # -> Alpha, Red, Green, Blue
frgb_32 = ColourRGBF(Alpha=Slider(1, range=0..1), Red=argb_17.Red, Green=argb_17.Green, Blue=argb_17.Blue)
previewlw_7 = CustomPreviewLineweights(Geometry=circle, Shader=frgb_32, Thickness=Slider(5, range=0..10), Absolute=False)

number_slider_60 = Slider(7, range=4..10)
panel_327 = Panel("""Pop. Density
Experience Diversity
Energy Effic.
Working Prox.
Living Prox.
Park Prox.
Live-work Balance
Solar Access
Mobility Perform.""")
python_21 = PythonScript(x=number_slider_60, scale=division_8, inL=panel_327)  # -> out, out_2; inputs inL: list; same code as python_18
radar_chart_data_list = PythonScript(
    solar=solar_by_id.avg,
    work=new_col_trans.score,
    live=new_col_trans_2.score,
    park=new_col_trans_3.score,
    tra=traffic_by_id_2.avg,
    lwb=balance_by_id.avg)  # -> out, L
# ---------- radar_chart_data_list: Python ----------
ds = [popden,expdiv,enEff,work,live,park,lwb,solar,tra]
L = [0.5]*len(ds)
for d in range(len(ds)):
    if ds[d]>0:
        L[d] = ds[d]
# ---------- end radar_chart_data_list ----------
panel_328 = Panel(python_21.out_2)
python_22 = PythonScript(x=number_slider_60, scale=division_8, inL=radar_chart_data_list.L)  # -> out, out_2; inputs inL: list; same code as python_18
number_slider_61 = Slider(18, range=0..100)
neg_18 = Negative(Value=Slider(42, range=0..100))
panel_329 = Panel(python_22.out_2)
vec_14 = VectorXYZ(XComponent=0, YComponent=neg_18, ZComponent=0)  # -> Vector, Length
python_23 = PythonScript(x=panel_329)  # -> out, a
# ---------- python_23: Python ----------
a = str(int(float(x) * 100))
# ---------- end python_23 ----------
multiplication_76 = Multiplication(A=number_slider_61, B=Slider(2, range=0..100))
swatch_15 = ColourSwatch(SwatchColor=RGB(255, 255, 255))

lng_13 = ListLength(List=panel_328)
divide_6 = DivideCurve(Curve=circle, Count=lng_13, Kinks=False)  # -> Points, Tangents, Parameters
ln_10 = Line(StartPoint=area_4.Centroid, EndPoint=divide_6.Points)
eval_6 = EvaluateCurve(Curve=ln_10, Parameter=Slider(1, range=0..1))  # -> Point, Tangent, Angle
eval_7 = EvaluateCurve(Curve=ln_10, Parameter=Slider(1.4, range=0..2))  # -> Point, Tangent, Angle
ln_11 = Line(StartPoint=area_4.Centroid, EndPoint=eval_6.Point)
eval_8 = EvaluateCurve(Curve=ln_11, Parameter=panel_329)  # -> Point, Tangent, Angle
pline_4 = PolyLine(Vertices=eval_8.Point, Closed=True)
fillet_2 = Fillet(Curve=pline_4, Radius=Slider(7.5, range=3..10))
boundary_5 = BoundarySurfaces(Edges=fillet_2)
move_59 = Move(Geometry=fillet_2, Motion=Vector(0, 0, 10))  # -> Geometry, Transform
move_60 = Move(Geometry=boundary_5, Motion=Vector(0, 0, 10))  # -> Geometry, Transform

pt_176 = Point(eval_7.Point)
move_61 = Move(Geometry=pt_176, Motion=vec_14.Vector)  # -> Geometry, Transform
tag_31 = TextTag3D(Location=move_61.Geometry, Text=python_23.a, Size=multiplication_76, Colour=swatch_15, Justification=5)
tag_32 = TextTag3D(Location=pt_176, Text=panel_328, Size=number_slider_61, Colour=swatch_15, Justification=5)

swatch_16 = ColourSwatch(SwatchColor=RGBA(20, 106, 255, 194))
argb_18 = SplitARGB(Colour=swatch_16)  # -> Alpha, Red, Green, Blue
frgb_33 = ColourRGBF(Alpha=Slider(0.575, range=0..1), Red=argb_18.Red, Green=argb_18.Green, Blue=argb_18.Blue)
previewlw_8 = CustomPreviewLineweights(Geometry=move_59.Geometry, Shader=frgb_33, Thickness=Slider(8, range=0..10), Absolute=False)
previewmat_6 = CustomPreviewMaterials(Geometry=move_60.Geometry, DiffuseColor=swatch_16, Transparency=Slider(0.5, range=0..1))

swatch_17 = ColourSwatch(SwatchColor=RGBA(255, 255, 255, 194))
argb_19 = SplitARGB(Colour=swatch_14)  # -> Alpha, Red, Green, Blue
frgb_34 = ColourRGBF(Alpha=Slider(1, range=0..1), Red=argb_19.Red, Green=argb_19.Green, Blue=argb_19.Blue)
previewlw_9 = CustomPreviewLineweights(Geometry=flatten([ln_10, scale_4.Geometry]), Shader=frgb_34, Thickness=Slider(1, range=0..10), Absolute=False)

# ==== cluster ModuleCenter
pt = ClusterInput()
int = ClusterInput()
num = ClusterInput()
int_2 = ClusterInput()

# ---- group: y
int_3 = Integer(int)

# ---- group: cell size
num_2 = Number(num)

# ---- group: x
int_4 = Integer(int_2)

# ---- group: center
pt_2 = Point(pt)

# ----
pt_3 = ConstructPoint(XCoordinate=0, YCoordinate=0, ZCoordinate=0)  # disabled
addition = Addition(A=int_4, B=0.5)
vec2pt = Vector2Pt(PointA=pt_3, PointB=pt_2, Unitize=False)  # -> Vector, Length; disabled
addition_2 = Addition(A=int_3, B=0.5)
multiplication = Multiplication(A=addition, B=num_2)
move = Move(Motion=vec2pt.Vector)  # -> Geometry, Transform; disabled
lng = ListLength(List=int_4)  # disabled
multiplication_2 = Multiplication(A=addition_2, B=num_2)
X = UnitX(Factor=multiplication)
repeat = RepeatData(Data=move.Transform, Length=lng)  # disabled
neg = Negative(Value=multiplication_2)
move_2 = Move(Geometry=pt_2, Motion=X)  # -> Geometry, Transform
graft = GraftTree(Tree=move_2.Transform, IncludeEmptyLists=True, IncludeNullItems=True)  # disabled
Y = UnitY(Factor=neg)
pshift = ShiftPaths(Data=repeat, Offset=-1)  # disabled
move_3 = Move(Geometry=move_2.Geometry, Motion=Y)  # -> Geometry, Transform
graft_2 = GraftTree(Tree=move_3.Transform, IncludeEmptyLists=True, IncludeNullItems=True)  # disabled
comp = Compound(Transforms=[graft, graft_2])  # disabled
graft_3 = GraftTree(Tree=pshift, IncludeEmptyLists=True, IncludeNullItems=True)  # disabled
comp_2 = Compound(Transforms=[comp, graft_3])  # disabled

# ---- group: module center
pt_4 = Point(move_3.Geometry)

# ----
pshift_2 = ShiftPaths(Data=comp_2, Offset=-1)  # disabled
transform = Transform(pshift_2)  # disabled
pt_5 = ClusterOutput(pt_4)
transform_2 = ClusterOutput(transform)  # disabled

# ==== cluster MoveToOrgin
num = ClusterInput()
G = ClusterInput()
num_2 = Number(num)
geobottomcenter = GeoBottomCenter(geo=G)
vec2pt = Vector2Pt(PointA=geobottomcenter, PointB=Point(0, 0, 0), Unitize=False)  # -> Vector, Length
move = Move(Geometry=G, Motion=vec2pt.Vector)  # -> Geometry, Transform
scale_nu = ScaleNU(Geometry=move.Geometry, Plane=PlaneXY(0, 0, 0), ScaleX=num_2, ScaleY=num_2, ScaleZ=1)  # -> Geometry, Transform
G_2 = ClusterOutput(scale_nu.Geometry)

# ==== cluster GeoBottomCenter_2
geo = ClusterInput()
geo_2 = Geometry(geo)
bbox = BoundingBox(Content=geo_2, Plane=PlaneXY(0, 0, 0))  # -> Box, Box_2
box_corners = BoxCorners(Box=bbox.Box)  # -> CornerA, CornerB, CornerC, CornerD, CornerE, CornerF, CornerG, CornerH
pdecon = Deconstruct(Point=box_corners.CornerA)  # -> XComponent, YComponent, ZComponent
pdecon_2 = Deconstruct(Point=box_corners.CornerC)  # -> XComponent, YComponent, ZComponent
addition = Addition(A=pdecon.XComponent, B=pdecon_2.XComponent)
addition_2 = Addition(A=pdecon.YComponent, B=pdecon_2.YComponent)
division = Division(A=addition, B=2)
division_2 = Division(A=addition_2, B=2)
pt = ConstructPoint(XCoordinate=division, YCoordinate=division_2, ZCoordinate=pdecon.ZComponent)
pshift = ShiftPaths(Data=pt, Offset=-1)
pt_2 = Point(pshift)
pt_3 = ClusterOutput(pt_2)

# ==== cluster EasterEggs
panel = Panel("79")  # disabled
panel_2 = Panel("30")  # disabled
subtraction = Subtraction(A=panel, B=1)  # disabled
subtraction_2 = Subtraction(A=panel_2, B=1)  # disabled
sqgrid = Square(Plane=PlaneXY(0, 0, 0), Size=1, ExtentX=subtraction, ExtentY=subtraction_2)  # -> Cells, Points; disabled
pdecon = Deconstruct(Point=sqgrid.Points)  # -> XComponent, YComponent, ZComponent; disabled
division = Division(A=pdecon.XComponent, B=panel)  # disabled
division_2 = Division(A=pdecon.YComponent, B=panel_2)  # disabled
pt = ConstructPoint(XCoordinate=division, YCoordinate=division_2, ZCoordinate=0)  # disabled
ahsv = SplitAHSV()  # -> Alpha, Hue, Saturation, Value; disabled
smaller = SmallerThan(FirstNumber=ahsv.Alpha, SecondNumber=1)  # -> SmallerThan, OrEqualTo; disabled
dispatch = Dispatch(List=sqgrid.Points, DispatchPattern=smaller.SmallerThan)  # -> ListA, ListB; disabled
dispatch_2 = Dispatch(DispatchPattern=smaller.SmallerThan)  # -> ListA, ListB; disabled
vec = VectorXYZ(XComponent=2, YComponent=-2, ZComponent=-10)  # -> Vector, Length; disabled
planesrf = PlaneSurface(Plane=dispatch.ListB, XSize=Domain(-0.5, 0.5), YSize=Domain(-0.5, 0.5))  # disabled
mesh = Mesh(flatten(planesrf))  # disabled
col = Colour(flatten(dispatch_2.ListB))  # disabled
mspray = MeshSpray(Mesh=graft(mesh), Points=Point(0, 0, 0), Colours=graft(col), SprayMode=0)  # disabled
mjoin = MeshJoin(Meshes=flatten(mspray))  # disabled
move = Move(Geometry=mjoin, Motion=vec.Vector)  # -> Geometry, Transform; disabled
mcol = MeshColours(Mesh=move.Geometry, Colours=RGB(0, 0, 0))  # disabled
preview = CustomPreview(Geometry=planesrf, Shader=dispatch_2.ListB)  # disabled
mjoin_2 = MeshJoin(Meshes=flatten([mjoin, mcol]))  # disabled
toggle = BooleanToggle(False)  # disabled
toggle_2 = BooleanToggle(False)  # disabled
panel_3 = Panel("7")  # disabled
swatch = ColourSwatch(SwatchColor=RGB(0, 0, 0))  # disabled
swatch_2 = ColourSwatch(SwatchColor=RGB(255, 115, 0))  # disabled

# ---- group: module meshes lego ref: 7 - J
mesh_2 = Mesh(<mesh referenced from the Rhino model>)  # disabled

# ---- group: on screen mesh ref: 8 - X
mesh_3 = Mesh(<mesh referenced from the Rhino model>)  # disabled

# ---- group: module meshes lego ref: 8 - X
mesh_4 = Mesh(<mesh referenced from the Rhino model>)  # disabled

# ----
panel_4 = Panel("7")  # disabled
mesh_5 = Mesh(<mesh referenced from the Rhino model>)  # disabled

# ---- group: on screen mesh ref: 7 - J
mesh_6 = Mesh(mjoin_2)  # disabled

# ----
mcol_2 = MeshColours(Mesh=mesh_3, Colours=swatch_2)  # disabled
mcol_3 = MeshColours(Mesh=mesh_5, Colours=swatch)  # disabled
shrink = ClusterInput()
shrink_2 = ClusterInput()
movetoorgin = MoveToOrgin(G=mesh_2, num=shrink)  # disabled
movetoorgin_2 = MoveToOrgin(G=mesh_4, num=shrink_2)  # disabled
mjoin_3 = MeshJoin(Meshes=[mcol_2, mcol_3])  # disabled

# ---- group: module meshes lego at orgin
mesh_7 = Mesh(movetoorgin)  # disabled

mesh_8 = Mesh(movetoorgin_2)  # disabled

# ----
A = ClusterInput()
A_2 = ClusterInput()
equals = Equality(FirstNumber=A, SecondNumber=panel_4)  # -> Equality, Inequality; disabled
int = Integer(equals.Equality)  # disabled
ma = MassAddition(Input=int)  # -> Result, PartialResults; disabled
larger = LargerThan(FirstNumber=ma.Result, SecondNumber=0)  # -> LargerThan, OrEqualTo; disabled
equals_2 = Equality(FirstNumber=A_2, SecondNumber=panel_3)  # -> Equality, Inequality; disabled
L = ClusterInput()
int_2 = Integer(equals_2.Equality)  # disabled
ma_2 = MassAddition(Input=int_2)  # -> Result, PartialResults; disabled
larger_2 = LargerThan(FirstNumber=ma_2.Result, SecondNumber=0)  # -> LargerThan, OrEqualTo; disabled
L_2 = ClusterInput()
dispatch_3 = Dispatch(List=L, DispatchPattern=equals_2.Equality)  # -> ListA, ListB; disabled

# ---- group: if has this special id
bool = Boolean(larger.LargerThan)  # disabled

bool_2 = Boolean(bool)  # disabled

# ----
getcamera = GetCamera(GetCamera=bool_2)  # -> Location, Target, LensLength, UpDirection; disabled
ln = Line(StartPoint=getcamera.Location, EndPoint=getcamera.Target)  # disabled
getplanefrom2pts = GetPlaneFrom2pts(pt_2=getcamera.Location, pt=getcamera.Target)  # disabled
dispatch_4 = Dispatch(List=L_2, DispatchPattern=equals.Equality)  # -> ListA, ListB; disabled
number_slider = Slider(6.4, range=0..10)  # disabled
number_slider_2 = Slider(14.4, range=0..100)  # disabled
pt_2 = ConstructPoint(XCoordinate=500, YCoordinate=500, ZCoordinate=20)  # disabled

# ---- group: if has this special id
bool_3 = Boolean(larger_2.LargerThan)  # disabled

bool_4 = Boolean(bool_3)  # disabled

# ----
getcamera_2 = GetCamera(GetCamera=bool_4)  # -> Location, Target, LensLength, UpDirection; disabled
ln_2 = Line(StartPoint=getcamera_2.Location, EndPoint=getcamera_2.Target)  # disabled
getplanefrom2pts_2 = GetPlaneFrom2pts(pt_2=getcamera_2.Location, pt=getcamera_2.Target)  # disabled
vec2pt = Vector2Pt(PointA=Point(0, 0, 0), PointB=dispatch_3.ListA, Unitize=False)  # -> Vector, Length; disabled
vec2pt_2 = Vector2Pt(PointA=Point(0, 0, 0), PointB=dispatch_4.ListA, Unitize=False)  # -> Vector, Length; disabled
move_2 = Move(Geometry=mesh_7, Motion=vec2pt.Vector)  # -> Geometry, Transform; disabled
pt_3 = Point(pt_2)  # disabled
move_3 = Move(Geometry=mesh_8, Motion=vec2pt_2.Vector)  # -> Geometry, Transform; disabled

# ---- group: current cam canvas pln
pln = Plane(getplanefrom2pts)  # disabled

pln_2 = Plane(getplanefrom2pts_2)  # disabled

# ----
xy = XYPlane(Origin=pt_3)  # disabled
number_slider_3 = Slider(0.01, range=0.001..1)  # disabled
number_slider_4 = Slider(0.01, range=0.001..1)  # disabled
number_slider_5 = Slider(0.81, range=0.001..101)  # disabled
movetoorgin_3 = MoveToOrgin(G=mjoin_3, num=number_slider)  # disabled
movetoorgin_4 = MoveToOrgin(G=mesh_6, num=number_slider_2)  # disabled
orient = Orient(Geometry=movetoorgin_4, Source=PlaneXY(0, 0, 0), Target=xy)  # -> Geometry, Transform; disabled
orient_2 = Orient(Geometry=movetoorgin_3, Source=PlaneXY(0, 0, 0), Target=pln)  # -> Geometry, Transform; disabled
orient_3 = Orient(Geometry=movetoorgin_4, Source=PlaneXY(0, 0, 0), Target=pln_2)  # -> Geometry, Transform; disabled
scale = Scale(Geometry=orient_2.Geometry, Center=getcamera.Location, Factor=number_slider_3)  # -> Geometry, Transform; disabled
scale_2 = Scale(Geometry=orient_3.Geometry, Center=getcamera_2.Location, Factor=number_slider_4)  # -> Geometry, Transform; disabled
scale_3 = Scale(Geometry=orient.Geometry, Center=pt_3, Factor=number_slider_5)  # -> Geometry, Transform; disabled
filter = StreamFilter(Gate=bool_2, Stream1=scale.Geometry)  # disabled
filter_2 = StreamFilter(Gate=bool_4, Stream1=scale_2.Geometry)  # disabled
filter_3 = StreamFilter(Gate=bool_4, Stream1=scale_3.Geometry)  # disabled

# ---- group: special JR
mesh_9 = Mesh(move_2.Geometry)  # disabled

# ---- group: on 3d view
mesh_10 = Mesh(filter)  # disabled

# ---- group: special Xin
mesh_11 = Mesh(move_3.Geometry)  # disabled

# ---- group: on 3d view
mesh_12 = Mesh(filter_2)  # disabled

# ---- group: on lego
mesh_13 = Mesh(filter_3)  # disabled

# ==== cluster RndReduceByRatio
L = ClusterInput()
B = ClusterInput()
lng = ListLength(List=L)
S = ClusterInput()
multiplication = Multiplication(A=lng, B=B)
reduce = RandomReduce(List=L, Reduction=multiplication, Seed=S)
L_2 = ClusterOutput(reduce)

# ==== cluster DashLine20
num = ClusterInput()
crv = ClusterInput()
crv_2 = Curve(reparameterize(graft(crv)))
num_2 = Number(num)
explode = Explode(Curve=crv_2, Recursive=True)  # -> Segments, Vertices
crv_3 = Curve(reparameterize(graft(explode.Segments)))
len = Length(Curve=crv_3)
division = Division(A=len, B=num_2)

# ---- group: make sure it's odd number
int = Integer(division)
mod = Modulus(A=int, B=Slider(2, range=0..10))
subtraction = Subtraction(A=Slider(1, range=0..1), B=mod)
addition = Addition(A=int, B=subtraction)

# ----
int_2 = Integer(addition)
dom = Domain(DomainStart=0, DomainEnd=expr("1-1/x", int_2))
dom_2 = Domain(DomainStart=expr("1/x", int_2), DomainEnd=1)
range = Range(Domain=dom_2, Steps=expr("x-1", int_2))
range_2 = Range(Domain=dom, Steps=expr("x-1", int_2))
series = Series(Start=0, Step=2, Count=expr("(x+1)/2", int_2))
dom_3 = Domain(DomainStart=range_2, DomainEnd=range)
item = ListItem(List=dom_3, Index=series, Wrap=False)
subcrv = SubCurve(BaseCurve=crv_3, Domain=item)
C = ClusterOutput(subcrv)

# ==== cluster AddArrowHead
num = ClusterInput()
crv = ClusterInput()

# ---- group: arrow size
num_2 = Number(num)

# ---- group: ref crvs - density arrow base
crv_2 = Curve(reparameterize(graft(crv)))

# ----
eval = EvaluateCurve(Curve=crv_2, Parameter=1)  # -> Point, Tangent, Angle
multiplication = Multiplication(A=num_2, B=Slider(0.2, range=0..1))
neg = Negative(Value=multiplication)
xy = XYPlane(Origin=eval.Point)
align = AlignPlane(Plane=xy, Direction=eval.Tangent)  # -> Plane, Angle
pt = PointOriented(BasePlane=align.Plane, UComponent=0, VComponent=-0.1, WComponent=0)
pt_2 = PointOriented(BasePlane=align.Plane, UComponent=0, VComponent=multiplication, WComponent=0)
pt_3 = PointOriented(BasePlane=align.Plane, UComponent=num_2, VComponent=0, WComponent=0)
pt_4 = PointOriented(BasePlane=align.Plane, UComponent=0, VComponent=neg, WComponent=0)
merge = Merge(Data1=eval.Point, Data2=pt_2, Data3=pt_3, Data4=pt_4, Data5=pt)
pline = PolyLine(Vertices=merge, Closed=False)
merge_2 = Merge(Data1=crv_2, Data2=pline)
join = JoinCurves(Curves=merge_2, Preserve=False)
pshift = ShiftPaths(Data=join, Offset=-2)
D = ClusterOutput(pshift)

# ==== cluster CellChangeArrowCrv
int = ClusterInput()
pt = ClusterInput()
pt_2 = ClusterInput()
num = ClusterInput()

# ---- group: id suggested
int_2 = Integer(graft(int))

# ---- group: module center suggested
pt_3 = Point(graft(pt))

# ---- group: cell change arrow start pts
pt_4 = Point(pt_2)

# ---- group: arrow size
num_2 = Number(num)

# ----
vec = VectorXYZ(XComponent=10, YComponent=0, ZComponent=20)  # -> Vector, Length
item = ListItem(List=pt_4, Index=int_2, Wrap=False)
move = Move(Geometry=pt_3, Motion=vec.Vector)  # -> Geometry, Transform

# ---- group: cell change arrow start pt
pt_5 = Point(item)

# ----
dist = Distance(PointA=pt_5, PointB=move.Geometry)
ln = Line(StartPoint=pt_5, EndPoint=move.Geometry)
multiplication = Multiplication(A=dist, B=0.14)
crv = Curve(reparameterize(ln))
eval = EvaluateCurve(Curve=crv, Parameter=0.5)  # -> Point, Tangent, Angle
rotate = Rotate(Geometry=eval.Tangent, Angle=degrees(-90), Plane=PlaneXY(0, 0, 0))  # -> Geometry, Transform
amp = Amplitude(Vector=rotate.Geometry, Amplitude=multiplication)
addition = Addition(A=eval.Point, B=amp)
pt_6 = Point(addition)
arc = Arc3Pt(PointA=pt_5, PointB=pt_6, PointC=move.Geometry)  # -> Arc, Plane, Radius

# ---- group: arc
crv_2 = Curve(reparameterize(arc.Arc))

# ----
len = Length(Curve=crv_2)
subtraction = Subtraction(A=len, B=num_2)
division = Division(A=subtraction, B=len)
dom = ConstructDomain(DomainStart=0, DomainEnd=division)
subcrv = SubCurve(BaseCurve=crv_2, Domain=dom)
pshift = ShiftPaths(Data=subcrv, Offset=-1)

# ---- group: arc trimed
crv_3 = Curve(pshift)

# ----
crv_4 = ClusterOutput(crv_3)

# ==== cluster Perspective
int = ClusterInput()
int_2 = ClusterInput()
pt = ClusterInput()

# ---- group: grid extent y
int_3 = Integer(int)

# ---- group: grid extent x
int_4 = Integer(int_2)

# ---- group: Pts Sample Grid Corner
pt_2 = Point(pt)

# ----
subtraction = Subtraction(A=int_4, B=1)
subtraction_2 = Subtraction(A=int_3, B=1)
item = ListItem(List=pt_2, Index=0, Wrap=False)
item_2 = ListItem(List=pt_2, Index=1, Wrap=False)
item_3 = ListItem(List=pt_2, Index=2, Wrap=False)
item_4 = ListItem(List=pt_2, Index=3, Wrap=False)
pt_3 = Point(item_4)
pt_4 = Point(item)
ln = Line(StartPoint=pt_3, EndPoint=pt_4)
pt_5 = Point(item_2)
ln_2 = Line(StartPoint=pt_4, EndPoint=pt_5)
pt_6 = Point(item_3)
ln_3 = Line(StartPoint=pt_6, EndPoint=pt_3)
ln_4 = Line(StartPoint=pt_5, EndPoint=pt_6)
llx = LineLine(Line1=ln, Line2=ln_4)  # -> ParamA, ParamB, PointA, PointB
pt_7 = Point(llx.PointA)
llx_2 = LineLine(Line1=ln_2, Line2=ln_3)  # -> ParamA, ParamB, PointA, PointB
pt_8 = Point(llx_2.PointA)
vec2pt = Vector2Pt(PointA=pt_8, PointB=pt_7, Unitize=False)  # -> Vector, Length
line = LineSDL(Start=pt_3, Direction=vec2pt.Vector, Length=1)
llx_3 = LineLine(Line1=ln_2, Line2=line)  # -> ParamA, ParamB, PointA, PointB
pt_9 = Point(llx_3.PointA)
ln_5 = Line(StartPoint=pt_3, EndPoint=pt_9)
divide = DivideCurve(Curve=ln_5, Count=subtraction_2, Kinks=False)  # -> Points, Tangents, Parameters
ln_6 = Line(StartPoint=pt_8, EndPoint=divide.Points)
llx_4 = LineLine(Line1=ln_4, Line2=line)  # -> ParamA, ParamB, PointA, PointB
pt_10 = Point(llx_4.PointA)
ln_7 = Line(StartPoint=pt_3, EndPoint=pt_10)
divide_2 = DivideCurve(Curve=ln_7, Count=subtraction, Kinks=False)  # -> Points, Tangents, Parameters
ln_8 = Line(StartPoint=pt_7, EndPoint=divide_2.Points)
ln_9 = Line(StartPoint=pt_8, EndPoint=pt_7)

# ---- group: x
line_2 = Line(ln_8)

# ---- group: y
line_3 = Line(ln_6)

# ----
graft = GraftTree(Tree=ln_6, IncludeEmptyLists=True, IncludeNullItems=True)
llx_5 = LineLine(Line1=line_2, Line2=graft)  # -> ParamA, ParamB, PointA, PointB

# ---- group: keystoned grid pts
pt_11 = Point(llx_5.PointA)

# ----
pt_12 = ClusterOutput(pt_11)

# ==== cluster RecordDensitySliderSet
num = ClusterInput()
int = ClusterInput()
set1 = ClusterInput()
integer = ClusterInput()
set2 = ClusterInput()

# ---- group: slider1
num_2 = Number(num)

# ---- group: dockID
int_2 = Integer(int)

# ---- group: set number
integer_2 = Integer(integer)

# ----
set1_2 = Integer(set1)
remap = RemapNumbers(Value=set1_2, Source="1 to 30", Target=Domain(0, 1))  # -> Mapped, Clipped
panel = Panel(remap.Mapped)
set2_2 = Integer(set2)
remap_2 = RemapNumbers(Value=set2_2, Source="1 to 30", Target=Domain(0, 1))  # -> Mapped, Clipped
panel_2 = Panel(remap_2.Mapped)
equals = Equality(FirstNumber=int_2, SecondNumber="5")  # -> Equality, Inequality
equals_2 = Equality(FirstNumber=int_2, SecondNumber="2")  # -> Equality, Inequality
equals_3 = Equality(FirstNumber=int_2, SecondNumber="3")  # -> Equality, Inequality
equals_4 = Equality(FirstNumber=int_2, SecondNumber="4")  # -> Equality, Inequality
equals_5 = Equality(FirstNumber=int_2, SecondNumber="0")  # -> Equality, Inequality
equals_6 = Equality(FirstNumber=int_2, SecondNumber="1")  # -> Equality, Inequality

# ---- group: density set 1
item = ListItem(List=panel, Index=0, Wrap=False)
item_2 = ListItem(List=panel, Index=2, Wrap=False)
item_3 = ListItem(List=panel, Index=1, Wrap=False)
item_4 = ListItem(List=panel, Index=3, Wrap=False)
item_5 = ListItem(List=panel, Index=4, Wrap=False)
item_6 = ListItem(List=panel, Index=5, Wrap=False)
panel_3 = Panel(item)
panel_4 = Panel(item_3)
panel_5 = Panel(item_2)
panel_6 = Panel(item_4)
panel_7 = Panel(item_5)
panel_8 = Panel(item_6)

# ---- group: density set 2
item_7 = ListItem(List=panel_2, Index=0, Wrap=False)
item_8 = ListItem(List=panel_2, Index=2, Wrap=False)
item_9 = ListItem(List=panel_2, Index=1, Wrap=False)
item_10 = ListItem(List=panel_2, Index=3, Wrap=False)
item_11 = ListItem(List=panel_2, Index=4, Wrap=False)
item_12 = ListItem(List=panel_2, Index=5, Wrap=False)
panel_9 = Panel(item_7)
panel_10 = Panel(item_9)
panel_11 = Panel(item_8)
panel_12 = Panel(item_10)
panel_13 = Panel(item_11)
panel_14 = Panel(item_12)

# ----
panel_15 = Panel(integer_2)
filter = StreamFilter(Gate=equals.Equality, Stream1=num_2)
filter_2 = StreamFilter(Gate=equals_2.Equality, Stream1=num_2)
filter_3 = StreamFilter(Gate=equals_3.Equality, Stream1=num_2)
filter_4 = StreamFilter(Gate=equals_4.Equality, Stream1=num_2)
filter_5 = StreamFilter(Gate=equals_5.Equality, Stream1=num_2)
filter_6 = StreamFilter(Gate=equals_6.Equality, Stream1=num_2)
filter_7 = StreamFilter(Gate=panel_15, Stream0=filter_5, Stream1=panel_3, Stream2=panel_9)
filter_8 = StreamFilter(Gate=panel_15, Stream0=filter, Stream1=panel_8, Stream2=panel_14)
filter_9 = StreamFilter(Gate=panel_15, Stream0=filter_2, Stream1=panel_5, Stream2=panel_11)
filter_10 = StreamFilter(Gate=panel_15, Stream0=filter_3, Stream1=panel_6, Stream2=panel_12)
filter_11 = StreamFilter(Gate=panel_15, Stream0=filter_4, Stream1=panel_7, Stream2=panel_13)
filter_12 = StreamFilter(Gate=panel_15, Stream0=filter_6, Stream1=panel_4, Stream2=panel_10)
rec = DataRecorder(filter_9, DataLimit=1, RecordData=True)
panel_16 = Panel(rec)
rec_2 = DataRecorder(filter_8, DataLimit=1, RecordData=True)
panel_17 = Panel(rec_2)
rec_3 = DataRecorder(filter_12, DataLimit=1, RecordData=True)
panel_18 = Panel(rec_3)
rec_4 = DataRecorder(filter_10, DataLimit=1, RecordData=True)
panel_19 = Panel(rec_4)
rec_5 = DataRecorder(filter_11, DataLimit=1, RecordData=True)
panel_20 = Panel(rec_5)
rec_6 = DataRecorder(filter_7, DataLimit=1, RecordData=True)
panel_21 = Panel(rec_6)
null = NullItem(Item=rec_2)  # -> NullFlags, InvalidFlags, Description
null_2 = NullItem(Item=rec)  # -> NullFlags, InvalidFlags, Description
null_3 = NullItem(Item=rec_4)  # -> NullFlags, InvalidFlags, Description
null_4 = NullItem(Item=rec_5)  # -> NullFlags, InvalidFlags, Description
null_5 = NullItem(Item=rec_6)  # -> NullFlags, InvalidFlags, Description
null_6 = NullItem(Item=rec_3)  # -> NullFlags, InvalidFlags, Description
filter_13 = StreamFilter(Gate=null.NullFlags, Stream0=rec_2, Stream1="0")
filter_14 = StreamFilter(Gate=null_2.NullFlags, Stream0=rec, Stream1="0")
filter_15 = StreamFilter(Gate=null_3.NullFlags, Stream0=rec_4, Stream1="0")
filter_16 = StreamFilter(Gate=null_4.NullFlags, Stream0=rec_5, Stream1="0")
filter_17 = StreamFilter(Gate=null_5.NullFlags, Stream0=rec_6, Stream1="0")
filter_18 = StreamFilter(Gate=null_6.NullFlags, Stream0=rec_3, Stream1="0")
merge = Merge(Data1=filter_17, Data2=filter_18, Data3=filter_14, Data4=filter_15, Data5=filter_16, Data6=filter_13)
remap_3 = RemapNumbers(Value=merge, Source=Domain(0, 1), Target="1 to 30")  # -> Mapped, Clipped

# ---- group: floor num for each type
int_3 = Integer(remap_3.Mapped)

# ----
panel_22 = Panel(int_3)

int_4 = ClusterOutput(int_3)

# ==== cluster LimitMaxID
int = ClusterInput()
int_2 = ClusterInput()

# ---- group: max id
int_3 = Integer(int)

# ---- group: all piece ids raw
int_4 = Integer(int_2)

# ----
lng = ListLength(List=int_4)
larger = LargerThan(FirstNumber=int_4, SecondNumber=int_3)  # -> LargerThan, OrEqualTo
repeat = RepeatData(Data="-1", Length=lng)
pshift = ShiftPaths(Data=repeat, Offset=-1)
merge = Merge(Data1=graft(int_4), Data2=graft(pshift))
item = ListItem(List=merge, Index=graft(larger.LargerThan), Wrap=False)
pshift_2 = ShiftPaths(Data=item, Offset=-1)

# ---- group: all piece ids
int_5 = Integer(pshift_2)

# ----
int_6 = ClusterOutput(int_5)

# ==== cluster GeoBottomCenter
geo = ClusterInput()
geo_2 = Geometry(geo)
bbox = BoundingBox(Content=geo_2, Plane=PlaneXY(0, 0, 0))  # -> Box, Box_2
box_corners = BoxCorners(Box=bbox.Box)  # -> CornerA, CornerB, CornerC, CornerD, CornerE, CornerF, CornerG, CornerH
pdecon = Deconstruct(Point=box_corners.CornerA)  # -> XComponent, YComponent, ZComponent
pdecon_2 = Deconstruct(Point=box_corners.CornerC)  # -> XComponent, YComponent, ZComponent
addition = Addition(A=pdecon.XComponent, B=pdecon_2.XComponent)
addition_2 = Addition(A=pdecon.YComponent, B=pdecon_2.YComponent)
division = Division(A=addition, B=2)
division_2 = Division(A=addition_2, B=2)
pt = ConstructPoint(XCoordinate=division, YCoordinate=division_2, ZCoordinate=pdecon.ZComponent)
pt_2 = Point(pt)
pt_3 = ClusterOutput(pt_2)

# ==== cluster GetPlaneFrom2pts
pt = ClusterInput()
pt_2 = ClusterInput()

# ---- group: current cam tgt pos
pt_3 = Point(pt)

# ---- group: current cam pos
pt_4 = Point(pt_2)

# ----
Z = UnitZ(Factor=100)
move = Move(Geometry=pt_3, Motion=Z)  # -> Geometry, Transform
pl_3pt = Plane3Pt(PointA=pt_3, PointB=pt_4, PointC=move.Geometry)
pt_5 = PointOriented(BasePlane=pl_3pt, UComponent=0, VComponent=0, WComponent=-100)
pt_6 = PointOriented(BasePlane=pl_3pt, UComponent=0, VComponent=100, WComponent=0)
pl_3pt_2 = Plane3Pt(PointA=pt_3, PointB=pt_5, PointC=pt_6)
pln = Plane(pl_3pt_2)
pln_2 = ClusterOutput(pln)
