# Grasshopper definition 180620_BentoScope_Madrid.gh (Grasshopper 0.9.76)
# plug-ins: Python Interpreter, Firefly.X, Human, gHowl, LunchBox

# ---- group: build meshes
number_slider = Slider(20, range=0..20)  # disabled
swatch = ColourSwatch(SwatchColor=RGB(255, 255, 255))  # disabled
swatch_2 = ColourSwatch(SwatchColor=RGB(255, 255, 255))  # disabled
mesh = Mesh(<mesh referenced from the Rhino model>)  # disabled
mesh_2 = Mesh([<mesh referenced from the Rhino model> x2])  # disabled
area = Area(Geometry=mesh_2)  # -> Area, Centroid; disabled
mesh_3 = Mesh([<mesh referenced from the Rhino model> x12])  # disabled
vec = VectorXYZ(XComponent=0, YComponent=number_slider, ZComponent=0)  # -> Vector, Length; disabled
mspray = MeshSpray(Mesh=mesh_2, Points=area.Centroid, Colours=[swatch_2, swatch], SprayMode=11)  # disabled
mjoin = MeshJoin(Meshes=mesh_3)  # disabled
move = Move(Motion=vec.Vector)  # -> Geometry, Transform; disabled

# ---- group: manual color space calibration for dock / Sample White
pt = Point(<point referenced from the Rhino model>)

# ---- group: manual color space calibration for dock / Sample Black
pt_2 = Point(<point referenced from the Rhino model>)

# ---- group: manual color space calibration for dock / Sample Blue
pt_3 = Point(<point referenced from the Rhino model>)  # disabled

# ---- group: manual color space calibration for dock / Sample Green
pt_4 = Point(<point referenced from the Rhino model>)  # disabled

# ---- group: manual color space calibration for dock / Sample Red
pt_5 = Point(<point referenced from the Rhino model>)

# ---- group: manual color space calibration for dock / Sample Yellow
pt_6 = Point(<point referenced from the Rhino model>)

# ----
pdecon = Deconstruct(Point=pt)  # -> XComponent, YComponent, ZComponent
pdecon_2 = Deconstruct(Point=pt_2)  # -> XComponent, YComponent, ZComponent
pdecon_3 = Deconstruct(Point=pt_5)  # -> XComponent, YComponent, ZComponent
pdecon_4 = Deconstruct(Point=pt_6)  # -> XComponent, YComponent, ZComponent
pdecon_5 = Deconstruct(Point=pt_3)  # -> XComponent, YComponent, ZComponent
pdecon_6 = Deconstruct(Point=pt_4)  # -> XComponent, YComponent, ZComponent

# ---- group: mesh, flat
mesh_4 = Mesh([<mesh referenced from the Rhino model> x9])

# ----
volume = Volume(Geometry=mesh_4)  # -> Volume, Centroid
pdecon_7 = Deconstruct(Point=volume.Centroid)  # -> XComponent, YComponent, ZComponent
pt_7 = ConstructPoint(XCoordinate=pdecon_7.XComponent, YCoordinate=pdecon_7.YComponent, ZCoordinate=0)
scale = Scale(Geometry=mesh_4, Center=pt_7, Factor=Slider(0.97, range=0..1))  # -> Geometry, Transform
mesh_5 = Mesh(scale.Geometry)

# ---- group: module meshes lego ref: -1
# Building Type Mesh
mesh_6 = Mesh(<mesh referenced from the Rhino model>)

# ---- group: module meshes lego ref: 0 to 5
mesh_7 = Mesh([<mesh referenced from the Rhino model> x9])

# ---- group: module meshes lego ref: 0 to 5 - with hight test
mesh_8 = Mesh([<mesh referenced from the Rhino model> x6])

# ----
frgb = ColourRGBF(Alpha=1, Red=pdecon.XComponent, Green=pdecon.YComponent, Blue=pdecon.ZComponent)
frgb_2 = ColourRGBF(Alpha=1, Red=pdecon_2.XComponent, Green=pdecon_2.YComponent, Blue=pdecon_2.ZComponent)
frgb_3 = ColourRGBF(Alpha=1, Red=pdecon_3.XComponent, Green=pdecon_3.YComponent, Blue=pdecon_3.ZComponent)
frgb_4 = ColourRGBF(Alpha=1, Red=pdecon_4.XComponent, Green=pdecon_4.YComponent, Blue=pdecon_4.ZComponent)
frgb_5 = ColourRGBF(Alpha=1, Red=pdecon_5.XComponent, Green=pdecon_5.YComponent, Blue=pdecon_5.ZComponent)
frgb_6 = ColourRGBF(Alpha=1, Red=pdecon_6.XComponent, Green=pdecon_6.YComponent, Blue=pdecon_6.ZComponent)

# ---- group: GH Profiler List_David Rutten_Jung
gh_profiler_list = VBScript()  # -> out; disabled
# ---------- gh_profiler_list: VB ----------
    If (_form IsNot Nothing) Then Return

    _form = New Form()
    _form.StartPosition = FormStartPosition.Manual
    _form.ShowInTaskbar = False
    _form.FormBorderStyle = FormBorderStyle.SizableToolWindow
    _form.Text = "Component List"
    AddHandler _form.FormClosing, AddressOf FormClosing

    _list = New ListView()
    _list.View = View.Details
    _list.AllowColumnReorder = False
    _list.MultiSelect = False
    _list.Columns.Add("Component", 200)
    _list.Columns.Add("Runtime", 80)
    _list.Dock = DockStyle.Fill
    AddHandler _list.ItemActivate, AddressOf ItemActivate
    _form.Controls.Add(_list)

    Grasshopper.GUI.GH_WindowsFormUtil.CenterFormOnCursor(_form, True)
    _form.Show(Instances.DocumentEditor)
    Instances.DocumentEditor.FormShepard.RegisterForm(_form)

    If (_handler) Then Return
    AddHandler GrasshopperDocument.SolutionEnd, AddressOf DocumentSolutionEnd
# ---------- gh_profiler_list: VB additional code ----------
  Private _form As Form
  Private _list As ListView
  Private _handler As Boolean = False

  Private Sub FormClosing(sender As Object, e As EventArgs)
    If (_form Is Nothing) Then Return
    RemoveHandler _form.FormClosing, AddressOf FormClosing
    RemoveHandler _list.ItemActivate, AddressOf ItemActivate

    _form = Nothing
    _list = Nothing
  End Sub
  Private Sub ItemActivate(sender As Object, e As EventArgs)
    Try
      Dim item As ListViewItem = _list.SelectedItems(0)
      Dim target As RectangleF = TryCast(item.Tag, IGH_DocumentObject).Attributes.Bounds
      Dim view As New Grasshopper.GUI.Canvas.GH_NamedView(Instances.ActiveCanvas.Viewport.ScreenPort, target)
      view.SetToViewport(Instances.ActiveCanvas, 350)
    Catch
    End Try
  End Sub

  Private Sub DocumentSolutionEnd(sender As Object, e As GH_SolutionEventArgs)
    If (_form Is Nothing) Then Return
    _list.Items.Clear()

    Dim doc As GH_Document = e.Document
    If (doc Is Nothing) Then Return
    If (doc.ObjectCount = 0) Then Return

    Dim times As Int64()
    Dim objects As IGH_DocumentObject()
    ReDim times(doc.ObjectCount - 1)
    ReDim objects(doc.ObjectCount - 1)
    For i As Int32 = 0 To doc.ObjectCount - 1
      Dim obj As IGH_ActiveObject = TryCast(doc.Objects(i), IGH_ActiveObject)
      If (obj Is Nothing) Then
        times(i) = 0
        objects(i) = doc.Objects(i)
        Continue For
      End If

      times(i) = obj.ProcessorTime.Ticks
      objects(i) = obj
    Next
    Array.Sort(times, objects)

    For i As Int32 = doc.ObjectCount - 1 To 0 Step -1
      If (times(i) < TimeSpan.TicksPerMillisecond) Then Continue For
      Dim item As New ListViewItem(objects(i).Name)
      item.Tag = objects(i)
      item.SubItems.Add(String.Format("{0:0} ms", New TimeSpan(times(i)).TotalMilliseconds))
      _list.Items.Add(item)
    Next
    _list.Invalidate()
  End Sub
# ---------- end gh_profiler_list ----------

# ---- group: Relative Filepath
vb = VBScript()  # -> out, A
# ---------- vb: VB ----------
    Dim gh_d As GH_Document = owner.OnPingDocument()

    If gh_d.IsFilePathDefined Then
      Print("A path is defined.")
      A = gh_d.FilePath
    Else
      Print("No path defined.")
    End If
# ---------- end vb ----------
panel = Panel(vb.out)
panel_2 = Panel(vb.A)
split = TextSplit(Text=panel_2, Separators="\")
shift = ShiftList(List=split, Shift=-1, Wrap=False)
txt = Text(flatten("Data\180615_Camera Capture_Madrid_table1.PNG"))
txt_2 = Text(flatten(shift))
join = TextJoin(Text=flatten([txt_2, txt]), Join="\")
# Reference Color
path = FilePath(join)
panel_3 = Panel(path)

# ----
merge = Merge(Data1=frgb, Data2=frgb_2, Data3=frgb_3, Data4=frgb_4, Data5=frgb_5, Data6=frgb_6)

# ---- group: mesh coloring
mesh_9 = Mesh([<mesh referenced from the Rhino model> x2])  # disabled
res_color = ColourSwatch(SwatchColor=RGB(251, 255, 122))
res_gray = ColourSwatch(SwatchColor=RGB(227, 227, 227))
sidewalk = ColourSwatch(SwatchColor=RGB(107, 107, 107))
bikelane = ColourSwatch(SwatchColor=RGB(86, 135, 87))
off_gray = ColourSwatch(SwatchColor=RGB(171, 171, 171))
offcolor = ColourSwatch(SwatchColor=RGB(255, 122, 122))
parking = ColourSwatch(SwatchColor=RGB(196, 156, 100))
blank = ColourSwatch(SwatchColor=RGB(110, 110, 110))
park = ColourSwatch(SwatchColor=RGB(165, 201, 44))
road = ColourSwatch(SwatchColor=RGB(64, 64, 64))
text = ColourSwatch(SwatchColor=RGB(0, 0, 0))
res_warm = ColourSwatch(SwatchColor=RGB(255, 251, 230))
text_new = ColourSwatch(SwatchColor=RGB(64, 64, 64))
off_cold = ColourSwatch(SwatchColor=RGB(230, 242, 255))
mcol = MeshColours(Mesh=mesh_9, Colours=res_gray)
# -2 means static context
# -1 means empty site
# please manually replace -1
# to building types 0 to 5
# 0 means RL
# 1 means RM
# 2 means RS
# 3 means OL
# 4 means OM
# 5 means OS
mesh_10 = Mesh(mcol)

# ---- group: All Manual Reference Colors
col = Colour(merge)

# ----
mesh_11 = Mesh(mesh_5)

# ---- group: heatmap oppacity
number_slider_2 = Slider(0.8, range=0..1)

# ---- group: all ref colors
col_2 = Colour(col)

# ---- group: Walkable distance
index = Slider(400, range=1..1500)

# ---- group: right click -> Slow(1s)
video_stream = WebCamVideoStream()  # disabled

# ----
pushtempstep = Button()

# ---- group: AI Step (manual)
aisteptest = Slider(24, range=-1..24)

# ----
slider1 = Slider(0.56, range=0..1)
slider2 = Slider(0.43, range=0..1)
list = ValueList({"Small": 440, "Large": 1760}, selected="Large")

# ---- group: manual or CV
list_2 = ValueList({"manual": 0, "CV": 1}, selected="manual")

# ---- group: ref color pop area
crv = Curve(<curve referenced from the Rhino model>)

# ----
path_2 = FilePath(path)

# ---- group: all rotations
panel_4 = Panel("270,270,270,270,270,270,270,270,270,270,270,270,270,270,270,270,270,270,270,270,270,270,270,270,270,270,270,270,270,270,270,270,180,180,180,180,180,180,180,180,180,180,180,180,180,180,180,180,180,180,180,180,180,180,180,180,180,180,180,180,180,180,180,180,90,90,90,90,90,90,90,90,90,90,90,90,90,90,90,90,90,90,90,90,90,90,90,90,90,90,90,90,90,90,90,90,0,0,0,0,0,0,0,0,0,0,0,0,0,0,0,0,0,0,0,0,0,0,0,0,0,0,0,0,0,0,0,0")

# ---- group: all color code quarts (no rotation)
# Decode Piece ID
panel_5 = Panel("2,0,0,0\t2,1,0,0\t2,0,1,0\t2,0,0,1\t2,1,1,0\t2,1,0,1\t2,0,1,1\t2,1,1,1\t3,0,0,0\t3,1,0,0\t3,0,1,0\t3,0,0,1\t3,1,1,0\t3,1,0,1\t3,0,1,1\t3,1,1,1\t4,0,0,0\t4,1,0,0\t4,0,1,0\t4,0,0,1\t4,1,1,0\t4,1,0,1\t4,0,1,1\t4,1,1,1\t5,0,0,0\t5,1,0,0\t5,0,1,0\t5,0,0,1\t5,1,1,0\t5,1,0,1\t5,0,1,1\t5,1,1,1")

# ----
# Input Parameters
gridextent_x = Slider(16, range=2..48)
gridextent_y = Slider(16, range=2..48)
toggle1 = BooleanToggle(False)
toggle2 = BooleanToggle(True)
toggle4 = BooleanToggle(False)
toggle3 = BooleanToggle(False)

_0_reslux = Slider(5, range=1..25)
_1_resmed = Slider(4, range=1..25)
_3_comhq = Slider(3, range=1..25)
_4_commed = Slider(6, range=1..25)
# CityMatrix CV
_5_rescw = Slider(1, range=1..25)
_2_resmu = Slider(2, range=1..25)

set1 = Button()
set2 = Button()

# ---- group: Density Array - Initial - set1
panel_6 = Panel("""20
10
5
5
5
5
0
0
30""")
panel_7 = Panel("""5
5
5
5
10
20
0
0
15""")

# ----
panel_8 = Panel("""5
5
5
5
5
5
0
0
5""")

# ---- group: Density Array - running - set 2
panel_9 = Panel("""30
30
30
30
30
30
0
0
30""")
panel_10 = Panel("""20
20
20
20
20
20
0
0
20""")
panel_11 = Panel("""10
10
10
10
10
10
0
0
10""")

# ----
load_bitmap = LoadBitmap(FilePathToImageLocation=path_2)

# ---- group: Int Grid X Extent
number_slider_3 = Slider(16, range=1..20)

# ---- group: Int Grid Y Extent
number_slider_4 = Slider(16, range=1..20)

# ---- group: Pts Sample Grid Corner
pt_8 = Point([<point referenced from the Rhino model> x4])

# ---- group: color calibration dock / ref color pop area
crv_2 = Curve(<curve referenced from the Rhino model>)  # disabled

# ---- group: dock position ref pts
# Dock Sampling
pt_9 = Point([<point referenced from the Rhino model> x4])

# ----
pline = PolyLine(Vertices=pt_8, Closed=False)

# ---- group: Sample Toggle
pt_10 = Point(<point referenced from the Rhino model>)

# ---- group: Sample Other
# Decode Slider Value
pt_11 = Point(<point referenced from the Rhino model>)

# ---- group: color ids
int = Integer("0")
int_2 = Integer("1")
int_3 = Integer("2")
int_4 = Integer("3")
int_5 = Integer("4")
# Grid Sampling
int_6 = Integer("5")

# ---- group: slider postion ref lines
# 3 Level Slider Sampling
crv_3 = Curve(reparameterize(graft([<curve referenced from the Rhino model> x5])))

# ---- group: Sample Others
# Decode Slider Value
pt_12 = Point([<point referenced from the Rhino model> x3])

# ---- group: Sample Toggle
pt_13 = Point(<point referenced from the Rhino model>)

# ---- group: Sample Others
pt_14 = Point([<point referenced from the Rhino model> x3])

# ---- group: Color Space Calibration sliders / ref color pop area
crv_4 = Curve([<curve referenced from the Rhino model> x2])  # disabled

# ---- group: Sample Toggle
pt_15 = Point(<point referenced from the Rhino model>)

# ---- group: slider position ref pts
# Slider Sampling
pt_16 = Point([<point referenced from the Rhino model> x2])

# Slider 2 Sampling
pt_17 = Point([<point referenced from the Rhino model> x2])

# ---- group: Color Space Calibration sliders / ref color pop area
crv_5 = Curve(<curve referenced from the Rhino model>)  # disabled

crv_6 = Curve(<curve referenced from the Rhino model>)  # disabled

# ---- group: live feed of webcam
data = Data(video_stream)

# ---- group: toggle 1 position ref pt
pt_18 = Point(<point referenced from the Rhino model>)

# ---- group: Sample Other
pt_19 = Point(<point referenced from the Rhino model>)

# ---- group: Sample Toggle
pt_20 = Point(<point referenced from the Rhino model>)

# ---- group: Color Space Calibration sliders / ref color pop area
crv_7 = Curve(<curve referenced from the Rhino model>)  # disabled

# ----
set1_2 = Integer(panel_6)
set2_2 = Integer(panel_9)
pdecon_8 = Deconstruct(Point=pt_20)  # -> XComponent, YComponent, ZComponent
pdecon_9 = Deconstruct(Point=pt_19)  # -> XComponent, YComponent, ZComponent
split_2 = TextSplit(Text=panel_4, Separators=",")

# ---- group: all color code quarts (with rotation)
panel_12 = Panel("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")

# ----
preview = CustomPreview(Geometry=pline, Shader=ColourSwatch(SwatchColor=RGB(255, 0, 230)))
pdecon_10 = Deconstruct(Point=pt_13)  # -> XComponent, YComponent, ZComponent
pdecon_11 = Deconstruct(Point=pt_12)  # -> XComponent, YComponent, ZComponent
pdecon_12 = Deconstruct(Point=pt_15)  # -> XComponent, YComponent, ZComponent
pdecon_13 = Deconstruct(Point=pt_14)  # -> XComponent, YComponent, ZComponent
merge_2 = Merge(Data1=int, Data2=int_2, Data3=int_3, Data4=int_4, Data5=int_5, Data6=int_6)

# ---- group: manual text city
panel_13 = Panel("""g,g,g,r,g,g,g,g,r,g,g,g,g,r,g,g
g,g,g,r,g,g,g,g,r,g,g,g,g,r,g,g
g,g,g,r,g,g,g,g,r,g,g,g,g,r,g,g
r,r,r,r,r,r,r,r,r,r,r,r,r,r,r,r
g,g,g,r,0,0,0,0,r,1,1,1,2,r,g,g
g,g,g,r,0,g,g,0,r,1,g,g,2,r,g,g
g,g,g,r,0,g,g,0,r,1,g,g,2,r,g,g
g,g,g,r,0,0,0,0,r,1,1,1,2,r,g,g
r,r,r,r,r,r,r,r,r,r,r,r,r,r,r,r
g,g,g,r,3,3,3,3,r,4,4,4,5,r,g,g
g,g,g,r,3,g,g,3,r,4,g,g,5,r,g,g
g,g,g,r,3,g,g,3,r,4,g,g,5,r,g,g
g,g,g,r,3,3,3,3,r,4,4,4,5,r,g,g
r,r,r,r,r,r,r,r,r,r,r,r,r,r,r,r
g,g,g,r,g,g,g,g,r,g,g,g,g,r,g,g
g,g,g,r,g,g,g,g,r,g,g,g,g,r,g,g""")

panel_14 = Panel("""b,r,b,b,b,b,r,b,b,b,b,r,b,b,b,b
r,r,r,r,r,r,r,r,r,r,r,r,r,r,r,r
b,r,b,b,b,b,r,b,b,b,b,r,b,b,b,b
b,r,b,g,g,b,r,b,g,g,b,r,b,g,g,b
b,r,b,g,g,b,r,b,g,g,b,r,b,g,g,b
b,r,b,b,b,b,r,b,b,b,b,r,b,b,b,b
r,r,r,r,r,r,r,r,r,r,r,r,r,r,r,r
b,r,b,b,b,b,r,4,4,4,4,r,3,3,3,3
b,r,b,g,g,b,r,4,g,g,4,r,3,g,g,3
b,r,b,g,g,b,r,4,g,g,4,r,3,g,g,3
b,r,b,b,b,b,r,4,4,4,4,r,3,3,3,3
r,r,r,r,r,r,r,r,r,r,r,r,r,r,r,r
b,r,2,2,2,2,r,1,1,1,1,r,0,0,0,0
b,r,2,g,g,2,r,1,g,g,1,r,0,g,g,0
b,r,2,g,g,2,r,1,g,g,1,r,0,g,g,0
b,r,2,2,2,2,r,1,1,1,1,r,0,0,0,0""")

# ---- group: startFlag
startflag = Button()
panel_15 = Panel(startflag)

# ----
pdecon_14 = Deconstruct(Point=pt_20)  # -> XComponent, YComponent, ZComponent
pdecon_15 = Deconstruct(Point=pt_19)  # -> XComponent, YComponent, ZComponent
frgb_7 = ColourRGBF(Alpha=1, Red=pdecon_8.XComponent, Green=pdecon_8.YComponent, Blue=pdecon_8.ZComponent)
frgb_8 = ColourRGBF(Alpha=1, Red=pdecon_9.XComponent, Green=pdecon_9.YComponent, Blue=pdecon_9.ZComponent)
multiplication = Multiplication(A=number_slider_4, B=2)
merge_3 = Merge(Data1=_0_reslux, Data2=_1_resmed, Data3=_2_resmu, Data4=_3_comhq, Data5=_4_commed, Data6=_5_rescw)
multiplication_2 = Multiplication(A=number_slider_3, B=2)
frgb_9 = ColourRGBF(Alpha=1, Red=pdecon_10.XComponent, Green=pdecon_10.YComponent, Blue=pdecon_10.ZComponent)
frgb_10 = ColourRGBF(Alpha=1, Red=pdecon_11.XComponent, Green=pdecon_11.YComponent, Blue=pdecon_11.ZComponent)
frgb_11 = ColourRGBF(Alpha=1, Red=pdecon_12.XComponent, Green=pdecon_12.YComponent, Blue=pdecon_12.ZComponent)
frgb_12 = ColourRGBF(Alpha=1, Red=pdecon_13.XComponent, Green=pdecon_13.YComponent, Blue=pdecon_13.ZComponent)

# ---- group: All Colors IDs
int_7 = Integer(merge_2)

# ----
frgb_13 = ColourRGBF(Alpha=1, Red=pdecon_14.XComponent, Green=pdecon_14.YComponent, Blue=pdecon_14.ZComponent)
frgb_14 = ColourRGBF(Alpha=1, Red=pdecon_15.XComponent, Green=pdecon_15.YComponent, Blue=pdecon_15.ZComponent)

# ---- group: all rotations reference
txt_3 = Text(split_2)

# ----
merge_4 = Merge(Data1=frgb_7, Data2=frgb_8)

# ---- group: webcam stream
data_2 = Data(data)

bmp = BitmapToModify(data_2)

bmp_2 = BitmapToModify(data_2)

bmp_3 = BitmapToModify(data_2)

bmp_4 = BitmapToModify(data_2)

# Toggle 1
bmp_5 = BitmapToModify(data_2)

# ----
sample = BitmapSampler(BitmapToModify=bmp_5, PointToSample=pt_18, BitmapToModify_2=bmp_5, PointToSample_2=pt_18, bitmap_filter=0)  # -> SampledImageData, SampledImageData_2
sample_2 = BitmapSampler(BitmapToModify=bmp, PointToSample=pt_9, BitmapToModify_2=bmp, PointToSample_2=pt_9, bitmap_filter=0)  # -> SampledImageData, SampledImageData_2
merge_5 = Merge(Data1=frgb_11, Data2=frgb_12)
merge_6 = Merge(Data1=frgb_9, Data2=frgb_10)
col_3 = Colour(sample.SampledImageData_2)
col_4 = Colour(sample_2.SampledImageData_2)
pline_2 = PolyLine(Vertices=pt_16, Closed=False)  # -> reparameterize(Polyline)
pline_3 = PolyLine(Vertices=pt_17, Closed=False)  # -> reparameterize(Polyline)
merge_7 = Merge(Data1=frgb_13, Data2=frgb_14)
perspective = Perspective(pt=pt_8, int_2=multiplication_2, int=multiplication)
panel_16 = Panel(txt_3)

# ---- group: tab
panel_17 = Panel("\t")

# ----
split_3 = TextSplit(Text=panel_12, Separators=panel_17)
divide = DivideCurve(Curve=crv_3, Count=Slider(1, range=1..99), Kinks=False)  # -> Points, Tangents, Parameters
divide_2 = DivideCurve(Curve=pline_2, Count=Slider(14, range=9..99), Kinks=False)  # -> Points, Tangents, Parameters
divide_3 = DivideCurve(Curve=pline_3, Count=Slider(21, range=9..99), Kinks=False)  # -> Points, Tangents, Parameters

# ---- group: All Manual Reference Colors
col_5 = Colour(merge_4)

# ---- group: gridExtent_y
int_8 = Integer(gridextent_y)

# ---- group: floor num for each type
int_9 = Integer(merge_3)

# ---- group: gridExtent_x
int_10 = Integer(gridextent_x)

# ---- group: toggle1
bool = Boolean(toggle1)

# ---- group: toggle2
bool_2 = Boolean(toggle2)

# ---- group: toggle3
bool_3 = Boolean(toggle3)

# ---- group: toggle4
bool_4 = Boolean(toggle4)

# ---- group: All Manual Reference Colors
col_6 = Colour(merge_6)

col_7 = Colour(merge_5)

# ----
preview_2 = CustomPreview(Geometry=pline_2, Shader=ColourSwatch(SwatchColor=RGB(255, 0, 230)))
preview_3 = CustomPreview(Geometry=pline_3, Shader=ColourSwatch(SwatchColor=RGB(255, 0, 230)))
panel_18 = Panel("""r,r,r,r,r,r,r,r,r,r,r,r,r,r,r,r
r,0,0,0,r,0,0,0,r,1,1,1,r,2,2,2
r,0,g,0,r,0,g,0,r,1,e,1,r,2,e,2
r,0,0,0,r,0,0,0,r,1,1,1,r,2,2,2
r,r,r,r,r,r,r,r,r,r,r,r,r,r,r,r
r,0,0,0,r,0,0,0,r,1,1,1,r,2,2,2
r,0,g,0,r,0,g,0,r,1,e,1,r,2,e,2
r,0,0,0,r,0,0,0,r,1,1,1,r,2,2,2
r,r,r,r,9,9,9,9,9,r,r,r,r,r,r,r
r,3,3,3,9,8,8,8,9,4,4,4,r,5,5,5
r,3,e,3,9,8,e,8,9,4,g,4,r,5,g,5
r,3,3,3,9,8,8,8,9,4,4,4,r,5,5,5
r,r,r,r,9,9,9,9,9,r,r,r,r,r,r,r
r,3,3,3,r,3,3,3,r,4,4,4,r,5,5,5
r,3,e,3,r,3,e,3,r,4,g,4,r,5,g,5
r,3,3,3,r,3,3,3,r,4,4,4,r,5,5,5""")

# ---- group: All Manual Reference Colors
col_8 = Colour(merge_7)

# ---- group: manual color space calibration for grid / Sample White
pt_21 = Point(<point referenced from the Rhino model>)

# ---- group: manual color space calibration for grid / Sample Black
pt_22 = Point(<point referenced from the Rhino model>)

# ---- group: manual color space calibration for grid / Sample Yellow
pt_23 = Point(<point referenced from the Rhino model>)

# ---- group: manual color space calibration for grid / Sample Blue
pt_24 = Point(<point referenced from the Rhino model>)  # disabled

# ---- group: manual color space calibration for grid / Sample Green
pt_25 = Point(<point referenced from the Rhino model>)  # disabled

# ---- group: manual color space calibration for grid / Sample Red
pt_26 = Point(<point referenced from the Rhino model>)

# ---- group: all color quarts reference
txt_4 = Text(split_3)

# ----
lng = ListLength(List=txt_4)

# ---- group: Position Calibration / CityMatrix CV Calibration
mesh_12 = MeshFromImage(Bmp=data_2, Sx=Domain(0, 1), Sy=Domain(0, 1), Z=0, C=True)  # disabled

# ----
pdecon_16 = Deconstruct(Point=pt_21)  # -> XComponent, YComponent, ZComponent
pdecon_17 = Deconstruct(Point=pt_22)  # -> XComponent, YComponent, ZComponent
pdecon_18 = Deconstruct(Point=pt_26)  # -> XComponent, YComponent, ZComponent
pdecon_19 = Deconstruct(Point=pt_23)  # -> XComponent, YComponent, ZComponent
pdecon_20 = Deconstruct(Point=pt_24)  # -> XComponent, YComponent, ZComponent
pdecon_21 = Deconstruct(Point=pt_25)  # -> XComponent, YComponent, ZComponent
# Decode Dock ID
cp = ClosestPoint(Point=col_4, Cloud=col_2)  # -> ClosestPoint, CPIndex, Distance

# ---- group: x
series = Series(Start=0, Step=1, Count=number_slider_3)

# ---- group: y
series_2 = Series(Start=0, Step=1, Count=number_slider_4)

# ---- group: slider and toggle ref colors
col_9 = Colour(col_5)

col_10 = Colour(col_6)

col_11 = Colour(col_7)

# ----
division = Division(A=lng, B="4")

# ---- group: webcam stream
bmp_6 = BitmapToModify(data_2)

# ---- group: slider sample pts
pt_27 = Point(divide.Points)

# ----
line = LineSDL(Start=pt_27, Direction=Vector(1, 0, 0), Length=0.005)
frgb_15 = ColourRGBF(Alpha=1, Red=pdecon_16.XComponent, Green=pdecon_16.YComponent, Blue=pdecon_16.ZComponent)
frgb_16 = ColourRGBF(Alpha=1, Red=pdecon_17.XComponent, Green=pdecon_17.YComponent, Blue=pdecon_17.ZComponent)
frgb_17 = ColourRGBF(Alpha=1, Red=pdecon_18.XComponent, Green=pdecon_18.YComponent, Blue=pdecon_18.ZComponent)
frgb_18 = ColourRGBF(Alpha=1, Red=pdecon_19.XComponent, Green=pdecon_19.YComponent, Blue=pdecon_19.ZComponent)
frgb_19 = ColourRGBF(Alpha=1, Red=pdecon_20.XComponent, Green=pdecon_20.YComponent, Blue=pdecon_20.ZComponent)
frgb_20 = ColourRGBF(Alpha=1, Red=pdecon_21.XComponent, Green=pdecon_21.YComponent, Blue=pdecon_21.ZComponent)

# ---- group: slider sample pts
pt_28 = Point(divide_2.Points)

# ----
line_2 = LineSDL(Start=pt_28, Direction=Vector(1, 0, 0), Length=0.005)

# ---- group: slider sample pts
pt_29 = Point(divide_3.Points)

# ----
line_3 = LineSDL(Start=pt_29, Direction=Vector(1, 0, 0), Length=0.005)

# ---- group: slider and toggle ref colors
col_12 = Colour(col_8)

# ----
cp_2 = ClosestPoint(Point=graft(col_3), Cloud=col_12)  # -> ClosestPoint, CPIndex, Distance
pshift = ShiftPaths(Data=cp_2.CPIndex, Offset=-1)

# ---- group: color ID
int_11 = Integer(pshift)

# ----
item = ListItem(List=int_7, Index=cp.CPIndex, Wrap=False)
sample_3 = BitmapSampler(BitmapToModify=bmp_2, PointToSample=pt_27, BitmapToModify_2=bmp_2, PointToSample_2=pt_27, bitmap_filter=0)  # -> SampledImageData, SampledImageData_2
panel_19 = Panel(txt_4)
sample_4 = BitmapSampler(BitmapToModify=bmp_3, PointToSample=pt_28, BitmapToModify_2=bmp_3, PointToSample_2=pt_28, bitmap_filter=0)  # -> SampledImageData, SampledImageData_2
sample_5 = BitmapSampler(BitmapToModify=bmp_4, PointToSample=pt_29, BitmapToModify_2=bmp_4, PointToSample_2=pt_29, bitmap_filter=0)  # -> SampledImageData, SampledImageData_2
multiplication_3 = Multiplication(A=series_2, B=4)
series_3 = Series(Start=0, Step=1, Count=division)
multiplication_4 = Multiplication(A=series, B=2)
merge_8 = Merge(Data1=frgb_15, Data2=frgb_16, Data3=frgb_17, Data4=frgb_18, Data5=frgb_19, Data6=frgb_20)
equals = Equality(FirstNumber=int_11, SecondNumber="0")  # -> Equality, Inequality
panel_20 = Panel("0,3,0,0")

# ---- group: keystoned grid pts
pt_30 = Point(perspective)

# ---- group: color code of each smaple pt
int_12 = Integer(item)

# ----
rev = ReverseList(List=int_12)
txt_5 = Text(rev)
join_2 = TextJoin(Text=txt_5, Join=",")
pshift_2 = ShiftPaths(Data=series_3, Offset=-1)
multiplication_5 = Multiplication(A=division, B="4")
pshift_3 = ShiftPaths(Data=sample_3.SampledImageData_2, Offset=-1)
pshift_4 = ShiftPaths(Data=sample_4.SampledImageData_2, Offset=-1)
pshift_5 = ShiftPaths(Data=sample_5.SampledImageData_2, Offset=-1)
multiplication_6 = Multiplication(A=multiplication_3, B=number_slider_3)
pshift_6 = ShiftPaths(Data=pt_30, Offset=-1)

# ---- group: all sample pts
pt_31 = Point(pshift_6)

# ----
sample_6 = BitmapSampler(BitmapToModify=bmp_6, PointToSample=pt_31, BitmapToModify_2=bmp_6, PointToSample_2=pt_31, bitmap_filter=0)  # -> SampledImageData, SampledImageData_2

# ---- group: All Manual Reference Colors
col_13 = Colour(merge_8)

# ---- group: toggle 1 value
bool_5 = Boolean(equals.Equality)

# ---- group: color code quart text data
txt_6 = Text(join_2)

# ----
panel_21 = Panel(txt_6)

# ---- group: sampled pts color
col_14 = Colour(pshift_3)

# ----
cp_3 = ClosestPoint(Point=graft(col_14), Cloud=col_9)  # -> ClosestPoint, CPIndex, Distance
pshift_7 = ShiftPaths(Data=cp_3.CPIndex, Offset=-1)

# ---- group: color IDs
int_13 = Integer(pshift_7)

# ----
dispatch = Dispatch(List=pt_27, DispatchPattern=int_13)  # -> ListA, ListB
pdecon_22 = Deconstruct(Point=dispatch.ListB)  # -> XComponent, YComponent, ZComponent
lng_2 = ListLength(List=dispatch.ListB)
ma = MassAddition(Input=pdecon_22.XComponent)  # -> Result, PartialResults
ma_2 = MassAddition(Input=pdecon_22.YComponent)  # -> Result, PartialResults
division_2 = Division(A=ma.Result, B=lng_2)
division_3 = Division(A=ma_2.Result, B=lng_2)
pt_32 = ConstructPoint(XCoordinate=division_2, YCoordinate=division_3, ZCoordinate=0)

# ---- group: average slide block pt
pt_33 = Point(pt_32)

# ----
crv_cp = CurveClosestPoint(Point=pt_33, Curve=crv_3)  # -> Point, Parameter, Distance
repeat = RepeatData(Data=pshift_2, Length=multiplication_5)

# ---- group: sampled pts color
col_15 = Colour(pshift_4)

# ----
cp_4 = ClosestPoint(Point=graft(col_15), Cloud=col_10)  # -> ClosestPoint, CPIndex, Distance
pshift_8 = ShiftPaths(Data=cp_4.CPIndex, Offset=-1)

# ---- group: color IDs
int_14 = Integer(pshift_8)

# ----
dispatch_2 = Dispatch(List=pt_28, DispatchPattern=int_14)  # -> ListA, ListB
pdecon_23 = Deconstruct(Point=dispatch_2.ListB)  # -> XComponent, YComponent, ZComponent
lng_3 = ListLength(List=dispatch_2.ListB)
ma_3 = MassAddition(Input=pdecon_23.XComponent)  # -> Result, PartialResults
ma_4 = MassAddition(Input=pdecon_23.YComponent)  # -> Result, PartialResults
division_4 = Division(A=ma_3.Result, B=lng_3)
division_5 = Division(A=ma_4.Result, B=lng_3)
pt_34 = ConstructPoint(XCoordinate=division_4, YCoordinate=division_5, ZCoordinate=0)

# ---- group: average slide block pt
pt_35 = Point(pt_34)

# ----
crv_cp_2 = CurveClosestPoint(Point=pt_35, Curve=pline_2)  # -> Point, Parameter, Distance

# ---- group: sampled pts color
col_16 = Colour(pshift_5)

# ----
# Decode Slider Value
cp_5 = ClosestPoint(Point=graft(col_16), Cloud=col_11)  # -> ClosestPoint, CPIndex, Distance
pshift_9 = ShiftPaths(Data=cp_5.CPIndex, Offset=-1)

# ---- group: color IDs
int_15 = Integer(pshift_9)

# ----
dispatch_3 = Dispatch(List=pt_29, DispatchPattern=int_15)  # -> ListA, ListB
pdecon_24 = Deconstruct(Point=dispatch_3.ListB)  # -> XComponent, YComponent, ZComponent
lng_4 = ListLength(List=dispatch_3.ListB)
ma_5 = MassAddition(Input=pdecon_24.XComponent)  # -> Result, PartialResults
ma_6 = MassAddition(Input=pdecon_24.YComponent)  # -> Result, PartialResults
division_6 = Division(A=ma_5.Result, B=lng_4)
division_7 = Division(A=ma_6.Result, B=lng_4)
pt_36 = ConstructPoint(XCoordinate=division_6, YCoordinate=division_7, ZCoordinate=0)

# ---- group: average slide block pt
pt_37 = Point(pt_36)

# ----
crv_cp_3 = CurveClosestPoint(Point=pt_37, Curve=pline_3)  # -> Point, Parameter, Distance
addition = Addition(A=multiplication_4, B=graft(multiplication_6))

# ---- group: module id data (manual)
txt_7 = Text(panel_14)

# ----
pshift_10 = ShiftPaths(Data=crv_cp.Parameter, Offset=-1)
pshift_11 = ShiftPaths(Data=crv_cp_2.Parameter, Offset=-1)
pshift_12 = ShiftPaths(Data=crv_cp_3.Parameter, Offset=-1)
pshift_13 = ShiftPaths(Data=repeat, Offset=-1)

# ---- group: all color quart ids reference
int_16 = Integer(pshift_13)

# ---- group: all sample color
col_17 = Colour(sample_6.SampledImageData_2)

# ----
pshift_14 = ShiftPaths(Data=addition, Offset=-1)

# ---- group: all ref colors
col_18 = Colour(col_13)

# ----
multiplication_7 = Multiplication(A=set2, B=2)
multiplication_8 = Multiplication(A=number_slider_3, B=2)
keysearch = KeyValueSearch(Keys=txt_4, Values=panel_16, Search=graft(txt_6))
keysearch_2 = KeyValueSearch(Keys=txt_4, Values=int_16, Search=graft(txt_6))
item_2 = ListItem(List=col_9, Index=int_13, Wrap=True)
panel_22 = Panel(int_16)
item_3 = ListItem(List=col_10, Index=int_14, Wrap=True)
item_4 = ListItem(List=col_11, Index=int_15, Wrap=True)
addition_2 = Addition(A=set1, B=multiplication_7)

# ---- group: slider read 0-1
num = Number(pshift_10)

# ----
panel_23 = Panel(num)

# ---- group: slider read 0-1
num_2 = Number(pshift_11)

# ----
panel_24 = Panel(num_2)

# ---- group: slider read 0-1
num_3 = Number(pshift_12)

# ----
panel_25 = Panel(num_3)
addition_3 = Addition(A=pshift_14, B=multiplication_8)
preview_4 = CustomPreview(Geometry=pt_27, Shader=item_2)
addition_4 = Addition(A=pshift_14, B=1)
preview_5 = CustomPreview(Geometry=pt_28, Shader=item_3)
preview_6 = CustomPreview(Geometry=pt_29, Shader=item_4)
nullrep = ReplaceNulls(Items=keysearch, Replacements="0")  # -> Items, Count
nullrep_2 = ReplaceNulls(Items=num, Replacements=0)  # -> Items, Count
nullrep_3 = ReplaceNulls(Items=keysearch_2, Replacements="-1")  # -> Items, Count
nullrep_4 = ReplaceNulls(Items=num_2, Replacements=0)  # -> Items, Count
nullrep_5 = ReplaceNulls(Items=num_3, Replacements=0)  # -> Items, Count
panel_26 = Panel(addition_2)

# ---- group: Color Space Calibration sliders / all ref colors
col_19 = Colour(col_12)  # disabled

# ----
panel_27 = Panel("""2
1
1
1
1
1""")
addition_5 = Addition(A=addition_3, B=1)
pshift_15 = ShiftPaths(Data=nullrep_2.Items, Offset=-1)
item_5 = ListItem(List=pshift_15, Index=2, Wrap=False)
item_6 = ListItem(List=pshift_15, Index=3, Wrap=False)
item_7 = ListItem(List=pshift_15, Index=0, Wrap=False)
item_8 = ListItem(List=pshift_15, Index=1, Wrap=False)
item_9 = ListItem(List=pshift_15, Index=4, Wrap=False)

# ---- group: max id
int_17 = Integer("9")

# ----
replace = ReplaceMembers(Set=nullrep_3.Items, Find="6", Replace="-1")
replace_2 = ReplaceMembers(Set=replace, Find="7", Replace="-1")

# ---- group: slider1
num_4 = Number(nullrep_4.Items)

# ---- group: slider2
num_5 = Number(nullrep_5.Items)

# ---- group: 3LevelSlider1
num_6 = Number(item_7)

# ---- group: 3LevelSlider2
num_7 = Number(item_8)

# ---- group: 3LevelSlider3
num_8 = Number(item_5)

# ---- group: 3LevelSlider4
num_9 = Number(item_6)

# ---- group: 3LevelSlider5
num_10 = Number(item_9)

# ----
cp_6 = ClosestPoint(Point=col_17, Cloud=col_18)  # -> ClosestPoint, CPIndex, Distance
pshift_16 = ShiftPaths(Data=nullrep.Items, Offset=-1)
set1_3 = Integer(set1_2)
set2_3 = Integer(set2_2)
replace_3 = ReplaceMembers(Set=replace_2, Find="9", Replace="-1")

# ---- group: set number
integer = Integer(panel_26)

# ----
pshift_17 = ShiftPaths(Data=replace_3, Offset=-1)

# ---- group: Color Space Calibration sliders / all ref colors
col_20 = Colour(col_9)  # disabled

# ---- group: max id
int_18 = Integer("9")

# ----
panel_28 = Panel("""1
1
1
1
1
1""")

# ---- group: Color Space Calibration sliders / all ref colors
col_21 = Colour(col_11)  # disabled

# ---- group: all sample color
col_22 = Colour(sample_6.SampledImageData_2)  # disabled

# ---- group: all ref colors
col_23 = Colour(col_18)  # disabled

# ---- group: Color Space Calibration sliders / all ref colors
col_24 = Colour(col_10)  # disabled

# ----
item_10 = ListItem(List=int_7, Index=cp_6.CPIndex, Wrap=False)
panel_29 = Panel("""10
10
10
10
10
10""")

# ---- group: color calibration dock / all ref colors
col_25 = Colour(col_2)  # disabled

# ---- group: dock id
int_19 = Integer(pshift_17)

# ---- group: dock rotation
int_20 = Integer("0")

# ---- group: color code of each smaple pt
int_21 = Integer(item_10)

# ----
panel_30 = Panel("""15
15
15
15
15
15""")

# ---- group: sample pts
item_11 = ListItem(List=pt_31, Index=addition_3, Wrap=False)
item_12 = ListItem(List=pt_31, Index=pshift_14, Wrap=False)
item_13 = ListItem(List=pt_31, Index=addition_5, Wrap=False)
item_14 = ListItem(List=pt_31, Index=addition_4, Wrap=False)

# ----
repeat_2 = RepeatData(Data=Slider(0, range=0..360), Length=256)

# ---- group: Color Space Calibration sliders / all ref colors
col_26 = Colour(col_21)  # disabled

# ----
panel_31 = Panel("""30
30
30
30
30
30""")

# ---- group: all 0
pshift_18 = ShiftPaths(Data=repeat_2, Offset=-1)

# ----
panel_32 = Panel("""29
30
30
30
30
30""")

# ---- group: color calibration dock / all ref colors
col_27 = Colour(col_25)  # disabled

# ---- group: floor height
panel_33 = Panel("3.5")

# ---- group: x
int_22 = Integer([0, 1, 2, 3, 4, 5, 6, 7, 8, 9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])

# ---- group: y
int_23 = Integer([0, 0, 0, 0, 0, 0, 0, 0, 0, 0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])

# ---- group: rotation
int_24 = Integer(pshift_18)

# ----
panel_34 = Panel(int_22)
panel_35 = Panel(int_23)
panel_36 = Panel(int_24)

# ---- group: color codes
item_15 = ListItem(List=int_21, Index=pshift_14, Wrap=False)
item_16 = ListItem(List=int_21, Index=addition_3, Wrap=False)
item_17 = ListItem(List=int_21, Index=addition_5, Wrap=False)
item_18 = ListItem(List=int_21, Index=addition_4, Wrap=False)

# ----
# Densities
# Initial
panel_37 = Panel("""10
25
5
15
5
5""")
nullrep_6 = ReplaceNulls(Items=int_20, Replacements=0)  # -> Items, Count
nullrep_7 = ReplaceNulls(Items=bool_5, Replacements=False)  # -> Items, Count

# ---- group: 3LevelSlider5
num_11 = Number(num_10)

# ---- group: 3LevelSlider4
num_12 = Number(num_9)

# ---- group: 3LevelSlider3
num_13 = Number(num_8)

# ---- group: 3LevelSlider1
num_14 = Number(num_6)

# ---- group: 3LevelSlider2
num_15 = Number(num_7)

# ----
merge_9 = Merge(Data1=graft(item_15), Data2=graft(item_16), Data3=graft(item_17), Data4=graft(item_18))

# ---- group: color code quarts
int_25 = Integer(merge_9)

# ----
rev_2 = ReverseList(List=int_25)
txt_8 = Text(rev_2)
join_3 = TextJoin(Text=txt_8, Join=",")
pshift_19 = ShiftPaths(Data=join_3, Offset=-1)

# ---- group: color code quart texts data
txt_9 = Text(pshift_19)

# ----
panel_38 = Panel(txt_9)
keysearch_3 = KeyValueSearch(Keys=txt_4, Values=panel_16, Search=graft(txt_9))
nullrep_8 = ReplaceNulls(Items=keysearch_3, Replacements="0")  # -> Items, Count
keysearch_4 = KeyValueSearch(Keys=txt_4, Values=int_16, Search=graft(txt_9))
pshift_20 = ShiftPaths(Data=nullrep_8.Items, Offset=-1)
nullrep_9 = ReplaceNulls(Items=keysearch_4, Replacements="-1")  # -> Items, Count
pshift_21 = ShiftPaths(Data=pshift_20, Offset=-1)
pshift_22 = ShiftPaths(Data=nullrep_9.Items, Offset=-1)
pshift_23 = ShiftPaths(Data=pshift_22, Offset=-1)

# ---- group: all rotation data
int_26 = Integer(pshift_21)

# ---- group: all piece ids raw
int_27 = Integer(pshift_23)

# ----
limitmaxid = LimitMaxID(int_2=int_27, int=int_17)

# ---- group: all piece ids
int_28 = Integer(limitmaxid)

# ---- group: rotation
int_29 = Integer(int_26)

# ----
panel_39 = Panel(int_28)

# ---- group: module id (CV)
int_30 = Integer(int_28)

# ----
panel_40 = Panel(int_30)
nullrep_10 = ReplaceNulls(Items=int_19, Replacements=-1)  # -> Items, Count
nullrep_11 = ReplaceNulls(Items=num_4, Replacements=0)  # -> Items, Count

# ---- group: dock rotation
int_31 = Integer(nullrep_6.Items)

# ---- group: scale control
num_16 = Number(1000)
division_8 = Division(A=list, B=num_16)

# ----
panel_41 = Panel("""r,r,r,r,r,r,r,r,r,r,r,r,r,r,r,r
r,0,0,0,r,0,0,0,r,1,1,1,r,2,2,2
r,0,g,0,r,0,g,0,r,1,e,1,r,2,e,2
r,0,0,0,r,0,0,0,r,1,1,1,r,2,2,2
r,r,r,r,r,r,r,r,r,r,r,r,r,r,r,r
r,0,0,0,r,0,0,0,r,1,1,1,r,2,2,2
r,0,g,0,r,0,g,0,r,1,e,1,r,2,e,2
r,0,0,0,r,0,0,0,r,1,1,1,r,2,2,2
r,r,r,r,r,r,r,r,r,r,r,r,r,r,r,r
r,3,3,3,r,3,3,3,r,4,4,4,r,5,5,5
r,3,e,3,r,3,e,3,r,4,g,4,r,5,g,5
r,3,3,3,r,3,3,3,r,4,4,4,r,5,5,5
r,r,r,r,r,r,r,r,r,r,r,r,r,r,r,r
r,3,3,3,r,3,3,3,r,4,4,4,r,5,5,5
r,3,e,3,r,3,e,3,r,4,g,4,r,5,g,5
r,3,3,3,r,3,3,3,r,4,4,4,r,5,5,5""")
panel_42 = Panel("""b,r,b,b,b,b,r,b,b,b,b,r,b,b,b,b
r,r,r,r,r,r,r,r,r,r,r,r,r,r,r,r
b,r,b,b,b,b,r,b,b,b,b,r,b,b,b,b
b,r,b,g,g,b,r,b,g,g,b,r,b,g,g,b
b,r,b,g,g,b,r,b,g,g,b,r,b,g,g,b
b,r,b,b,b,b,r,b,b,b,b,r,b,b,b,b
r,r,r,r,r,r,r,r,r,r,r,r,r,r,r,r
b,r,b,b,b,b,r,4,4,4,4,r,3,3,3,3
b,r,b,g,g,b,r,4,g,g,4,r,3,g,g,3
b,r,b,g,g,b,r,4,g,g,4,r,3,g,g,3
b,r,b,b,b,b,r,4,4,4,4,r,3,3,3,3
r,r,r,r,r,r,r,r,r,r,r,r,r,r,r,r
b,r,2,2,2,2,r,1,1,1,1,r,0,0,0,0
b,r,2,g,g,2,r,1,g,g,1,r,0,g,g,0
b,r,2,g,g,2,r,1,g,g,1,r,0,g,g,0
b,r,2,2,2,2,r,1,1,1,1,r,0,0,0,0""")
# Building Heights
panel_43 = Panel("""8,8,9,9,g,g,g,g,0,0,1,2,3,3,4,5
e,e,e,e,g,g,g,g,0,0,1,2,3,3,4,5
e,e,e,e,g,g,g,g,0,0,1,2,3,3,4,5
e,e,e,e,g,g,g,g,0,0,1,2,3,3,4,5
0,0,1,2,3,3,4,5,e,e,e,e,g,g,g,g
0,0,1,2,3,3,4,5,e,e,e,e,g,g,g,g
0,0,1,2,3,3,4,5,e,e,e,e,g,g,g,g
0,0,1,2,3,3,4,5,e,e,e,e,g,g,g,g
e,e,e,e,g,g,g,g,0,0,1,2,3,3,4,5
e,e,e,e,g,g,g,g,0,0,1,2,3,3,4,5
e,e,e,e,g,g,g,g,0,0,1,2,3,3,4,5
e,e,e,e,g,g,g,g,0,0,1,2,3,3,4,5
0,0,1,2,3,3,4,5,e,e,e,e,g,g,g,g
0,0,1,2,3,3,4,5,e,e,e,e,g,g,g,g
0,0,1,2,3,3,4,5,e,e,e,e,g,g,g,g
0,0,1,2,3,3,4,5,e,e,e,e,g,g,g,g""")
python = PythonScript(opt=division_8, grid_s=panel_18, grid_r=panel_42, grid_l=panel_43)  # -> out, grid
# ---------- python: Python ----------
if opt > 1:
    grid = grid_l
elif opt < 1:
    grid = grid_s
else:
    grid = grid_r
# ---------- end python ----------

# ---- group: manual text city
panel_44 = Panel(python.grid)

# ---- group: module id data (manual)
txt_10 = Text(panel_44)

# ----
rep = ReplaceText(Text=txt_10, Find="e", Replace="-1", RecursiveReplace=False)
rep_2 = ReplaceText(Text=rep, Find="r", Replace="6", RecursiveReplace=False)
rep_3 = ReplaceText(Text=rep_2, Find="g", Replace="7", RecursiveReplace=False)
rep_4 = ReplaceText(Text=rep_3, Find="b", Replace="0", RecursiveReplace=False)
panel_45 = Panel(rep_4)

# ---- group: module id data
txt_11 = Text(rep_4)

# ----
split_4 = TextSplit(Text=txt_11)
cull = CullPattern(List=split_4, CullPattern=[True, False])
join_4 = TextJoin(Text=cull, Join=",")
split_5 = TextSplit(Text=join_4, Separators=",")
pshift_24 = ShiftPaths(Data=split_5, Offset=-2)

# ---- group: all piece ids raw
int_32 = Integer(pshift_24)

# ----
limitmaxid_2 = LimitMaxID(int_2=int_32, int=int_18)

# ---- group: module id (manual)
# Grid Base Data
int_33 = Integer(limitmaxid_2)

# ----
panel_46 = Panel(int_33)
nullrep_12 = ReplaceNulls(Items=num_5, Replacements=0)  # -> Items, Count
# CityMatrix
# 
# "Ryan" Yan Zhang <ryanz@mit.edu>
# MIT Media Lab, Changing Place Group
# September. 2016
# Densities
# Running
panel_47 = Panel("""30
1
1
1
1
1""")

# ---- group: module id (CV partial masked to manual)
int_34 = Integer(int_30)

# ---- group: module id (manual)
int_35 = Integer(int_33)

# ---- group: module id (CV)
int_36 = Integer(int_30)

# ---- group: toggle1
bool_6 = Boolean(nullrep_7.Items)

# ---- group: temp overide
panel_48 = Panel("1.0")

# ---- group: dockID
int_37 = Integer(nullrep_10.Items)

# ---- group: slider1
num_17 = Number(nullrep_11.Items)

# ---- group: slider2
num_18 = Number(nullrep_12.Items)

# ----
filter = StreamFilter(Gate=list_2, Stream0="1.0", Stream1=num_11)
filter_2 = StreamFilter(Gate=list_2, Stream0="1.0", Stream1=num_12)
filter_3 = StreamFilter(Gate=list_2, Stream0="1.0", Stream1=num_13)
filter_4 = StreamFilter(Gate=list_2, Stream0="1.0", Stream1=num_15)
filter_5 = StreamFilter(Gate=list_2, Stream0="1.0", Stream1=num_14)
filter_6 = StreamFilter(Gate=list_2, Stream0="0", Stream1=int_31)
filter_7 = StreamFilter(Gate=list_2, Stream0=Toggle(True), Stream1=bool_6)
filter_8 = StreamFilter(Gate=list_2, Stream0=int_35, Stream1=int_36)
filter_9 = StreamFilter(Gate=list_2, Stream0=slider1, Stream1=num_17)
filter_10 = StreamFilter(Gate=list_2, Stream0="-1", Stream1=int_37)
filter_11 = StreamFilter(Gate=list_2, Stream0=slider2, Stream1=num_18)

# ---- group: gridExtent_x
int_38 = Integer(int_10)

# ---- group: gridExtent_y
int_39 = Integer(int_8)

# ---- group: module id
int_40 = Integer(filter_8)

# ---- group: x
int_41 = Integer(int_22)

# ---- group: y
int_42 = Integer(int_23)

# ---- group: rotation
int_43 = Integer(int_24)

# ---- group: slider2
num_19 = Number(filter_11)

# ---- group: dockID
int_44 = Integer(filter_10)

int_45 = Integer(int_44)

# ---- group: toggle1
bool_7 = Boolean(panel_48)

# ---- group: slider1
num_20 = Number(filter_9)

num_21 = Number(num_20)

# ----
record_density_slider_set = RecordDensitySliderSet(int=int_45, num=num_21, integer=integer, set1=set1_3, set2=set2_3)

# ---- group: floor num for each type
int_46 = Integer(record_density_slider_set)

# ----
panel_49 = Panel(int_46)

multiplication_9 = Multiplication(A=int_46, B=panel_33)

# ---- group: building height for each type
num_22 = Number(multiplication_9)

# ----
nullrep_13 = ReplaceNulls(Items=int_46, Replacements=1)  # -> Items, Count

# ---- group: floor num for each type
int_47 = Integer(nullrep_13.Items)

# ---- group: dock rotation
int_48 = Integer(filter_6)

# ---- group: 3LevelSlider3
num_23 = Number(panel_48)

# ---- group: 3LevelSlider4
num_24 = Number(panel_48)

# ---- group: 3LevelSlider1
num_25 = Number(panel_48)

# ---- group: 3LevelSlider2
num_26 = Number(panel_48)

# ---- group: 3LevelSlider5
num_27 = Number(panel_48)

# ----
_3levelsliderstoweights_py = PythonScript(s0=num_25, s1=num_26, s2=num_23, s3=num_24, s4=num_27)  # -> out, weights
# ---------- _3levelsliderstoweights_py: Python ----------
if s0==0.0 and s1==0.0 and s2==0.0 and s3==0.0 and s4==0.0:
    weights = [0.0, 0.0, 0.0, 0.0, 0.0]
else:
    ts = [s0, s1, s2, s3, s4]
    tTotal = 0.0
    for t in ts:
        tTotal = tTotal + t
    print 'tTotal = ' + str(tTotal)
    weights = list(map(lambda x: x/tTotal, ts))
    print 'weights = ' + str(weights)
# ---------- end _3levelsliderstoweights_py ----------

# ---- group: toggle3
bool_8 = Boolean(bool_3)

# ---- group: toggle2
bool_9 = Boolean(bool_2)

# ---- group: toggle4
bool_10 = Boolean(bool_4)

# ----
togglestoweights_py = PythonScript()  # -> out, a, weights; disabled
# ---------- togglestoweights_py: Python ----------
if not bool0 and not bool1 and not bool2 and not bool3 and not bool4:
    weights = [0.0, 0.0, 0.0, 0.0, 0.0]
else:
    bools = [bool0, bool1, bool2, bool3, bool4]
    ts = list(map(lambda x: float(x), bools))
    tTotal = 0.0
    for t in ts:
        tTotal = tTotal + t
    print 'tTotal = ' + str(tTotal)
    weights = list(map(lambda x: x/tTotal, ts))
    print 'weights = ' + str(weights)
# ---------- end togglestoweights_py ----------
pshift_25 = ShiftPaths(Data=_3levelsliderstoweights_py.weights, Offset=-1)

# ---- group: AI weights
num_28 = Number(pshift_25)

# ----
panel_50 = Panel(num_28)

# ---- group: module id
int_49 = Integer(int_40)

# ---- group: Toggle 1
# AI Step Control
bool_11 = Boolean(bool_7)

# ---- group: works, no memory leak
initsticky_py = PythonScript()  # -> out, a
# ---------- initsticky_py: Python ----------
import scriptcontext as sc
import time

sc.sticky["count"] = -1
sc.sticky["bool"] = False

print(time.time())
sc.sticky["prevTime"] = time.time()


a = True
# ---------- end initsticky_py ----------
stickycount_py = PythonScript(x=bool_11, push=pushtempstep, tempStep=aisteptest, initiated=initsticky_py.a)  # -> out, a; inputs push: Boolean, tempStep: Int32
# ---------- stickycount_py: Python ----------
import scriptcontext as sc
import time

if initiated and not x == sc.sticky["bool"] :
    if time.time() - sc.sticky["prevTime"] >= 0.5 :
        sc.sticky["count"] = sc.sticky["count"] + 1
    sc.sticky["prevTime"] = time.time()

if push:
    print(push)
    sc.sticky["count"] = tempStep

sc.sticky["bool"] = x

print(sc.sticky["count"])
print(sc.sticky["prevTime"])
print(sc.sticky["bool"])
print(time.time())

a = sc.sticky["count"]
# ---------- end stickycount_py ----------

# ---- group: floor num for each type
int_50 = Integer(int_46)

# Human Interation @ Lego - Outside
int_51 = Integer(int_46)  # disabled

# ----
number_slider_5 = Slider(17, range=0..100)  # disabled
number_slider_6 = Slider(0, range=0..10)  # disabled
number_slider_7 = Slider(0, range=-30..0)  # disabled
number_slider_8 = Slider(5.1, range=0..10)  # disabled
# mid
number_slider_9 = Slider(55, range=0..100)  # disabled
number_slider_10 = Slider(51, range=0..100)  # disabled
number_slider_11 = Slider(46, range=0..100)  # disabled
# old
number_slider_12 = Slider(23, range=0..100)  # disabled
number_slider_13 = Slider(69, range=0..100)  # disabled
equals_2 = Equality(FirstNumber=int_49, SecondNumber="0")  # -> Equality, Inequality
equals_3 = Equality(FirstNumber=int_49, SecondNumber="1")  # -> Equality, Inequality
equals_4 = Equality(FirstNumber=int_49, SecondNumber="3")  # -> Equality, Inequality
equals_5 = Equality(FirstNumber=int_49, SecondNumber="2")  # -> Equality, Inequality
equals_6 = Equality(FirstNumber=int_49, SecondNumber="4")  # -> Equality, Inequality
equals_7 = Equality(FirstNumber=int_49, SecondNumber="5")  # -> Equality, Inequality
equals_8 = Equality(FirstNumber=int_49, SecondNumber="8")  # -> Equality, Inequality
# Dashboard
number_slider_14 = Slider(0.4, range=0..1)
# young
number_slider_15 = Slider(200, range=0..500)  # disabled
number_slider_16 = Slider(120, range=0..500)  # disabled
number_slider_17 = Slider(75, range=0..500)  # disabled
item_19 = ListItem(List=int_50, Index="0", Wrap=False)
item_20 = ListItem(List=int_50, Index="2", Wrap=False)
item_21 = ListItem(List=int_50, Index="1", Wrap=False)
item_22 = ListItem(List=int_50, Index="3", Wrap=False)
item_23 = ListItem(List=int_50, Index="8", Wrap=False)
item_24 = ListItem(List=int_50, Index="4", Wrap=False)
item_25 = ListItem(List=int_50, Index="5", Wrap=False)

# ---- group: ppl per flr
# id5
# id3
# id4
# id0
# id2
# id1
# young
# mid
# old
panel_51 = Panel("0")  # disabled
panel_52 = Panel("0")  # disabled
panel_53 = Panel("18")  # disabled
panel_54 = Panel("0")  # disabled
panel_55 = Panel("28")  # disabled
panel_56 = Panel("0")  # disabled
panel_57 = Panel("63")  # disabled
panel_58 = Panel("0")  # disabled
panel_59 = Panel("0")  # disabled
panel_60 = Panel("0")  # disabled
panel_61 = Panel("0")  # disabled
panel_62 = Panel("52")  # disabled
panel_63 = Panel("87")  # disabled
panel_64 = Panel("0")  # disabled
panel_65 = Panel("0")  # disabled
panel_66 = Panel("156")  # disabled
panel_67 = Panel("0")  # disabled
panel_68 = Panel("0")  # disabled
num_29 = Number([panel_51, panel_54, panel_60, panel_64])  # disabled
num_30 = Number([panel_52, panel_58, panel_61, panel_67])  # disabled
num_31 = Number([panel_56, panel_59, panel_65, panel_68])  # disabled

# ----
int_52 = Integer(equals_2.Equality)
int_53 = Integer(equals_3.Equality)
int_54 = Integer(equals_4.Equality)
int_55 = Integer(equals_5.Equality)
int_56 = Integer(equals_6.Equality)
int_57 = Integer(equals_7.Equality)
int_58 = Integer(equals_8.Equality)
min = Minimum(A=stickycount_py.a, B="24")
ma_7 = MassAddition(Input=int_52)  # -> Result, PartialResults
ma_8 = MassAddition(Input=int_53)  # -> Result, PartialResults
ma_9 = MassAddition(Input=int_54)  # -> Result, PartialResults
ma_10 = MassAddition(Input=int_55)  # -> Result, PartialResults
ma_11 = MassAddition(Input=int_56)  # -> Result, PartialResults

# ---- group: building id 0 fl #
int_59 = Integer(item_19)

# ---- group: building id 2 fl #
int_60 = Integer(item_20)

# ---- group: building id 1 fl #
int_61 = Integer(item_21)

# ----
ma_12 = MassAddition(Input=int_57)  # -> Result, PartialResults

# ---- group: building id 3 fl #
int_62 = Integer(item_22)

# ----
ma_13 = MassAddition(Input=int_58)  # -> Result, PartialResults
pt_38 = ConstructPoint(XCoordinate=number_slider_6, YCoordinate=number_slider_7, ZCoordinate=number_slider_8)  # disabled

# ---- group: building id 4 fl #
int_63 = Integer(item_24)

# ---- group: building id 5 fl #
int_64 = Integer(item_25)

# ---- group: building id 8 fl #
int_65 = Integer(item_23)

# ---- group: AI Step (manual)
int_66 = Integer(aisteptest)

# ----
panel_69 = Panel(int_66)

# ---- group: AI Step (CV)
int_67 = Integer(min)

# ----
panel_70 = Panel(int_67)

# ---- group: range
B = DomainEnd(number_slider_15)  # disabled

# ----
int_68 = Integer(ma_7.Result)
panel_71 = Panel(int_68)
int_69 = Integer(ma_8.Result)
panel_72 = Panel(int_69)
int_70 = Integer(ma_9.Result)
panel_73 = Panel(int_70)
int_71 = Integer(ma_10.Result)
panel_74 = Panel(int_71)
int_72 = Integer(ma_13.Result)
panel_75 = Panel(int_72)
filter_12 = StreamFilter(Gate=list_2, Stream0=int_66, Stream1=int_67)
int_73 = Integer(ma_11.Result)
panel_76 = Panel(int_73)

# ---- group: range
B_2 = DomainEnd(number_slider_16)  # disabled

B_3 = DomainEnd(number_slider_17)  # disabled

# ----
int_74 = Integer(ma_12.Result)
panel_77 = Panel(int_74)
xy = XYPlane(Origin=pt_38)  # disabled

# ---- group: AI Step
int_75 = Integer(filter_12)

# ----
panel_78 = Panel(int_75)
dom = ConstructDomain(DomainStart=0, DomainEnd=B)  # disabled
dom_2 = ConstructDomain(DomainStart=0, DomainEnd=B_2)  # disabled
dom_3 = ConstructDomain(DomainStart=0, DomainEnd=B_3)  # disabled

# ---- group: Micro-unit Building #
int_76 = Integer(int_71)

# ---- group: Luxury Building #
int_77 = Integer(int_68)

# ---- group: Regular residential Building #
int_78 = Integer(int_69)

# ---- group: Head Quater Building #
int_79 = Integer(int_70)

# ---- group: Regular Office Building #
int_80 = Integer(int_73)

# ---- group: Co-working Building #
int_81 = Integer(int_74)

# ---- group: Clean Ind Building #
int_82 = Integer(int_72)

# ---- group: scale increase in area
sqr = Square(Value=division_8)

# ---- group: parking cell #
parking_cell = Slider(0, range=0..50)

# ---- group: AI Step from Python Server
int_83 = Integer(int_75)

# ----
panel_79 = Panel(int_83)

# ---- group: multipe for ppls
number_slider_18 = Slider(0.2, range=-0.01..2)  # disabled

# ----
multiplication_10 = Multiplication(A=num_29, B=number_slider_18)  # disabled
multiplication_11 = Multiplication(A=num_30, B=number_slider_18)  # disabled
multiplication_12 = Multiplication(A=num_31, B=number_slider_18)  # disabled
num_32 = Number(multiplication_10)  # disabled
num_33 = Number(multiplication_11)  # disabled
num_34 = Number(multiplication_12)  # disabled

# ---- group: AI Step
int_84 = Integer(int_83)

# ----
panel_80 = Panel(int_84)

# ---- group: park cell #
park_cell = Slider(150, range=0..150)

# ----
multiplication_13 = Multiplication(A="18", B=sqr)
multiplication_14 = Multiplication(A="63", B=sqr)
multiplication_15 = Multiplication(A="52", B=sqr)
multiplication_16 = Multiplication(A="156", B=sqr)
multiplication_17 = Multiplication(A="28", B=sqr)
multiplication_18 = Multiplication(A="87", B=sqr)
multiplication_19 = Multiplication(A="87", B=sqr)
round = Round(Number=multiplication_14)  # -> Nearest, Floor, Ceiling
round_2 = Round(Number=multiplication_15)  # -> Nearest, Floor, Ceiling
round_3 = Round(Number=multiplication_16)  # -> Nearest, Floor, Ceiling
round_4 = Round(Number=multiplication_18)  # -> Nearest, Floor, Ceiling
round_5 = Round(Number=multiplication_19)  # -> Nearest, Floor, Ceiling
panel_81 = Panel(round_5.Nearest)
round_6 = Round(Number=multiplication_13)  # -> Nearest, Floor, Ceiling
round_7 = Round(Number=multiplication_17)  # -> Nearest, Floor, Ceiling

# ---- group: ppl per flr
panel_82 = Panel(round_6.Nearest)
panel_83 = Panel(round_7.Nearest)
panel_84 = Panel(round.Nearest)
panel_85 = Panel(round_2.Nearest)
panel_86 = Panel(round_4.Nearest)
panel_87 = Panel(round_3.Nearest)

# ---- group: reduce ratio
number_slider_19 = Slider(0, range=0..1)  # disabled

# ----
number_slider_20 = Slider(52, range=0..100)  # disabled
number_slider_21 = Slider(0.2, range=0..1)  # disabled
number_slider_22 = Slider(59, range=0..100)  # disabled
number_slider_23 = Slider(0.2, range=0..1)  # disabled
number_slider_24 = Slider(72, range=0..100)  # disabled
number_slider_25 = Slider(0.2, range=0..1)  # disabled
merge_10 = Merge(
    Data1=panel_82,
    Data2=panel_83,
    Data3=panel_84,
    Data4=panel_85,
    Data5=panel_86,
    Data6=panel_87,
    Data7=panel_81,
    Data8=panel_81,
    Data9=panel_81)

# ---- group: how many floors in total
multiplication_20 = Multiplication(A=int_63, B=int_80)
multiplication_21 = Multiplication(A=int_61, B=int_78)
multiplication_22 = Multiplication(A=int_64, B=int_81)
multiplication_23 = Multiplication(A=int_60, B=int_76)
multiplication_24 = Multiplication(A=int_59, B=int_77)
multiplication_25 = Multiplication(A=int_62, B=int_79)

# ----
multiplication_26 = Multiplication(A=int_65, B=int_82)
multiplication_27 = Multiplication(A=panel_86, B=multiplication_20)
multiplication_28 = Multiplication(A=panel_83, B=multiplication_21)
multiplication_29 = Multiplication(A=panel_84, B=multiplication_23)
multiplication_30 = Multiplication(A=panel_87, B=multiplication_22)
multiplication_31 = Multiplication(A=panel_81, B=multiplication_26)
multiplication_32 = Multiplication(A=panel_82, B=multiplication_24)
multiplication_33 = Multiplication(A=panel_85, B=multiplication_25)
mid_mid_career = ColourSwatch(SwatchColor=RGB(255, 208, 0))  # disabled

# ---- group: # ppl per flr
num_35 = Number(merge_10)

# ----
mln_young = ColourSwatch(SwatchColor=RGB(0, 166, 255))  # disabled
exc_elderly = ColourSwatch(SwatchColor=RGB(255, 0, 0))  # disabled

# ---- group: Regular Office ppl #
int_85 = Integer(multiplication_27)

# ---- group: dot shape
number_slider_26 = Slider(9, range=0..10)  # disabled
number_slider_27 = Slider(3, range=0..10)  # disabled
polygon = Polygon(Plane=PlaneXY(0, 0, 0), Radius=number_slider_27, Segments=number_slider_26, FilletRadius=0)  # -> Polygon, Length; disabled
boundary = BoundarySurfaces(Edges=polygon.Polygon)  # disabled
mesh_13 = Mesh(boundary)  # disabled

# ----
mesh_14 = Mesh(mesh_13)  # disabled
mesh_15 = Mesh(mesh_13)  # disabled
mesh_16 = Mesh(mesh_13)  # disabled

# ---- group: Head Quater ppl #
int_86 = Integer(multiplication_33)

# ---- group: Co-working ppl #
int_87 = Integer(multiplication_30)

# ---- group: Micro-unit ppl #
int_88 = Integer(multiplication_29)

# ---- group: Luxury ppl #
int_89 = Integer(multiplication_32)

# ---- group: Regular residential ppl #
int_90 = Integer(multiplication_28)

# ---- group: CleanInd ppl #
int_91 = Integer(multiplication_31)

# ----
panel_88 = Panel("0.0 To 400000.0")  # disabled
res_warm_2 = ColourSwatch(SwatchColor=RGB(255, 246, 204))
off_cold_2 = ColourSwatch(SwatchColor=RGB(204, 229, 255))

# ---- group: bar diagram ppl range
equals_9 = Equality(FirstNumber=list, SecondNumber=1760)  # -> Equality, Inequality
p_n_c = PickNChoose(Pattern=equals_9.Inequality, Stream0="0 to 800000", Stream1="0 to 50000")
domain = Domain(p_n_c)

# ---- group: Dashboard Text Color
color = ColourSwatch(SwatchColor=RGB(201, 201, 201))
col_28 = Colour(color)

# ----
ma_14 = MassAddition(Input=[int_88, int_90, int_89])  # -> Result, PartialResults
ma_15 = MassAddition(Input=[int_87, int_85, int_86, int_91])  # -> Result, PartialResults

# ---- group: total working ppl #
int_92 = Integer(ma_15.Result)

# ---- group: total residential ppl #
int_93 = Integer(ma_14.Result)

# ----
addition_6 = Addition(A=int_93, B=int_92)

# ---- group: total ppl #
int_94 = Integer(addition_6)  # disabled

# ----
remap = RemapNumbers(Value=int_94, Source=panel_88, Target=Domain(0, 1))  # -> Mapped, Clipped; disabled

# ---- group: Dashboard Text Size 2
size = Slider(13.5, range=0..100)
num_36 = Number(size)

# ---- group: Dashboard Text Size 1
size_2 = Slider(15, range=0..100)
num_37 = Number(size_2)

# ----
max = Maximum(A=remap.Mapped, B=0)  # disabled
min_2 = Minimum(A=max, B=1)  # disabled
mid_mid_career_2 = ColourSwatch(SwatchColor=RGB(255, 208, 0))
_0 = Slider(0, range=0..1)

# ---- group: v sep ln length
number_slider_28 = Slider(16, range=10..20)

# ---- group: total ppl #
int_95 = Integer(addition_6)

# ----
# Bar Diagram
mln_young_2 = ColourSwatch(SwatchColor=RGB(0, 166, 255))
exc_elderly_2 = ColourSwatch(SwatchColor=RGB(0, 255, 85))
exc_elderly_3 = ColourSwatch(SwatchColor=RGB(255, 0, 0))

# ---- group: gridExtent_x
int_96 = Integer(int_38)  # disabled

# ---- group: gh ref pt start
pt_39 = Point(<point referenced from the Rhino model>)

# ---- group: gh ref pt end
pt_40 = Point(<point referenced from the Rhino model>)

# ----
number_slider_29 = Slider(0.5, range=0..1)  # disabled
subtraction = Subtraction(A=int_96, B=1)  # disabled
pdecon_25 = Deconstruct(Point=pt_40)  # -> XComponent, YComponent, ZComponent
pdecon_26 = Deconstruct(Point=pt_39)  # -> XComponent, YComponent, ZComponent
panel_89 = Panel(",\"popDensity\":")  # disabled
txt_12 = Text(min_2)  # disabled
panel_90 = Panel(int_95)
int_97 = Integer(int_41)  # disabled
neg = Negative(Value=number_slider_28)
graft = GraftTree(Tree=_0, IncludeEmptyLists=True, IncludeNullItems=True)
txt_13 = Text(num_20)  # disabled
subtraction_2 = Subtraction(A=subtraction, B=int_97)  # disabled
merge_11 = Merge(Data1=mln_young_2, Data2=mid_mid_career_2, Data3=exc_elderly_3)
merge_12 = Merge(Data1=mln_young_2, Data2=mid_mid_career_2, Data3=exc_elderly_3, Data4=exc_elderly_2)
Y = UnitY(Factor=number_slider_28)
Y_2 = UnitY(Factor=neg)
# Send to Unity (json, UDP)
panel_91 = Panel("{\"grid\":[")  # disabled
panel_92 = Panel("],\"objects\":{")  # disabled
panel_93 = Panel("}")  # disabled
panel_94 = Panel("{\"type\":")  # disabled
panel_95 = Panel(",\"x\":")  # disabled
panel_96 = Panel(",\"y\":")  # disabled
txt_14 = Text(int_42)  # disabled
panel_97 = Panel(",\"rot\":")  # disabled
txt_15 = Text(int_43)  # disabled
panel_98 = Panel("}")  # disabled
panel_99 = Panel(",")  # disabled
panel_100 = Panel("\"slider1\":")  # disabled
panel_101 = Panel(",\"toggle2\":")  # disabled
panel_102 = Panel(",\"toggle3\":")  # disabled
panel_103 = Panel(",\"toggle4\":")  # disabled
panel_104 = Panel(",\"dockID\":")  # disabled
txt_16 = Text(int_44)  # disabled
panel_105 = Panel(",\"density\":[")  # disabled
txt_17 = Text(int_40)  # disabled
txt_18 = Text(subtraction_2)  # disabled
panel_106 = Panel(",\"toggle1\":")  # disabled
int_98 = Integer(bool_8)  # disabled
panel_107 = Panel(",\"dockRotation\":")  # disabled
txt_19 = Text(int_48)  # disabled
panel_108 = Panel(",\"IDMax\":15")  # disabled
panel_109 = Panel("],\"pop_young\":0,\"pop_mid\":0,\"pop_old\":0")  # disabled
panel_110 = Panel("}")  # disabled
int_99 = Integer(bool_7)  # disabled
int_100 = Integer(bool_8)  # disabled
txt_20 = Text(number_slider_29)  # disabled
int_101 = Integer(bool_9)  # disabled

ttl_min = Slider(60, range=0..100)
type_min = Slider(20, range=0..100)

txt_21 = Text(int_46)  # disabled
panel_111 = Panel(",")  # disabled
nullrep_14 = ReplaceNulls(Items=int_93, Replacements=0)  # -> Items, Count
txt_22 = Text(int_99)  # disabled
txt_23 = Text(int_101)  # disabled
txt_24 = Text(int_98)  # disabled
txt_25 = Text(int_100)  # disabled
nullrep_15 = ReplaceNulls(Items=int_89, Replacements=0)  # -> Items, Count
nullrep_16 = ReplaceNulls(Items=int_88, Replacements=0)  # -> Items, Count
nullrep_17 = ReplaceNulls(Items=int_90, Replacements=0)  # -> Items, Count
max_2 = Maximum(A=nullrep_14.Items, B=ttl_min)
lng_5 = ListLength(List=txt_17)  # disabled
repeat_3 = RepeatData(Data=panel_97, Length=lng_5)  # disabled
repeat_4 = RepeatData(Data=panel_98, Length=lng_5)  # disabled
repeat_5 = RepeatData(Data=panel_96, Length=lng_5)  # disabled
repeat_6 = RepeatData(Data=panel_95, Length=lng_5)  # disabled
repeat_7 = RepeatData(Data=panel_94, Length=lng_5)  # disabled
join_5 = TextJoin(Text=txt_21, Join=panel_111)  # disabled
max_3 = Maximum(A=nullrep_15.Items, B=type_min)
max_4 = Maximum(A=nullrep_17.Items, B=type_min)
max_5 = Maximum(A=nullrep_16.Items, B=type_min)
pshift_26 = ShiftPaths(Data=repeat_3, Offset=-1)  # disabled
pshift_27 = ShiftPaths(Data=repeat_4, Offset=-1)  # disabled
pshift_28 = ShiftPaths(Data=repeat_6, Offset=-1)  # disabled
pshift_29 = ShiftPaths(Data=repeat_5, Offset=-1)  # disabled
pshift_30 = ShiftPaths(Data=repeat_7, Offset=-1)  # disabled

# ---- group: R
int_102 = Integer(max_2)

# ----
neg_2 = Negative(Value=number_slider_28)

# ---- group: RL
int_103 = Integer(max_3)

# ---- group: RM
int_104 = Integer(max_4)

# ---- group: RS
int_105 = Integer(max_5)

# ----
addition_7 = Addition(A=int_105, B=int_104)
addition_8 = Addition(A=addition_7, B=int_103)
merge_13 = Merge(Data1=graft, Data2=int_105, Data3=addition_7, Data4=addition_8)
# Population Matrix - New
pt_41 = Point(<point referenced from the Rhino model>)
col_29 = Colour(res_warm_2)
merge_14 = Merge(
    Data1=graft(pshift_30),
    Data2=graft(txt_17),
    Data3=graft(pshift_28),
    Data4=graft(txt_18),
    Data5=graft(pshift_29),
    Data6=graft(txt_14),
    Data7=graft(pshift_26),
    Data8=graft(txt_15),
    Data9=graft(pshift_27))  # disabled
sort = SortList(Keys=flatten(merge_13))  # -> Keys, ValuesA

# ---- group: 0-1
remap_2 = RemapNumbers(Value=flatten(sort.Keys), Source=domain, Target=Domain(0, 1))  # -> Mapped, Clipped

# ---- group: ttl h len
subtraction_3 = Subtraction(A=pdecon_25.XComponent, B=pdecon_26.XComponent)

# ----
pt_42 = Point(<point referenced from the Rhino model>)
num_38 = Number(num_37)
pt_43 = Point(<point referenced from the Rhino model>)
num_39 = Number(num_37)
col_30 = Colour(res_warm_2)
pt_44 = Point(<point referenced from the Rhino model>)
num_40 = Number(num_37)
col_31 = Colour(res_warm_2)
division_9 = Division(A=neg_2, B=2)
col_32 = Colour(res_warm_2)
division_10 = Division(A=number_slider_28, B=2)

# ---- group: RL
tag = TextTag3D(Location=pt_43, Text=int_103, Size=num_39, Colour=col_31, Justification=7)

# ----
join_6 = TextJoin(Text=merge_14)  # disabled

# ---- group: RS
tag_2 = TextTag3D(Location=pt_42, Text=int_105, Size=num_38, Colour=col_30, Justification=7)

# ---- group: RM
tag_3 = TextTag3D(Location=pt_44, Text=int_104, Size=num_40, Colour=col_32, Justification=7)

# ----
nullrep_18 = ReplaceNulls(Items=int_92, Replacements=0)  # -> Items, Count
multiplication_34 = Multiplication(A=remap_2.Mapped, B=subtraction_3)
Y_3 = UnitY(Factor=division_9)
Y_4 = UnitY(Factor=division_10)
nullrep_19 = ReplaceNulls(Items=int_91, Replacements=0)  # -> Items, Count
nullrep_20 = ReplaceNulls(Items=int_86, Replacements=0)  # -> Items, Count
pshift_31 = ShiftPaths(Data=join_6, Offset=-1)  # disabled
nullrep_21 = ReplaceNulls(Items=int_87, Replacements=0)  # -> Items, Count
max_6 = Maximum(A=nullrep_18.Items, B=ttl_min)
nullrep_22 = ReplaceNulls(Items=int_85, Replacements=0)  # -> Items, Count
addition_9 = Addition(A=pdecon_26.XComponent, B=multiplication_34)

# ---- group: O
int_106 = Integer(max_6)

# ----
max_7 = Maximum(A=nullrep_19.Items, B=type_min)
max_8 = Maximum(A=nullrep_21.Items, B=type_min)
max_9 = Maximum(A=nullrep_20.Items, B=type_min)
max_10 = Maximum(A=nullrep_22.Items, B=type_min)
txt_26 = Text(pshift_31)  # disabled
panel_112 = Panel(txt_26)  # disabled
join_7 = TextJoin(Text=txt_26, Join=panel_99)  # disabled
txt_27 = Text(join_7)  # disabled

# ---- group: CI
int_107 = Integer(max_7)

# ---- group: OL
int_108 = Integer(max_9)

# ---- group: OM
int_109 = Integer(max_10)

# ---- group: OS
int_110 = Integer(max_8)

# ----
addition_10 = Addition(A=int_110, B=int_109)
addition_11 = Addition(A=addition_10, B=int_108)
addition_12 = Addition(A=addition_11, B=int_107)
merge_15 = Merge(Data1=graft, Data2=int_110, Data3=addition_10, Data4=addition_11, Data5=addition_12)
sort_2 = SortList(Keys=flatten(merge_15))  # -> Keys, ValuesA

# ---- group: 0-1
remap_3 = RemapNumbers(Value=flatten(sort_2.Keys), Source=domain, Target=Domain(0, 1))  # -> Mapped, Clipped

# ----
multiplication_35 = Multiplication(A=remap_3.Mapped, B=subtraction_3)
addition_13 = Addition(A=pdecon_26.XComponent, B=multiplication_35)
pt_45 = ConstructPoint(XCoordinate=addition_13, YCoordinate=pdecon_26.YComponent, ZCoordinate=0)
move_2 = Move(Geometry=pt_45, Motion=Y_3)  # -> Geometry, Transform
shift_2 = ShiftList(List=move_2.Geometry, Shift=-1, Wrap=False)
pt_46 = Point(<point referenced from the Rhino model>)
col_33 = Colour(off_cold_2)
pt_47 = ConstructPoint(XCoordinate=addition_9, YCoordinate=pdecon_26.YComponent, ZCoordinate=0)
move_3 = Move(Geometry=pt_47, Motion=Y_4)  # -> Geometry, Transform
shift_3 = ShiftList(List=move_3.Geometry, Shift=-1, Wrap=False)
merge_16 = Merge(
    Data1=panel_91,
    Data2=txt_27,
    Data3=panel_92,
    Data4=panel_100,
    Data5=txt_20,
    Data6=panel_106,
    Data7=txt_22,
    Data8=panel_101,
    Data9=txt_23,
    Data10=panel_102,
    Data11=txt_24,
    Data12=panel_103,
    Data13=txt_25,
    Data14=panel_104,
    Data15=txt_16,
    Data16=panel_107,
    Data17=txt_19,
    Data18=panel_108,
    Data19=panel_89,
    Data20=txt_12,
    Data21=panel_105,
    Data22=join_5,
    Data23=panel_109,
    Data24=panel_110,
    Data25=panel_93)  # disabled
shift_4 = ShiftList(List=move_2.Geometry, Shift=1, Wrap=False)
pt_48 = Point(<point referenced from the Rhino model>)
num_41 = Number(num_37)
col_34 = Colour(off_cold_2)
shift_5 = ShiftList(List=move_3.Geometry, Shift=1, Wrap=False)
pt_49 = Point(<point referenced from the Rhino model>)
num_42 = Number(num_37)
pt_50 = Point(<point referenced from the Rhino model>)
num_43 = Number(num_37)
col_35 = Colour(off_cold_2)
pt_51 = Point(<point referenced from the Rhino model>)
num_44 = Number(num_37)
col_36 = Colour(off_cold_2)
col_37 = Colour(off_cold_2)

# ---- group: lower v sep ln
line_4 = LineSDL(Start=pt_45, Direction=Y_2, Length=number_slider_28)

# ---- group: h sep ln
ln = Line(StartPoint=pt_39, EndPoint=pt_40)

# ---- group: CI
tag_4 = TextTag3D(Location=pt_48, Text=int_107, Size=num_41, Colour=col_34, Justification=7)

# ---- group: OL
tag_5 = TextTag3D(Location=pt_50, Text=int_108, Size=num_43, Colour=col_36, Justification=7)

# ---- group: OS
tag_6 = TextTag3D(Location=pt_49, Text=int_110, Size=num_42, Colour=col_35, Justification=7)

# ---- group: OM
tag_7 = TextTag3D(Location=pt_51, Text=int_109, Size=num_44, Colour=col_37, Justification=7)

# ----
ln_2 = Line(StartPoint=shift_2, EndPoint=shift_4)
ln_3 = Line(StartPoint=shift_3, EndPoint=shift_5)
neg_3 = Negative(Value=number_slider_28)

# ---- group: upper v sep ln
line_5 = LineSDL(Start=pt_47, Direction=Y, Length=number_slider_28)

# ----
neg_4 = Negative(Value=number_slider_28)
join_8 = TextJoin(Text=merge_16)  # disabled
division_11 = Division(A=neg_3, B=6)
division_12 = Division(A=neg_4, B=6)
sort_pt = SortPoints(Points=flatten(pt_45))  # -> Points, Indices
panel_113 = Panel("127.0.0.1")  # disabled
panel_114 = Panel("7002")  # disabled

# ---- group: Dashboard Text Size 3
size_3 = Slider(12, range=0..100)
num_45 = Number(size_3)

# ----
num_46 = Number(num_45)

# ---- group: residential total
tag_8 = TextTag3D(Location=pt_41, Text=int_102, Size=num_46, Colour=col_29, Justification=7)

# ----
num_47 = Number(num_45)

# ---- group: office total
tag_9 = TextTag3D(Location=pt_46, Text=int_106, Size=num_47, Colour=col_33, Justification=7)

# ----
Y_5 = UnitY(Factor=division_11)
Y_6 = UnitY(Factor=division_12)
pt_52 = Point(<point referenced from the Rhino model>)
int_111 = Integer(int_60)
pt_53 = Point(<point referenced from the Rhino model>)
int_112 = Integer(int_59)
pt_54 = Point(<point referenced from the Rhino model>)
int_113 = Integer(int_61)
col_38 = Colour(res_warm_2)
col_39 = Colour(res_warm_2)
num_48 = Number(num_45)
num_49 = Number(num_45)
col_40 = Colour(res_warm_2)
num_50 = Number(num_45)
division_13 = Division(A=number_slider_28, B=3)
division_14 = Division(A=number_slider_28, B=3)
sort_pt_2 = SortPoints(Points=flatten(pt_47))  # -> Points, Indices

# ---- group: json data to send
txt_28 = Text(join_8)  # disabled

# ----
panel_115 = Panel(txt_28)  # disabled

# ---- group: 2
tag_10 = TextTag3D(Location=pt_52, Text=int_111, Size=num_48, Colour=col_38, Justification=7)

# ---- group: 0
tag_11 = TextTag3D(Location=pt_53, Text=int_112, Size=num_49, Colour=col_39, Justification=7)

# ---- group: 1
tag_12 = TextTag3D(Location=pt_54, Text=int_113, Size=num_50, Colour=col_40, Justification=7)

# ----
move_4 = Move(Geometry=ln_2, Motion=Y_5)  # -> Geometry, Transform
move_5 = Move(Geometry=ln_3, Motion=Y_6)  # -> Geometry, Transform
Y_7 = UnitY(Factor=division_13)
Y_8 = UnitY(Factor=division_14)

# ---- group: last pt O
item_26 = ListItem(List=sort_pt.Points, Index=-1, Wrap=True)

# ---- group: last pt R
item_27 = ListItem(List=sort_pt_2.Points, Index=-1, Wrap=True)

# ----
extr = Extrude(Base=move_4.Geometry, Direction=Y_7)
extr_2 = Extrude(Base=move_5.Geometry, Direction=Y_8)
udp = UDPSender(Address=panel_113, Port=panel_114, Pattern=0, Data=txt_28)  # disabled
pt_55 = Point(<point referenced from the Rhino model>)
int_114 = Integer(int_64)
pt_56 = Point(<point referenced from the Rhino model>)
int_115 = Integer(int_62)
pt_57 = Point(<point referenced from the Rhino model>)
int_116 = Integer(int_63)
col_41 = Colour(off_cold_2)
pt_58 = Point(<point referenced from the Rhino model>)
int_117 = Integer(int_65)
col_42 = Colour(off_cold_2)
num_51 = Number(num_45)
num_52 = Number(num_45)
col_43 = Colour(off_cold_2)
col_44 = Colour(off_cold_2)
num_53 = Number(num_45)
num_54 = Number(num_45)
neg_5 = Negative(Value=number_slider_28)
division_15 = Division(A=neg_5, B=1.5)
mesh_17 = Mesh(extr)
Y_9 = UnitY(Factor=division_15)
move_6 = Move(Geometry=item_26, Motion=Y_9)  # -> Geometry, Transform
mesh_18 = Mesh(extr_2)
division_16 = Division(A=number_slider_28, B=1.5)
Y_10 = UnitY(Factor=division_16)
move_7 = Move(Geometry=item_27, Motion=Y_10)  # -> Geometry, Transform

# ---- group: 5
tag_13 = TextTag3D(Location=pt_55, Text=int_114, Size=num_51, Colour=col_41, Justification=7)

# ---- group: 3
tag_14 = TextTag3D(Location=pt_56, Text=int_115, Size=num_52, Colour=col_42, Justification=7)

# ---- group: 8
tag_15 = TextTag3D(Location=pt_58, Text=int_117, Size=num_54, Colour=col_44, Justification=7)

# ---- group: 4
tag_16 = TextTag3D(Location=pt_57, Text=int_116, Size=num_53, Colour=col_43, Justification=7)

# ----
mspray_2 = MeshSpray(Mesh=graft(mesh_17), Points=Point(0, 0, 0), Colours=graft(merge_12), SprayMode=0)
mspray_3 = MeshSpray(Mesh=graft(mesh_18), Points=Point(0, 0, 0), Colours=graft(merge_11), SprayMode=0)
X = UnitX(Factor=5)
move_8 = Move(Geometry=move_6.Geometry, Motion=X)  # -> Geometry, Transform
X_2 = UnitX(Factor=5)
move_9 = Move(Geometry=move_7.Geometry, Motion=X_2)  # -> Geometry, Transform
pshift_32 = ShiftPaths(Data=mspray_2, Offset=-1)
pshift_33 = ShiftPaths(Data=mspray_3, Offset=-1)

# ---- group: all sep lns
crv_8 = Curve([ln, line_5, line_4])

# ----
pt_59 = Point(move_8.Geometry)
num_55 = Number(num_36)
pt_60 = Point(move_9.Geometry)
num_56 = Number(num_36)
col_45 = Colour(off_cold_2)
col_46 = Colour(res_warm_2)

# ---- group: work
mesh_19 = Mesh(pshift_32)

tag_17 = TextTag3D(Location=pt_59, Text="work", Size=num_55, Colour=col_45, Justification=4)

# ---- group: live
tag_18 = TextTag3D(Location=pt_60, Text="live", Size=num_56, Colour=col_46, Justification=4)

mesh_20 = Mesh(pshift_33)

# ----
preview_7 = CustomPreview(Geometry=crv_8, Shader=col_28)

# ---- group: json data to send
# Send to CityIO Server
# (json, internet, Yasushi)
txt_29 = Text(txt_28)  # disabled

# ----
dam = DataDam(DataA=txt_29, BufferDelay=10000000, BufferMode=2)  # disabled
panel_116 = Panel("table/update/citymatrix")  # disabled
panel_117 = Panel("https://cityio.media.mit.edu")  # disabled
send_table_data = PythonScript(url=panel_117, path=panel_116, jsonString=dam)  # -> out; disabled
# ---------- send_table_data: Python ----------
import System 
import System.Net 
import System.Uri
import System.IO
import System.Text.Encoding
import json


def postTable(url,stringData,debug=False):
    webclient = System.Net.WebClient()
    webclient.Headers['Content-type'] = 'text/plain'
    
    if debug:
        
        # simple validation before we send
        try:
            json.loads(stringData)
        except:
            print 'invalid string, revise your string data'
            return
        
        # this will block your process
        data = System.Text.Encoding.Default.GetBytes(stringData)
        webclient.UploadData(url,'POST',data)
        
    else:
        data = System.Text.Encoding.Default.GetBytes(stringData)
        webclient.UploadDataAsync(url,'POST',data)

endpoint = System.Uri('{}/{}'.format(url,path))



postTable(endpoint,jsonString,False)
# rhino crashes using async callbacks,
# so try the following if something is wrong
# postData(endpoint,jsonString,debug=True)
# ---------- end send_table_data ----------
panel_118 = Panel(send_table_data)  # disabled
panel_119 = Panel("""-0.2
0.0
0.2
-0.4
0.0
0.4
0
0
1""")

# ---- group: heatmap transparency
num_57 = Number(number_slider_2)

# ---- group: module id
int_118 = Integer(int_40)

# ---- group: shrink
cell_shrink = Slider(1, range=0.75..1)

# ----
move_z = Slider(6.5, range=0..30)

# ---- group: shrink
cell_shrink_2 = Slider(0.98, range=0.75..1)

# ---- group: gridExtent_x
int_119 = Integer(int_38)

# ---- group: shrink
num_58 = Number(cell_shrink_2)

# ---- group: gridExtent_y
int_120 = Integer(int_39)

# ---- group: rotation
int_121 = Integer(int_43)

# ---- group: module id
int_122 = Integer(int_40)

# ---- group: y
int_123 = Integer(int_42)

# ---- group: x
int_124 = Integer(int_41)

# ---- group: toggle1
bool_12 = Boolean(Toggle(True))

# ---- group: colortizer orgin
# LEGO Grid System
pt_61 = Point(<point referenced from the Rhino model>)

# ---- group: table size ref pt
pt_62 = Point(<point referenced from the Rhino model>)

# ----
number_slider_30 = Slider(-560, range=-1000..1000)  # disabled
num_59 = Number(1)  # disabled
vec_2 = VectorXYZ(XComponent=num_59, YComponent=num_59, ZComponent=0)  # -> Vector, Length; disabled
amp = Amplitude(Vector=vec_2.Vector, Amplitude=number_slider_30)  # disabled
move_10 = Move(Geometry=pt_62, Motion=amp)  # -> Geometry, Transform; disabled

# ---- group: floor num for each type
int_125 = Integer(int_46)

# ---- group: colortizer orgin
pt_63 = Point(pt_61)

# ---- group: # ppl per flr
num_60 = Number(num_35)

# ---- group: gridExtent_x
# Energy/Cost Efficiency Formular:
# Sum of (Nearest N Building Population/Distance to that building)
int_126 = Integer(int_38)

# ---- group: gridExtent_y
int_127 = Integer(int_39)

# ---- group: x
int_128 = Integer(int_41)

# ---- group: y
int_129 = Integer(int_42)

# ---- group: module id
int_130 = Integer(int_118)

# ---- group: shrink
num_61 = Number(cell_shrink)

# ----
Z = UnitZ(Factor=20)
panel_120 = Panel("C:\Users\RYAN\Documents\GitHub\CityMatrix\Map\Amenities Maps\Amenities_Trans.png")
# Dashboard
# Dock
panel_121 = Panel("Residential")
panel_122 = Panel("C:\Users\RYAN\Documents\GitHub\CityMatrix\Map\Amenities Maps\Amenities_85Alpha.png")
# C:\Users\RYAN\Documents\GitHub\CityMatrix\Map\HAMBURG RS 1600pxl.jpg
panel_123 = Panel("0.0")

# ---- group: dockID
int_131 = Integer(int_44)

# ---- group: dockRotation
int_132 = Integer(int_48)

# ----
xy_2 = XYPlane(Origin=pt_61)
dist = Distance(PointA=pt_61, PointB=pt_62)

# ---- group: module meshes lego ref: -1
mesh_21 = Mesh(mesh_6)

# ---- group: module meshes lego ref: 0 to 5
mesh_22 = Mesh(mesh_7)

# ----
multiplication_36 = Multiplication(A=int_125, B=num_60)
neg_6 = Negative(Value=int_132)

# ---- group: private car / sidewalk quator 0s
mesh_23 = Mesh([<mesh referenced from the Rhino model> x4])
pt_64 = Point(<point referenced from the Rhino model>)

# ----
division_17 = Division(A=dist, B=int_119)

# ---- group: private car / sidewalk quator 0s
mesh_24 = Mesh([<mesh referenced from the Rhino model> x4])
pt_65 = Point(<point referenced from the Rhino model>)

# ---- group: influence range - distance limit
number_slider_31 = Slider(200, range=0..1000)

# ----
txt_30 = Text(["Large Unit", "Medium Unit", "Small Unit", "Large Unit", "Medium Unit", "Small Unit"])

# ---- group: infulence range - # nearest
range_count = Slider(49, range=1..130)

# ----
movetoorgin = MoveToOrgin(G=mesh_21, num=num_58)
movetoorgin_2 = MoveToOrgin(G=mesh_22, num=num_58)
txt_31 = Text([panel_121, "Residential", "Residential", "Office", "Office", "Office"])
movetoorgin_3 = MoveToOrgin(G=mesh_11, num=num_58)

# ---- group: base cplane
pln = Plane(xy_2)

# ----
# Google Map @ Lego
planesrf = PlaneSurface(Plane=pln, XSize=Domain(0, 1000), YSize=Domain(-1000, 0))
move_11 = Move(Geometry=planesrf, Motion=Z)  # -> Geometry, Transform

# ---- group: sidewalk check matrix
python_2 = PythonScript(xe=int_119, ye=int_120, x=int_124, y=int_123, id=int_122)  # -> out, m; inputs x: list, y: list, id: list
# ---------- python_2: Python ----------
"""
CityMatrix

written by "Ryan" Yan Zhang <ryanz@mit.edu>
for MIT Media Lab, Changing Place Group
April.6th.2016
"""

import rhinoscriptsyntax as rs

m = [[-1 for n in range(xe)] for n in range(ye)]

#for n in range(len(id)):
#    if id[n] == 7:
#        m[y[n]][x[n]] = 6
#    else:
#        m[y[n]][x[n]] = id[n]

for n in range(len(id)):
    m[y[n]][x[n]] = id[n]

for n in range(ye):
    print m[n]
# ---------- end python_2 ----------

# ---- group: road check matrix
python_3 = PythonScript(xe=int_119, ye=int_120, x=int_124, y=int_123, id=int_122)  # -> out, m; inputs x: list, y: list, id: list; same code as python_2

python_4 = PythonScript(xe=int_119, ye=int_120, x=int_124, y=int_123, id=int_122)  # -> out, m; inputs x: list, y: list, id: list; same code as python_2

# ----
larger = LargerThan(FirstNumber=int_130, SecondNumber="0")  # -> LargerThan, OrEqualTo
smaller = SmallerThan(FirstNumber=int_130, SecondNumber="5")  # -> SmallerThan, OrEqualTo
equals_10 = Equality(FirstNumber=int_130, SecondNumber="8")  # -> Equality, Inequality
number_slider_32 = Slider(14, range=0..100)
item_28 = ListItem(List=txt_30, Index=int_131, Wrap=False)

# ---- group: private car / road quator 0s
mesh_25 = Mesh([<mesh referenced from the Rhino model> x4])
pt_66 = Point(<point referenced from the Rhino model>)

# ----
item_29 = ListItem(List=txt_31, Index=int_131, Wrap=False)

# ---- group: private car / center line quator 0s
mesh_26 = Mesh([<mesh referenced from the Rhino model> x4])
pt_67 = Point(<point referenced from the Rhino model>)

# ---- group: private car / sidewalk quator 1s
pt_68 = Point(<point referenced from the Rhino model>)
mesh_27 = Mesh([<mesh referenced from the Rhino model> x4])

# ---- group: private car
scale_nu = ScaleNU(Geometry=mesh_23, Plane=pt_64, ScaleX=num_58, ScaleY=num_58, ScaleZ=1)  # -> Geometry, Transform
scale_nu_2 = ScaleNU(Geometry=mesh_27, Plane=pt_68, ScaleX=num_58, ScaleY=num_58, ScaleZ=1)  # -> Geometry, Transform

# ---- group: private car / sidewalk quator 1s
pt_69 = Point(<point referenced from the Rhino model>)
mesh_28 = Mesh([<mesh referenced from the Rhino model> x4])

# ---- group: private car
scale_nu_3 = ScaleNU(Geometry=mesh_24, Plane=pt_65, ScaleX=num_58, ScaleY=num_58, ScaleZ=1)  # -> Geometry, Transform
scale_nu_4 = ScaleNU(Geometry=mesh_28, Plane=pt_69, ScaleX=num_58, ScaleY=num_58, ScaleZ=1)  # -> Geometry, Transform

# ----
pt_70 = Point(<point referenced from the Rhino model>)

# ---- group: # ppl per building
num_62 = Number(multiplication_36)

# ----
panel_124 = Panel(num_62)
swatch_3 = ColourSwatch(SwatchColor=RGB(255, 255, 255))

# ---- group: cell size
num_63 = Number(division_17)

num_64 = Number(num_63)

num_65 = Number(num_64)

# ----
modulecenter = ModuleCenter(pt=pt_63, num=num_65, int_2=int_128, int=int_129)  # -> pt_5, transform_2
division_18 = Division(A=num_65, B=2)
neg_7 = Negative(Value=division_18)
dom_4 = ConstructDomain(DomainStart=neg_7, DomainEnd=division_18)
modulecenter_2 = ModuleCenter(pt=pt_61, num=num_63, int_2=int_124, int=int_123)  # -> pt_5, transform_2

# ---- group: module center
pt_71 = Point(modulecenter_2.pt_5)

# ----
equals_11 = Equality(FirstNumber=list, SecondNumber=1760)  # -> Equality, Inequality
number_slider_33 = Slider(3, range=0..3)  # disabled
and = GateAnd(A=larger.OrEqualTo, B=smaller.OrEqualTo)
vec2pt = Vector2Pt(PointA=Point(0, 0, 0), PointB=pt_70, Unitize=False)  # -> Vector, Length

# ---- group: private car / road quator 1s
mesh_29 = Mesh([<mesh referenced from the Rhino model> x4])
pt_72 = Point(<point referenced from the Rhino model>)

# ---- group: private car
scale_nu_5 = ScaleNU(Geometry=mesh_25, Plane=pt_66, ScaleX=num_58, ScaleY=num_58, ScaleZ=1)  # -> Geometry, Transform
scale_nu_6 = ScaleNU(Geometry=mesh_29, Plane=pt_72, ScaleX=num_58, ScaleY=num_58, ScaleZ=1)  # -> Geometry, Transform

# ---- group: private car / center line quator 1s
mesh_30 = Mesh([<mesh referenced from the Rhino model> x4])
pt_73 = Point(<point referenced from the Rhino model>)

# ---- group: private car
scale_nu_7 = ScaleNU(Geometry=mesh_26, Plane=pt_67, ScaleX=num_58, ScaleY=num_58, ScaleZ=1)  # -> Geometry, Transform
scale_nu_8 = ScaleNU(Geometry=mesh_30, Plane=pt_73, ScaleX=num_58, ScaleY=num_58, ScaleZ=1)  # -> Geometry, Transform

# ---- group: sidewalk check list
python_5 = PythonScript(xe=int_119, ye=int_120, x=int_124, y=int_123, id=int_122, m=python_2.m)  # -> out, rdType; inputs x: list, y: list, id: list, m: list
# ---------- python_5: Python ----------
"""
CityMatrix

written by "Ryan" Yan Zhang <ryanz@mit.edu>
for MIT Media Lab, Changing Place Group
April.6th.2016
"""

import rhinoscriptsyntax as rs

rdType = []

for n in range(len(id)):
    
    code = []
    
    if id[n] in [6,9]:
        
        # 0: check x, y+1
        if y[n]+1>ye-1:
            code.append(1)
        else:
            if m[y[n]+1][x[n]] in [6,9]:
                code.append(1)
            else:
                code.append(0)
        
        # 1: check x+1, y
        if x[n]+1>xe-1:
            code.append(1)
        else:
            if m[y[n]][x[n]+1] in [6,9]:
                code.append(1)
            else:
                code.append(0)
        
        # 2: check x, y-1
        if y[n]-1<0:
            code.append(1)
        else:
            if m[y[n]-1][x[n]] in [6,9]:
                code.append(1)
            else:
                code.append(0)
        
        # 3: check x-1, y
        if x[n]-1<0:
            code.append(1)
        else:
            if m[y[n]][x[n]-1] in [6,9]:
                code.append(1)
            else:
                code.append(0)
    
    else:
        
        code = [0,0,0,0]
    
    print code
    rdType.append(code)
# ---------- end python_5 ----------

# ---- group: road check list
python_6 = PythonScript(xe=int_119, ye=int_120, x=int_124, y=int_123, id=int_122, m=python_3.m)  # -> out, rdType; inputs x: list, y: list, id: list, m: list; same code as python_5
python_7 = PythonScript(xe=int_119, ye=int_120, x=int_124, y=int_123, id=int_122, m=python_4.m)  # -> out, rdType; inputs x: list, y: list, id: list, m: list
# ---------- python_7: Python ----------
"""
CityMatrix

written by "Ryan" Yan Zhang <ryanz@mit.edu>
for MIT Media Lab, Changing Place Group
April.6th.2016
"""

import rhinoscriptsyntax as rs

rdType = []

for n in range(len(id)):
    
    code = []
    
    if id[n]==6:
        
        # 0: check x, y+1
        if y[n]+1>ye-1:
            code.append(1)
        else:
            if m[y[n]+1][x[n]]==6:
                code.append(1)
            else:
                code.append(0)
        
        # 1: check x+1, y
        if x[n]+1>xe-1:
            code.append(1)
        else:
            if m[y[n]][x[n]+1]==6:
                code.append(1)
            else:
                code.append(0)
        
        # 2: check x, y-1
        if y[n]-1<0:
            code.append(1)
        else:
            if m[y[n]-1][x[n]]==6:
                code.append(1)
            else:
                code.append(0)
        
        # 3: check x-1, y
        if x[n]-1<0:
            code.append(1)
        else:
            if m[y[n]][x[n]-1]==6:
                code.append(1)
            else:
                code.append(0)
    
    else:
        
        code = [0,0,0,0]
    
    print code
    rdType.append(code)
# ---------- end python_7 ----------

# ----
pt_74 = Point(<point referenced from the Rhino model>)
pt_75 = Point(<point referenced from the Rhino model>)
or = GateOr(A=and, B=equals_10.Equality)
planesrf_2 = PlaneSurface(Plane=PlaneXY(0, 0, 0), XSize=dom_4, YSize=dom_4)

# ---- group: PEV / sidewalk quator 0s
mesh_31 = Mesh([<mesh referenced from the Rhino model> x4])
pt_76 = Point(<point referenced from the Rhino model>)

mesh_32 = Mesh([<mesh referenced from the Rhino model> x4])
pt_77 = Point(<point referenced from the Rhino model>)

# ----
show_google_map = BooleanToggle(True)

# ---- group: module center
pt_78 = Point(modulecenter.pt_5)

# ---- group: isBuilding
bool_13 = Boolean(or)

# ---- group: unit name
tag_19 = TextTag3D(Location=pt_74, Text=item_28, Size=number_slider_32, Colour=swatch_3, Justification=5)

# ---- group: module meshes lego at orgin
mesh_33 = Mesh(movetoorgin)

mesh_34 = Mesh(movetoorgin_2)

# ----
item_30 = ListItem(List=mesh_34, Index=int_131, Wrap=False)
rotate = Rotate(Geometry=item_30, Angle=degrees(int_132), Plane=PlaneXY(0, 0, 0))  # -> Geometry, Transform
move_12 = Move(Geometry=rotate.Geometry, Motion=vec2pt.Vector)  # -> Geometry, Transform

# ---- group: res/off
tag_20 = TextTag3D(Location=pt_75, Text=item_29, Size=number_slider_32, Colour=swatch_3, Justification=5)

# ----
mesh_35 = Mesh(movetoorgin_3)

# ---- group: PEV / road quator 0s
mesh_36 = Mesh([<mesh referenced from the Rhino model> x4])
pt_79 = Point(<point referenced from the Rhino model>)

# ---- group: PEV / center line quator 0s
mesh_37 = Mesh(mesh_26)
pt_80 = Point(pt_67)

# ----
scale_nu_9 = ScaleNU(Geometry=planesrf_2, Plane=PlaneXY(0, 0, 0), ScaleX=num_61, ScaleY=num_61, ScaleZ=1)  # -> Geometry, Transform
Z_2 = UnitZ(Factor=move_z)

# ---- group: PEV / sidewalk quator 1s
mesh_38 = Mesh([<mesh referenced from the Rhino model> x4])
pt_81 = Point(<point referenced from the Rhino model>)

# ---- group: PEV
scale_nu_10 = ScaleNU(Geometry=mesh_31, Plane=pt_76, ScaleX=num_58, ScaleY=num_58, ScaleZ=1)  # -> Geometry, Transform
scale_nu_11 = ScaleNU(Geometry=mesh_38, Plane=pt_81, ScaleX=num_58, ScaleY=num_58, ScaleZ=1)  # -> Geometry, Transform

# ---- group: PEV / sidewalk quator 1s
mesh_39 = Mesh([<mesh referenced from the Rhino model> x4])
pt_82 = Point(<point referenced from the Rhino model>)

# ---- group: PEV
scale_nu_12 = ScaleNU(Geometry=mesh_32, Plane=pt_77, ScaleX=num_58, ScaleY=num_58, ScaleZ=1)  # -> Geometry, Transform
scale_nu_13 = ScaleNU(Geometry=mesh_39, Plane=pt_82, ScaleX=num_58, ScaleY=num_58, ScaleZ=1)  # -> Geometry, Transform

# ----
panel_125 = Panel("0")  # disabled
item_31 = ListItem(List=mesh_39, Index=number_slider_33, Wrap=True)  # disabled
panel_126 = Panel("5")  # disabled
dispatch_4 = Dispatch(List=int_130, DispatchPattern=bool_13)  # -> ListA, ListB
dispatch_5 = Dispatch(List=pt_78, DispatchPattern=bool_13)  # -> ListA, ListB

# ---- group: dock lego modules
mesh_40 = Mesh(move_12.Geometry)

# ----
larger_2 = LargerThan(FirstNumber=int_122, SecondNumber="0")  # -> LargerThan, OrEqualTo
smaller_2 = SmallerThan(FirstNumber=int_122, SecondNumber="5")  # -> SmallerThan, OrEqualTo
larger_3 = LargerThan(FirstNumber=int_122, SecondNumber=panel_125)  # -> LargerThan, OrEqualTo; disabled
smaller_3 = SmallerThan(FirstNumber=int_122, SecondNumber=panel_126)  # -> SmallerThan, OrEqualTo; disabled

# ---- group: PEV / road quator 1s
mesh_41 = Mesh([<mesh referenced from the Rhino model> x4])
pt_83 = Point(<point referenced from the Rhino model>)

# ---- group: PEV
scale_nu_14 = ScaleNU(Geometry=mesh_36, Plane=pt_79, ScaleX=num_58, ScaleY=num_58, ScaleZ=1)  # -> Geometry, Transform
scale_nu_15 = ScaleNU(Geometry=mesh_41, Plane=pt_83, ScaleX=num_58, ScaleY=num_58, ScaleZ=1)  # -> Geometry, Transform

# ---- group: PEV / center line quator 1s
mesh_42 = Mesh(mesh_30)
pt_84 = Point(pt_73)

# ---- group: PEV
scale_nu_16 = ScaleNU(Geometry=mesh_37, Plane=pt_80, ScaleX=num_58, ScaleY=num_58, ScaleZ=1)  # -> Geometry, Transform
scale_nu_17 = ScaleNU(Geometry=mesh_42, Plane=pt_84, ScaleX=num_58, ScaleY=num_58, ScaleZ=1)  # -> Geometry, Transform

# ----
move_13 = Move(Geometry=scale_nu_9.Geometry, Motion=Z_2)  # -> Geometry, Transform

# ---- group: toggle1
bool_14 = Boolean(bool_12)

# ----
filter_13 = StreamFilter(Gate=bool_14, Stream0=scale_nu_2.Geometry, Stream1=scale_nu_11.Geometry)
filter_14 = StreamFilter(Gate=bool_14, Stream0=scale_nu.Geometry, Stream1=scale_nu_10.Geometry)
mesh_43 = Mesh(filter_13)
mesh_44 = Mesh(filter_14)
filter_15 = StreamFilter(Gate=bool_14, Stream0=pt_64, Stream1=pt_76)
filter_16 = StreamFilter(Gate=bool_14, Stream0=pt_68, Stream1=pt_81)
pt_85 = Point(filter_16)
pt_86 = Point(filter_15)

# ---- group: toggle1
bool_15 = Boolean(bool_12)

# ----
filter_17 = StreamFilter(Gate=bool_15, Stream0=scale_nu_4.Geometry, Stream1=scale_nu_13.Geometry)
filter_18 = StreamFilter(Gate=bool_15, Stream0=scale_nu_3.Geometry, Stream1=scale_nu_12.Geometry)
mesh_45 = Mesh(filter_17)
mesh_46 = Mesh(filter_18)
filter_19 = StreamFilter(Gate=bool_15, Stream0=pt_65, Stream1=pt_77)
filter_20 = StreamFilter(Gate=bool_15, Stream0=pt_69, Stream1=pt_82)
pt_87 = Point(filter_20)
pt_88 = Point(filter_19)

# ---- group: sidewalk check list
python_8 = PythonScript(
    pt=pt_71,
    id=int_122,
    rdType=python_5.rdType,
    rdQua0=mesh_44,
    c0=pt_86,
    rdQua1=mesh_43,
    c1=pt_85,
    rdQua2=mesh_46,
    c2=pt_88,
    rdQua3=mesh_45,
    c3=pt_87)  # -> out, allRoadMesh; inputs pt: list, id: list, rdType: list, rdQua0: list, rdQua1: list, rdQua2: list, rdQua3: list
# ---------- python_8: Python ----------
"""
CityMatrix

written by "Ryan" Yan Zhang <ryanz@mit.edu>
for MIT Media Lab, Changing Place Group
April.6th.2016
"""

import rhinoscriptsyntax as rs
import Rhino.Geometry as rg

allRoadMesh = []

for n in range(len(id)):
    
    if id[n] in [6]:
        
        for i in range(len(rdType[n])):
            t = rdType[n][i]
            v = rs.PointCoordinates(pt[n])
            if t == 0:
                c = rs.PointCoordinates(c0)
                vx = v[0]-c[0]
                vy = v[1]-c[1]
                new = rs.CopyObject(rdQua0[i],(vx,vy,0.))
            else:
                c = rs.PointCoordinates(c1)
                vx = v[0]-c[0]
                vy = v[1]-c[1]
                new = rs.CopyObject(rdQua1[i],(vx,vy,0.))
            allRoadMesh.append(new)
    elif id[n] in [9]:
        
        for i in range(len(rdType[n])):
            t = rdType[n][i]
            v = rs.PointCoordinates(pt[n])
            if t == 0:
                c = rs.PointCoordinates(c2)
                vx = v[0]-c[0]
                vy = v[1]-c[1]
                new = rs.CopyObject(rdQua2[i],(vx,vy,0.))
            else:
                c = rs.PointCoordinates(c3)
                vx = v[0]-c[0]
                vy = v[1]-c[1]
                new = rs.CopyObject(rdQua3[i],(vx,vy,0.))
            allRoadMesh.append(new)
# ---------- end python_8 ----------

# ----
and_2 = GateAnd(A=larger_2.OrEqualTo, B=smaller_2.OrEqualTo)

# ---- group: module center - building only
pt_89 = Point(dispatch_5.ListA)

# ----
cps = ClosestPoints(Point=pt_78, Cloud=pt_89, Count=range_count)  # -> ClosestPoint, CPIndex, Distance
smaller_4 = SmallerThan(FirstNumber=cps.Distance, SecondNumber=number_slider_31)  # -> SmallerThan, OrEqualTo

# ---- group: module id - building only
int_133 = Integer(dispatch_4.ListA)

# ----
item_32 = ListItem(List=int_133, Index=cps.CPIndex, Wrap=False)
equals_12 = Equality(FirstNumber=int_122, SecondNumber="8")  # -> Equality, Inequality

# ---- group: toggle1
bool_16 = Boolean(bool_12)

# ----
and_3 = GateAnd(A=larger_3.OrEqualTo, B=smaller_3.OrEqualTo)  # disabled
filter_21 = StreamFilter(Gate=bool_16, Stream0=scale_nu_5.Geometry, Stream1=scale_nu_14.Geometry)
filter_22 = StreamFilter(Gate=bool_16, Stream0=scale_nu_6.Geometry, Stream1=scale_nu_15.Geometry)
vec2pt_2 = Vector2Pt(PointA=Point(0, 0, 0), PointB=pt_78, Unitize=False)  # -> Vector, Length

# ---- group: toggle1
bool_17 = Boolean(bool_12)

# ----
filter_23 = StreamFilter(Gate=bool_17, Stream0=scale_nu_7.Geometry, Stream1=scale_nu_16.Geometry)
filter_24 = StreamFilter(Gate=bool_17, Stream0=scale_nu_8.Geometry, Stream1=scale_nu_17.Geometry)
dispatch_6 = Dispatch(List=cps.ClosestPoint, DispatchPattern=smaller_4.OrEqualTo)  # -> ListA, ListB
dispatch_7 = Dispatch(List=item_32, DispatchPattern=smaller_4.OrEqualTo)  # -> ListA, ListB
dispatch_8 = Dispatch(List=cps.Distance, DispatchPattern=smaller_4.OrEqualTo)  # -> ListA, ListB
or_2 = GateOr(A=and_2, B=equals_12.Equality)
dispatch_9 = Dispatch(List=int_122, DispatchPattern=or_2)  # -> ListA, ListB; disabled

# ---- group: filted id
int_134 = Integer(dispatch_9.ListA)  # disabled

# ----
item_33 = ListItem(List=int_51, Index=graft(int_134), Wrap=True)  # disabled
pshift_34 = ShiftPaths(Data=item_33, Offset=-1)  # disabled

# ---- group: flr #s
txt_32 = Text(pshift_34)  # disabled

# ----
item_34 = ListItem(List=num_34, Index=graft(int_134), Wrap=True)  # disabled
item_35 = ListItem(List=num_32, Index=graft(int_134), Wrap=True)  # disabled
item_36 = ListItem(List=num_33, Index=graft(int_134), Wrap=True)  # disabled
pshift_35 = ShiftPaths(Data=item_34, Offset=-1)  # disabled
pshift_36 = ShiftPaths(Data=item_35, Offset=-1)  # disabled
pshift_37 = ShiftPaths(Data=item_36, Offset=-1)  # disabled

# ---- group: old per flr
num_66 = Number(pshift_35)  # disabled

# ---- group: young per flr
num_67 = Number(pshift_36)  # disabled

# ---- group: mid per flr
num_68 = Number(pshift_37)  # disabled

# ----
multiplication_37 = Multiplication(A=num_68, B=txt_32)  # disabled
multiplication_38 = Multiplication(A=num_67, B=txt_32)  # disabled
multiplication_39 = Multiplication(A=num_66, B=txt_32)  # disabled

# ---- group: total ppl in building mid
int_135 = Integer(multiplication_37)  # disabled

# ---- group: total ppl in building young
int_136 = Integer(multiplication_38)  # disabled

# ----
addition_14 = Addition(A=int_136, B=int_135)  # disabled

# ---- group: total ppl in building old
int_137 = Integer(multiplication_39)  # disabled

# ----
addition_15 = Addition(A=addition_14, B=int_137)  # disabled

# ---- group: total ppl in building - all
int_138 = Integer(addition_15)  # disabled

# ----
dispatch_10 = Dispatch(List=int_122, DispatchPattern=or_2)  # -> ListA, ListB
dispatch_11 = Dispatch(List=int_122, DispatchPattern=or_2)  # -> ListA, ListB

# ---- group: translate example
pt_90 = Point(Point(-15, -8, 0))  # disabled
python_9 = PythonScript(point=pt_90)  # -> out, output; inputs point: Point3d; disabled
# ---------- python_9: Python ----------
import Rhino

transform = Rhino.Geometry.Transform.Translation(0,0,5)
point.Transform(transform)

output = point
# ---------- end python_9 ----------

# ---- group: toggle1
# Toggles
bool_18 = Boolean(bool_7)

# ---- group: toggle2
bool_19 = Boolean(bool_9)

bool_20 = Boolean(bool_19)  # disabled

# ---- group: toggle3
bool_21 = Boolean(bool_8)

# ---- group: toggle4
bool_22 = Boolean(bool_10)

# ----
mesh_47 = Mesh(filter_22)
mesh_48 = Mesh(filter_21)
mesh_49 = Mesh(filter_24)
mesh_50 = Mesh(filter_23)
equals_13 = Equality(FirstNumber=int_122, SecondNumber="8")  # -> Equality, Inequality
equals_14 = Equality(FirstNumber=int_122, SecondNumber="9")  # -> Equality, Inequality
larger_4 = LargerThan(FirstNumber=int_122, SecondNumber="6")  # -> LargerThan, OrEqualTo
smaller_5 = SmallerThan(FirstNumber=int_122, SecondNumber="0")  # -> SmallerThan, OrEqualTo
panel_127 = Panel(int_133)
item_37 = ListItem(List=mesh_34, Index=graft(dispatch_10.ListA), Wrap=False)
item_38 = ListItem(List=mesh_35, Index=graft(dispatch_11.ListA), Wrap=False)
and_4 = GateAnd(A=larger_4.LargerThan, B=equals_13.Inequality)
filter_25 = StreamFilter(Gate=bool_16, Stream0=pt_66, Stream1=pt_79)
filter_26 = StreamFilter(Gate=bool_16, Stream0=pt_72, Stream1=pt_83)
filter_27 = StreamFilter(Gate=bool_17, Stream0=pt_67, Stream1=pt_80)
filter_28 = StreamFilter(Gate=bool_17, Stream0=pt_73, Stream1=pt_84)

# ---- group: bldg cntr in range
pt_91 = Point(dispatch_6.ListA)

# ---- group: distances in range
num_69 = Number(dispatch_8.ListA)

# ---- group: module ids in range
int_139 = Integer(dispatch_7.ListA)

# ----
pshift_38 = ShiftPaths(Data=item_37, Offset=-1)
pshift_39 = ShiftPaths(Data=item_38, Offset=-1)
dispatch_12 = Dispatch(List=int_121, DispatchPattern=or_2)  # -> ListA, ListB
dispatch_13 = Dispatch(List=int_121, DispatchPattern=or_2)  # -> ListA, ListB
and_5 = GateAnd(A=and_4, B=equals_14.Inequality)
dispatch_14 = Dispatch(List=pt_71, DispatchPattern=and_5)  # -> ListA, ListB
vec2pt_3 = Vector2Pt(PointA=Point(0, 0, 0), PointB=dispatch_14.ListA, Unitize=False)  # -> Vector, Length
item_39 = ListItem(List=panel_119, Index=int_139, Wrap=False)
item_40 = ListItem(List=int_125, Index=int_139, Wrap=False)
pt_92 = Point(filter_26)
pt_93 = Point(filter_28)
pt_94 = Point(filter_25)

# ---- group: road check list
python_10 = PythonScript(pt=pt_71, id=int_122, rdType=python_6.rdType, rdQua0=mesh_48, c0=pt_94, rdQua1=mesh_47, c1=pt_92)  # -> out, allRoadMesh; inputs pt: list, id: list, rdType: list, rdQua0: list, rdQua1: list
# ---------- python_10: Python ----------
"""
CityMatrix

written by "Ryan" Yan Zhang <ryanz@mit.edu>
for MIT Media Lab, Changing Place Group
April.6th.2016
"""

import rhinoscriptsyntax as rs
import Rhino.Geometry as rg

allRoadMesh = []

for n in range(len(id)):
    
    if id[n] in [6,9]:
        
        for i in range(len(rdType[n])):
            t = rdType[n][i]
            v = rs.PointCoordinates(pt[n])
            if t == 0:
                c = rs.PointCoordinates(c0)
                vx = v[0]-c[0]
                vy = v[1]-c[1]
                new = rs.CopyObject(rdQua0[i],(vx,vy,0.))
            else:
                c = rs.PointCoordinates(c1)
                vx = v[0]-c[0]
                vy = v[1]-c[1]
                new = rs.CopyObject(rdQua1[i],(vx,vy,0.))
            allRoadMesh.append(new)
# ---------- end python_10 ----------

# ----
pt_95 = Point(filter_27)

# ---- group: road check list
python_11 = PythonScript(pt=pt_71, id=int_122, rdType=python_7.rdType, rdQua0=mesh_50, c0=pt_95, rdQua1=mesh_49, c1=pt_93)  # -> out, allRoadMesh; inputs pt: list, id: list, rdType: list, rdQua0: list, rdQua1: list
# ---------- python_11: Python ----------
"""
CityMatrix

written by "Ryan" Yan Zhang <ryanz@mit.edu>
for MIT Media Lab, Changing Place Group
April.6th.2016
"""

import rhinoscriptsyntax as rs
import Rhino.Geometry as rg

allRoadMesh = []

for n in range(len(id)):
    
    if id[n]==6:
        
        for i in range(len(rdType[n])):
            t = rdType[n][i]
            v = rs.PointCoordinates(pt[n])
            if t == 0:
                c = rs.PointCoordinates(c0)
                vx = v[0]-c[0]
                vy = v[1]-c[1]
                new = rs.CopyObject(rdQua0[i],(vx,vy,0.))
            else:
                c = rs.PointCoordinates(c1)
                vx = v[0]-c[0]
                vy = v[1]-c[1]
                new = rs.CopyObject(rdQua1[i],(vx,vy,0.))
            allRoadMesh.append(new)
# ---------- end python_11 ----------

# ----
panel_128 = Panel("6")  # disabled
panel_129 = Panel("7")  # disabled
addition_16 = Addition(A=num_69, B=num_65)
panel_130 = Panel(equals_12.Equality)
txt_33 = Text(["Amenity On", "Amenity Off"])
txt_34 = Text(["Human Int. On", "Human Int. Off"])
txt_35 = Text(["Sat. Map On", "Sat. Map Off"])
txt_36 = Text(["Next", "- Next -"])
rotate_2 = Rotate(Geometry=pshift_38, Angle=degrees(dispatch_12.ListA), Plane=PlaneXY(0, 0, 0))  # -> Geometry, Transform
graft_2 = GraftTree(Tree=rotate_2.Transform, IncludeEmptyLists=True, IncludeNullItems=True)  # disabled
rotate_3 = Rotate(Geometry=pshift_39, Angle=degrees(dispatch_13.ListA), Plane=PlaneXY(0, 0, 0))  # -> Geometry, Transform
dispatch_15 = Dispatch(List=pt_71, DispatchPattern=or_2)  # -> ListA, ListB
number_slider_34 = Slider(7, range=0..100)
dispatch_16 = Dispatch(List=pt_71, DispatchPattern=or_2)  # -> ListA, ListB
move_14 = Move(Geometry=mesh_33, Motion=vec2pt_3.Vector)  # -> Geometry, Transform
multiplication_40 = Multiplication(A=item_39, B=item_40)
item_41 = ListItem(List=txt_33, Index=bool_21, Wrap=True)
item_42 = ListItem(List=txt_35, Index=bool_22, Wrap=True)
item_43 = ListItem(List=txt_34, Index=bool_19, Wrap=True)

# ---- group: fill pattern / fill rate
panel_131 = Panel("1")

# ----
item_44 = ListItem(List=txt_36, Index=bool_18, Wrap=True)

# ---- group: AI Step
int_140 = Integer()

# ----
panel_132 = Panel(int_140)
swatch_4 = ColourSwatch(SwatchColor=RGB(125, 125, 125))

# ---- group: fill pattern / dot cntr spacing div #
panel_133 = Panel("20")

# ----
Y_11 = UnitY(Factor=-100)

# ---- group: fill pattern / cell size
num_70 = Number(num_63)

# ---- group: energy/cost efficiency in range
num_71 = Number(multiplication_40)

# ----
vec2pt_4 = Vector2Pt(PointA=Point(0, 0, 0), PointB=dispatch_15.ListA, Unitize=False)  # -> Vector, Length
equals_15 = Equality(FirstNumber=int_122, SecondNumber=panel_128)  # -> Equality, Inequality; disabled
equals_16 = Equality(FirstNumber=int_122, SecondNumber=panel_129)  # -> Equality, Inequality; disabled
vec2pt_5 = Vector2Pt(PointA=Point(0, 0, 0), PointB=dispatch_16.ListA, Unitize=False)  # -> Vector, Length

# ---- group: distances in range - avoid 0
num_72 = Number(addition_16)

# ----
join_9 = TextJoin(Text=["AIStep: ", int_140])
pt_96 = Point(<point referenced from the Rhino model>)
move_15 = Move(Geometry=pt_96, Motion=Y_11)  # -> Geometry, Transform
pt_97 = Point(<point referenced from the Rhino model>)  # disabled
pt_98 = Point(<point referenced from the Rhino model>)  # disabled
pt_99 = Point(<point referenced from the Rhino model>)  # disabled

# ---- group: score range by experience
panel_134 = Panel("-0.4 To 0.6")

# ----
move_16 = Move(Geometry=rotate_2.Geometry, Motion=vec2pt_4.Vector)  # -> Geometry, Transform
graft_3 = GraftTree(Tree=move_16.Transform, IncludeEmptyLists=True, IncludeNullItems=True)  # disabled
comp = Compound(Transforms=[graft_2, graft_3])  # disabled
transform = Transform(Geometry=xy, Transform=comp)  # disabled
pshift_40 = ShiftPaths(Data=transform, Offset=-1)  # disabled

# ---- group: people dots base plans
pln_2 = Plane(pshift_40)  # disabled

# ---- group: block #
lng_6 = ListLength(List=pln_2)  # disabled

# ---- group: seed d
random = Random(Range=Domain(0, 10000), Number=lng_6, Seed=number_slider_5)  # disabled

# ---- group: seed r
random_2 = Random(Range=Domain(0, 10000), Number=lng_6, Seed=number_slider_9)  # disabled

# ---- group: seed d
random_3 = Random(Range=Domain(0, 10000), Number=lng_6, Seed=number_slider_10)  # disabled

random_4 = Random(Range=Domain(0, 10000), Number=lng_6, Seed=number_slider_11)  # disabled

# ---- group: seed r
random_5 = Random(Range=Domain(0, 10000), Number=lng_6, Seed=number_slider_12)  # disabled

random_6 = Random(Range=Domain(0, 10000), Number=lng_6, Seed=number_slider_13)  # disabled

# ----
pshift_41 = ShiftPaths(Data=random_2, Offset=-1)  # disabled
pshift_42 = ShiftPaths(Data=random, Offset=-1)  # disabled
pshift_43 = ShiftPaths(Data=random_5, Offset=-1)  # disabled
pshift_44 = ShiftPaths(Data=random_6, Offset=-1)  # disabled
pshift_45 = ShiftPaths(Data=random_3, Offset=-1)  # disabled
pshift_46 = ShiftPaths(Data=random_4, Offset=-1)  # disabled

# ---- group: d
random_7 = Random(Range=Domain(0, 1), Number=int_136, Seed=pshift_42)  # disabled

# ---- group: r
random_8 = Random(Range=Domain(0, 360), Number=int_136, Seed=pshift_41)  # disabled

# ---- group: d
random_9 = Random(Range=Domain(0, 1), Number=int_135, Seed=pshift_45)  # disabled

random_10 = Random(Range=Domain(0, 1), Number=int_137, Seed=pshift_46)  # disabled

# ---- group: r
random_11 = Random(Range=Domain(0, 360), Number=int_135, Seed=pshift_43)  # disabled

random_12 = Random(Range=Domain(0, 360), Number=int_137, Seed=pshift_44)  # disabled

# ----
graph = GraphMapper(
    random_7,
    x0=0,
    x1=1,
    y0=0,
    y1=1,
    container_name="Bezier",
    cpx=[0, 0.2763824463, 1, 1],
    cpy=[0, 0.2786865234, 0.3680863976, 1])  # disabled
graph_2 = GraphMapper(
    random_9,
    x0=0,
    x1=1,
    y0=0,
    y1=1,
    container_name="Bezier",
    cpx=[0, 0.3430397809, 1, 1],
    cpy=[0, 0.5653408766, 0.3680863976, 1])  # disabled
graph_3 = GraphMapper(
    random_10,
    x0=0,
    x1=1,
    y0=0,
    y1=1,
    container_name="Bezier",
    cpx=[0, 0.2961647809, 0.9886363745, 1],
    cpy=[0, 0.6839488745, 0.5063920021, 1])  # disabled
rad = Radians(Degrees=random_8)  # disabled
rad_2 = Radians(Degrees=random_11)  # disabled
rad_3 = Radians(Degrees=random_12)  # disabled
remap_4 = RemapNumbers(Value=graph, Source=Domain(0, 1), Target=dom)  # -> Mapped, Clipped; disabled
remap_5 = RemapNumbers(Value=graph_2, Source=Domain(0, 1), Target=dom_2)  # -> Mapped, Clipped; disabled
remap_6 = RemapNumbers(Value=graph_3, Source=Domain(0, 1), Target=dom_3)  # -> Mapped, Clipped; disabled
pt_100 = PointCylindrical(BasePlane=graft(pln_2), Angle=rad, Radius=remap_4.Mapped, Elevation=0)  # disabled
pt_101 = PointCylindrical(BasePlane=graft(pln_2), Angle=rad_2, Radius=remap_5.Mapped, Elevation=0)  # disabled
pt_102 = PointCylindrical(BasePlane=graft(pln_2), Angle=rad_3, Radius=remap_6.Mapped, Elevation=0)  # disabled
pshift_47 = ShiftPaths(Data=pt_100, Offset=-1)  # disabled
pdecon_27 = Deconstruct(Point=pshift_47)  # -> XComponent, YComponent, ZComponent; disabled
pshift_48 = ShiftPaths(Data=pt_101, Offset=-1)  # disabled
pdecon_28 = Deconstruct(Point=pshift_48)  # -> XComponent, YComponent, ZComponent; disabled
pshift_49 = ShiftPaths(Data=pt_102, Offset=-1)  # disabled
pdecon_29 = Deconstruct(Point=pshift_49)  # -> XComponent, YComponent, ZComponent; disabled
inc = Includes(Value=pdecon_27.YComponent, Domain=Domain(0, 1000))  # -> Includes, Deviation; disabled
inc_2 = Includes(Value=pdecon_27.XComponent, Domain=Domain(0, 1000))  # -> Includes, Deviation; disabled
inc_3 = Includes(Value=pdecon_28.YComponent, Domain=Domain(0, 1000))  # -> Includes, Deviation; disabled
inc_4 = Includes(Value=pdecon_28.XComponent, Domain=Domain(0, 1000))  # -> Includes, Deviation; disabled
inc_5 = Includes(Value=pdecon_29.YComponent, Domain=Domain(0, 1000))  # -> Includes, Deviation; disabled
inc_6 = Includes(Value=pdecon_29.XComponent, Domain=Domain(0, 1000))  # -> Includes, Deviation; disabled
and_6 = GateAnd(A=inc_2.Includes, B=inc.Includes)  # disabled
and_7 = GateAnd(A=inc_4.Includes, B=inc_3.Includes)  # disabled
and_8 = GateAnd(A=inc_6.Includes, B=inc_5.Includes)  # disabled
dispatch_17 = Dispatch(List=pshift_47, DispatchPattern=and_6)  # -> ListA, ListB; disabled
dispatch_18 = Dispatch(List=pshift_48, DispatchPattern=and_7)  # -> ListA, ListB; disabled
dispatch_19 = Dispatch(List=pshift_49, DispatchPattern=and_8)  # -> ListA, ListB; disabled
pt_103 = Point(dispatch_17.ListA)  # disabled
pt_104 = Point(dispatch_18.ListA)  # disabled
pt_105 = Point(dispatch_19.ListA)  # disabled
rnd_reduce_by_ratio = RndReduceByRatio(L=pt_103, B=number_slider_19, S=number_slider_20)  # disabled
rnd_reduce_by_ratio_2 = RndReduceByRatio(L=pt_104, B=number_slider_19, S=number_slider_22)  # disabled
rnd_reduce_by_ratio_3 = RndReduceByRatio(L=pt_105, B=number_slider_19, S=number_slider_24)  # disabled
pt_106 = Point(rnd_reduce_by_ratio)  # disabled
move_17 = Move(Geometry=mesh_14, Motion=pt_106)  # -> Geometry, Transform; disabled
pt_107 = Point(rnd_reduce_by_ratio_2)  # disabled
move_18 = Move(Geometry=mesh_16, Motion=pt_107)  # -> Geometry, Transform; disabled
pt_108 = Point(rnd_reduce_by_ratio_3)  # disabled
move_19 = Move(Geometry=mesh_15, Motion=pt_108)  # -> Geometry, Transform; disabled
mjoin_2 = MeshJoin(Meshes=move_17.Geometry)  # disabled
mjoin_3 = MeshJoin(Meshes=move_19.Geometry)  # disabled
mjoin_4 = MeshJoin(Meshes=move_18.Geometry)  # disabled
mcol_2 = MeshColours(Mesh=mjoin_2, Colours=mln_young)  # disabled
mcol_3 = MeshColours(Mesh=mjoin_3, Colours=exc_elderly)  # disabled
mcol_4 = MeshColours(Mesh=mjoin_4, Colours=mid_mid_career)  # disabled
preview_8 = CustomPreview(Geometry=pt_107, Shader=mid_mid_career)  # disabled
preview_9 = CustomPreview(Geometry=pt_108, Shader=exc_elderly)  # disabled
filter_29 = StreamFilter(Gate=bool_20, Stream1=mcol_2)  # disabled
filter_30 = StreamFilter(Gate=bool_20, Stream1=mcol_3)  # disabled
preview_10 = CustomPreview(Geometry=pt_106, Shader=mln_young)  # disabled
filter_31 = StreamFilter(Gate=bool_20, Stream1=mcol_4)  # disabled

# ---- group: old ppl dots mesh
mesh_51 = Mesh(filter_30)  # disabled

# ---- group: mid ppl dots mesh
mesh_52 = Mesh(filter_31)  # disabled

# ---- group: young ppl dots mesh
mesh_53 = Mesh(filter_29)  # disabled

# ----
move_20 = Move(Geometry=rotate_3.Geometry, Motion=vec2pt_5.Vector)  # -> Geometry, Transform
or_3 = GateOr(A=equals_15.Equality, B=equals_16.Equality)  # disabled
division_19 = Division(A=num_71, B=num_72)

# ---- group: amenities
tag_21 = TextTag3D(Location=pt_97, Text=item_41, Size=number_slider_32, Colour=swatch_3, Justification=5)  # disabled

# ---- group: google map
tag_22 = TextTag3D(Location=pt_98, Text=item_42, Size=number_slider_32, Colour=swatch_3, Justification=5)  # disabled

# ---- group: human interaction
tag_23 = TextTag3D(Location=pt_99, Text=item_43, Size=number_slider_32, Colour=swatch_3, Justification=5)  # disabled

# ---- group: AI Step Next
tag_24 = TextTag3D(Location=move_15.Geometry, Text=item_44, Size=number_slider_34, Colour=swatch_4, Justification=5)

# ---- group: AI Step Int
tag_25 = TextTag3D(Location=pt_96, Text=join_9, Size=number_slider_34, Colour=swatch_4, Justification=5)

# ----
gradient = Gradient(LowerLimit=0, UpperLimit=1, stops=[0: RGB(255, 0, 0), 0.5: RGB(222, 222, 0), 1: RGB(0, 128, 0)])
dispatch_20 = Dispatch(List=pt_71, DispatchPattern=or_3)  # -> ListA, ListB; disabled
ma_16 = MassAddition(Input=division_19)  # -> Result, PartialResults

# ---- group: road center pts
pt_109 = Point(dispatch_20.ListA)  # disabled

# ---- group: road mesh final!
mesh_54 = Mesh(python_10.allRoadMesh)

# ---- group: center line mesh final!
mesh_55 = Mesh(python_11.allRoadMesh)  # disabled

# ----
easter_eggs = EasterEggs(L=pt_71, A_2=int_122, shrink=num_58, L_2=pt_71, A=int_122, shrink_2=num_58)  # disabled

# ---- group: blank
mesh_56 = Mesh(move_14.Geometry)

# ---- group: sidewalk mesh final!
mesh_57 = Mesh(python_8.allRoadMesh)

# ---- group: building lego modules
mesh_58 = Mesh(move_16.Geometry)

# ----
mesh_59 = Mesh(move_20.Geometry)
pshift_50 = ShiftPaths(Data=ma_16.Result, Offset=-1)
# AI Weights
panel_135 = Panel("1 to 30")
panel_136 = Panel("""Density
Diversity
Energy
Traffic
Solar""")

# ---- group: AIWeights
num_73 = Number()

# ----
panel_137 = Panel("%")  # disabled

# ---- group: Ref Pts
# Slider 2 - Heatmap Mode
pt_110 = Point([<point referenced from the Rhino model> x5])

# ---- group: Alpha
number_slider_35 = Slider(0.5, range=0..1)

# ---- group: population density score
num_74 = Number(pshift_50)

# ----
bnd = Bounds(Numbers=num_74)
panel_138 = Panel(bnd)
panel_139 = Panel("""Mobility
Effic.""")
panel_140 = Panel("""Satellite
Imagery""")
panel_141 = Panel("""Pop.
Density""")
panel_142 = Panel("""Exp.
Diversity""")
panel_143 = Panel("""Energy
Effic.""")
panel_144 = Panel("""Working
Prox.""")
panel_145 = Panel("""H.M.
Off""")
panel_146 = Panel("""Park
Prox.""")
panel_147 = Panel("""Live/Work
Balance""")
panel_148 = Panel("""Living
Prox.""")
panel_149 = Panel("""Mobility
Perform.""")
panel_150 = Panel("""Solar
Perform.""")

# ---- group: slider1
# Slider
num_75 = Number(num_20)

# ----
range = Range(Domain=panel_135, Steps=100)
lng_7 = ListLength(List=num_73)
multiplication_41 = Multiplication(A=num_75, B=100)
multiplication_42 = Multiplication(A=num_73, B=100)  # disabled
remap_7 = RemapNumbers(Value=num_74, Source=panel_134, Target=Domain(0, 1))  # -> Mapped, Clipped
max_11 = Maximum(A=remap_7.Mapped, B=0)
min_3 = Minimum(A=max_11, B=1)
txt_37 = Text(panel_136)
txt_38 = Text(panel_137)  # disabled
txt_39 = Text("")
int_141 = Integer(range)

# ---- group: population density score normalized
num_76 = Number(remap_7.Mapped)

# ----
gradient_2 = Gradient(LowerLimit=0, UpperLimit=1, Parameter=num_76, stops=[0: RGB(0, 0, 0), 1: RGB(255, 255, 255)])
Z_3 = UnitZ(Factor="10")
repeat_8 = RepeatData(Data=txt_39, Length=lng_7)
repeat_9 = RepeatData(Data=txt_38, Length=lng_7)  # disabled
int_142 = Integer(multiplication_42)  # disabled
txt_40 = Text(int_141)
int_143 = Integer(multiplication_41)
merge_17 = Merge(
    Data1=panel_145,
    Data2=panel_140,
    Data3=panel_141,
    Data4=panel_142,
    Data5=panel_143,
    Data6=panel_144,
    Data7=panel_148,
    Data8=panel_146,
    Data9=panel_147,
    Data10=panel_149,
    Data11=panel_150)
pshift_51 = ShiftPaths(Data=int_142, Offset=-1)  # disabled
pshift_52 = ShiftPaths(Data=repeat_8, Offset=-2)
pshift_53 = ShiftPaths(Data=repeat_9, Offset=-2)  # disabled
python_12 = PythonScript(x=merge_17)  # -> out, a; inputs x: list
# ---------- python_12: Python ----------
a = [i for i in range(len(x))]
# ---------- end python_12 ----------
swatch_5 = ColourSwatch(SwatchColor=RGB(255, 255, 255))

# ---- group: keystone box corners
pt_111 = Point([<point referenced from the Rhino model> x4])

# ----
Z_4 = UnitZ(Factor="500")
item_45 = ListItem(List=txt_40, Index=int_143, Wrap=True)

# ---- group: keystone box corners
pt_112 = Point(pt_111)

# ---- group: colortizer orgin
pt_113 = Point(pt_61)

# ---- group: table size ref pt
pt_114 = Point(pt_62)

# ----
avr = Average(Input=num_76)
merge_18 = Merge(Data1=graft(txt_37), Data2=graft(pshift_52), Data3=graft(pshift_51), Data4=graft(pshift_53))
item_46 = ListItem(List=pt_112, Index=1, Wrap=True)
item_47 = ListItem(List=pt_112, Index=0, Wrap=True)
item_48 = ListItem(List=pt_112, Index=2, Wrap=True)
item_49 = ListItem(List=pt_112, Index=3, Wrap=True)
pt_115 = Point(<point referenced from the Rhino model>)
dist_2 = Distance(PointA=pt_113, PointB=pt_114)
neg_8 = Negative(Value=dist_2)
Y_12 = UnitY(Factor=neg_8)
move_21 = Move(Geometry=pt_114, Motion=Y_12)  # -> Geometry, Transform
move_22 = Move(Geometry=move_21.Geometry, Motion=Z_4)  # -> Geometry, Transform

# ---- group: fl # slider
tag_26 = TextTag3D(Location=pt_115, Text=item_45, Size=Slider(16, range=0..100), Colour=swatch_3, Justification=8)

# ----
move_23 = Move(Geometry=item_46, Motion=Z_4)  # -> Geometry, Transform
move_24 = Move(Geometry=item_49, Motion=Z_4)  # -> Geometry, Transform
move_25 = Move(Geometry=item_47, Motion=Z_4)  # -> Geometry, Transform
move_26 = Move(Geometry=item_48, Motion=Z_4)  # -> Geometry, Transform
join_10 = TextJoin(Text=merge_18)
box = Box2Pt(PointA=pt_113, PointB=move_22.Geometry, Plane=PlaneXY(0, 0, 0))
tbox = TwistedBox(
    CornerA=item_47,
    CornerB=item_46,
    CornerC=item_48,
    CornerD=item_49,
    CornerE=move_25.Geometry,
    CornerF=move_23.Geometry,
    CornerG=move_26.Geometry,
    CornerH=move_24.Geometry)
pshift_54 = ShiftPaths(Data=join_10, Offset=-1)
python_13 = PythonScript(x=list)  # -> out, a
# ---------- python_13: Python ----------
if x < 1000:
    a = str(x)+"m"
elif x> 1000:
    a = str(x//1000) +"," + str(x%1000) + "m"
# ---------- end python_13 ----------

pt_116 = Point([<point referenced from the Rhino model> x2])
tag_27 = TextTag3D(Location=pt_116, Text=python_13.a, Size=Slider(15, range=0..100), Colour=swatch_5, Justification=5)

python_14 = PythonScript(x=list)  # -> out, a
# ---------- python_14: Python ----------
x = x/0.276225

a = "1:"+str(int(x/100)*100 )
# ---------- end python_14 ----------

pt_117 = Point(<point referenced from the Rhino model>)
tag_28 = TextTag3D(Location=pt_117, Text=python_14.a, Size=Slider(15, range=0..100), Colour=swatch_5, Justification=4)

txt_41 = Text(pshift_54)
panel_151 = Panel(txt_41)

# ---- group: base box
box_2 = Box(box)

# ---- group: keystone box
tbox_2 = TwistedBox(tbox)

# ---- group: cell size
num_77 = Number(num_63)

# ---- group: module id
int_144 = Integer(int_40)

int_145 = Integer(int_40)

# ---- group: fl # slider
tag_29 = TextTag3D(
    Location=pt_110,
    Text=txt_41,
    Size=Slider(12, range=0..100),
    Colour=ColourSwatch(SwatchColor=RGB(255, 255, 255)),
    Justification=1)

# ---- group: cell size
num_78 = Number(num_63)

# ---- group: shrink
cell_shrink_3 = Slider(1, range=0.75..1)

# ----
move_z_2 = Slider(6.5, range=0..30)

# ---- group: shrink
cell_shrink_4 = Slider(1, range=0.75..1)

# ----
move_z_3 = Slider(6.5, range=0..30)

# ---- group: Diversity Formular
# Population Diversity Heatmap - GH
panel_152 = Panel("\CityMatrix_ML\01_Software\RH_GH\Grasshopper\ImagesInGH\Diversity Formular.PNG")  # disabled
path_3 = FilePath("C:\Users\RYAN\Dropbox (MIT)\01_Work\Share\_CityScope\CityMatrix_ML\01_Software\RH_GH\Grasshopper\ImagesInGH\Diversity Formular.PNG")  # disabled
panel_153 = Panel(path_3)  # disabled
load_bitmap_2 = LoadBitmap(FilePathToImageLocation=path_3)  # disabled

# ---- group: floor num for each type
int_146 = Integer(int_46)

# ---- group: colortizer orgin
pt_118 = Point(pt_61)

# ---- group: # ppl per flr
num_79 = Number(num_35)

# ---- group: cell size
num_80 = Number(num_77)

# ---- group: gridExtent_x
int_147 = Integer(int_38)

# ---- group: gridExtent_y
int_148 = Integer(int_39)

# ---- group: module id
int_149 = Integer(int_144)

# ---- group: x
int_150 = Integer(int_41)

# ---- group: y
int_151 = Integer(int_42)

# ---- group: shrink
num_81 = Number(cell_shrink_3)

# ---- group: floor num for each type
int_152 = Integer(int_46)

# ---- group: colortizer orgin
pt_119 = Point(pt_61)

# ---- group: # ppl per flr
num_82 = Number(num_35)

# ---- group: cell size
num_83 = Number(num_78)

# ---- group: gridExtent_x
# Population Density Formular:
# Sum of (Nearest N Building Population/Distance to that building)
int_153 = Integer(int_38)

# ---- group: gridExtent_y
int_154 = Integer(int_39)

# ---- group: x
int_155 = Integer(int_41)

# ---- group: y
int_156 = Integer(int_42)

# ---- group: shrink
num_84 = Number(cell_shrink_4)

# ---- group: module id
int_157 = Integer(int_145)

# ---- group: total parking cell number
# Parking & Park
int_158 = Integer(parking_cell)

# ---- group: cell size
num_85 = Number(division_17)

# ---- group: 3D City / module id
int_159 = Integer(int_40)

# ---- group: parking / meshes lego ref: parking
mesh_60 = Mesh(<mesh referenced from the Rhino model>)  # disabled

# ---- group: blank modules
mesh_61 = Mesh(mesh_56)

# ---- group: meshes lego ref: park
mesh_62 = Mesh(<mesh referenced from the Rhino model>)

# ---- group: total park cell number
int_160 = Integer(park_cell)

# ----
division_20 = Division(A=num_85, B=2.5)

# ---- group: prevent 0
panel_154 = Panel(".000001")

panel_155 = Panel(".000001")  # disabled

# ----
number_slider_36 = Slider(6.2, range=0..10)  # disabled

# ---- group: prevent 0
panel_156 = Panel(".000001")  # disabled

# ----
multiplication_43 = Multiplication(A=int_146, B=num_79)

# ---- group: note: none of P1, P2, or P3 could be 0 !!!
panel_157 = Panel("(P1*log10(P1)+P2*log10(P2)+P3*log10(P3)+P4*log10(P4)+P5*log10(P5)+P6*log10(P6)+P9*log10(P9)) / log10(7) * (-1)")

panel_158 = Panel("(P1*log10(P1)+P2*log10(P2)+P3*log10(P3)) / log10(3) * (-1)")  # disabled

# ---- group: prevent 0
panel_159 = Panel(".000001")  # disabled

# ---- group: note: none of P1, P2, or P3 could be 0 !!!
panel_160 = Panel("(P1*log10(P1)+P2*log10(P2)+P3*log10(P3)) / log10(3) * (-1)")  # disabled

panel_161 = Panel("(P1*log10(P1)+P2*log10(P2)) / log10(2) * (-1)")  # disabled

# ----
modulecenter_3 = ModuleCenter(pt=pt_118, num=num_80, int_2=int_150, int=int_151)  # -> pt_5, transform_2
division_21 = Division(A=num_80, B=2)
neg_9 = Negative(Value=division_21)

# ---- group: dockID
int_161 = Integer(int_44)  # disabled

# ----
multiplication_44 = Multiplication(A=int_152, B=num_82)

# ---- group: influence range - distance limit
number_slider_37 = Slider(217.9, range=0..1000)

# ---- group: infulence range - # nearest
range_count_2 = Slider(49, range=1..130)

# ---- group: 3D City / 3D building site move amount
X_3 = UnitX(Factor="10000")

# ---- group: module center
pt_120 = Point(modulecenter_2.pt_5)  # disabled

# ----
# On Dashboard
panel_162 = Panel("-1")  # disabled
modulecenter_4 = ModuleCenter(pt=pt_119, num=num_83, int_2=int_155, int=int_156)  # -> pt_5, transform_2
# Activation Mask
# On LEGOs
srf = Surface(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)  # disabled

# ---- group: module id
int_162 = Integer(int_40)  # disabled

# ----
division_22 = Division(A=num_83, B=2)
neg_10 = Negative(Value=division_22)

# ---- group: dockID
int_163 = Integer(int_131)  # disabled

# ----
neg_11 = Negative(Value=division_20)

# ---- group: ref mask srf - R
srf_2 = Surface(<surface referenced from the Rhino model>)  # disabled

# ---- group: ref mask srf - RM
srf_3 = Surface(<surface referenced from the Rhino model>)  # disabled

# ---- group: ref mask srf - bar live
srf_4 = Surface(<surface referenced from the Rhino model>)  # disabled

# ---- group: ref mask srf - RS
srf_5 = Surface(<surface referenced from the Rhino model>)  # disabled

# ----
geobottomcenter = GeoBottomCenter_2(geo=mesh_61)

# ---- group: influence range - distance limit
number_slider_38 = Slider(200, range=0..1000)

# ---- group: ref mask srf - RL
srf_6 = Surface(<surface referenced from the Rhino model>)  # disabled

# ---- group: infulence range - # nearest
range_count_3 = Slider(49, range=1..130)

# ----
movetoorgin_4 = MoveToOrgin(G=mesh_62, num=num_58)
larger_5 = LargerThan(FirstNumber=int_149, SecondNumber="0")  # -> LargerThan, OrEqualTo
smaller_6 = SmallerThan(FirstNumber=int_149, SecondNumber="5")  # -> SmallerThan, OrEqualTo
equals_17 = Equality(FirstNumber=int_130, SecondNumber="8")  # -> Equality, Inequality
dom_5 = ConstructDomain(DomainStart=neg_9, DomainEnd=division_21)
larger_6 = LargerThan(FirstNumber=int_157, SecondNumber="0")  # -> LargerThan, OrEqualTo
smaller_7 = SmallerThan(FirstNumber=int_157, SecondNumber="5")  # -> SmallerThan, OrEqualTo
mesh_63 = Mesh(srf)  # disabled
equals_18 = Equality(FirstNumber=int_130, SecondNumber="8")  # -> Equality, Inequality
equals_19 = Equality(FirstNumber=int_163, SecondNumber=panel_162)  # -> Equality, Inequality; disabled
ind = ColourSwatch(SwatchColor=RGB(71, 71, 71))

# ---- group: # ppl per building
num_86 = Number(multiplication_43)

# ----
panel_163 = Panel(num_86)
ind_2 = ColourSwatch(SwatchColor=RGB(0, 68, 255))
panel_164 = Panel("2")  # disabled
panel_165 = Panel("1")  # disabled
panel_166 = Panel("0")  # disabled
equals_20 = Equality(FirstNumber=int_162, SecondNumber=int_163)  # -> Equality, Inequality; disabled
dom_6 = ConstructDomain(DomainStart=neg_10, DomainEnd=division_22)

# ---- group: 3D City / module center
pt_121 = Point(pt_71)

# ----
panel_167 = Panel("-1")  # disabled

# ---- group: # ppl per building
num_87 = Number(multiplication_44)

# ----
panel_168 = Panel(num_87)
Z_5 = UnitZ(Factor=number_slider_36)  # disabled
lng_8 = ListLength(List=geobottomcenter)

# ---- group: 3D City / blank
mesh_64 = Mesh(mesh_56)

# ---- group: 3D City / sidewalk mesh final!
mesh_65 = Mesh(python_8.allRoadMesh)

# ----
equals_21 = Equality(FirstNumber=int_161, SecondNumber=panel_165)  # -> Equality, Inequality; disabled
and_9 = GateAnd(A=larger_5.OrEqualTo, B=smaller_6.OrEqualTo)
equals_22 = Equality(FirstNumber=int_161, SecondNumber=panel_164)  # -> Equality, Inequality; disabled
and_10 = GateAnd(A=equals_22.Inequality, B=equals_21.Inequality)  # disabled
equals_23 = Equality(FirstNumber=int_161, SecondNumber=panel_166)  # -> Equality, Inequality; disabled
and_11 = GateAnd(A=and_10, B=equals_23.Inequality)  # disabled
equals_24 = Equality(FirstNumber=int_161, SecondNumber=panel_167)  # -> Equality, Inequality; disabled
and_12 = GateAnd(A=larger_6.OrEqualTo, B=smaller_7.OrEqualTo)
or_4 = GateOr(A=and_9, B=equals_17.Equality)
planesrf_3 = PlaneSurface(Plane=PlaneXY(0, 0, 0), XSize=dom_5, YSize=dom_5)
division_23 = Division(A=int_158, B=lng_8)
and_13 = GateAnd(A=equals_21.Inequality, B=equals_24.Inequality)  # disabled
and_14 = GateAnd(A=equals_22.Inequality, B=equals_24.Inequality)  # disabled
and_15 = GateAnd(A=equals_23.Inequality, B=equals_24.Inequality)  # disabled
move_27 = Move(Geometry=mesh_63, Motion=Z_5)  # -> Geometry, Transform; disabled
or_5 = GateOr(A=and_12, B=equals_18.Equality)
equals_25 = Equality(FirstNumber=int_159, SecondNumber="8")  # -> Equality, Inequality
planesrf_4 = PlaneSurface(Plane=PlaneXY(0, 0, 0), XSize=dom_6, YSize=dom_6)

# ---- group: module meshes lego at orgin
mesh_66 = Mesh(movetoorgin_4)

# ---- group: module center
pt_122 = Point(modulecenter_3.pt_5)

# ---- group: isBuilding
bool_23 = Boolean(or_4)

# ----
and_16 = GateAnd(A=and_11, B=equals_24.Inequality)  # disabled

# ---- group: mask settings
swatch_6 = ColourSwatch(SwatchColor=RGB(0, 0, 0))  # disabled
panel_169 = Panel(".5")  # disabled
path_4 = FilePath("C:\Users\RYAN\Documents\GitHub\CityMatrix\Map\MAP_BLACK.png")  # disabled

# ----
dispatch_21 = Dispatch(List=pt_120, DispatchPattern=equals_20.Inequality)  # -> ListA, ListB; disabled

# ---- group: module center
pt_123 = Point(modulecenter_4.pt_5)

# ---- group: isBuilding
bool_24 = Boolean(or_5)

# ----
randomsplit = RandomSplitList(MasterList=geobottomcenter, Seed=Slider(32, range=0..100), Split=division_23)  # -> ListA, ListB
lng_9 = ListLength(List=randomsplit.ListA)
division_24 = Division(A=int_160, B=lng_9)
scale_nu_18 = ScaleNU(Geometry=planesrf_3, Plane=PlaneXY(0, 0, 0), ScaleX=num_81, ScaleY=num_81, ScaleZ=1)  # -> Geometry, Transform
Z_6 = UnitZ(Factor=move_z_2)
filter_32 = StreamFilter(Gate=and_13, Stream1=srf_3)  # disabled
filter_33 = StreamFilter(Gate=and_16, Stream1=srf_4)  # disabled
filter_34 = StreamFilter(Gate=and_14, Stream1=srf_5)  # disabled
filter_35 = StreamFilter(Gate=and_15, Stream1=srf_6)  # disabled
mesh_67 = Mesh(mesh_59)
filter_36 = StreamFilter(Gate=and_16, Stream1=srf_2)  # disabled
randomsplit_2 = RandomSplitList(MasterList=randomsplit.ListA, Seed=Slider(25, range=0..100), Split=division_24)  # -> ListA, ListB
scale_nu_19 = ScaleNU(Geometry=planesrf_4, Plane=PlaneXY(0, 0, 0), ScaleX=num_84, ScaleY=num_84, ScaleZ=1)  # -> Geometry, Transform
Z_7 = UnitZ(Factor=move_z_3)

# ---- group: mask setting
swatch_7 = ColourSwatch(SwatchColor=RGBA(0, 0, 0, 127))  # disabled

# ----
dispatch_22 = Dispatch(List=int_149, DispatchPattern=bool_23)  # -> ListA, ListB
dispatch_23 = Dispatch(List=pt_122, DispatchPattern=bool_23)  # -> ListA, ListB

# ---- group: 3D City / cell size
num_88 = Number(division_17)

# ---- group: cell area
sqr_2 = Square(Value=num_88)

# ----
multiplication_45 = Multiplication(A=sqr_2, B=number_slider_14)

# ---- group: floor area
num_89 = Number(multiplication_45)

# ----
vec2pt_6 = Vector2Pt(PointA=Point(0, 0, 0), PointB=dispatch_21.ListA, Unitize=False)  # -> Vector, Length; disabled
move_28 = Move(Geometry=scale_nu_18.Geometry, Motion=Z_6)  # -> Geometry, Transform
dispatch_24 = Dispatch(List=int_157, DispatchPattern=bool_24)  # -> ListA, ListB
dispatch_25 = Dispatch(List=pt_123, DispatchPattern=bool_24)  # -> ListA, ListB

# ---- group: 3D City / 3D building site move amount
vec_3 = Vector(X_3)

# ----
move_29 = Move(Geometry=scale_nu_19.Geometry, Motion=Z_7)  # -> Geometry, Transform
move_30 = Move(Geometry=move_27.Geometry, Motion=vec2pt_6.Vector)  # -> Geometry, Transform; disabled
preview_11 = CustomPreview(Geometry=filter_32, Shader=swatch_7)  # disabled
preview_12 = CustomPreview(Geometry=filter_33, Shader=swatch_7)  # disabled
preview_13 = CustomPreview(Geometry=filter_34, Shader=swatch_7)  # disabled
preview_14 = CustomPreview(Geometry=filter_35, Shader=swatch_7)  # disabled
preview_15 = CustomPreview(Geometry=filter_36, Shader=swatch_7)  # disabled
# Population Diversity Formular:
# (P1*log10(P1)+P2*log10(P2)+P3*log10(P3)) / log10(3) * (-1)
# P is probability
panel_170 = Panel("""Res. Small
Density
Approximity
Health
Life Quality
Traffic
Energy
Education
Invation""")

# ---- group: parking / parking center
pt_124 = Point(randomsplit.ListB)

# ---- group: park center lego
pt_125 = Point(randomsplit_2.ListB)

# ---- group: module center - building only
pt_126 = Point(dispatch_23.ListA)

# ----
cps_2 = ClosestPoints(Point=pt_126, Cloud=pt_126, Count=range_count_2)  # -> ClosestPoint, CPIndex, Distance
smaller_8 = SmallerThan(FirstNumber=cps_2.Distance, SecondNumber=number_slider_37)  # -> SmallerThan, OrEqualTo

# ---- group: module id - building only
int_164 = Integer(dispatch_22.ListA)

# ----
item_50 = ListItem(List=int_164, Index=cps_2.CPIndex, Wrap=False)

# ---- group: module center - building only
pt_127 = Point(dispatch_25.ListA)

# ----
cps_3 = ClosestPoints(Point=pt_123, Cloud=pt_127, Count=range_count_3)  # -> ClosestPoint, CPIndex, Distance
smaller_9 = SmallerThan(FirstNumber=cps_3.Distance, SecondNumber=number_slider_38)  # -> SmallerThan, OrEqualTo

# ---- group: module id - building only
int_165 = Integer(dispatch_24.ListA)

# ----
item_51 = ListItem(List=int_165, Index=cps_3.CPIndex, Wrap=False)
vec2pt_7 = Vector2Pt(PointA=Point(0, 0, 0), PointB=pt_126, Unitize=False)  # -> Vector, Length

# ---- group: 3D City / base height
panel_171 = Panel("5.0")

# ----
vec2pt_8 = Vector2Pt(PointA=Point(0, 0, 0), PointB=pt_123, Unitize=False)  # -> Vector, Length
dispatch_26 = Dispatch(List=item_50, DispatchPattern=smaller_8.OrEqualTo)  # -> ListA, ListB
mjoin_5 = MeshJoin(Meshes=move_30.Geometry)  # disabled

# ---- group: ref mask srf - O
srf_7 = Surface(<surface referenced from the Rhino model>)  # disabled

# ---- group: ref mask srf - OM
srf_8 = Surface(<surface referenced from the Rhino model>)  # disabled

# ---- group: ref mask srf - bar work
srf_9 = Surface(<surface referenced from the Rhino model>)  # disabled

# ---- group: ref mask srf - OS
srf_10 = Surface(<surface referenced from the Rhino model>)  # disabled

# ---- group: ref mask srf - OL
srf_11 = Surface(<surface referenced from the Rhino model>)  # disabled

# ----
dispatch_27 = Dispatch(List=cps_3.ClosestPoint, DispatchPattern=smaller_9.OrEqualTo)  # -> ListA, ListB
dispatch_28 = Dispatch(List=item_51, DispatchPattern=smaller_9.OrEqualTo)  # -> ListA, ListB
dispatch_29 = Dispatch(List=cps_3.Distance, DispatchPattern=smaller_9.OrEqualTo)  # -> ListA, ListB
panel_172 = Panel("1.0")  # disabled
panel_173 = Panel("0.0")  # disabled
panel_174 = Panel("1.0")  # disabled
panel_175 = Panel("0.0")  # disabled
vec2pt_9 = Vector2Pt(PointA=Point(0, 0, 0), PointB=pt_125, Unitize=False)  # -> Vector, Length
panel_176 = Panel("1.0")  # disabled
panel_177 = Panel("0.0")  # disabled

# ---- group: 3D City / building height for each type
num_90 = Number(num_22)

# ----
panel_178 = Panel("5")  # disabled
panel_179 = Panel("4")  # disabled
panel_180 = Panel("3")  # disabled
filter_37 = StreamFilter(Gate=equals_19.Equality, Stream0=mjoin_5)  # disabled
move_31 = Move(Geometry=mesh_66, Motion=vec2pt_9.Vector)  # -> Geometry, Transform

# ---- group: module ids in range
int_166 = Integer(dispatch_26.ListA)

# ----
equals_26 = Equality(FirstNumber=int_161, SecondNumber=panel_179)  # -> Equality, Inequality; disabled
equals_27 = Equality(FirstNumber=int_161, SecondNumber=panel_178)  # -> Equality, Inequality; disabled
and_17 = GateAnd(A=equals_27.Inequality, B=equals_26.Inequality)  # disabled
equals_28 = Equality(FirstNumber=int_161, SecondNumber=panel_180)  # -> Equality, Inequality; disabled
and_18 = GateAnd(A=and_17, B=equals_28.Inequality)  # disabled

# ---- group: bldg cntr in range
pt_128 = Point(dispatch_27.ListA)

# ---- group: distances in range
num_91 = Number(dispatch_29.ListA)

# ---- group: module ids in range
int_167 = Integer(dispatch_28.ListA)

# ----
num_92 = Number(panel_172)  # disabled
num_93 = Number(panel_173)  # disabled
num_94 = Number(panel_174)  # disabled
num_95 = Number(panel_175)  # disabled
num_96 = Number(panel_176)  # disabled
num_97 = Number(panel_177)  # disabled
num_98 = Number("1.0")
num_99 = Number("0.0")

number_slider_39 = Slider(1, range=0..10)
argb = SplitARGB(Colour=ColourSwatch(SwatchColor=RGB(0, 0, 0)))  # -> Alpha, Red, Green, Blue
frgb_21 = ColourRGBF(Alpha=Slider(1, range=0..1), Red=argb.Red, Green=argb.Green, Blue=argb.Blue)

and_19 = GateAnd(A=equals_26.Inequality, B=equals_24.Inequality)  # disabled
and_20 = GateAnd(A=equals_27.Inequality, B=equals_24.Inequality)  # disabled
and_21 = GateAnd(A=equals_28.Inequality, B=equals_24.Inequality)  # disabled
previewmat = CustomPreviewMaterials(Geometry=filter_37, DiffuseColor=swatch_6, Transparency=panel_169, DiffuseBitmap=path_4)  # disabled
and_22 = GateAnd(A=and_18, B=equals_24.Inequality)  # disabled
equals_29 = Equality(FirstNumber=int_166, SecondNumber="3")  # -> Equality, Inequality
equals_30 = Equality(FirstNumber=int_166, SecondNumber="5")  # -> Equality, Inequality
equals_31 = Equality(FirstNumber=int_166, SecondNumber="4")  # -> Equality, Inequality
equals_32 = Equality(FirstNumber=int_166, SecondNumber="0")  # -> Equality, Inequality
equals_33 = Equality(FirstNumber=int_166, SecondNumber="2")  # -> Equality, Inequality
equals_34 = Equality(FirstNumber=int_166, SecondNumber="1")  # -> Equality, Inequality
equals_35 = Equality(FirstNumber=int_166, SecondNumber="8")  # -> Equality, Inequality
item_52 = ListItem(List=num_87, Index=int_167, Wrap=False)
addition_17 = Addition(A=num_91, B=num_83)
filter_38 = StreamFilter(Gate=and_19, Stream1=srf_8)  # disabled
filter_39 = StreamFilter(Gate=and_22, Stream1=srf_9)  # disabled
filter_40 = StreamFilter(Gate=and_20, Stream1=srf_10)  # disabled
filter_41 = StreamFilter(Gate=and_21, Stream1=srf_11)  # disabled
filter_42 = StreamFilter(Gate=and_22, Stream1=srf_7)  # disabled
int_168 = Integer(equals_29.Equality)
int_169 = Integer(equals_32.Equality)
int_170 = Integer(equals_31.Equality)
int_171 = Integer(equals_30.Equality)
int_172 = Integer(equals_34.Equality)
int_173 = Integer(equals_33.Equality)
int_174 = Integer(equals_35.Equality)

# ---- group: park lego
mesh_68 = Mesh(move_31.Geometry)

# ----
ma_17 = MassAddition(Input=int_168)  # -> Result, PartialResults
ma_18 = MassAddition(Input=int_171)  # -> Result, PartialResults
ma_19 = MassAddition(Input=int_170)  # -> Result, PartialResults
ma_20 = MassAddition(Input=int_169)  # -> Result, PartialResults
ma_21 = MassAddition(Input=int_173)  # -> Result, PartialResults
ma_22 = MassAddition(Input=int_172)  # -> Result, PartialResults
ma_23 = MassAddition(Input=int_174)  # -> Result, PartialResults

# ---- group: 3D City / building height factor
number_slider_40 = Slider(3.1, range=0..10)

# ----
preview_16 = CustomPreview(Geometry=filter_38, Shader=swatch_7)  # disabled
preview_17 = CustomPreview(Geometry=filter_39, Shader=swatch_7)  # disabled
preview_18 = CustomPreview(Geometry=filter_40, Shader=swatch_7)  # disabled
preview_19 = CustomPreview(Geometry=filter_41, Shader=swatch_7)  # disabled
preview_20 = CustomPreview(Geometry=filter_42, Shader=swatch_7)  # disabled

# ---- group: distances in range - avoid 0
num_100 = Number(addition_17)

# ---- group: # ppl in range
num_101 = Number(item_52)

# ----
gradient_3 = Gradient(LowerLimit=0, UpperLimit=1, stops=[0: RGB(255, 0, 0), 0.5: RGB(222, 222, 0), 1: RGB(0, 128, 0)])

# ---- group: score range by experience
panel_181 = Panel("0.0 To 500.0")

# ---- group: building # in range
int_175 = Integer(ma_21.Result)
int_176 = Integer(ma_20.Result)
int_177 = Integer(ma_22.Result)
int_178 = Integer(ma_17.Result)
int_179 = Integer(ma_19.Result)
int_180 = Integer(ma_23.Result)

int_181 = Integer(ma_18.Result)

# ----
division_25 = Division(A=num_101, B=num_100)
gradient_4 = Gradient(LowerLimit=0, UpperLimit=1, stops=[0: RGB(255, 0, 0), 0.5: RGB(222, 222, 0), 1: RGB(0, 128, 0)])
item_53 = ListItem(List=num_86, Index="0", Wrap=False)
item_54 = ListItem(List=num_86, Index="2", Wrap=False)
item_55 = ListItem(List=num_86, Index="1", Wrap=False)
item_56 = ListItem(List=num_86, Index="3", Wrap=False)
item_57 = ListItem(List=num_86, Index="4", Wrap=False)
item_58 = ListItem(List=num_86, Index="5", Wrap=False)
item_59 = ListItem(List=num_86, Index="8", Wrap=False)

# ---- group: Alpha
number_slider_41 = Slider(0.5, range=0..1)

# ----
equals_36 = Equality(FirstNumber=list, SecondNumber=1760)  # -> Equality, Inequality
ma_24 = MassAddition(Input=division_25)  # -> Result, PartialResults

# ---- group: # ppl per building
num_102 = Number(item_53)
num_103 = Number(item_55)
num_104 = Number(item_54)
num_105 = Number(item_56)
num_106 = Number(item_57)
num_107 = Number(item_58)

# ----
num_108 = Number(item_59)
pshift_55 = ShiftPaths(Data=ma_24.Result, Offset=-1)
p_n_c_2 = PickNChoose(Pattern=equals_36.Inequality, Stream0=panel_181, Stream1="0.0 To 50.0")
multiplication_46 = Multiplication(A=int_178, B=num_105)
multiplication_47 = Multiplication(A=int_177, B=num_103)
multiplication_48 = Multiplication(A=int_179, B=num_106)
multiplication_49 = Multiplication(A=int_181, B=num_107)
multiplication_50 = Multiplication(A=int_176, B=num_102)
multiplication_51 = Multiplication(A=int_175, B=num_104)
multiplication_52 = Multiplication(A=int_180, B=num_108)

# ---- group: Alpha
number_slider_42 = Slider(0.5, range=0..1)

# ---- group: population density score
num_109 = Number(pshift_55)

# ----
bnd_2 = Bounds(Numbers=num_109)
panel_182 = Panel(bnd_2)
pshift_56 = ShiftPaths(Data=multiplication_46, Offset=-1)
pshift_57 = ShiftPaths(Data=multiplication_47, Offset=-1)
pshift_58 = ShiftPaths(Data=multiplication_50, Offset=-1)
pshift_59 = ShiftPaths(Data=multiplication_51, Offset=-1)
pshift_60 = ShiftPaths(Data=multiplication_48, Offset=-1)
pshift_61 = ShiftPaths(Data=multiplication_49, Offset=-1)
pshift_62 = ShiftPaths(Data=multiplication_52, Offset=-1)
remap_8 = RemapNumbers(Value=num_109, Source=p_n_c_2, Target=Domain(0, 1))  # -> Mapped, Clipped
max_12 = Maximum(A=remap_8.Mapped, B=0)
min_4 = Minimum(A=max_12, B=1)

# ---- group: total # ppl in range
num_110 = Number(pshift_58)
num_111 = Number(pshift_57)
num_112 = Number(pshift_59)
num_113 = Number(pshift_56)
num_114 = Number(pshift_60)
num_115 = Number(pshift_61)

num_116 = Number(num_110)
num_117 = Number(num_111)
num_118 = Number(num_112)
num_119 = Number(num_113)
num_120 = Number(num_114)
num_121 = Number(num_115)

# ----
addition_18 = Addition(A=num_119, B=num_120)  # disabled
addition_19 = Addition(A=num_116, B=num_117)  # disabled
addition_20 = Addition(A=addition_18, B=num_121)  # disabled
addition_21 = Addition(A=addition_19, B=num_118)  # disabled

# ---- group: living
num_122 = Number(addition_21)  # disabled

# ---- group: working
num_123 = Number(addition_20)  # disabled

# ---- group: RL pop.
num_124 = Number(graft(num_116))

# ---- group: OL pop.
num_125 = Number(graft(num_119))

# ---- group: RS pop.
num_126 = Number(graft(num_118))

# ---- group: OS pop.
num_127 = Number(graft(num_121))

# ---- group: OL pop.
num_128 = Number(graft(num_119))  # disabled

# ---- group: OM pop.
num_129 = Number(graft(num_120))

# ---- group: RM pop.
num_130 = Number(graft(num_117))

# ---- group: OS pop.
num_131 = Number(graft(num_121))  # disabled

# ---- group: OM pop.
num_132 = Number(graft(num_120))  # disabled

# ---- group: RL pop.
num_133 = Number(graft(num_116))  # disabled

# ---- group: RS pop.
num_134 = Number(graft(num_118))  # disabled

# ---- group: RM pop.
num_135 = Number(graft(num_117))  # disabled

# ---- group: R pop.
num_136 = Number(graft(num_122))  # disabled

# ---- group: O pop.
num_137 = Number(graft(num_123))  # disabled

# ----
addition_22 = Addition(A=num_127, B=panel_154)
addition_23 = Addition(A=num_126, B=panel_154)
addition_24 = Addition(A=num_125, B=panel_154)
addition_25 = Addition(A=num_124, B=panel_154)
addition_26 = Addition(A=num_129, B=panel_154)
addition_27 = Addition(A=num_130, B=panel_154)
addition_28 = Addition(A=num_131, B=panel_155)  # disabled
addition_29 = Addition(A=num_128, B=panel_155)  # disabled
addition_30 = Addition(A=num_132, B=panel_155)  # disabled
addition_31 = Addition(A=num_134, B=panel_156)  # disabled
addition_32 = Addition(A=num_133, B=panel_156)  # disabled
addition_33 = Addition(A=num_135, B=panel_156)  # disabled
addition_34 = Addition(A=num_136, B=panel_159)  # disabled
addition_35 = Addition(A=num_137, B=panel_159)  # disabled
ma_25 = MassAddition(Input=[addition_29, addition_30, addition_28])  # -> Result, PartialResults; disabled
ma_26 = MassAddition(Input=[addition_32, addition_33, addition_31])  # -> Result, PartialResults; disabled
ma_27 = MassAddition(Input=[addition_34, addition_35])  # -> Result, PartialResults; disabled

# ---- group: total O. pop.
num_138 = Number(ma_25.Result)  # disabled

# ----
division_26 = Division(A=addition_29, B=num_138)  # disabled
division_27 = Division(A=addition_28, B=num_138)  # disabled
division_28 = Division(A=addition_30, B=num_138)  # disabled

# ---- group: total res. pop.
num_139 = Number(ma_26.Result)  # disabled

# ----
division_29 = Division(A=addition_32, B=num_139)  # disabled
division_30 = Division(A=addition_31, B=num_139)  # disabled
division_31 = Division(A=addition_33, B=num_139)  # disabled

# ---- group: total O. pop.
num_140 = Number(ma_27.Result)  # disabled

# ----
division_32 = Division(A=addition_34, B=num_140)  # disabled
division_33 = Division(A=addition_35, B=num_140)  # disabled

# ---- group: % OL pop.
num_141 = Number(division_26)  # disabled

# ---- group: % OM pop.
num_142 = Number(division_28)  # disabled

# ---- group: % OS pop.
num_143 = Number(division_27)  # disabled

# ---- group: % RL pop.
num_144 = Number(division_29)  # disabled

# ---- group: % RM pop.
num_145 = Number(division_31)  # disabled

# ---- group: % RS pop.
num_146 = Number(division_30)  # disabled

# ---- group: % OL pop.
num_147 = Number(division_32)  # disabled

# ---- group: % OM pop.
num_148 = Number(division_33)  # disabled

# ---- group: Diversity Calc
eval = Evaluate(F=panel_158, P1=num_141, P2=num_142, P3=num_143)  # disabled

eval_2 = Evaluate(F=panel_160, P1=num_144, P2=num_145, P3=num_146)  # disabled

eval_3 = Evaluate(F=panel_161, P1=num_147, P2=num_148)  # disabled

# ----
pshift_63 = ShiftPaths(Data=eval, Offset=-1)  # disabled
pshift_64 = ShiftPaths(Data=eval_2, Offset=-1)  # disabled
pshift_65 = ShiftPaths(Data=eval_3, Offset=-1)  # disabled

# ---- group: office diversity - all
num_149 = Number(pshift_63)  # disabled

# ---- group: residential diversity - all
num_150 = Number(pshift_64)  # disabled

# ---- group: living working diversity - all
num_151 = Number(pshift_65)  # disabled

# ----
replace_4 = ReplaceMembers(Set=num_149, Find=num_92, Replace=num_93)  # disabled
replace_5 = ReplaceMembers(Set=num_150, Find=num_94, Replace=num_95)  # disabled
replace_6 = ReplaceMembers(Set=num_151, Find=num_96, Replace=num_97)  # disabled

# ---- group: office diversity
num_152 = Number(replace_4)  # disabled

# ---- group: residential diversity
num_153 = Number(replace_5)  # disabled

# ---- group: living working diversity
num_154 = Number(replace_6)  # disabled

# ----
addition_36 = Addition(A=num_153, B=num_152)  # disabled
addition_37 = Addition(A=addition_36, B=num_154)  # disabled
division_34 = Division(A=addition_37, B=3)  # disabled
num_155 = Number(pshift_62)
num_156 = Number(num_155)

# ---- group: CI pop.
num_157 = Number(graft(num_156))

# ----
addition_38 = Addition(A=num_157, B=panel_154)
ma_28 = MassAddition(Input=[addition_25, addition_27, addition_23, addition_24, addition_26, addition_22, addition_38])  # -> Result, PartialResults

# ---- group: total O. pop.
num_158 = Number(ma_28.Result)

# ----
division_35 = Division(A=addition_24, B=num_158)
division_36 = Division(A=addition_25, B=num_158)
division_37 = Division(A=addition_22, B=num_158)
division_38 = Division(A=addition_23, B=num_158)
division_39 = Division(A=addition_26, B=num_158)
division_40 = Division(A=addition_27, B=num_158)
division_41 = Division(A=addition_38, B=num_158)

# ---- group: % RL pop.
num_159 = Number(division_36)

# ---- group: % OL pop.
num_160 = Number(division_35)

# ---- group: % RM pop.
num_161 = Number(division_40)

# ---- group: % OM pop.
num_162 = Number(division_39)

# ---- group: % RS pop.
num_163 = Number(division_38)

# ---- group: % OS pop.
num_164 = Number(division_37)

# ---- group: % CI pop.
num_165 = Number(division_41)

# ---- group: Diversity Calc
eval_4 = Evaluate(F=panel_157, P1=num_159, P2=num_161, P3=num_163, P4=num_160, P5=num_162, P6=num_164, P9=num_165)

# ----
pshift_66 = ShiftPaths(Data=eval_4, Offset=-1)

# ---- group: diversity - all
num_166 = Number(pshift_66)

# ----
replace_7 = ReplaceMembers(Set=num_166, Find=num_98, Replace=num_99)

# ---- group: diversity
num_167 = Number(replace_7)

# ---- group: final pop. diversity
num_168 = Number(num_167)

# ----
gradient_5 = Gradient(LowerLimit=0, UpperLimit=1, Parameter=num_168, stops=[0: RGB(0, 0, 0), 1: RGB(255, 255, 255)])
avr_2 = Average(Input=num_168)

# ---- group: population density score normalized
num_169 = Number(remap_8.Mapped)

# ----
gradient_6 = Gradient(LowerLimit=0, UpperLimit=1, Parameter=num_169, stops=[0: RGB(0, 0, 0), 1: RGB(255, 255, 255)])
Z_8 = UnitZ(Factor="10")
avr_3 = Average(Input=num_169)
Z_9 = UnitZ(Factor="10")

multiplication_53 = Multiplication(A=num_63, B=division_8)
cell_size = Number(multiplication_53)

python_15 = PythonScript(x=Slider(9, range=6..15), scale=division_8)  # -> out, out_2; inputs inL: list
# ---------- python_15: Python ----------
out = x if scale>1 else x+2
# ---------- end python_15 ----------

# ---- group: adjust scales
subtraction_4 = Subtraction(A=python_15.out_2, B="0.75")
dom_7 = ConstructDomain(DomainStart="-0.25", DomainEnd=subtraction_4)

# ----
panel_183 = Panel(dom_7)
remap_9 = RemapNumbers(Value=num_19, Source=Domain(0, 1), Target=panel_183)  # -> Mapped, Clipped

# ---- group: viz ctrl - slider
int_182 = Integer(remap_9.Mapped)

# ----
panel_184 = Panel(int_182)

# ---- group: viz ctrl - slider
int_183 = Integer(int_182)

# ----
panel_185 = Panel(int_183)

# ---- group: viz ctrl - AI override
int_184 = Integer(int_183)

# ----
panel_186 = Panel(int_184)

# ---- group: viz ctrl - AI override
# Energy/Cost Efficiency Heatmap - GH
int_185 = Integer(int_184)

# ----
panel_187 = Panel(int_185)
filter_43 = StreamFilter(Gate=int_185, Stream4=int_118)

# ---- group: viz ctrl - AI override
int_186 = Integer(int_184)

# ----
panel_188 = Panel(int_186)
equals_37 = Equality(FirstNumber=int_186, SecondNumber="1")  # -> Equality, Inequality

# ---- group: Show Google Map
bool_25 = Boolean(equals_37.Equality)

# ----
filter_44 = StreamFilter(Gate=bool_25, Stream1=move_11.Geometry)

# ---- group: keystone
morph = BoxMorph(Geometry=filter_44, Reference=box_2, Target=tbox_2)

# ----
pt_129 = Point(<point referenced from the Rhino model>)
pt_130 = Point(<point referenced from the Rhino model>)
ln_4 = Line(StartPoint=pt_129, EndPoint=pt_130)
subtraction_5 = Subtraction(A=python_15.out_2, B="1")
divide_4 = DivideCurve(Curve=ln_4, Count=subtraction_5, Kinks=False)  # -> Points, Tangents, Parameters

crv_9 = Curve(<curve referenced from the Rhino model>)
subtraction_6 = Subtraction(A=python_15.out_2, B="0")
divide_5 = DivideCurve(Curve=crv_9, Count=subtraction_6, Kinks=False)  # -> Points, Tangents, Parameters

filter_45 = StreamFilter(Gate=int_185, Stream4=num_76)
gradient_7 = Gradient(
    LowerLimit=0,
    UpperLimit=1,
    Parameter=filter_45,
    stops=[0: RGB(255, 0, 0), 0.299: RGB(255, 110, 0), 0.5: RGB(255, 255, 0), 0.703: RGB(123, 255, 0), 1: RGB(0, 255, 0)])

# ---- group: Ref Pts
pt_131 = Point(divide_4.Points)

# ----
item_60 = ListItem(List=pt_131, Index="0", Wrap=True)
item_61 = ListItem(List=pt_131, Index="1", Wrap=True)
dist_3 = Distance(PointA=item_60, PointB=item_61)
division_42 = Division(A=dist_3, B="2")
vec_4 = VectorXYZ(XComponent=division_42, YComponent=0, ZComponent=0)  # -> Vector, Length
move_32 = Move(Geometry=pt_131, Motion=vec_4.Vector)  # -> Geometry, Transform

# ---- group: Ref Pts
pt_132 = Point(divide_5.Points)

# ----
item_62 = ListItem(List=pt_132, Index="0", Wrap=True)
item_63 = ListItem(List=pt_132, Index="1", Wrap=True)
dist_4 = Distance(PointA=item_62, PointB=item_63)
division_43 = Division(A=dist_4, B="2")
vec_5 = VectorXYZ(XComponent=division_43, YComponent=0, ZComponent=0)  # -> Vector, Length
move_33 = Move(Geometry=pt_132, Motion=vec_5.Vector)  # -> Geometry, Transform

filter_46 = StreamFilter(Gate=bool_25, Stream0=mesh_58)
argb_2 = SplitARGB(Colour=gradient_7)  # -> Alpha, Red, Green, Blue
filter_47 = StreamFilter(Gate=bool_25, Stream0=mesh_59)
filter_48 = StreamFilter(Gate=bool_25, Stream0=mesh_54)
filter_49 = StreamFilter(Gate=bool_25, Stream0=mesh_55)  # disabled
filter_50 = StreamFilter(Gate=bool_25, Stream0=mesh_56)
filter_51 = StreamFilter(Gate=bool_25, Stream0=mesh_57)

pdecon_30 = Deconstruct(Point=item_60)  # -> XComponent, YComponent, ZComponent
pdecon_31 = Deconstruct(Point=item_62)  # -> XComponent, YComponent, ZComponent
python_16 = PythonScript(x=subtraction_6)  # -> out, a; inputs x: Int32
# ---------- python_16: Python ----------
import math
a = []
for n in range(x):
    i = max(n-int(x/2),int(x/2)-n)+2
    a.append(i)
    
print(a)
# ---------- end python_16 ----------
subtraction_7 = Subtraction(A=pdecon_30.YComponent, B=pdecon_31.YComponent)
division_44 = Division(A=subtraction_7, B=python_16.a)

number_slider_43 = Slider(10, range=0..30)
neg_12 = Negative(Value=number_slider_43)
vec_6 = VectorXYZ(XComponent=0, YComponent=Slider(10, range=0..30), ZComponent=0)  # -> Vector, Length
vec_7 = VectorXYZ(XComponent=number_slider_43, YComponent=0, ZComponent=0)  # -> Vector, Length
vec_8 = VectorXYZ(XComponent=neg_12, YComponent=0, ZComponent=0)  # -> Vector, Length
move_34 = Move(Geometry=move_33.Geometry, Motion=vec_7.Vector)  # -> Geometry, Transform
move_35 = Move(Geometry=move_33.Geometry, Motion=vec_8.Vector)  # -> Geometry, Transform
ln_5 = Line(StartPoint=move_34.Geometry, EndPoint=move_35.Geometry)
vec_9 = VectorXYZ(XComponent=0, YComponent=division_44, ZComponent=0)  # -> Vector, Length
split_6 = SplitList(List=ln_5, Index=subtraction_6)  # -> ListA, ListB
crv_10 = Curve(split_6.ListA)
curvepoint = PointOnCurve(crv_10, parameter=0.5)
move_36 = Move(Geometry=curvepoint, Motion=vec_9.Vector)  # -> Geometry, Transform

frgb_22 = ColourRGBF(Alpha=num_57, Red=argb_2.Red, Green=argb_2.Green, Blue=argb_2.Blue)

# ---- group: viz color
col_47 = Colour(frgb_22)

# ---- group: Position Calibration / center line mesh final!
mesh_69 = Mesh(filter_49)  # disabled

# ---- group: Position Calibration / road mesh final!
mesh_70 = Mesh(filter_48)

# ---- group: Position Calibration / blank
mesh_71 = Mesh(filter_50)

# ---- group: Position Calibration / building lego modules
mesh_72 = Mesh(filter_46)

# ---- group: Position Calibration / sidewalk mesh final!
mesh_73 = Mesh(filter_51)

# ----
subtraction_8 = Subtraction(A=subtraction_7, B=division_44)
neg_13 = Negative(Value=subtraction_8)
vec_10 = VectorXYZ(XComponent=0, YComponent=neg_13, ZComponent=0)  # -> Vector, Length
move_37 = Move(Geometry=move_32.Geometry, Motion=vec_6.Vector)  # -> Geometry, Transform
move_38 = Move(Geometry=move_32.Geometry, Motion=vec_10.Vector)  # -> Geometry, Transform
ln_6 = Line(StartPoint=move_38.Geometry, EndPoint=move_37.Geometry)
ln_7 = Line(StartPoint=move_38.Geometry, EndPoint=move_36.Geometry)
ln_8 = Line(StartPoint=curvepoint, EndPoint=move_36.Geometry)

# ---- group: viz ctrl - AI override
int_187 = Integer(int_184)

# ----
equals_38 = Equality(FirstNumber=int_187, SecondNumber=python_12.a)  # -> Equality, Inequality
item_64 = ListItem(List=[ColourSwatch(SwatchColor=RGB(125, 125, 125)), swatch_5], Index=equals_38.Equality, Wrap=False)

# ---- group: keystone
morph_2 = BoxMorph(Geometry=mesh_71, Reference=box_2, Target=tbox_2)

morph_3 = BoxMorph(Geometry=mesh_72, Reference=box_2, Target=tbox_2)

morph_4 = BoxMorph(Geometry=mesh_73, Reference=box_2, Target=tbox_2)

morph_5 = BoxMorph(Geometry=mesh_70, Reference=box_2, Target=tbox_2)

# ----
python_17 = PythonScript(x=subtraction_6, scale=division_8, inL=merge_17)  # -> out, out_2; inputs inL: list
# ---------- python_17: Python ----------
out = inL[:int(x)] if scale>1 else inL
# ---------- end python_17 ----------
python_18 = PythonScript(x=subtraction_6, scale=division_8, inL=item_64)  # -> out, out_2; inputs inL: list; same code as python_17
panel_189 = Panel(int_187)

# ---- group: blank
mesh_74 = Mesh(morph_2)

# ---- group: building lego modules
mesh_75 = Mesh(morph_3)

# ---- group: fl # slider
tag_30 = TextTag3D(Location=pt_131, Text=python_17.out_2, Size=Slider(13.5, range=0..100), Colour=python_18.out_2, Justification=4)

# ---- group: road mesh final!
mesh_76 = Mesh(morph_5)

# ---- group: sidewalk mesh final!
mesh_77 = Mesh(morph_4)

# ----
item_65 = ListItem(List=ln_6, Index=int_187, Wrap=True)
item_66 = ListItem(List=crv_10, Index=int_187, Wrap=True)
item_67 = ListItem(List=ln_8, Index=int_187, Wrap=True)
item_68 = ListItem(List=ln_7, Index=int_187, Wrap=True)
# Population Density Heatmap - GH
previewlw = CustomPreviewLineweights(Geometry=[ln_8, ln_7, ln_6, crv_10], Shader=ColourSwatch(SwatchColor=RGB(125, 125, 125)), Absolute=False)
previewlw_2 = CustomPreviewLineweights(Geometry=[item_66, item_67, item_68, item_65], Shader=ColourSwatch(SwatchColor=RGB(255, 255, 255)), Absolute=False)

# ---- group: viz ctrl - AI override
int_188 = Integer(int_184)

# ----
panel_190 = Panel(int_188)

# ---- group: viz ctrl - AI override
int_189 = Integer(int_184)

# ----
panel_191 = Panel(int_189)
filter_52 = StreamFilter(Gate=int_188, Stream3=int_144)
filter_53 = StreamFilter(Gate=int_189, Stream2=int_145)

# ---- group: 3D City / road mesh final!
mesh_78 = Mesh(mesh_70)

# ----
filter_54 = StreamFilter(Gate=int_188, Stream3=num_168)
filter_55 = StreamFilter(Gate=int_189, Stream2=num_169)
gradient_8 = Gradient(
    LowerLimit=0,
    UpperLimit=1,
    Parameter=filter_54,
    stops=[0: RGB(255, 0, 0), 0.299: RGB(255, 110, 0), 0.5: RGB(255, 255, 0), 0.703: RGB(123, 255, 0), 1: RGB(0, 255, 0)])
filter_56 = StreamFilter(Gate=bool_25, Stream0=mesh_68)
gradient_9 = Gradient(
    LowerLimit=0,
    UpperLimit=1,
    Parameter=filter_55,
    stops=[0: RGB(255, 0, 0), 0.299: RGB(255, 110, 0), 0.5: RGB(255, 255, 0), 0.703: RGB(123, 255, 0), 1: RGB(0, 255, 0)])
argb_3 = SplitARGB(Colour=gradient_8)  # -> Alpha, Red, Green, Blue

# ---- group: Position Calibration / park lego
mesh_79 = Mesh(filter_56)

# ----
frgb_23 = ColourRGBF(Alpha=num_57, Red=argb_3.Red, Green=argb_3.Green, Blue=argb_3.Blue)
argb_4 = SplitARGB(Colour=gradient_9)  # -> Alpha, Red, Green, Blue

# ---- group: viz color
col_48 = Colour(frgb_23)

# ----
frgb_24 = ColourRGBF(Alpha=num_57, Red=argb_4.Red, Green=argb_4.Green, Blue=argb_4.Blue)

# ---- group: keystone
morph_6 = BoxMorph(Geometry=mesh_79, Reference=box_2, Target=tbox_2)

# ---- group: viz color
col_49 = Colour(frgb_24)

# ---- group: park lego
mesh_80 = Mesh(morph_6)

# ---- group: viz ctrl - AI override
int_190 = Integer(int_184)

# ----
number_slider_44 = Slider(7, range=0..9)
panel_192 = Panel(int_190)
int_191 = Integer(int_190)

# ---- group: distance index
index_2 = Slider(300, range=1..1500)

# ----
# Work Prox - Tuo
panel_193 = Panel("5")
run_module = GhPythonScript(need=panel_193, actual=int_191)  # -> out, run; inputs need: Int32, actual: Int32
# ---------- run_module: Python ----------
__author__ = "sunt"
__version__ = "2018.06.03"

import rhinoscriptsyntax as rs

run = ( need == actual)
# ---------- end run_module ----------

run_module_2 = GhPythonScript(need="6", actual=int_191)  # -> out, run; inputs need: Int32, actual: Int32; same code as run_module

# ----
# Park Prox - Tuo
panel_194 = Panel("7")
run_module_3 = GhPythonScript(need=panel_194, actual=int_191)  # -> out, run; inputs need: Int32, actual: Int32; same code as run_module

# ----
# Solar - Tuo
panel_195 = Panel("10")
run_module_4 = GhPythonScript(need=panel_195, actual=int_191)  # -> out, run; inputs need: Int32, actual: Int32; same code as run_module

# ---- group: Ratio
# Living Prox - Tuo
num_170 = Number(division_8)

# ----
# Make python data tree/list- Tuo
make_grid_list = GhPythonScript(x=int_38, y=int_39, ids=int_40)  # -> out, outL; inputs ids: list
# ---------- make_grid_list: Python ----------
__author__ = "sunt"
__version__ = "2018.06.03"

import rhinoscriptsyntax as rs

print(x,y)
print(ids)
outL = []

for newY in range(y):
    row = []
    for newX in range(x):
        row.append(ids[newX+newY*16])
    outL.append(row)
    
print(outL)
# ---------- end make_grid_list ----------
floor_height = Number(panel_33)
iron2panel = GhPythonScript(ironList=make_grid_list.outL)  # -> out, panelOut
# ---------- iron2panel: Python ----------
"""Provides a scripting component.
    Inputs:
        centroid: Building's centroid point (area)
        floors: the number of floor
        grid: The gird
        cellSize: the size of the grid cell
        
    Output:
        a: The a output variable"""

__author__ = "sunt"
__version__ = "2018.05.28"

import rhinoscriptsyntax as rs

panelOut = ironList
# ---------- end iron2panel ----------
floor_replace = PythonScript(inL=make_grid_list.outL, floorDict=int_50)  # -> out, outL; inputs floorDict: list
# ---------- floor_replace: Python ----------
outL = inL[:]
print(outL)

replaceDict ={x: floorDict[x] for x in range(5)}
if len(floorDict)>=7:
    replaceDict[8]=floorDict[8]
#print(replaceDict)

for item in range(len(outL)):
    outL[item] = int(replaceDict.get(int(outL[item]),0))

print(outL)
# ---------- end floor_replace ----------
panel_196 = Panel(floor_replace.outL)

panel_197 = Panel(make_grid_list.outL)

# ---- group: control on/off
# Traffic - Tuo
panel_198 = Panel("9")
run_module_5 = GhPythonScript(need=panel_198, actual=int_191)  # -> out, run; inputs need: Int32, actual: Int32; same code as run_module

# ----
python_19 = PythonScript(x=index, y=num_88)  # -> out, a
# ---------- python_19: Python ----------
a = float(x)-2*float(y)
# ---------- end python_19 ----------

# ---- group: control on/off
# Live/work balance- Tuo
panel_199 = Panel("8")
run_module_6 = GhPythonScript(need=panel_199, actual=int_191)  # -> out, run; inputs need: Int32, actual: Int32; same code as run_module

# ----
multiplication_54 = Multiplication(A=python_19.a, B=num_170)
division_45 = Division(A=python_19.a, B=num_170)

k = Slider(3, range=3..30)
grid_x_extent = Number(int_119)
grid_y_extent = Number(int_120)

k_2 = Slider(3, range=3..30)
grid_x_extent_2 = Number(int_119)
grid_y_extent_2 = Number(int_120)

k_3 = Slider(1, range=1..30)
grid_x_extent_3 = Number(int_119)
grid_y_extent_3 = Number(int_120)

index_3 = Slider(100, range=1..500)
cell_size_2 = Number(cell_size)
grid_x_extent_4 = Number(int_119)
grid_y_extent_4 = Number(int_120)
height_by_id = GhPythonScript(inL=floor_replace.outL, h=floor_height)  # -> out, outL; inputs inL: list
# ---------- height_by_id: Python ----------
__author__ = "sunt"
__version__ = "2018.06.01"

import rhinoscriptsyntax as rs

outL = [h*x for x in inL]
# ---------- end height_by_id ----------
solar_by_id = GhPythonScript(inL=height_by_id.outL, xExt=grid_x_extent_4, yExt=grid_y_extent_4, index=index_3, cellSize=cell_size_2)  # -> out, outL, avg; inputs inL: tree, xExt: Int32
# ---------- solar_by_id: Python ----------
"""Provides a scripting component.
    Inputs:
        centroid: Building's centroid point (area)
        floors: the number of floor
        grid: The gird
        cellSize: the size of the grid cell
        
    Output:
        a: The a output variable"""

__author__ = "sunt"
__version__ = "2018.05.28"

import rhinoscriptsyntax as rs
import math
import Grasshopper as gh

xExt = int(xExt)
yExt = int(yExt)
cellSize = int(cellSize)

outL = [[0 for x in range(xExt)] for y in range(yExt)]
shadows = [0.5,1,0.5,0.25,0.5,1,0.5,0.25,0.125,0.25,0.5,1,0.5,0.25,0.125]

#print(outL)
#print(inL.Branch(0)[0])

score,count = 0,0

for bldgY in range(yExt):
    for bldgX in range(xExt):
        solInd = 0
        shadowInd = 0
        h = float(inL.Branch(bldgY)[bldgX])
        row1 = [(bldgY+1,bldgX+i) for i in range(-1,2)]
        row2 = [(bldgY+2,bldgX+i) for i in range(-2,3)]
        row3 = [(bldgY+3,bldgX+i) for i in range(-3,4)]
        rows_raw = [row1,row2,row3]
#        print(int(30*3.5/cellSize))
        rows = rows_raw[:max(1,int(30*3.5/cellSize))]
        for r in range(len(rows)):
            for (newY,newX) in rows[r]:
                if 0<=newX and newX<xExt and 0<=newY and newY<yExt:
                    solInd += max((float(inL.Branch(newY)[newX])-h-cellSize*r)*shadows[shadowInd],0)
                shadowInd+=1
#        print(solInd)
        outL[bldgY][bldgX] = solInd/index
        if h > 0:
            
            score += max(1-solInd/index,0)
            count += 1
#            print("add score: ",score)
            
avg = score/count
#print(count)
#print(outL)
# ---------- end solar_by_id ----------
iron2panel_2 = GhPythonScript(run=run_module_4.run, ironList=solar_by_id.outL)  # -> out, panelOut
# ---------- iron2panel_2: Python ----------
"""Provides a scripting component.
    Inputs:
        centroid: Building's centroid point (area)
        floors: the number of floor
        grid: The gird
        cellSize: the size of the grid cell
        
    Output:
        a: The a output variable"""

__author__ = "sunt"
__version__ = "2018.05.28"

import rhinoscriptsyntax as rs

panelOut = ironList if run else None
# ---------- end iron2panel_2 ----------

# ---- group: building extrusion
byheight = PythonScript(inPanelList=floor_replace.outL, heights=floor_height)  # -> out, outPanelList; inputs inPanelList: list
# ---------- byheight: Python ----------
import Grasshopper as gh

outPanelList = inPanelList[:]


for item in range(len(outPanelList)):
    outPanelList[item] = int(outPanelList[item])*heights

    
print(outPanelList)
# ---------- end byheight ----------
panel_200 = Panel(byheight.outPanelList)
grid_x_extent_5 = Number(int_119)
grid_y_extent_5 = Number(int_120)
sqgrid = Square(Plane=PlaneXY(0, 0, 0), Size=num_63, ExtentX=grid_x_extent_5, ExtentY=grid_y_extent_5)  # -> Cells, Points
rev_3 = ReverseList(List=sqgrid.Cells)
Z_10 = UnitZ(Factor=1)
flip = FlipMatrix(Data=rev_3)
amp_2 = Amplitude(Vector=Z_10, Amplitude=flatten(panel_200))
boundary_2 = BoundarySurfaces(Edges=flatten(flip))
extr_3 = Extrude(Base=boundary_2, Direction=amp_2)
getgridcorners = GhPythonScript(cells=rev_3, x=grid_x_extent_5, y=grid_y_extent_5)  # -> out, corners; inputs cells: list
# ---------- getgridcorners: Python ----------
__author__ = "sunt"
__version__ = "2018.05.28"

import rhinoscriptsyntax as rs

print(cells[0])
print(cells[-1])

a= rs.CurvePoints(cells[0])[3]
b= rs.CurvePoints(cells[int(x)-1])[0]
d= rs.CurvePoints(cells[-int(x)])[2]
c= rs.CurvePoints(cells[-1])[1]

corners = [b,a,d,c]
# ---------- end getgridcorners ----------

# ----
area_2 = Area(Geometry=boundary_2)  # -> Area, Centroid
tag_31 = TextTag3D(Location=area_2.Centroid, Text=flatten(num_76), Size=Slider(9.3, range=0..100), Colour=swatch_5, Justification=4)  # disabled

run = GhPythonScript(i=area_2.Centroid, run=run_module_2.run)  # -> out, o
# ---------- run: Python ----------
__author__ = "sunt"
__version__ = "2018.06.03"

import rhinoscriptsyntax as rs

o = i if run else []
# ---------- end run ----------
panel_201 = Panel("""3
4
5
8""")
panel_202 = Panel("""0
1
2""")
filter_elements = GhPythonScript(E=flatten(area_2.Centroid), ids=flatten(iron2panel.panelOut), f1=panel_201, f2=panel_202)  # -> out, ind1, outE1, outE2; inputs E: list, ids: list of Int32, f1: list of Int32, f2: list of Int32
# ---------- filter_elements: Python ----------
__author__ = "sunt"
__version__ = "2018.06.03"

import rhinoscriptsyntax as rs

outE1,outE2,ind1 = [],[],[]
print(f1,f2)

for e in range(len(ids)):
    if ids[e] in f1:
        outE1.append(E[e])
        ind1.append(e)
    elif ids[e] in f2:
        outE2.append(E[e])
# ---------- end filter_elements ----------
pt_133 = Point(flatten(filter_elements.outE1))
pt_134 = Point(filter_elements.outE2)
cps_4 = ClosestPoints(Point=pt_133, Cloud=pt_134, Count=k)  # -> ClosestPoint, CPIndex, Distance
avr_4 = Average(Input=cps_4.Distance)  # -> flatten(ArithmeticMean)
panel_203 = Panel(avr_4)

run_2 = GhPythonScript(i=area_2.Centroid, run=run_module.run)  # -> out, o; same code as run
panel_204 = Panel("""3
4
5
8""")
panel_205 = Panel("""0
1
2""")
filter_elements_2 = GhPythonScript(E=flatten(area_2.Centroid), ids=flatten(iron2panel.panelOut), f1=panel_205, f2=panel_204)  # -> out, ind1, outE1, outE2; inputs E: list, ids: list of Int32, f1: list of Int32, f2: list of Int32; same code as filter_elements
pt_135 = Point(flatten(filter_elements_2.outE1))
pt_136 = Point(filter_elements_2.outE2)
cps_5 = ClosestPoints(Point=pt_135, Cloud=pt_136, Count=k_2)  # -> ClosestPoint, CPIndex, Distance
avr_5 = Average(Input=cps_5.Distance)  # -> flatten(ArithmeticMean)
panel_206 = Panel(avr_5)

run_3 = GhPythonScript(i=area_2.Centroid, run=run_module_3.run)  # -> out, o; same code as run
panel_207 = Panel("""0
1
2
3
4
5
8""")
filter_elements_3 = GhPythonScript(E=flatten(area_2.Centroid), ids=flatten(iron2panel.panelOut), f1=panel_207, f2="7")  # -> out, ind1, outE1, outE2; inputs E: list, ids: list of Int32, f1: list of Int32, f2: list of Int32; same code as filter_elements
pt_137 = Point(flatten(filter_elements_3.outE1))
pt_138 = Point(filter_elements_3.outE2)
cps_6 = ClosestPoints(Point=pt_137, Cloud=pt_138, Count=k_3)  # -> ClosestPoint, CPIndex, Distance
avr_6 = Average(Input=cps_6.Distance)  # -> flatten(ArithmeticMean)
panel_208 = Panel(avr_6)

panel_209 = Panel("""0.890961
0.955006
0.551884
0.6437
0.6437
0.797975
0.654717
0.5
0.621275""")  # disabled
panel_210 = Panel(iron2panel_2.panelOut)
panel_211 = Panel(cps_6.Distance)
new_col_trans = GhPythonScript(x=grid_x_extent_2, y=grid_y_extent_2, ids=filter_elements_2.ind1, knn=panel_206, index=division_45)  # -> out, value, score; inputs x: Int32, y: Int32, ids: list, knn: list of Int32
# ---------- new_col_trans: Python ----------
__author__ = "sunt"
__version__ = "2018.06.04"

import rhinoscriptsyntax as rs

value= []
print(ids)
print(knn)
k = 0
for i in range(int(x*y)):
    if i != ids[k]:
        value.append(0)
    else:
        value.append(1-(knn[k]-100)/index)
        if k < len(ids)-1:
            k+=1
            
value_n0= [v for v in value if v>0]
score = sum(value_n0)/max(1,len(value_n0))
#print(score)
#print(value)
# ---------- end new_col_trans ----------
new_col_trans_2 = GhPythonScript(x=grid_x_extent_3, y=grid_y_extent_3, ids=filter_elements_3.ind1, knn=panel_208, index=division_45)  # -> out, value, score; inputs x: Int32, y: Int32, ids: list, knn: list of Int32
# ---------- new_col_trans_2: Python ----------
__author__ = "sunt"
__version__ = "2018.06.04"

import rhinoscriptsyntax as rs

value= []
print(index)
#print(ids)
#print(knn)
k = 0
for i in range(int(x*y)):
    if i != ids[k]:
        value.append(0)
    else:
        value.append(1-(knn[k]-62.5)/int(index))
        if k < len(ids)-1:
            k+=1
            
value_n0= [v for v in value if v>0]
score = sum(value_n0)/max(1,len(value_n0))
#print(score)
# ---------- end new_col_trans_2 ----------
new_col_trans_3 = GhPythonScript(x=grid_x_extent, y=grid_y_extent, ids=filter_elements.ind1, knn=panel_203, index=division_45)  # -> out, value, score; inputs x: Int32, y: Int32, ids: list, knn: list of Int32
# ---------- new_col_trans_3: Python ----------
__author__ = "sunt"
__version__ = "2018.06.04"

import rhinoscriptsyntax as rs

value= []
print(ids)
print(knn)
k = 0
for i in range(int(x*y)):
    if i != ids[k]:
        value.append(0)
    else:
        value.append(1-(knn[k]-100)/index)
        if k < len(ids)-1:
            k+=1
            
value_n0= [v for v in value if v>0]
score = sum(value_n0)/max(1,len(value_n0))
#print(value_n0)
#print(score)
# ---------- end new_col_trans_3 ----------
iron2panel_3 = GhPythonScript(run=run_module.run, ironList=new_col_trans.value)  # -> out, panelOut; same code as iron2panel_2
iron2panel_4 = GhPythonScript(run=run_module_2.run, ironList=new_col_trans_3.value)  # -> out, panelOut; same code as iron2panel_2
iron2panel_5 = GhPythonScript(run=run_module_3.run, ironList=new_col_trans_2.value)  # -> out, panelOut; same code as iron2panel_2

# ---- group: bk
gradient_10 = Gradient(LowerLimit=0, UpperLimit=1, Parameter=panel_210, stops=[0: RGB(255, 255, 0), 1: RGB(0, 50, 199)])

# ----
gradient_11 = Gradient(
    LowerLimit=0,
    UpperLimit=1,
    Parameter=panel_210,
    stops=[0: RGB(255, 255, 0), 0.296: RGB(210, 219, 35), 0.5: RGB(134, 158, 93), 0.701: RGB(39, 80, 168), 1: RGB(0, 50, 199)])
panel_212 = Panel("""0
1
2
3
4
5
6
7
8
9""")
nonetype = GhPythonScript(i=gradient_11)  # -> out, run, o
# ---------- nonetype: Python ----------
__author__ = "sunt"
__version__ = "2018.06.03"

import rhinoscriptsyntax as rs
print(type(i))
if type(i)==type(None):
    o = []
    run = False
else:
    o = i
    run = True
# ---------- end nonetype ----------
run_4 = GhPythonScript(i=panel_212, run=nonetype.run)  # -> out, o; inputs run: tree
# ---------- run_4: Python ----------
__author__ = "sunt"
__version__ = "2018.06.03"

import rhinoscriptsyntax as rs

o = i if run.BranchCount >= 2 and run.Branch(0) else []
# ---------- end run_4 ----------

# ---- group: bk
gradient_12 = Gradient(
    LowerLimit=0,
    UpperLimit=1,
    Parameter=iron2panel_3.panelOut,
    stops=[0: RGB(255, 0, 0), 0.5: RGB(255, 255, 0), 1: RGB(0, 128, 0)])

# ----
gradient_13 = Gradient(
    LowerLimit=0,
    UpperLimit=1,
    Parameter=iron2panel_5.panelOut,
    stops=[0: RGB(255, 0, 0), 0.299: RGB(255, 110, 0), 0.5: RGB(255, 255, 0), 0.703: RGB(123, 255, 0), 1: RGB(0, 255, 0)])
nonetype_2 = GhPythonScript(i=gradient_13)  # -> out, run, o; same code as nonetype
run_5 = GhPythonScript(i=panel_207, run=nonetype_2.run)  # -> out, o; inputs run: list
# ---------- run_5: Python ----------
__author__ = "sunt"
__version__ = "2018.06.03"

import rhinoscriptsyntax as rs

o = i if len(run) >= 2 and run[0] else []
# ---------- end run_5 ----------

gradient_14 = Gradient(
    LowerLimit=0,
    UpperLimit=1,
    Parameter=iron2panel_3.panelOut,
    stops=[0: RGB(255, 0, 0), 0.299: RGB(255, 110, 0), 0.5: RGB(255, 255, 0), 0.703: RGB(123, 255, 0), 1: RGB(0, 255, 0)])
nonetype_3 = GhPythonScript(i=gradient_14)  # -> out, run, o; same code as nonetype
run_6 = GhPythonScript(i=panel_205, run=nonetype_3.run)  # -> out, o; inputs run: list; same code as run_5

gradient_15 = Gradient(
    LowerLimit=0,
    UpperLimit=1,
    Parameter=iron2panel_4.panelOut,
    stops=[0: RGB(255, 0, 0), 0.299: RGB(255, 110, 0), 0.5: RGB(255, 255, 0), 0.703: RGB(123, 255, 0), 1: RGB(0, 255, 0)])
nonetype_4 = GhPythonScript(i=gradient_15)  # -> out, run, o; same code as nonetype
run_7 = GhPythonScript(i=panel_201, run=nonetype_4.run)  # -> out, o; inputs run: list; same code as run_5

# ---- group: color calibration dock
# Color Space Viz / Sliders and Toggles
number_slider_45 = Slider(300, range=0..1000)  # disabled
mjoin_6 = MeshJoin(Meshes=crv_2)  # disabled
popgeo = PopulateGeometry(Geometry=mjoin_6, Count=number_slider_45, Seed=1)  # disabled
sample_7 = BitmapSampler(BitmapToModify=bmp_4, PointToSample=popgeo, BitmapToModify_2=bmp_4, PointToSample_2=popgeo, bitmap_filter=0)  # -> SampledImageData, SampledImageData_2; disabled
argb_5 = SplitARGB(Colour=col_27)  # -> Alpha, Red, Green, Blue; disabled
ahsv = SplitAHSV(Colour=col_27)  # -> Alpha, Hue, Saturation, Value; disabled
pt_139 = ConstructPoint(XCoordinate=argb_5.Red, YCoordinate=argb_5.Green, ZCoordinate=argb_5.Blue)  # disabled
pt_140 = ConstructPoint(XCoordinate=ahsv.Hue, YCoordinate=ahsv.Saturation, ZCoordinate=ahsv.Value)  # disabled
pt_141 = Point(col_27)  # disabled
sph = Sphere(Base=pt_140, Radius=0.05)  # disabled
sph_2 = Sphere(Base=pt_139, Radius=0.05)  # disabled
preview_21 = CustomPreview(Geometry=sph, Shader=col_27)  # disabled
preview_22 = CustomPreview(Geometry=sph_2, Shader=col_27)  # disabled
box_3 = Box2Pt(PointA=Point(0, 0, 0), PointB=Point(1, 1, 1), Plane=PlaneXY(0, 0, 0))  # disabled
box_4 = Box2Pt(PointA=Point(0, 0, 0), PointB=Point(1, 1, 1), Plane=PlaneXY(0, 0, 0))  # disabled
voronoi³ = Voronoi3D(Points=pt_140, Box=box_3)  # -> Cells, Boundary; disabled
voronoi³_2 = Voronoi3D(Points=pt_139, Box=box_4)  # -> Cells, Boundary; disabled
brep = Brep(voronoi³.Cells)  # disabled
brep_2 = Brep(voronoi³_2.Cells)  # disabled
range_2 = Range(Domain=Domain(0, 1), Steps=10)  # disabled
graft_4 = GraftTree(Tree=range_2, IncludeEmptyLists=True, IncludeNullItems=True)  # disabled
pt_142 = ConstructPoint(XCoordinate=range_2, YCoordinate=graft_4, ZCoordinate=0)  # disabled
Z_11 = UnitZ(Factor=range_2)  # disabled
pshift_67 = ShiftPaths(Data=pt_142, Offset=-1)  # disabled
graft_5 = GraftTree(Tree=Z_11, IncludeEmptyLists=True, IncludeNullItems=True)  # disabled
number_slider_46 = Slider(5, range=0..10)  # disabled
move_39 = Move(Geometry=pshift_67, Motion=graft_5)  # -> Geometry, Transform; disabled
flip_2 = FlipMatrix(Data=move_39.Geometry)  # disabled
item_69 = ListItem(List=flip_2, Index=number_slider_46, Wrap=False)  # disabled

# ---- group: color calibration dock / ref sample colors
col_50 = Colour(sample_7.SampledImageData_2)  # disabled

# ---- group: color calibration dock / all sample color
col_51 = Colour(col_50)  # disabled

col_52 = Colour(col_51)  # disabled

# ---- group: color calibration dock / color space pts - one plan
pt_143 = Point(item_69)  # disabled

# ---- group: color calibration dock / color space pts
pt_144 = Point(flip_2)  # disabled

# ---- group: color calibration dock / color space pts - showing
pt_145 = Point(pt_144)  # disabled

# ---- group: color calibration dock (continued)
argb_6 = SplitARGB(Colour=col_52)  # -> Alpha, Red, Green, Blue; disabled
ahsv_2 = SplitAHSV(Colour=col_52)  # -> Alpha, Hue, Saturation, Value; disabled
pt_146 = ConstructPoint(XCoordinate=argb_6.Red, YCoordinate=argb_6.Green, ZCoordinate=argb_6.Blue)  # disabled
pt_147 = ConstructPoint(XCoordinate=ahsv_2.Hue, YCoordinate=ahsv_2.Saturation, ZCoordinate=ahsv_2.Value)  # disabled
pt_148 = Point(col_52)  # disabled
preview_23 = CustomPreview(Geometry=pt_147, Shader=col_52)  # disabled
preview_24 = CustomPreview(Geometry=pt_146, Shader=col_52)  # disabled
pdecon_32 = Deconstruct(Point=pt_145)  # -> XComponent, YComponent, ZComponent; disabled
hsl = ColourHSL(Alpha=1, Hue=pdecon_32.XComponent, Saturation=pdecon_32.YComponent, Luminance=pdecon_32.ZComponent)  # disabled
frgb_25 = ColourRGBF(Alpha=1, Red=pdecon_32.XComponent, Green=pdecon_32.YComponent, Blue=pdecon_32.ZComponent)  # disabled
preview_25 = CustomPreview(Geometry=pt_145, Shader=hsl)  # disabled
pt_149 = Point(frgb_25)  # disabled
preview_26 = CustomPreview(Geometry=pt_145, Shader=frgb_25)  # disabled

# ---- group: color calibration dock / connecting sample pt and its color space pt
number_slider_47 = Slider(98, range=0..300)  # disabled
ln_9 = Line(StartPoint=popgeo, EndPoint=pt_146)  # disabled
item_70 = ListItem(List=ln_9, Index=number_slider_47, Wrap=True)  # disabled
crv_11 = Curve(item_70)  # disabled

# ---- group: Color Space Calibration sliders
# Color Space Viz / Sliders and Toggles
number_slider_48 = Slider(300, range=0..1000)  # disabled
number_slider_49 = Slider(300, range=0..1000)  # disabled
number_slider_50 = Slider(300, range=0..1000)  # disabled
number_slider_51 = Slider(300, range=0..1000)  # disabled
mjoin_7 = MeshJoin(Meshes=crv)  # disabled
mjoin_8 = MeshJoin(Meshes=crv_5)  # disabled
mjoin_9 = MeshJoin(Meshes=crv_6)  # disabled
mjoin_10 = MeshJoin(Meshes=crv_7)  # disabled
popgeo_2 = PopulateGeometry(Geometry=mjoin_7, Count=number_slider_48, Seed=1)  # disabled
popgeo_3 = PopulateGeometry(Geometry=mjoin_8, Count=number_slider_49, Seed=1)  # disabled
popgeo_4 = PopulateGeometry(Geometry=mjoin_9, Count=number_slider_50, Seed=1)  # disabled
popgeo_5 = PopulateGeometry(Geometry=mjoin_10, Count=number_slider_51, Seed=1)  # disabled
sample_8 = BitmapSampler(BitmapToModify=bmp_2, PointToSample=popgeo_2, BitmapToModify_2=bmp_2, PointToSample_2=popgeo_2, bitmap_filter=0)  # -> SampledImageData, SampledImageData_2; disabled
sample_9 = BitmapSampler(BitmapToModify=bmp_3, PointToSample=popgeo_3, BitmapToModify_2=bmp_3, PointToSample_2=popgeo_3, bitmap_filter=0)  # -> SampledImageData, SampledImageData_2; disabled
sample_10 = BitmapSampler(BitmapToModify=bmp_4, PointToSample=popgeo_4, BitmapToModify_2=bmp_4, PointToSample_2=popgeo_4, bitmap_filter=0)  # -> SampledImageData, SampledImageData_2; disabled
sample_11 = BitmapSampler(BitmapToModify=bmp_5, PointToSample=popgeo_5, BitmapToModify_2=bmp_5, PointToSample_2=popgeo_5, bitmap_filter=0)  # -> SampledImageData, SampledImageData_2; disabled
argb_7 = SplitARGB(Colour=col_26)  # -> Alpha, Red, Green, Blue; disabled
ahsv_3 = SplitAHSV(Colour=col_26)  # -> Alpha, Hue, Saturation, Value; disabled
pt_150 = ConstructPoint(XCoordinate=argb_7.Red, YCoordinate=argb_7.Green, ZCoordinate=argb_7.Blue)  # disabled
pt_151 = ConstructPoint(XCoordinate=ahsv_3.Hue, YCoordinate=ahsv_3.Saturation, ZCoordinate=ahsv_3.Value)  # disabled
pt_152 = Point(col_26)  # disabled
sph_3 = Sphere(Base=pt_151, Radius=0.05)  # disabled
sph_4 = Sphere(Base=pt_150, Radius=0.05)  # disabled
preview_27 = CustomPreview(Geometry=sph_3, Shader=col_26)  # disabled
preview_28 = CustomPreview(Geometry=sph_4, Shader=col_26)  # disabled
box_5 = Box2Pt(PointA=Point(0, 0, 0), PointB=Point(1, 1, 1), Plane=PlaneXY(0, 0, 0))  # disabled
box_6 = Box2Pt(PointA=Point(0, 0, 0), PointB=Point(1, 1, 1), Plane=PlaneXY(0, 0, 0))  # disabled
voronoi³_3 = Voronoi3D(Points=pt_151, Box=box_5)  # -> Cells, Boundary; disabled
voronoi³_4 = Voronoi3D(Points=pt_150, Box=box_6)  # -> Cells, Boundary; disabled
brep_3 = Brep(voronoi³_3.Cells)  # disabled
brep_4 = Brep(voronoi³_4.Cells)  # disabled
range_3 = Range(Domain=Domain(0, 1), Steps=10)  # disabled
graft_6 = GraftTree(Tree=range_3, IncludeEmptyLists=True, IncludeNullItems=True)  # disabled
pt_153 = ConstructPoint(XCoordinate=range_3, YCoordinate=graft_6, ZCoordinate=0)  # disabled
Z_12 = UnitZ(Factor=range_3)  # disabled
pshift_68 = ShiftPaths(Data=pt_153, Offset=-1)  # disabled
graft_7 = GraftTree(Tree=Z_12, IncludeEmptyLists=True, IncludeNullItems=True)  # disabled
number_slider_52 = Slider(5, range=0..10)  # disabled
move_40 = Move(Geometry=pshift_68, Motion=graft_7)  # -> Geometry, Transform; disabled
flip_3 = FlipMatrix(Data=move_40.Geometry)  # disabled
item_71 = ListItem(List=flip_3, Index=number_slider_52, Wrap=False)  # disabled

# ---- group: Color Space Calibration sliders / ref sample colors
col_53 = Colour(sample_8.SampledImageData_2)  # disabled

col_54 = Colour(sample_9.SampledImageData_2)  # disabled

col_55 = Colour(sample_10.SampledImageData_2)  # disabled

col_56 = Colour(sample_11.SampledImageData_2)  # disabled

# ---- group: Color Space Calibration sliders / all sample color
col_57 = Colour(col_56)  # disabled

col_58 = Colour(col_53)  # disabled

col_59 = Colour(col_55)  # disabled

col_60 = Colour(col_54)  # disabled

col_61 = Colour([col_59, col_60])  # disabled

# ---- group: Color Space Calibration sliders / color space pts - one plan
pt_154 = Point(item_71)  # disabled

# ---- group: Color Space Calibration sliders / color space pts
pt_155 = Point(flip_3)  # disabled

# ---- group: Color Space Calibration sliders / color space pts - showing
pt_156 = Point(pt_155)  # disabled

# ---- group: Color Space Calibration sliders (continued)
argb_8 = SplitARGB(Colour=col_61)  # -> Alpha, Red, Green, Blue; disabled
ahsv_4 = SplitAHSV(Colour=col_61)  # -> Alpha, Hue, Saturation, Value; disabled
pt_157 = ConstructPoint(XCoordinate=argb_8.Red, YCoordinate=argb_8.Green, ZCoordinate=argb_8.Blue)  # disabled
pt_158 = ConstructPoint(XCoordinate=ahsv_4.Hue, YCoordinate=ahsv_4.Saturation, ZCoordinate=ahsv_4.Value)  # disabled
pt_159 = Point(col_61)  # disabled
preview_29 = CustomPreview(Geometry=pt_158, Shader=col_61)  # disabled
preview_30 = CustomPreview(Geometry=pt_157, Shader=col_61)  # disabled
pdecon_33 = Deconstruct(Point=pt_156)  # -> XComponent, YComponent, ZComponent; disabled
hsl_2 = ColourHSL(Alpha=1, Hue=pdecon_33.XComponent, Saturation=pdecon_33.YComponent, Luminance=pdecon_33.ZComponent)  # disabled
frgb_26 = ColourRGBF(Alpha=1, Red=pdecon_33.XComponent, Green=pdecon_33.YComponent, Blue=pdecon_33.ZComponent)  # disabled
preview_31 = CustomPreview(Geometry=pt_156, Shader=hsl_2)  # disabled
pt_160 = Point(frgb_26)  # disabled
preview_32 = CustomPreview(Geometry=pt_156, Shader=frgb_26)  # disabled

# ---- group: Position Calibration / disable when not calibrating CV
box_7 = CenterBox(Base=pt_9, X=0.003, Y=0.003, Z=0.003)  # disabled
item_72 = ListItem(List=col_2, Index=item, Wrap=False)  # disabled

# ---- group: Position Calibration / disable when not calibrating CV / all sample boxes
box_8 = Box(box_7)  # disabled

# ---- group: Position Calibration / disable when not calibrating CV (continued)
preview_33 = CustomPreview(Geometry=box_8, Shader=item_72)  # disabled

# ---- group: Position Calibration
move_41 = Move(Geometry=mesh_12, Motion=Vector(0, 0, -0.1))  # -> Geometry, Transform; disabled
addition_39 = Addition(A=item_12, B=item_13)  # disabled
division_46 = Division(A=addition_39, B=2)  # disabled

# ---- group: Position Calibration / moved down 0.1
mesh_81 = Mesh(move_41.Geometry)  # disabled

# ---- group: Position Calibration / quart mid pts
pt_161 = Point(division_46)  # disabled

# ---- group: Position Calibration (continued)
tag_32 = TextTag3D(Location=pt_161, Text=int_28, Size=0.01, Justification=5)  # disabled

# ---- group: Position Calibration / disable when not calibrating CV
box_9 = CenterBox(Base=pt_31, X=0.003, Y=0.003, Z=0.003)  # disabled
item_73 = ListItem(List=col_18, Index=cp_6.CPIndex, Wrap=False)  # disabled

# ---- group: Position Calibration / disable when not calibrating CV / all sample boxes
box_10 = Box(box_9)  # disabled

# ---- group: Position Calibration / disable when not calibrating CV (continued)
# Closest Color Code
preview_34 = CustomPreview(Geometry=box_10, Shader=item_73)  # disabled

# ----
# Color Space Viz / Grid
argb_9 = SplitARGB(Colour=col_22)  # -> Alpha, Red, Green, Blue; disabled
ahsv_5 = SplitAHSV(Colour=col_22)  # -> Alpha, Hue, Saturation, Value; disabled
argb_10 = SplitARGB(Colour=col_23)  # -> Alpha, Red, Green, Blue; disabled
ahsv_6 = SplitAHSV(Colour=col_23)  # -> Alpha, Hue, Saturation, Value; disabled
pt_162 = ConstructPoint(XCoordinate=argb_9.Red, YCoordinate=argb_9.Green, ZCoordinate=argb_9.Blue)  # disabled
pt_163 = ConstructPoint(XCoordinate=ahsv_5.Hue, YCoordinate=ahsv_5.Saturation, ZCoordinate=ahsv_5.Value)  # disabled
pt_164 = ConstructPoint(XCoordinate=argb_10.Red, YCoordinate=argb_10.Green, ZCoordinate=argb_10.Blue)  # disabled
pt_165 = ConstructPoint(XCoordinate=ahsv_6.Hue, YCoordinate=ahsv_6.Saturation, ZCoordinate=ahsv_6.Value)  # disabled
pt_166 = Point(col_22)  # disabled
pt_167 = Point(col_23)  # disabled
sph_5 = Sphere(Base=pt_165, Radius=0.05)  # disabled
sph_6 = Sphere(Base=pt_164, Radius=0.05)  # disabled
preview_35 = CustomPreview(Geometry=pt_163, Shader=col_22)  # disabled
preview_36 = CustomPreview(Geometry=pt_162, Shader=col_22)  # disabled
preview_37 = CustomPreview(Geometry=sph_5, Shader=col_23)  # disabled
preview_38 = CustomPreview(Geometry=sph_6, Shader=col_23)  # disabled
box_11 = Box2Pt(PointA=Point(0, 0, 0), PointB=Point(1, 1, 1), Plane=PlaneXY(0, 0, 0))  # disabled
box_12 = Box2Pt(PointA=Point(0, 0, 0), PointB=Point(1, 1, 1), Plane=PlaneXY(0, 0, 0))  # disabled
voronoi³_5 = Voronoi3D(Points=pt_165, Box=box_11)  # -> Cells, Boundary; disabled
voronoi³_6 = Voronoi3D(Points=pt_164, Box=box_12)  # -> Cells, Boundary; disabled
brep_5 = Brep(voronoi³_5.Cells)  # disabled
brep_6 = Brep(voronoi³_6.Cells)  # disabled
range_4 = Range(Domain=Domain(0, 1), Steps=10)  # disabled
graft_8 = GraftTree(Tree=range_4, IncludeEmptyLists=True, IncludeNullItems=True)  # disabled
pt_168 = ConstructPoint(XCoordinate=range_4, YCoordinate=graft_8, ZCoordinate=0)  # disabled
Z_13 = UnitZ(Factor=range_4)  # disabled
pshift_69 = ShiftPaths(Data=pt_168, Offset=-1)  # disabled
graft_9 = GraftTree(Tree=Z_13, IncludeEmptyLists=True, IncludeNullItems=True)  # disabled
number_slider_53 = Slider(5, range=0..10)  # disabled
move_42 = Move(Geometry=pshift_69, Motion=graft_9)  # -> Geometry, Transform; disabled
flip_4 = FlipMatrix(Data=move_42.Geometry)  # disabled
item_74 = ListItem(List=flip_4, Index=number_slider_53, Wrap=False)  # disabled

# ---- group: connecting sample pt and its color space pt
number_slider_54 = Slider(860, range=0..1024)  # disabled
ln_10 = Line(StartPoint=pt_162, EndPoint=pt_31)  # disabled
item_75 = ListItem(List=ln_10, Index=number_slider_54, Wrap=True)  # disabled
crv_12 = Curve(item_75)  # disabled

# ---- group: color space pts - one plan
pt_169 = Point(item_74)  # disabled

# ---- group: color space pts
pt_170 = Point(flip_4)  # disabled

# ---- group: color space pts - showing
pt_171 = Point(pt_170)  # disabled

# ----
pdecon_34 = Deconstruct(Point=pt_171)  # -> XComponent, YComponent, ZComponent; disabled
hsl_3 = ColourHSL(Alpha=1, Hue=pdecon_34.XComponent, Saturation=pdecon_34.YComponent, Luminance=pdecon_34.ZComponent)  # disabled
frgb_27 = ColourRGBF(Alpha=1, Red=pdecon_34.XComponent, Green=pdecon_34.YComponent, Blue=pdecon_34.ZComponent)  # disabled
preview_39 = CustomPreview(Geometry=pt_171, Shader=hsl_3)  # disabled
pt_172 = Point(frgb_27)  # disabled
preview_40 = CustomPreview(Geometry=pt_171, Shader=frgb_27)  # disabled

# ---- group: Relative Filepath
vb_2 = VBScript()  # -> out, A; same code as vb
panel_213 = Panel(vb_2.out)
panel_214 = Panel(vb_2.A)
split_7 = TextSplit(Text=panel_214, Separators="\")
shift_6 = ShiftList(List=split_7, Shift=-1, Wrap=False)
panel_215 = Panel("Data\madrid_map_1760m.jpg")
txt_42 = Text(flatten(shift_6))

# ----
p_n_c_3 = PickNChoose(Pattern=equals_11.Inequality, Stream0=panel_215, Stream1="Data\madrid_map_440m.jpg")

# ---- group: Relative Filepath (continued)
txt_43 = Text(flatten(p_n_c_3))
join_11 = TextJoin(Text=flatten([txt_42, txt_43]), Join="\")
path_5 = FilePath(join_11)
panel_216 = Panel(path_5)

# ----
previewmat_2 = CustomPreviewMaterials(Geometry=morph, DiffuseColor=ColourSwatch(SwatchColor=RGB(255, 255, 255)), Transparency=panel_123, DiffuseBitmap=path_5)

# ---- group: fill pattern
division_47 = Division(A=num_70, B=2)
subtraction_9 = Subtraction(A=panel_133, B=1)
multiplication_55 = Multiplication(A=subtraction_9, B=2)
division_48 = Division(A=num_70, B=panel_133)
division_49 = Division(A=division_48, B=2)
neg_14 = Negative(Value=division_47)
multiplication_56 = Multiplication(A=multiplication_55, B=".58")
multiplication_57 = Multiplication(A=division_49, B=panel_131)
Y_13 = UnitY(Factor=neg_14)
X_4 = UnitX(Factor=neg_14)
Y_14 = UnitY(Factor=multiplication_57)
X_5 = UnitX(Factor=multiplication_57)
trigrid = Triangular(Plane=PlaneXY(0, 0, 0), Size=division_48, ExtentX=multiplication_55, ExtentY=multiplication_56)  # -> Cells, Points
cp_7 = ControlPoints(Curve=trigrid.Cells)  # -> Points, Weights, Knots
shift_7 = ShiftList(List=cp_7.Points, Shift=1, Wrap=False)  # -> flatten(List)
cullpt = CullDuplicates(Points=shift_7, Tolerance=0.1, CullMode=3)  # -> Points, Indices, Valence
move_43 = Move(Geometry=cullpt.Points, Motion=X_4)  # -> Geometry, Transform
move_44 = Move(Geometry=move_43.Geometry, Motion=Y_13)  # -> Geometry, Transform

# ---- group: fill pattern / pattern cntr pts
pt_173 = Point(flatten(move_44.Geometry))

# ---- group: fill pattern (continued)
polygon_2 = Polygon(Plane=pt_173, Radius=multiplication_57, Segments=4, FilletRadius=0)  # -> Polygon, Length
mesh_82 = MeshBrep(
    Brep=polygon_2.Polygon,
    Settings={GridMaxCount=0, GridMinCount=16, JaggedSeams=False, MaxEdgeLength=0, MinEdgeLength=0.0001, MinTolerance=0, Refine=True, RefineAngle=0, RelativeTolerance=0.65, SimplePlanes=True, Tolerance=0})
mjoin_11 = MeshJoin(Meshes=mesh_82)
move_45 = Move(Geometry=mjoin_11, Motion=X_5)  # -> Geometry, Transform
move_46 = Move(Geometry=move_45.Geometry, Motion=Y_14)  # -> Geometry, Transform

# ---- group: fill pattern / heatmap fill pattern
mesh_83 = Mesh(move_46.Geometry)

# ----
filter_57 = StreamFilter(Gate=int_185, Stream4=mesh_83)

# ---- group: mesh srf at orgin
mesh_84 = Mesh(filter_57)

# ----
move_47 = Move(Geometry=mesh_84, Motion=vec2pt_2.Vector)  # -> Geometry, Transform

# ---- group: mesh srfs at module centers
mesh_85 = Mesh(move_47.Geometry)

# ---- group: keystone
morph_7 = BoxMorph(Geometry=mesh_85, Reference=box_2, Target=tbox_2)

# ----
move_48 = Move(Geometry=morph_7, Motion=Z_3)  # -> Geometry, Transform

# ---- group: Position Calibration / population density viz
preview_41 = CustomPreview(Geometry=move_48.Geometry, Shader=col_47)

# ----
filter_58 = StreamFilter(Gate=int_188, Stream3=mesh_83)
filter_59 = StreamFilter(Gate=int_189, Stream2=mesh_83)

# ---- group: mesh srf at orgin
mesh_86 = Mesh(filter_58)

mesh_87 = Mesh(filter_59)

# ----
move_49 = Move(Geometry=mesh_86, Motion=vec2pt_7.Vector)  # -> Geometry, Transform
move_50 = Move(Geometry=mesh_87, Motion=vec2pt_8.Vector)  # -> Geometry, Transform

# ---- group: mesh srfs at module centers
mesh_88 = Mesh(move_49.Geometry)

mesh_89 = Mesh(move_50.Geometry)

# ---- group: keystone
morph_8 = BoxMorph(Geometry=mesh_88, Reference=box_2, Target=tbox_2)

morph_9 = BoxMorph(Geometry=mesh_89, Reference=box_2, Target=tbox_2)

# ----
move_51 = Move(Geometry=morph_8, Motion=Z_8)  # -> Geometry, Transform
move_52 = Move(Geometry=morph_9, Motion=Z_9)  # -> Geometry, Transform

# ---- group: Position Calibration / population density viz
preview_42 = CustomPreview(Geometry=move_51.Geometry, Shader=col_48)

preview_43 = CustomPreview(Geometry=move_52.Geometry, Shader=col_49)

# ---- group: 3D City
# 3D City Grid System
number_slider_55 = Slider(10, range=10..100)
Z_14 = UnitZ(Factor=number_slider_55)
msphereex = MeshSphereEx(Base=Z_14, Radius=number_slider_55, Count=Slider(5, range=0..10))
Z_15 = UnitZ(Factor=Slider(6, range=0..10))
move_53 = Move(Geometry=msphereex, Motion=Z_15)  # -> Geometry, Transform
com = ColourSwatch(SwatchColor=RGB(71, 71, 71))
com_2 = ColourSwatch(SwatchColor=RGB(77, 166, 255))
res = ColourSwatch(SwatchColor=RGB(255, 201, 77))
res_2 = ColourSwatch(SwatchColor=RGB(76, 76, 76))
larger_7 = LargerThan(FirstNumber=int_159, SecondNumber="0")  # -> LargerThan, OrEqualTo
smaller_10 = SmallerThan(FirstNumber=int_159, SecondNumber="5")  # -> SmallerThan, OrEqualTo
vec_11 = Vector(X_3)
mcol_5 = MeshColours(Mesh=move_53.Geometry, Colours=park)
tree_scale = Slider(0.81, range=0.5..2)
merge_19 = Merge(Data1=res, Data2=res, Data3=res, Data4=com_2, Data5=com_2, Data6=com_2, Data7=com_2, Data8=com_2, Data9=ind_2)
merge_20 = Merge(Data1=res_2, Data2=res_2, Data3=res_2, Data4=com, Data5=com, Data6=com, Data7=com, Data8=com, Data9=ind)
and_23 = GateAnd(A=larger_7.OrEqualTo, B=smaller_10.OrEqualTo)
merge_21 = Merge(Data1=merge_19, Data2=merge_20)
dom_8 = ConstructDomain(DomainStart=neg_11, DomainEnd=division_20)
move_54 = Move(Geometry=pt_125, Motion=vec_3)  # -> Geometry, Transform
tree = Slider(2.13, range=0..5)
division_50 = Division(A=num_88, B=2)
move_55 = Move(Geometry=mesh_78, Motion=vec_11)  # -> Geometry, Transform
move_56 = Move(Geometry=mesh_65, Motion=vec_11)  # -> Geometry, Transform
move_57 = Move(Geometry=mesh_64, Motion=vec_11)  # -> Geometry, Transform
multiplication_58 = Multiplication(A=division_50, B=Slider(0.95, range=0..1))
neg_15 = Negative(Value=multiplication_58)
multiplication_59 = Multiplication(A="3", B=tree)
division_51 = Division(A=num_90, B=division_8)
multiplication_60 = Multiplication(A="3", B=tree)
dom_9 = ConstructDomain(DomainStart=multiplication_59, DomainEnd=multiplication_60)
move_58 = Move(Geometry=mesh_68, Motion=vec_3)  # -> Geometry, Transform
dom_10 = ConstructDomain(DomainStart=neg_15, DomainEnd=multiplication_58)
panel_217 = Panel(division_51)

# ----
or_6 = GateOr(A=and_23, B=equals_25.Equality)

# ---- group: 3D City / meshes 3D ref: Tree
mesh_90 = Mesh(mcol_5)

# ---- group: 3D City / is building or not
bool_26 = Boolean(or_6)

# ---- group: 3D City / color for each type
col_62 = Colour(merge_21)

# ---- group: 3D City / park center 3D
pt_174 = Point(move_54.Geometry)

# ----
move_59 = Move(Geometry=mesh_67, Motion=vec_11)  # -> Geometry, Transform

# ---- group: 3D City / park 3D
mesh_91 = Mesh(move_58.Geometry)

# ---- group: 3D City / road
mesh_92 = Mesh(move_55.Geometry)

# ---- group: 3D City / sidewalk
mesh_93 = Mesh(move_56.Geometry)

# ---- group: 3D City / blank
mesh_94 = Mesh(move_57.Geometry)

# ---- group: parking
movetoorgin_5 = MoveToOrgin(G=mesh_60, num=num_58)  # disabled
vec2pt_10 = Vector2Pt(PointA=Point(0, 0, 0), PointB=pt_124, Unitize=False)  # -> Vector, Length; disabled

# ---- group: parking / module meshes lego at orgin
mesh_95 = Mesh(movetoorgin_5)  # disabled

# ---- group: 3D City (continued)
dispatch_30 = Dispatch(List=pt_121, DispatchPattern=bool_26)  # -> ListA, ListB
dispatch_31 = Dispatch(List=int_159, DispatchPattern=bool_26)  # -> ListA, ListB
planesrf_5 = PlaneSurface(Plane=pt_174, XSize=dom_8, YSize=dom_8)
lng_10 = ListLength(List=pt_174)
random_13 = Random(Range="0.8 to 1.4", Number=lng_10, Seed=Slider(72, range=0..100))
multiplication_61 = Multiplication(A=random_13, B=tree_scale)
scale_2 = Scale(Geometry=mesh_90, Center=Point(0, 0, 0), Factor=multiplication_61)  # -> Geometry, Transform
random_14 = Random(Range=dom_9, Number=lng_10, Seed=Slider(17, range=0..100))
random_15 = Random(Range=Domain(0, 1000), Number=lng_10, Seed=Slider(35, range=0..100))
popgeo_6 = PopulateGeometry(Geometry=flatten(planesrf_5), Count=flatten(random_14), Seed=flatten(random_15))

# ---- group: 3D City / building center
pt_175 = Point(dispatch_30.ListA)

# ---- group: 3D City / building id
int_192 = Integer(dispatch_31.ListA)

# ---- group: 3D City / tree center
pt_176 = Point(flatten(popgeo_6))

# ---- group: 3D City (continued)
equals_39 = Equality(FirstNumber=int_192, SecondNumber=int_163)  # -> Equality, Inequality
multiplication_62 = Multiplication(A=equals_39.Inequality, B=6)
addition_40 = Addition(A=int_192, B=multiplication_62)
vec2pt_11 = Vector2Pt(PointA=Point(0, 0, 0), PointB=pt_176, Unitize=False)  # -> Vector, Length
filter_60 = StreamFilter(Gate=equals_19.Equality, Stream0=addition_40, Stream1=int_192)
item_76 = ListItem(List=col_62, Index=graft(filter_60), Wrap=False)
pshift_70 = ShiftPaths(Data=item_76, Offset=-1)
move_60 = Move(Geometry=scale_2.Geometry, Motion=vec2pt_11.Vector)  # -> Geometry, Transform
item_77 = ListItem(List=panel_217, Index=graft(int_192), Wrap=False)
pshift_71 = ShiftPaths(Data=item_77, Offset=-1)
multiplication_63 = Multiplication(A=pshift_71, B=number_slider_40)

# ---- group: 3D City / color for each building
col_63 = Colour(pshift_70)

# ---- group: 3D City / building height of each building
num_171 = Number(multiplication_63)

# ---- group: 3D City (continued)
addition_41 = Addition(A=num_171, B=panel_171)
dom_11 = ConstructDomain(DomainStart=0, DomainEnd=addition_41)
box_13 = DomainBox(Base=pt_175, X=dom_10, Y=dom_10, Z=dom_11)
move_61 = Move(Geometry=box_13, Motion=vec_11)  # -> Geometry, Transform

# ---- group: 3D City / building geo
box_14 = Box(move_61.Geometry)

# ---- group: textured buildings
panel_218 = Panel("C:\Users\RYAN\Documents\GitHub\CityMatrix\Map\PEV_PSG AND PKG_300DPI.png")
boxmap = BoxMapping(Mesh=box_14, Box=box_14)
previewmat_3 = CustomPreviewMaterials(Geometry=boxmap, DiffuseColor=ColourSwatch(SwatchColor=RGB(255, 255, 255)), Transparency="0.01", DiffuseBitmap=panel_218)

# ----
addition_42 = Addition(A=num_171, B=Slider(5, range=0..100))
vec_12 = VectorXYZ(XComponent=0, YComponent=0, ZComponent=addition_42)  # -> Vector, Length
move_62 = Move(Geometry=move_59.Geometry, Motion=vec_12.Vector)  # -> Geometry, Transform
wires = BrepWireframe(Brep=graft(box_14), Density=-1)

# ---- group: Position Calibration / trees 3D
mesh_96 = Mesh(move_60.Geometry)

# ---- group: 3D City / 3D Buldings
preview_44 = CustomPreview(Geometry=box_14, Shader=col_63)

# ----
previewmat_4 = CustomPreviewMaterials(Geometry=box_14, DiffuseColor=col_63, Transparency=Slider(0.7, range=0..1))
partition = PartitionList(List=wires, Size=12)
preview_45 = CustomPreview(
    Geometry=move_62.Geometry,
    Shader={ambient=RGB(0, 0, 0), diffuse=RGB(255, 105, 180), emission=RGB(76, 32, 54), shine=0.5, specular=RGB(255, 255, 255), transparency=0})

# ---- group: parking (continued)
move_63 = Move(Geometry=mesh_95, Motion=vec2pt_10.Vector)  # -> Geometry, Transform; disabled

# ---- group: parking / parking lego
mesh_97 = Mesh(move_63.Geometry)  # disabled

# ---- group: parking (continued)
move_64 = Move(Geometry=mesh_97, Motion=vec_3)  # -> Geometry, Transform; disabled
filter_61 = StreamFilter(Gate=bool_25, Stream0=mesh_97)  # disabled

# ---- group: parking / parking 3D
mesh_98 = Mesh(move_64.Geometry)  # disabled

# ---- group: parking / parking lego
mesh_99 = Mesh(filter_61)  # disabled

# ----
number_slider_56 = Slider(7, range=4..10)
panel_219 = Panel("""Pop. Density
Experience Diversity
Energy Effic.
Working Prox.
Living Prox.
Park Prox.
Live-work Balance
Solar Access
Mobility Perform.""")
python_20 = PythonScript(x=number_slider_56, scale=division_8, inL=panel_219)  # -> out, out_2; inputs inL: list; same code as python_17
panel_220 = Panel(python_20.out_2)
number_slider_57 = Slider(18, range=0..100)
neg_16 = Negative(Value=Slider(42, range=0..100))
vec_13 = VectorXYZ(XComponent=0, YComponent=neg_16, ZComponent=0)  # -> Vector, Length
multiplication_64 = Multiplication(A=number_slider_57, B=Slider(2, range=0..100))
swatch_8 = ColourSwatch(SwatchColor=RGB(255, 255, 255))

number_slider_58 = Slider(7.5, range=3..10)
rings = GhPythonScript()  # -> out, a
# ---------- rings: Python ----------
__author__ = "sunt"
__version__ = "2018.06.04"

import rhinoscriptsyntax as rs

a = [0.2*(i+1) for i in range(4)]
# ---------- end rings ----------
# Radar Chart - Tuo
circle = Circle({Plane=Plane(origin=(1813.714054, -922.0555175, 0), x=(0.9138115486, -0.4061384661, 0), y=(0.4061384661, 0.9138115486, 0)), Radius=293.866235})
area_3 = Area(Geometry=circle)  # -> Area, Centroid
scale_3 = Scale(Geometry=circle, Center=area_3.Centroid, Factor=rings.a)  # -> Geometry, Transform
lng_11 = ListLength(List=panel_220)
divide_6 = DivideCurve(Curve=circle, Count=lng_11, Kinks=False)  # -> Points, Tangents, Parameters
ln_11 = Line(StartPoint=area_3.Centroid, EndPoint=divide_6.Points)
eval_5 = EvaluateCurve(Curve=ln_11, Parameter=Slider(1, range=0..1))  # -> Point, Tangent, Angle
eval_6 = EvaluateCurve(Curve=ln_11, Parameter=Slider(1.4, range=0..2))  # -> Point, Tangent, Angle
ln_12 = Line(StartPoint=area_3.Centroid, EndPoint=eval_5.Point)

eval_7 = EvaluateCurve(Curve=ln_12, Parameter=panel_209)  # -> Point, Tangent, Angle
pline_4 = PolyLine(Vertices=eval_7.Point, Closed=True)
fillet = Fillet(Curve=pline_4, Radius=number_slider_58)
boundary_3 = BoundarySurfaces(Edges=fillet)
move_65 = Move(Geometry=fillet, Motion=Vector(0, 0, 8))  # -> Geometry, Transform
move_66 = Move(Geometry=boundary_3, Motion=Vector(0, 0, 8))  # -> Geometry, Transform

swatch_9 = ColourSwatch(SwatchColor=RGBA(150, 150, 150, 194))
argb_11 = SplitARGB(Colour=swatch_9)  # -> Alpha, Red, Green, Blue
frgb_28 = ColourRGBF(Alpha=Slider(1, range=0..1), Red=argb_11.Red, Green=argb_11.Green, Blue=argb_11.Blue)
previewlw_3 = CustomPreviewLineweights(Geometry=circle, Shader=frgb_28, Thickness=Slider(5, range=0..10), Absolute=False)

swatch_10 = ColourSwatch(SwatchColor=RGBA(255, 255, 255, 194))
argb_12 = SplitARGB(Colour=swatch_9)  # -> Alpha, Red, Green, Blue
frgb_29 = ColourRGBF(Alpha=Slider(1, range=0..1), Red=argb_12.Red, Green=argb_12.Green, Blue=argb_12.Blue)
previewlw_4 = CustomPreviewLineweights(Geometry=flatten([ln_11, scale_3.Geometry]), Shader=frgb_29, Thickness=Slider(1, range=0..10), Absolute=False)

swatch_11 = ColourSwatch(SwatchColor=RGBA(166, 166, 166, 194))
argb_13 = SplitARGB(Colour=swatch_11)  # -> Alpha, Red, Green, Blue
frgb_30 = ColourRGBF(Alpha=Slider(0.575, range=0..1), Red=argb_13.Red, Green=argb_13.Green, Blue=argb_13.Blue)
previewlw_5 = CustomPreviewLineweights(Geometry=move_65.Geometry, Shader=frgb_30, Thickness=Slider(1, range=0..10), Absolute=False)
previewmat_5 = CustomPreviewMaterials(Geometry=move_66.Geometry, DiffuseColor=swatch_11, Transparency=Slider(0.41, range=0..1))

index_4 = Slider(10000, range=1000..100000)
cell_size_3 = Number(cell_size)
grid_x_extent_6 = Number(int_119)
grid_y_extent_6 = Number(int_120)
ppl_by_id = GhPythonScript(
    run=run_module_5.run,
    inL=iron2panel.panelOut,
    id0=int_89,
    id1=int_90,
    id2=int_88,
    id3=int_86,
    id4=int_85,
    id5=int_87,
    id8=int_91)  # -> out, outL; inputs inL: list
# ---------- ppl_by_id: Python ----------
__author__ = "sunt"
__version__ = "2018.06.01"

import rhinoscriptsyntax as rs
run =True
if run:
    
    outL = inL[:]
    
    replaceDict ={0:id0,1:id1,2:id2,3:id3,4:id4,5:id5,8:id8}
    
    for item in range(len(outL)):
        outL[item] = int(replaceDict.get(outL[item],0))
    
        
    print(outL)
# ---------- end ppl_by_id ----------
traffic_by_id = GhPythonScript(inL=ppl_by_id.outL, xExt=grid_x_extent_6, yExt=grid_y_extent_6, cellSize=cell_size_3)  # -> out, outL; inputs inL: tree, xExt: Int32; disabled
# ---------- traffic_by_id: Python ----------
"""Provides a scripting component.
    Inputs:
        centroid: Building's centroid point (area)
        floors: the number of floor
        grid: The gird
        cellSize: the size of the grid cell
        
    Output:
        a: The a output variable"""

__author__ = "sunt"
__version__ = "2018.05.28"

import rhinoscriptsyntax as rs
import math
import Grasshopper as gh

xExt = int(xExt)
yExt = int(yExt)

midL = [[0 for x in range(xExt)] for y in range(yExt)]
outL = [[0 for x in range(xExt)] for y in range(yExt)]

print(outL)
print(inL.Branch(0)[0])




for bldgY in range(yExt):
    for bldgX in range(xExt):
        if float(inL.Branch(bldgY)[bldgX]) == 0:
            trafInd = 0
            for y in range(int(bldgY-2), int(bldgY+3)):
                for x in range(int(bldgX-2), int(bldgX+3)):
                    if 0<=x and x<xExt and 0<=y and y<yExt:
                        if bldgY-y == 2 or bldgY-y == -2 or bldgX-x == 2 or bldgX-x == -2:
                            trafInd += 0.5* float(inL.Branch(y)[x])
                        else:
                            trafInd += float(inL.Branch(y)[x])
            midL[bldgY][bldgX] = trafInd

for bldgY in range(yExt):
    for bldgX in range(xExt):
        if float(inL.Branch(bldgY)[bldgX]) == 0:
            accInd = midL[bldgY][bldgX]
            for (newY,newX) in [(bldgY-1,bldgX),(bldgY+1,bldgX),(bldgY,bldgX-1),(bldgY,bldgX+1)]:
                if 0<=newX and newX<xExt and 0<=newY and newY<yExt:
                    accInd += midL[newY][newX]*0.5
            outL[bldgY][bldgX] = accInd/10000

print(outL)
# ---------- end traffic_by_id ----------

panel_221 = Panel(ppl_by_id.outL)

balance_by_id = GhPythonScript(ids=iron2panel.panelOut, inL=ppl_by_id.outL, xExt=grid_x_extent_6, yExt=grid_y_extent_6)  # -> out, outL, avg; inputs ids: tree, inL: tree, xExt: Int32
# ---------- balance_by_id: Python ----------
"""Provides a scripting component.
    Inputs:
        centroid: Building's centroid point (area)
        floors: the number of floor
        grid: The gird
        cellSize: the size of the grid cell
        
    Output:
        a: The a output variable"""

__author__ = "sunt"
__version__ = "2018.05.28"

import rhinoscriptsyntax as rs
import math
import Grasshopper as gh

xExt = int(xExt)
yExt = int(yExt)

print(ids.Branch(0)[0])
print(inL.Branch(0)[0])

midL = [[0 for x in range(xExt)] for y in range(yExt)]
outL = [[0 for x in range(xExt)] for y in range(yExt)]
#
##print(outL)
##print(inL.Branch(0)[0])
#
score,count = 0,0


for bldgY in range(yExt):
    for bldgX in range(xExt):
        if int(ids.Branch(bldgY)[bldgX])in [0,1,2,3,4,5,6,8]:
            res, emp = 0,0
            for newY in range(bldgY-3,bldgY+4):
                for newX in range(bldgX-3,bldgX+4):
                    if 0<=newX and newX<xExt and 0<=newY and newY<yExt:
                        if int(ids.Branch(newY)[newX])<3:
                            res += int(inL.Branch(newY)[newX])
                        elif int(ids.Branch(newY)[newX])>=3:
                            emp += int(inL.Branch(newY)[newX])
            s = 1-max(0.5-res/(res+emp),res/(res+emp)-0.5)*2
            outL[bldgY][bldgX] = s
            score += s
            count += 1
            
avg = score/count
print(avg)
#
#for bldgY in range(yExt):
#    for bldgX in range(xExt):
#        if float(inL.Branch(bldgY)[bldgX]) == 0:
#            accInd = midL[bldgY][bldgX]
#            for (newY,newX) in [(bldgY-1,bldgX),(bldgY+1,bldgX),(bldgY,bldgX-1),(bldgY,bldgX+1)]:
#                if 0<=newX and newX<xExt and 0<=newY and newY<yExt:
#                    accInd += midL[newY][newX]*0.5
#            for (newY,newX) in [(bldgY-2,bldgX),(bldgY+2,bldgX),(bldgY,bldgX-2),(bldgY,bldgX+2)]:
#                if 0<=newX and newX<xExt and 0<=newY and newY<yExt:
#                    accInd += midL[newY][newX]*0.5
#            outL[bldgY][bldgX] = accInd/index
#            score += max(0,1-accInd/index)
#            count += 1
#avg = score/max(count,1)

#print(outL)
# ---------- end balance_by_id ----------
iron2panel_6 = GhPythonScript(run=run_module_6.run, ironList=balance_by_id.outL)  # -> out, panelOut; same code as iron2panel_2

traffic_by_id_2 = GhPythonScript(
    ids=iron2panel.panelOut,
    inL=ppl_by_id.outL,
    xExt=grid_x_extent_6,
    yExt=grid_y_extent_6,
    index=index_4,
    balance=balance_by_id.avg)  # -> out, midL, outL, avg; inputs ids: tree, inL: tree, xExt: Int32
# ---------- traffic_by_id_2: Python ----------
"""Provides a scripting component.
    Inputs:
        centroid: Building's centroid point (area)
        floors: the number of floor
        grid: The gird
        cellSize: the size of the grid cell
        
    Output:
        a: The a output variable"""

__author__ = "sunt"
__version__ = "2018.05.28"

import rhinoscriptsyntax as rs
import math
import Grasshopper as gh

xExt = int(xExt)
yExt = int(yExt)

midL = [[0 for x in range(xExt)] for y in range(yExt)]
outL = [[0 for x in range(xExt)] for y in range(yExt)]

#print(outL)
#print(inL.Branch(0)[0])

score,count = 0,0


for bldgY in range(yExt):
    for bldgX in range(xExt):
        if float(ids.Branch(bldgY)[bldgX]) in [6,9]:
            trafInd = 0
            for (newY,newX) in [(bldgY-1,bldgX),(bldgY+1,bldgX),(bldgY,bldgX-1),(bldgY,bldgX+1)]:
                if 0<=newX and newX<xExt and 0<=newY and newY<yExt:
                    trafInd += inL.Branch(newY)[newX]
            midL[bldgY][bldgX] = trafInd

for bldgY in range(yExt):
    for bldgX in range(xExt):
        if float(ids.Branch(bldgY)[bldgX]) in [6,9]:
            accInd = midL[bldgY][bldgX]
            for (newY,newX) in [(bldgY-1,bldgX),(bldgY+1,bldgX),(bldgY,bldgX-1),(bldgY,bldgX+1)]:
                if 0<=newX and newX<xExt and 0<=newY and newY<yExt:
                    accInd += midL[newY][newX]*0.5
            for (newY,newX) in [(bldgY-2,bldgX),(bldgY+2,bldgX),(bldgY,bldgX-2),(bldgY,bldgX+2)]:
                if 0<=newX and newX<xExt and 0<=newY and newY<yExt:
                    accInd += midL[newY][newX]*0.5
            outL[bldgY][bldgX] = max(0,1-accInd/index * (1-balance))
            score += max(0,1-accInd/index * (1-balance))
            count += 1
avg = score/max(count,1)

#print(outL)
# ---------- end traffic_by_id_2 ----------
iron2panel_7 = GhPythonScript(run=run_module_5.run, ironList=traffic_by_id_2.outL)  # -> out, panelOut; same code as iron2panel_2

radar_chart_data_list = PythonScript(
    popden=avr_3,
    expdiv=avr_2,
    enEff=avr,
    solar=solar_by_id.avg,
    work=new_col_trans.score,
    live=new_col_trans_3.score,
    park=new_col_trans_2.score,
    tra=traffic_by_id_2.avg,
    lwb=balance_by_id.avg)  # -> out, L
# ---------- radar_chart_data_list: Python ----------
ds = [popden,expdiv,enEff,work,live,park,lwb,solar,tra]
L = [0.5]*len(ds)
for d in range(len(ds)):
    if ds[d]>0:
        L[d] = ds[d]
# ---------- end radar_chart_data_list ----------
python_21 = PythonScript(x=number_slider_56, scale=division_8, inL=radar_chart_data_list.L)  # -> out, out_2; inputs inL: list; same code as python_17
panel_222 = Panel(python_21.out_2)
python_22 = PythonScript(x=panel_222)  # -> out, a
# ---------- python_22: Python ----------
a = str(int(float(x) * 100))
# ---------- end python_22 ----------
pt_177 = Point(eval_6.Point)
move_67 = Move(Geometry=pt_177, Motion=vec_13.Vector)  # -> Geometry, Transform
tag_33 = TextTag3D(Location=move_67.Geometry, Text=python_22.a, Size=multiplication_64, Colour=swatch_8, Justification=5)
tag_34 = TextTag3D(Location=pt_177, Text=panel_220, Size=number_slider_57, Colour=swatch_8, Justification=5)

eval_8 = EvaluateCurve(Curve=ln_12, Parameter=panel_222)  # -> Point, Tangent, Angle
pline_5 = PolyLine(Vertices=eval_8.Point, Closed=True)
fillet_2 = Fillet(Curve=pline_5, Radius=number_slider_58)
boundary_4 = BoundarySurfaces(Edges=fillet_2)
move_68 = Move(Geometry=fillet_2, Motion=Vector(0, 0, 10))  # -> Geometry, Transform
move_69 = Move(Geometry=boundary_4, Motion=Vector(0, 0, 10))  # -> Geometry, Transform

panel_223 = Panel(iron2panel_7.panelOut)
panel_224 = Panel(iron2panel_6.panelOut)

swatch_12 = ColourSwatch(SwatchColor=RGBA(20, 106, 255, 194))
argb_14 = SplitARGB(Colour=swatch_12)  # -> Alpha, Red, Green, Blue
frgb_31 = ColourRGBF(Alpha=Slider(0.575, range=0..1), Red=argb_14.Red, Green=argb_14.Green, Blue=argb_14.Blue)
previewlw_6 = CustomPreviewLineweights(Geometry=move_68.Geometry, Shader=frgb_31, Thickness=Slider(8, range=0..10), Absolute=False)
previewmat_6 = CustomPreviewMaterials(Geometry=move_69.Geometry, DiffuseColor=swatch_12, Transparency=Slider(0.5, range=0..1))

gradient_16 = Gradient(
    LowerLimit=0,
    UpperLimit=1,
    Parameter=panel_223,
    stops=[0: RGB(255, 0, 0), 0.299: RGB(255, 110, 0), 0.5: RGB(255, 255, 0), 0.703: RGB(123, 255, 0), 1: RGB(0, 255, 0)])

gradient_17 = Gradient(
    LowerLimit=0.01,
    UpperLimit=1,
    Parameter=panel_223,
    stops=[1e-06: RGB(255, 255, 240), 0.5: RGB(255, 255, 0), 1: RGB(255, 0, 0)])
panel_225 = Panel("""6
9""")
nonetype_5 = GhPythonScript(i=gradient_16)  # -> out, run, o; same code as nonetype
run_8 = GhPythonScript(i=panel_225, run=nonetype_5.run)  # -> out, o; inputs run: tree; same code as run_4

gradient_18 = Gradient(
    LowerLimit=0,
    UpperLimit=1,
    Parameter=panel_224,
    stops=[0: RGB(255, 0, 0), 0.299: RGB(255, 110, 0), 0.5: RGB(255, 255, 0), 0.703: RGB(123, 255, 0), 1: RGB(0, 255, 0)])
gradient_19 = Gradient(LowerLimit=0, UpperLimit=1, Parameter=panel_224, stops=[0: RGB(255, 0, 0), 0.5: RGB(255, 255, 0), 1: RGB(0, 128, 0)])

panel_226 = Panel("""0
1
2
3
4
5
8""")
nonetype_6 = GhPythonScript(i=gradient_18)  # -> out, run, o; same code as nonetype
run_9 = GhPythonScript(i=panel_226, run=nonetype_6.run)  # -> out, o; inputs run: tree; same code as run_4

col_64 = Colour(flatten([nonetype.o, nonetype_5.o, nonetype_3.o, nonetype_4.o, nonetype_2.o, nonetype_6.o]))
filter_elements_4 = GhPythonScript(t=num_57, ids=flatten(iron2panel.panelOut), filter=flatten([run_4.o, run_8.o, run_6.o, run_7.o, run_5.o, run_9.o]))  # -> out, outE; inputs ids: list, filter: list of Int32
# ---------- filter_elements_4: Python ----------
__author__ = "sunt"
__version__ = "2018.06.03"

import rhinoscriptsyntax as rs

#print(E)
print(filter)
outE = []

for e in range(len(ids)):
    if ids[e] in filter:
        outE.append(t)
    else:
        outE.append(0)
# ---------- end filter_elements_4 ----------
argb_15 = SplitARGB(Colour=col_64)  # -> Alpha, Red, Green, Blue
# HeatMap display - Tuo
move_70 = Move(Geometry=boundary_2, Motion=Vector(0, 0, 8))  # -> Geometry, Transform
frgb_32 = ColourRGBF(Alpha=filter_elements_4.outE, Red=argb_15.Red, Green=argb_15.Green, Blue=argb_15.Blue)
mesh_100 = Mesh(move_70.Geometry)
panel_227 = Panel(filter_elements_4.outE)

# ---- group: keystone
morph_10 = BoxMorph(Geometry=mesh_100, Reference=box_2, Target=tbox_2)

# ---- group: Tuo Heatmaps
preview_46 = CustomPreview(Geometry=morph_10, Shader=frgb_32)

# ==== cluster ModuleCenter
pt = ClusterInput()
int = ClusterInput()
num = ClusterInput()
int_2 = ClusterInput()

# ---- group: y
int_3 = Integer(int)

# ---- group: cell size
num_2 = Number(num)

# ---- group: x
int_4 = Integer(int_2)

# ---- group: center
pt_2 = Point(pt)

# ----
pt_3 = ConstructPoint(XCoordinate=0, YCoordinate=0, ZCoordinate=0)  # disabled
addition = Addition(A=int_4, B=0.5)
vec2pt = Vector2Pt(PointA=pt_3, PointB=pt_2, Unitize=False)  # -> Vector, Length; disabled
addition_2 = Addition(A=int_3, B=0.5)
multiplication = Multiplication(A=addition, B=num_2)
move = Move(Motion=vec2pt.Vector)  # -> Geometry, Transform; disabled
lng = ListLength(List=int_4)  # disabled
multiplication_2 = Multiplication(A=addition_2, B=num_2)
X = UnitX(Factor=multiplication)
repeat = RepeatData(Data=move.Transform, Length=lng)  # disabled
neg = Negative(Value=multiplication_2)
move_2 = Move(Geometry=pt_2, Motion=X)  # -> Geometry, Transform
graft = GraftTree(Tree=move_2.Transform, IncludeEmptyLists=True, IncludeNullItems=True)  # disabled
Y = UnitY(Factor=neg)
pshift = ShiftPaths(Data=repeat, Offset=-1)  # disabled
move_3 = Move(Geometry=move_2.Geometry, Motion=Y)  # -> Geometry, Transform
graft_2 = GraftTree(Tree=move_3.Transform, IncludeEmptyLists=True, IncludeNullItems=True)  # disabled
comp = Compound(Transforms=[graft, graft_2])  # disabled
graft_3 = GraftTree(Tree=pshift, IncludeEmptyLists=True, IncludeNullItems=True)  # disabled
comp_2 = Compound(Transforms=[comp, graft_3])  # disabled

# ---- group: module center
pt_4 = Point(move_3.Geometry)

# ----
pshift_2 = ShiftPaths(Data=comp_2, Offset=-1)  # disabled
transform = Transform(pshift_2)  # disabled
pt_5 = ClusterOutput(pt_4)
transform_2 = ClusterOutput(transform)  # disabled

# ==== cluster MoveToOrgin
num = ClusterInput()
G = ClusterInput()
num_2 = Number(num)
geobottomcenter = GeoBottomCenter(geo=G)
vec2pt = Vector2Pt(PointA=geobottomcenter, PointB=Point(0, 0, 0), Unitize=False)  # -> Vector, Length
move = Move(Geometry=G, Motion=vec2pt.Vector)  # -> Geometry, Transform
scale_nu = ScaleNU(Geometry=move.Geometry, Plane=PlaneXY(0, 0, 0), ScaleX=num_2, ScaleY=num_2, ScaleZ=1)  # -> Geometry, Transform
G_2 = ClusterOutput(scale_nu.Geometry)

# ==== cluster GeoBottomCenter_2
geo = ClusterInput()
geo_2 = Geometry(geo)
bbox = BoundingBox(Content=geo_2, Plane=PlaneXY(0, 0, 0))  # -> Box, Box_2
box_corners = BoxCorners(Box=bbox.Box)  # -> CornerA, CornerB, CornerC, CornerD, CornerE, CornerF, CornerG, CornerH
pdecon = Deconstruct(Point=box_corners.CornerA)  # -> XComponent, YComponent, ZComponent
pdecon_2 = Deconstruct(Point=box_corners.CornerC)  # -> XComponent, YComponent, ZComponent
addition = Addition(A=pdecon.XComponent, B=pdecon_2.XComponent)
addition_2 = Addition(A=pdecon.YComponent, B=pdecon_2.YComponent)
division = Division(A=addition, B=2)
division_2 = Division(A=addition_2, B=2)
pt = ConstructPoint(XCoordinate=division, YCoordinate=division_2, ZCoordinate=pdecon.ZComponent)
pshift = ShiftPaths(Data=pt, Offset=-1)
pt_2 = Point(pshift)
pt_3 = ClusterOutput(pt_2)

# ==== cluster EasterEggs
panel = Panel("79")  # disabled
panel_2 = Panel("30")  # disabled
subtraction = Subtraction(A=panel, B=1)  # disabled
subtraction_2 = Subtraction(A=panel_2, B=1)  # disabled
sqgrid = Square(Plane=PlaneXY(0, 0, 0), Size=1, ExtentX=subtraction, ExtentY=subtraction_2)  # -> Cells, Points; disabled
pdecon = Deconstruct(Point=sqgrid.Points)  # -> XComponent, YComponent, ZComponent; disabled
division = Division(A=pdecon.XComponent, B=panel)  # disabled
division_2 = Division(A=pdecon.YComponent, B=panel_2)  # disabled
pt = ConstructPoint(XCoordinate=division, YCoordinate=division_2, ZCoordinate=0)  # disabled
ahsv = SplitAHSV()  # -> Alpha, Hue, Saturation, Value; disabled
smaller = SmallerThan(FirstNumber=ahsv.Alpha, SecondNumber=1)  # -> SmallerThan, OrEqualTo; disabled
dispatch = Dispatch(List=sqgrid.Points, DispatchPattern=smaller.SmallerThan)  # -> ListA, ListB; disabled
dispatch_2 = Dispatch(DispatchPattern=smaller.SmallerThan)  # -> ListA, ListB; disabled
vec = VectorXYZ(XComponent=2, YComponent=-2, ZComponent=-10)  # -> Vector, Length; disabled
planesrf = PlaneSurface(Plane=dispatch.ListB, XSize=Domain(-0.5, 0.5), YSize=Domain(-0.5, 0.5))  # disabled
mesh = Mesh(flatten(planesrf))  # disabled
col = Colour(flatten(dispatch_2.ListB))  # disabled
mspray = MeshSpray(Mesh=graft(mesh), Points=Point(0, 0, 0), Colours=graft(col), SprayMode=0)  # disabled
mjoin = MeshJoin(Meshes=flatten(mspray))  # disabled
move = Move(Geometry=mjoin, Motion=vec.Vector)  # -> Geometry, Transform; disabled
mcol = MeshColours(Mesh=move.Geometry, Colours=RGB(0, 0, 0))  # disabled
preview = CustomPreview(Geometry=planesrf, Shader=dispatch_2.ListB)  # disabled
mjoin_2 = MeshJoin(Meshes=flatten([mjoin, mcol]))  # disabled
toggle = BooleanToggle(False)  # disabled
toggle_2 = BooleanToggle(False)  # disabled
panel_3 = Panel("7")  # disabled
swatch = ColourSwatch(SwatchColor=RGB(0, 0, 0))  # disabled
swatch_2 = ColourSwatch(SwatchColor=RGB(255, 115, 0))  # disabled

# ---- group: module meshes lego ref: 7 - J
mesh_2 = Mesh(<mesh referenced from the Rhino model>)  # disabled

# ---- group: on screen mesh ref: 8 - X
mesh_3 = Mesh(<mesh referenced from the Rhino model>)  # disabled

# ---- group: module meshes lego ref: 8 - X
mesh_4 = Mesh(<mesh referenced from the Rhino model>)  # disabled

# ----
panel_4 = Panel("7")  # disabled
mesh_5 = Mesh(<mesh referenced from the Rhino model>)  # disabled

# ---- group: on screen mesh ref: 7 - J
mesh_6 = Mesh(mjoin_2)  # disabled

# ----
mcol_2 = MeshColours(Mesh=mesh_3, Colours=swatch_2)  # disabled
mcol_3 = MeshColours(Mesh=mesh_5, Colours=swatch)  # disabled
shrink = ClusterInput()
shrink_2 = ClusterInput()
movetoorgin = MoveToOrgin(G=mesh_2, num=shrink)  # disabled
movetoorgin_2 = MoveToOrgin(G=mesh_4, num=shrink_2)  # disabled
mjoin_3 = MeshJoin(Meshes=[mcol_2, mcol_3])  # disabled

# ---- group: module meshes lego at orgin
mesh_7 = Mesh(movetoorgin)  # disabled

mesh_8 = Mesh(movetoorgin_2)  # disabled

# ----
A = ClusterInput()
A_2 = ClusterInput()
equals = Equality(FirstNumber=A, SecondNumber=panel_4)  # -> Equality, Inequality; disabled
int = Integer(equals.Equality)  # disabled
ma = MassAddition(Input=int)  # -> Result, PartialResults; disabled
larger = LargerThan(FirstNumber=ma.Result, SecondNumber=0)  # -> LargerThan, OrEqualTo; disabled
equals_2 = Equality(FirstNumber=A_2, SecondNumber=panel_3)  # -> Equality, Inequality; disabled
L = ClusterInput()
int_2 = Integer(equals_2.Equality)  # disabled
ma_2 = MassAddition(Input=int_2)  # -> Result, PartialResults; disabled
larger_2 = LargerThan(FirstNumber=ma_2.Result, SecondNumber=0)  # -> LargerThan, OrEqualTo; disabled
L_2 = ClusterInput()
dispatch_3 = Dispatch(List=L, DispatchPattern=equals_2.Equality)  # -> ListA, ListB; disabled

# ---- group: if has this special id
bool = Boolean(larger.LargerThan)  # disabled

bool_2 = Boolean(bool)  # disabled

# ----
getcamera = GetCamera(GetCamera=bool_2)  # -> Location, Target, LensLength, UpDirection; disabled
ln = Line(StartPoint=getcamera.Location, EndPoint=getcamera.Target)  # disabled
getplanefrom2pts = GetPlaneFrom2pts(pt_2=getcamera.Location, pt=getcamera.Target)  # disabled
dispatch_4 = Dispatch(List=L_2, DispatchPattern=equals.Equality)  # -> ListA, ListB; disabled
number_slider = Slider(6.4, range=0..10)  # disabled
number_slider_2 = Slider(14.4, range=0..100)  # disabled
pt_2 = ConstructPoint(XCoordinate=500, YCoordinate=500, ZCoordinate=20)  # disabled

# ---- group: if has this special id
bool_3 = Boolean(larger_2.LargerThan)  # disabled

bool_4 = Boolean(bool_3)  # disabled

# ----
getcamera_2 = GetCamera(GetCamera=bool_4)  # -> Location, Target, LensLength, UpDirection; disabled
ln_2 = Line(StartPoint=getcamera_2.Location, EndPoint=getcamera_2.Target)  # disabled
getplanefrom2pts_2 = GetPlaneFrom2pts(pt_2=getcamera_2.Location, pt=getcamera_2.Target)  # disabled
vec2pt = Vector2Pt(PointA=Point(0, 0, 0), PointB=dispatch_3.ListA, Unitize=False)  # -> Vector, Length; disabled
vec2pt_2 = Vector2Pt(PointA=Point(0, 0, 0), PointB=dispatch_4.ListA, Unitize=False)  # -> Vector, Length; disabled
move_2 = Move(Geometry=mesh_7, Motion=vec2pt.Vector)  # -> Geometry, Transform; disabled
pt_3 = Point(pt_2)  # disabled
move_3 = Move(Geometry=mesh_8, Motion=vec2pt_2.Vector)  # -> Geometry, Transform; disabled

# ---- group: current cam canvas pln
pln = Plane(getplanefrom2pts)  # disabled

pln_2 = Plane(getplanefrom2pts_2)  # disabled

# ----
xy = XYPlane(Origin=pt_3)  # disabled
number_slider_3 = Slider(0.01, range=0.001..1)  # disabled
number_slider_4 = Slider(0.01, range=0.001..1)  # disabled
number_slider_5 = Slider(0.81, range=0.001..101)  # disabled
movetoorgin_3 = MoveToOrgin(G=mjoin_3, num=number_slider)  # disabled
movetoorgin_4 = MoveToOrgin(G=mesh_6, num=number_slider_2)  # disabled
orient = Orient(Geometry=movetoorgin_4, Source=PlaneXY(0, 0, 0), Target=xy)  # -> Geometry, Transform; disabled
orient_2 = Orient(Geometry=movetoorgin_3, Source=PlaneXY(0, 0, 0), Target=pln)  # -> Geometry, Transform; disabled
orient_3 = Orient(Geometry=movetoorgin_4, Source=PlaneXY(0, 0, 0), Target=pln_2)  # -> Geometry, Transform; disabled
scale = Scale(Geometry=orient_2.Geometry, Center=getcamera.Location, Factor=number_slider_3)  # -> Geometry, Transform; disabled
scale_2 = Scale(Geometry=orient_3.Geometry, Center=getcamera_2.Location, Factor=number_slider_4)  # -> Geometry, Transform; disabled
scale_3 = Scale(Geometry=orient.Geometry, Center=pt_3, Factor=number_slider_5)  # -> Geometry, Transform; disabled
filter = StreamFilter(Gate=bool_2, Stream1=scale.Geometry)  # disabled
filter_2 = StreamFilter(Gate=bool_4, Stream1=scale_2.Geometry)  # disabled
filter_3 = StreamFilter(Gate=bool_4, Stream1=scale_3.Geometry)  # disabled

# ---- group: special JR
mesh_9 = Mesh(move_2.Geometry)  # disabled

# ---- group: on 3d view
mesh_10 = Mesh(filter)  # disabled

# ---- group: special Xin
mesh_11 = Mesh(move_3.Geometry)  # disabled

# ---- group: on 3d view
mesh_12 = Mesh(filter_2)  # disabled

# ---- group: on lego
mesh_13 = Mesh(filter_3)  # disabled

# ==== cluster RndReduceByRatio
L = ClusterInput()
B = ClusterInput()
lng = ListLength(List=L)
S = ClusterInput()
multiplication = Multiplication(A=lng, B=B)
reduce = RandomReduce(List=L, Reduction=multiplication, Seed=S)
L_2 = ClusterOutput(reduce)

# ==== cluster Perspective
int = ClusterInput()
int_2 = ClusterInput()
pt = ClusterInput()

# ---- group: grid extent y
int_3 = Integer(int)

# ---- group: grid extent x
int_4 = Integer(int_2)

# ---- group: Pts Sample Grid Corner
pt_2 = Point(pt)

# ----
subtraction = Subtraction(A=int_4, B=1)
subtraction_2 = Subtraction(A=int_3, B=1)
item = ListItem(List=pt_2, Index=0, Wrap=False)
item_2 = ListItem(List=pt_2, Index=1, Wrap=False)
item_3 = ListItem(List=pt_2, Index=2, Wrap=False)
item_4 = ListItem(List=pt_2, Index=3, Wrap=False)
pt_3 = Point(item_4)
pt_4 = Point(item)
ln = Line(StartPoint=pt_3, EndPoint=pt_4)
pt_5 = Point(item_2)
ln_2 = Line(StartPoint=pt_4, EndPoint=pt_5)
pt_6 = Point(item_3)
ln_3 = Line(StartPoint=pt_6, EndPoint=pt_3)
ln_4 = Line(StartPoint=pt_5, EndPoint=pt_6)
llx = LineLine(Line1=ln, Line2=ln_4)  # -> ParamA, ParamB, PointA, PointB
pt_7 = Point(llx.PointA)
llx_2 = LineLine(Line1=ln_2, Line2=ln_3)  # -> ParamA, ParamB, PointA, PointB
pt_8 = Point(llx_2.PointA)
vec2pt = Vector2Pt(PointA=pt_8, PointB=pt_7, Unitize=False)  # -> Vector, Length
line = LineSDL(Start=pt_3, Direction=vec2pt.Vector, Length=1)
llx_3 = LineLine(Line1=ln_2, Line2=line)  # -> ParamA, ParamB, PointA, PointB
pt_9 = Point(llx_3.PointA)
ln_5 = Line(StartPoint=pt_3, EndPoint=pt_9)
divide = DivideCurve(Curve=ln_5, Count=subtraction_2, Kinks=False)  # -> Points, Tangents, Parameters
ln_6 = Line(StartPoint=pt_8, EndPoint=divide.Points)
llx_4 = LineLine(Line1=ln_4, Line2=line)  # -> ParamA, ParamB, PointA, PointB
pt_10 = Point(llx_4.PointA)
ln_7 = Line(StartPoint=pt_3, EndPoint=pt_10)
divide_2 = DivideCurve(Curve=ln_7, Count=subtraction, Kinks=False)  # -> Points, Tangents, Parameters
ln_8 = Line(StartPoint=pt_7, EndPoint=divide_2.Points)
ln_9 = Line(StartPoint=pt_8, EndPoint=pt_7)

# ---- group: x
line_2 = Line(ln_8)

# ---- group: y
line_3 = Line(ln_6)

# ----
graft = GraftTree(Tree=ln_6, IncludeEmptyLists=True, IncludeNullItems=True)
llx_5 = LineLine(Line1=line_2, Line2=graft)  # -> ParamA, ParamB, PointA, PointB

# ---- group: keystoned grid pts
pt_11 = Point(llx_5.PointA)

# ----
pt_12 = ClusterOutput(pt_11)

# ==== cluster RecordDensitySliderSet
num = ClusterInput()
int = ClusterInput()
set1 = ClusterInput()
integer = ClusterInput()
set2 = ClusterInput()

# ---- group: slider1
num_2 = Number(num)

# ---- group: dockID
int_2 = Integer(int)

# ---- group: set number
integer_2 = Integer(integer)

# ----
set1_2 = Integer(set1)
remap = RemapNumbers(Value=set1_2, Source="1 to 30", Target=Domain(0, 1))  # -> Mapped, Clipped
panel = Panel(remap.Mapped)
set2_2 = Integer(set2)
remap_2 = RemapNumbers(Value=set2_2, Source="1 to 30", Target=Domain(0, 1))  # -> Mapped, Clipped
panel_2 = Panel(remap_2.Mapped)
equals = Equality(FirstNumber=int_2, SecondNumber="6")  # -> Equality, Inequality
equals_2 = Equality(FirstNumber=int_2, SecondNumber="5")  # -> Equality, Inequality
equals_3 = Equality(FirstNumber=int_2, SecondNumber="2")  # -> Equality, Inequality
equals_4 = Equality(FirstNumber=int_2, SecondNumber="3")  # -> Equality, Inequality
equals_5 = Equality(FirstNumber=int_2, SecondNumber="4")  # -> Equality, Inequality
equals_6 = Equality(FirstNumber=int_2, SecondNumber="0")  # -> Equality, Inequality
equals_7 = Equality(FirstNumber=int_2, SecondNumber="1")  # -> Equality, Inequality
equals_8 = Equality(FirstNumber=int_2, SecondNumber="7")  # -> Equality, Inequality
equals_9 = Equality(FirstNumber=int_2, SecondNumber="8")  # -> Equality, Inequality

# ---- group: density set 2
item = ListItem(List=panel_2, Index=0, Wrap=False)
item_2 = ListItem(List=panel_2, Index=2, Wrap=False)
item_3 = ListItem(List=panel_2, Index=1, Wrap=False)
item_4 = ListItem(List=panel_2, Index=3, Wrap=False)
item_5 = ListItem(List=panel_2, Index=4, Wrap=False)
item_6 = ListItem(List=panel_2, Index=5, Wrap=False)
panel_3 = Panel(item)
panel_4 = Panel(item_3)
panel_5 = Panel(item_2)
panel_6 = Panel(item_4)
panel_7 = Panel(item_5)
panel_8 = Panel(item_6)

# ----
item_7 = ListItem(List=panel_2, Index=6, Wrap=False)
item_8 = ListItem(List=panel_2, Index=7, Wrap=False)
item_9 = ListItem(List=panel_2, Index=8, Wrap=False)

# ---- group: density set 1
item_10 = ListItem(List=panel, Index=0, Wrap=False)
item_11 = ListItem(List=panel, Index=2, Wrap=False)
item_12 = ListItem(List=panel, Index=1, Wrap=False)
item_13 = ListItem(List=panel, Index=3, Wrap=False)
item_14 = ListItem(List=panel, Index=4, Wrap=False)
item_15 = ListItem(List=panel, Index=5, Wrap=False)
panel_9 = Panel(item_10)
panel_10 = Panel(item_12)
panel_11 = Panel(item_11)
panel_12 = Panel(item_13)
panel_13 = Panel(item_14)
panel_14 = Panel(item_15)

# ----
item_16 = ListItem(List=panel, Index=6, Wrap=False)
item_17 = ListItem(List=panel, Index=7, Wrap=False)
item_18 = ListItem(List=panel, Index=8, Wrap=False)
filter = StreamFilter(Gate=equals.Equality, Stream1=num_2)
panel_15 = Panel(integer_2)
panel_16 = Panel(item_7)
panel_17 = Panel(item_8)
panel_18 = Panel(item_9)
filter_2 = StreamFilter(Gate=equals_2.Equality, Stream1=num_2)
filter_3 = StreamFilter(Gate=equals_3.Equality, Stream1=num_2)
filter_4 = StreamFilter(Gate=equals_4.Equality, Stream1=num_2)
filter_5 = StreamFilter(Gate=equals_5.Equality, Stream1=num_2)
filter_6 = StreamFilter(Gate=equals_6.Equality, Stream1=num_2)
filter_7 = StreamFilter(Gate=equals_7.Equality, Stream1=num_2)
filter_8 = StreamFilter(Gate=equals_8.Equality, Stream1=num_2)
filter_9 = StreamFilter(Gate=equals_9.Equality, Stream1=num_2)
panel_19 = Panel(item_16)
panel_20 = Panel(item_17)
panel_21 = Panel(item_18)
filter_10 = StreamFilter(Gate=panel_15, Stream0=filter, Stream1=panel_19, Stream2=panel_16)
filter_11 = StreamFilter(Gate=panel_15, Stream0=filter_6, Stream1=panel_9, Stream2=panel_3)
filter_12 = StreamFilter(Gate=panel_15, Stream0=filter_2, Stream1=panel_14, Stream2=panel_8)
filter_13 = StreamFilter(Gate=panel_15, Stream0=filter_3, Stream1=panel_11, Stream2=panel_5)
filter_14 = StreamFilter(Gate=panel_15, Stream0=filter_4, Stream1=panel_12, Stream2=panel_6)
filter_15 = StreamFilter(Gate=panel_15, Stream0=filter_5, Stream1=panel_13, Stream2=panel_7)
filter_16 = StreamFilter(Gate=panel_15, Stream0=filter_8, Stream1=panel_20, Stream2=panel_17)
filter_17 = StreamFilter(Gate=panel_15, Stream0=filter_7, Stream1=panel_10, Stream2=panel_4)
filter_18 = StreamFilter(Gate=panel_15, Stream0=filter_9, Stream1=panel_21, Stream2=panel_18)
rec = DataRecorder(filter_10, DataLimit=1, RecordData=True)
panel_22 = Panel(rec)
rec_2 = DataRecorder(filter_13, DataLimit=1, RecordData=True)
panel_23 = Panel(rec_2)
rec_3 = DataRecorder(filter_12, DataLimit=1, RecordData=True)
panel_24 = Panel(rec_3)
rec_4 = DataRecorder(filter_17, DataLimit=1, RecordData=True)
panel_25 = Panel(rec_4)
rec_5 = DataRecorder(filter_14, DataLimit=1, RecordData=True)
panel_26 = Panel(rec_5)
rec_6 = DataRecorder(filter_15, DataLimit=1, RecordData=True)
panel_27 = Panel(rec_6)
rec_7 = DataRecorder(filter_11, DataLimit=1, RecordData=True)
panel_28 = Panel(rec_7)
rec_8 = DataRecorder(filter_16, DataLimit=1, RecordData=True)
panel_29 = Panel(rec_8)
rec_9 = DataRecorder(filter_18, DataLimit=1, RecordData=True)
panel_30 = Panel(rec_9)
null = NullItem(Item=rec)  # -> NullFlags, InvalidFlags, Description
null_2 = NullItem(Item=rec_3)  # -> NullFlags, InvalidFlags, Description
null_3 = NullItem(Item=rec_2)  # -> NullFlags, InvalidFlags, Description
null_4 = NullItem(Item=rec_5)  # -> NullFlags, InvalidFlags, Description
null_5 = NullItem(Item=rec_6)  # -> NullFlags, InvalidFlags, Description
null_6 = NullItem(Item=rec_7)  # -> NullFlags, InvalidFlags, Description
null_7 = NullItem(Item=rec_4)  # -> NullFlags, InvalidFlags, Description
null_8 = NullItem(Item=rec_8)  # -> NullFlags, InvalidFlags, Description
null_9 = NullItem(Item=rec_9)  # -> NullFlags, InvalidFlags, Description
filter_19 = StreamFilter(Gate=null.NullFlags, Stream0=rec, Stream1="0")
filter_20 = StreamFilter(Gate=null_2.NullFlags, Stream0=rec_3, Stream1="0")
filter_21 = StreamFilter(Gate=null_3.NullFlags, Stream0=rec_2, Stream1="0")
filter_22 = StreamFilter(Gate=null_4.NullFlags, Stream0=rec_5, Stream1="0")
filter_23 = StreamFilter(Gate=null_5.NullFlags, Stream0=rec_6, Stream1="0")
filter_24 = StreamFilter(Gate=null_6.NullFlags, Stream0=rec_7, Stream1="0")
filter_25 = StreamFilter(Gate=null_7.NullFlags, Stream0=rec_4, Stream1="0")
filter_26 = StreamFilter(Gate=null_8.NullFlags, Stream0=rec_8, Stream1="0")
filter_27 = StreamFilter(Gate=null_9.NullFlags, Stream0=rec_9, Stream1="0")
merge = Merge(
    Data1=filter_24,
    Data2=filter_25,
    Data3=filter_21,
    Data4=filter_22,
    Data5=filter_23,
    Data6=filter_20,
    Data7=filter_19,
    Data8=filter_26,
    Data9=filter_27)
remap_3 = RemapNumbers(Value=merge, Source=Domain(0, 1), Target="1 to 30")  # -> Mapped, Clipped

# ---- group: floor num for each type
int_3 = Integer(remap_3.Mapped)

# ----
panel_31 = Panel(int_3)

int_4 = ClusterOutput(int_3)

# ==== cluster LimitMaxID
int = ClusterInput()
int_2 = ClusterInput()

# ---- group: max id
int_3 = Integer(int)

# ---- group: all piece ids raw
int_4 = Integer(int_2)

# ----
lng = ListLength(List=int_4)
larger = LargerThan(FirstNumber=int_4, SecondNumber=int_3)  # -> LargerThan, OrEqualTo
repeat = RepeatData(Data="-1", Length=lng)
pshift = ShiftPaths(Data=repeat, Offset=-1)
merge = Merge(Data1=graft(int_4), Data2=graft(pshift))
item = ListItem(List=merge, Index=graft(larger.LargerThan), Wrap=False)
pshift_2 = ShiftPaths(Data=item, Offset=-1)

# ---- group: all piece ids
int_5 = Integer(pshift_2)

# ----
int_6 = ClusterOutput(int_5)

# ==== cluster GeoBottomCenter
geo = ClusterInput()
geo_2 = Geometry(geo)
bbox = BoundingBox(Content=geo_2, Plane=PlaneXY(0, 0, 0))  # -> Box, Box_2
box_corners = BoxCorners(Box=bbox.Box)  # -> CornerA, CornerB, CornerC, CornerD, CornerE, CornerF, CornerG, CornerH
pdecon = Deconstruct(Point=box_corners.CornerA)  # -> XComponent, YComponent, ZComponent
pdecon_2 = Deconstruct(Point=box_corners.CornerC)  # -> XComponent, YComponent, ZComponent
addition = Addition(A=pdecon.XComponent, B=pdecon_2.XComponent)
addition_2 = Addition(A=pdecon.YComponent, B=pdecon_2.YComponent)
division = Division(A=addition, B=2)
division_2 = Division(A=addition_2, B=2)
pt = ConstructPoint(XCoordinate=division, YCoordinate=division_2, ZCoordinate=pdecon.ZComponent)
pt_2 = Point(pt)
pt_3 = ClusterOutput(pt_2)

# ==== cluster GetPlaneFrom2pts
pt = ClusterInput()
pt_2 = ClusterInput()

# ---- group: current cam tgt pos
pt_3 = Point(pt)

# ---- group: current cam pos
pt_4 = Point(pt_2)

# ----
Z = UnitZ(Factor=100)
move = Move(Geometry=pt_3, Motion=Z)  # -> Geometry, Transform
pl_3pt = Plane3Pt(PointA=pt_3, PointB=pt_4, PointC=move.Geometry)
pt_5 = PointOriented(BasePlane=pl_3pt, UComponent=0, VComponent=0, WComponent=-100)
pt_6 = PointOriented(BasePlane=pl_3pt, UComponent=0, VComponent=100, WComponent=0)
pl_3pt_2 = Plane3Pt(PointA=pt_3, PointB=pt_5, PointC=pt_6)
pln = Plane(pl_3pt_2)
pln_2 = ClusterOutput(pln)
