# Grasshopper definition 180607_walkability heatmaps extracted from volpe.gh (Grasshopper 0.9.76)

int = Integer(Slider(14, range=1..30))
int_2 = Integer(Slider(14, range=-21..30))
int_3 = Integer(int_2)
int_4 = Integer(int)
series = Series(Start=0, Step=1, Count=int_3)
multiplication = Multiplication(B=4)
split = TextSplit(Text="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", Separators="\t")
multiplication_2 = Multiplication(A=series, B=2)
multiplication_3 = Multiplication(A=multiplication, B=int_4)
txt = Text(split)
nullrep = ReplaceNulls(Items=Slider(0.2, range=0..1), Replacements=0)  # -> Items, Count
col = Colour()
addition = Addition(A=multiplication_2, B=graft(multiplication_3))
pshift = ShiftPaths(Data=addition, Offset=-1)
multiplication_4 = Multiplication(A=int_3, B=2)
lng = ListLength(List=txt)
addition_2 = Addition(A=pshift, B=1)
addition_3 = Addition(A=pshift, B=multiplication_4)
division = Division(A=lng, B="4")
series_2 = Series(Start=0, Step=1, Count=division)
addition_4 = Addition(A=addition_3, B=1)
pshift_2 = ShiftPaths(Data=series_2, Offset=-1)
multiplication_5 = Multiplication(A=division, B="4")
repeat = RepeatData(Data=pshift_2, Length=multiplication_5)
pshift_3 = ShiftPaths(Data=repeat, Offset=-1)
panel = Panel("""1,0,0,0,0,0,0,0,0,0,0,0,0,0
1,0,0,0,0,0,0,0,0,0,0,0,0,0
1,0,0,0,0,0,0,1,1,1,1,1,1,1
1,0,0,0,0,0,0,1,1,1,1,1,1,1
1,0,0,0,0,0,0,1,1,1,1,1,1,1
1,0,0,0,0,0,0,1,1,1,1,1,1,1
1,0,0,0,0,0,0,1,1,1,1,1,1,1
0,0,0,0,0,0,0,1,1,1,1,1,1,1
0,0,0,0,0,0,0,0,0,1,1,1,1,1
0,0,0,0,0,0,0,0,0,0,0,0,1,1
0,0,0,0,0,0,0,0,0,0,0,1,1,1
1,1,0,0,0,0,0,0,0,0,0,1,1,1
1,1,1,1,1,0,0,0,0,0,0,1,1,1
1,1,1,1,1,1,1,1,0,0,1,1,1,1""")
merge = Merge()
int_5 = Integer(pshift_3)
merge_2 = Merge()
merge_3 = Merge(Data1=merge, Data2=merge_2)
txt_2 = Text(panel)
col_2 = Colour([RGB(115, 105, 112), RGB(157, 84, 87), RGB(189, 167, 147)])
cp = ClosestPoint(Point=col, Cloud=col_2)  # -> ClosestPoint, CPIndex, Distance
item = ListItem(List=merge_3, Index=cp.CPIndex, Wrap=False)
int_6 = Integer(item)
item_2 = ListItem(List=int_6, Index=pshift, Wrap=False)
item_3 = ListItem(List=int_6, Index=addition_3, Wrap=False)
item_4 = ListItem(List=int_6, Index=addition_4, Wrap=False)
item_5 = ListItem(List=int_6, Index=addition_2, Wrap=False)
merge_4 = Merge(Data1=graft(item_2), Data2=graft(item_3), Data3=graft(item_4), Data4=graft(item_5))
int_7 = Integer(merge_4)
rev = ReverseList(List=int_7)
txt_3 = Text(rev)
join = TextJoin(Text=txt_3, Join=",")
pshift_4 = ShiftPaths(Data=join, Offset=-1)
txt_4 = Text(pshift_4)
keysearch = KeyValueSearch(Keys=txt, Values=int_5, Search=graft(txt_4))
nullrep_2 = ReplaceNulls(Items=keysearch, Replacements="-1")  # -> Items, Count
pshift_5 = ShiftPaths(Data=nullrep_2.Items, Offset=-1)
pshift_6 = ShiftPaths(Data=pshift_5, Offset=-1)
int_8 = Integer(pshift_6)
int_9 = Integer(int_8)
id_masking = IDMasking(int_2=int_9, T=txt_2)
int_10 = Integer(id_masking)
int_11 = Integer(int_2)
int_12 = Integer(int_10)
num = Number(nullrep.Items)
remap = RemapNumbers(Value=num, Source=Domain(0, 1), Target=Domain(0, 9))  # -> Mapped, Clipped
int_13 = Integer(int_11)
pt = Point(<point referenced from the Rhino model>)
pt_2 = Point(<point referenced from the Rhino model>)
int_14 = Integer(remap.Mapped)
dist = Distance(PointA=pt, PointB=pt_2)
division_2 = Division(A=dist, B=int_13)
num_2 = Number(division_2)
panel_2 = Panel("""B,B,B,B,B,B,B,B,B,B,B,B,B,B,B,B,B,B,R,R,G,G,R,R,0,G,2,2,2,R,R,R,4,R,2,G,G,2,B,B,4,4,4,4
B,B,B,B,B,B,B,B,B,B,B,B,B,B,B,B,B,R,R,G,G,R,R,0,1,1,2,1,R,R,4,5,5,R,R,2,G,G,2,B,3,3,B,B
B,B,B,B,B,B,B,B,B,B,B,B,B,B,B,B,R,R,G,G,R,R,0,1,1,1,P,R,R,B,B,4,5,4,R,R,2,G,4,3,4,B,B,4
B,B,B,B,B,B,B,B,B,B,B,B,B,B,B,R,R,G,G,R,R,3,3,5,4,P,R,R,R,4,B,4,5,5,5,R,B,4,4,3,B,B,3,4
B,B,B,B,B,B,B,B,B,B,B,B,R,R,R,R,G,G,R,R,3,3,3,P,P,R,R,P,R,3,B,G,4,5,B,R,R,4,B,B,B,B,3,5
B,B,B,B,B,B,B,B,B,B,B,R,R,G,G,G,R,R,R,3,3,R,R,R,R,R,P,P,R,4,4,B,B,B,B,B,R,4,4,G,G,B,3,3
B,B,B,B,B,B,R,R,R,R,R,R,G,G,R,R,R,3,4,4,4,R,4,4,4,R,P,P,R,4,4,B,B,B,4,4,R,3,B,G,G,B,B,4
B,B,R,R,R,R,R,B,B,B,B,G,G,R,R,3,3,3,3,3,3,R,4,4,4,R,P,P,R,4,3,4,4,4,4,4,R,3,3,G,G,G,B,3
B,R,R,B,B,B,B,G,G,G,G,R,R,R,G,3,3,4,3,4,B,R,P,P,P,R,3,3,R,4,3,4,4,4,4,4,R,4,5,B,B,B,B,B
R,R,B,B,B,R,G,R,R,R,R,R,G,3,3,3,3,3,3,P,P,R,P,P,P,R,3,3,R,R,R,R,R,P,P,4,R,R,B,3,3,3,3,B
R,B,B,B,R,R,R,R,3,3,3,3,3,G,3,B,B,B,P,2,2,R,4,4,4,R,3,3,B,3,3,P,3,3,P,4,4,R,B,4,3,3,4,B
R,B,B,R,R,G,G,R,3,3,3,3,3,G,3,B,P,P,P,2,2,R,4,4,4,R,3,3,B,3,3,3,3,3,P,4,R,R,R,R,R,R,R,R
R,B,B,R,G,G,4,R,3,3,3,3,3,G,3,G,P,P,G,G,G,R,R,R,R,R,R,R,R,R,R,R,R,R,R,R,R,3,3,3,3,B,B,R
R,R,R,R,R,R,R,R,R,R,R,R,R,R,R,R,R,R,R,R,R,R,G,G,3,3,3,B,B,4,4,4,3,4,4,4,R,3,3,3,4,4,4,R
R,G,R,B,4,4,4,4,4,4,4,4,4,R,4,P,4,4,5,5,5,R,G,G,3,3,3,3,3,3,3,3,3,3,3,R,R,3,3,3,3,4,4,R
R,R,R,4,4,4,4,4,4,4,4,4,4,R,4,P,4,4,5,5,5,R,R,R,R,3,3,3,3,4,4,3,3,3,3,R,3,3,3,3,3,4,4,R
R,B,B,B,B,B,B,B,B,B,B,B,B,R,P,P,4,4,5,5,5,R,-1,-1,R,R,R,3,3,3,3,3,3,3,4,R,3,3,3,3,3,4,4,R
R,B,B,B,B,B,B,B,B,B,B,B,B,R,R,P,4,4,R,5,5,R,-1,-1,-1,-1,R,R,R,R,4,3,3,3,3,R,R,R,R,R,3,4,4,R
R,G,4,4,4,B,B,B,B,B,B,B,B,B,R,R,R,R,R,R,R,R,-1,-1,-1,-1,-1,-1,-1,R,R,R,R,R,4,R,4,4,4,R,R,R,R,R
R,G,4,4,4,4,4,B,B,B,B,B,B,B,0,1,3,3,0,0,R,-1,-1,-1,-1,-1,-1,-1,-1,-1,-1,-1,-1,R,R,R,R,4,4,B,4,4,4,R
R,G,4,4,4,B,B,B,B,B,B,B,B,B,0,0,4,4,1,1,R,-1,-1,-1,-1,-1,-1,-1,-1,-1,-1,-1,-1,-1,-1,-1,R,R,R,R,4,4,4,R
R,B,4,3,4,4,B,B,B,B,B,B,B,R,R,R,R,R,R,R,R,R,R,R,-1,-1,-1,-1,-1,-1,-1,-1,-1,-1,-1,4,4,R,G,R,R,R,G,R
R,G,3,3,4,4,B,B,B,B,B,4,3,R,B,B,B,B,B,R,0,1,0,R,R,-1,-1,-1,-1,-1,-1,-1,-1,-1,-1,4,4,R,G,R,4,R,R,R
R,G,3,3,4,4,B,4,B,B,B,4,3,R,B,B,B,B,B,R,0,0,0,1,R,R,-1,-1,-1,-1,-1,-1,-1,-1,4,4,R,R,4,R,4,4,4,R
R,R,R,R,R,R,R,R,R,R,R,R,R,R,R,R,R,R,R,R,0,B,B,0,0,R,-1,-1,-1,-1,-1,-1,-1,-1,4,4,R,4,4,R,B,B,B,R
R,G,4,4,4,4,4,4,R,3,3,3,R,R,R,3,3,3,3,R,0,1,B,B,0,R,-1,-1,-1,-1,-1,-1,-1,4,4,4,R,4,R,4,4,3,3,R
R,G,4,4,4,4,4,4,R,3,3,3,R,G,R,3,3,3,3,R,0,G,G,G,0,R,-1,-1,-1,-1,-1,-1,-1,4,4,R,4,4,R,3,3,3,3,R
R,G,4,4,4,4,4,4,R,3,3,3,R,G,R,4,4,5,5,R,0,0,1,0,0,R,-1,-1,-1,-1,-1,-1,-1,4,4,R,3,3,R,3,3,B,B,R
R,R,R,R,R,R,R,R,R,R,R,R,R,R,R,R,R,R,R,R,R,R,R,R,R,R,-1,-1,-1,-1,-1,-1,-1,4,4,R,3,R,R,G,G,G,G,R
R,3,4,3,3,4,3,4,R,3,4,3,3,4,3,4,3,4,R,-1,-1,-1,-1,-1,-1,-1,-1,-1,-1,-1,-1,-1,-1,4,4,R,4,R,3,3,4,4,4,R
R,4,3,3,4,3,3,3,R,B,3,3,4,3,3,3,3,3,R,-1,-1,-1,-1,-1,-1,-1,-1,-1,-1,-1,-1,-1,-1,4,G,R,G,R,4,3,3,R,R,R
R,R,R,R,R,R,R,R,R,R,R,R,R,R,R,R,R,R,R,R,R,R,R,R,R,R,R,R,R,R,R,R,R,R,R,R,R,R,R,R,R,R,G,G
R,G,4,G,4,G,3,3,R,1,0,1,0,0,0,0,0,R,4,5,3,3,4,4,4,R,1,1,1,1,1,1,R,G,G,G,G,G,G,G,R,R,R,G
4,P,4,4,4,P,3,3,R,1,0,1,0,0,0,0,0,R,G,G,G,G,G,G,3,R,1,1,1,1,1,1,R,1,1,1,0,1,1,1,R,4,R,R
P,P,4,P,P,P,3,3,R,1,0,1,0,1,0,1,0,R,4,5,3,3,4,4,3,R,0,1,0,1,1,1,R,0,1,0,1,0,1,0,R,4,4,4
R,R,R,R,R,R,R,R,R,R,R,R,R,R,R,R,R,R,R,R,R,R,R,R,R,R,R,R,R,R,R,R,R,R,R,R,R,R,R,R,R,P,4,4
4,G,B,B,B,4,4,4,R,G,G,G,G,G,G,G,R,P,G,4,4,P,P,P,P,R,4,4,4,4,P,P,R,1,1,4,4,4,1,1,R,P,P,5
4,G,4,B,B,4,B,B,R,G,G,G,G,G,G,G,R,P,G,4,3,4,4,4,4,R,4,4,4,P,P,P,R,0,1,4,4,4,1,0,R,P,P,4
4,G,4,B,B,4,4,4,R,P,P,P,P,3,P,P,R,P,G,4,4,4,4,4,4,R,4,4,4,P,P,P,R,0,1,4,4,4,1,0,R,P,P,4
4,R,R,R,R,R,R,R,R,3,3,3,3,3,P,R,R,R,R,R,R,R,R,R,R,R,R,R,R,R,R,R,R,R,R,R,R,R,R,R,R,P,P,4
4,P,P,4,4,4,4,4,R,3,3,3,3,3,P,R,4,P,4,4,4,4,4,4,4,R,G,4,4,4,4,4,R,1,0,1,0,1,0,1,R,P,P,4
4,P,4,P,4,4,4,4,R,3,3,3,P,P,3,R,4,4,P,P,4,4,P,4,4,R,4,4,4,P,P,4,R,0,1,0,1,0,1,0,R,P,P,P
R,R,R,R,R,R,R,R,R,R,R,R,R,R,R,R,R,R,R,R,R,R,R,R,R,R,R,R,R,R,R,R,R,R,R,R,R,R,R,R,R,P,P,P
R,1,0,1,2,G,G,1,R,1,G,G,G,1,R,1,1,1,0,0,1,1,1,1,1,R,1,2,1,1,0,1,R,1,G,G,G,G,G,G,R,P,P,P""")
number_slider = Slider(11, range=1..44)
number_slider_2 = Slider(13, range=1..44)
number_slider_3 = Slider(44, range=1..44)
number_slider_4 = Slider(44, range=1..44)
int_15 = Integer(number_slider_2)
int_16 = Integer(number_slider)
int_17 = Integer(number_slider_4)
int_18 = Integer(number_slider_3)

# ---- group: influence range
# Proximity (Walkability) to Offices
range_count = Slider(30, range=1..80)

# ---- group: cell size
num_3 = Number(num_2)

# ---- group: heat map mesh z position
number_slider_5 = Slider(2.1, range=0..10)

# ---- group: shrink
cell_shrink = Slider(1, range=0.15..1)

# ---- group: heatmap slider (0 to 5)
int_19 = Integer(int_14)

# ----
range_count_2 = Slider(49, range=1..80)

# ---- group: infulence range - # nearest
range_count_3 = Slider(30, range=1..80)

# ---- group: heat map mesh z position
num_4 = Number(number_slider_5)

# ----
equals = Equality(FirstNumber=int_19, SecondNumber="3")  # -> Equality, Inequality

# ---- group: cell size
num_5 = Number(num_3)

# ---- group: heat map mesh z position
num_6 = Number(number_slider_5)

num_7 = Number(number_slider_5)

# ---- group: cell size
num_8 = Number(num_3)

# ----
division_3 = Division(A=num_3, B=2)

# ---- group: heat map mesh z position
num_9 = Number(number_slider_5)

# ---- group: cell size
num_10 = Number(num_3)

# ----
Z = UnitZ(Factor=num_6)
Z_2 = UnitZ(Factor=num_7)
neg = Negative(Value=division_3)

# ---- group: show heatmap or not
bool = Boolean(equals.Equality)

# ----
pt_3 = ConstructPoint(XCoordinate=0, YCoordinate=0, ZCoordinate=num_4)
dom = ConstructDomain(DomainStart=neg, DomainEnd=division_3)
full_site_grid_matrix_calculation = FullSiteGridMatrixCalculation(
    A_2=number_slider,
    xi=int_3,
    yi=int_4,
    x_2=int_18,
    num_2=num_2,
    y_2=int_17,
    xs=int_16,
    A_3=number_slider_2,
    ys=int_15,
    C_2=number_slider_3,
    G=pt,
    A=number_slider_3,
    num=num_2,
    B=number_slider_4,
    C=number_slider_4,
    L=number_slider_3)  # -> int_2, G_2, x_3, y_3, z_2
planesrf = PlaneSurface(Plane=pt_3, XSize=dom, YSize=dom)
scale_nu = ScaleNU(Geometry=planesrf, Plane=PlaneXY(0, 0, 0), ScaleX=cell_shrink, ScaleY=cell_shrink, ScaleZ=1)  # -> Geometry, Transform

# ---- group: Mesh at Orgin to Copy
mesh = Mesh(scale_nu.Geometry)

# ---- group: heatmap opacity
number_slider_6 = Slider(0.7, range=0..1)

# ----
site_data_text_cleanup_replacement = SiteDataTextCleanupReplacement(T=panel_2)
pt_4 = Point(full_site_grid_matrix_calculation.G_2)

# ---- group: module center (ful site)
# Heatmaps Output Geometry
pt_5 = Point(pt_4)

pt_6 = Point(pt_4)

pt_7 = Point(pt_5)

pt_8 = Point(pt_4)

# ----
stream_filter = StreamFilter(Gate=int_19, Stream2=pt_6)
stream_filter_2 = StreamFilter(Gate=int_19, Stream3=pt_8)
stream_filter_3 = StreamFilter(Gate=int_19, Stream4=pt_7)

# ---- group: module center (ful site)
pt_9 = Point(stream_filter)

pt_10 = Point(stream_filter_3)

pt_11 = Point(stream_filter_2)

# ---- group: avoiding 0
Z_3 = UnitZ(Factor=num_9)
move = Move(Geometry=pt_10, Motion=Z_3)  # -> Geometry, Transform

# ----
move_2 = Move(Geometry=pt_9, Motion=Z)  # -> Geometry, Transform
move_3 = Move(Geometry=pt_11, Motion=Z_2)  # -> Geometry, Transform

# ---- group: module center - checking pts
pt_12 = Point(graft(move.Geometry))

# ----
int_20 = Integer(int_12)
textformating = TextFormating(txt=site_data_text_cleanup_replacement)
full_site_id_replacement = FullSiteIDReplacement(int_5=textformating, int=int_20, int_2=full_site_grid_matrix_calculation.int_2)  # -> L, _1_list
int_21 = Integer(full_site_id_replacement.L)

# ---- group: full site module id
int_22 = Integer(int_21)

int_23 = Integer(int_22)

int_24 = Integer(int_22)

int_25 = Integer(int_22)

# ----
stream_filter_4 = StreamFilter(Gate=int_19, Stream2=int_23)
# Proximity (Walkability) to Residential Buildings
stream_filter_5 = StreamFilter(Gate=int_19, Stream3=int_25)
# Proximity (Walkability) to Open Spaces
stream_filter_6 = StreamFilter(Gate=int_19, Stream4=int_24)

# ---- group: full site module id
int_26 = Integer(stream_filter_4)

int_27 = Integer(stream_filter_5)

# ----
equals_2 = Equality(FirstNumber=int_22, SecondNumber="-2")  # -> Equality, Inequality

# ---- group: full site module id
int_28 = Integer(stream_filter_6)

# ---- group: is dynamic
bool_2 = Boolean(equals_2.Inequality)

# ----
equals_3 = Equality(FirstNumber=int_26, SecondNumber="4")  # -> Equality, Inequality
equals_4 = Equality(FirstNumber=int_26, SecondNumber="3")  # -> Equality, Inequality
equals_5 = Equality(FirstNumber=int_26, SecondNumber="5")  # -> Equality, Inequality
equals_6 = Equality(FirstNumber=int_27, SecondNumber="4")  # -> Equality, Inequality
equals_7 = Equality(FirstNumber=int_27, SecondNumber="3")  # -> Equality, Inequality
equals_8 = Equality(FirstNumber=int_27, SecondNumber="5")  # -> Equality, Inequality
equals_9 = Equality(FirstNumber=int_27, SecondNumber="1")  # -> Equality, Inequality
equals_10 = Equality(FirstNumber=int_27, SecondNumber="0")  # -> Equality, Inequality
equals_11 = Equality(FirstNumber=int_27, SecondNumber="2")  # -> Equality, Inequality
equals_12 = Equality(FirstNumber=int_26, SecondNumber="1")  # -> Equality, Inequality
equals_13 = Equality(FirstNumber=int_26, SecondNumber="0")  # -> Equality, Inequality
equals_14 = Equality(FirstNumber=int_26, SecondNumber="2")  # -> Equality, Inequality
dispatch = Dispatch(List=pt_5, DispatchPattern=bool_2)  # -> ListA, ListB
or = GateOr(A=equals_4.Equality, B=equals_3.Equality)
dispatch_2 = Dispatch(List=pt_5, DispatchPattern=bool_2)  # -> ListA, ListB
or_2 = GateOr(A=or, B=equals_5.Equality)
equals_15 = Equality(FirstNumber=int_28, SecondNumber="-1")  # -> Equality, Inequality
or_3 = GateOr(A=equals_7.Equality, B=equals_6.Equality)
or_4 = GateOr(A=equals_10.Equality, B=equals_9.Equality)
or_5 = GateOr(A=equals_13.Equality, B=equals_12.Equality)
or_6 = GateOr(A=or_3, B=equals_8.Equality)
or_7 = GateOr(A=or_4, B=equals_11.Equality)
or_8 = GateOr(A=or_5, B=equals_14.Equality)

# ---- group: module id (dynamic only)
int_29 = Integer(dispatch.ListA)

# ----
bool_3 = Boolean(or_2)

# ---- group: is open space
bool_4 = Boolean(equals_15.Equality)

# ----
bool_5 = Boolean(or_6)
bool_6 = Boolean(or_7)
bool_7 = Boolean(or_8)
dispatch_3 = Dispatch(List=pt_9, DispatchPattern=bool_3)  # -> ListA, ListB
dispatch_4 = Dispatch(List=pt_11, DispatchPattern=bool_6)  # -> ListA, ListB
dispatch_5 = Dispatch(List=move_3.Geometry, DispatchPattern=bool_5)  # -> ListA, ListB
dispatch_6 = Dispatch(List=move_2.Geometry, DispatchPattern=bool_7)  # -> ListA, ListB

# ---- group: module center (dynamic only)
pt_13 = Point([dispatch_6.ListA, dispatch_5.ListA, move.Geometry])

# ----
vec2pt = Vector2Pt(PointA=Point(0, 0, 0), PointB=pt_13, Unitize=False)  # -> Vector, Length
dispatch_7 = Dispatch(List=pt_10, DispatchPattern=bool_4)  # -> ListA, ListB
pt_14 = Point(graft(dispatch_5.ListA))
pt_15 = Point(dispatch_4.ListA)
pt_16 = Point(dispatch_3.ListA)
pt_17 = Point(graft(dispatch_6.ListA))
move_4 = Move(Geometry=mesh, Motion=vec2pt.Vector)  # -> Geometry, Transform

# ---- group: open space module center
pt_18 = Point(dispatch_7.ListA)

# ----
cps = ClosestPoints(Point=pt_17, Cloud=pt_16, Count=range_count_2)  # -> ClosestPoint, CPIndex, Distance
cps_2 = ClosestPoints(Point=pt_14, Cloud=pt_15, Count=range_count)  # -> ClosestPoint, CPIndex, Distance
cps_3 = ClosestPoints(Point=pt_12, Cloud=pt_18, Count=range_count_3)  # -> ClosestPoint, CPIndex, Distance
ma = MassAddition(Input=cps.Distance)  # -> Result, PartialResults
ma_2 = MassAddition(Input=cps_2.Distance)  # -> Result, PartialResults

# ---- group: mesh on lego (dynamic only)
mesh_2 = Mesh(move_4.Geometry)

# ----
pshift_7 = ShiftPaths(Data=ma.Result, Offset=-2)
ma_3 = MassAddition(Input=cps_3.Distance)  # -> Result, PartialResults
pshift_8 = ShiftPaths(Data=ma_2.Result, Offset=-2)
pshift_9 = ShiftPaths(Data=ma_3.Result, Offset=-2)
num_11 = Number(pshift_7)
num_12 = Number(pshift_8)

# ---- group: distance to closest open spaces
num_13 = Number(pshift_9)

# ----
one_over_x = OneOverX(Value=num_11)
one_over_x_2 = OneOverX(Value=num_12)
filter = StreamFilter(Gate=bool, Stream1=mesh_2)
one_over_x_3 = OneOverX(Value=num_13)
bool_8 = Boolean(bool_2)
num_14 = Number(one_over_x)
bool_9 = Boolean(bool_2)
num_15 = Number(one_over_x_2)

# ---- group: is dynamic
bool_10 = Boolean(bool_2)

# ---- group: proximity score - all
num_16 = Number(one_over_x_3)

# ----
dispatch_8 = Dispatch(List=num_14, DispatchPattern=bool_8)  # -> ListA, ListB
dispatch_9 = Dispatch(List=num_15, DispatchPattern=bool_9)  # -> ListA, ListB
dispatch_10 = Dispatch(List=num_16, DispatchPattern=bool_10)  # -> ListA, ListB
num_17 = Number(dispatch_8.ListA)
num_18 = Number(dispatch_9.ListA)

# ---- group: proximity score - dynamic
num_19 = Number(dispatch_10.ListA)

# ----
bnd = Bounds(Numbers=num_17)
panel_3 = Panel(bnd)
panel_4 = Panel("0.1 To 1.0")
remap_2 = RemapNumbers(Value=num_17, Source="0.0 to 0.0002", Target="0.1 To 1.0")  # -> Mapped, Clipped
bnd_2 = Bounds(Numbers=num_18)
panel_5 = Panel(bnd_2)
remap_3 = RemapNumbers(Value=num_18, Source="0.0 to 0.00175", Target="0.1 To 1.0")  # -> Mapped, Clipped
bnd_3 = Bounds(Numbers=num_19)
panel_6 = Panel(bnd_3)
remap_4 = RemapNumbers(Value=num_19, Source=bnd_3, Target=Domain(0, 1))  # -> Mapped, Clipped
num_20 = Number(remap_2.Mapped)
panel_7 = Panel(num_20)
num_21 = Number(remap_3.Mapped)
panel_8 = Panel(num_21)

# ---- group: heat map volume - normalized
num_22 = Number(remap_4.Mapped)

num_23 = Number([num_22, num_21, num_20])

# ----
gradient = Gradient(LowerLimit=0, UpperLimit=1, Parameter=num_23, stops=[0: RGB(255, 0, 0), 0.5: RGB(255, 255, 0), 1: RGB(0, 128, 0)])
argb = SplitARGB(Colour=gradient)  # -> Alpha, Red, Green, Blue
multiplication_6 = Multiplication(A=number_slider_6, B=argb.Alpha)
frgb = ColourRGBF(Alpha=multiplication_6, Red=argb.Red, Green=argb.Green, Blue=argb.Blue)

# ---- group: heatmap
preview = CustomPreview(Geometry=mesh_2, Shader=frgb)

# ----
panel_9 = Panel(num_22)

# ==== cluster IDMasking
T = ClusterInput()
split = TextSplit(Text=T)
cull = CullPattern(List=split, CullPattern=[True, False])
panel = Panel(cull)
join = TextJoin(Text=panel, Join=",")
split_2 = TextSplit(Text=join, Separators=",")
pshift = ShiftPaths(Data=split_2, Offset=-2)

# ---- group: masking data
int = Integer(pshift)

# ----
panel_2 = Panel(int)
lng = ListLength(List=split_2)
int_2 = ClusterInput()

# ---- group: module id
int_3 = Integer(int_2)

# ----
repeat = RepeatData(Data="-2", Length=lng)
pshift_2 = ShiftPaths(Data=repeat, Offset=-3)
panel_3 = Panel(pshift_2)
merge = Merge(Data1=graft(int_3), Data2=graft(pshift_2))
item = ListItem(List=merge, Index=graft(int), Wrap=False)
pshift_3 = ShiftPaths(Data=item, Offset=-1)
D = ClusterOutput(pshift_3)

# ==== cluster TextFormating
txt = ClusterInput()
txt_2 = Text(txt)

# ---- group: 'Enter'
panel = Panel("")

# ----
split = TextSplit(Text=txt_2, Separators=panel)
lng = ListLength(List=split)
addition = Addition(A=lng, B=1)
division = Division(A=addition, B=2)
series = Series(Start=0, Step=2, Count=division)
item = ListItem(List=split, Index=series, Wrap=False)
pshift = ShiftPaths(Data=item, Offset=1)
graft = GraftTree(Tree=pshift, IncludeEmptyLists=True, IncludeNullItems=True)
split_2 = TextSplit(Text=graft, Separators=",")
pshift_2 = ShiftPaths(Data=split_2, Offset=-2)
txt_3 = Text(pshift_2)
txt_4 = ClusterOutput(txt_3)

# ==== cluster SiteDataTextCleanupReplacement
T = ClusterInput()
rep = ReplaceText(Text=T, Find="-1", Replace="-5", RecursiveReplace=False)
rep_2 = ReplaceText(Text=rep, Find="R", Replace="6", RecursiveReplace=False)
rep_3 = ReplaceText(Text=rep_2, Find="B", Replace="-1", RecursiveReplace=False)
rep_4 = ReplaceText(Text=rep_3, Find="P", Replace="-1", RecursiveReplace=False)
rep_5 = ReplaceText(Text=rep_4, Find="G", Replace="-1", RecursiveReplace=False)
R = ClusterOutput(rep_5)

# ==== cluster FullSiteGridMatrixCalculation
C = ClusterInput()
A = ClusterInput()
B = ClusterInput()
C_2 = ClusterInput()
L = ClusterInput()
series = Series(Start=0, Step=1, Count=C)
multiplication = Multiplication(A=A, B=B)
series_2 = Series(Start=0, Step=1, Count=C_2)
repeat = RepeatData(Data=graft(series), Length=L)
pshift = ShiftPaths(Data=repeat, Offset=-1)
repeat_2 = RepeatData(Data=series_2, Length=multiplication)
pshift_2 = ShiftPaths(Data=pshift, Offset=-1)
pshift_3 = ShiftPaths(Data=repeat_2, Offset=-1)
lng = ListLength(List=pshift_3)
repeat_3 = RepeatData(Data="0", Length=lng)
pshift_4 = ShiftPaths(Data=repeat_3, Offset=-1)
x = Integer(pshift_3)
y = Integer(pshift_2)

# ---- group: rotation
z = Integer(pshift_4)

# ----
xi = ClusterInput()
yi = ClusterInput()
x_2 = ClusterInput()
y_2 = ClusterInput()
xs = ClusterInput()
ys = ClusterInput()
panel = Panel(x)
panel_2 = Panel(y)
panel_3 = Panel(z)
replacingitemid = ReplacingItemID(int_4=xi, int=yi, int_6=x_2, int_5=y_2, int_3=xs, int_2=ys)
int = Integer(replacingitemid)
int_2 = ClusterOutput(int)
G = ClusterInput()
num = ClusterInput()
y_3 = ClusterOutput(y)
z_2 = ClusterOutput(z)
x_3 = ClusterOutput(x)
modulecenter = ModuleCenter(pt=G, num=num, int_2=x, int=y)  # -> pt_5, transform_2
num_2 = ClusterInput()

# ---- group: cell size
num_3 = Number(num_2)

# ----
A_2 = ClusterInput()
A_3 = ClusterInput()
multiplication_2 = Multiplication(A=A_2, B=num_3)
multiplication_3 = Multiplication(A=A_3, B=num_3)
neg = Negative(Value=multiplication_2)
vec = VectorXYZ(XComponent=neg, YComponent=multiplication_3, ZComponent=0)  # -> Vector, Length
move = Move(Geometry=modulecenter.pt_5, Motion=vec.Vector)  # -> Geometry, Transform
G_2 = ClusterOutput(move.Geometry)

# ==== cluster FullSiteIDReplacement
int = ClusterInput()
int_2 = ClusterInput()

# ---- group: all module piece ids - from CityMatrix CV
int_3 = Integer(int)

# ---- group: replacing item indices
int_4 = Integer(int_2)

# ----
int_5 = ClusterInput()
# Ignoring masked items (marked as -5 in the full site grid)
# in the replacement array
panel = Panel("-5")

# ---- group: all module piece ids - from Text Data
int_6 = Integer(int_5)

# ----
rev = ReverseList(List=int_6)
item = ListItem(List=rev, Index=int_4, Wrap=True)
equals = Equality(FirstNumber=item, SecondNumber=panel)  # -> Equality, Inequality
panel_2 = Panel(equals.Equality)
int_7 = Integer(flatten(panel_2))
cull = CullPattern(List=int_4, CullPattern=int_7)
cull_2 = CullPattern(List=int_3, CullPattern=int_7)
lng = ListLength(List=cull_2)
repeat = RepeatData(Data="-1", Length=lng)
replace = ReplaceItems(List=rev, Item=repeat, Indices=cull, Wrap=False)
replace_2 = ReplaceItems(List=rev, Item=cull_2, Indices=cull, Wrap=False)
L = ClusterOutput(replace_2)
_1_list = ClusterOutput(replace)

# ==== cluster ReplacingItemID
int = ClusterInput()
int_2 = ClusterInput()
int_3 = ClusterInput()
int_4 = ClusterInput()
int_5 = ClusterInput()
int_6 = ClusterInput()

# ---- group: gridExtent_y_i
int_7 = Integer(int)

# ---- group: gridExtent_y_s
int_8 = Integer(int_2)

# ---- group: gridExtent_x_s
int_9 = Integer(int_3)

# ---- group: gridExtent_x_i
int_10 = Integer(int_4)

# ---- group: gridExtent_y
int_11 = Integer(int_5)

# ---- group: gridExtent_x
int_12 = Integer(int_6)

# ---- group: adding y
series = Series(Start=0, Step=1, Count=int_7)
int_13 = Integer(series)
graft = GraftTree(Tree=int_13, IncludeEmptyLists=True, IncludeNullItems=True)
repeat = RepeatData(Data=graft, Length=int_10)
pshift = ShiftPaths(Data=repeat, Offset=-2)
addition = Addition(A=int_8, B=pshift)
multiplication = Multiplication(A=addition, B=int_12)

# ---- group: adding x
multiplication_2 = Multiplication(A=int_10, B=int_7)
series_2 = Series(Start=0, Step=1, Count=multiplication_2)
int_14 = Integer(series_2)
mod = Modulus(A=int_14, B=int_10)
addition_2 = Addition(A=int_9, B=mod)

# ----
addition_3 = Addition(A=multiplication, B=addition_2)

# ---- group: item replacing ID
int_15 = Integer(addition_3)

# ----
int_16 = ClusterOutput(int_15)

# ==== cluster ModuleCenter
pt = ClusterInput()
int = ClusterInput()
num = ClusterInput()
int_2 = ClusterInput()

# ---- group: y
int_3 = Integer(int)

# ---- group: cell size
num_2 = Number(num)

# ---- group: x
int_4 = Integer(int_2)

# ---- group: center
pt_2 = Point(pt)

# ----
pt_3 = ConstructPoint(XCoordinate=0, YCoordinate=0, ZCoordinate=0)  # disabled
addition = Addition(A=int_4, B=0.5)
vec2pt = Vector2Pt(PointA=pt_3, PointB=pt_2, Unitize=False)  # -> Vector, Length; disabled
addition_2 = Addition(A=int_3, B=0.5)
multiplication = Multiplication(A=addition, B=num_2)
move = Move(Motion=vec2pt.Vector)  # -> Geometry, Transform; disabled
lng = ListLength(List=int_4)  # disabled
multiplication_2 = Multiplication(A=addition_2, B=num_2)
X = UnitX(Factor=multiplication)
repeat = RepeatData(Data=move.Transform, Length=lng)  # disabled
neg = Negative(Value=multiplication_2)
move_2 = Move(Geometry=pt_2, Motion=X)  # -> Geometry, Transform
graft = GraftTree(Tree=move_2.Transform, IncludeEmptyLists=True, IncludeNullItems=True)  # disabled
Y = UnitY(Factor=neg)
pshift = ShiftPaths(Data=repeat, Offset=-1)  # disabled
move_3 = Move(Geometry=move_2.Geometry, Motion=Y)  # -> Geometry, Transform
graft_2 = GraftTree(Tree=move_3.Transform, IncludeEmptyLists=True, IncludeNullItems=True)  # disabled
comp = Compound(Transforms=[graft, graft_2])  # disabled
graft_3 = GraftTree(Tree=pshift, IncludeEmptyLists=True, IncludeNullItems=True)  # disabled
comp_2 = Compound(Transforms=[comp, graft_3])  # disabled

# ---- group: module center
pt_4 = Point(move_3.Geometry)

# ----
pshift_2 = ShiftPaths(Data=comp_2, Offset=-1)  # disabled
transform = Transform(pshift_2)  # disabled
pt_5 = ClusterOutput(pt_4)
transform_2 = ClusterOutput(transform)  # disabled
